# Grasshopper definition ABxM CrossSectionAgents.gh (Grasshopper 1.0.7)
# plug-ins: sof_gh_sofistik-2022, HygroDesign, Heteroptera, ABxM.Grasshopper

crosec = BilayerCrossSection(
    Radii=<missing>,
    Directions=<missing>,
    BoardWidth=<missing>,
    SnapTolerance=<missing>,
    SupportParameters=<missing>,
    BasePlane=<missing>)
io = IO(
    SofistikDocumentProperties_VersionMajor="2022",
    SofistikDocumentProperties_VersionMinor="4",
    SofistikDocumentProperties_VersionName="2022")
number_slider = Slider(1, range=0..10)
genes = GenePool(
    Decimals=2,
    Maximum=1,
    Minimum=-1,
    Value=[0.5550358237, -0.8119721617, 0.6383034054, 0.9835135909, -0.6513712693, 0.6727321817, -0.3406666496, -0.6062679736, 0.5638630351, 0.7659066765, -0.5128728345, -0.1654117234, 0.6089472648, 0.9818360628, 0.8400640543])
neg = Negative(Value=number_slider)
dom = ConstructDomain(DomainStart=neg, DomainEnd=number_slider)
gnc = PoolController(GenePool=genes, Count=Slider(15, range=0..15), Range=dom, Randomness=1)
merge = Merge(Data1="0", Data2=genes)
rev = ReverseList(List=merge)
lng = ListLength(List=rev)  # -> expr("x-1", Length)
dom_2 = ConstructDomain(DomainStart=1, DomainEnd=lng)
subset = SubList(List=rev, Domain=dom_2, Wrap=True)  # -> List, Index
lng_2 = ListLength(List=merge)  # -> expr("(x*2) - 1", Length)
merge_2 = Merge(Data1=flatten(merge), Data2=flatten(subset.List))
series = Series(Start=0, Step=Slider(0.5, range=0..1), Count=lng_2)
pt = ConstructPoint(XCoordinate=series, YCoordinate=0, ZCoordinate=merge_2)
board_width = Slider(0.15, range=0.1..0.5)
nurbs = NurbsCurve(Vertices=pt, Degree=3, Periodic=False)  # -> reparameterize(Curve), Length, Domain
c_script = CSharpScript(
    minimumRadius=Slider(0.5, range=0..2),
    Reference=["C:\Users\Alex Reiner\AppData\Roaming\Grasshopper\Libraries\ABxM.Core.dll", "C:\Users\Alex Reiner\AppData\Roaming\Grasshopper\Libraries\HygroDesign.Core.dll"])  # -> out, oBehaviour; inputs minimumRadius: Double
# ---------- c_script: C# usings ----------
using ABxM.Core;
using ABxM.Core.Agent;
using ABxM.Core.Behavior;

using HygroDesign.Core;
# ---------- c_script: C# ----------
    minRad = minimumRadius;
    oBehaviour = radBehaviour;
# ---------- c_script: C# additional code ----------
  static double minRad;
  RadiusBehaviour radBehaviour = new RadiusBehaviour();

  public class RadiusBehaviour : BehaviorBase
  {
    public RadiusBehaviour()
    {
    }
    
    public override void Execute(AgentBase agent)
    {
      CrossSectionAgent CSAgent = agent as CrossSectionAgent;
      double minimumStep = 0.01;
      //check clusters
      CrossSectionAgentSystem agentSystem = agent.AgentSystem as CrossSectionAgentSystem;
      CrossSection crossSection = agentSystem.CrossSection;

      bool smaller = false;
      for(int i = 0; i < crossSection.BoardCurves.Count; i++)
      {
        //check if this agent has control over this board curve
        if(crossSection.BoardCurves[i].ControlPointID != agent.Id) continue;
        if(crossSection.BoardCurves[i].AverageRadius < minRad){ smaller = true; break;}
      }
      if(smaller == false) return;

      //update control points
      Line midLine = new Line(crossSection.NurbsCurve.Points[agent.Id - 1].Location, crossSection.NurbsCurve.Points[agent.Id + 1].Location);
      Point3d targetPoint = midLine.ClosestPoint(crossSection.NurbsCurve.Points[agent.Id].Location, true);
      Vector3d moveVector = new Vector3d(targetPoint - crossSection.NurbsCurve.Points[agent.Id].Location);
      moveVector *= 0.1;

      if (moveVector.Length < minimumStep) { moveVector.Unitize(); moveVector *= minimumStep; }

      //nurbsPoints.Add(new Tuple<int, Point3d>(agent.Id, new Point3d(crossSection.NurbsCurve.Points[agent.Id].Location.X, 0.0, (NurbsCurve.Points[agent.Id].Location + moveVector).Z)));
      CSAgent.Moves.Add(moveVector);
      CSAgent.Weights.Add(1.0);
      return;
    }
  }

  /*
  MinimumRadius = minRadius;
            double minimumStep = 0.01;
            int safety = 100;

            while(safety >= 0)
            {
                safety--;

                //loop to check clusters
                bool[] memberSmaller = new bool[NurbsCurve.Points.Count];
                int falseCount = 0;
                for (int i = 0; i < BoardCurves.Count; i++)
                {
                    if (BoardCurves[i].AverageRadius < MinimumRadius) memberSmaller[BoardCurves[i].ControlPointID] = true;
                    else falseCount++;
                }
                if (falseCount == BoardCurves.Count) return;

                List<Tuple<int, Point3d>> nurbsPoints = new List<Tuple<int, Point3d>>();
                //loop to update control points
                for (int i = 0; i < NurbsCurve.Points.Count; i++)
                {
                    if (memberSmaller[i] == false) continue;

                    Line midLine = new Line(NurbsCurve.Points[i - 1].Location, NurbsCurve.Points[i + 1].Location);
                    Point3d targetPoint = midLine.ClosestPoint(NurbsCurve.Points[i].Location, true);
                    Vector3d moveVector = new Vector3d(targetPoint - NurbsCurve.Points[i].Location);
                    moveVector *= 0.1;

                    if (moveVector.Length < minimumStep) { moveVector.Unitize(); moveVector *= minimumStep; }

                    nurbsPoints.Add(new Tuple<int, Point3d>(i, new Point3d(NurbsCurve.Points[i].Location.X, 0.0, (NurbsCurve.Points[i].Location + moveVector).Z)));
                }

                foreach (Tuple<int, Point3d> pair in nurbsPoints)
                    NurbsCurve.Points.SetPoint(pair.Item1, pair.Item2);

                //update nurbs curve
                BoardCurves = NurbsToBoardCurves();
            }
 */
# ---------- end c_script ----------
geo = Geometry(nurbs.Curve)
crosec_2 = CrossSectionFromNurbsCurve(NurbsCurve=geo, BoardWidth=board_width)
agent = CrossSectionAgent(StartingPoint=pt, Behaviours=c_script.oBehaviour)
agentsystem = CrossSectionAgentSystem(CrossSection=crosec_2, Agents=agent)
trigger = Trigger(Interval=20, TimerInterval=20, Target=solver)  # disabled
solver = StepByStepSolver(Reset=Button(), Execute=Toggle(False), AgentSystems=agentsystem)  # -> DisplayGeometries, AllAgentSystems, IterationCount
data = Data(solver.AllAgentSystems)
python = GhPythonScript(x=data)  # -> out, a, b, c, d, e
# ---------- python: Python ----------
curves = []
ids = []
radii = []
controlPoints = []

for board in x.CrossSection.BoardCurves:
    curves.append(board.Curve)
    ids.append(board.ControlPointID)
    radii.append(board.AverageRadius)

for agent in x.Agents:
    controlPoints.append(agent.Position)

e = x.CrossSection.NurbsCurve

a = curves
b = ids
c = radii
d = controlPoints
# ---------- end python ----------
python_2 = GhPythonScript(x=data)  # -> out, a
# ---------- python_2: Python ----------
a = x.Agents.Count
# ---------- end python_2 ----------
panel = Panel(python_2.a)
crv = Curve(python.e)
crv_2 = Curve(python.a)
pt_2 = Point(python.d)
num = Number(python.b)
num_2 = Number(python.c)
lng_3 = ListLength(List=pt)
ln = Line(StartPoint=pt, EndPoint=pt_2)
partition = PartitionList(List=pt_2, Size=lng_3)
panel_2 = Panel(ln)
