# Grasshopper definition BilayerDesign - Fabrication.gh (Grasshopper 1.0.7)
# plug-ins: HygroDesign, Pufferfish, Bookworm, treesloth01

# ---- group: spruce
panel = Panel("spruce")
number_slider = Slider(0.0001, range=0..0.0001)
number_slider_2 = Slider(0.0019, range=0..1)
number_slider_3 = Slider(0.0036, range=0..1)
number_slider_4 = Slider(10000, range=0..20000)
number_slider_5 = Slider(450, range=0..20000)
number_slider_6 = Slider(800, range=0..20000)
number_slider_7 = Slider(400, range=0..1000)

# ---- group: beech
panel_2 = Panel("beech")
number_slider_8 = Slider(0.0001, range=0..0.0001)
number_slider_9 = Slider(0.002, range=0..1)
number_slider_10 = Slider(0.0041, range=0..1)
number_slider_11 = Slider(14000, range=0..20000)
number_slider_12 = Slider(2280, range=0..20000)
number_slider_13 = Slider(1160, range=0..20000)
number_slider_14 = Slider(720, range=0..1000)

# ----
number_slider_15 = Slider(30, range=0..100)
division = Division(A=Slider(991, range=0..1000), B="6")
division_2 = Division(A=Slider(5000, range=0..10000), B=division)
num = Number(Slider(150, range=0..1000))
round = Round(Number=division_2)  # -> Nearest, Floor, Ceiling
num_2 = Number(round.Floor)
species = WoodSpecies(
    name=panel_2,
    density=number_slider_14,
    LExp=number_slider_8,
    RExp=number_slider_9,
    TExp=number_slider_10,
    LEmod=number_slider_11,
    REmod=number_slider_12,
    TEmod=number_slider_13)
species_2 = WoodSpecies(
    name=panel,
    density=number_slider_7,
    LExp=number_slider,
    RExp=number_slider_2,
    TExp=number_slider_3,
    LEmod=number_slider_4,
    REmod=number_slider_6,
    TEmod=number_slider_5)
panel_3 = Panel(HMaxelLength=division, HMaxelWidth=num, LengthCount=num_2, WidthCount=Slider(13, range=0..100))
dec_pan = DeconstructPanel(Panel=panel_3)  # -> Bilayers, graft(HMaxels), LengthRange, WidthRange

number_slider_16 = Slider(1000, range=0..1000)
rectangle = Rectangle(Plane=PlaneXY(0, 0, 0), XSize=number_slider_16, YSize=number_slider_16, Radius=0)  # -> Rectangle, Length
drec = DeconstuctRectangle(Rectangle=rectangle.Rectangle)  # -> BasePlane, XInterval, YInterval
dedomain = DeconstructDomain(Domain=drec.YInterval)  # -> Start, End
subtraction = Subtraction(A=dedomain.End, B=dedomain.Start)
division_3 = Division(A=subtraction, B=2)
dom = ConstructDomain(DomainStart=0, DomainEnd=1)
addition = Addition(A=dedomain.Start, B=division_3)
number_slider_17 = Slider(0.412, range=0..1)
dom_2 = ConstructDomain(DomainStart=addition, DomainEnd=dedomain.End)
dom_3 = ConstructDomain(DomainStart=addition, DomainEnd=dedomain.Start)
remap = RemapNumbers(Value=number_slider_17, Source=dom, Target=dom_3)  # -> Mapped, Clipped
remap_2 = RemapNumbers(Value=Slider(1, range=0..1), Source=dom, Target=drec.XInterval)  # -> Mapped, Clipped
remap_3 = RemapNumbers(Value=number_slider_17, Source=dom, Target=dom_2)  # -> Mapped, Clipped
remap_4 = RemapNumbers(Value=Slider(1, range=0..1), Source=dom, Target=drec.XInterval)  # -> Mapped, Clipped
pt = ConstructPoint(XCoordinate=0, YCoordinate=remap_2.Mapped, ZCoordinate=0)
pt_2 = ConstructPoint(XCoordinate=remap.Mapped, YCoordinate=remap_4.Mapped, ZCoordinate=0)
pt_3 = ConstructPoint(XCoordinate=remap_3.Mapped, YCoordinate=remap_4.Mapped, ZCoordinate=0)
pt_4 = ConstructPoint(XCoordinate=number_slider_16, YCoordinate=remap_2.Mapped, ZCoordinate=0)
merge = Merge(Data1=pt, Data2=pt_2, Data3=pt_3, Data4=pt_4)
nurbs = NurbsCurve(Vertices=merge, Degree=2, Periodic=False)  # -> Curve, Length, Domain

number_slider_18 = Slider(1000, range=0..1000)
rectangle_2 = Rectangle(Plane=PlaneXY(0, 0, 0), XSize=number_slider_18, YSize=number_slider_18, Radius=0)  # -> Rectangle, Length
drec_2 = DeconstuctRectangle(Rectangle=rectangle_2.Rectangle)  # -> BasePlane, XInterval, YInterval
dedomain_2 = DeconstructDomain(Domain=drec_2.YInterval)  # -> Start, End
subtraction_2 = Subtraction(A=dedomain_2.End, B=dedomain_2.Start)
division_4 = Division(A=subtraction_2, B=2)
dom_4 = ConstructDomain(DomainStart=0, DomainEnd=1)
addition_2 = Addition(A=dedomain_2.Start, B=division_4)
number_slider_19 = Slider(0.575, range=0..1)
dom_5 = ConstructDomain(DomainStart=addition_2, DomainEnd=dedomain_2.End)
dom_6 = ConstructDomain(DomainStart=addition_2, DomainEnd=dedomain_2.Start)
remap_5 = RemapNumbers(Value=number_slider_19, Source=dom_4, Target=dom_6)  # -> Mapped, Clipped
remap_6 = RemapNumbers(Value=Slider(0.201, range=0..1), Source=dom_4, Target=drec_2.XInterval)  # -> Mapped, Clipped
remap_7 = RemapNumbers(Value=number_slider_19, Source=dom_4, Target=dom_5)  # -> Mapped, Clipped
remap_8 = RemapNumbers(Value=Slider(0.143, range=0..1), Source=dom_4, Target=drec_2.XInterval)  # -> Mapped, Clipped
pt_5 = ConstructPoint(XCoordinate=0, YCoordinate=remap_6.Mapped, ZCoordinate=0)
pt_6 = ConstructPoint(XCoordinate=remap_5.Mapped, YCoordinate=remap_8.Mapped, ZCoordinate=0)
pt_7 = ConstructPoint(XCoordinate=remap_7.Mapped, YCoordinate=remap_8.Mapped, ZCoordinate=0)
pt_8 = ConstructPoint(XCoordinate=number_slider_18, YCoordinate=remap_6.Mapped, ZCoordinate=0)
merge_2 = Merge(Data1=pt_5, Data2=pt_6, Data3=pt_7, Data4=pt_8)
nurbs_2 = NurbsCurve(Vertices=merge_2, Degree=2, Periodic=False)  # -> Curve, Length, Domain

number_slider_20 = Slider(1000, range=0..1000)
rectangle_3 = Rectangle(Plane=PlaneXY(0, 0, 0), XSize=number_slider_20, YSize=number_slider_20, Radius=0)  # -> Rectangle, Length
drec_3 = DeconstuctRectangle(Rectangle=rectangle_3.Rectangle)  # -> BasePlane, XInterval, YInterval
dedomain_3 = DeconstructDomain(Domain=drec_3.YInterval)  # -> Start, End
subtraction_3 = Subtraction(A=dedomain_3.End, B=dedomain_3.Start)
division_5 = Division(A=subtraction_3, B=2)
dom_7 = ConstructDomain(DomainStart=0, DomainEnd=1)
addition_3 = Addition(A=dedomain_3.Start, B=division_5)
number_slider_21 = Slider(0.439, range=0..1)
dom_8 = ConstructDomain(DomainStart=addition_3, DomainEnd=dedomain_3.End)
dom_9 = ConstructDomain(DomainStart=addition_3, DomainEnd=dedomain_3.Start)
remap_9 = RemapNumbers(Value=number_slider_21, Source=dom_7, Target=dom_9)  # -> Mapped, Clipped
remap_10 = RemapNumbers(Value=Slider(0.696, range=0..1), Source=dom_7, Target=drec_3.XInterval)  # -> Mapped, Clipped
remap_11 = RemapNumbers(Value=number_slider_21, Source=dom_7, Target=dom_8)  # -> Mapped, Clipped
remap_12 = RemapNumbers(Value=Slider(0.039, range=0..1), Source=dom_7, Target=drec_3.XInterval)  # -> Mapped, Clipped
pt_9 = ConstructPoint(XCoordinate=0, YCoordinate=remap_10.Mapped, ZCoordinate=0)
pt_10 = ConstructPoint(XCoordinate=remap_9.Mapped, YCoordinate=remap_12.Mapped, ZCoordinate=0)
pt_11 = ConstructPoint(XCoordinate=remap_11.Mapped, YCoordinate=remap_12.Mapped, ZCoordinate=0)
pt_12 = ConstructPoint(XCoordinate=number_slider_20, YCoordinate=remap_10.Mapped, ZCoordinate=0)
merge_3 = Merge(Data1=pt_9, Data2=pt_10, Data3=pt_11, Data4=pt_12)
nurbs_3 = NurbsCurve(Vertices=merge_3, Degree=2, Periodic=False)  # -> Curve, Length, Domain

number_slider_22 = Slider(1000, range=0..1000)
rectangle_4 = Rectangle(Plane=PlaneXY(0, 0, 0), XSize=number_slider_22, YSize=number_slider_22, Radius=0)  # -> Rectangle, Length
drec_4 = DeconstuctRectangle(Rectangle=rectangle_4.Rectangle)  # -> BasePlane, XInterval, YInterval
dedomain_4 = DeconstructDomain(Domain=drec_4.YInterval)  # -> Start, End
subtraction_4 = Subtraction(A=dedomain_4.End, B=dedomain_4.Start)
division_6 = Division(A=subtraction_4, B=2)
dom_10 = ConstructDomain(DomainStart=0, DomainEnd=1)
addition_4 = Addition(A=dedomain_4.Start, B=division_6)
number_slider_23 = Slider(0.852, range=0..1)
dom_11 = ConstructDomain(DomainStart=addition_4, DomainEnd=dedomain_4.End)
dom_12 = ConstructDomain(DomainStart=addition_4, DomainEnd=dedomain_4.Start)
remap_13 = RemapNumbers(Value=number_slider_23, Source=dom_10, Target=dom_12)  # -> Mapped, Clipped
remap_14 = RemapNumbers(Value=Slider(0, range=0..1), Source=dom_10, Target=drec_4.XInterval)  # -> Mapped, Clipped
remap_15 = RemapNumbers(Value=number_slider_23, Source=dom_10, Target=dom_11)  # -> Mapped, Clipped
remap_16 = RemapNumbers(Value=Slider(0, range=0..1), Source=dom_10, Target=drec_4.XInterval)  # -> Mapped, Clipped
pt_13 = ConstructPoint(XCoordinate=0, YCoordinate=remap_14.Mapped, ZCoordinate=0)
pt_14 = ConstructPoint(XCoordinate=remap_13.Mapped, YCoordinate=remap_16.Mapped, ZCoordinate=0)
pt_15 = ConstructPoint(XCoordinate=remap_15.Mapped, YCoordinate=remap_16.Mapped, ZCoordinate=0)
pt_16 = ConstructPoint(XCoordinate=number_slider_22, YCoordinate=remap_14.Mapped, ZCoordinate=0)
merge_4 = Merge(Data1=pt_13, Data2=pt_14, Data3=pt_15, Data4=pt_16)
nurbs_4 = NurbsCurve(Vertices=merge_4, Degree=2, Periodic=False)  # -> Curve, Length, Domain

number_slider_24 = Slider(1000, range=0..1000)
rectangle_5 = Rectangle(Plane=PlaneXY(0, 0, 0), XSize=number_slider_24, YSize=number_slider_24, Radius=0)  # -> Rectangle, Length
drec_5 = DeconstuctRectangle(Rectangle=rectangle_5.Rectangle)  # -> BasePlane, XInterval, YInterval
dedomain_5 = DeconstructDomain(Domain=drec_5.YInterval)  # -> Start, End
subtraction_5 = Subtraction(A=dedomain_5.End, B=dedomain_5.Start)
division_7 = Division(A=subtraction_5, B=2)
number_slider_25 = Slider(0.089, range=0..1)
dom_13 = ConstructDomain(DomainStart=0, DomainEnd=1)
addition_5 = Addition(A=dedomain_5.Start, B=division_7)
dom_14 = ConstructDomain(DomainStart=addition_5, DomainEnd=dedomain_5.End)
dom_15 = ConstructDomain(DomainStart=addition_5, DomainEnd=dedomain_5.Start)
remap_17 = RemapNumbers(Value=number_slider_25, Source=dom_13, Target=dom_15)  # -> Mapped, Clipped
remap_18 = RemapNumbers(Value=Slider(0, range=0..1), Source=dom_13, Target=drec_5.XInterval)  # -> Mapped, Clipped
remap_19 = RemapNumbers(Value=number_slider_25, Source=dom_13, Target=dom_14)  # -> Mapped, Clipped
remap_20 = RemapNumbers(Value=Slider(0, range=0..1), Source=dom_13, Target=drec_5.XInterval)  # -> Mapped, Clipped
pt_17 = ConstructPoint(XCoordinate=0, YCoordinate=remap_18.Mapped, ZCoordinate=0)
pt_18 = ConstructPoint(XCoordinate=remap_17.Mapped, YCoordinate=remap_20.Mapped, ZCoordinate=0)
pt_19 = ConstructPoint(XCoordinate=remap_19.Mapped, YCoordinate=remap_20.Mapped, ZCoordinate=0)
pt_20 = ConstructPoint(XCoordinate=number_slider_24, YCoordinate=remap_18.Mapped, ZCoordinate=0)
merge_5 = Merge(Data1=pt_17, Data2=pt_18, Data3=pt_19, Data4=pt_20)
nurbs_5 = NurbsCurve(Vertices=merge_5, Degree=2, Periodic=False)  # -> Curve, Length, Domain

number_slider_26 = Slider(1000, range=0..1000)
rectangle_6 = Rectangle(Plane=PlaneXY(0, 0, 0), XSize=number_slider_26, YSize=number_slider_26, Radius=0)  # -> Rectangle, Length
drec_6 = DeconstuctRectangle(Rectangle=rectangle_6.Rectangle)  # -> BasePlane, XInterval, YInterval
dedomain_6 = DeconstructDomain(Domain=drec_6.YInterval)  # -> Start, End
subtraction_6 = Subtraction(A=dedomain_6.End, B=dedomain_6.Start)
division_8 = Division(A=subtraction_6, B=2)
dom_16 = ConstructDomain(DomainStart=0, DomainEnd=1)
addition_6 = Addition(A=dedomain_6.Start, B=division_8)
number_slider_27 = Slider(0.37, range=0..1)
dom_17 = ConstructDomain(DomainStart=addition_6, DomainEnd=dedomain_6.End)
dom_18 = ConstructDomain(DomainStart=addition_6, DomainEnd=dedomain_6.Start)
remap_21 = RemapNumbers(Value=number_slider_27, Source=dom_16, Target=dom_18)  # -> Mapped, Clipped
remap_22 = RemapNumbers(Value=Slider(0, range=0..1), Source=dom_16, Target=drec_6.XInterval)  # -> Mapped, Clipped
remap_23 = RemapNumbers(Value=number_slider_27, Source=dom_16, Target=dom_17)  # -> Mapped, Clipped
remap_24 = RemapNumbers(Value=Slider(0.282, range=0..1), Source=dom_16, Target=drec_6.XInterval)  # -> Mapped, Clipped
pt_21 = ConstructPoint(XCoordinate=0, YCoordinate=remap_22.Mapped, ZCoordinate=0)
pt_22 = ConstructPoint(XCoordinate=remap_21.Mapped, YCoordinate=remap_24.Mapped, ZCoordinate=0)
pt_23 = ConstructPoint(XCoordinate=remap_23.Mapped, YCoordinate=remap_24.Mapped, ZCoordinate=0)
pt_24 = ConstructPoint(XCoordinate=number_slider_26, YCoordinate=remap_22.Mapped, ZCoordinate=0)
merge_6 = Merge(Data1=pt_21, Data2=pt_22, Data3=pt_23, Data4=pt_24)
nurbs_6 = NurbsCurve(Vertices=merge_6, Degree=2, Periodic=False)  # -> Curve, Length, Domain

number_slider_28 = Slider(1000, range=0..1000)
rectangle_7 = Rectangle(Plane=PlaneXY(0, 0, 0), XSize=number_slider_28, YSize=number_slider_28, Radius=0)  # -> Rectangle, Length
drec_7 = DeconstuctRectangle(Rectangle=rectangle_7.Rectangle)  # -> BasePlane, XInterval, YInterval
dedomain_7 = DeconstructDomain(Domain=drec_7.YInterval)  # -> Start, End
subtraction_7 = Subtraction(A=dedomain_7.End, B=dedomain_7.Start)
division_9 = Division(A=subtraction_7, B=2)
dom_19 = ConstructDomain(DomainStart=0, DomainEnd=1)
addition_7 = Addition(A=dedomain_7.Start, B=division_9)
number_slider_29 = Slider(0.852, range=0..1)
dom_20 = ConstructDomain(DomainStart=addition_7, DomainEnd=dedomain_7.End)
dom_21 = ConstructDomain(DomainStart=addition_7, DomainEnd=dedomain_7.Start)
remap_25 = RemapNumbers(Value=number_slider_29, Source=dom_19, Target=dom_21)  # -> Mapped, Clipped
remap_26 = RemapNumbers(Value=Slider(1, range=0..1), Source=dom_19, Target=drec_7.XInterval)  # -> Mapped, Clipped
remap_27 = RemapNumbers(Value=number_slider_29, Source=dom_19, Target=dom_20)  # -> Mapped, Clipped
remap_28 = RemapNumbers(Value=Slider(1, range=0..1), Source=dom_19, Target=drec_7.XInterval)  # -> Mapped, Clipped
pt_25 = ConstructPoint(XCoordinate=0, YCoordinate=remap_26.Mapped, ZCoordinate=0)
pt_26 = ConstructPoint(XCoordinate=remap_25.Mapped, YCoordinate=remap_28.Mapped, ZCoordinate=0)
pt_27 = ConstructPoint(XCoordinate=remap_27.Mapped, YCoordinate=remap_28.Mapped, ZCoordinate=0)
pt_28 = ConstructPoint(XCoordinate=number_slider_28, YCoordinate=remap_26.Mapped, ZCoordinate=0)
merge_7 = Merge(Data1=pt_25, Data2=pt_26, Data3=pt_27, Data4=pt_28)
nurbs_7 = NurbsCurve(Vertices=merge_7, Degree=2, Periodic=False)  # -> Curve, Length, Domain

merge_8 = Merge(Data1=nurbs.Curve, Data2=nurbs_2.Curve, Data3=nurbs_4.Curve)
lng = ListLength(List=merge_8)
merge_9 = Merge(Data1=nurbs_3.Curve, Data2=nurbs_5.Curve, Data3=nurbs_6.Curve, Data4=nurbs_7.Curve)
subtraction_8 = Subtraction(A=lng, B=1)
lng_2 = ListLength(List=merge_9)
division_10 = Division(A=Slider(4466, range=0..10000), B=subtraction_8)
subtraction_9 = Subtraction(A=lng_2, B=1)
series = Series(Start=0, Step=division_10, Count=lng)
division_11 = Division(A=Slider(4466, range=0..10000), B=subtraction_9)
X = UnitX(Factor=series)
series_2 = Series(Start=0, Step=division_11, Count=lng_2)
neg = Negative(Value=Slider(3000, range=0..3000))
move = Move(Geometry=merge_8, Motion=X)  # -> Geometry, Transform
X_2 = UnitX(Factor=series_2)

crv = Curve(merge_8)
lng_3 = ListLength(List=crv)  # -> expr("x-2", Length)
dom_22 = ConstructDomain(DomainStart=0, DomainEnd=lng_3)
subset = SubList(List=crv, Domain=dom_22, Wrap=True)  # -> graft(List), Index
shift = ShiftList(List=crv, Shift=1, Wrap=False)  # -> graft(List)
merge_10 = Merge(Data1=subset.List, Data2=shift)  # -> simplify(Result)
group = Group(Objects=merge_10)  # -> flatten(Group)

Y = UnitY(Factor=neg)
neg_2 = Negative(Value=Slider(1496, range=0..3000))
move_2 = Move(Geometry=move.Geometry, Motion=Y)  # -> Geometry, Transform
move_3 = Move(Geometry=merge_9, Motion=X_2)  # -> Geometry, Transform

crv_2 = Curve(merge_9)
lng_4 = ListLength(List=crv_2)  # -> expr("x-2", Length)
dom_23 = ConstructDomain(DomainStart=0, DomainEnd=lng_4)
subset_2 = SubList(List=crv_2, Domain=dom_23, Wrap=True)  # -> graft(List), Index
shift_2 = ShiftList(List=crv_2, Shift=1, Wrap=False)  # -> graft(List)
merge_11 = Merge(Data1=subset_2.List, Data2=shift_2)  # -> simplify(Result)
group_2 = Group(Objects=merge_11)  # -> flatten(Group)

data = Data(dec_pan.HMaxels)
dec_hmaxel = DeconstructHMaxel(HMaxel=data)  # -> PassiveLayers, ActiveBoards, Height, RowRange, ColumnRange, DesiredRadius, BlendedRadius, ShapedHMaxel
rectangle_8 = Rectangle(Plane=PlaneXY(0, 0, 0), XSize=dec_hmaxel.RowRange, YSize=dec_hmaxel.ColumnRange, Radius=0)  # -> Rectangle, Length
area = Area(Geometry=rectangle_8.Rectangle)  # -> Area, Centroid

Y_2 = UnitY(Factor=neg_2)
move_4 = Move(Geometry=move_3.Geometry, Motion=Y_2)  # -> Geometry, Transform

num_3 = Number(dec_pan.WidthRange)
num_4 = Number(dec_pan.LengthRange)
dedomain_8 = DeconstructDomain(Domain=num_3)  # -> Start, End
subtraction_10 = Subtraction(A=dedomain_8.End, B=dedomain_8.Start)
division_12 = Division(A=subtraction_10, B=2)
number_slider_30 = Slider(0.174, range=0..1)
addition_8 = Addition(A=dedomain_8.Start, B=division_12)
dom_24 = ConstructDomain(DomainStart=0, DomainEnd=1)
dom_25 = ConstructDomain(DomainStart=addition_8, DomainEnd=dedomain_8.End)
dom_26 = ConstructDomain(DomainStart=addition_8, DomainEnd=dedomain_8.Start)
remap_29 = RemapNumbers(Value=Slider(0.36, range=0.25..1), Source=dom_24, Target=num_4)  # -> Mapped, Clipped
remap_30 = RemapNumbers(Value=Slider(0.051, range=0..0.75), Source=dom_24, Target=num_4)  # -> Mapped, Clipped
remap_31 = RemapNumbers(Value=number_slider_30, Source=dom_24, Target=dom_26)  # -> Mapped, Clipped
remap_32 = RemapNumbers(Value=number_slider_30, Source=dom_24, Target=dom_25)  # -> Mapped, Clipped
pt_29 = ConstructPoint(XCoordinate=remap_29.Mapped, YCoordinate=dedomain_8.Start, ZCoordinate=0)
pt_30 = ConstructPoint(XCoordinate=remap_30.Mapped, YCoordinate=remap_31.Mapped, ZCoordinate=0)
pt_31 = ConstructPoint(XCoordinate=remap_30.Mapped, YCoordinate=remap_32.Mapped, ZCoordinate=0)
pt_32 = ConstructPoint(XCoordinate=remap_29.Mapped, YCoordinate=dedomain_8.End, ZCoordinate=0)
merge_12 = Merge(Data1=pt_29, Data2=pt_30, Data3=pt_31, Data4=pt_32)
nurbs_8 = NurbsCurve(Vertices=merge_12, Degree=2, Periodic=False)  # -> Curve, Length, Domain

# ---- group: generate distribution
pt_33 = Point(simplify(area.Centroid))
data_2 = Data(group)
pdecon = Deconstruct(Point=pt_33)  # -> XComponent, YComponent, ZComponent
bnd = Bounds(Numbers=flatten(pdecon.XComponent))
bnd_2 = Bounds(Numbers=flatten(pdecon.YComponent))
lng_5 = ListLength(List=data_2)
dedomain_9 = DeconstructDomain(Domain=bnd)  # -> Start, End
remap_33 = RemapNumbers(Value=pdecon.YComponent, Source=bnd_2, Target=Domain(0, 1))  # -> graft(Mapped), Clipped
c_script = CSharpScript(count=lng_5, start=dedomain_9.Start, end=dedomain_9.End)  # -> out, A; inputs count: Int32, start: Double, end: Double
# ---------- c_script: C# ----------
    double totalLength = end - start;
    double domLength = totalLength / (double) count;

    List<Interval> intervals = new List<Interval>();
    double currentStart = start;
    for(int i = 0; i < count; i++)
    {
      intervals.Add(new Interval(currentStart, currentStart + domLength));
      currentStart += domLength;
    }
    A = intervals;
# ---------- end c_script ----------
num_5 = Number(graft(pdecon.XComponent))
inc = Includes(Value=num_5, Domain=simplify(c_script.A))  # -> Includes, Deviation
cull = CullPattern(List=data_2, CullPattern=inc.Includes)
item = ListItem(List=cull, Index=0, Wrap=True)
cull_2 = CullPattern(List=c_script.A, CullPattern=inc.Includes)
ungroup = Ungroup(Group=item)  # -> simplify(Objects)
item_2 = ListItem(List=cull_2, Index=0, Wrap=True)
remap_34 = RemapNumbers(Value=num_5, Source=item_2, Target=Domain(0, 1))  # -> Mapped, Clipped
eval = EvaluateCurve(Curve=reparameterize(ungroup), Parameter=remap_33.Mapped)  # -> Point, Tangent, Angle
pdecon_2 = Deconstruct(Point=eval.Point)  # -> XComponent, YComponent, ZComponent
item_3 = ListItem(List=pdecon_2.YComponent, Index=0, Wrap=True)  # -> Item, Item1
twn2nums = TweenTwoNumbers(NumberA=item_3.Item, NumberB=item_3.Item1, Factor=remap_34.Mapped)
num_6 = Number(twn2nums)

pt_34 = Point(simplify(area.Centroid))
data_3 = Data(group_2)
pdecon_3 = Deconstruct(Point=pt_34)  # -> XComponent, YComponent, ZComponent
bnd_3 = Bounds(Numbers=flatten(pdecon_3.XComponent))
bnd_4 = Bounds(Numbers=flatten(pdecon_3.YComponent))
lng_6 = ListLength(List=data_3)
dedomain_10 = DeconstructDomain(Domain=bnd_3)  # -> Start, End
remap_35 = RemapNumbers(Value=pdecon_3.YComponent, Source=bnd_4, Target=Domain(0, 1))  # -> graft(Mapped), Clipped
c_script_2 = CSharpScript(count=lng_6, start=dedomain_10.Start, end=dedomain_10.End)  # -> out, A; inputs count: Int32, start: Double, end: Double; same code as c_script
num_7 = Number(graft(pdecon_3.XComponent))
inc_2 = Includes(Value=num_7, Domain=simplify(c_script_2.A))  # -> Includes, Deviation
cull_3 = CullPattern(List=data_3, CullPattern=inc_2.Includes)
item_4 = ListItem(List=cull_3, Index=0, Wrap=True)
cull_4 = CullPattern(List=c_script_2.A, CullPattern=inc_2.Includes)
ungroup_2 = Ungroup(Group=item_4)  # -> simplify(Objects)
item_5 = ListItem(List=cull_4, Index=0, Wrap=True)
remap_36 = RemapNumbers(Value=num_7, Source=item_5, Target=Domain(0, 1))  # -> Mapped, Clipped
eval_2 = EvaluateCurve(Curve=reparameterize(ungroup_2), Parameter=remap_35.Mapped)  # -> Point, Tangent, Angle
pdecon_4 = Deconstruct(Point=eval_2.Point)  # -> XComponent, YComponent, ZComponent
item_6 = ListItem(List=pdecon_4.YComponent, Index=0, Wrap=True)  # -> Item, Item1
twn2nums_2 = TweenTwoNumbers(NumberA=item_6.Item, NumberB=item_6.Item1, Factor=remap_36.Mapped)
num_8 = Number(twn2nums_2)

# ---- group: material / beech
data_4 = Data(species)

# ---- group: material / Species
crv_3 = Curve(nurbs_8.Curve)

# ---- group: material / spruce
data_5 = Data(species_2)

# ---- group: material
pt_35 = Point(graft(area.Centroid))
xz = XZPlane(Origin=pt_35)
pcx = CurvePlane(Curve=crv_3, Plane=xz)  # -> simplify(Points), ParamsC, ParamsP
pdecon_5 = Deconstruct(Point=pcx.Points)  # -> XComponent, YComponent, ZComponent
pdecon_6 = Deconstruct(Point=pt_35)  # -> XComponent, YComponent, ZComponent
smaller = SmallerThan(FirstNumber=pdecon_5.XComponent, SecondNumber=pdecon_6.XComponent)  # -> SmallerThan, OrEqualTo
not = GateNot(A=smaller.SmallerThan)
cull_5 = CullPattern(List=data_4, CullPattern=not)
cull_6 = CullPattern(List=data_5, CullPattern=smaller.SmallerThan)
merge_13 = Merge(Data1=cull_5, Data2=cull_6)  # -> simplify(Result)
dup = DuplicateData(Data=merge_13, Number="2", Order=True)  # -> simplify(Data)

# ----
num_9 = Number(num_6)
rec = Rectangle(rectangle.Rectangle)
drec_8 = DeconstuctRectangle(Rectangle=rec)  # -> BasePlane, XInterval, YInterval
dom_27 = ConstructDomain(DomainStart=Slider(25, range=0..100), DomainEnd=Slider(75, range=0..100))
remap_37 = RemapNumbers(Value=num_9, Source=drec_8.YInterval, Target=dom_27)  # -> Mapped, Clipped
trim = TrimTree(Tree=remap_37.Mapped, Depth=1)

num_10 = Number(num_8)
rec_2 = Rectangle(rectangle.Rectangle)
drec_9 = DeconstuctRectangle(Rectangle=rec_2)  # -> BasePlane, XInterval, YInterval
dom_28 = ConstructDomain(DomainStart=0, DomainEnd=1)
remap_38 = RemapNumbers(Value=num_10, Source=drec_9.YInterval, Target=dom_28)  # -> Mapped, Clipped
trim_2 = TrimTree(Tree=remap_38.Mapped, Depth=1)

data_6 = Data(panel_3)
data_7 = Data(species_2)
data_8 = Data(dec_pan.HMaxels)

data_9 = Data(data_6)
panel_4 = Panel("""0
1""")
data_10 = Data(data_7)
bilayer = ConstructBilayer(
    Panel=data_9,
    BoardLength=Slider(5, range=0..10),
    RowOffsets=panel_4,
    PassiveSpecies=data_10,
    ActiveThickness=Slider(20, range=0..100),
    PassiveThickness=Slider(4, range=0..10))

data_11 = Data(data_6)
panel_5 = Panel("""1
0""")
data_12 = Data(data_7)
bilayer_2 = ConstructBilayer(
    Panel=data_11,
    BoardLength=Slider(5, range=0..10),
    RowOffsets=panel_5,
    PassiveSpecies=data_12,
    ActiveThickness=Slider(20, range=0..100),
    PassiveThickness=Slider(4, range=0..10))

up_hmaxel = UpdateHMaxel(HMaxel=simplify(data_8), Height=simplify(trim), RadiusFactor=simplify(trim_2), Species=simplify(dup))  # -> flatten(HMaxel)
merge_14 = Merge(Data1=bilayer, Data2=bilayer_2)
data_13 = Data(panel_3)
up_pan = UpdatePanel(Panel=data_13, Bilayers=merge_14, HMaxels=up_hmaxel)
number_slider_31 = Slider(6, range=0..10)
num_11 = Number(num_2)
division_13 = Division(A=num_11, B=number_slider_31)
num_12 = Number(dec_pan.WidthRange)
num_13 = Number(dec_pan.LengthRange)
rectangle_9 = Rectangle(Plane=PlaneXY(0, 0, 0), XSize=num_13, YSize=num_12, Radius=0)  # -> Rectangle, Length
boundary = BoundarySurfaces(Edges=rectangle_9.Rectangle)

num_14 = Number(dec_pan.WidthRange)
num_15 = Number(dec_pan.LengthRange)
dedomain_11 = DeconstructDomain(Domain=num_14)  # -> Start, End
subtraction_11 = Subtraction(A=dedomain_11.End, B=dedomain_11.Start)
division_14 = Division(A=subtraction_11, B=2)
number_slider_32 = Slider(0.4, range=0..1)
addition_9 = Addition(A=dedomain_11.Start, B=division_14)
dom_29 = ConstructDomain(DomainStart=0, DomainEnd=1)
dom_30 = ConstructDomain(DomainStart=addition_9, DomainEnd=dedomain_11.End)
dom_31 = ConstructDomain(DomainStart=addition_9, DomainEnd=dedomain_11.Start)
remap_39 = RemapNumbers(Value=Slider(0.415, range=0.25..1), Source=dom_29, Target=num_15)  # -> Mapped, Clipped
remap_40 = RemapNumbers(Value=Slider(0.256, range=0..1), Source=dom_29, Target=num_15)  # -> Mapped, Clipped
remap_41 = RemapNumbers(Value=number_slider_32, Source=dom_29, Target=dom_31)  # -> Mapped, Clipped
remap_42 = RemapNumbers(Value=number_slider_32, Source=dom_29, Target=dom_30)  # -> Mapped, Clipped
pt_36 = ConstructPoint(XCoordinate=remap_39.Mapped, YCoordinate=dedomain_11.Start, ZCoordinate=0)
pt_37 = ConstructPoint(XCoordinate=remap_40.Mapped, YCoordinate=remap_41.Mapped, ZCoordinate=0)
pt_38 = ConstructPoint(XCoordinate=remap_40.Mapped, YCoordinate=remap_42.Mapped, ZCoordinate=0)
pt_39 = ConstructPoint(XCoordinate=remap_39.Mapped, YCoordinate=dedomain_11.End, ZCoordinate=0)
merge_15 = Merge(Data1=pt_36, Data2=pt_37, Data3=pt_38, Data4=pt_39)
nurbs_9 = NurbsCurve(Vertices=merge_15, Degree=2, Periodic=False)  # -> Curve, Length, Domain
divide = DivideCurve(Curve=nurbs_9.Curve, Count=Slider(50, range=0..100), Kinks=False)  # -> Points, Tangents, Parameters
srf_cp = SurfaceClosestPoint(Point=divide.Points, Surface=boundary)  # -> Point, UVPoint, Distance

lamination_width = Slider(991, range=0..1500)
num_16 = Number(division)
number_slider_33 = Slider(24, range=0..100)
number_slider_34 = Slider(1071, range=0..10000)

# ---- group: spruce left
panel_6 = Panel("https://docs.google.com/spreadsheets/d/1Q0xuMOoM9MJtYBJnVYEzEPmUDS6WbwrvgMLvJoCEvrc/edit#gid=0")
readcell = ReadCell(
    SpreadsheetURL=panel_6,
    SheetName="Sheet1",
    CellRange="A3:B82",
    DuplicateMerged=False,
    SameLength=False,
    Read=Toggle(True))
decell = DeconstructCell(Cell=readcell)  # -> FormattedValue, UserEnteredValue, CellFormat

# ---- group: spruce left / remove null branches
c_script_3 = CSharpScript(obj=decell.FormattedValue)  # -> out, A; inputs obj: tree
# ---------- c_script_3: C# ----------
    DataTree<object> output = new DataTree<object>();
    
    int currentID = 0;
    for(int i = 0; i < obj.BranchCount; i++)
    {
      if(obj.Branch(i)[1] as string != "null")
      {
        output.AddRange(obj.Branch(i), new GH_Path(currentID));
        currentID++;
      }
    }
    A = output;
# ---------- end c_script_3 ----------

# ---- group: spruce left (continued)
item_7 = ListItem(List=c_script_3.A, Index=0, Wrap=True)  # -> flatten(Item), Item1

# ---- group: name
data_14 = Data(item_7.Item)
lng_7 = ListLength(List=data_14)
dup_2 = DuplicateData(Data="SL", Number=lng_7, Order=True)  # -> graft(Data)
txt = Text(graft(data_14))
merge_16 = Merge(Data1=simplify(dup_2), Data2=simplify(txt))
join = TextJoin(Text=merge_16)

# ---- group: rt
num_17 = Number(item_7.Item1)

# ---- group: spruce right
panel_7 = Panel("https://docs.google.com/spreadsheets/d/1Q0xuMOoM9MJtYBJnVYEzEPmUDS6WbwrvgMLvJoCEvrc/edit#gid=0")
readcell_2 = ReadCell(
    SpreadsheetURL=panel_7,
    SheetName="Sheet1",
    CellRange="D3:E70",
    DuplicateMerged=False,
    SameLength=False,
    Read=Toggle(True))
decell_2 = DeconstructCell(Cell=readcell_2)  # -> FormattedValue, UserEnteredValue, CellFormat

# ---- group: spruce right / remove null branches
c_script_4 = CSharpScript(obj=decell_2.FormattedValue)  # -> out, A; inputs obj: tree; same code as c_script_3

# ---- group: spruce right (continued)
item_8 = ListItem(List=c_script_4.A, Index=0, Wrap=True)  # -> flatten(Item), Item1

# ---- group: name
data_15 = Data(item_8.Item)
lng_8 = ListLength(List=data_15)
dup_3 = DuplicateData(Data="SR", Number=lng_8, Order=True)  # -> graft(Data)
txt_2 = Text(graft(data_15))
merge_17 = Merge(Data1=simplify(dup_3), Data2=simplify(txt_2))
join_2 = TextJoin(Text=merge_17)

# ---- group: rt
num_18 = Number(item_8.Item1)

# ----
merge_18 = Merge(Data1=join, Data2=num_17)
merge_19 = Merge(Data1=join_2, Data2=num_18)
entwine = Entwine(Branch0X=merge_18, Branch1X=merge_19, FlattenInputs=False)
renumber = RenumberPaths(Data=entwine)
item_9 = ListItem(List=renumber, Index=0, Wrap=True)  # -> flatten(Item), flatten(Item1)

# ---- group: beech left
panel_8 = Panel("https://docs.google.com/spreadsheets/d/1Q0xuMOoM9MJtYBJnVYEzEPmUDS6WbwrvgMLvJoCEvrc/edit#gid=0")
readcell_3 = ReadCell(
    SpreadsheetURL=panel_8,
    SheetName="Sheet1",
    CellRange="G3:H36",
    DuplicateMerged=False,
    SameLength=False,
    Read=Toggle(True))
decell_3 = DeconstructCell(Cell=readcell_3)  # -> FormattedValue, UserEnteredValue, CellFormat

# ---- group: beech left / remove null branches
c_script_5 = CSharpScript(obj=decell_3.FormattedValue)  # -> out, A; inputs obj: tree; same code as c_script_3

# ---- group: beech left (continued)
item_10 = ListItem(List=c_script_5.A, Index=0, Wrap=True)  # -> flatten(Item), Item1

# ---- group: name
data_16 = Data(item_10.Item)
lng_9 = ListLength(List=data_16)
dup_4 = DuplicateData(Data="BL", Number=lng_9, Order=True)  # -> graft(Data)
txt_3 = Text(graft(data_16))
merge_20 = Merge(Data1=simplify(dup_4), Data2=simplify(txt_3))
join_3 = TextJoin(Text=merge_20)

# ---- group: rt
num_19 = Number(item_10.Item1)

# ---- group: beech right
panel_9 = Panel("https://docs.google.com/spreadsheets/d/1Q0xuMOoM9MJtYBJnVYEzEPmUDS6WbwrvgMLvJoCEvrc/edit#gid=0")
readcell_4 = ReadCell(
    SpreadsheetURL=panel_9,
    SheetName="Sheet1",
    CellRange="J3:K38",
    DuplicateMerged=False,
    SameLength=False,
    Read=Toggle(True))
decell_4 = DeconstructCell(Cell=readcell_4)  # -> FormattedValue, UserEnteredValue, CellFormat

# ---- group: beech right / remove null branches
c_script_6 = CSharpScript(obj=decell_4.FormattedValue)  # -> out, A; inputs obj: tree; same code as c_script_3

# ---- group: beech right (continued)
item_11 = ListItem(List=c_script_6.A, Index=0, Wrap=True)  # -> flatten(Item), Item1

# ---- group: name
data_17 = Data(item_11.Item)
lng_10 = ListLength(List=data_17)
dup_5 = DuplicateData(Data="BR", Number=lng_10, Order=True)  # -> graft(Data)
txt_4 = Text(graft(data_17))
merge_21 = Merge(Data1=simplify(dup_5), Data2=simplify(txt_4))
join_4 = TextJoin(Text=merge_21)

# ---- group: rt
num_20 = Number(item_11.Item1)

# ----
merge_22 = Merge(Data1=join_3, Data2=num_19)
merge_23 = Merge(Data1=join_4, Data2=num_20)
entwine_2 = Entwine(Branch0X=merge_22, Branch1X=merge_23, FlattenInputs=False)
renumber_2 = RenumberPaths(Data=entwine_2)
item_12 = ListItem(List=renumber_2, Index=0, Wrap=True)  # -> flatten(Item), flatten(Item1)

lng_11 = ListLength(List=item_9.Item)
lng_12 = ListLength(List=item_12.Item)
dup_6 = DuplicateData(Data=Slider(2500, range=0..2500), Number=lng_11, Order=True)
dup_7 = DuplicateData(Data=Slider(1000, range=0..1000), Number=lng_12, Order=True)
dup_8 = DuplicateData(Data=Slider(150, range=0..1000), Number=lng_11, Order=True)
dup_9 = DuplicateData(Data=Slider(150, range=0..1000), Number=lng_12, Order=True)
dup_10 = DuplicateData(Data=Slider(27, range=0..100), Number=lng_11, Order=True)
dup_11 = DuplicateData(Data=species, Number=lng_12, Order=True)
dup_12 = DuplicateData(Data=Slider(27, range=0..100), Number=lng_12, Order=True)
dup_13 = DuplicateData(Data=species_2, Number=lng_11, Order=True)
merge_24 = Merge(Data1=item_9.Item1, Data2=item_12.Item1)
merge_25 = Merge(Data1=dup_10, Data2=dup_12)
merge_26 = Merge(Data1=dup_6, Data2=dup_7)
merge_27 = Merge(Data1=dup_8, Data2=dup_9)
merge_28 = Merge(Data1=item_9.Item, Data2=item_12.Item)
merge_29 = Merge(Data1=dup_13, Data2=dup_11)

stock_boards = StockBoards(Name=merge_28, Species=merge_29, Thickness=merge_25, Length=merge_26, Width=merge_27, RTAngle=merge_24, MoistureChange=0)

panel_10 = Panel("""10
3""")
data_18 = Data(up_pan)
data_19 = Data(stock_boards)
c_script_7 = CSharpScript(Reference="C:\Users\Alex Reiner\AppData\Roaming\Grasshopper\Libraries\HygroDesign.Core.dll")  # -> out, A
# ---------- c_script_7: C# usings ----------
using BilayerDesign;
# ---------- c_script_7: C# ----------
    TimoshenkoPrediction timo = new TimoshenkoPrediction();
    A = timo;
# ---------- c_script_7: C# additional code ----------
  public class TimoshenkoPrediction : PredictionEngine
  {

    public TimoshenkoPrediction()
    {
    }

    public override double Predict(StockBoard board, Bilayer bilayer, double moistureChange)
    {
      double h1 = bilayer.PassiveLayer.Thickness;
      double h2 = bilayer.ActiveLayer.Thickness;
      double h = h1 + h2;
      double m = h1 / h2;
      double e1 = bilayer.PassiveLayer.Species.Attributes["LEmod"];
      double e2 = GrainAngleInterpolation(board.RTAngle, board.Species.Attributes["REmod"], board.Species.Attributes["TEmod"]);
      double n = e1 / e2;
      double a1 = bilayer.PassiveLayer.Species.Attributes["LExp"];
      double a2 = GrainAngleInterpolation(board.RTAngle, board.Species.Attributes["RExp"], board.Species.Attributes["TExp"]);
      double deltaAlpha = a2 - a1;
      double kValue = 6 * Math.Pow(1.0 + m, 2) / (3 * Math.Pow(1 + m, 2) + (1 + m * n) * Math.Pow(m, 2) + (1 / (m * n)));
      double curvature = kValue * ((moistureChange * deltaAlpha) / h);
      return 1 / (curvature /* * TimError*/ );
    }

    public static double GrainAngleInterpolation(double rtAngle, double eR, double eT)
    {
      double angleConv = RhinoMath.ToRadians(rtAngle);
      double angleT = Math.Cos(angleConv);
      double angleR = Math.Sin(angleConv);
      double eActive = eT * Math.Pow(angleT, 2) + eR * Math.Pow(angleR, 2);
      return eActive;
    }
  }
# ---------- end c_script_7 ----------
stockpile = ConstructStockPile(Panels=data_18, StockBoards=data_19, MoistureChanges=panel_10, PredictionEngine=c_script_7.A)
sel_env = ConstructSelectionEnvironment(Panels=data_18, StockPile=stockpile)

# ---- group: convolution
c_script_8 = CSharpScript(
    tan=Slider(1, range=0.01..3),
    lon=Slider(0.5, range=0.01..3),
    rad=Slider(10000, range=0..10000),
    stiff=Slider(0.75, range=0.01..3),
    Reference="C:\Users\Alex Reiner\AppData\Roaming\Grasshopper\Libraries\HygroDesign.Core.dll")  # -> out, A; inputs tan: Double, lon: Double, rad: Double, stiff: Double, thick: Double
# ---------- c_script_8: C# ----------
    HMaxelConvolution convEngine = new HMaxelConvolution(tan, lon, rad, stiff, thick);
    A = convEngine;
# ---------- c_script_8: C# additional code ----------
  public class HMaxelConvolution : ConvolutionEngine
  {
    public double Tangential { get; set; }
    public double Longitudinal { get; set; }
    public double RadiusMax { get; set; }
    public double StiffnessInfluence { get; set; }
    public double ThicknessInfluence { get; set; }
    public HMaxelConvolution(double tangential, double longitudinal, double radiusMax, double stiffnessInfluence, double thicknessInfluence)
    {
      Tangential = tangential;
      Longitudinal = longitudinal;
      RadiusMax = radiusMax;
      StiffnessInfluence = stiffnessInfluence;
      ThicknessInfluence = thicknessInfluence;
    }

    public override Panel Convolution(Panel panel)
    {
      double MaxRad = double.MinValue;
      double MinRad = double.MaxValue;

      double MaxRStiff = double.MinValue;
      double MinRStiff = double.MaxValue;
      double MaxLStiff = double.MinValue;
      double MinLStiff = double.MaxValue;

      for (int i = 0; i < panel.HMaxels.GetLength(0); i++)
      {
        for (int j = 0; j < panel.HMaxels.GetLength(1); j++)
        {
          double averageRStiffness = 0;
          double averageLStiffness = 0;
          double weightedRadius = 0;
          double totalRWeights = 0;

          HMaxel hmaxel = panel.HMaxels[i, j];
          List<Tuple<double, double>> tuples = new List<Tuple<double, double>>();
          for (int v = 0; v < hmaxel.ActiveBoards.Count; v++)
          {
            averageRStiffness += (double) hmaxel.ActiveBoards[v].StockBoard.Species.Attributes["REmod"];
            averageLStiffness += (double) hmaxel.ActiveBoards[v].StockBoard.Species.Attributes["LEmod"];

            weightedRadius += (hmaxel.ActiveBoards[v].Radius * (double) hmaxel.ActiveBoards[v].StockBoard.Species.Attributes["REmod"]);
            totalRWeights += (double) hmaxel.ActiveBoards[v].StockBoard.Species.Attributes["REmod"];

          }
          averageRStiffness /= hmaxel.ActiveBoards.Count;
          averageLStiffness /= hmaxel.ActiveBoards.Count;
          weightedRadius /= totalRWeights;
          panel.HMaxels[i, j].Attributes.Add("REmod", averageRStiffness);
          panel.HMaxels[i, j].Attributes.Add("LEmod", averageLStiffness);
          panel.HMaxels[i, j].Attributes.Add("weighted radius", weightedRadius);

          if (weightedRadius > MaxRad) MaxRad = weightedRadius;
          if (weightedRadius < MinRad) MinRad = weightedRadius;
          if (averageLStiffness > MaxLStiff) MaxLStiff = averageLStiffness;
          if (averageLStiffness < MinLStiff) MinLStiff = averageLStiffness;
          if (averageRStiffness > MaxRStiff) MaxRStiff = averageRStiffness;
          if (averageRStiffness < MinRStiff) MinRStiff = averageRStiffness;
        }
      }
      //set factors
      for (int i = 0; i < panel.HMaxels.GetLength(0); i++)
      {
        for (int j = 0; j < panel.HMaxels.GetLength(1); j++)
        {
          panel.HMaxels[i, j].Attributes.Add("REmodFactor", Remap((double) panel.HMaxels[i, j].Attributes["REmod"], MinRStiff, MaxRStiff, 1 - StiffnessInfluence, 1));
          panel.HMaxels[i, j].Attributes.Add("LEmodFactor", Remap((double) panel.HMaxels[i, j].Attributes["LEmod"], MinLStiff, MaxLStiff, 1 - StiffnessInfluence, 1));
          panel.HMaxels[i, j].Attributes.Add("RadiusFactor", Remap((double) panel.HMaxels[i, j].Attributes["weighted radius"], MinRad, RadiusMax, 1, 0));

        }
      }

      //horizontal convolution
      for (int i = 0; i < panel.HMaxels.GetLength(0); i++)
      {
        for (int j = 0; j < panel.HMaxels.GetLength(1); j++)
        {
          double totalWeights = 0;
          double blendedRadius = 0;
          for (int x = 0; x < panel.HMaxels.GetLength(0); x++)
          {
            for (int y = 0; y < panel.HMaxels.GetLength(1); y++)
            {

              double xdist = Math.Abs(panel.HMaxels[i, j].X - panel.HMaxels[x, y].X);
              double ydist = Math.Abs(panel.HMaxels[i, j].Y - panel.HMaxels[x, y].Y);
              double LFactor = (double) panel.HMaxels[x, y].Attributes["LEmodFactor"] / Math.Pow(xdist + 1, Longitudinal);
              double RFactor = (double) panel.HMaxels[x, y].Attributes["REmodFactor"] / Math.Pow(ydist + 1, Tangential);
              blendedRadius += (double) panel.HMaxels[x, y].Attributes["weighted radius"] * (double) panel.HMaxels[i, j].Attributes["RadiusFactor"] * LFactor * RFactor;
              totalWeights += (double) panel.HMaxels[x, y].Attributes["RadiusFactor"] * LFactor * RFactor;

            }
          }

          panel.HMaxels[i, j].BlendedRaidus = blendedRadius / totalWeights;

        }
      }
      return panel;
    }
    public static double Remap(double val, double from1, double to1, double from2, double to2)
    {
      return (val - from1) / (to1 - from1) * (to2 - from2) + from2;
    }
  }
# ---------- end c_script_8 ----------
data_20 = Data(sel_env)
rad_blend = RadiusBlending(Panels=data_20, ConvolutionEngine=c_script_8.A)
dec_pan_2 = DeconstructPanel(Panel=rad_blend)  # -> Bilayers, HMaxels, LengthRange, WidthRange
dec_hmaxel_2 = DeconstructHMaxel(HMaxel=dec_pan_2.HMaxels)  # -> PassiveLayers, ActiveBoards, Height, RowRange, ColumnRange, DesiredRadius, BlendedRadius, ShapedHMaxel

# ----
num_21 = Number(expr("x/2", num_11))
dedomain_12 = DeconstructDomain(Domain=dec_hmaxel_2.RowRange)  # -> Start, End
bnd_5 = Bounds(Numbers=dedomain_12.Start)
bnd_6 = Bounds(Numbers=dedomain_12.End)
dedomain_13 = DeconstructDomain(Domain=bnd_5)  # -> Start, End
dedomain_14 = DeconstructDomain(Domain=bnd_6)  # -> Start, End
x_minus_one = XMinusOne(NumberX=division_13)
subtraction_12 = Subtraction(A=dedomain_14.End, B=dedomain_13.Start)
division_15 = Division(A=subtraction_12, B=x_minus_one)
series_3 = Series(Start=dedomain_13.Start, Step=division_15, Count=division_13)
pt_40 = ConstructPoint(XCoordinate=series_3, YCoordinate=0, ZCoordinate=0)
yz = YZPlane(Origin=pt_40)  # -> simplify(graft(Plane))

partition = PartitionList(List=dec_hmaxel_2.BlendedRadius, Size=num_11)  # -> simplify(Chunks)
flip = FlipMatrix(Data=partition)
num_22 = Number(flip)
c_script_9 = CSharpScript(x=num_22, y=number_slider_31)  # -> out, A; inputs x: tree, y: Int32
# ---------- c_script_9: C# ----------
    DataTree<object> output = new DataTree<object>();

    for(int i = 0; i < x.BranchCount; i++)
    {
      if(i % y == 0)output.AddRange(x.Branch(i), new GH_Path(i));
    }
    A = output;
# ---------- end c_script_9 ----------
renumber_3 = RenumberPaths(Data=c_script_9.A)

num_23 = Number(num)
pln = Plane(yz)
num_24 = Number(renumber_3)
c_script_10 = CSharpScript()  # -> out, A; inputs x: tree
# ---------- c_script_10: C# ----------
    DataTree<object> output = new DataTree<object>();
    int firstIndex = 0;
    int branchCount = 0;
    for(int i = 0; i < x.BranchCount; i++)
    {
      GH_Path path = new GH_Path(firstIndex, branchCount);
      if(x.Paths[i][0] == firstIndex)
      {
        output.AddRange(x.Branch(i), path);
      }
      else
      {
        firstIndex++;
        branchCount = -1;
        i--;
      }
      branchCount++;
    }
    A = output;
# ---------- end c_script_10 ----------
c_script_11 = CSharpScript(iRadii=num_24, iBoardWidth=num_23, iPlanes=pln)  # -> out, simplify(A); inputs iRadii: tree of Double, iBoardWidth: Double, iPlanes: tree of Plane
# ---------- c_script_11: C# ----------
    DataTree<Point3d> pointTree = new DataTree<Point3d>();

    for (int j = 0; j < iRadii.BranchCount; j++)
    {

      //initialize variables
      Plane bp = iPlanes.Branch(j)[0];
      Point3d startPoint = new Point3d(bp.Origin);
      Point3d centerPoint = startPoint;
      Vector3d rotationAxis = new Vector3d(bp.ZAxis);
      Vector3d centerPointVect = new Vector3d(bp.YAxis);
      centerPointVect.Rotate(Math.PI / 2, rotationAxis);

      for (int i = 0; i < iRadii.Branch(j).Count; i++){
        GH_Path pth = iRadii.Paths[j].AppendElement(i);
        Point3d point1 = startPoint;
        Point3d point2 = startPoint;

        pointTree.Add(point1, pth);

        //calculate rotation angle
        Double arcLength = iBoardWidth;
        Double radius = iRadii.Branch(j)[i];
        Double rotation = (arcLength / radius);

        //calculate rotation center point
        centerPointVect.Unitize();
        centerPointVect *= radius;
        centerPoint += centerPointVect;


        //execute half rotation
        Transform tx = Transform.Rotation(rotation / 2, rotationAxis, centerPoint);


        point2.Transform(tx);
        pointTree.Add(point2, pth);

        //execute full rotation
        tx = Transform.Rotation(rotation, rotationAxis, centerPoint);
        startPoint.Transform(tx);
        pointTree.Add(startPoint, pth);

        //updata rotation parameters
        centerPoint = startPoint;
        centerPointVect.Transform(tx);
      }
    }
    A = pointTree;
# ---------- end c_script_11 ----------

trim_3 = TrimTree(Tree=c_script_11.A, Depth=1)
cullpt = CullDuplicates(Points=trim_3, Tolerance=0.1, CullMode=3)  # -> Points, Indices, Valence
pt_41 = Point(cullpt.Points)

# ---- group: animate
pt_42 = Point(simplify(pt_41))
pln_2 = Plane(graft(pln))
num_25 = Number(Slider(1, range=0..1))
c_script_12 = CSharpScript(iPoints=simplify(pt_42), iPlanes=pln_2, iShapeFactor=num_25)  # -> out, A; inputs iPoints: tree of Point3d, iPlanes: tree of Plane, iShapeFactor: Double
# ---------- c_script_12: C# ----------
    DataTree<Point3d> output = new DataTree<Point3d>();
    
    double shapeFactor = 1.0 - iShapeFactor;

    //step through curves
    for (int i = 0; i < iPoints.BranchCount; i++)
    {
      Plane currentPlane = iPlanes.Branch(iPoints.Path(i)[0])[0];

      //get vectors from plane
      Vector3d zVect = currentPlane.YAxis;

      Vector3d rotVect = currentPlane.ZAxis;

      //create new startpoint inside list
      Point3d startPoint = iPoints.Branch(i)[0];

      //step through points. Create and rotate vectors
      for (int j = 0; j < iPoints.Branch(i).Count; j++)
      {
        if (j == 0) output.Add(startPoint, iPoints.Path(i));
        else{
          //create current segment vector
          Vector3d segmentVect = new Vector3d(iPoints.Branch(i)[j] - iPoints.Branch(i)[j - 1]);

          //measure angle with vertical vector
          double angle = Vector3d.VectorAngle(zVect, segmentVect, currentPlane);

          //rotate
          segmentVect.Rotate(-angle * shapeFactor, rotVect);

          startPoint += segmentVect;
          output.Add(startPoint, iPoints.Path(i));
        }
      }
    }

    A = output;
# ---------- end c_script_12 ----------
pt_43 = Point(c_script_12.A)
intcrv = Interpolate(Vertices=pt_43, Degree=3, Periodic=False, KnotStyle=1)  # -> Curve, Length, Domain
crv_4 = Curve(intcrv.Curve)

# ----
crv_5 = Curve(crv_4)
pt_44 = Point(simplify(graft(yz)))
end = EndPoints(Curve=crv_5)  # -> Start, End
vec2pt = Vector2Pt(PointA=end.Start, PointB=end.End, Unitize=False)  # -> Vector, Length
yz_2 = YZPlane(Origin=end.Start)
Y_3 = UnitY(Factor="-1")
angle = Angle(VectorA=vec2pt.Vector, VectorB=Y_3, Plane=yz_2)  # -> Angle, Reflex
rotate = Rotate(Geometry=crv_5, Angle=angle.Angle, Plane=yz_2)  # -> Geometry, Transform
curvepoint = PointOnCurve(rotate.Geometry, parameter=0.5)
vec2pt_2 = Vector2Pt(PointA=curvepoint, PointB=pt_44, Unitize=False)  # -> Vector, Length
move_5 = Move(Geometry=rotate.Geometry, Motion=vec2pt_2.Vector)  # -> Geometry, Transform
path_mapper = PathMapper(move_5.Geometry, source=["{A;B}", "{A}"], target=["{A}", "{0}"])
crv_6 = Curve(path_mapper)
flip_2 = FlipCurve(Curve=crv_6)  # -> Curve, Flag
loft = Loft(Curves=flip_2.Curve, Options={Adjust=False, Closed=False, LoftEnds=0, LoftSimp=0, LoftType=0, Rebuild=10, Refit=0.01})
srf = Surface(loft)

crv_7 = Curve(flip_2.Curve)
crv_8 = Curve(reparameterize(crv_7))
srf_2 = Surface(boundary)
debrep = DeconstructBrep(Brep=srf_2)  # -> Faces, Edges, Vertices
item_13 = ListItem(List=crv_8, Index=0, Wrap=True)
bbox = BoundingBox(Content=crv_7, Plane=PlaneXY(0, 0, 0), UnionBox=True)  # -> Box, Box_2
number_slider_35 = Slider(10, range=0..30)
end_2 = EndPoints(Curve=item_13)  # -> Start, End
debox = DeconstructBox(Box=bbox.Box)  # -> Plane, X, Y, Z
len = Length(Curve=debrep.Edges)
pdecon_7 = Deconstruct(Point=end_2.Start)  # -> XComponent, YComponent, ZComponent
pdecon_8 = Deconstruct(Point=end_2.End)  # -> XComponent, YComponent, ZComponent
sort = SortList(Keys=len, ValuesA=debrep.Edges)  # -> Keys, reverse(ValuesA)
dedomain_15 = DeconstructDomain(Domain=debox.X)  # -> Start, End
addition_10 = Addition(A=pdecon_7.YComponent, B=number_slider_35)
subtraction_13 = Subtraction(A=pdecon_8.YComponent, B=number_slider_35)
item_14 = ListItem(List=sort.ValuesA, Index=0, Wrap=True)  # -> Item, Item1
pt_45 = ConstructPoint(XCoordinate=0, YCoordinate=addition_10, ZCoordinate=0)
pt_46 = ConstructPoint(XCoordinate=dedomain_15.End, YCoordinate=addition_10, ZCoordinate=0)
pt_47 = ConstructPoint(XCoordinate=0, YCoordinate=subtraction_13, ZCoordinate=0)
pt_48 = ConstructPoint(XCoordinate=dedomain_15.End, YCoordinate=subtraction_13, ZCoordinate=0)
flip_3 = FlipCurve(Curve=item_14.Item)  # -> Curve, Flag
vec2pt_3 = Vector2Pt(PointA=pt_45, PointB=pt_46, Unitize=False)  # -> Vector, Length
Z = UnitZ(Factor=1)
vec2pt_4 = Vector2Pt(PointA=pt_47, PointB=pt_48, Unitize=False)  # -> Vector, Length
Z_2 = UnitZ(Factor=1)
merge_30 = Merge(Data1=flip_3.Curve, Data2=item_14.Item1)
lng_13 = ListLength(List=crv_7)
pl = ConstructPlane(Origin=pt_45, XAxis=vec2pt_3.Vector, YAxis=Z)
pl_2 = ConstructPlane(Origin=pt_47, XAxis=vec2pt_4.Vector, YAxis=Z_2)
divide_2 = DivideCurve(Curve=merge_30, Count=expr("x-1", lng_13), Kinks=False)  # -> Points, Tangents, Parameters
merge_31 = Merge(Data1=pl, Data2=pl_2)
flip_4 = FlipMatrix(Data=divide_2.Points)
pcx_2 = CurvePlane(Curve=graft(crv_8), Plane=merge_31)  # -> Points, ParamsC, ParamsP
item_15 = ListItem(List=flip_4, Index=0, Wrap=True)  # -> Item, Item1
ln = Line(StartPoint=item_15.Item, EndPoint=item_15.Item1)

pdecon_9 = Deconstruct(Point=pcx_2.Points)  # -> XComponent, YComponent, ZComponent
sort_2 = SortList(Keys=pdecon_9.ZComponent, ValuesA=pcx_2.ParamsC)  # -> Keys, reverse(ValuesA)
item_16 = ListItem(List=sort_2.ValuesA, Index=0, Wrap=True)

trim_4 = TrimTree(Tree=item_16, Depth=1)
eval_3 = EvaluateCurve(Curve=ln, Parameter=trim_4)  # -> simplify(Point), Tangent, Angle
flip_5 = FlipMatrix(Data=eval_3.Point)
intcrv_2 = Interpolate(Vertices=flip_5, Degree=3, Periodic=False, KnotStyle=1)  # -> Curve, Length, Domain

divide_3 = DivideCurve(Curve=intcrv_2.Curve, Count=Slider(100, range=0..1000), Kinks=False)  # -> simplify(Points), Tangents, Parameters
srf_cp_2 = SurfaceClosestPoint(Point=divide_3.Points, Surface=boundary)  # -> Point, UVPoint, Distance

srf_3 = Surface(srf)
evalsrf = EvaluateSurface(Surface=srf_3, Point=srf_cp_2.UVPoint)  # -> Point, Normal, UDirection, VDirection, Frame
number_slider_36 = Slider(100, range=0..100)
intcrv_3 = Interpolate(Vertices=evalsrf.Point, Degree=3, Periodic=False, KnotStyle=1)  # -> Curve, Length, Domain
ext = ExtendCurve(Curve=intcrv_3.Curve, Type=0, Start=number_slider_36, End=number_slider_36)
srfsplit = SurfaceSplit(Surface=srf_3, Curves=flatten(ext))
area_2 = Area(Geometry=srfsplit)  # -> Area, Centroid
area_3 = Area(Geometry=srf_3)  # -> Area, Centroid
pdecon_10 = Deconstruct(Point=area_2.Centroid)  # -> XComponent, YComponent, ZComponent
pdecon_11 = Deconstruct(Point=area_3.Centroid)  # -> XComponent, YComponent, ZComponent
subtraction_14 = Subtraction(A=pdecon_11.YComponent, B=pdecon_10.YComponent)
abs = Absolute(Value=subtraction_14)
sort_3 = SortList(Keys=abs, ValuesA=srfsplit)  # -> Keys, ValuesA
item_17 = ListItem(List=sort_3.ValuesA, Index=0, Wrap=True)

evalsrf_2 = EvaluateSurface(Surface=srf, Point=srf_cp.UVPoint)  # -> Point, Normal, UDirection, VDirection, Frame
srf_4 = Surface(item_17)
intcrv_4 = Interpolate(Vertices=evalsrf_2.Point, Degree=3, Periodic=False, KnotStyle=1)  # -> Curve, Length, Domain
srfsplit_2 = SurfaceSplit(Surface=srf_4, Curves=intcrv_4.Curve)
area_4 = Area(Geometry=srfsplit_2)  # -> Area, Centroid
pdecon_12 = Deconstruct(Point=area_4.Centroid)  # -> XComponent, YComponent, ZComponent
sort_4 = SortList(Keys=pdecon_12.XComponent, ValuesA=srfsplit_2)  # -> Keys, ValuesA
item_18 = ListItem(List=sort_4.ValuesA, Index=0, Wrap=True)
brep = Brep(item_18)

pan_srf = PanelSurface(Panel=rad_blend, Surface=item_17)
entwine_3 = Entwine(Branch00=item_17, Branch01=brep, FlattenInputs=True)
trim_breps = TrimmingBreps(Panel=pan_srf, Breps=entwine_3)
dec_pan_3 = DeconstructPanel(Panel=trim_breps)  # -> Bilayers, HMaxels, LengthRange, WidthRange
dec_bilayer = DeconstructBilayer(Bilayer=dec_pan_3.Bilayers)  # -> ActiveLayer, PassiveLayer
dec_active_layer = DeconstructActiveLayer(ActiveLayer=dec_bilayer.ActiveLayer)  # -> simplify(ActiveLayerBoards), Thickness
dec_active_board = DeconstructActiveBoard(ActiveBoard=dec_active_layer.ActiveLayerBoards)  # -> HMaxels, StockBoard, Thickness, RowRange, ColumnRange, DesiredRadius, Radius, BlendedRadius, MoistureChange, ShapedBoard
dec_stock_board = DeconstructStockBoard(StockBoard=dec_active_board.StockBoard)  # -> Name, Species, RTAngle, Length, Width, ActiveBoards
dec_secies = DeconstructSpecies(Species=dec_stock_board.Species)
domain = Domain(dec_active_board.RowRange)
trim_5 = TrimTree(Tree=dec_active_board.ShapedBoard, Depth=1)
trim_6 = TrimTree(Tree=domain, Depth=1)
trim_7 = TrimTree(Tree=simplify(dec_secies), Depth=1)
null = NullItem(Item=trim_5)  # -> NullFlags, InvalidFlags, Description
c_script_13 = CSharpScript(
    boards=dec_active_layer.ActiveLayerBoards,
    ranges=trim_6,
    length=lamination_width,
    overlap=num_16,
    Reference="C:\Users\Alex Reiner\AppData\Roaming\Grasshopper\Libraries\HygroDesign.Core.dll")  # -> out, A; inputs boards: tree, ranges: tree, length: Double, overlap: Double
# ---------- c_script_13: C# ----------
    DataTree<ActiveBoard> laminationGroups = new DataTree<ActiveBoard>();


    for(int i = 0; i < ranges.BranchCount; i++)
    {
      for(int j = 0; j < ranges.Branch(i).Count; j++)
      {
        for(int x = 1; x < 10; x++)
        {
          double test = (x * length) - ((x - 1) * overlap);

          if(Math.Floor(ranges.Branch(i)[j][1]) > test)continue;
          GH_Path path = ranges.Paths[i].AppendElement(x);
          laminationGroups.Add(boards.Branch(i)[j] as ActiveBoard, path);
          break;
        }
      }
    }
    A = laminationGroups;
# ---------- end c_script_13 ----------
not_2 = GateNot(A=null.NullFlags)
cull_7 = CullPattern(List=simplify(trim_7), CullPattern=simplify(not_2))
cull_8 = CullPattern(List=trim_5, CullPattern=not_2)
chars = Characters(Text=cull_7)  # -> Result, Unicode
dec_active_board_2 = DeconstructActiveBoard(ActiveBoard=c_script_13.A)  # -> HMaxels, StockBoard, Thickness, RowRange, ColumnRange, DesiredRadius, Radius, BlendedRadius, MoistureChange, ShapedBoard
bang = ExplodeTree(Data=cull_8)  # -> Branch0, Branch1
lng_14 = ListLength(List=chars.Result)
rectangle_10 = Rectangle(Plane=PlaneXY(0, 0, 0), XSize=dec_active_board_2.RowRange, YSize=dec_active_board_2.ColumnRange, Radius=0)  # -> Rectangle, Length
offsrf = OffsetSurface(Surface=bang.Branch1, Distance=expr("-x", number_slider_33), BothSides=0, CreateSolid=True)
equals = Equality(FirstNumber=lng_14, SecondNumber="5")  # -> Equality, Inequality
cset = CreateSet(List=flatten(lng_14))  # -> Set, Map
offsrf_2 = OffsetSurface(Surface=bang.Branch0, Distance=number_slider_33, BothSides=0, CreateSolid=True)
trim_8 = TrimTree(Tree=rectangle_10.Rectangle, Depth=1)
bbox_2 = BoundingBox(Content=trim_8, Plane=PlaneXY(0, 0, 0), UnionBox=True)  # -> flatten(Box), Box_2
cull_9 = CullPattern(List=ColourSwatch(SwatchColor=RGB(250, 116, 82)), CullPattern=equals.Equality)
cull_10 = CullPattern(List=ColourSwatch(SwatchColor=RGB(250, 165, 90)), CullPattern=equals.Inequality)
entwine_4 = Entwine(Branch00=offsrf_2, Branch01=offsrf, FlattenInputs=True)  # -> graft(Result)
group_3 = Group(Objects=trim_8)  # -> flatten(Group)
merge_32 = Merge(Data1=cull_9, Data2=cull_10)  # -> simplify(Result)
debox_2 = DeconstructBox(Box=bbox_2.Box)  # -> Plane, X, Y, Z
dedomain_16 = DeconstructDomain(Domain=debox_2.X)  # -> Start, End
python = GhPythonScript(x=trim_breps)  # -> out, a
# ---------- python: Python ----------
x.CalculateCenterOfGravity()
a = x.Centroid
# ---------- end python ----------
preview = CustomPreview(Geometry=entwine_4, Material=merge_32)
neg_3 = Negative(Value=dedomain_16.Start)
lng_15 = ListLength(List=group_3)
X_3 = UnitX(Factor=neg_3)
series_4 = Series(Start=number_slider_34, Step=number_slider_34, Count=lng_15)  # -> simplify(Series)
move_6 = Move(Geometry=group_3, Motion=X_3)  # -> Geometry, Transform
X_4 = UnitX(Factor=series_4)
dec_stock_board_2 = DeconstructStockBoard(StockBoard=dec_active_board_2.StockBoard)  # -> Name, Species, RTAngle, Length, Width, ActiveBoards
move_7 = Move(Geometry=move_6.Geometry, Motion=X_4)  # -> Geometry, Transform
ungroup_3 = Ungroup(Group=move_7.Geometry)
dec_secies_2 = DeconstructSpecies(Species=dec_stock_board_2.Species)
trim_9 = TrimTree(Tree=simplify(dec_secies_2), Depth=1)
chars_2 = Characters(Text=trim_9)  # -> Result, Unicode
lng_16 = ListLength(List=chars_2.Result)
equals_2 = Equality(FirstNumber=lng_16, SecondNumber="5")  # -> Equality, Inequality
cull_11 = CullPattern(List=ColourSwatch(SwatchColor=RGB(250, 116, 82)), CullPattern=equals_2.Equality)
cull_12 = CullPattern(List=ColourSwatch(SwatchColor=RGB(250, 165, 90)), CullPattern=equals_2.Inequality)
merge_33 = Merge(Data1=cull_11, Data2=cull_12)  # -> simplify(Result)
trim_10 = TrimTree(Tree=merge_33, Depth=1)
boundary_2 = BoundarySurfaces(Edges=ungroup_3)
area_5 = Area(Geometry=boundary_2)  # -> Area, Centroid
preview_2 = CustomPreview(Geometry=boundary_2, Material=trim_10)
trim_11 = TrimTree(Tree=simplify(dec_stock_board_2.Name), Depth=1)
tag = TextTag3D(
    Location=area_5.Centroid,
    Text=trim_11,
    Size=Slider(54, range=0..100),
    Colour=ColourSwatch(SwatchColor=RGB(0, 0, 0)),
    Justification=5)
