# Grasshopper definition BilayerDesign - Rebuild.gh (Grasshopper 1.0.7)
# plug-ins: HygroDesign, Pufferfish, treesloth01

number_slider = Slider(1000, range=0..1000)
neg = Negative(Value=number_slider)
rectangle = Rectangle(Plane=PlaneXY(0, 0, 0), XSize=number_slider, YSize=neg, Radius=0)  # -> Rectangle, Length
drec = DeconstuctRectangle(Rectangle=rectangle.Rectangle)  # -> BasePlane, XInterval, YInterval
dedomain = DeconstructDomain(Domain=drec.XInterval)  # -> Start, End
dedomain_2 = DeconstructDomain(Domain=drec.YInterval)  # -> Start, End
pt = ConstructPoint(XCoordinate=dedomain.Start, YCoordinate=0, ZCoordinate=0)
pt_2 = ConstructPoint(XCoordinate=dedomain.End, YCoordinate=0, ZCoordinate=0)
subtraction = Subtraction(A=dedomain_2.End, B=dedomain_2.Start)
ln = Line(StartPoint=pt, EndPoint=pt_2)
divide = DivideCurve(Curve=ln, Count=expr("x-1", Slider(3, range=0..10)), Kinks=False)  # -> Points, Tangents, Parameters
multiplication = Multiplication(A=subtraction, B=Slider(0.545, range=0.5..1))
multiplication_2 = Multiplication(A=subtraction, B=Slider(0.486, range=0..0.5))
multiplication_3 = Multiplication(A=subtraction, B=Slider(0.937, range=0.5..1))
multiplication_4 = Multiplication(A=subtraction, B=Slider(0.115, range=0..1))
multiplication_5 = Multiplication(A=subtraction, B=Slider(1, range=0.5..1))
multiplication_6 = Multiplication(A=subtraction, B=Slider(0.338, range=0..0.5))
multiplication_7 = Multiplication(A=subtraction, B=Slider(0.56, range=0.5..1))
multiplication_8 = Multiplication(A=subtraction, B=Slider(0.481, range=0..0.5))
neg_2 = Negative(Value=multiplication_2)
neg_3 = Negative(Value=multiplication)
neg_4 = Negative(Value=multiplication_4)
neg_5 = Negative(Value=multiplication_3)
neg_6 = Negative(Value=multiplication_6)
neg_7 = Negative(Value=multiplication_5)
neg_8 = Negative(Value=multiplication_8)
neg_9 = Negative(Value=multiplication_7)
item = ListItem(List=divide.Points, Index=0, Wrap=True)  # -> Item, Item1, Item2
Y = UnitY(Factor=neg_2)
Y_2 = UnitY(Factor=neg_4)
Y_3 = UnitY(Factor=neg_3)
Y_4 = UnitY(Factor=neg_5)
Y_5 = UnitY(Factor=neg_6)
Y_6 = UnitY(Factor=neg_7)
Y_7 = UnitY(Factor=neg_8)
Y_8 = UnitY(Factor=neg_9)
move = Move(Geometry=[item.Item, item.Item2], Motion=Y)  # -> Geometry, Transform
move_2 = Move(Geometry=item.Item1, Motion=Y_3)  # -> Geometry, Transform
move_3 = Move(Geometry=[item.Item, item.Item2], Motion=Y_2)  # -> Geometry, Transform
move_4 = Move(Geometry=item.Item1, Motion=Y_4)  # -> Geometry, Transform
move_5 = Move(Geometry=[item.Item, item.Item2], Motion=Y_5)  # -> Geometry, Transform
move_6 = Move(Geometry=item.Item1, Motion=Y_6)  # -> Geometry, Transform
move_7 = Move(Geometry=[item.Item, item.Item2], Motion=Y_7)  # -> Geometry, Transform
move_8 = Move(Geometry=item.Item1, Motion=Y_8)  # -> Geometry, Transform
item_2 = ListItem(List=move.Geometry, Index=0, Wrap=True)  # -> Item, Item1
item_3 = ListItem(List=move_3.Geometry, Index=0, Wrap=True)  # -> Item, Item1
item_4 = ListItem(List=move_5.Geometry, Index=0, Wrap=True)  # -> Item, Item1
item_5 = ListItem(List=move_7.Geometry, Index=0, Wrap=True)  # -> Item, Item1
merge = Merge(Data1=flatten(item_2.Item), Data2=flatten(move_2.Geometry), Data3=flatten(item_2.Item1))
merge_2 = Merge(Data1=flatten(item_3.Item), Data2=flatten(move_4.Geometry), Data3=flatten(item_3.Item1))
merge_3 = Merge(Data1=flatten(item_4.Item), Data2=flatten(move_6.Geometry), Data3=flatten(item_4.Item1))
merge_4 = Merge(Data1=flatten(item_5.Item), Data2=flatten(move_8.Geometry), Data3=flatten(item_5.Item1))
intcrv = Interpolate(Vertices=merge, Degree=3, Periodic=False, KnotStyle=1)  # -> Curve, Length, Domain
intcrv_2 = Interpolate(Vertices=merge_2, Degree=3, Periodic=False, KnotStyle=1)  # -> Curve, Length, Domain
intcrv_3 = Interpolate(Vertices=merge_3, Degree=3, Periodic=False, KnotStyle=1)  # -> Curve, Length, Domain
intcrv_4 = Interpolate(Vertices=merge_4, Degree=3, Periodic=False, KnotStyle=1)  # -> Curve, Length, Domain
merge_5 = Merge(Data1=intcrv.Curve, Data2=intcrv_2.Curve, Data3=intcrv_3.Curve, Data4=intcrv_4.Curve)
rec = Rectangle(rectangle.Rectangle)

number_slider_2 = Slider(150, range=0..1000)

# ---- group: spruce
panel = Panel("spruce")
number_slider_3 = Slider(0.0001, range=0..0.0001)
number_slider_4 = Slider(0.0019, range=0..1)
number_slider_5 = Slider(0.0036, range=0..1)
number_slider_6 = Slider(10000, range=0..20000)
number_slider_7 = Slider(450, range=0..20000)
number_slider_8 = Slider(800, range=0..20000)
number_slider_9 = Slider(400, range=0..1000)

# ---- group: beech
panel_2 = Panel("beech")
number_slider_10 = Slider(0.0001, range=0..0.0001)
number_slider_11 = Slider(0.002, range=0..1)
number_slider_12 = Slider(0.0041, range=0..1)
number_slider_13 = Slider(14000, range=0..20000)
number_slider_14 = Slider(2280, range=0..20000)
number_slider_15 = Slider(1160, range=0..20000)
number_slider_16 = Slider(720, range=0..1000)

# ----
number_slider_17 = Slider(20, range=0..100)
spruce_count = Slider(160, range=0..500)
beech_count = Slider(50, range=0..500)
num = Number(number_slider_2)
num_2 = Number(number_slider_17)
species = WoodSpecies(
    name=panel_2,
    density=number_slider_16,
    LExp=number_slider_10,
    RExp=number_slider_11,
    TExp=number_slider_12,
    LEmod=number_slider_13,
    REmod=number_slider_14,
    TEmod=number_slider_15)
species_2 = WoodSpecies(
    name=panel,
    density=number_slider_9,
    LExp=number_slider_3,
    RExp=number_slider_4,
    TExp=number_slider_5,
    LEmod=number_slider_6,
    REmod=number_slider_8,
    TEmod=number_slider_7)
panel_3 = Panel(HMaxelLength=Slider(250, range=0..1000), HMaxelWidth=num, LengthCount=num_2, WidthCount=Slider(13, range=0..100))
dec_pan = DeconstructPanel(Panel=panel_3)  # -> Bilayers, graft(HMaxels), LengthRange, WidthRange

number_slider_18 = Slider(1000, range=0..1000)
rectangle_2 = Rectangle(Plane=PlaneXY(0, 0, 0), XSize=number_slider_18, YSize=number_slider_18, Radius=0)  # -> Rectangle, Length
drec_2 = DeconstuctRectangle(Rectangle=rectangle_2.Rectangle)  # -> BasePlane, XInterval, YInterval
dedomain_3 = DeconstructDomain(Domain=drec_2.YInterval)  # -> Start, End
subtraction_2 = Subtraction(A=dedomain_3.End, B=dedomain_3.Start)
division = Division(A=subtraction_2, B=2)
dom = ConstructDomain(DomainStart=0, DomainEnd=1)
addition = Addition(A=dedomain_3.Start, B=division)
number_slider_19 = Slider(0.412, range=0..1)
dom_2 = ConstructDomain(DomainStart=addition, DomainEnd=dedomain_3.End)
dom_3 = ConstructDomain(DomainStart=addition, DomainEnd=dedomain_3.Start)
remap = RemapNumbers(Value=number_slider_19, Source=dom, Target=dom_3)  # -> Mapped, Clipped
remap_2 = RemapNumbers(Value=Slider(0.997, range=0..1), Source=dom, Target=drec_2.XInterval)  # -> Mapped, Clipped
remap_3 = RemapNumbers(Value=number_slider_19, Source=dom, Target=dom_2)  # -> Mapped, Clipped
remap_4 = RemapNumbers(Value=Slider(0.857, range=0..1), Source=dom, Target=drec_2.XInterval)  # -> Mapped, Clipped
pt_3 = ConstructPoint(XCoordinate=0, YCoordinate=remap_2.Mapped, ZCoordinate=0)
pt_4 = ConstructPoint(XCoordinate=remap.Mapped, YCoordinate=remap_4.Mapped, ZCoordinate=0)
pt_5 = ConstructPoint(XCoordinate=remap_3.Mapped, YCoordinate=remap_4.Mapped, ZCoordinate=0)
pt_6 = ConstructPoint(XCoordinate=number_slider_18, YCoordinate=remap_2.Mapped, ZCoordinate=0)
merge_6 = Merge(Data1=pt_3, Data2=pt_4, Data3=pt_5, Data4=pt_6)
nurbs = NurbsCurve(Vertices=merge_6, Degree=2, Periodic=False)  # -> Curve, Length, Domain

number_slider_20 = Slider(1000, range=0..1000)
rectangle_3 = Rectangle(Plane=PlaneXY(0, 0, 0), XSize=number_slider_20, YSize=number_slider_20, Radius=0)  # -> Rectangle, Length
drec_3 = DeconstuctRectangle(Rectangle=rectangle_3.Rectangle)  # -> BasePlane, XInterval, YInterval
dedomain_4 = DeconstructDomain(Domain=drec_3.YInterval)  # -> Start, End
subtraction_3 = Subtraction(A=dedomain_4.End, B=dedomain_4.Start)
division_2 = Division(A=subtraction_3, B=2)
dom_4 = ConstructDomain(DomainStart=0, DomainEnd=1)
addition_2 = Addition(A=dedomain_4.Start, B=division_2)
number_slider_21 = Slider(0.77, range=0..1)
dom_5 = ConstructDomain(DomainStart=addition_2, DomainEnd=dedomain_4.End)
dom_6 = ConstructDomain(DomainStart=addition_2, DomainEnd=dedomain_4.Start)
remap_5 = RemapNumbers(Value=number_slider_21, Source=dom_4, Target=dom_6)  # -> Mapped, Clipped
remap_6 = RemapNumbers(Value=Slider(0.945, range=0..1), Source=dom_4, Target=drec_3.XInterval)  # -> Mapped, Clipped
remap_7 = RemapNumbers(Value=number_slider_21, Source=dom_4, Target=dom_5)  # -> Mapped, Clipped
remap_8 = RemapNumbers(Value=Slider(0.046, range=0..1), Source=dom_4, Target=drec_3.XInterval)  # -> Mapped, Clipped
pt_7 = ConstructPoint(XCoordinate=0, YCoordinate=remap_6.Mapped, ZCoordinate=0)
pt_8 = ConstructPoint(XCoordinate=remap_5.Mapped, YCoordinate=remap_8.Mapped, ZCoordinate=0)
pt_9 = ConstructPoint(XCoordinate=remap_7.Mapped, YCoordinate=remap_8.Mapped, ZCoordinate=0)
pt_10 = ConstructPoint(XCoordinate=number_slider_20, YCoordinate=remap_6.Mapped, ZCoordinate=0)
merge_7 = Merge(Data1=pt_7, Data2=pt_8, Data3=pt_9, Data4=pt_10)
nurbs_2 = NurbsCurve(Vertices=merge_7, Degree=2, Periodic=False)  # -> Curve, Length, Domain

number_slider_22 = Slider(1000, range=0..1000)
rectangle_4 = Rectangle(Plane=PlaneXY(0, 0, 0), XSize=number_slider_22, YSize=number_slider_22, Radius=0)  # -> Rectangle, Length
drec_4 = DeconstuctRectangle(Rectangle=rectangle_4.Rectangle)  # -> BasePlane, XInterval, YInterval
dedomain_5 = DeconstructDomain(Domain=drec_4.YInterval)  # -> Start, End
subtraction_4 = Subtraction(A=dedomain_5.End, B=dedomain_5.Start)
division_3 = Division(A=subtraction_4, B=2)
dom_7 = ConstructDomain(DomainStart=0, DomainEnd=1)
addition_3 = Addition(A=dedomain_5.Start, B=division_3)
number_slider_23 = Slider(0.852, range=0..1)
dom_8 = ConstructDomain(DomainStart=addition_3, DomainEnd=dedomain_5.End)
dom_9 = ConstructDomain(DomainStart=addition_3, DomainEnd=dedomain_5.Start)
remap_9 = RemapNumbers(Value=number_slider_23, Source=dom_7, Target=dom_9)  # -> Mapped, Clipped
remap_10 = RemapNumbers(Value=Slider(0.014, range=0..1), Source=dom_7, Target=drec_4.XInterval)  # -> Mapped, Clipped
remap_11 = RemapNumbers(Value=number_slider_23, Source=dom_7, Target=dom_8)  # -> Mapped, Clipped
remap_12 = RemapNumbers(Value=Slider(0.781, range=0..1), Source=dom_7, Target=drec_4.XInterval)  # -> Mapped, Clipped
pt_11 = ConstructPoint(XCoordinate=0, YCoordinate=remap_10.Mapped, ZCoordinate=0)
pt_12 = ConstructPoint(XCoordinate=remap_9.Mapped, YCoordinate=remap_12.Mapped, ZCoordinate=0)
pt_13 = ConstructPoint(XCoordinate=remap_11.Mapped, YCoordinate=remap_12.Mapped, ZCoordinate=0)
pt_14 = ConstructPoint(XCoordinate=number_slider_22, YCoordinate=remap_10.Mapped, ZCoordinate=0)
merge_8 = Merge(Data1=pt_11, Data2=pt_12, Data3=pt_13, Data4=pt_14)
nurbs_3 = NurbsCurve(Vertices=merge_8, Degree=2, Periodic=False)  # -> Curve, Length, Domain

# ---- group: name
num_3 = Number(spruce_count)
series = Series(Start=0, Step=1, Count=num_3)
dup = DuplicateData(Data="S", Number=num_3, Order=True)  # -> graft(Data)
txt = Text(graft(series))
merge_9 = Merge(Data1=dup, Data2=txt)  # -> simplify(Result)
join = TextJoin(Text=merge_9)  # -> flatten(Result)

num_4 = Number(beech_count)
series_2 = Series(Start=0, Step=1, Count=num_4)
dup_2 = DuplicateData(Data="B", Number=num_4, Order=True)  # -> graft(Data)
txt_2 = Text(graft(series_2))
merge_10 = Merge(Data1=dup_2, Data2=txt_2)  # -> simplify(Result)
join_2 = TextJoin(Text=merge_10)  # -> flatten(Result)

# ---- group: active thickness
number_slider_24 = Slider(20, range=0..100)

# ---- group: RT
dom_10 = ConstructDomain(DomainStart=Slider(15, range=0..100), DomainEnd=Slider(75, range=0..100))
random = Random(Range=dom_10, Number=spruce_count, Seed=Slider(225, range=0..1000))

dom_11 = ConstructDomain(DomainStart=Slider(15, range=0..100), DomainEnd=Slider(75, range=0..100))
random_2 = Random(Range=dom_11, Number=beech_count, Seed=Slider(225, range=0..1000))

# ---- group: beech
data = Data(species)

# ---- group: spruce
data_2 = Data(species_2)

# ----
panel_4 = Panel("C:\Users\Alex Reiner\Documents\GitHub\HygroDesign\Grasshopper")
panel_5 = Panel("C:\Users\Alex Reiner\Documents\GitHub\HygroDesign\Grasshopper")
num_5 = Number(number_slider_2)

# ---- group: spruce
data_3 = Data(data_2)
num_6 = Number(spruce_count)
dup_3 = DuplicateData(Data=data_3, Number=num_6, Order=True)

# ---- group: beech
num_7 = Number(beech_count)
data_4 = Data(data)
dup_4 = DuplicateData(Data=data_4, Number=num_7, Order=True)

# ---- group: thickness
num_8 = Number(number_slider_24)
num_9 = Number(spruce_count)
dup_5 = DuplicateData(Data=num_8, Number=num_9, Order=True)

# ---- group: length
num_10 = Number("1000")
num_11 = Number(beech_count)
dup_6 = DuplicateData(Data=num_10, Number=num_11, Order=True)

num_12 = Number("2500")
num_13 = Number(spruce_count)
dup_7 = DuplicateData(Data=num_12, Number=num_13, Order=True)

# ---- group: width
num_14 = Number(num_5)
num_15 = Number(spruce_count)
dup_8 = DuplicateData(Data=num_14, Number=num_15, Order=True)

# ---- group: thickness
num_16 = Number(number_slider_24)
num_17 = Number(beech_count)
dup_9 = DuplicateData(Data=num_16, Number=num_17, Order=True)

# ---- group: width
num_18 = Number(num_5)
num_19 = Number(beech_count)
dup_10 = DuplicateData(Data=num_18, Number=num_19, Order=True)

# ----
num_20 = Number(spruce_count)
num_21 = Number(beech_count)
dup_11 = DuplicateData(Data=panel_4, Number=num_20, Order=True)
dup_12 = DuplicateData(Data=panel_5, Number=num_21, Order=True)
entwine = Entwine(Branch00=join_2, Branch01=join, FlattenInputs=True)  # -> flatten(Result)
entwine_2 = Entwine(Branch00=random_2, Branch01=random, FlattenInputs=True)  # -> flatten(Result)
entwine_3 = Entwine(Branch00=dup_4, Branch01=dup_3, FlattenInputs=True)  # -> flatten(Result)
entwine_4 = Entwine(Branch00=dup_6, Branch01=dup_7, FlattenInputs=True)  # -> flatten(Result)
entwine_5 = Entwine(Branch00=dup_9, Branch01=dup_5, FlattenInputs=True)  # -> flatten(Result)
entwine_6 = Entwine(Branch00=dup_10, Branch01=dup_8, FlattenInputs=True)  # -> flatten(Result)
entwine_7 = Entwine(Branch00=dup_12, Branch01=dup_11, FlattenInputs=True)  # -> flatten(Result)
stock_boards = StockBoards(
    Name=entwine,
    Species=entwine_3,
    Thickness=entwine_5,
    Length=entwine_4,
    Width=entwine_6,
    RTAngle=entwine_2,
    ImgPath=entwine_7)

merge_11 = Merge(Data1=nurbs.Curve, Data2=nurbs_2.Curve, Data3=nurbs_3.Curve)
crv = Curve(merge_11)
lng = ListLength(List=crv)  # -> expr("x-2", Length)
dom_12 = ConstructDomain(DomainStart=0, DomainEnd=lng)
subset = SubList(List=crv, Domain=dom_12, Wrap=True)  # -> graft(List), Index
shift = ShiftList(List=crv, Shift=1, Wrap=False)  # -> graft(List)
merge_12 = Merge(Data1=subset.List, Data2=shift)  # -> simplify(Result)
group = Group(Objects=merge_12)  # -> flatten(Group)

crv_2 = Curve(merge_5)
lng_2 = ListLength(List=crv_2)  # -> expr("x-2", Length)
dom_13 = ConstructDomain(DomainStart=0, DomainEnd=lng_2)
subset_2 = SubList(List=crv_2, Domain=dom_13, Wrap=True)  # -> graft(List), Index
shift_2 = ShiftList(List=crv_2, Shift=1, Wrap=False)  # -> graft(List)
merge_13 = Merge(Data1=subset_2.List, Data2=shift_2)  # -> simplify(Result)
group_2 = Group(Objects=merge_13)  # -> flatten(Group)

data_5 = Data(dec_pan.HMaxels)
dec_hmaxel = DeconstructHMaxel(HMaxel=data_5)  # -> PassiveLayers, ActiveBoards, Height, RowRange, ColumnRange, DesiredRadius, BlendedRadius, ShapedHMaxel
rectangle_5 = Rectangle(Plane=PlaneXY(0, 0, 0), XSize=dec_hmaxel.RowRange, YSize=dec_hmaxel.ColumnRange, Radius=0)  # -> Rectangle, Length
area = Area(Geometry=rectangle_5.Rectangle)  # -> Area, Centroid

num_22 = Number(dec_pan.WidthRange)
num_23 = Number(dec_pan.LengthRange)
dedomain_6 = DeconstructDomain(Domain=num_22)  # -> Start, End
subtraction_5 = Subtraction(A=dedomain_6.End, B=dedomain_6.Start)
division_4 = Division(A=subtraction_5, B=2)
number_slider_25 = Slider(1, range=0..1)
addition_4 = Addition(A=dedomain_6.Start, B=division_4)
dom_14 = ConstructDomain(DomainStart=0, DomainEnd=1)
dom_15 = ConstructDomain(DomainStart=addition_4, DomainEnd=dedomain_6.End)
dom_16 = ConstructDomain(DomainStart=addition_4, DomainEnd=dedomain_6.Start)
remap_13 = RemapNumbers(Value=Slider(1, range=0.25..1), Source=dom_14, Target=num_23)  # -> Mapped, Clipped
remap_14 = RemapNumbers(Value=Slider(0, range=0..0.75), Source=dom_14, Target=num_23)  # -> Mapped, Clipped
remap_15 = RemapNumbers(Value=number_slider_25, Source=dom_14, Target=dom_16)  # -> Mapped, Clipped
remap_16 = RemapNumbers(Value=number_slider_25, Source=dom_14, Target=dom_15)  # -> Mapped, Clipped
pt_15 = ConstructPoint(XCoordinate=remap_13.Mapped, YCoordinate=dedomain_6.Start, ZCoordinate=0)
pt_16 = ConstructPoint(XCoordinate=remap_14.Mapped, YCoordinate=remap_15.Mapped, ZCoordinate=0)
pt_17 = ConstructPoint(XCoordinate=remap_14.Mapped, YCoordinate=remap_16.Mapped, ZCoordinate=0)
pt_18 = ConstructPoint(XCoordinate=remap_13.Mapped, YCoordinate=dedomain_6.End, ZCoordinate=0)
merge_14 = Merge(Data1=pt_15, Data2=pt_16, Data3=pt_17, Data4=pt_18)
nurbs_4 = NurbsCurve(Vertices=merge_14, Degree=2, Periodic=False)  # -> Curve, Length, Domain

# ---- group: generate distribution
pt_19 = Point(simplify(area.Centroid))
data_6 = Data(group)
pdecon = Deconstruct(Point=pt_19)  # -> XComponent, YComponent, ZComponent
bnd = Bounds(Numbers=flatten(pdecon.XComponent))
bnd_2 = Bounds(Numbers=flatten(pdecon.YComponent))
lng_3 = ListLength(List=data_6)
dedomain_7 = DeconstructDomain(Domain=bnd)  # -> Start, End
remap_17 = RemapNumbers(Value=pdecon.YComponent, Source=bnd_2, Target=Domain(0, 1))  # -> graft(Mapped), Clipped
c_script = CSharpScript(count=lng_3, start=dedomain_7.Start, end=dedomain_7.End)  # -> out, A; inputs count: Int32, start: Double, end: Double
# ---------- c_script: C# ----------
    double totalLength = end - start;
    double domLength = totalLength / (double) count;

    List<Interval> intervals = new List<Interval>();
    double currentStart = start;
    for(int i = 0; i < count; i++)
    {
      intervals.Add(new Interval(currentStart, currentStart + domLength));
      currentStart += domLength;
    }
    A = intervals;
# ---------- end c_script ----------
num_24 = Number(graft(pdecon.XComponent))
inc = Includes(Value=num_24, Domain=simplify(c_script.A))  # -> Includes, Deviation
cull = CullPattern(List=data_6, CullPattern=inc.Includes)
item_6 = ListItem(List=cull, Index=0, Wrap=True)
cull_2 = CullPattern(List=c_script.A, CullPattern=inc.Includes)
ungroup = Ungroup(Group=item_6)  # -> simplify(Objects)
item_7 = ListItem(List=cull_2, Index=0, Wrap=True)
remap_18 = RemapNumbers(Value=num_24, Source=item_7, Target=Domain(0, 1))  # -> Mapped, Clipped
eval = EvaluateCurve(Curve=reparameterize(ungroup), Parameter=remap_17.Mapped)  # -> Point, Tangent, Angle
pdecon_2 = Deconstruct(Point=eval.Point)  # -> XComponent, YComponent, ZComponent
item_8 = ListItem(List=pdecon_2.YComponent, Index=0, Wrap=True)  # -> Item, Item1
twn2nums = TweenTwoNumbers(NumberA=item_8.Item, NumberB=item_8.Item1, Factor=remap_18.Mapped)
num_25 = Number(twn2nums)

pt_20 = Point(simplify(area.Centroid))
data_7 = Data(group_2)
pdecon_3 = Deconstruct(Point=pt_20)  # -> XComponent, YComponent, ZComponent
bnd_3 = Bounds(Numbers=flatten(pdecon_3.XComponent))
bnd_4 = Bounds(Numbers=flatten(pdecon_3.YComponent))
lng_4 = ListLength(List=data_7)
dedomain_8 = DeconstructDomain(Domain=bnd_3)  # -> Start, End
remap_19 = RemapNumbers(Value=pdecon_3.YComponent, Source=bnd_4, Target=Domain(0, 1))  # -> graft(Mapped), Clipped
c_script_2 = CSharpScript(count=lng_4, start=dedomain_8.Start, end=dedomain_8.End)  # -> out, A; inputs count: Int32, start: Double, end: Double; same code as c_script
num_26 = Number(graft(pdecon_3.XComponent))
inc_2 = Includes(Value=num_26, Domain=simplify(c_script_2.A))  # -> Includes, Deviation
cull_3 = CullPattern(List=data_7, CullPattern=inc_2.Includes)
item_9 = ListItem(List=cull_3, Index=0, Wrap=True)
cull_4 = CullPattern(List=c_script_2.A, CullPattern=inc_2.Includes)
ungroup_2 = Ungroup(Group=item_9)  # -> simplify(Objects)
item_10 = ListItem(List=cull_4, Index=0, Wrap=True)
remap_20 = RemapNumbers(Value=num_26, Source=item_10, Target=Domain(0, 1))  # -> Mapped, Clipped
eval_2 = EvaluateCurve(Curve=reparameterize(ungroup_2), Parameter=remap_19.Mapped)  # -> Point, Tangent, Angle
pdecon_4 = Deconstruct(Point=eval_2.Point)  # -> XComponent, YComponent, ZComponent
item_11 = ListItem(List=pdecon_4.YComponent, Index=0, Wrap=True)  # -> Item, Item1
twn2nums_2 = TweenTwoNumbers(NumberA=item_11.Item, NumberB=item_11.Item1, Factor=remap_20.Mapped)
num_27 = Number(twn2nums_2)

# ---- group: material / beech
data_8 = Data(species)

# ---- group: material / Species
crv_3 = Curve(nurbs_4.Curve)

# ---- group: material / spruce
data_9 = Data(species_2)

# ---- group: material
pt_21 = Point(graft(area.Centroid))
xz = XZPlane(Origin=pt_21)
pcx = CurvePlane(Curve=crv_3, Plane=xz)  # -> simplify(Points), ParamsC, ParamsP
pdecon_5 = Deconstruct(Point=pcx.Points)  # -> XComponent, YComponent, ZComponent
pdecon_6 = Deconstruct(Point=pt_21)  # -> XComponent, YComponent, ZComponent
smaller = SmallerThan(FirstNumber=pdecon_5.XComponent, SecondNumber=pdecon_6.XComponent)  # -> SmallerThan, OrEqualTo
not = GateNot(A=smaller.SmallerThan)
cull_5 = CullPattern(List=data_8, CullPattern=not)
cull_6 = CullPattern(List=data_9, CullPattern=smaller.SmallerThan)
merge_15 = Merge(Data1=cull_5, Data2=cull_6)  # -> simplify(Result)
dup_13 = DuplicateData(Data=merge_15, Number="2", Order=True)  # -> simplify(Data)

# ----
num_28 = Number(num_25)
rec_2 = Rectangle(rectangle_2.Rectangle)
drec_5 = DeconstuctRectangle(Rectangle=rec_2)  # -> BasePlane, XInterval, YInterval
dom_17 = ConstructDomain(DomainStart=Slider(25, range=0..100), DomainEnd=Slider(75, range=0..100))
remap_21 = RemapNumbers(Value=num_28, Source=drec_5.YInterval, Target=dom_17)  # -> Mapped, Clipped
trim = TrimTree(Tree=remap_21.Mapped, Depth=1)

num_29 = Number(num_27)
rec_3 = Rectangle(rec)
drec_6 = DeconstuctRectangle(Rectangle=rec_3)  # -> BasePlane, XInterval, YInterval
dom_18 = ConstructDomain(DomainStart=0, DomainEnd=1)
remap_22 = RemapNumbers(Value=num_29, Source=drec_6.YInterval, Target=dom_18)  # -> Mapped, Clipped
trim_2 = TrimTree(Tree=remap_22.Mapped, Depth=1)

data_10 = Data(panel_3)
data_11 = Data(species_2)
data_12 = Data(dec_pan.HMaxels)

data_13 = Data(data_10)
panel_6 = Panel("""0
1""")
data_14 = Data(data_11)
bilayer = ConstructBilayer(
    Panel=data_13,
    BoardLength=Slider(4, range=0..10),
    RowOffsets=panel_6,
    PassiveSpecies=data_14,
    ActiveThickness=Slider(20, range=0..100),
    PassiveThickness=Slider(4, range=0..10))

data_15 = Data(data_10)
panel_7 = Panel("""2
3""")
data_16 = Data(data_11)
bilayer_2 = ConstructBilayer(
    Panel=data_15,
    BoardLength=Slider(4, range=0..10),
    RowOffsets=panel_7,
    PassiveSpecies=data_16,
    ActiveThickness=Slider(20, range=0..100),
    PassiveThickness=Slider(4, range=0..10))

up_hmaxel = UpdateHMaxel(HMaxel=simplify(data_12), Height=simplify(trim), RadiusFactor=simplify(trim_2), Species=simplify(dup_13))  # -> flatten(HMaxel)
merge_16 = Merge(Data1=bilayer, Data2=bilayer_2)
data_17 = Data(panel_3)
up_pan = UpdatePanel(Panel=data_17, Bilayers=merge_16, HMaxels=up_hmaxel)

panel_8 = Panel("""10
3""")
data_18 = Data(up_pan)
data_19 = Data(stock_boards)
c_script_3 = CSharpScript(Reference="C:\Users\Alex Reiner\AppData\Roaming\Grasshopper\Libraries\HygroDesign.Core.dll")  # -> out, A
# ---------- c_script_3: C# usings ----------
using BilayerDesign;
# ---------- c_script_3: C# ----------
    TimoshenkoPrediction timo = new TimoshenkoPrediction();
    A = timo;
# ---------- c_script_3: C# additional code ----------
  public class TimoshenkoPrediction : PredictionEngine
  {

    public TimoshenkoPrediction()
    {
    }

    public override double Predict(StockBoard board, Bilayer bilayer, double moistureChange)
    {
      double h1 = bilayer.PassiveLayer.Thickness;
      double h2 = bilayer.ActiveLayer.Thickness;
      double h = h1 + h2;
      double m = h1 / h2;
      double e1 = bilayer.PassiveLayer.Species.Attributes["LEmod"];
      double e2 = GrainAngleInterpolation(board.RTAngle, board.Species.Attributes["REmod"], board.Species.Attributes["TEmod"]);
      double n = e1 / e2;
      double a1 = bilayer.PassiveLayer.Species.Attributes["LExp"];
      double a2 = GrainAngleInterpolation(board.RTAngle, board.Species.Attributes["RExp"], board.Species.Attributes["TExp"]);
      double deltaAlpha = a2 - a1;
      double kValue = 6 * Math.Pow(1.0 + m, 2) / (3 * Math.Pow(1 + m, 2) + (1 + m * n) * Math.Pow(m, 2) + (1 / (m * n)));
      double curvature = kValue * ((moistureChange * deltaAlpha) / h);
      return 1 / (curvature /* * TimError*/ );
    }

    public static double GrainAngleInterpolation(double rtAngle, double eR, double eT)
    {
      double angleConv = RhinoMath.ToRadians(rtAngle);
      double angleT = Math.Cos(angleConv);
      double angleR = Math.Sin(angleConv);
      double eActive = eT * Math.Pow(angleT, 2) + eR * Math.Pow(angleR, 2);
      return eActive;
    }
  }
# ---------- end c_script_3 ----------
stockpile = ConstructStockPile(Panels=data_18, StockBoards=data_19, MoistureChanges=panel_8, PredictionEngine=c_script_3.A)
sel_env = ConstructSelectionEnvironment(Panels=data_18, StockPile=stockpile)

# ---- group: convolution
c_script_4 = CSharpScript(
    tan=Slider(1, range=0.01..3),
    lon=Slider(0.5, range=0.01..3),
    rad=Slider(10000, range=0..10000),
    stiff=Slider(0.75, range=0.01..3),
    thick=Slider(0.04, range=0.01..3),
    Reference="C:\Users\Alex Reiner\AppData\Roaming\Grasshopper\Libraries\HygroDesign.Core.dll")  # -> out, A; inputs tan: Double, lon: Double, rad: Double, stiff: Double, thick: Double
# ---------- c_script_4: C# ----------
    HMaxelConvolution convEngine = new HMaxelConvolution(tan, lon, rad, stiff, thick);
    A = convEngine;
# ---------- c_script_4: C# additional code ----------
  public class HMaxelConvolution : ConvolutionEngine
  {
    public double Tangential { get; set; }
    public double Longitudinal { get; set; }
    public double RadiusMax { get; set; }
    public double StiffnessInfluence { get; set; }
    public double ThicknessInfluence { get; set; }
    public HMaxelConvolution(double tangential, double longitudinal, double radiusMax, double stiffnessInfluence, double thicknessInfluence)
    {
      Tangential = tangential;
      Longitudinal = longitudinal;
      RadiusMax = radiusMax;
      StiffnessInfluence = stiffnessInfluence;
      ThicknessInfluence = thicknessInfluence;
    }

    public override Panel Convolution(Panel panel)
    {
      double MaxRad = double.MinValue;
      double MinRad = double.MaxValue;

      double MaxRStiff = double.MinValue;
      double MinRStiff = double.MaxValue;
      double MaxLStiff = double.MinValue;
      double MinLStiff = double.MaxValue;

      for (int i = 0; i < panel.HMaxels.GetLength(0); i++)
      {
        for (int j = 0; j < panel.HMaxels.GetLength(1); j++)
        {
          double averageRStiffness = 0;
          double averageLStiffness = 0;
          double weightedRadius = 0;
          double totalRWeights = 0;

          HMaxel hmaxel = panel.HMaxels[i, j];
          List<Tuple<double, double>> tuples = new List<Tuple<double, double>>();
          for (int v = 0; v < hmaxel.ActiveBoards.Count; v++)
          {
            averageRStiffness += (double) hmaxel.ActiveBoards[v].StockBoard.Species.Attributes["REmod"];
            averageLStiffness += (double) hmaxel.ActiveBoards[v].StockBoard.Species.Attributes["LEmod"];

            weightedRadius += (hmaxel.ActiveBoards[v].Radius * (double) hmaxel.ActiveBoards[v].StockBoard.Species.Attributes["REmod"]);
            totalRWeights += (double) hmaxel.ActiveBoards[v].StockBoard.Species.Attributes["REmod"];

          }
          averageRStiffness /= hmaxel.ActiveBoards.Count;
          averageLStiffness /= hmaxel.ActiveBoards.Count;
          weightedRadius /= totalRWeights;
          panel.HMaxels[i, j].Attributes.Add("REmod", averageRStiffness);
          panel.HMaxels[i, j].Attributes.Add("LEmod", averageLStiffness);
          panel.HMaxels[i, j].Attributes.Add("weighted radius", weightedRadius);

          if (weightedRadius > MaxRad) MaxRad = weightedRadius;
          if (weightedRadius < MinRad) MinRad = weightedRadius;
          if (averageLStiffness > MaxLStiff) MaxLStiff = averageLStiffness;
          if (averageLStiffness < MinLStiff) MinLStiff = averageLStiffness;
          if (averageRStiffness > MaxRStiff) MaxRStiff = averageRStiffness;
          if (averageRStiffness < MinRStiff) MinRStiff = averageRStiffness;
        }
      }
      //set factors
      for (int i = 0; i < panel.HMaxels.GetLength(0); i++)
      {
        for (int j = 0; j < panel.HMaxels.GetLength(1); j++)
        {
          panel.HMaxels[i, j].Attributes.Add("REmodFactor", Remap((double) panel.HMaxels[i, j].Attributes["REmod"], MinRStiff, MaxRStiff, 1 - StiffnessInfluence, 1));
          panel.HMaxels[i, j].Attributes.Add("LEmodFactor", Remap((double) panel.HMaxels[i, j].Attributes["LEmod"], MinLStiff, MaxLStiff, 1 - StiffnessInfluence, 1));
          panel.HMaxels[i, j].Attributes.Add("RadiusFactor", Remap((double) panel.HMaxels[i, j].Attributes["weighted radius"], MinRad, RadiusMax, 1, 0));

        }
      }

      //horizontal convolution
      for (int i = 0; i < panel.HMaxels.GetLength(0); i++)
      {
        for (int j = 0; j < panel.HMaxels.GetLength(1); j++)
        {
          double totalWeights = 0;
          double blendedRadius = 0;
          for (int x = 0; x < panel.HMaxels.GetLength(0); x++)
          {
            for (int y = 0; y < panel.HMaxels.GetLength(1); y++)
            {

              double xdist = Math.Abs(panel.HMaxels[i, j].X - panel.HMaxels[x, y].X);
              double ydist = Math.Abs(panel.HMaxels[i, j].Y - panel.HMaxels[x, y].Y);
              double LFactor = (double) panel.HMaxels[x, y].Attributes["LEmodFactor"] / Math.Pow(xdist + 1, Longitudinal);
              double RFactor = (double) panel.HMaxels[x, y].Attributes["REmodFactor"] / Math.Pow(ydist + 1, Tangential);
              blendedRadius += (double) panel.HMaxels[x, y].Attributes["weighted radius"] * (double) panel.HMaxels[i, j].Attributes["RadiusFactor"] * LFactor * RFactor;
              totalWeights += (double) panel.HMaxels[x, y].Attributes["RadiusFactor"] * LFactor * RFactor;

            }
          }

          panel.HMaxels[i, j].BlendedRaidus = blendedRadius / totalWeights;

        }
      }
      return panel;
    }
    public static double Remap(double val, double from1, double to1, double from2, double to2)
    {
      return (val - from1) / (to1 - from1) * (to2 - from2) + from2;
    }
  }
# ---------- end c_script_4 ----------
data_20 = Data(sel_env)
rad_blend = RadiusBlending(Panels=data_20, ConvolutionEngine=c_script_4.A)

# ----
num_30 = Number(number_slider_17)
dec_pan_2 = DeconstructPanel(Panel=rad_blend)  # -> Bilayers, HMaxels, LengthRange, WidthRange
dec_hmaxel_2 = DeconstructHMaxel(HMaxel=dec_pan_2.HMaxels)  # -> PassiveLayers, ActiveBoards, Height, RowRange, ColumnRange, DesiredRadius, BlendedRadius, ShapedHMaxel

partition = PartitionList(List=dec_hmaxel_2.BlendedRadius, Size=num_30)  # -> simplify(Chunks)
flip = FlipMatrix(Data=partition)
num_31 = Number(flip)

division_5 = Division(A=num_30, B=Slider(2, range=0..10))

dedomain_9 = DeconstructDomain(Domain=dec_hmaxel_2.RowRange)  # -> Start, End
num_32 = Number(division_5)
bnd_5 = Bounds(Numbers=dedomain_9.Start)
bnd_6 = Bounds(Numbers=dedomain_9.End)
dedomain_10 = DeconstructDomain(Domain=bnd_5)  # -> Start, End
dedomain_11 = DeconstructDomain(Domain=bnd_6)  # -> Start, End
x_minus_one = XMinusOne(NumberX=num_32)
subtraction_6 = Subtraction(A=dedomain_11.End, B=dedomain_10.Start)
division_6 = Division(A=subtraction_6, B=x_minus_one)
series_3 = Series(Start=dedomain_10.Start, Step=division_6, Count=num_32)
pt_22 = ConstructPoint(XCoordinate=series_3, YCoordinate=0, ZCoordinate=0)
yz = YZPlane(Origin=pt_22)  # -> simplify(graft(Plane))

c_script_5 = CSharpScript(x=num_31)  # -> out, A; inputs x: tree
# ---------- c_script_5: C# ----------
    DataTree<object> output1 = new DataTree<object>();

    //if(x.BranchCount != y.BranchCount) Component.AddRuntimeMessage(GH_RuntimeMessageLevel.Error, "Branch counts must be equal.");
    for(int i = 0; i < x.BranchCount; i++)
    {
      if(i % 2 == 0)continue;
      output1.AddRange(x.Branch(i), new GH_Path(i));
    }
    A = output1;
# ---------- end c_script_5 ----------
renumber = RenumberPaths(Data=c_script_5.A)
renumber_2 = RenumberPaths(Data=yz)

num_33 = Number(number_slider_2)
num_34 = Number(renumber)
pln = Plane(renumber_2)
c_script_6 = CSharpScript()  # -> out, A; inputs x: tree
# ---------- c_script_6: C# ----------
    DataTree<object> output = new DataTree<object>();
    int firstIndex = 0;
    int branchCount = 0;
    for(int i = 0; i < x.BranchCount; i++)
    {
      GH_Path path = new GH_Path(firstIndex, branchCount);
      if(x.Paths[i][0] == firstIndex)
      {
        output.AddRange(x.Branch(i), path);
      }
      else
      {
        firstIndex++;
        branchCount = -1;
        i--;
      }
      branchCount++;
    }
    A = output;
# ---------- end c_script_6 ----------
c_script_7 = CSharpScript(iRadii=num_34, iBoardWidth=num_33, iPlanes=pln)  # -> out, simplify(A); inputs iRadii: tree of Double, iBoardWidth: Double, iPlanes: tree of Plane
# ---------- c_script_7: C# ----------
    DataTree<Point3d> pointTree = new DataTree<Point3d>();

    for (int j = 0; j < iRadii.BranchCount; j++)
    {

      //initialize variables
      Plane bp = iPlanes.Branch(j)[0];
      Point3d startPoint = new Point3d(bp.Origin);
      Point3d centerPoint = startPoint;
      Vector3d rotationAxis = new Vector3d(bp.ZAxis);
      Vector3d centerPointVect = new Vector3d(bp.YAxis);
      centerPointVect.Rotate(Math.PI / 2, rotationAxis);

      for (int i = 0; i < iRadii.Branch(j).Count; i++){
        GH_Path pth = iRadii.Paths[j].AppendElement(i);
        Point3d point1 = startPoint;
        Point3d point2 = startPoint;

        pointTree.Add(point1, pth);

        //calculate rotation angle
        Double arcLength = iBoardWidth;
        Double radius = iRadii.Branch(j)[i];
        Double rotation = (arcLength / radius);

        //calculate rotation center point
        centerPointVect.Unitize();
        centerPointVect *= radius;
        centerPoint += centerPointVect;


        //execute half rotation
        Transform tx = Transform.Rotation(rotation / 2, rotationAxis, centerPoint);


        point2.Transform(tx);
        pointTree.Add(point2, pth);

        //execute full rotation
        tx = Transform.Rotation(rotation, rotationAxis, centerPoint);
        startPoint.Transform(tx);
        pointTree.Add(startPoint, pth);

        //updata rotation parameters
        centerPoint = startPoint;
        centerPointVect.Transform(tx);
      }
    }
    A = pointTree;
# ---------- end c_script_7 ----------

trim_3 = TrimTree(Tree=c_script_7.A, Depth=1)
cullpt = CullDuplicates(Points=trim_3, Tolerance=0.1, CullMode=3)  # -> Points, Indices, Valence
pt_23 = Point(cullpt.Points)

# ---- group: animate
pt_24 = Point(simplify(pt_23))
pln_2 = Plane(graft(pln))
num_35 = Number(Slider(1, range=0..1))
c_script_8 = CSharpScript(iPoints=simplify(pt_24), iPlanes=pln_2, iShapeFactor=num_35)  # -> out, A; inputs iPoints: tree of Point3d, iPlanes: tree of Plane, iShapeFactor: Double
# ---------- c_script_8: C# ----------
    DataTree<Point3d> output = new DataTree<Point3d>();
    
    double shapeFactor = 1.0 - iShapeFactor;

    //step through curves
    for (int i = 0; i < iPoints.BranchCount; i++)
    {
      Plane currentPlane = iPlanes.Branch(iPoints.Path(i)[0])[0];

      //get vectors from plane
      Vector3d zVect = currentPlane.YAxis;

      Vector3d rotVect = currentPlane.ZAxis;

      //create new startpoint inside list
      Point3d startPoint = iPoints.Branch(i)[0];

      //step through points. Create and rotate vectors
      for (int j = 0; j < iPoints.Branch(i).Count; j++)
      {
        if (j == 0) output.Add(startPoint, iPoints.Path(i));
        else{
          //create current segment vector
          Vector3d segmentVect = new Vector3d(iPoints.Branch(i)[j] - iPoints.Branch(i)[j - 1]);

          //measure angle with vertical vector
          double angle = Vector3d.VectorAngle(zVect, segmentVect, currentPlane);

          //rotate
          segmentVect.Rotate(-angle * shapeFactor, rotVect);

          startPoint += segmentVect;
          output.Add(startPoint, iPoints.Path(i));
        }
      }
    }

    A = output;
# ---------- end c_script_8 ----------
pt_25 = Point(c_script_8.A)
intcrv_5 = Interpolate(Vertices=pt_25, Degree=3, Periodic=False, KnotStyle=1)  # -> Curve, Length, Domain
crv_4 = Curve(intcrv_5.Curve)

# ----
neg_10 = Negative(Value=Slider(0.1, range=0..1))
vec = VectorXYZ(XComponent=Slider(1, range=0..1), YComponent=neg_10, ZComponent=0)  # -> Vector, Length
pt_26 = ConstructPoint(XCoordinate=0, YCoordinate=Slider(853, range=0..1000), ZCoordinate=0)
Z = UnitZ(Factor=1)
pl = ConstructPlane(Origin=pt_26, XAxis=vec.Vector, YAxis=Z)
xz_2 = XZPlane(Origin=Point(0, 0, 0))
mirror = Mirror(Geometry=pl, Plane=xz_2)  # -> Geometry, Transform
merge_17 = Merge(Data1=pl, Data2=mirror.Geometry)

crv_5 = Curve(crv_4)
pt_27 = Point(simplify(graft(yz)))
end = EndPoints(Curve=crv_5)  # -> Start, End
vec2pt = Vector2Pt(PointA=end.Start, PointB=end.End, Unitize=False)  # -> Vector, Length
yz_2 = YZPlane(Origin=end.Start)
Y_9 = UnitY(Factor="-1")
angle = Angle(VectorA=vec2pt.Vector, VectorB=Y_9, Plane=yz_2)  # -> Angle, Reflex
rotate = Rotate(Geometry=crv_5, Angle=angle.Angle, Plane=yz_2)  # -> Geometry, Transform
curvepoint = PointOnCurve(rotate.Geometry, parameter=0.5)
vec2pt_2 = Vector2Pt(PointA=curvepoint, PointB=pt_27, Unitize=False)  # -> Vector, Length
move_9 = Move(Geometry=rotate.Geometry, Motion=vec2pt_2.Vector)  # -> Geometry, Transform
path_mapper = PathMapper(move_9.Geometry, source=["{A;B}", "{A}"], target=["{A}", "{0}"])
crv_6 = Curve(path_mapper)

flip_2 = FlipCurve(Curve=crv_6)  # -> Curve, Flag

loft = Loft(Curves=flip_2.Curve, Options={Adjust=False, Closed=False, LoftEnds=0, LoftSimp=0, LoftType=1, Rebuild=10, Refit=0.01})
srf = Surface(loft)

srf_2 = Surface(srf)
sec = BrepPlane(Brep=srf_2, Plane=merge_17)  # -> flatten(Curves), Points
srfsplit = SurfaceSplit(Surface=srf_2, Curves=sec.Curves)
debrep = DeconstructBrep(Brep=srf_2)  # -> Faces, Edges, Vertices
debrep_2 = DeconstructBrep(Brep=srfsplit)  # -> Faces, Edges, Vertices
avr = Average(Input=debrep.Vertices)
avr_2 = Average(Input=debrep_2.Vertices)  # -> flatten(ArithmeticMean)
pdecon_7 = Deconstruct(Point=avr)  # -> XComponent, YComponent, ZComponent
pdecon_8 = Deconstruct(Point=avr_2)  # -> XComponent, YComponent, ZComponent
pt_28 = ConstructPoint(XCoordinate=pdecon_7.XComponent, YCoordinate=pdecon_7.YComponent, ZCoordinate=0)
pt_29 = ConstructPoint(XCoordinate=pdecon_8.XComponent, YCoordinate=pdecon_8.YComponent, ZCoordinate=0)
dist = Distance(PointA=pt_28, PointB=pt_29)
sort = SortList(Keys=dist, ValuesA=srfsplit)  # -> Keys, ValuesA
item_12 = ListItem(List=sort.ValuesA, Index=0, Wrap=True)

pan_srf = PanelSurface(Panel=rad_blend, Surface=item_12)
dec_pan_3 = DeconstructPanel(Panel=pan_srf)  # -> Bilayers, HMaxels, LengthRange, WidthRange
item_13 = ListItem(List=dec_pan_3.Bilayers, Index=0, Wrap=True)  # -> Item, Item1
dec_bilayer = DeconstructBilayer(Bilayer=item_13.Item)  # -> ActiveLayer, PassiveLayer
dec_pan_4 = DeconstructPanel(Panel=pan_srf)  # -> Bilayers, HMaxels, LengthRange, WidthRange
dec_active_layer = DeconstructActiveLayer(ActiveLayer=dec_bilayer.ActiveLayer)  # -> simplify(graft(ActiveLayerBoards)), Thickness
dec_hmaxel_3 = DeconstructHMaxel(HMaxel=dec_pan_4.HMaxels)  # -> PassiveLayers, ActiveBoards, Height, RowRange, ColumnRange, DesiredRadius, BlendedRadius, ShapedHMaxel
dec_active_board = DeconstructActiveBoard(ActiveBoard=dec_active_layer.ActiveLayerBoards)  # -> HMaxels, StockBoard, Thickness, RowRange, ColumnRange, DesiredRadius, Radius, BlendedRadius, ShapedBoard
dec_active_board_2 = DeconstructActiveBoard(ActiveBoard=dec_hmaxel_3.ActiveBoards)  # -> HMaxels, StockBoard, Thickness, RowRange, ColumnRange, DesiredRadius, Radius, BlendedRadius, ShapedBoard
dec_passive = DeconstructPassiveLayer(PassiveLayer=dec_hmaxel_3.PassiveLayers)  # -> Species, Thickness
brep = Brep(dec_active_board.ShapedBoard)
null = NullItem(Item=brep)  # -> NullFlags, InvalidFlags, Description
not_2 = GateNot(A=null.NullFlags)
dispatch = Dispatch(List=dec_active_layer.ActiveLayerBoards, DispatchPattern=not_2)  # -> ListA, ListB

dec_active_board_3 = DeconstructActiveBoard(ActiveBoard=simplify(dispatch.ListB))  # -> HMaxels, StockBoard, Thickness, RowRange, ColumnRange, DesiredRadius, Radius, BlendedRadius, ShapedBoard
dec_stock_board = DeconstructStockBoard(StockBoard=dec_active_board_3.StockBoard)  # -> simplify(Name), simplify(Species), RTAngle, Length, Width, ActiveBoards
rectangle_6 = Rectangle(Plane=PlaneXY(0, 0, 0), XSize=dec_active_board_3.RowRange, YSize=dec_active_board_3.ColumnRange, Radius=0)  # -> Rectangle, Length
area_2 = Area(Geometry=rectangle_6.Rectangle)  # -> Area, Centroid
boundary = BoundarySurfaces(Edges=rectangle_6.Rectangle)
preview = CustomPreview(
    Geometry=boundary,
    Material={diffuse=RGB(221, 160, 221), emission=RGB(66, 48, 66), shine=0.5, specular=RGB(255, 255, 255), transparency=0})
tag = TextTag3D(Location=area_2.Centroid, Text=dec_stock_board.Name, Size=Slider(69, range=0..100), Colour=RGB(0, 0, 0), Justification=5)

dec_active_board_4 = DeconstructActiveBoard(ActiveBoard=simplify(dispatch.ListA))  # -> HMaxels, StockBoard, Thickness, RowRange, ColumnRange, DesiredRadius, Radius, BlendedRadius, ShapedBoard
bnd_7 = Bounds(Numbers=flatten(dec_active_board_4.BlendedRadius))
dedomain_12 = DeconstructDomain(Domain=bnd_7)  # -> Start, End
dec_stock_board_2 = DeconstructStockBoard(StockBoard=dec_active_board_4.StockBoard)  # -> simplify(Name), simplify(Species), RTAngle, Length, Width, ActiveBoards
rectangle_7 = Rectangle(Plane=PlaneXY(0, 0, 0), XSize=dec_active_board_4.RowRange, YSize=dec_active_board_4.ColumnRange, Radius=0)  # -> Rectangle, Length
gradient = Gradient(
    LowerLimit=dedomain_12.Start,
    UpperLimit=dedomain_12.End,
    Parameter=dec_active_board_4.BlendedRadius,
    stops=[0: RGB(158, 0, 65), 0.0312: RGB(175, 20, 70), 0.0625: RGB(192, 39, 74), 0.0938: RGB(209, 58, 78), 0.125: RGB(220, 73, 75), 0.156: RGB(230, 88, 72)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])
area_3 = Area(Geometry=rectangle_7.Rectangle)  # -> Area, Centroid
boundary_2 = BoundarySurfaces(Edges=rectangle_7.Rectangle)
preview_2 = CustomPreview(Geometry=boundary_2, Material=gradient)
tag_2 = TextTag3D(
    Location=area_3.Centroid,
    Text=dec_stock_board_2.Name,
    Size=Slider(69, range=0..100),
    Colour=RGB(0, 0, 0),
    Justification=5)
