# Grasshopper definition BilayerDesign - Stock implemented.gh (Grasshopper 1.0.7)
# plug-ins: HygroDesign, Pufferfish, Bookworm, treesloth01, Heteroptera

number_slider = Slider(1000, range=0..1000)
neg = Negative(Value=number_slider)
rectangle = Rectangle(Plane=PlaneXY(0, 0, 0), XSize=number_slider, YSize=neg, Radius=0)  # -> Rectangle, Length
drec = DeconstuctRectangle(Rectangle=rectangle.Rectangle)  # -> BasePlane, XInterval, YInterval
dedomain = DeconstructDomain(Domain=drec.XInterval)  # -> Start, End
dedomain_2 = DeconstructDomain(Domain=drec.YInterval)  # -> Start, End
pt = ConstructPoint(XCoordinate=dedomain.Start, YCoordinate=0, ZCoordinate=0)
pt_2 = ConstructPoint(XCoordinate=dedomain.End, YCoordinate=0, ZCoordinate=0)
subtraction = Subtraction(A=dedomain_2.End, B=dedomain_2.Start)
ln = Line(StartPoint=pt, EndPoint=pt_2)
divide = DivideCurve(Curve=ln, Count=expr("x-1", Slider(3, range=0..10)), Kinks=False)  # -> Points, Tangents, Parameters
multiplication = Multiplication(A=subtraction, B=Slider(0.545, range=0.5..1))
multiplication_2 = Multiplication(A=subtraction, B=Slider(0.486, range=0..0.5))
multiplication_3 = Multiplication(A=subtraction, B=Slider(0.937, range=0.5..1))
multiplication_4 = Multiplication(A=subtraction, B=Slider(0.115, range=0..1))
multiplication_5 = Multiplication(A=subtraction, B=Slider(1, range=0.5..1))
multiplication_6 = Multiplication(A=subtraction, B=Slider(0.338, range=0..0.5))
multiplication_7 = Multiplication(A=subtraction, B=Slider(0.56, range=0.5..1))
multiplication_8 = Multiplication(A=subtraction, B=Slider(0.481, range=0..0.5))
neg_2 = Negative(Value=multiplication_2)
neg_3 = Negative(Value=multiplication)
neg_4 = Negative(Value=multiplication_4)
neg_5 = Negative(Value=multiplication_3)
neg_6 = Negative(Value=multiplication_6)
neg_7 = Negative(Value=multiplication_5)
neg_8 = Negative(Value=multiplication_8)
neg_9 = Negative(Value=multiplication_7)
item = ListItem(List=divide.Points, Index=0, Wrap=True)  # -> Item, Item1, Item2
Y = UnitY(Factor=neg_2)
Y_2 = UnitY(Factor=neg_4)
Y_3 = UnitY(Factor=neg_3)
Y_4 = UnitY(Factor=neg_5)
Y_5 = UnitY(Factor=neg_6)
Y_6 = UnitY(Factor=neg_7)
Y_7 = UnitY(Factor=neg_8)
Y_8 = UnitY(Factor=neg_9)
move = Move(Geometry=[item.Item, item.Item2], Motion=Y)  # -> Geometry, Transform
move_2 = Move(Geometry=item.Item1, Motion=Y_3)  # -> Geometry, Transform
move_3 = Move(Geometry=[item.Item, item.Item2], Motion=Y_2)  # -> Geometry, Transform
move_4 = Move(Geometry=item.Item1, Motion=Y_4)  # -> Geometry, Transform
move_5 = Move(Geometry=[item.Item, item.Item2], Motion=Y_5)  # -> Geometry, Transform
move_6 = Move(Geometry=item.Item1, Motion=Y_6)  # -> Geometry, Transform
move_7 = Move(Geometry=[item.Item, item.Item2], Motion=Y_7)  # -> Geometry, Transform
move_8 = Move(Geometry=item.Item1, Motion=Y_8)  # -> Geometry, Transform
item_2 = ListItem(List=move.Geometry, Index=0, Wrap=True)  # -> Item, Item1
item_3 = ListItem(List=move_3.Geometry, Index=0, Wrap=True)  # -> Item, Item1
item_4 = ListItem(List=move_5.Geometry, Index=0, Wrap=True)  # -> Item, Item1
item_5 = ListItem(List=move_7.Geometry, Index=0, Wrap=True)  # -> Item, Item1
merge = Merge(Data1=flatten(item_2.Item), Data2=flatten(move_2.Geometry), Data3=flatten(item_2.Item1))
merge_2 = Merge(Data1=flatten(item_3.Item), Data2=flatten(move_4.Geometry), Data3=flatten(item_3.Item1))
merge_3 = Merge(Data1=flatten(item_4.Item), Data2=flatten(move_6.Geometry), Data3=flatten(item_4.Item1))
merge_4 = Merge(Data1=flatten(item_5.Item), Data2=flatten(move_8.Geometry), Data3=flatten(item_5.Item1))
intcrv = Interpolate(Vertices=merge, Degree=3, Periodic=False, KnotStyle=1)  # -> Curve, Length, Domain
intcrv_2 = Interpolate(Vertices=merge_2, Degree=3, Periodic=False, KnotStyle=1)  # -> Curve, Length, Domain
intcrv_3 = Interpolate(Vertices=merge_3, Degree=3, Periodic=False, KnotStyle=1)  # -> Curve, Length, Domain
intcrv_4 = Interpolate(Vertices=merge_4, Degree=3, Periodic=False, KnotStyle=1)  # -> Curve, Length, Domain
merge_5 = Merge(Data1=intcrv.Curve, Data2=intcrv_2.Curve, Data3=intcrv_3.Curve, Data4=intcrv_4.Curve)
rec = Rectangle(rectangle.Rectangle)

number_slider_2 = Slider(150, range=0..1000)

# ---- group: spruce
panel = Panel("spruce")
number_slider_3 = Slider(0.0001, range=0..0.0001)
number_slider_4 = Slider(0.0019, range=0..1)
number_slider_5 = Slider(0.0036, range=0..1)
number_slider_6 = Slider(10000, range=0..20000)
number_slider_7 = Slider(450, range=0..20000)
number_slider_8 = Slider(800, range=0..20000)
number_slider_9 = Slider(400, range=0..1000)

# ---- group: beech
panel_2 = Panel("beech")
number_slider_10 = Slider(0.0001, range=0..0.0001)
number_slider_11 = Slider(0.002, range=0..1)
number_slider_12 = Slider(0.0041, range=0..1)
number_slider_13 = Slider(14000, range=0..20000)
number_slider_14 = Slider(2280, range=0..20000)
number_slider_15 = Slider(1160, range=0..20000)
number_slider_16 = Slider(720, range=0..1000)

# ----
number_slider_17 = Slider(20, range=0..100)
num = Number(number_slider_2)
num_2 = Number(number_slider_17)
species = WoodSpecies(
    name=panel_2,
    density=number_slider_16,
    LExp=number_slider_10,
    RExp=number_slider_11,
    TExp=number_slider_12,
    LEmod=number_slider_13,
    REmod=number_slider_14,
    TEmod=number_slider_15)
species_2 = WoodSpecies(
    name=panel,
    density=number_slider_9,
    LExp=number_slider_3,
    RExp=number_slider_4,
    TExp=number_slider_5,
    LEmod=number_slider_6,
    REmod=number_slider_8,
    TEmod=number_slider_7)
panel_3 = Panel(HMaxelLength=Slider(250, range=0..1000), HMaxelWidth=num, LengthCount=num_2, WidthCount=Slider(13, range=0..100))
dec_pan = DeconstructPanel(Panel=panel_3)  # -> Bilayers, graft(HMaxels), LengthRange, WidthRange

number_slider_18 = Slider(1000, range=0..1000)
rectangle_2 = Rectangle(Plane=PlaneXY(0, 0, 0), XSize=number_slider_18, YSize=number_slider_18, Radius=0)  # -> Rectangle, Length
drec_2 = DeconstuctRectangle(Rectangle=rectangle_2.Rectangle)  # -> BasePlane, XInterval, YInterval
dedomain_3 = DeconstructDomain(Domain=drec_2.YInterval)  # -> Start, End
subtraction_2 = Subtraction(A=dedomain_3.End, B=dedomain_3.Start)
division = Division(A=subtraction_2, B=2)
dom = ConstructDomain(DomainStart=0, DomainEnd=1)
addition = Addition(A=dedomain_3.Start, B=division)
number_slider_19 = Slider(0.412, range=0..1)
dom_2 = ConstructDomain(DomainStart=addition, DomainEnd=dedomain_3.End)
dom_3 = ConstructDomain(DomainStart=addition, DomainEnd=dedomain_3.Start)
remap = RemapNumbers(Value=number_slider_19, Source=dom, Target=dom_3)  # -> Mapped, Clipped
remap_2 = RemapNumbers(Value=Slider(0.845, range=0..1), Source=dom, Target=drec_2.XInterval)  # -> Mapped, Clipped
remap_3 = RemapNumbers(Value=number_slider_19, Source=dom, Target=dom_2)  # -> Mapped, Clipped
remap_4 = RemapNumbers(Value=Slider(0.891, range=0..1), Source=dom, Target=drec_2.XInterval)  # -> Mapped, Clipped
pt_3 = ConstructPoint(XCoordinate=0, YCoordinate=remap_2.Mapped, ZCoordinate=0)
pt_4 = ConstructPoint(XCoordinate=remap.Mapped, YCoordinate=remap_4.Mapped, ZCoordinate=0)
pt_5 = ConstructPoint(XCoordinate=remap_3.Mapped, YCoordinate=remap_4.Mapped, ZCoordinate=0)
pt_6 = ConstructPoint(XCoordinate=number_slider_18, YCoordinate=remap_2.Mapped, ZCoordinate=0)
merge_6 = Merge(Data1=pt_3, Data2=pt_4, Data3=pt_5, Data4=pt_6)
nurbs = NurbsCurve(Vertices=merge_6, Degree=2, Periodic=False)  # -> Curve, Length, Domain

number_slider_20 = Slider(1000, range=0..1000)
rectangle_3 = Rectangle(Plane=PlaneXY(0, 0, 0), XSize=number_slider_20, YSize=number_slider_20, Radius=0)  # -> Rectangle, Length
drec_3 = DeconstuctRectangle(Rectangle=rectangle_3.Rectangle)  # -> BasePlane, XInterval, YInterval
dedomain_4 = DeconstructDomain(Domain=drec_3.YInterval)  # -> Start, End
subtraction_3 = Subtraction(A=dedomain_4.End, B=dedomain_4.Start)
division_2 = Division(A=subtraction_3, B=2)
dom_4 = ConstructDomain(DomainStart=0, DomainEnd=1)
addition_2 = Addition(A=dedomain_4.Start, B=division_2)
number_slider_21 = Slider(0.77, range=0..1)
dom_5 = ConstructDomain(DomainStart=addition_2, DomainEnd=dedomain_4.End)
dom_6 = ConstructDomain(DomainStart=addition_2, DomainEnd=dedomain_4.Start)
remap_5 = RemapNumbers(Value=number_slider_21, Source=dom_4, Target=dom_6)  # -> Mapped, Clipped
remap_6 = RemapNumbers(Value=Slider(0.45, range=0..1), Source=dom_4, Target=drec_3.XInterval)  # -> Mapped, Clipped
remap_7 = RemapNumbers(Value=number_slider_21, Source=dom_4, Target=dom_5)  # -> Mapped, Clipped
remap_8 = RemapNumbers(Value=Slider(0.529, range=0..1), Source=dom_4, Target=drec_3.XInterval)  # -> Mapped, Clipped
pt_7 = ConstructPoint(XCoordinate=0, YCoordinate=remap_6.Mapped, ZCoordinate=0)
pt_8 = ConstructPoint(XCoordinate=remap_5.Mapped, YCoordinate=remap_8.Mapped, ZCoordinate=0)
pt_9 = ConstructPoint(XCoordinate=remap_7.Mapped, YCoordinate=remap_8.Mapped, ZCoordinate=0)
pt_10 = ConstructPoint(XCoordinate=number_slider_20, YCoordinate=remap_6.Mapped, ZCoordinate=0)
merge_7 = Merge(Data1=pt_7, Data2=pt_8, Data3=pt_9, Data4=pt_10)
nurbs_2 = NurbsCurve(Vertices=merge_7, Degree=2, Periodic=False)  # -> Curve, Length, Domain

number_slider_22 = Slider(1000, range=0..1000)
rectangle_4 = Rectangle(Plane=PlaneXY(0, 0, 0), XSize=number_slider_22, YSize=number_slider_22, Radius=0)  # -> Rectangle, Length
drec_4 = DeconstuctRectangle(Rectangle=rectangle_4.Rectangle)  # -> BasePlane, XInterval, YInterval
dedomain_5 = DeconstructDomain(Domain=drec_4.YInterval)  # -> Start, End
subtraction_4 = Subtraction(A=dedomain_5.End, B=dedomain_5.Start)
division_3 = Division(A=subtraction_4, B=2)
dom_7 = ConstructDomain(DomainStart=0, DomainEnd=1)
addition_3 = Addition(A=dedomain_5.Start, B=division_3)
number_slider_23 = Slider(0.852, range=0..1)
dom_8 = ConstructDomain(DomainStart=addition_3, DomainEnd=dedomain_5.End)
dom_9 = ConstructDomain(DomainStart=addition_3, DomainEnd=dedomain_5.Start)
remap_9 = RemapNumbers(Value=number_slider_23, Source=dom_7, Target=dom_9)  # -> Mapped, Clipped
remap_10 = RemapNumbers(Value=Slider(0.365, range=0..1), Source=dom_7, Target=drec_4.XInterval)  # -> Mapped, Clipped
remap_11 = RemapNumbers(Value=number_slider_23, Source=dom_7, Target=dom_8)  # -> Mapped, Clipped
remap_12 = RemapNumbers(Value=Slider(0.333, range=0..1), Source=dom_7, Target=drec_4.XInterval)  # -> Mapped, Clipped
pt_11 = ConstructPoint(XCoordinate=0, YCoordinate=remap_10.Mapped, ZCoordinate=0)
pt_12 = ConstructPoint(XCoordinate=remap_9.Mapped, YCoordinate=remap_12.Mapped, ZCoordinate=0)
pt_13 = ConstructPoint(XCoordinate=remap_11.Mapped, YCoordinate=remap_12.Mapped, ZCoordinate=0)
pt_14 = ConstructPoint(XCoordinate=number_slider_22, YCoordinate=remap_10.Mapped, ZCoordinate=0)
merge_8 = Merge(Data1=pt_11, Data2=pt_12, Data3=pt_13, Data4=pt_14)
nurbs_3 = NurbsCurve(Vertices=merge_8, Degree=2, Periodic=False)  # -> Curve, Length, Domain

merge_9 = Merge(Data1=nurbs.Curve, Data2=nurbs_2.Curve, Data3=nurbs_3.Curve)
crv = Curve(merge_9)
lng = ListLength(List=crv)  # -> expr("x-2", Length)
dom_10 = ConstructDomain(DomainStart=0, DomainEnd=lng)
subset = SubList(List=crv, Domain=dom_10, Wrap=True)  # -> graft(List), Index
shift = ShiftList(List=crv, Shift=1, Wrap=False)  # -> graft(List)
merge_10 = Merge(Data1=subset.List, Data2=shift)  # -> simplify(Result)
group = Group(Objects=merge_10)  # -> flatten(Group)

crv_2 = Curve(merge_5)
lng_2 = ListLength(List=crv_2)  # -> expr("x-2", Length)
dom_11 = ConstructDomain(DomainStart=0, DomainEnd=lng_2)
subset_2 = SubList(List=crv_2, Domain=dom_11, Wrap=True)  # -> graft(List), Index
shift_2 = ShiftList(List=crv_2, Shift=1, Wrap=False)  # -> graft(List)
merge_11 = Merge(Data1=subset_2.List, Data2=shift_2)  # -> simplify(Result)
group_2 = Group(Objects=merge_11)  # -> flatten(Group)

data = Data(dec_pan.HMaxels)
dec_hmaxel = DeconstructHMaxel(HMaxel=data)  # -> PassiveLayers, ActiveBoards, Height, RowRange, ColumnRange, DesiredRadius, BlendedRadius, ShapedHMaxel
rectangle_5 = Rectangle(Plane=PlaneXY(0, 0, 0), XSize=dec_hmaxel.RowRange, YSize=dec_hmaxel.ColumnRange, Radius=0)  # -> Rectangle, Length
area = Area(Geometry=rectangle_5.Rectangle)  # -> Area, Centroid

num_3 = Number(dec_pan.WidthRange)
num_4 = Number(dec_pan.LengthRange)
dedomain_6 = DeconstructDomain(Domain=num_3)  # -> Start, End
subtraction_5 = Subtraction(A=dedomain_6.End, B=dedomain_6.Start)
division_4 = Division(A=subtraction_5, B=2)
number_slider_24 = Slider(1, range=0..1)
addition_4 = Addition(A=dedomain_6.Start, B=division_4)
dom_12 = ConstructDomain(DomainStart=0, DomainEnd=1)
dom_13 = ConstructDomain(DomainStart=addition_4, DomainEnd=dedomain_6.End)
dom_14 = ConstructDomain(DomainStart=addition_4, DomainEnd=dedomain_6.Start)
remap_13 = RemapNumbers(Value=Slider(1, range=0.25..1), Source=dom_12, Target=num_4)  # -> Mapped, Clipped
remap_14 = RemapNumbers(Value=Slider(0, range=0..0.75), Source=dom_12, Target=num_4)  # -> Mapped, Clipped
remap_15 = RemapNumbers(Value=number_slider_24, Source=dom_12, Target=dom_14)  # -> Mapped, Clipped
remap_16 = RemapNumbers(Value=number_slider_24, Source=dom_12, Target=dom_13)  # -> Mapped, Clipped
pt_15 = ConstructPoint(XCoordinate=remap_13.Mapped, YCoordinate=dedomain_6.Start, ZCoordinate=0)
pt_16 = ConstructPoint(XCoordinate=remap_14.Mapped, YCoordinate=remap_15.Mapped, ZCoordinate=0)
pt_17 = ConstructPoint(XCoordinate=remap_14.Mapped, YCoordinate=remap_16.Mapped, ZCoordinate=0)
pt_18 = ConstructPoint(XCoordinate=remap_13.Mapped, YCoordinate=dedomain_6.End, ZCoordinate=0)
merge_12 = Merge(Data1=pt_15, Data2=pt_16, Data3=pt_17, Data4=pt_18)
nurbs_4 = NurbsCurve(Vertices=merge_12, Degree=2, Periodic=False)  # -> Curve, Length, Domain

# ---- group: generate distribution
pt_19 = Point(simplify(area.Centroid))
data_2 = Data(group)
pdecon = Deconstruct(Point=pt_19)  # -> XComponent, YComponent, ZComponent
bnd = Bounds(Numbers=flatten(pdecon.XComponent))
bnd_2 = Bounds(Numbers=flatten(pdecon.YComponent))
lng_3 = ListLength(List=data_2)
dedomain_7 = DeconstructDomain(Domain=bnd)  # -> Start, End
remap_17 = RemapNumbers(Value=pdecon.YComponent, Source=bnd_2, Target=Domain(0, 1))  # -> graft(Mapped), Clipped
c_script = CSharpScript(count=lng_3, start=dedomain_7.Start, end=dedomain_7.End)  # -> out, A; inputs count: Int32, start: Double, end: Double
# ---------- c_script: C# ----------
    double totalLength = end - start;
    double domLength = totalLength / (double) count;

    List<Interval> intervals = new List<Interval>();
    double currentStart = start;
    for(int i = 0; i < count; i++)
    {
      intervals.Add(new Interval(currentStart, currentStart + domLength));
      currentStart += domLength;
    }
    A = intervals;
# ---------- end c_script ----------
num_5 = Number(graft(pdecon.XComponent))
inc = Includes(Value=num_5, Domain=simplify(c_script.A))  # -> Includes, Deviation
cull = CullPattern(List=data_2, CullPattern=inc.Includes)
item_6 = ListItem(List=cull, Index=0, Wrap=True)
cull_2 = CullPattern(List=c_script.A, CullPattern=inc.Includes)
ungroup = Ungroup(Group=item_6)  # -> simplify(Objects)
item_7 = ListItem(List=cull_2, Index=0, Wrap=True)
remap_18 = RemapNumbers(Value=num_5, Source=item_7, Target=Domain(0, 1))  # -> Mapped, Clipped
eval = EvaluateCurve(Curve=reparameterize(ungroup), Parameter=remap_17.Mapped)  # -> Point, Tangent, Angle
pdecon_2 = Deconstruct(Point=eval.Point)  # -> XComponent, YComponent, ZComponent
item_8 = ListItem(List=pdecon_2.YComponent, Index=0, Wrap=True)  # -> Item, Item1
twn2nums = TweenTwoNumbers(NumberA=item_8.Item, NumberB=item_8.Item1, Factor=remap_18.Mapped)
num_6 = Number(twn2nums)

pt_20 = Point(simplify(area.Centroid))
data_3 = Data(group_2)
pdecon_3 = Deconstruct(Point=pt_20)  # -> XComponent, YComponent, ZComponent
bnd_3 = Bounds(Numbers=flatten(pdecon_3.XComponent))
bnd_4 = Bounds(Numbers=flatten(pdecon_3.YComponent))
lng_4 = ListLength(List=data_3)
dedomain_8 = DeconstructDomain(Domain=bnd_3)  # -> Start, End
remap_19 = RemapNumbers(Value=pdecon_3.YComponent, Source=bnd_4, Target=Domain(0, 1))  # -> graft(Mapped), Clipped
c_script_2 = CSharpScript(count=lng_4, start=dedomain_8.Start, end=dedomain_8.End)  # -> out, A; inputs count: Int32, start: Double, end: Double; same code as c_script
num_7 = Number(graft(pdecon_3.XComponent))
inc_2 = Includes(Value=num_7, Domain=simplify(c_script_2.A))  # -> Includes, Deviation
cull_3 = CullPattern(List=data_3, CullPattern=inc_2.Includes)
item_9 = ListItem(List=cull_3, Index=0, Wrap=True)
cull_4 = CullPattern(List=c_script_2.A, CullPattern=inc_2.Includes)
ungroup_2 = Ungroup(Group=item_9)  # -> simplify(Objects)
item_10 = ListItem(List=cull_4, Index=0, Wrap=True)
remap_20 = RemapNumbers(Value=num_7, Source=item_10, Target=Domain(0, 1))  # -> Mapped, Clipped
eval_2 = EvaluateCurve(Curve=reparameterize(ungroup_2), Parameter=remap_19.Mapped)  # -> Point, Tangent, Angle
pdecon_4 = Deconstruct(Point=eval_2.Point)  # -> XComponent, YComponent, ZComponent
item_11 = ListItem(List=pdecon_4.YComponent, Index=0, Wrap=True)  # -> Item, Item1
twn2nums_2 = TweenTwoNumbers(NumberA=item_11.Item, NumberB=item_11.Item1, Factor=remap_20.Mapped)
num_8 = Number(twn2nums_2)

# ---- group: material / beech
data_4 = Data(species)

# ---- group: material / Species
crv_3 = Curve(nurbs_4.Curve)

# ---- group: material / spruce
data_5 = Data(species_2)

# ---- group: material
pt_21 = Point(graft(area.Centroid))
xz = XZPlane(Origin=pt_21)
pcx = CurvePlane(Curve=crv_3, Plane=xz)  # -> simplify(Points), ParamsC, ParamsP
pdecon_5 = Deconstruct(Point=pcx.Points)  # -> XComponent, YComponent, ZComponent
pdecon_6 = Deconstruct(Point=pt_21)  # -> XComponent, YComponent, ZComponent
smaller = SmallerThan(FirstNumber=pdecon_5.XComponent, SecondNumber=pdecon_6.XComponent)  # -> SmallerThan, OrEqualTo
not = GateNot(A=smaller.SmallerThan)
cull_5 = CullPattern(List=data_4, CullPattern=not)
cull_6 = CullPattern(List=data_5, CullPattern=smaller.SmallerThan)
merge_13 = Merge(Data1=cull_5, Data2=cull_6)  # -> simplify(Result)
dup = DuplicateData(Data=merge_13, Number="2", Order=True)  # -> simplify(Data)

# ----
num_9 = Number(num_6)
rec_2 = Rectangle(rectangle_2.Rectangle)
drec_5 = DeconstuctRectangle(Rectangle=rec_2)  # -> BasePlane, XInterval, YInterval
dom_15 = ConstructDomain(DomainStart=Slider(25, range=0..100), DomainEnd=Slider(75, range=0..100))
remap_21 = RemapNumbers(Value=num_9, Source=drec_5.YInterval, Target=dom_15)  # -> Mapped, Clipped
trim = TrimTree(Tree=remap_21.Mapped, Depth=1)

num_10 = Number(num_8)
rec_3 = Rectangle(rec)
drec_6 = DeconstuctRectangle(Rectangle=rec_3)  # -> BasePlane, XInterval, YInterval
dom_16 = ConstructDomain(DomainStart=0, DomainEnd=1)
remap_22 = RemapNumbers(Value=num_10, Source=drec_6.YInterval, Target=dom_16)  # -> Mapped, Clipped
trim_2 = TrimTree(Tree=remap_22.Mapped, Depth=1)

data_6 = Data(panel_3)
data_7 = Data(species_2)
data_8 = Data(dec_pan.HMaxels)

data_9 = Data(data_6)
panel_4 = Panel("""0
1""")
data_10 = Data(data_7)
bilayer = ConstructBilayer(
    Panel=data_9,
    BoardLength=Slider(4, range=0..10),
    RowOffsets=panel_4,
    PassiveSpecies=data_10,
    ActiveThickness=Slider(20, range=0..100),
    PassiveThickness=Slider(4, range=0..10))

data_11 = Data(data_6)
panel_5 = Panel("""2
3""")
data_12 = Data(data_7)
bilayer_2 = ConstructBilayer(
    Panel=data_11,
    BoardLength=Slider(4, range=0..10),
    RowOffsets=panel_5,
    PassiveSpecies=data_12,
    ActiveThickness=Slider(20, range=0..100),
    PassiveThickness=Slider(4, range=0..10))

up_hmaxel = UpdateHMaxel(HMaxel=simplify(data_8), Height=simplify(trim), RadiusFactor=simplify(trim_2), Species=simplify(dup))  # -> flatten(HMaxel)
merge_14 = Merge(Data1=bilayer, Data2=bilayer_2)
data_13 = Data(panel_3)
up_pan = UpdatePanel(Panel=data_13, Bilayers=merge_14, HMaxels=up_hmaxel)
num_11 = Number(number_slider_17)
num_12 = Number(dec_pan.WidthRange)
num_13 = Number(dec_pan.LengthRange)
rectangle_6 = Rectangle(Plane=PlaneXY(0, 0, 0), XSize=num_13, YSize=num_12, Radius=0)  # -> Rectangle, Length
boundary = BoundarySurfaces(Edges=rectangle_6.Rectangle)

# ---- group: freeform
debrep = DeconstructBrep(Brep=boundary)  # -> Faces, Edges, Vertices
len = Length(Curve=debrep.Edges)
sort = SortList(Keys=len, ValuesA=debrep.Edges)  # -> Keys, reverse(ValuesA)
item_12 = ListItem(List=sort.ValuesA, Index=0, Wrap=True)  # -> Item, Item1
flip = FlipCurve(Curve=item_12.Item)  # -> Curve, Flag
number_slider_25 = Slider(5, range=0..10)
bnd_5 = Bounds(Numbers=sort.Keys)
merge_15 = Merge(Data1=flip.Curve, Data2=item_12.Item1)
dedomain_9 = DeconstructDomain(Domain=bnd_5)  # -> Start, End
division_5 = Division(A=dedomain_9.Start, B=2)
divide_2 = DivideCurve(Curve=merge_15, Count=expr("x-1", number_slider_25), Kinks=False)  # -> simplify(Points), Tangents, Parameters
genes = GenePool(Decimals=2, Maximum=775, Minimum=0, Value=[27.53, 44.94, 332.11, 446.28, 439.34])
subtraction_6 = Subtraction(A=division_5, B=Slider(200, range=0..1000))
flip_2 = FlipMatrix(Data=divide_2.Points)
dom_17 = ConstructDomain(DomainStart=0, DomainEnd=subtraction_6)
avr = Average(Input=flip_2)
gnc = PoolController(GenePool=genes, Count=number_slider_25, Range=dom_17, Randomness=1)
vec2pt = Vector2Pt(PointA=flip_2, PointB=avr, Unitize=False)  # -> Vector, Length
amp = Amplitude(Vector=vec2pt.Vector, Amplitude=graft(genes))
move_9 = Move(Geometry=flip_2, Motion=amp)  # -> Geometry, Transform
flip_3 = FlipMatrix(Data=move_9.Geometry)
intcrv_5 = Interpolate(Vertices=flip_3, Degree=3, Periodic=False, KnotStyle=1)  # -> simplify(Curve), Length, Domain

# ----
num_14 = Number(dec_pan.WidthRange)
num_15 = Number(dec_pan.LengthRange)
dedomain_10 = DeconstructDomain(Domain=num_14)  # -> Start, End
subtraction_7 = Subtraction(A=dedomain_10.End, B=dedomain_10.Start)
division_6 = Division(A=subtraction_7, B=2)
number_slider_26 = Slider(0.4, range=0..1)
addition_5 = Addition(A=dedomain_10.Start, B=division_6)
dom_18 = ConstructDomain(DomainStart=0, DomainEnd=1)
dom_19 = ConstructDomain(DomainStart=addition_5, DomainEnd=dedomain_10.End)
dom_20 = ConstructDomain(DomainStart=addition_5, DomainEnd=dedomain_10.Start)
remap_23 = RemapNumbers(Value=Slider(0.387, range=0.25..1), Source=dom_18, Target=num_15)  # -> Mapped, Clipped
remap_24 = RemapNumbers(Value=Slider(0.619, range=0..1), Source=dom_18, Target=num_15)  # -> Mapped, Clipped
remap_25 = RemapNumbers(Value=number_slider_26, Source=dom_18, Target=dom_20)  # -> Mapped, Clipped
remap_26 = RemapNumbers(Value=number_slider_26, Source=dom_18, Target=dom_19)  # -> Mapped, Clipped
pt_22 = ConstructPoint(XCoordinate=remap_23.Mapped, YCoordinate=dedomain_10.Start, ZCoordinate=0)
pt_23 = ConstructPoint(XCoordinate=remap_24.Mapped, YCoordinate=remap_25.Mapped, ZCoordinate=0)
pt_24 = ConstructPoint(XCoordinate=remap_24.Mapped, YCoordinate=remap_26.Mapped, ZCoordinate=0)
pt_25 = ConstructPoint(XCoordinate=remap_23.Mapped, YCoordinate=dedomain_10.End, ZCoordinate=0)
merge_16 = Merge(Data1=pt_22, Data2=pt_23, Data3=pt_24, Data4=pt_25)
nurbs_5 = NurbsCurve(Vertices=merge_16, Degree=2, Periodic=False)  # -> Curve, Length, Domain
divide_3 = DivideCurve(Curve=nurbs_5.Curve, Count=Slider(50, range=0..100), Kinks=False)  # -> Points, Tangents, Parameters
srf_cp = SurfaceClosestPoint(Point=divide_3.Points, Surface=boundary)  # -> Point, UVPoint, Distance

# ---- group: spruce left
panel_6 = Panel("https://docs.google.com/spreadsheets/d/1Q0xuMOoM9MJtYBJnVYEzEPmUDS6WbwrvgMLvJoCEvrc/edit#gid=0")
readcell = ReadCell(
    SpreadsheetURL=panel_6,
    SheetName="Sheet1",
    CellRange="A3:B82",
    DuplicateMerged=False,
    SameLength=False,
    Read=Toggle(True))
decell = DeconstructCell(Cell=readcell)  # -> FormattedValue, UserEnteredValue, CellFormat

# ---- group: spruce left / remove null branches
c_script_3 = CSharpScript(obj=decell.FormattedValue)  # -> out, A; inputs obj: tree
# ---------- c_script_3: C# ----------
    DataTree<object> output = new DataTree<object>();
    
    int currentID = 0;
    for(int i = 0; i < obj.BranchCount; i++)
    {
      if(obj.Branch(i)[1] as string != "null")
      {
        output.AddRange(obj.Branch(i), new GH_Path(currentID));
        currentID++;
      }
    }
    A = output;
# ---------- end c_script_3 ----------

# ---- group: spruce left (continued)
item_13 = ListItem(List=c_script_3.A, Index=0, Wrap=True)  # -> flatten(Item), Item1

# ---- group: name
data_14 = Data(item_13.Item)
lng_5 = ListLength(List=data_14)
dup_2 = DuplicateData(Data="SL", Number=lng_5, Order=True)  # -> graft(Data)
txt = Text(graft(data_14))
merge_17 = Merge(Data1=simplify(dup_2), Data2=simplify(txt))
join = TextJoin(Text=merge_17)

# ---- group: rt
num_16 = Number(item_13.Item1)

# ---- group: spruce right
panel_7 = Panel("https://docs.google.com/spreadsheets/d/1Q0xuMOoM9MJtYBJnVYEzEPmUDS6WbwrvgMLvJoCEvrc/edit#gid=0")
readcell_2 = ReadCell(
    SpreadsheetURL=panel_7,
    SheetName="Sheet1",
    CellRange="D3:E70",
    DuplicateMerged=False,
    SameLength=False,
    Read=Toggle(True))
decell_2 = DeconstructCell(Cell=readcell_2)  # -> FormattedValue, UserEnteredValue, CellFormat

# ---- group: spruce right / remove null branches
c_script_4 = CSharpScript(obj=decell_2.FormattedValue)  # -> out, A; inputs obj: tree; same code as c_script_3

# ---- group: spruce right (continued)
item_14 = ListItem(List=c_script_4.A, Index=0, Wrap=True)  # -> flatten(Item), Item1

# ---- group: name
data_15 = Data(item_14.Item)
lng_6 = ListLength(List=data_15)
dup_3 = DuplicateData(Data="SR", Number=lng_6, Order=True)  # -> graft(Data)
txt_2 = Text(graft(data_15))
merge_18 = Merge(Data1=simplify(dup_3), Data2=simplify(txt_2))
join_2 = TextJoin(Text=merge_18)

# ---- group: rt
num_17 = Number(item_14.Item1)

# ----
merge_19 = Merge(Data1=join, Data2=num_16)
merge_20 = Merge(Data1=join_2, Data2=num_17)
entwine = Entwine(Branch0X=merge_19, Branch1X=merge_20, FlattenInputs=False)
renumber = RenumberPaths(Data=entwine)
item_15 = ListItem(List=renumber, Index=0, Wrap=True)  # -> flatten(Item), flatten(Item1)

# ---- group: beech left
panel_8 = Panel("https://docs.google.com/spreadsheets/d/1Q0xuMOoM9MJtYBJnVYEzEPmUDS6WbwrvgMLvJoCEvrc/edit#gid=0")
readcell_3 = ReadCell(
    SpreadsheetURL=panel_8,
    SheetName="Sheet1",
    CellRange="G3:H36",
    DuplicateMerged=False,
    SameLength=False,
    Read=Toggle(True))
decell_3 = DeconstructCell(Cell=readcell_3)  # -> FormattedValue, UserEnteredValue, CellFormat

# ---- group: beech left / remove null branches
c_script_5 = CSharpScript(obj=decell_3.FormattedValue)  # -> out, A; inputs obj: tree; same code as c_script_3

# ---- group: beech left (continued)
item_16 = ListItem(List=c_script_5.A, Index=0, Wrap=True)  # -> flatten(Item), Item1

# ---- group: name
data_16 = Data(item_16.Item)
lng_7 = ListLength(List=data_16)
dup_4 = DuplicateData(Data="BL", Number=lng_7, Order=True)  # -> graft(Data)
txt_3 = Text(graft(data_16))
merge_21 = Merge(Data1=simplify(dup_4), Data2=simplify(txt_3))
join_3 = TextJoin(Text=merge_21)

# ---- group: rt
num_18 = Number(item_16.Item1)

# ---- group: beech right
panel_9 = Panel("https://docs.google.com/spreadsheets/d/1Q0xuMOoM9MJtYBJnVYEzEPmUDS6WbwrvgMLvJoCEvrc/edit#gid=0")
readcell_4 = ReadCell(
    SpreadsheetURL=panel_9,
    SheetName="Sheet1",
    CellRange="J3:K38",
    DuplicateMerged=False,
    SameLength=False,
    Read=Toggle(True))
decell_4 = DeconstructCell(Cell=readcell_4)  # -> FormattedValue, UserEnteredValue, CellFormat

# ---- group: beech right / remove null branches
c_script_6 = CSharpScript(obj=decell_4.FormattedValue)  # -> out, A; inputs obj: tree; same code as c_script_3

# ---- group: beech right (continued)
item_17 = ListItem(List=c_script_6.A, Index=0, Wrap=True)  # -> flatten(Item), Item1

# ---- group: name
data_17 = Data(item_17.Item)
lng_8 = ListLength(List=data_17)
dup_5 = DuplicateData(Data="BR", Number=lng_8, Order=True)  # -> graft(Data)
txt_4 = Text(graft(data_17))
merge_22 = Merge(Data1=simplify(dup_5), Data2=simplify(txt_4))
join_4 = TextJoin(Text=merge_22)

# ---- group: rt
num_19 = Number(item_17.Item1)

# ----
merge_23 = Merge(Data1=join_3, Data2=num_18)
merge_24 = Merge(Data1=join_4, Data2=num_19)
entwine_2 = Entwine(Branch0X=merge_23, Branch1X=merge_24, FlattenInputs=False)
renumber_2 = RenumberPaths(Data=entwine_2)
item_18 = ListItem(List=renumber_2, Index=0, Wrap=True)  # -> flatten(Item), flatten(Item1)

lng_9 = ListLength(List=item_15.Item)
lng_10 = ListLength(List=item_18.Item)
dup_6 = DuplicateData(Data=Slider(2500, range=0..2500), Number=lng_9, Order=True)
dup_7 = DuplicateData(Data=Slider(1000, range=0..1000), Number=lng_10, Order=True)
dup_8 = DuplicateData(Data=Slider(150, range=0..1000), Number=lng_9, Order=True)
dup_9 = DuplicateData(Data=Slider(150, range=0..1000), Number=lng_10, Order=True)
dup_10 = DuplicateData(Data=Slider(27, range=0..100), Number=lng_9, Order=True)
dup_11 = DuplicateData(Data=species, Number=lng_10, Order=True)
dup_12 = DuplicateData(Data=Slider(27, range=0..100), Number=lng_10, Order=True)
dup_13 = DuplicateData(Data=species_2, Number=lng_9, Order=True)
merge_25 = Merge(Data1=item_15.Item1, Data2=item_18.Item1)
merge_26 = Merge(Data1=dup_10, Data2=dup_12)
merge_27 = Merge(Data1=dup_6, Data2=dup_7)
merge_28 = Merge(Data1=dup_8, Data2=dup_9)
merge_29 = Merge(Data1=item_15.Item, Data2=item_18.Item)
merge_30 = Merge(Data1=dup_13, Data2=dup_11)

stock_boards = StockBoards(Name=merge_29, Species=merge_30, Thickness=merge_26, Length=merge_27, Width=merge_28, RTAngle=merge_25, MoistureChange=0)

panel_10 = Panel("""12
5""")
data_18 = Data(up_pan)
data_19 = Data(stock_boards)
c_script_7 = CSharpScript(Reference="C:\Users\Alex Reiner\AppData\Roaming\Grasshopper\Libraries\HygroDesign.Core.dll")  # -> out, A
# ---------- c_script_7: C# usings ----------
using BilayerDesign;
# ---------- c_script_7: C# ----------
    TimoshenkoPrediction timo = new TimoshenkoPrediction();
    A = timo;
# ---------- c_script_7: C# additional code ----------
  public class TimoshenkoPrediction : PredictionEngine
  {

    public TimoshenkoPrediction()
    {
    }

    public override double Predict(StockBoard board, Bilayer bilayer, double moistureChange)
    {
      double h1 = bilayer.PassiveLayer.Thickness;
      double h2 = bilayer.ActiveLayer.Thickness;
      double h = h1 + h2;
      double m = h1 / h2;
      double e1 = bilayer.PassiveLayer.Species.Attributes["LEmod"];
      double e2 = GrainAngleInterpolation(board.RTAngle, board.Species.Attributes["REmod"], board.Species.Attributes["TEmod"]);
      double n = e1 / e2;
      double a1 = bilayer.PassiveLayer.Species.Attributes["LExp"];
      double a2 = GrainAngleInterpolation(board.RTAngle, board.Species.Attributes["RExp"], board.Species.Attributes["TExp"]);
      double deltaAlpha = a2 - a1;
      double kValue = 6 * Math.Pow(1.0 + m, 2) / (3 * Math.Pow(1 + m, 2) + (1 + m * n) * Math.Pow(m, 2) + (1 / (m * n)));
      double curvature = kValue * ((moistureChange * deltaAlpha) / h);
      return 1 / (curvature /* * TimError*/ );
    }

    public static double GrainAngleInterpolation(double rtAngle, double eR, double eT)
    {
      double angleConv = RhinoMath.ToRadians(rtAngle);
      double angleT = Math.Cos(angleConv);
      double angleR = Math.Sin(angleConv);
      double eActive = eT * Math.Pow(angleT, 2) + eR * Math.Pow(angleR, 2);
      return eActive;
    }
  }
# ---------- end c_script_7 ----------
stockpile = ConstructStockPile(Panels=data_18, StockBoards=data_19, MoistureChanges=panel_10, PredictionEngine=c_script_7.A)
sel_env = ConstructSelectionEnvironment(Panels=data_18, StockPile=stockpile)

# ---- group: convolution
c_script_8 = CSharpScript(
    tan=Slider(1, range=0.01..3),
    lon=Slider(0.46, range=0.01..3),
    rad=Slider(10000, range=0..10000),
    stiff=Slider(0.75, range=0.01..3),
    thick=Slider(0.04, range=0.01..3),
    Reference="C:\Users\Alex Reiner\AppData\Roaming\Grasshopper\Libraries\HygroDesign.Core.dll")  # -> out, A; inputs tan: Double, lon: Double, rad: Double, stiff: Double, thick: Double
# ---------- c_script_8: C# ----------
    HMaxelConvolution convEngine = new HMaxelConvolution(tan, lon, rad, stiff, thick);
    A = convEngine;
# ---------- c_script_8: C# additional code ----------
  public class HMaxelConvolution : ConvolutionEngine
  {
    public double Tangential { get; set; }
    public double Longitudinal { get; set; }
    public double RadiusMax { get; set; }
    public double StiffnessInfluence { get; set; }
    public double ThicknessInfluence { get; set; }
    public HMaxelConvolution(double tangential, double longitudinal, double radiusMax, double stiffnessInfluence, double thicknessInfluence)
    {
      Tangential = tangential;
      Longitudinal = longitudinal;
      RadiusMax = radiusMax;
      StiffnessInfluence = stiffnessInfluence;
      ThicknessInfluence = thicknessInfluence;
    }

    public override Panel Convolution(Panel panel)
    {
      double MaxRad = double.MinValue;
      double MinRad = double.MaxValue;

      double MaxRStiff = double.MinValue;
      double MinRStiff = double.MaxValue;
      double MaxLStiff = double.MinValue;
      double MinLStiff = double.MaxValue;

      for (int i = 0; i < panel.HMaxels.GetLength(0); i++)
      {
        for (int j = 0; j < panel.HMaxels.GetLength(1); j++)
        {
          double averageRStiffness = 0;
          double averageLStiffness = 0;
          double weightedRadius = 0;
          double totalRWeights = 0;

          HMaxel hmaxel = panel.HMaxels[i, j];
          List<Tuple<double, double>> tuples = new List<Tuple<double, double>>();
          for (int v = 0; v < hmaxel.ActiveBoards.Count; v++)
          {
            averageRStiffness += (double) hmaxel.ActiveBoards[v].StockBoard.Species.Attributes["REmod"];
            averageLStiffness += (double) hmaxel.ActiveBoards[v].StockBoard.Species.Attributes["LEmod"];

            weightedRadius += (hmaxel.ActiveBoards[v].Radius * (double) hmaxel.ActiveBoards[v].StockBoard.Species.Attributes["REmod"]);
            totalRWeights += (double) hmaxel.ActiveBoards[v].StockBoard.Species.Attributes["REmod"];

          }
          averageRStiffness /= hmaxel.ActiveBoards.Count;
          averageLStiffness /= hmaxel.ActiveBoards.Count;
          weightedRadius /= totalRWeights;
          panel.HMaxels[i, j].Attributes.Add("REmod", averageRStiffness);
          panel.HMaxels[i, j].Attributes.Add("LEmod", averageLStiffness);
          panel.HMaxels[i, j].Attributes.Add("weighted radius", weightedRadius);

          if (weightedRadius > MaxRad) MaxRad = weightedRadius;
          if (weightedRadius < MinRad) MinRad = weightedRadius;
          if (averageLStiffness > MaxLStiff) MaxLStiff = averageLStiffness;
          if (averageLStiffness < MinLStiff) MinLStiff = averageLStiffness;
          if (averageRStiffness > MaxRStiff) MaxRStiff = averageRStiffness;
          if (averageRStiffness < MinRStiff) MinRStiff = averageRStiffness;
        }
      }
      //set factors
      for (int i = 0; i < panel.HMaxels.GetLength(0); i++)
      {
        for (int j = 0; j < panel.HMaxels.GetLength(1); j++)
        {
          panel.HMaxels[i, j].Attributes.Add("REmodFactor", Remap((double) panel.HMaxels[i, j].Attributes["REmod"], MinRStiff, MaxRStiff, 1 - StiffnessInfluence, 1));
          panel.HMaxels[i, j].Attributes.Add("LEmodFactor", Remap((double) panel.HMaxels[i, j].Attributes["LEmod"], MinLStiff, MaxLStiff, 1 - StiffnessInfluence, 1));
          panel.HMaxels[i, j].Attributes.Add("RadiusFactor", Remap((double) panel.HMaxels[i, j].Attributes["weighted radius"], MinRad, RadiusMax, 1, 0));

        }
      }

      //horizontal convolution
      for (int i = 0; i < panel.HMaxels.GetLength(0); i++)
      {
        for (int j = 0; j < panel.HMaxels.GetLength(1); j++)
        {
          double totalWeights = 0;
          double blendedRadius = 0;
          for (int x = 0; x < panel.HMaxels.GetLength(0); x++)
          {
            for (int y = 0; y < panel.HMaxels.GetLength(1); y++)
            {

              double xdist = Math.Abs(panel.HMaxels[i, j].X - panel.HMaxels[x, y].X);
              double ydist = Math.Abs(panel.HMaxels[i, j].Y - panel.HMaxels[x, y].Y);
              double LFactor = (double) panel.HMaxels[x, y].Attributes["LEmodFactor"] / Math.Pow(xdist + 1, Longitudinal);
              double RFactor = (double) panel.HMaxels[x, y].Attributes["REmodFactor"] / Math.Pow(ydist + 1, Tangential);
              blendedRadius += (double) panel.HMaxels[x, y].Attributes["weighted radius"] * (double) panel.HMaxels[i, j].Attributes["RadiusFactor"] * LFactor * RFactor;
              totalWeights += (double) panel.HMaxels[x, y].Attributes["RadiusFactor"] * LFactor * RFactor;

            }
          }

          panel.HMaxels[i, j].BlendedRaidus = blendedRadius / totalWeights;

        }
      }
      return panel;
    }
    public static double Remap(double val, double from1, double to1, double from2, double to2)
    {
      return (val - from1) / (to1 - from1) * (to2 - from2) + from2;
    }
  }
# ---------- end c_script_8 ----------
data_20 = Data(sel_env)
rad_blend = RadiusBlending(Panels=data_20, ConvolutionEngine=c_script_8.A)
dec_pan_2 = DeconstructPanel(Panel=rad_blend)  # -> Bilayers, HMaxels, LengthRange, WidthRange
dec_hmaxel_2 = DeconstructHMaxel(HMaxel=dec_pan_2.HMaxels)  # -> PassiveLayers, ActiveBoards, Height, RowRange, ColumnRange, DesiredRadius, BlendedRadius, ShapedHMaxel

# ----
num_20 = Number(expr("x/2", num_11))
dedomain_11 = DeconstructDomain(Domain=dec_hmaxel_2.RowRange)  # -> Start, End
bnd_6 = Bounds(Numbers=dedomain_11.Start)
bnd_7 = Bounds(Numbers=dedomain_11.End)
dedomain_12 = DeconstructDomain(Domain=bnd_6)  # -> Start, End
dedomain_13 = DeconstructDomain(Domain=bnd_7)  # -> Start, End
x_minus_one = XMinusOne(NumberX=num_20)
subtraction_8 = Subtraction(A=dedomain_13.End, B=dedomain_12.Start)
division_7 = Division(A=subtraction_8, B=x_minus_one)
series = Series(Start=dedomain_12.Start, Step=division_7, Count=num_20)
pt_26 = ConstructPoint(XCoordinate=series, YCoordinate=0, ZCoordinate=0)
yz = YZPlane(Origin=pt_26)  # -> simplify(graft(Plane))

partition = PartitionList(List=dec_hmaxel_2.BlendedRadius, Size=num_11)  # -> simplify(Chunks)
flip_4 = FlipMatrix(Data=partition)
num_21 = Number(flip_4)
c_script_9 = CSharpScript(x=num_21)  # -> out, A; inputs x: tree
# ---------- c_script_9: C# ----------
    DataTree<object> output = new DataTree<object>();

    for(int i = 0; i < x.BranchCount; i++)
    {
      if(i % 2 == 0)output.AddRange(x.Branch(i), new GH_Path(i));
    }
    A = output;
# ---------- end c_script_9 ----------
renumber_3 = RenumberPaths(Data=c_script_9.A)

num_22 = Number(number_slider_2)
pln = Plane(yz)
num_23 = Number(renumber_3)
c_script_10 = CSharpScript()  # -> out, A; inputs x: tree
# ---------- c_script_10: C# ----------
    DataTree<object> output = new DataTree<object>();
    int firstIndex = 0;
    int branchCount = 0;
    for(int i = 0; i < x.BranchCount; i++)
    {
      GH_Path path = new GH_Path(firstIndex, branchCount);
      if(x.Paths[i][0] == firstIndex)
      {
        output.AddRange(x.Branch(i), path);
      }
      else
      {
        firstIndex++;
        branchCount = -1;
        i--;
      }
      branchCount++;
    }
    A = output;
# ---------- end c_script_10 ----------
c_script_11 = CSharpScript(iRadii=num_23, iBoardWidth=num_22, iPlanes=pln)  # -> out, simplify(A); inputs iRadii: tree of Double, iBoardWidth: Double, iPlanes: tree of Plane
# ---------- c_script_11: C# ----------
    DataTree<Point3d> pointTree = new DataTree<Point3d>();

    for (int j = 0; j < iRadii.BranchCount; j++)
    {

      //initialize variables
      Plane bp = iPlanes.Branch(j)[0];
      Point3d startPoint = new Point3d(bp.Origin);
      Point3d centerPoint = startPoint;
      Vector3d rotationAxis = new Vector3d(bp.ZAxis);
      Vector3d centerPointVect = new Vector3d(bp.YAxis);
      centerPointVect.Rotate(Math.PI / 2, rotationAxis);

      for (int i = 0; i < iRadii.Branch(j).Count; i++){
        GH_Path pth = iRadii.Paths[j].AppendElement(i);
        Point3d point1 = startPoint;
        Point3d point2 = startPoint;

        pointTree.Add(point1, pth);

        //calculate rotation angle
        Double arcLength = iBoardWidth;
        Double radius = iRadii.Branch(j)[i];
        Double rotation = (arcLength / radius);

        //calculate rotation center point
        centerPointVect.Unitize();
        centerPointVect *= radius;
        centerPoint += centerPointVect;


        //execute half rotation
        Transform tx = Transform.Rotation(rotation / 2, rotationAxis, centerPoint);


        point2.Transform(tx);
        pointTree.Add(point2, pth);

        //execute full rotation
        tx = Transform.Rotation(rotation, rotationAxis, centerPoint);
        startPoint.Transform(tx);
        pointTree.Add(startPoint, pth);

        //updata rotation parameters
        centerPoint = startPoint;
        centerPointVect.Transform(tx);
      }
    }
    A = pointTree;
# ---------- end c_script_11 ----------

trim_3 = TrimTree(Tree=c_script_11.A, Depth=1)
cullpt = CullDuplicates(Points=trim_3, Tolerance=0.1, CullMode=3)  # -> Points, Indices, Valence
pt_27 = Point(cullpt.Points)

# ---- group: animate
pt_28 = Point(simplify(pt_27))
pln_2 = Plane(graft(pln))
num_24 = Number(Slider(1, range=0..1))
c_script_12 = CSharpScript(iPoints=simplify(pt_28), iPlanes=pln_2, iShapeFactor=num_24)  # -> out, A; inputs iPoints: tree of Point3d, iPlanes: tree of Plane, iShapeFactor: Double
# ---------- c_script_12: C# ----------
    DataTree<Point3d> output = new DataTree<Point3d>();
    
    double shapeFactor = 1.0 - iShapeFactor;

    //step through curves
    for (int i = 0; i < iPoints.BranchCount; i++)
    {
      Plane currentPlane = iPlanes.Branch(iPoints.Path(i)[0])[0];

      //get vectors from plane
      Vector3d zVect = currentPlane.YAxis;

      Vector3d rotVect = currentPlane.ZAxis;

      //create new startpoint inside list
      Point3d startPoint = iPoints.Branch(i)[0];

      //step through points. Create and rotate vectors
      for (int j = 0; j < iPoints.Branch(i).Count; j++)
      {
        if (j == 0) output.Add(startPoint, iPoints.Path(i));
        else{
          //create current segment vector
          Vector3d segmentVect = new Vector3d(iPoints.Branch(i)[j] - iPoints.Branch(i)[j - 1]);

          //measure angle with vertical vector
          double angle = Vector3d.VectorAngle(zVect, segmentVect, currentPlane);

          //rotate
          segmentVect.Rotate(-angle * shapeFactor, rotVect);

          startPoint += segmentVect;
          output.Add(startPoint, iPoints.Path(i));
        }
      }
    }

    A = output;
# ---------- end c_script_12 ----------
pt_29 = Point(c_script_12.A)
intcrv_6 = Interpolate(Vertices=pt_29, Degree=3, Periodic=False, KnotStyle=1)  # -> Curve, Length, Domain
crv_4 = Curve(intcrv_6.Curve)

# ----
crv_5 = Curve(crv_4)
pt_30 = Point(simplify(graft(yz)))
end = EndPoints(Curve=crv_5)  # -> Start, End
vec2pt_2 = Vector2Pt(PointA=end.Start, PointB=end.End, Unitize=False)  # -> Vector, Length
yz_2 = YZPlane(Origin=end.Start)
Y_9 = UnitY(Factor="-1")
angle = Angle(VectorA=vec2pt_2.Vector, VectorB=Y_9, Plane=yz_2)  # -> Angle, Reflex
rotate = Rotate(Geometry=crv_5, Angle=angle.Angle, Plane=yz_2)  # -> Geometry, Transform
curvepoint = PointOnCurve(rotate.Geometry, parameter=0.5)
vec2pt_3 = Vector2Pt(PointA=curvepoint, PointB=pt_30, Unitize=False)  # -> Vector, Length
move_10 = Move(Geometry=rotate.Geometry, Motion=vec2pt_3.Vector)  # -> Geometry, Transform
path_mapper = PathMapper(move_10.Geometry, source=["{A;B}", "{A}"], target=["{A}", "{0}"])
crv_6 = Curve(path_mapper)
flip_5 = FlipCurve(Curve=crv_6)  # -> Curve, Flag
loft = Loft(Curves=flip_5.Curve, Options={Adjust=False, Closed=False, LoftEnds=0, LoftSimp=0, LoftType=0, Rebuild=10, Refit=0.01})
srf = Surface(loft)

# ---- group: straight plane cut
crv_7 = Curve(flip_5.Curve)
srf_2 = Surface(boundary)
bbox = BoundingBox(Content=crv_7, Plane=PlaneXY(0, 0, 0), UnionBox=True)  # -> Box, Box_2
debrep_2 = DeconstructBrep(Brep=srf_2)  # -> Faces, Edges, Vertices
debox = DeconstructBox(Box=bbox.Box)  # -> Plane, X, Y, Z
len_2 = Length(Curve=debrep_2.Edges)
dedomain_14 = DeconstructDomain(Domain=debox.X)  # -> Start, End
dedomain_15 = DeconstructDomain(Domain=debox.Y)  # -> Start, End
sort_2 = SortList(Keys=len_2, ValuesA=debrep_2.Edges)  # -> Keys, reverse(ValuesA)
multiplication_9 = Multiplication(A=dedomain_15.Start, B=Slider(0.522, range=0..1))
item_19 = ListItem(List=sort_2.ValuesA, Index=0, Wrap=True)  # -> Item, Item1
pt_31 = ConstructPoint(XCoordinate=0, YCoordinate=dedomain_15.Start, ZCoordinate=0)
pt_32 = ConstructPoint(XCoordinate=dedomain_14.End, YCoordinate=multiplication_9, ZCoordinate=0)
flip_6 = FlipCurve(Curve=item_19.Item)  # -> Curve, Flag
vec2pt_4 = Vector2Pt(PointA=pt_31, PointB=pt_32, Unitize=False)  # -> Vector, Length
Z = UnitZ(Factor=1)
merge_31 = Merge(Data1=flip_6.Curve, Data2=item_19.Item1)
lng_11 = ListLength(List=crv_7)
pl = ConstructPlane(Origin=pt_31, XAxis=vec2pt_4.Vector, YAxis=Z)
xz_2 = XZPlane(Origin=Point(0, 0, 0))
mirror = Mirror(Geometry=pl, Plane=xz_2)  # -> Geometry, Transform
divide_4 = DivideCurve(Curve=merge_31, Count=expr("x-1", lng_11), Kinks=False)  # -> Points, Tangents, Parameters
crv_8 = Curve(reparameterize(graft(crv_7)))
merge_32 = Merge(Data1=pl, Data2=mirror.Geometry)
flip_7 = FlipMatrix(Data=divide_4.Points)
pcx_2 = CurvePlane(Curve=crv_8, Plane=merge_32)  # -> Points, ParamsC, ParamsP
item_20 = ListItem(List=flip_7, Index=0, Wrap=True)  # -> Item, Item1
trim_4 = TrimTree(Tree=pcx_2.ParamsC, Depth=1)
ln_2 = Line(StartPoint=item_20.Item, EndPoint=item_20.Item1)
eval_3 = EvaluateCurve(Curve=ln_2, Parameter=trim_4)  # -> simplify(Point), Tangent, Angle
flip_8 = FlipMatrix(Data=eval_3.Point)
intcrv_7 = Interpolate(Vertices=flip_8, Degree=3, Periodic=False, KnotStyle=1)  # -> Curve, Length, Domain

# ----
divide_5 = DivideCurve(Curve=intcrv_7.Curve, Count=Slider(100, range=0..1000), Kinks=False)  # -> simplify(Points), Tangents, Parameters
srf_cp_2 = SurfaceClosestPoint(Point=divide_5.Points, Surface=boundary)  # -> Point, UVPoint, Distance

pan_srf = PanelSurface(Panel=rad_blend, Surface=srf)

srf_3 = Surface(srf)
evalsrf = EvaluateSurface(Surface=srf_3, Point=srf_cp_2.UVPoint)  # -> Point, Normal, UDirection, VDirection, Frame
number_slider_27 = Slider(100, range=0..100)
intcrv_8 = Interpolate(Vertices=evalsrf.Point, Degree=3, Periodic=False, KnotStyle=1)  # -> Curve, Length, Domain
ext = ExtendCurve(Curve=intcrv_8.Curve, Type=0, Start=number_slider_27, End=number_slider_27)
srfsplit = SurfaceSplit(Surface=srf_3, Curves=flatten(ext))
area_2 = Area(Geometry=srfsplit)  # -> Area, Centroid
area_3 = Area(Geometry=srf_3)  # -> Area, Centroid
pdecon_7 = Deconstruct(Point=area_2.Centroid)  # -> XComponent, YComponent, ZComponent
pdecon_8 = Deconstruct(Point=area_3.Centroid)  # -> XComponent, YComponent, ZComponent
subtraction_9 = Subtraction(A=pdecon_8.YComponent, B=pdecon_7.YComponent)
abs = Absolute(Value=subtraction_9)
sort_3 = SortList(Keys=abs, ValuesA=srfsplit)  # -> Keys, ValuesA
item_21 = ListItem(List=sort_3.ValuesA, Index=0, Wrap=True)

evalsrf_2 = EvaluateSurface(Surface=srf, Point=srf_cp.UVPoint)  # -> Point, Normal, UDirection, VDirection, Frame
srf_4 = Surface(item_21)
intcrv_9 = Interpolate(Vertices=evalsrf_2.Point, Degree=3, Periodic=False, KnotStyle=1)  # -> Curve, Length, Domain
srfsplit_2 = SurfaceSplit(Surface=srf_4, Curves=intcrv_9.Curve)
area_4 = Area(Geometry=srfsplit_2)  # -> Area, Centroid
pdecon_9 = Deconstruct(Point=area_4.Centroid)  # -> XComponent, YComponent, ZComponent
sort_4 = SortList(Keys=pdecon_9.XComponent, ValuesA=srfsplit_2)  # -> Keys, ValuesA
item_22 = ListItem(List=sort_4.ValuesA, Index=0, Wrap=True)
brep = Brep(item_22)
entwine_3 = Entwine(Branch00=item_21, Branch01=brep, FlattenInputs=True)
trim_breps = TrimmingBreps(Panel=pan_srf, Breps=entwine_3)

dec_pan_3 = DeconstructPanel(Panel=trim_breps)  # -> Bilayers, HMaxels, LengthRange, WidthRange
dec_bilayer = DeconstructBilayer(Bilayer=dec_pan_3.Bilayers)  # -> ActiveLayer, PassiveLayer
item_23 = ListItem(List=dec_bilayer.ActiveLayer, Index=0, Wrap=True)  # -> Item, Item1
dec_active_layer = DeconstructActiveLayer(ActiveLayer=dec_bilayer.ActiveLayer)  # -> simplify(ActiveLayerBoards), Thickness
dec_pan_4 = DeconstructPanel(Panel=trim_breps)  # -> Bilayers, HMaxels, LengthRange, WidthRange
dec_hmaxel_3 = DeconstructHMaxel(HMaxel=dec_pan_4.HMaxels)  # -> PassiveLayers, ActiveBoards, Height, RowRange, ColumnRange, DesiredRadius, BlendedRadius, ShapedHMaxel
dec_active_board = DeconstructActiveBoard(ActiveBoard=dec_active_layer.ActiveLayerBoards)  # -> HMaxels, StockBoard, Thickness, RowRange, ColumnRange, DesiredRadius, Radius, BlendedRadius, MoistureChange, simplify(ShapedBoard)
brep_2 = Brep(flatten(dec_active_board.ShapedBoard))
dec_passive = DeconstructPassiveLayer(PassiveLayer=dec_hmaxel_3.PassiveLayers)  # -> Species, Thickness
