# Grasshopper definition BilayerDesign - Variable Thickness Eddy.gh (Grasshopper 1.0.7)
# plug-ins: Utils, Sofistik, Human, Weaverbird, EleFront, Telepathy, HygroDesign, Pufferfish, MeshEdit Components, Karamba3D, Kangaroo2 Components, LunchBox, Wombat

# ---- group: beech
species = WoodSpecies(
    Name="beech",
    LExpansion=Slider(0.0001, range=0..0.0001),
    RExpansion=Slider(0.002, range=0..1),
    TExpansion=Slider(0.0041, range=0..1),
    LElasticModulus=Slider(14000, range=0..20000),
    RElasticModulus=Slider(2280, range=0..20000),
    TElasticModulus=Slider(1160, range=0..20000))

# ---- group: spruce
species_2 = WoodSpecies(
    Name="spruce",
    LExpansion=Slider(0.0001, range=0..0.0001),
    RExpansion=Slider(0.0019, range=0..1),
    TExpansion=Slider(0.0036, range=0..1),
    LElasticModulus=Slider(10000, range=0..20000),
    RElasticModulus=Slider(800, range=0..20000),
    TElasticModulus=Slider(450, range=0..20000))

# ----
number_slider = Slider(150, range=0..10000)
number_slider_2 = Slider(4, range=0..10)
number_slider_3 = Slider(2500, range=0..10000)
number_slider_4 = Slider(35, range=0..100)
xy = XYPlane(Origin=Point(0, 0, 0))
multiplication = Multiplication(A=number_slider_4, B=number_slider)
multiplication_2 = Multiplication(A=number_slider_3, B=number_slider_2)
bilayer = Bilayer(
    BasePlane=xy,
    BoardWidth=number_slider,
    BoardLength=number_slider_3,
    WidthCount=number_slider_4,
    LengthCount=number_slider_2,
    ActiveThickness=Slider(20, range=0..100),
    PassiveThickness=Slider(4, range=0..100),
    PassiveSpecies=species_2)
rectangle = Rectangle(Plane=PlaneXY(0, 0, 0), XSize=multiplication_2, YSize=multiplication, Radius=0)  # -> Rectangle, Length
num = Number(number_slider)
num_2 = Number(number_slider_3)

number_slider_5 = Slider(1000, range=0..1000)
neg = Negative(Value=number_slider_5)
rectangle_2 = Rectangle(Plane=PlaneXY(0, 0, 0), XSize=number_slider_5, YSize=neg, Radius=0)  # -> Rectangle, Length
drec = DeconstuctRectangle(Rectangle=rectangle_2.Rectangle)  # -> BasePlane, XInterval, YInterval
dedomain = DeconstructDomain(Domain=drec.XInterval)  # -> Start, End
dedomain_2 = DeconstructDomain(Domain=drec.YInterval)  # -> Start, End
pt = ConstructPoint(XCoordinate=dedomain.Start, YCoordinate=0, ZCoordinate=0)
pt_2 = ConstructPoint(XCoordinate=dedomain.End, YCoordinate=0, ZCoordinate=0)
subtraction = Subtraction(A=dedomain_2.End, B=dedomain_2.Start)
ln = Line(StartPoint=pt, EndPoint=pt_2)
number_slider_6 = Slider(0.6, range=0.5..1)
number_slider_7 = Slider(0.4, range=0..0.5)
divide = DivideCurve(Curve=ln, Count=expr("x-1", Slider(3, range=0..10)), Kinks=False)  # -> Points, Tangents, Parameters
multiplication_3 = Multiplication(A=subtraction, B=Slider(1, range=0.5..1))
multiplication_4 = Multiplication(A=subtraction, B=Slider(0.2, range=0..0.5))
multiplication_5 = Multiplication(A=subtraction, B=Slider(0.8, range=0.5..1))
multiplication_6 = Multiplication(A=subtraction, B=Slider(0.3, range=0..1))
multiplication_7 = Multiplication(A=subtraction, B=number_slider_6)
multiplication_8 = Multiplication(A=subtraction, B=number_slider_6)
neg_2 = Negative(Value=multiplication_4)
neg_3 = Negative(Value=multiplication_3)
neg_4 = Negative(Value=multiplication_6)
neg_5 = Negative(Value=multiplication_5)
neg_6 = Negative(Value=multiplication_8)
neg_7 = Negative(Value=multiplication_7)
item = ListItem(List=divide.Points, Index=0, Wrap=True)  # -> Item, Item1, Item2
Y = UnitY(Factor=neg_2)
Y_2 = UnitY(Factor=neg_4)
Y_3 = UnitY(Factor=neg_3)
Y_4 = UnitY(Factor=neg_5)
Y_5 = UnitY(Factor=neg_6)
Y_6 = UnitY(Factor=neg_7)
move = Move(Geometry=[item.Item, item.Item2], Motion=Y)  # -> Geometry, Transform
move_2 = Move(Geometry=item.Item1, Motion=Y_3)  # -> Geometry, Transform
move_3 = Move(Geometry=[item.Item, item.Item2], Motion=Y_2)  # -> Geometry, Transform
move_4 = Move(Geometry=item.Item1, Motion=Y_4)  # -> Geometry, Transform
move_5 = Move(Geometry=[item.Item, item.Item2], Motion=Y_5)  # -> Geometry, Transform
move_6 = Move(Geometry=item.Item1, Motion=Y_6)  # -> Geometry, Transform
item_2 = ListItem(List=move.Geometry, Index=0, Wrap=True)  # -> Item, Item1
item_3 = ListItem(List=move_3.Geometry, Index=0, Wrap=True)  # -> Item, Item1
item_4 = ListItem(List=move_5.Geometry, Index=0, Wrap=True)  # -> Item, Item1
merge = Merge(Data1=flatten(item_2.Item), Data2=flatten(move_2.Geometry), Data3=flatten(item_2.Item1))
merge_2 = Merge(Data1=flatten(item_3.Item), Data2=flatten(move_4.Geometry), Data3=flatten(item_3.Item1))
merge_3 = Merge(Data1=flatten(item_4.Item), Data2=flatten(move_6.Geometry), Data3=flatten(item_4.Item1))
intcrv = Interpolate(Vertices=merge, Degree=3, Periodic=False, KnotStyle=1)  # -> Curve, Length, Domain
intcrv_2 = Interpolate(Vertices=merge_2, Degree=3, Periodic=False, KnotStyle=1)  # -> Curve, Length, Domain
intcrv_3 = Interpolate(Vertices=merge_3, Degree=3, Periodic=False, KnotStyle=1)  # -> Curve, Length, Domain
merge_4 = Merge(Data1=intcrv.Curve, Data2=intcrv_2.Curve, Data3=intcrv_3.Curve)
rec = Rectangle(rectangle_2.Rectangle)

board_count = Slider(500, range=0..500)

# ---- group: name
num_3 = Number(board_count)
series = Series(Start=0, Step=1, Count=num_3)
dup = DuplicateData(Data="S", Number=num_3, Order=True)  # -> graft(Data)
txt = Text(graft(series))
merge_5 = Merge(Data1=dup, Data2=txt)  # -> simplify(Result)
join = TextJoin(Text=merge_5)  # -> flatten(Result)

# ---- group: active thickness
number_slider_8 = Slider(20, range=0..100)

# ---- group: RT
dom = ConstructDomain(DomainStart=Slider(15, range=0..100), DomainEnd=Slider(75, range=0..100))
random = Random(Range=dom, Number=board_count, Seed=Slider(225, range=0..1000))

# ---- group: name
num_4 = Number(board_count)
series_2 = Series(Start=0, Step=1, Count=num_4)
dup_2 = DuplicateData(Data="B", Number=num_4, Order=True)  # -> graft(Data)
txt_2 = Text(graft(series_2))
merge_6 = Merge(Data1=dup_2, Data2=txt_2)  # -> simplify(Result)
join_2 = TextJoin(Text=merge_6)  # -> flatten(Result)

# ---- group: thickness
num_5 = Number(number_slider_8)
num_6 = Number(board_count)
dup_3 = DuplicateData(Data=num_5, Number=num_6, Order=True)

# ---- group: length
num_7 = Number(num_2)
num_8 = Number(board_count)
dup_4 = DuplicateData(Data=num_7, Number=num_8, Order=True)

# ---- group: width
num_9 = Number(num)
num_10 = Number(board_count)
dup_5 = DuplicateData(Data=num_9, Number=num_10, Order=True)

# ---- group: beech
data = Data(species)

# ---- group: spruce
data_2 = Data(species_2)

# ---- group: bounding rectangle input (rectangle y domain represents full range of radii from stockpiles)
rec_2 = Rectangle(rec)

# ----
stock_boards = StockBoards(Name=join_2, Species=data, Thickness=dup_3, Length=dup_4, Width=dup_5, RTAngle=random)
stock_boards_2 = StockBoards(Name=join, Species=data_2, Thickness=dup_3, Length=dup_4, Width=dup_5, RTAngle=random)
merge_7 = Merge(Data1=stock_boards, Data2=stock_boards_2)

# ---- group: curve controller inputs (represents distribution of radii along a given cross section)
crv = Curve(merge_4)

# ----
crv_2 = Curve(crv)
lng = ListLength(List=crv_2)  # -> expr("x-2", Length)
dom_2 = ConstructDomain(DomainStart=0, DomainEnd=lng)
subset = SubList(List=crv_2, Domain=dom_2, Wrap=True)  # -> graft(List), Index
shift = ShiftList(List=crv_2, Shift=1, Wrap=False)  # -> graft(List)
merge_8 = Merge(Data1=subset.List, Data2=shift)  # -> simplify(Result)
group = Group(Objects=merge_8)  # -> flatten(Group)

deconstruct_bilayer = DeconstructBilayer(Bilayer=bilayer)
dec_board = DeconstructBoard(Board=deconstruct_bilayer)  # -> Polyline, Name, Species, RTAngle, MoistureChange, DesiredRadius, Radius, BlendedRadius, BoardRegions
area = Area(Geometry=dec_board.Polyline)  # -> Area, Centroid
c_script = CSharpScript(rects=flatten(dec_board.Polyline))  # -> out; inputs rects: list of Rectangle3d; disabled
# ---------- c_script: C# usings ----------
using Rhino.DocObjects;
# ---------- c_script: C# ----------
    var object_enumerator_settings = new ObjectEnumeratorSettings();

    var rhinoObjects = RhinoDoc.ActiveDoc.Objects.GetObjectList(object_enumerator_settings);
    var objectTable = RhinoDoc.ActiveDoc.Objects;

    foreach( var rhinoObject in rhinoObjects)
    {
      if(rhinoObject.ObjectType == ObjectType.Curve)
      {
        Curve rhinoCurve = rhinoObject.Geometry as Curve;
        if(rhinoCurve.IsClosed)objectTable.Delete(rhinoObject);
      }
    }

    foreach(var rect in rects)objectTable.AddCurve(rect.ToNurbsCurve());
# ---------- end c_script ----------
pt_3 = Point(simplify(area.Centroid))

# ---- group: generate distribution
pt_4 = Point(simplify(pt_3))
data_3 = Data(group)
pdecon = Deconstruct(Point=pt_4)  # -> XComponent, YComponent, ZComponent
bnd = Bounds(Numbers=flatten(pdecon.XComponent))
bnd_2 = Bounds(Numbers=flatten(pdecon.YComponent))
lng_2 = ListLength(List=data_3)
dedomain_3 = DeconstructDomain(Domain=bnd)  # -> Start, End
remap = RemapNumbers(Value=pdecon.YComponent, Source=bnd_2, Target=Domain(0, 1))  # -> graft(Mapped), Clipped
c_script_2 = CSharpScript(count=lng_2, start=dedomain_3.Start, end=dedomain_3.End)  # -> out, A; inputs count: Int32, start: Double, end: Double
# ---------- c_script_2: C# ----------
    double totalLength = end - start;
    double domLength = totalLength / (double) count;

    List<Interval> intervals = new List<Interval>();
    double currentStart = start;
    for(int i = 0; i < count; i++)
    {
      intervals.Add(new Interval(currentStart, currentStart + domLength));
      currentStart += domLength;
    }
    A = intervals;
# ---------- end c_script_2 ----------
num_11 = Number(graft(pdecon.XComponent))
inc = Includes(Value=num_11, Domain=simplify(c_script_2.A))  # -> Includes, Deviation
cull = CullPattern(List=data_3, CullPattern=inc.Includes)
item_5 = ListItem(List=cull, Index=0, Wrap=True)
cull_2 = CullPattern(List=c_script_2.A, CullPattern=inc.Includes)
ungroup = Ungroup(Group=item_5)  # -> simplify(Objects)
item_6 = ListItem(List=cull_2, Index=0, Wrap=True)
remap_2 = RemapNumbers(Value=num_11, Source=item_6, Target=Domain(0, 1))  # -> Mapped, Clipped
eval = EvaluateCurve(Curve=reparameterize(ungroup), Parameter=remap.Mapped)  # -> Point, Tangent, Angle
pdecon_2 = Deconstruct(Point=eval.Point)  # -> XComponent, YComponent, ZComponent
item_7 = ListItem(List=pdecon_2.YComponent, Index=0, Wrap=True)  # -> Item, Item1
twn2nums = TweenTwoNumbers(NumberA=item_7.Item, NumberB=item_7.Item1, Factor=remap_2.Mapped)
num_12 = Number(twn2nums)

# ----
bbox = BoundingBox(Content=dec_board.Polyline, Plane=PlaneXY(0, 0, 0), UnionBox=True)  # -> Box, Box_2
debox = DeconstructBox(Box=bbox.Box)  # -> Plane, X, Y, Z
dedomain_4 = DeconstructDomain(Domain=debox.X)  # -> Start, End
dedomain_5 = DeconstructDomain(Domain=debox.Y)  # -> Start, End
pt_5 = ConstructPoint(XCoordinate=dedomain_4.End, YCoordinate=dedomain_5.End, ZCoordinate=0)
pt_6 = ConstructPoint(XCoordinate=dedomain_4.Start, YCoordinate=dedomain_5.End, ZCoordinate=0)
pt_7 = ConstructPoint(XCoordinate=dedomain_4.Start, YCoordinate=dedomain_5.Start, ZCoordinate=0)
pt_8 = ConstructPoint(XCoordinate=dedomain_4.End, YCoordinate=dedomain_5.Start, ZCoordinate=0)
merge_9 = Merge(Data1=pt_5, Data2=pt_6, Data3=pt_7, Data4=pt_8)
nurbs = NurbsCurve(Vertices=merge_9, Degree=3, Periodic=False)  # -> Curve, Length, Domain

# ---- group: material / beech
data_4 = Data(species)

# ---- group: material / Species
crv_3 = Curve(nurbs.Curve)

# ---- group: material / spruce
data_5 = Data(species_2)

# ---- group: material
pt_9 = Point(graft(pt_3))
xz = XZPlane(Origin=pt_9)
pcx = CurvePlane(Curve=crv_3, Plane=xz)  # -> simplify(Points), ParamsC, ParamsP
pdecon_3 = Deconstruct(Point=pcx.Points)  # -> XComponent, YComponent, ZComponent
pdecon_4 = Deconstruct(Point=pt_9)  # -> XComponent, YComponent, ZComponent
smaller = SmallerThan(FirstNumber=pdecon_3.XComponent, SecondNumber=pdecon_4.XComponent)  # -> SmallerThan, OrEqualTo
not = GateNot(A=smaller.SmallerThan)
cull_3 = CullPattern(List=data_4, CullPattern=not)
cull_4 = CullPattern(List=data_5, CullPattern=smaller.SmallerThan)
merge_10 = Merge(Data1=cull_3, Data2=cull_4)  # -> simplify(Result)
path_mapper = PathMapper(merge_10, source="{A}", target="{0}")

# ---- group: Thickness
dec_reg = DeconstructBoardRegion(BoardRegion=dec_board.BoardRegions)  # -> Polyline, Name, Species, RTAngle, MoistureChange, DesiredRadius, Radius, BlendedRadius, ThicknessBlendedRadius
area_2 = Area(Geometry=dec_reg.Polyline)  # -> Area, Centroid
pt_10 = Point(simplify(area_2.Centroid))
pdecon_5 = Deconstruct(Point=pt_10)  # -> XComponent, YComponent, ZComponent
bnd_3 = Bounds(Numbers=flatten(pdecon_5.XComponent))
dom_3 = ConstructDomain(DomainStart=Slider(1.2, range=0..1.2), DomainEnd=Slider(0, range=0..1))
remap_3 = RemapNumbers(Value=pdecon_5.XComponent, Source=bnd_3, Target=dom_3)  # -> Mapped, Clipped

# ----
pt_11 = Point(pt_3)
pdecon_6 = Deconstruct(Point=pt_11)  # -> XComponent, YComponent, ZComponent
bnd_4 = Bounds(Numbers=flatten(pdecon_6.XComponent))
dom_4 = ConstructDomain(DomainStart="1", DomainEnd="0")
remap_4 = RemapNumbers(Value=pdecon_6.XComponent, Source=bnd_4, Target=dom_4)  # -> simplify(Mapped), Clipped

num_13 = Number(num_12)
rec_3 = Rectangle(rec_2)
drec_2 = DeconstuctRectangle(Rectangle=rec_3)  # -> BasePlane, XInterval, YInterval
dom_5 = ConstructDomain(DomainStart=0, DomainEnd=1)
remap_5 = RemapNumbers(Value=num_13, Source=drec_2.YInterval, Target=dom_5)  # -> Mapped, Clipped
trim = TrimTree(Tree=remap_5.Mapped, Depth=1)

data_6 = Data(bilayer)
tag = TextTag3D(Location=pt_10, Text=remap_3.Mapped, Size=Slider(100, range=0..100), Justification=7)

update_bilayer = UpdateBilayer(Bilayer=data_6, Radius=trim, RadiusWeight=remap_4.Mapped, Material=path_mapper)
dup_bilayer = DuplicateBilayer(Bilayer=update_bilayer, Count=Slider(3, range=0..10))
panel = Panel(Bilayers=dup_bilayer)
adjust_cro_sec = AdjustCrossSection(Panel=panel, Thicknesses=remap_3.Mapped)
dup_panel = DuplicatePanel(Panel=adjust_cro_sec, Count=Slider(3, range=0..10))

# ---- group: moisture changes
panel_2 = Panel("""2
4
8""")
num_14 = Number(panel_2)

# ----
data_7 = Data(merge_7)
design_env = DesignEnvironment(Panels=dup_panel, StockBoards=data_7, MoistureChanges=num_14)  # -> Panels, StockBoards
convolution = CurvatureConvolution(
    Panels=design_env.Panels,
    TengentialBlending=Slider(0.34, range=0.01..3),
    LongitudinalBlending=Slider(0.3, range=0.01..3),
    MaxRadiusInfluence=100000,
    StiffnessFactor=0.1,
    ThicknessFactor=0.1,
    VisualizeBoardWeights=0)  # -> Panels, Weights

cross_section = BooleanToggle(True)
relaxation = BooleanToggle(False)
cull_5 = CullPattern(List=convolution.Panels, CullPattern=cross_section)

item_8 = ListItem(List=convolution.Panels, Index=0, Wrap=True)  # -> Item, Item1
deconstruct_panel = DeconstructPanel(Panel=item_8.Item)
deconstruct_bilayer_2 = DeconstructBilayer(Bilayer=deconstruct_panel)
dec_board_2 = DeconstructBoard(Board=deconstruct_bilayer_2)  # -> Polyline, Name, Species, RTAngle, MoistureChange, DesiredRadius, Radius, BlendedRadius, BoardRegions
display_panel = DisplayPanels(Panels=item_8.Item)  # -> ActiveBoards, PassiveBoards
dec_reg_2 = DeconstructBoardRegion(BoardRegion=dec_board_2.BoardRegions)  # -> Polyline, Name, Species, RTAngle, MoistureChange, DesiredRadius, Radius, BlendedRadius, ThicknessBlendedRadius

bbox_2 = BoundingBox(Content=flatten(dec_reg_2.Polyline), Plane=PlaneXY(0, 0, 0), UnionBox=True)  # -> Box, Box_2
debox_2 = DeconstructBox(Box=bbox_2.Box)  # -> Plane, X, Y, Z
dedomain_6 = DeconstructDomain(Domain=debox_2.Y)  # -> Start, End
subtraction_2 = Subtraction(A=dedomain_6.End, B=dedomain_6.Start)
multiplication_9 = Multiplication(A=subtraction_2, B="1.5")
series_3 = Series(Start=Slider(6884, range=0..10000), Step=multiplication_9, Count=Slider(5, range=0..10))
item_9 = ListItem(List=series_3, Index=0, Wrap=True)  # -> Item, Item1, Item2, Item3, Item4

crosecset = UniqueCrossSections(Panel=cull_5)
dec_reg_3 = DeconstructBoardRegion(BoardRegion=crosecset)  # -> Polyline, Name, Species, RTAngle, MoistureChange, DesiredRadius, Radius, BlendedRadius, ThicknessBlendedRadius

python = GhPythonScript(x=dec_reg_2.Species)  # -> out, a
# ---------- python: Python ----------
a = x.Name
# ---------- end python ----------
len = TextLength(Text=python.a)
bnd_5 = Bounds(Numbers=flatten(len))
dedomain_7 = DeconstructDomain(Domain=bnd_5)  # -> Start, End
gradient = Gradient(
    LowerLimit=dedomain_7.Start,
    UpperLimit=dedomain_7.End,
    Parameter=len,
    stops=[0: RGB(80, 55, 25), 0.5: RGB(159, 65, 29), 1: RGB(174, 166, 129)])
Y_7 = UnitY(Factor=item_9.Item3)
vec = Vector(Y_7)
move_7 = Move(Geometry=display_panel.ActiveBoards, Motion=vec)  # -> Geometry, Transform
move_8 = Move(Geometry=display_panel.PassiveBoards, Motion=vec)  # -> Geometry, Transform
preview = CustomPreview(Geometry=move_7.Geometry, Material=gradient)
preview_2 = CustomPreview(Geometry=move_8.Geometry, Material=ColourSwatch(SwatchColor=RGB(115, 115, 115)))

bnd_6 = Bounds(Numbers=flatten(dec_reg_2.RTAngle))
dedomain_8 = DeconstructDomain(Domain=bnd_6)  # -> Start, End
gradient_2 = Gradient(
    LowerLimit=dedomain_8.Start,
    UpperLimit=dedomain_8.End,
    Parameter=dec_reg_2.RTAngle,
    stops=[0: RGB(124, 0, 219), 1: RGB(207, 130, 255)])
Y_8 = UnitY(Factor=item_9.Item2)
vec_2 = Vector(Y_8)
move_9 = Move(Geometry=display_panel.ActiveBoards, Motion=vec_2)  # -> Geometry, Transform
move_10 = Move(Geometry=display_panel.PassiveBoards, Motion=vec_2)  # -> Geometry, Transform
preview_3 = CustomPreview(Geometry=move_9.Geometry, Material=gradient_2)
preview_4 = CustomPreview(Geometry=move_10.Geometry, Material=ColourSwatch(SwatchColor=RGB(115, 115, 115)))

bnd_7 = Bounds(Numbers=flatten(dec_reg_2.MoistureChange))
dedomain_9 = DeconstructDomain(Domain=bnd_7)  # -> Start, End
Y_9 = UnitY(Factor=item_9.Item1)
gradient_3 = Gradient(
    LowerLimit=dedomain_9.Start,
    UpperLimit=dedomain_9.End,
    Parameter=dec_reg_2.MoistureChange,
    stops=[0: RGB(180, 239, 240), 0.502: RGB(122, 194, 214), 1: RGB(120, 176, 222)])
vec_3 = Vector(Y_9)
move_11 = Move(Geometry=display_panel.ActiveBoards, Motion=vec_3)  # -> Geometry, Transform
move_12 = Move(Geometry=display_panel.PassiveBoards, Motion=vec_3)  # -> Geometry, Transform
preview_5 = CustomPreview(Geometry=move_11.Geometry, Material=gradient_3)
preview_6 = CustomPreview(Geometry=move_12.Geometry, Material=ColourSwatch(SwatchColor=RGB(115, 115, 115)))

c_script_3 = CSharpScript(desired=dec_reg_2.DesiredRadius, actual=dec_reg_2.ThicknessBlendedRadius)  # -> out, A; inputs desired: Double, actual: Double
# ---------- c_script_3: C# ----------
    A = 100 * Math.Abs(desired - actual) / ((desired + actual) / 2);
# ---------- end c_script_3 ----------
Y_10 = UnitY(Factor=item_9.Item)
gradient_4 = Gradient(LowerLimit=0, UpperLimit="100", Parameter=c_script_3.A, stops=[0.15: RGB(255, 130, 160), 0.85: RGB(220, 0, 40)])
vec_4 = Vector(Y_10)
move_13 = Move(Geometry=display_panel.ActiveBoards, Motion=vec_4)  # -> Geometry, Transform
move_14 = Move(Geometry=display_panel.PassiveBoards, Motion=vec_4)  # -> Geometry, Transform
swatch = ColourSwatch(SwatchColor=RGBA(0, 0, 0, 66))
preview_7 = CustomPreview(Geometry=move_13.Geometry, Material=gradient_4)
preview_8 = CustomPreview(Geometry=move_14.Geometry, Material=gradient_4)

number_slider_9 = Slider(1, range=0..100000)  # disabled

cull_6 = CullPattern(List=cull_5, CullPattern=cross_section)
deconstruct_panel_2 = DeconstructPanel(Panel=cull_6)
deconstruct_bilayer_3 = DeconstructBilayer(Bilayer=deconstruct_panel_2)
dec_board_3 = DeconstructBoard(Board=deconstruct_bilayer_3)  # -> Polyline, Name, Species, RTAngle, MoistureChange, DesiredRadius, Radius, BlendedRadius, BoardRegions
dec_reg_4 = DeconstructBoardRegion(BoardRegion=dec_board_3.BoardRegions)  # -> Polyline, ThicknessBlendedRadius, Species, MoistureChange, DesiredRadius, Radius, BlendedRadius, ThicknessBlendedRadius_2, ThicknessBlendedRadius_3

# ---- group: 2022 - Edgar
panel_3 = Panel("C:\Program Files\SOFiSTiK\2023\SOFiSTiK 2023\wps.exe")  # disabled
panel_4 = Panel("C:\Program Files\SOFiSTiK\2023\SOFiSTiK 2023\sof_cdb_w_edu-2023.dll")  # disabled
entwine = Entwine(Branch00=panel_3, Branch01=panel_4, FlattenInputs=True)  # -> simplify(Result); disabled

# ---- group: Create_Data_Path
button = Button()  # disabled

# ----
panel_5 = Panel("C:\Program Files\SOFiSTiK\2020\SOFiSTiK 2020\wps.exe")  # disabled
panel_6 = Panel("C:\Program Files\SOFiSTiK\2020\SOFiSTiK 2020\sof_cdb_w-70.dll")  # disabled
sofistik_path = ValueList({"2022-Edgar": 1, "2022-Other Users": 2}, selected="2022-Edgar")  # disabled
entwine_2 = Entwine(Branch00=panel_5, Branch01=panel_6, FlattenInputs=True)  # -> simplify(Result); disabled
filter = StreamFilter(Gate=sofistik_path, Stream0=entwine_2, Stream1=entwine)  # disabled
bang = ExplodeTree(Data=filter)  # -> Branch0, Branch1; disabled
pathwps_exe = Data(bang.Branch0)  # disabled
pathcdb_dll = FilePath(bang.Branch1)  # disabled
panel_7 = Panel("structure")  # disabled
panel_8 = Panel("\")  # disabled
pathinfo = PathInfo()  # -> Directory, Filename, Path
concat = Concatenate(FragmentA=pathinfo.Path)  # disabled
concat_2 = Concatenate(FragmentA=pathinfo.Path, FragmentB=panel_8, FragmentD=panel_7)  # disabled
createfolder = CSharpScript(path=concat, create=button)  # -> out, A; inputs path: String, create: Boolean; disabled
# ---------- createfolder: C# ----------
 
    
    if (create)
    {    
      if(!System.IO.Directory.Exists(path))
        System.IO.Directory.CreateDirectory(path);
    }
# ---------- end createfolder ----------
panel_9 = Panel(concat)  # disabled
panel_10 = Panel(concat_2)  # disabled
path = Data(panel_10)  # disabled

relay = Relay()  # disabled

# ---- group: Main Surfaces
surfaces = Data()  # disabled
assemble_structural_area_sofistik = AssembleStructuralAreaSofistik(Geometry=surfaces, GroupNr=relay)  # -> simplify(StructuralAreasSofiMesh)

# ---- group: Mesh
item_10 = ListItem(List=surfaces, Index=0, Wrap=True)  # disabled
item_11 = ListItem(List=surfaces, Index=0, Wrap=True)  # -> Item1, Item; disabled
debrep = DeconstructBrep(Brep=item_10)  # -> Faces, Edges, Vertices; disabled
debrep_2 = DeconstructBrep(Brep=item_11.Item1)  # -> Faces, Edges, Vertices; disabled
debrep_3 = DeconstructBrep(Brep=surfaces)  # -> Faces, Edges, Vertices; disabled
number_slider_10 = Slider(1, range=0..10)  # disabled
item_12 = ListItem(List=debrep.Vertices, Index=0, Wrap=True)  # -> Item, Item1; disabled
item_13 = ListItem(List=debrep_2.Vertices, Index=0, Wrap=True)  # -> Item1, Item; disabled
item_14 = ListItem(List=debrep_3.Edges, Index=number_slider_10, Wrap=True)  # disabled
pt_12 = Point(item_12.Item1)  # disabled
pt_13 = Point(item_12.Item)  # disabled
pt_14 = Point(item_13.Item1)  # disabled
data_8 = Data(item_14)  # disabled
len_2 = Length(Curve=data_8)  # disabled
len_3 = Length(Curve=debrep_3.Edges)  # disabled
rec_3pt = Rectangle3Pt(PointA=pt_13, PointB=pt_14, PointC=pt_12)  # -> Rectangle, Length; disabled
smaller_2 = SmallerThan(FirstNumber=len_2, SecondNumber=len_3)  # -> SmallerThan, OrEqualTo; disabled
boundary = BoundarySurfaces(Edges=rec_3pt.Rectangle)  # disabled
area_3 = Area(Geometry=boundary)  # -> Area, Centroid; disabled
cull_7 = CullPattern(List=debrep_3.Edges, CullPattern=smaller_2.SmallerThan)  # disabled
multiplication_10 = Multiplication(A=area_3.Area, B=1.5)  # disabled
panel_11 = Panel("1")  # disabled
assemble_structural_line_sofistik = AssembleStructuralLineSofistik(Curve=cull_7, GroupNr=<missing>)

# ---- group: Sof_Meshing
button_2 = Button()  # disabled
toggle = BooleanToggle(True)  # disabled

# ----
panel_12 = Panel("10000")  # disabled
panel_13 = Panel("0.13")  # disabled
panel_14 = Panel("-0.005")  # disabled
panel_15 = Panel("1.8")  # disabled
assemble_mesh_properties_sofimesh = AssembleMeshPropertiesSofiMesh(
    GroupDivisor=panel_12,
    Topo="ON 0",
    TolG=panel_14,
    HMin=panel_13,
    Fein=panel_13,
    EFak=panel_15,
    Prog=panel_15,
    NodeIndex=1000)

# ----
# SOFIMESH
generate_mesh_sofistik = GenerateMeshSofistik(
    Path=path,
    StructuralLines=assemble_structural_line_sofistik,
    StructuralAreas=assemble_structural_area_sofistik,
    MeshProperties=assemble_mesh_properties_sofimesh,
    WpsExe=pathwps_exe,
    Cdb_w50Dll=pathcdb_dll,
    Run=button_2,
    meshs_Branch0_Path="{1}",
    meshs_Branch1_Path="{2}",
    meshs_Branch2_Path="{7}",
    meshs_Branch3_Path="{8}",
    meshs_Branch4_Path="{9}",
    meshs_Branch5_Path="{10}",
    meshs_Branch6_Path="{11}",
    meshs_Branch7_Path="{12}",
    meshs_Branch8_Path="{13}",
    meshs_Branch9_Path="{14}",
    meshs_Branch10_Path="{15}",
    meshs_Branch11_Path="{16}",
    meshs_Branch12_Path="{17}",
    meshs_Branch13_Path="{18}",
    meshs_Branch14_Path="{19}",
    meshs_Branch15_Path="{20}",
    meshs_Branch16_Path="{21}",
    meshs_Branch17_Path="{22}",
    meshs_Branch18_Path="{23}",
    meshs_Branch19_Path="{24}",
    meshs_Branch20_Path="{25}",
    meshs_Branch21_Path="{26}",
    meshs_Branch22_Path="{27}",
    meshs_Branch23_Path="{28}",
    meshs_Branch24_Path="{29}",
    meshs_Branch25_Path="{30}",
    meshs_Branch26_Path="{31}",
    meshs_Branch27_Path="{32}",
    meshs_Branch28_Path="{33}",
    meshs_Branch29_Path="{34}"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)  # -> Meshs, Completed
flatten = FlattenTree(Tree=generate_mesh_sofistik.Meshs, Path="{0}")  # -> simplify(graft(Tree)); disabled
mesh = Mesh(flatten)  # disabled

pt_15 = Point()  # disabled
support = RemoteSender(pt_15)
relay_2 = Relay()  # disabled
# timb no 11 ep 17136[N/mm2] g 667[N/mm2] e90 370[N/mm2] g90 50[N/mm2] gam 7.2[KN/m3]
panel_16 = Panel("beech")  # disabled
# timb no 11 ep 12200[N/mm2] g 690[N/mm2] e90 370[N/mm2] g90 50[N/mm2] gam 4.8[KN/m3]
panel_17 = Panel("Süruce")  # disabled

# ---- group: AQUA
material = Panel("""KOPF
UNIT 5
NORM 'DIN' 'en199x-200x' COUN 49 UNIT 5

HOLZ 1    C '24:1' E90 370 BEZ "=Spruce"
ARBL EPS BRUC SIG 1.300000[-]
HMAT 1 TYP FOUR NSP 0.100000 A 1

HOLZ 4  PLY '40:1' TMAX 10 BEZ "=Plywood 40 Cl.1 (EN 1995)"
ARBL EPS BRUC SIG 1.200000[-]
HMAT 4 TYP FOUR NSP 0.100000 A 1

STAH 6    S '235' TMAX 40 BEZ "=S 235 (EN 10025-2)" GAM 0.0
ARBL EPS GEBR SIG 1[-]
ARBL EPS BRUC SIG 1[-] TYP  EXT
HMAT 3 TYP FOUR NSP 0 A 1

HOLZ NR 20 ep 1713[N/mm2] g 880[N/mm2] e90 1000[N/mm2] g90 61[N/mm2] gam 7.2[KN/m3]


HOLZ NR 10 ep 12200[N/mm2] g 690[N/mm2] e90 370[N/mm2] g90 50[N/mm2] gam 4.8[KN/m3]


HOLZ NR 11 ep 370[N/mm2] g 690[N/mm2] e90 12200[N/mm2] g90 50[N/mm2] gam 4.8[KN/m3]

MLAY NR 100  T0 {0}[mm]  11 $$
             T1 {1}[mm]  10 $$
             T2 {0}[mm]  11 Bez 'Bilayer'

MLAY NR 101  T0 {0}[mm]  11 $$
             T1 {1}[mm]  20 $$
             T2 {0}[mm]  11 Bez 'BilayerB'

MLAY NR 200  T0 {0}[mm]  11 $$
             T1 {1}[mm]  10 $$
	     T3 {0}[mm]  11 $$
             T4 {1}[mm]  10 $$
             T5 {0}[mm]  11 Bez '2Bilayer'

MLAY NR 201  T0 {0}[mm]  11 $$
             T1 {1}[mm]  20 $$
	     T3 {0}[mm]  11 $$
             T4 {1}[mm]  20 $$
             T5 {0}[mm]  11 Bez '2BilayerB'

MLAY NR 300  T0 {0}[mm]  11 $$
             T1 {1}[mm]  10 $$
	     T2 {0}[mm]  11 $$
             T3 {1}[mm]  10 $$
	     T4 {0}[mm]  11 $$
             T5 {1}[mm]  10 $$
             T6 {0}[mm]  11 Bez '3Bilayer'

MLAY NR 301  T0 {0}[mm]  11 $$
             T1 {1}[mm]  20 $$
	     T2 {0}[mm]  11 $$
             T3 {1}[mm]  20 $$
	     T4 {0}[mm]  11 $$
             T5 {1}[mm]  20 $$
             T6 {0}[mm]  11 Bez '3BilayerB'""")  # disabled
panel_18 = Panel("4")  # disabled
panel_19 = Panel("20")  # disabled
format = Format(Format=material, Culture=127, Data0=panel_18, Data1=panel_19)  # disabled
panel_20 = Panel(format)  # disabled
aqua_file = Data(panel_20)  # disabled

# ----
mesh_2 = Data(mesh)  # disabled
graft = GraftTree(Tree=mesh_2, IncludeEmptyLists=True, IncludeNullItems=True)  # -> simplify(Tree); disabled
area_4 = Area(Geometry=graft)  # -> Area, Centroid; disabled
addition = Addition(A=panel_18, B=panel_19, C=panel_18)  # disabled
srf_cp = SurfaceClosestPoint(Point=area_4.Centroid, Surface=graft(surfaces))  # -> Point, UVPoint, Distance; disabled
curvature = PrincipalCurvature(Surface=graft(surfaces), Point=srf_cp.UVPoint)  # -> Frame, Min, Max, MinDirection, MaxDirection; disabled
deplane = DeconstructPlane(Plane=curvature.Frame)  # -> Origin, XAxis, YAxis, ZAxis; disabled
amp = Amplitude(Vector=deplane.XAxis, Amplitude=0.1)  # disabled
amp_2 = Amplitude(Vector=deplane.YAxis, Amplitude=0.1)  # disabled
amp_3 = Amplitude(Vector=deplane.ZAxis, Amplitude=0.1)  # disabled
vdis = VectorDisplay(Anchor=area_4.Centroid, Vector=amp)  # disabled
vdis_2 = VectorDisplay(Anchor=area_4.Centroid, Vector=amp_2)  # disabled
vdis_3 = VectorDisplay(Anchor=area_4.Centroid, Vector=amp_3)  # disabled
assemble_shell_sofistika = AssembleShellSofistikA(Mesh=simplify(graft(mesh_2)), MaterialNr=<missing>, Thickness=reverse(relay_2), GroupNr=simplify(graft(relay)))  # -> flatten(Shell)

# ---- group: Preassembly
preassemble_model_sofistik = PreAssembleModelSofistik(Points=flatten(pt_15), Shells=assemble_shell_sofistika, tol=0.001)  # -> NodeList, Shells, Beams, Trusses, Cables, Couplings

# ----
support_2 = RemoteReceiver(support)
# Ase: +prog ase urs:5 $ SINGLE LCs
# kopf
# steu solv 4
# WARN = 120,575
# syst prob line iter 1000
# lf 1000 egz 1.0 bez 'G'
# ende
number_slider_11 = Slider(0.05, range=0..0.1)  # disabled

# ---- group: Loading / Selfweight Floor Build Up
item_15 = ListItem(List=preassemble_model_sofistik.Shells, Index=0, Wrap=True)  # -> Item, Item1; disabled
panel_21 = Panel("1001")  # disabled
panel_22 = Panel("pzz")  # disabled
panel_23 = Panel("-1.5")  # disabled
assemble_meshload_sofistik = AssembleMeshLoadSofistik(LoadMesh=item_15.Item1, LoadcaseNumber=panel_21, LoadType=panel_22, LoadValues=panel_23)  # -> flatten(MeshLoad)

# ---- group: Loading / Traffic Loads
item_16 = ListItem(List=preassemble_model_sofistik.Shells, Index=0, Wrap=True)  # -> Item, Item1; disabled
panel_24 = Panel("1002")  # disabled
panel_25 = Panel("pzz")  # disabled
panel_26 = Panel("0")  # disabled
assemble_meshload_sofistik_2 = AssembleMeshLoadSofistik(LoadMesh=item_16.Item1, LoadcaseNumber=panel_24, LoadType=panel_25, LoadValues=panel_26)  # -> flatten(MeshLoad)

# ----
# ASE
ase = Panel("""+prog ase urs:5 $ SINGLE LCs
kopf
steu solv 4
WARN = 120,575
syst prob line iter 1000
lf 1000 egz 1.0 bez 'G'
ende""")  # disabled
# SLS: $--------------------------
# $SOLVER
# #define SOLV = 4 $4 = paralleles Rechnen
# #define WARN = 120,575
# $SYSTEM
# #define PROB = TH3
# #define nITER = 250
# #define FMAX = 1.1
# #define TOL = -0.0001
# #define NMAT = nein
# #define ITER = 3 W2 1 $3 W2 1 = Update Steifigkeit nach jedem Iterationsschritt
# $SEILE
# #define SEIL = 0 $0=ohne inneren Seildurchhang; 2=mit
# $Deadload
# #define G=1.00
# $--------------------------
# 
# +PROG ASE
# #define LF =100
# #define BEZ='1.0G+1.0Gadd'
# KOPF LF$(LF): $(BEZ)
# STEU SOLV $(SOLV) ; STEU ITER $(ITER) ; STEU SEIL $(SEIL)
# SYST PROB $(PROB) ITER $(nITER) FMAX $(FMAX) TOL $(TOL) NMAT $(NMAT)
# STEU WARN $(WARN)
# GRUP      -  $ alle Gruppen einschalten
# 
# LF $(LF) EGZ $(G)*1.0 BEZ $(BEZ)
# LC 1001 FAKT 1.0 $Gadd
# ENDE
# 
# +PROG ASE
# #define LF =101
# #define BEZ='1.0G+1.0Gadd+1.0Code'
# KOPF LF$(LF): $(BEZ)
# STEU SOLV $(SOLV) ; STEU ITER $(ITER) ; STEU SEIL $(SEIL)
# SYST PROB $(PROB) ITER $(nITER) FMAX $(FMAX) TOL $(TOL) NMAT $(NMAT)
# STEU WARN $(WARN)
# GRUP      -  $ alle Gruppen einschalten
# 
# LF $(LF) EGZ $(G)*1.0 BEZ $(BEZ)
# LC 1001 FAKT 1.0 $Gadd
# LC 1002 FAKT 1.0 $Code
# ENDE
# 
# +PROG ASE
# #define LF =102
# #define BEZ='1.0G+1.0Gadd+1.0Code+1.0Q1'
# KOPF LF$(LF): $(BEZ)
# STEU SOLV $(SOLV) ; STEU ITER $(ITER) ; STEU SEIL $(SEIL)
# SYST PROB $(PROB) ITER $(nITER) FMAX $(FMAX) TOL $(TOL) NMAT $(NMAT)
# STEU WARN $(WARN)
# GRUP      -  $ alle Gruppen einschalten
# 
# LF $(LF) EGZ $(G)*1.0 BEZ $(BEZ)
# LC 1001 FAKT 1.0 $Gadd
# LC 1002 FAKT 1.0 $Code
# LC 1003 FAKT 1.0 $Q1
# ENDE
sls = Panel("""$--------------------------
$SOLVER
#define SOLV = 4 $4 = paralleles Rechnen
#define WARN = 120,575
$SYSTEM
#define PROB = TH2
#define nITER = 250
#define FMAX = 1.1
#define TOL = -0.01
#define NMAT = nein
#define ITER = 3 W2 1 $3 W2 1 = Update Steifigkeit nach jedem Iterationsschritt
$SEILE
#define SEIL = 0 $0=ohne inneren Seildurchhang; 2=mit
$Deadload
#define G=1.00
$--------------------------

+PROG ASE
#define LF =101
#define BEZ='1.0G+1.0Gadd+1.0Code'
KOPF LF$(LF): $(BEZ)
STEU SOLV $(SOLV) ; STEU ITER $(ITER) ; STEU SEIL $(SEIL)
SYST PROB $(PROB) ITER $(nITER) FMAX $(FMAX) TOL $(TOL) NMAT $(NMAT)
STEU WARN $(WARN)
GRUP      -  $ alle Gruppen einschalten

LF $(LF) EGZ $(G)*1.0 BEZ $(BEZ)
LC 1001 FAKT 1.0 $Gadd
LC 1002 FAKT 1.0 $Code
ENDE""")  # disabled
# ULS: $--------------------------
# $SOLVER
# #define SOLV = 4 $4 = paralleles Rechnen
# #define WARN =  120,575
# $SYSTEM
# #define PROB = TH3
# #define nITER = 250
# #define FMAX = 1.1
# #define TOL = -0.0001
# #define NMAT = nein
# #define ITER = 3 W2 1 $3 W2 1 = Update Steifigkeit nach jedem Iterationsschritt
# $SEILE
# #define SEIL = 0 $0=ohne inneren Seildurchhang; 2=mit
# $Deadload
# #define G=1.00
# $--------------------------
# 
# +PROG ASE
# #define LF =200
# #define BEZ='1.35G+1.35Gadd'
# KOPF LF$(LF): $(BEZ)
# STEU SOLV $(SOLV) ; STEU ITER $(ITER) ; STEU SEIL $(SEIL)
# SYST PROB $(PROB) ITER $(nITER) FMAX $(FMAX) TOL $(TOL) NMAT $(NMAT)
# STEU WARN $(WARN)
# GRUP      -  $ alle Gruppen einschalten
# 
# LF $(LF) EGZ $(G)*1.35 BEZ $(BEZ)
# LC 1001 FAKT 1.35 $Gadd
# ENDE
# 
# +PROG ASE
# #define LF =201
# #define BEZ='1.35G+1.35Gadd+1.5Code'
# KOPF LF$(LF): $(BEZ)
# STEU SOLV $(SOLV) ; STEU ITER $(ITER) ; STEU SEIL $(SEIL)
# SYST PROB $(PROB) ITER $(nITER) FMAX $(FMAX) TOL $(TOL) NMAT $(NMAT)
# STEU WARN $(WARN)
# GRUP      -  $ alle Gruppen einschalten
# 
# LF $(LF) EGZ $(G)*1.35 BEZ $(BEZ)
# LC 1001 FAKT 1.35 $Gadd
# LC 1002 FAKT 1.5 $Code
# ENDE
# 
# +PROG ASE
# #define LF =202
# #define BEZ='1.35G+1.35Gadd+1.5Code+1.5Q1'
# KOPF LF$(LF): $(BEZ)
# STEU SOLV $(SOLV) ; STEU ITER $(ITER) ; STEU SEIL $(SEIL)
# SYST PROB $(PROB) ITER $(nITER) FMAX $(FMAX) TOL $(TOL) NMAT $(NMAT)
# STEU WARN $(WARN)
# GRUP      -  $ alle Gruppen einschalten
# 
# LF $(LF) EGZ $(G)*1.35 BEZ $(BEZ)
# LC 1001 FAKT 1.35 $Gadd
# LC 1002 FAKT 1.5 $Code
# LC 1003 FAKT 1.5 $Q1
# ENDE
uls = Panel("""$--------------------------
$SOLVER
#define SOLV = 4 $4 = paralleles Rechnen
#define WARN =  120,575
$SYSTEM
#define PROB = TH2
#define nITER = 250
#define FMAX = 1.1
#define TOL = -0.01
#define NMAT = nein
#define ITER = 3 W2 1 $3 W2 1 = Update Steifigkeit nach jedem Iterationsschritt
$SEILE
#define SEIL = 0 $0=ohne inneren Seildurchhang; 2=mit
$Deadload
#define G=1.00
$--------------------------

+PROG ASE
#define LF =201
#define BEZ='1.35G+1.35Gadd+1.5Code'
KOPF LF$(LF): $(BEZ)
STEU SOLV $(SOLV) ; STEU ITER $(ITER) ; STEU SEIL $(SEIL)
SYST PROB $(PROB) ITER $(nITER) FMAX $(FMAX) TOL $(TOL) NMAT $(NMAT)
STEU WARN $(WARN)
GRUP      -  $ alle Gruppen einschalten

LF $(LF) EGZ $(G)*1.35 BEZ $(BEZ)
LC 1001 FAKT 1.35 $Gadd
LC 1002 FAKT 1.5 $Code
ENDE""")  # disabled
merge_11 = Merge(Data1=ase, Data2=sls, Data3=uls)  # disabled

cullpt = CullDuplicates(Points=support_2, Tolerance=number_slider_11, CullMode=1)  # -> Points, Indices, Valence; disabled

# ----
# SUPPORT DEFINITION
node_sofistik = NodeSofistik(preassemble_model_sofistik.NodeList)
find_nodes_sofistik = FindNodesSofistik(Nodes=node_sofistik, Geometry=cullpt.Points, tol=0.001)
panel_27 = Panel("F")  # disabled
assemble_support_sofistik = AssembleSupportSofistik(Node=find_nodes_sofistik, Type=panel_27)

# ---- group: Loading / Random Point Load / Point Load
panel_28 = Panel("1003")  # disabled
panel_29 = Panel("pzz")  # disabled
panel_30 = Panel("-1.0")  # disabled

# ---- group: Loading / Random Point Load
mesh_3 = Mesh(mesh)  # disabled
item_17 = ListItem(List=flatten(mesh_3), Index=0, Wrap=True)  # -> Item, Item1; disabled
demesh = DeconstructMesh(Mesh=item_17.Item1)  # -> Vertices, Faces, Colours, Normals; disabled
random_point = GhPythonScript(x=demesh.Vertices)  # -> out, a; inputs x: list of Point3d; disabled
# ---------- random_point: Python ----------
import Rhino.Geometry as rg
import random

# List of points

# Get a random point from the list
random_point = random.choice(x)

a = random_point
# ---------- end random_point ----------
pt_16 = Point(random_point.a)  # disabled
find_nodes_sofistik_2 = FindNodesSofistik(Nodes=preassemble_model_sofistik.NodeList, Geometry=pt_16, tol=0.001)
assemble_pointload_sofistik = AssemblePointLoadSofistik(LoadNodes=find_nodes_sofistik_2, LoadcaseNumber=panel_28, LoadType=panel_29, LoadValues=panel_30)

# ----
intersect_shells_sofistik = IntersectShellsSofistik(Shells=preassemble_model_sofistik.Shells, shell_combination=0, tol=0.001)  # -> NodesASofistikA, NodesBSofistikA
panel_31 = Panel("KF")  # disabled
assemble_coupling_sofistik = AssembleCouplingSofistik(Node=intersect_shells_sofistik.NodesASofistikA, ReferenceNode=intersect_shells_sofistik.NodesBSofistikA, Type=panel_31)  # -> flatten(CouplingSofistikA)

# ---- group: Loading
merge_12 = Merge(Data1=assemble_meshload_sofistik, Data2=assemble_meshload_sofistik_2)  # disabled

# ---- group: Calculation
support_sofistik = SupportSofistik(flatten(assemble_support_sofistik))
path_2 = Data(path)  # disabled
aqua = Data(aqua_file)  # disabled
button_3 = Button()  # disabled
load_sofistik = LoadSofistik(merge_12)
assemble_model_sofistik = AssembleModelSofistik(
    Path=path_2,
    AquaFile=aqua,
    Nodes=preassemble_model_sofistik.NodeList,
    Shells=flatten(preassemble_model_sofistik.Shells),
    Beams=preassemble_model_sofistik.Beams,
    Couplings=assemble_coupling_sofistik,
    Supports=support_sofistik,
    Loads=load_sofistik,
    AseFile=merge_11,
    SofistikPath=pathwps_exe,
    Run=button_2,
    disable_warnings=False,
    run_sofistik=True)  # -> CdbPath, GroupDivisor, Springs, Beams, Trusses, Cables, Completed, Errors

# ----
toggle_2 = BooleanToggle(False)  # disabled

# ---- group: Sofistik
button_4 = Button()  # disabled
button_5 = Button()  # disabled
button_6 = Button()  # disabled
button_7 = Button()  # disabled
open_sofistik = OpenSofistik(Path=assemble_model_sofistik.CdbPath, Teddy=button_4, Animator=button_5, Wingraf=button_6, FileLocation=button_7)

# ----
panel_32 = Panel("""101 SLS - Deform
202 ULS - Stresses""")  # disabled

number_slider_12 = Slider(2, range=0..100)  # disabled
toggle_3 = BooleanToggle(True)  # disabled
load_case = Panel("101")  # disabled
uls_2 = Panel("201")  # disabled
pathcdb_dll_2 = FilePath(pathcdb_dll)  # disabled
pathcdb = FilePath(assemble_model_sofistik.CdbPath)  # disabled

number_slider_13 = Slider(6000, range=0..10000)  # disabled

# ---- group: CLT
pathcdb_2 = FilePath(pathcdb)  # disabled
panel_33 = Panel("0.8")  # disabled
pathcdb_dll_3 = FilePath(pathcdb_dll_2)  # disabled
check_cross_sections = CSharpScript(
    path=pathcdb_2,
    lcNumbers=uls_2,
    dllPath=pathcdb_dll_3,
    kmod=panel_33,
    run=toggle_3,
    Reference="C:\Users\Alex Reiner\AppData\Roaming\Grasshopper\Libraries\Sofistik.gha")  # -> out, eta_x, eta_y, eta_vxy, eta_vz, eta_v, eta; inputs path: String, lcNumbers: list of Int32, dllPath: String, kmod: Double, run: Boolean; disabled
# ---------- check_cross_sections: C# usings ----------
using System.IO;
using System.Linq;
using System.Data;
using System.Drawing;
using System.Reflection;
using System.Windows.Forms;
using System.Xml;
using System.Xml.Linq;
using System.Runtime.InteropServices;

using Rhino.DocObjects;
using Rhino.Collections;
using GH_IO;
using GH_IO.Serialization;
using Sofistik;
using Sofistik.Properties;
using Sofistik.Meshing;
# ---------- check_cross_sections: C# ----------
    // Safety factor
    double gammaM = 1.3;

    // Check for validity
    if (string.IsNullOrWhiteSpace(path)) { return; }
    if (string.IsNullOrWhiteSpace(dllPath)) { return; }

    if (!run)
      return;

    // Load sof_cdb.dll under specified path
    NativeMethods.SetDllDirectory(Path.GetDirectoryName(dllPath));
    IntPtr hModule = NativeMethods.LoadLibrary(dllPath);
    if (hModule == IntPtr.Zero)
    {
      Print("HModule = IntPtr.Zero, aborted");
      return;
    }

    // Retrieve the materials from the database
    materialInfos = CdbMethods.GetMaterialInfos(hModule, path);
    materials = new Dictionary<int, Sofistik.Material>();
    foreach (KeyValuePair<int, MaterialType> materialInfo in materialInfos)
    {
      int mnr = materialInfo.Key;
      materials.Add(mnr, CdbMethods.GetMaterial(hModule, path, mnr));
    }

    //  foreach (KeyValuePair<int, Sofistik.Material> kvp in materials)
    //  {
    //    int mnr = kvp.Key;
    //    TimberMaterial material = kvp.Value as TimberMaterial;
    //    if (material == null)
    //      continue;
    //    Rhino.RhinoApp.WriteLine("material " + mnr.ToString() + " Fv,k " + (0.001 * material.Fv_k).ToString());
    //    Rhino.RhinoApp.WriteLine("material " + mnr.ToString() + " Fvb,k " + (0.001 * material.Fvb_k).ToString());
    //    Rhino.RhinoApp.WriteLine("material " + mnr.ToString() + " Fvb,90,k " + (0.001 * material.Fvb90_k).ToString());
    //  }

    // Retrieve quads and quad results from database
    List<CQUAD> quads = CdbMethods.GetQuads(hModule, path);
    int nQuads = quads.Count;

    quadResults = new Dictionary<int,List<CQUAD_FOR>>();
    foreach (var quad in quads)
    {
      quadResults.Add(quad.m_NR, new List<CQUAD_FOR>());
    }
    foreach (int lcNumber in lcNumbers)
    {
      if (lcNumber <= 0)
        return;
      List<CQUAD_FOR> quadForces = CdbMethods.GetQuadForces(hModule, path, lcNumber);
      if (quadForces.Count != nQuads)
      {
        Print("quadForces.Count != quads.Count");
        return;
      }
      foreach (var quadForce in quadForces)
      {
        int quadNr = quadForce.m_NR;
        if(quadResults.ContainsKey(quadNr))
        {
          quadResults[quadNr].Add(quadForce);
        }
      }
    }

    // Initialize output variables
    List<double> _eta_x = new List<double>();
    List<double> _eta_y = new List<double>();
    List<double> _eta_vxy = new List<double>();
    List<double> _eta_vz = new List<double>();
    List<double> _eta_v = new List<double>();
    List<double> _eta = new List<double>();

    for (int i = 0; i < nQuads; i++)
    {
      double eta_x_i = 0.0;
      double eta_y_i = 0.0;
      double eta_vxy_i = 0.0;
      double eta_vz_i = 0.0;
      double eta_v_i = 0.0;

      // retrieve quadnr and thickness
      int quadNr = quads[i].m_NR;
      double t = 1000.0 * (double) quads[i].m_THICK[0]; // mm

      // retrieve material nr of the quad
      int mnr = quads[i].m_MAT;

      // check if material is mlay or single layer material
      if (materials[mnr].MaterialType != MaterialType.Mlay)
      {
        ComputeSingleLayerResult(quadNr, t, mnr, kmod, gammaM, out eta_x_i, out eta_y_i, out eta_vxy_i, out eta_vz_i);
      }
      else
      {
        ComputeMultiLayerResult(quadNr, mnr, kmod, gammaM, out eta_x_i, out eta_y_i, out eta_vxy_i, out eta_vz_i);
      }
      eta_v_i = eta_vxy_i + eta_vz_i;
      double eta_i = new double[]{eta_x_i, eta_y_i, eta_v_i}.Max();
      _eta_x.Add(eta_x_i);
      _eta_y.Add(eta_y_i);
      _eta_vxy.Add(eta_vxy_i);
      _eta_vz.Add(eta_vz_i);
      _eta_v.Add(eta_v_i);
      _eta.Add(eta_i);
    }

    eta_x = _eta_x;
    eta_y = _eta_y;
    eta_vxy = _eta_vxy;
    eta_vz = _eta_vz;
    eta_v = _eta_v;
    eta = _eta;

    NativeMethods.FreeLibrary(hModule);
    NativeMethods.SetDllDirectory(null);
# ---------- check_cross_sections: C# additional code ----------
  Dictionary<int, MaterialType> materialInfos;
  Dictionary<int, Sofistik.Material> materials;
  Dictionary<int,List<CQUAD_FOR>> quadResults;

  protected void ComputeSingleLayerResult(int quadNr, double t, int mnr, double kmod, double gammaM,
    out double eta_x, out double eta_y, out double eta_vxy, out double eta_vz)
  {
    // retrieve the material values of the quad
    TimberMaterial material = materials[mnr] as TimberMaterial;
    if (material == null)
    {
      Print("Cannot perform timber checks on non-timber materials, aborted.");
      eta_x = 0.0;
      eta_y = 0.0;
      eta_vxy = 0.0;
      eta_vz = 0.0;
      return;
    }
    double fm0_rd = 0.001 * (kmod / gammaM) * material.Fm0_k;
    double fm90_rd = 0.001 * (kmod / gammaM) * material.Fm90_k;   // N/mm²
    double ft0_rd = 0.001 * (kmod / gammaM) * material.Ft0_k;    // N/mm²
    double ft90_rd = 0.001 * (kmod / gammaM) * material.Ft90_k;   // N/mm²
    double fc0_rd = 0.001 * (kmod / gammaM) * material.Fc0_k;    // N/mm²
    double fc90_rd = 0.001 * (kmod / gammaM) * material.Fc90_k;   // N/mm²
    double fv_rd = 0.001 * (kmod / gammaM) * material.Fv_k;     // N/mm²
    double fvb_rd = 0.001 * (kmod / gammaM) * material.Fvb_k;    // N/mm²
    double fvb90_rd = 0.001 * (kmod / gammaM) * material.Fvb90_k;  // N/mm²

    // retrieve the quad forces for this quad, n --> kN/m, m --> kN-m/m
    List<CQUAD_FOR> quadForces = quadResults[quadNr];
    double nx_t = 0.0;
    double nx_c = 0.0;
    double ny_t = 0.0;
    double ny_c = 0.0;
    double nxy = 0.0;
    double mx = 0.0;
    double my = 0.0;
    double mxy = 0.0;
    double vx = 0.0;
    double vy = 0.0;
    foreach (var quadForce in quadForces)
    {
      if (quadForce.m_NX > nx_t)
        nx_t = quadForce.m_NX;
      if (quadForce.m_NX < nx_c)
        nx_c = quadForce.m_NX;
      if (quadForce.m_NY > ny_t)
        ny_t = quadForce.m_NY;
      if (quadForce.m_NY < ny_c)
        ny_c = quadForce.m_NY;
      if (Math.Abs(quadForce.m_NXY) > nxy)
        nxy = Math.Abs(quadForce.m_NXY);

      if (Math.Abs(quadForce.m_MXX) > mx)
        mx = Math.Abs(quadForce.m_MXX);
      if (Math.Abs(quadForce.m_MYY) > my)
        my = Math.Abs(quadForce.m_MYY);
      if (Math.Abs(quadForce.m_MXY) > mxy)
        mxy = Math.Abs(quadForce.m_MXY);

      if (Math.Abs(quadForce.m_VX) > vx)
        vx = Math.Abs(quadForce.m_VX);
      if (Math.Abs(quadForce.m_VY) > vy)
        vy = Math.Abs(quadForce.m_VY);
    }

    // Bending Resistance and Axial resistance
    // x-Direction:
    double mx_rd = 0.001 * fm0_rd * t * t / 6.0;
    double nx_c_rd = fc0_rd * t;  // kN/m
    double nx_t_rd = ft0_rd * t;  // kN/m

    // y-Direction:
    double my_rd = 0.001 * fm90_rd * t * t / 6.0;
    double ny_c_rd = fc90_rd * t;  // kN/m
    double ny_t_rd = ft90_rd * t;  // kN/m

    // Torsion Resistance
    double mxy_rd = 1000.0 * fv_rd * t * t / 6.0; // TODO: CHECK THIS

    // In-Plane shear resistance
    double nxy_rd = 1000.0 * fv_rd * t;

    // Out-of-plane shear resistance
    double vx_rd = fvb_rd * t / 1.5;
    double vy_rd = fvb90_rd * t / 1.5;

    eta_x = Math.Max(
      mx / mx_rd + nx_t / nx_t_rd,
      mx / mx_rd - nx_c / nx_c_rd);

    eta_y = Math.Max(
      my / my_rd + ny_t / ny_t_rd,
      my / my_rd - ny_c / ny_c_rd);
    eta_vxy = mxy / mxy_rd + nxy / nxy_rd;
    eta_vz = Math.Sqrt(Math.Pow(vx / vx_rd, 2) + Math.Pow(vy / vy_rd, 2));
  }

  protected void ComputeMultiLayerResult(int quadNr, int mnr, double kmod, double gammaM,
    out double eta_x, out double eta_y, out double eta_vxy, out double eta_vz)
  {
    eta_x = 0.0;
    eta_y = 0.0;
    eta_vxy = 0.0;
    eta_vz = 0.0;

    int layerMaterialNr = 0;

    LayeredMaterial layeredMaterial = materials[mnr] as LayeredMaterial;
    if (layeredMaterial == null)
    {
      Print("Multi-Layer results can only be computed with multi-layer materials.");
      return;
    }

    Dictionary<int,TimberMaterial> timberMaterials = new Dictionary<int,TimberMaterial>();
    foreach (int key in materials.Keys)
    {
      var timberMaterial = materials[key] as TimberMaterial;
      if (timberMaterial != null)
      {
        timberMaterials.Add(key, timberMaterial);
      }
    }

    List<Tuple<int,double,double>> layers = layeredMaterial.Layers;

    // compute t, assume symetric build-up
    double t = 0.0;     // m
    double tmax = 0.0;  // m
    for (int j = 0; j < layers.Count; j++)
    {
      t += layers[j].Item2;
      if (layers[j].Item2 > tmax)
      {
        tmax = layers[j].Item2;
      }
    }

    // retrieve the quad forces for this quad, n --> kN/m, m --> kN-m/m
    List<CQUAD_FOR> quadForces = quadResults[quadNr];
    double nx_t = 0.0;
    double nx_c = 0.0;
    double ny_t = 0.0;
    double ny_c = 0.0;
    double nxy = 0.0;
    double mx = 0.0;
    double my = 0.0;
    double mxy = 0.0;
    double vx = 0.0;
    double vy = 0.0;
    foreach (var quadForce in quadForces)
    {
      if (quadForce.m_NX > nx_t)
        nx_t = quadForce.m_NX;
      if (quadForce.m_NX < nx_c)
        nx_c = quadForce.m_NX;
      if (quadForce.m_NY > ny_t)
        ny_t = quadForce.m_NY;
      if (quadForce.m_NY < ny_c)
        ny_c = quadForce.m_NY;
      if (Math.Abs(quadForce.m_NXY) > nxy)
        nxy = Math.Abs(quadForce.m_NXY);

      if (Math.Abs(quadForce.m_MXX) > mx)
        mx = Math.Abs(quadForce.m_MXX);
      if (Math.Abs(quadForce.m_MYY) > my)
        my = Math.Abs(quadForce.m_MYY);
      if (Math.Abs(quadForce.m_MXY) > mxy)
        mxy = Math.Abs(quadForce.m_MXY);

      if (Math.Abs(quadForce.m_VX) > vx)
        vx = Math.Abs(quadForce.m_VX);
      if (Math.Abs(quadForce.m_VY) > vy)
        vy = Math.Abs(quadForce.m_VY);
    }

    // compute Bx, By and Bxy
    // compute Dx, Dy and Dxy
    double Bx = 0.0;
    double By = 0.0;
    double Bxy = 0.0;
    double Dx = 0.0;
    double Dy = 0.0;
    double Dxy = 0.0;
    double z_j = -0.5 * t;
    for (int j = 0; j < layers.Count; j++)
    {
      // material properties
      double Ex_j = timberMaterials[layers[j].Item1].E0;   // [kN/m²]
      double Ey_j = timberMaterials[layers[j].Item1].E90;  // [kN/m²]
      double Gxy_j = timberMaterials[layers[j].Item1].G0;  // [kN/m²]

      // geometry information
      double t_j = layers[j].Item2;
      z_j += 0.5 * t_j;
      Bx += Ex_j * (t_j * Math.Pow(z_j, 2) + Math.Pow(t_j, 3) / 12);
      By += Ey_j * (t_j * Math.Pow(z_j, 2) + Math.Pow(t_j, 3) / 12);
      Bxy += Gxy_j * (2 * t_j * Math.Pow(z_j, 2) + Math.Pow(t_j, 3) / 6);
      Dx += Ex_j * t_j;
      Dy += Ey_j * t_j;
      Dxy += Gxy_j * t_j;
      z_j += 0.5 * t_j;
    }

    // compute ESx and ESy
    double ESx = 0.0;
    double ESy = 0.0;
    z_j = 0.0;
    if (layers.Count == 3 || layers.Count == 7 || layers.Count == 11)
    {
      // rolling shear, critical layer for x-Direction: midlayer
      // rolling shear, critical layer for y-Direction: midlayer + 1
      for (int j = layers.Count / 2; j < layers.Count; j++)
      {
        // material properties
        double Ex_j = timberMaterials[layers[j].Item1].E0;   // [kN/m²]
        double Ey_j = timberMaterials[layers[j].Item1].E90;  // [kN/m²]

        // geometry information
        double t_j = layers[j].Item2;
        if (j > layers.Count / 2)
        {
          z_j += 0.5 * t_j;
          ESx += Ex_j * z_j * t_j;
          ESy += Ey_j * z_j * t_j;
        }
        else
        {
          ESx += Ex_j * t_j * t_j / 8.0;
        }
        z_j += 0.5 * t_j;
      }
    }
    else if (layers.Count == 5 || layers.Count == 9 || layers.Count == 13)
    {
      // rolling shear, critical layer for x-Direction: midlayer + 1
      // rolling shear, critical layer for y-Direction: midlayer
      for (int j = layers.Count / 2; j < layers.Count; j++)
      {
        // material properties
        double Ex_j = timberMaterials[layers[j].Item1].E0;   // [kN/m²]
        double Ey_j = timberMaterials[layers[j].Item1].E90;  // [kN/m²]

        // geometry information
        double t_j = layers[j].Item2;
        if (j > layers.Count / 2)
        {
          z_j += 0.5 * t_j;
          ESx += Ex_j * z_j * t_j;
          ESy += Ey_j * z_j * t_j;
        }
        else
        {
          ESy += Ey_j * t_j * t_j / 8.0;
        }
        z_j += 0.5 * t_j;
      }
    }
    else
    {
      Print("Asymetric build-up, or too many layers, not supported.");
      return;
    }

    // Bending Resistance and Axial resistance
    // x-Direction:
    layerMaterialNr = layers[layers.Count - 1].Item1;
    double fm_rd = 0.001 * (kmod / gammaM) * timberMaterials[layerMaterialNr].Fm0_k; // N/mm²
    double ft0_rd = 0.001 * (kmod / gammaM) * timberMaterials[layerMaterialNr].Ft0_k; // N/mm²
    double fc0_rd = 0.001 * (kmod / gammaM) * timberMaterials[layerMaterialNr].Fc0_k; // N/mm²

    double zo = 0.5 * t;
    double mx_rd = 1000.0 * fm_rd * Bx / (timberMaterials[layerMaterialNr].E0 * zo);
    double nx_c_rd = 1000.0 * fc0_rd * Dx / (timberMaterials[layerMaterialNr].E0);
    double nx_t_rd = 1000.0 * ft0_rd * Dx / (timberMaterials[layerMaterialNr].E0);

    // y-Direction:
    layerMaterialNr = layers[layers.Count - 2].Item1;
    fm_rd = 0.001 * (kmod / gammaM) * timberMaterials[layerMaterialNr].Fm0_k; // N/mm²
    ft0_rd = 0.001 * (kmod / gammaM) * timberMaterials[layerMaterialNr].Ft0_k; // N/mm²
    fc0_rd = 0.001 * (kmod / gammaM) * timberMaterials[layerMaterialNr].Fc0_k; // N/mm²

    double to = t - layers[layers.Count - 1].Item2;
    zo = to - 0.5 * t;
    double my_rd = 1000.0 * fm_rd * By / (timberMaterials[layerMaterialNr].E90 * zo);
    double ny_c_rd = 1000.0 * fc0_rd * Dy / (timberMaterials[layerMaterialNr].E90);
    double ny_t_rd = 1000.0 * ft0_rd * Dy / (timberMaterials[layerMaterialNr].E90);

    // Material values shear + torsion
    double fv_k = double.MaxValue;
    double fv_T_k = double.MaxValue;
    foreach (var layer in layers)
    {
      if (timberMaterials[layer.Item1].Fv_k < fv_k)
      {
        fv_k = timberMaterials[layer.Item1].Fv_k;
      }
      if (timberMaterials[layer.Item1].Fvb90_k < fv_T_k)
      {
        fv_T_k = timberMaterials[layer.Item1].Fvb90_k;
      }
    }
    double fv_rd = 0.001 * (kmod / gammaM) * fv_k;       // N/mm²
    double fv_T_rd = 0.001 * (kmod / gammaM) * fv_T_k;   // N/mm²

    // Twisting Resistance
    zo = 0.5 * t;
    layerMaterialNr = layers[layers.Count - 1].Item1;
    double mxy_rd = 1000.0 * fv_T_rd * Bxy / (timberMaterials[layerMaterialNr].G0 * zo);

    // In-Plane shear resistance
    layerMaterialNr = layers[layers.Count - 1].Item1;
    double t0_netto = Dx / (timberMaterials[layerMaterialNr].E0);
    layerMaterialNr = layers[layers.Count - 2].Item1;
    double t90_netto = Dy / (timberMaterials[layerMaterialNr].E90);
    double t_netto = Math.Min(t0_netto, t90_netto);
    double a = 0.15;
    double nxy_1_rd = 1000.0 * fv_T_rd * t_netto * a / (3.0 * tmax);
    double nxy_2_rd = 1000.0 * fv_rd * t;
    double nxy_rd = Math.Min(nxy_1_rd, nxy_2_rd);

    // Out-of-plane shear resistance
    double fv_R_rd = 0.0;    // N/mm²
    double vx_rd = (1000.0 * fv_R_rd * Bx) / ESx;
    double vy_rd = 0.0;
    switch (layers.Count)
    {
      case 3:
        // rolling shear, critical layer for x-Direction: midlayer
        fv_R_rd = 0.001 * (kmod / gammaM) * timberMaterials[layers[1].Item1].Fvb_k;
        vx_rd = (1000.0 * fv_R_rd * Bx) / ESx;
        // for y-Direction: no rolling shear, simple shear for the mid board
        double t_mid = layers[1].Item2;
        vy_rd = (1000.0 * fv_T_rd * t_mid) / 1.5;
        break;
      case 5:
        // rolling shear, critical layer for x-Direction: midlayer - 1
        fv_R_rd = 0.001 * (kmod / gammaM) * timberMaterials[layers[1].Item1].Fvb_k;
        vx_rd = (1000.0 * fv_R_rd * Bx) / ESx;
        // rolling shear, critical layer for y-Direction: midlayer
        fv_R_rd = 0.001 * (kmod / gammaM) * timberMaterials[layers[2].Item1].Fvb_k;
        vy_rd = (1000.0 * fv_R_rd * By) / ESy;
        break;
      case 7:
        // rolling shear, critical layer for x-Direction: midlayer
        fv_R_rd = 0.001 * (kmod / gammaM) * timberMaterials[layers[3].Item1].Fvb_k;
        vx_rd = (1000.0 * fv_R_rd * Bx) / ESx;
        // rolling shear, critical layer for y-Direction: midlayer - 1
        fv_R_rd = 0.001 * (kmod / gammaM) * timberMaterials[layers[2].Item1].Fvb_k;
        vy_rd = (1000.0 * fv_R_rd * By) / ESy;
        break;
      case 9:
        // rolling shear, critical layer for x-Direction: midlayer - 1
        fv_R_rd = 0.001 * (kmod / gammaM) * timberMaterials[layers[3].Item1].Fvb_k;
        vx_rd = (1000.0 * fv_R_rd * Bx) / ESx;
        // rolling shear, critical layer for y-Direction: midlayer
        fv_R_rd = 0.001 * (kmod / gammaM) * timberMaterials[layers[4].Item1].Fvb_k;
        vy_rd = (1000.0 * fv_R_rd * By) / ESy;
        break;
      default:
        Print("Asymetric build-up, or too many layers, not supported.");
        return;
    }
    eta_x = Math.Max(
      mx / mx_rd + nx_t / nx_t_rd,
      mx / mx_rd - nx_c / nx_c_rd);

    eta_y = Math.Max(
      my / my_rd + ny_t / ny_t_rd,
      my / my_rd - ny_c / ny_c_rd);
    eta_vxy = mxy / mxy_rd + nxy / nxy_rd;
    eta_vz = Math.Sqrt(Math.Pow(vx / vx_rd, 2) + Math.Pow(vy / vy_rd, 2));
  }

  internal class NativeMethods
  {
    [DllImport("Kernel32.dll", BestFitMapping = false, CharSet = CharSet.Ansi, SetLastError = true, ThrowOnUnmappableChar = true)]
    internal static extern IntPtr LoadLibrary([MarshalAs(UnmanagedType.LPStr)]string lpFileName);

    [DllImport("Kernel32.dll", BestFitMapping = false, CharSet = CharSet.Ansi, ExactSpelling = true, SetLastError = true, ThrowOnUnmappableChar = true)]
    internal static extern IntPtr GetProcAddress(IntPtr hModule, string procName);

    [DllImport("Kernel32.dll", SetLastError = true)]
    internal static extern bool FreeLibrary(IntPtr hModule);

    [DllImport("Kernel32.dll", CharSet = CharSet.Unicode, SetLastError = true)]
    [return: MarshalAs(UnmanagedType.Bool)]
    internal static extern bool SetDllDirectory(string lpPathName);
  }
# ---------- end check_cross_sections ----------
bnd_8 = Bounds(Numbers=check_cross_sections.eta_x)  # disabled
bnd_9 = Bounds(Numbers=check_cross_sections.eta_y)  # disabled
bnd_10 = Bounds(Numbers=check_cross_sections.eta_vxy)  # disabled
bnd_11 = Bounds(Numbers=check_cross_sections.eta_vz)  # disabled
bnd_12 = Bounds(Numbers=check_cross_sections.eta_v)  # disabled
bnd_13 = Bounds(Numbers=check_cross_sections.eta)  # disabled
addition_2 = Addition(A=check_cross_sections.eta_vxy, B=check_cross_sections.eta_vz)  # disabled
panel_34 = Panel([bnd_8, bnd_9, bnd_10, bnd_11, bnd_12, bnd_13])  # disabled
bnd_14 = Bounds(Numbers=addition_2)  # disabled
get_deformed_mesh_sofistik = GetDeformedMeshSofistik(Path=pathcdb_2, LoadCase=1, ScalingFactor=100, SofistikPath=pathcdb_dll_3, Run=toggle_3)  # -> InitialMesh, DeformedMesh
number_slider_14 = Slider(1, range=0..1)  # disabled
dedomain_10 = DeconstructDomain(Domain=bnd_13)  # -> Start, End; disabled
gradient_5 = Gradient(
    LowerLimit=number_slider_14,
    UpperLimit=dedomain_10.Start,
    Parameter=check_cross_sections.eta,
    stops=[0: RGB(234, 38, 0), 0.25: RGB(234, 126, 0), 0.5: RGB(254, 244, 84), 0.75: RGB(173, 203, 249), 1: RGB(75, 107, 169)])  # disabled

# ---- group: Deformation / mm
kragarmlänge = Data()  # disabled
multiplication_11 = Multiplication(A=kragarmlänge, B=1000)  # disabled
panel_35 = Panel("150")  # disabled
division = Division(A=multiplication_11, B=panel_35)  # disabled
panel_36 = Panel(division)  # disabled

# ----
panel_37 = Panel(check_cross_sections.eta)  # disabled

# ---- group: Manual Stress Calculation
panel_38 = Panel("400")  # disabled
panel_39 = Panel("5")  # disabled
panel_40 = Panel("20")  # disabled
panel_41 = Panel("5")  # disabled
panel_42 = Panel("11000")  # disabled
panel_43 = Panel("0.5")  # disabled
python_2 = GhPythonScript(E0=panel_42, E90=panel_38, t1=panel_39, t2=panel_40, nxx=panel_41, mxx=panel_43, nyy=panel_41, myy=panel_43)  # -> out, sigma_x_top, sigma_x_bot, sig_y_top_1, sig_y_int_1, sig_y_int_2, sig_y_bot_2; disabled
# ---------- python_2: Python ----------
import math 

# -------------- X direction -------------
Ax  = t2
Wxx = Ax*Ax/6

sigma_nx    = nxx / Ax
sigma_mxx   = mxx / Wxx * 1000
sigma_x_top = sigma_nx - sigma_mxx
sigma_x_bot = sigma_nx + sigma_mxx


# -------------- Y direction -------------
by_eq   = E90/E0
Ay_1    = t1
Ay_2    = t2 * by_eq
Ay_eq   = Ay_1 + Ay_2 
zg_y_1  = t1/2
zg_y_2  = t1 + t2/2
zg_y    = (zg_y_1 * Ay_1 + zg_y_2 * Ay_2) / Ay_eq
Iyy_1   = t1*t1*t1/12
Iyy_2   = t2*t2*t2/12*by_eq
Iyy     = Iyy_1 + Iyy_2 + math.pow(zg_y - zg_y_1,2)*Ay_1 + math.pow(zg_y - zg_y_2,2)*Ay_2

eps_y_top = myy / Iyy / E0 * (0 - zg_y) * 1000         + nyy / Ay_eq / E0
eps_y_int = myy / Iyy / E0 * (t1 - zg_y) * 1000        + nyy / Ay_eq / E0
eps_y_bot = myy / Iyy / E0 * (t1 + t2 - zg_y) * 1000   + nyy / Ay_eq / E0

sig_y_top_1 = eps_y_top * E0
sig_y_int_1 = eps_y_int * E0 
sig_y_int_2 = eps_y_int * E90 
sig_y_bot_2 = eps_y_bot * E90
# ---------- end python_2 ----------
panel_44 = Panel([python_2.sig_y_top_1, python_2.sig_y_int_1, python_2.sig_y_int_2, python_2.sig_y_bot_2])  # disabled

# ---- group: Manual Stress Calculation / Make sure you have used the same setting for analysis!
panel_45 = Panel("400")  # disabled
panel_46 = Panel("5")  # disabled
panel_47 = Panel("20")  # disabled
panel_48 = Panel("11000")  # disabled

# ---- group: Manual Stress Calculation
toggle_4 = BooleanToggle(True)  # disabled
pathcdb_dll_4 = FilePath(pathcdb)  # disabled
number_slider_15 = Slider(0, range=0..100)  # disabled
get_shell_forces_sofistik = GetShellForcesSofistik(Path=pathcdb_dll_2, LoadCase=1, SofistikPath=pathcdb_dll_4, Run=toggle_4)  # -> QNR, T, MXX, MYY, MXY, VX, VY, NXX, NYY, NXY
get_deformed_mesh_sofistik_2 = GetDeformedMeshSofistik(LoadCase=1, ScalingFactor=number_slider_15, SofistikPath=pathcdb_dll_4, Run=toggle_4)  # -> InitialMesh, DeformedMesh
int = Integer(get_shell_forces_sofistik.MXX)  # disabled
facen = FaceNormals(Mesh=get_deformed_mesh_sofistik_2.InitialMesh)  # -> Centers, Normals; disabled
python_3 = GhPythonScript(
    E0=panel_48,
    E90=panel_45,
    t1=panel_46,
    t2=panel_47,
    nxx=get_shell_forces_sofistik.NXX,
    mxx=get_shell_forces_sofistik.MXX,
    nyy=get_shell_forces_sofistik.NYY,
    myy=get_shell_forces_sofistik.MYY)  # -> out, sig_x_top, sig_x_bot, sig_y_top_1, sig_y_int_1, sig_y_int_2, sig_y_bot_2; disabled
# ---------- python_3: Python ----------
import math 

# -------------- X direction -------------
Ax  = t2
Wxx = Ax*Ax/6

sigma_nx    = nxx / Ax
sigma_mxx   = mxx / Wxx * 1000
sig_x_top = sigma_nx - sigma_mxx
sig_x_bot = sigma_nx + sigma_mxx


# -------------- Y direction -------------
by_eq   = E90/E0
Ay_1    = t1
Ay_2    = t2 * by_eq
Ay_eq   = Ay_1 + Ay_2 
zg_y_1  = t1/2
zg_y_2  = t1 + t2/2
zg_y    = (zg_y_1 * Ay_1 + zg_y_2 * Ay_2) / Ay_eq
Iyy_1   = t1*t1*t1/12
Iyy_2   = t2*t2*t2/12*by_eq
Iyy     = Iyy_1 + Iyy_2 + math.pow(zg_y - zg_y_1,2)*Ay_1 + math.pow(zg_y - zg_y_2,2)*Ay_2

eps_y_top = myy / Iyy / E0 * (0 - zg_y) * 1000         + nyy / Ay_eq / E0
eps_y_int = myy / Iyy / E0 * (t1 - zg_y) * 1000        + nyy / Ay_eq / E0
eps_y_bot = myy / Iyy / E0 * (t1 + t2 - zg_y) * 1000   + nyy / Ay_eq / E0

sig_y_top_1 = eps_y_top * E0
sig_y_int_1 = eps_y_int * E0 
sig_y_int_2 = eps_y_int * E90 
sig_y_bot_2 = eps_y_bot * E90
# ---------- end python_3 ----------
number_slider_16 = Slider(10, range=0..10)  # disabled
bnd_15 = Bounds(Numbers=get_shell_forces_sofistik.MXX)  # disabled
entwine_3 = Entwine(Branch00=python_3.sig_x_top, Branch01=python_3.sig_x_bot, FlattenInputs=True)  # disabled
dedomain_11 = DeconstructDomain(Domain=bnd_15)  # -> Start, End; disabled
textdot = DefineTextDot(Text=get_shell_forces_sofistik.MXX, Location=facen.Centers, Font="Arial", Size=number_slider_16)
swatch_2 = ColourSwatch(SwatchColor=RGB(255, 255, 255))  # disabled
flip = FlipMatrix(Data=entwine_3)  # disabled
gradient_6 = Gradient(
    LowerLimit=dedomain_11.Start,
    UpperLimit=dedomain_11.End,
    Parameter=get_shell_forces_sofistik.MXX,
    stops=[0: RGB(234, 38, 0), 0.25: RGB(234, 126, 0), 0.5: RGB(254, 244, 84), 0.75: RGB(173, 203, 249), 1: RGB(75, 107, 169)])  # disabled
abs = Absolute()  # disabled
abs_2 = Absolute(Value=flip)  # disabled
sort = SortList(Keys=abs_2, ValuesA=flip)  # -> Keys, ValuesA; disabled
item_18 = ListItem(List=reverse(sort.ValuesA), Index=0, Wrap=True)  # -> flatten(Item); disabled
colourmesh = ColourMesh(Mesh=get_deformed_mesh_sofistik_2.InitialMesh, Colors=gradient_6)

# ----
sort_2 = SortList(Keys=flatten(check_cross_sections.eta))  # -> reverse(Keys), ValuesA; disabled
expression = Expression(x=sort_2.Keys, Expression="Round(x,2)")  # disabled
maxutilisation = Panel(expression)  # disabled

panel_49 = Panel("150")  # disabled

# ---- group: Deformation
get_nodal_results_sofistik = GetNodalResultsSofistik(Path=pathcdb, LoadCases=load_case, SofistikPath=pathcdb_dll_2, Run=toggle_3)  # -> NodeNumber, Nodes, LoadForces, LoadMoments, Displacements, Rotations, Forces, Moments
get_deformed_mesh_sofistika = GetDeformedMeshSofistikA(Path=pathcdb, LoadCase=load_case, ScalingFactor=number_slider_12, SofistikPath=pathcdb_dll_2, Run=toggle_3)  # -> InitialMesh, DeformedMesh
vlen = VectorLength(Vector=get_nodal_results_sofistik.Displacements)  # disabled
demesh_2 = DeconstructMesh(Mesh=get_deformed_mesh_sofistika.DeformedMesh)  # -> Vertices, Faces, Colours, Normals; disabled
vec_5 = Vector(get_nodal_results_sofistik.Displacements)  # disabled
num_15 = Number(get_nodal_results_sofistik.Displacements)  # disabled
vlen_2 = VectorLength(Vector=vec_5)  # disabled
bnd_16 = Bounds(Numbers=num_15)  # disabled
num_16 = Number(vlen_2)  # disabled
bnd_17 = Bounds(Numbers=num_16)  # disabled
dedomain_12 = DeconstructDomain(Domain=bnd_16)  # -> Start, End; disabled
dedomain_13 = DeconstructDomain(Domain=bnd_17)  # -> Start, End; disabled
gradient_7 = Gradient(
    LowerLimit=dedomain_12.End,
    UpperLimit=dedomain_12.Start,
    Parameter=panel_49,
    stops=[0: RGB(234, 38, 0), 0.25: RGB(234, 126, 0), 0.5: RGB(254, 244, 84), 0.75: RGB(173, 203, 249), 1: RGB(75, 107, 169)])  # disabled
expression_2 = Expression(x=dedomain_13.End, Expression="Round(x*1000,2)")  # disabled
sort_3 = SortList(Keys=vlen, ValuesA=get_nodal_results_sofistik.Nodes)  # -> reverse(Keys), reverse(ValuesA); disabled
totalmaxdisplacement_mm = Panel(expression_2)  # disabled
smaller_3 = SmallerThan(FirstNumber=panel_36, SecondNumber=totalmaxdisplacement_mm)  # -> SmallerThan, OrEqualTo; disabled
panel_50 = Panel(smaller_3.SmallerThan)  # disabled
sort_4 = SortList(Keys=vlen, ValuesA=demesh_2.Vertices)  # -> reverse(Keys), reverse(ValuesA); disabled
item_19 = ListItem(List=sort_3.ValuesA, Index=0, Wrap=True)  # disabled
item_20 = ListItem(List=sort_4.ValuesA, Index=0, Wrap=True)  # disabled
panel_51 = Panel(" mm")  # disabled
panel_52 = Panel("   ")  # disabled
concat_3 = Concatenate(FragmentA=panel_52, FragmentB=totalmaxdisplacement_mm, FragmentC=panel_51)  # disabled
swatch_3 = ColourSwatch(SwatchColor=RGB(0, 0, 0))  # disabled
tag_2 = TextTag(Location=item_19, Text=concat_3, Colour=swatch_3)  # disabled
pt_17 = Point(item_19)  # disabled

# ----
eta_vxy_vz = Panel(bnd_14)  # disabled
eta_v = Panel(bnd_12)  # disabled
eta = Panel(bnd_13)  # disabled
eta_y = Panel(bnd_9)  # disabled
eta_vxy = Panel(bnd_10)  # disabled
eta_vz = Panel(bnd_11)  # disabled
eta_x = Panel(bnd_8)  # disabled

# ---- group: Deformed
dedomain_14 = DeconstructDomain(Domain=bnd_13)  # -> Start, End; disabled
gradient_8 = Gradient(
    LowerLimit=dedomain_14.End,
    UpperLimit=dedomain_14.Start,
    Parameter=check_cross_sections.eta,
    stops=[0: RGB(234, 38, 0), 0.25: RGB(234, 126, 0), 0.5: RGB(254, 244, 84), 0.75: RGB(173, 203, 249), 1: RGB(75, 107, 169)])  # disabled
gradient_9 = Gradient(
    LowerLimit=dedomain_14.End,
    UpperLimit=dedomain_14.Start,
    Parameter=check_cross_sections.eta,
    stops=[0: RGB(217, 76, 48), 0.25: RGB(199, 133, 58), 0.5: RGB(214, 205, 71), 0.75: RGB(99, 142, 207), 1: RGB(12, 60, 156)])  # disabled
number_slider_17 = Slider(0.001, range=0..0.1)  # disabled
wbfacepolys = WeaverbirdsFacePolylines(Mesh=get_deformed_mesh_sofistik.InitialMesh)  # -> flatten(Polygons); disabled

# ----
facen_2 = FaceNormals(Mesh=get_deformed_mesh_sofistik.InitialMesh)  # -> Centers, Normals; disabled
number_slider_18 = Slider(28, range=0..2100)  # disabled
neg_8 = Negative(Value=number_slider_18)  # disabled
panel_53 = Panel("0")  # disabled
dom_6 = ConstructDomain(DomainStart=neg_8, DomainEnd=number_slider_18)  # disabled
dom_7 = ConstructDomain(DomainStart=panel_53, DomainEnd=number_slider_18)  # disabled
sort_5 = SortList(Keys=check_cross_sections.eta, ValuesA=facen_2.Centers, ValuesB=gradient_5)  # -> reverse(flatten(Keys)), reverse(flatten(ValuesA)), reverse(flatten(ValuesB)); disabled
subset_2 = SubList(List=sort_5.Keys, Domain=dom_7, Wrap=True)  # -> List, Index; disabled
subset_3 = SubList(List=sort_5.ValuesA, Domain=dom_7, Wrap=True)  # -> List, Index; disabled
subset_4 = SubList(List=sort_5.ValuesB, Domain=dom_7, Wrap=True)  # -> List, Index; disabled
expression_3 = Expression(x=subset_2.List, Expression="Round(x,2)")  # disabled
swatch_4 = ColourSwatch(SwatchColor=RGB(0, 191, 255))  # disabled
swatch_5 = ColourSwatch(SwatchColor=RGB(0, 0, 0))  # disabled
number_slider_19 = Slider(15, range=1..50)  # disabled
number_slider_20 = Slider(1, range=0..50)  # disabled
maxutilisation_2 = Panel(expression_3)  # disabled

item_21 = ListItem(List=maxutilisation, Index=0, Wrap=True)  # disabled
maxutilisation_3 = Panel(item_21)  # disabled
panel_54 = Panel("150")  # disabled
number_slider_21 = Slider(0.1, range=0..1)  # disabled

wbjoin = WeaverbirdsJoinMeshesAndWeld(Mesh=get_deformed_mesh_sofistika.DeformedMesh, Weld=False)  # disabled
wbjoin_2 = WeaverbirdsJoinMeshesAndWeld(Mesh=get_deformed_mesh_sofistika.InitialMesh, Weld=False)  # disabled
number_slider_22 = Slider(0.02, range=0..1)  # disabled
facen_3 = FaceNormals(Mesh=wbjoin_2)  # -> Centers, Normals; disabled
facen_4 = FaceNormals(Mesh=wbjoin)  # -> Centers, Normals; disabled
wbfacepolys_2 = WeaverbirdsFacePolylines(Mesh=wbjoin)  # -> flatten(Polygons); disabled
wbfacepolys_3 = WeaverbirdsFacePolylines(Mesh=wbjoin_2)  # -> flatten(Polygons); disabled
swatch_6 = ColourSwatch(SwatchColor=RGB(255, 0, 0))  # disabled
swatch_7 = ColourSwatch(SwatchColor=RGB(0, 0, 0))  # disabled
dist = Distance(PointA=facen_3.Centers, PointB=facen_4.Centers)  # disabled
sph = Sphere(Base=pt_17, Radius=number_slider_22)  # disabled
sph_2 = Sphere(Base=item_20, Radius=number_slider_22)  # disabled
bnd_18 = Bounds(Numbers=dist)  # disabled
dedomain_15 = DeconstructDomain(Domain=bnd_18)  # -> Start, End; disabled
gradient_10 = Gradient(
    LowerLimit=dedomain_15.End,
    UpperLimit=dedomain_15.Start,
    Parameter=dist,
    stops=[0: RGBA(235, 39, 0, 80), 0.25: RGBA(235, 125, 0, 80), 0.5: RGBA(255, 244, 84, 80), 0.83: RGBA(172, 203, 250, 80), 1: RGBA(74, 77, 168, 80)])  # disabled
gradient_11 = Gradient(
    LowerLimit=dedomain_15.End,
    UpperLimit=dedomain_15.Start,
    Parameter=dist,
    stops=[0: RGBA(186, 31, 0, 45), 0.25: RGBA(199, 106, 0, 45), 0.5: RGBA(232, 217, 0, 45), 0.83: RGBA(0, 97, 242, 45), 1: RGBA(0, 8, 240, 45)])  # disabled
gradient_12 = Gradient(
    LowerLimit=number_slider_21,
    UpperLimit=dedomain_15.Start,
    Parameter=dist,
    stops=[0: RGB(234, 38, 0), 0.25: RGB(234, 126, 0), 0.5: RGB(254, 244, 84), 0.83: RGB(173, 203, 249), 1: RGB(74, 77, 168)])  # disabled
number_slider_23 = Slider(0.01, range=0..10)  # disabled
number_slider_24 = Slider(14, range=0..20)  # disabled

number_slider_25 = Slider(28, range=0..436)  # disabled
fonts = FontTable()  # disabled
item_22 = ListItem(List=fonts, Index=number_slider_25, Wrap=True)  # disabled
panel_55 = Panel(item_22)  # disabled

# ---- group: CLT Utilization
colourmesh_2 = ColourMesh(Mesh=get_deformed_mesh_sofistik.InitialMesh, Colors=gradient_5)
previewlw = CustomPreviewLineweights(Geometry=wbfacepolys, Shader=gradient_9, Thickness=number_slider_17, Absolute=True)  # disabled
screentext = ScreenOrientedText(
    Text=maxutilisation_2,
    Justification=7,
    Location=subset_3.List,
    SizeFactor=number_slider_19,
    Color=swatch_5,
    Depth=number_slider_20,
    Absolute=False)  # disabled

# ---- group: Deformation / Deformed
colourmesh_3 = ColourMesh(Mesh=get_deformed_mesh_sofistika.DeformedMesh, Colors=gradient_12)
previewlw_2 = CustomPreviewLineweights(Geometry=wbfacepolys_2, Shader=gradient_11, Thickness=number_slider_23, Absolute=True)  # disabled
previewlw_3 = CustomPreviewLineweights(Geometry=sph_2, Shader=swatch_6, Thickness=number_slider_23, Absolute=True)  # disabled
screentext_2 = ScreenOrientedText(
    Text=concat_3,
    Font=item_22,
    Justification=7,
    Location=item_20,
    SizeFactor=number_slider_24,
    Color=swatch_7,
    Depth=0,
    Absolute=False)  # disabled

# ---- group: Deformation / Undeformed
colourmesh_4 = ColourMesh(Mesh=get_deformed_mesh_sofistika.InitialMesh, Colors=gradient_7)
previewlw_4 = CustomPreviewLineweights(Geometry=wbfacepolys_3, Shader=gradient_11, Thickness=number_slider_23, Absolute=True)  # disabled
screentext_3 = ScreenOrientedText(
    Text=concat_3,
    Font=item_22,
    Justification=7,
    Location=pt_17,
    SizeFactor=number_slider_24,
    Color=swatch_7,
    Depth=0,
    Absolute=False)  # disabled
previewlw_5 = CustomPreviewLineweights(Geometry=sph, Shader=swatch_6, Thickness=number_slider_23, Absolute=True)  # disabled

# ----
crv_4 = Curve(dec_reg_3.Polyline)
area_5 = Area(Geometry=crv_4)  # -> Area, Centroid
avr = Average(Input=area_5.Centroid)
bbox_3 = BoundingBox(Content=flatten(avr), Plane=PlaneXY(0, 0, 0), UnionBox=True)  # -> Box, Box_2
debox_3 = DeconstructBox(Box=bbox_3.Box)  # -> Plane, X, Y, Z
dedomain_16 = DeconstructDomain(Domain=debox_3.X)  # -> Start, End
subtraction_3 = Subtraction(A=dedomain_16.End, B=dedomain_16.Start)

trim_2 = TrimTree(Tree=crv_4, Depth=1)

bbox_4 = BoundingBox(Content=trim_2, Plane=PlaneXY(0, 0, 0), UnionBox=True)  # -> Box, Box_2
debox_4 = DeconstructBox(Box=bbox_4.Box)  # -> Plane, X, Y, Z
dedomain_17 = DeconstructDomain(Domain=debox_4.X)  # -> Start, End
subtraction_4 = Subtraction(A=dedomain_17.End, B=dedomain_17.Start)
area_6 = Area(Geometry=bbox_4.Box)  # -> Area, Centroid
division_2 = Division(A=subtraction_4, B=subtraction_3)
scale = Scale(Geometry=avr, Center=area_6.Centroid, Factor=division_2)  # -> Geometry, Transform
yz = YZPlane(Origin=scale.Geometry)

num_17 = Number(num)
pln = Plane(yz)
num_18 = Number(dec_reg_3.ThicknessBlendedRadius)
c_script_4 = CSharpScript(iRadii=num_18, iBoardWidth=num_17, iPlanes=pln)  # -> out, simplify(A); inputs iRadii: tree of Double, iBoardWidth: Double, iPlanes: tree of Plane
# ---------- c_script_4: C# ----------
    DataTree<Point3d> pointTree = new DataTree<Point3d>();

    for (int j = 0; j < iRadii.BranchCount; j++)
    {

      //initialize variables
      Plane bp = iPlanes.Branch(j)[0];
      Point3d startPoint = new Point3d(bp.Origin);
      Point3d centerPoint = startPoint;
      Vector3d rotationAxis = new Vector3d(bp.ZAxis);
      Vector3d centerPointVect = new Vector3d(bp.YAxis);
      centerPointVect.Rotate(Math.PI / 2, rotationAxis);

      for (int i = 0; i < iRadii.Branch(j).Count; i++){
        GH_Path pth = iRadii.Paths[j].AppendElement(i);
        Point3d point1 = startPoint;
        Point3d point2 = startPoint;

        pointTree.Add(point1, pth);

        //calculate rotation angle
        Double arcLength = iBoardWidth;
        Double radius = iRadii.Branch(j)[i];
        Double rotation = (arcLength / radius);

        //calculate rotation center point
        centerPointVect.Unitize();
        centerPointVect *= radius;
        centerPoint += centerPointVect;


        //execute half rotation
        Transform tx = Transform.Rotation(rotation / 2, rotationAxis, centerPoint);


        point2.Transform(tx);
        pointTree.Add(point2, pth);

        //execute full rotation
        tx = Transform.Rotation(rotation, rotationAxis, centerPoint);
        startPoint.Transform(tx);
        pointTree.Add(startPoint, pth);

        //updata rotation parameters
        centerPoint = startPoint;
        centerPointVect.Transform(tx);
      }
    }
    A = pointTree;
# ---------- end c_script_4 ----------

trim_3 = TrimTree(Tree=c_script_4.A, Depth=1)
cullpt_2 = CullDuplicates(Points=trim_3, Tolerance=0.1, CullMode=3)  # -> Points, Indices, Valence
pt_18 = Point(cullpt_2.Points)

# ---- group: animate
pt_19 = Point(simplify(pt_18))
pln_2 = Plane(graft(pln))
num_19 = Number(Slider(1, range=0..1))
c_script_5 = CSharpScript(iPoints=simplify(pt_19), iPlanes=pln_2, iShapeFactor=num_19)  # -> out, A; inputs iPoints: tree of Point3d, iPlanes: tree of Plane, iShapeFactor: Double
# ---------- c_script_5: C# ----------
    DataTree<Point3d> output = new DataTree<Point3d>();
    
    double shapeFactor = 1.0 - iShapeFactor;

    //step through curves
    for (int i = 0; i < iPoints.BranchCount; i++)
    {
      Plane currentPlane = iPlanes.Branch(iPoints.Path(i)[0])[0];

      //get vectors from plane
      Vector3d zVect = currentPlane.YAxis;

      Vector3d rotVect = currentPlane.ZAxis;

      //create new startpoint inside list
      Point3d startPoint = iPoints.Branch(i)[0];

      //step through points. Create and rotate vectors
      for (int j = 0; j < iPoints.Branch(i).Count; j++)
      {
        if (j == 0) output.Add(startPoint, iPoints.Path(i));
        else{
          //create current segment vector
          Vector3d segmentVect = new Vector3d(iPoints.Branch(i)[j] - iPoints.Branch(i)[j - 1]);

          //measure angle with vertical vector
          double angle = Vector3d.VectorAngle(zVect, segmentVect, currentPlane);

          //rotate
          segmentVect.Rotate(-angle * shapeFactor, rotVect);

          startPoint += segmentVect;
          output.Add(startPoint, iPoints.Path(i));
        }
      }
    }

    A = output;
# ---------- end c_script_5 ----------
pt_20 = Point(c_script_5.A)
intcrv_4 = Interpolate(Vertices=pt_20, Degree=3, Periodic=False, KnotStyle=1)  # -> Curve, Length, Domain
crv_5 = Curve(intcrv_4.Curve)

# ----
crv_6 = Curve(crv_5)
pt_21 = Point(simplify(graft(scale.Geometry)))
end = EndPoints(Curve=crv_6)  # -> Start, End
vec2pt = Vector2Pt(PointA=end.Start, PointB=end.End, Unitize=False)  # -> Vector, Length
yz_2 = YZPlane(Origin=end.Start)
Y_11 = UnitY(Factor="-1")
angle = Angle(VectorA=vec2pt.Vector, VectorB=Y_11, Plane=yz_2)  # -> Angle, Reflex
rotate = Rotate(Geometry=crv_6, Angle=angle.Angle, Plane=yz_2)  # -> Geometry, Transform
curvepoint = PointOnCurve(rotate.Geometry, parameter=0.5)
vec2pt_2 = Vector2Pt(PointA=curvepoint, PointB=pt_21, Unitize=False)  # -> Vector, Length
move_15 = Move(Geometry=rotate.Geometry, Motion=vec2pt_2.Vector)  # -> Geometry, Transform
path_mapper_2 = PathMapper(move_15.Geometry, source=["{A;B}", "{A}"], target=["{A}", "{0}"])
crv_7 = Curve(path_mapper_2)
loft = Loft(Curves=crv_7, Options={Adjust=False, Closed=False, LoftEnds=0, LoftSimp=0, LoftType=2, Rebuild=10, Refit=0.01})

bool = Boolean(relaxation)  # disabled
cull_8 = CullPattern(List=loft, CullPattern=bool)  # disabled
number_slider_26 = Slider(8, range=0..100)  # disabled
srf = Surface(cull_8)  # disabled
num_20 = Number(number_slider_4)  # disabled
quads = QuadPanels(Surface=srf, UDivisions=number_slider_26, VDivisions=num_20)  # disabled
srf_2 = Surface(reparameterize(simplify(quads)))  # disabled

smesh = SimpleMesh(Brep=srf_2)  # disabled
area_7 = MeshArea(Mesh=smesh)  # -> Area, Centroid; disabled
meshcp = MeshClosestPoint(Point=area_7.Centroid, Mesh=smesh)  # -> Point, Index, Parameter; disabled
meval = MeshEval(Mesh=smesh, Parameter=meshcp.Parameter)  # -> Point, Normal, Colour; disabled
pl = PlaneNormal(Origin=meval.Point, ZAxis=meval.Normal)  # disabled
X = UnitX(Factor=1)  # disabled
deplane_2 = DeconstructPlane(Plane=pl)  # -> Origin, XAxis, YAxis, ZAxis; disabled
angle_2 = Angle(VectorA=deplane_2.XAxis, VectorB=X, Plane=pl)  # -> Angle, Reflex; disabled
rotate_2 = Rotate(Geometry=pl, Angle=angle_2.Angle, Plane=pl)  # -> graft(Geometry), Transform; disabled

medges = MeshEdges(Mesh=smesh)  # -> simplify(NakedEdges), InteriorEdges, NonManifoldEdges; disabled
curvepoint_2 = PointOnCurve(medges.NakedEdges, parameter=0.5)  # disabled
plcoord = PlaneCoordinates(Point=curvepoint_2, System=rotate_2.Geometry)  # -> XCoordinate, YCoordinate, ZCoordinate; disabled
sort_6 = SortList(Keys=plcoord.XCoordinate, ValuesA=medges.NakedEdges)  # -> Keys, ValuesA; disabled
item_23 = ListItem(List=reverse(sort_6.ValuesA), Index=0, Wrap=True)  # disabled
item_24 = ListItem(List=sort_6.ValuesA, Index=0, Wrap=True)  # disabled

merge_13 = Merge(Data1=item_24, Data2=item_23)  # disabled
trim_4 = TrimTree(Tree=merge_13, Depth=1)  # disabled
rdlines = RemoveDuplicateLinesKaramba3D(Line=trim_4, LimitDistance=0.005)  # -> OutLine, Info, Indexes; disabled
join_3 = JoinCurves(Curves=rdlines.OutLine, Preserve=False)  # disabled
explode = Explode(Curve=join_3, Recursive=True)  # -> Segments, simplify(Vertices); disabled
pline = PolyLine(Vertices=explode.Vertices, Closed=False)  # -> simplify(graft(Polyline)); disabled
path_mapper_3 = PathMapper(pline, source=["{A}", "{A;B}"], target=["{0}", "{A}"])  # disabled
curvepoint_3 = PointOnCurve(path_mapper_3, parameter=0.5)  # disabled
pdecon_7 = Deconstruct(Point=curvepoint_3)  # -> XComponent, YComponent, ZComponent; disabled
sort_7 = SortList(Keys=pdecon_7.XComponent, ValuesA=path_mapper_3)  # -> Keys, ValuesA; disabled
crv_8 = Curve(sort_7.ValuesA)  # disabled

crv_9 = Curve(crv_8)  # disabled
item_25 = ListItem(List=crv_9, Index=0, Wrap=True)  # disabled
curvepoint_4 = PointOnCurve(crv_9, parameter=0.5)  # disabled
curvepoint_5 = PointOnCurve(item_25, parameter=0.5)  # disabled
vec2pt_3 = Vector2Pt(PointA=curvepoint_5, PointB=curvepoint_4, Unitize=False)  # -> Vector, Length; disabled
move_16 = Move(Geometry=item_25, Motion=vec2pt_3.Vector)  # -> Geometry, Transform; disabled

crv_10 = Curve(crv_8)  # disabled
flip_2 = FlipCurve(Curve=crv_10, Guide=move_16.Geometry)  # -> Curve, Flag; disabled

explode_2 = Explode(Curve=flip_2.Curve, Recursive=True)  # -> simplify(Segments), Vertices; disabled
explode_3 = Explode(Curve=move_16.Geometry, Recursive=True)  # -> simplify(Segments), Vertices; disabled
lng_3 = ListLength(List=explode_2.Segments)  # disabled
lng_4 = ListLength(List=explode_2.Segments)  # disabled
lng_5 = ListLength(List=explode_3.Segments)  # disabled
lng_6 = ListLength(List=explode_3.Segments)  # disabled
subtraction_5 = Subtraction(A=lng_3, B=2)  # disabled
subtraction_6 = Subtraction(A=lng_4, B=1)  # disabled
subtraction_7 = Subtraction(A=lng_5, B=2)  # disabled
subtraction_8 = Subtraction(A=lng_6, B=1)  # disabled
dom_8 = ConstructDomain(DomainStart=0, DomainEnd=subtraction_5)  # disabled
dom_9 = ConstructDomain(DomainStart=1, DomainEnd=subtraction_6)  # disabled
dom_10 = ConstructDomain(DomainStart=0, DomainEnd=subtraction_7)  # disabled
dom_11 = ConstructDomain(DomainStart=1, DomainEnd=subtraction_8)  # disabled
subset_5 = SubList(List=explode_2.Segments, Domain=dom_8, Wrap=True)  # -> List, Index; disabled
subset_6 = SubList(List=explode_2.Segments, Domain=dom_9, Wrap=True)  # -> List, Index; disabled
subset_7 = SubList(List=explode_3.Segments, Domain=dom_10, Wrap=True)  # -> List, Index; disabled
subset_8 = SubList(List=explode_3.Segments, Domain=dom_11, Wrap=True)  # -> List, Index; disabled
angle_3 = Angle(VectorA=subset_7.List, VectorB=subset_8.List)  # -> simplify(Angle), Reflex; disabled
angle_4 = Angle(VectorA=subset_5.List, VectorB=subset_6.List)  # -> simplify(Angle), Reflex; disabled
num_21 = Number(angle_3.Angle)  # disabled
num_22 = Number(angle_4.Angle)  # disabled

explode_4 = Explode(Curve=flip_2.Curve, Recursive=True)  # -> simplify(Segments), Vertices; disabled
explode_5 = Explode(Curve=move_16.Geometry, Recursive=True)  # -> simplify(Segments), Vertices; disabled
path_mapper_4 = PathMapper(explode_4.Segments, source=["{A}(i)", "{A;B}(i)"], target=["{i}(A)", "{A;i}(B)"])  # disabled
path_mapper_5 = PathMapper(explode_5.Segments, source=["{A}(i)", "{A;B}(i)"], target=["{i}(A)", "{A;i}(B)"])  # disabled
crv_11 = Curve(path_mapper_5)  # disabled
crv_12 = Curve(path_mapper_4)  # disabled
lng_7 = ListLength(List=crv_12)  # -> expr("x-2", Length); disabled
lng_8 = ListLength(List=crv_11)  # -> expr("x-2", Length); disabled
lng_9 = ListLength(List=crv_12)  # -> expr("x-1", Length); disabled
lng_10 = ListLength(List=crv_11)  # -> expr("x-1", Length); disabled
dom_12 = ConstructDomain(DomainStart=0, DomainEnd=lng_7)  # disabled
dom_13 = ConstructDomain(DomainStart=0, DomainEnd=lng_8)  # disabled
dom_14 = ConstructDomain(DomainStart=1, DomainEnd=lng_9)  # disabled
dom_15 = ConstructDomain(DomainStart=1, DomainEnd=lng_10)  # disabled
subset_9 = SubList(List=crv_12, Domain=dom_12, Wrap=True)  # -> graft(List), Index; disabled
subset_10 = SubList(List=crv_11, Domain=dom_13, Wrap=True)  # -> graft(List), Index; disabled
subset_11 = SubList(List=crv_12, Domain=dom_14, Wrap=True)  # -> graft(List), Index; disabled
subset_12 = SubList(List=crv_11, Domain=dom_15, Wrap=True)  # -> graft(List), Index; disabled
loft_2 = Loft(
    Curves=[subset_9.List, subset_11.List],
    Options={Adjust=False, Closed=False, LoftEnds=0, LoftSimp=0, LoftType=0, Rebuild=10, Refit=0.01})  # -> simplify(Loft); disabled
loft_3 = Loft(
    Curves=[subset_10.List, subset_12.List],
    Options={Adjust=False, Closed=False, LoftEnds=0, LoftSimp=0, LoftType=0, Rebuild=10, Refit=0.01})  # -> simplify(Loft); disabled
smesh_2 = SimpleMesh(Brep=loft_2)  # disabled
smesh_3 = SimpleMesh(Brep=loft_3)  # disabled
path_mapper_6 = PathMapper(smesh_3, source=["{A;B;C}", "{A;B}"], target=["{A}", "{0}"])  # disabled
path_mapper_7 = PathMapper(smesh_2, source=["{A;B;C}", "{A;B}"], target=["{A}", "{0}"])  # disabled
mjoin = MeshJoin(Meshes=path_mapper_6)  # disabled
mjoin_2 = MeshJoin(Meshes=path_mapper_7)  # disabled
weld = WeldMesh(Mesh=mjoin, Angle=3.141592654)  # disabled
weld_2 = WeldMesh(Mesh=mjoin_2, Angle=3.141592654)  # disabled

explode_6 = Explode(Curve=move_16.Geometry, Recursive=True)  # -> Segments, Vertices; disabled
num_23 = Number(num_22)  # disabled
num_24 = Number(num_21)  # disabled
mesh_4 = Mesh(weld)  # disabled
path_mapper_8 = PathMapper(explode_6.Vertices, source=["{A;B}(i)", "{A}(i)"], target=["{A;i}(B)", "{i}(A)"])  # disabled
division_3 = Division(A=num_23, B=num_24)  # disabled
avr_2 = Average(Input=division_3)  # disabled
number_slider_27 = Slider(100, range=0..100000)  # disabled
number_slider_28 = Slider(1, range=0..10000)  # disabled
number_slider_29 = Slider(10000, range=0..10000)  # disabled
pline_2 = PolyLine(Vertices=path_mapper_8, Closed=False)  # -> simplify(Polyline); disabled
path_mapper_9 = PathMapper(pline_2, source=["{A;B}", "{A}"], target=["{A}", "{0}"])  # disabled
crv_13 = Curve(move_16.Geometry)  # disabled
show = Show(G=mesh_4)  # disabled
rod = Rod(Polyline=path_mapper_9, LengthFactor=1, AngleFactor=1, AxialStrength=number_slider_27, BendStrength=number_slider_28)  # disabled
path_mapper_10 = PathMapper(rod, source=["{A;B}", "{A}"], target=["{A}", "{0}"])  # disabled

path_mapper_11 = PathMapper(avr_2, source=["{A}", "{A;B}"], target=["{0}", "{A}"])  # disabled

rod_2 = Rod(
    Polyline=crv_13,
    LengthFactor=1,
    AngleFactor=path_mapper_11,
    AxialStrength=number_slider_27,
    BendStrength=number_slider_29)  # disabled
path_mapper_12 = PathMapper(rod_2, source=["{A;B}", "{A}"], target=["{A}", "{0}"])  # disabled
merge_14 = Merge(Data1=path_mapper_10, Data2=path_mapper_12, Data3=show)  # disabled

zombiesolver = ZombieSolver(GoalObjects=merge_14, Threshold=1e-10, Tolerance=0.0001, MaxIterations=number_slider_9)  # -> I, V, O; disabled
mesh_5 = Mesh(zombiesolver.O)  # disabled
clean = CleanTree(RemoveNulls=True, RemoveInvalid=True, RemoveEmpty=False, Tree=mesh_5)  # disabled

wbedges = WeaverbirdsMeshEdges(MeshOrPolylines=graft(clean))  # -> simplify(Lines); disabled
mesh_6 = Mesh(simplify(graft(clean)))  # disabled

wbedges_2 = WeaverbirdsMeshEdges(MeshOrPolylines=weld_2)  # -> simplify(Lines); disabled
line = Line(wbedges)  # disabled
number_slider_30 = Slider(1330, range=0..10000)  # disabled
group_2 = Group(Objects=line)  # -> flatten(Group); disabled
len_4 = Length(Curve=wbedges_2)  # disabled
len_5 = Length(Curve=line)  # disabled
lng_11 = ListLength(List=group_2)  # disabled
subtraction_9 = Subtraction(A=len_5, B=len_4)  # disabled
series_4 = Series(Start=0, Step=number_slider_30, Count=lng_11)  # disabled
number_slider_31 = Slider(5928, range=0..10000)  # disabled
smaller_4 = SmallerThan(FirstNumber=subtraction_9, SecondNumber=0)  # -> SmallerThan, OrEqualTo; disabled
dispatch = Dispatch(List=subtraction_9, DispatchPattern=smaller_4.SmallerThan)  # -> ListA, ListB; disabled
Y_12 = UnitY(Factor=series_4)  # disabled
Y_13 = UnitY(Factor=number_slider_31)  # disabled
move_17 = Move(Geometry=group_2, Motion=Y_12)  # -> Geometry, Transform; disabled
bnd_19 = Bounds(Numbers=dispatch.ListA)  # disabled
bnd_20 = Bounds(Numbers=dispatch.ListB)  # disabled
number_slider_32 = Slider(7456, range=0..10000)  # disabled
move_18 = Move(Geometry=move_17.Geometry, Motion=Y_13)  # -> Geometry, Transform; disabled
dedomain_18 = DeconstructDomain(Domain=bnd_20)  # -> Start, End; disabled
dedomain_19 = DeconstructDomain(Domain=bnd_19)  # -> Start, End; disabled
X_2 = UnitX(Factor=number_slider_32)  # disabled
move_19 = Move(Geometry=move_18.Geometry, Motion=X_2)  # -> Geometry, Transform; disabled
gradient_13 = Gradient(
    LowerLimit=dedomain_19.Start,
    UpperLimit=dedomain_19.End,
    Parameter=dispatch.ListA,
    stops=[0: RGB(75, 107, 169), 0.501: RGB(173, 203, 249), 1: RGB(254, 244, 84)])  # disabled
gradient_14 = Gradient(
    LowerLimit=dedomain_18.Start,
    UpperLimit=dedomain_18.End,
    Parameter=dispatch.ListB,
    stops=[0: RGB(254, 244, 84), 0.499: RGB(234, 126, 0), 1: RGB(234, 38, 0), 1: RGB(75, 107, 169), 1: RGB(173, 203, 249)])  # disabled
ungroup_2 = Ungroup(Group=move_19.Geometry)  # disabled
dispatch_2 = Dispatch(List=ungroup_2, DispatchPattern=smaller_4.SmallerThan)  # -> ListA, ListB; disabled
previewlw_6 = CustomPreviewLineweights(Geometry=dispatch_2.ListA, Shader=gradient_13, Thickness=3, Absolute=False)  # disabled
previewlw_7 = CustomPreviewLineweights(Geometry=dispatch_2.ListB, Shader=gradient_14, Thickness=3, Absolute=False)  # disabled

crv_14 = Curve(wbedges)  # disabled
end_2 = EndPoints(Curve=crv_14)  # -> Start, End; disabled
pdecon_8 = Deconstruct(Point=end_2.Start)  # -> XComponent, YComponent, ZComponent; disabled
pdecon_9 = Deconstruct(Point=end_2.End)  # -> XComponent, YComponent, ZComponent; disabled
subtraction_10 = Subtraction(A=pdecon_8.XComponent, B=pdecon_9.XComponent)  # disabled
number_slider_33 = Slider(100, range=0..100)  # disabled
abs_3 = Absolute(Value=subtraction_10)  # disabled
smaller_5 = SmallerThan(FirstNumber=abs_3, SecondNumber=number_slider_33)  # -> SmallerThan, OrEqualTo; disabled
cull_9 = CullPattern(List=crv_14, CullPattern=smaller_5.SmallerThan)  # disabled
join_4 = JoinCurves(Curves=cull_9, Preserve=False)  # disabled
curvepoint_6 = PointOnCurve(join_4, parameter=0.5)  # disabled
pdecon_10 = Deconstruct(Point=curvepoint_6)  # -> XComponent, YComponent, ZComponent; disabled
sort_8 = SortList(Keys=pdecon_10.XComponent, ValuesA=join_4)  # -> Keys, ValuesA; disabled
explode_7 = Explode(Curve=sort_8.ValuesA, Recursive=True)  # -> Segments, simplify(Vertices); disabled
intcrv_5 = Interpolate(Vertices=explode_7.Vertices, Degree=3, Periodic=False, KnotStyle=1)  # -> Curve, Length, Domain; disabled
path_mapper_13 = PathMapper(intcrv_5.Curve, source=["{A;B}", "{A}"], target=["{A}", "{0}"])  # disabled
loft_4 = Loft(Curves=path_mapper_13, Options={Adjust=False, Closed=False, LoftEnds=0, LoftSimp=0, LoftType=0, Rebuild=10, Refit=0.01})  # disabled

mesh_7 = Mesh(mesh_6)  # disabled
number_slider_34 = Slider(1, range=0..1)  # disabled
num_25 = Number(expr("x+1", number_slider_26))  # disabled
medges_2 = MeshEdges(Mesh=mesh_7)  # -> NakedEdges, InteriorEdges, NonManifoldEdges; disabled
demesh_3 = DeconstructMesh(Mesh=mesh_7)  # -> Vertices, Faces, Colours, Normals; disabled
join_5 = JoinCurves(Curves=medges_2.NakedEdges, Preserve=False)  # disabled
patch = Patch(Curves=join_5, Points=demesh_3.Vertices, Spans=num_25, Flexibility=number_slider_34, Trim=True)  # disabled
srf_3 = Surface(simplify(patch))  # disabled

# ---- group: control gate
srf_4 = Surface(loft_4)
srf_5 = Surface(loft)
bool_2 = Boolean(relaxation)
not_2 = GateNot(A=bool_2)
cull_10 = CullPattern(List=srf_5, CullPattern=not_2)
merge_15 = Merge(Data1=srf_4, Data2=cull_10)

# ----
crv_15 = Curve(dec_reg_4.Polyline)
srf_6 = Surface(reparameterize(simplify(graft(merge_15))))
rec_4 = Rectangle(rectangle.Rectangle)
explode_8 = Explode(Curve=crv_15, Recursive=True)  # -> Segments, Vertices
path_mapper_14 = PathMapper(crv_15, source=["{A;B}", "{A}", "{A;B;C}"], target=["{A}", "{0}", "{A}"])
len_6 = Length(Curve=explode_8.Segments)
tstat = TreeStatistics(Tree=path_mapper_14)  # -> Paths, Length, Count
division_4 = Division(A=len_6, B=Slider(100, range=0..100))
lng_12 = ListLength(List=tstat.Paths)
divide_2 = DivideCurve(Curve=explode_8.Segments, Count=division_4, Kinks=False)  # -> Points, Tangents, Parameters
dup_6 = DuplicateData(Data=rec_4, Number=lng_12, Order=True)  # -> graft(Data)
path_mapper_15 = PathMapper(divide_2.Points, source=["{A;B;C;D}", "{A;B;C}", "{A;B;C;D;E}"], target=["{A}", "{0}", "{A}"])
srf_7 = Surface(reparameterize(simplify(dup_6)))
srf_cp_2 = SurfaceClosestPoint(Point=path_mapper_15, Surface=srf_7)  # -> Point, UVPoint, Distance
evalsrf = EvaluateSurface(Surface=reparameterize(srf_6), Point=srf_cp_2.UVPoint)  # -> Point, Normal, UDirection, VDirection, Frame
c_script_6 = CSharpScript(trimmedTree=evalsrf.Point, originalTree=divide_2.Points)  # -> out, A; inputs trimmedTree: tree, originalTree: tree
# ---------- c_script_6: C# ----------
    if(originalTree.DataCount != trimmedTree.DataCount) Component.AddRuntimeMessage(GH_RuntimeMessageLevel.Error, "Number of items in both trees must be equal");

    DataTree<object> outputs = new DataTree<object>();
    List<GH_Path> paths = GetPaths(originalTree);
    //step through trimmed tree objects and add them to output tree with the correct

    int counter = 0;
    for(int i = 0; i < trimmedTree.BranchCount; i++)
    {
      for(int j = 0; j < trimmedTree.Branch(i).Count; j++)
      {
        outputs.Add(trimmedTree.Branch(i)[j], paths[counter]);
        counter++;
      }
    }
    A = outputs;
# ---------- c_script_6: C# additional code ----------
  public List<GH_Path> GetPaths(DataTree<object> originalTree)
  {
    List<GH_Path> output = new List<GH_Path>();
    for(int i = 0; i < originalTree.BranchCount; i++)
    {
      for(int j = 0; j < originalTree.Branch(i).Count; j++)
      {
        output.Add(originalTree.Paths[i]);
      }
    }
    return output;
  }
# ---------- end c_script_6 ----------
intcrv_6 = Interpolate(Vertices=c_script_6.A, Degree=3, Periodic=False, KnotStyle=1)  # -> Curve, Length, Domain
trim_5 = TrimTree(Tree=intcrv_6.Curve, Depth=1)
item_26 = ListItem(List=trim_5, Index=0, Wrap=True)  # -> Item, Item1, Item2, Item3
flip_3 = FlipCurve(Curve=item_26.Item3)  # -> Curve, Flag
merge_16 = Merge(Data1=item_26.Item1, Data2=flip_3.Curve)
loft_5 = Loft(Curves=merge_16, Options={Adjust=False, Closed=False, LoftEnds=0, LoftSimp=0, LoftType=0, Rebuild=10, Refit=0.01})

srf_8 = Surface(merge_15)
edges = BrepEdges(Brep=srf_8)  # -> Naked, Interior, NonManifold
len_7 = Length(Curve=edges.Naked)
sort_9 = SortList(Keys=len_7, ValuesA=edges.Naked)  # -> Keys, reverse(ValuesA)
item_27 = ListItem(List=sort_9.ValuesA, Index=0, Wrap=True)  # -> Item, Item1
flip_4 = FlipCurve(Curve=item_27.Item1)  # -> Curve, Flag
merge_17 = Merge(Data1=item_27.Item, Data2=flip_4.Curve)
divide_3 = DivideCurve(Curve=merge_17, Count=Slider(100, range=0..100), Kinks=False)  # -> Points, Tangents, Parameters
path_mapper_16 = PathMapper(divide_3.Points, source="{A;B;C}(i)", target="{A;B;i}(C)")
item_28 = ListItem(List=path_mapper_16, Index=0, Wrap=True)  # -> Item, Item1
dist_2 = Distance(PointA=item_28.Item, PointB=item_28.Item1)
trim_6 = TrimTree(Tree=dist_2, Depth=1)
bnd_21 = Bounds(Numbers=trim_6)
dedomain_20 = DeconstructDomain(Domain=bnd_21)  # -> simplify(Start), End
multiplication_12 = Multiplication(A=dedomain_20.Start, B=Slider(0.95, range=0..1))  # -> flatten(Result)
c_script_7 = CSharpScript(x=multiplication_12)  # -> out, A; inputs x: list of Double
# ---------- c_script_7: C# ----------
    List<double> output = new List<double>();
    
    double currentVal = 0;
    for(int i = 0; i < x.Count; i++)
    {
      output.Add(currentVal);
      currentVal += x[i];
    }
    A = output;
# ---------- end c_script_7 ----------
Y_14 = UnitY(Factor=c_script_7.A)
move_20 = Move(Geometry=srf_8, Motion=graft(Y_14))  # -> Geometry, Transform

mesh_8 = Mesh(mesh_6)  # disabled
mesh_9 = Mesh(flatten(mesh_8))  # disabled
number_slider_35 = Slider(2905, range=0..10000)  # disabled
c_script_8 = CSharpScript(mesh=mesh_8, surface=srf_3)  # -> out, Curvature; inputs mesh: Mesh, surface: Surface; disabled
# ---------- c_script_8: C# ----------
        //get surface gaussian curvature at each mesh point
        List<double> gaussianCurvatures = new List<double>();
        double maxGaussian = 0;
        double minGaussian = double.MaxValue;

        double U;
        double V;

        for (int i = 0; i < mesh.Vertices.Count; i++)
        {
            Point3d currentMeshPoint = mesh.Vertices.Point3dAt(i);
            surface.ClosestPoint(currentMeshPoint, out U, out V);
            SurfaceCurvature surfaceCurvature = surface.CurvatureAt(U, V);
            double gaussian = surfaceCurvature.Gaussian;
            gaussianCurvatures.Add(gaussian);

            //get the range of curvatures
            if (gaussian > maxGaussian) maxGaussian = gaussian;
            if( gaussian < minGaussian) minGaussian = gaussian;
        }


        //get the range of curvatures


        //remap the curvatures to color values on the mesh points
        for (int i = 0; i < mesh.Vertices.Count; i++)
        {
            double hue = (gaussianCurvatures[i] - minGaussian) / (0 - minGaussian) * (0.5 - maxGaussian) + maxGaussian;
        }
        Curvature = gaussianCurvatures;
# ---------- end c_script_8 ----------
move_21 = Move(Geometry=mesh_9, Motion=Y_14)  # -> simplify(graft(Geometry)), Transform; disabled
num_26 = Number(c_script_8.Curvature)  # disabled
Y_15 = UnitY(Factor=number_slider_35)  # disabled
number_slider_36 = Slider(7456, range=0..10000)  # disabled
bnd_22 = Bounds(Numbers=num_26)  # disabled
mesh_10 = Mesh(move_21.Geometry)  # disabled
dedomain_21 = DeconstructDomain(Domain=bnd_22)  # -> Start, End; disabled
move_22 = Move(Geometry=mesh_10, Motion=Y_15)  # -> Geometry, Transform; disabled
X_3 = UnitX(Factor=number_slider_36)  # disabled
gradient_15 = Gradient(
    LowerLimit=dedomain_21.Start,
    UpperLimit=dedomain_21.End,
    Parameter=num_26,
    stops=[0: RGB(0, 128, 0), 0.5: RGB(255, 255, 0), 1: RGB(255, 0, 0)])  # disabled
move_23 = Move(Geometry=move_22.Geometry, Motion=X_3)  # -> Geometry, Transform; disabled
c_script_9 = CSharpScript(mesh=move_23.Geometry, colors=simplify(gradient_15))  # -> out, A; inputs mesh: Mesh, colors: list of Color; disabled
# ---------- c_script_9: C# ----------
    for(int i = 0; i < mesh.Vertices.Count; i++)
    {
      mesh.VertexColors.SetColor(i, colors[i]);
    }
    A = mesh;
# ---------- end c_script_9 ----------

gaussian_curvature = Panel(bnd_22)  # disabled
relaxation_2 = Panel(bnd_19)  # disabled

trim_7 = TrimTree(Tree=loft_5, Depth=2)
vec_6 = Vector(Y_14)
join_6 = BrepJoin(Breps=trim_7)  # -> Breps, Closed
trim_8 = TrimTree(Tree=join_6.Breps, Depth=1)
item_29 = ListItem(List=trim_8, Index=0, Wrap=True)  # -> flatten(Item)
move_24 = Move(Geometry=item_29, Motion=vec_6)  # -> Geometry, Transform

brep = Brep(move_24.Geometry)

c_script_10 = CSharpScript(breps=brep)  # -> out, A; inputs breps: list
# ---------- c_script_10: C# ----------
    DataTree<object> output = new DataTree<object>();
    if(breps.Count == 1) return;
    for(int i = 0; i < breps.Count; i++)
    {
      GH_Path path = new GH_Path(i);
      if(i == 0)output.Add(breps[i + 1], path);
      else if(i == breps.Count - 1)output.Add(breps[i - 1], path);
      else
      {
        output.Add(breps[i - 1], path);
        output.Add(breps[i + 1], path);
      }
    }
    A = output;
# ---------- end c_script_10 ----------
splitmul = SplitBrepMultiple(Brep=graft(brep), Cutters=c_script_10.A)
area_8 = Area(Geometry=splitmul)  # -> Area, Centroid
sort_10 = SortList(Keys=area_8.Area, ValuesA=splitmul)  # -> Keys, reverse(ValuesA)
item_30 = ListItem(List=sort_10.ValuesA, Index=0, Wrap=True)
brep_2 = Brep(flatten(item_30))

item_31 = ListItem(List=brep_2, Index=0, Wrap=True)
item_32 = ListItem(List=brep_2, Index=1, Wrap=True)
number_slider_37 = Slider(1000, range=0..1000)
bbx = BrepBrep(BrepA=item_31, BrepB=item_32)  # -> Curves, Points
ext = ExtendCurve(Curve=bbx.Curves, Type=0, Start=number_slider_37, End=number_slider_37)
Y_16 = UnitY(Factor=Slider(10000, range=0..10000))
neg_9 = Negative(Value=Y_16)
extr = Extrude(Base=ext, Direction=neg_9)
split = SplitBrep(Brep=item_31, Cutter=extr)
area_9 = Area(Geometry=split)  # -> Area, Centroid
pdecon_11 = Deconstruct(Point=area_9.Centroid)  # -> XComponent, YComponent, ZComponent
sort_11 = SortList(Keys=pdecon_11.ZComponent, ValuesA=split)  # -> Keys, reverse(ValuesA)
item_33 = ListItem(List=sort_11.ValuesA, Index=0, Wrap=True)

item_34 = ListItem(List=reverse(brep_2), Index=0, Wrap=True)
item_35 = ListItem(List=reverse(brep_2), Index=1, Wrap=True)
number_slider_38 = Slider(1000, range=0..1000)
bbx_2 = BrepBrep(BrepA=item_34, BrepB=item_35)  # -> Curves, Points
ext_2 = ExtendCurve(Curve=bbx_2.Curves, Type=0, Start=number_slider_38, End=number_slider_38)
Y_17 = UnitY(Factor=Slider(10000, range=0..10000))
extr_2 = Extrude(Base=ext_2, Direction=Y_17)
split_2 = SplitBrep(Brep=item_34, Cutter=extr_2)
area_10 = Area(Geometry=split_2)  # -> Area, Centroid
pdecon_12 = Deconstruct(Point=area_10.Centroid)  # -> XComponent, YComponent, ZComponent
sort_12 = SortList(Keys=pdecon_12.ZComponent, ValuesA=split_2)  # -> Keys, reverse(ValuesA)
item_36 = ListItem(List=sort_12.ValuesA, Index=0, Wrap=True)

brep_3 = Brep(brep_2)

lng_13 = ListLength(List=brep_3)
dom_16 = ConstructDomain(DomainStart=1, DomainEnd=expr("x-2", lng_13))
larger = LargerThan(FirstNumber=lng_13, SecondNumber=2)  # -> LargerThan, OrEqualTo
subset_13 = SubList(List=brep_3, Domain=dom_16, Wrap=True)  # -> List, Index
cull_11 = CullPattern(List=subset_13.List, CullPattern=larger.LargerThan)

lng_14 = ListLength(List=brep_2)  # -> expr("x-1", Length)
merge_18 = Merge(Data1=flatten(item_33), Data2=flatten(cull_11), Data3=flatten(item_36))
dom_17 = ConstructDomain(DomainStart=0, DomainEnd=lng_14)
subset_14 = SubList(List=merge_18, Domain=dom_17, Wrap=True)  # -> List, Index

debrep_4 = DeconstructBrep(Brep=subset_14.List)  # -> simplify(Faces), Edges, Vertices
debrep_5 = DeconstructBrep(Brep=debrep_4.Faces)  # -> Faces, Edges, Vertices
pdecon_13 = Deconstruct(Point=debrep_5.Vertices)  # -> XComponent, YComponent, ZComponent
avr_3 = Average(Input=debrep_5.Vertices)
sort_13 = SortList(Keys=pdecon_13.XComponent)  # -> Keys, ValuesA
item_37 = ListItem(List=sort_13.Keys, Index=0, Wrap=True)
pdecon_14 = Deconstruct(Point=avr_3)  # -> XComponent, YComponent, ZComponent
trim_9 = TrimTree(Tree=pdecon_14.YComponent, Depth=1)
trim_10 = TrimTree(Tree=item_37, Depth=1)
sort_14 = SortList(Keys=trim_10, ValuesA=debrep_4.Faces, ValuesB=trim_9)  # -> Keys, ValuesA, ValuesB
round = Round(Number=sort_14.Keys)  # -> Nearest, Floor, Ceiling
cset = CreateSet(List=round.Nearest)  # -> Set, Map
c_script_11 = CSharpScript(valueSet=cset.Set, values=round.Nearest, others1=sort_14.ValuesA, others2=sort_14.ValuesB)  # -> out, A, B; inputs valueSet: tree of Double, values: tree of Double, others1: tree, others2: tree
# ---------- c_script_11: C# ----------
    DataTree<object> output1 = new DataTree<object>();
    DataTree<object> output2 = new DataTree<object>();

    for(int i = 0; i < values.BranchCount; i++)
    {
      for(int j = 0; j < values.Branch(i).Count; j++)
      {
        for(int v = 0; v < valueSet.Branch(i).Count; v++)
        {
          if(values.Branch(i)[j] == valueSet.Branch(i)[v])
          {
            output1.Add(others1.Branch(i)[j], new GH_Path(i, v));
            output2.Add(others2.Branch(i)[j], new GH_Path(i, v));
          }
        }
      }
    }
    A = output1;
    B = output2;
# ---------- end c_script_11 ----------
sort_15 = SortList(Keys=c_script_11.B, ValuesA=c_script_11.A)  # -> Keys, ValuesA
c_script_12 = CSharpScript(surfaces=sort_15.ValuesA)  # -> out, A; inputs surfaces: tree
# ---------- c_script_12: C# ----------
    //find longest branch for each panel
    List<int> longestBranchLength = new List<int>();
    int basePath = 0;
    for(int i = 0; i < surfaces.BranchCount; i++)
    {
      if(surfaces.Paths[i][0] == basePath)
      {
        if(longestBranchLength.Count == basePath)longestBranchLength.Add(surfaces.Branch(i).Count);
        if(surfaces.Branch(i).Count > longestBranchLength[basePath]) longestBranchLength[basePath] = surfaces.Branch(i).Count;
      }
      else 
      {
        basePath++;
        longestBranchLength.Add(surfaces.Branch(i).Count);
      }
    }
    
    DataTree<object> output = new DataTree<object>();
    //add surfaces to correct paths, flipping matrix but keeping rows straight
    for(int i = 0; i < surfaces.BranchCount; i++)
    {
      int offset = (longestBranchLength[surfaces.Paths[i][0]] - surfaces.Branch(i).Count) / 2;
      for(int j = 0; j < surfaces.Branch(i).Count; j++)
      {
        GH_Path path = new GH_Path(surfaces.Paths[i][0], j + offset);
        output.Add(surfaces.Branch(i)[j], path);
      }
    }
    A = output;
# ---------- end c_script_12 ----------
trim_11 = TrimTree(Tree=c_script_12.A, Depth=1)

brep_4 = Brep(subset_14.List)
join_7 = BrepJoin(Breps=brep_4)  # -> Breps, Closed
debrep_6 = DeconstructBrep(Brep=join_7.Breps)  # -> Faces, Edges, Vertices
pdecon_15 = Deconstruct(Point=debrep_6.Vertices)  # -> XComponent, YComponent, ZComponent
equalst = EqualityWithinTolerance(FirstNumber=pdecon_15.XComponent, SecondNumber="0", Tolerance=Slider(10, range=0..10))  # -> Equality, Inequality
cull_12 = CullPattern(List=debrep_6.Vertices, CullPattern=equalst.Equality)

# ---- group: surfaces
srf_9 = Surface(trim_11)

# ---- group: support points
pt_22 = Point(cull_12)

# ---- group: brep extension if needed
debrep_7 = DeconstructBrep(Brep=brep)  # -> simplify(Faces), Edges, Vertices; disabled
debrep_8 = DeconstructBrep(Brep=debrep_7.Faces)  # -> Faces, Edges, Vertices; disabled
pdecon_16 = Deconstruct(Point=debrep_8.Vertices)  # -> XComponent, YComponent, ZComponent; disabled
sort_16 = SortList(Keys=pdecon_16.XComponent)  # -> Keys, ValuesA; disabled
item_38 = ListItem(List=sort_16.Keys, Index=0, Wrap=True)  # disabled
trim_12 = TrimTree(Tree=debrep_8.Faces, Depth=1)  # disabled
trim_13 = TrimTree(Tree=item_38, Depth=1)  # disabled
round_2 = Round(Number=trim_13)  # -> Nearest, Floor, Ceiling; disabled
sort_17 = SortList(Keys=round_2.Nearest, ValuesA=trim_12)  # -> Keys, simplify(ValuesA); disabled
cset_2 = CreateSet(List=round_2.Nearest)  # -> Set, Map; disabled
item_39 = ListItem(List=reverse(cset_2.Set), Index=0, Wrap=True)  # disabled
item_40 = ListItem(List=cset_2.Set, Index=0, Wrap=True)  # disabled
equals = Equality(FirstNumber=sort_17.Keys, SecondNumber=item_40)  # -> Equality, Inequality; disabled
equals_2 = Equality(FirstNumber=sort_17.Keys, SecondNumber=item_39)  # -> Equality, Inequality; disabled
and = GateAnd(A=equals.Inequality, B=equals_2.Inequality)  # disabled
number_slider_39 = Slider(1000, range=0..1000)  # disabled
number_slider_40 = Slider(1000, range=0..1000)  # disabled

# ---- group: brep extension if needed / middle
cull_13 = CullPattern(List=sort_17.ValuesA, CullPattern=and)  # disabled

# ---- group: brep extension if needed / start
cull_14 = CullPattern(List=sort_17.ValuesA, CullPattern=equals.Equality)  # disabled

# ---- group: brep extension if needed / end
cull_15 = CullPattern(List=sort_17.ValuesA, CullPattern=equals_2.Equality)  # disabled

# ---- group: brep extension if needed (continued)
extendsrf = ExtendSurface(Surface=cull_14, WestEdge=0, SouthEdge=0, EastEdge=number_slider_39, NorthEdge=0, ExtensionType=True)  # disabled
extendsrf_2 = ExtendSurface(Surface=cull_15, WestEdge=number_slider_40, SouthEdge=0, EastEdge=0, NorthEdge=0, ExtensionType=True)  # disabled
merge_19 = Merge(Data1=cull_13, Data2=extendsrf, Data3=extendsrf_2)  # disabled
join_8 = BrepJoin(Breps=merge_19)  # -> flatten(Breps), Closed; disabled

# ----
data_9 = Data(cull_6)
data_10 = Data(species_2)
dec_panel_buildups = DeconstructPanelBuildup(Panels=data_9)  # -> WoodSpecies, Thicknesses
tstat_2 = TreeStatistics(Tree=dec_panel_buildups.Thicknesses)  # -> Paths, Length, Count
lng_15 = ListLength(List=tstat_2.Paths)
dup_7 = DuplicateData(Data=data_10, Number=lng_15, Order=True)  # -> graft(Data)
dup_8 = DuplicateData(Data="4", Number=lng_15, Order=True)  # -> graft(Data)
match = MatchTree(Tree=dup_7, Guide=dec_panel_buildups.WoodSpecies)
match_2 = MatchTree(Tree=dup_8, Guide=dec_panel_buildups.Thicknesses)
merge_20 = Merge(Data1=dec_panel_buildups.WoodSpecies, Data2=match)
merge_21 = Merge(Data1=dec_panel_buildups.Thicknesses, Data2=match_2)

# ---- group: thicknesses
num_27 = Number(merge_21)

# ---- group: species
data_11 = Data(merge_20)

# ----
c_script_13 = CSharpScript(x=data_11)  # -> out, A; inputs x: tree
# ---------- c_script_13: C# ----------
    DataTree<object> output = new DataTree<object>();
    int firstIndex = 0;
    int branchCount = 0;
    for(int i = 0; i < x.BranchCount; i++)
    {
      GH_Path path = new GH_Path(firstIndex, branchCount);
      if(x.Paths[i][0] == firstIndex)
      {
        output.AddRange(x.Branch(i), path);
      }
      else
      {
        firstIndex++;
        branchCount = -1;
        i--;
      }
      branchCount++;
    }
    A = output;
# ---------- end c_script_13 ----------
c_script_14 = CSharpScript(x=num_27)  # -> out, A; inputs x: tree; same code as c_script_13

debrep_9 = DeconstructBrep(Brep=simplify(graft(brep)))  # -> simplify(Faces), Edges, Vertices
brep_5 = Brep(subset_14.List)
edges_2 = BrepEdges(Brep=brep_5)  # -> Naked, Interior, NonManifold
srf_10 = Surface(graft(debrep_9.Faces))
crv_16 = Curve(edges_2.Naked)
debrep_10 = DeconstructBrep(Brep=srf_10)  # -> Faces, Edges, simplify(Vertices)
join_9 = JoinCurves(Curves=crv_16, Preserve=False)  # -> simplify(Curves)
len_8 = Length(Curve=join_9)
group_3 = Group(Objects=debrep_10.Vertices)
sort_18 = SortList(Keys=len_8, ValuesA=join_9)  # -> Keys, reverse(ValuesA)
trim_14 = TrimTree(Tree=group_3, Depth=1)
lng_16 = ListLength(List=trim_14)
item_41 = ListItem(List=sort_18.ValuesA, Index=0, Wrap=True)
project = Project(Geometry=item_41, Plane=PlaneXY(0, 0, 0))  # -> Geometry, Transform
dup_9 = DuplicateData(Data=project.Geometry, Number=lng_16, Order=True)  # -> simplify(graft(Data))

project_2 = Project(Geometry=debrep_10.Vertices, Plane=PlaneXY(0, 0, 0))  # -> Geometry, Transform

incurve = PointInCurve(Point=project_2.Geometry, Curve=dup_9)  # -> Relationship, Point
equals_3 = Equality(FirstNumber=incurve.Relationship, SecondNumber="0")  # -> Equality, Inequality
cull_16 = CullPattern(List=incurve.Relationship, CullPattern=equals_3.Inequality)
lng_17 = ListLength(List=cull_16)
larger_2 = LargerThan(FirstNumber=lng_17, SecondNumber="0")  # -> LargerThan, OrEqualTo

trim_15 = TrimTree(Tree=simplify(debrep_10.Faces), Depth=1)
item_42 = ListItem(List=trim_15, Index=Slider(21, range=0..1000), Wrap=True)

bool_3 = Boolean(larger_2.LargerThan)
cull_17 = CullPattern(List=c_script_13.A, CullPattern=bool_3)
cull_18 = CullPattern(List=c_script_14.A, CullPattern=bool_3)
clean_2 = CleanTree(RemoveNulls=True, RemoveInvalid=True, RemoveEmpty=True, Tree=cull_17)
clean_3 = CleanTree(RemoveNulls=True, RemoveInvalid=True, RemoveEmpty=True, Tree=cull_18)
c_script_15 = CSharpScript(x=clean_2)  # -> out, A; inputs x: tree; same code as c_script_13
c_script_16 = CSharpScript(x=clean_3)  # -> out, A; inputs x: tree; same code as c_script_13

# ---- group: species
data_12 = Data(c_script_15.A)

# ---- group: thicknesses
num_28 = Number(c_script_16.A)

# ----
lng_18 = ListLength(List=num_28)
bnd_23 = Bounds(Numbers=flatten(lng_18))
dedomain_22 = DeconstructDomain(Domain=bnd_23)  # -> Start, End
gradient_16 = Gradient(
    LowerLimit=dedomain_22.Start,
    UpperLimit=dedomain_22.End,
    Parameter=lng_18,
    stops=[0: RGB(255, 255, 255), 1: RGB(59, 59, 59)])
preview_9 = CustomPreview(Geometry=graft(srf_9), Material=gradient_16)

# ---- group: buildups
dec_secies = DeconstructSpecies(Species=data_12)  # -> N, LX, RX, TX, LE, RE, TE
cset_3 = CreateSet(List=dec_secies.N)  # -> Set, Map
material_buildups = Panel("""100
200
300
101
201
301""")

# ---- group: buildups / layer count
lng_19 = ListLength(List=dec_secies.N)

# ---- group: buildups / material type
lng_20 = ListLength(List=cset_3.Set)

# ---- group: buildups (continued)
c_script_17 = CSharpScript(layerCount=lng_19, materialCount=lng_20)  # -> out, A; inputs layerCount: tree of Int32, materialCount: tree of Int32
# ---------- c_script_17: C# ----------
    DataTree<int> keys = new DataTree<int>();

    for(int i = 0; i < layerCount.BranchCount;i++)
    {
      int lCount = layerCount.Branch(i)[0];
      int mCount = materialCount.Branch(i)[0];
      GH_Path path = materialCount.Paths[i];

      if(lCount == 3 && mCount == 1) keys.Add(0, path);
      if(lCount == 5 && mCount == 1) keys.Add(1, path);
      if(lCount == 7 && mCount == 1) keys.Add(2, path);
      if(lCount == 3 && mCount == 2) keys.Add(3, path);
      if(lCount == 5 && mCount == 2) keys.Add(4, path);
      if(lCount == 7 && mCount == 2) keys.Add(5, path);

    }
    A = keys;
# ---------- end c_script_17 ----------
item_43 = ListItem(List=material_buildups, Index=c_script_17.A, Wrap=True)

# ---- group: material ids
num_29 = Number(item_43)
