# Grasshopper definition BilayerDesign - demonstrator karamba.gh (Grasshopper 1.0.7)
# plug-ins: HygroDesign, Pufferfish, MeshEdit Components, Karamba3D, Kangaroo2 Components, Weaverbird, Human, LunchBox, Opossum2_0_Proto_A

# ---- group: beech
panel = Panel("beech")
number_slider = Slider(0.0001, range=0..0.0001)
number_slider_2 = Slider(0.002, range=0..1)
number_slider_3 = Slider(0.0041, range=0..1)
number_slider_4 = Slider(14000, range=0..20000)
number_slider_5 = Slider(2280, range=0..20000)
number_slider_6 = Slider(1160, range=0..20000)
number_slider_7 = Slider(720, range=0..1000)

# ---- group: spruce
panel_2 = Panel("spruce")
number_slider_8 = Slider(0.0001, range=0..0.0001)
number_slider_9 = Slider(0.0019, range=0..1)
number_slider_10 = Slider(0.0036, range=0..1)
number_slider_11 = Slider(10000, range=0..20000)
number_slider_12 = Slider(800, range=0..20000)
number_slider_13 = Slider(450, range=0..20000)
number_slider_14 = Slider(400, range=0..1000)

# ---- group: must be even
number_slider_15 = Slider(2, range=0..10)

# ----
number_slider_16 = Slider(1000, range=0..1000)
rectangle = Rectangle(Plane=PlaneXY(0, 0, 0), XSize=number_slider_16, YSize=number_slider_16, Radius=0)  # -> Rectangle, Length
drec = DeconstuctRectangle(Rectangle=rectangle.Rectangle)  # -> BasePlane, XInterval, YInterval
dedomain = DeconstructDomain(Domain=drec.YInterval)  # -> Start, End
subtraction = Subtraction(A=dedomain.End, B=dedomain.Start)
division = Division(A=subtraction, B=2)
number_slider_17 = Slider(0.412, range=0..1)
number_slider_18 = Slider(0.997, range=0..1)
dom = ConstructDomain(DomainStart=0, DomainEnd=1)
number_slider_19 = Slider(0.857, range=0..1)
addition = Addition(A=dedomain.Start, B=division)
dom_2 = ConstructDomain(DomainStart=addition, DomainEnd=dedomain.End)
dom_3 = ConstructDomain(DomainStart=addition, DomainEnd=dedomain.Start)
remap = RemapNumbers(Value=number_slider_17, Source=dom, Target=dom_3)  # -> Mapped, Clipped
remap_2 = RemapNumbers(Value=number_slider_18, Source=dom, Target=drec.XInterval)  # -> Mapped, Clipped
remap_3 = RemapNumbers(Value=number_slider_17, Source=dom, Target=dom_2)  # -> Mapped, Clipped
remap_4 = RemapNumbers(Value=number_slider_19, Source=dom, Target=drec.XInterval)  # -> Mapped, Clipped
pt = ConstructPoint(XCoordinate=0, YCoordinate=remap_2.Mapped, ZCoordinate=0)
pt_2 = ConstructPoint(XCoordinate=remap.Mapped, YCoordinate=remap_4.Mapped, ZCoordinate=0)
pt_3 = ConstructPoint(XCoordinate=remap_3.Mapped, YCoordinate=remap_4.Mapped, ZCoordinate=0)
pt_4 = ConstructPoint(XCoordinate=number_slider_16, YCoordinate=remap_2.Mapped, ZCoordinate=0)
merge = Merge(Data1=pt, Data2=pt_2, Data3=pt_3, Data4=pt_4)
nurbs = NurbsCurve(Vertices=merge, Degree=2, Periodic=False)  # -> Curve, Length, Domain

number_slider_20 = Slider(1000, range=0..1000)
rectangle_2 = Rectangle(Plane=PlaneXY(0, 0, 0), XSize=number_slider_20, YSize=number_slider_20, Radius=0)  # -> Rectangle, Length
drec_2 = DeconstuctRectangle(Rectangle=rectangle_2.Rectangle)  # -> BasePlane, XInterval, YInterval
dedomain_2 = DeconstructDomain(Domain=drec_2.YInterval)  # -> Start, End
subtraction_2 = Subtraction(A=dedomain_2.End, B=dedomain_2.Start)
division_2 = Division(A=subtraction_2, B=2)
number_slider_21 = Slider(0.77, range=0..1)
number_slider_22 = Slider(0.945, range=0..1)
dom_4 = ConstructDomain(DomainStart=0, DomainEnd=1)
addition_2 = Addition(A=dedomain_2.Start, B=division_2)
number_slider_23 = Slider(0.046, range=0..1)
dom_5 = ConstructDomain(DomainStart=addition_2, DomainEnd=dedomain_2.End)
dom_6 = ConstructDomain(DomainStart=addition_2, DomainEnd=dedomain_2.Start)
remap_5 = RemapNumbers(Value=number_slider_21, Source=dom_4, Target=dom_6)  # -> Mapped, Clipped
remap_6 = RemapNumbers(Value=number_slider_22, Source=dom_4, Target=drec_2.XInterval)  # -> Mapped, Clipped
remap_7 = RemapNumbers(Value=number_slider_21, Source=dom_4, Target=dom_5)  # -> Mapped, Clipped
remap_8 = RemapNumbers(Value=number_slider_23, Source=dom_4, Target=drec_2.XInterval)  # -> Mapped, Clipped
pt_5 = ConstructPoint(XCoordinate=0, YCoordinate=remap_6.Mapped, ZCoordinate=0)
pt_6 = ConstructPoint(XCoordinate=remap_5.Mapped, YCoordinate=remap_8.Mapped, ZCoordinate=0)
pt_7 = ConstructPoint(XCoordinate=remap_7.Mapped, YCoordinate=remap_8.Mapped, ZCoordinate=0)
pt_8 = ConstructPoint(XCoordinate=number_slider_20, YCoordinate=remap_6.Mapped, ZCoordinate=0)
merge_2 = Merge(Data1=pt_5, Data2=pt_6, Data3=pt_7, Data4=pt_8)
nurbs_2 = NurbsCurve(Vertices=merge_2, Degree=2, Periodic=False)  # -> Curve, Length, Domain

number_slider_24 = Slider(1000, range=0..1000)
rectangle_3 = Rectangle(Plane=PlaneXY(0, 0, 0), XSize=number_slider_24, YSize=number_slider_24, Radius=0)  # -> Rectangle, Length
drec_3 = DeconstuctRectangle(Rectangle=rectangle_3.Rectangle)  # -> BasePlane, XInterval, YInterval
dedomain_3 = DeconstructDomain(Domain=drec_3.YInterval)  # -> Start, End
subtraction_3 = Subtraction(A=dedomain_3.End, B=dedomain_3.Start)
division_3 = Division(A=subtraction_3, B=2)
number_slider_25 = Slider(0.014, range=0..1)
dom_7 = ConstructDomain(DomainStart=0, DomainEnd=1)
number_slider_26 = Slider(0.852, range=0..1)
addition_3 = Addition(A=dedomain_3.Start, B=division_3)
number_slider_27 = Slider(0.781, range=0..1)
dom_8 = ConstructDomain(DomainStart=addition_3, DomainEnd=dedomain_3.End)
dom_9 = ConstructDomain(DomainStart=addition_3, DomainEnd=dedomain_3.Start)
remap_9 = RemapNumbers(Value=number_slider_26, Source=dom_7, Target=dom_9)  # -> Mapped, Clipped
remap_10 = RemapNumbers(Value=number_slider_25, Source=dom_7, Target=drec_3.XInterval)  # -> Mapped, Clipped
remap_11 = RemapNumbers(Value=number_slider_26, Source=dom_7, Target=dom_8)  # -> Mapped, Clipped
remap_12 = RemapNumbers(Value=number_slider_27, Source=dom_7, Target=drec_3.XInterval)  # -> Mapped, Clipped
pt_9 = ConstructPoint(XCoordinate=0, YCoordinate=remap_10.Mapped, ZCoordinate=0)
pt_10 = ConstructPoint(XCoordinate=remap_9.Mapped, YCoordinate=remap_12.Mapped, ZCoordinate=0)
pt_11 = ConstructPoint(XCoordinate=remap_11.Mapped, YCoordinate=remap_12.Mapped, ZCoordinate=0)
pt_12 = ConstructPoint(XCoordinate=number_slider_24, YCoordinate=remap_10.Mapped, ZCoordinate=0)
merge_3 = Merge(Data1=pt_9, Data2=pt_10, Data3=pt_11, Data4=pt_12)
nurbs_3 = NurbsCurve(Vertices=merge_3, Degree=2, Periodic=False)  # -> Curve, Length, Domain

spruce_count = Slider(160, range=0..500)
beech_count = Slider(50, range=0..500)
int = Integer(number_slider_15)
number_slider_28 = Slider(0.481, range=0..0.5)
number_slider_29 = Slider(0.56, range=0.5..1)
species = WoodSpecies(
    name=panel,
    density=number_slider_7,
    LExp=number_slider,
    RExp=number_slider_2,
    TExp=number_slider_3,
    LEmod=number_slider_4,
    REmod=number_slider_5,
    TEmod=number_slider_6)
species_2 = WoodSpecies(
    name=panel_2,
    density=number_slider_14,
    LExp=number_slider_8,
    RExp=number_slider_9,
    TExp=number_slider_10,
    LEmod=number_slider_11,
    REmod=number_slider_12,
    TEmod=number_slider_13)

number_slider_30 = Slider(150, range=0..10000)
number_slider_31 = Slider(5, range=0..10)
number_slider_32 = Slider(1000, range=0..10000)
number_slider_33 = Slider(13, range=0..100)
xy = XYPlane(Origin=Point(0, 0, 0))
multiplication = Multiplication(A=number_slider_33, B=number_slider_30)
multiplication_2 = Multiplication(A=number_slider_32, B=number_slider_31)
bilayer = Bilayer(
    BasePlane=xy,
    BoardWidth=number_slider_30,
    BoardLength=number_slider_32,
    WidthCount=number_slider_33,
    LengthCount=number_slider_31,
    ActiveThickness=Slider(20, range=0..100),
    PassiveThickness=Slider(4, range=0..100),
    PassiveSpecies=species_2,
    RegionCount=int)
rectangle_4 = Rectangle(Plane=PlaneXY(0, 0, 0), XSize=multiplication_2, YSize=multiplication, Radius=0)  # -> Rectangle, Length
num = Number(number_slider_30)
num_2 = Number(number_slider_32)

drec_4 = DeconstuctRectangle(Rectangle=rectangle_4.Rectangle)  # -> BasePlane, XInterval, YInterval
panel_3 = Panel(drec_4.XInterval)
panel_4 = Panel(drec_4.YInterval)

# ---- group: name
num_3 = Number(spruce_count)
series = Series(Start=0, Step=1, Count=num_3)
dup = DuplicateData(Data="S", Number=num_3, Order=True)  # -> graft(Data)
txt = Text(graft(series))
merge_4 = Merge(Data1=dup, Data2=txt)  # -> simplify(Result)
join = TextJoin(Text=merge_4)  # -> flatten(Result)

num_4 = Number(beech_count)
series_2 = Series(Start=0, Step=1, Count=num_4)
dup_2 = DuplicateData(Data="B", Number=num_4, Order=True)  # -> graft(Data)
txt_2 = Text(graft(series_2))
merge_5 = Merge(Data1=dup_2, Data2=txt_2)  # -> simplify(Result)
join_2 = TextJoin(Text=merge_5)  # -> flatten(Result)

# ---- group: active thickness
number_slider_34 = Slider(20, range=0..100)

# ---- group: RT
dom_10 = ConstructDomain(DomainStart=Slider(15, range=0..100), DomainEnd=Slider(75, range=0..100))
random = Random(Range=dom_10, Number=spruce_count, Seed=Slider(225, range=0..1000))

dom_11 = ConstructDomain(DomainStart=Slider(15, range=0..100), DomainEnd=Slider(75, range=0..100))
random_2 = Random(Range=dom_11, Number=beech_count, Seed=Slider(225, range=0..1000))

# ----
panel_5 = Panel("C:\Users\Alex Reiner\Documents\GitHub\HygroDesign\Grasshopper")
panel_6 = Panel("C:\Users\Alex Reiner\Documents\GitHub\HygroDesign\Grasshopper")

# ---- group: spruce
data = Data(species_2)
num_5 = Number(spruce_count)
dup_3 = DuplicateData(Data=data, Number=num_5, Order=True)

# ---- group: beech
num_6 = Number(beech_count)
data_2 = Data(species)
dup_4 = DuplicateData(Data=data_2, Number=num_6, Order=True)

# ---- group: thickness
num_7 = Number(number_slider_34)
num_8 = Number(spruce_count)
dup_5 = DuplicateData(Data=num_7, Number=num_8, Order=True)

# ---- group: length
num_9 = Number("2500")
num_10 = Number(beech_count)
dup_6 = DuplicateData(Data=num_9, Number=num_10, Order=True)

num_11 = Number("2500")
num_12 = Number(spruce_count)
dup_7 = DuplicateData(Data=num_11, Number=num_12, Order=True)

# ---- group: width
num_13 = Number(num)
num_14 = Number(spruce_count)
dup_8 = DuplicateData(Data=num_13, Number=num_14, Order=True)

# ---- group: thickness
num_15 = Number(number_slider_34)
num_16 = Number(beech_count)
dup_9 = DuplicateData(Data=num_15, Number=num_16, Order=True)

# ---- group: width
num_17 = Number(num)
num_18 = Number(beech_count)
dup_10 = DuplicateData(Data=num_17, Number=num_18, Order=True)

# ----
num_19 = Number(spruce_count)
num_20 = Number(beech_count)
dup_11 = DuplicateData(Data=panel_5, Number=num_19, Order=True)
dup_12 = DuplicateData(Data=panel_6, Number=num_20, Order=True)
entwine = Entwine(Branch00=dup_9, Branch01=dup_5, FlattenInputs=True)  # -> flatten(Result)
entwine_2 = Entwine(Branch00=join_2, Branch01=join, FlattenInputs=True)  # -> flatten(Result)
entwine_3 = Entwine(Branch00=dup_10, Branch01=dup_8, FlattenInputs=True)  # -> flatten(Result)
entwine_4 = Entwine(Branch00=dup_6, Branch01=dup_7, FlattenInputs=True)  # -> flatten(Result)
entwine_5 = Entwine(Branch00=random_2, Branch01=random, FlattenInputs=True)  # -> flatten(Result)
entwine_6 = Entwine(Branch00=dup_4, Branch01=dup_3, FlattenInputs=True)  # -> flatten(Result)
entwine_7 = Entwine(Branch00=dup_12, Branch01=dup_11, FlattenInputs=True)  # -> flatten(Result)
stock_boards = StockBoards(
    Name=entwine_2,
    Species=entwine_6,
    Thickness=entwine,
    Length=entwine_4,
    Width=entwine_3,
    RTAngle=entwine_5,
    ImgPath=entwine_7)
merge_6 = Merge(Data1=nurbs.Curve, Data2=nurbs_2.Curve, Data3=nurbs_3.Curve)

crv = Curve(merge_6)
lng = ListLength(List=crv)  # -> expr("x-2", Length)
dom_12 = ConstructDomain(DomainStart=0, DomainEnd=lng)
subset = SubList(List=crv, Domain=dom_12, Wrap=True)  # -> graft(List), Index
shift = ShiftList(List=crv, Shift=1, Wrap=False)  # -> graft(List)
merge_7 = Merge(Data1=subset.List, Data2=shift)  # -> simplify(Result)
group = Group(Objects=merge_7)  # -> flatten(Group)

deconstruct_bilayer = DeconstructBilayer(Bilayer=bilayer)
dec_board = DeconstructBoard(Board=deconstruct_bilayer)  # -> Polyline, Name, Species, RTAngle, MoistureChange, DesiredRadius, Radius, BlendedRadius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
area = Area(Geometry=dec_board.Polyline)  # -> Area, Centroid
c_script = CSharpScript(rects=flatten(dec_board.Polyline))  # -> out; inputs rects: list of Rectangle3d; disabled
# ---------- c_script: C# usings ----------
using Rhino.DocObjects;
# ---------- c_script: C# ----------
    var object_enumerator_settings = new ObjectEnumeratorSettings();

    var rhinoObjects = RhinoDoc.ActiveDoc.Objects.GetObjectList(object_enumerator_settings);
    var objectTable = RhinoDoc.ActiveDoc.Objects;

    foreach( var rhinoObject in rhinoObjects)
    {
      if(rhinoObject.ObjectType == ObjectType.Curve)
      {
        Curve rhinoCurve = rhinoObject.Geometry as Curve;
        if(rhinoCurve.IsClosed)objectTable.Delete(rhinoObject);
      }
    }

    foreach(var rect in rects)objectTable.AddCurve(rect.ToNurbsCurve());
# ---------- end c_script ----------
pt_13 = Point(simplify(area.Centroid))

# ---- group: Thickness
dec_reg = DeconstructBoardRegion(BoardRegion=dec_board.BoardRegions)  # -> Polyline, Name, Species, RTAngle, MoistureChange, DesiredRadius, Radius, BlendedRadius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
area_2 = Area(Geometry=dec_reg.Polyline)  # -> Area, Centroid
pt_14 = Point(simplify(area_2.Centroid))

# ----
bbox = BoundingBox(Content=dec_board.Polyline, Plane=PlaneXY(0, 0, 0), UnionBox=True)  # -> Box, Box_2
debox = DeconstructBox(Box=bbox.Box)  # -> Plane, X, Y, Z
dedomain_4 = DeconstructDomain(Domain=debox.Y)  # -> Start, End
subtraction_4 = Subtraction(A=dedomain_4.End, B=dedomain_4.Start)
division_4 = Division(A=subtraction_4, B=2)
number_slider_35 = Slider(0.262, range=0.25..1)
number_slider_36 = Slider(0.003, range=0..0.75)
number_slider_37 = Slider(0.998, range=0..1)
addition_4 = Addition(A=dedomain_4.Start, B=division_4)
dom_13 = ConstructDomain(DomainStart=0, DomainEnd=1)
dom_14 = ConstructDomain(DomainStart=addition_4, DomainEnd=dedomain_4.End)
dom_15 = ConstructDomain(DomainStart=addition_4, DomainEnd=dedomain_4.Start)
remap_13 = RemapNumbers(Value=number_slider_35, Source=dom_13, Target=debox.X)  # -> Mapped, Clipped
remap_14 = RemapNumbers(Value=number_slider_36, Source=dom_13, Target=debox.X)  # -> Mapped, Clipped
remap_15 = RemapNumbers(Value=number_slider_37, Source=dom_13, Target=dom_15)  # -> Mapped, Clipped
remap_16 = RemapNumbers(Value=number_slider_37, Source=dom_13, Target=dom_14)  # -> Mapped, Clipped
pt_15 = ConstructPoint(XCoordinate=remap_13.Mapped, YCoordinate=dedomain_4.Start, ZCoordinate=0)
pt_16 = ConstructPoint(XCoordinate=remap_14.Mapped, YCoordinate=remap_15.Mapped, ZCoordinate=0)
pt_17 = ConstructPoint(XCoordinate=remap_14.Mapped, YCoordinate=remap_16.Mapped, ZCoordinate=0)
pt_18 = ConstructPoint(XCoordinate=remap_13.Mapped, YCoordinate=dedomain_4.End, ZCoordinate=0)
merge_8 = Merge(Data1=pt_15, Data2=pt_16, Data3=pt_17, Data4=pt_18)
nurbs_4 = NurbsCurve(Vertices=merge_8, Degree=2, Periodic=False)  # -> Curve, Length, Domain

# ---- group: generate distribution
pt_19 = Point(simplify(pt_14))
data_3 = Data(group)
pdecon = Deconstruct(Point=pt_19)  # -> XComponent, YComponent, ZComponent
bnd = Bounds(Numbers=flatten(pdecon.XComponent))
bnd_2 = Bounds(Numbers=flatten(pdecon.YComponent))
lng_2 = ListLength(List=data_3)
dedomain_5 = DeconstructDomain(Domain=bnd)  # -> Start, End
remap_17 = RemapNumbers(Value=pdecon.YComponent, Source=bnd_2, Target=Domain(0, 1))  # -> graft(Mapped), Clipped
c_script_2 = CSharpScript(count=lng_2, start=dedomain_5.Start, end=dedomain_5.End)  # -> out, A; inputs count: Int32, start: Double, end: Double
# ---------- c_script_2: C# ----------
    double totalLength = end - start;
    double domLength = totalLength / (double) count;

    List<Interval> intervals = new List<Interval>();
    double currentStart = start;
    for(int i = 0; i < count; i++)
    {
      intervals.Add(new Interval(currentStart, currentStart + domLength));
      currentStart += domLength;
    }
    A = intervals;
# ---------- end c_script_2 ----------
num_21 = Number(graft(pdecon.XComponent))
inc = Includes(Value=num_21, Domain=simplify(c_script_2.A))  # -> Includes, Deviation
cull = CullPattern(List=data_3, CullPattern=inc.Includes)
item = ListItem(List=cull, Index=0, Wrap=True)
cull_2 = CullPattern(List=c_script_2.A, CullPattern=inc.Includes)
ungroup = Ungroup(Group=item)  # -> simplify(Objects)
item_2 = ListItem(List=cull_2, Index=0, Wrap=True)
remap_18 = RemapNumbers(Value=num_21, Source=item_2, Target=Domain(0, 1))  # -> Mapped, Clipped
eval = EvaluateCurve(Curve=reparameterize(ungroup), Parameter=remap_17.Mapped)  # -> Point, Tangent, Angle
pdecon_2 = Deconstruct(Point=eval.Point)  # -> XComponent, YComponent, ZComponent
item_3 = ListItem(List=pdecon_2.YComponent, Index=0, Wrap=True)  # -> Item, Item1
twn2nums = TweenTwoNumbers(NumberA=item_3.Item, NumberB=item_3.Item1, Factor=remap_18.Mapped)
num_22 = Number(twn2nums)

# ---- group: material / beech
data_4 = Data(species)

# ---- group: material / Species
crv_2 = Curve(nurbs_4.Curve)

# ---- group: material / spruce
data_5 = Data(species_2)

# ---- group: material
pt_20 = Point(graft(pt_13))
xz = XZPlane(Origin=pt_20)
pcx = CurvePlane(Curve=crv_2, Plane=xz)  # -> simplify(Points), ParamsC, ParamsP
pdecon_3 = Deconstruct(Point=pcx.Points)  # -> XComponent, YComponent, ZComponent
pdecon_4 = Deconstruct(Point=pt_20)  # -> XComponent, YComponent, ZComponent
smaller = SmallerThan(FirstNumber=pdecon_3.XComponent, SecondNumber=pdecon_4.XComponent)  # -> SmallerThan, OrEqualTo
not = GateNot(A=smaller.SmallerThan)
cull_3 = CullPattern(List=data_4, CullPattern=not)
cull_4 = CullPattern(List=data_5, CullPattern=smaller.SmallerThan)
merge_9 = Merge(Data1=cull_3, Data2=cull_4)  # -> simplify(Result)
path_mapper = PathMapper(merge_9, source="{A}", target="{0}")

# ----
pt_21 = Point(pt_13)
pdecon_5 = Deconstruct(Point=pt_21)  # -> XComponent, YComponent, ZComponent
bnd_3 = Bounds(Numbers=flatten(pdecon_5.XComponent))
dom_16 = ConstructDomain(DomainStart="1", DomainEnd="0")
remap_19 = RemapNumbers(Value=pdecon_5.XComponent, Source=bnd_3, Target=dom_16)  # -> simplify(Mapped), Clipped

num_23 = Number(num_22)
rec = Rectangle(rectangle.Rectangle)
drec_5 = DeconstuctRectangle(Rectangle=rec)  # -> BasePlane, XInterval, YInterval
dom_17 = ConstructDomain(DomainStart=0, DomainEnd=Slider(1.2, range=0..10))
remap_20 = RemapNumbers(Value=num_23, Source=drec_5.YInterval, Target=dom_17)  # -> Mapped, Clipped
trim = TrimTree(Tree=remap_20.Mapped, Depth=1)

data_6 = Data(bilayer)
number_slider_38 = Slider(7.569, range=2..10)
number_slider_39 = Slider(9.957, range=2..10)

# ---- group: moisture changes
panel_7 = Panel("""10
5""")

# ----
merge_10 = Merge(Data1=number_slider_38, Data2=number_slider_39)

# ---- group: timoshenko prediction
c_script_3 = CSharpScript(Reference="C:\Users\Alex Reiner\AppData\Roaming\Grasshopper\Libraries\HygroDesign.Core.dll")  # -> out, A
# ---------- c_script_3: C# usings ----------
using BilayerDesign;
# ---------- c_script_3: C# ----------
    TimoshenkoPrediction timo = new TimoshenkoPrediction();
    A = timo;
# ---------- c_script_3: C# additional code ----------
  public class TimoshenkoPrediction : PredictionEngine
  {

    public TimoshenkoPrediction()
    {
    }

    public override double Predict(StockBoard board, Bilayer bilayer, double moistureChange)
    {
      double h1 = bilayer.PassiveLayer.Height;
      double h2 = bilayer.ActiveThickness;
      double h = h1 + h2;
      double m = h1 / h2;
      double e1 = bilayer.PassiveLayer.Species.Attributes["LEmod"];
      double e2 = GrainAngleInterpolation(board.RTAngle, board.Species.Attributes["REmod"], board.Species.Attributes["TEmod"]);
      double n = e1 / e2;
      double a1 = bilayer.PassiveLayer.Species.Attributes["LExp"];
      double a2 = GrainAngleInterpolation(board.RTAngle, board.Species.Attributes["RExp"], board.Species.Attributes["TExp"]);
      double deltaAlpha = a2 - a1;
      double kValue = 6 * Math.Pow(1.0 + m, 2) / (3 * Math.Pow(1 + m, 2) + (1 + m * n) * Math.Pow(m, 2) + (1 / (m * n)));
      double curvature = kValue * ((moistureChange * deltaAlpha) / h);
      return 1 / (curvature /* * TimError*/ );
    }

    public static double GrainAngleInterpolation(double rtAngle, double eR, double eT)
    {
      double angleConv = RhinoMath.ToRadians(rtAngle);
      double angleT = Math.Cos(angleConv);
      double angleR = Math.Sin(angleConv);
      double eActive = eT * Math.Pow(angleT, 2) + eR * Math.Pow(angleR, 2);
      return eActive;
    }
  }
# ---------- end c_script_3 ----------

# ---- group: convolution v1
c_script_4 = CSharpScript(
    tan=Slider(1, range=0.01..3),
    lon=Slider(0.1, range=0.01..3),
    rad=Slider(10000, range=0..10000),
    stiff=Slider(0.1, range=0.01..3),
    thick=Slider(0.1, range=0.01..3),
    Reference="C:\Users\Alex Reiner\AppData\Roaming\Grasshopper\Libraries\HygroDesign.Core.dll")  # -> out, A; inputs tan: Double, lon: Double, rad: Double, stiff: Double, thick: Double
# ---------- c_script_4: C# ----------
    MyConvolution convEngine = new MyConvolution(tan, lon, rad, stiff, thick);
    A = convEngine;
# ---------- c_script_4: C# additional code ----------
  public class MyConvolution : ConvolutionEngine
  {
    double Tangential { get; set; }
    double Longitudinal { get; set; }
    double RadiusMax { get; set; }
    double StiffnessInfluence { get; set; }
    double ThicknessInfluence { get; set; }

    public MyConvolution(double tangential, double longitudinal, double radiusMax, double stiffnessInfluence, double thicknessInfluence)
    {
      Tangential = tangential;
      Longitudinal = longitudinal;
      RadiusMax = radiusMax;
      StiffnessInfluence = stiffnessInfluence;
      ThicknessInfluence = thicknessInfluence;
    }

    public override Panel Convolution(Panel panel)
    {
      panel = SetConvolutionFactors(panel, RadiusMax, StiffnessInfluence);
      panel = CurvatureConvolution(panel, Longitudinal, Tangential);
      return ThicknessConvolution(panel, ThicknessInfluence);
    }

    public Panel SetConvolutionFactors(Panel panel, double maxRadiusInfluence, double stiffnessFactor)
    {
      //get stiffness bounds
      double maxLongStiffness = 0;
      double minLongStiffness = double.MaxValue;
      double maxHorizStiffness = 0;
      double minHorizStiffness = double.MaxValue;
      double minCurvature = double.MaxValue;

      foreach (Bilayer bilayer in panel.Bilayers)
      {
        foreach (ActiveBoard board in bilayer.Boards)
        {
          if (board.Species.Attributes["LEmod"] > maxLongStiffness) maxLongStiffness = board.Species.Attributes["LEmod"];
          if (board.Species.Attributes["LEmod"] < minLongStiffness) minLongStiffness = board.Species.Attributes["LEmod"];
          if (board.Species.Attributes["REmod"] > maxHorizStiffness) maxHorizStiffness = board.Species.Attributes["REmod"];
          if (board.Species.Attributes["REmod"] < minHorizStiffness) minHorizStiffness = board.Species.Attributes["REmod"];
          if (board.Radius < minCurvature) minCurvature = board.Radius;
        }
      }

      foreach (Bilayer bilayer in panel.Bilayers)
      {
        //set factors
        foreach (ActiveBoard board in bilayer.Boards)
        {
          board.LongStiffnessFactor = Panel.Remap(board.Species.Attributes["LEmod"], minLongStiffness, maxLongStiffness, 1 - stiffnessFactor, 1);
          board.RadStiffnessFactor = Panel.Remap(board.Species.Attributes["REmod"], minHorizStiffness, maxHorizStiffness, 1 - stiffnessFactor, 1);

          board.RadiusFactor = Panel.Remap(board.Radius, minCurvature, maxRadiusInfluence, 1, 0);
        }
      }

      return panel;

    }

    public Panel CurvatureConvolution(Panel panel, double horizontal, double vertical)
    {
      foreach (Bilayer bilayer in panel.Bilayers)
      {
        foreach (ActiveBoard board in bilayer.Boards)
        {
          board.ConvolutionWeights = new List<Tuple<double, double>>();

          foreach (ActiveBoard testBoard in bilayer.Boards)
          {
            double closestX = double.MaxValue;
            double closestY = double.MaxValue;

            if (Math.Abs(testBoard.RowRange[0] - board.Centroid.X) < closestX) closestX = Math.Abs(testBoard.RowRange[0] - board.Centroid.X);
            if (Math.Abs(testBoard.RowRange[1] - board.Centroid.X) < closestX) closestX = Math.Abs(testBoard.RowRange[1] - board.Centroid.X);
            if (testBoard.RowRange[0] <= board.Centroid.X + 10 && testBoard.RowRange[1] >= board.Centroid.X - 10) closestX = 0;
            if (Math.Abs(testBoard.Centroid.X - board.Centroid.X) < closestX) closestX = Math.Abs(testBoard.Centroid.X - board.Centroid.X);

            if (Math.Abs(testBoard.ColumnRange[0] - board.Centroid.Y) < closestY) closestY = Math.Abs(testBoard.ColumnRange[0] - board.Centroid.Y);
            if (Math.Abs(testBoard.ColumnRange[1] - board.Centroid.Y) < closestY) closestY = Math.Abs(testBoard.ColumnRange[1] - board.Centroid.Y);
            if (testBoard.ColumnRange[0] <= board.Centroid.Y + 10 && testBoard.ColumnRange[1] >= board.Centroid.Y - 10) closestY = board.Width / 2;
            if (Math.Abs(testBoard.Centroid.Y - board.Centroid.Y) < closestY) closestY = Math.Abs(testBoard.Centroid.Y - board.Centroid.Y);

            double LongFactor = testBoard.LongStiffnessFactor / Math.Pow(closestX + 1, horizontal);
            double RadFactor = testBoard.RadStiffnessFactor / Math.Pow(closestY + 1, vertical);

            board.ConvolutionWeights.Add(new Tuple<double, double>(testBoard.Radius, testBoard.RadiusFactor * (LongFactor * RadFactor)));
          }
        }

        foreach (ActiveBoard board in bilayer.Boards)
        {

          double weightSum = 0;
          foreach (Tuple<double, double> valueWeight in board.ConvolutionWeights)
          {
            board.BlendedRadius += valueWeight.Item1 * valueWeight.Item2;
            weightSum += valueWeight.Item2;

          }
          board.BlendedRadius /= weightSum;

        }
      }
      return panel;
    }

    public Panel ThicknessConvolution(Panel panel, double thicknessFactor)
    {
      double minThickness = double.MaxValue;
      double maxThickness = 0;
      foreach (Bilayer bilayer in panel.Bilayers)
      {
        double thickness = bilayer.ActiveThickness + bilayer.PassiveLayer.Height;
        if (thickness < minThickness) minThickness = thickness;
        if (thickness > maxThickness) maxThickness = thickness;
      }

      panel.FindThicknessNeighbors();

      foreach (Bilayer bilayer in panel.Bilayers)
      {
        double bilayerThicknessFactor = 1;
        if (minThickness != maxThickness) bilayerThicknessFactor = Panel.Remap(bilayer.ActiveThickness + bilayer.PassiveLayer.Height, minThickness, maxThickness, 1 - thicknessFactor, 1);

        foreach (ActiveBoard board in bilayer.Boards)
        {
          double weights = board.RadStiffnessFactor + bilayerThicknessFactor;
          double weightedTotal = board.BlendedRadius * weights;

          foreach (BoardRegion region in board.Regions)
          {
            foreach (BoardRegion regionNeighbor in region.RegionStack)
            {
              double neighborThicknessFactor = 1;
              if (minThickness != maxThickness) neighborThicknessFactor = Panel.Remap(regionNeighbor.Parent.Parent.ActiveThickness + regionNeighbor.Parent.Parent.PassiveLayer.Height, minThickness, maxThickness, 1 - thicknessFactor, 1);

              weights += regionNeighbor.Parent.RadStiffnessFactor + neighborThicknessFactor;

              weightedTotal += regionNeighbor.Parent.BlendedRadius * (regionNeighbor.Parent.RadStiffnessFactor + neighborThicknessFactor);
            }

            region.ThicknessBlendedRadius = weightedTotal / weights;
          }
        }
      }
      return panel;
    }
  }
# ---------- end c_script_4 ----------

# ----
division_5 = Division(A=int, B=2)
python = GhPythonScript(x=species)  # -> out, a, b
# ---------- python: Python ----------
a = x.Attributes["LEmod"]
b = x.Attributes["REmod"]
# ---------- end python ----------
python_2 = GhPythonScript(x=species_2)  # -> out, a, b; same code as python

# ---- group: active layer
ft0 = Slider(80, range=0..100)
gamma = Slider(7.37, range=0..10)
num_24 = Number(Slider(20, range=0..100))

# ---- group: passive layer
num_25 = Number(Slider(8, range=0..10))
ft0_2 = Slider(0, range=0..100)

# ---- group: active layer
ft0_3 = Slider(80, range=0..100)
gamma_2 = Slider(4.21, range=0..10)
num_26 = Number(Slider(20, range=0..100))

# ---- group: passive layer
num_27 = Number(Slider(8, range=0..10))
ft0_4 = Slider(0, range=0..100)

# ---- group: active layer
ft0_5 = Slider(80, range=0..100)
gamma_3 = Slider(7.37, range=0..10)
num_28 = Number(Slider(60, range=0..100))

# ---- group: passive layer
ft0_6 = Slider(0, range=0..100)
num_29 = Number(Slider(16, range=0..20))

# ---- group: active layer
ft0_7 = Slider(80, range=0..100)
gamma_4 = Slider(4.21, range=0..10)
num_30 = Number(Slider(16, range=0..100))

# ---- group: passive layer
num_31 = Number(Slider(16, range=0..20))
ft0_8 = Slider(0, range=0..100)

# ---- group: active layer
ft0_9 = Slider(80, range=0..100)
gamma_5 = Slider(7.37, range=0..10)
num_32 = Number(Slider(40, range=0..100))

# ---- group: passive layer
ft0_10 = Slider(0, range=0..100)
num_33 = Number(Slider(12, range=0..20))

# ---- group: active layer
ft0_11 = Slider(80, range=0..100)
gamma_6 = Slider(4.21, range=0..10)
num_34 = Number(Slider(40, range=0..100))

# ---- group: passive layer
ft0_12 = Slider(0, range=0..100)
num_35 = Number(Slider(12, range=0..20))

# ---- group: active layer / total thickness
addition_5 = Addition(A=num_24, B=num_25)

addition_6 = Addition(A=num_26, B=num_27)

addition_7 = Addition(A=num_28, B=num_29)

addition_8 = Addition(A=num_30, B=num_31)

addition_9 = Addition(A=num_32, B=num_33)

addition_10 = Addition(A=num_34, B=num_35)

# ---- group: active layer / distance from bottom
expression = Expression(x=addition_5, y=num_24, Expression="x - y/2")

expression_2 = Expression(x=addition_6, y=num_26, Expression="x - y/2")

expression_3 = Expression(x=addition_7, y=num_28, Expression="x - y/2")

expression_4 = Expression(x=addition_8, y=num_30, Expression="x - y/2")

# ---- group: passive layer / distance from bottom
expression_5 = Expression(x=expression, y=addition_5, Expression="x - y/2")

# ---- group: active layer / distance from bottom
expression_6 = Expression(x=addition_9, y=num_32, Expression="x - y/2")

# ---- group: passive layer / distance from bottom
expression_7 = Expression(x=expression_2, y=addition_6, Expression="x - y/2")

# ---- group: active layer / distance from bottom
expression_8 = Expression(x=addition_10, y=num_34, Expression="x - y/2")

# ---- group: passive layer / distance from bottom
expression_9 = Expression(x=expression_3, y=addition_7, Expression="x - y/2")

expression_10 = Expression(x=expression_4, y=addition_8, Expression="x - y/2")

# ---- group: active layer / CG from bottom
division_6 = Division(A=addition_5, B=2)

division_7 = Division(A=addition_6, B=2)

division_8 = Division(A=addition_7, B=2)

# ---- group: passive layer / distance from bottom
expression_11 = Expression(x=expression_6, y=addition_9, Expression="x - y/2")

# ---- group: active layer / CG from bottom
division_9 = Division(A=addition_8, B=2)

# ---- group: passive layer / distance from bottom
expression_12 = Expression(x=expression_8, y=addition_10, Expression="x - y/2")

# ---- group: active layer / CG from bottom
division_10 = Division(A=addition_9, B=2)

division_11 = Division(A=addition_10, B=2)

# ---- group: passive layer / dist from CG
subtraction_5 = Subtraction(A=expression_5, B=division_6)
abs = Absolute(Value=subtraction_5)

subtraction_6 = Subtraction(A=expression_7, B=division_7)
abs_2 = Absolute(Value=subtraction_6)

subtraction_7 = Subtraction(A=expression_9, B=division_8)
abs_3 = Absolute(Value=subtraction_7)

# ---- group: active layer / dist from CG
subtraction_8 = Subtraction(A=expression, B=division_6)
abs_4 = Absolute(Value=subtraction_8)

# ---- group: passive layer / dist from CG
subtraction_9 = Subtraction(A=expression_10, B=division_9)
abs_5 = Absolute(Value=subtraction_9)

# ---- group: active layer / dist from CG
subtraction_10 = Subtraction(A=expression_2, B=division_7)
abs_6 = Absolute(Value=subtraction_10)

subtraction_11 = Subtraction(A=expression_3, B=division_8)
abs_7 = Absolute(Value=subtraction_11)

# ---- group: passive layer / dist from CG
subtraction_12 = Subtraction(A=expression_11, B=division_10)
abs_8 = Absolute(Value=subtraction_12)

# ---- group: active layer / dist from CG
subtraction_13 = Subtraction(A=expression_4, B=division_9)
abs_9 = Absolute(Value=subtraction_13)

# ---- group: passive layer / dist from CG
subtraction_14 = Subtraction(A=expression_12, B=division_11)
abs_10 = Absolute(Value=subtraction_14)

# ---- group: active layer / dist from CG
subtraction_15 = Subtraction(A=expression_6, B=division_10)
abs_11 = Absolute(Value=subtraction_15)

subtraction_16 = Subtraction(A=expression_8, B=division_11)
abs_12 = Absolute(Value=subtraction_16)

# ---- group: active layer / l
expression_13 = Expression(x=num_24, Expression="1000*x^3/12")

# ---- group: passive layer / l
expression_14 = Expression(x=num_25, Expression="1000*x^3/12")

# ---- group: passive layer / Ax2
expression_15 = Expression(x=num_25, y=abs, Expression="1000*x*y^2")

# ---- group: active layer / l
expression_16 = Expression(x=num_26, Expression="1000*x^3/12")

# ---- group: passive layer / l
expression_17 = Expression(x=num_27, Expression="1000*x^3/12")

# ---- group: passive layer / Ax2
expression_18 = Expression(x=num_27, y=abs_2, Expression="1000*x*y^2")

# ---- group: active layer / l
expression_19 = Expression(x=num_28, Expression="1000*x^3/12")

# ---- group: passive layer / l
expression_20 = Expression(x=num_29, Expression="1000*x^3/12")

# ---- group: passive layer / Ax2
expression_21 = Expression(x=num_29, y=abs_3, Expression="1000*x*y^2")

# ---- group: active layer / Ax2
expression_22 = Expression(x=num_24, y=abs_4, Expression="1000*x*y^2")

# ---- group: active layer / l
expression_23 = Expression(x=num_30, Expression="1000*x^3/12")

# ---- group: passive layer / l
expression_24 = Expression(x=num_31, Expression="1000*x^3/12")

# ---- group: passive layer / Ax2
expression_25 = Expression(x=num_31, y=abs_5, Expression="1000*x*y^2")

# ---- group: active layer / Ax2
expression_26 = Expression(x=num_26, y=abs_6, Expression="1000*x*y^2")

expression_27 = Expression(x=num_28, y=abs_7, Expression="1000*x*y^2")

# ---- group: active layer / l
expression_28 = Expression(x=num_32, Expression="1000*x^3/12")

# ---- group: passive layer / l
expression_29 = Expression(x=num_33, Expression="1000*x^3/12")

# ---- group: passive layer / Ax2
expression_30 = Expression(x=num_33, y=abs_8, Expression="1000*x*y^2")

# ---- group: active layer / Ax2
expression_31 = Expression(x=num_30, y=abs_9, Expression="1000*x*y^2")

# ---- group: active layer / l
expression_32 = Expression(x=num_34, Expression="1000*x^3/12")

# ---- group: passive layer / l
expression_33 = Expression(x=num_35, Expression="1000*x^3/12")

# ---- group: passive layer / Ax2
expression_34 = Expression(x=num_35, y=abs_10, Expression="1000*x*y^2")

# ---- group: active layer / Ax2
expression_35 = Expression(x=num_32, y=abs_11, Expression="1000*x*y^2")

expression_36 = Expression(x=num_34, y=abs_12, Expression="1000*x*y^2")

# ---- group: active layer / total l
addition_11 = Addition(A=expression_13, B=expression_22)

addition_12 = Addition(A=expression_16, B=expression_26)

addition_13 = Addition(A=expression_19, B=expression_27)

addition_14 = Addition(A=expression_23, B=expression_31)

addition_15 = Addition(A=expression_28, B=expression_35)

# ---- group: passive layer / total l
addition_16 = Addition(A=expression_14, B=expression_15)

# ---- group: active layer / total l
addition_17 = Addition(A=expression_32, B=expression_36)

# ---- group: passive layer / total l
addition_18 = Addition(A=expression_17, B=expression_18)

addition_19 = Addition(A=expression_20, B=expression_21)

addition_20 = Addition(A=expression_24, B=expression_25)

addition_21 = Addition(A=expression_29, B=expression_30)

addition_22 = Addition(A=expression_33, B=expression_34)

# ---- group: active layer / El0
multiplication_3 = Multiplication(A=python.a, B=addition_11)

# ---- group: active layer / T x ft0
multiplication_4 = Multiplication(A=num_24, B=ft0)

# ---- group: active layer / T x Gam
multiplication_5 = Multiplication(A=gamma, B=num_24)

# ---- group: passive layer / El0
multiplication_6 = Multiplication(A=python_2.b, B=addition_16)

# ---- group: passive layer / El90
multiplication_7 = Multiplication(A=python_2.a, B=addition_16)

# ---- group: passive layer / T x ft0
multiplication_8 = Multiplication(A=num_25, B=ft0_2)

# ---- group: active layer / El90
multiplication_9 = Multiplication(A=python.b, B=addition_11)

# ---- group: active layer / El0
multiplication_10 = Multiplication(A=python_2.a, B=addition_12)

# ---- group: active layer / T x ft0
multiplication_11 = Multiplication(A=num_26, B=ft0_3)

# ---- group: active layer / T x Gam
multiplication_12 = Multiplication(A=gamma_2, B=num_26)

# ---- group: passive layer / El0
multiplication_13 = Multiplication(A=python_2.b, B=addition_18)

# ---- group: passive layer / El90
multiplication_14 = Multiplication(A=python_2.a, B=addition_18)

# ---- group: passive layer / T x ft0
multiplication_15 = Multiplication(A=num_27, B=ft0_4)

# ---- group: active layer / El0
multiplication_16 = Multiplication(A=python.a, B=addition_13)

# ---- group: active layer / T x ft0
multiplication_17 = Multiplication(A=num_28, B=ft0_5)

# ---- group: active layer / T x Gam
multiplication_18 = Multiplication(A=gamma_3, B=num_28)

# ---- group: passive layer / El0
multiplication_19 = Multiplication(A=python_2.b, B=addition_19)

# ---- group: passive layer / El90
multiplication_20 = Multiplication(A=python_2.a, B=addition_19)

# ---- group: passive layer / T x ft0
multiplication_21 = Multiplication(A=num_29, B=ft0_6)

# ---- group: active layer / El90
multiplication_22 = Multiplication(A=python_2.b, B=addition_12)

multiplication_23 = Multiplication(A=python.b, B=addition_13)

# ---- group: active layer / El0
multiplication_24 = Multiplication(A=python_2.a, B=addition_14)

# ---- group: active layer / T x ft0
multiplication_25 = Multiplication(A=num_30, B=ft0_7)

# ---- group: active layer / T x Gam
multiplication_26 = Multiplication(A=gamma_4, B=num_30)

# ---- group: passive layer / El0
multiplication_27 = Multiplication(A=python_2.b, B=addition_20)

# ---- group: passive layer / El90
multiplication_28 = Multiplication(A=python_2.a, B=addition_20)

# ---- group: passive layer / T x ft0
multiplication_29 = Multiplication(A=num_31, B=ft0_8)

# ---- group: active layer / El90
multiplication_30 = Multiplication(A=python_2.b, B=addition_14)

# ---- group: active layer / El0
multiplication_31 = Multiplication(A=python.a, B=addition_15)

# ---- group: active layer / T x ft0
multiplication_32 = Multiplication(A=num_32, B=ft0_9)

# ---- group: active layer / T x Gam
multiplication_33 = Multiplication(A=gamma_5, B=num_32)

# ---- group: passive layer / El0
multiplication_34 = Multiplication(A=python_2.b, B=addition_21)

# ---- group: passive layer / El90
multiplication_35 = Multiplication(A=python_2.a, B=addition_21)

# ---- group: passive layer / T x ft0
multiplication_36 = Multiplication(A=num_33, B=ft0_10)

# ---- group: active layer / El90
multiplication_37 = Multiplication(A=python.b, B=addition_15)

# ---- group: active layer / El0
multiplication_38 = Multiplication(A=python_2.a, B=addition_17)

# ---- group: active layer / T x ft0
multiplication_39 = Multiplication(A=num_34, B=ft0_11)

# ---- group: active layer / T x Gam
multiplication_40 = Multiplication(A=gamma_6, B=num_34)

# ---- group: passive layer / El0
multiplication_41 = Multiplication(A=python_2.b, B=addition_22)

# ---- group: passive layer / El90
multiplication_42 = Multiplication(A=python_2.a, B=addition_22)

# ---- group: passive layer / T x ft0
multiplication_43 = Multiplication(A=num_35, B=ft0_12)

# ---- group: active layer / El90
multiplication_44 = Multiplication(A=python_2.b, B=addition_17)

# ---- group: effective material properties / El0 eff (Nmm2)
addition_23 = Addition(A=multiplication_3, B=multiplication_6)

# ---- group: effective material properties / El90 eff (Nmm2)
addition_24 = Addition(A=multiplication_9, B=multiplication_7)

# ---- group: effective material properties / Sum T x Ft0
addition_25 = Addition(A=multiplication_4, B=multiplication_8)

# ---- group: effective material properties / total thickness
addition_26 = Addition(A=num_24, B=num_25)

# ---- group: effective material properties / El0 eff (Nmm2)
addition_27 = Addition(A=multiplication_10, B=multiplication_13)

# ---- group: effective material properties / El90 eff (Nmm2)
addition_28 = Addition(A=multiplication_22, B=multiplication_14)

# ---- group: effective material properties / El0 eff (Nmm2)
addition_29 = Addition(A=multiplication_16, B=multiplication_19)

# ---- group: effective material properties / El90 eff (Nmm2)
addition_30 = Addition(A=multiplication_23, B=multiplication_20)

# ---- group: effective material properties / Sum T x Ft0
addition_31 = Addition(A=multiplication_11, B=multiplication_15)

# ---- group: effective material properties / total thickness
addition_32 = Addition(A=num_26, B=num_27)

# ---- group: effective material properties / Sum Tx Gam
addition_33 = Addition(A=multiplication_5)

# ---- group: effective material properties / Sum T x Ft0
addition_34 = Addition(A=multiplication_17, B=multiplication_21)

# ---- group: effective material properties / total thickness
addition_35 = Addition(A=num_28, B=num_29)

# ---- group: effective material properties / El0 eff (Nmm2)
addition_36 = Addition(A=multiplication_24, B=multiplication_27)

# ---- group: effective material properties / El90 eff (Nmm2)
addition_37 = Addition(A=multiplication_30, B=multiplication_28)

# ---- group: effective material properties / Sum Tx Gam
addition_38 = Addition(A=multiplication_12)

# ---- group: effective material properties / Sum T x Ft0
addition_39 = Addition(A=multiplication_25, B=multiplication_29)

# ---- group: effective material properties / total thickness
addition_40 = Addition(A=num_30, B=num_31)

# ---- group: effective material properties / Sum Tx Gam
addition_41 = Addition(A=multiplication_18)

# ---- group: effective material properties / El0 eff (Nmm2)
addition_42 = Addition(A=multiplication_31, B=multiplication_34)

# ---- group: effective material properties / El90 eff (Nmm2)
addition_43 = Addition(A=multiplication_37, B=multiplication_35)

# ---- group: effective material properties / Sum Tx Gam
addition_44 = Addition(A=multiplication_26)

# ---- group: effective material properties / Sum T x Ft0
addition_45 = Addition(A=multiplication_32, B=multiplication_36)

# ---- group: effective material properties / total thickness
addition_46 = Addition(A=num_32, B=num_33)

# ---- group: effective material properties / El0 eff (Nmm2)
addition_47 = Addition(A=multiplication_38, B=multiplication_41)

# ---- group: effective material properties / El90 eff (Nmm2)
addition_48 = Addition(A=multiplication_44, B=multiplication_42)

# ---- group: effective material properties / Sum T x Ft0
addition_49 = Addition(A=multiplication_39, B=multiplication_43)

# ---- group: effective material properties / total thickness
addition_50 = Addition(A=num_34, B=num_35)

# ---- group: effective material properties / Sum Tx Gam
addition_51 = Addition(A=multiplication_33)

addition_52 = Addition(A=multiplication_40)

# ---- group: effective material properties / lx / ly
expression_37 = Expression(x=addition_26, Expression="1000*x^3/12")

expression_38 = Expression(x=addition_32, Expression="1000*x^3/12")

expression_39 = Expression(x=addition_35, Expression="1000*x^3/12")

expression_40 = Expression(x=addition_40, Expression="1000*x^3/12")

expression_41 = Expression(x=addition_46, Expression="1000*x^3/12")

expression_42 = Expression(x=addition_50, Expression="1000*x^3/12")

# ---- group: effective material properties / E0eff
division_12 = Division(A=addition_23, B=expression_37)

# ---- group: effective material properties / E90eff
division_13 = Division(A=addition_24, B=expression_37)

# ---- group: effective material properties / ft eff
division_14 = Division(A=addition_25, B=addition_26)

# ---- group: effective material properties / E0eff
division_15 = Division(A=addition_27, B=expression_38)

# ---- group: effective material properties / E90eff
division_16 = Division(A=addition_28, B=expression_38)

# ---- group: effective material properties / Gamma eff
division_17 = Division(A=addition_38, B=addition_32)

# ---- group: effective material properties / ft eff
division_18 = Division(A=addition_31, B=addition_32)

# ---- group: effective material properties
matprops = MaterialPropertiesKaramba3D(
    FamilyOfMaterial="Spruce / Spruce",
    Name="Spruce / Spruce",
    ElementIdentifier="Spruce / Spruce",
    YoungsModulusKNCm2Dir1=expr("x*0.1", division_15),
    YoungsModulusKNCm2Dir2=expr("x*0.1", division_16),
    InPlaneShearModulus_kN_cm2="42",
    InPlaneLateralContractionCoefficient=Slider(0.012, range=0..0.1, expression="0.012"),
    TransverseShearModulusKNCm2Dir1="5",
    TransverseShearModulusKNCm2Dir2="5",
    SpecificWeight_kN_m3=division_17,
    CoefficientOfThermalExpansion1CDir1=1.2e-05,
    CoefficientOfThermalExpansion1CDir2=1.2e-05,
    TensileStrengthKNCm2Dir1=division_18,
    TensileStrengthKNCm2Dir2=division_18,
    CompressiveStrengthKNCm2Dir1=-23.5,
    CompressiveStrengthKNCm2Dir2=-23.5,
    ShearStrengthKNCm2Dir12=13.6,
    TsaiWuIntCoeff=0,
    StrengthHypothesis="MISES",
    mode="Orthotropic")  # -> flatten(Material)

# ---- group: effective material properties / Gamma eff
division_19 = Division(A=addition_33, B=addition_26)

# ---- group: effective material properties
matprops_2 = MaterialPropertiesKaramba3D(
    FamilyOfMaterial="Beech / Spruce",
    Name="Beech / Spruce",
    ElementIdentifier="Beech / Spruce",
    YoungsModulusKNCm2Dir1=expr("x*0.1", division_12),
    YoungsModulusKNCm2Dir2=expr("x*0.1", division_13),
    InPlaneShearModulus_kN_cm2="47",
    InPlaneLateralContractionCoefficient=Slider(0.012, range=0..0.1, expression="0.012"),
    TransverseShearModulusKNCm2Dir1="5",
    TransverseShearModulusKNCm2Dir2="5",
    SpecificWeight_kN_m3=division_19,
    CoefficientOfThermalExpansion1CDir1=1.2e-05,
    CoefficientOfThermalExpansion1CDir2=1.2e-05,
    TensileStrengthKNCm2Dir1=division_14,
    TensileStrengthKNCm2Dir2=division_14,
    CompressiveStrengthKNCm2Dir1=-23.5,
    CompressiveStrengthKNCm2Dir2=-23.5,
    ShearStrengthKNCm2Dir12=13.6,
    TsaiWuIntCoeff=0,
    StrengthHypothesis="MISES",
    mode="Orthotropic")  # -> flatten(Material)

# ---- group: effective material properties / E0eff
division_20 = Division(A=addition_29, B=expression_39)

# ---- group: effective material properties / E90eff
division_21 = Division(A=addition_30, B=expression_39)

# ---- group: effective material properties / ft eff
division_22 = Division(A=addition_34, B=addition_35)

# ---- group: effective material properties / E0eff
division_23 = Division(A=addition_36, B=expression_40)

# ---- group: effective material properties / E90eff
division_24 = Division(A=addition_37, B=expression_40)

# ---- group: effective material properties / Gamma eff
division_25 = Division(A=addition_44, B=addition_40)

# ---- group: effective material properties / ft eff
division_26 = Division(A=addition_39, B=addition_40)

# ---- group: effective material properties
matprops_3 = MaterialPropertiesKaramba3D(
    FamilyOfMaterial="Spruce / Spruce",
    Name="Spruce / Spruce",
    ElementIdentifier="Spruce / Spruce",
    YoungsModulusKNCm2Dir1=expr("x*0.1", division_23),
    YoungsModulusKNCm2Dir2=expr("x*0.1", division_24),
    InPlaneShearModulus_kN_cm2="42",
    InPlaneLateralContractionCoefficient=Slider(0.012, range=0..0.1, expression="0.012"),
    TransverseShearModulusKNCm2Dir1="5",
    TransverseShearModulusKNCm2Dir2="5",
    SpecificWeight_kN_m3=division_25,
    CoefficientOfThermalExpansion1CDir1=1.2e-05,
    CoefficientOfThermalExpansion1CDir2=1.2e-05,
    TensileStrengthKNCm2Dir1=division_26,
    TensileStrengthKNCm2Dir2=division_26,
    CompressiveStrengthKNCm2Dir1=-23.5,
    CompressiveStrengthKNCm2Dir2=-23.5,
    ShearStrengthKNCm2Dir12=13.6,
    TsaiWuIntCoeff=0,
    StrengthHypothesis="MISES",
    mode="Orthotropic")  # -> flatten(Material)

# ---- group: effective material properties / Gamma eff
division_27 = Division(A=addition_41, B=addition_35)

# ---- group: effective material properties
matprops_4 = MaterialPropertiesKaramba3D(
    FamilyOfMaterial="Beech / Spruce",
    Name="Beech / Spruce",
    ElementIdentifier="Beech / Spruce",
    YoungsModulusKNCm2Dir1=expr("x*0.1", division_20),
    YoungsModulusKNCm2Dir2=expr("x*0.1", division_21),
    InPlaneShearModulus_kN_cm2="47",
    InPlaneLateralContractionCoefficient=Slider(0.012, range=0..0.1, expression="0.012"),
    TransverseShearModulusKNCm2Dir1="5",
    TransverseShearModulusKNCm2Dir2="5",
    SpecificWeight_kN_m3=division_27,
    CoefficientOfThermalExpansion1CDir1=1.2e-05,
    CoefficientOfThermalExpansion1CDir2=1.2e-05,
    TensileStrengthKNCm2Dir1=division_22,
    TensileStrengthKNCm2Dir2=division_22,
    CompressiveStrengthKNCm2Dir1=-23.5,
    CompressiveStrengthKNCm2Dir2=-23.5,
    ShearStrengthKNCm2Dir12=13.6,
    TsaiWuIntCoeff=0,
    StrengthHypothesis="MISES",
    mode="Orthotropic")  # -> flatten(Material)

# ---- group: effective material properties / E0eff
division_28 = Division(A=addition_42, B=expression_41)

# ---- group: effective material properties / E90eff
division_29 = Division(A=addition_43, B=expression_41)

# ---- group: effective material properties / ft eff
division_30 = Division(A=addition_45, B=addition_46)

# ---- group: effective material properties / E0eff
division_31 = Division(A=addition_47, B=expression_42)

# ---- group: effective material properties / E90eff
division_32 = Division(A=addition_48, B=expression_42)

# ---- group: effective material properties / Gamma eff
division_33 = Division(A=addition_52, B=addition_50)

# ---- group: effective material properties / ft eff
division_34 = Division(A=addition_49, B=addition_50)

# ---- group: effective material properties
matprops_5 = MaterialPropertiesKaramba3D(
    FamilyOfMaterial="Spruce / Spruce",
    Name="Spruce / Spruce",
    ElementIdentifier="Spruce / Spruce",
    YoungsModulusKNCm2Dir1=expr("x*0.1", division_31),
    YoungsModulusKNCm2Dir2=expr("x*0.1", division_32),
    InPlaneShearModulus_kN_cm2="42",
    InPlaneLateralContractionCoefficient=Slider(0.012, range=0..0.1, expression="0.012"),
    TransverseShearModulusKNCm2Dir1="5",
    TransverseShearModulusKNCm2Dir2="5",
    SpecificWeight_kN_m3=division_33,
    CoefficientOfThermalExpansion1CDir1=1.2e-05,
    CoefficientOfThermalExpansion1CDir2=1.2e-05,
    TensileStrengthKNCm2Dir1=division_34,
    TensileStrengthKNCm2Dir2=division_34,
    CompressiveStrengthKNCm2Dir1=-23.5,
    CompressiveStrengthKNCm2Dir2=-23.5,
    ShearStrengthKNCm2Dir12=13.6,
    TsaiWuIntCoeff=0,
    StrengthHypothesis="MISES",
    mode="Orthotropic")  # -> flatten(Material)

# ---- group: effective material properties / Gamma eff
division_35 = Division(A=addition_51, B=addition_46)

# ---- group: effective material properties
matprops_6 = MaterialPropertiesKaramba3D(
    FamilyOfMaterial="Beech / Spruce",
    Name="Beech / Spruce",
    ElementIdentifier="Beech / Spruce",
    YoungsModulusKNCm2Dir1=expr("x*0.1", division_28),
    YoungsModulusKNCm2Dir2=expr("x*0.1", division_29),
    InPlaneShearModulus_kN_cm2="47",
    InPlaneLateralContractionCoefficient=Slider(0.012, range=0..0.1, expression="0.012"),
    TransverseShearModulusKNCm2Dir1="5",
    TransverseShearModulusKNCm2Dir2="5",
    SpecificWeight_kN_m3=division_35,
    CoefficientOfThermalExpansion1CDir1=1.2e-05,
    CoefficientOfThermalExpansion1CDir2=1.2e-05,
    TensileStrengthKNCm2Dir1=division_30,
    TensileStrengthKNCm2Dir2=division_30,
    CompressiveStrengthKNCm2Dir1=-23.5,
    CompressiveStrengthKNCm2Dir2=-23.5,
    ShearStrengthKNCm2Dir12=13.6,
    TsaiWuIntCoeff=0,
    StrengthHypothesis="MISES",
    mode="Orthotropic")  # -> flatten(Material)

# ----
addition_53 = Addition(A=num_30, B=num_31)
addition_54 = Addition(A=num_24, B=num_25)
addition_55 = Addition(A=num_32, B=num_33)
addition_56 = Addition(A=num_28, B=num_29)
addition_57 = Addition(A=num_26, B=num_27)
addition_58 = Addition(A=num_34, B=num_35)
division_36 = Division(A=addition_53, B=10)
division_37 = Division(A=addition_54, B=10)
division_38 = Division(A=addition_55, B=10)
division_39 = Division(A=addition_56, B=10)
division_40 = Division(A=addition_57, B=10)
division_41 = Division(A=addition_58, B=10)

multiplication_45 = Multiplication(A=Slider(1.5, range=0..10), B="1.35")
multiplication_46 = Multiplication(A="-9.8", B="1.35")
Z = UnitZ(Factor=multiplication_45)
Z_2 = UnitZ(Factor=multiplication_46)
rev = Reverse(Vector=Z)

loads = LoadsKaramba3D(Vector=Z_2, LCase="0", mode="Gravity")
movopossum_3_0_0 = Opossum(
    OpossumData_NumberOfObjectives=1,
    OpossumData_OptimizationType=0,
    OpossumData_ResultSerializationStatus=1,
    OpossumData_ObjectiveValue=[3.003838367, 3.014245331, 4.131268, 2.765296504, 7.113601156, 8.97558129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],
    OpossumData_ParameterList=["0.810236,0.054314,0.248894,0.444025,0.958800,0.347327,0.494059,0.909065,0.464686,0.165871,0.702288,0.204955,0.943978,0.237881,0.883637,0.499389,0.972172,0.378594,0.383735,0.697977,3.824402,7.214066", "0.026921,0.835398,0.625240,0.994108,0.435246,0.327011,0.312100,0.671911,0.123711,0.380860,0.456421,0.377292,0.758864,0.298418,0.650602,0.440482,0.625707,0.125329,0.473781,0.587031,8.767138,8.031678", "0.722325,0.970524,0.855641,0.868241,0.682877,0.994910,0.577423,0.569816,0.441741,0.083690,0.602776,0.620634,0.589852,0.364010,0.903614,0.167407,0.854498,0.495853,0.037526,0.943293,3.668702,4.939902", "0.242246,0.753159,0.683049,0.100550,0.510515,0.722398,0.099906,0.293140,0.940952,0.980074,0.305473,0.511054,0.544735,0.193732,0.797832,0.571392,0.731403,0.022002,0.220352,0.794729,9.476561,9.277106", "0.596432,0.292805,0.520109,0.200050,0.884506,0.179645,0.740755,0.782253,0.836138,0.274183,0.505711,0.709226,0.881921,0.401226,0.597827,0.858875,0.709444,0.389702,0.060295,0.539531,7.496776,2.254548", "0.968795,0.116008,0.975794,0.576945,0.189796,0.875766,0.149308,0.516097,0.270201,0.560298,0.931523,0.052045,0.811548,0.099761,0.737237,0.898055,0.607850,0.078650,0.131859,0.725350,2.691104,3.576175"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],
    OpossumData_objective=num_54,
    OpossumData_variable=[number_slider_26, number_slider_27, number_slider_25, number_slider_21, number_slider_23, number_slider_22, number_slider_18, number_slider_19, number_slider_17, number_slider_37, number_slider_35, number_slider_36, number_slider_45, number_slider_44, number_slider_46, number_slider_41, number_slider_43, number_slider_42, number_slider_28, number_slider_29, number_slider_38, number_slider_39])
X = UnitX(Factor=Slider(6102, range=0..20000))

number_slider_40 = Slider(1000, range=0..1000)
neg = Negative(Value=number_slider_40)
rectangle_5 = Rectangle(Plane=PlaneXY(0, 0, 0), XSize=number_slider_40, YSize=neg, Radius=0)  # -> Rectangle, Length
drec_6 = DeconstuctRectangle(Rectangle=rectangle_5.Rectangle)  # -> BasePlane, XInterval, YInterval
dedomain_6 = DeconstructDomain(Domain=drec_6.XInterval)  # -> Start, End
dedomain_7 = DeconstructDomain(Domain=drec_6.YInterval)  # -> Start, End
pt_22 = ConstructPoint(XCoordinate=dedomain_6.Start, YCoordinate=0, ZCoordinate=0)
pt_23 = ConstructPoint(XCoordinate=dedomain_6.End, YCoordinate=0, ZCoordinate=0)
subtraction_17 = Subtraction(A=dedomain_7.End, B=dedomain_7.Start)
ln = Line(StartPoint=pt_22, EndPoint=pt_23)
number_slider_41 = Slider(0.115, range=0..1)
number_slider_42 = Slider(0.486, range=0..0.5)
number_slider_43 = Slider(0.545, range=0.5..1)
number_slider_44 = Slider(0.338, range=0..0.5)
number_slider_45 = Slider(1, range=0.5..1)
number_slider_46 = Slider(0.937, range=0.5..1)
divide = DivideCurve(Curve=ln, Count=expr("x-1", Slider(3, range=0..10)), Kinks=False)  # -> Points, Tangents, Parameters
multiplication_47 = Multiplication(A=subtraction_17, B=number_slider_43)
multiplication_48 = Multiplication(A=subtraction_17, B=number_slider_42)
multiplication_49 = Multiplication(A=subtraction_17, B=number_slider_46)
multiplication_50 = Multiplication(A=subtraction_17, B=number_slider_41)
multiplication_51 = Multiplication(A=subtraction_17, B=number_slider_45)
multiplication_52 = Multiplication(A=subtraction_17, B=number_slider_44)
neg_2 = Negative(Value=multiplication_48)
neg_3 = Negative(Value=multiplication_47)
neg_4 = Negative(Value=multiplication_50)
neg_5 = Negative(Value=multiplication_49)
neg_6 = Negative(Value=multiplication_52)
neg_7 = Negative(Value=multiplication_51)
item_4 = ListItem(List=divide.Points, Index=0, Wrap=True)  # -> Item, Item1, Item2
Y = UnitY(Factor=neg_2)
Y_2 = UnitY(Factor=neg_4)
Y_3 = UnitY(Factor=neg_3)
Y_4 = UnitY(Factor=neg_5)
Y_5 = UnitY(Factor=neg_6)
Y_6 = UnitY(Factor=neg_7)
move = Move(Geometry=[item_4.Item, item_4.Item2], Motion=Y)  # -> Geometry, Transform
move_2 = Move(Geometry=item_4.Item1, Motion=Y_3)  # -> Geometry, Transform
move_3 = Move(Geometry=[item_4.Item, item_4.Item2], Motion=Y_2)  # -> Geometry, Transform
move_4 = Move(Geometry=item_4.Item1, Motion=Y_4)  # -> Geometry, Transform
move_5 = Move(Geometry=[item_4.Item, item_4.Item2], Motion=Y_5)  # -> Geometry, Transform
move_6 = Move(Geometry=item_4.Item1, Motion=Y_6)  # -> Geometry, Transform
item_5 = ListItem(List=move.Geometry, Index=0, Wrap=True)  # -> Item, Item1
item_6 = ListItem(List=move_3.Geometry, Index=0, Wrap=True)  # -> Item, Item1
item_7 = ListItem(List=move_5.Geometry, Index=0, Wrap=True)  # -> Item, Item1
merge_11 = Merge(Data1=flatten(item_5.Item), Data2=flatten(move_2.Geometry), Data3=flatten(item_5.Item1))
merge_12 = Merge(Data1=flatten(item_6.Item), Data2=flatten(move_4.Geometry), Data3=flatten(item_6.Item1))
merge_13 = Merge(Data1=flatten(item_7.Item), Data2=flatten(move_6.Geometry), Data3=flatten(item_7.Item1))
intcrv = Interpolate(Vertices=merge_11, Degree=3, Periodic=False, KnotStyle=1)  # -> Curve, Length, Domain
intcrv_2 = Interpolate(Vertices=merge_12, Degree=3, Periodic=False, KnotStyle=1)  # -> Curve, Length, Domain
intcrv_3 = Interpolate(Vertices=merge_13, Degree=3, Periodic=False, KnotStyle=1)  # -> Curve, Length, Domain
rec_2 = Rectangle(rectangle_5.Rectangle)

multiplication_53 = Multiplication(A=subtraction_17, B=number_slider_29)
multiplication_54 = Multiplication(A=subtraction_17, B=number_slider_28)
neg_8 = Negative(Value=multiplication_54)
neg_9 = Negative(Value=multiplication_53)
Y_7 = UnitY(Factor=neg_8)
Y_8 = UnitY(Factor=neg_9)
move_7 = Move(Geometry=[item_4.Item, item_4.Item2], Motion=Y_7)  # -> Geometry, Transform
move_8 = Move(Geometry=item_4.Item1, Motion=Y_8)  # -> Geometry, Transform
item_8 = ListItem(List=move_7.Geometry, Index=0, Wrap=True)  # -> Item, Item1
merge_14 = Merge(Data1=flatten(item_8.Item), Data2=flatten(move_8.Geometry), Data3=flatten(item_8.Item1))
intcrv_4 = Interpolate(Vertices=merge_14, Degree=3, Periodic=False, KnotStyle=1)  # -> Curve, Length, Domain
merge_15 = Merge(Data1=intcrv.Curve, Data2=intcrv_2.Curve, Data3=intcrv_3.Curve, Data4=intcrv_4.Curve)

# ---- group: bounding rectangle input (rectangle y domain represents full range of radii from stockpiles)
rec_3 = Rectangle(rec_2)

# ---- group: curve controller inputs (represents distribution of radii along a given cross section)
crv_3 = Curve(merge_15)

# ----
crv_4 = Curve(crv_3)
lng_3 = ListLength(List=crv_4)  # -> expr("x-2", Length)
dom_18 = ConstructDomain(DomainStart=0, DomainEnd=lng_3)
subset_2 = SubList(List=crv_4, Domain=dom_18, Wrap=True)  # -> graft(List), Index
shift_2 = ShiftList(List=crv_4, Shift=1, Wrap=False)  # -> graft(List)
merge_16 = Merge(Data1=subset_2.List, Data2=shift_2)  # -> simplify(Result)
group_2 = Group(Objects=merge_16)  # -> flatten(Group)

# ---- group: generate distribution
pt_24 = Point(simplify(pt_13))
data_7 = Data(group_2)
pdecon_6 = Deconstruct(Point=pt_24)  # -> XComponent, YComponent, ZComponent
bnd_4 = Bounds(Numbers=flatten(pdecon_6.XComponent))
bnd_5 = Bounds(Numbers=flatten(pdecon_6.YComponent))
lng_4 = ListLength(List=data_7)
dedomain_8 = DeconstructDomain(Domain=bnd_4)  # -> Start, End
remap_21 = RemapNumbers(Value=pdecon_6.YComponent, Source=bnd_5, Target=Domain(0, 1))  # -> graft(Mapped), Clipped
c_script_5 = CSharpScript(count=lng_4, start=dedomain_8.Start, end=dedomain_8.End)  # -> out, A; inputs count: Int32, start: Double, end: Double; same code as c_script_2
num_36 = Number(graft(pdecon_6.XComponent))
inc_2 = Includes(Value=num_36, Domain=simplify(c_script_5.A))  # -> Includes, Deviation
cull_5 = CullPattern(List=data_7, CullPattern=inc_2.Includes)
item_9 = ListItem(List=cull_5, Index=0, Wrap=True)
cull_6 = CullPattern(List=c_script_5.A, CullPattern=inc_2.Includes)
ungroup_2 = Ungroup(Group=item_9)  # -> simplify(Objects)
item_10 = ListItem(List=cull_6, Index=0, Wrap=True)
remap_22 = RemapNumbers(Value=num_36, Source=item_10, Target=Domain(0, 1))  # -> Mapped, Clipped
eval_2 = EvaluateCurve(Curve=reparameterize(ungroup_2), Parameter=remap_21.Mapped)  # -> Point, Tangent, Angle
pdecon_7 = Deconstruct(Point=eval_2.Point)  # -> XComponent, YComponent, ZComponent
item_11 = ListItem(List=pdecon_7.YComponent, Index=0, Wrap=True)  # -> Item, Item1
twn2nums_2 = TweenTwoNumbers(NumberA=item_11.Item, NumberB=item_11.Item1, Factor=remap_22.Mapped)
num_37 = Number(twn2nums_2)

# ----
num_38 = Number(num_37)
rec_4 = Rectangle(rec_3)
drec_7 = DeconstuctRectangle(Rectangle=rec_4)  # -> BasePlane, XInterval, YInterval
dom_19 = ConstructDomain(DomainStart=0, DomainEnd=1)
remap_23 = RemapNumbers(Value=num_38, Source=drec_7.YInterval, Target=dom_19)  # -> Mapped, Clipped
trim_2 = TrimTree(Tree=remap_23.Mapped, Depth=1)

update_bilayer = UpdateBilayer(Bilayer=data_6, Radius=trim_2, RadiusWeight=remap_19.Mapped, Material=path_mapper)
dup_bilayer = DuplicateBilayer(Bilayer=update_bilayer, Count=Slider(2, range=0..10))
panel_8 = Panel(Bilayers=dup_bilayer)
adjust_cro_sec = AdjustCrossSection(Panel=panel_8, Thicknesses=trim)
dup_panel = DuplicatePanel(Panel=adjust_cro_sec, Count=Slider(1, range=0..10))

data_8 = Data(dup_panel)
data_9 = Data(stock_boards)
num_39 = Number(merge_10)
rad_pred = RadiusPrediction(Panels=data_8, StockBoards=data_9, MoistureChanges=num_39, PredictionEngine=c_script_3.A)
design_env = DesignEnvironment(Panels=data_8, StockPile=rad_pred)
convolution = CurvatureConvolution(Panels=design_env, ConvolutionEngine=c_script_4.A)

item_12 = ListItem(List=convolution, Index=0, Wrap=True)  # -> Item, Item1
deconstruct_panel = DeconstructPanel(Panel=item_12.Item)
deconstruct_bilayer_2 = DeconstructBilayer(Bilayer=deconstruct_panel)
dec_board_2 = DeconstructBoard(Board=deconstruct_bilayer_2)  # -> Polyline, Name, Species, RTAngle, MoistureChange, DesiredRadius, Radius, BlendedRadius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
display_panel = DisplayPanels(Panels=item_12.Item)  # -> ActiveBoards, PassiveBoards
dec_reg_2 = DeconstructBoardRegion(BoardRegion=dec_board_2.BoardRegions)  # -> Polyline, Name, Species, RTAngle, MoistureChange, DesiredRadius, Radius, BlendedRadius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

cross_section = BooleanToggle(True)
relaxation = BooleanToggle(False)
cull_7 = CullPattern(List=convolution, CullPattern=cross_section)

crosecset = UniqueCrossSections(Panel=cull_7)
dec_reg_3 = DeconstructBoardRegion(BoardRegion=crosecset)  # -> Polyline, Name, Species, RTAngle, MoistureChange, DesiredRadius, Radius, BlendedRadius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

bbox_2 = BoundingBox(Content=flatten(dec_reg_2.Polyline), Plane=PlaneXY(0, 0, 0), UnionBox=True)  # -> Box, Box_2
debox_2 = DeconstructBox(Box=bbox_2.Box)  # -> Plane, X, Y, Z
dedomain_9 = DeconstructDomain(Domain=debox_2.Y)  # -> Start, End
subtraction_18 = Subtraction(A=dedomain_9.End, B=dedomain_9.Start)
multiplication_55 = Multiplication(A=subtraction_18, B="1.5")
series_3 = Series(Start=Slider(10000, range=0..10000), Step=multiplication_55, Count=Slider(10, range=0..10))
item_13 = ListItem(List=series_3, Index=0, Wrap=True)  # -> Item, Item1, Item2, Item3, Item4, Item5

deconstruct_bilayer_3 = DeconstructBilayer(Bilayer=deconstruct_panel)
bang = ExplodeTree(Data=deconstruct_bilayer_3)
c_script_6 = CSharpScript(tree=dec_reg_3.Polyline, downsample=division_5)  # -> out, A; inputs tree: tree, downsample: Int32
# ---------- c_script_6: C# ----------
    DataTree<object> output = new DataTree<object>();
    for(int i = 0; i < tree.BranchCount; i++)
    {
      if(tree.Paths[i][1] % downsample == 0)
      {
        output.AddRange(tree.Branch(i), tree.Paths[i]);
      }
    }
    A = output;
# ---------- end c_script_6 ----------
c_script_7 = CSharpScript(tree=dec_reg_3.ThicknessBlendedRadius, downsample=division_5)  # -> out, A; inputs tree: tree, downsample: Int32; same code as c_script_6
dec_board_3 = DeconstructBoard(Board=bang)  # -> Polyline, Name, Species, RTAngle, MoistureChange, DesiredRadius, Radius, BlendedRadius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
dec_reg_4 = DeconstructBoardRegion(BoardRegion=dec_board_3.BoardRegions)  # -> Polyline, Name, Species, RTAngle, MoistureChange, DesiredRadius, Radius, BlendedRadius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

bnd_6 = Bounds(Numbers=flatten(dec_reg_2.ThicknessBlendedRadius))
dedomain_10 = DeconstructDomain(Domain=bnd_6)  # -> Start, End
Y_9 = UnitY(Factor=item_13.Item)
gradient = Gradient(
    LowerLimit=dedomain_10.Start,
    UpperLimit=dedomain_10.End,
    Parameter=dec_reg_2.ThicknessBlendedRadius,
    stops=[0: RGB(255, 255, 255), 1: RGB(0, 0, 0)])
vec = Vector(Y_9)
move_9 = Move(Geometry=display_panel.ActiveBoards, Motion=vec)  # -> Geometry, Transform
move_10 = Move(Geometry=display_panel.PassiveBoards, Motion=vec)  # -> Geometry, Transform
area_3 = Area(Geometry=move_9.Geometry)  # -> Area, Centroid
Z_3 = UnitZ(Factor=Slider(10, range=0..10))
move_11 = Move(Geometry=area_3.Centroid, Motion=Z_3)  # -> Geometry, Transform
round = Round(Number=dec_reg_2.ThicknessBlendedRadius)  # -> Nearest, Floor, Ceiling
preview = CustomPreview(Geometry=move_10.Geometry, Material=gradient)  # disabled
tag = TextTag3D(Location=move_11.Geometry, Text=round.Nearest, Size=Slider(100, range=0..100), Colour=RGB(255, 0, 0), Justification=5)
preview_2 = CustomPreview(Geometry=move_9.Geometry, Material=gradient)

panel_9 = Panel(bnd_6)
dec_panel_buildups = DeconstructPanelBuildup(Panels=item_12.Item)  # -> WoodSpecies, Thicknesses, Face

python_3 = GhPythonScript(x=dec_reg_2.Species)  # -> out, a
# ---------- python_3: Python ----------
a = x.Name
# ---------- end python_3 ----------
len = TextLength(Text=python_3.a)
bnd_7 = Bounds(Numbers=flatten(len))
dedomain_11 = DeconstructDomain(Domain=bnd_7)  # -> Start, End
gradient_2 = Gradient(
    LowerLimit=dedomain_11.Start,
    UpperLimit=dedomain_11.End,
    Parameter=len,
    stops=[0: RGB(80, 55, 25), 0.5: RGB(159, 65, 29), 1: RGB(174, 166, 129)])
Y_10 = UnitY(Factor=item_13.Item4)
vec_2 = Vector(Y_10)
move_12 = Move(Geometry=display_panel.ActiveBoards, Motion=vec_2)  # -> Geometry, Transform
move_13 = Move(Geometry=display_panel.PassiveBoards, Motion=vec_2)  # -> Geometry, Transform
preview_3 = CustomPreview(Geometry=move_12.Geometry, Material=gradient_2)
preview_4 = CustomPreview(Geometry=move_13.Geometry, Material=ColourSwatch(SwatchColor=RGB(115, 115, 115)))  # disabled

mesh = Mesh(dec_reg_4.Polyline)
lng_5 = ListLength(List=dec_panel_buildups.WoodSpecies)

c_script_8 = CSharpScript(desired=dec_reg_2.DesiredRadius, actual=dec_reg_2.ThicknessBlendedRadius)  # -> out, A; inputs desired: Double, actual: Double
# ---------- c_script_8: C# ----------
    A = 100 * Math.Abs(desired - actual) / ((desired + actual) / 2);
# ---------- end c_script_8 ----------
bnd_8 = Bounds(Numbers=flatten(c_script_8.A))
panel_10 = Panel(bnd_8)
Y_11 = UnitY(Factor=item_13.Item1)
gradient_3 = Gradient(LowerLimit=0, UpperLimit="100", Parameter=c_script_8.A, stops=[0.15: RGB(255, 130, 160), 0.85: RGB(220, 0, 40)])
vec_3 = Vector(Y_11)
move_14 = Move(Geometry=display_panel.ActiveBoards, Motion=vec_3)  # -> Geometry, Transform
move_15 = Move(Geometry=display_panel.PassiveBoards, Motion=vec_3)  # -> Geometry, Transform
swatch = ColourSwatch(SwatchColor=RGBA(0, 0, 0, 66))
preview_5 = CustomPreview(Geometry=move_14.Geometry, Material=gradient_3)
preview_6 = CustomPreview(Geometry=move_15.Geometry, Material=gradient_3)  # disabled

c_script_9 = CSharpScript(x=lng_5)  # -> out, flatten(A); inputs x: tree
# ---------- c_script_9: C# ----------
    DataTree<object> output = new DataTree<object>();
    int firstIndex = 0;
    int branchCount = 0;
    for(int i = 0; i < x.BranchCount; i++)
    {
      GH_Path path = new GH_Path(firstIndex, branchCount);
      if(x.Paths[i][0] == firstIndex)
      {
        output.AddRange(x.Branch(i), path);
      }
      else
      {
        firstIndex++;
        branchCount = -1;
        i--;
      }
      branchCount++;
    }
    A = output;
# ---------- end c_script_9 ----------

bnd_9 = Bounds(Numbers=flatten(c_script_9.A))
dedomain_12 = DeconstructDomain(Domain=bnd_9)  # -> Start, End
gradient_4 = Gradient(
    LowerLimit=dedomain_12.Start,
    UpperLimit=dedomain_12.End,
    Parameter=c_script_9.A,
    stops=[0: RGB(0, 128, 0), 0.5: RGB(255, 255, 0), 1: RGB(255, 0, 0)])
Y_12 = UnitY(Factor=item_13.Item5)
vec_4 = Vector(Y_12)
move_16 = Move(Geometry=mesh, Motion=vec_4)  # -> flatten(Geometry), Transform
preview_7 = CustomPreview(Geometry=move_16.Geometry, Material=gradient_4)

bnd_10 = Bounds(Numbers=flatten(dec_reg_2.RTAngle))
dedomain_13 = DeconstructDomain(Domain=bnd_10)  # -> Start, End
gradient_5 = Gradient(
    LowerLimit=dedomain_13.Start,
    UpperLimit=dedomain_13.End,
    Parameter=dec_reg_2.RTAngle,
    stops=[0: RGB(124, 0, 219), 1: RGB(207, 130, 255)])
Y_13 = UnitY(Factor=item_13.Item2)
vec_5 = Vector(Y_13)
move_17 = Move(Geometry=display_panel.ActiveBoards, Motion=vec_5)  # -> Geometry, Transform
move_18 = Move(Geometry=display_panel.PassiveBoards, Motion=vec_5)  # -> Geometry, Transform
preview_8 = CustomPreview(Geometry=move_17.Geometry, Material=gradient_5)
preview_9 = CustomPreview(Geometry=move_18.Geometry, Material=ColourSwatch(SwatchColor=RGB(115, 115, 115)))  # disabled

bnd_11 = Bounds(Numbers=flatten(dec_reg_2.MoistureChange))
dedomain_14 = DeconstructDomain(Domain=bnd_11)  # -> Start, End
Y_14 = UnitY(Factor=item_13.Item3)
gradient_6 = Gradient(
    LowerLimit=dedomain_14.Start,
    UpperLimit=dedomain_14.End,
    Parameter=dec_reg_2.MoistureChange,
    stops=[0: RGB(156, 216, 217), 0.502: RGB(77, 123, 135), 1: RGB(55, 81, 102)])
vec_6 = Vector(Y_14)
move_19 = Move(Geometry=display_panel.ActiveBoards, Motion=vec_6)  # -> Geometry, Transform
move_20 = Move(Geometry=display_panel.PassiveBoards, Motion=vec_6)  # -> Geometry, Transform
preview_10 = CustomPreview(Geometry=move_19.Geometry, Material=gradient_6)
preview_11 = CustomPreview(Geometry=move_20.Geometry, Material=ColourSwatch(SwatchColor=RGB(115, 115, 115)))  # disabled

c_script_10 = CSharpScript(x=c_script_7.A)  # -> out, A; inputs x: tree; same code as c_script_9

crv_5 = Curve(c_script_6.A)
area_4 = Area(Geometry=crv_5)  # -> Area, Centroid
bbox_3 = BoundingBox(Content=flatten(dec_reg_3.Polyline), Plane=PlaneXY(0, 0, 0), UnionBox=True)  # -> Box, Box_2
avr = Average(Input=area_4.Centroid)
debox_3 = DeconstructBox(Box=bbox_3.Box)  # -> Plane, X, Y, Z

pdecon_8 = Deconstruct(Point=avr)  # -> XComponent, YComponent, ZComponent
trim_3 = TrimTree(Tree=pdecon_8.XComponent, Depth=1)
bnd_12 = Bounds(Numbers=trim_3)

remap_24 = RemapNumbers(Value=pdecon_8.XComponent, Source=bnd_12, Target=debox_3.X)  # -> Mapped, Clipped
pt_25 = ConstructPoint(XCoordinate=remap_24.Mapped, YCoordinate=pdecon_8.YComponent, ZCoordinate=pdecon_8.ZComponent)
yz = YZPlane(Origin=pt_25)

c_script_11 = CSharpScript(x=yz)  # -> out, A; inputs x: tree; same code as c_script_9

num_40 = Number(num)
num_41 = Number(c_script_10.A)
pln = Plane(c_script_11.A)
c_script_12 = CSharpScript(iRadii=num_41, iBoardWidth=num_40, iPlanes=pln)  # -> out, simplify(A); inputs iRadii: tree of Double, iBoardWidth: Double, iPlanes: tree of Plane
# ---------- c_script_12: C# ----------
    DataTree<Point3d> pointTree = new DataTree<Point3d>();

    for (int j = 0; j < iRadii.BranchCount; j++)
    {

      //initialize variables
      Plane bp = iPlanes.Branch(j)[0];
      Point3d startPoint = new Point3d(bp.Origin);
      Point3d centerPoint = startPoint;
      Vector3d rotationAxis = new Vector3d(bp.ZAxis);
      Vector3d centerPointVect = new Vector3d(bp.YAxis);
      centerPointVect.Rotate(Math.PI / 2, rotationAxis);

      for (int i = 0; i < iRadii.Branch(j).Count; i++){
        GH_Path pth = iRadii.Paths[j].AppendElement(i);
        Point3d point1 = startPoint;
        Point3d point2 = startPoint;

        pointTree.Add(point1, pth);

        //calculate rotation angle
        Double arcLength = iBoardWidth;
        Double radius = iRadii.Branch(j)[i];
        Double rotation = (arcLength / radius);

        //calculate rotation center point
        centerPointVect.Unitize();
        centerPointVect *= radius;
        centerPoint += centerPointVect;


        //execute half rotation
        Transform tx = Transform.Rotation(rotation / 2, rotationAxis, centerPoint);


        point2.Transform(tx);
        pointTree.Add(point2, pth);

        //execute full rotation
        tx = Transform.Rotation(rotation, rotationAxis, centerPoint);
        startPoint.Transform(tx);
        pointTree.Add(startPoint, pth);

        //updata rotation parameters
        centerPoint = startPoint;
        centerPointVect.Transform(tx);
      }
    }
    A = pointTree;
# ---------- end c_script_12 ----------

trim_4 = TrimTree(Tree=c_script_12.A, Depth=1)
cullpt = CullDuplicates(Points=trim_4, Tolerance=0.1, CullMode=3)  # -> Points, Indices, Valence
pt_26 = Point(cullpt.Points)

# ---- group: animate
pt_27 = Point(simplify(pt_26))
pln_2 = Plane(graft(pln))
num_42 = Number(Slider(1, range=0..1))
c_script_13 = CSharpScript(iPoints=simplify(pt_27), iPlanes=pln_2, iShapeFactor=num_42)  # -> out, A; inputs iPoints: tree of Point3d, iPlanes: tree of Plane, iShapeFactor: Double
# ---------- c_script_13: C# ----------
    DataTree<Point3d> output = new DataTree<Point3d>();
    
    double shapeFactor = 1.0 - iShapeFactor;

    //step through curves
    for (int i = 0; i < iPoints.BranchCount; i++)
    {
      Plane currentPlane = iPlanes.Branch(iPoints.Path(i)[0])[0];

      //get vectors from plane
      Vector3d zVect = currentPlane.YAxis;

      Vector3d rotVect = currentPlane.ZAxis;

      //create new startpoint inside list
      Point3d startPoint = iPoints.Branch(i)[0];

      //step through points. Create and rotate vectors
      for (int j = 0; j < iPoints.Branch(i).Count; j++)
      {
        if (j == 0) output.Add(startPoint, iPoints.Path(i));
        else{
          //create current segment vector
          Vector3d segmentVect = new Vector3d(iPoints.Branch(i)[j] - iPoints.Branch(i)[j - 1]);

          //measure angle with vertical vector
          double angle = Vector3d.VectorAngle(zVect, segmentVect, currentPlane);

          //rotate
          segmentVect.Rotate(-angle * shapeFactor, rotVect);

          startPoint += segmentVect;
          output.Add(startPoint, iPoints.Path(i));
        }
      }
    }

    A = output;
# ---------- end c_script_13 ----------
pt_28 = Point(c_script_13.A)
intcrv_5 = Interpolate(Vertices=pt_28, Degree=3, Periodic=False, KnotStyle=1)  # -> Curve, Length, Domain
crv_6 = Curve(intcrv_5.Curve)

# ----
crv_7 = Curve(crv_6)
pt_29 = Point(simplify(graft(pt_25)))
end = EndPoints(Curve=crv_7)  # -> Start, End
vec2pt = Vector2Pt(PointA=end.Start, PointB=end.End, Unitize=False)  # -> Vector, Length
yz_2 = YZPlane(Origin=end.Start)
Y_15 = UnitY(Factor="-1")
angle = Angle(VectorA=vec2pt.Vector, VectorB=Y_15, Plane=yz_2)  # -> Angle, Reflex
rotate = Rotate(Geometry=crv_7, Angle=angle.Angle, Plane=yz_2)  # -> Geometry, Transform
curvepoint = PointOnCurve(rotate.Geometry, parameter=0.5)
vec2pt_2 = Vector2Pt(PointA=curvepoint, PointB=pt_29, Unitize=False)  # -> Vector, Length
move_21 = Move(Geometry=rotate.Geometry, Motion=vec2pt_2.Vector)  # -> Geometry, Transform
path_mapper_2 = PathMapper(move_21.Geometry, source=["{A;B}", "{A}"], target=["{A}", "{0}"])
crv_8 = Curve(path_mapper_2)
loft = Loft(Curves=crv_8, Options={Adjust=False, Closed=False, LoftEnds=0, LoftSimp=0, LoftType=2, Rebuild=10, Refit=0.01})

bool = Boolean(relaxation)
cull_8 = CullPattern(List=loft, CullPattern=bool)
number_slider_47 = Slider(8, range=0..100)
srf = Surface(cull_8)
num_43 = Number(number_slider_33)
quads = QuadPanels(Surface=srf, UDivisions=number_slider_47, VDivisions=num_43)
srf_2 = Surface(reparameterize(simplify(quads)))

smesh = SimpleMesh(Brep=srf_2)
area_5 = MeshArea(Mesh=smesh)  # -> Area, Centroid
meshcp = MeshClosestPoint(Point=area_5.Centroid, Mesh=smesh)  # -> Point, Index, Parameter
meval = MeshEval(Mesh=smesh, Parameter=meshcp.Parameter)  # -> Point, Normal, Colour
pl = PlaneNormal(Origin=meval.Point, ZAxis=meval.Normal)
X_2 = UnitX(Factor=1)
deplane = DeconstructPlane(Plane=pl)  # -> Origin, XAxis, YAxis, ZAxis
angle_2 = Angle(VectorA=deplane.XAxis, VectorB=X_2, Plane=pl)  # -> Angle, Reflex
rotate_2 = Rotate(Geometry=pl, Angle=angle_2.Angle, Plane=pl)  # -> graft(Geometry), Transform

medges = MeshEdges(Mesh=smesh)  # -> simplify(NakedEdges), InteriorEdges, NonManifoldEdges
curvepoint_2 = PointOnCurve(medges.NakedEdges, parameter=0.5)
plcoord = PlaneCoordinates(Point=curvepoint_2, System=rotate_2.Geometry)  # -> XCoordinate, YCoordinate, ZCoordinate
sort = SortList(Keys=plcoord.XCoordinate, ValuesA=medges.NakedEdges)  # -> Keys, ValuesA
item_14 = ListItem(List=reverse(sort.ValuesA), Index=0, Wrap=True)
item_15 = ListItem(List=sort.ValuesA, Index=0, Wrap=True)

merge_17 = Merge(Data1=item_15, Data2=item_14)
trim_5 = TrimTree(Tree=merge_17, Depth=1)
rdlines = RemoveDuplicateLinesKaramba3D(Line=trim_5, LimitDistance=0.005)  # -> OutLine, Info, Indexes
join_3 = JoinCurves(Curves=rdlines.OutLine, Preserve=False)
explode = Explode(Curve=join_3, Recursive=True)  # -> Segments, simplify(Vertices)
pline = PolyLine(Vertices=explode.Vertices, Closed=False)  # -> simplify(graft(Polyline))
path_mapper_3 = PathMapper(pline, source=["{A}", "{A;B}"], target=["{0}", "{A}"])
curvepoint_3 = PointOnCurve(path_mapper_3, parameter=0.5)
pdecon_9 = Deconstruct(Point=curvepoint_3)  # -> XComponent, YComponent, ZComponent
sort_2 = SortList(Keys=pdecon_9.XComponent, ValuesA=path_mapper_3)  # -> Keys, ValuesA
crv_9 = Curve(sort_2.ValuesA)

crv_10 = Curve(crv_9)
item_16 = ListItem(List=crv_10, Index=0, Wrap=True)
curvepoint_4 = PointOnCurve(crv_10, parameter=0.5)
curvepoint_5 = PointOnCurve(item_16, parameter=0.5)
vec2pt_3 = Vector2Pt(PointA=curvepoint_5, PointB=curvepoint_4, Unitize=False)  # -> Vector, Length
move_22 = Move(Geometry=item_16, Motion=vec2pt_3.Vector)  # -> Geometry, Transform

crv_11 = Curve(crv_9)
flip = FlipCurve(Curve=crv_11, Guide=move_22.Geometry)  # -> Curve, Flag

explode_2 = Explode(Curve=flip.Curve, Recursive=True)  # -> simplify(Segments), Vertices
explode_3 = Explode(Curve=move_22.Geometry, Recursive=True)  # -> simplify(Segments), Vertices
lng_6 = ListLength(List=explode_2.Segments)
lng_7 = ListLength(List=explode_2.Segments)
lng_8 = ListLength(List=explode_3.Segments)
lng_9 = ListLength(List=explode_3.Segments)
subtraction_19 = Subtraction(A=lng_6, B=2)
subtraction_20 = Subtraction(A=lng_7, B=1)
subtraction_21 = Subtraction(A=lng_8, B=2)
subtraction_22 = Subtraction(A=lng_9, B=1)
dom_20 = ConstructDomain(DomainStart=0, DomainEnd=subtraction_19)
dom_21 = ConstructDomain(DomainStart=1, DomainEnd=subtraction_20)
dom_22 = ConstructDomain(DomainStart=0, DomainEnd=subtraction_21)
dom_23 = ConstructDomain(DomainStart=1, DomainEnd=subtraction_22)
subset_3 = SubList(List=explode_2.Segments, Domain=dom_20, Wrap=True)  # -> graft(List), Index
subset_4 = SubList(List=explode_2.Segments, Domain=dom_21, Wrap=True)  # -> graft(List), Index
subset_5 = SubList(List=explode_3.Segments, Domain=dom_22, Wrap=True)  # -> graft(List), Index
subset_6 = SubList(List=explode_3.Segments, Domain=dom_23, Wrap=True)  # -> graft(List), Index
angle_3 = Angle(VectorA=subset_5.List, VectorB=subset_6.List)  # -> simplify(Angle), Reflex
angle_4 = Angle(VectorA=subset_3.List, VectorB=subset_4.List)  # -> simplify(Angle), Reflex
join_4 = JoinCurves(Curves=[subset_5.List, subset_6.List], Preserve=False)  # -> simplify(Curves)
num_44 = Number(angle_3.Angle)
num_45 = Number(angle_4.Angle)

explode_4 = Explode(Curve=flip.Curve, Recursive=True)  # -> simplify(Segments), Vertices
explode_5 = Explode(Curve=move_22.Geometry, Recursive=True)  # -> simplify(Segments), Vertices
path_mapper_4 = PathMapper(explode_4.Segments, source=["{A}(i)", "{A;B}(i)"], target=["{i}(A)", "{A;i}(B)"])
path_mapper_5 = PathMapper(explode_5.Segments, source=["{A}(i)", "{A;B}(i)"], target=["{i}(A)", "{A;i}(B)"])
crv_12 = Curve(path_mapper_5)
crv_13 = Curve(path_mapper_4)
lng_10 = ListLength(List=crv_13)  # -> expr("x-2", Length)
lng_11 = ListLength(List=crv_12)  # -> expr("x-2", Length)
lng_12 = ListLength(List=crv_13)  # -> expr("x-1", Length)
lng_13 = ListLength(List=crv_12)  # -> expr("x-1", Length)
dom_24 = ConstructDomain(DomainStart=0, DomainEnd=lng_10)
dom_25 = ConstructDomain(DomainStart=0, DomainEnd=lng_11)
dom_26 = ConstructDomain(DomainStart=1, DomainEnd=lng_12)
dom_27 = ConstructDomain(DomainStart=1, DomainEnd=lng_13)
subset_7 = SubList(List=crv_13, Domain=dom_24, Wrap=True)  # -> graft(List), Index
subset_8 = SubList(List=crv_12, Domain=dom_25, Wrap=True)  # -> graft(List), Index
subset_9 = SubList(List=crv_13, Domain=dom_26, Wrap=True)  # -> graft(List), Index
subset_10 = SubList(List=crv_12, Domain=dom_27, Wrap=True)  # -> graft(List), Index
loft_2 = Loft(
    Curves=[subset_7.List, subset_9.List],
    Options={Adjust=False, Closed=False, LoftEnds=0, LoftSimp=0, LoftType=0, Rebuild=10, Refit=0.01})  # -> simplify(Loft)
loft_3 = Loft(
    Curves=[subset_8.List, subset_10.List],
    Options={Adjust=False, Closed=False, LoftEnds=0, LoftSimp=0, LoftType=0, Rebuild=10, Refit=0.01})  # -> simplify(Loft)
smesh_2 = SimpleMesh(Brep=loft_2)
smesh_3 = SimpleMesh(Brep=loft_3)
path_mapper_6 = PathMapper(smesh_3, source=["{A;B;C}", "{A;B}"], target=["{A}", "{0}"])
path_mapper_7 = PathMapper(smesh_2, source=["{A;B;C}", "{A;B}"], target=["{A}", "{0}"])
mjoin = MeshJoin(Meshes=path_mapper_6)
mjoin_2 = MeshJoin(Meshes=path_mapper_7)
weld = WeldMesh(Mesh=mjoin, Angle=3.141592654)
weld_2 = WeldMesh(Mesh=mjoin_2, Angle=3.141592654)

explode_6 = Explode(Curve=move_22.Geometry, Recursive=True)  # -> Segments, Vertices
num_46 = Number(num_45)
num_47 = Number(num_44)
mesh_2 = Mesh(weld)
division_42 = Division(A=num_46, B=num_47)  # -> graft(Result)
path_mapper_8 = PathMapper(explode_6.Vertices, source=["{A;B}(i)", "{A}(i)"], target=["{A;i}(B)", "{i}(A)"])
pline_2 = PolyLine(Vertices=path_mapper_8, Closed=False)  # -> simplify(Polyline)
path_mapper_9 = PathMapper(pline_2, source=["{A;B}", "{A}"], target=["{A}", "{0}"])
crv_14 = Curve(join_4)
show = Show(G=mesh_2)  # -> flatten(G)
rod = Rod(
    Polyline=path_mapper_9,
    LengthFactor=1,
    AngleFactor=1,
    AxialStrength=Slider(1, range=0..100000),
    BendStrength=Slider(1, range=0..10000))  # -> flatten(R)
rod_2 = Rod(
    Polyline=crv_14,
    LengthFactor=1,
    AngleFactor=division_42,
    AxialStrength=Slider(1, range=0..100000),
    BendStrength=Slider(100000, range=0..1000000))  # -> flatten(R)
merge_18 = Merge(Data1=rod, Data2=rod_2, Data3=show)

zombiesolver = ZombieSolver(GoalObjects=flatten(merge_18), Threshold=1e-10, Tolerance=0.0001, MaxIterations=Slider(10000, range=0..100000))  # -> I, V, O
mesh_3 = Mesh(zombiesolver.O)
clean = CleanTree(RemoveNulls=True, RemoveInvalid=True, RemoveEmpty=False, Tree=mesh_3)

wbedges = WeaverbirdsMeshEdges(MeshOrPolylines=graft(clean))  # -> simplify(Lines)
mesh_4 = Mesh(simplify(graft(clean)))

wbedges_2 = WeaverbirdsMeshEdges(MeshOrPolylines=weld_2)  # -> simplify(Lines)
line = Line(wbedges)
group_3 = Group(Objects=line)  # -> flatten(Group)
len_2 = Length(Curve=wbedges_2)
len_3 = Length(Curve=line)
lng_14 = ListLength(List=group_3)
subtraction_23 = Subtraction(A=len_3, B=len_2)
series_4 = Series(Start=0, Step=Slider(1330, range=0..10000), Count=lng_14)
smaller_2 = SmallerThan(FirstNumber=subtraction_23, SecondNumber=0)  # -> SmallerThan, OrEqualTo
dispatch = Dispatch(List=subtraction_23, DispatchPattern=smaller_2.SmallerThan)  # -> ListA, ListB
Y_16 = UnitY(Factor=series_4)
Y_17 = UnitY(Factor=Slider(5928, range=0..10000))
move_23 = Move(Geometry=group_3, Motion=Y_16)  # -> Geometry, Transform
bnd_13 = Bounds(Numbers=dispatch.ListA)
bnd_14 = Bounds(Numbers=dispatch.ListB)
move_24 = Move(Geometry=move_23.Geometry, Motion=Y_17)  # -> Geometry, Transform
dedomain_15 = DeconstructDomain(Domain=bnd_14)  # -> Start, End
dedomain_16 = DeconstructDomain(Domain=bnd_13)  # -> Start, End
X_3 = UnitX(Factor=Slider(7456, range=0..10000))
move_25 = Move(Geometry=move_24.Geometry, Motion=X_3)  # -> Geometry, Transform
gradient_7 = Gradient(
    LowerLimit=dedomain_16.Start,
    UpperLimit=dedomain_16.End,
    Parameter=dispatch.ListA,
    stops=[0: RGB(75, 107, 169), 0.501: RGB(173, 203, 249), 1: RGB(254, 244, 84)])
gradient_8 = Gradient(
    LowerLimit=dedomain_15.Start,
    UpperLimit=dedomain_15.End,
    Parameter=dispatch.ListB,
    stops=[0: RGB(254, 244, 84), 0.499: RGB(234, 126, 0), 1: RGB(234, 38, 0), 1: RGB(75, 107, 169), 1: RGB(173, 203, 249)])
ungroup_3 = Ungroup(Group=move_25.Geometry)
dispatch_2 = Dispatch(List=ungroup_3, DispatchPattern=smaller_2.SmallerThan)  # -> ListA, ListB
previewlw = CustomPreviewLineweights(Geometry=dispatch_2.ListA, Shader=gradient_7, Thickness=3, Absolute=False)
previewlw_2 = CustomPreviewLineweights(Geometry=dispatch_2.ListB, Shader=gradient_8, Thickness=3, Absolute=False)

crv_15 = Curve(wbedges)
end_2 = EndPoints(Curve=crv_15)  # -> Start, End
pdecon_10 = Deconstruct(Point=end_2.Start)  # -> XComponent, YComponent, ZComponent
pdecon_11 = Deconstruct(Point=end_2.End)  # -> XComponent, YComponent, ZComponent
subtraction_24 = Subtraction(A=pdecon_10.XComponent, B=pdecon_11.XComponent)
abs_13 = Absolute(Value=subtraction_24)
smaller_3 = SmallerThan(FirstNumber=abs_13, SecondNumber=Slider(100, range=0..100))  # -> SmallerThan, OrEqualTo
cull_9 = CullPattern(List=crv_15, CullPattern=smaller_3.SmallerThan)
join_5 = JoinCurves(Curves=cull_9, Preserve=False)
curvepoint_6 = PointOnCurve(join_5, parameter=0.5)
pdecon_12 = Deconstruct(Point=curvepoint_6)  # -> XComponent, YComponent, ZComponent
sort_3 = SortList(Keys=pdecon_12.XComponent, ValuesA=join_5)  # -> Keys, ValuesA
explode_7 = Explode(Curve=sort_3.ValuesA, Recursive=True)  # -> Segments, simplify(Vertices)
intcrv_6 = Interpolate(Vertices=explode_7.Vertices, Degree=3, Periodic=False, KnotStyle=1)  # -> Curve, Length, Domain
path_mapper_10 = PathMapper(intcrv_6.Curve, source=["{A;B}", "{A}"], target=["{A}", "{0}"])
loft_4 = Loft(Curves=path_mapper_10, Options={Adjust=False, Closed=False, LoftEnds=0, LoftSimp=0, LoftType=0, Rebuild=10, Refit=0.01})

mesh_5 = Mesh(mesh_4)
num_48 = Number(expr("x+1", number_slider_47))
medges_2 = MeshEdges(Mesh=mesh_5)  # -> NakedEdges, InteriorEdges, NonManifoldEdges
demesh = DeconstructMesh(Mesh=mesh_5)  # -> Vertices, Faces, Colours, Normals
join_6 = JoinCurves(Curves=medges_2.NakedEdges, Preserve=False)
patch = Patch(Curves=join_6, Points=demesh.Vertices, Spans=num_48, Flexibility=Slider(1, range=0..1), Trim=True)
srf_3 = Surface(simplify(patch))

mesh_6 = Mesh(mesh_4)  # disabled
mesh_7 = Mesh(flatten(mesh_6))  # disabled
number_slider_48 = Slider(2905, range=0..10000)  # disabled
c_script_14 = CSharpScript(mesh=mesh_6, surface=srf_3)  # -> out, Curvature; inputs mesh: Mesh, surface: Surface; disabled
# ---------- c_script_14: C# ----------
        //get surface gaussian curvature at each mesh point
        List<double> gaussianCurvatures = new List<double>();
        double maxGaussian = 0;
        double minGaussian = double.MaxValue;

        double U;
        double V;

        for (int i = 0; i < mesh.Vertices.Count; i++)
        {
            Point3d currentMeshPoint = mesh.Vertices.Point3dAt(i);
            surface.ClosestPoint(currentMeshPoint, out U, out V);
            SurfaceCurvature surfaceCurvature = surface.CurvatureAt(U, V);
            double gaussian = surfaceCurvature.Gaussian;
            gaussianCurvatures.Add(gaussian);

            //get the range of curvatures
            if (gaussian > maxGaussian) maxGaussian = gaussian;
            if( gaussian < minGaussian) minGaussian = gaussian;
        }


        //get the range of curvatures


        //remap the curvatures to color values on the mesh points
        for (int i = 0; i < mesh.Vertices.Count; i++)
        {
            double hue = (gaussianCurvatures[i] - minGaussian) / (0 - minGaussian) * (0.5 - maxGaussian) + maxGaussian;
        }
        Curvature = gaussianCurvatures;
# ---------- end c_script_14 ----------
move_26 = Move(Geometry=mesh_7, Motion=Vector(0, 0, 10))  # -> simplify(graft(Geometry)), Transform; disabled
num_49 = Number(c_script_14.Curvature)  # disabled
Y_18 = UnitY(Factor=number_slider_48)  # disabled
number_slider_49 = Slider(7456, range=0..10000)  # disabled
bnd_15 = Bounds(Numbers=num_49)  # disabled
mesh_8 = Mesh(move_26.Geometry)  # disabled
dedomain_17 = DeconstructDomain(Domain=bnd_15)  # -> Start, End; disabled
move_27 = Move(Geometry=mesh_8, Motion=Y_18)  # -> Geometry, Transform; disabled
X_4 = UnitX(Factor=number_slider_49)  # disabled
gradient_9 = Gradient(
    LowerLimit=dedomain_17.Start,
    UpperLimit=dedomain_17.End,
    Parameter=num_49,
    stops=[0: RGB(0, 128, 0), 0.5: RGB(255, 255, 0), 1: RGB(255, 0, 0)])  # disabled
move_28 = Move(Geometry=move_27.Geometry, Motion=X_4)  # -> Geometry, Transform; disabled
c_script_15 = CSharpScript(mesh=move_28.Geometry, colors=simplify(gradient_9))  # -> out, A; inputs mesh: Mesh, colors: list of Color; disabled
# ---------- c_script_15: C# ----------
    for(int i = 0; i < mesh.Vertices.Count; i++)
    {
      mesh.VertexColors.SetColor(i, colors[i]);
    }
    A = mesh;
# ---------- end c_script_15 ----------

gaussian_curvature = Panel(bnd_15)
relaxation_2 = Panel(bnd_13)

# ---- group: control gate
srf_4 = Surface(loft_4)
srf_5 = Surface(loft)
bool_2 = Boolean(relaxation)
not_2 = GateNot(A=bool_2)
cull_10 = CullPattern(List=srf_5, CullPattern=not_2)
cull_11 = CullPattern(List=cull_7, CullPattern=cross_section)
merge_19 = Merge(Data1=srf_4, Data2=cull_10)

# ----
srf_6 = Surface(merge_19)

debrep = DeconstructBrep(Brep=srf_6)  # -> Faces, Edges, Vertices
crv_16 = Curve(debrep.Edges)
curvepoint_7 = PointOnCurve(crv_16, parameter=0.5)
number_slider_50 = Slider(0.2, range=0..0.5)
pdecon_13 = Deconstruct(Point=curvepoint_7)  # -> XComponent, YComponent, ZComponent
sort_4 = SortList(Keys=pdecon_13.XComponent, ValuesA=crv_16)  # -> Keys, ValuesA
subtraction_25 = Subtraction(A="1", B=number_slider_50)
item_17 = ListItem(List=sort_4.ValuesA, Index=0, Wrap=True)  # -> Item, Item1, Item2, Item3
merge_20 = Merge(Data1=number_slider_50, Data2=subtraction_25)
eval_3 = EvaluateCurve(Curve=reparameterize(item_17.Item3), Parameter=merge_20)  # -> Point, Tangent, Angle

srf_7 = Surface(flatten(srf_6))
data_10 = Data(cull_11)
pan_srf = UpdatePanelSurface(Panel=data_10, Surface=srf_7)  # -> flatten(Panel)
deconstruct_panel_2 = DeconstructPanel(Panel=pan_srf)
deconstruct_bilayer_4 = DeconstructBilayer(Bilayer=deconstruct_panel_2)
dec_board_4 = DeconstructBoard(Board=deconstruct_bilayer_4)  # -> Polyline, Name, Species, RTAngle, MoistureChange, DesiredRadius, Radius, BlendedRadius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
dec_reg_5 = DeconstructBoardRegion(BoardRegion=dec_board_4.BoardRegions)  # -> Polyline, Name, Species, RTAngle, MoistureChange, DesiredRadius, Radius, BlendedRadius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

trim_6 = TrimTree(Tree=dec_reg_5.ShapedRegion, Depth=1)
join_7 = BrepJoin(Breps=trim_6)  # -> Breps, Closed
trim_7 = TrimTree(Tree=join_7.Breps, Depth=1)
item_18 = ListItem(List=trim_7, Index=0, Wrap=True)  # -> flatten(Item)

item_19 = ListItem(List=eval_3.Point, Index=0, Wrap=True)  # -> Item, Item1
end_3 = EndPoints(Curve=item_17.Item)  # -> Start, End
merge_21 = Merge(Data1=end_3.Start, Data2=end_3.End, Data3=item_19.Item, Data4=item_19.Item1)  # -> flatten(Result)
pdecon_14 = Deconstruct(Point=merge_21)  # -> XComponent, YComponent, ZComponent
sort_5 = SortList(Keys=pdecon_14.XComponent, ValuesA=merge_21)  # -> Keys, ValuesA
item_20 = ListItem(List=sort_5.ValuesA, Index=0, Wrap=True)  # -> Item, Item1, Item2, Item3
merge_22 = Merge(Data1=item_20.Item, Data2=item_20.Item1)
merge_23 = Merge(Data1=item_20.Item2, Data2=item_20.Item3)
pdecon_15 = Deconstruct(Point=merge_23)  # -> XComponent, YComponent, ZComponent
pdecon_16 = Deconstruct(Point=merge_22)  # -> XComponent, YComponent, ZComponent
sort_6 = SortList(Keys=pdecon_15.YComponent, ValuesA=merge_23)  # -> Keys, ValuesA
sort_7 = SortList(Keys=pdecon_16.YComponent, ValuesA=merge_22)  # -> Keys, ValuesA
project = Project(Geometry=sort_6.ValuesA, Plane=PlaneXY(0, 0, 0))  # -> Geometry, Transform
project_2 = Project(Geometry=sort_7.ValuesA, Plane=PlaneXY(0, 0, 0))  # -> Geometry, Transform
item_21 = ListItem(List=project_2.Geometry, Index=0, Wrap=True)  # -> Item, Item1
item_22 = ListItem(List=project.Geometry, Index=0, Wrap=True)  # -> Item, Item1
ln_2 = Line(StartPoint=item_21.Item, EndPoint=item_22.Item)
ln_3 = Line(StartPoint=item_21.Item1, EndPoint=item_22.Item1)
Z_4 = UnitZ(Factor=1)
pl_2 = ConstructPlane(Origin=item_21.Item, XAxis=ln_2, YAxis=Z_4)
pl_3 = ConstructPlane(Origin=item_21.Item1, XAxis=ln_3, YAxis=Z_4)
merge_24 = Merge(Data1=pl_3, Data2=pl_2)  # -> flatten(Result)

number_slider_51 = Slider(10000, range=0..10000)
dom_28 = ConstructDomain(DomainStart=expr("-x", number_slider_51), DomainEnd=number_slider_51)
pln_3 = Plane(merge_24)
planesrf = PlaneSurface(Plane=pln_3, XSize=dom_28, YSize=dom_28)
splitmul = SplitBrepMultiple(Brep=item_18, Cutters=planesrf)
area_6 = Area(Geometry=splitmul)  # -> Area, Centroid
area_7 = Area(Geometry=item_18)  # -> Area, Centroid
pdecon_17 = Deconstruct(Point=area_7.Centroid)  # -> XComponent, YComponent, ZComponent
pdecon_18 = Deconstruct(Point=area_6.Centroid)  # -> XComponent, YComponent, ZComponent
pt_30 = ConstructPoint(XCoordinate=0, YCoordinate=pdecon_17.YComponent, ZCoordinate=0)
pt_31 = ConstructPoint(XCoordinate=0, YCoordinate=pdecon_18.YComponent, ZCoordinate=0)
dist = Distance(PointA=pt_30, PointB=pt_31)
sort_8 = SortList(Keys=dist, ValuesA=splitmul)  # -> Keys, ValuesA
item_23 = ListItem(List=sort_8.ValuesA, Index=0, Wrap=True)
match_brep = MatchTrimmedRegionBrep(Panel=cull_11, Brep=item_23)  # -> Panel, Regions, Faces
brep = Brep(item_23)

python_4 = GhPythonScript(x=match_brep.Panel)  # -> out, a
# ---------- python_4: Python ----------
a = x.Centroid
# ---------- end python_4 ----------
pdecon_19 = Deconstruct(Point=python_4.a)  # -> XComponent, YComponent, ZComponent
pt_32 = Point(python_4.a)
multiplication_56 = Multiplication(A=pdecon_19.XComponent, B=Slider(0.0003, range=0..1))
num_50 = Number(multiplication_56)

panel_11 = Panel(multiplication_56)

pt_33 = Point(pt_32)
pdecon_20 = Deconstruct(Point=pt_33)  # -> XComponent, YComponent, ZComponent
subtraction_26 = Subtraction(A=pdecon_20.XComponent, B=Slider(500, range=0..1000))
pt_34 = ConstructPoint(XCoordinate=subtraction_26, YCoordinate=pdecon_20.YComponent, ZCoordinate=pdecon_20.ZComponent)

data_11 = Data(species_2)
data_12 = Data(match_brep.Panel)
dec_panel_buildups_2 = DeconstructPanelBuildup(Panels=data_12)  # -> WoodSpecies, Thicknesses, Face
tstat = TreeStatistics(Tree=dec_panel_buildups_2.Thicknesses)  # -> Paths, Length, Count
lng_15 = ListLength(List=tstat.Paths)
dup_13 = DuplicateData(Data=data_11, Number=lng_15, Order=True)  # -> graft(Data)
dup_14 = DuplicateData(Data="4", Number=lng_15, Order=True)  # -> graft(Data)
match = MatchTree(Tree=dup_13, Guide=dec_panel_buildups_2.WoodSpecies)
match_2 = MatchTree(Tree=dup_14, Guide=dec_panel_buildups_2.Thicknesses)
merge_25 = Merge(Data1=dec_panel_buildups_2.WoodSpecies, Data2=match)
merge_26 = Merge(Data1=dec_panel_buildups_2.Thicknesses, Data2=match_2)

# ---- group: species
data_13 = Data(merge_25)

# ---- group: thicknesses
num_51 = Number(merge_26)

# ----
c_script_16 = CSharpScript(x=data_13)  # -> out, A; inputs x: tree; same code as c_script_9
c_script_17 = CSharpScript(x=num_51)  # -> out, A; inputs x: tree; same code as c_script_9

brep_2 = Brep(dec_panel_buildups_2.Face)

dec_secies = DeconstructSpecies(Species=c_script_16.A)  # -> N, LX, RX, TX, LE, RE, TE
cset = CreateSet(List=dec_secies.N)  # -> Set, Map
lng_16 = ListLength(List=cset.Set)
bnd_16 = Bounds(Numbers=flatten(lng_16))
dom_29 = ConstructDomain(DomainStart=Slider(0.105, range=0..1), DomainEnd=Slider(0.784, range=0..1))
remap_25 = RemapNumbers(Value=lng_16, Source=bnd_16, Target=dom_29)  # -> Mapped, Clipped
panel_12 = Panel(remap_25.Mapped)

c_script_18 = CSharpScript(x=brep_2)  # -> out, A; inputs x: tree; same code as c_script_9
c_script_19 = CSharpScript(x=c_script_17.A)  # -> out, A; inputs x: tree of Double
# ---------- c_script_19: C# ----------
    DataTree<double> offsets = new DataTree<double>();

    for(int i = 0; i < x.BranchCount; i++)
    {
      double total = 0;
      for(int j = 0; j < x.Branch(i).Count; j++)
      {
        offsets.Add(total,x.Paths[i]);
        total += x.Branch(i)[j];
      }
    }
    A = offsets;
# ---------- end c_script_19 ----------
offsrf = OffsetSurface(Surface=c_script_18.A, Distance=c_script_19.A, BothSides=0, CreateSolid=False)  # disabled
offsrf_2 = OffsetSurface(Surface=offsrf, Distance=graft(c_script_17.A), BothSides=0, CreateSolid=True)  # -> simplify(Offset); disabled
hsv = ColourHSV(Alpha=Slider(1, range=0..1), Hue=Slider(0.618, range=0..1), Saturation=remap_25.Mapped, Value=1)
trim_8 = TrimTree(Tree=offsrf_2, Depth=1)  # disabled
preview_12 = CustomPreview(Geometry=c_script_18.A, Material=hsv)

brep_3 = Brep(brep_2)
debrep_2 = DeconstructBrep(Brep=brep_3)  # -> Faces, Edges, Vertices
avr_2 = Average(Input=debrep_2.Vertices)
srf_cp = SurfaceClosestPoint(Point=avr_2, Surface=brep_3)  # -> Point, UVPoint, Distance
evalsrf = EvaluateSurface(Surface=brep_3, Point=srf_cp.UVPoint)  # -> Point, Normal, UDirection, VDirection, Frame
pl_4 = ConstructPlane(Origin=evalsrf.Point, XAxis=evalsrf.UDirection, YAxis=evalsrf.VDirection)
cir = Circle(Plane=pl_4, Radius=Slider(10, range=0..10))
alongcrv = SortAlongCurve(Points=debrep_2.Vertices, Curve=cir)  # -> Points, Indices
pline_3 = PolyLine(Vertices=alongcrv.Points, Closed=True)  # -> simplify(Polyline)
pline2msh = PolylineToMesh(Polyline=pline_3, Quadrangulate=True)  # -> flatten(Mesh)
mjoin_3 = MeshJoin(Meshes=pline2msh)
qrmesh = QuadRemesh(Mesh=mjoin_3, Settings=Slider(1000, range=0..3000))  # -> simplify(flatten(QuadResult))

brep_4 = Brep(item_23)
edges = BrepEdges(Brep=brep_4)  # -> Naked, Interior, NonManifold
crv_17 = Curve(edges.Naked)
demesh_2 = DeconstructMesh(Mesh=qrmesh)  # -> Vertices, Faces, Colours, Normals
join_8 = JoinCurves(Curves=crv_17, Preserve=False)
crv_cp = CurveClosestPoint(Point=demesh_2.Vertices, Curve=join_8)  # -> Point, Parameter, Distance
equalst = EqualityWithinTolerance(FirstNumber=crv_cp.Distance, SecondNumber="0", Tolerance=Slider(30, range=0..30))  # -> Equality, Inequality
cull_12 = CullPattern(List=demesh_2.Vertices, CullPattern=equalst.Equality)

pdecon_21 = Deconstruct(Point=cull_12)  # -> XComponent, YComponent, ZComponent
equalst_2 = EqualityWithinTolerance(FirstNumber=pdecon_21.XComponent, SecondNumber="0", Tolerance=0.01)  # -> Equality, Inequality
cull_13 = CullPattern(List=cull_12, CullPattern=equalst_2.Equality)
pdecon_22 = Deconstruct(Point=cull_13)  # -> XComponent, YComponent, ZComponent
sort_9 = SortList(Keys=pdecon_22.ZComponent, ValuesA=cull_13)  # -> Keys, reverse(ValuesA)
item_24 = ListItem(List=sort_9.ValuesA, Index=0, Wrap=True)  # -> Item, Item1
merge_27 = Merge(Data1=item_24.Item, Data2=item_24.Item1)

xz_2 = XZPlane(Origin=Point(0, 0, 0))
project_3 = Project(Geometry=cull_12, Plane=xz_2)  # -> Geometry, Transform
project_4 = Project(Geometry=pt_34, Plane=xz_2)  # -> Geometry, Transform
dist_2 = Distance(PointA=project_4.Geometry, PointB=project_3.Geometry)
sort_10 = SortList(Keys=dist_2, ValuesA=cull_12)  # -> Keys, ValuesA
item_25 = ListItem(List=sort_10.ValuesA, Index=0, Wrap=True)  # -> Item, Item1
merge_28 = Merge(Data1=item_25.Item, Data2=item_25.Item1)
pt_35 = Point(merge_28)

# ---- group: species
data_14 = Data(c_script_16.A)

# ---- group: support points
pt_36 = Point([pt_35, merge_27])

# ----
number_slider_52 = Slider(0.001, range=0..0.001)
mesh_9 = Mesh(qrmesh)
scale = Scale(Geometry=pt_36, Center=Point(0, 0, 0), Factor=number_slider_52)  # -> Geometry, Transform
scale_2 = Scale(Geometry=mesh_9, Center=Point(0, 0, 0), Factor=number_slider_52)  # -> Geometry, Transform

# ---- group: buildups
dec_secies_2 = DeconstructSpecies(Species=data_14)  # -> N, LX, RX, TX, LE, RE, TE
cset_2 = CreateSet(List=dec_secies_2.N)  # -> Set, Map
material_buildups = Panel("""100
200
300
101
201
301""")

# ---- group: buildups / layer count
lng_17 = ListLength(List=dec_secies_2.N)

# ---- group: buildups / material type
lng_18 = ListLength(List=cset_2.Set)

# ---- group: buildups (continued)
c_script_20 = CSharpScript(layerCount=lng_17, materialCount=lng_18)  # -> out, A; inputs layerCount: tree of Int32, materialCount: tree of Int32
# ---------- c_script_20: C# ----------
    DataTree<int> keys = new DataTree<int>();

    for(int i = 0; i < layerCount.BranchCount;i++)
    {
      int lCount = layerCount.Branch(i)[0];
      int mCount = materialCount.Branch(i)[0];
      GH_Path path = materialCount.Paths[i];

      if(lCount == 3 && mCount == 1) keys.Add(0, path);
      if(lCount == 5 && mCount == 1) keys.Add(1, path);
      if(lCount == 7 && mCount == 1) keys.Add(2, path);
      if(lCount == 3 && mCount == 2) keys.Add(3, path);
      if(lCount == 5 && mCount == 2) keys.Add(4, path);
      if(lCount == 7 && mCount == 2) keys.Add(5, path);

    }
    A = keys;
# ---------- end c_script_20 ----------
item_26 = ListItem(List=material_buildups, Index=c_script_20.A, Wrap=True)

# ---- group: material ids
num_52 = Number(item_26)

# ----
facen = FaceNormals(Mesh=qrmesh)  # -> Centers, Normals
trim_9 = TrimTree(Tree=num_52, Depth=1)
brep_5 = Brep(brep_2)
c_script_21 = CSharpScript(breps=flatten(brep_5), points=graft(facen.Centers))  # -> out, A; inputs breps: list of Brep, points: tree of Point3d
# ---------- c_script_21: C# ----------
    DataTree<int> output = new DataTree<int>();

    for(int i = 0; i < breps.Count; i++)
    {
      int[] indicies = new int[points.Branch(i).Count];
      System.Threading.Tasks.Parallel.For(0, points.Branch(i).Count, j =>
        {
        Point3d point;
        ComponentIndex ci;
        double s;
        double t;
        Vector3d normal;

        breps[i].ClosestPoint(points.Branch(i)[j], out point, out ci, out s, out t, 100, out normal);
        indicies[j] = ci.Index;
        });
      output.AddRange(indicies, new GH_Path(i));
    }
    A = output;
# ---------- end c_script_21 ----------
c_script_22 = CSharpScript(breps=flatten(brep_5), points=facen.Centers, tree=num_52)  # -> out, A; inputs breps: list of Brep, points: list of Point3d, tree: tree of Int32
# ---------- c_script_22: C# ----------
    int[] indices = new int[points.Count];

    //for(int i = 0; i < points.Count; i++)
    System.Threading.Tasks.Parallel.For(0, points.Count, i =>
      {
      double closest = double.MaxValue;
      int closestID = 0;
      int closestBrep = 0;
      for(int j = 0; j < breps.Count; j++)
      {
        Point3d point;
        ComponentIndex ci;
        double s;
        double t;
        Vector3d normal;

        if(!breps[j].ClosestPoint(points[i], out point, out ci, out s, out t, 100, out normal))continue;
        if(points[i].DistanceToSquared(point) < closest)
        {
          closest = points[i].DistanceToSquared(point);
          closestID = ci.Index;

          closestBrep = j;
        }
        indices[i] = tree.Branch(closestBrep)[closestID];
        //RhinoApp.WriteLine(closest.ToString());
      }
      });
    A = indices;
# ---------- end c_script_22 ----------
item_27 = ListItem(List=trim_9, Index=c_script_21.A, Wrap=True)

int_2 = Integer(graft(c_script_22.A))
int_3 = Integer(graft(c_script_22.A))
int_4 = Integer(graft(c_script_22.A))
int_5 = Integer(graft(c_script_22.A))
int_6 = Integer(graft(c_script_22.A))
int_7 = Integer(graft(c_script_22.A))
equals = Equality(FirstNumber=int_2, SecondNumber=Slider(300, range=0..1000))  # -> Equality, Inequality
equals_2 = Equality(FirstNumber=int_4, SecondNumber=Slider(201, range=0..1000))  # -> Equality, Inequality
equals_3 = Equality(FirstNumber=int_3, SecondNumber=Slider(101, range=0..1000))  # -> Equality, Inequality
equals_4 = Equality(FirstNumber=int_5, SecondNumber=Slider(301, range=0..1000))  # -> Equality, Inequality
equals_5 = Equality(FirstNumber=int_6, SecondNumber=Slider(200, range=0..1000))  # -> Equality, Inequality
equals_6 = Equality(FirstNumber=int_7, SecondNumber=Slider(100, range=0..1000))  # -> Equality, Inequality
cull_14 = CullPattern(List=division_36, CullPattern=equals.Equality)
cull_15 = CullPattern(List=matprops_3, CullPattern=equals.Equality)
cull_16 = CullPattern(List=matprops_6, CullPattern=equals_2.Equality)
cull_17 = CullPattern(List=matprops_2, CullPattern=equals_3.Equality)
cull_18 = CullPattern(List=division_37, CullPattern=equals_3.Equality)
cull_19 = CullPattern(List=division_38, CullPattern=equals_2.Equality)
cull_20 = CullPattern(List=division_39, CullPattern=equals_4.Equality)
cull_21 = CullPattern(List=matprops_4, CullPattern=equals_4.Equality)
cull_22 = CullPattern(List=matprops_5, CullPattern=equals_5.Equality)
cull_23 = CullPattern(List=division_40, CullPattern=equals_6.Equality)
cull_24 = CullPattern(List=division_41, CullPattern=equals_5.Equality)
cull_25 = CullPattern(List=matprops, CullPattern=equals_6.Equality)
merge_29 = Merge(Data1=cull_17, Data2=cull_25, Data3=cull_16, Data4=cull_22, Data5=cull_21, Data6=cull_15)  # -> flatten(Result)
merge_30 = Merge(Data1=cull_18, Data2=cull_23, Data3=cull_19, Data4=cull_24, Data5=cull_20, Data6=cull_14)  # -> flatten(Result)

# ---- group: Karamba simulation
mesh_10 = Mesh(scale_2.Geometry)
supp = SupportKaramba3D(PosInd=scale.Geometry, menu=[buttons(on, off, on, off, off, off)])
cross_section_2 = CrossSectionKaramba3D(FamilyNameOfCrossSection="DefaultCroSec", Materials=merge_29, Heights_cm=merge_30, mode="Shell - Var")
loads_2 = LoadsKaramba3D(Vector=rev, Mesh=mesh_10, LCase="0", mode="MeshLoad -Const.", menu=[buttons(off, on, off), buttons(on, on)])  # disabled
meshtoshell = MeshToShellKaramba3D(Mesh=mesh_10, CrossSection=cross_section_2, LimitDistance_m=0.005)  # -> Element, Points, Info
assemble = AssembleModelKaramba3D(
    Elem=meshtoshell.Element,
    Support=supp,
    Load=flatten([loads_2, loads]),
    CrossSection=cross_section_2,
    LimitDistance_m=0.005)  # -> Model, Info, Mass_kg, CenterOfGravity, LoadCaseNames

# ----
analyze = AnalyzeKaramba3D(Model=assemble.Model)  # -> CalculatedModel, MaximumDisplacement_cm, ResultingForceOfGravity_kN, ElasticEnergyChange_kNm

# ---- group: Karamba simulation (continued)
modelview = ModelViewKaramba3D(Model=analyze.CalculatedModel, ResultFactors=1, ResultCase=-1)  # -> Model, DeformedMesh, DeformedAxes, DeformedModel
shellview = ShellViewKaramba3D(Model=modelview.Model, IndexOfLayer=0)  # -> Model, MeshesOfRenderedShells, LegendColors, LegendTags
mesh_11 = Mesh(shellview.MeshesOfRenderedShells)

# ----
legend = Legend(Colour=shellview.LegendColors, Tags=shellview.LegendTags, LegendType=1)
scale_3 = Scale(Geometry=mesh_11, Center=Point(0, 0, 0), Factor=Slider(1000, range=0..50000))  # -> Geometry, Transform
mesh_12 = Mesh(scale_3.Geometry)
move_29 = Move(Geometry=mesh_12, Motion=X)  # -> Geometry, Transform

null = NullItem(Item=analyze.MaximumDisplacement_cm)  # -> NullFlags, InvalidFlags, Description
cull_26 = CullPattern(List=Slider(1000, range=0..1000), CullPattern=null.NullFlags)
merge_31 = Merge(Data1=analyze.MaximumDisplacement_cm, Data2=cull_26)  # -> flatten(Result)
clean_2 = CleanTree(RemoveNulls=True, RemoveInvalid=True, RemoveEmpty=False, Tree=merge_31)
num_53 = Number(flatten(clean_2))

panel_13 = Panel(num_53)
addition_59 = Addition(A=num_50, B=num_53)
num_54 = Number(addition_59)

panel_14 = Panel(num_54)
