# Grasshopper definition BilayerDesign Thickness Update.gh (Grasshopper 1.0.7)
# plug-ins: Sofistik, Telepathy, HygroDesign, Pufferfish, MeshEdit Components, Karamba3D, Kangaroo2 Components, Weaverbird, Human, LunchBox, Wombat

update = Button()
python = GhPythonScript(update=update)  # inputs update: Boolean
# ---------- python: Python ----------
# Seghier Mohamed Abdelaziz - 2021 - seghierdesign@gmail.com

import Grasshopper as gh

ghDoc = ghenv.Component.OnPingDocument()
objects = ghDoc.Objects

object = []

for obj in objects: 

    if obj.NickName.Length == 0:
        if str(obj.RemovedFromDocument.DeclaringType) == "Grasshopper.Kernel.GH_Component":
            object.append(obj)
                
if update == True:
    gh.Kernel.GH_Document.NewSolution(ghDoc,False)
    for o in object:
        gh.Kernel.GH_Document.RemoveObject(ghDoc ,o,False)
# ---------- end python ----------

# ---- group: beech
species = WoodSpecies(
    Name="beech",
    LExpansion=Slider(0.0001, range=0..0.0001),
    RExpansion=Slider(0.002, range=0..1),
    TExpansion=Slider(0.0041, range=0..1),
    LElasticModulus=Slider(14000, range=0..20000),
    RElasticModulus=Slider(2280, range=0..20000),
    TElasticModulus=Slider(1160, range=0..20000))

# ---- group: spruce
species_2 = WoodSpecies(
    Name="spruce",
    LExpansion=Slider(0.0001, range=0..0.0001),
    RExpansion=Slider(0.0019, range=0..1),
    TExpansion=Slider(0.0036, range=0..1),
    LElasticModulus=Slider(10000, range=0..20000),
    RElasticModulus=Slider(800, range=0..20000),
    TElasticModulus=Slider(450, range=0..20000))

# ---- group: must be even
number_slider = Slider(4, range=0..10)

# ----
int = Integer(number_slider)

number_slider_2 = Slider(150, range=0..10000)
number_slider_3 = Slider(4, range=0..10)
number_slider_4 = Slider(2500, range=0..10000)
number_slider_5 = Slider(31, range=0..100)
xy = XYPlane(Origin=Point(0, 0, 0))
multiplication = Multiplication(A=number_slider_5, B=number_slider_2)
multiplication_2 = Multiplication(A=number_slider_4, B=number_slider_3)
bilayer = Bilayer(
    BasePlane=xy,
    BoardWidth=number_slider_2,
    BoardLength=number_slider_4,
    WidthCount=number_slider_5,
    LengthCount=number_slider_3,
    ActiveThickness=Slider(20, range=0..100),
    PassiveThickness=Slider(4, range=0..100),
    PassiveSpecies=species_2,
    RegionCount=int)
rectangle = Rectangle(Plane=PlaneXY(0, 0, 0), XSize=multiplication_2, YSize=multiplication, Radius=0)  # -> Rectangle, Length
num = Number(number_slider_2)
num_2 = Number(number_slider_4)

number_slider_6 = Slider(1000, range=0..1000)
neg = Negative(Value=number_slider_6)
rectangle_2 = Rectangle(Plane=PlaneXY(0, 0, 0), XSize=number_slider_6, YSize=neg, Radius=0)  # -> Rectangle, Length
drec = DeconstuctRectangle(Rectangle=rectangle_2.Rectangle)  # -> BasePlane, XInterval, YInterval
dedomain = DeconstructDomain(Domain=drec.XInterval)  # -> Start, End
dedomain_2 = DeconstructDomain(Domain=drec.YInterval)  # -> Start, End
pt = ConstructPoint(XCoordinate=dedomain.Start, YCoordinate=0, ZCoordinate=0)
pt_2 = ConstructPoint(XCoordinate=dedomain.End, YCoordinate=0, ZCoordinate=0)
subtraction = Subtraction(A=dedomain_2.End, B=dedomain_2.Start)
ln = Line(StartPoint=pt, EndPoint=pt_2)
number_slider_7 = Slider(0.6, range=0.5..1)
number_slider_8 = Slider(0.4, range=0..0.5)
divide = DivideCurve(Curve=ln, Count=expr("x-1", Slider(3, range=0..10)), Kinks=False)  # -> Points, Tangents, Parameters
multiplication_3 = Multiplication(A=subtraction, B=Slider(1, range=0.5..1))
multiplication_4 = Multiplication(A=subtraction, B=Slider(0.2, range=0..0.5))
multiplication_5 = Multiplication(A=subtraction, B=Slider(0.8, range=0.5..1))
multiplication_6 = Multiplication(A=subtraction, B=Slider(0.3, range=0..1))
multiplication_7 = Multiplication(A=subtraction, B=number_slider_7)
multiplication_8 = Multiplication(A=subtraction, B=number_slider_7)
neg_2 = Negative(Value=multiplication_4)
neg_3 = Negative(Value=multiplication_3)
neg_4 = Negative(Value=multiplication_6)
neg_5 = Negative(Value=multiplication_5)
neg_6 = Negative(Value=multiplication_8)
neg_7 = Negative(Value=multiplication_7)
item = ListItem(List=divide.Points, Index=0, Wrap=True)  # -> Item, Item1, Item2
Y = UnitY(Factor=neg_2)
Y_2 = UnitY(Factor=neg_4)
Y_3 = UnitY(Factor=neg_3)
Y_4 = UnitY(Factor=neg_5)
Y_5 = UnitY(Factor=neg_6)
Y_6 = UnitY(Factor=neg_7)
move = Move(Geometry=[item.Item, item.Item2], Motion=Y)  # -> Geometry, Transform
move_2 = Move(Geometry=item.Item1, Motion=Y_3)  # -> Geometry, Transform
move_3 = Move(Geometry=[item.Item, item.Item2], Motion=Y_2)  # -> Geometry, Transform
move_4 = Move(Geometry=item.Item1, Motion=Y_4)  # -> Geometry, Transform
move_5 = Move(Geometry=[item.Item, item.Item2], Motion=Y_5)  # -> Geometry, Transform
move_6 = Move(Geometry=item.Item1, Motion=Y_6)  # -> Geometry, Transform
item_2 = ListItem(List=move.Geometry, Index=0, Wrap=True)  # -> Item, Item1
item_3 = ListItem(List=move_3.Geometry, Index=0, Wrap=True)  # -> Item, Item1
item_4 = ListItem(List=move_5.Geometry, Index=0, Wrap=True)  # -> Item, Item1
merge = Merge(Data1=flatten(item_2.Item), Data2=flatten(move_2.Geometry), Data3=flatten(item_2.Item1))
merge_2 = Merge(Data1=flatten(item_3.Item), Data2=flatten(move_4.Geometry), Data3=flatten(item_3.Item1))
merge_3 = Merge(Data1=flatten(item_4.Item), Data2=flatten(move_6.Geometry), Data3=flatten(item_4.Item1))
intcrv = Interpolate(Vertices=merge, Degree=3, Periodic=False, KnotStyle=1)  # -> Curve, Length, Domain
intcrv_2 = Interpolate(Vertices=merge_2, Degree=3, Periodic=False, KnotStyle=1)  # -> Curve, Length, Domain
intcrv_3 = Interpolate(Vertices=merge_3, Degree=3, Periodic=False, KnotStyle=1)  # -> Curve, Length, Domain
merge_4 = Merge(Data1=intcrv.Curve, Data2=intcrv_2.Curve, Data3=intcrv_3.Curve)
rec = Rectangle(rectangle_2.Rectangle)

board_count = Slider(500, range=0..500)

# ---- group: name
num_3 = Number(board_count)
series = Series(Start=0, Step=1, Count=num_3)
dup = DuplicateData(Data="S", Number=num_3, Order=True)  # -> graft(Data)
txt = Text(graft(series))
merge_5 = Merge(Data1=dup, Data2=txt)  # -> simplify(Result)
join = TextJoin(Text=merge_5)  # -> flatten(Result)

# ---- group: active thickness
number_slider_9 = Slider(20, range=0..100)

# ---- group: RT
dom = ConstructDomain(DomainStart=Slider(15, range=0..100), DomainEnd=Slider(75, range=0..100))
random = Random(Range=dom, Number=board_count, Seed=Slider(225, range=0..1000))

# ---- group: name
num_4 = Number(board_count)
series_2 = Series(Start=0, Step=1, Count=num_4)
dup_2 = DuplicateData(Data="B", Number=num_4, Order=True)  # -> graft(Data)
txt_2 = Text(graft(series_2))
merge_6 = Merge(Data1=dup_2, Data2=txt_2)  # -> simplify(Result)
join_2 = TextJoin(Text=merge_6)  # -> flatten(Result)

# ---- group: thickness
num_5 = Number(number_slider_9)
num_6 = Number(board_count)
dup_3 = DuplicateData(Data=num_5, Number=num_6, Order=True)

# ---- group: length
num_7 = Number(num_2)
num_8 = Number(board_count)
dup_4 = DuplicateData(Data=num_7, Number=num_8, Order=True)

# ---- group: width
num_9 = Number(num)
num_10 = Number(board_count)
dup_5 = DuplicateData(Data=num_9, Number=num_10, Order=True)

# ---- group: beech
data = Data(species)

# ---- group: spruce
data_2 = Data(species_2)

# ---- group: bounding rectangle input (rectangle y domain represents full range of radii from stockpiles)
rec_2 = Rectangle(rec)

# ----
stock_boards = StockBoards(Name=join_2, Species=data, Thickness=dup_3, Length=dup_4, Width=dup_5, RTAngle=random)
stock_boards_2 = StockBoards(Name=join, Species=data_2, Thickness=dup_3, Length=dup_4, Width=dup_5, RTAngle=random)
merge_7 = Merge(Data1=stock_boards, Data2=stock_boards_2)

# ---- group: curve controller inputs (represents distribution of radii along a given cross section)
crv = Curve(merge_4)

# ----
crv_2 = Curve(crv)
lng = ListLength(List=crv_2)  # -> expr("x-2", Length)
dom_2 = ConstructDomain(DomainStart=0, DomainEnd=lng)
subset = SubList(List=crv_2, Domain=dom_2, Wrap=True)  # -> graft(List), Index
shift = ShiftList(List=crv_2, Shift=1, Wrap=False)  # -> graft(List)
merge_8 = Merge(Data1=subset.List, Data2=shift)  # -> simplify(Result)
group = Group(Objects=merge_8)  # -> flatten(Group)

deconstruct_bilayer = DeconstructBilayer(Bilayer=bilayer)
dec_board = DeconstructBoard(Board=deconstruct_bilayer)  # -> Polyline, Name, Species, RTAngle, MoistureChange, DesiredRadius, Radius, BlendedRadius, BoardRegions
area = Area(Geometry=dec_board.Polyline)  # -> Area, Centroid
c_script = CSharpScript(rects=flatten(dec_board.Polyline))  # -> out; inputs rects: list of Rectangle3d; disabled
# ---------- c_script: C# usings ----------
using Rhino.DocObjects;
# ---------- c_script: C# ----------
    var object_enumerator_settings = new ObjectEnumeratorSettings();

    var rhinoObjects = RhinoDoc.ActiveDoc.Objects.GetObjectList(object_enumerator_settings);
    var objectTable = RhinoDoc.ActiveDoc.Objects;

    foreach( var rhinoObject in rhinoObjects)
    {
      if(rhinoObject.ObjectType == ObjectType.Curve)
      {
        Curve rhinoCurve = rhinoObject.Geometry as Curve;
        if(rhinoCurve.IsClosed)objectTable.Delete(rhinoObject);
      }
    }

    foreach(var rect in rects)objectTable.AddCurve(rect.ToNurbsCurve());
# ---------- end c_script ----------
pt_3 = Point(simplify(area.Centroid))

# ---- group: generate distribution
pt_4 = Point(simplify(pt_3))
data_3 = Data(group)
pdecon = Deconstruct(Point=pt_4)  # -> XComponent, YComponent, ZComponent
bnd = Bounds(Numbers=flatten(pdecon.XComponent))
bnd_2 = Bounds(Numbers=flatten(pdecon.YComponent))
lng_2 = ListLength(List=data_3)
dedomain_3 = DeconstructDomain(Domain=bnd)  # -> Start, End
remap = RemapNumbers(Value=pdecon.YComponent, Source=bnd_2, Target=Domain(0, 1))  # -> graft(Mapped), Clipped
c_script_2 = CSharpScript(count=lng_2, start=dedomain_3.Start, end=dedomain_3.End)  # -> out, A; inputs count: Int32, start: Double, end: Double
# ---------- c_script_2: C# ----------
    double totalLength = end - start;
    double domLength = totalLength / (double) count;

    List<Interval> intervals = new List<Interval>();
    double currentStart = start;
    for(int i = 0; i < count; i++)
    {
      intervals.Add(new Interval(currentStart, currentStart + domLength));
      currentStart += domLength;
    }
    A = intervals;
# ---------- end c_script_2 ----------
num_11 = Number(graft(pdecon.XComponent))
inc = Includes(Value=num_11, Domain=simplify(c_script_2.A))  # -> Includes, Deviation
cull = CullPattern(List=data_3, CullPattern=inc.Includes)
item_5 = ListItem(List=cull, Index=0, Wrap=True)
cull_2 = CullPattern(List=c_script_2.A, CullPattern=inc.Includes)
ungroup = Ungroup(Group=item_5)  # -> simplify(Objects)
item_6 = ListItem(List=cull_2, Index=0, Wrap=True)
remap_2 = RemapNumbers(Value=num_11, Source=item_6, Target=Domain(0, 1))  # -> Mapped, Clipped
eval = EvaluateCurve(Curve=reparameterize(ungroup), Parameter=remap.Mapped)  # -> Point, Tangent, Angle
pdecon_2 = Deconstruct(Point=eval.Point)  # -> XComponent, YComponent, ZComponent
item_7 = ListItem(List=pdecon_2.YComponent, Index=0, Wrap=True)  # -> Item, Item1
twn2nums = TweenTwoNumbers(NumberA=item_7.Item, NumberB=item_7.Item1, Factor=remap_2.Mapped)
num_12 = Number(twn2nums)

# ----
bbox = BoundingBox(Content=dec_board.Polyline, Plane=PlaneXY(0, 0, 0), UnionBox=True)  # -> Box, Box_2
debox = DeconstructBox(Box=bbox.Box)  # -> Plane, X, Y, Z
dedomain_4 = DeconstructDomain(Domain=debox.X)  # -> Start, End
dedomain_5 = DeconstructDomain(Domain=debox.Y)  # -> Start, End
pt_5 = ConstructPoint(XCoordinate=dedomain_4.End, YCoordinate=dedomain_5.End, ZCoordinate=0)
pt_6 = ConstructPoint(XCoordinate=dedomain_4.Start, YCoordinate=dedomain_5.End, ZCoordinate=0)
pt_7 = ConstructPoint(XCoordinate=dedomain_4.Start, YCoordinate=dedomain_5.Start, ZCoordinate=0)
pt_8 = ConstructPoint(XCoordinate=dedomain_4.End, YCoordinate=dedomain_5.Start, ZCoordinate=0)
merge_9 = Merge(Data1=pt_5, Data2=pt_6, Data3=pt_7, Data4=pt_8)
nurbs = NurbsCurve(Vertices=merge_9, Degree=3, Periodic=False)  # -> Curve, Length, Domain

# ---- group: material / beech
data_4 = Data(species)

# ---- group: material / Species
crv_3 = Curve(nurbs.Curve)

# ---- group: material / spruce
data_5 = Data(species_2)

# ---- group: material
pt_9 = Point(graft(pt_3))
xz = XZPlane(Origin=pt_9)
pcx = CurvePlane(Curve=crv_3, Plane=xz)  # -> simplify(Points), ParamsC, ParamsP
pdecon_3 = Deconstruct(Point=pcx.Points)  # -> XComponent, YComponent, ZComponent
pdecon_4 = Deconstruct(Point=pt_9)  # -> XComponent, YComponent, ZComponent
smaller = SmallerThan(FirstNumber=pdecon_3.XComponent, SecondNumber=pdecon_4.XComponent)  # -> SmallerThan, OrEqualTo
not = GateNot(A=smaller.SmallerThan)
cull_3 = CullPattern(List=data_4, CullPattern=not)
cull_4 = CullPattern(List=data_5, CullPattern=smaller.SmallerThan)
merge_10 = Merge(Data1=cull_3, Data2=cull_4)  # -> simplify(Result)
path_mapper = PathMapper(merge_10, source="{A}", target="{0}")

# ---- group: Thickness
dec_reg = DeconstructBoardRegion(BoardRegion=dec_board.BoardRegions)  # -> Polyline, Name, Species, RTAngle, MoistureChange, DesiredRadius, Radius, BlendedRadius, ThicknessBlendedRadius
area_2 = Area(Geometry=dec_reg.Polyline)  # -> Area, Centroid
pt_10 = Point(simplify(area_2.Centroid))
pdecon_5 = Deconstruct(Point=pt_10)  # -> XComponent, YComponent, ZComponent
bnd_3 = Bounds(Numbers=flatten(pdecon_5.XComponent))
dom_3 = ConstructDomain(DomainStart=Slider(1.2, range=0..1.2), DomainEnd=Slider(0.2, range=0..1))
remap_3 = RemapNumbers(Value=pdecon_5.XComponent, Source=bnd_3, Target=dom_3)  # -> Mapped, Clipped

# ----
pt_11 = Point(pt_3)
pdecon_6 = Deconstruct(Point=pt_11)  # -> XComponent, YComponent, ZComponent
bnd_4 = Bounds(Numbers=flatten(pdecon_6.XComponent))
dom_4 = ConstructDomain(DomainStart="1", DomainEnd="0")
remap_4 = RemapNumbers(Value=pdecon_6.XComponent, Source=bnd_4, Target=dom_4)  # -> simplify(Mapped), Clipped

num_13 = Number(num_12)
rec_3 = Rectangle(rec_2)
drec_2 = DeconstuctRectangle(Rectangle=rec_3)  # -> BasePlane, XInterval, YInterval
dom_5 = ConstructDomain(DomainStart=0, DomainEnd=1)
remap_5 = RemapNumbers(Value=num_13, Source=drec_2.YInterval, Target=dom_5)  # -> Mapped, Clipped
trim = TrimTree(Tree=remap_5.Mapped, Depth=1)

data_6 = Data(bilayer)

update_bilayer = UpdateBilayer(Bilayer=data_6, Radius=trim, RadiusWeight=remap_4.Mapped, Material=path_mapper)
dup_bilayer = DuplicateBilayer(Bilayer=update_bilayer, Count=Slider(3, range=0..10))
panel = Panel(Bilayers=dup_bilayer)
adjust_cro_sec = AdjustCrossSection(Panel=panel, Thicknesses=remap_3.Mapped)
dup_panel = DuplicatePanel(Panel=adjust_cro_sec, Count=Slider(3, range=0..10))

# ---- group: moisture changes
panel_2 = Panel("""2
4
8
12""")
num_14 = Number(panel_2)

# ----
data_7 = Data(merge_7)
design_env = DesignEnvironment(Panels=dup_panel, StockBoards=data_7, MoistureChanges=num_14)  # -> Panels, StockBoards
convolution = CurvatureConvolution(
    Panels=design_env.Panels,
    TengentialBlending=Slider(1, range=0.01..3),
    LongitudinalBlending=Slider(1, range=0.01..3),
    MaxRadiusInfluence=100000,
    StiffnessFactor=0.1,
    ThicknessFactor=0.1,
    VisualizeBoardWeights=0)  # -> Panels, Weights

cross_section = BooleanToggle(True)  # disabled
relaxation = BooleanToggle(False)  # disabled
cull_5 = CullPattern(List=convolution.Panels, CullPattern=cross_section)  # disabled

item_8 = ListItem(List=convolution.Panels, Index=0, Wrap=True)  # -> Item, Item1
deconstruct_panel = DeconstructPanel(Panel=item_8.Item)
deconstruct_bilayer_2 = DeconstructBilayer(Bilayer=deconstruct_panel)
dec_board_2 = DeconstructBoard(Board=deconstruct_bilayer_2)  # -> Polyline, Name, Species, RTAngle, MoistureChange, DesiredRadius, Radius, BlendedRadius, BoardRegions
display_panel = DisplayPanels(Panels=item_8.Item)  # -> ActiveBoards, PassiveBoards
dec_reg_2 = DeconstructBoardRegion(BoardRegion=dec_board_2.BoardRegions)  # -> Polyline, Name, Species, RTAngle, MoistureChange, DesiredRadius, Radius, BlendedRadius, ThicknessBlendedRadius

crosecset = UniqueCrossSections(Panel=cull_5)  # disabled
dec_reg_3 = DeconstructBoardRegion(BoardRegion=crosecset)  # -> Polyline, Name, Species, RTAngle, MoistureChange, DesiredRadius, Radius, BlendedRadius, ThicknessBlendedRadius; disabled

bbox_2 = BoundingBox(Content=flatten(dec_reg_2.Polyline), Plane=PlaneXY(0, 0, 0), UnionBox=True)  # -> Box, Box_2
debox_2 = DeconstructBox(Box=bbox_2.Box)  # -> Plane, X, Y, Z
dedomain_6 = DeconstructDomain(Domain=debox_2.Y)  # -> Start, End
subtraction_2 = Subtraction(A=dedomain_6.End, B=dedomain_6.Start)
multiplication_9 = Multiplication(A=subtraction_2, B="1.5")
series_3 = Series(Start=Slider(10000, range=0..10000), Step=multiplication_9, Count=Slider(5, range=0..10))
item_9 = ListItem(List=series_3, Index=0, Wrap=True)  # -> Item, Item1, Item2, Item3, Item4

bnd_5 = Bounds(Numbers=flatten(dec_reg_2.BlendedRadius))
division = Division(A=int, B=2)  # disabled
panel_3 = Panel(bnd_5)
c_script_3 = CSharpScript(tree=dec_reg_3.Polyline, downsample=division)  # -> out, A; inputs tree: tree, downsample: Int32; disabled
# ---------- c_script_3: C# ----------
    DataTree<object> output = new DataTree<object>();
    for(int i = 0; i < tree.BranchCount; i++)
    {
      if(tree.Paths[i][1] % downsample == 0)
      {
        output.AddRange(tree.Branch(i), tree.Paths[i]);
      }
    }
    A = output;
# ---------- end c_script_3 ----------
c_script_4 = CSharpScript(tree=dec_reg_3.ThicknessBlendedRadius, downsample=division)  # -> out, A; inputs tree: tree, downsample: Int32; disabled; same code as c_script_3

bnd_6 = Bounds(Numbers=flatten(dec_reg_2.ThicknessBlendedRadius))
dedomain_7 = DeconstructDomain(Domain=bnd_6)  # -> Start, End
Y_7 = UnitY(Factor=item_9.Item)
gradient = Gradient(
    LowerLimit=dedomain_7.Start,
    UpperLimit=dedomain_7.End,
    Parameter=dec_reg_2.ThicknessBlendedRadius,
    stops=[0: RGB(255, 255, 255), 1: RGB(0, 0, 0)])
vec = Vector(Y_7)
move_7 = Move(Geometry=display_panel.ActiveBoards, Motion=vec)  # -> Geometry, Transform
move_8 = Move(Geometry=display_panel.PassiveBoards, Motion=vec)  # -> Geometry, Transform
area_3 = Area(Geometry=move_7.Geometry)  # -> Area, Centroid
Z = UnitZ(Factor=Slider(10, range=0..10))
move_9 = Move(Geometry=area_3.Centroid, Motion=Z)  # -> Geometry, Transform
round = Round(Number=dec_reg_2.ThicknessBlendedRadius)  # -> Nearest, Floor, Ceiling
preview = CustomPreview(Geometry=move_8.Geometry, Material=gradient)
tag = TextTag3D(Location=move_9.Geometry, Text=round.Nearest, Size=Slider(100, range=0..100), Colour=RGB(255, 0, 0), Justification=5)
preview_2 = CustomPreview(Geometry=move_7.Geometry, Material=gradient)

panel_4 = Panel(bnd_6)

python_2 = GhPythonScript(x=dec_reg_2.Species)  # -> out, a
# ---------- python_2: Python ----------
a = x.Name
# ---------- end python_2 ----------
len = TextLength(Text=python_2.a)
bnd_7 = Bounds(Numbers=flatten(len))
dedomain_8 = DeconstructDomain(Domain=bnd_7)  # -> Start, End
gradient_2 = Gradient(
    LowerLimit=dedomain_8.Start,
    UpperLimit=dedomain_8.End,
    Parameter=len,
    stops=[0: RGB(80, 55, 25), 0.5: RGB(159, 65, 29), 1: RGB(174, 166, 129)])
Y_8 = UnitY(Factor=item_9.Item4)
vec_2 = Vector(Y_8)
move_10 = Move(Geometry=display_panel.ActiveBoards, Motion=vec_2)  # -> Geometry, Transform
move_11 = Move(Geometry=display_panel.PassiveBoards, Motion=vec_2)  # -> Geometry, Transform
preview_3 = CustomPreview(Geometry=move_10.Geometry, Material=gradient_2)
preview_4 = CustomPreview(Geometry=move_11.Geometry, Material=ColourSwatch(SwatchColor=RGB(115, 115, 115)))

bnd_8 = Bounds(Numbers=flatten(dec_reg_2.RTAngle))
dedomain_9 = DeconstructDomain(Domain=bnd_8)  # -> Start, End
gradient_3 = Gradient(
    LowerLimit=dedomain_9.Start,
    UpperLimit=dedomain_9.End,
    Parameter=dec_reg_2.RTAngle,
    stops=[0: RGB(124, 0, 219), 1: RGB(207, 130, 255)])
Y_9 = UnitY(Factor=item_9.Item2)
vec_3 = Vector(Y_9)
move_12 = Move(Geometry=display_panel.ActiveBoards, Motion=vec_3)  # -> Geometry, Transform
move_13 = Move(Geometry=display_panel.PassiveBoards, Motion=vec_3)  # -> Geometry, Transform
preview_5 = CustomPreview(Geometry=move_12.Geometry, Material=gradient_3)
preview_6 = CustomPreview(Geometry=move_13.Geometry, Material=ColourSwatch(SwatchColor=RGB(115, 115, 115)))

bnd_9 = Bounds(Numbers=flatten(dec_reg_2.MoistureChange))
dedomain_10 = DeconstructDomain(Domain=bnd_9)  # -> Start, End
Y_10 = UnitY(Factor=item_9.Item3)
gradient_4 = Gradient(
    LowerLimit=dedomain_10.Start,
    UpperLimit=dedomain_10.End,
    Parameter=dec_reg_2.MoistureChange,
    stops=[0: RGB(180, 239, 240), 0.502: RGB(122, 194, 214), 1: RGB(120, 176, 222)])
vec_4 = Vector(Y_10)
move_14 = Move(Geometry=display_panel.ActiveBoards, Motion=vec_4)  # -> Geometry, Transform
move_15 = Move(Geometry=display_panel.PassiveBoards, Motion=vec_4)  # -> Geometry, Transform
preview_7 = CustomPreview(Geometry=move_14.Geometry, Material=gradient_4)
preview_8 = CustomPreview(Geometry=move_15.Geometry, Material=ColourSwatch(SwatchColor=RGB(115, 115, 115)))

c_script_5 = CSharpScript(desired=dec_reg_2.DesiredRadius, actual=dec_reg_2.ThicknessBlendedRadius)  # -> out, A; inputs desired: Double, actual: Double
# ---------- c_script_5: C# ----------
    A = 100 * Math.Abs(desired - actual) / ((desired + actual) / 2);
# ---------- end c_script_5 ----------
Y_11 = UnitY(Factor=item_9.Item1)
gradient_5 = Gradient(LowerLimit=0, UpperLimit="100", Parameter=c_script_5.A, stops=[0.15: RGB(255, 130, 160), 0.85: RGB(220, 0, 40)])
vec_5 = Vector(Y_11)
move_16 = Move(Geometry=display_panel.ActiveBoards, Motion=vec_5)  # -> Geometry, Transform
move_17 = Move(Geometry=display_panel.PassiveBoards, Motion=vec_5)  # -> Geometry, Transform
swatch = ColourSwatch(SwatchColor=RGBA(0, 0, 0, 66))
preview_9 = CustomPreview(Geometry=move_16.Geometry, Material=gradient_5)
preview_10 = CustomPreview(Geometry=move_17.Geometry, Material=gradient_5)

c_script_6 = CSharpScript(x=c_script_4.A)  # -> out, A; inputs x: tree; disabled
# ---------- c_script_6: C# ----------
    DataTree<object> output = new DataTree<object>();
    int firstIndex = 0;
    int branchCount = 0;
    for(int i = 0; i < x.BranchCount; i++)
    {
      GH_Path path = new GH_Path(firstIndex, branchCount);
      if(x.Paths[i][0] == firstIndex)
      {
        output.AddRange(x.Branch(i), path);
      }
      else
      {
        firstIndex++;
        branchCount = -1;
        i--;
      }
      branchCount++;
    }
    A = output;
# ---------- end c_script_6 ----------
panel_5 = Panel("-1")  # disabled
number_slider_10 = Slider(1, range=0..100000)  # disabled

cull_6 = CullPattern(List=cull_5, CullPattern=cross_section)
deconstruct_panel_2 = DeconstructPanel(Panel=cull_6)
deconstruct_bilayer_3 = DeconstructBilayer(Bilayer=deconstruct_panel_2)
dec_board_3 = DeconstructBoard(Board=deconstruct_bilayer_3)  # -> Polyline, Name, Species, RTAngle, MoistureChange, DesiredRadius, Radius, BlendedRadius, BoardRegions
dec_reg_4 = DeconstructBoardRegion(BoardRegion=dec_board_3.BoardRegions)  # -> Polyline, ThicknessBlendedRadius, Species, MoistureChange, DesiredRadius, Radius, BlendedRadius, ThicknessBlendedRadius_2, ThicknessBlendedRadius_3

support = RemoteSender(<missing>)
support_2 = RemoteReceiver(support)
node_sofistik = NodeSofistik(<missing>)
support_sofistik = SupportSofistik(flatten(<missing>))
load_sofistik = LoadSofistik(<missing>)

crv_4 = Curve(c_script_3.A)  # disabled
area_4 = Area(Geometry=crv_4)  # -> Area, Centroid; disabled
bbox_3 = BoundingBox(Content=flatten(dec_reg_3.Polyline), Plane=PlaneXY(0, 0, 0), UnionBox=True)  # -> Box, Box_2; disabled
avr = Average(Input=area_4.Centroid)  # disabled
debox_3 = DeconstructBox(Box=bbox_3.Box)  # -> Plane, X, Y, Z; disabled

pdecon_7 = Deconstruct(Point=avr)  # -> XComponent, YComponent, ZComponent; disabled
trim_2 = TrimTree(Tree=pdecon_7.XComponent, Depth=1)  # disabled
bnd_10 = Bounds(Numbers=trim_2)  # disabled

remap_6 = RemapNumbers(Value=pdecon_7.XComponent, Source=bnd_10, Target=debox_3.X)  # -> Mapped, Clipped; disabled
pt_12 = ConstructPoint(XCoordinate=remap_6.Mapped, YCoordinate=pdecon_7.YComponent, ZCoordinate=pdecon_7.ZComponent)  # disabled
yz = YZPlane(Origin=pt_12)  # disabled

c_script_7 = CSharpScript(x=yz)  # -> out, A; inputs x: tree; disabled; same code as c_script_6

num_15 = Number(num)  # disabled
num_16 = Number(c_script_6.A)  # disabled
pln = Plane(c_script_7.A)  # disabled
c_script_8 = CSharpScript(iRadii=num_16, iBoardWidth=num_15, iPlanes=pln)  # -> out, simplify(A); inputs iRadii: tree of Double, iBoardWidth: Double, iPlanes: tree of Plane; disabled
# ---------- c_script_8: C# ----------
    DataTree<Point3d> pointTree = new DataTree<Point3d>();

    for (int j = 0; j < iRadii.BranchCount; j++)
    {

      //initialize variables
      Plane bp = iPlanes.Branch(j)[0];
      Point3d startPoint = new Point3d(bp.Origin);
      Point3d centerPoint = startPoint;
      Vector3d rotationAxis = new Vector3d(bp.ZAxis);
      Vector3d centerPointVect = new Vector3d(bp.YAxis);
      centerPointVect.Rotate(Math.PI / 2, rotationAxis);

      for (int i = 0; i < iRadii.Branch(j).Count; i++){
        GH_Path pth = iRadii.Paths[j].AppendElement(i);
        Point3d point1 = startPoint;
        Point3d point2 = startPoint;

        pointTree.Add(point1, pth);

        //calculate rotation angle
        Double arcLength = iBoardWidth;
        Double radius = iRadii.Branch(j)[i];
        Double rotation = (arcLength / radius);

        //calculate rotation center point
        centerPointVect.Unitize();
        centerPointVect *= radius;
        centerPoint += centerPointVect;


        //execute half rotation
        Transform tx = Transform.Rotation(rotation / 2, rotationAxis, centerPoint);


        point2.Transform(tx);
        pointTree.Add(point2, pth);

        //execute full rotation
        tx = Transform.Rotation(rotation, rotationAxis, centerPoint);
        startPoint.Transform(tx);
        pointTree.Add(startPoint, pth);

        //updata rotation parameters
        centerPoint = startPoint;
        centerPointVect.Transform(tx);
      }
    }
    A = pointTree;
# ---------- end c_script_8 ----------

trim_3 = TrimTree(Tree=c_script_8.A, Depth=1)  # disabled
cullpt = CullDuplicates(Points=trim_3, Tolerance=0.1, CullMode=3)  # -> Points, Indices, Valence; disabled
pt_13 = Point(cullpt.Points)  # disabled

# ---- group: animate
number_slider_11 = Slider(1, range=0..1)  # disabled
pt_14 = Point(simplify(pt_13))  # disabled
pln_2 = Plane(graft(pln))  # disabled
num_17 = Number(number_slider_11)  # disabled
c_script_9 = CSharpScript(iPoints=simplify(pt_14), iPlanes=pln_2, iShapeFactor=num_17)  # -> out, A; inputs iPoints: tree of Point3d, iPlanes: tree of Plane, iShapeFactor: Double; disabled
# ---------- c_script_9: C# ----------
    DataTree<Point3d> output = new DataTree<Point3d>();
    
    double shapeFactor = 1.0 - iShapeFactor;

    //step through curves
    for (int i = 0; i < iPoints.BranchCount; i++)
    {
      Plane currentPlane = iPlanes.Branch(iPoints.Path(i)[0])[0];

      //get vectors from plane
      Vector3d zVect = currentPlane.YAxis;

      Vector3d rotVect = currentPlane.ZAxis;

      //create new startpoint inside list
      Point3d startPoint = iPoints.Branch(i)[0];

      //step through points. Create and rotate vectors
      for (int j = 0; j < iPoints.Branch(i).Count; j++)
      {
        if (j == 0) output.Add(startPoint, iPoints.Path(i));
        else{
          //create current segment vector
          Vector3d segmentVect = new Vector3d(iPoints.Branch(i)[j] - iPoints.Branch(i)[j - 1]);

          //measure angle with vertical vector
          double angle = Vector3d.VectorAngle(zVect, segmentVect, currentPlane);

          //rotate
          segmentVect.Rotate(-angle * shapeFactor, rotVect);

          startPoint += segmentVect;
          output.Add(startPoint, iPoints.Path(i));
        }
      }
    }

    A = output;
# ---------- end c_script_9 ----------
pt_15 = Point(c_script_9.A)  # disabled
intcrv_4 = Interpolate(Vertices=pt_15, Degree=3, Periodic=False, KnotStyle=1)  # -> Curve, Length, Domain; disabled
crv_5 = Curve(intcrv_4.Curve)  # disabled

# ----
crv_6 = Curve(crv_5)  # disabled
pt_16 = Point(simplify(graft(pt_12)))  # disabled
end = EndPoints(Curve=crv_6)  # -> Start, End; disabled
vec2pt = Vector2Pt(PointA=end.Start, PointB=end.End, Unitize=False)  # -> Vector, Length; disabled
yz_2 = YZPlane(Origin=end.Start)  # disabled
Y_12 = UnitY(Factor=panel_5)  # disabled
angle = Angle(VectorA=vec2pt.Vector, VectorB=Y_12, Plane=yz_2)  # -> Angle, Reflex; disabled
rotate = Rotate(Geometry=crv_6, Angle=angle.Angle, Plane=yz_2)  # -> Geometry, Transform; disabled
curvepoint = PointOnCurve(rotate.Geometry, parameter=0.5)  # disabled
vec2pt_2 = Vector2Pt(PointA=curvepoint, PointB=pt_16, Unitize=False)  # -> Vector, Length; disabled
move_18 = Move(Geometry=rotate.Geometry, Motion=vec2pt_2.Vector)  # -> Geometry, Transform; disabled
path_mapper_2 = PathMapper(move_18.Geometry, source=["{A;B}", "{A}"], target=["{A}", "{0}"])  # disabled
crv_7 = Curve(path_mapper_2)  # disabled
loft = Loft(Curves=crv_7, Options={Adjust=False, Closed=False, LoftEnds=0, LoftSimp=0, LoftType=2, Rebuild=10, Refit=0.01})  # disabled

bool = Boolean(relaxation)  # disabled
cull_7 = CullPattern(List=loft, CullPattern=bool)  # disabled
number_slider_12 = Slider(8, range=0..100)  # disabled
srf = Surface(cull_7)  # disabled
num_18 = Number(number_slider_5)  # disabled
quads = QuadPanels(Surface=srf, UDivisions=number_slider_12, VDivisions=num_18)  # disabled
srf_2 = Surface(reparameterize(simplify(quads)))  # disabled

smesh = SimpleMesh(Brep=srf_2)  # disabled
area_5 = MeshArea(Mesh=smesh)  # -> Area, Centroid; disabled
meshcp = MeshClosestPoint(Point=area_5.Centroid, Mesh=smesh)  # -> Point, Index, Parameter; disabled
meval = MeshEval(Mesh=smesh, Parameter=meshcp.Parameter)  # -> Point, Normal, Colour; disabled
pl = PlaneNormal(Origin=meval.Point, ZAxis=meval.Normal)  # disabled
X = UnitX(Factor=1)  # disabled
deplane = DeconstructPlane(Plane=pl)  # -> Origin, XAxis, YAxis, ZAxis; disabled
angle_2 = Angle(VectorA=deplane.XAxis, VectorB=X, Plane=pl)  # -> Angle, Reflex; disabled
rotate_2 = Rotate(Geometry=pl, Angle=angle_2.Angle, Plane=pl)  # -> graft(Geometry), Transform; disabled

medges = MeshEdges(Mesh=smesh)  # -> simplify(NakedEdges), InteriorEdges, NonManifoldEdges; disabled
curvepoint_2 = PointOnCurve(medges.NakedEdges, parameter=0.5)  # disabled
plcoord = PlaneCoordinates(Point=curvepoint_2, System=rotate_2.Geometry)  # -> XCoordinate, YCoordinate, ZCoordinate; disabled
sort = SortList(Keys=plcoord.XCoordinate, ValuesA=medges.NakedEdges)  # -> Keys, ValuesA; disabled
item_10 = ListItem(List=reverse(sort.ValuesA), Index=0, Wrap=True)  # disabled
item_11 = ListItem(List=sort.ValuesA, Index=0, Wrap=True)  # disabled

merge_11 = Merge(Data1=item_11, Data2=item_10)  # disabled
trim_4 = TrimTree(Tree=merge_11, Depth=1)  # disabled
rdlines = RemoveDuplicateLinesKaramba3D(Line=trim_4, LimitDistance=0.005)  # -> OutLine, Info, Indexes; disabled
join_3 = JoinCurves(Curves=rdlines.OutLine, Preserve=False)  # disabled
explode = Explode(Curve=join_3, Recursive=True)  # -> Segments, simplify(Vertices); disabled
pline = PolyLine(Vertices=explode.Vertices, Closed=False)  # -> simplify(graft(Polyline)); disabled
path_mapper_3 = PathMapper(pline, source=["{A}", "{A;B}"], target=["{0}", "{A}"])  # disabled
curvepoint_3 = PointOnCurve(path_mapper_3, parameter=0.5)  # disabled
pdecon_8 = Deconstruct(Point=curvepoint_3)  # -> XComponent, YComponent, ZComponent; disabled
sort_2 = SortList(Keys=pdecon_8.XComponent, ValuesA=path_mapper_3)  # -> Keys, ValuesA; disabled
crv_8 = Curve(sort_2.ValuesA)  # disabled

crv_9 = Curve(crv_8)  # disabled
item_12 = ListItem(List=crv_9, Index=0, Wrap=True)  # disabled
curvepoint_4 = PointOnCurve(crv_9, parameter=0.5)  # disabled
curvepoint_5 = PointOnCurve(item_12, parameter=0.5)  # disabled
vec2pt_3 = Vector2Pt(PointA=curvepoint_5, PointB=curvepoint_4, Unitize=False)  # -> Vector, Length; disabled
move_19 = Move(Geometry=item_12, Motion=vec2pt_3.Vector)  # -> Geometry, Transform; disabled

crv_10 = Curve(crv_8)  # disabled
flip = FlipCurve(Curve=crv_10, Guide=move_19.Geometry)  # -> Curve, Flag; disabled

explode_2 = Explode(Curve=flip.Curve, Recursive=True)  # -> simplify(Segments), Vertices; disabled
explode_3 = Explode(Curve=move_19.Geometry, Recursive=True)  # -> simplify(Segments), Vertices; disabled
lng_3 = ListLength(List=explode_2.Segments)  # disabled
lng_4 = ListLength(List=explode_2.Segments)  # disabled
lng_5 = ListLength(List=explode_3.Segments)  # disabled
lng_6 = ListLength(List=explode_3.Segments)  # disabled
subtraction_3 = Subtraction(A=lng_3, B=2)  # disabled
subtraction_4 = Subtraction(A=lng_4, B=1)  # disabled
subtraction_5 = Subtraction(A=lng_5, B=2)  # disabled
subtraction_6 = Subtraction(A=lng_6, B=1)  # disabled
dom_6 = ConstructDomain(DomainStart=0, DomainEnd=subtraction_3)  # disabled
dom_7 = ConstructDomain(DomainStart=1, DomainEnd=subtraction_4)  # disabled
dom_8 = ConstructDomain(DomainStart=0, DomainEnd=subtraction_5)  # disabled
dom_9 = ConstructDomain(DomainStart=1, DomainEnd=subtraction_6)  # disabled
subset_2 = SubList(List=explode_2.Segments, Domain=dom_6, Wrap=True)  # -> List, Index; disabled
subset_3 = SubList(List=explode_2.Segments, Domain=dom_7, Wrap=True)  # -> List, Index; disabled
subset_4 = SubList(List=explode_3.Segments, Domain=dom_8, Wrap=True)  # -> List, Index; disabled
subset_5 = SubList(List=explode_3.Segments, Domain=dom_9, Wrap=True)  # -> List, Index; disabled
angle_3 = Angle(VectorA=subset_4.List, VectorB=subset_5.List)  # -> simplify(Angle), Reflex; disabled
angle_4 = Angle(VectorA=subset_2.List, VectorB=subset_3.List)  # -> simplify(Angle), Reflex; disabled
num_19 = Number(angle_3.Angle)  # disabled
num_20 = Number(angle_4.Angle)  # disabled

explode_4 = Explode(Curve=flip.Curve, Recursive=True)  # -> simplify(Segments), Vertices; disabled
explode_5 = Explode(Curve=move_19.Geometry, Recursive=True)  # -> simplify(Segments), Vertices; disabled
path_mapper_4 = PathMapper(explode_4.Segments, source=["{A}(i)", "{A;B}(i)"], target=["{i}(A)", "{A;i}(B)"])  # disabled
path_mapper_5 = PathMapper(explode_5.Segments, source=["{A}(i)", "{A;B}(i)"], target=["{i}(A)", "{A;i}(B)"])  # disabled
crv_11 = Curve(path_mapper_5)  # disabled
crv_12 = Curve(path_mapper_4)  # disabled
lng_7 = ListLength(List=crv_12)  # -> expr("x-2", Length); disabled
lng_8 = ListLength(List=crv_11)  # -> expr("x-2", Length); disabled
lng_9 = ListLength(List=crv_12)  # -> expr("x-1", Length); disabled
lng_10 = ListLength(List=crv_11)  # -> expr("x-1", Length); disabled
dom_10 = ConstructDomain(DomainStart=0, DomainEnd=lng_7)  # disabled
dom_11 = ConstructDomain(DomainStart=0, DomainEnd=lng_8)  # disabled
dom_12 = ConstructDomain(DomainStart=1, DomainEnd=lng_9)  # disabled
dom_13 = ConstructDomain(DomainStart=1, DomainEnd=lng_10)  # disabled
subset_6 = SubList(List=crv_12, Domain=dom_10, Wrap=True)  # -> graft(List), Index; disabled
subset_7 = SubList(List=crv_11, Domain=dom_11, Wrap=True)  # -> graft(List), Index; disabled
subset_8 = SubList(List=crv_12, Domain=dom_12, Wrap=True)  # -> graft(List), Index; disabled
subset_9 = SubList(List=crv_11, Domain=dom_13, Wrap=True)  # -> graft(List), Index; disabled
loft_2 = Loft(
    Curves=[subset_6.List, subset_8.List],
    Options={Adjust=False, Closed=False, LoftEnds=0, LoftSimp=0, LoftType=0, Rebuild=10, Refit=0.01})  # -> simplify(Loft); disabled
loft_3 = Loft(
    Curves=[subset_7.List, subset_9.List],
    Options={Adjust=False, Closed=False, LoftEnds=0, LoftSimp=0, LoftType=0, Rebuild=10, Refit=0.01})  # -> simplify(Loft); disabled
smesh_2 = SimpleMesh(Brep=loft_2)  # disabled
smesh_3 = SimpleMesh(Brep=loft_3)  # disabled
path_mapper_6 = PathMapper(smesh_3, source=["{A;B;C}", "{A;B}"], target=["{A}", "{0}"])  # disabled
path_mapper_7 = PathMapper(smesh_2, source=["{A;B;C}", "{A;B}"], target=["{A}", "{0}"])  # disabled
mjoin = MeshJoin(Meshes=path_mapper_6)  # disabled
mjoin_2 = MeshJoin(Meshes=path_mapper_7)  # disabled
weld = WeldMesh(Mesh=mjoin, Angle=3.141592654)  # disabled
weld_2 = WeldMesh(Mesh=mjoin_2, Angle=3.141592654)  # disabled

explode_6 = Explode(Curve=move_19.Geometry, Recursive=True)  # -> Segments, Vertices; disabled
num_21 = Number(num_20)  # disabled
num_22 = Number(num_19)  # disabled
mesh = Mesh(weld)  # disabled
path_mapper_8 = PathMapper(explode_6.Vertices, source=["{A;B}(i)", "{A}(i)"], target=["{A;i}(B)", "{i}(A)"])  # disabled
division_2 = Division(A=num_21, B=num_22)  # disabled
avr_2 = Average(Input=division_2)  # disabled
number_slider_13 = Slider(100, range=0..100000)  # disabled
number_slider_14 = Slider(1, range=0..10000)  # disabled
number_slider_15 = Slider(10000, range=0..10000)  # disabled
pline_2 = PolyLine(Vertices=path_mapper_8, Closed=False)  # -> simplify(Polyline); disabled
path_mapper_9 = PathMapper(pline_2, source=["{A;B}", "{A}"], target=["{A}", "{0}"])  # disabled
crv_13 = Curve(move_19.Geometry)  # disabled
show = Show(G=mesh)  # disabled
rod = Rod(Polyline=path_mapper_9, LengthFactor=1, AngleFactor=1, AxialStrength=number_slider_13, BendStrength=number_slider_14)  # disabled
path_mapper_10 = PathMapper(rod, source=["{A;B}", "{A}"], target=["{A}", "{0}"])  # disabled

path_mapper_11 = PathMapper(avr_2, source=["{A}", "{A;B}"], target=["{0}", "{A}"])  # disabled

rod_2 = Rod(
    Polyline=crv_13,
    LengthFactor=1,
    AngleFactor=path_mapper_11,
    AxialStrength=number_slider_13,
    BendStrength=number_slider_15)  # disabled
path_mapper_12 = PathMapper(rod_2, source=["{A;B}", "{A}"], target=["{A}", "{0}"])  # disabled
merge_12 = Merge(Data1=path_mapper_10, Data2=path_mapper_12, Data3=show)  # disabled

zombiesolver = ZombieSolver(GoalObjects=merge_12, Threshold=1e-10, Tolerance=0.0001, MaxIterations=number_slider_10)  # -> I, V, O; disabled
mesh_2 = Mesh(zombiesolver.O)  # disabled
clean = CleanTree(RemoveNulls=True, RemoveInvalid=True, RemoveEmpty=False, Tree=mesh_2)  # disabled

wbedges = WeaverbirdsMeshEdges(MeshOrPolylines=graft(clean))  # -> simplify(Lines); disabled
mesh_3 = Mesh(simplify(graft(clean)))  # disabled

wbedges_2 = WeaverbirdsMeshEdges(MeshOrPolylines=weld_2)  # -> simplify(Lines); disabled
line = Line(wbedges)  # disabled
number_slider_16 = Slider(1330, range=0..10000)  # disabled
group_2 = Group(Objects=line)  # -> flatten(Group); disabled
len_2 = Length(Curve=wbedges_2)  # disabled
len_3 = Length(Curve=line)  # disabled
lng_11 = ListLength(List=group_2)  # disabled
subtraction_7 = Subtraction(A=len_3, B=len_2)  # disabled
series_4 = Series(Start=0, Step=number_slider_16, Count=lng_11)  # disabled
number_slider_17 = Slider(5928, range=0..10000)  # disabled
smaller_2 = SmallerThan(FirstNumber=subtraction_7, SecondNumber=0)  # -> SmallerThan, OrEqualTo; disabled
dispatch = Dispatch(List=subtraction_7, DispatchPattern=smaller_2.SmallerThan)  # -> ListA, ListB; disabled
Y_13 = UnitY(Factor=series_4)  # disabled
Y_14 = UnitY(Factor=number_slider_17)  # disabled
move_20 = Move(Geometry=group_2, Motion=Y_13)  # -> Geometry, Transform; disabled
bnd_11 = Bounds(Numbers=dispatch.ListA)  # disabled
bnd_12 = Bounds(Numbers=dispatch.ListB)  # disabled
number_slider_18 = Slider(7456, range=0..10000)  # disabled
move_21 = Move(Geometry=move_20.Geometry, Motion=Y_14)  # -> Geometry, Transform; disabled
dedomain_11 = DeconstructDomain(Domain=bnd_12)  # -> Start, End; disabled
dedomain_12 = DeconstructDomain(Domain=bnd_11)  # -> Start, End; disabled
X_2 = UnitX(Factor=number_slider_18)  # disabled
move_22 = Move(Geometry=move_21.Geometry, Motion=X_2)  # -> Geometry, Transform; disabled
gradient_6 = Gradient(
    LowerLimit=dedomain_12.Start,
    UpperLimit=dedomain_12.End,
    Parameter=dispatch.ListA,
    stops=[0: RGB(75, 107, 169), 0.501: RGB(173, 203, 249), 1: RGB(254, 244, 84)])  # disabled
gradient_7 = Gradient(
    LowerLimit=dedomain_11.Start,
    UpperLimit=dedomain_11.End,
    Parameter=dispatch.ListB,
    stops=[0: RGB(254, 244, 84), 0.499: RGB(234, 126, 0), 1: RGB(234, 38, 0), 1: RGB(75, 107, 169), 1: RGB(173, 203, 249)])  # disabled
ungroup_2 = Ungroup(Group=move_22.Geometry)  # disabled
dispatch_2 = Dispatch(List=ungroup_2, DispatchPattern=smaller_2.SmallerThan)  # -> ListA, ListB; disabled
previewlw = CustomPreviewLineweights(Geometry=dispatch_2.ListA, Shader=gradient_6, Thickness=3, Absolute=False)  # disabled
previewlw_2 = CustomPreviewLineweights(Geometry=dispatch_2.ListB, Shader=gradient_7, Thickness=3, Absolute=False)  # disabled

crv_14 = Curve(wbedges)  # disabled
end_2 = EndPoints(Curve=crv_14)  # -> Start, End; disabled
pdecon_9 = Deconstruct(Point=end_2.Start)  # -> XComponent, YComponent, ZComponent; disabled
pdecon_10 = Deconstruct(Point=end_2.End)  # -> XComponent, YComponent, ZComponent; disabled
subtraction_8 = Subtraction(A=pdecon_9.XComponent, B=pdecon_10.XComponent)  # disabled
number_slider_19 = Slider(100, range=0..100)  # disabled
abs = Absolute(Value=subtraction_8)  # disabled
smaller_3 = SmallerThan(FirstNumber=abs, SecondNumber=number_slider_19)  # -> SmallerThan, OrEqualTo; disabled
cull_8 = CullPattern(List=crv_14, CullPattern=smaller_3.SmallerThan)  # disabled
join_4 = JoinCurves(Curves=cull_8, Preserve=False)  # disabled
curvepoint_6 = PointOnCurve(join_4, parameter=0.5)  # disabled
pdecon_11 = Deconstruct(Point=curvepoint_6)  # -> XComponent, YComponent, ZComponent; disabled
sort_3 = SortList(Keys=pdecon_11.XComponent, ValuesA=join_4)  # -> Keys, ValuesA; disabled
explode_7 = Explode(Curve=sort_3.ValuesA, Recursive=True)  # -> Segments, simplify(Vertices); disabled
intcrv_5 = Interpolate(Vertices=explode_7.Vertices, Degree=3, Periodic=False, KnotStyle=1)  # -> Curve, Length, Domain; disabled
path_mapper_13 = PathMapper(intcrv_5.Curve, source=["{A;B}", "{A}"], target=["{A}", "{0}"])  # disabled
loft_4 = Loft(Curves=path_mapper_13, Options={Adjust=False, Closed=False, LoftEnds=0, LoftSimp=0, LoftType=0, Rebuild=10, Refit=0.01})  # disabled

mesh_4 = Mesh(mesh_3)  # disabled
number_slider_20 = Slider(1, range=0..1)  # disabled
num_23 = Number(expr("x+1", number_slider_12))  # disabled
medges_2 = MeshEdges(Mesh=mesh_4)  # -> NakedEdges, InteriorEdges, NonManifoldEdges; disabled
demesh = DeconstructMesh(Mesh=mesh_4)  # -> Vertices, Faces, Colours, Normals; disabled
join_5 = JoinCurves(Curves=medges_2.NakedEdges, Preserve=False)  # disabled
patch = Patch(Curves=join_5, Points=demesh.Vertices, Spans=num_23, Flexibility=number_slider_20, Trim=True)  # disabled
srf_3 = Surface(simplify(patch))  # disabled

# ---- group: control gate
srf_4 = Surface(loft_4)
srf_5 = Surface(loft)
bool_2 = Boolean(relaxation)
not_2 = GateNot(A=bool_2)
cull_9 = CullPattern(List=srf_5, CullPattern=not_2)
merge_13 = Merge(Data1=srf_4, Data2=cull_9)

# ----
crv_15 = Curve(dec_reg_4.Polyline)
srf_6 = Surface(reparameterize(simplify(graft(merge_13))))
rec_4 = Rectangle(rectangle.Rectangle)
explode_8 = Explode(Curve=crv_15, Recursive=True)  # -> Segments, Vertices
path_mapper_14 = PathMapper(crv_15, source=["{A;B}", "{A}", "{A;B;C}"], target=["{A}", "{0}", "{A}"])
len_4 = Length(Curve=explode_8.Segments)
tstat = TreeStatistics(Tree=path_mapper_14)  # -> Paths, Length, Count
division_3 = Division(A=len_4, B=Slider(100, range=0..100))
lng_12 = ListLength(List=tstat.Paths)
divide_2 = DivideCurve(Curve=explode_8.Segments, Count=division_3, Kinks=False)  # -> Points, Tangents, Parameters
dup_6 = DuplicateData(Data=rec_4, Number=lng_12, Order=True)  # -> graft(Data)
path_mapper_15 = PathMapper(divide_2.Points, source=["{A;B;C;D}", "{A;B;C}", "{A;B;C;D;E}"], target=["{A}", "{0}", "{A}"])
srf_7 = Surface(reparameterize(simplify(dup_6)))
srf_cp = SurfaceClosestPoint(Point=path_mapper_15, Surface=srf_7)  # -> Point, UVPoint, Distance
evalsrf = EvaluateSurface(Surface=reparameterize(srf_6), Point=srf_cp.UVPoint)  # -> Point, Normal, UDirection, VDirection, Frame
c_script_10 = CSharpScript(trimmedTree=evalsrf.Point, originalTree=divide_2.Points)  # -> out, A; inputs trimmedTree: tree, originalTree: tree
# ---------- c_script_10: C# ----------
    if(originalTree.DataCount != trimmedTree.DataCount) Component.AddRuntimeMessage(GH_RuntimeMessageLevel.Error, "Number of items in both trees must be equal");

    DataTree<object> outputs = new DataTree<object>();
    List<GH_Path> paths = GetPaths(originalTree);
    //step through trimmed tree objects and add them to output tree with the correct

    int counter = 0;
    for(int i = 0; i < trimmedTree.BranchCount; i++)
    {
      for(int j = 0; j < trimmedTree.Branch(i).Count; j++)
      {
        outputs.Add(trimmedTree.Branch(i)[j], paths[counter]);
        counter++;
      }
    }
    A = outputs;
# ---------- c_script_10: C# additional code ----------
  public List<GH_Path> GetPaths(DataTree<object> originalTree)
  {
    List<GH_Path> output = new List<GH_Path>();
    for(int i = 0; i < originalTree.BranchCount; i++)
    {
      for(int j = 0; j < originalTree.Branch(i).Count; j++)
      {
        output.Add(originalTree.Paths[i]);
      }
    }
    return output;
  }
# ---------- end c_script_10 ----------
intcrv_6 = Interpolate(Vertices=c_script_10.A, Degree=3, Periodic=False, KnotStyle=1)  # -> Curve, Length, Domain
trim_5 = TrimTree(Tree=intcrv_6.Curve, Depth=1)
item_13 = ListItem(List=trim_5, Index=0, Wrap=True)  # -> Item, Item1, Item2, Item3
flip_2 = FlipCurve(Curve=item_13.Item3)  # -> Curve, Flag
merge_14 = Merge(Data1=item_13.Item1, Data2=flip_2.Curve)
loft_5 = Loft(Curves=merge_14, Options={Adjust=False, Closed=False, LoftEnds=0, LoftSimp=0, LoftType=0, Rebuild=10, Refit=0.01})

srf_8 = Surface(merge_13)
edges = BrepEdges(Brep=srf_8)  # -> Naked, Interior, NonManifold
len_5 = Length(Curve=edges.Naked)
sort_4 = SortList(Keys=len_5, ValuesA=edges.Naked)  # -> Keys, reverse(ValuesA)
item_14 = ListItem(List=sort_4.ValuesA, Index=0, Wrap=True)  # -> Item, Item1
flip_3 = FlipCurve(Curve=item_14.Item1)  # -> Curve, Flag
merge_15 = Merge(Data1=item_14.Item, Data2=flip_3.Curve)
divide_3 = DivideCurve(Curve=merge_15, Count=Slider(100, range=0..100), Kinks=False)  # -> Points, Tangents, Parameters
path_mapper_16 = PathMapper(divide_3.Points, source="{A;B;C}(i)", target="{A;B;i}(C)")
item_15 = ListItem(List=path_mapper_16, Index=0, Wrap=True)  # -> Item, Item1
dist = Distance(PointA=item_15.Item, PointB=item_15.Item1)
trim_6 = TrimTree(Tree=dist, Depth=1)
bnd_13 = Bounds(Numbers=trim_6)
dedomain_13 = DeconstructDomain(Domain=bnd_13)  # -> simplify(Start), End
multiplication_10 = Multiplication(A=dedomain_13.Start, B=Slider(0.95, range=0..1))  # -> flatten(Result)
c_script_11 = CSharpScript(x=multiplication_10)  # -> out, A; inputs x: list of Double
# ---------- c_script_11: C# ----------
    List<double> output = new List<double>();
    
    double currentVal = 0;
    for(int i = 0; i < x.Count; i++)
    {
      output.Add(currentVal);
      currentVal += x[i];
    }
    A = output;
# ---------- end c_script_11 ----------
Y_15 = UnitY(Factor=c_script_11.A)
move_23 = Move(Geometry=srf_8, Motion=graft(Y_15))  # -> Geometry, Transform

mesh_5 = Mesh(mesh_3)  # disabled
mesh_6 = Mesh(flatten(mesh_5))  # disabled
number_slider_21 = Slider(2905, range=0..10000)  # disabled
c_script_12 = CSharpScript(mesh=mesh_5, surface=srf_3)  # -> out, Curvature; inputs mesh: Mesh, surface: Surface; disabled
# ---------- c_script_12: C# ----------
        //get surface gaussian curvature at each mesh point
        List<double> gaussianCurvatures = new List<double>();
        double maxGaussian = 0;
        double minGaussian = double.MaxValue;

        double U;
        double V;

        for (int i = 0; i < mesh.Vertices.Count; i++)
        {
            Point3d currentMeshPoint = mesh.Vertices.Point3dAt(i);
            surface.ClosestPoint(currentMeshPoint, out U, out V);
            SurfaceCurvature surfaceCurvature = surface.CurvatureAt(U, V);
            double gaussian = surfaceCurvature.Gaussian;
            gaussianCurvatures.Add(gaussian);

            //get the range of curvatures
            if (gaussian > maxGaussian) maxGaussian = gaussian;
            if( gaussian < minGaussian) minGaussian = gaussian;
        }


        //get the range of curvatures


        //remap the curvatures to color values on the mesh points
        for (int i = 0; i < mesh.Vertices.Count; i++)
        {
            double hue = (gaussianCurvatures[i] - minGaussian) / (0 - minGaussian) * (0.5 - maxGaussian) + maxGaussian;
        }
        Curvature = gaussianCurvatures;
# ---------- end c_script_12 ----------
move_24 = Move(Geometry=mesh_6, Motion=Y_15)  # -> simplify(graft(Geometry)), Transform; disabled
num_24 = Number(c_script_12.Curvature)  # disabled
Y_16 = UnitY(Factor=number_slider_21)  # disabled
number_slider_22 = Slider(7456, range=0..10000)  # disabled
bnd_14 = Bounds(Numbers=num_24)  # disabled
mesh_7 = Mesh(move_24.Geometry)  # disabled
dedomain_14 = DeconstructDomain(Domain=bnd_14)  # -> Start, End; disabled
move_25 = Move(Geometry=mesh_7, Motion=Y_16)  # -> Geometry, Transform; disabled
X_3 = UnitX(Factor=number_slider_22)  # disabled
gradient_8 = Gradient(
    LowerLimit=dedomain_14.Start,
    UpperLimit=dedomain_14.End,
    Parameter=num_24,
    stops=[0: RGB(0, 128, 0), 0.5: RGB(255, 255, 0), 1: RGB(255, 0, 0)])  # disabled
move_26 = Move(Geometry=move_25.Geometry, Motion=X_3)  # -> Geometry, Transform; disabled
c_script_13 = CSharpScript(mesh=move_26.Geometry, colors=simplify(gradient_8))  # -> out, A; inputs mesh: Mesh, colors: list of Color; disabled
# ---------- c_script_13: C# ----------
    for(int i = 0; i < mesh.Vertices.Count; i++)
    {
      mesh.VertexColors.SetColor(i, colors[i]);
    }
    A = mesh;
# ---------- end c_script_13 ----------

gaussian_curvature = Panel(bnd_14)  # disabled
relaxation_2 = Panel(bnd_11)  # disabled

trim_7 = TrimTree(Tree=loft_5, Depth=2)
vec_6 = Vector(Y_15)
join_6 = BrepJoin(Breps=trim_7)  # -> Breps, Closed
trim_8 = TrimTree(Tree=join_6.Breps, Depth=1)
item_16 = ListItem(List=trim_8, Index=0, Wrap=True)  # -> flatten(Item)
move_27 = Move(Geometry=item_16, Motion=vec_6)  # -> Geometry, Transform

brep = Brep(move_27.Geometry)

# ---- group: brep extension if needed
debrep = DeconstructBrep(Brep=brep)  # -> simplify(Faces), Edges, Vertices
debrep_2 = DeconstructBrep(Brep=debrep.Faces)  # -> Faces, Edges, Vertices
pdecon_12 = Deconstruct(Point=debrep_2.Vertices)  # -> XComponent, YComponent, ZComponent
sort_5 = SortList(Keys=pdecon_12.XComponent)  # -> Keys, ValuesA
item_17 = ListItem(List=sort_5.Keys, Index=0, Wrap=True)
trim_9 = TrimTree(Tree=debrep_2.Faces, Depth=1)
trim_10 = TrimTree(Tree=item_17, Depth=1)
round_2 = Round(Number=trim_10)  # -> Nearest, Floor, Ceiling
sort_6 = SortList(Keys=round_2.Nearest, ValuesA=trim_9)  # -> Keys, simplify(ValuesA)
cset = CreateSet(List=round_2.Nearest)  # -> Set, Map
item_18 = ListItem(List=reverse(cset.Set), Index=0, Wrap=True)
item_19 = ListItem(List=cset.Set, Index=0, Wrap=True)
equals = Equality(FirstNumber=sort_6.Keys, SecondNumber=item_19)  # -> Equality, Inequality
equals_2 = Equality(FirstNumber=sort_6.Keys, SecondNumber=item_18)  # -> Equality, Inequality
and = GateAnd(A=equals.Inequality, B=equals_2.Inequality)

# ---- group: brep extension if needed / middle
cull_10 = CullPattern(List=sort_6.ValuesA, CullPattern=and)

# ---- group: brep extension if needed / start
cull_11 = CullPattern(List=sort_6.ValuesA, CullPattern=equals.Equality)

# ---- group: brep extension if needed / end
cull_12 = CullPattern(List=sort_6.ValuesA, CullPattern=equals_2.Equality)

# ---- group: brep extension if needed (continued)
extendsrf = ExtendSurface(Surface=cull_11, WestEdge=0, SouthEdge=0, EastEdge=Slider(1000, range=0..1000), NorthEdge=0, ExtensionType=True)
extendsrf_2 = ExtendSurface(Surface=cull_12, WestEdge=Slider(1000, range=0..1000), SouthEdge=0, EastEdge=0, NorthEdge=0, ExtensionType=True)
merge_16 = Merge(Data1=cull_10, Data2=extendsrf, Data3=extendsrf_2)
join_7 = BrepJoin(Breps=merge_16)  # -> flatten(Breps), Closed

# ----
c_script_14 = CSharpScript(breps=join_7.Breps)  # -> out, A; inputs breps: list
# ---------- c_script_14: C# ----------
    DataTree<object> output = new DataTree<object>();
    if(breps.Count == 1) return;
    for(int i = 0; i < breps.Count; i++)
    {
      GH_Path path = new GH_Path(i);
      if(i == 0)output.Add(breps[i + 1], path);
      else if(i == breps.Count - 1)output.Add(breps[i - 1], path);
      else
      {
        output.Add(breps[i - 1], path);
        output.Add(breps[i + 1], path);
      }
    }
    A = output;
# ---------- end c_script_14 ----------
splitmul = SplitBrepMultiple(Brep=graft(brep), Cutters=c_script_14.A)
area_6 = Area(Geometry=splitmul)  # -> Area, Centroid
sort_7 = SortList(Keys=area_6.Area, ValuesA=splitmul)  # -> Keys, reverse(ValuesA)
item_20 = ListItem(List=sort_7.ValuesA, Index=0, Wrap=True)
brep_2 = Brep(flatten(item_20))

item_21 = ListItem(List=reverse(brep_2), Index=0, Wrap=True)
item_22 = ListItem(List=reverse(brep_2), Index=1, Wrap=True)
bbx = BrepBrep(BrepA=item_21, BrepB=item_22)  # -> Curves, Points
crv_16 = Curve(bbx.Curves)
explode_9 = Explode(Curve=crv_16, Recursive=True)  # -> Segments, flatten(Vertices)
pdecon_13 = Deconstruct(Point=explode_9.Vertices)  # -> XComponent, YComponent, ZComponent
sort_8 = SortList(Keys=pdecon_13.XComponent, ValuesA=explode_9.Vertices)  # -> Keys, ValuesA
cullpt_2 = CullDuplicates(Points=sort_8.ValuesA, Tolerance=0.1, CullMode=3)  # -> Points, Indices, Valence
intcrv_7 = Interpolate(Vertices=cullpt_2.Points, Degree=3, Periodic=False, KnotStyle=1)  # -> Curve, Length, Domain
Y_17 = UnitY(Factor=Slider(30, range=0..100))
move_28 = Move(Geometry=intcrv_7.Curve, Motion=Y_17)  # -> Geometry, Transform
number_slider_23 = Slider(1000, range=0..1000)
ext = ExtendCurve(Curve=move_28.Geometry, Type=0, Start=number_slider_23, End=number_slider_23)
Y_18 = UnitY(Factor=Slider(10000, range=0..10000))
extr = Extrude(Base=ext, Direction=Y_18)
split = SplitBrep(Brep=item_21, Cutter=extr)
area_7 = Area(Geometry=split)  # -> Area, Centroid
pdecon_14 = Deconstruct(Point=area_7.Centroid)  # -> XComponent, YComponent, ZComponent
sort_9 = SortList(Keys=pdecon_14.ZComponent, ValuesA=split)  # -> Keys, reverse(ValuesA)
item_23 = ListItem(List=sort_9.ValuesA, Index=0, Wrap=True)

item_24 = ListItem(List=brep_2, Index=0, Wrap=True)
item_25 = ListItem(List=brep_2, Index=1, Wrap=True)
bbx_2 = BrepBrep(BrepA=item_24, BrepB=item_25)  # -> Curves, Points
crv_17 = Curve(bbx_2.Curves)
explode_10 = Explode(Curve=crv_17, Recursive=True)  # -> Segments, flatten(Vertices)
pdecon_15 = Deconstruct(Point=explode_10.Vertices)  # -> XComponent, YComponent, ZComponent
sort_10 = SortList(Keys=pdecon_15.XComponent, ValuesA=explode_10.Vertices)  # -> Keys, ValuesA
cullpt_3 = CullDuplicates(Points=sort_10.ValuesA, Tolerance=0.1, CullMode=3)  # -> Points, Indices, Valence
intcrv_8 = Interpolate(Vertices=cullpt_3.Points, Degree=3, Periodic=False, KnotStyle=1)  # -> Curve, Length, Domain
Y_19 = UnitY(Factor=Slider(30, range=0..100))
number_slider_24 = Slider(1000, range=0..1000)
move_29 = Move(Geometry=intcrv_8.Curve, Motion=Y_19)  # -> Geometry, Transform
ext_2 = ExtendCurve(Curve=move_29.Geometry, Type=0, Start=number_slider_24, End=number_slider_24)
Y_20 = UnitY(Factor=Slider(10000, range=0..10000))
neg_8 = Negative(Value=Y_20)
extr_2 = Extrude(Base=ext_2, Direction=neg_8)
split_2 = SplitBrep(Brep=item_24, Cutter=extr_2)
area_8 = Area(Geometry=split_2)  # -> Area, Centroid
pdecon_16 = Deconstruct(Point=area_8.Centroid)  # -> XComponent, YComponent, ZComponent
sort_11 = SortList(Keys=pdecon_16.ZComponent, ValuesA=split_2)  # -> Keys, reverse(ValuesA)
item_26 = ListItem(List=sort_11.ValuesA, Index=0, Wrap=True)

brep_3 = Brep(brep_2)

lng_13 = ListLength(List=brep_3)
dom_14 = ConstructDomain(DomainStart=1, DomainEnd=expr("x-2", lng_13))
larger = LargerThan(FirstNumber=lng_13, SecondNumber=2)  # -> LargerThan, OrEqualTo
subset_10 = SubList(List=brep_3, Domain=dom_14, Wrap=True)  # -> List, Index
cull_13 = CullPattern(List=subset_10.List, CullPattern=larger.LargerThan)

lng_14 = ListLength(List=brep_2)  # -> expr("x-1", Length)
merge_17 = Merge(Data1=flatten(item_26), Data2=flatten(cull_13), Data3=flatten(item_23))
dom_15 = ConstructDomain(DomainStart=0, DomainEnd=lng_14)
subset_11 = SubList(List=merge_17, Domain=dom_15, Wrap=True)  # -> List, Index

# ---- group: find cull pattern
brep_4 = Brep(move_27.Geometry)
brep_5 = Brep(subset_11.List)
c_script_15 = CSharpScript(untrimmed=brep_4, trimmed=brep_5)  # -> out, A; inputs untrimmed: list of Brep, trimmed: list of Brep
# ---------- c_script_15: C# usings ----------
using Rhino.Geometry.Collections;
# ---------- c_script_15: C# ----------
    DataTree<bool> remains = new DataTree<bool>();
    for(int i = 0; i < untrimmed.Count; i++)
    {

      for(int j = 0; j < untrimmed[i].Faces.Count; j++)
      {
        remains.Add(false, new GH_Path(i));
      }

      BrepFaceList untrimmedFaces = untrimmed[i].Faces;

      //System.Threading.Tasks.Parallel.For(0, untrimmedFaces.Count, j =>
      for(int j = 0; j < untrimmedFaces.Count; j++)
      {

        BrepFaceList trimmedFaces = trimmed[i].Faces;

        for(int v = 0; v < trimmedFaces.Count; v++)
        {
          //var surface = trimmedFaces[v];
          //surface.SetDomain(0, new Interval(0, 1));
          //surface.SetDomain(1, new Interval(0, 1));
          Point3d centroid = trimmedFaces[v].PointAt(0.5, 0.5);

          double U;
          double V;
          untrimmedFaces[j].ClosestPoint(centroid, out U, out V);
          Point3d testPoint = untrimmedFaces[j].PointAt(U, V);

          if(testPoint.DistanceToSquared(centroid) < RhinoDoc.ActiveDoc.ModelAbsoluteTolerance *2)
          {
            remains.Branch(i)[j] = true;
            break;
          }
        }
      }
    }
    A = remains;
# ---------- end c_script_15 ----------

# ----
brep_6 = Brep(subset_11.List)
join_8 = BrepJoin(Breps=brep_6)  # -> Breps, Closed
debrep_3 = DeconstructBrep(Brep=join_8.Breps)  # -> Faces, Edges, Vertices
pdecon_17 = Deconstruct(Point=debrep_3.Vertices)  # -> XComponent, YComponent, ZComponent
equalst = EqualityWithinTolerance(FirstNumber=pdecon_17.XComponent, SecondNumber="0", Tolerance=Slider(10, range=0..10))  # -> Equality, Inequality
cull_14 = CullPattern(List=debrep_3.Vertices, CullPattern=equalst.Equality)

# ---- group: support points
pt_17 = Point(cull_14)

# ----
data_8 = Data(cull_6)
data_9 = Data(species_2)
dec_panel_buildups = DeconstructPanelBuildup(Panels=data_8)  # -> WoodSpecies, Thicknesses
tstat_2 = TreeStatistics(Tree=dec_panel_buildups.Thicknesses)  # -> Paths, Length, Count
lng_15 = ListLength(List=tstat_2.Paths)
dup_7 = DuplicateData(Data=data_9, Number=lng_15, Order=True)  # -> graft(Data)
dup_8 = DuplicateData(Data="4", Number=lng_15, Order=True)  # -> graft(Data)
match = MatchTree(Tree=dup_7, Guide=dec_panel_buildups.WoodSpecies)
match_2 = MatchTree(Tree=dup_8, Guide=dec_panel_buildups.Thicknesses)
merge_18 = Merge(Data1=dec_panel_buildups.WoodSpecies, Data2=match)
merge_19 = Merge(Data1=dec_panel_buildups.Thicknesses, Data2=match_2)

# ---- group: thicknesses
num_25 = Number(merge_19)

# ---- group: species
data_10 = Data(merge_18)

# ----
c_script_16 = CSharpScript(x=data_10)  # -> out, A; inputs x: tree; same code as c_script_6
c_script_17 = CSharpScript(x=num_25)  # -> out, A; inputs x: tree; same code as c_script_6

cull_15 = CullPattern(List=c_script_17.A, CullPattern=graft(c_script_15.A))
cull_16 = CullPattern(List=c_script_16.A, CullPattern=graft(c_script_15.A))
clean_2 = CleanTree(RemoveNulls=True, RemoveInvalid=True, RemoveEmpty=True, Tree=cull_16)
clean_3 = CleanTree(RemoveNulls=True, RemoveInvalid=True, RemoveEmpty=True, Tree=cull_15)
c_script_18 = CSharpScript(x=clean_2)  # -> out, A; inputs x: tree; same code as c_script_6
c_script_19 = CSharpScript(x=clean_3)  # -> out, A; inputs x: tree; same code as c_script_6

# ---- group: species
data_11 = Data(c_script_18.A)

# ---- group: thicknesses
num_26 = Number(c_script_19.A)

# ---- group: buildups
dec_secies = DeconstructSpecies(Species=data_11)  # -> N, LX, RX, TX, LE, RE, TE
cset_2 = CreateSet(List=dec_secies.N)  # -> Set, Map
material_buildups = Panel("""100
200
300
101
201
301""")

# ---- group: buildups / layer count
lng_16 = ListLength(List=dec_secies.N)

# ---- group: buildups / material type
lng_17 = ListLength(List=cset_2.Set)

# ---- group: buildups (continued)
c_script_20 = CSharpScript(layerCount=lng_16, materialCount=lng_17)  # -> out, A; inputs layerCount: tree of Int32, materialCount: tree of Int32
# ---------- c_script_20: C# ----------
    DataTree<int> keys = new DataTree<int>();

    for(int i = 0; i < layerCount.BranchCount;i++)
    {
      int lCount = layerCount.Branch(i)[0];
      int mCount = materialCount.Branch(i)[0];
      GH_Path path = materialCount.Paths[i];

      if(lCount == 3 && mCount == 1) keys.Add(0, path);
      if(lCount == 5 && mCount == 1) keys.Add(1, path);
      if(lCount == 7 && mCount == 1) keys.Add(2, path);
      if(lCount == 3 && mCount == 2) keys.Add(3, path);
      if(lCount == 5 && mCount == 2) keys.Add(4, path);
      if(lCount == 7 && mCount == 2) keys.Add(5, path);

    }
    A = keys;
# ---------- end c_script_20 ----------
item_27 = ListItem(List=material_buildups, Index=c_script_20.A, Wrap=True)

# ---- group: material ids
num_27 = Number(item_27)

# ----
lng_18 = ListLength(List=num_26)
debrep_4 = DeconstructBrep(Brep=subset_11.List)  # -> Faces, Edges, Vertices
bnd_15 = Bounds(Numbers=flatten(lng_18))
dedomain_15 = DeconstructDomain(Domain=bnd_15)  # -> Start, End
gradient_9 = Gradient(
    LowerLimit=dedomain_15.Start,
    UpperLimit=dedomain_15.End,
    Parameter=lng_18,
    stops=[0: RGB(255, 255, 255), 1: RGB(59, 59, 59)])

# ---- group: surfaces
srf_9 = Surface(debrep_4.Faces)

# ----
preview_11 = CustomPreview(Geometry=simplify(graft(srf_9)), Material=gradient_9)
