# Grasshopper definition Digital Twins.gh (Grasshopper 1.0.7)
# plug-ins: HygroDesign, Pufferfish, treesloth01, Opossum2_0_Proto_A

# ---- group: spruce
panel = Panel("spruce")
number_slider = Slider(0.0001, range=0..0.0001)
number_slider_2 = Slider(0.0019, range=0..1)
number_slider_3 = Slider(0.0036, range=0..1)
number_slider_4 = Slider(10000, range=0..20000)
number_slider_5 = Slider(800, range=0..20000)
number_slider_6 = Slider(450, range=0..20000)
number_slider_7 = Slider(400, range=0..1000)

# ---- group: beech
panel_2 = Panel("beech")
number_slider_8 = Slider(0.0001, range=0..0.0001)
number_slider_9 = Slider(0.002, range=0..1)
number_slider_10 = Slider(0.0041, range=0..1)
number_slider_11 = Slider(14000, range=0..20000)
number_slider_12 = Slider(1160, range=0..20000)
number_slider_13 = Slider(2280, range=0..20000)
number_slider_14 = Slider(720, range=0..1000)

# ---- group: spruce
panel_3 = Panel("spruce")
number_slider_15 = Slider(0.0019, range=0..1)
number_slider_16 = Slider(450, range=0..20000)
number_slider_17 = Slider(0.0001, range=0..0.0001)
number_slider_18 = Slider(0.0036, range=0..1)
number_slider_19 = Slider(10000, range=0..20000)
number_slider_20 = Slider(800, range=0..20000)
number_slider_21 = Slider(400, range=0..1000)

# ---- group: beech
panel_4 = Panel("beech")
number_slider_22 = Slider(0.0001, range=0..0.0001)
number_slider_23 = Slider(0.002, range=0..1)
number_slider_24 = Slider(0.0041, range=0..1)
number_slider_25 = Slider(14000, range=0..20000)
number_slider_26 = Slider(2280, range=0..20000)
number_slider_27 = Slider(1160, range=0..20000)
number_slider_28 = Slider(720, range=0..1000)

# ----
number_slider_29 = Slider(100, range=0..100)
number_slider_30 = Slider(7, range=0..10)
number_slider_31 = Slider(4, range=0..10)
number_slider_32 = Slider(79, range=0..100)
number_slider_33 = Slider(8, range=0..10)
number_slider_34 = Slider(5, range=0..10)
species = WoodSpecies(
    name=panel_2,
    density=number_slider_14,
    LExp=number_slider_8,
    RExp=number_slider_9,
    TExp=number_slider_10,
    LEmod=number_slider_11,
    REmod=number_slider_13,
    TEmod=number_slider_12)
species_2 = WoodSpecies(
    name=panel,
    density=number_slider_7,
    LExp=number_slider,
    RExp=number_slider_2,
    TExp=number_slider_3,
    LEmod=number_slider_4,
    REmod=number_slider_5,
    TEmod=number_slider_6)
panel_5 = CosntructPanel(
    HMaxelLength=Slider(150, range=0..1000),
    HMaxelWidth=number_slider_29,
    LengthCount=number_slider_30,
    WidthCount=number_slider_31)
species_3 = WoodSpecies(
    name=panel_4,
    density=number_slider_28,
    LExp=number_slider_22,
    RExp=number_slider_23,
    TExp=number_slider_24,
    LEmod=number_slider_25,
    REmod=number_slider_26,
    TEmod=number_slider_27)
species_4 = WoodSpecies(
    name=panel_3,
    density=number_slider_21,
    LExp=number_slider_17,
    RExp=number_slider_15,
    TExp=number_slider_18,
    LEmod=number_slider_19,
    REmod=number_slider_20,
    TEmod=number_slider_16)
panel_6 = CosntructPanel(
    HMaxelLength=Slider(145, range=0..1000),
    HMaxelWidth=number_slider_32,
    LengthCount=number_slider_33,
    WidthCount=number_slider_34)

panel_7 = Panel("""0
1""")
bilayer = ConstructBilayer(
    Panel=panel_5,
    BoardLength=Slider(2, range=0..10),
    RowOffsets=panel_7,
    PassiveSpecies=species_2,
    ActiveThickness=Slider(12, range=0..100),
    PassiveThickness=Slider(4, range=0..10))

species_5 = Panel("""0
0
0
1
0
0
1
1
1
0
0
1
1
0
0
1
1
1
0
0
0
1""")
equals = Equality(FirstNumber=graft(species_5), SecondNumber="0")  # -> Equality, Inequality
cull = CullPattern(List=species_4, CullPattern=equals.Inequality)
cull_2 = CullPattern(List=species_3, CullPattern=equals.Equality)
merge = Merge(Data1=cull_2, Data2=cull)  # -> flatten(Result)

panel_8 = Panel("""0
1""")
bilayer_2 = ConstructBilayer(
    Panel=panel_6,
    BoardLength=Slider(2, range=0..10),
    RowOffsets=panel_8,
    PassiveSpecies=species_4,
    ActiveThickness=Slider(12, range=0..100),
    PassiveThickness=Slider(4, range=0..10))

rt = Panel("""53.8
36.5
19.5
16.9
21.4
37.5
85.7
18.9
18.5
46.1
34.5
85.7
85.7
21.4
36.5
38.2
31.3
18.5
43.8
22.9
27.9
32.3""")
mc = Panel("""22.4
21.3
19.4
18.3
23.6
21.9
19.7
17.4
16.3
24.7
22.6
16.5
17.1
19.6
20.9
19.8
19.9
15.0
22.4
19.1
21.7
16.7""")
dec_pan = DeconstructPanel(Panel=panel_5)  # -> Bilayers, HMaxels, LengthRange, WidthRange
dec_pan_2 = DeconstructPanel(Panel=panel_6)  # -> Bilayers, HMaxels, LengthRange, WidthRange
up_pan = UpdatePanel(Panel=panel_5, Bilayers=bilayer, HMaxels=dec_pan.HMaxels)
up_pan_2 = UpdatePanel(Panel=panel_6, Bilayers=bilayer_2, HMaxels=dec_pan_2.HMaxels)
lng = ListLength(List=rt)
listdexs = ListIndices(List=rt)
dup = DuplicateData(Data=Slider(290, range=0..300), Number=lng, Order=True)
dup_2 = DuplicateData(Data=Slider(12, range=0..300), Number=lng, Order=True)
dup_3 = DuplicateData(Data=Slider(79, range=0..300), Number=lng, Order=True)
subtraction = Subtraction(A=mc, B=Slider(9, range=0..10))
num = Number(rt)
txt = Text(listdexs)
stock_boards = StockBoards(Name=txt, Species=merge, Thickness=dup_2, Length=dup, Width=dup_3, RTAngle=num, MoistureChange=subtraction)

# ---- group: working well on pure spruce
number_slider_35 = Slider(3, range=0.01..3)
number_slider_36 = Slider(0.0993, range=0.0001..0.1)
number_slider_37 = Slider(11.662, range=0.01..100)
number_slider_38 = Slider(0, range=0..100000)
number_slider_39 = Slider(0.07, range=0.01..3)

# ----
number_slider_40 = Slider(0.01, range=0.01..3)
number_slider_41 = Slider(0.0001, range=0.0001..0.1)
number_slider_42 = Slider(100, range=0.01..100)
number_slider_43 = Slider(99758, range=0..100000)
number_slider_44 = Slider(3, range=0.01..3)

pan_stock = PanelStockBoards(Panel=up_pan_2, StockBoards=stock_boards)
c_script = CSharpScript(Reference="C:\Users\Alex Reiner\AppData\Roaming\Grasshopper\Libraries\HygroDesign.Core.dll")  # -> out, A
# ---------- c_script: C# usings ----------
using BilayerDesign;
# ---------- c_script: C# ----------
    TimoshenkoPrediction timo = new TimoshenkoPrediction();
    A = timo;
# ---------- c_script: C# additional code ----------
  public class TimoshenkoPrediction : PredictionEngine
  {

    public TimoshenkoPrediction()
    {
    }

    public override double Predict(StockBoard board, Bilayer bilayer, double moistureChange)
    {
      double h1 = bilayer.PassiveLayer.Thickness;
      double h2 = bilayer.ActiveLayer.Thickness;
      double h = h1 + h2;
      double m = h1 / h2;
      double e1 = bilayer.PassiveLayer.Species.Attributes["LEmod"];
      double e2 = GrainAngleInterpolation(board.RTAngle, board.Species.Attributes["REmod"], board.Species.Attributes["TEmod"]);
      double n = e1 / e2;
      double a1 = bilayer.PassiveLayer.Species.Attributes["LExp"];
      double a2 = GrainAngleInterpolation(board.RTAngle, board.Species.Attributes["RExp"], board.Species.Attributes["TExp"]);
      double deltaAlpha = a2 - a1;
      double kValue = 6 * Math.Pow(1.0 + m, 2) / (3 * Math.Pow(1 + m, 2) + (1 + m * n) * Math.Pow(m, 2) + (1 / (m * n)));
      double curvature = kValue * ((moistureChange * deltaAlpha) / h);
      return 1 / (curvature /* * TimError*/ );
    }

    public static double GrainAngleInterpolation(double rtAngle, double eR, double eT)
    {
      double angleConv = RhinoMath.ToRadians(rtAngle);
      double angleT = Math.Cos(angleConv);
      double angleR = Math.Sin(angleConv);
      double eActive = eT * Math.Pow(angleT, 2) + eR * Math.Pow(angleR, 2);
      return eActive;
    }
  }
# ---------- end c_script ----------
pred_rad = RadiusPrediction(Panel=pan_stock, PredictionEngine=c_script.A)
c_script_2 = CSharpScript(
    tan=number_slider_40,
    lon=number_slider_41,
    rad=number_slider_43,
    stiff=number_slider_42,
    thick=number_slider_44,
    Reference="C:\Users\Alex Reiner\AppData\Roaming\Grasshopper\Libraries\HygroDesign.Core.dll")  # -> out, A; inputs tan: Double, lon: Double, rad: Double, stiff: Double, thick: Double
# ---------- c_script_2: C# ----------
    HMaxelConvolution convEngine = new HMaxelConvolution(tan, lon, rad, stiff, thick);
    A = convEngine;
# ---------- c_script_2: C# additional code ----------
  public class HMaxelConvolution : ConvolutionEngine
  {
    public double Tangential { get; set; }
    public double Longitudinal { get; set; }
    public double RadiusMax { get; set; }
    public double StiffnessInfluence { get; set; }
    public double ThicknessInfluence { get; set; }
    public HMaxelConvolution(double tangential, double longitudinal, double radiusMax, double stiffnessInfluence, double thicknessInfluence)
    {
      Tangential = tangential;
      Longitudinal = longitudinal;
      RadiusMax = radiusMax;
      StiffnessInfluence = stiffnessInfluence;
      ThicknessInfluence = thicknessInfluence;
    }

    public override Panel Convolution(Panel panel)
    {
      double MaxRad = double.MinValue;
      double MinRad = double.MaxValue;

      double MaxRStiff = double.MinValue;
      double MinRStiff = double.MaxValue;
      double MaxLStiff = double.MinValue;
      double MinLStiff = double.MaxValue;

      for (int i = 0; i < panel.HMaxels.GetLength(0); i++)
      {
        for (int j = 0; j < panel.HMaxels.GetLength(1); j++)
        {
          double averageRStiffness = 0;
          double averageLStiffness = 0;
          double weightedRadius = 0;
          double totalRWeights = 0;

          HMaxel hmaxel = panel.HMaxels[i, j];
          List<Tuple<double, double>> tuples = new List<Tuple<double, double>>();
          for (int v = 0; v < hmaxel.ActiveBoards.Count; v++)
          {
                    
            averageRStiffness += (double) hmaxel.ActiveBoards[v].StockBoard.Species.Attributes["REmod"];
            averageLStiffness += (double) hmaxel.ActiveBoards[v].StockBoard.Species.Attributes["LEmod"];
                    

            weightedRadius += (hmaxel.ActiveBoards[v].Radius * (double) hmaxel.ActiveBoards[v].StockBoard.Species.Attributes["REmod"]);
            totalRWeights += (double) hmaxel.ActiveBoards[v].StockBoard.Species.Attributes["REmod"];

          }
          averageRStiffness /= hmaxel.ActiveBoards.Count;
          averageLStiffness /= hmaxel.ActiveBoards.Count;
          weightedRadius /= totalRWeights;
          panel.HMaxels[i, j].Attributes.Add("REmod", averageRStiffness);
          panel.HMaxels[i, j].Attributes.Add("LEmod", averageLStiffness);
          panel.HMaxels[i, j].Attributes.Add("weighted radius", weightedRadius);

          if (weightedRadius > MaxRad) MaxRad = weightedRadius;
          if (weightedRadius < MinRad) MinRad = weightedRadius;
          if (averageLStiffness > MaxLStiff) MaxLStiff = averageLStiffness;
          if (averageLStiffness < MinLStiff) MinLStiff = averageLStiffness;
          if (averageRStiffness > MaxRStiff) MaxRStiff = averageRStiffness;
          if (averageRStiffness < MinRStiff) MinRStiff = averageRStiffness;
                
        }
      }
      //set factors
      for (int i = 0; i < panel.HMaxels.GetLength(0); i++)
      {
        for (int j = 0; j < panel.HMaxels.GetLength(1); j++)
        {
          panel.HMaxels[i, j].Attributes.Add("REmodFactor", Remap((double) panel.HMaxels[i, j].Attributes["REmod"], MinRStiff, MaxRStiff, 1 - StiffnessInfluence, 1));
          panel.HMaxels[i, j].Attributes.Add("LEmodFactor", Remap((double) panel.HMaxels[i, j].Attributes["LEmod"], MinLStiff, MaxLStiff, 1 - StiffnessInfluence, 1));
          panel.HMaxels[i, j].Attributes.Add("RadiusFactor", Remap((double) panel.HMaxels[i, j].Attributes["weighted radius"], MinRad, RadiusMax, 1, 0));

        }
      }

      //horizontal convolution
      for (int i = 0; i < panel.HMaxels.GetLength(0); i++)
      {
        for (int j = 0; j < panel.HMaxels.GetLength(1); j++)
        {
          double totalWeights = 0;
          double blendedRadius = 0;
          for (int x = 0; x < panel.HMaxels.GetLength(0); x++)
          {
            for (int y = 0; y < panel.HMaxels.GetLength(1); y++)
            {

              double xdist = Math.Abs(panel.HMaxels[i, j].X - panel.HMaxels[x, y].X);
              double ydist = Math.Abs(panel.HMaxels[i, j].Y - panel.HMaxels[x, y].Y);
              double LFactor = (double) panel.HMaxels[x, y].Attributes["LEmodFactor"] / Math.Pow(xdist + 1, Longitudinal);
              double RFactor = (double) panel.HMaxels[x, y].Attributes["REmodFactor"] / Math.Pow(ydist + 1, Tangential);
              blendedRadius += (double) panel.HMaxels[x, y].Attributes["weighted radius"] * (double) panel.HMaxels[i, j].Attributes["RadiusFactor"] * LFactor * RFactor;
              totalWeights += (double) panel.HMaxels[x, y].Attributes["RadiusFactor"] * LFactor * RFactor;

            }
          }

          panel.HMaxels[i, j].BlendedRaidus = blendedRadius / totalWeights;

        }
      }
      return panel;
    }
    public static double Remap(double val, double from1, double to1, double from2, double to2)
    {
      if(from1 == to1 || from2 == to2) return val;
      else return (val - from1) / (to1 - from1) * (to2 - from2) + from2;
    }
  }
# ---------- end c_script_2 ----------
rad_blend = RadiusBlending(Panels=pred_rad, ConvolutionEngine=c_script_2.A)

dec_pan_3 = DeconstructPanel(Panel=rad_blend)  # -> Bilayers, HMaxels, LengthRange, WidthRange
dec_hmaxel = DeconstructHMaxel(HMaxel=dec_pan_3.HMaxels)  # -> PassiveLayers, ActiveBoards, Height, RowRange, ColumnRange, DesiredRadius, BlendedRadius, ShapedHMaxel

num_2 = Number(number_slider_30)
num_3 = Number(number_slider_33)
rectangle = Rectangle(Plane=PlaneXY(0, 0, 0), XSize=dec_hmaxel.RowRange, YSize=dec_hmaxel.ColumnRange, Radius=0)  # -> Rectangle, Length

partition = PartitionList(List=dec_hmaxel.BlendedRadius, Size=num_3)  # -> simplify(Chunks)
flip = FlipMatrix(Data=partition)
num_4 = Number(flip)
c_script_3 = CSharpScript(x=num_4)  # -> out, A; inputs x: tree
# ---------- c_script_3: C# ----------
    DataTree<object> output = new DataTree<object>();

    for(int i = 0; i < x.BranchCount; i++)
    {
      if(i % 2 == 0)output.AddRange(x.Branch(i), new GH_Path(i));
    }
    A = output;
# ---------- end c_script_3 ----------
renumber = RenumberPaths(Data=c_script_3.A)

num_5 = Number(expr("x/2", num_3))
dedomain = DeconstructDomain(Domain=dec_hmaxel.RowRange)  # -> Start, End
bnd = Bounds(Numbers=dedomain.Start)
bnd_2 = Bounds(Numbers=dedomain.End)
round = Round(Number=num_5)  # -> Nearest, Floor, Ceiling
dedomain_2 = DeconstructDomain(Domain=bnd)  # -> Start, End
dedomain_3 = DeconstructDomain(Domain=bnd_2)  # -> Start, End
x_minus_one = XMinusOne(NumberX=round.Nearest)
subtraction_2 = Subtraction(A=dedomain_3.End, B=dedomain_2.Start)
division = Division(A=subtraction_2, B=x_minus_one)
series = Series(Start=dedomain_2.Start, Step=division, Count=round.Nearest)
pt = ConstructPoint(XCoordinate=series, YCoordinate=0, ZCoordinate=0)
yz = YZPlane(Origin=pt)  # -> simplify(graft(Plane))

pln = Plane(yz)
num_6 = Number(renumber)
num_7 = Number(number_slider_32)
c_script_4 = CSharpScript()  # -> out, A; inputs x: tree
# ---------- c_script_4: C# ----------
    DataTree<object> output = new DataTree<object>();
    int firstIndex = 0;
    int branchCount = 0;
    for(int i = 0; i < x.BranchCount; i++)
    {
      GH_Path path = new GH_Path(firstIndex, branchCount);
      if(x.Paths[i][0] == firstIndex)
      {
        output.AddRange(x.Branch(i), path);
      }
      else
      {
        firstIndex++;
        branchCount = -1;
        i--;
      }
      branchCount++;
    }
    A = output;
# ---------- end c_script_4 ----------
c_script_5 = CSharpScript(iRadii=num_6, iBoardWidth=num_7, iPlanes=pln)  # -> out, simplify(A); inputs iRadii: tree of Double, iBoardWidth: Double, iPlanes: tree of Plane
# ---------- c_script_5: C# ----------
    DataTree<Point3d> pointTree = new DataTree<Point3d>();

    for (int j = 0; j < iRadii.BranchCount; j++)
    {

      //initialize variables
      Plane bp = iPlanes.Branch(j)[0];
      Point3d startPoint = new Point3d(bp.Origin);
      Point3d centerPoint = startPoint;
      Vector3d rotationAxis = new Vector3d(bp.ZAxis);
      Vector3d centerPointVect = new Vector3d(bp.YAxis);
      centerPointVect.Rotate(Math.PI / 2, rotationAxis);

      for (int i = 0; i < iRadii.Branch(j).Count; i++){
        GH_Path pth = iRadii.Paths[j].AppendElement(i);
        Point3d point1 = startPoint;
        Point3d point2 = startPoint;

        pointTree.Add(point1, pth);

        //calculate rotation angle
        Double arcLength = iBoardWidth;
        Double radius = iRadii.Branch(j)[i];
        Double rotation = (arcLength / radius);

        //calculate rotation center point
        centerPointVect.Unitize();
        centerPointVect *= radius;
        centerPoint += centerPointVect;


        //execute half rotation
        Transform tx = Transform.Rotation(rotation / 2, rotationAxis, centerPoint);


        point2.Transform(tx);
        pointTree.Add(point2, pth);

        //execute full rotation
        tx = Transform.Rotation(rotation, rotationAxis, centerPoint);
        startPoint.Transform(tx);
        pointTree.Add(startPoint, pth);

        //updata rotation parameters
        centerPoint = startPoint;
        centerPointVect.Transform(tx);
      }
    }
    A = pointTree;
# ---------- end c_script_5 ----------

trim = TrimTree(Tree=c_script_5.A, Depth=1)
cullpt = CullDuplicates(Points=trim, Tolerance=0.1, CullMode=3)  # -> Points, Indices, Valence
pt_2 = Point(cullpt.Points)

# ---- group: animate
pt_3 = Point(simplify(pt_2))
pln_2 = Plane(graft(pln))
num_8 = Number(Slider(1, range=0..1))
c_script_6 = CSharpScript(iPoints=simplify(pt_3), iPlanes=pln_2, iShapeFactor=num_8)  # -> out, A; inputs iPoints: tree of Point3d, iPlanes: tree of Plane, iShapeFactor: Double
# ---------- c_script_6: C# ----------
    DataTree<Point3d> output = new DataTree<Point3d>();
    
    double shapeFactor = 1.0 - iShapeFactor;

    //step through curves
    for (int i = 0; i < iPoints.BranchCount; i++)
    {
      Plane currentPlane = iPlanes.Branch(iPoints.Path(i)[0])[0];

      //get vectors from plane
      Vector3d zVect = currentPlane.YAxis;

      Vector3d rotVect = currentPlane.ZAxis;

      //create new startpoint inside list
      Point3d startPoint = iPoints.Branch(i)[0];

      //step through points. Create and rotate vectors
      for (int j = 0; j < iPoints.Branch(i).Count; j++)
      {
        if (j == 0) output.Add(startPoint, iPoints.Path(i));
        else{
          //create current segment vector
          Vector3d segmentVect = new Vector3d(iPoints.Branch(i)[j] - iPoints.Branch(i)[j - 1]);

          //measure angle with vertical vector
          double angle = Vector3d.VectorAngle(zVect, segmentVect, currentPlane);

          //rotate
          segmentVect.Rotate(-angle * shapeFactor, rotVect);

          startPoint += segmentVect;
          output.Add(startPoint, iPoints.Path(i));
        }
      }
    }

    A = output;
# ---------- end c_script_6 ----------
pt_4 = Point(c_script_6.A)
intcrv = Interpolate(Vertices=pt_4, Degree=3, Periodic=False, KnotStyle=1)  # -> Curve, Length, Domain
crv = Curve(intcrv.Curve)

# ----
crv_2 = Curve(crv)
pt_5 = Point(simplify(graft(yz)))
end = EndPoints(Curve=crv_2)  # -> Start, End
vec2pt = Vector2Pt(PointA=end.Start, PointB=end.End, Unitize=False)  # -> Vector, Length
yz_2 = YZPlane(Origin=end.Start)
Y = UnitY(Factor="-1")
angle = Angle(VectorA=vec2pt.Vector, VectorB=Y, Plane=yz_2)  # -> Angle, Reflex
rotate = Rotate(Geometry=crv_2, Angle=angle.Angle, Plane=yz_2)  # -> Geometry, Transform
curvepoint = PointOnCurve(rotate.Geometry, parameter=0.5)
vec2pt_2 = Vector2Pt(PointA=curvepoint, PointB=pt_5, Unitize=False)  # -> Vector, Length
move = Move(Geometry=rotate.Geometry, Motion=vec2pt_2.Vector)  # -> Geometry, Transform
path_mapper = PathMapper(move.Geometry, source=["{A;B}", "{A}"], target=["{A}", "{0}"])
crv_3 = Curve(path_mapper)
flip_2 = FlipCurve(Curve=crv_3)  # -> Curve, Flag
loft = Loft(Curves=flip_2.Curve, Options={Adjust=False, Closed=False, LoftEnds=0, LoftSimp=0, LoftType=0, Rebuild=10, Refit=0.01})
srf = Surface(loft)

multiplication = Multiplication(A=number_slider_29, B=number_slider_31)
division_2 = Division(A=multiplication, B="2")
Y_2 = UnitY(Factor=division_2)
multiplication_2 = Multiplication(A=number_slider_32, B=number_slider_34)
division_3 = Division(A=multiplication_2, B="2")
Y_3 = UnitY(Factor=division_3)
move_2 = Move(Geometry=srf, Motion=Y_3)  # -> Geometry, Transform

geo = Geometry(move_2.Geometry)
debrep = DeconstructBrep(Brep=geo)  # -> Faces, Edges, Vertices
pdecon = Deconstruct(Point=debrep.Vertices)  # -> XComponent, YComponent, ZComponent
sort = SortList(Keys=pdecon.YComponent, ValuesA=debrep.Vertices)  # -> Keys, ValuesA
item = ListItem(List=sort.ValuesA, Index=0, Wrap=True)  # -> Item, Item1
merge_2 = Merge(Data1=item.Item, Data2=item.Item1)
pdecon_2 = Deconstruct(Point=merge_2)  # -> XComponent, YComponent, ZComponent
sort_2 = SortList(Keys=pdecon_2.XComponent, ValuesA=merge_2)  # -> Keys, ValuesA
item_2 = ListItem(List=sort_2.ValuesA, Index=0, Wrap=True)  # -> Item, Item1
avr = Average(Input=sort_2.ValuesA)
vec2pt_3 = Vector2Pt(PointA=item_2.Item, PointB=item_2.Item1, Unitize=False)  # -> Vector, Length
pdecon_3 = Deconstruct(Point=avr)  # -> XComponent, YComponent, ZComponent
pl = ConstructPlane(Origin=avr, XAxis=vec2pt_3.Vector, YAxis=Vector(0, 1, 0))
pt_6 = ConstructPoint(XCoordinate=pdecon_3.XComponent, YCoordinate=pdecon_3.YComponent, ZCoordinate=0)
pl_2 = ConstructPlane(Origin=pt_6, XAxis=Vector(1, 0, 0), YAxis=Vector(0, 1, 0))
orient = Orient(Geometry=geo, Source=pl, Target=pl_2)  # -> Geometry, Transform

mesh = Mesh(<mesh referenced from the Rhino model>)
Y_4 = UnitY(Factor=Slider(500, range=0..1000))
move_3 = Move(Geometry=orient.Geometry, Motion=Y_4)  # -> Geometry, Transform

bbox = BoundingBox(Content=move_3.Geometry, Plane=PlaneXY(0, 0, 0))  # -> Box, Box_2
debox = DeconstructBox(Box=bbox.Box)  # -> Plane, X, Y, Z
number_slider_45 = Slider(5, range=0..10)
dedomain_4 = DeconstructDomain(Domain=debox.X)  # -> Start, End
subtraction_3 = Subtraction(A=dedomain_4.End, B=dedomain_4.Start)
division_4 = Division(A=subtraction_3, B=number_slider_45)
series_2 = Series(Start=dedomain_4.Start, Step=division_4, Count=expr("x+1", number_slider_45))
lng_2 = ListLength(List=series_2)  # -> expr("x-2", Length)
dom = ConstructDomain(DomainStart="1", DomainEnd=lng_2)
subset = SubList(List=series_2, Domain=dom, Wrap=True)  # -> List, Index
pt_7 = ConstructPoint(XCoordinate=subset.List, YCoordinate=0, ZCoordinate=0)
yz_3 = YZPlane(Origin=pt_7)

mesh_2 = Mesh(<mesh referenced from the Rhino model>)
sec = BrepPlane(Brep=move_3.Geometry, Plane=yz_3)  # -> Curves, Points
sec_2 = MeshPlane(Mesh=mesh, Plane=yz_3)
divide = DivideCurve(Curve=sec.Curves, Count=10, Kinks=False)  # -> Points, Tangents, Parameters
divide_2 = DivideCurve(Curve=sec_2, Count=10, Kinks=False)  # -> Points, Tangents, Parameters
intcrv_2 = Interpolate(Vertices=divide.Points, Degree=3, Periodic=False, KnotStyle=1)  # -> simplify(Curve), Length, Domain
intcrv_3 = Interpolate(Vertices=divide_2.Points, Degree=3, Periodic=False, KnotStyle=1)  # -> simplify(Curve), Length, Domain
crv_cp = CurveClosestPoint(Point=divide.Points, Curve=intcrv_2.Curve)  # -> Point, Parameter, Distance
crv_cp_2 = CurveClosestPoint(Point=divide_2.Points, Curve=intcrv_3.Curve)  # -> Point, Parameter, Distance
curvature = Curvature(Curve=intcrv_2.Curve, Parameter=crv_cp.Parameter)  # -> P, K, C
curvature_2 = Curvature(Curve=intcrv_3.Curve, Parameter=crv_cp_2.Parameter)  # -> P, K, C
area = Area(Geometry=curvature.C)  # -> Area, Centroid
area_2 = Area(Geometry=curvature_2.C)  # -> Area, Centroid
dist = Distance(PointA=curvature.P, PointB=area.Centroid)  # -> simplify(Distance)
dist_2 = Distance(PointA=curvature_2.P, PointB=area_2.Centroid)  # -> simplify(Distance)
subtraction_4 = Subtraction(A=dist_2, B=dist)
abs = Absolute(Value=subtraction_4)  # -> flatten(Result)
_2º = PowerOf2(Value=abs)
ma = MassAddition(Input=abs)  # -> Result, PartialResults
panel_9 = Panel(ma.Result)
num_9 = Number(ma.Result)
movopossum_3_0_0 = Opossum(
    OpossumData_NumberOfObjectives=1,
    OpossumData_OptimizationType=0,
    OpossumData_ResultSerializationStatus=1,
    OpossumData_ObjectiveValue=[54356.07118, 55976.50478, 58753.18418, 55911.52812, 53942.40108, 53957.33458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],
    OpossumData_ParameterList=["0.012366,0.311410,54393.000000,95.024933,1.329129", "0.081262,2.486241,88827.000000,37.086304,2.710301", "0.066332,1.650083,2080.000000,23.257627,0.662734", "0.050050,1.505000,50000.000000,50.005000,1.505000", "0.001332,0.077263,99774.000000,99.901665,0.214640", "0.001224,0.082432,71806.000000,99.499826,0.160714"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],
    OpossumData_objective=num_10,
    OpossumData_variable=[number_slider_41, number_slider_40, number_slider_43, number_slider_42, number_slider_44])
num_10 = Number(num_9)

rt_2 = Panel("""28.6
35.9
35
51.2
29.7
36.7
45.8
59.8
24.3
31.2
37.8
53.6
30.1
68.7
27.6
54.5""")
mc_2 = Panel("""9.0
15.1
16.0
20.9
8.6
13.1
17.1
19.2
9.7
13.4
16.4
21.5
9.0
14.2
15.6
17.2""")
lng_3 = ListLength(List=rt_2)
listdexs_2 = ListIndices(List=rt_2)
dup_4 = DuplicateData(Data=species_2, Number=lng_3, Order=True)
dup_5 = DuplicateData(Data=Slider(300, range=0..300), Number=lng_3, Order=True)
dup_6 = DuplicateData(Data=Slider(12, range=0..300), Number=lng_3, Order=True)
dup_7 = DuplicateData(Data=Slider(150, range=0..300), Number=lng_3, Order=True)
txt_2 = Text(listdexs_2)
num_11 = Number(rt_2)

subtraction_5 = Subtraction(A=mc_2, B=Slider(9, range=0..10))
smaller = SmallerThan(FirstNumber=subtraction_5, SecondNumber=Slider(0, range=0..100))  # -> SmallerThan, OrEqualTo
dispatch = Dispatch(List=graft(subtraction_5), DispatchPattern=graft(smaller.OrEqualTo))  # -> ListA, ListB
lng_4 = ListLength(List=dispatch.ListA)
dup_8 = DuplicateData(Data=Slider(1, range=0..1), Number=lng_4, Order=True)
merge_3 = Merge(Data1=dup_8, Data2=dispatch.ListB)  # -> flatten(Result)

stock_boards_2 = StockBoards(Name=txt_2, Species=dup_4, Thickness=dup_6, Length=dup_5, Width=dup_7, RTAngle=num_11, MoistureChange=merge_3)

pan_stock_2 = PanelStockBoards(Panel=up_pan, StockBoards=stock_boards_2)
c_script_7 = CSharpScript(Reference="C:\Users\Alex Reiner\AppData\Roaming\Grasshopper\Libraries\HygroDesign.Core.dll")  # -> out, A; same code as c_script
pred_rad_2 = RadiusPrediction(Panel=pan_stock_2, PredictionEngine=c_script_7.A)
c_script_8 = CSharpScript(
    tan=number_slider_40,
    lon=number_slider_41,
    rad=number_slider_43,
    stiff=number_slider_42,
    thick=number_slider_44,
    Reference="C:\Users\Alex Reiner\AppData\Roaming\Grasshopper\Libraries\HygroDesign.Core.dll")  # -> out, A; inputs tan: Double, lon: Double, rad: Double, stiff: Double, thick: Double; same code as c_script_2
rad_blend_2 = RadiusBlending(Panels=pred_rad_2, ConvolutionEngine=c_script_8.A)

dec_pan_4 = DeconstructPanel(Panel=rad_blend_2)  # -> Bilayers, HMaxels, LengthRange, WidthRange
dec_hmaxel_2 = DeconstructHMaxel(HMaxel=dec_pan_4.HMaxels)  # -> PassiveLayers, ActiveBoards, Height, RowRange, ColumnRange, DesiredRadius, BlendedRadius, ShapedHMaxel

rectangle_2 = Rectangle(Plane=PlaneXY(0, 0, 0), XSize=dec_hmaxel_2.RowRange, YSize=dec_hmaxel_2.ColumnRange, Radius=0)  # -> Rectangle, Length

partition_2 = PartitionList(List=dec_hmaxel_2.BlendedRadius, Size=num_2)  # -> simplify(Chunks)
flip_3 = FlipMatrix(Data=partition_2)
num_12 = Number(flip_3)
c_script_9 = CSharpScript(x=num_12)  # -> out, A; inputs x: tree; same code as c_script_3
renumber_2 = RenumberPaths(Data=c_script_9.A)

num_13 = Number(expr("x/2", num_2))
dedomain_5 = DeconstructDomain(Domain=dec_hmaxel_2.RowRange)  # -> Start, End
bnd_3 = Bounds(Numbers=dedomain_5.Start)
bnd_4 = Bounds(Numbers=dedomain_5.End)
round_2 = Round(Number=num_13)  # -> Nearest, Floor, Ceiling
dedomain_6 = DeconstructDomain(Domain=bnd_3)  # -> Start, End
dedomain_7 = DeconstructDomain(Domain=bnd_4)  # -> Start, End
x_minus_one_2 = XMinusOne(NumberX=round_2.Nearest)
subtraction_6 = Subtraction(A=dedomain_7.End, B=dedomain_6.Start)
division_5 = Division(A=subtraction_6, B=x_minus_one_2)
series_3 = Series(Start=dedomain_6.Start, Step=division_5, Count=round_2.Nearest)
pt_8 = ConstructPoint(XCoordinate=series_3, YCoordinate=0, ZCoordinate=0)
yz_4 = YZPlane(Origin=pt_8)  # -> simplify(graft(Plane))

pln_3 = Plane(yz_4)
num_14 = Number(renumber_2)
num_15 = Number(number_slider_29)
c_script_10 = CSharpScript()  # -> out, A; inputs x: tree; same code as c_script_4
c_script_11 = CSharpScript(iRadii=num_14, iBoardWidth=num_15, iPlanes=pln_3)  # -> out, simplify(A); inputs iRadii: tree of Double, iBoardWidth: Double, iPlanes: tree of Plane; same code as c_script_5

trim_2 = TrimTree(Tree=c_script_11.A, Depth=1)
cullpt_2 = CullDuplicates(Points=trim_2, Tolerance=0.1, CullMode=3)  # -> Points, Indices, Valence
pt_9 = Point(cullpt_2.Points)

# ---- group: animate
pt_10 = Point(simplify(pt_9))
pln_4 = Plane(graft(pln_3))
num_16 = Number(Slider(1, range=0..1))
c_script_12 = CSharpScript(iPoints=simplify(pt_10), iPlanes=pln_4, iShapeFactor=num_16)  # -> out, A; inputs iPoints: tree of Point3d, iPlanes: tree of Plane, iShapeFactor: Double; same code as c_script_6
pt_11 = Point(c_script_12.A)
intcrv_4 = Interpolate(Vertices=pt_11, Degree=3, Periodic=False, KnotStyle=1)  # -> Curve, Length, Domain
crv_4 = Curve(intcrv_4.Curve)

# ----
crv_5 = Curve(crv_4)
pt_12 = Point(simplify(graft(yz_4)))
end_2 = EndPoints(Curve=crv_5)  # -> Start, End
vec2pt_4 = Vector2Pt(PointA=end_2.Start, PointB=end_2.End, Unitize=False)  # -> Vector, Length
yz_5 = YZPlane(Origin=end_2.Start)
Y_5 = UnitY(Factor="-1")
angle_2 = Angle(VectorA=vec2pt_4.Vector, VectorB=Y_5, Plane=yz_5)  # -> Angle, Reflex
rotate_2 = Rotate(Geometry=crv_5, Angle=angle_2.Angle, Plane=yz_5)  # -> Geometry, Transform
curvepoint_2 = PointOnCurve(rotate_2.Geometry, parameter=0.5)
vec2pt_5 = Vector2Pt(PointA=curvepoint_2, PointB=pt_12, Unitize=False)  # -> Vector, Length
move_4 = Move(Geometry=rotate_2.Geometry, Motion=vec2pt_5.Vector)  # -> Geometry, Transform
path_mapper_2 = PathMapper(move_4.Geometry, source=["{A;B}", "{A}"], target=["{A}", "{0}"])
crv_6 = Curve(path_mapper_2)
flip_4 = FlipCurve(Curve=crv_6)  # -> Curve, Flag
loft_2 = Loft(Curves=flip_4.Curve, Options={Adjust=False, Closed=False, LoftEnds=0, LoftSimp=0, LoftType=0, Rebuild=10, Refit=0.01})
srf_2 = Surface(loft_2)

move_5 = Move(Geometry=srf_2, Motion=Y_2)  # -> Geometry, Transform

geo_2 = Geometry(move_5.Geometry)
debrep_2 = DeconstructBrep(Brep=geo_2)  # -> Faces, Edges, Vertices
pdecon_4 = Deconstruct(Point=debrep_2.Vertices)  # -> XComponent, YComponent, ZComponent
sort_3 = SortList(Keys=pdecon_4.YComponent, ValuesA=debrep_2.Vertices)  # -> Keys, ValuesA
item_3 = ListItem(List=sort_3.ValuesA, Index=0, Wrap=True)  # -> Item, Item1
merge_4 = Merge(Data1=item_3.Item, Data2=item_3.Item1)
pdecon_5 = Deconstruct(Point=merge_4)  # -> XComponent, YComponent, ZComponent
sort_4 = SortList(Keys=pdecon_5.XComponent, ValuesA=merge_4)  # -> Keys, ValuesA
item_4 = ListItem(List=sort_4.ValuesA, Index=0, Wrap=True)  # -> Item, Item1
avr_2 = Average(Input=sort_4.ValuesA)
vec2pt_6 = Vector2Pt(PointA=item_4.Item, PointB=item_4.Item1, Unitize=False)  # -> Vector, Length
pdecon_6 = Deconstruct(Point=avr_2)  # -> XComponent, YComponent, ZComponent
pl_3 = ConstructPlane(Origin=avr_2, XAxis=vec2pt_6.Vector, YAxis=Vector(0, 1, 0))
pt_13 = ConstructPoint(XCoordinate=pdecon_6.XComponent, YCoordinate=pdecon_6.YComponent, ZCoordinate=0)
pl_4 = ConstructPlane(Origin=pt_13, XAxis=Vector(1, 0, 0), YAxis=Vector(0, 1, 0))
orient_2 = Orient(Geometry=geo_2, Source=pl_3, Target=pl_4)  # -> Geometry, Transform

bbox_2 = BoundingBox(Content=orient_2.Geometry, Plane=PlaneXY(0, 0, 0))  # -> Box, Box_2
debox_2 = DeconstructBox(Box=bbox_2.Box)  # -> Plane, X, Y, Z
number_slider_46 = Slider(5, range=0..10)
dedomain_8 = DeconstructDomain(Domain=debox_2.X)  # -> Start, End
subtraction_7 = Subtraction(A=dedomain_8.End, B=dedomain_8.Start)
division_6 = Division(A=subtraction_7, B=number_slider_46)
series_4 = Series(Start=dedomain_8.Start, Step=division_6, Count=expr("x+1", number_slider_46))
lng_5 = ListLength(List=series_4)  # -> expr("x-2", Length)
dom_2 = ConstructDomain(DomainStart="1", DomainEnd=lng_5)
subset_2 = SubList(List=series_4, Domain=dom_2, Wrap=True)  # -> List, Index
pt_14 = ConstructPoint(XCoordinate=subset_2.List, YCoordinate=0, ZCoordinate=0)
yz_6 = YZPlane(Origin=pt_14)

sec_3 = BrepPlane(Brep=orient_2.Geometry, Plane=yz_6)  # -> Curves, Points
sec_4 = MeshPlane(Mesh=mesh_2, Plane=yz_6)
divide_3 = DivideCurve(Curve=sec_3.Curves, Count=10, Kinks=False)  # -> Points, Tangents, Parameters
divide_4 = DivideCurve(Curve=sec_4, Count=10, Kinks=False)  # -> Points, Tangents, Parameters
intcrv_5 = Interpolate(Vertices=divide_3.Points, Degree=3, Periodic=False, KnotStyle=1)  # -> simplify(Curve), Length, Domain
intcrv_6 = Interpolate(Vertices=divide_4.Points, Degree=3, Periodic=False, KnotStyle=1)  # -> simplify(Curve), Length, Domain
crv_cp_3 = CurveClosestPoint(Point=divide_3.Points, Curve=intcrv_5.Curve)  # -> Point, Parameter, Distance
crv_cp_4 = CurveClosestPoint(Point=divide_4.Points, Curve=intcrv_6.Curve)  # -> Point, Parameter, Distance
curvature_3 = Curvature(Curve=intcrv_5.Curve, Parameter=crv_cp_3.Parameter)  # -> P, K, C
curvature_4 = Curvature(Curve=intcrv_6.Curve, Parameter=crv_cp_4.Parameter)  # -> P, K, C
area_3 = Area(Geometry=curvature_3.C)  # -> Area, Centroid
area_4 = Area(Geometry=curvature_4.C)  # -> Area, Centroid
dist_3 = Distance(PointA=curvature_3.P, PointB=area_3.Centroid)  # -> simplify(Distance)
dist_4 = Distance(PointA=curvature_4.P, PointB=area_4.Centroid)  # -> simplify(Distance)
subtraction_8 = Subtraction(A=dist_4, B=dist_3)
abs_2 = Absolute(Value=subtraction_8)  # -> flatten(Result)
_2º_2 = PowerOf2(Value=abs_2)
ma_2 = MassAddition(Input=abs_2)  # -> Result, PartialResults
num_17 = Number(ma_2.Result)
addition = Addition(A=num_17, B=num_9)
