# Grasshopper definition BilayerDesign - Fabrication - Prototype.gh (Grasshopper 1.0.7)
# plug-ins: HygroDesign, Pufferfish, Bookworm, treesloth01, Utils, Sofistik, Human, Weaverbird, EleFront, Telepathy

# ---- group: spruce
panel = Panel("spruce")
number_slider = Slider(0.0001, range=0..0.0001)
number_slider_2 = Slider(0.0019, range=0..1)
number_slider_3 = Slider(0.0036, range=0..1)
number_slider_4 = Slider(10000, range=0..20000)
number_slider_5 = Slider(450, range=0..20000)
number_slider_6 = Slider(800, range=0..20000)
number_slider_7 = Slider(400, range=0..1000)

# ---- group: beech
panel_2 = Panel("beech")
number_slider_8 = Slider(0.0001, range=0..0.0001)
number_slider_9 = Slider(0.002, range=0..1)
number_slider_10 = Slider(0.0041, range=0..1)
number_slider_11 = Slider(14000, range=0..20000)
number_slider_12 = Slider(2280, range=0..20000)
number_slider_13 = Slider(1160, range=0..20000)
number_slider_14 = Slider(720, range=0..1000)

# ----
number_slider_15 = Slider(30, range=0..100)
division = Division(A=Slider(991, range=0..1000), B="6")
division_2 = Division(A=Slider(5000, range=0..10000), B=division)
num = Number(Slider(150, range=0..1000))
round = Round(Number=division_2)  # -> Nearest, Floor, Ceiling
num_2 = Number(round.Floor)
species = WoodSpecies(
    name=panel_2,
    density=number_slider_14,
    LExp=number_slider_8,
    RExp=number_slider_9,
    TExp=number_slider_10,
    LEmod=number_slider_11,
    REmod=number_slider_12,
    TEmod=number_slider_13)
species_2 = WoodSpecies(
    name=panel,
    density=number_slider_7,
    LExp=number_slider,
    RExp=number_slider_2,
    TExp=number_slider_3,
    LEmod=number_slider_4,
    REmod=number_slider_6,
    TEmod=number_slider_5)
panel_3 = Panel(HMaxelLength=division, HMaxelWidth=num, LengthCount=num_2, WidthCount=Slider(13, range=0..100))
dec_pan = DeconstructPanel(Panel=panel_3)  # -> Bilayers, graft(HMaxels), LengthRange, WidthRange

number_slider_16 = Slider(1000, range=0..1000)
rectangle = Rectangle(Plane=PlaneXY(0, 0, 0), XSize=number_slider_16, YSize=number_slider_16, Radius=0)  # -> Rectangle, Length
drec = DeconstuctRectangle(Rectangle=rectangle.Rectangle)  # -> BasePlane, XInterval, YInterval
dedomain = DeconstructDomain(Domain=drec.YInterval)  # -> Start, End
subtraction = Subtraction(A=dedomain.End, B=dedomain.Start)
division_3 = Division(A=subtraction, B=2)
dom = ConstructDomain(DomainStart=0, DomainEnd=1)
addition = Addition(A=dedomain.Start, B=division_3)
number_slider_17 = Slider(0.412, range=0..1)
dom_2 = ConstructDomain(DomainStart=addition, DomainEnd=dedomain.End)
dom_3 = ConstructDomain(DomainStart=addition, DomainEnd=dedomain.Start)
remap = RemapNumbers(Value=number_slider_17, Source=dom, Target=dom_3)  # -> Mapped, Clipped
remap_2 = RemapNumbers(Value=Slider(1, range=0..1), Source=dom, Target=drec.XInterval)  # -> Mapped, Clipped
remap_3 = RemapNumbers(Value=number_slider_17, Source=dom, Target=dom_2)  # -> Mapped, Clipped
remap_4 = RemapNumbers(Value=Slider(1, range=0..1), Source=dom, Target=drec.XInterval)  # -> Mapped, Clipped
pt = ConstructPoint(XCoordinate=0, YCoordinate=remap_2.Mapped, ZCoordinate=0)
pt_2 = ConstructPoint(XCoordinate=remap.Mapped, YCoordinate=remap_4.Mapped, ZCoordinate=0)
pt_3 = ConstructPoint(XCoordinate=remap_3.Mapped, YCoordinate=remap_4.Mapped, ZCoordinate=0)
pt_4 = ConstructPoint(XCoordinate=number_slider_16, YCoordinate=remap_2.Mapped, ZCoordinate=0)
merge = Merge(Data1=pt, Data2=pt_2, Data3=pt_3, Data4=pt_4)
nurbs = NurbsCurve(Vertices=merge, Degree=2, Periodic=False)  # -> Curve, Length, Domain

number_slider_18 = Slider(1000, range=0..1000)
rectangle_2 = Rectangle(Plane=PlaneXY(0, 0, 0), XSize=number_slider_18, YSize=number_slider_18, Radius=0)  # -> Rectangle, Length
drec_2 = DeconstuctRectangle(Rectangle=rectangle_2.Rectangle)  # -> BasePlane, XInterval, YInterval
dedomain_2 = DeconstructDomain(Domain=drec_2.YInterval)  # -> Start, End
subtraction_2 = Subtraction(A=dedomain_2.End, B=dedomain_2.Start)
division_4 = Division(A=subtraction_2, B=2)
dom_4 = ConstructDomain(DomainStart=0, DomainEnd=1)
addition_2 = Addition(A=dedomain_2.Start, B=division_4)
number_slider_19 = Slider(0.575, range=0..1)
dom_5 = ConstructDomain(DomainStart=addition_2, DomainEnd=dedomain_2.End)
dom_6 = ConstructDomain(DomainStart=addition_2, DomainEnd=dedomain_2.Start)
remap_5 = RemapNumbers(Value=number_slider_19, Source=dom_4, Target=dom_6)  # -> Mapped, Clipped
remap_6 = RemapNumbers(Value=Slider(0.201, range=0..1), Source=dom_4, Target=drec_2.XInterval)  # -> Mapped, Clipped
remap_7 = RemapNumbers(Value=number_slider_19, Source=dom_4, Target=dom_5)  # -> Mapped, Clipped
remap_8 = RemapNumbers(Value=Slider(0.143, range=0..1), Source=dom_4, Target=drec_2.XInterval)  # -> Mapped, Clipped
pt_5 = ConstructPoint(XCoordinate=0, YCoordinate=remap_6.Mapped, ZCoordinate=0)
pt_6 = ConstructPoint(XCoordinate=remap_5.Mapped, YCoordinate=remap_8.Mapped, ZCoordinate=0)
pt_7 = ConstructPoint(XCoordinate=remap_7.Mapped, YCoordinate=remap_8.Mapped, ZCoordinate=0)
pt_8 = ConstructPoint(XCoordinate=number_slider_18, YCoordinate=remap_6.Mapped, ZCoordinate=0)
merge_2 = Merge(Data1=pt_5, Data2=pt_6, Data3=pt_7, Data4=pt_8)
nurbs_2 = NurbsCurve(Vertices=merge_2, Degree=2, Periodic=False)  # -> Curve, Length, Domain

number_slider_20 = Slider(1000, range=0..1000)
rectangle_3 = Rectangle(Plane=PlaneXY(0, 0, 0), XSize=number_slider_20, YSize=number_slider_20, Radius=0)  # -> Rectangle, Length
drec_3 = DeconstuctRectangle(Rectangle=rectangle_3.Rectangle)  # -> BasePlane, XInterval, YInterval
dedomain_3 = DeconstructDomain(Domain=drec_3.YInterval)  # -> Start, End
subtraction_3 = Subtraction(A=dedomain_3.End, B=dedomain_3.Start)
division_5 = Division(A=subtraction_3, B=2)
dom_7 = ConstructDomain(DomainStart=0, DomainEnd=1)
addition_3 = Addition(A=dedomain_3.Start, B=division_5)
number_slider_21 = Slider(0.852, range=0..1)
dom_8 = ConstructDomain(DomainStart=addition_3, DomainEnd=dedomain_3.End)
dom_9 = ConstructDomain(DomainStart=addition_3, DomainEnd=dedomain_3.Start)
remap_9 = RemapNumbers(Value=number_slider_21, Source=dom_7, Target=dom_9)  # -> Mapped, Clipped
remap_10 = RemapNumbers(Value=Slider(0, range=0..1), Source=dom_7, Target=drec_3.XInterval)  # -> Mapped, Clipped
remap_11 = RemapNumbers(Value=number_slider_21, Source=dom_7, Target=dom_8)  # -> Mapped, Clipped
remap_12 = RemapNumbers(Value=Slider(0, range=0..1), Source=dom_7, Target=drec_3.XInterval)  # -> Mapped, Clipped
pt_9 = ConstructPoint(XCoordinate=0, YCoordinate=remap_10.Mapped, ZCoordinate=0)
pt_10 = ConstructPoint(XCoordinate=remap_9.Mapped, YCoordinate=remap_12.Mapped, ZCoordinate=0)
pt_11 = ConstructPoint(XCoordinate=remap_11.Mapped, YCoordinate=remap_12.Mapped, ZCoordinate=0)
pt_12 = ConstructPoint(XCoordinate=number_slider_20, YCoordinate=remap_10.Mapped, ZCoordinate=0)
merge_3 = Merge(Data1=pt_9, Data2=pt_10, Data3=pt_11, Data4=pt_12)
nurbs_3 = NurbsCurve(Vertices=merge_3, Degree=2, Periodic=False)  # -> Curve, Length, Domain

number_slider_22 = Slider(1000, range=0..1000)
rectangle_4 = Rectangle(Plane=PlaneXY(0, 0, 0), XSize=number_slider_22, YSize=number_slider_22, Radius=0)  # -> Rectangle, Length
drec_4 = DeconstuctRectangle(Rectangle=rectangle_4.Rectangle)  # -> BasePlane, XInterval, YInterval
dedomain_4 = DeconstructDomain(Domain=drec_4.YInterval)  # -> Start, End
subtraction_4 = Subtraction(A=dedomain_4.End, B=dedomain_4.Start)
division_6 = Division(A=subtraction_4, B=2)
number_slider_23 = Slider(0.37, range=0..1)
dom_10 = ConstructDomain(DomainStart=0, DomainEnd=1)
addition_4 = Addition(A=dedomain_4.Start, B=division_6)
dom_11 = ConstructDomain(DomainStart=addition_4, DomainEnd=dedomain_4.End)
dom_12 = ConstructDomain(DomainStart=addition_4, DomainEnd=dedomain_4.Start)
remap_13 = RemapNumbers(Value=number_slider_23, Source=dom_10, Target=dom_12)  # -> Mapped, Clipped
remap_14 = RemapNumbers(Value=Slider(0.6, range=0..1), Source=dom_10, Target=drec_4.XInterval)  # -> Mapped, Clipped
remap_15 = RemapNumbers(Value=number_slider_23, Source=dom_10, Target=dom_11)  # -> Mapped, Clipped
remap_16 = RemapNumbers(Value=Slider(0.4, range=0..1), Source=dom_10, Target=drec_4.XInterval)  # -> Mapped, Clipped
pt_13 = ConstructPoint(XCoordinate=0, YCoordinate=remap_14.Mapped, ZCoordinate=0)
pt_14 = ConstructPoint(XCoordinate=remap_13.Mapped, YCoordinate=remap_16.Mapped, ZCoordinate=0)
pt_15 = ConstructPoint(XCoordinate=remap_15.Mapped, YCoordinate=remap_16.Mapped, ZCoordinate=0)
pt_16 = ConstructPoint(XCoordinate=number_slider_22, YCoordinate=remap_14.Mapped, ZCoordinate=0)
merge_4 = Merge(Data1=pt_13, Data2=pt_14, Data3=pt_15, Data4=pt_16)
nurbs_4 = NurbsCurve(Vertices=merge_4, Degree=2, Periodic=False)  # -> Curve, Length, Domain

number_slider_24 = Slider(1000, range=0..1000)
rectangle_5 = Rectangle(Plane=PlaneXY(0, 0, 0), XSize=number_slider_24, YSize=number_slider_24, Radius=0)  # -> Rectangle, Length
drec_5 = DeconstuctRectangle(Rectangle=rectangle_5.Rectangle)  # -> BasePlane, XInterval, YInterval
dedomain_5 = DeconstructDomain(Domain=drec_5.YInterval)  # -> Start, End
subtraction_5 = Subtraction(A=dedomain_5.End, B=dedomain_5.Start)
division_7 = Division(A=subtraction_5, B=2)
dom_13 = ConstructDomain(DomainStart=0, DomainEnd=1)
addition_5 = Addition(A=dedomain_5.Start, B=division_7)
number_slider_25 = Slider(0.852, range=0..1)
dom_14 = ConstructDomain(DomainStart=addition_5, DomainEnd=dedomain_5.End)
dom_15 = ConstructDomain(DomainStart=addition_5, DomainEnd=dedomain_5.Start)
remap_17 = RemapNumbers(Value=number_slider_25, Source=dom_13, Target=dom_15)  # -> Mapped, Clipped
remap_18 = RemapNumbers(Value=Slider(1, range=0..1), Source=dom_13, Target=drec_5.XInterval)  # -> Mapped, Clipped
remap_19 = RemapNumbers(Value=number_slider_25, Source=dom_13, Target=dom_14)  # -> Mapped, Clipped
remap_20 = RemapNumbers(Value=Slider(1, range=0..1), Source=dom_13, Target=drec_5.XInterval)  # -> Mapped, Clipped
pt_17 = ConstructPoint(XCoordinate=0, YCoordinate=remap_18.Mapped, ZCoordinate=0)
pt_18 = ConstructPoint(XCoordinate=remap_17.Mapped, YCoordinate=remap_20.Mapped, ZCoordinate=0)
pt_19 = ConstructPoint(XCoordinate=remap_19.Mapped, YCoordinate=remap_20.Mapped, ZCoordinate=0)
pt_20 = ConstructPoint(XCoordinate=number_slider_24, YCoordinate=remap_18.Mapped, ZCoordinate=0)
merge_5 = Merge(Data1=pt_17, Data2=pt_18, Data3=pt_19, Data4=pt_20)
nurbs_5 = NurbsCurve(Vertices=merge_5, Degree=2, Periodic=False)  # -> Curve, Length, Domain

number_slider_26 = Slider(1000, range=0..1000)
rectangle_6 = Rectangle(Plane=PlaneXY(0, 0, 0), XSize=number_slider_26, YSize=number_slider_26, Radius=0)  # -> Rectangle, Length
drec_6 = DeconstuctRectangle(Rectangle=rectangle_6.Rectangle)  # -> BasePlane, XInterval, YInterval
dedomain_6 = DeconstructDomain(Domain=drec_6.YInterval)  # -> Start, End
subtraction_6 = Subtraction(A=dedomain_6.End, B=dedomain_6.Start)
division_8 = Division(A=subtraction_6, B=2)
dom_16 = ConstructDomain(DomainStart=0, DomainEnd=1)
addition_6 = Addition(A=dedomain_6.Start, B=division_8)
number_slider_27 = Slider(0.743, range=0..1)
dom_17 = ConstructDomain(DomainStart=addition_6, DomainEnd=dedomain_6.End)
dom_18 = ConstructDomain(DomainStart=addition_6, DomainEnd=dedomain_6.Start)
remap_21 = RemapNumbers(Value=number_slider_27, Source=dom_16, Target=dom_18)  # -> Mapped, Clipped
remap_22 = RemapNumbers(Value=Slider(0.35, range=0..1), Source=dom_16, Target=drec_6.XInterval)  # -> Mapped, Clipped
remap_23 = RemapNumbers(Value=number_slider_27, Source=dom_16, Target=dom_17)  # -> Mapped, Clipped
remap_24 = RemapNumbers(Value=Slider(0, range=0..1), Source=dom_16, Target=drec_6.XInterval)  # -> Mapped, Clipped
pt_21 = ConstructPoint(XCoordinate=0, YCoordinate=remap_22.Mapped, ZCoordinate=0)
pt_22 = ConstructPoint(XCoordinate=remap_21.Mapped, YCoordinate=remap_24.Mapped, ZCoordinate=0)
pt_23 = ConstructPoint(XCoordinate=remap_23.Mapped, YCoordinate=remap_24.Mapped, ZCoordinate=0)
pt_24 = ConstructPoint(XCoordinate=number_slider_26, YCoordinate=remap_22.Mapped, ZCoordinate=0)
merge_6 = Merge(Data1=pt_21, Data2=pt_22, Data3=pt_23, Data4=pt_24)
nurbs_6 = NurbsCurve(Vertices=merge_6, Degree=2, Periodic=False)  # -> Curve, Length, Domain

number_slider_28 = Slider(1000, range=0..1000)
rectangle_7 = Rectangle(Plane=PlaneXY(0, 0, 0), XSize=number_slider_28, YSize=number_slider_28, Radius=0)  # -> Rectangle, Length
drec_7 = DeconstuctRectangle(Rectangle=rectangle_7.Rectangle)  # -> BasePlane, XInterval, YInterval
dedomain_7 = DeconstructDomain(Domain=drec_7.YInterval)  # -> Start, End
subtraction_7 = Subtraction(A=dedomain_7.End, B=dedomain_7.Start)
division_9 = Division(A=subtraction_7, B=2)
number_slider_29 = Slider(0.466, range=0..1)
dom_19 = ConstructDomain(DomainStart=0, DomainEnd=1)
addition_7 = Addition(A=dedomain_7.Start, B=division_9)
dom_20 = ConstructDomain(DomainStart=addition_7, DomainEnd=dedomain_7.End)
dom_21 = ConstructDomain(DomainStart=addition_7, DomainEnd=dedomain_7.Start)
remap_25 = RemapNumbers(Value=number_slider_29, Source=dom_19, Target=dom_21)  # -> Mapped, Clipped
remap_26 = RemapNumbers(Value=Slider(0.1, range=0..1), Source=dom_19, Target=drec_7.XInterval)  # -> Mapped, Clipped
remap_27 = RemapNumbers(Value=number_slider_29, Source=dom_19, Target=dom_20)  # -> Mapped, Clipped
remap_28 = RemapNumbers(Value=Slider(0, range=0..1), Source=dom_19, Target=drec_7.XInterval)  # -> Mapped, Clipped
pt_25 = ConstructPoint(XCoordinate=0, YCoordinate=remap_26.Mapped, ZCoordinate=0)
pt_26 = ConstructPoint(XCoordinate=remap_25.Mapped, YCoordinate=remap_28.Mapped, ZCoordinate=0)
pt_27 = ConstructPoint(XCoordinate=remap_27.Mapped, YCoordinate=remap_28.Mapped, ZCoordinate=0)
pt_28 = ConstructPoint(XCoordinate=number_slider_28, YCoordinate=remap_26.Mapped, ZCoordinate=0)
merge_7 = Merge(Data1=pt_25, Data2=pt_26, Data3=pt_27, Data4=pt_28)
nurbs_7 = NurbsCurve(Vertices=merge_7, Degree=2, Periodic=False)  # -> Curve, Length, Domain

merge_8 = Merge(Data1=nurbs.Curve, Data2=nurbs_2.Curve, Data3=nurbs_3.Curve)
lng = ListLength(List=merge_8)
subtraction_8 = Subtraction(A=lng, B=1)
division_10 = Division(A=Slider(4466, range=0..10000), B=subtraction_8)
series = Series(Start=0, Step=division_10, Count=lng)
X = UnitX(Factor=series)
merge_9 = Merge(Data1=nurbs_6.Curve, Data2=nurbs_7.Curve, Data3=nurbs_4.Curve, Data4=nurbs_5.Curve)
neg = Negative(Value=Slider(3000, range=0..3000))
move = Move(Geometry=merge_8, Motion=X)  # -> Geometry, Transform
lng_2 = ListLength(List=merge_9)

crv = Curve(merge_8)
lng_3 = ListLength(List=crv)  # -> expr("x-2", Length)
dom_22 = ConstructDomain(DomainStart=0, DomainEnd=lng_3)
subset = SubList(List=crv, Domain=dom_22, Wrap=True)  # -> graft(List), Index
shift = ShiftList(List=crv, Shift=1, Wrap=False)  # -> graft(List)
merge_10 = Merge(Data1=subset.List, Data2=shift)  # -> simplify(Result)
group = Group(Objects=merge_10)  # -> flatten(Group)

Y = UnitY(Factor=neg)
subtraction_9 = Subtraction(A=lng_2, B=1)
move_2 = Move(Geometry=move.Geometry, Motion=Y)  # -> Geometry, Transform

crv_2 = Curve(merge_9)
lng_4 = ListLength(List=crv_2)  # -> expr("x-2", Length)
dom_23 = ConstructDomain(DomainStart=0, DomainEnd=lng_4)
subset_2 = SubList(List=crv_2, Domain=dom_23, Wrap=True)  # -> graft(List), Index
shift_2 = ShiftList(List=crv_2, Shift=1, Wrap=False)  # -> graft(List)
merge_11 = Merge(Data1=subset_2.List, Data2=shift_2)  # -> simplify(Result)
group_2 = Group(Objects=merge_11)  # -> flatten(Group)

data = Data(dec_pan.HMaxels)
dec_hmaxel = DeconstructHMaxel(HMaxel=data)  # -> PassiveLayers, ActiveBoards, Height, RowRange, ColumnRange, DesiredRadius, BlendedRadius, ShapedHMaxel
rectangle_8 = Rectangle(Plane=PlaneXY(0, 0, 0), XSize=dec_hmaxel.RowRange, YSize=dec_hmaxel.ColumnRange, Radius=0)  # -> Rectangle, Length
area = Area(Geometry=rectangle_8.Rectangle)  # -> Area, Centroid

division_11 = Division(A=Slider(4466, range=0..10000), B=subtraction_9)
series_2 = Series(Start=0, Step=division_11, Count=lng_2)
X_2 = UnitX(Factor=series_2)
neg_2 = Negative(Value=Slider(2261, range=0..3000))
move_3 = Move(Geometry=merge_9, Motion=X_2)  # -> Geometry, Transform

num_3 = Number(dec_pan.WidthRange)
num_4 = Number(dec_pan.LengthRange)
dedomain_8 = DeconstructDomain(Domain=num_3)  # -> Start, End
subtraction_10 = Subtraction(A=dedomain_8.End, B=dedomain_8.Start)
division_12 = Division(A=subtraction_10, B=2)
number_slider_30 = Slider(0.174, range=0..1)
addition_8 = Addition(A=dedomain_8.Start, B=division_12)
dom_24 = ConstructDomain(DomainStart=0, DomainEnd=1)
dom_25 = ConstructDomain(DomainStart=addition_8, DomainEnd=dedomain_8.End)
dom_26 = ConstructDomain(DomainStart=addition_8, DomainEnd=dedomain_8.Start)
remap_29 = RemapNumbers(Value=Slider(0.36, range=0.25..1), Source=dom_24, Target=num_4)  # -> Mapped, Clipped
remap_30 = RemapNumbers(Value=Slider(0.051, range=0..0.75), Source=dom_24, Target=num_4)  # -> Mapped, Clipped
remap_31 = RemapNumbers(Value=number_slider_30, Source=dom_24, Target=dom_26)  # -> Mapped, Clipped
remap_32 = RemapNumbers(Value=number_slider_30, Source=dom_24, Target=dom_25)  # -> Mapped, Clipped
pt_29 = ConstructPoint(XCoordinate=remap_29.Mapped, YCoordinate=dedomain_8.Start, ZCoordinate=0)
pt_30 = ConstructPoint(XCoordinate=remap_30.Mapped, YCoordinate=remap_31.Mapped, ZCoordinate=0)
pt_31 = ConstructPoint(XCoordinate=remap_30.Mapped, YCoordinate=remap_32.Mapped, ZCoordinate=0)
pt_32 = ConstructPoint(XCoordinate=remap_29.Mapped, YCoordinate=dedomain_8.End, ZCoordinate=0)
merge_12 = Merge(Data1=pt_29, Data2=pt_30, Data3=pt_31, Data4=pt_32)
nurbs_8 = NurbsCurve(Vertices=merge_12, Degree=2, Periodic=False)  # -> Curve, Length, Domain

Y_2 = UnitY(Factor=neg_2)
move_4 = Move(Geometry=move_3.Geometry, Motion=Y_2)  # -> Geometry, Transform

# ---- group: generate distribution
pt_33 = Point(simplify(area.Centroid))
data_2 = Data(group)
pdecon = Deconstruct(Point=pt_33)  # -> XComponent, YComponent, ZComponent
bnd = Bounds(Numbers=flatten(pdecon.XComponent))
bnd_2 = Bounds(Numbers=flatten(pdecon.YComponent))
lng_5 = ListLength(List=data_2)
dedomain_9 = DeconstructDomain(Domain=bnd)  # -> Start, End
remap_33 = RemapNumbers(Value=pdecon.YComponent, Source=bnd_2, Target=Domain(0, 1))  # -> graft(Mapped), Clipped
c_script = CSharpScript(count=lng_5, start=dedomain_9.Start, end=dedomain_9.End)  # -> out, A; inputs count: Int32, start: Double, end: Double
# ---------- c_script: C# ----------
    double totalLength = end - start;
    double domLength = totalLength / (double) count;

    List<Interval> intervals = new List<Interval>();
    double currentStart = start;
    for(int i = 0; i < count; i++)
    {
      intervals.Add(new Interval(currentStart, currentStart + domLength));
      currentStart += domLength;
    }
    A = intervals;
# ---------- end c_script ----------
num_5 = Number(graft(pdecon.XComponent))
inc = Includes(Value=num_5, Domain=simplify(c_script.A))  # -> Includes, Deviation
cull = CullPattern(List=data_2, CullPattern=inc.Includes)
item = ListItem(List=cull, Index=0, Wrap=True)
cull_2 = CullPattern(List=c_script.A, CullPattern=inc.Includes)
ungroup = Ungroup(Group=item)  # -> simplify(Objects)
item_2 = ListItem(List=cull_2, Index=0, Wrap=True)
remap_34 = RemapNumbers(Value=num_5, Source=item_2, Target=Domain(0, 1))  # -> Mapped, Clipped
eval = EvaluateCurve(Curve=reparameterize(ungroup), Parameter=remap_33.Mapped)  # -> Point, Tangent, Angle
pdecon_2 = Deconstruct(Point=eval.Point)  # -> XComponent, YComponent, ZComponent
item_3 = ListItem(List=pdecon_2.YComponent, Index=0, Wrap=True)  # -> Item, Item1
twn2nums = TweenTwoNumbers(NumberA=item_3.Item, NumberB=item_3.Item1, Factor=remap_34.Mapped)
num_6 = Number(twn2nums)

pt_34 = Point(simplify(area.Centroid))
data_3 = Data(group_2)
pdecon_3 = Deconstruct(Point=pt_34)  # -> XComponent, YComponent, ZComponent
bnd_3 = Bounds(Numbers=flatten(pdecon_3.XComponent))
bnd_4 = Bounds(Numbers=flatten(pdecon_3.YComponent))
lng_6 = ListLength(List=data_3)
dedomain_10 = DeconstructDomain(Domain=bnd_3)  # -> Start, End
remap_35 = RemapNumbers(Value=pdecon_3.YComponent, Source=bnd_4, Target=Domain(0, 1))  # -> graft(Mapped), Clipped
c_script_2 = CSharpScript(count=lng_6, start=dedomain_10.Start, end=dedomain_10.End)  # -> out, A; inputs count: Int32, start: Double, end: Double; same code as c_script
num_7 = Number(graft(pdecon_3.XComponent))
inc_2 = Includes(Value=num_7, Domain=simplify(c_script_2.A))  # -> Includes, Deviation
cull_3 = CullPattern(List=data_3, CullPattern=inc_2.Includes)
item_4 = ListItem(List=cull_3, Index=0, Wrap=True)
cull_4 = CullPattern(List=c_script_2.A, CullPattern=inc_2.Includes)
ungroup_2 = Ungroup(Group=item_4)  # -> simplify(Objects)
item_5 = ListItem(List=cull_4, Index=0, Wrap=True)
remap_36 = RemapNumbers(Value=num_7, Source=item_5, Target=Domain(0, 1))  # -> Mapped, Clipped
eval_2 = EvaluateCurve(Curve=reparameterize(ungroup_2), Parameter=remap_35.Mapped)  # -> Point, Tangent, Angle
pdecon_4 = Deconstruct(Point=eval_2.Point)  # -> XComponent, YComponent, ZComponent
item_6 = ListItem(List=pdecon_4.YComponent, Index=0, Wrap=True)  # -> Item, Item1
twn2nums_2 = TweenTwoNumbers(NumberA=item_6.Item, NumberB=item_6.Item1, Factor=remap_36.Mapped)
num_8 = Number(twn2nums_2)

# ---- group: material / beech
data_4 = Data(species)

# ---- group: material / Species
crv_3 = Curve(nurbs_8.Curve)

# ---- group: material / spruce
data_5 = Data(species_2)

# ---- group: material
pt_35 = Point(graft(area.Centroid))
xz = XZPlane(Origin=pt_35)
pcx = CurvePlane(Curve=crv_3, Plane=xz)  # -> simplify(Points), ParamsC, ParamsP
pdecon_5 = Deconstruct(Point=pcx.Points)  # -> XComponent, YComponent, ZComponent
pdecon_6 = Deconstruct(Point=pt_35)  # -> XComponent, YComponent, ZComponent
smaller = SmallerThan(FirstNumber=pdecon_5.XComponent, SecondNumber=pdecon_6.XComponent)  # -> SmallerThan, OrEqualTo
not = GateNot(A=smaller.SmallerThan)
cull_5 = CullPattern(List=data_4, CullPattern=not)
cull_6 = CullPattern(List=data_5, CullPattern=smaller.SmallerThan)
merge_13 = Merge(Data1=cull_5, Data2=cull_6)  # -> simplify(Result)
dup = DuplicateData(Data=merge_13, Number="2", Order=True)  # -> simplify(Data)

# ----
num_9 = Number(num_6)
rec = Rectangle(rectangle.Rectangle)
drec_8 = DeconstuctRectangle(Rectangle=rec)  # -> BasePlane, XInterval, YInterval
dom_27 = ConstructDomain(DomainStart=Slider(25, range=0..100), DomainEnd=Slider(75, range=0..100))
remap_37 = RemapNumbers(Value=num_9, Source=drec_8.YInterval, Target=dom_27)  # -> Mapped, Clipped
trim = TrimTree(Tree=remap_37.Mapped, Depth=1)

num_10 = Number(num_8)
rec_2 = Rectangle(rectangle.Rectangle)
drec_9 = DeconstuctRectangle(Rectangle=rec_2)  # -> BasePlane, XInterval, YInterval
dom_28 = ConstructDomain(DomainStart=0, DomainEnd=1)
remap_38 = RemapNumbers(Value=num_10, Source=drec_9.YInterval, Target=dom_28)  # -> Mapped, Clipped
trim_2 = TrimTree(Tree=remap_38.Mapped, Depth=1)

data_6 = Data(panel_3)
data_7 = Data(species_2)
data_8 = Data(dec_pan.HMaxels)

data_9 = Data(data_6)
panel_4 = Panel("""0
1""")
data_10 = Data(data_7)
bilayer = ConstructBilayer(
    Panel=data_9,
    BoardLength=Slider(5, range=0..10),
    RowOffsets=panel_4,
    PassiveSpecies=data_10,
    ActiveThickness=Slider(20, range=0..100),
    PassiveThickness=Slider(4, range=0..10))

data_11 = Data(data_6)
panel_5 = Panel("""1
0""")
data_12 = Data(data_7)
bilayer_2 = ConstructBilayer(
    Panel=data_11,
    BoardLength=Slider(5, range=0..10),
    RowOffsets=panel_5,
    PassiveSpecies=data_12,
    ActiveThickness=Slider(20, range=0..100),
    PassiveThickness=Slider(4, range=0..10))

up_hmaxel = UpdateHMaxel(HMaxel=simplify(data_8), Height=simplify(trim), RadiusFactor=simplify(trim_2), Species=simplify(dup))  # -> flatten(HMaxel)
merge_14 = Merge(Data1=bilayer, Data2=bilayer_2)
data_13 = Data(panel_3)
up_pan = UpdatePanel(Panel=data_13, Bilayers=merge_14, HMaxels=up_hmaxel)
number_slider_31 = Slider(6, range=0..10)
num_11 = Number(num_2)
division_13 = Division(A=num_11, B=number_slider_31)
num_12 = Number(dec_pan.WidthRange)
num_13 = Number(dec_pan.LengthRange)
rectangle_9 = Rectangle(Plane=PlaneXY(0, 0, 0), XSize=num_13, YSize=num_12, Radius=0)  # -> Rectangle, Length
boundary = BoundarySurfaces(Edges=rectangle_9.Rectangle)

num_14 = Number(dec_pan.WidthRange)
num_15 = Number(dec_pan.LengthRange)
dedomain_11 = DeconstructDomain(Domain=num_14)  # -> Start, End
subtraction_11 = Subtraction(A=dedomain_11.End, B=dedomain_11.Start)
division_14 = Division(A=subtraction_11, B=2)
number_slider_32 = Slider(0.4, range=0..1)
addition_9 = Addition(A=dedomain_11.Start, B=division_14)
dom_29 = ConstructDomain(DomainStart=0, DomainEnd=1)
dom_30 = ConstructDomain(DomainStart=addition_9, DomainEnd=dedomain_11.End)
dom_31 = ConstructDomain(DomainStart=addition_9, DomainEnd=dedomain_11.Start)
remap_39 = RemapNumbers(Value=Slider(0.415, range=0.25..1), Source=dom_29, Target=num_15)  # -> Mapped, Clipped
remap_40 = RemapNumbers(Value=Slider(0.256, range=0..1), Source=dom_29, Target=num_15)  # -> Mapped, Clipped
remap_41 = RemapNumbers(Value=number_slider_32, Source=dom_29, Target=dom_31)  # -> Mapped, Clipped
remap_42 = RemapNumbers(Value=number_slider_32, Source=dom_29, Target=dom_30)  # -> Mapped, Clipped
pt_36 = ConstructPoint(XCoordinate=remap_39.Mapped, YCoordinate=dedomain_11.Start, ZCoordinate=0)
pt_37 = ConstructPoint(XCoordinate=remap_40.Mapped, YCoordinate=remap_41.Mapped, ZCoordinate=0)
pt_38 = ConstructPoint(XCoordinate=remap_40.Mapped, YCoordinate=remap_42.Mapped, ZCoordinate=0)
pt_39 = ConstructPoint(XCoordinate=remap_39.Mapped, YCoordinate=dedomain_11.End, ZCoordinate=0)
merge_15 = Merge(Data1=pt_36, Data2=pt_37, Data3=pt_38, Data4=pt_39)
nurbs_9 = NurbsCurve(Vertices=merge_15, Degree=2, Periodic=False)  # -> Curve, Length, Domain
divide = DivideCurve(Curve=nurbs_9.Curve, Count=Slider(50, range=0..100), Kinks=False)  # -> Points, Tangents, Parameters
srf_cp = SurfaceClosestPoint(Point=divide.Points, Surface=boundary)  # -> Point, UVPoint, Distance

lamination_width = Slider(991, range=0..1500)
num_16 = Number(division)
number_slider_33 = Slider(24, range=0..100)
Z = UnitZ(Factor=Slider(89, range=0..1000))
number_slider_34 = Slider(1071, range=0..10000)
material_buildups = Panel("""100
200
300
150
250
350""")  # disabled

# ---- group: Support Points
brep = Brep()  # disabled
number_slider_35 = Slider(10, range=0..10)  # disabled
debrep = DeconstructBrep(Brep=brep)  # -> simplify(Faces), Edges, flatten(Vertices); disabled
pdecon_7 = Deconstruct(Point=debrep.Vertices)  # -> XComponent, YComponent, ZComponent; disabled
panel_6 = Panel("0")  # disabled
equalst = EqualityWithinTolerance(FirstNumber=pdecon_7.XComponent, SecondNumber=panel_6, Tolerance=number_slider_35)  # -> Equality, Inequality; disabled
cull_7 = CullPattern(List=debrep.Vertices, CullPattern=equalst.Equality)  # disabled

# ---- group: Create_Data_Path
button = Button()  # disabled

# ----
panel_7 = Panel("C:\Program Files\SOFiSTiK\2020\SOFiSTiK 2020\wps.exe")  # disabled
panel_8 = Panel("C:\Program Files\SOFiSTiK\2020\SOFiSTiK 2020\sof_cdb_w-70.dll")  # disabled
panel_9 = Panel("C:\Program Files\SOFiSTiK\2023\SOFiSTiK 2023\wps.exe")  # disabled
panel_10 = Panel("C:\Program Files\SOFiSTiK\2023\SOFiSTiK 2023\sof_cdb_w_edu-2023.dll")  # disabled
sofistik_path = ValueList({"2022-Edgar": 1, "2022-Other Users": 2}, selected="2022-Edgar")  # disabled
entwine = Entwine(Branch00=panel_7, Branch01=panel_8, FlattenInputs=True)  # -> simplify(Result); disabled
entwine_2 = Entwine(Branch00=panel_9, Branch01=panel_10, FlattenInputs=True)  # -> simplify(Result); disabled
filter = StreamFilter(Gate=sofistik_path, Stream0=entwine, Stream1=entwine_2)  # disabled
bang = ExplodeTree(Data=filter)  # -> Branch0, Branch1; disabled
pathwps_exe = Data(bang.Branch0)  # disabled
pathcdb_dll = FilePath(bang.Branch1)  # disabled
pathinfo = PathInfo()  # -> Directory, Filename, Path; disabled
panel_11 = Panel("structure")  # disabled
panel_12 = Panel("\")  # disabled
concat = Concatenate(FragmentA=pathinfo.Path)  # disabled
concat_2 = Concatenate(FragmentA=pathinfo.Path, FragmentB=panel_12, FragmentD=panel_11)  # disabled
createfolder = CSharpScript(path=concat, create=button)  # -> out, A; inputs path: String, create: Boolean; disabled
# ---------- createfolder: C# ----------
 
    
    if (create)
    {    
      if(!System.IO.Directory.Exists(path))
        System.IO.Directory.CreateDirectory(path);
    }
# ---------- end createfolder ----------
panel_13 = Panel(concat)  # disabled
panel_14 = Panel(concat_2)  # disabled
path = Data(panel_14)  # disabled

# ---- group: Support Points / surfaces
srf = Surface(debrep.Faces)  # disabled

# ---- group: Support Points / support points
pt_40 = Point(cull_7)  # disabled

# ---- group: Support Points
panel_15 = Panel("0.001")  # disabled
scale = Scale(Geometry=brep, Center=Point(0, 0, 0), Factor=panel_15)  # -> Geometry, Transform; disabled
scale_2 = Scale(Geometry=pt_40, Center=Point(0, 0, 0), Factor=panel_15)  # -> Geometry, Transform; disabled
pt_41 = Point(scale_2.Geometry)  # disabled

# ----
panel_16 = Panel("10000")  # disabled
panel_17 = Panel("0.13")  # disabled
panel_18 = Panel("-0.005")  # disabled
panel_19 = Panel("1.8")  # disabled
assemble_mesh_properties_sofimesh = AssembleMeshPropertiesSofiMesh(
    GroupDivisor=panel_16,
    Topo="ON 0",
    TolG=panel_18,
    HMin=panel_17,
    Fein=panel_17,
    EFak=panel_19,
    Prog=panel_19,
    NodeIndex=1000)  # disabled

button_2 = Button()  # disabled
panel_20 = Panel("""101
200
201
300
301""")  # disabled
panel_21 = Panel("""100
200
200
200
200""")  # disabled
support = RemoteSender(pt_41)  # disabled
number_slider_36 = Slider(7.6, range=0..10)  # disabled
num_17 = Number(panel_20)  # disabled
panel_22 = Panel("5.6")  # disabled
panel_23 = Panel("")  # disabled
# timb no 11 ep 17136[N/mm2] g 667[N/mm2] e90 370[N/mm2] g90 50[N/mm2] gam 7.2[KN/m3]
panel_24 = Panel("beech")  # disabled
# timb no 11 ep 12200[N/mm2] g 690[N/mm2] e90 370[N/mm2] g90 50[N/mm2] gam 4.8[KN/m3]
panel_25 = Panel("Süruce")  # disabled

# ---- group: AQUA
material = Panel("""KOPF
UNIT 5
NORM 'DIN' 'en199x-200x' COUN 49 UNIT 5

HOLZ 1    C '24:1' E90 370 BEZ "=Spruce"
ARBL EPS BRUC SIG 1.300000[-]
HMAT 1 TYP FOUR NSP 0.100000 A 1

HOLZ 4  PLY '40:1' TMAX 10 BEZ "=Plywood 40 Cl.1 (EN 1995)"
ARBL EPS BRUC SIG 1.200000[-]
HMAT 4 TYP FOUR NSP 0.100000 A 1

STAH 6    S '235' TMAX 40 BEZ "=S 235 (EN 10025-2)" GAM 0.0
ARBL EPS GEBR SIG 1[-]
ARBL EPS BRUC SIG 1[-] TYP  EXT
HMAT 3 TYP FOUR NSP 0 A 1

HOLZ NR 20 ep 17130[N/mm2] g 880[N/mm2] e90 1000[N/mm2] g90 61[N/mm2] gam 7.4[KN/m3]


HOLZ NR 10 ep 11000[N/mm2] g 690[N/mm2] e90 370[N/mm2] g90 50[N/mm2] gam 4.8[KN/m3]


HOLZ NR 11 ep 370[N/mm2] g 690[N/mm2] e90 12200[N/mm2] g90 50[N/mm2] gam 4.8[KN/m3]

MLAY NR 100  T0 {0}[mm]  11 $$
             T1 {1}[mm]  10 $$
             T2 {0}[mm]  11 Bez 'Bilayer'

MLAY NR 101  T0 {0}[mm]  11 $$
             T1 {1}[mm]  20 $$
             T2 {0}[mm]  11 Bez 'BilayerB'

MLAY NR 200  T0 {0}[mm]  11 $$
             T1 {1}[mm]  10 $$
	     T3 {0}[mm]  11 $$
             T4 {1}[mm]  10 $$
             T5 {0}[mm]  11 Bez '2Bilayer'

MLAY NR 201  T0 {0}[mm]  11 $$
             T1 {1}[mm]  20 $$
	     T3 {0}[mm]  11 $$
             T4 {1}[mm]  20 $$
             T5 {0}[mm]  11 Bez '2BilayerB'

MLAY NR 300  T0 {0}[mm]  11 $$
             T1 {1}[mm]  10 $$
	     T2 {0}[mm]  11 $$
             T3 {1}[mm]  10 $$
	     T4 {0}[mm]  11 $$
             T5 {1}[mm]  10 $$
             T6 {0}[mm]  11 Bez '3Bilayer'

MLAY NR 301  T0 {0}[mm]  11 $$
             T1 {1}[mm]  20 $$
	     T2 {0}[mm]  11 $$
             T3 {1}[mm]  20 $$
	     T4 {0}[mm]  11 $$
             T5 {1}[mm]  20 $$
             T6 {0}[mm]  11 Bez '3BilayerB'""")  # disabled
panel_26 = Panel("20")  # disabled
panel_27 = Panel("4")  # disabled
format = Format(Format=material, Culture=127, Data0=panel_27, Data1=panel_26)  # disabled
panel_28 = Panel(format)  # disabled
aqua_file = Data(panel_28)  # disabled

# ----
support_2 = RemoteReceiver(support)  # disabled
# Ase: +prog ase urs:5 $ SINGLE LCs
# kopf
# steu solv 4
# WARN = 120,575
# syst prob line iter 1000
# lf 1000 egz 1.0 bez 'G'
# ende
number_slider_37 = Slider(0.05, range=0..0.1)  # disabled

ase = Panel("""+prog ase urs:5 $ SINGLE LCs
kopf
steu solv 4
WARN = 120,575
syst prob line iter 1000
lf 1000 egz 1.0 bez 'G'
ende""")  # disabled
# SLS: $--------------------------
# $SOLVER
# #define SOLV = 4 $4 = paralleles Rechnen
# #define WARN = 120,575
# $SYSTEM
# #define PROB = TH3
# #define nITER = 250
# #define FMAX = 1.1
# #define TOL = -0.0001
# #define NMAT = nein
# #define ITER = 3 W2 1 $3 W2 1 = Update Steifigkeit nach jedem Iterationsschritt
# $SEILE
# #define SEIL = 0 $0=ohne inneren Seildurchhang; 2=mit
# $Deadload
# #define G=1.00
# $--------------------------
# 
# +PROG ASE
# #define LF =100
# #define BEZ='1.0G+1.0Gadd'
# KOPF LF$(LF): $(BEZ)
# STEU SOLV $(SOLV) ; STEU ITER $(ITER) ; STEU SEIL $(SEIL)
# SYST PROB $(PROB) ITER $(nITER) FMAX $(FMAX) TOL $(TOL) NMAT $(NMAT)
# STEU WARN $(WARN)
# GRUP      -  $ alle Gruppen einschalten
# 
# LF $(LF) EGZ $(G)*1.0 BEZ $(BEZ)
# LC 1001 FAKT 1.0 $Gadd
# ENDE
# 
# +PROG ASE
# #define LF =101
# #define BEZ='1.0G+1.0Gadd+1.0Code'
# KOPF LF$(LF): $(BEZ)
# STEU SOLV $(SOLV) ; STEU ITER $(ITER) ; STEU SEIL $(SEIL)
# SYST PROB $(PROB) ITER $(nITER) FMAX $(FMAX) TOL $(TOL) NMAT $(NMAT)
# STEU WARN $(WARN)
# GRUP      -  $ alle Gruppen einschalten
# 
# LF $(LF) EGZ $(G)*1.0 BEZ $(BEZ)
# LC 1001 FAKT 1.0 $Gadd
# LC 1002 FAKT 1.0 $Code
# ENDE
# 
# +PROG ASE
# #define LF =102
# #define BEZ='1.0G+1.0Gadd+1.0Code+1.0Q1'
# KOPF LF$(LF): $(BEZ)
# STEU SOLV $(SOLV) ; STEU ITER $(ITER) ; STEU SEIL $(SEIL)
# SYST PROB $(PROB) ITER $(nITER) FMAX $(FMAX) TOL $(TOL) NMAT $(NMAT)
# STEU WARN $(WARN)
# GRUP      -  $ alle Gruppen einschalten
# 
# LF $(LF) EGZ $(G)*1.0 BEZ $(BEZ)
# LC 1001 FAKT 1.0 $Gadd
# LC 1002 FAKT 1.0 $Code
# LC 1003 FAKT 1.0 $Q1
# ENDE
sls = Panel("""$--------------------------
$SOLVER
#define SOLV = 4 $4 = paralleles Rechnen
#define WARN = 120,575
$SYSTEM
#define PROB = line
#define nITER = 250
#define FMAX = 1.1
#define TOL = -0.01
#define NMAT = nein
#define ITER = 3 W2 1 $3 W2 1 = Update Steifigkeit nach jedem Iterationsschritt
$SEILE
#define SEIL = 0 $0=ohne inneren Seildurchhang; 2=mit
$Deadload
#define G=1.00
$--------------------------

+PROG ASE
#define LF =101
#define BEZ='1.0G+1.0Gadd+1.0Code'
KOPF LF$(LF): $(BEZ)
STEU SOLV $(SOLV) ; STEU ITER $(ITER) ; STEU SEIL $(SEIL)
SYST PROB $(PROB) ITER $(nITER) FMAX $(FMAX) TOL $(TOL) NMAT $(NMAT)
STEU WARN $(WARN)
GRUP      -  $ alle Gruppen einschalten

LF $(LF) EGZ $(G)*1.0 BEZ $(BEZ)
LC 1001 FAKT 1.0 $Gadd
LC 1002 FAKT 1.0 $Code
ENDE""")  # disabled
# ULS: $--------------------------
# $SOLVER
# #define SOLV = 4 $4 = paralleles Rechnen
# #define WARN =  120,575
# $SYSTEM
# #define PROB = TH3
# #define nITER = 250
# #define FMAX = 1.1
# #define TOL = -0.0001
# #define NMAT = nein
# #define ITER = 3 W2 1 $3 W2 1 = Update Steifigkeit nach jedem Iterationsschritt
# $SEILE
# #define SEIL = 0 $0=ohne inneren Seildurchhang; 2=mit
# $Deadload
# #define G=1.00
# $--------------------------
# 
# +PROG ASE
# #define LF =200
# #define BEZ='1.35G+1.35Gadd'
# KOPF LF$(LF): $(BEZ)
# STEU SOLV $(SOLV) ; STEU ITER $(ITER) ; STEU SEIL $(SEIL)
# SYST PROB $(PROB) ITER $(nITER) FMAX $(FMAX) TOL $(TOL) NMAT $(NMAT)
# STEU WARN $(WARN)
# GRUP      -  $ alle Gruppen einschalten
# 
# LF $(LF) EGZ $(G)*1.35 BEZ $(BEZ)
# LC 1001 FAKT 1.35 $Gadd
# ENDE
# 
# +PROG ASE
# #define LF =201
# #define BEZ='1.35G+1.35Gadd+1.5Code'
# KOPF LF$(LF): $(BEZ)
# STEU SOLV $(SOLV) ; STEU ITER $(ITER) ; STEU SEIL $(SEIL)
# SYST PROB $(PROB) ITER $(nITER) FMAX $(FMAX) TOL $(TOL) NMAT $(NMAT)
# STEU WARN $(WARN)
# GRUP      -  $ alle Gruppen einschalten
# 
# LF $(LF) EGZ $(G)*1.35 BEZ $(BEZ)
# LC 1001 FAKT 1.35 $Gadd
# LC 1002 FAKT 1.5 $Code
# ENDE
# 
# +PROG ASE
# #define LF =202
# #define BEZ='1.35G+1.35Gadd+1.5Code+1.5Q1'
# KOPF LF$(LF): $(BEZ)
# STEU SOLV $(SOLV) ; STEU ITER $(ITER) ; STEU SEIL $(SEIL)
# SYST PROB $(PROB) ITER $(nITER) FMAX $(FMAX) TOL $(TOL) NMAT $(NMAT)
# STEU WARN $(WARN)
# GRUP      -  $ alle Gruppen einschalten
# 
# LF $(LF) EGZ $(G)*1.35 BEZ $(BEZ)
# LC 1001 FAKT 1.35 $Gadd
# LC 1002 FAKT 1.5 $Code
# LC 1003 FAKT 1.5 $Q1
# ENDE
uls = Panel("""$--------------------------
$SOLVER
#define SOLV = 4 $4 = paralleles Rechnen
#define WARN =  120,575
$SYSTEM
#define PROB = line
#define nITER = 250
#define FMAX = 1.1
#define TOL = -0.01
#define NMAT = nein
#define ITER = 3 W2 1 $3 W2 1 = Update Steifigkeit nach jedem Iterationsschritt
$SEILE
#define SEIL = 0 $0=ohne inneren Seildurchhang; 2=mit
$Deadload
#define G=1.00
$--------------------------

+PROG ASE
#define LF =201
#define BEZ='1.35G+1.35Gadd+1.5Code'
KOPF LF$(LF): $(BEZ)
STEU SOLV $(SOLV) ; STEU ITER $(ITER) ; STEU SEIL $(SEIL)
SYST PROB $(PROB) ITER $(nITER) FMAX $(FMAX) TOL $(TOL) NMAT $(NMAT)
STEU WARN $(WARN)
GRUP      -  $ alle Gruppen einschalten

LF $(LF) EGZ $(G)*1.35 BEZ $(BEZ)
LC 1001 FAKT 1.35 $Gadd
LC 1002 FAKT 1.5 $Code
ENDE""")  # disabled
merge_16 = Merge(Data1=ase, Data2=sls, Data3=uls)  # disabled

cullpt = CullDuplicates(Points=support_2, Tolerance=number_slider_37, CullMode=1)  # -> Points, Indices, Valence; disabled

# ---- group: Loading / Random Point Load / Point Load
panel_29 = Panel("1003")  # disabled
panel_30 = Panel("pzz")  # disabled
panel_31 = Panel("-1.0")  # disabled

# ----
panel_32 = Panel("KF")  # disabled
button_3 = Button()  # disabled
panel_33 = Panel("""101 SLS - Deform
202 ULS - Stresses""")  # disabled
number_slider_38 = Slider(6000, range=0..10000)  # disabled

# ---- group: Deformation / mm
kragarmlänge = Data()  # disabled
multiplication = Multiplication(A=kragarmlänge, B=1000)  # disabled
panel_34 = Panel("150")  # disabled
division_15 = Division(A=multiplication, B=panel_34)  # disabled
panel_35 = Panel(division_15)  # disabled

# ---- group: Manual Stress Calculation
panel_36 = Panel("400")  # disabled
panel_37 = Panel("5")  # disabled
panel_38 = Panel("20")  # disabled
panel_39 = Panel("5")  # disabled
panel_40 = Panel("11000")  # disabled
panel_41 = Panel("0.5")  # disabled
python = GhPythonScript(E0=panel_40, E90=panel_36, t1=panel_37, t2=panel_38, nxx=panel_39, mxx=panel_41, nyy=panel_39, myy=panel_41)  # -> out, sigma_x_top, sigma_x_bot, sig_y_top_1, sig_y_int_1, sig_y_int_2, sig_y_bot_2; disabled
# ---------- python: Python ----------
import math 

# -------------- X direction -------------
Ax  = t2
Wxx = Ax*Ax/6

sigma_nx    = nxx / Ax
sigma_mxx   = mxx / Wxx * 1000
sigma_x_top = sigma_nx - sigma_mxx
sigma_x_bot = sigma_nx + sigma_mxx


# -------------- Y direction -------------
by_eq   = E90/E0
Ay_1    = t1
Ay_2    = t2 * by_eq
Ay_eq   = Ay_1 + Ay_2 
zg_y_1  = t1/2
zg_y_2  = t1 + t2/2
zg_y    = (zg_y_1 * Ay_1 + zg_y_2 * Ay_2) / Ay_eq
Iyy_1   = t1*t1*t1/12
Iyy_2   = t2*t2*t2/12*by_eq
Iyy     = Iyy_1 + Iyy_2 + math.pow(zg_y - zg_y_1,2)*Ay_1 + math.pow(zg_y - zg_y_2,2)*Ay_2

eps_y_top = myy / Iyy / E0 * (0 - zg_y) * 1000         + nyy / Ay_eq / E0
eps_y_int = myy / Iyy / E0 * (t1 - zg_y) * 1000        + nyy / Ay_eq / E0
eps_y_bot = myy / Iyy / E0 * (t1 + t2 - zg_y) * 1000   + nyy / Ay_eq / E0

sig_y_top_1 = eps_y_top * E0
sig_y_int_1 = eps_y_int * E0 
sig_y_int_2 = eps_y_int * E90 
sig_y_bot_2 = eps_y_bot * E90
# ---------- end python ----------
panel_42 = Panel([python.sig_y_top_1, python.sig_y_int_1, python.sig_y_int_2, python.sig_y_bot_2])  # disabled

# ---- group: Manual Stress Calculation / Make sure you have used the same setting for analysis!
panel_43 = Panel("400")  # disabled
panel_44 = Panel("5")  # disabled
panel_45 = Panel("20")  # disabled
panel_46 = Panel("11000")  # disabled

# ----
panel_47 = Panel("150")  # disabled
number_slider_39 = Slider(0.2, range=0..1)  # disabled
panel_48 = Panel("150")  # disabled
number_slider_40 = Slider(0.1, range=0..1)  # disabled

number_slider_41 = Slider(28, range=0..436)  # disabled
fonts = FontTable()  # disabled
item_7 = ListItem(List=fonts, Index=number_slider_41, Wrap=True)  # disabled
panel_49 = Panel(item_7)  # disabled

# ---- group: spruce left
panel_50 = Panel("https://docs.google.com/spreadsheets/d/1Q0xuMOoM9MJtYBJnVYEzEPmUDS6WbwrvgMLvJoCEvrc/edit#gid=0")
readcell = ReadCell(
    SpreadsheetURL=panel_50,
    SheetName="Sheet1",
    CellRange="A3:B82",
    DuplicateMerged=False,
    SameLength=False,
    Read=Toggle(True))
decell = DeconstructCell(Cell=readcell)  # -> FormattedValue, UserEnteredValue, CellFormat

# ---- group: spruce left / remove null branches
c_script_3 = CSharpScript(obj=decell.FormattedValue)  # -> out, A; inputs obj: tree
# ---------- c_script_3: C# ----------
    DataTree<object> output = new DataTree<object>();
    
    int currentID = 0;
    for(int i = 0; i < obj.BranchCount; i++)
    {
      if(obj.Branch(i)[1] as string != "null")
      {
        output.AddRange(obj.Branch(i), new GH_Path(currentID));
        currentID++;
      }
    }
    A = output;
# ---------- end c_script_3 ----------

# ---- group: spruce left (continued)
item_8 = ListItem(List=c_script_3.A, Index=0, Wrap=True)  # -> flatten(Item), Item1

# ---- group: name
data_14 = Data(item_8.Item)
lng_7 = ListLength(List=data_14)
dup_2 = DuplicateData(Data="SL", Number=lng_7, Order=True)  # -> graft(Data)
txt = Text(graft(data_14))
merge_17 = Merge(Data1=simplify(dup_2), Data2=simplify(txt))
join = TextJoin(Text=merge_17)

# ---- group: rt
num_18 = Number(item_8.Item1)

# ---- group: spruce right
panel_51 = Panel("https://docs.google.com/spreadsheets/d/1Q0xuMOoM9MJtYBJnVYEzEPmUDS6WbwrvgMLvJoCEvrc/edit#gid=0")
readcell_2 = ReadCell(
    SpreadsheetURL=panel_51,
    SheetName="Sheet1",
    CellRange="D3:E70",
    DuplicateMerged=False,
    SameLength=False,
    Read=Toggle(True))
decell_2 = DeconstructCell(Cell=readcell_2)  # -> FormattedValue, UserEnteredValue, CellFormat

# ---- group: spruce right / remove null branches
c_script_4 = CSharpScript(obj=decell_2.FormattedValue)  # -> out, A; inputs obj: tree; same code as c_script_3

# ---- group: spruce right (continued)
item_9 = ListItem(List=c_script_4.A, Index=0, Wrap=True)  # -> flatten(Item), Item1

# ---- group: name
data_15 = Data(item_9.Item)
lng_8 = ListLength(List=data_15)
dup_3 = DuplicateData(Data="SR", Number=lng_8, Order=True)  # -> graft(Data)
txt_2 = Text(graft(data_15))
merge_18 = Merge(Data1=simplify(dup_3), Data2=simplify(txt_2))
join_2 = TextJoin(Text=merge_18)

# ---- group: rt
num_19 = Number(item_9.Item1)

# ----
merge_19 = Merge(Data1=join, Data2=num_18)
merge_20 = Merge(Data1=join_2, Data2=num_19)
entwine_3 = Entwine(Branch0X=merge_19, Branch1X=merge_20, FlattenInputs=False)
renumber = RenumberPaths(Data=entwine_3)
item_10 = ListItem(List=renumber, Index=0, Wrap=True)  # -> flatten(Item), flatten(Item1)

# ---- group: beech left
panel_52 = Panel("https://docs.google.com/spreadsheets/d/1Q0xuMOoM9MJtYBJnVYEzEPmUDS6WbwrvgMLvJoCEvrc/edit#gid=0")
readcell_3 = ReadCell(
    SpreadsheetURL=panel_52,
    SheetName="Sheet1",
    CellRange="G3:H36",
    DuplicateMerged=False,
    SameLength=False,
    Read=Toggle(True))
decell_3 = DeconstructCell(Cell=readcell_3)  # -> FormattedValue, UserEnteredValue, CellFormat

# ---- group: beech left / remove null branches
c_script_5 = CSharpScript(obj=decell_3.FormattedValue)  # -> out, A; inputs obj: tree; same code as c_script_3

# ---- group: beech left (continued)
item_11 = ListItem(List=c_script_5.A, Index=0, Wrap=True)  # -> flatten(Item), Item1

# ---- group: name
data_16 = Data(item_11.Item)
lng_9 = ListLength(List=data_16)
dup_4 = DuplicateData(Data="BL", Number=lng_9, Order=True)  # -> graft(Data)
txt_3 = Text(graft(data_16))
merge_21 = Merge(Data1=simplify(dup_4), Data2=simplify(txt_3))
join_3 = TextJoin(Text=merge_21)

# ---- group: rt
num_20 = Number(item_11.Item1)

# ---- group: beech right
panel_53 = Panel("https://docs.google.com/spreadsheets/d/1Q0xuMOoM9MJtYBJnVYEzEPmUDS6WbwrvgMLvJoCEvrc/edit#gid=0")
readcell_4 = ReadCell(
    SpreadsheetURL=panel_53,
    SheetName="Sheet1",
    CellRange="J3:K38",
    DuplicateMerged=False,
    SameLength=False,
    Read=Toggle(True))
decell_4 = DeconstructCell(Cell=readcell_4)  # -> FormattedValue, UserEnteredValue, CellFormat

# ---- group: beech right / remove null branches
c_script_6 = CSharpScript(obj=decell_4.FormattedValue)  # -> out, A; inputs obj: tree; same code as c_script_3

# ---- group: beech right (continued)
item_12 = ListItem(List=c_script_6.A, Index=0, Wrap=True)  # -> flatten(Item), Item1

# ---- group: name
data_17 = Data(item_12.Item)
lng_10 = ListLength(List=data_17)
dup_5 = DuplicateData(Data="BR", Number=lng_10, Order=True)  # -> graft(Data)
txt_4 = Text(graft(data_17))
merge_22 = Merge(Data1=simplify(dup_5), Data2=simplify(txt_4))
join_4 = TextJoin(Text=merge_22)

# ---- group: rt
num_21 = Number(item_12.Item1)

# ----
merge_23 = Merge(Data1=join_3, Data2=num_20)
merge_24 = Merge(Data1=join_4, Data2=num_21)
entwine_4 = Entwine(Branch0X=merge_23, Branch1X=merge_24, FlattenInputs=False)
renumber_2 = RenumberPaths(Data=entwine_4)
item_13 = ListItem(List=renumber_2, Index=0, Wrap=True)  # -> flatten(Item), flatten(Item1)

lng_11 = ListLength(List=item_10.Item)
lng_12 = ListLength(List=item_13.Item)
dup_6 = DuplicateData(Data=Slider(2500, range=0..2500), Number=lng_11, Order=True)
dup_7 = DuplicateData(Data=Slider(1000, range=0..1000), Number=lng_12, Order=True)
dup_8 = DuplicateData(Data=Slider(150, range=0..1000), Number=lng_11, Order=True)
dup_9 = DuplicateData(Data=Slider(150, range=0..1000), Number=lng_12, Order=True)
dup_10 = DuplicateData(Data=Slider(27, range=0..100), Number=lng_11, Order=True)
dup_11 = DuplicateData(Data=species, Number=lng_12, Order=True)
dup_12 = DuplicateData(Data=Slider(27, range=0..100), Number=lng_12, Order=True)
dup_13 = DuplicateData(Data=species_2, Number=lng_11, Order=True)
merge_25 = Merge(Data1=item_10.Item1, Data2=item_13.Item1)
merge_26 = Merge(Data1=dup_10, Data2=dup_12)
merge_27 = Merge(Data1=dup_6, Data2=dup_7)
merge_28 = Merge(Data1=dup_8, Data2=dup_9)
merge_29 = Merge(Data1=item_10.Item, Data2=item_13.Item)
merge_30 = Merge(Data1=dup_13, Data2=dup_11)

stock_boards = StockBoards(Name=merge_29, Species=merge_30, Thickness=merge_26, Length=merge_27, Width=merge_28, RTAngle=merge_25, MoistureChange=0)

panel_54 = Panel("""7
2""")
data_18 = Data(up_pan)
data_19 = Data(stock_boards)
c_script_7 = CSharpScript(Reference="C:\Users\Alex Reiner\AppData\Roaming\Grasshopper\Libraries\HygroDesign.Core.dll")  # -> out, A
# ---------- c_script_7: C# usings ----------
using BilayerDesign;
# ---------- c_script_7: C# ----------
    TimoshenkoPrediction timo = new TimoshenkoPrediction();
    A = timo;
# ---------- c_script_7: C# additional code ----------
  public class TimoshenkoPrediction : PredictionEngine
  {

    public TimoshenkoPrediction()
    {
    }

    public override double Predict(StockBoard board, Bilayer bilayer, double moistureChange)
    {
      double h1 = bilayer.PassiveLayer.Thickness;
      double h2 = bilayer.ActiveLayer.Thickness;
      double h = h1 + h2;
      double m = h1 / h2;
      double e1 = bilayer.PassiveLayer.Species.Attributes["LEmod"];
      double e2 = GrainAngleInterpolation(board.RTAngle, board.Species.Attributes["REmod"], board.Species.Attributes["TEmod"]);
      double n = e1 / e2;
      double a1 = bilayer.PassiveLayer.Species.Attributes["LExp"];
      double a2 = GrainAngleInterpolation(board.RTAngle, board.Species.Attributes["RExp"], board.Species.Attributes["TExp"]);
      double deltaAlpha = a2 - a1;
      double kValue = 6 * Math.Pow(1.0 + m, 2) / (3 * Math.Pow(1 + m, 2) + (1 + m * n) * Math.Pow(m, 2) + (1 / (m * n)));
      double curvature = kValue * ((moistureChange * deltaAlpha) / h);
      return 1 / (curvature /* * TimError*/ );
    }

    public static double GrainAngleInterpolation(double rtAngle, double eR, double eT)
    {
      double angleConv = RhinoMath.ToRadians(rtAngle);
      double angleT = Math.Cos(angleConv);
      double angleR = Math.Sin(angleConv);
      double eActive = eT * Math.Pow(angleT, 2) + eR * Math.Pow(angleR, 2);
      return eActive;
    }
  }
# ---------- end c_script_7 ----------
stockpile = ConstructStockPile(Panels=data_18, StockBoards=data_19, MoistureChanges=panel_54, PredictionEngine=c_script_7.A)
sel_env = ConstructSelectionEnvironment(Panels=data_18, StockPile=stockpile)

# ---- group: convolution
c_script_8 = CSharpScript(
    tan=Slider(1, range=0.01..3),
    lon=Slider(0.5, range=0.01..3),
    rad=Slider(10000, range=0..10000),
    stiff=Slider(0.75, range=0.01..3),
    Reference="C:\USERS\ALEX REINER\APPDATA\ROAMING\GRASSHOPPER\LIBRARIES\HygroDesign.Core.dll")  # -> out, A; inputs tan: Double, lon: Double, rad: Double, stiff: Double, thick: Double
# ---------- c_script_8: C# ----------
    HMaxelConvolution convEngine = new HMaxelConvolution(tan, lon, rad, stiff, thick);
    A = convEngine;
# ---------- c_script_8: C# additional code ----------
  public class HMaxelConvolution : ConvolutionEngine
  {
    public double Tangential { get; set; }
    public double Longitudinal { get; set; }
    public double RadiusMax { get; set; }
    public double StiffnessInfluence { get; set; }
    public double ThicknessInfluence { get; set; }
    public HMaxelConvolution(double tangential, double longitudinal, double radiusMax, double stiffnessInfluence, double thicknessInfluence)
    {
      Tangential = tangential;
      Longitudinal = longitudinal;
      RadiusMax = radiusMax;
      StiffnessInfluence = stiffnessInfluence;
      ThicknessInfluence = thicknessInfluence;
    }

    public override Panel Convolution(Panel panel)
    {
      double MaxRad = double.MinValue;
      double MinRad = double.MaxValue;

      double MaxRStiff = double.MinValue;
      double MinRStiff = double.MaxValue;
      double MaxLStiff = double.MinValue;
      double MinLStiff = double.MaxValue;

      for (int i = 0; i < panel.HMaxels.GetLength(0); i++)
      {
        for (int j = 0; j < panel.HMaxels.GetLength(1); j++)
        {
          double averageRStiffness = 0;
          double averageLStiffness = 0;
          double weightedRadius = 0;
          double totalRWeights = 0;

          HMaxel hmaxel = panel.HMaxels[i, j];
          List<Tuple<double, double>> tuples = new List<Tuple<double, double>>();
          for (int v = 0; v < hmaxel.ActiveBoards.Count; v++)
          {
            averageRStiffness += (double) hmaxel.ActiveBoards[v].StockBoard.Species.Attributes["REmod"];
            averageLStiffness += (double) hmaxel.ActiveBoards[v].StockBoard.Species.Attributes["LEmod"];

            weightedRadius += (hmaxel.ActiveBoards[v].Radius * (double) hmaxel.ActiveBoards[v].StockBoard.Species.Attributes["REmod"]);
            totalRWeights += (double) hmaxel.ActiveBoards[v].StockBoard.Species.Attributes["REmod"];

          }
          averageRStiffness /= hmaxel.ActiveBoards.Count;
          averageLStiffness /= hmaxel.ActiveBoards.Count;
          weightedRadius /= totalRWeights;
          panel.HMaxels[i, j].Attributes.Add("REmod", averageRStiffness);
          panel.HMaxels[i, j].Attributes.Add("LEmod", averageLStiffness);
          panel.HMaxels[i, j].Attributes.Add("weighted radius", weightedRadius);

          if (weightedRadius > MaxRad) MaxRad = weightedRadius;
          if (weightedRadius < MinRad) MinRad = weightedRadius;
          if (averageLStiffness > MaxLStiff) MaxLStiff = averageLStiffness;
          if (averageLStiffness < MinLStiff) MinLStiff = averageLStiffness;
          if (averageRStiffness > MaxRStiff) MaxRStiff = averageRStiffness;
          if (averageRStiffness < MinRStiff) MinRStiff = averageRStiffness;
        }
      }
      //set factors
      for (int i = 0; i < panel.HMaxels.GetLength(0); i++)
      {
        for (int j = 0; j < panel.HMaxels.GetLength(1); j++)
        {
          panel.HMaxels[i, j].Attributes.Add("REmodFactor", Remap((double) panel.HMaxels[i, j].Attributes["REmod"], MinRStiff, MaxRStiff, 1 - StiffnessInfluence, 1));
          panel.HMaxels[i, j].Attributes.Add("LEmodFactor", Remap((double) panel.HMaxels[i, j].Attributes["LEmod"], MinLStiff, MaxLStiff, 1 - StiffnessInfluence, 1));
          panel.HMaxels[i, j].Attributes.Add("RadiusFactor", Remap((double) panel.HMaxels[i, j].Attributes["weighted radius"], MinRad, RadiusMax, 1, 0));

        }
      }

      //horizontal convolution
      for (int i = 0; i < panel.HMaxels.GetLength(0); i++)
      {
        for (int j = 0; j < panel.HMaxels.GetLength(1); j++)
        {
          double totalWeights = 0;
          double blendedRadius = 0;
          for (int x = 0; x < panel.HMaxels.GetLength(0); x++)
          {
            for (int y = 0; y < panel.HMaxels.GetLength(1); y++)
            {

              double xdist = Math.Abs(panel.HMaxels[i, j].X - panel.HMaxels[x, y].X);
              double ydist = Math.Abs(panel.HMaxels[i, j].Y - panel.HMaxels[x, y].Y);
              double LFactor = (double) panel.HMaxels[x, y].Attributes["LEmodFactor"] / Math.Pow(xdist + 1, Longitudinal);
              double RFactor = (double) panel.HMaxels[x, y].Attributes["REmodFactor"] / Math.Pow(ydist + 1, Tangential);
              blendedRadius += (double) panel.HMaxels[x, y].Attributes["weighted radius"] * (double) panel.HMaxels[i, j].Attributes["RadiusFactor"] * LFactor * RFactor;
              totalWeights += (double) panel.HMaxels[x, y].Attributes["RadiusFactor"] * LFactor * RFactor;

            }
          }

          panel.HMaxels[i, j].BlendedRaidus = blendedRadius / totalWeights;

        }
      }
      return panel;
    }
    public static double Remap(double val, double from1, double to1, double from2, double to2)
    {
      return (val - from1) / (to1 - from1) * (to2 - from2) + from2;
    }
  }
# ---------- end c_script_8 ----------
data_20 = Data(sel_env)
rad_blend = RadiusBlending(Panels=data_20, ConvolutionEngine=c_script_8.A)
dec_pan_2 = DeconstructPanel(Panel=rad_blend)  # -> Bilayers, HMaxels, LengthRange, WidthRange
dec_hmaxel_2 = DeconstructHMaxel(HMaxel=dec_pan_2.HMaxels)  # -> PassiveLayers, ActiveBoards, Height, RowRange, ColumnRange, DesiredRadius, BlendedRadius, ShapedHMaxel

# ----
num_22 = Number(expr("x/2", num_11))
dedomain_12 = DeconstructDomain(Domain=dec_hmaxel_2.RowRange)  # -> Start, End
bnd_5 = Bounds(Numbers=dedomain_12.Start)
bnd_6 = Bounds(Numbers=dedomain_12.End)
dedomain_13 = DeconstructDomain(Domain=bnd_5)  # -> Start, End
dedomain_14 = DeconstructDomain(Domain=bnd_6)  # -> Start, End
x_minus_one = XMinusOne(NumberX=division_13)
subtraction_12 = Subtraction(A=dedomain_14.End, B=dedomain_13.Start)
division_16 = Division(A=subtraction_12, B=x_minus_one)
series_3 = Series(Start=dedomain_13.Start, Step=division_16, Count=division_13)
pt_42 = ConstructPoint(XCoordinate=series_3, YCoordinate=0, ZCoordinate=0)
yz = YZPlane(Origin=pt_42)  # -> simplify(graft(Plane))

partition = PartitionList(List=dec_hmaxel_2.BlendedRadius, Size=num_11)  # -> simplify(Chunks)
flip = FlipMatrix(Data=partition)
num_23 = Number(flip)
c_script_9 = CSharpScript(x=num_23, y=number_slider_31)  # -> out, A; inputs x: tree, y: Int32
# ---------- c_script_9: C# ----------
    DataTree<object> output = new DataTree<object>();

    for(int i = 0; i < x.BranchCount; i++)
    {
      if(i % y == 0)output.AddRange(x.Branch(i), new GH_Path(i));
    }
    A = output;
# ---------- end c_script_9 ----------
renumber_3 = RenumberPaths(Data=c_script_9.A)

num_24 = Number(num)
pln = Plane(yz)
num_25 = Number(renumber_3)
c_script_10 = CSharpScript()  # -> out, A; inputs x: tree
# ---------- c_script_10: C# ----------
    DataTree<object> output = new DataTree<object>();
    int firstIndex = 0;
    int branchCount = 0;
    for(int i = 0; i < x.BranchCount; i++)
    {
      GH_Path path = new GH_Path(firstIndex, branchCount);
      if(x.Paths[i][0] == firstIndex)
      {
        output.AddRange(x.Branch(i), path);
      }
      else
      {
        firstIndex++;
        branchCount = -1;
        i--;
      }
      branchCount++;
    }
    A = output;
# ---------- end c_script_10 ----------
c_script_11 = CSharpScript(iRadii=num_25, iBoardWidth=num_24, iPlanes=pln)  # -> out, simplify(A); inputs iRadii: tree of Double, iBoardWidth: Double, iPlanes: tree of Plane
# ---------- c_script_11: C# ----------
    DataTree<Point3d> pointTree = new DataTree<Point3d>();

    for (int j = 0; j < iRadii.BranchCount; j++)
    {

      //initialize variables
      Plane bp = iPlanes.Branch(j)[0];
      Point3d startPoint = new Point3d(bp.Origin);
      Point3d centerPoint = startPoint;
      Vector3d rotationAxis = new Vector3d(bp.ZAxis);
      Vector3d centerPointVect = new Vector3d(bp.YAxis);
      centerPointVect.Rotate(Math.PI / 2, rotationAxis);

      for (int i = 0; i < iRadii.Branch(j).Count; i++){
        GH_Path pth = iRadii.Paths[j].AppendElement(i);
        Point3d point1 = startPoint;
        Point3d point2 = startPoint;

        pointTree.Add(point1, pth);

        //calculate rotation angle
        Double arcLength = iBoardWidth;
        Double radius = iRadii.Branch(j)[i];
        Double rotation = (arcLength / radius);

        //calculate rotation center point
        centerPointVect.Unitize();
        centerPointVect *= radius;
        centerPoint += centerPointVect;


        //execute half rotation
        Transform tx = Transform.Rotation(rotation / 2, rotationAxis, centerPoint);


        point2.Transform(tx);
        pointTree.Add(point2, pth);

        //execute full rotation
        tx = Transform.Rotation(rotation, rotationAxis, centerPoint);
        startPoint.Transform(tx);
        pointTree.Add(startPoint, pth);

        //updata rotation parameters
        centerPoint = startPoint;
        centerPointVect.Transform(tx);
      }
    }
    A = pointTree;
# ---------- end c_script_11 ----------

trim_3 = TrimTree(Tree=c_script_11.A, Depth=1)
cullpt_2 = CullDuplicates(Points=trim_3, Tolerance=0.1, CullMode=3)  # -> Points, Indices, Valence
pt_43 = Point(cullpt_2.Points)

# ---- group: animate
pt_44 = Point(simplify(pt_43))
pln_2 = Plane(graft(pln))
num_26 = Number(Slider(1, range=0..1))
c_script_12 = CSharpScript(iPoints=simplify(pt_44), iPlanes=pln_2, iShapeFactor=num_26)  # -> out, A; inputs iPoints: tree of Point3d, iPlanes: tree of Plane, iShapeFactor: Double
# ---------- c_script_12: C# ----------
    DataTree<Point3d> output = new DataTree<Point3d>();
    
    double shapeFactor = 1.0 - iShapeFactor;

    //step through curves
    for (int i = 0; i < iPoints.BranchCount; i++)
    {
      Plane currentPlane = iPlanes.Branch(iPoints.Path(i)[0])[0];

      //get vectors from plane
      Vector3d zVect = currentPlane.YAxis;

      Vector3d rotVect = currentPlane.ZAxis;

      //create new startpoint inside list
      Point3d startPoint = iPoints.Branch(i)[0];

      //step through points. Create and rotate vectors
      for (int j = 0; j < iPoints.Branch(i).Count; j++)
      {
        if (j == 0) output.Add(startPoint, iPoints.Path(i));
        else{
          //create current segment vector
          Vector3d segmentVect = new Vector3d(iPoints.Branch(i)[j] - iPoints.Branch(i)[j - 1]);

          //measure angle with vertical vector
          double angle = Vector3d.VectorAngle(zVect, segmentVect, currentPlane);

          //rotate
          segmentVect.Rotate(-angle * shapeFactor, rotVect);

          startPoint += segmentVect;
          output.Add(startPoint, iPoints.Path(i));
        }
      }
    }

    A = output;
# ---------- end c_script_12 ----------
pt_45 = Point(c_script_12.A)
intcrv = Interpolate(Vertices=pt_45, Degree=3, Periodic=False, KnotStyle=1)  # -> Curve, Length, Domain
crv_4 = Curve(intcrv.Curve)

# ----
crv_5 = Curve(crv_4)
pt_46 = Point(simplify(graft(yz)))
end = EndPoints(Curve=crv_5)  # -> Start, End
vec2pt = Vector2Pt(PointA=end.Start, PointB=end.End, Unitize=False)  # -> Vector, Length
yz_2 = YZPlane(Origin=end.Start)
Y_3 = UnitY(Factor="-1")
angle = Angle(VectorA=vec2pt.Vector, VectorB=Y_3, Plane=yz_2)  # -> Angle, Reflex
rotate = Rotate(Geometry=crv_5, Angle=angle.Angle, Plane=yz_2)  # -> Geometry, Transform
curvepoint = PointOnCurve(rotate.Geometry, parameter=0.5)
vec2pt_2 = Vector2Pt(PointA=curvepoint, PointB=pt_46, Unitize=False)  # -> Vector, Length
move_5 = Move(Geometry=rotate.Geometry, Motion=vec2pt_2.Vector)  # -> Geometry, Transform
path_mapper = PathMapper(move_5.Geometry, source=["{A;B}", "{A}"], target=["{A}", "{0}"])
crv_6 = Curve(path_mapper)
flip_2 = FlipCurve(Curve=crv_6)  # -> Curve, Flag
loft = Loft(Curves=flip_2.Curve, Options={Adjust=False, Closed=False, LoftEnds=0, LoftSimp=0, LoftType=0, Rebuild=10, Refit=0.01})
srf_2 = Surface(loft)

crv_7 = Curve(flip_2.Curve)
crv_8 = Curve(reparameterize(crv_7))
srf_3 = Surface(boundary)
debrep_2 = DeconstructBrep(Brep=srf_3)  # -> Faces, Edges, Vertices
item_14 = ListItem(List=crv_8, Index=0, Wrap=True)
bbox = BoundingBox(Content=crv_7, Plane=PlaneXY(0, 0, 0), UnionBox=True)  # -> Box, Box_2
number_slider_42 = Slider(10, range=0..30)
end_2 = EndPoints(Curve=item_14)  # -> Start, End
debox = DeconstructBox(Box=bbox.Box)  # -> Plane, X, Y, Z
len = Length(Curve=debrep_2.Edges)
pdecon_8 = Deconstruct(Point=end_2.Start)  # -> XComponent, YComponent, ZComponent
pdecon_9 = Deconstruct(Point=end_2.End)  # -> XComponent, YComponent, ZComponent
sort = SortList(Keys=len, ValuesA=debrep_2.Edges)  # -> Keys, reverse(ValuesA)
dedomain_15 = DeconstructDomain(Domain=debox.X)  # -> Start, End
addition_10 = Addition(A=pdecon_8.YComponent, B=number_slider_42)
subtraction_13 = Subtraction(A=pdecon_9.YComponent, B=number_slider_42)
item_15 = ListItem(List=sort.ValuesA, Index=0, Wrap=True)  # -> Item, Item1
pt_47 = ConstructPoint(XCoordinate=0, YCoordinate=addition_10, ZCoordinate=0)
pt_48 = ConstructPoint(XCoordinate=dedomain_15.End, YCoordinate=addition_10, ZCoordinate=0)
pt_49 = ConstructPoint(XCoordinate=0, YCoordinate=subtraction_13, ZCoordinate=0)
pt_50 = ConstructPoint(XCoordinate=dedomain_15.End, YCoordinate=subtraction_13, ZCoordinate=0)
flip_3 = FlipCurve(Curve=item_15.Item)  # -> Curve, Flag
vec2pt_3 = Vector2Pt(PointA=pt_47, PointB=pt_48, Unitize=False)  # -> Vector, Length
Z_2 = UnitZ(Factor=1)
vec2pt_4 = Vector2Pt(PointA=pt_49, PointB=pt_50, Unitize=False)  # -> Vector, Length
Z_3 = UnitZ(Factor=1)
merge_31 = Merge(Data1=flip_3.Curve, Data2=item_15.Item1)
lng_13 = ListLength(List=crv_7)
pl = ConstructPlane(Origin=pt_47, XAxis=vec2pt_3.Vector, YAxis=Z_2)
pl_2 = ConstructPlane(Origin=pt_49, XAxis=vec2pt_4.Vector, YAxis=Z_3)
divide_2 = DivideCurve(Curve=merge_31, Count=expr("x-1", lng_13), Kinks=False)  # -> Points, Tangents, Parameters
merge_32 = Merge(Data1=pl, Data2=pl_2)
flip_4 = FlipMatrix(Data=divide_2.Points)
pcx_2 = CurvePlane(Curve=graft(crv_8), Plane=merge_32)  # -> Points, ParamsC, ParamsP
item_16 = ListItem(List=flip_4, Index=0, Wrap=True)  # -> Item, Item1
ln = Line(StartPoint=item_16.Item, EndPoint=item_16.Item1)

pdecon_10 = Deconstruct(Point=pcx_2.Points)  # -> XComponent, YComponent, ZComponent
sort_2 = SortList(Keys=pdecon_10.ZComponent, ValuesA=pcx_2.ParamsC)  # -> Keys, reverse(ValuesA)
item_17 = ListItem(List=sort_2.ValuesA, Index=0, Wrap=True)

trim_4 = TrimTree(Tree=item_17, Depth=1)
eval_3 = EvaluateCurve(Curve=ln, Parameter=trim_4)  # -> simplify(Point), Tangent, Angle
flip_5 = FlipMatrix(Data=eval_3.Point)
intcrv_2 = Interpolate(Vertices=flip_5, Degree=3, Periodic=False, KnotStyle=1)  # -> Curve, Length, Domain

divide_3 = DivideCurve(Curve=intcrv_2.Curve, Count=Slider(100, range=0..1000), Kinks=False)  # -> simplify(Points), Tangents, Parameters
srf_cp_2 = SurfaceClosestPoint(Point=divide_3.Points, Surface=boundary)  # -> Point, UVPoint, Distance

srf_4 = Surface(srf_2)
evalsrf = EvaluateSurface(Surface=srf_4, Point=srf_cp_2.UVPoint)  # -> Point, Normal, UDirection, VDirection, Frame
number_slider_43 = Slider(100, range=0..100)
intcrv_3 = Interpolate(Vertices=evalsrf.Point, Degree=3, Periodic=False, KnotStyle=1)  # -> Curve, Length, Domain
ext = ExtendCurve(Curve=intcrv_3.Curve, Type=0, Start=number_slider_43, End=number_slider_43)
srfsplit = SurfaceSplit(Surface=srf_4, Curves=flatten(ext))
area_2 = Area(Geometry=srf_4)  # -> Area, Centroid
area_3 = Area(Geometry=srfsplit)  # -> Area, Centroid
pdecon_11 = Deconstruct(Point=area_2.Centroid)  # -> XComponent, YComponent, ZComponent
pdecon_12 = Deconstruct(Point=area_3.Centroid)  # -> XComponent, YComponent, ZComponent
subtraction_14 = Subtraction(A=pdecon_11.YComponent, B=pdecon_12.YComponent)
abs = Absolute(Value=subtraction_14)
sort_3 = SortList(Keys=abs, ValuesA=srfsplit)  # -> Keys, ValuesA
item_18 = ListItem(List=sort_3.ValuesA, Index=0, Wrap=True)

evalsrf_2 = EvaluateSurface(Surface=srf_2, Point=srf_cp.UVPoint)  # -> Point, Normal, UDirection, VDirection, Frame
srf_5 = Surface(item_18)
intcrv_4 = Interpolate(Vertices=evalsrf_2.Point, Degree=3, Periodic=False, KnotStyle=1)  # -> Curve, Length, Domain
srfsplit_2 = SurfaceSplit(Surface=srf_5, Curves=intcrv_4.Curve)
area_4 = Area(Geometry=srfsplit_2)  # -> Area, Centroid
pdecon_13 = Deconstruct(Point=area_4.Centroid)  # -> XComponent, YComponent, ZComponent
sort_4 = SortList(Keys=pdecon_13.XComponent, ValuesA=srfsplit_2)  # -> Keys, ValuesA
item_19 = ListItem(List=sort_4.ValuesA, Index=0, Wrap=True)
brep_2 = Brep(item_19)

pan_srf = PanelSurface(Panel=rad_blend, Surface=item_18)
entwine_5 = Entwine(Branch00=item_18, Branch01=brep_2, FlattenInputs=True)
trim_breps = TrimmingBreps(Panel=pan_srf, Breps=entwine_5)
dec_pan_3 = DeconstructPanel(Panel=trim_breps)  # -> Bilayers, HMaxels, LengthRange, WidthRange
panel_55 = Panel(entwine_5)
python_2 = GhPythonScript(x=trim_breps)  # -> out, a
# ---------- python_2: Python ----------
x.CalculateCenterOfGravity()
a = x.Centroid
# ---------- end python_2 ----------
dec_bilayer = DeconstructBilayer(Bilayer=dec_pan_3.Bilayers)  # -> ActiveLayer, PassiveLayer
dec_active_layer = DeconstructActiveLayer(ActiveLayer=dec_bilayer.ActiveLayer)  # -> simplify(ActiveLayerBoards), Thickness
dec_active_board = DeconstructActiveBoard(ActiveBoard=dec_active_layer.ActiveLayerBoards)  # -> HMaxels, StockBoard, Thickness, RowRange, ColumnRange, DesiredRadius, Radius, BlendedRadius, MoistureChange, ShapedBoard
dec_stock_board = DeconstructStockBoard(StockBoard=dec_active_board.StockBoard)  # -> Name, Species, RTAngle, Length, Width, ActiveBoards
domain = Domain(dec_active_board.RowRange)
dec_secies = DeconstructSpecies(Species=dec_stock_board.Species)
trim_5 = TrimTree(Tree=dec_active_board.ShapedBoard, Depth=1)
trim_6 = TrimTree(Tree=domain, Depth=1)
trim_7 = TrimTree(Tree=simplify(dec_secies), Depth=1)
null = NullItem(Item=trim_5)  # -> NullFlags, InvalidFlags, Description
not_2 = GateNot(A=null.NullFlags)
c_script_13 = CSharpScript(
    boards=dec_active_layer.ActiveLayerBoards,
    ranges=trim_6,
    length=lamination_width,
    overlap=num_16,
    Reference="C:\USERS\ALEX REINER\APPDATA\ROAMING\GRASSHOPPER\LIBRARIES\HygroDesign.Core.dll")  # -> out, A; inputs boards: tree, ranges: tree, length: Double, overlap: Double
# ---------- c_script_13: C# ----------
    DataTree<ActiveBoard> laminationGroups = new DataTree<ActiveBoard>();


    for(int i = 0; i < ranges.BranchCount; i++)
    {
      for(int j = 0; j < ranges.Branch(i).Count; j++)
      {
        for(int x = 1; x < 10; x++)
        {
          double test = (x * length) - ((x - 1) * overlap);

          if(Math.Floor(ranges.Branch(i)[j][1]) > test)continue;
          GH_Path path = ranges.Paths[i].AppendElement(x);
          laminationGroups.Add(boards.Branch(i)[j] as ActiveBoard, path);
          break;
        }
      }
    }
    A = laminationGroups;
# ---------- end c_script_13 ----------
cull_8 = CullPattern(List=simplify(trim_7), CullPattern=simplify(not_2))
trim_8 = TrimTree(Tree=dec_active_board.BlendedRadius, Depth=1)
cull_9 = CullPattern(List=trim_5, CullPattern=not_2)
chars = Characters(Text=cull_8)  # -> Result, Unicode
bang_2 = ExplodeTree(Data=cull_9)  # -> Branch0, Branch1
bnd_7 = Bounds(Numbers=flatten(dec_active_board.BlendedRadius))
lng_14 = ListLength(List=chars.Result)
dec_active_board_2 = DeconstructActiveBoard(ActiveBoard=c_script_13.A)  # -> HMaxels, StockBoard, Thickness, RowRange, ColumnRange, DesiredRadius, Radius, BlendedRadius, MoistureChange, ShapedBoard
cull_10 = CullPattern(List=simplify(trim_8), CullPattern=simplify(not_2))
offsrf = OffsetSurface(Surface=bang_2.Branch1, Distance=expr("-x", number_slider_33), BothSides=0, CreateSolid=True)
offsrf_2 = OffsetSurface(Surface=bang_2.Branch0, Distance=number_slider_33, BothSides=0, CreateSolid=True)
dedomain_16 = DeconstructDomain(Domain=bnd_7)  # -> Start, End
equals = Equality(FirstNumber=lng_14, SecondNumber="5")  # -> Equality, Inequality
cset = CreateSet(List=flatten(lng_14))  # -> Set, Map
rectangle_10 = Rectangle(Plane=PlaneXY(0, 0, 0), XSize=dec_active_board_2.RowRange, YSize=dec_active_board_2.ColumnRange, Radius=0)  # -> Rectangle, Length
offsrf_3 = OffsetSurface(Surface=bang_2.Branch0, Distance=number_slider_33, BothSides=False, CreateSolid=True)
gradient = Gradient(
    LowerLimit=dedomain_16.Start,
    UpperLimit=dedomain_16.End,
    Parameter=cull_10,
    stops=[0: RGB(48, 18, 59), 0.0312: RGB(57, 41, 114), 0.0625: RGB(64, 64, 161), 0.0938: RGB(68, 86, 199), 0.125: RGB(70, 107, 227), 0.156: RGB(70, 127, 246)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])
offsrf_4 = OffsetSurface(Surface=bang_2.Branch1, Distance=expr("-x", number_slider_33), BothSides=False, CreateSolid=True)
cull_11 = CullPattern(List=ColourSwatch(SwatchColor=RGB(250, 116, 82)), CullPattern=equals.Equality)
cull_12 = CullPattern(List=ColourSwatch(SwatchColor=RGB(250, 165, 90)), CullPattern=equals.Inequality)
trim_9 = TrimTree(Tree=rectangle_10.Rectangle, Depth=1)
area_5 = Area(Geometry=cull_9)  # -> Area, Centroid
bbox_2 = BoundingBox(Content=trim_9, Plane=PlaneXY(0, 0, 0), UnionBox=True)  # -> flatten(Box), Box_2
group_3 = Group(Objects=trim_9)  # -> flatten(Group)
panel_56 = Panel(bnd_7)
merge_33 = Merge(Data1=cull_11, Data2=cull_12)  # -> simplify(Result)
move_6 = Move(Geometry=area_5.Centroid, Motion=Z)  # -> Geometry, Transform
round_2 = Round(Number=cull_10)  # -> Nearest, Floor, Ceiling
entwine_6 = Entwine(Branch00=offsrf_3, Branch01=offsrf_4, FlattenInputs=True)  # -> graft(Result)
debox_2 = DeconstructBox(Box=bbox_2.Box)  # -> Plane, X, Y, Z
dedomain_17 = DeconstructDomain(Domain=debox_2.X)  # -> Start, End
tag = TextTag3D(Location=move_6.Geometry, Text=round_2.Nearest, Size=Slider(46, range=0..100), Colour=RGB(0, 0, 0), Justification=5)
preview = CustomPreview(Geometry=entwine_6, Material=graft(gradient))
neg_3 = Negative(Value=dedomain_17.Start)
lng_15 = ListLength(List=group_3)
X_3 = UnitX(Factor=neg_3)
series_4 = Series(Start=number_slider_34, Step=number_slider_34, Count=lng_15)  # -> simplify(Series)
move_7 = Move(Geometry=group_3, Motion=X_3)  # -> Geometry, Transform
X_4 = UnitX(Factor=series_4)
dec_stock_board_2 = DeconstructStockBoard(StockBoard=dec_active_board_2.StockBoard)  # -> Name, Species, RTAngle, Length, Width, ActiveBoards
move_8 = Move(Geometry=move_7.Geometry, Motion=X_4)  # -> Geometry, Transform
ungroup_3 = Ungroup(Group=move_8.Geometry)
dec_secies_2 = DeconstructSpecies(Species=dec_stock_board_2.Species)
trim_10 = TrimTree(Tree=simplify(dec_secies_2), Depth=1)
chars_2 = Characters(Text=trim_10)  # -> Result, Unicode
lng_16 = ListLength(List=chars_2.Result)
equals_2 = Equality(FirstNumber=lng_16, SecondNumber="5")  # -> Equality, Inequality
cull_13 = CullPattern(List=ColourSwatch(SwatchColor=RGB(250, 116, 82)), CullPattern=equals_2.Equality)
cull_14 = CullPattern(List=ColourSwatch(SwatchColor=RGB(250, 165, 90)), CullPattern=equals_2.Inequality)
merge_34 = Merge(Data1=cull_13, Data2=cull_14)  # -> simplify(Result)

dec_pan_4 = DeconstructPanel(Panel=trim_breps)  # -> Bilayers, HMaxels, LengthRange, WidthRange; disabled
dec_pan_5 = DeconstructPanel(Panel=trim_breps)  # -> Bilayers, HMaxels, LengthRange, WidthRange; disabled
dec_bilayer_2 = DeconstructBilayer(Bilayer=dec_pan_4.Bilayers)  # -> ActiveLayer, PassiveLayer; disabled
dec_hmaxel_3 = DeconstructHMaxel(HMaxel=dec_pan_5.HMaxels)  # -> PassiveLayers, simplify(ActiveBoards), Height, RowRange, ColumnRange, DesiredRadius, BlendedRadius, ShapedHMaxel; disabled
item_20 = ListItem(List=dec_bilayer_2.ActiveLayer, Index=0, Wrap=True)  # -> Item, Item1; disabled
dec_active_layer_2 = DeconstructActiveLayer(ActiveLayer=dec_bilayer_2.ActiveLayer)  # -> simplify(ActiveLayerBoards), Thickness; disabled
dec_active_board_3 = DeconstructActiveBoard(ActiveBoard=dec_active_layer_2.ActiveLayerBoards)  # -> HMaxels, StockBoard, Thickness, RowRange, ColumnRange, DesiredRadius, Radius, BlendedRadius, MoistureChange, simplify(ShapedBoard); disabled

trim_11 = TrimTree(Tree=merge_34, Depth=1)
boundary_2 = BoundarySurfaces(Edges=ungroup_3)
area_6 = Area(Geometry=boundary_2)  # -> Area, Centroid
preview_2 = CustomPreview(Geometry=boundary_2, Material=trim_11)
trim_12 = TrimTree(Tree=simplify(dec_stock_board_2.Name), Depth=1)
tag_2 = TextTag3D(
    Location=area_6.Centroid,
    Text=trim_12,
    Size=Slider(54, range=0..100),
    Colour=ColourSwatch(SwatchColor=RGB(0, 0, 0)),
    Justification=5)
dec_active_board_4 = DeconstructActiveBoard(ActiveBoard=dec_hmaxel_3.ActiveBoards)  # -> HMaxels, StockBoard, flatten(Thickness), RowRange, ColumnRange, DesiredRadius, Radius, BlendedRadius, MoistureChange, ShapedBoard; disabled
dec_stock_board_3 = DeconstructStockBoard(StockBoard=dec_active_board_4.StockBoard)  # -> Name, Species, RTAngle, Length, Width, ActiveBoards; disabled
brep_3 = Brep(simplify(dec_hmaxel_3.ShapedHMaxel))  # disabled
null_2 = NullItem(Item=brep_3)  # -> NullFlags, InvalidFlags, Description; disabled
dec_secies_3 = DeconstructSpecies(Species=dec_stock_board_3.Species)  # -> simplify(Name); disabled
trim_13 = TrimTree(Tree=dec_secies_3, Depth=1)  # disabled
chars_3 = Characters(Text=trim_13)  # -> Result, Unicode; disabled
not_3 = GateNot(A=null_2.NullFlags)  # disabled
lng_17 = ListLength(List=chars_3.Result)  # disabled
trim_14 = TrimTree(Tree=lng_17, Depth=1)  # disabled
lng_18 = ListLength(List=trim_13)  # disabled
sort_5 = SortList(Keys=trim_14)  # -> Keys, ValuesA; disabled
item_21 = ListItem(List=sort_5.Keys, Index=0, Wrap=True)  # -> flatten(Item); disabled
cull_15 = CullPattern(List=flatten(lng_18), CullPattern=not_3)  # disabled
cull_16 = CullPattern(List=item_21, CullPattern=not_3)  # disabled
cull_17 = CullPattern(List=brep_3, CullPattern=not_3)  # disabled
c_script_14 = CSharpScript(layers=cull_15, materials=cull_16)  # -> out, A, B, C; inputs layers: list of Int32, materials: list of Int32; disabled
# ---------- c_script_14: C# ----------
    
    List<int> keys = new List<int>();
    List<int> numberize = new List<int>();
    List<double> thickness = new List<double>();

    for(int i = 0; i < layers.Count ;i++)
    {
      int lCount = layers[i];
      int mat = materials[i];

      numberize.Add(i + 1);

      if(lCount == 1 && mat == 5)
      {
        keys.Add(0);
        thickness.Add(2.8);
      }
      if(lCount == 1 && mat == 6)
      {
        keys.Add(3);
        thickness.Add(2.8);
      }
      if(lCount == 2 && mat == 5)
      {
        keys.Add(1);
        thickness.Add(5.2);
      }
      if(lCount == 2 && mat == 6)
      {
        keys.Add(4);
        thickness.Add(5.2);
      }

    }

    A = keys;
    B = numberize;
    C = thickness;
# ---------- end c_script_14 ----------
item_22 = ListItem(List=material_buildups, Index=c_script_14.A, Wrap=True)  # disabled

# ---- group: material ids
num_27 = Number(item_22)  # disabled

# ----
num_28 = Number(c_script_14.B)  # disabled
num_29 = Number(c_script_14.C)  # disabled
thicknesses = RemoteSender(num_29)  # disabled
group_nr = RemoteSender(num_28)  # disabled
mat = RemoteSender(num_27)  # disabled

# ---- group: Main Surfaces
surfaces = Data(scale.Geometry)  # disabled
assemble_structural_area_sofistik = AssembleStructuralAreaSofistik(Geometry=surfaces, GroupNr=group_nr)  # -> simplify(StructuralAreasSofiMesh); disabled

# ---- group: Mesh
item_23 = ListItem(List=surfaces, Index=0, Wrap=True)  # disabled
item_24 = ListItem(List=surfaces, Index=0, Wrap=True)  # -> Item1, Item; disabled
debrep_3 = DeconstructBrep(Brep=item_23)  # -> Faces, Edges, Vertices; disabled
debrep_4 = DeconstructBrep(Brep=item_24.Item1)  # -> Faces, Edges, Vertices; disabled
debrep_5 = DeconstructBrep(Brep=surfaces)  # -> Faces, Edges, Vertices; disabled
number_slider_44 = Slider(1, range=0..10)  # disabled
item_25 = ListItem(List=debrep_3.Vertices, Index=0, Wrap=True)  # -> Item, Item1; disabled
item_26 = ListItem(List=debrep_4.Vertices, Index=0, Wrap=True)  # -> Item1, Item; disabled
item_27 = ListItem(List=debrep_5.Edges, Index=number_slider_44, Wrap=True)  # disabled
pt_51 = Point(item_25.Item)  # disabled
pt_52 = Point(item_25.Item1)  # disabled
pt_53 = Point(item_26.Item1)  # disabled
data_21 = Data(item_27)  # disabled
len_2 = Length(Curve=data_21)  # disabled
len_3 = Length(Curve=debrep_5.Edges)  # disabled
rec_3pt = Rectangle3Pt(PointA=pt_51, PointB=pt_53, PointC=pt_52)  # -> Rectangle, Length; disabled
smaller_2 = SmallerThan(FirstNumber=len_2, SecondNumber=len_3)  # -> SmallerThan, OrEqualTo; disabled
boundary_3 = BoundarySurfaces(Edges=rec_3pt.Rectangle)  # disabled
area_7 = Area(Geometry=boundary_3)  # -> Area, Centroid; disabled
cull_18 = CullPattern(List=debrep_5.Edges, CullPattern=smaller_2.SmallerThan)  # disabled
multiplication_2 = Multiplication(A=area_7.Area, B=1.5)  # disabled
panel_57 = Panel("1")  # disabled
assemble_structural_line_sofistik = AssembleStructuralLineSofistik(Curve=cull_18, GroupNr=0)  # disabled

# ----
generate_mesh_sofistik = GenerateMeshSofistik(
    Path=path,
    StructuralLines=assemble_structural_line_sofistik,
    StructuralAreas=flatten(assemble_structural_area_sofistik),
    MeshProperties=assemble_mesh_properties_sofimesh,
    WpsExe=pathwps_exe,
    Cdb_w50Dll=pathcdb_dll,
    Run=button_2,
    meshs_Branch0_Path="{31}",
    meshs_Branch1_Path="{32}",
    meshs_Branch2_Path="{33}",
    meshs_Branch3_Path="{34}",
    meshs_Branch4_Path="{35}",
    meshs_Branch5_Path="{36}",
    meshs_Branch6_Path="{37}",
    meshs_Branch7_Path="{38}",
    meshs_Branch8_Path="{61}",
    meshs_Branch9_Path="{62}",
    meshs_Branch10_Path="{63}",
    meshs_Branch11_Path="{64}",
    meshs_Branch12_Path="{65}",
    meshs_Branch13_Path="{66}",
    meshs_Branch14_Path="{67}",
    meshs_Branch15_Path="{68}",
    meshs_Branch16_Path="{69}",
    meshs_Branch17_Path="{70}",
    meshs_Branch18_Path="{71}",
    meshs_Branch19_Path="{72}",
    meshs_Branch20_Path="{73}",
    meshs_Branch21_Path="{74}",
    meshs_Branch22_Path="{75}",
    meshs_Branch23_Path="{76}",
    meshs_Branch24_Path="{77}",
    meshs_Branch25_Path="{78}",
    meshs_Branch26_Path="{79}",
    meshs_Branch27_Path="{91}",
    meshs_Branch28_Path="{92}",
    meshs_Branch29_Path="{93}"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)  # -> Meshs, Completed; disabled
flatten = FlattenTree(Tree=generate_mesh_sofistik.Meshs, Path="{0}")  # -> simplify(graft(Tree)); disabled
mesh = Mesh(flatten(flatten))  # disabled
thicknesses_2 = RemoteReceiver(thicknesses)  # disabled
mat_2 = RemoteReceiver(mat)  # disabled

mesh_2 = Data(mesh)  # disabled
graft = GraftTree(Tree=mesh_2, IncludeEmptyLists=True, IncludeNullItems=True)  # -> simplify(Tree); disabled
area_8 = Area(Geometry=graft)  # -> Area, Centroid; disabled
addition_11 = Addition(A=panel_27, B=panel_26, C=panel_27)  # disabled
srf_cp_3 = SurfaceClosestPoint(Point=area_8.Centroid, Surface=graft(surfaces))  # -> Point, UVPoint, Distance; disabled
curvature = PrincipalCurvature(Surface=graft(surfaces), Point=srf_cp_3.UVPoint)  # -> Frame, Min, Max, MinDirection, MaxDirection; disabled
deplane = DeconstructPlane(Plane=curvature.Frame)  # -> Origin, XAxis, YAxis, ZAxis; disabled
amp = Amplitude(Vector=deplane.XAxis, Amplitude=0.1)  # disabled
amp_2 = Amplitude(Vector=deplane.YAxis, Amplitude=0.1)  # disabled
amp_3 = Amplitude(Vector=deplane.ZAxis, Amplitude=0.1)  # disabled
# Material: KOPF
# UNIT 5
# NORM 'DIN' 'en199x-200x' COUN 49 UNIT 5
# 
# HOLZ 1    C '24:1' E90 370 BEZ "=Spruce"
# ARBL EPS BRUC SIG 1.300000[-]
# HMAT 1 TYP FOUR NSP 0.100000 A 1
# 
# HOLZ 4  PLY '40:1' TMAX 10 BEZ "=Plywood 40 Cl.1 (EN 1995)"
# ARBL EPS BRUC SIG 1.200000[-]
# HMAT 4 TYP FOUR NSP 0.100000 A 1
# 
# STAH 6    S '235' TMAX 40 BEZ "=S 235 (EN 10025-2)" GAM 0.0
# ARBL EPS GEBR SIG 1[-]
# ARBL EPS BRUC SIG 1[-] TYP  EXT
# HMAT 3 TYP FOUR NSP 0 A 1
# 
# HOLZ NR 20 ep 17130[N/mm2] g 880[N/mm2] e90 1000[N/mm2] g90 61[N/mm2] gam 7.4[KN/m3]
# 
# 
# HOLZ NR 10 ep 11000[N/mm2] g 690[N/mm2] e90 370[N/mm2] g90 50[N/mm2] gam 4.8[KN/m3]
# 
# 
# HOLZ NR 11 ep 370[N/mm2] g 690[N/mm2] e90 12200[N/mm2] g90 50[N/mm2] gam 4.8[KN/m3]
# 
# MLAY NR 100  T0 {0}[mm]  11 $$
#              T1 {1}[mm]  10 $$
#              T2 {0}[mm]  11 Bez 'Bilayer'
# 
# MLAY NR 101  T0 {0}[mm]  11 $$
#              T1 {1}[mm]  20 $$
#              T2 {0}[mm]  11 Bez 'BilayerB'
# 
# MLAY NR 200  T0 {0}[mm]  11 $$
#              T1 {1}[mm]  10 $$
# 	     T3 {0}[mm]  11 $$
#              T4 {1}[mm]  10 $$
#              T5 {0}[mm]  11 Bez '2Bilayer'
# 
# MLAY NR 201  T0 {0}[mm]  11 $$
#              T1 {1}[mm]  20 $$
# 	     T3 {0}[mm]  11 $$
#              T4 {1}[mm]  20 $$
#              T5 {0}[mm]  11 Bez '2BilayerB'
# 
# MLAY NR 300  T0 {0}[mm]  11 $$
#              T1 {1}[mm]  10 $$
# 	     T2 {0}[mm]  11 $$
#              T3 {1}[mm]  10 $$
# 	     T4 {0}[mm]  11 $$
#              T5 {1}[mm]  10 $$
#              T6 {0}[mm]  11 Bez '3Bilayer'
# 
# MLAY NR 301  T0 {0}[mm]  11 $$
#              T1 {1}[mm]  20 $$
# 	     T2 {0}[mm]  11 $$
#              T3 {1}[mm]  20 $$
# 	     T4 {0}[mm]  11 $$
#              T5 {1}[mm]  20 $$
#              T6 {0}[mm]  11 Bez '3BilayerB'
vdis = VectorDisplay(Anchor=area_8.Centroid, Vector=amp)  # disabled
vdis_2 = VectorDisplay(Anchor=area_8.Centroid, Vector=amp_2)  # disabled
vdis_3 = VectorDisplay(Anchor=area_8.Centroid, Vector=amp_3)  # disabled
assemble_shell_sofistika = AssembleShellSofistikA(Mesh=simplify(graft(mesh_2)), MaterialNr=graft(mat_2), Thickness=graft(thicknesses_2), GroupNr=simplify(graft(group_nr)))  # -> flatten(Shell); disabled

# ---- group: Utilisation Test
number_slider_45 = Slider(100, range=0..100)  # disabled
number_slider_46 = Slider(101, range=0..1000)  # disabled
replace = ReplaceMembers(Set=mat_2, Find=num_17, Replace=panel_21)  # disabled

# ----
replace_2 = ReplaceMembers(Set=thicknesses_2, Find=number_slider_36, Replace=panel_22)  # disabled
panel_58 = Panel(mat_2)  # disabled
panel_59 = Panel(replace)  # disabled

# ---- group: Preassembly
preassemble_model_sofistik = PreAssembleModelSofistik(Points=flatten(pt_41), Shells=assemble_shell_sofistika, tol=0.001)  # -> NodeList, Shells, Beams, Trusses, Cables, Couplings; disabled

# ---- group: Loading / Random Point Load
mesh_3 = Mesh(mesh)  # disabled
item_28 = ListItem(List=flatten(mesh_3), Index=0, Wrap=True)  # -> Item, Item1; disabled
demesh = DeconstructMesh(Mesh=item_28.Item1)  # -> Vertices, Faces, Colours, Normals; disabled
random_point = GhPythonScript(x=demesh.Vertices)  # -> out, a; inputs x: list of Point3d; disabled
# ---------- random_point: Python ----------
import Rhino.Geometry as rg
import random

# List of points

# Get a random point from the list
random_point = random.choice(x)

a = random_point
# ---------- end random_point ----------
pt_54 = Point(random_point.a)  # disabled
find_nodes_sofistik = FindNodesSofistik(Nodes=preassemble_model_sofistik.NodeList, Geometry=pt_54, tol=0.001)  # disabled
assemble_pointload_sofistik = AssemblePointLoadSofistik(LoadNodes=find_nodes_sofistik, LoadcaseNumber=panel_29, LoadType=panel_30, LoadValues=panel_31)  # disabled

# ----
node_sofistik = NodeSofistik(preassemble_model_sofistik.NodeList)  # disabled
find_nodes_sofistik_2 = FindNodesSofistik(Nodes=node_sofistik, Geometry=cullpt.Points, tol=0.001)  # disabled
panel_60 = Panel("F")  # disabled
assemble_support_sofistik = AssembleSupportSofistik(Node=find_nodes_sofistik_2, Type=panel_60)  # disabled

mesh_4 = Mesh(preassemble_model_sofistik.Shells)  # disabled

# ---- group: Loading / Traffic Loads
item_29 = ListItem(List=preassemble_model_sofistik.Shells, Index=0, Wrap=True)  # -> Item, Item1; disabled
panel_61 = Panel("1002")  # disabled
panel_62 = Panel("pzz")  # disabled
panel_63 = Panel("0")  # disabled
assemble_meshload_sofistik = AssembleMeshLoadSofistik(LoadMesh=mesh_4, LoadcaseNumber=panel_61, LoadType=panel_62, LoadValues=panel_63)  # -> flatten(MeshLoad); disabled

# ----
intersect_shells_sofistik = IntersectShellsSofistik(Shells=preassemble_model_sofistik.Shells, shell_combination=0, tol=0.001)  # -> NodesASofistikA, NodesBSofistikA; disabled

# ---- group: Loading / Selfweight Floor Build Up
panel_64 = Panel("1001")  # disabled
panel_65 = Panel("pzz")  # disabled
panel_66 = Panel("-1.0")  # disabled
assemble_meshload_sofistik_2 = AssembleMeshLoadSofistik(LoadMesh=mesh_4, LoadcaseNumber=panel_64, LoadType=panel_65, LoadValues=panel_66)  # -> flatten(MeshLoad); disabled

# ----
assemble_coupling_sofistik = AssembleCouplingSofistik(Node=intersect_shells_sofistik.NodesASofistikA, ReferenceNode=intersect_shells_sofistik.NodesBSofistikA, Type=panel_32)  # -> flatten(CouplingSofistikA); disabled

# ---- group: Loading
merge_35 = Merge(Data1=assemble_meshload_sofistik_2, Data2=assemble_meshload_sofistik)  # disabled

# ---- group: Calculation
support_sofistik = SupportSofistik(flatten(assemble_support_sofistik))  # disabled
path_2 = Data(path)  # disabled
aqua = Data(aqua_file)  # disabled
load_sofistik = LoadSofistik(merge_35)  # disabled
assemble_model_sofistik = AssembleModelSofistik(
    Path=path_2,
    AquaFile=aqua,
    Nodes=preassemble_model_sofistik.NodeList,
    Shells=flatten(preassemble_model_sofistik.Shells),
    Beams=preassemble_model_sofistik.Beams,
    Couplings=assemble_coupling_sofistik,
    Supports=support_sofistik,
    Loads=load_sofistik,
    AseFile=merge_16,
    SofistikPath=pathwps_exe,
    Run=button_3,
    disable_warnings=False,
    run_sofistik=True)  # -> CdbPath, GroupDivisor, Springs, Beams, Trusses, Cables, Completed, Errors; disabled

# ---- group: Sofistik
button_4 = Button()  # disabled
button_5 = Button()  # disabled
button_6 = Button()  # disabled
button_7 = Button()  # disabled
open_sofistik = OpenSofistik(Path=assemble_model_sofistik.CdbPath, Teddy=button_4, Animator=button_5, Wingraf=button_6, FileLocation=button_7)  # disabled

# ----
number_slider_47 = Slider(2, range=0..100)  # disabled
toggle = BooleanToggle(True)  # disabled
load_case = Panel("101")  # disabled
uls_2 = Panel("201")  # disabled
pathcdb_dll_2 = FilePath(pathcdb_dll)  # disabled
pathcdb = FilePath(assemble_model_sofistik.CdbPath)  # disabled

# ---- group: Manual Stress Calculation
toggle_2 = BooleanToggle(True)  # disabled
pathcdb_dll_3 = FilePath(pathcdb)  # disabled
number_slider_48 = Slider(0, range=0..100)  # disabled
get_shell_forces_sofistik = GetShellForcesSofistik(Path=pathcdb_dll_2, LoadCase=1, SofistikPath=pathcdb_dll_3, Run=toggle_2)  # -> QNR, T, MXX, MYY, MXY, VX, VY, NXX, NYY, NXY; disabled
get_deformed_mesh_sofistik = GetDeformedMeshSofistik(LoadCase=1, ScalingFactor=number_slider_48, SofistikPath=pathcdb_dll_3, Run=toggle_2)  # -> InitialMesh, DeformedMesh; disabled
int = Integer(get_shell_forces_sofistik.MXX)  # disabled
facen = FaceNormals(Mesh=get_deformed_mesh_sofistik.InitialMesh)  # -> Centers, Normals; disabled
python_3 = GhPythonScript(
    E0=panel_46,
    E90=panel_43,
    t1=panel_44,
    t2=panel_45,
    nxx=get_shell_forces_sofistik.NXX,
    mxx=get_shell_forces_sofistik.MXX,
    nyy=get_shell_forces_sofistik.NYY,
    myy=get_shell_forces_sofistik.MYY)  # -> out, sig_x_top, sig_x_bot, sig_y_top_1, sig_y_int_1, sig_y_int_2, sig_y_bot_2; disabled
# ---------- python_3: Python ----------
import math 

# -------------- X direction -------------
Ax  = t2
Wxx = Ax*Ax/6

sigma_nx    = nxx / Ax
sigma_mxx   = mxx / Wxx * 1000
sig_x_top = sigma_nx - sigma_mxx
sig_x_bot = sigma_nx + sigma_mxx


# -------------- Y direction -------------
by_eq   = E90/E0
Ay_1    = t1
Ay_2    = t2 * by_eq
Ay_eq   = Ay_1 + Ay_2 
zg_y_1  = t1/2
zg_y_2  = t1 + t2/2
zg_y    = (zg_y_1 * Ay_1 + zg_y_2 * Ay_2) / Ay_eq
Iyy_1   = t1*t1*t1/12
Iyy_2   = t2*t2*t2/12*by_eq
Iyy     = Iyy_1 + Iyy_2 + math.pow(zg_y - zg_y_1,2)*Ay_1 + math.pow(zg_y - zg_y_2,2)*Ay_2

eps_y_top = myy / Iyy / E0 * (0 - zg_y) * 1000         + nyy / Ay_eq / E0
eps_y_int = myy / Iyy / E0 * (t1 - zg_y) * 1000        + nyy / Ay_eq / E0
eps_y_bot = myy / Iyy / E0 * (t1 + t2 - zg_y) * 1000   + nyy / Ay_eq / E0

sig_y_top_1 = eps_y_top * E0
sig_y_int_1 = eps_y_int * E0 
sig_y_int_2 = eps_y_int * E90 
sig_y_bot_2 = eps_y_bot * E90
# ---------- end python_3 ----------
number_slider_49 = Slider(10, range=0..10)  # disabled
bnd_8 = Bounds(Numbers=get_shell_forces_sofistik.MXX)  # disabled
entwine_7 = Entwine(Branch00=python_3.sig_x_top, Branch01=python_3.sig_x_bot, FlattenInputs=True)  # disabled
dedomain_18 = DeconstructDomain(Domain=bnd_8)  # -> Start, End; disabled
textdot = DefineTextDot(Text=get_shell_forces_sofistik.MXX, Location=facen.Centers, Font="Arial", Size=number_slider_49)
swatch = ColourSwatch(SwatchColor=RGB(255, 255, 255))  # disabled
flip_6 = FlipMatrix(Data=entwine_7)  # disabled
gradient_2 = Gradient(
    LowerLimit=dedomain_18.Start,
    UpperLimit=dedomain_18.End,
    Parameter=get_shell_forces_sofistik.MXX,
    stops=[0: RGB(234, 38, 0), 0.25: RGB(234, 126, 0), 0.5: RGB(254, 244, 84), 0.75: RGB(173, 203, 249), 1: RGB(75, 107, 169)])  # disabled
abs_2 = Absolute()  # disabled
abs_3 = Absolute(Value=flip_6)  # disabled
sort_6 = SortList(Keys=abs_3, ValuesA=flip_6)  # -> Keys, ValuesA; disabled
item_30 = ListItem(List=reverse(sort_6.ValuesA), Index=0, Wrap=True)  # -> flatten(Item); disabled
colourmesh = ColourMesh(Mesh=get_deformed_mesh_sofistik.InitialMesh, Colors=gradient_2)  # disabled

# ---- group: Deformation
get_nodal_results_sofistik = GetNodalResultsSofistik(Path=pathcdb, LoadCases=load_case, SofistikPath=pathcdb_dll_2, Run=toggle)  # -> NodeNumber, Nodes, LoadForces, LoadMoments, Displacements, Rotations, Forces, Moments; disabled
get_deformed_mesh_sofistika = GetDeformedMeshSofistikA(Path=pathcdb, LoadCase=load_case, ScalingFactor=number_slider_47, SofistikPath=pathcdb_dll_2, Run=toggle)  # -> InitialMesh, DeformedMesh; disabled
vlen = VectorLength(Vector=get_nodal_results_sofistik.Displacements)  # disabled
demesh_2 = DeconstructMesh(Mesh=get_deformed_mesh_sofistika.DeformedMesh)  # -> Vertices, Faces, Colours, Normals; disabled
vec = Vector(get_nodal_results_sofistik.Displacements)  # disabled
num_30 = Number(get_nodal_results_sofistik.Displacements)  # disabled
vlen_2 = VectorLength(Vector=vec)  # disabled
bnd_9 = Bounds(Numbers=num_30)  # disabled
num_31 = Number(vlen_2)  # disabled
bnd_10 = Bounds(Numbers=num_31)  # disabled
dedomain_19 = DeconstructDomain(Domain=bnd_9)  # -> Start, End; disabled
dedomain_20 = DeconstructDomain(Domain=bnd_10)  # -> Start, End; disabled
gradient_3 = Gradient(
    LowerLimit=dedomain_19.End,
    UpperLimit=dedomain_19.Start,
    Parameter=panel_47,
    stops=[0: RGB(234, 38, 0), 0.25: RGB(234, 126, 0), 0.5: RGB(254, 244, 84), 0.75: RGB(173, 203, 249), 1: RGB(75, 107, 169)])  # disabled
expression = Expression(x=dedomain_20.End, Expression="Round(x*1000,2)")  # disabled
sort_7 = SortList(Keys=vlen, ValuesA=get_nodal_results_sofistik.Nodes)  # -> reverse(Keys), reverse(ValuesA); disabled
totalmaxdisplacement_mm = Panel(expression)  # disabled
smaller_3 = SmallerThan(FirstNumber=panel_35, SecondNumber=totalmaxdisplacement_mm)  # -> SmallerThan, OrEqualTo; disabled
panel_67 = Panel(smaller_3.SmallerThan)  # disabled
sort_8 = SortList(Keys=vlen, ValuesA=demesh_2.Vertices)  # -> reverse(Keys), reverse(ValuesA); disabled
item_31 = ListItem(List=sort_7.ValuesA, Index=0, Wrap=True)  # disabled
item_32 = ListItem(List=sort_8.ValuesA, Index=0, Wrap=True)  # disabled
panel_68 = Panel(" mm")  # disabled
panel_69 = Panel("   ")  # disabled
concat_3 = Concatenate(FragmentA=panel_69, FragmentB=totalmaxdisplacement_mm, FragmentC=panel_68)  # disabled
swatch_2 = ColourSwatch(SwatchColor=RGB(0, 0, 0))  # disabled
tag_3 = TextTag(Location=item_31, Text=concat_3, Colour=swatch_2)  # disabled
pt_55 = Point(item_31)  # disabled

# ---- group: CLT
panel_70 = Panel("0.8")  # disabled
pathcdb_2 = FilePath(pathcdb)  # disabled
pathcdb_dll_4 = FilePath(pathcdb_dll_2)  # disabled
check_cross_sections = CSharpScript(
    path=pathcdb_2,
    lcNumbers=uls_2,
    dllPath=pathcdb_dll_4,
    kmod=panel_70,
    run=toggle,
    Reference="C:\USERS\EDDY\DESKTOP\Templates\Sofistik\GH Scripts\Sofistik.gha")  # -> out, eta_x, eta_y, eta_vxy, eta_vz, eta_v, eta; inputs path: String, lcNumbers: list of Int32, dllPath: String, kmod: Double, run: Boolean; disabled
# ---------- check_cross_sections: C# usings ----------
using System.IO;
using System.Linq;
using System.Data;
using System.Drawing;
using System.Reflection;
using System.Windows.Forms;
using System.Xml;
using System.Xml.Linq;
using System.Runtime.InteropServices;

using Rhino.DocObjects;
using Rhino.Collections;
using GH_IO;
using GH_IO.Serialization;
using Sofistik;
using Sofistik.Properties;
using Sofistik.Meshing;
# ---------- check_cross_sections: C# ----------
    // Safety factor
    double gammaM = 1.3;

    // Check for validity
    if (string.IsNullOrWhiteSpace(path)) { return; }
    if (string.IsNullOrWhiteSpace(dllPath)) { return; }

    if (!run)
      return;

    // Load sof_cdb.dll under specified path
    NativeMethods.SetDllDirectory(Path.GetDirectoryName(dllPath));
    IntPtr hModule = NativeMethods.LoadLibrary(dllPath);
    if (hModule == IntPtr.Zero)
    {
      Print("HModule = IntPtr.Zero, aborted");
      return;
    }

    // Retrieve the materials from the database
    materialInfos = CdbMethods.GetMaterialInfos(hModule, path);
    materials = new Dictionary<int, Sofistik.Material>();
    foreach (KeyValuePair<int, MaterialType> materialInfo in materialInfos)
    {
      int mnr = materialInfo.Key;
      materials.Add(mnr, CdbMethods.GetMaterial(hModule, path, mnr));
    }

    //  foreach (KeyValuePair<int, Sofistik.Material> kvp in materials)
    //  {
    //    int mnr = kvp.Key;
    //    TimberMaterial material = kvp.Value as TimberMaterial;
    //    if (material == null)
    //      continue;
    //    Rhino.RhinoApp.WriteLine("material " + mnr.ToString() + " Fv,k " + (0.001 * material.Fv_k).ToString());
    //    Rhino.RhinoApp.WriteLine("material " + mnr.ToString() + " Fvb,k " + (0.001 * material.Fvb_k).ToString());
    //    Rhino.RhinoApp.WriteLine("material " + mnr.ToString() + " Fvb,90,k " + (0.001 * material.Fvb90_k).ToString());
    //  }

    // Retrieve quads and quad results from database
    List<CQUAD> quads = CdbMethods.GetQuads(hModule, path);
    int nQuads = quads.Count;

    quadResults = new Dictionary<int,List<CQUAD_FOR>>();
    foreach (var quad in quads)
    {
      quadResults.Add(quad.m_NR, new List<CQUAD_FOR>());
    }
    foreach (int lcNumber in lcNumbers)
    {
      if (lcNumber <= 0)
        return;
      List<CQUAD_FOR> quadForces = CdbMethods.GetQuadForces(hModule, path, lcNumber);
      if (quadForces.Count != nQuads)
      {
        Print("quadForces.Count != quads.Count");
        return;
      }
      foreach (var quadForce in quadForces)
      {
        int quadNr = quadForce.m_NR;
        if(quadResults.ContainsKey(quadNr))
        {
          quadResults[quadNr].Add(quadForce);
        }
      }
    }

    // Initialize output variables
    List<double> _eta_x = new List<double>();
    List<double> _eta_y = new List<double>();
    List<double> _eta_vxy = new List<double>();
    List<double> _eta_vz = new List<double>();
    List<double> _eta_v = new List<double>();
    List<double> _eta = new List<double>();

    for (int i = 0; i < nQuads; i++)
    {
      double eta_x_i = 0.0;
      double eta_y_i = 0.0;
      double eta_vxy_i = 0.0;
      double eta_vz_i = 0.0;
      double eta_v_i = 0.0;

      // retrieve quadnr and thickness
      int quadNr = quads[i].m_NR;
      double t = 1000.0 * (double) quads[i].m_THICK[0]; // mm

      // retrieve material nr of the quad
      int mnr = quads[i].m_MAT;

      // check if material is mlay or single layer material
      if (materials[mnr].MaterialType != MaterialType.Mlay)
      {
        ComputeSingleLayerResult(quadNr, t, mnr, kmod, gammaM, out eta_x_i, out eta_y_i, out eta_vxy_i, out eta_vz_i);
      }
      else
      {
        ComputeMultiLayerResult(quadNr, mnr, kmod, gammaM, out eta_x_i, out eta_y_i, out eta_vxy_i, out eta_vz_i);
      }
      eta_v_i = eta_vxy_i + eta_vz_i;
      double eta_i = new double[]{eta_x_i, eta_y_i, eta_v_i}.Max();
      _eta_x.Add(eta_x_i);
      _eta_y.Add(eta_y_i);
      _eta_vxy.Add(eta_vxy_i);
      _eta_vz.Add(eta_vz_i);
      _eta_v.Add(eta_v_i);
      _eta.Add(eta_i);
    }

    eta_x = _eta_x;
    eta_y = _eta_y;
    eta_vxy = _eta_vxy;
    eta_vz = _eta_vz;
    eta_v = _eta_v;
    eta = _eta;

    NativeMethods.FreeLibrary(hModule);
    NativeMethods.SetDllDirectory(null);
# ---------- check_cross_sections: C# additional code ----------
  Dictionary<int, MaterialType> materialInfos;
  Dictionary<int, Sofistik.Material> materials;
  Dictionary<int,List<CQUAD_FOR>> quadResults;

  protected void ComputeSingleLayerResult(int quadNr, double t, int mnr, double kmod, double gammaM,
    out double eta_x, out double eta_y, out double eta_vxy, out double eta_vz)
  {
    // retrieve the material values of the quad
    TimberMaterial material = materials[mnr] as TimberMaterial;
    if (material == null)
    {
      Print("Cannot perform timber checks on non-timber materials, aborted.");
      eta_x = 0.0;
      eta_y = 0.0;
      eta_vxy = 0.0;
      eta_vz = 0.0;
      return;
    }
    double fm0_rd = 0.001 * (kmod / gammaM) * material.Fm0_k;
    double fm90_rd = 0.001 * (kmod / gammaM) * material.Fm90_k;   // N/mm²
    double ft0_rd = 0.001 * (kmod / gammaM) * material.Ft0_k;    // N/mm²
    double ft90_rd = 0.001 * (kmod / gammaM) * material.Ft90_k;   // N/mm²
    double fc0_rd = 0.001 * (kmod / gammaM) * material.Fc0_k;    // N/mm²
    double fc90_rd = 0.001 * (kmod / gammaM) * material.Fc90_k;   // N/mm²
    double fv_rd = 0.001 * (kmod / gammaM) * material.Fv_k;     // N/mm²
    double fvb_rd = 0.001 * (kmod / gammaM) * material.Fvb_k;    // N/mm²
    double fvb90_rd = 0.001 * (kmod / gammaM) * material.Fvb90_k;  // N/mm²

    // retrieve the quad forces for this quad, n --> kN/m, m --> kN-m/m
    List<CQUAD_FOR> quadForces = quadResults[quadNr];
    double nx_t = 0.0;
    double nx_c = 0.0;
    double ny_t = 0.0;
    double ny_c = 0.0;
    double nxy = 0.0;
    double mx = 0.0;
    double my = 0.0;
    double mxy = 0.0;
    double vx = 0.0;
    double vy = 0.0;
    foreach (var quadForce in quadForces)
    {
      if (quadForce.m_NX > nx_t)
        nx_t = quadForce.m_NX;
      if (quadForce.m_NX < nx_c)
        nx_c = quadForce.m_NX;
      if (quadForce.m_NY > ny_t)
        ny_t = quadForce.m_NY;
      if (quadForce.m_NY < ny_c)
        ny_c = quadForce.m_NY;
      if (Math.Abs(quadForce.m_NXY) > nxy)
        nxy = Math.Abs(quadForce.m_NXY);

      if (Math.Abs(quadForce.m_MXX) > mx)
        mx = Math.Abs(quadForce.m_MXX);
      if (Math.Abs(quadForce.m_MYY) > my)
        my = Math.Abs(quadForce.m_MYY);
      if (Math.Abs(quadForce.m_MXY) > mxy)
        mxy = Math.Abs(quadForce.m_MXY);

      if (Math.Abs(quadForce.m_VX) > vx)
        vx = Math.Abs(quadForce.m_VX);
      if (Math.Abs(quadForce.m_VY) > vy)
        vy = Math.Abs(quadForce.m_VY);
    }

    // Bending Resistance and Axial resistance
    // x-Direction:
    double mx_rd = 0.001 * fm0_rd * t * t / 6.0;
    double nx_c_rd = fc0_rd * t;  // kN/m
    double nx_t_rd = ft0_rd * t;  // kN/m

    // y-Direction:
    double my_rd = 0.001 * fm90_rd * t * t / 6.0;
    double ny_c_rd = fc90_rd * t;  // kN/m
    double ny_t_rd = ft90_rd * t;  // kN/m

    // Torsion Resistance
    double mxy_rd = 1000.0 * fv_rd * t * t / 6.0; // TODO: CHECK THIS

    // In-Plane shear resistance
    double nxy_rd = 1000.0 * fv_rd * t;

    // Out-of-plane shear resistance
    double vx_rd = fvb_rd * t / 1.5;
    double vy_rd = fvb90_rd * t / 1.5;

    eta_x = Math.Max(
      mx / mx_rd + nx_t / nx_t_rd,
      mx / mx_rd - nx_c / nx_c_rd);

    eta_y = Math.Max(
      my / my_rd + ny_t / ny_t_rd,
      my / my_rd - ny_c / ny_c_rd);
    eta_vxy = mxy / mxy_rd + nxy / nxy_rd;
    eta_vz = Math.Sqrt(Math.Pow(vx / vx_rd, 2) + Math.Pow(vy / vy_rd, 2));
  }

  protected void ComputeMultiLayerResult(int quadNr, int mnr, double kmod, double gammaM,
    out double eta_x, out double eta_y, out double eta_vxy, out double eta_vz)
  {
    eta_x = 0.0;
    eta_y = 0.0;
    eta_vxy = 0.0;
    eta_vz = 0.0;

    int layerMaterialNr = 0;

    LayeredMaterial layeredMaterial = materials[mnr] as LayeredMaterial;
    if (layeredMaterial == null)
    {
      Print("Multi-Layer results can only be computed with multi-layer materials.");
      return;
    }

    Dictionary<int,TimberMaterial> timberMaterials = new Dictionary<int,TimberMaterial>();
    foreach (int key in materials.Keys)
    {
      var timberMaterial = materials[key] as TimberMaterial;
      if (timberMaterial != null)
      {
        timberMaterials.Add(key, timberMaterial);
      }
    }

    List<Tuple<int,double,double>> layers = layeredMaterial.Layers;

    // compute t, assume symetric build-up
    double t = 0.0;     // m
    double tmax = 0.0;  // m
    for (int j = 0; j < layers.Count; j++)
    {
      t += layers[j].Item2;
      if (layers[j].Item2 > tmax)
      {
        tmax = layers[j].Item2;
      }
    }

    // retrieve the quad forces for this quad, n --> kN/m, m --> kN-m/m
    List<CQUAD_FOR> quadForces = quadResults[quadNr];
    double nx_t = 0.0;
    double nx_c = 0.0;
    double ny_t = 0.0;
    double ny_c = 0.0;
    double nxy = 0.0;
    double mx = 0.0;
    double my = 0.0;
    double mxy = 0.0;
    double vx = 0.0;
    double vy = 0.0;
    foreach (var quadForce in quadForces)
    {
      if (quadForce.m_NX > nx_t)
        nx_t = quadForce.m_NX;
      if (quadForce.m_NX < nx_c)
        nx_c = quadForce.m_NX;
      if (quadForce.m_NY > ny_t)
        ny_t = quadForce.m_NY;
      if (quadForce.m_NY < ny_c)
        ny_c = quadForce.m_NY;
      if (Math.Abs(quadForce.m_NXY) > nxy)
        nxy = Math.Abs(quadForce.m_NXY);

      if (Math.Abs(quadForce.m_MXX) > mx)
        mx = Math.Abs(quadForce.m_MXX);
      if (Math.Abs(quadForce.m_MYY) > my)
        my = Math.Abs(quadForce.m_MYY);
      if (Math.Abs(quadForce.m_MXY) > mxy)
        mxy = Math.Abs(quadForce.m_MXY);

      if (Math.Abs(quadForce.m_VX) > vx)
        vx = Math.Abs(quadForce.m_VX);
      if (Math.Abs(quadForce.m_VY) > vy)
        vy = Math.Abs(quadForce.m_VY);
    }

    // compute Bx, By and Bxy
    // compute Dx, Dy and Dxy
    double Bx = 0.0;
    double By = 0.0;
    double Bxy = 0.0;
    double Dx = 0.0;
    double Dy = 0.0;
    double Dxy = 0.0;
    double z_j = -0.5 * t;
    for (int j = 0; j < layers.Count; j++)
    {
      // material properties
      double Ex_j = timberMaterials[layers[j].Item1].E0;   // [kN/m²]
      double Ey_j = timberMaterials[layers[j].Item1].E90;  // [kN/m²]
      double Gxy_j = timberMaterials[layers[j].Item1].G0;  // [kN/m²]

      // geometry information
      double t_j = layers[j].Item2;
      z_j += 0.5 * t_j;
      Bx += Ex_j * (t_j * Math.Pow(z_j, 2) + Math.Pow(t_j, 3) / 12);
      By += Ey_j * (t_j * Math.Pow(z_j, 2) + Math.Pow(t_j, 3) / 12);
      Bxy += Gxy_j * (2 * t_j * Math.Pow(z_j, 2) + Math.Pow(t_j, 3) / 6);
      Dx += Ex_j * t_j;
      Dy += Ey_j * t_j;
      Dxy += Gxy_j * t_j;
      z_j += 0.5 * t_j;
    }

    // compute ESx and ESy
    double ESx = 0.0;
    double ESy = 0.0;
    z_j = 0.0;
    if (layers.Count == 3 || layers.Count == 7 || layers.Count == 11)
    {
      // rolling shear, critical layer for x-Direction: midlayer
      // rolling shear, critical layer for y-Direction: midlayer + 1
      for (int j = layers.Count / 2; j < layers.Count; j++)
      {
        // material properties
        double Ex_j = timberMaterials[layers[j].Item1].E0;   // [kN/m²]
        double Ey_j = timberMaterials[layers[j].Item1].E90;  // [kN/m²]

        // geometry information
        double t_j = layers[j].Item2;
        if (j > layers.Count / 2)
        {
          z_j += 0.5 * t_j;
          ESx += Ex_j * z_j * t_j;
          ESy += Ey_j * z_j * t_j;
        }
        else
        {
          ESx += Ex_j * t_j * t_j / 8.0;
        }
        z_j += 0.5 * t_j;
      }
    }
    else if (layers.Count == 5 || layers.Count == 9 || layers.Count == 13)
    {
      // rolling shear, critical layer for x-Direction: midlayer + 1
      // rolling shear, critical layer for y-Direction: midlayer
      for (int j = layers.Count / 2; j < layers.Count; j++)
      {
        // material properties
        double Ex_j = timberMaterials[layers[j].Item1].E0;   // [kN/m²]
        double Ey_j = timberMaterials[layers[j].Item1].E90;  // [kN/m²]

        // geometry information
        double t_j = layers[j].Item2;
        if (j > layers.Count / 2)
        {
          z_j += 0.5 * t_j;
          ESx += Ex_j * z_j * t_j;
          ESy += Ey_j * z_j * t_j;
        }
        else
        {
          ESy += Ey_j * t_j * t_j / 8.0;
        }
        z_j += 0.5 * t_j;
      }
    }
    else
    {
      Print("Asymetric build-up, or too many layers, not supported.");
      return;
    }

    // Bending Resistance and Axial resistance
    // x-Direction:
    layerMaterialNr = layers[layers.Count - 1].Item1;
    double fm_rd = 0.001 * (kmod / gammaM) * timberMaterials[layerMaterialNr].Fm0_k; // N/mm²
    double ft0_rd = 0.001 * (kmod / gammaM) * timberMaterials[layerMaterialNr].Ft0_k; // N/mm²
    double fc0_rd = 0.001 * (kmod / gammaM) * timberMaterials[layerMaterialNr].Fc0_k; // N/mm²

    double zo = 0.5 * t;
    double mx_rd = 1000.0 * fm_rd * Bx / (timberMaterials[layerMaterialNr].E0 * zo);
    double nx_c_rd = 1000.0 * fc0_rd * Dx / (timberMaterials[layerMaterialNr].E0);
    double nx_t_rd = 1000.0 * ft0_rd * Dx / (timberMaterials[layerMaterialNr].E0);

    // y-Direction:
    layerMaterialNr = layers[layers.Count - 2].Item1;
    fm_rd = 0.001 * (kmod / gammaM) * timberMaterials[layerMaterialNr].Fm0_k; // N/mm²
    ft0_rd = 0.001 * (kmod / gammaM) * timberMaterials[layerMaterialNr].Ft0_k; // N/mm²
    fc0_rd = 0.001 * (kmod / gammaM) * timberMaterials[layerMaterialNr].Fc0_k; // N/mm²

    double to = t - layers[layers.Count - 1].Item2;
    zo = to - 0.5 * t;
    double my_rd = 1000.0 * fm_rd * By / (timberMaterials[layerMaterialNr].E90 * zo);
    double ny_c_rd = 1000.0 * fc0_rd * Dy / (timberMaterials[layerMaterialNr].E90);
    double ny_t_rd = 1000.0 * ft0_rd * Dy / (timberMaterials[layerMaterialNr].E90);

    // Material values shear + torsion
    double fv_k = double.MaxValue;
    double fv_T_k = double.MaxValue;
    foreach (var layer in layers)
    {
      if (timberMaterials[layer.Item1].Fv_k < fv_k)
      {
        fv_k = timberMaterials[layer.Item1].Fv_k;
      }
      if (timberMaterials[layer.Item1].Fvb90_k < fv_T_k)
      {
        fv_T_k = timberMaterials[layer.Item1].Fvb90_k;
      }
    }
    double fv_rd = 0.001 * (kmod / gammaM) * fv_k;       // N/mm²
    double fv_T_rd = 0.001 * (kmod / gammaM) * fv_T_k;   // N/mm²

    // Twisting Resistance
    zo = 0.5 * t;
    layerMaterialNr = layers[layers.Count - 1].Item1;
    double mxy_rd = 1000.0 * fv_T_rd * Bxy / (timberMaterials[layerMaterialNr].G0 * zo);

    // In-Plane shear resistance
    layerMaterialNr = layers[layers.Count - 1].Item1;
    double t0_netto = Dx / (timberMaterials[layerMaterialNr].E0);
    layerMaterialNr = layers[layers.Count - 2].Item1;
    double t90_netto = Dy / (timberMaterials[layerMaterialNr].E90);
    double t_netto = Math.Min(t0_netto, t90_netto);
    double a = 0.15;
    double nxy_1_rd = 1000.0 * fv_T_rd * t_netto * a / (3.0 * tmax);
    double nxy_2_rd = 1000.0 * fv_rd * t;
    double nxy_rd = Math.Min(nxy_1_rd, nxy_2_rd);

    // Out-of-plane shear resistance
    double fv_R_rd = 0.0;    // N/mm²
    double vx_rd = (1000.0 * fv_R_rd * Bx) / ESx;
    double vy_rd = 0.0;
    switch (layers.Count)
    {
      case 3:
        // rolling shear, critical layer for x-Direction: midlayer
        fv_R_rd = 0.001 * (kmod / gammaM) * timberMaterials[layers[1].Item1].Fvb_k;
        vx_rd = (1000.0 * fv_R_rd * Bx) / ESx;
        // for y-Direction: no rolling shear, simple shear for the mid board
        double t_mid = layers[1].Item2;
        vy_rd = (1000.0 * fv_T_rd * t_mid) / 1.5;
        break;
      case 5:
        // rolling shear, critical layer for x-Direction: midlayer - 1
        fv_R_rd = 0.001 * (kmod / gammaM) * timberMaterials[layers[1].Item1].Fvb_k;
        vx_rd = (1000.0 * fv_R_rd * Bx) / ESx;
        // rolling shear, critical layer for y-Direction: midlayer
        fv_R_rd = 0.001 * (kmod / gammaM) * timberMaterials[layers[2].Item1].Fvb_k;
        vy_rd = (1000.0 * fv_R_rd * By) / ESy;
        break;
      case 7:
        // rolling shear, critical layer for x-Direction: midlayer
        fv_R_rd = 0.001 * (kmod / gammaM) * timberMaterials[layers[3].Item1].Fvb_k;
        vx_rd = (1000.0 * fv_R_rd * Bx) / ESx;
        // rolling shear, critical layer for y-Direction: midlayer - 1
        fv_R_rd = 0.001 * (kmod / gammaM) * timberMaterials[layers[2].Item1].Fvb_k;
        vy_rd = (1000.0 * fv_R_rd * By) / ESy;
        break;
      case 9:
        // rolling shear, critical layer for x-Direction: midlayer - 1
        fv_R_rd = 0.001 * (kmod / gammaM) * timberMaterials[layers[3].Item1].Fvb_k;
        vx_rd = (1000.0 * fv_R_rd * Bx) / ESx;
        // rolling shear, critical layer for y-Direction: midlayer
        fv_R_rd = 0.001 * (kmod / gammaM) * timberMaterials[layers[4].Item1].Fvb_k;
        vy_rd = (1000.0 * fv_R_rd * By) / ESy;
        break;
      default:
        Print("Asymetric build-up, or too many layers, not supported.");
        return;
    }
    eta_x = Math.Max(
      mx / mx_rd + nx_t / nx_t_rd,
      mx / mx_rd - nx_c / nx_c_rd);

    eta_y = Math.Max(
      my / my_rd + ny_t / ny_t_rd,
      my / my_rd - ny_c / ny_c_rd);
    eta_vxy = mxy / mxy_rd + nxy / nxy_rd;
    eta_vz = Math.Sqrt(Math.Pow(vx / vx_rd, 2) + Math.Pow(vy / vy_rd, 2));
  }

  internal class NativeMethods
  {
    [DllImport("Kernel32.dll", BestFitMapping = false, CharSet = CharSet.Ansi, SetLastError = true, ThrowOnUnmappableChar = true)]
    internal static extern IntPtr LoadLibrary([MarshalAs(UnmanagedType.LPStr)]string lpFileName);

    [DllImport("Kernel32.dll", BestFitMapping = false, CharSet = CharSet.Ansi, ExactSpelling = true, SetLastError = true, ThrowOnUnmappableChar = true)]
    internal static extern IntPtr GetProcAddress(IntPtr hModule, string procName);

    [DllImport("Kernel32.dll", SetLastError = true)]
    internal static extern bool FreeLibrary(IntPtr hModule);

    [DllImport("Kernel32.dll", CharSet = CharSet.Unicode, SetLastError = true)]
    [return: MarshalAs(UnmanagedType.Bool)]
    internal static extern bool SetDllDirectory(string lpPathName);
  }
# ---------- end check_cross_sections ----------
bnd_11 = Bounds(Numbers=check_cross_sections.eta_x)  # disabled
bnd_12 = Bounds(Numbers=check_cross_sections.eta_y)  # disabled
bnd_13 = Bounds(Numbers=check_cross_sections.eta_vxy)  # disabled
bnd_14 = Bounds(Numbers=check_cross_sections.eta_vz)  # disabled
bnd_15 = Bounds(Numbers=check_cross_sections.eta_v)  # disabled
bnd_16 = Bounds(Numbers=check_cross_sections.eta)  # disabled
addition_12 = Addition(A=check_cross_sections.eta_vxy, B=check_cross_sections.eta_vz)  # disabled
panel_71 = Panel([bnd_11, bnd_12, bnd_13, bnd_14, bnd_15, bnd_16])  # disabled
bnd_17 = Bounds(Numbers=addition_12)  # disabled
get_deformed_mesh_sofistik_2 = GetDeformedMeshSofistik(Path=pathcdb_2, LoadCase=1, ScalingFactor=100, SofistikPath=pathcdb_dll_4, Run=toggle)  # -> InitialMesh, DeformedMesh; disabled
number_slider_50 = Slider(1, range=0..1)  # disabled
dedomain_21 = DeconstructDomain(Domain=bnd_16)  # -> Start, End; disabled
gradient_4 = Gradient(
    LowerLimit=dedomain_21.End,
    UpperLimit=dedomain_21.Start,
    Parameter=check_cross_sections.eta,
    stops=[0: RGB(234, 38, 0), 0.25: RGB(234, 126, 0), 0.5: RGB(254, 244, 84), 0.75: RGB(173, 203, 249), 1: RGB(75, 107, 169)])  # disabled

# ----
panel_72 = Panel(check_cross_sections.eta)  # disabled

sort_9 = SortList(Keys=flatten(check_cross_sections.eta))  # -> reverse(Keys), ValuesA; disabled
expression_2 = Expression(x=sort_9.Keys, Expression="Round(x,2)")  # disabled
maxutilisation = Panel(expression_2)  # disabled

eta_y = Panel(bnd_12)  # disabled
eta_vxy_vz = Panel(bnd_17)  # disabled
eta_v = Panel(bnd_15)  # disabled
eta = Panel(bnd_16)  # disabled
eta_vxy = Panel(bnd_13)  # disabled
eta_vz = Panel(bnd_14)  # disabled
eta_x = Panel(bnd_11)  # disabled

# ---- group: Deformed
dedomain_22 = DeconstructDomain(Domain=bnd_16)  # -> Start, End; disabled
gradient_5 = Gradient(
    LowerLimit=dedomain_22.End,
    UpperLimit=dedomain_22.Start,
    Parameter=check_cross_sections.eta,
    stops=[0: RGB(234, 38, 0), 0.25: RGB(234, 126, 0), 0.5: RGB(254, 244, 84), 0.75: RGB(173, 203, 249), 1: RGB(75, 107, 169)])  # disabled
gradient_6 = Gradient(
    LowerLimit=dedomain_22.End,
    UpperLimit=dedomain_22.Start,
    Parameter=check_cross_sections.eta,
    stops=[0: RGB(217, 76, 48), 0.25: RGB(199, 133, 58), 0.5: RGB(214, 205, 71), 0.75: RGB(99, 142, 207), 1: RGB(12, 60, 156)])  # disabled
number_slider_51 = Slider(0.001, range=0..0.1)  # disabled
wbfacepolys = WeaverbirdsFacePolylines(Mesh=get_deformed_mesh_sofistik_2.InitialMesh)  # -> flatten(Polygons); disabled

# ----
facen_2 = FaceNormals(Mesh=get_deformed_mesh_sofistik_2.InitialMesh)  # -> Centers, Normals; disabled
number_slider_52 = Slider(28, range=0..2100)  # disabled
neg_4 = Negative(Value=number_slider_52)  # disabled
panel_73 = Panel("0")  # disabled
dom_32 = ConstructDomain(DomainStart=neg_4, DomainEnd=number_slider_52)  # disabled
dom_33 = ConstructDomain(DomainStart=panel_73, DomainEnd=number_slider_52)  # disabled
sort_10 = SortList(Keys=check_cross_sections.eta, ValuesA=facen_2.Centers, ValuesB=gradient_4)  # -> reverse(flatten(Keys)), reverse(flatten(ValuesA)), reverse(flatten(ValuesB)); disabled
subset_3 = SubList(List=sort_10.Keys, Domain=dom_33, Wrap=True)  # -> List, Index; disabled
subset_4 = SubList(List=sort_10.ValuesA, Domain=dom_33, Wrap=True)  # -> List, Index; disabled
subset_5 = SubList(List=sort_10.ValuesB, Domain=dom_33, Wrap=True)  # -> List, Index; disabled
expression_3 = Expression(x=subset_3.List, Expression="Round(x,2)")  # disabled
swatch_3 = ColourSwatch(SwatchColor=RGB(0, 0, 0))  # disabled
swatch_4 = ColourSwatch(SwatchColor=RGB(0, 191, 255))  # disabled
number_slider_53 = Slider(15, range=1..50)  # disabled
number_slider_54 = Slider(1, range=0..50)  # disabled
maxutilisation_2 = Panel(expression_3)  # disabled

item_33 = ListItem(List=maxutilisation, Index=0, Wrap=True)  # disabled

wbjoin = WeaverbirdsJoinMeshesAndWeld(Mesh=get_deformed_mesh_sofistika.DeformedMesh, Weld=False)  # disabled
wbjoin_2 = WeaverbirdsJoinMeshesAndWeld(Mesh=get_deformed_mesh_sofistika.InitialMesh, Weld=False)  # disabled
number_slider_55 = Slider(0.02, range=0..1)  # disabled
facen_3 = FaceNormals(Mesh=wbjoin_2)  # -> Centers, Normals; disabled
facen_4 = FaceNormals(Mesh=wbjoin)  # -> Centers, Normals; disabled
wbfacepolys_2 = WeaverbirdsFacePolylines(Mesh=wbjoin)  # -> flatten(Polygons); disabled
wbfacepolys_3 = WeaverbirdsFacePolylines(Mesh=wbjoin_2)  # -> flatten(Polygons); disabled
swatch_5 = ColourSwatch(SwatchColor=RGB(255, 0, 0))  # disabled
swatch_6 = ColourSwatch(SwatchColor=RGB(0, 0, 0))  # disabled
dist = Distance(PointA=facen_3.Centers, PointB=facen_4.Centers)  # disabled
sph = Sphere(Base=pt_55, Radius=number_slider_55)  # disabled
sph_2 = Sphere(Base=item_32, Radius=number_slider_55)  # disabled
bnd_18 = Bounds(Numbers=dist)  # disabled
dedomain_23 = DeconstructDomain(Domain=bnd_18)  # -> Start, End; disabled
gradient_7 = Gradient(
    LowerLimit=dedomain_23.End,
    UpperLimit=dedomain_23.Start,
    Parameter=dist,
    stops=[0: RGBA(235, 39, 0, 80), 0.25: RGBA(235, 125, 0, 80), 0.5: RGBA(255, 244, 84, 80), 0.83: RGBA(172, 203, 250, 80), 1: RGBA(74, 77, 168, 80)])  # disabled
gradient_8 = Gradient(
    LowerLimit=dedomain_23.End,
    UpperLimit=dedomain_23.Start,
    Parameter=dist,
    stops=[0: RGBA(186, 31, 0, 45), 0.25: RGBA(199, 106, 0, 45), 0.5: RGBA(232, 217, 0, 45), 0.83: RGBA(0, 97, 242, 45), 1: RGBA(0, 8, 240, 45)])  # disabled
gradient_9 = Gradient(
    LowerLimit=number_slider_40,
    UpperLimit=dedomain_23.Start,
    Parameter=dist,
    stops=[0: RGB(234, 38, 0), 0.25: RGB(234, 126, 0), 0.5: RGB(254, 244, 84), 0.83: RGB(173, 203, 249), 1: RGB(74, 77, 168)])  # disabled
number_slider_56 = Slider(0.01, range=0..10)  # disabled
number_slider_57 = Slider(14, range=0..20)  # disabled

maxutilisation_3 = Panel(item_33)  # disabled

# ---- group: CLT Utilization
previewlw = CustomPreviewLineweights(Geometry=wbfacepolys, Shader=gradient_6, Thickness=number_slider_51, Absolute=True)  # disabled
colourmesh_2 = ColourMesh(Mesh=get_deformed_mesh_sofistik_2.InitialMesh, Colors=gradient_4)  # disabled
screentext = ScreenOrientedText(
    Text=maxutilisation_2,
    Justification=7,
    Location=subset_4.List,
    SizeFactor=number_slider_53,
    Color=swatch_3,
    Depth=number_slider_54,
    Absolute=False)  # disabled

# ---- group: Deformation / Deformed
previewlw_2 = CustomPreviewLineweights(Geometry=wbfacepolys_2, Shader=gradient_8, Thickness=number_slider_56, Absolute=True)  # disabled
colourmesh_3 = ColourMesh(Mesh=get_deformed_mesh_sofistika.DeformedMesh, Colors=gradient_9)  # disabled
previewlw_3 = CustomPreviewLineweights(Geometry=sph_2, Shader=swatch_5, Thickness=number_slider_56, Absolute=True)  # disabled
screentext_2 = ScreenOrientedText(
    Text=concat_3,
    Font=item_7,
    Justification=7,
    Location=item_32,
    SizeFactor=number_slider_57,
    Color=swatch_6,
    Depth=0,
    Absolute=False)  # disabled

# ---- group: Deformation / Undeformed
colourmesh_4 = ColourMesh(Mesh=get_deformed_mesh_sofistika.InitialMesh, Colors=gradient_3)  # disabled
previewlw_4 = CustomPreviewLineweights(Geometry=wbfacepolys_3, Shader=gradient_8, Thickness=number_slider_56, Absolute=True)  # disabled
# SOFIMESH
screentext_3 = ScreenOrientedText(
    Text=concat_3,
    Font=item_7,
    Justification=7,
    Location=pt_55,
    SizeFactor=number_slider_57,
    Color=swatch_6,
    Depth=0,
    Absolute=False)  # disabled
previewlw_5 = CustomPreviewLineweights(Geometry=sph, Shader=swatch_5, Thickness=number_slider_56, Absolute=True)  # disabled
