# Grasshopper definition BilayerDesign - Structural optimization with fixed stock.gh (Grasshopper 1.0.7)
# plug-ins: Sofistik, Telepathy, HygroDesign, Pufferfish, MeshEdit Components, Karamba3D, Kangaroo2 Components, Weaverbird, Human, LunchBox, Wombat, Opossum2_0_Proto_A

update = Button()
python = GhPythonScript(update=update)  # inputs update: Boolean
# ---------- python: Python ----------
# Seghier Mohamed Abdelaziz - 2021 - seghierdesign@gmail.com

import Grasshopper as gh

ghDoc = ghenv.Component.OnPingDocument()
objects = ghDoc.Objects

object = []

for obj in objects: 

    if obj.NickName.Length == 0:
        if str(obj.RemovedFromDocument.DeclaringType) == "Grasshopper.Kernel.GH_Component":
            object.append(obj)
                
if update == True:
    gh.Kernel.GH_Document.NewSolution(ghDoc,False)
    for o in object:
        gh.Kernel.GH_Document.RemoveObject(ghDoc ,o,False)
# ---------- end python ----------

number_slider = Slider(1000, range=0..1000)
neg = Negative(Value=number_slider)
rectangle = Rectangle(Plane=PlaneXY(0, 0, 0), XSize=number_slider, YSize=neg, Radius=0)  # -> Rectangle, Length
drec = DeconstuctRectangle(Rectangle=rectangle.Rectangle)  # -> BasePlane, XInterval, YInterval
dedomain = DeconstructDomain(Domain=drec.XInterval)  # -> Start, End
dedomain_2 = DeconstructDomain(Domain=drec.YInterval)  # -> Start, End
pt = ConstructPoint(XCoordinate=dedomain.Start, YCoordinate=0, ZCoordinate=0)
pt_2 = ConstructPoint(XCoordinate=dedomain.End, YCoordinate=0, ZCoordinate=0)
subtraction = Subtraction(A=dedomain_2.End, B=dedomain_2.Start)
ln = Line(StartPoint=pt, EndPoint=pt_2)
number_slider_2 = Slider(0.334, range=0..1)
number_slider_3 = Slider(0.304, range=0..0.5)
number_slider_4 = Slider(0.5, range=0..0.5)
number_slider_5 = Slider(0.841, range=0.5..1)
number_slider_6 = Slider(0.999, range=0.5..1)
number_slider_7 = Slider(1, range=0.5..1)
divide = DivideCurve(Curve=ln, Count=expr("x-1", Slider(3, range=0..10)), Kinks=False)  # -> Points, Tangents, Parameters
multiplication = Multiplication(A=subtraction, B=number_slider_6)
multiplication_2 = Multiplication(A=subtraction, B=number_slider_3)
multiplication_3 = Multiplication(A=subtraction, B=number_slider_7)
multiplication_4 = Multiplication(A=subtraction, B=number_slider_2)
multiplication_5 = Multiplication(A=subtraction, B=number_slider_5)
multiplication_6 = Multiplication(A=subtraction, B=number_slider_4)
neg_2 = Negative(Value=multiplication_2)
neg_3 = Negative(Value=multiplication)
neg_4 = Negative(Value=multiplication_4)
neg_5 = Negative(Value=multiplication_3)
neg_6 = Negative(Value=multiplication_6)
neg_7 = Negative(Value=multiplication_5)
item = ListItem(List=divide.Points, Index=0, Wrap=True)  # -> Item, Item1, Item2
Y = UnitY(Factor=neg_2)
Y_2 = UnitY(Factor=neg_4)
Y_3 = UnitY(Factor=neg_3)
Y_4 = UnitY(Factor=neg_5)
Y_5 = UnitY(Factor=neg_6)
Y_6 = UnitY(Factor=neg_7)
move = Move(Geometry=[item.Item, item.Item2], Motion=Y)  # -> Geometry, Transform
move_2 = Move(Geometry=item.Item1, Motion=Y_3)  # -> Geometry, Transform
move_3 = Move(Geometry=[item.Item, item.Item2], Motion=Y_2)  # -> Geometry, Transform
move_4 = Move(Geometry=item.Item1, Motion=Y_4)  # -> Geometry, Transform
move_5 = Move(Geometry=[item.Item, item.Item2], Motion=Y_5)  # -> Geometry, Transform
move_6 = Move(Geometry=item.Item1, Motion=Y_6)  # -> Geometry, Transform
item_2 = ListItem(List=move.Geometry, Index=0, Wrap=True)  # -> Item, Item1
item_3 = ListItem(List=move_3.Geometry, Index=0, Wrap=True)  # -> Item, Item1
item_4 = ListItem(List=move_5.Geometry, Index=0, Wrap=True)  # -> Item, Item1
merge = Merge(Data1=flatten(item_2.Item), Data2=flatten(move_2.Geometry), Data3=flatten(item_2.Item1))
merge_2 = Merge(Data1=flatten(item_3.Item), Data2=flatten(move_4.Geometry), Data3=flatten(item_3.Item1))
merge_3 = Merge(Data1=flatten(item_4.Item), Data2=flatten(move_6.Geometry), Data3=flatten(item_4.Item1))
intcrv = Interpolate(Vertices=merge, Degree=3, Periodic=False, KnotStyle=1)  # -> Curve, Length, Domain
intcrv_2 = Interpolate(Vertices=merge_2, Degree=3, Periodic=False, KnotStyle=1)  # -> Curve, Length, Domain
intcrv_3 = Interpolate(Vertices=merge_3, Degree=3, Periodic=False, KnotStyle=1)  # -> Curve, Length, Domain
merge_4 = Merge(Data1=intcrv.Curve, Data2=intcrv_2.Curve, Data3=intcrv_3.Curve)
rec = Rectangle(rectangle.Rectangle)

# ---- group: beech
species = WoodSpecies(
    Name="beech",
    LExpansion=Slider(0.0001, range=0..0.0001),
    RExpansion=Slider(0.002, range=0..1),
    TExpansion=Slider(0.0041, range=0..1),
    LElasticModulus=Slider(14000, range=0..20000),
    RElasticModulus=Slider(2280, range=0..20000),
    TElasticModulus=Slider(1160, range=0..20000))

# ---- group: spruce
species_2 = WoodSpecies(
    Name="spruce",
    LExpansion=Slider(0.0001, range=0..0.0001),
    RExpansion=Slider(0.0019, range=0..1),
    TExpansion=Slider(0.0036, range=0..1),
    LElasticModulus=Slider(10000, range=0..20000),
    RElasticModulus=Slider(800, range=0..20000),
    TElasticModulus=Slider(450, range=0..20000))

# ---- group: must be even
number_slider_8 = Slider(4, range=0..10)

# ----
number_slider_9 = Slider(1000, range=0..1000)
rectangle_2 = Rectangle(Plane=PlaneXY(0, 0, 0), XSize=number_slider_9, YSize=number_slider_9, Radius=0)  # -> Rectangle, Length
drec_2 = DeconstuctRectangle(Rectangle=rectangle_2.Rectangle)  # -> BasePlane, XInterval, YInterval
dedomain_3 = DeconstructDomain(Domain=drec_2.YInterval)  # -> Start, End
subtraction_2 = Subtraction(A=dedomain_3.End, B=dedomain_3.Start)
division = Division(A=subtraction_2, B=2)
number_slider_10 = Slider(0.124, range=0..1)
number_slider_11 = Slider(0.949, range=0..1)
dom = ConstructDomain(DomainStart=0, DomainEnd=1)
number_slider_12 = Slider(0.998, range=0..1)
addition = Addition(A=dedomain_3.Start, B=division)
dom_2 = ConstructDomain(DomainStart=addition, DomainEnd=dedomain_3.End)
dom_3 = ConstructDomain(DomainStart=addition, DomainEnd=dedomain_3.Start)
remap = RemapNumbers(Value=number_slider_10, Source=dom, Target=dom_3)  # -> Mapped, Clipped
remap_2 = RemapNumbers(Value=number_slider_11, Source=dom, Target=drec_2.XInterval)  # -> Mapped, Clipped
remap_3 = RemapNumbers(Value=number_slider_10, Source=dom, Target=dom_2)  # -> Mapped, Clipped
remap_4 = RemapNumbers(Value=number_slider_12, Source=dom, Target=drec_2.XInterval)  # -> Mapped, Clipped
pt_3 = ConstructPoint(XCoordinate=0, YCoordinate=remap_2.Mapped, ZCoordinate=0)
pt_4 = ConstructPoint(XCoordinate=remap.Mapped, YCoordinate=remap_4.Mapped, ZCoordinate=0)
pt_5 = ConstructPoint(XCoordinate=remap_3.Mapped, YCoordinate=remap_4.Mapped, ZCoordinate=0)
pt_6 = ConstructPoint(XCoordinate=number_slider_9, YCoordinate=remap_2.Mapped, ZCoordinate=0)
merge_5 = Merge(Data1=pt_3, Data2=pt_4, Data3=pt_5, Data4=pt_6)
nurbs = NurbsCurve(Vertices=merge_5, Degree=2, Periodic=False)  # -> Curve, Length, Domain

number_slider_13 = Slider(1000, range=0..1000)
rectangle_3 = Rectangle(Plane=PlaneXY(0, 0, 0), XSize=number_slider_13, YSize=number_slider_13, Radius=0)  # -> Rectangle, Length
drec_3 = DeconstuctRectangle(Rectangle=rectangle_3.Rectangle)  # -> BasePlane, XInterval, YInterval
dedomain_4 = DeconstructDomain(Domain=drec_3.YInterval)  # -> Start, End
subtraction_3 = Subtraction(A=dedomain_4.End, B=dedomain_4.Start)
division_2 = Division(A=subtraction_3, B=2)
number_slider_14 = Slider(0.677, range=0..1)
number_slider_15 = Slider(0.831, range=0..1)
dom_4 = ConstructDomain(DomainStart=0, DomainEnd=1)
addition_2 = Addition(A=dedomain_4.Start, B=division_2)
number_slider_16 = Slider(0.491, range=0..1)
dom_5 = ConstructDomain(DomainStart=addition_2, DomainEnd=dedomain_4.End)
dom_6 = ConstructDomain(DomainStart=addition_2, DomainEnd=dedomain_4.Start)
remap_5 = RemapNumbers(Value=number_slider_14, Source=dom_4, Target=dom_6)  # -> Mapped, Clipped
remap_6 = RemapNumbers(Value=number_slider_15, Source=dom_4, Target=drec_3.XInterval)  # -> Mapped, Clipped
remap_7 = RemapNumbers(Value=number_slider_14, Source=dom_4, Target=dom_5)  # -> Mapped, Clipped
remap_8 = RemapNumbers(Value=number_slider_16, Source=dom_4, Target=drec_3.XInterval)  # -> Mapped, Clipped
pt_7 = ConstructPoint(XCoordinate=0, YCoordinate=remap_6.Mapped, ZCoordinate=0)
pt_8 = ConstructPoint(XCoordinate=remap_5.Mapped, YCoordinate=remap_8.Mapped, ZCoordinate=0)
pt_9 = ConstructPoint(XCoordinate=remap_7.Mapped, YCoordinate=remap_8.Mapped, ZCoordinate=0)
pt_10 = ConstructPoint(XCoordinate=number_slider_13, YCoordinate=remap_6.Mapped, ZCoordinate=0)
merge_6 = Merge(Data1=pt_7, Data2=pt_8, Data3=pt_9, Data4=pt_10)
nurbs_2 = NurbsCurve(Vertices=merge_6, Degree=2, Periodic=False)  # -> Curve, Length, Domain

number_slider_17 = Slider(1000, range=0..1000)
rectangle_4 = Rectangle(Plane=PlaneXY(0, 0, 0), XSize=number_slider_17, YSize=number_slider_17, Radius=0)  # -> Rectangle, Length
drec_4 = DeconstuctRectangle(Rectangle=rectangle_4.Rectangle)  # -> BasePlane, XInterval, YInterval
dedomain_5 = DeconstructDomain(Domain=drec_4.YInterval)  # -> Start, End
subtraction_4 = Subtraction(A=dedomain_5.End, B=dedomain_5.Start)
division_3 = Division(A=subtraction_4, B=2)
number_slider_18 = Slider(0.21, range=0..1)
dom_7 = ConstructDomain(DomainStart=0, DomainEnd=1)
number_slider_19 = Slider(0.985, range=0..1)
addition_3 = Addition(A=dedomain_5.Start, B=division_3)
number_slider_20 = Slider(0.241, range=0..1)
dom_8 = ConstructDomain(DomainStart=addition_3, DomainEnd=dedomain_5.End)
dom_9 = ConstructDomain(DomainStart=addition_3, DomainEnd=dedomain_5.Start)
remap_9 = RemapNumbers(Value=number_slider_19, Source=dom_7, Target=dom_9)  # -> Mapped, Clipped
remap_10 = RemapNumbers(Value=number_slider_18, Source=dom_7, Target=drec_4.XInterval)  # -> Mapped, Clipped
remap_11 = RemapNumbers(Value=number_slider_19, Source=dom_7, Target=dom_8)  # -> Mapped, Clipped
remap_12 = RemapNumbers(Value=number_slider_20, Source=dom_7, Target=drec_4.XInterval)  # -> Mapped, Clipped
pt_11 = ConstructPoint(XCoordinate=0, YCoordinate=remap_10.Mapped, ZCoordinate=0)
pt_12 = ConstructPoint(XCoordinate=remap_9.Mapped, YCoordinate=remap_12.Mapped, ZCoordinate=0)
pt_13 = ConstructPoint(XCoordinate=remap_11.Mapped, YCoordinate=remap_12.Mapped, ZCoordinate=0)
pt_14 = ConstructPoint(XCoordinate=number_slider_17, YCoordinate=remap_10.Mapped, ZCoordinate=0)
merge_7 = Merge(Data1=pt_11, Data2=pt_12, Data3=pt_13, Data4=pt_14)
nurbs_3 = NurbsCurve(Vertices=merge_7, Degree=2, Periodic=False)  # -> Curve, Length, Domain

int = Integer(number_slider_8)

number_slider_21 = Slider(150, range=0..10000)
number_slider_22 = Slider(4, range=0..10)
number_slider_23 = Slider(2500, range=0..10000)
number_slider_24 = Slider(21, range=0..100)
xy = XYPlane(Origin=Point(0, 0, 0))
multiplication_7 = Multiplication(A=number_slider_24, B=number_slider_21)
multiplication_8 = Multiplication(A=number_slider_23, B=number_slider_22)
bilayer = Bilayer(
    BasePlane=xy,
    BoardWidth=number_slider_21,
    BoardLength=number_slider_23,
    WidthCount=number_slider_24,
    LengthCount=number_slider_22,
    ActiveThickness=Slider(20, range=0..100),
    PassiveThickness=Slider(4, range=0..100),
    PassiveSpecies=species_2,
    RegionCount=int)
rectangle_5 = Rectangle(Plane=PlaneXY(0, 0, 0), XSize=multiplication_8, YSize=multiplication_7, Radius=0)  # -> Rectangle, Length
num = Number(number_slider_21)
num_2 = Number(number_slider_23)

board_count = Slider(500, range=0..500)
drec_5 = DeconstuctRectangle(Rectangle=rectangle_5.Rectangle)  # -> BasePlane, XInterval, YInterval
panel = Panel(drec_5.XInterval)
panel_2 = Panel(drec_5.YInterval)

# ---- group: name
num_3 = Number(board_count)
series = Series(Start=0, Step=1, Count=num_3)
dup = DuplicateData(Data="S", Number=num_3, Order=True)  # -> graft(Data)
txt = Text(graft(series))
merge_8 = Merge(Data1=dup, Data2=txt)  # -> simplify(Result)
join = TextJoin(Text=merge_8)  # -> flatten(Result)

# ---- group: active thickness
number_slider_25 = Slider(20, range=0..100)

# ---- group: RT
dom_10 = ConstructDomain(DomainStart=Slider(15, range=0..100), DomainEnd=Slider(75, range=0..100))
random = Random(Range=dom_10, Number=board_count, Seed=Slider(225, range=0..1000))

# ---- group: name
num_4 = Number(board_count)
series_2 = Series(Start=0, Step=1, Count=num_4)
dup_2 = DuplicateData(Data="B", Number=num_4, Order=True)  # -> graft(Data)
txt_2 = Text(graft(series_2))
merge_9 = Merge(Data1=dup_2, Data2=txt_2)  # -> simplify(Result)
join_2 = TextJoin(Text=merge_9)  # -> flatten(Result)

# ---- group: thickness
num_5 = Number(number_slider_25)
num_6 = Number(board_count)
dup_3 = DuplicateData(Data=num_5, Number=num_6, Order=True)

# ---- group: length
num_7 = Number(num_2)
num_8 = Number(board_count)
dup_4 = DuplicateData(Data=num_7, Number=num_8, Order=True)

# ---- group: width
num_9 = Number(num)
num_10 = Number(board_count)
dup_5 = DuplicateData(Data=num_9, Number=num_10, Order=True)

# ---- group: beech
data = Data(species)

# ---- group: spruce
data_2 = Data(species_2)

# ---- group: bounding rectangle input (rectangle y domain represents full range of radii from stockpiles)
rec_2 = Rectangle(rec)

# ----
stock_boards = StockBoards(Name=join_2, Species=data, Thickness=dup_3, Length=dup_4, Width=dup_5, RTAngle=random)
stock_boards_2 = StockBoards(Name=join, Species=data_2, Thickness=dup_3, Length=dup_4, Width=dup_5, RTAngle=random)
merge_10 = Merge(Data1=stock_boards, Data2=stock_boards_2)

# ---- group: curve controller inputs (represents distribution of radii along a given cross section)
crv = Curve(merge_4)

# ----
crv_2 = Curve(crv)
lng = ListLength(List=crv_2)  # -> expr("x-2", Length)
dom_11 = ConstructDomain(DomainStart=0, DomainEnd=lng)
subset = SubList(List=crv_2, Domain=dom_11, Wrap=True)  # -> graft(List), Index
shift = ShiftList(List=crv_2, Shift=1, Wrap=False)  # -> graft(List)
merge_11 = Merge(Data1=subset.List, Data2=shift)  # -> simplify(Result)
group = Group(Objects=merge_11)  # -> flatten(Group)

merge_12 = Merge(Data1=nurbs.Curve, Data2=nurbs_2.Curve, Data3=nurbs_3.Curve)

crv_3 = Curve(merge_12)
lng_2 = ListLength(List=crv_3)  # -> expr("x-2", Length)
dom_12 = ConstructDomain(DomainStart=0, DomainEnd=lng_2)
subset_2 = SubList(List=crv_3, Domain=dom_12, Wrap=True)  # -> graft(List), Index
shift_2 = ShiftList(List=crv_3, Shift=1, Wrap=False)  # -> graft(List)
merge_13 = Merge(Data1=subset_2.List, Data2=shift_2)  # -> simplify(Result)
group_2 = Group(Objects=merge_13)  # -> flatten(Group)

deconstruct_bilayer = DeconstructBilayer(Bilayer=bilayer)
dec_board = DeconstructBoard(Board=deconstruct_bilayer)  # -> Polyline, Name, Species, RTAngle, MoistureChange, DesiredRadius, Radius, BlendedRadius, BoardRegions
area = Area(Geometry=dec_board.Polyline)  # -> Area, Centroid
c_script = CSharpScript(rects=flatten(dec_board.Polyline))  # -> out; inputs rects: list of Rectangle3d; disabled
# ---------- c_script: C# usings ----------
using Rhino.DocObjects;
# ---------- c_script: C# ----------
    var object_enumerator_settings = new ObjectEnumeratorSettings();

    var rhinoObjects = RhinoDoc.ActiveDoc.Objects.GetObjectList(object_enumerator_settings);
    var objectTable = RhinoDoc.ActiveDoc.Objects;

    foreach( var rhinoObject in rhinoObjects)
    {
      if(rhinoObject.ObjectType == ObjectType.Curve)
      {
        Curve rhinoCurve = rhinoObject.Geometry as Curve;
        if(rhinoCurve.IsClosed)objectTable.Delete(rhinoObject);
      }
    }

    foreach(var rect in rects)objectTable.AddCurve(rect.ToNurbsCurve());
# ---------- end c_script ----------
pt_15 = Point(simplify(area.Centroid))

# ---- group: Thickness
dec_reg = DeconstructBoardRegion(BoardRegion=dec_board.BoardRegions)  # -> Polyline, Name, Species, RTAngle, MoistureChange, DesiredRadius, Radius, BlendedRadius, ThicknessBlendedRadius
area_2 = Area(Geometry=dec_reg.Polyline)  # -> Area, Centroid
pt_16 = Point(simplify(area_2.Centroid))
pdecon = Deconstruct(Point=pt_16)  # -> XComponent, YComponent, ZComponent
bnd = Bounds(Numbers=flatten(pdecon.XComponent))
dom_13 = ConstructDomain(DomainStart=Slider(1.2, range=0..1.2), DomainEnd=Slider(0.2, range=0..1))
remap_13 = RemapNumbers(Value=pdecon.XComponent, Source=bnd, Target=dom_13)  # -> Mapped, Clipped

# ----
bbox = BoundingBox(Content=dec_board.Polyline, Plane=PlaneXY(0, 0, 0), UnionBox=True)  # -> Box, Box_2
debox = DeconstructBox(Box=bbox.Box)  # -> Plane, X, Y, Z
dedomain_6 = DeconstructDomain(Domain=debox.Y)  # -> Start, End
subtraction_5 = Subtraction(A=dedomain_6.End, B=dedomain_6.Start)
division_4 = Division(A=subtraction_5, B=2)
number_slider_26 = Slider(0.587, range=0.25..1)
number_slider_27 = Slider(0.75, range=0..0.75)
number_slider_28 = Slider(0.792, range=0..1)
addition_4 = Addition(A=dedomain_6.Start, B=division_4)
dom_14 = ConstructDomain(DomainStart=0, DomainEnd=1)
dom_15 = ConstructDomain(DomainStart=addition_4, DomainEnd=dedomain_6.End)
dom_16 = ConstructDomain(DomainStart=addition_4, DomainEnd=dedomain_6.Start)
remap_14 = RemapNumbers(Value=number_slider_26, Source=dom_14, Target=debox.X)  # -> Mapped, Clipped
remap_15 = RemapNumbers(Value=number_slider_27, Source=dom_14, Target=debox.X)  # -> Mapped, Clipped
remap_16 = RemapNumbers(Value=number_slider_28, Source=dom_14, Target=dom_16)  # -> Mapped, Clipped
remap_17 = RemapNumbers(Value=number_slider_28, Source=dom_14, Target=dom_15)  # -> Mapped, Clipped
pt_17 = ConstructPoint(XCoordinate=remap_14.Mapped, YCoordinate=dedomain_6.Start, ZCoordinate=0)
pt_18 = ConstructPoint(XCoordinate=remap_15.Mapped, YCoordinate=remap_16.Mapped, ZCoordinate=0)
pt_19 = ConstructPoint(XCoordinate=remap_15.Mapped, YCoordinate=remap_17.Mapped, ZCoordinate=0)
pt_20 = ConstructPoint(XCoordinate=remap_14.Mapped, YCoordinate=dedomain_6.End, ZCoordinate=0)
merge_14 = Merge(Data1=pt_17, Data2=pt_18, Data3=pt_19, Data4=pt_20)
nurbs_4 = NurbsCurve(Vertices=merge_14, Degree=2, Periodic=False)  # -> Curve, Length, Domain

# ---- group: generate distribution
pt_21 = Point(simplify(pt_15))
data_3 = Data(group)
pdecon_2 = Deconstruct(Point=pt_21)  # -> XComponent, YComponent, ZComponent
bnd_2 = Bounds(Numbers=flatten(pdecon_2.XComponent))
bnd_3 = Bounds(Numbers=flatten(pdecon_2.YComponent))
lng_3 = ListLength(List=data_3)
dedomain_7 = DeconstructDomain(Domain=bnd_2)  # -> Start, End
remap_18 = RemapNumbers(Value=pdecon_2.YComponent, Source=bnd_3, Target=Domain(0, 1))  # -> graft(Mapped), Clipped
c_script_2 = CSharpScript(count=lng_3, start=dedomain_7.Start, end=dedomain_7.End)  # -> out, A; inputs count: Int32, start: Double, end: Double
# ---------- c_script_2: C# ----------
    double totalLength = end - start;
    double domLength = totalLength / (double) count;

    List<Interval> intervals = new List<Interval>();
    double currentStart = start;
    for(int i = 0; i < count; i++)
    {
      intervals.Add(new Interval(currentStart, currentStart + domLength));
      currentStart += domLength;
    }
    A = intervals;
# ---------- end c_script_2 ----------
num_11 = Number(graft(pdecon_2.XComponent))
inc = Includes(Value=num_11, Domain=simplify(c_script_2.A))  # -> Includes, Deviation
cull = CullPattern(List=data_3, CullPattern=inc.Includes)
item_5 = ListItem(List=cull, Index=0, Wrap=True)
cull_2 = CullPattern(List=c_script_2.A, CullPattern=inc.Includes)
ungroup = Ungroup(Group=item_5)  # -> simplify(Objects)
item_6 = ListItem(List=cull_2, Index=0, Wrap=True)
remap_19 = RemapNumbers(Value=num_11, Source=item_6, Target=Domain(0, 1))  # -> Mapped, Clipped
eval = EvaluateCurve(Curve=reparameterize(ungroup), Parameter=remap_18.Mapped)  # -> Point, Tangent, Angle
pdecon_3 = Deconstruct(Point=eval.Point)  # -> XComponent, YComponent, ZComponent
item_7 = ListItem(List=pdecon_3.YComponent, Index=0, Wrap=True)  # -> Item, Item1
twn2nums = TweenTwoNumbers(NumberA=item_7.Item, NumberB=item_7.Item1, Factor=remap_19.Mapped)
num_12 = Number(twn2nums)

pt_22 = Point(simplify(pt_16))
data_4 = Data(group_2)
pdecon_4 = Deconstruct(Point=pt_22)  # -> XComponent, YComponent, ZComponent
bnd_4 = Bounds(Numbers=flatten(pdecon_4.XComponent))
bnd_5 = Bounds(Numbers=flatten(pdecon_4.YComponent))
lng_4 = ListLength(List=data_4)
dedomain_8 = DeconstructDomain(Domain=bnd_4)  # -> Start, End
remap_20 = RemapNumbers(Value=pdecon_4.YComponent, Source=bnd_5, Target=Domain(0, 1))  # -> graft(Mapped), Clipped
c_script_3 = CSharpScript(count=lng_4, start=dedomain_8.Start, end=dedomain_8.End)  # -> out, A; inputs count: Int32, start: Double, end: Double; same code as c_script_2
num_13 = Number(graft(pdecon_4.XComponent))
inc_2 = Includes(Value=num_13, Domain=simplify(c_script_3.A))  # -> Includes, Deviation
cull_3 = CullPattern(List=data_4, CullPattern=inc_2.Includes)
item_8 = ListItem(List=cull_3, Index=0, Wrap=True)
cull_4 = CullPattern(List=c_script_3.A, CullPattern=inc_2.Includes)
ungroup_2 = Ungroup(Group=item_8)  # -> simplify(Objects)
item_9 = ListItem(List=cull_4, Index=0, Wrap=True)
remap_21 = RemapNumbers(Value=num_13, Source=item_9, Target=Domain(0, 1))  # -> Mapped, Clipped
eval_2 = EvaluateCurve(Curve=reparameterize(ungroup_2), Parameter=remap_20.Mapped)  # -> Point, Tangent, Angle
pdecon_5 = Deconstruct(Point=eval_2.Point)  # -> XComponent, YComponent, ZComponent
item_10 = ListItem(List=pdecon_5.YComponent, Index=0, Wrap=True)  # -> Item, Item1
twn2nums_2 = TweenTwoNumbers(NumberA=item_10.Item, NumberB=item_10.Item1, Factor=remap_21.Mapped)
num_14 = Number(twn2nums_2)

# ----
movopossum_3_0_0 = Opossum(
    OpossumData_NumberOfObjectives=1,
    OpossumData_OptimizationType=0,
    OpossumData_ResultSerializationStatus=1,
    OpossumData_ObjectiveValue=[171.337974, 78.20576294, 233.5006891, 52.2456167, 112.6515665, 87.16872321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],
    OpossumData_ParameterList=["0.686249,0.832744,0.874099,0.604964,0.426961,0.118197,0.978557,0.683467,0.879848,0.524374,0.750035,0.213669,0.918091,0.309135,0.688690,0.533434,0.287383,0.966986", "0.450256,0.290769,0.749759,0.173994,0.223431,0.970667,0.688714,0.056303,0.163315,0.275706,0.577429,0.444650,0.586607,0.024624,0.751670,0.715112,0.384067,0.274958", "0.178952,0.466741,0.680630,0.868311,0.737514,0.423697,0.840121,0.224610,0.330001,0.684513,0.488578,0.728749,0.995944,0.075970,0.734183,0.550156,0.442819,0.473734", "0.080174,0.766449,0.963517,0.449121,0.051822,0.294014,0.159033,0.795119,0.676060,0.143611,0.696501,0.325760,0.685687,0.446600,0.925766,0.769721,0.332508,0.188174", "0.588211,0.632220,0.448521,0.048435,0.681716,0.389388,0.466755,0.415341,0.752419,0.017450,0.332281,0.522199,0.884869,0.201990,0.838087,0.681803,0.067910,0.781951", "0.968328,0.524671,0.564335,0.540529,0.842433,0.727111,0.206328,0.943605,0.584993,0.380395,0.981095,0.146919,0.610205,0.265851,0.567083,0.919174,0.474375,0.032325"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],
    OpossumData_objective=num_43,
    OpossumData_variable=[number_slider_19, number_slider_20, number_slider_18, number_slider_14, number_slider_16, number_slider_15, number_slider_10, number_slider_12, number_slider_11, number_slider_28, number_slider_26, number_slider_27, number_slider_5, number_slider_4, number_slider_7, number_slider_6, number_slider_3, number_slider_2])

# ---- group: material / beech
data_5 = Data(species)

# ---- group: material / Species
crv_4 = Curve(nurbs_4.Curve)

# ---- group: material / spruce
data_6 = Data(species_2)

# ---- group: material
pt_23 = Point(graft(pt_15))
xz = XZPlane(Origin=pt_23)
pcx = CurvePlane(Curve=crv_4, Plane=xz)  # -> simplify(Points), ParamsC, ParamsP
pdecon_6 = Deconstruct(Point=pcx.Points)  # -> XComponent, YComponent, ZComponent
pdecon_7 = Deconstruct(Point=pt_23)  # -> XComponent, YComponent, ZComponent
smaller = SmallerThan(FirstNumber=pdecon_6.XComponent, SecondNumber=pdecon_7.XComponent)  # -> SmallerThan, OrEqualTo
not = GateNot(A=smaller.SmallerThan)
cull_5 = CullPattern(List=data_5, CullPattern=not)
cull_6 = CullPattern(List=data_6, CullPattern=smaller.SmallerThan)
merge_15 = Merge(Data1=cull_5, Data2=cull_6)  # -> simplify(Result)
path_mapper = PathMapper(merge_15, source="{A}", target="{0}")

# ----
pt_24 = Point(pt_15)
pdecon_8 = Deconstruct(Point=pt_24)  # -> XComponent, YComponent, ZComponent
bnd_6 = Bounds(Numbers=flatten(pdecon_8.XComponent))
dom_17 = ConstructDomain(DomainStart="1", DomainEnd="0")
remap_22 = RemapNumbers(Value=pdecon_8.XComponent, Source=bnd_6, Target=dom_17)  # -> simplify(Mapped), Clipped

num_15 = Number(num_12)
rec_3 = Rectangle(rec_2)
drec_6 = DeconstuctRectangle(Rectangle=rec_3)  # -> BasePlane, XInterval, YInterval
dom_18 = ConstructDomain(DomainStart=0, DomainEnd=1)
remap_23 = RemapNumbers(Value=num_15, Source=drec_6.YInterval, Target=dom_18)  # -> Mapped, Clipped
trim = TrimTree(Tree=remap_23.Mapped, Depth=1)

num_16 = Number(num_14)
rec_4 = Rectangle(rectangle_2.Rectangle)
drec_7 = DeconstuctRectangle(Rectangle=rec_4)  # -> BasePlane, XInterval, YInterval
dom_19 = ConstructDomain(DomainStart=0, DomainEnd=Slider(1.2, range=0..10))
remap_24 = RemapNumbers(Value=num_16, Source=drec_7.YInterval, Target=dom_19)  # -> Mapped, Clipped
trim_2 = TrimTree(Tree=remap_24.Mapped, Depth=1)

data_7 = Data(bilayer)
panel_3 = Panel(path_mapper)

update_bilayer = UpdateBilayer(Bilayer=data_7, Radius=trim, RadiusWeight=remap_22.Mapped, Material=path_mapper)
dup_bilayer = DuplicateBilayer(Bilayer=update_bilayer, Count=Slider(3, range=0..10))
panel_4 = Panel(Bilayers=dup_bilayer)
adjust_cro_sec = AdjustCrossSection(Panel=panel_4, Thicknesses=trim_2)
dup_panel = DuplicatePanel(Panel=adjust_cro_sec, Count=Slider(3, range=0..10))

# ---- group: moisture changes
panel_5 = Panel("""2
4
8""")
num_17 = Number(panel_5)

# ----
data_8 = Data(merge_10)
design_env = DesignEnvironment(Panels=dup_panel, StockBoards=data_8, MoistureChanges=num_17)  # -> Panels, StockBoards
convolution = CurvatureConvolution(
    Panels=design_env.Panels,
    TengentialBlending=Slider(0.7, range=0.01..3),
    LongitudinalBlending=Slider(0.8, range=0.01..3),
    MaxRadiusInfluence=100000,
    StiffnessFactor=0.1,
    ThicknessFactor=0.1,
    VisualizeBoardWeights=0)  # -> Panels, Weights

cross_section = BooleanToggle(True)
relaxation = BooleanToggle(False)
cull_7 = CullPattern(List=convolution.Panels, CullPattern=cross_section)

item_11 = ListItem(List=convolution.Panels, Index=0, Wrap=True)  # -> Item, Item1
deconstruct_panel = DeconstructPanel(Panel=item_11.Item)
deconstruct_bilayer_2 = DeconstructBilayer(Bilayer=deconstruct_panel)
dec_board_2 = DeconstructBoard(Board=deconstruct_bilayer_2)  # -> Polyline, Name, Species, RTAngle, MoistureChange, DesiredRadius, Radius, BlendedRadius, BoardRegions
display_panel = DisplayPanels(Panels=item_11.Item)  # -> ActiveBoards, PassiveBoards
dec_reg_2 = DeconstructBoardRegion(BoardRegion=dec_board_2.BoardRegions)  # -> Polyline, Name, Species, RTAngle, MoistureChange, DesiredRadius, Radius, BlendedRadius, ThicknessBlendedRadius

crosecset = UniqueCrossSections(Panel=cull_7)
dec_reg_3 = DeconstructBoardRegion(BoardRegion=crosecset)  # -> Polyline, Name, Species, RTAngle, MoistureChange, DesiredRadius, Radius, BlendedRadius, ThicknessBlendedRadius

bbox_2 = BoundingBox(Content=flatten(dec_reg_2.Polyline), Plane=PlaneXY(0, 0, 0), UnionBox=True)  # -> Box, Box_2
debox_2 = DeconstructBox(Box=bbox_2.Box)  # -> Plane, X, Y, Z
dedomain_9 = DeconstructDomain(Domain=debox_2.Y)  # -> Start, End
subtraction_6 = Subtraction(A=dedomain_9.End, B=dedomain_9.Start)
multiplication_9 = Multiplication(A=subtraction_6, B="1.5")
series_3 = Series(Start=Slider(10000, range=0..10000), Step=multiplication_9, Count=Slider(10, range=0..10))
item_12 = ListItem(List=series_3, Index=0, Wrap=True)  # -> Item, Item1, Item2, Item3, Item4, Item5

deconstruct_bilayer_3 = DeconstructBilayer(Bilayer=deconstruct_panel)
division_5 = Division(A=int, B=2)
bang = ExplodeTree(Data=deconstruct_bilayer_3)
c_script_4 = CSharpScript(tree=dec_reg_3.Polyline, downsample=division_5)  # -> out, A; inputs tree: tree, downsample: Int32
# ---------- c_script_4: C# ----------
    DataTree<object> output = new DataTree<object>();
    for(int i = 0; i < tree.BranchCount; i++)
    {
      if(tree.Paths[i][1] % downsample == 0)
      {
        output.AddRange(tree.Branch(i), tree.Paths[i]);
      }
    }
    A = output;
# ---------- end c_script_4 ----------
c_script_5 = CSharpScript(tree=dec_reg_3.ThicknessBlendedRadius, downsample=division_5)  # -> out, A; inputs tree: tree, downsample: Int32; same code as c_script_4
dec_board_3 = DeconstructBoard(Board=bang)  # -> Polyline, Name, Species, RTAngle, MoistureChange, DesiredRadius, Radius, BlendedRadius, BoardRegions
dec_reg_4 = DeconstructBoardRegion(BoardRegion=dec_board_3.BoardRegions)  # -> flatten(Polyline), Name, Species, RTAngle, MoistureChange, DesiredRadius, Radius, BlendedRadius, ThicknessBlendedRadius

bnd_7 = Bounds(Numbers=flatten(dec_reg_2.ThicknessBlendedRadius))
dedomain_10 = DeconstructDomain(Domain=bnd_7)  # -> Start, End
Y_7 = UnitY(Factor=item_12.Item)
gradient = Gradient(
    LowerLimit=dedomain_10.Start,
    UpperLimit=dedomain_10.End,
    Parameter=dec_reg_2.ThicknessBlendedRadius,
    stops=[0: RGB(255, 255, 255), 1: RGB(0, 0, 0)])
vec = Vector(Y_7)
move_7 = Move(Geometry=display_panel.ActiveBoards, Motion=vec)  # -> Geometry, Transform
move_8 = Move(Geometry=display_panel.PassiveBoards, Motion=vec)  # -> Geometry, Transform
area_3 = Area(Geometry=move_7.Geometry)  # -> Area, Centroid
Z = UnitZ(Factor=Slider(10, range=0..10))
move_9 = Move(Geometry=area_3.Centroid, Motion=Z)  # -> Geometry, Transform
round = Round(Number=dec_reg_2.ThicknessBlendedRadius)  # -> Nearest, Floor, Ceiling
preview = CustomPreview(Geometry=move_8.Geometry, Material=gradient)  # disabled
tag = TextTag3D(Location=move_9.Geometry, Text=round.Nearest, Size=Slider(100, range=0..100), Colour=RGB(255, 0, 0), Justification=5)
preview_2 = CustomPreview(Geometry=move_7.Geometry, Material=gradient)

panel_6 = Panel(bnd_7)
dec_panel_buildups = DeconstructPanelBuildup(Panels=item_11.Item)  # -> WoodSpecies, Thicknesses

python_2 = GhPythonScript(x=dec_reg_2.Species)  # -> out, a
# ---------- python_2: Python ----------
a = x.Name
# ---------- end python_2 ----------
len = TextLength(Text=python_2.a)
bnd_8 = Bounds(Numbers=flatten(len))
dedomain_11 = DeconstructDomain(Domain=bnd_8)  # -> Start, End
gradient_2 = Gradient(
    LowerLimit=dedomain_11.Start,
    UpperLimit=dedomain_11.End,
    Parameter=len,
    stops=[0: RGB(80, 55, 25), 0.5: RGB(159, 65, 29), 1: RGB(174, 166, 129)])
Y_8 = UnitY(Factor=item_12.Item4)
vec_2 = Vector(Y_8)
move_10 = Move(Geometry=display_panel.ActiveBoards, Motion=vec_2)  # -> Geometry, Transform
move_11 = Move(Geometry=display_panel.PassiveBoards, Motion=vec_2)  # -> Geometry, Transform
preview_3 = CustomPreview(Geometry=move_10.Geometry, Material=gradient_2)
preview_4 = CustomPreview(Geometry=move_11.Geometry, Material=ColourSwatch(SwatchColor=RGB(115, 115, 115)))

mesh = Mesh(dec_reg_4.Polyline)
lng_5 = ListLength(List=dec_panel_buildups.WoodSpecies)

c_script_6 = CSharpScript(desired=dec_reg_2.DesiredRadius, actual=dec_reg_2.ThicknessBlendedRadius)  # -> out, A; inputs desired: Double, actual: Double
# ---------- c_script_6: C# ----------
    A = 100 * Math.Abs(desired - actual) / ((desired + actual) / 2);
# ---------- end c_script_6 ----------
bnd_9 = Bounds(Numbers=flatten(c_script_6.A))
panel_7 = Panel(bnd_9)
Y_9 = UnitY(Factor=item_12.Item1)
gradient_3 = Gradient(LowerLimit=0, UpperLimit="100", Parameter=c_script_6.A, stops=[0.15: RGB(255, 130, 160), 0.85: RGB(220, 0, 40)])
vec_3 = Vector(Y_9)
move_12 = Move(Geometry=display_panel.ActiveBoards, Motion=vec_3)  # -> Geometry, Transform
move_13 = Move(Geometry=display_panel.PassiveBoards, Motion=vec_3)  # -> Geometry, Transform
swatch = ColourSwatch(SwatchColor=RGBA(0, 0, 0, 66))
preview_5 = CustomPreview(Geometry=move_12.Geometry, Material=gradient_3)
preview_6 = CustomPreview(Geometry=move_13.Geometry, Material=gradient_3)

c_script_7 = CSharpScript(x=lng_5)  # -> out, flatten(A); inputs x: tree
# ---------- c_script_7: C# ----------
    DataTree<object> output = new DataTree<object>();
    int firstIndex = 0;
    int branchCount = 0;
    for(int i = 0; i < x.BranchCount; i++)
    {
      GH_Path path = new GH_Path(firstIndex, branchCount);
      if(x.Paths[i][0] == firstIndex)
      {
        output.AddRange(x.Branch(i), path);
      }
      else
      {
        firstIndex++;
        branchCount = -1;
        i--;
      }
      branchCount++;
    }
    A = output;
# ---------- end c_script_7 ----------

bnd_10 = Bounds(Numbers=flatten(c_script_7.A))
dedomain_12 = DeconstructDomain(Domain=bnd_10)  # -> Start, End
gradient_4 = Gradient(
    LowerLimit=dedomain_12.Start,
    UpperLimit=dedomain_12.End,
    Parameter=c_script_7.A,
    stops=[0: RGB(0, 128, 0), 0.5: RGB(255, 255, 0), 1: RGB(255, 0, 0)])
Y_10 = UnitY(Factor=item_12.Item5)
vec_4 = Vector(Y_10)
move_14 = Move(Geometry=mesh, Motion=vec_4)  # -> Geometry, Transform
preview_7 = CustomPreview(Geometry=move_14.Geometry, Material=gradient_4)

bnd_11 = Bounds(Numbers=flatten(dec_reg_2.RTAngle))
dedomain_13 = DeconstructDomain(Domain=bnd_11)  # -> Start, End
gradient_5 = Gradient(
    LowerLimit=dedomain_13.Start,
    UpperLimit=dedomain_13.End,
    Parameter=dec_reg_2.RTAngle,
    stops=[0: RGB(124, 0, 219), 1: RGB(207, 130, 255)])
Y_11 = UnitY(Factor=item_12.Item2)
vec_5 = Vector(Y_11)
move_15 = Move(Geometry=display_panel.ActiveBoards, Motion=vec_5)  # -> Geometry, Transform
move_16 = Move(Geometry=display_panel.PassiveBoards, Motion=vec_5)  # -> Geometry, Transform
preview_8 = CustomPreview(Geometry=move_15.Geometry, Material=gradient_5)
preview_9 = CustomPreview(Geometry=move_16.Geometry, Material=ColourSwatch(SwatchColor=RGB(115, 115, 115)))

bnd_12 = Bounds(Numbers=flatten(dec_reg_2.MoistureChange))
dedomain_14 = DeconstructDomain(Domain=bnd_12)  # -> Start, End
Y_12 = UnitY(Factor=item_12.Item3)
gradient_6 = Gradient(
    LowerLimit=dedomain_14.Start,
    UpperLimit=dedomain_14.End,
    Parameter=dec_reg_2.MoistureChange,
    stops=[0: RGB(156, 216, 217), 0.502: RGB(77, 123, 135), 1: RGB(55, 81, 102)])
vec_6 = Vector(Y_12)
move_17 = Move(Geometry=display_panel.ActiveBoards, Motion=vec_6)  # -> Geometry, Transform
move_18 = Move(Geometry=display_panel.PassiveBoards, Motion=vec_6)  # -> Geometry, Transform
preview_10 = CustomPreview(Geometry=move_17.Geometry, Material=gradient_6)
preview_11 = CustomPreview(Geometry=move_18.Geometry, Material=ColourSwatch(SwatchColor=RGB(115, 115, 115)))

c_script_8 = CSharpScript(x=c_script_5.A)  # -> out, A; inputs x: tree; same code as c_script_7
number_slider_29 = Slider(1, range=0..100000)  # disabled

cull_8 = CullPattern(List=cull_7, CullPattern=cross_section)
deconstruct_panel_2 = DeconstructPanel(Panel=cull_8)
deconstruct_bilayer_4 = DeconstructBilayer(Bilayer=deconstruct_panel_2)
dec_board_4 = DeconstructBoard(Board=deconstruct_bilayer_4)  # -> Polyline, Name, Species, RTAngle, MoistureChange, DesiredRadius, Radius, BlendedRadius, BoardRegions
dec_reg_5 = DeconstructBoardRegion(BoardRegion=dec_board_4.BoardRegions)  # -> Polyline, ThicknessBlendedRadius, Species, MoistureChange, DesiredRadius, Radius, BlendedRadius, ThicknessBlendedRadius_2, ThicknessBlendedRadius_3

python_3 = GhPythonScript(x=species)  # -> out, a, b
# ---------- python_3: Python ----------
a = x.LElasticModulus
b = x.RElasticModulus
# ---------- end python_3 ----------
python_4 = GhPythonScript(x=species_2)  # -> out, a, b; same code as python_3

# ---- group: active layer
ft0 = Slider(80, range=0..100)
gamma = Slider(7.37, range=0..10)
num_18 = Number(Slider(20, range=0..100))

# ---- group: passive layer
num_19 = Number(Slider(8, range=0..10))
ft0_2 = Slider(0, range=0..100)

# ---- group: active layer
ft0_3 = Slider(80, range=0..100)
gamma_2 = Slider(4.21, range=0..10)
num_20 = Number(Slider(20, range=0..100))

# ---- group: passive layer
num_21 = Number(Slider(8, range=0..10))
ft0_4 = Slider(0, range=0..100)

# ---- group: active layer
ft0_5 = Slider(80, range=0..100)
gamma_3 = Slider(7.37, range=0..10)
num_22 = Number(Slider(60, range=0..100))

# ---- group: passive layer
ft0_6 = Slider(0, range=0..100)
num_23 = Number(Slider(16, range=0..20))

# ---- group: active layer
ft0_7 = Slider(80, range=0..100)
gamma_4 = Slider(4.21, range=0..10)
num_24 = Number(Slider(16, range=0..100))

# ---- group: passive layer
num_25 = Number(Slider(16, range=0..20))
ft0_8 = Slider(0, range=0..100)

# ---- group: active layer
ft0_9 = Slider(80, range=0..100)
gamma_5 = Slider(7.37, range=0..10)
num_26 = Number(Slider(40, range=0..100))

# ---- group: passive layer
ft0_10 = Slider(0, range=0..100)
num_27 = Number(Slider(12, range=0..20))

# ---- group: active layer
ft0_11 = Slider(80, range=0..100)
gamma_6 = Slider(4.21, range=0..10)
num_28 = Number(Slider(40, range=0..100))

# ---- group: passive layer
ft0_12 = Slider(0, range=0..100)
num_29 = Number(Slider(12, range=0..20))

# ---- group: active layer / total thickness
addition_5 = Addition(A=num_18, B=num_19)

addition_6 = Addition(A=num_20, B=num_21)

addition_7 = Addition(A=num_22, B=num_23)

addition_8 = Addition(A=num_24, B=num_25)

addition_9 = Addition(A=num_26, B=num_27)

addition_10 = Addition(A=num_28, B=num_29)

# ---- group: active layer / distance from bottom
expression = Expression(x=addition_5, y=num_18, Expression="x - y/2")

expression_2 = Expression(x=addition_6, y=num_20, Expression="x - y/2")

expression_3 = Expression(x=addition_7, y=num_22, Expression="x - y/2")

expression_4 = Expression(x=addition_8, y=num_24, Expression="x - y/2")

# ---- group: passive layer / distance from bottom
expression_5 = Expression(x=expression, y=addition_5, Expression="x - y/2")

# ---- group: active layer / distance from bottom
expression_6 = Expression(x=addition_9, y=num_26, Expression="x - y/2")

# ---- group: passive layer / distance from bottom
expression_7 = Expression(x=expression_2, y=addition_6, Expression="x - y/2")

# ---- group: active layer / distance from bottom
expression_8 = Expression(x=addition_10, y=num_28, Expression="x - y/2")

# ---- group: passive layer / distance from bottom
expression_9 = Expression(x=expression_3, y=addition_7, Expression="x - y/2")

expression_10 = Expression(x=expression_4, y=addition_8, Expression="x - y/2")

# ---- group: active layer / CG from bottom
division_6 = Division(A=addition_5, B=2)

division_7 = Division(A=addition_6, B=2)

division_8 = Division(A=addition_7, B=2)

# ---- group: passive layer / distance from bottom
expression_11 = Expression(x=expression_6, y=addition_9, Expression="x - y/2")

# ---- group: active layer / CG from bottom
division_9 = Division(A=addition_8, B=2)

# ---- group: passive layer / distance from bottom
expression_12 = Expression(x=expression_8, y=addition_10, Expression="x - y/2")

# ---- group: active layer / CG from bottom
division_10 = Division(A=addition_9, B=2)

division_11 = Division(A=addition_10, B=2)

# ---- group: passive layer / dist from CG
subtraction_7 = Subtraction(A=expression_5, B=division_6)
abs = Absolute(Value=subtraction_7)

subtraction_8 = Subtraction(A=expression_7, B=division_7)
abs_2 = Absolute(Value=subtraction_8)

subtraction_9 = Subtraction(A=expression_9, B=division_8)
abs_3 = Absolute(Value=subtraction_9)

# ---- group: active layer / dist from CG
subtraction_10 = Subtraction(A=expression, B=division_6)
abs_4 = Absolute(Value=subtraction_10)

# ---- group: passive layer / dist from CG
subtraction_11 = Subtraction(A=expression_10, B=division_9)
abs_5 = Absolute(Value=subtraction_11)

# ---- group: active layer / dist from CG
subtraction_12 = Subtraction(A=expression_2, B=division_7)
abs_6 = Absolute(Value=subtraction_12)

subtraction_13 = Subtraction(A=expression_3, B=division_8)
abs_7 = Absolute(Value=subtraction_13)

# ---- group: passive layer / dist from CG
subtraction_14 = Subtraction(A=expression_11, B=division_10)
abs_8 = Absolute(Value=subtraction_14)

# ---- group: active layer / dist from CG
subtraction_15 = Subtraction(A=expression_4, B=division_9)
abs_9 = Absolute(Value=subtraction_15)

# ---- group: passive layer / dist from CG
subtraction_16 = Subtraction(A=expression_12, B=division_11)
abs_10 = Absolute(Value=subtraction_16)

# ---- group: active layer / dist from CG
subtraction_17 = Subtraction(A=expression_6, B=division_10)
abs_11 = Absolute(Value=subtraction_17)

subtraction_18 = Subtraction(A=expression_8, B=division_11)
abs_12 = Absolute(Value=subtraction_18)

# ---- group: active layer / l
expression_13 = Expression(x=num_18, Expression="1000*x^3/12")

# ---- group: passive layer / l
expression_14 = Expression(x=num_19, Expression="1000*x^3/12")

# ---- group: passive layer / Ax2
expression_15 = Expression(x=num_19, y=abs, Expression="1000*x*y^2")

# ---- group: active layer / l
expression_16 = Expression(x=num_20, Expression="1000*x^3/12")

# ---- group: passive layer / l
expression_17 = Expression(x=num_21, Expression="1000*x^3/12")

# ---- group: passive layer / Ax2
expression_18 = Expression(x=num_21, y=abs_2, Expression="1000*x*y^2")

# ---- group: active layer / l
expression_19 = Expression(x=num_22, Expression="1000*x^3/12")

# ---- group: passive layer / l
expression_20 = Expression(x=num_23, Expression="1000*x^3/12")

# ---- group: passive layer / Ax2
expression_21 = Expression(x=num_23, y=abs_3, Expression="1000*x*y^2")

# ---- group: active layer / Ax2
expression_22 = Expression(x=num_18, y=abs_4, Expression="1000*x*y^2")

# ---- group: active layer / l
expression_23 = Expression(x=num_24, Expression="1000*x^3/12")

# ---- group: passive layer / l
expression_24 = Expression(x=num_25, Expression="1000*x^3/12")

# ---- group: passive layer / Ax2
expression_25 = Expression(x=num_25, y=abs_5, Expression="1000*x*y^2")

# ---- group: active layer / Ax2
expression_26 = Expression(x=num_20, y=abs_6, Expression="1000*x*y^2")

expression_27 = Expression(x=num_22, y=abs_7, Expression="1000*x*y^2")

# ---- group: active layer / l
expression_28 = Expression(x=num_26, Expression="1000*x^3/12")

# ---- group: passive layer / l
expression_29 = Expression(x=num_27, Expression="1000*x^3/12")

# ---- group: passive layer / Ax2
expression_30 = Expression(x=num_27, y=abs_8, Expression="1000*x*y^2")

# ---- group: active layer / Ax2
expression_31 = Expression(x=num_24, y=abs_9, Expression="1000*x*y^2")

# ---- group: active layer / l
expression_32 = Expression(x=num_28, Expression="1000*x^3/12")

# ---- group: passive layer / l
expression_33 = Expression(x=num_29, Expression="1000*x^3/12")

# ---- group: passive layer / Ax2
expression_34 = Expression(x=num_29, y=abs_10, Expression="1000*x*y^2")

# ---- group: active layer / Ax2
expression_35 = Expression(x=num_26, y=abs_11, Expression="1000*x*y^2")

expression_36 = Expression(x=num_28, y=abs_12, Expression="1000*x*y^2")

# ---- group: active layer / total l
addition_11 = Addition(A=expression_13, B=expression_22)

addition_12 = Addition(A=expression_16, B=expression_26)

addition_13 = Addition(A=expression_19, B=expression_27)

addition_14 = Addition(A=expression_23, B=expression_31)

addition_15 = Addition(A=expression_28, B=expression_35)

# ---- group: passive layer / total l
addition_16 = Addition(A=expression_14, B=expression_15)

# ---- group: active layer / total l
addition_17 = Addition(A=expression_32, B=expression_36)

# ---- group: passive layer / total l
addition_18 = Addition(A=expression_17, B=expression_18)

addition_19 = Addition(A=expression_20, B=expression_21)

addition_20 = Addition(A=expression_24, B=expression_25)

addition_21 = Addition(A=expression_29, B=expression_30)

addition_22 = Addition(A=expression_33, B=expression_34)

# ---- group: active layer / El0
multiplication_10 = Multiplication(A=python_3.a, B=addition_11)

# ---- group: active layer / T x ft0
multiplication_11 = Multiplication(A=num_18, B=ft0)

# ---- group: active layer / T x Gam
multiplication_12 = Multiplication(A=gamma, B=num_18)

# ---- group: passive layer / El0
multiplication_13 = Multiplication(A=python_4.b, B=addition_16)

# ---- group: passive layer / El90
multiplication_14 = Multiplication(A=python_4.a, B=addition_16)

# ---- group: passive layer / T x ft0
multiplication_15 = Multiplication(A=num_19, B=ft0_2)

# ---- group: active layer / El90
multiplication_16 = Multiplication(A=python_3.b, B=addition_11)

# ---- group: active layer / El0
multiplication_17 = Multiplication(A=python_4.a, B=addition_12)

# ---- group: active layer / T x ft0
multiplication_18 = Multiplication(A=num_20, B=ft0_3)

# ---- group: active layer / T x Gam
multiplication_19 = Multiplication(A=gamma_2, B=num_20)

# ---- group: passive layer / El0
multiplication_20 = Multiplication(A=python_4.b, B=addition_18)

# ---- group: passive layer / El90
multiplication_21 = Multiplication(A=python_4.a, B=addition_18)

# ---- group: passive layer / T x ft0
multiplication_22 = Multiplication(A=num_21, B=ft0_4)

# ---- group: active layer / El0
multiplication_23 = Multiplication(A=python_3.a, B=addition_13)

# ---- group: active layer / T x ft0
multiplication_24 = Multiplication(A=num_22, B=ft0_5)

# ---- group: active layer / T x Gam
multiplication_25 = Multiplication(A=gamma_3, B=num_22)

# ---- group: passive layer / El0
multiplication_26 = Multiplication(A=python_4.b, B=addition_19)

# ---- group: passive layer / El90
multiplication_27 = Multiplication(A=python_4.a, B=addition_19)

# ---- group: passive layer / T x ft0
multiplication_28 = Multiplication(A=num_23, B=ft0_6)

# ---- group: active layer / El90
multiplication_29 = Multiplication(A=python_4.b, B=addition_12)

multiplication_30 = Multiplication(A=python_3.b, B=addition_13)

# ---- group: active layer / El0
multiplication_31 = Multiplication(A=python_4.a, B=addition_14)

# ---- group: active layer / T x ft0
multiplication_32 = Multiplication(A=num_24, B=ft0_7)

# ---- group: active layer / T x Gam
multiplication_33 = Multiplication(A=gamma_4, B=num_24)

# ---- group: passive layer / El0
multiplication_34 = Multiplication(A=python_4.b, B=addition_20)

# ---- group: passive layer / El90
multiplication_35 = Multiplication(A=python_4.a, B=addition_20)

# ---- group: passive layer / T x ft0
multiplication_36 = Multiplication(A=num_25, B=ft0_8)

# ---- group: active layer / El90
multiplication_37 = Multiplication(A=python_4.b, B=addition_14)

# ---- group: active layer / El0
multiplication_38 = Multiplication(A=python_3.a, B=addition_15)

# ---- group: active layer / T x ft0
multiplication_39 = Multiplication(A=num_26, B=ft0_9)

# ---- group: active layer / T x Gam
multiplication_40 = Multiplication(A=gamma_5, B=num_26)

# ---- group: passive layer / El0
multiplication_41 = Multiplication(A=python_4.b, B=addition_21)

# ---- group: passive layer / El90
multiplication_42 = Multiplication(A=python_4.a, B=addition_21)

# ---- group: passive layer / T x ft0
multiplication_43 = Multiplication(A=num_27, B=ft0_10)

# ---- group: active layer / El90
multiplication_44 = Multiplication(A=python_3.b, B=addition_15)

# ---- group: active layer / El0
multiplication_45 = Multiplication(A=python_4.a, B=addition_17)

# ---- group: active layer / T x ft0
multiplication_46 = Multiplication(A=num_28, B=ft0_11)

# ---- group: active layer / T x Gam
multiplication_47 = Multiplication(A=gamma_6, B=num_28)

# ---- group: passive layer / El0
multiplication_48 = Multiplication(A=python_4.b, B=addition_22)

# ---- group: passive layer / El90
multiplication_49 = Multiplication(A=python_4.a, B=addition_22)

# ---- group: passive layer / T x ft0
multiplication_50 = Multiplication(A=num_29, B=ft0_12)

# ---- group: active layer / El90
multiplication_51 = Multiplication(A=python_4.b, B=addition_17)

# ---- group: effective material properties / El0 eff (Nmm2)
addition_23 = Addition(A=multiplication_10, B=multiplication_13)

# ---- group: effective material properties / El90 eff (Nmm2)
addition_24 = Addition(A=multiplication_16, B=multiplication_14)

# ---- group: effective material properties / Sum T x Ft0
addition_25 = Addition(A=multiplication_11, B=multiplication_15)

# ---- group: effective material properties / total thickness
addition_26 = Addition(A=num_18, B=num_19)

# ---- group: effective material properties / El0 eff (Nmm2)
addition_27 = Addition(A=multiplication_17, B=multiplication_20)

# ---- group: effective material properties / El90 eff (Nmm2)
addition_28 = Addition(A=multiplication_29, B=multiplication_21)

# ---- group: effective material properties / El0 eff (Nmm2)
addition_29 = Addition(A=multiplication_23, B=multiplication_26)

# ---- group: effective material properties / El90 eff (Nmm2)
addition_30 = Addition(A=multiplication_30, B=multiplication_27)

# ---- group: effective material properties / Sum T x Ft0
addition_31 = Addition(A=multiplication_18, B=multiplication_22)

# ---- group: effective material properties / total thickness
addition_32 = Addition(A=num_20, B=num_21)

# ---- group: effective material properties / Sum Tx Gam
addition_33 = Addition(A=multiplication_12)

# ---- group: effective material properties / Sum T x Ft0
addition_34 = Addition(A=multiplication_24, B=multiplication_28)

# ---- group: effective material properties / total thickness
addition_35 = Addition(A=num_22, B=num_23)

# ---- group: effective material properties / El0 eff (Nmm2)
addition_36 = Addition(A=multiplication_31, B=multiplication_34)

# ---- group: effective material properties / El90 eff (Nmm2)
addition_37 = Addition(A=multiplication_37, B=multiplication_35)

# ---- group: effective material properties / Sum Tx Gam
addition_38 = Addition(A=multiplication_19)

# ---- group: effective material properties / Sum T x Ft0
addition_39 = Addition(A=multiplication_32, B=multiplication_36)

# ---- group: effective material properties / total thickness
addition_40 = Addition(A=num_24, B=num_25)

# ---- group: effective material properties / Sum Tx Gam
addition_41 = Addition(A=multiplication_25)

# ---- group: effective material properties / El0 eff (Nmm2)
addition_42 = Addition(A=multiplication_38, B=multiplication_41)

# ---- group: effective material properties / El90 eff (Nmm2)
addition_43 = Addition(A=multiplication_44, B=multiplication_42)

# ---- group: effective material properties / Sum Tx Gam
addition_44 = Addition(A=multiplication_33)

# ---- group: effective material properties / Sum T x Ft0
addition_45 = Addition(A=multiplication_39, B=multiplication_43)

# ---- group: effective material properties / total thickness
addition_46 = Addition(A=num_26, B=num_27)

# ---- group: effective material properties / El0 eff (Nmm2)
addition_47 = Addition(A=multiplication_45, B=multiplication_48)

# ---- group: effective material properties / El90 eff (Nmm2)
addition_48 = Addition(A=multiplication_51, B=multiplication_49)

# ---- group: effective material properties / Sum T x Ft0
addition_49 = Addition(A=multiplication_46, B=multiplication_50)

# ---- group: effective material properties / total thickness
addition_50 = Addition(A=num_28, B=num_29)

# ---- group: effective material properties / Sum Tx Gam
addition_51 = Addition(A=multiplication_40)

addition_52 = Addition(A=multiplication_47)

# ---- group: effective material properties / lx / ly
expression_37 = Expression(x=addition_26, Expression="1000*x^3/12")

expression_38 = Expression(x=addition_32, Expression="1000*x^3/12")

expression_39 = Expression(x=addition_35, Expression="1000*x^3/12")

expression_40 = Expression(x=addition_40, Expression="1000*x^3/12")

expression_41 = Expression(x=addition_46, Expression="1000*x^3/12")

expression_42 = Expression(x=addition_50, Expression="1000*x^3/12")

# ---- group: effective material properties / E0eff
division_12 = Division(A=addition_23, B=expression_37)

# ---- group: effective material properties / E90eff
division_13 = Division(A=addition_24, B=expression_37)

# ---- group: effective material properties / ft eff
division_14 = Division(A=addition_25, B=addition_26)

# ---- group: effective material properties / E0eff
division_15 = Division(A=addition_27, B=expression_38)

# ---- group: effective material properties / E90eff
division_16 = Division(A=addition_28, B=expression_38)

# ---- group: effective material properties / Gamma eff
division_17 = Division(A=addition_38, B=addition_32)

# ---- group: effective material properties / ft eff
division_18 = Division(A=addition_31, B=addition_32)

# ---- group: effective material properties
matprops = MaterialPropertiesKaramba3D(
    FamilyOfMaterial="Spruce / Spruce",
    Name="Spruce / Spruce",
    ElementIdentifier="Spruce / Spruce",
    YoungsModulusKNCm2Dir1=expr("x*0.1", division_15),
    YoungsModulusKNCm2Dir2=expr("x*0.1", division_16),
    InPlaneShearModulus_kN_cm2="42",
    InPlaneLateralContractionCoefficient=Slider(0.012, range=0..0.1, expression="0.012"),
    TransverseShearModulusKNCm2Dir1="5",
    TransverseShearModulusKNCm2Dir2="5",
    SpecificWeight_kN_m3=division_17,
    CoefficientOfThermalExpansion1CDir1=1.2e-05,
    CoefficientOfThermalExpansion1CDir2=1.2e-05,
    TensileStrengthKNCm2Dir1=division_18,
    TensileStrengthKNCm2Dir2=division_18,
    CompressiveStrengthKNCm2Dir1=-23.5,
    CompressiveStrengthKNCm2Dir2=-23.5,
    ShearStrengthKNCm2Dir12=13.6,
    TsaiWuIntCoeff=0,
    StrengthHypothesis="MISES",
    mode="Orthotropic")  # -> flatten(Material)

# ---- group: effective material properties / Gamma eff
division_19 = Division(A=addition_33, B=addition_26)

# ---- group: effective material properties
matprops_2 = MaterialPropertiesKaramba3D(
    FamilyOfMaterial="Beech / Spruce",
    Name="Beech / Spruce",
    ElementIdentifier="Beech / Spruce",
    YoungsModulusKNCm2Dir1=expr("x*0.1", division_12),
    YoungsModulusKNCm2Dir2=expr("x*0.1", division_13),
    InPlaneShearModulus_kN_cm2="47",
    InPlaneLateralContractionCoefficient=Slider(0.012, range=0..0.1, expression="0.012"),
    TransverseShearModulusKNCm2Dir1="5",
    TransverseShearModulusKNCm2Dir2="5",
    SpecificWeight_kN_m3=division_19,
    CoefficientOfThermalExpansion1CDir1=1.2e-05,
    CoefficientOfThermalExpansion1CDir2=1.2e-05,
    TensileStrengthKNCm2Dir1=division_14,
    TensileStrengthKNCm2Dir2=division_14,
    CompressiveStrengthKNCm2Dir1=-23.5,
    CompressiveStrengthKNCm2Dir2=-23.5,
    ShearStrengthKNCm2Dir12=13.6,
    TsaiWuIntCoeff=0,
    StrengthHypothesis="MISES",
    mode="Orthotropic")  # -> flatten(Material)

# ---- group: effective material properties / E0eff
division_20 = Division(A=addition_29, B=expression_39)

# ---- group: effective material properties / E90eff
division_21 = Division(A=addition_30, B=expression_39)

# ---- group: effective material properties / ft eff
division_22 = Division(A=addition_34, B=addition_35)

# ---- group: effective material properties / E0eff
division_23 = Division(A=addition_36, B=expression_40)

# ---- group: effective material properties / E90eff
division_24 = Division(A=addition_37, B=expression_40)

# ---- group: effective material properties / Gamma eff
division_25 = Division(A=addition_44, B=addition_40)

# ---- group: effective material properties / ft eff
division_26 = Division(A=addition_39, B=addition_40)

# ---- group: effective material properties
matprops_3 = MaterialPropertiesKaramba3D(
    FamilyOfMaterial="Spruce / Spruce",
    Name="Spruce / Spruce",
    ElementIdentifier="Spruce / Spruce",
    YoungsModulusKNCm2Dir1=expr("x*0.1", division_23),
    YoungsModulusKNCm2Dir2=expr("x*0.1", division_24),
    InPlaneShearModulus_kN_cm2="42",
    InPlaneLateralContractionCoefficient=Slider(0.012, range=0..0.1, expression="0.012"),
    TransverseShearModulusKNCm2Dir1="5",
    TransverseShearModulusKNCm2Dir2="5",
    SpecificWeight_kN_m3=division_25,
    CoefficientOfThermalExpansion1CDir1=1.2e-05,
    CoefficientOfThermalExpansion1CDir2=1.2e-05,
    TensileStrengthKNCm2Dir1=division_26,
    TensileStrengthKNCm2Dir2=division_26,
    CompressiveStrengthKNCm2Dir1=-23.5,
    CompressiveStrengthKNCm2Dir2=-23.5,
    ShearStrengthKNCm2Dir12=13.6,
    TsaiWuIntCoeff=0,
    StrengthHypothesis="MISES",
    mode="Orthotropic")  # -> flatten(Material)

# ---- group: effective material properties / Gamma eff
division_27 = Division(A=addition_41, B=addition_35)

# ---- group: effective material properties
matprops_4 = MaterialPropertiesKaramba3D(
    FamilyOfMaterial="Beech / Spruce",
    Name="Beech / Spruce",
    ElementIdentifier="Beech / Spruce",
    YoungsModulusKNCm2Dir1=expr("x*0.1", division_20),
    YoungsModulusKNCm2Dir2=expr("x*0.1", division_21),
    InPlaneShearModulus_kN_cm2="47",
    InPlaneLateralContractionCoefficient=Slider(0.012, range=0..0.1, expression="0.012"),
    TransverseShearModulusKNCm2Dir1="5",
    TransverseShearModulusKNCm2Dir2="5",
    SpecificWeight_kN_m3=division_27,
    CoefficientOfThermalExpansion1CDir1=1.2e-05,
    CoefficientOfThermalExpansion1CDir2=1.2e-05,
    TensileStrengthKNCm2Dir1=division_22,
    TensileStrengthKNCm2Dir2=division_22,
    CompressiveStrengthKNCm2Dir1=-23.5,
    CompressiveStrengthKNCm2Dir2=-23.5,
    ShearStrengthKNCm2Dir12=13.6,
    TsaiWuIntCoeff=0,
    StrengthHypothesis="MISES",
    mode="Orthotropic")  # -> flatten(Material)

# ---- group: effective material properties / E0eff
division_28 = Division(A=addition_42, B=expression_41)

# ---- group: effective material properties / E90eff
division_29 = Division(A=addition_43, B=expression_41)

# ---- group: effective material properties / ft eff
division_30 = Division(A=addition_45, B=addition_46)

# ---- group: effective material properties / E0eff
division_31 = Division(A=addition_47, B=expression_42)

# ---- group: effective material properties / E90eff
division_32 = Division(A=addition_48, B=expression_42)

# ---- group: effective material properties / Gamma eff
division_33 = Division(A=addition_52, B=addition_50)

# ---- group: effective material properties / ft eff
division_34 = Division(A=addition_49, B=addition_50)

# ---- group: effective material properties
matprops_5 = MaterialPropertiesKaramba3D(
    FamilyOfMaterial="Spruce / Spruce",
    Name="Spruce / Spruce",
    ElementIdentifier="Spruce / Spruce",
    YoungsModulusKNCm2Dir1=expr("x*0.1", division_31),
    YoungsModulusKNCm2Dir2=expr("x*0.1", division_32),
    InPlaneShearModulus_kN_cm2="42",
    InPlaneLateralContractionCoefficient=Slider(0.012, range=0..0.1, expression="0.012"),
    TransverseShearModulusKNCm2Dir1="5",
    TransverseShearModulusKNCm2Dir2="5",
    SpecificWeight_kN_m3=division_33,
    CoefficientOfThermalExpansion1CDir1=1.2e-05,
    CoefficientOfThermalExpansion1CDir2=1.2e-05,
    TensileStrengthKNCm2Dir1=division_34,
    TensileStrengthKNCm2Dir2=division_34,
    CompressiveStrengthKNCm2Dir1=-23.5,
    CompressiveStrengthKNCm2Dir2=-23.5,
    ShearStrengthKNCm2Dir12=13.6,
    TsaiWuIntCoeff=0,
    StrengthHypothesis="MISES",
    mode="Orthotropic")  # -> flatten(Material)
# ---- group: effective material properties / Gamma eff
division_35 = Division(A=addition_51, B=addition_46)

# ---- group: effective material properties
matprops_6 = MaterialPropertiesKaramba3D(
    FamilyOfMaterial="Beech / Spruce",
    Name="Beech / Spruce",
    ElementIdentifier="Beech / Spruce",
    YoungsModulusKNCm2Dir1=expr("x*0.1", division_28),
    YoungsModulusKNCm2Dir2=expr("x*0.1", division_29),
    InPlaneShearModulus_kN_cm2="47",
    InPlaneLateralContractionCoefficient=Slider(0.012, range=0..0.1, expression="0.012"),
    TransverseShearModulusKNCm2Dir1="5",
    TransverseShearModulusKNCm2Dir2="5",
    SpecificWeight_kN_m3=division_35,
    CoefficientOfThermalExpansion1CDir1=1.2e-05,
    CoefficientOfThermalExpansion1CDir2=1.2e-05,
    TensileStrengthKNCm2Dir1=division_30,
    TensileStrengthKNCm2Dir2=division_30,
    CompressiveStrengthKNCm2Dir1=-23.5,
    CompressiveStrengthKNCm2Dir2=-23.5,
    ShearStrengthKNCm2Dir12=13.6,
    TsaiWuIntCoeff=0,
    StrengthHypothesis="MISES",
    mode="Orthotropic")  # -> flatten(Material)

# ----
addition_53 = Addition(A=num_24, B=num_25)
number_slider_30 = Slider(0.001, range=0..0.001)
addition_54 = Addition(A=num_18, B=num_19)
addition_55 = Addition(A=num_26, B=num_27)
addition_56 = Addition(A=num_22, B=num_23)
addition_57 = Addition(A=num_20, B=num_21)
addition_58 = Addition(A=num_28, B=num_29)
division_36 = Division(A=addition_53, B=10)
division_37 = Division(A=addition_54, B=10)
division_38 = Division(A=addition_55, B=10)
division_39 = Division(A=addition_56, B=10)
division_40 = Division(A=addition_57, B=10)
division_41 = Division(A=addition_58, B=10)

multiplication_52 = Multiplication(A=Slider(1.5, range=0..10), B="1.35")
multiplication_53 = Multiplication(A="-9.8", B="1.35")
Z_2 = UnitZ(Factor=multiplication_52)
Z_3 = UnitZ(Factor=multiplication_53)
rev = Reverse(Vector=Z_2)

loads = LoadsKaramba3D(Vector=Z_3, LCase="0", mode="Gravity")
X = UnitX(Factor=Slider(12193, range=0..20000))
support = RemoteSender(<missing>)
support_2 = RemoteReceiver(support)
node_sofistik = NodeSofistik(<missing>)
support_sofistik = SupportSofistik(flatten(<missing>))
load_sofistik = LoadSofistik(<missing>)

crv_5 = Curve(c_script_4.A)
area_4 = Area(Geometry=crv_5)  # -> Area, Centroid
bbox_3 = BoundingBox(Content=flatten(dec_reg_3.Polyline), Plane=PlaneXY(0, 0, 0), UnionBox=True)  # -> Box, Box_2
avr = Average(Input=area_4.Centroid)
debox_3 = DeconstructBox(Box=bbox_3.Box)  # -> Plane, X, Y, Z

pdecon_9 = Deconstruct(Point=avr)  # -> XComponent, YComponent, ZComponent
trim_3 = TrimTree(Tree=pdecon_9.XComponent, Depth=1)
bnd_13 = Bounds(Numbers=trim_3)

remap_25 = RemapNumbers(Value=pdecon_9.XComponent, Source=bnd_13, Target=debox_3.X)  # -> Mapped, Clipped
pt_25 = ConstructPoint(XCoordinate=remap_25.Mapped, YCoordinate=pdecon_9.YComponent, ZCoordinate=pdecon_9.ZComponent)
yz = YZPlane(Origin=pt_25)

c_script_9 = CSharpScript(x=yz)  # -> out, A; inputs x: tree; same code as c_script_7

num_30 = Number(num)
num_31 = Number(c_script_8.A)
pln = Plane(c_script_9.A)
c_script_10 = CSharpScript(iRadii=num_31, iBoardWidth=num_30, iPlanes=pln)  # -> out, simplify(A); inputs iRadii: tree of Double, iBoardWidth: Double, iPlanes: tree of Plane
# ---------- c_script_10: C# ----------
    DataTree<Point3d> pointTree = new DataTree<Point3d>();

    for (int j = 0; j < iRadii.BranchCount; j++)
    {

      //initialize variables
      Plane bp = iPlanes.Branch(j)[0];
      Point3d startPoint = new Point3d(bp.Origin);
      Point3d centerPoint = startPoint;
      Vector3d rotationAxis = new Vector3d(bp.ZAxis);
      Vector3d centerPointVect = new Vector3d(bp.YAxis);
      centerPointVect.Rotate(Math.PI / 2, rotationAxis);

      for (int i = 0; i < iRadii.Branch(j).Count; i++){
        GH_Path pth = iRadii.Paths[j].AppendElement(i);
        Point3d point1 = startPoint;
        Point3d point2 = startPoint;

        pointTree.Add(point1, pth);

        //calculate rotation angle
        Double arcLength = iBoardWidth;
        Double radius = iRadii.Branch(j)[i];
        Double rotation = (arcLength / radius);

        //calculate rotation center point
        centerPointVect.Unitize();
        centerPointVect *= radius;
        centerPoint += centerPointVect;


        //execute half rotation
        Transform tx = Transform.Rotation(rotation / 2, rotationAxis, centerPoint);


        point2.Transform(tx);
        pointTree.Add(point2, pth);

        //execute full rotation
        tx = Transform.Rotation(rotation, rotationAxis, centerPoint);
        startPoint.Transform(tx);
        pointTree.Add(startPoint, pth);

        //updata rotation parameters
        centerPoint = startPoint;
        centerPointVect.Transform(tx);
      }
    }
    A = pointTree;
# ---------- end c_script_10 ----------

trim_4 = TrimTree(Tree=c_script_10.A, Depth=1)
cullpt = CullDuplicates(Points=trim_4, Tolerance=0.1, CullMode=3)  # -> Points, Indices, Valence
pt_26 = Point(cullpt.Points)

# ---- group: animate
pt_27 = Point(simplify(pt_26))
pln_2 = Plane(graft(pln))
num_32 = Number(Slider(1, range=0..1))
c_script_11 = CSharpScript(iPoints=simplify(pt_27), iPlanes=pln_2, iShapeFactor=num_32)  # -> out, A; inputs iPoints: tree of Point3d, iPlanes: tree of Plane, iShapeFactor: Double
# ---------- c_script_11: C# ----------
    DataTree<Point3d> output = new DataTree<Point3d>();
    
    double shapeFactor = 1.0 - iShapeFactor;

    //step through curves
    for (int i = 0; i < iPoints.BranchCount; i++)
    {
      Plane currentPlane = iPlanes.Branch(iPoints.Path(i)[0])[0];

      //get vectors from plane
      Vector3d zVect = currentPlane.YAxis;

      Vector3d rotVect = currentPlane.ZAxis;

      //create new startpoint inside list
      Point3d startPoint = iPoints.Branch(i)[0];

      //step through points. Create and rotate vectors
      for (int j = 0; j < iPoints.Branch(i).Count; j++)
      {
        if (j == 0) output.Add(startPoint, iPoints.Path(i));
        else{
          //create current segment vector
          Vector3d segmentVect = new Vector3d(iPoints.Branch(i)[j] - iPoints.Branch(i)[j - 1]);

          //measure angle with vertical vector
          double angle = Vector3d.VectorAngle(zVect, segmentVect, currentPlane);

          //rotate
          segmentVect.Rotate(-angle * shapeFactor, rotVect);

          startPoint += segmentVect;
          output.Add(startPoint, iPoints.Path(i));
        }
      }
    }

    A = output;
# ---------- end c_script_11 ----------
pt_28 = Point(c_script_11.A)
intcrv_4 = Interpolate(Vertices=pt_28, Degree=3, Periodic=False, KnotStyle=1)  # -> Curve, Length, Domain
crv_6 = Curve(intcrv_4.Curve)

# ----
crv_7 = Curve(crv_6)
pt_29 = Point(simplify(graft(pt_25)))
end = EndPoints(Curve=crv_7)  # -> Start, End
vec2pt = Vector2Pt(PointA=end.Start, PointB=end.End, Unitize=False)  # -> Vector, Length
yz_2 = YZPlane(Origin=end.Start)
Y_13 = UnitY(Factor="-1")
angle = Angle(VectorA=vec2pt.Vector, VectorB=Y_13, Plane=yz_2)  # -> Angle, Reflex
rotate = Rotate(Geometry=crv_7, Angle=angle.Angle, Plane=yz_2)  # -> Geometry, Transform
curvepoint = PointOnCurve(rotate.Geometry, parameter=0.5)
vec2pt_2 = Vector2Pt(PointA=curvepoint, PointB=pt_29, Unitize=False)  # -> Vector, Length
move_19 = Move(Geometry=rotate.Geometry, Motion=vec2pt_2.Vector)  # -> Geometry, Transform
path_mapper_2 = PathMapper(move_19.Geometry, source=["{A;B}", "{A}"], target=["{A}", "{0}"])
crv_8 = Curve(path_mapper_2)
loft = Loft(Curves=crv_8, Options={Adjust=False, Closed=False, LoftEnds=0, LoftSimp=0, LoftType=2, Rebuild=10, Refit=0.01})

bool = Boolean(relaxation)  # disabled
cull_9 = CullPattern(List=loft, CullPattern=bool)  # disabled
number_slider_31 = Slider(8, range=0..100)  # disabled
srf = Surface(cull_9)  # disabled
num_33 = Number(number_slider_24)  # disabled
quads = QuadPanels(Surface=srf, UDivisions=number_slider_31, VDivisions=num_33)  # disabled
srf_2 = Surface(reparameterize(simplify(quads)))  # disabled

smesh = SimpleMesh(Brep=srf_2)  # disabled
area_5 = MeshArea(Mesh=smesh)  # -> Area, Centroid; disabled
meshcp = MeshClosestPoint(Point=area_5.Centroid, Mesh=smesh)  # -> Point, Index, Parameter; disabled
meval = MeshEval(Mesh=smesh, Parameter=meshcp.Parameter)  # -> Point, Normal, Colour; disabled
pl = PlaneNormal(Origin=meval.Point, ZAxis=meval.Normal)  # disabled
X_2 = UnitX(Factor=1)  # disabled
deplane = DeconstructPlane(Plane=pl)  # -> Origin, XAxis, YAxis, ZAxis; disabled
angle_2 = Angle(VectorA=deplane.XAxis, VectorB=X_2, Plane=pl)  # -> Angle, Reflex; disabled
rotate_2 = Rotate(Geometry=pl, Angle=angle_2.Angle, Plane=pl)  # -> graft(Geometry), Transform; disabled

medges = MeshEdges(Mesh=smesh)  # -> simplify(NakedEdges), InteriorEdges, NonManifoldEdges; disabled
curvepoint_2 = PointOnCurve(medges.NakedEdges, parameter=0.5)  # disabled
plcoord = PlaneCoordinates(Point=curvepoint_2, System=rotate_2.Geometry)  # -> XCoordinate, YCoordinate, ZCoordinate; disabled
sort = SortList(Keys=plcoord.XCoordinate, ValuesA=medges.NakedEdges)  # -> Keys, ValuesA; disabled
item_13 = ListItem(List=reverse(sort.ValuesA), Index=0, Wrap=True)  # disabled
item_14 = ListItem(List=sort.ValuesA, Index=0, Wrap=True)  # disabled

merge_16 = Merge(Data1=item_14, Data2=item_13)  # disabled
trim_5 = TrimTree(Tree=merge_16, Depth=1)  # disabled
rdlines = RemoveDuplicateLinesKaramba3D(Line=trim_5, LimitDistance=0.005)  # -> OutLine, Info, Indexes; disabled
join_3 = JoinCurves(Curves=rdlines.OutLine, Preserve=False)  # disabled
explode = Explode(Curve=join_3, Recursive=True)  # -> Segments, simplify(Vertices); disabled
pline = PolyLine(Vertices=explode.Vertices, Closed=False)  # -> simplify(graft(Polyline)); disabled
path_mapper_3 = PathMapper(pline, source=["{A}", "{A;B}"], target=["{0}", "{A}"])  # disabled
curvepoint_3 = PointOnCurve(path_mapper_3, parameter=0.5)  # disabled
pdecon_10 = Deconstruct(Point=curvepoint_3)  # -> XComponent, YComponent, ZComponent; disabled
sort_2 = SortList(Keys=pdecon_10.XComponent, ValuesA=path_mapper_3)  # -> Keys, ValuesA; disabled
crv_9 = Curve(sort_2.ValuesA)  # disabled

crv_10 = Curve(crv_9)  # disabled
item_15 = ListItem(List=crv_10, Index=0, Wrap=True)  # disabled
curvepoint_4 = PointOnCurve(crv_10, parameter=0.5)  # disabled
curvepoint_5 = PointOnCurve(item_15, parameter=0.5)  # disabled
vec2pt_3 = Vector2Pt(PointA=curvepoint_5, PointB=curvepoint_4, Unitize=False)  # -> Vector, Length; disabled
move_20 = Move(Geometry=item_15, Motion=vec2pt_3.Vector)  # -> Geometry, Transform; disabled

crv_11 = Curve(crv_9)  # disabled
flip = FlipCurve(Curve=crv_11, Guide=move_20.Geometry)  # -> Curve, Flag; disabled

explode_2 = Explode(Curve=flip.Curve, Recursive=True)  # -> simplify(Segments), Vertices; disabled
explode_3 = Explode(Curve=move_20.Geometry, Recursive=True)  # -> simplify(Segments), Vertices; disabled
lng_6 = ListLength(List=explode_2.Segments)  # disabled
lng_7 = ListLength(List=explode_2.Segments)  # disabled
lng_8 = ListLength(List=explode_3.Segments)  # disabled
lng_9 = ListLength(List=explode_3.Segments)  # disabled
subtraction_19 = Subtraction(A=lng_6, B=2)  # disabled
subtraction_20 = Subtraction(A=lng_7, B=1)  # disabled
subtraction_21 = Subtraction(A=lng_8, B=2)  # disabled
subtraction_22 = Subtraction(A=lng_9, B=1)  # disabled
dom_20 = ConstructDomain(DomainStart=0, DomainEnd=subtraction_19)  # disabled
dom_21 = ConstructDomain(DomainStart=1, DomainEnd=subtraction_20)  # disabled
dom_22 = ConstructDomain(DomainStart=0, DomainEnd=subtraction_21)  # disabled
dom_23 = ConstructDomain(DomainStart=1, DomainEnd=subtraction_22)  # disabled
subset_3 = SubList(List=explode_2.Segments, Domain=dom_20, Wrap=True)  # -> List, Index; disabled
subset_4 = SubList(List=explode_2.Segments, Domain=dom_21, Wrap=True)  # -> List, Index; disabled
subset_5 = SubList(List=explode_3.Segments, Domain=dom_22, Wrap=True)  # -> List, Index; disabled
subset_6 = SubList(List=explode_3.Segments, Domain=dom_23, Wrap=True)  # -> List, Index; disabled
angle_3 = Angle(VectorA=subset_5.List, VectorB=subset_6.List)  # -> simplify(Angle), Reflex; disabled
angle_4 = Angle(VectorA=subset_3.List, VectorB=subset_4.List)  # -> simplify(Angle), Reflex; disabled
num_34 = Number(angle_3.Angle)  # disabled
num_35 = Number(angle_4.Angle)  # disabled

explode_4 = Explode(Curve=flip.Curve, Recursive=True)  # -> simplify(Segments), Vertices; disabled
explode_5 = Explode(Curve=move_20.Geometry, Recursive=True)  # -> simplify(Segments), Vertices; disabled
path_mapper_4 = PathMapper(explode_4.Segments, source=["{A}(i)", "{A;B}(i)"], target=["{i}(A)", "{A;i}(B)"])  # disabled
path_mapper_5 = PathMapper(explode_5.Segments, source=["{A}(i)", "{A;B}(i)"], target=["{i}(A)", "{A;i}(B)"])  # disabled
crv_12 = Curve(path_mapper_5)  # disabled
crv_13 = Curve(path_mapper_4)  # disabled
lng_10 = ListLength(List=crv_13)  # -> expr("x-2", Length); disabled
lng_11 = ListLength(List=crv_12)  # -> expr("x-2", Length); disabled
lng_12 = ListLength(List=crv_13)  # -> expr("x-1", Length); disabled
lng_13 = ListLength(List=crv_12)  # -> expr("x-1", Length); disabled
dom_24 = ConstructDomain(DomainStart=0, DomainEnd=lng_10)  # disabled
dom_25 = ConstructDomain(DomainStart=0, DomainEnd=lng_11)  # disabled
dom_26 = ConstructDomain(DomainStart=1, DomainEnd=lng_12)  # disabled
dom_27 = ConstructDomain(DomainStart=1, DomainEnd=lng_13)  # disabled
subset_7 = SubList(List=crv_13, Domain=dom_24, Wrap=True)  # -> graft(List), Index; disabled
subset_8 = SubList(List=crv_12, Domain=dom_25, Wrap=True)  # -> graft(List), Index; disabled
subset_9 = SubList(List=crv_13, Domain=dom_26, Wrap=True)  # -> graft(List), Index; disabled
subset_10 = SubList(List=crv_12, Domain=dom_27, Wrap=True)  # -> graft(List), Index; disabled
loft_2 = Loft(
    Curves=[subset_7.List, subset_9.List],
    Options={Adjust=False, Closed=False, LoftEnds=0, LoftSimp=0, LoftType=0, Rebuild=10, Refit=0.01})  # -> simplify(Loft); disabled
loft_3 = Loft(
    Curves=[subset_8.List, subset_10.List],
    Options={Adjust=False, Closed=False, LoftEnds=0, LoftSimp=0, LoftType=0, Rebuild=10, Refit=0.01})  # -> simplify(Loft); disabled
smesh_2 = SimpleMesh(Brep=loft_2)  # disabled
smesh_3 = SimpleMesh(Brep=loft_3)  # disabled
path_mapper_6 = PathMapper(smesh_3, source=["{A;B;C}", "{A;B}"], target=["{A}", "{0}"])  # disabled
path_mapper_7 = PathMapper(smesh_2, source=["{A;B;C}", "{A;B}"], target=["{A}", "{0}"])  # disabled
mjoin = MeshJoin(Meshes=path_mapper_6)  # disabled
mjoin_2 = MeshJoin(Meshes=path_mapper_7)  # disabled
weld = WeldMesh(Mesh=mjoin, Angle=3.141592654)  # disabled
weld_2 = WeldMesh(Mesh=mjoin_2, Angle=3.141592654)  # disabled

explode_6 = Explode(Curve=move_20.Geometry, Recursive=True)  # -> Segments, Vertices; disabled
num_36 = Number(num_35)  # disabled
num_37 = Number(num_34)  # disabled
mesh_2 = Mesh(weld)  # disabled
path_mapper_8 = PathMapper(explode_6.Vertices, source=["{A;B}(i)", "{A}(i)"], target=["{A;i}(B)", "{i}(A)"])  # disabled
division_42 = Division(A=num_36, B=num_37)  # disabled
avr_2 = Average(Input=division_42)  # disabled
number_slider_32 = Slider(100, range=0..100000)  # disabled
number_slider_33 = Slider(1, range=0..10000)  # disabled
number_slider_34 = Slider(10000, range=0..10000)  # disabled
pline_2 = PolyLine(Vertices=path_mapper_8, Closed=False)  # -> simplify(Polyline); disabled
path_mapper_9 = PathMapper(pline_2, source=["{A;B}", "{A}"], target=["{A}", "{0}"])  # disabled
crv_14 = Curve(move_20.Geometry)  # disabled
show = Show(G=mesh_2)  # disabled
rod = Rod(Polyline=path_mapper_9, LengthFactor=1, AngleFactor=1, AxialStrength=number_slider_32, BendStrength=number_slider_33)  # disabled
path_mapper_10 = PathMapper(rod, source=["{A;B}", "{A}"], target=["{A}", "{0}"])  # disabled

path_mapper_11 = PathMapper(avr_2, source=["{A}", "{A;B}"], target=["{0}", "{A}"])  # disabled

rod_2 = Rod(
    Polyline=crv_14,
    LengthFactor=1,
    AngleFactor=path_mapper_11,
    AxialStrength=number_slider_32,
    BendStrength=number_slider_34)  # disabled
path_mapper_12 = PathMapper(rod_2, source=["{A;B}", "{A}"], target=["{A}", "{0}"])  # disabled
merge_17 = Merge(Data1=path_mapper_10, Data2=path_mapper_12, Data3=show)  # disabled

zombiesolver = ZombieSolver(GoalObjects=merge_17, Threshold=1e-10, Tolerance=0.0001, MaxIterations=number_slider_29)  # -> I, V, O; disabled
mesh_3 = Mesh(zombiesolver.O)  # disabled
clean = CleanTree(RemoveNulls=True, RemoveInvalid=True, RemoveEmpty=False, Tree=mesh_3)  # disabled

wbedges = WeaverbirdsMeshEdges(MeshOrPolylines=graft(clean))  # -> simplify(Lines); disabled
mesh_4 = Mesh(simplify(graft(clean)))  # disabled

wbedges_2 = WeaverbirdsMeshEdges(MeshOrPolylines=weld_2)  # -> simplify(Lines); disabled
line = Line(wbedges)  # disabled
number_slider_35 = Slider(1330, range=0..10000)  # disabled
group_3 = Group(Objects=line)  # -> flatten(Group); disabled
len_2 = Length(Curve=wbedges_2)  # disabled
len_3 = Length(Curve=line)  # disabled
lng_14 = ListLength(List=group_3)  # disabled
subtraction_23 = Subtraction(A=len_3, B=len_2)  # disabled
series_4 = Series(Start=0, Step=number_slider_35, Count=lng_14)  # disabled
number_slider_36 = Slider(5928, range=0..10000)  # disabled
smaller_2 = SmallerThan(FirstNumber=subtraction_23, SecondNumber=0)  # -> SmallerThan, OrEqualTo; disabled
dispatch = Dispatch(List=subtraction_23, DispatchPattern=smaller_2.SmallerThan)  # -> ListA, ListB; disabled
Y_14 = UnitY(Factor=series_4)  # disabled
Y_15 = UnitY(Factor=number_slider_36)  # disabled
move_21 = Move(Geometry=group_3, Motion=Y_14)  # -> Geometry, Transform; disabled
bnd_14 = Bounds(Numbers=dispatch.ListA)  # disabled
bnd_15 = Bounds(Numbers=dispatch.ListB)  # disabled
number_slider_37 = Slider(7456, range=0..10000)  # disabled
move_22 = Move(Geometry=move_21.Geometry, Motion=Y_15)  # -> Geometry, Transform; disabled
dedomain_15 = DeconstructDomain(Domain=bnd_15)  # -> Start, End; disabled
dedomain_16 = DeconstructDomain(Domain=bnd_14)  # -> Start, End; disabled
X_3 = UnitX(Factor=number_slider_37)  # disabled
move_23 = Move(Geometry=move_22.Geometry, Motion=X_3)  # -> Geometry, Transform; disabled
gradient_7 = Gradient(
    LowerLimit=dedomain_16.Start,
    UpperLimit=dedomain_16.End,
    Parameter=dispatch.ListA,
    stops=[0: RGB(75, 107, 169), 0.501: RGB(173, 203, 249), 1: RGB(254, 244, 84)])  # disabled
gradient_8 = Gradient(
    LowerLimit=dedomain_15.Start,
    UpperLimit=dedomain_15.End,
    Parameter=dispatch.ListB,
    stops=[0: RGB(254, 244, 84), 0.499: RGB(234, 126, 0), 1: RGB(234, 38, 0), 1: RGB(75, 107, 169), 1: RGB(173, 203, 249)])  # disabled
ungroup_3 = Ungroup(Group=move_23.Geometry)  # disabled
dispatch_2 = Dispatch(List=ungroup_3, DispatchPattern=smaller_2.SmallerThan)  # -> ListA, ListB; disabled
previewlw = CustomPreviewLineweights(Geometry=dispatch_2.ListA, Shader=gradient_7, Thickness=3, Absolute=False)  # disabled
previewlw_2 = CustomPreviewLineweights(Geometry=dispatch_2.ListB, Shader=gradient_8, Thickness=3, Absolute=False)  # disabled

crv_15 = Curve(wbedges)  # disabled
end_2 = EndPoints(Curve=crv_15)  # -> Start, End; disabled
pdecon_11 = Deconstruct(Point=end_2.Start)  # -> XComponent, YComponent, ZComponent; disabled
pdecon_12 = Deconstruct(Point=end_2.End)  # -> XComponent, YComponent, ZComponent; disabled
subtraction_24 = Subtraction(A=pdecon_11.XComponent, B=pdecon_12.XComponent)  # disabled
number_slider_38 = Slider(100, range=0..100)  # disabled
abs_13 = Absolute(Value=subtraction_24)  # disabled
smaller_3 = SmallerThan(FirstNumber=abs_13, SecondNumber=number_slider_38)  # -> SmallerThan, OrEqualTo; disabled
cull_10 = CullPattern(List=crv_15, CullPattern=smaller_3.SmallerThan)  # disabled
join_4 = JoinCurves(Curves=cull_10, Preserve=False)  # disabled
curvepoint_6 = PointOnCurve(join_4, parameter=0.5)  # disabled
pdecon_13 = Deconstruct(Point=curvepoint_6)  # -> XComponent, YComponent, ZComponent; disabled
sort_3 = SortList(Keys=pdecon_13.XComponent, ValuesA=join_4)  # -> Keys, ValuesA; disabled
explode_7 = Explode(Curve=sort_3.ValuesA, Recursive=True)  # -> Segments, simplify(Vertices); disabled
intcrv_5 = Interpolate(Vertices=explode_7.Vertices, Degree=3, Periodic=False, KnotStyle=1)  # -> Curve, Length, Domain; disabled
path_mapper_13 = PathMapper(intcrv_5.Curve, source=["{A;B}", "{A}"], target=["{A}", "{0}"])  # disabled
loft_4 = Loft(Curves=path_mapper_13, Options={Adjust=False, Closed=False, LoftEnds=0, LoftSimp=0, LoftType=0, Rebuild=10, Refit=0.01})  # disabled

mesh_5 = Mesh(mesh_4)  # disabled
number_slider_39 = Slider(1, range=0..1)  # disabled
num_38 = Number(expr("x+1", number_slider_31))  # disabled
medges_2 = MeshEdges(Mesh=mesh_5)  # -> NakedEdges, InteriorEdges, NonManifoldEdges; disabled
demesh = DeconstructMesh(Mesh=mesh_5)  # -> Vertices, Faces, Colours, Normals; disabled
join_5 = JoinCurves(Curves=medges_2.NakedEdges, Preserve=False)  # disabled
patch = Patch(Curves=join_5, Points=demesh.Vertices, Spans=num_38, Flexibility=number_slider_39, Trim=True)  # disabled
srf_3 = Surface(simplify(patch))  # disabled

# ---- group: control gate
srf_4 = Surface(loft_4)
srf_5 = Surface(loft)
bool_2 = Boolean(relaxation)
not_2 = GateNot(A=bool_2)
cull_11 = CullPattern(List=srf_5, CullPattern=not_2)
merge_18 = Merge(Data1=srf_4, Data2=cull_11)

# ----
crv_16 = Curve(dec_reg_5.Polyline)
srf_6 = Surface(reparameterize(simplify(graft(merge_18))))
rec_5 = Rectangle(rectangle_5.Rectangle)
explode_8 = Explode(Curve=crv_16, Recursive=True)  # -> Segments, Vertices
path_mapper_14 = PathMapper(crv_16, source=["{A;B}", "{A}", "{A;B;C}"], target=["{A}", "{0}", "{A}"])
len_4 = Length(Curve=explode_8.Segments)
tstat = TreeStatistics(Tree=path_mapper_14)  # -> Paths, Length, Count
division_43 = Division(A=len_4, B=Slider(100, range=0..100))
lng_15 = ListLength(List=tstat.Paths)
divide_2 = DivideCurve(Curve=explode_8.Segments, Count=division_43, Kinks=False)  # -> Points, Tangents, Parameters
dup_6 = DuplicateData(Data=rec_5, Number=lng_15, Order=True)  # -> graft(Data)
path_mapper_15 = PathMapper(divide_2.Points, source=["{A;B;C;D}", "{A;B;C}", "{A;B;C;D;E}"], target=["{A}", "{0}", "{A}"])
srf_7 = Surface(reparameterize(simplify(dup_6)))
srf_cp = SurfaceClosestPoint(Point=path_mapper_15, Surface=srf_7)  # -> Point, UVPoint, Distance
evalsrf = EvaluateSurface(Surface=reparameterize(srf_6), Point=srf_cp.UVPoint)  # -> Point, Normal, UDirection, VDirection, Frame
c_script_12 = CSharpScript(trimmedTree=evalsrf.Point, originalTree=divide_2.Points)  # -> out, A; inputs trimmedTree: tree, originalTree: tree
# ---------- c_script_12: C# ----------
    if(originalTree.DataCount != trimmedTree.DataCount) Component.AddRuntimeMessage(GH_RuntimeMessageLevel.Error, "Number of items in both trees must be equal");

    DataTree<object> outputs = new DataTree<object>();
    List<GH_Path> paths = GetPaths(originalTree);
    //step through trimmed tree objects and add them to output tree with the correct

    int counter = 0;
    for(int i = 0; i < trimmedTree.BranchCount; i++)
    {
      for(int j = 0; j < trimmedTree.Branch(i).Count; j++)
      {
        outputs.Add(trimmedTree.Branch(i)[j], paths[counter]);
        counter++;
      }
    }
    A = outputs;
# ---------- c_script_12: C# additional code ----------
  public List<GH_Path> GetPaths(DataTree<object> originalTree)
  {
    List<GH_Path> output = new List<GH_Path>();
    for(int i = 0; i < originalTree.BranchCount; i++)
    {
      for(int j = 0; j < originalTree.Branch(i).Count; j++)
      {
        output.Add(originalTree.Paths[i]);
      }
    }
    return output;
  }
# ---------- end c_script_12 ----------
intcrv_6 = Interpolate(Vertices=c_script_12.A, Degree=3, Periodic=False, KnotStyle=1)  # -> Curve, Length, Domain
trim_6 = TrimTree(Tree=intcrv_6.Curve, Depth=1)
item_16 = ListItem(List=trim_6, Index=0, Wrap=True)  # -> Item, Item1, Item2, Item3
flip_2 = FlipCurve(Curve=item_16.Item3)  # -> Curve, Flag
merge_19 = Merge(Data1=item_16.Item1, Data2=flip_2.Curve)
loft_5 = Loft(Curves=merge_19, Options={Adjust=False, Closed=False, LoftEnds=0, LoftSimp=0, LoftType=0, Rebuild=10, Refit=0.01})

srf_8 = Surface(merge_18)
edges = BrepEdges(Brep=srf_8)  # -> Naked, Interior, NonManifold
len_5 = Length(Curve=edges.Naked)
sort_4 = SortList(Keys=len_5, ValuesA=edges.Naked)  # -> Keys, reverse(ValuesA)
item_17 = ListItem(List=sort_4.ValuesA, Index=0, Wrap=True)  # -> Item, Item1
flip_3 = FlipCurve(Curve=item_17.Item1)  # -> Curve, Flag
merge_20 = Merge(Data1=item_17.Item, Data2=flip_3.Curve)
divide_3 = DivideCurve(Curve=merge_20, Count=Slider(100, range=0..100), Kinks=False)  # -> Points, Tangents, Parameters
path_mapper_16 = PathMapper(divide_3.Points, source="{A;B;C}(i)", target="{A;B;i}(C)")
item_18 = ListItem(List=path_mapper_16, Index=0, Wrap=True)  # -> Item, Item1
dist = Distance(PointA=item_18.Item, PointB=item_18.Item1)
trim_7 = TrimTree(Tree=dist, Depth=1)
bnd_16 = Bounds(Numbers=trim_7)
dedomain_17 = DeconstructDomain(Domain=bnd_16)  # -> simplify(Start), End
multiplication_54 = Multiplication(A=dedomain_17.Start, B=Slider(0.95, range=0..1))  # -> flatten(Result)
c_script_13 = CSharpScript(x=multiplication_54)  # -> out, A; inputs x: list of Double
# ---------- c_script_13: C# ----------
    List<double> output = new List<double>();
    
    double currentVal = 0;
    for(int i = 0; i < x.Count; i++)
    {
      output.Add(currentVal);
      currentVal += x[i];
    }
    A = output;
# ---------- end c_script_13 ----------
Y_16 = UnitY(Factor=c_script_13.A)
move_24 = Move(Geometry=srf_8, Motion=graft(Y_16))  # -> Geometry, Transform

mesh_6 = Mesh(mesh_4)  # disabled
mesh_7 = Mesh(flatten(mesh_6))  # disabled
number_slider_40 = Slider(2905, range=0..10000)  # disabled
c_script_14 = CSharpScript(mesh=mesh_6, surface=srf_3)  # -> out, Curvature; inputs mesh: Mesh, surface: Surface; disabled
# ---------- c_script_14: C# ----------
        //get surface gaussian curvature at each mesh point
        List<double> gaussianCurvatures = new List<double>();
        double maxGaussian = 0;
        double minGaussian = double.MaxValue;

        double U;
        double V;

        for (int i = 0; i < mesh.Vertices.Count; i++)
        {
            Point3d currentMeshPoint = mesh.Vertices.Point3dAt(i);
            surface.ClosestPoint(currentMeshPoint, out U, out V);
            SurfaceCurvature surfaceCurvature = surface.CurvatureAt(U, V);
            double gaussian = surfaceCurvature.Gaussian;
            gaussianCurvatures.Add(gaussian);

            //get the range of curvatures
            if (gaussian > maxGaussian) maxGaussian = gaussian;
            if( gaussian < minGaussian) minGaussian = gaussian;
        }


        //get the range of curvatures


        //remap the curvatures to color values on the mesh points
        for (int i = 0; i < mesh.Vertices.Count; i++)
        {
            double hue = (gaussianCurvatures[i] - minGaussian) / (0 - minGaussian) * (0.5 - maxGaussian) + maxGaussian;
        }
        Curvature = gaussianCurvatures;
# ---------- end c_script_14 ----------
move_25 = Move(Geometry=mesh_7, Motion=Y_16)  # -> simplify(graft(Geometry)), Transform; disabled
num_39 = Number(c_script_14.Curvature)  # disabled
Y_17 = UnitY(Factor=number_slider_40)  # disabled
number_slider_41 = Slider(7456, range=0..10000)  # disabled
bnd_17 = Bounds(Numbers=num_39)  # disabled
mesh_8 = Mesh(move_25.Geometry)  # disabled
dedomain_18 = DeconstructDomain(Domain=bnd_17)  # -> Start, End; disabled
move_26 = Move(Geometry=mesh_8, Motion=Y_17)  # -> Geometry, Transform; disabled
X_4 = UnitX(Factor=number_slider_41)  # disabled
gradient_9 = Gradient(
    LowerLimit=dedomain_18.Start,
    UpperLimit=dedomain_18.End,
    Parameter=num_39,
    stops=[0: RGB(0, 128, 0), 0.5: RGB(255, 255, 0), 1: RGB(255, 0, 0)])  # disabled
move_27 = Move(Geometry=move_26.Geometry, Motion=X_4)  # -> Geometry, Transform; disabled
c_script_15 = CSharpScript(mesh=move_27.Geometry, colors=simplify(gradient_9))  # -> out, A; inputs mesh: Mesh, colors: list of Color; disabled
# ---------- c_script_15: C# ----------
    for(int i = 0; i < mesh.Vertices.Count; i++)
    {
      mesh.VertexColors.SetColor(i, colors[i]);
    }
    A = mesh;
# ---------- end c_script_15 ----------

gaussian_curvature = Panel(bnd_17)  # disabled
relaxation_2 = Panel(bnd_14)  # disabled

trim_8 = TrimTree(Tree=loft_5, Depth=2)
vec_7 = Vector(Y_16)
join_6 = BrepJoin(Breps=trim_8)  # -> Breps, Closed
trim_9 = TrimTree(Tree=join_6.Breps, Depth=1)
item_19 = ListItem(List=trim_9, Index=0, Wrap=True)  # -> flatten(Item)
move_28 = Move(Geometry=item_19, Motion=vec_7)  # -> Geometry, Transform

brep = Brep(move_28.Geometry)

# ---- group: brep extension if needed
debrep = DeconstructBrep(Brep=brep)  # -> simplify(Faces), Edges, Vertices
debrep_2 = DeconstructBrep(Brep=debrep.Faces)  # -> Faces, Edges, Vertices
pdecon_14 = Deconstruct(Point=debrep_2.Vertices)  # -> XComponent, YComponent, ZComponent
sort_5 = SortList(Keys=pdecon_14.XComponent)  # -> Keys, ValuesA
item_20 = ListItem(List=sort_5.Keys, Index=0, Wrap=True)
trim_10 = TrimTree(Tree=debrep_2.Faces, Depth=1)
trim_11 = TrimTree(Tree=item_20, Depth=1)
round_2 = Round(Number=trim_11)  # -> Nearest, Floor, Ceiling
sort_6 = SortList(Keys=round_2.Nearest, ValuesA=trim_10)  # -> Keys, simplify(ValuesA)
cset = CreateSet(List=round_2.Nearest)  # -> Set, Map
item_21 = ListItem(List=reverse(cset.Set), Index=0, Wrap=True)
item_22 = ListItem(List=cset.Set, Index=0, Wrap=True)
equals = Equality(FirstNumber=sort_6.Keys, SecondNumber=item_22)  # -> Equality, Inequality
equals_2 = Equality(FirstNumber=sort_6.Keys, SecondNumber=item_21)  # -> Equality, Inequality
and = GateAnd(A=equals.Inequality, B=equals_2.Inequality)

# ---- group: brep extension if needed / middle
cull_12 = CullPattern(List=sort_6.ValuesA, CullPattern=and)

# ---- group: brep extension if needed / start
cull_13 = CullPattern(List=sort_6.ValuesA, CullPattern=equals.Equality)

# ---- group: brep extension if needed / end
cull_14 = CullPattern(List=sort_6.ValuesA, CullPattern=equals_2.Equality)

# ---- group: brep extension if needed (continued)
extendsrf = ExtendSurface(Surface=cull_13, WestEdge=0, SouthEdge=0, EastEdge=Slider(1000, range=0..1000), NorthEdge=0, ExtensionType=True)
extendsrf_2 = ExtendSurface(Surface=cull_14, WestEdge=Slider(1000, range=0..1000), SouthEdge=0, EastEdge=0, NorthEdge=0, ExtensionType=True)
merge_21 = Merge(Data1=cull_12, Data2=extendsrf, Data3=extendsrf_2)
join_7 = BrepJoin(Breps=merge_21)  # -> flatten(Breps), Closed

# ----
c_script_16 = CSharpScript(breps=join_7.Breps)  # -> out, A; inputs breps: list
# ---------- c_script_16: C# ----------
    DataTree<object> output = new DataTree<object>();
    if(breps.Count == 1) return;
    for(int i = 0; i < breps.Count; i++)
    {
      GH_Path path = new GH_Path(i);
      if(i == 0)output.Add(breps[i + 1], path);
      else if(i == breps.Count - 1)output.Add(breps[i - 1], path);
      else
      {
        output.Add(breps[i - 1], path);
        output.Add(breps[i + 1], path);
      }
    }
    A = output;
# ---------- end c_script_16 ----------
splitmul = SplitBrepMultiple(Brep=graft(brep), Cutters=c_script_16.A)
area_6 = Area(Geometry=splitmul)  # -> Area, Centroid
sort_7 = SortList(Keys=area_6.Area, ValuesA=splitmul)  # -> Keys, reverse(ValuesA)
item_23 = ListItem(List=sort_7.ValuesA, Index=0, Wrap=True)
brep_2 = Brep(flatten(item_23))

item_24 = ListItem(List=reverse(brep_2), Index=0, Wrap=True)
item_25 = ListItem(List=reverse(brep_2), Index=1, Wrap=True)
bbx = BrepBrep(BrepA=item_24, BrepB=item_25)  # -> Curves, Points
crv_17 = Curve(bbx.Curves)
explode_9 = Explode(Curve=crv_17, Recursive=True)  # -> Segments, flatten(Vertices)
pdecon_15 = Deconstruct(Point=explode_9.Vertices)  # -> XComponent, YComponent, ZComponent
sort_8 = SortList(Keys=pdecon_15.XComponent, ValuesA=explode_9.Vertices)  # -> Keys, ValuesA
cullpt_2 = CullDuplicates(Points=sort_8.ValuesA, Tolerance=0.1, CullMode=3)  # -> Points, Indices, Valence
intcrv_7 = Interpolate(Vertices=cullpt_2.Points, Degree=3, Periodic=False, KnotStyle=1)  # -> Curve, Length, Domain
Y_18 = UnitY(Factor=Slider(30, range=0..100))
move_29 = Move(Geometry=intcrv_7.Curve, Motion=Y_18)  # -> Geometry, Transform
number_slider_42 = Slider(1000, range=0..1000)
ext = ExtendCurve(Curve=move_29.Geometry, Type=0, Start=number_slider_42, End=number_slider_42)
Y_19 = UnitY(Factor=Slider(10000, range=0..10000))
extr = Extrude(Base=ext, Direction=Y_19)
split = SplitBrep(Brep=item_24, Cutter=extr)
area_7 = Area(Geometry=split)  # -> Area, Centroid
pdecon_16 = Deconstruct(Point=area_7.Centroid)  # -> XComponent, YComponent, ZComponent
sort_9 = SortList(Keys=pdecon_16.ZComponent, ValuesA=split)  # -> Keys, reverse(ValuesA)
item_26 = ListItem(List=sort_9.ValuesA, Index=0, Wrap=True)

item_27 = ListItem(List=brep_2, Index=1, Wrap=True)

item_28 = ListItem(List=brep_2, Index=0, Wrap=True)
bbx_2 = BrepBrep(BrepA=item_28, BrepB=item_27)  # -> Curves, Points
crv_18 = Curve(bbx_2.Curves)
explode_10 = Explode(Curve=crv_18, Recursive=True)  # -> Segments, flatten(Vertices)
pdecon_17 = Deconstruct(Point=explode_10.Vertices)  # -> XComponent, YComponent, ZComponent
sort_10 = SortList(Keys=pdecon_17.XComponent, ValuesA=explode_10.Vertices)  # -> Keys, ValuesA
cullpt_3 = CullDuplicates(Points=sort_10.ValuesA, Tolerance=0.1, CullMode=3)  # -> Points, Indices, Valence
intcrv_8 = Interpolate(Vertices=cullpt_3.Points, Degree=3, Periodic=False, KnotStyle=1)  # -> Curve, Length, Domain
Y_20 = UnitY(Factor=expr("-x", Slider(30, range=0..100)))
number_slider_43 = Slider(1000, range=0..1000)
move_30 = Move(Geometry=intcrv_8.Curve, Motion=Y_20)  # -> Geometry, Transform
ext_2 = ExtendCurve(Curve=move_30.Geometry, Type=0, Start=number_slider_43, End=number_slider_43)
Y_21 = UnitY(Factor=Slider(10000, range=0..10000))
neg_8 = Negative(Value=Y_21)
extr_2 = Extrude(Base=ext_2, Direction=neg_8)
split_2 = SplitBrep(Brep=item_28, Cutter=extr_2)
area_8 = Area(Geometry=split_2)  # -> Area, Centroid
pdecon_18 = Deconstruct(Point=area_8.Centroid)  # -> XComponent, YComponent, ZComponent
sort_11 = SortList(Keys=pdecon_18.ZComponent, ValuesA=split_2)  # -> Keys, reverse(ValuesA)
item_29 = ListItem(List=sort_11.ValuesA, Index=0, Wrap=True)

brep_3 = Brep(brep_2)

lng_16 = ListLength(List=brep_3)
dom_28 = ConstructDomain(DomainStart=1, DomainEnd=expr("x-2", lng_16))
larger = LargerThan(FirstNumber=lng_16, SecondNumber=2)  # -> LargerThan, OrEqualTo
subset_11 = SubList(List=brep_3, Domain=dom_28, Wrap=True)  # -> List, Index
cull_15 = CullPattern(List=subset_11.List, CullPattern=larger.LargerThan)

lng_17 = ListLength(List=brep_2)  # -> expr("x-1", Length)
merge_22 = Merge(Data1=flatten(item_29), Data2=flatten(cull_15), Data3=flatten(item_26))
dom_29 = ConstructDomain(DomainStart=0, DomainEnd=lng_17)
subset_12 = SubList(List=merge_22, Domain=dom_29, Wrap=True)  # -> List, Index

null = NullItem(Item=splitmul)  # -> NullFlags, InvalidFlags, Description
cull_16 = CullPattern(List=brep, CullPattern=null.NullFlags)
merge_23 = Merge(Data1=cull_16, Data2=subset_12.List)
clean_2 = CleanTree(RemoveNulls=True, RemoveInvalid=True, RemoveEmpty=True, Tree=merge_23)

# ---- group: find cull pattern
brep_4 = Brep(move_28.Geometry)  # disabled
brep_5 = Brep(merge_23)  # disabled
c_script_17 = CSharpScript(untrimmed=brep_4, trimmed=brep_5)  # -> out, A; inputs untrimmed: list of Brep, trimmed: list of Brep; disabled
# ---------- c_script_17: C# usings ----------
using Rhino.Geometry.Collections;
# ---------- c_script_17: C# ----------
    DataTree<bool> remains = new DataTree<bool>();
    for(int i = 0; i < untrimmed.Count; i++)
    {

      for(int j = 0; j < untrimmed[i].Faces.Count; j++)
      {
        remains.Add(false, new GH_Path(i));
      }

      BrepFaceList untrimmedFaces = untrimmed[i].Faces;

      //System.Threading.Tasks.Parallel.For(0, untrimmedFaces.Count, j =>
      for(int j = 0; j < untrimmedFaces.Count; j++)
      {

        BrepFaceList trimmedFaces = trimmed[i].Faces;

        for(int v = 0; v < trimmedFaces.Count; v++)
        {
          //var surface = trimmedFaces[v];
          //surface.SetDomain(0, new Interval(0, 1));
          //surface.SetDomain(1, new Interval(0, 1));
          Point3d centroid = trimmedFaces[v].PointAt(0.5, 0.5);

          double U;
          double V;
          untrimmedFaces[j].ClosestPoint(centroid, out U, out V);
          Point3d testPoint = untrimmedFaces[j].PointAt(U, V);

          if(testPoint.DistanceToSquared(centroid) < RhinoDoc.ActiveDoc.ModelAbsoluteTolerance *2)
          {
            remains.Branch(i)[j] = true;
            break;
          }
        }
      }
    }
    A = remains;
# ---------- end c_script_17 ----------

# ----
data_9 = Data(cull_8)
data_10 = Data(species_2)
dec_panel_buildups_2 = DeconstructPanelBuildup(Panels=data_9)  # -> WoodSpecies, Thicknesses
tstat_2 = TreeStatistics(Tree=dec_panel_buildups_2.Thicknesses)  # -> Paths, Length, Count
lng_18 = ListLength(List=tstat_2.Paths)
dup_7 = DuplicateData(Data=data_10, Number=lng_18, Order=True)  # -> graft(Data)
dup_8 = DuplicateData(Data="4", Number=lng_18, Order=True)  # -> graft(Data)
match = MatchTree(Tree=dup_7, Guide=dec_panel_buildups_2.WoodSpecies)
match_2 = MatchTree(Tree=dup_8, Guide=dec_panel_buildups_2.Thicknesses)
merge_24 = Merge(Data1=dec_panel_buildups_2.WoodSpecies, Data2=match)
merge_25 = Merge(Data1=dec_panel_buildups_2.Thicknesses, Data2=match_2)

# ---- group: thicknesses
num_40 = Number(merge_25)

# ---- group: species
data_11 = Data(merge_24)

# ----
c_script_18 = CSharpScript(x=data_11)  # -> out, A; inputs x: tree; same code as c_script_7
c_script_19 = CSharpScript(x=num_40)  # -> out, A; inputs x: tree; same code as c_script_7

cull_17 = CullPattern(List=c_script_19.A, CullPattern=graft(c_script_17.A))  # disabled
cull_18 = CullPattern(List=c_script_18.A, CullPattern=graft(c_script_17.A))  # disabled

clean_3 = CleanTree(RemoveNulls=True, RemoveInvalid=True, RemoveEmpty=True, Tree=c_script_18.A)
clean_4 = CleanTree(RemoveNulls=True, RemoveInvalid=True, RemoveEmpty=True, Tree=c_script_19.A)
c_script_20 = CSharpScript(x=clean_3)  # -> out, A; inputs x: tree; same code as c_script_7
c_script_21 = CSharpScript(x=clean_4)  # -> out, A; inputs x: tree; same code as c_script_7

# ---- group: species
data_12 = Data(c_script_20.A)

# ---- group: thicknesses
num_41 = Number(c_script_21.A)

# ----
debrep_3 = DeconstructBrep(Brep=clean_2)  # -> Faces, Edges, simplify(Vertices)
cullpt_4 = CullDuplicates(Points=flatten(debrep_3.Vertices), Tolerance=0.1, CullMode=3)  # -> simplify(Points), Indices, Valence
del = DelaunayMesh(Points=cullpt_4.Points, Plane=PlaneXY(0, 0, 0))  # -> simplify(Mesh)
qrmesh = QuadRemesh(Mesh=del, Settings=Slider(1000, range=0..1000))  # -> simplify(flatten(QuadResult))

tria = TriangularPanelsA(Surface=debrep_3.Faces, UDivisions=Slider(2, range=0..10), VDivisions=Slider(1, range=0..1))  # -> flatten(Panels)
path_mapper_17 = PathMapper(cullpt_4.Points, source=["{A;B;C;D}", "{A;B;C}"], target=["{A;B;C;D}", "{A;B;C}"])
trim_12 = TrimTree(Tree=cullpt_4.Points, Depth=1)
smesh_4 = SimpleMesh(Brep=tria)
mesh_9 = Mesh(tria)

mjoin_3 = MeshJoin(Meshes=smesh_4)

weld_3 = WeldMesh(Mesh=mjoin_3, Angle=3.141592654)

mesh_10 = Mesh(qrmesh)
demesh_2 = DeconstructMesh(Mesh=mesh_10)  # -> Vertices, Faces, Colours, Normals
pdecon_19 = Deconstruct(Point=demesh_2.Vertices)  # -> XComponent, YComponent, ZComponent
equalst = EqualityWithinTolerance(FirstNumber=pdecon_19.XComponent, SecondNumber="0", Tolerance=Slider(10, range=0..10))  # -> Equality, Inequality
cull_19 = CullPattern(List=demesh_2.Vertices, CullPattern=equalst.Equality)

# ---- group: support points
pt_30 = Point(cull_19)

# ----
mesh_11 = Mesh(qrmesh)
scale = Scale(Geometry=pt_30, Center=Point(0, 0, 0), Factor=number_slider_30)  # -> Geometry, Transform
scale_2 = Scale(Geometry=mesh_11, Center=Point(0, 0, 0), Factor=number_slider_30)  # -> Geometry, Transform

# ---- group: buildups
dec_secies = DeconstructSpecies(Species=data_12)  # -> N, LX, RX, TX, LE, RE, TE
cset_2 = CreateSet(List=dec_secies.N)  # -> Set, Map
material_buildups = Panel("""100
200
300
101
201
301""")

# ---- group: buildups / layer count
lng_19 = ListLength(List=dec_secies.N)

# ---- group: buildups / material type
lng_20 = ListLength(List=cset_2.Set)

# ---- group: buildups (continued)
c_script_22 = CSharpScript(layerCount=lng_19, materialCount=lng_20)  # -> out, A; inputs layerCount: tree of Int32, materialCount: tree of Int32
# ---------- c_script_22: C# ----------
    DataTree<int> keys = new DataTree<int>();

    for(int i = 0; i < layerCount.BranchCount;i++)
    {
      int lCount = layerCount.Branch(i)[0];
      int mCount = materialCount.Branch(i)[0];
      GH_Path path = materialCount.Paths[i];

      if(lCount == 3 && mCount == 1) keys.Add(0, path);
      if(lCount == 5 && mCount == 1) keys.Add(1, path);
      if(lCount == 7 && mCount == 1) keys.Add(2, path);
      if(lCount == 3 && mCount == 2) keys.Add(3, path);
      if(lCount == 5 && mCount == 2) keys.Add(4, path);
      if(lCount == 7 && mCount == 2) keys.Add(5, path);

    }
    A = keys;
# ---------- end c_script_22 ----------
item_30 = ListItem(List=material_buildups, Index=c_script_22.A, Wrap=True)

# ---- group: material ids
num_42 = Number(item_30)

# ----
trim_13 = TrimTree(Tree=num_42, Depth=1)
brep_6 = Brep(brep)
facen = FaceNormals(Mesh=qrmesh)  # -> Centers, Normals
facen_2 = FaceNormals(Mesh=qrmesh)  # -> Centers, Normals
c_script_23 = CSharpScript(breps=brep_6, points=facen_2.Centers)  # -> out, A; inputs breps: list of Brep, points: tree of Point3d
# ---------- c_script_23: C# ----------
    DataTree<int> output = new DataTree<int>();

    for(int i = 0; i < breps.Count; i++)
    {
      int[] indicies = new int[points.Branch(i).Count];
      System.Threading.Tasks.Parallel.For(0, points.Branch(i).Count, j =>
        {
        Point3d point;
        ComponentIndex ci;
        double s;
        double t;
        Vector3d normal;

        breps[i].ClosestPoint(points.Branch(i)[j], out point, out ci, out s, out t, 100, out normal);
        indicies[j] = ci.Index;
        });
      output.AddRange(indicies, new GH_Path(i));
    }
    A = output;
# ---------- end c_script_23 ----------
c_script_24 = CSharpScript(breps=brep_6, points=facen.Centers, tree=trim_13)  # -> out, A; inputs breps: list of Brep, points: list of Point3d, tree: tree of Int32
# ---------- c_script_24: C# ----------
    int[] indices = new int[points.Count];

    //for(int i = 0; i < points.Count; i++)
    System.Threading.Tasks.Parallel.For(0, points.Count, i =>
      {
      double closest = double.MaxValue;
      int closestID = 0;
      int closestBrep = 0;
      for(int j = 0; j < breps.Count; j++)
      {
        Point3d point;
        ComponentIndex ci;
        double s;
        double t;
        Vector3d normal;

        if(!breps[j].ClosestPoint(points[i], out point, out ci, out s, out t, 100, out normal))continue;
        if(points[i].DistanceToSquared(point) < closest)
        {
          closest = points[i].DistanceToSquared(point);
          closestID = ci.Index;

          closestBrep = j;
        }
        indices[i] = tree.Branch(closestBrep)[closestID];
        //RhinoApp.WriteLine(closest.ToString());
      }
      });
    A = indices;
# ---------- end c_script_24 ----------
item_31 = ListItem(List=trim_13, Index=c_script_23.A, Wrap=True)

int_2 = Integer(graft(c_script_24.A))
int_3 = Integer(graft(c_script_24.A))
int_4 = Integer(graft(c_script_24.A))
int_5 = Integer(graft(c_script_24.A))
int_6 = Integer(graft(c_script_24.A))
int_7 = Integer(graft(c_script_24.A))
equals_3 = Equality(FirstNumber=int_2, SecondNumber=Slider(300, range=0..1000))  # -> Equality, Inequality
equals_4 = Equality(FirstNumber=int_4, SecondNumber=Slider(201, range=0..1000))  # -> Equality, Inequality
equals_5 = Equality(FirstNumber=int_3, SecondNumber=Slider(101, range=0..1000))  # -> Equality, Inequality
equals_6 = Equality(FirstNumber=int_5, SecondNumber=Slider(301, range=0..1000))  # -> Equality, Inequality
equals_7 = Equality(FirstNumber=int_6, SecondNumber=Slider(200, range=0..1000))  # -> Equality, Inequality
equals_8 = Equality(FirstNumber=int_7, SecondNumber=Slider(100, range=0..1000))  # -> Equality, Inequality
cull_20 = CullPattern(List=division_36, CullPattern=equals_3.Equality)
cull_21 = CullPattern(List=matprops_3, CullPattern=equals_3.Equality)
cull_22 = CullPattern(List=matprops_6, CullPattern=equals_4.Equality)
cull_23 = CullPattern(List=matprops_2, CullPattern=equals_5.Equality)
cull_24 = CullPattern(List=division_37, CullPattern=equals_5.Equality)
cull_25 = CullPattern(List=division_38, CullPattern=equals_4.Equality)
cull_26 = CullPattern(List=division_39, CullPattern=equals_6.Equality)
cull_27 = CullPattern(List=matprops_4, CullPattern=equals_6.Equality)
cull_28 = CullPattern(List=matprops_5, CullPattern=equals_7.Equality)
cull_29 = CullPattern(List=division_40, CullPattern=equals_8.Equality)
cull_30 = CullPattern(List=division_41, CullPattern=equals_7.Equality)
cull_31 = CullPattern(List=matprops, CullPattern=equals_8.Equality)

txt_3 = Text(item_31)
wbfacepolys = WeaverbirdsFacePolylines(Mesh=qrmesh)
chars = Characters(Text=txt_3)  # -> Result, Unicode
smesh_5 = SimpleMesh(Brep=wbfacepolys)
item_32 = ListItem(List=reverse(chars.Result), Index=0, Wrap=True)
item_33 = ListItem(List=chars.Result, Index=0, Wrap=True)
trim_14 = TrimTree(Tree=item_32, Depth=1)
trim_15 = TrimTree(Tree=item_33, Depth=1)
bnd_18 = Bounds(Numbers=flatten(trim_14))
dom_30 = ConstructDomain(DomainStart=Slider(0.165, range=0..1), DomainEnd=Slider(0.099, range=0..1))
bnd_19 = Bounds(Numbers=flatten(trim_15))
dom_31 = ConstructDomain(DomainStart=Slider(0.14, range=0..1), DomainEnd=Slider(1, range=0..1))
remap_26 = RemapNumbers(Value=trim_14, Source=bnd_18, Target=dom_30)  # -> Mapped, Clipped
remap_27 = RemapNumbers(Value=trim_15, Source=bnd_19, Target=dom_31)  # -> Mapped, Clipped
hsl = ColourHSL(Alpha=1, Hue=remap_26.Mapped, Saturation=remap_27.Mapped, Luminance=0.5)

preview_12 = CustomPreview(Geometry=simplify(smesh_5), Material=hsl)  # disabled

merge_26 = Merge(Data1=cull_23, Data2=cull_31, Data3=cull_22, Data4=cull_28, Data5=cull_27, Data6=cull_21)  # -> flatten(Result)
merge_27 = Merge(Data1=cull_24, Data2=cull_29, Data3=cull_25, Data4=cull_30, Data5=cull_26, Data6=cull_20)  # -> flatten(Result)

# ---- group: Karamba simulation
mesh_12 = Mesh(scale_2.Geometry)
supp = SupportKaramba3D(PosInd=scale.Geometry, menu=[buttons(on, on, on, on, on, on)])
cross_section_2 = CrossSectionKaramba3D(FamilyNameOfCrossSection="DefaultCroSec", Materials=merge_26, Heights_cm=merge_27, mode="Shell - Var")
loads_2 = LoadsKaramba3D(Vector=rev, Mesh=mesh_12, LCase="0", mode="MeshLoad -Const.", menu=[buttons(off, on, off), buttons(on, on)])
meshtoshell = MeshToShellKaramba3D(Mesh=mesh_12, CrossSection=cross_section_2, LimitDistance_m=0.005)  # -> Element, Points, Info
assemble = AssembleModelKaramba3D(
    Elem=meshtoshell.Element,
    Support=supp,
    Load=flatten([loads_2, loads]),
    CrossSection=cross_section_2,
    LimitDistance_m=0.005)  # -> Model, Info, Mass_kg, CenterOfGravity, LoadCaseNames

# ----
analyze = AnalyzeKaramba3D(Model=assemble.Model)  # -> CalculatedModel, MaximumDisplacement_cm, ResultingForceOfGravity_kN, ElasticEnergyChange_kNm

null_2 = NullItem(Item=analyze.MaximumDisplacement_cm)  # -> NullFlags, InvalidFlags, Description
cull_32 = CullPattern(List=Slider(1000, range=0..1000), CullPattern=null_2.NullFlags)
merge_28 = Merge(Data1=analyze.MaximumDisplacement_cm, Data2=cull_32)  # -> flatten(Result)
clean_5 = CleanTree(RemoveNulls=True, RemoveInvalid=True, RemoveEmpty=False, Tree=merge_28)
num_43 = Number(flatten(clean_5))
panel_8 = Panel(num_43)

# ---- group: Karamba simulation (continued)
modelview = ModelViewKaramba3D(Model=analyze.CalculatedModel, ResultFactors=1, ResultCase=-1)  # -> Model, DeformedMesh, DeformedAxes, DeformedModel
shellview = ShellViewKaramba3D(Model=modelview.Model, IndexOfLayer=0)  # -> Model, MeshesOfRenderedShells, LegendColors, LegendTags
mesh_13 = Mesh(shellview.MeshesOfRenderedShells)

# ----
legend = Legend(Colour=shellview.LegendColors, Tags=shellview.LegendTags, LegendType=1)
scale_3 = Scale(Geometry=mesh_13, Center=Point(0, 0, 0), Factor=Slider(1000, range=0..50000))  # -> Geometry, Transform
mesh_14 = Mesh(scale_3.Geometry)
move_31 = Move(Geometry=mesh_14, Motion=X)  # -> Geometry, Transform
