# Grasshopper definition BilayerDesign - Variable Thickness Eddy.gh (Grasshopper 1.0.7)
# plug-ins: HygroDesign, Pufferfish, MeshEdit Components, Karamba3D, Kangaroo2 Components, Weaverbird, Human, LunchBox, Utils, Sofistik, EleFront, Telepathy

# ---- group: beech
species = WoodSpecies(
    Name="beech",
    LExpansion=Slider(0.0001, range=0..0.0001),
    RExpansion=Slider(0.002, range=0..1),
    TExpansion=Slider(0.0041, range=0..1),
    LElasticModulus=Slider(14000, range=0..20000),
    RElasticModulus=Slider(2280, range=0..20000),
    TElasticModulus=Slider(1160, range=0..20000))

# ---- group: spruce
species_2 = WoodSpecies(
    Name="spruce",
    LExpansion=Slider(0.0001, range=0..0.0001),
    RExpansion=Slider(0.0019, range=0..1),
    TExpansion=Slider(0.0036, range=0..1),
    LElasticModulus=Slider(10000, range=0..20000),
    RElasticModulus=Slider(800, range=0..20000),
    TElasticModulus=Slider(450, range=0..20000))

# ----
number_slider = Slider(150, range=0..10000)
number_slider_2 = Slider(2500, range=0..10000)
number_slider_3 = Slider(3, range=0..10)
number_slider_4 = Slider(20, range=0..100)
xy = XYPlane(Origin=Point(0, 0, 0))
multiplication = Multiplication(A=number_slider_4, B=number_slider)
multiplication_2 = Multiplication(A=number_slider_2, B=number_slider_3)
bilayer = Bilayer(
    BasePlane=xy,
    BoardWidth=number_slider,
    BoardLength=number_slider_2,
    WidthCount=number_slider_4,
    LengthCount=number_slider_3,
    ActiveThickness=Slider(20, range=0..100),
    PassiveThickness=Slider(4, range=0..100),
    PassiveSpecies=species_2)
rectangle = Rectangle(Plane=PlaneXY(0, 0, 0), XSize=multiplication_2, YSize=multiplication, Radius=0)  # -> Rectangle, Length
num = Number(number_slider)
num_2 = Number(number_slider_2)

number_slider_5 = Slider(1000, range=0..1000)
neg = Negative(Value=number_slider_5)
rectangle_2 = Rectangle(Plane=PlaneXY(0, 0, 0), XSize=number_slider_5, YSize=neg, Radius=0)  # -> Rectangle, Length
drec = DeconstuctRectangle(Rectangle=rectangle_2.Rectangle)  # -> BasePlane, XInterval, YInterval
dedomain = DeconstructDomain(Domain=drec.XInterval)  # -> Start, End
dedomain_2 = DeconstructDomain(Domain=drec.YInterval)  # -> Start, End
pt = ConstructPoint(XCoordinate=dedomain.Start, YCoordinate=0, ZCoordinate=0)
pt_2 = ConstructPoint(XCoordinate=dedomain.End, YCoordinate=0, ZCoordinate=0)
subtraction = Subtraction(A=dedomain_2.End, B=dedomain_2.Start)
ln = Line(StartPoint=pt, EndPoint=pt_2)
number_slider_6 = Slider(0.4, range=0..0.5)
number_slider_7 = Slider(0.6, range=0.5..1)
divide = DivideCurve(Curve=ln, Count=expr("x-1", Slider(3, range=0..10)), Kinks=False)  # -> Points, Tangents, Parameters
multiplication_3 = Multiplication(A=subtraction, B=Slider(1, range=0.5..1))
multiplication_4 = Multiplication(A=subtraction, B=Slider(0.2, range=0..0.5))
multiplication_5 = Multiplication(A=subtraction, B=Slider(0.8, range=0.5..1))
multiplication_6 = Multiplication(A=subtraction, B=Slider(0.3, range=0..1))
multiplication_7 = Multiplication(A=subtraction, B=number_slider_7)
multiplication_8 = Multiplication(A=subtraction, B=number_slider_7)
neg_2 = Negative(Value=multiplication_4)
neg_3 = Negative(Value=multiplication_3)
neg_4 = Negative(Value=multiplication_6)
neg_5 = Negative(Value=multiplication_5)
neg_6 = Negative(Value=multiplication_8)
neg_7 = Negative(Value=multiplication_7)
item = ListItem(List=divide.Points, Index=0, Wrap=True)  # -> Item, Item1, Item2
Y = UnitY(Factor=neg_2)
Y_2 = UnitY(Factor=neg_4)
Y_3 = UnitY(Factor=neg_3)
Y_4 = UnitY(Factor=neg_5)
Y_5 = UnitY(Factor=neg_6)
Y_6 = UnitY(Factor=neg_7)
move = Move(Geometry=[item.Item, item.Item2], Motion=Y)  # -> Geometry, Transform
move_2 = Move(Geometry=item.Item1, Motion=Y_3)  # -> Geometry, Transform
move_3 = Move(Geometry=[item.Item, item.Item2], Motion=Y_2)  # -> Geometry, Transform
move_4 = Move(Geometry=item.Item1, Motion=Y_4)  # -> Geometry, Transform
move_5 = Move(Geometry=[item.Item, item.Item2], Motion=Y_5)  # -> Geometry, Transform
move_6 = Move(Geometry=item.Item1, Motion=Y_6)  # -> Geometry, Transform
item_2 = ListItem(List=move.Geometry, Index=0, Wrap=True)  # -> Item, Item1
item_3 = ListItem(List=move_3.Geometry, Index=0, Wrap=True)  # -> Item, Item1
item_4 = ListItem(List=move_5.Geometry, Index=0, Wrap=True)  # -> Item, Item1
merge = Merge(Data1=flatten(item_2.Item), Data2=flatten(move_2.Geometry), Data3=flatten(item_2.Item1))
merge_2 = Merge(Data1=flatten(item_3.Item), Data2=flatten(move_4.Geometry), Data3=flatten(item_3.Item1))
merge_3 = Merge(Data1=flatten(item_4.Item), Data2=flatten(move_6.Geometry), Data3=flatten(item_4.Item1))
intcrv = Interpolate(Vertices=merge, Degree=3, Periodic=False, KnotStyle=1)  # -> Curve, Length, Domain
intcrv_2 = Interpolate(Vertices=merge_2, Degree=3, Periodic=False, KnotStyle=1)  # -> Curve, Length, Domain
intcrv_3 = Interpolate(Vertices=merge_3, Degree=3, Periodic=False, KnotStyle=1)  # -> Curve, Length, Domain
merge_4 = Merge(Data1=intcrv.Curve, Data2=intcrv_2.Curve, Data3=intcrv_3.Curve)
rec = Rectangle(rectangle_2.Rectangle)

board_count = Slider(200, range=0..500)

# ---- group: name
num_3 = Number(board_count)
series = Series(Start=0, Step=1, Count=num_3)
dup = DuplicateData(Data="S", Number=num_3, Order=True)  # -> graft(Data)
txt = Text(graft(series))
merge_5 = Merge(Data1=dup, Data2=txt)  # -> simplify(Result)
join = TextJoin(Text=merge_5)  # -> flatten(Result)

# ---- group: active thickness
number_slider_8 = Slider(20, range=0..100)

# ---- group: RT
dom = ConstructDomain(DomainStart=Slider(15, range=0..100), DomainEnd=Slider(75, range=0..100))
random = Random(Range=dom, Number=board_count, Seed=Slider(225, range=0..1000))

# ---- group: name
num_4 = Number(board_count)
series_2 = Series(Start=0, Step=1, Count=num_4)
dup_2 = DuplicateData(Data="B", Number=num_4, Order=True)  # -> graft(Data)
txt_2 = Text(graft(series_2))
merge_6 = Merge(Data1=dup_2, Data2=txt_2)  # -> simplify(Result)
join_2 = TextJoin(Text=merge_6)  # -> flatten(Result)

# ---- group: thickness
num_5 = Number(number_slider_8)
num_6 = Number(board_count)
dup_3 = DuplicateData(Data=num_5, Number=num_6, Order=True)

# ---- group: length
num_7 = Number(num_2)
num_8 = Number(board_count)
dup_4 = DuplicateData(Data=num_7, Number=num_8, Order=True)

# ---- group: width
num_9 = Number(num)
num_10 = Number(board_count)
dup_5 = DuplicateData(Data=num_9, Number=num_10, Order=True)

# ---- group: beech
data = Data(species)

# ---- group: spruce
data_2 = Data(species_2)

# ---- group: bounding rectangle input (rectangle y domain represents full range of radii from stockpiles)
rec_2 = Rectangle(rec)

# ----
stock_boards = StockBoards(Name=join_2, Species=data, Thickness=dup_3, Length=dup_4, Width=dup_5, RTAngle=random)
stock_boards_2 = StockBoards(Name=join, Species=data_2, Thickness=dup_3, Length=dup_4, Width=dup_5, RTAngle=random)
merge_7 = Merge(Data1=stock_boards, Data2=stock_boards_2)

# ---- group: curve controller inputs (represents distribution of radii along a given cross section)
crv = Curve(merge_4)

# ----
crv_2 = Curve(crv)
lng = ListLength(List=crv_2)  # -> expr("x-2", Length)
dom_2 = ConstructDomain(DomainStart=0, DomainEnd=lng)
subset = SubList(List=crv_2, Domain=dom_2, Wrap=True)  # -> graft(List), Index
shift = ShiftList(List=crv_2, Shift=1, Wrap=False)  # -> graft(List)
merge_8 = Merge(Data1=subset.List, Data2=shift)  # -> simplify(Result)
group = Group(Objects=merge_8)  # -> flatten(Group)

deconstruct_bilayer = DeconstructBilayer(Bilayer=bilayer)
dec_board = DeconstructBoard(Board=deconstruct_bilayer)  # -> Polyline, Name, Species, RTAngle, MoistureChange, DesiredRadius, Radius, BlendedRadius, BoardRegions
area = Area(Geometry=dec_board.Polyline)  # -> Area, Centroid
c_script = CSharpScript(rects=flatten(dec_board.Polyline))  # -> out; inputs rects: list of Rectangle3d; disabled
# ---------- c_script: C# usings ----------
using Rhino.DocObjects;
# ---------- c_script: C# ----------
    var object_enumerator_settings = new ObjectEnumeratorSettings();

    var rhinoObjects = RhinoDoc.ActiveDoc.Objects.GetObjectList(object_enumerator_settings);
    var objectTable = RhinoDoc.ActiveDoc.Objects;

    foreach( var rhinoObject in rhinoObjects)
    {
      if(rhinoObject.ObjectType == ObjectType.Curve)
      {
        Curve rhinoCurve = rhinoObject.Geometry as Curve;
        if(rhinoCurve.IsClosed)objectTable.Delete(rhinoObject);
      }
    }

    foreach(var rect in rects)objectTable.AddCurve(rect.ToNurbsCurve());
# ---------- end c_script ----------
pt_3 = Point(simplify(area.Centroid))

# ---- group: generate distribution
pt_4 = Point(simplify(pt_3))
data_3 = Data(group)
pdecon = Deconstruct(Point=pt_4)  # -> XComponent, YComponent, ZComponent
bnd = Bounds(Numbers=flatten(pdecon.XComponent))
bnd_2 = Bounds(Numbers=flatten(pdecon.YComponent))
lng_2 = ListLength(List=data_3)
dedomain_3 = DeconstructDomain(Domain=bnd)  # -> Start, End
remap = RemapNumbers(Value=pdecon.YComponent, Source=bnd_2, Target=Domain(0, 1))  # -> graft(Mapped), Clipped
c_script_2 = CSharpScript(count=lng_2, start=dedomain_3.Start, end=dedomain_3.End)  # -> out, A; inputs count: Int32, start: Double, end: Double
# ---------- c_script_2: C# ----------
    double totalLength = end - start;
    double domLength = totalLength / (double) count;

    List<Interval> intervals = new List<Interval>();
    double currentStart = start;
    for(int i = 0; i < count; i++)
    {
      intervals.Add(new Interval(currentStart, currentStart + domLength));
      currentStart += domLength;
    }
    A = intervals;
# ---------- end c_script_2 ----------
num_11 = Number(graft(pdecon.XComponent))
inc = Includes(Value=num_11, Domain=simplify(c_script_2.A))  # -> Includes, Deviation
cull = CullPattern(List=data_3, CullPattern=inc.Includes)
item_5 = ListItem(List=cull, Index=0, Wrap=True)
cull_2 = CullPattern(List=c_script_2.A, CullPattern=inc.Includes)
ungroup = Ungroup(Group=item_5)  # -> simplify(Objects)
item_6 = ListItem(List=cull_2, Index=0, Wrap=True)
remap_2 = RemapNumbers(Value=num_11, Source=item_6, Target=Domain(0, 1))  # -> Mapped, Clipped
eval = EvaluateCurve(Curve=reparameterize(ungroup), Parameter=remap.Mapped)  # -> Point, Tangent, Angle
pdecon_2 = Deconstruct(Point=eval.Point)  # -> XComponent, YComponent, ZComponent
item_7 = ListItem(List=pdecon_2.YComponent, Index=0, Wrap=True)  # -> Item, Item1
twn2nums = TweenTwoNumbers(NumberA=item_7.Item, NumberB=item_7.Item1, Factor=remap_2.Mapped)
num_12 = Number(twn2nums)

# ----
bbox = BoundingBox(Content=dec_board.Polyline, Plane=PlaneXY(0, 0, 0), UnionBox=True)  # -> Box, Box_2
debox = DeconstructBox(Box=bbox.Box)  # -> Plane, X, Y, Z
dedomain_4 = DeconstructDomain(Domain=debox.X)  # -> Start, End
dedomain_5 = DeconstructDomain(Domain=debox.Y)  # -> Start, End
pt_5 = ConstructPoint(XCoordinate=dedomain_4.End, YCoordinate=dedomain_5.End, ZCoordinate=0)
pt_6 = ConstructPoint(XCoordinate=dedomain_4.Start, YCoordinate=dedomain_5.End, ZCoordinate=0)
pt_7 = ConstructPoint(XCoordinate=dedomain_4.Start, YCoordinate=dedomain_5.Start, ZCoordinate=0)
pt_8 = ConstructPoint(XCoordinate=dedomain_4.End, YCoordinate=dedomain_5.Start, ZCoordinate=0)
merge_9 = Merge(Data1=pt_5, Data2=pt_6, Data3=pt_7, Data4=pt_8)
nurbs = NurbsCurve(Vertices=merge_9, Degree=3, Periodic=False)  # -> Curve, Length, Domain

# ---- group: material / Species
crv_3 = Curve(nurbs.Curve)

# ---- group: material / beech
data_4 = Data(species)

# ---- group: material / spruce
data_5 = Data(species_2)

# ---- group: material
pt_9 = Point(graft(pt_3))
xz = XZPlane(Origin=pt_9)
pcx = CurvePlane(Curve=crv_3, Plane=xz)  # -> simplify(Points), ParamsC, ParamsP
pdecon_3 = Deconstruct(Point=pcx.Points)  # -> XComponent, YComponent, ZComponent
pdecon_4 = Deconstruct(Point=pt_9)  # -> XComponent, YComponent, ZComponent
smaller = SmallerThan(FirstNumber=pdecon_3.XComponent, SecondNumber=pdecon_4.XComponent)  # -> SmallerThan, OrEqualTo
not = GateNot(A=smaller.SmallerThan)
cull_3 = CullPattern(List=data_4, CullPattern=not)
cull_4 = CullPattern(List=data_5, CullPattern=smaller.SmallerThan)
merge_10 = Merge(Data1=cull_3, Data2=cull_4)  # -> simplify(Result)
path_mapper = PathMapper(merge_10, source="{A}", target="{0}")

# ---- group: Thickness
dec_reg = DeconstructBoardRegion(BoardRegion=dec_board.BoardRegions)  # -> Polyline, Name, Species, RTAngle, MoistureChange, DesiredRadius, Radius, BlendedRadius, ThicknessBlendedRadius
area_2 = Area(Geometry=dec_reg.Polyline)  # -> Area, Centroid
pt_10 = Point(simplify(area_2.Centroid))
pdecon_5 = Deconstruct(Point=pt_10)  # -> XComponent, YComponent, ZComponent
bnd_3 = Bounds(Numbers=flatten(pdecon_5.XComponent))
dom_3 = ConstructDomain(DomainStart=Slider(0.6, range=0..1.2), DomainEnd=Slider(0.21, range=0..1))
remap_3 = RemapNumbers(Value=pdecon_5.XComponent, Source=bnd_3, Target=dom_3)  # -> Mapped, Clipped

# ----
pt_11 = Point(pt_3)
pdecon_6 = Deconstruct(Point=pt_11)  # -> XComponent, YComponent, ZComponent
bnd_4 = Bounds(Numbers=flatten(pdecon_6.XComponent))
dom_4 = ConstructDomain(DomainStart="1", DomainEnd="0")
remap_4 = RemapNumbers(Value=pdecon_6.XComponent, Source=bnd_4, Target=dom_4)  # -> simplify(Mapped), Clipped

num_13 = Number(num_12)
rec_3 = Rectangle(rec_2)
drec_2 = DeconstuctRectangle(Rectangle=rec_3)  # -> BasePlane, XInterval, YInterval
dom_5 = ConstructDomain(DomainStart=0, DomainEnd=1)
remap_5 = RemapNumbers(Value=num_13, Source=drec_2.YInterval, Target=dom_5)  # -> Mapped, Clipped
trim = TrimTree(Tree=remap_5.Mapped, Depth=1)

data_6 = Data(bilayer)

update_bilayer = UpdateBilayer(Bilayer=data_6, Radius=trim, RadiusWeight=remap_4.Mapped, Material=path_mapper)
dup_bilayer = DuplicateBilayer(Bilayer=update_bilayer, Count=Slider(4, range=0..10))
panel = Panel(Bilayers=dup_bilayer)
adjust_cro_sec = AdjustCrossSection(Panel=panel, Thicknesses=remap_3.Mapped)
dup_panel = DuplicatePanel(Panel=adjust_cro_sec, Count=Slider(2, range=0..10))

# ---- group: moisture changes
panel_2 = Panel("""2
4
8""")
num_14 = Number(panel_2)

# ----
data_7 = Data(merge_7)
design_env = DesignEnvironment(Panels=dup_panel, StockBoards=data_7, MoistureChanges=num_14)  # -> Panels, StockBoards
convolution = CurvatureConvolution(
    Panels=design_env.Panels,
    TengentialBlending=Slider(0.34, range=0.01..3),
    LongitudinalBlending=Slider(0.3, range=0.01..3),
    MaxRadiusInfluence=100000,
    StiffnessFactor=0.1,
    ThicknessFactor=0.1,
    VisualizeBoardWeights=0)  # -> Panels, Weights

cross_section = BooleanToggle(True)
relaxation = BooleanToggle(False)
cull_5 = CullPattern(List=convolution.Panels, CullPattern=cross_section)

item_8 = ListItem(List=convolution.Panels, Index=0, Wrap=True)  # -> Item, Item1
deconstruct_panel = DeconstructPanel(Panel=item_8.Item)
deconstruct_bilayer_2 = DeconstructBilayer(Bilayer=deconstruct_panel)
dec_board_2 = DeconstructBoard(Board=deconstruct_bilayer_2)  # -> Polyline, Name, Species, RTAngle, MoistureChange, DesiredRadius, Radius, BlendedRadius, BoardRegions
display_panel = DisplayPanels(Panels=item_8.Item)  # -> ActiveBoards, PassiveBoards
dec_reg_2 = DeconstructBoardRegion(BoardRegion=dec_board_2.BoardRegions)  # -> Polyline, Name, Species, RTAngle, MoistureChange, DesiredRadius, Radius, BlendedRadius, ThicknessBlendedRadius

bbox_2 = BoundingBox(Content=flatten(dec_reg_2.Polyline), Plane=PlaneXY(0, 0, 0), UnionBox=True)  # -> Box, Box_2
debox_2 = DeconstructBox(Box=bbox_2.Box)  # -> Plane, X, Y, Z
dedomain_6 = DeconstructDomain(Domain=debox_2.Y)  # -> Start, End
subtraction_2 = Subtraction(A=dedomain_6.End, B=dedomain_6.Start)
multiplication_9 = Multiplication(A=subtraction_2, B="1.5")
series_3 = Series(Start=Slider(5981, range=0..10000), Step=multiplication_9, Count=Slider(5, range=0..10))
item_9 = ListItem(List=series_3, Index=0, Wrap=True)  # -> Item, Item1, Item2, Item3, Item4

crosecset = UniqueCrossSections(Panel=cull_5)
dec_reg_3 = DeconstructBoardRegion(BoardRegion=crosecset)  # -> Polyline, Name, Species, RTAngle, MoistureChange, DesiredRadius, Radius, BlendedRadius, ThicknessBlendedRadius

python = GhPythonScript(x=dec_reg_2.Species)  # -> out, a
# ---------- python: Python ----------
a = x.Name
# ---------- end python ----------
len = TextLength(Text=python.a)
bnd_5 = Bounds(Numbers=flatten(len))
dedomain_7 = DeconstructDomain(Domain=bnd_5)  # -> Start, End
gradient = Gradient(
    LowerLimit=dedomain_7.Start,
    UpperLimit=dedomain_7.End,
    Parameter=len,
    stops=[0: RGB(80, 55, 25), 0.5: RGB(159, 65, 29), 1: RGB(174, 166, 129)])
Y_7 = UnitY(Factor=item_9.Item3)
vec = Vector(Y_7)
move_7 = Move(Geometry=display_panel.ActiveBoards, Motion=vec)  # -> Geometry, Transform
move_8 = Move(Geometry=display_panel.PassiveBoards, Motion=vec)  # -> Geometry, Transform
preview = CustomPreview(Geometry=move_7.Geometry, Material=gradient)
preview_2 = CustomPreview(Geometry=move_8.Geometry, Material=ColourSwatch(SwatchColor=RGB(115, 115, 115)))

bnd_6 = Bounds(Numbers=flatten(dec_reg_2.RTAngle))
dedomain_8 = DeconstructDomain(Domain=bnd_6)  # -> Start, End
gradient_2 = Gradient(
    LowerLimit=dedomain_8.Start,
    UpperLimit=dedomain_8.End,
    Parameter=dec_reg_2.RTAngle,
    stops=[0: RGB(124, 0, 219), 1: RGB(207, 130, 255)])
Y_8 = UnitY(Factor=item_9.Item2)
vec_2 = Vector(Y_8)
move_9 = Move(Geometry=display_panel.ActiveBoards, Motion=vec_2)  # -> Geometry, Transform
move_10 = Move(Geometry=display_panel.PassiveBoards, Motion=vec_2)  # -> Geometry, Transform
preview_3 = CustomPreview(Geometry=move_9.Geometry, Material=gradient_2)
preview_4 = CustomPreview(Geometry=move_10.Geometry, Material=ColourSwatch(SwatchColor=RGB(115, 115, 115)))

bnd_7 = Bounds(Numbers=flatten(dec_reg_2.MoistureChange))
dedomain_9 = DeconstructDomain(Domain=bnd_7)  # -> Start, End
Y_9 = UnitY(Factor=item_9.Item1)
gradient_3 = Gradient(
    LowerLimit=dedomain_9.Start,
    UpperLimit=dedomain_9.End,
    Parameter=dec_reg_2.MoistureChange,
    stops=[0.15: RGB(130, 253, 255), 0.85: RGB(0, 172, 219)])
vec_3 = Vector(Y_9)
move_11 = Move(Geometry=display_panel.ActiveBoards, Motion=vec_3)  # -> Geometry, Transform
move_12 = Move(Geometry=display_panel.PassiveBoards, Motion=vec_3)  # -> Geometry, Transform
preview_5 = CustomPreview(Geometry=move_11.Geometry, Material=gradient_3)
preview_6 = CustomPreview(Geometry=move_12.Geometry, Material=ColourSwatch(SwatchColor=RGB(115, 115, 115)))

c_script_3 = CSharpScript(desired=dec_reg_2.DesiredRadius, actual=dec_reg_2.ThicknessBlendedRadius)  # -> out, A; inputs desired: Double, actual: Double
# ---------- c_script_3: C# ----------
    A = 100 * Math.Abs(desired - actual) / ((desired + actual) / 2);
# ---------- end c_script_3 ----------
Y_10 = UnitY(Factor=item_9.Item)
gradient_4 = Gradient(LowerLimit=0, UpperLimit="100", Parameter=c_script_3.A, stops=[0.15: RGB(255, 130, 160), 0.85: RGB(220, 0, 40)])
vec_4 = Vector(Y_10)
move_13 = Move(Geometry=display_panel.ActiveBoards, Motion=vec_4)  # -> Geometry, Transform
move_14 = Move(Geometry=display_panel.PassiveBoards, Motion=vec_4)  # -> Geometry, Transform
swatch = ColourSwatch(SwatchColor=RGBA(0, 0, 0, 66))
preview_7 = CustomPreview(Geometry=move_13.Geometry, Material=gradient_4)
preview_8 = CustomPreview(Geometry=move_14.Geometry, Material=gradient_4)

cull_6 = CullPattern(List=cull_5, CullPattern=cross_section)
deconstruct_panel_2 = DeconstructPanel(Panel=cull_6)
deconstruct_bilayer_3 = DeconstructBilayer(Bilayer=deconstruct_panel_2)
dec_board_3 = DeconstructBoard(Board=deconstruct_bilayer_3)  # -> Polyline, Name, Species, RTAngle, MoistureChange, DesiredRadius, Radius, BlendedRadius, BoardRegions
dec_reg_4 = DeconstructBoardRegion(BoardRegion=dec_board_3.BoardRegions)  # -> Polyline, ThicknessBlendedRadius, Species, MoistureChange, DesiredRadius, Radius, BlendedRadius, ThicknessBlendedRadius_2, ThicknessBlendedRadius_3

# ---- group: 2022 - Edgar
panel_3 = Panel("C:\Program Files\SOFiSTiK\2023\SOFiSTiK 2023\wps.exe")  # disabled
panel_4 = Panel("C:\Program Files\SOFiSTiK\2023\SOFiSTiK 2023\sof_cdb_w_edu-2023.dll")  # disabled
entwine = Entwine(Branch00=panel_3, Branch01=panel_4, FlattenInputs=True)  # -> simplify(Result); disabled

# ---- group: Create_Data_Path
button = Button()  # disabled

# ----
panel_5 = Panel("C:\Program Files\SOFiSTiK\2020\SOFiSTiK 2020\wps.exe")  # disabled
panel_6 = Panel("C:\Program Files\SOFiSTiK\2020\SOFiSTiK 2020\sof_cdb_w-70.dll")  # disabled
sofistik_path = ValueList({"2022-Edgar": 1, "2022-Other Users": 2}, selected="2022-Edgar")  # disabled
entwine_2 = Entwine(Branch00=panel_5, Branch01=panel_6, FlattenInputs=True)  # -> simplify(Result); disabled
filter = StreamFilter(Gate=sofistik_path, Stream0=entwine_2, Stream1=entwine)  # disabled
bang = ExplodeTree(Data=filter)  # -> Branch0, Branch1; disabled
pathwps_exe = Data(bang.Branch0)  # disabled
pathcdb_dll = FilePath(bang.Branch1)  # disabled
panel_7 = Panel("structure")  # disabled
panel_8 = Panel("\")  # disabled
pathinfo = PathInfo()  # -> Directory, Filename, Path
concat = Concatenate(FragmentA=pathinfo.Path)  # disabled
concat_2 = Concatenate(FragmentA=pathinfo.Path, FragmentB=panel_8, FragmentD=panel_7)  # disabled
createfolder = CSharpScript(path=concat, create=button)  # -> out, A; inputs path: String, create: Boolean; disabled
# ---------- createfolder: C# ----------
 
    
    if (create)
    {    
      if(!System.IO.Directory.Exists(path))
        System.IO.Directory.CreateDirectory(path);
    }
# ---------- end createfolder ----------
panel_9 = Panel(concat)  # disabled
panel_10 = Panel(concat_2)  # disabled
path = Data(panel_10)  # disabled

# ---- group: Sof_Meshing
button_2 = Button()  # disabled
toggle = BooleanToggle(True)  # disabled

# ----
panel_11 = Panel("10000")  # disabled
panel_12 = Panel("0.13")  # disabled
panel_13 = Panel("-0.005")  # disabled
panel_14 = Panel("1.8")  # disabled
assemble_mesh_properties_sofimesh = AssembleMeshPropertiesSofiMesh(
    GroupDivisor=panel_11,
    Topo="ON 0",
    TolG=panel_13,
    HMin=panel_12,
    Fein=panel_12,
    EFak=panel_14,
    Prog=panel_14,
    NodeIndex=1000)

# ----
# timb no 11 ep 17136[N/mm2] g 667[N/mm2] e90 370[N/mm2] g90 50[N/mm2] gam 7.2[KN/m3]
panel_15 = Panel("beech")  # disabled
# timb no 11 ep 12200[N/mm2] g 690[N/mm2] e90 370[N/mm2] g90 50[N/mm2] gam 4.8[KN/m3]
panel_16 = Panel("Süruce")  # disabled

# ---- group: AQUA
material = Panel("""KOPF
UNIT 5
NORM 'DIN' 'en199x-200x' COUN 49 UNIT 5

HOLZ 1    C '24:1' E90 370 BEZ "=Spruce"
ARBL EPS BRUC SIG 1.300000[-]
HMAT 1 TYP FOUR NSP 0.100000 A 1

HOLZ 4  PLY '40:1' TMAX 10 BEZ "=Plywood 40 Cl.1 (EN 1995)"
ARBL EPS BRUC SIG 1.200000[-]
HMAT 4 TYP FOUR NSP 0.100000 A 1

STAH 6    S '235' TMAX 40 BEZ "=S 235 (EN 10025-2)" GAM 0.0
ARBL EPS GEBR SIG 1[-]
ARBL EPS BRUC SIG 1[-] TYP  EXT
HMAT 3 TYP FOUR NSP 0 A 1

HOLZ NR 20 ep 1713[N/mm2] g 880[N/mm2] e90 1000[N/mm2] g90 61[N/mm2] gam 7.2[KN/m3]


HOLZ NR 10 ep 12200[N/mm2] g 690[N/mm2] e90 370[N/mm2] g90 50[N/mm2] gam 4.8[KN/m3]


HOLZ NR 11 ep 370[N/mm2] g 690[N/mm2] e90 12200[N/mm2] g90 50[N/mm2] gam 4.8[KN/m3]

MLAY NR 100  T0 {0}[mm]  11 $$
             T1 {1}[mm]  10 $$
             T2 {0}[mm]  11 Bez 'Bilayer'

MLAY NR 101  T0 {0}[mm]  11 $$
             T1 {1}[mm]  20 $$
             T2 {0}[mm]  11 Bez 'BilayerB'

MLAY NR 200  T0 {0}[mm]  11 $$
             T1 {1}[mm]  10 $$
	     T3 {0}[mm]  11 $$
             T4 {1}[mm]  10 $$
             T5 {0}[mm]  11 Bez '2Bilayer'

MLAY NR 201  T0 {0}[mm]  11 $$
             T1 {1}[mm]  20 $$
	     T3 {0}[mm]  11 $$
             T4 {1}[mm]  20 $$
             T5 {0}[mm]  11 Bez '2BilayerB'

MLAY NR 300  T0 {0}[mm]  11 $$
             T1 {1}[mm]  10 $$
	     T2 {0}[mm]  11 $$
             T3 {1}[mm]  10 $$
	     T4 {0}[mm]  11 $$
             T5 {1}[mm]  10 $$
             T6 {0}[mm]  11 Bez '3Bilayer'

MLAY NR 301  T0 {0}[mm]  11 $$
             T1 {1}[mm]  20 $$
	     T2 {0}[mm]  11 $$
             T3 {1}[mm]  20 $$
	     T4 {0}[mm]  11 $$
             T5 {1}[mm]  20 $$
             T6 {0}[mm]  11 Bez '3BilayerB'""")  # disabled
panel_17 = Panel("4")  # disabled
panel_18 = Panel("20")  # disabled
format = Format(Format=material, Culture=127, Data0=panel_17, Data1=panel_18)  # disabled
panel_19 = Panel(format)  # disabled
aqua_file = Data(panel_19)  # disabled

# ----
# Ase: +prog ase urs:5 $ SINGLE LCs
# kopf
# steu solv 4
# WARN = 120,575
# syst prob line iter 1000
# lf 1000 egz 1.0 bez 'G'
# ende
number_slider_9 = Slider(0.05, range=0..0.1)  # disabled

# ----
# ASE
ase = Panel("""+prog ase urs:5 $ SINGLE LCs
kopf
steu solv 4
WARN = 120,575
syst prob line iter 1000
lf 1000 egz 1.0 bez 'G'
ende""")  # disabled
# SLS: $--------------------------
# $SOLVER
# #define SOLV = 4 $4 = paralleles Rechnen
# #define WARN = 120,575
# $SYSTEM
# #define PROB = TH3
# #define nITER = 250
# #define FMAX = 1.1
# #define TOL = -0.0001
# #define NMAT = nein
# #define ITER = 3 W2 1 $3 W2 1 = Update Steifigkeit nach jedem Iterationsschritt
# $SEILE
# #define SEIL = 0 $0=ohne inneren Seildurchhang; 2=mit
# $Deadload
# #define G=1.00
# $--------------------------
# 
# +PROG ASE
# #define LF =100
# #define BEZ='1.0G+1.0Gadd'
# KOPF LF$(LF): $(BEZ)
# STEU SOLV $(SOLV) ; STEU ITER $(ITER) ; STEU SEIL $(SEIL)
# SYST PROB $(PROB) ITER $(nITER) FMAX $(FMAX) TOL $(TOL) NMAT $(NMAT)
# STEU WARN $(WARN)
# GRUP      -  $ alle Gruppen einschalten
# 
# LF $(LF) EGZ $(G)*1.0 BEZ $(BEZ)
# LC 1001 FAKT 1.0 $Gadd
# ENDE
# 
# +PROG ASE
# #define LF =101
# #define BEZ='1.0G+1.0Gadd+1.0Code'
# KOPF LF$(LF): $(BEZ)
# STEU SOLV $(SOLV) ; STEU ITER $(ITER) ; STEU SEIL $(SEIL)
# SYST PROB $(PROB) ITER $(nITER) FMAX $(FMAX) TOL $(TOL) NMAT $(NMAT)
# STEU WARN $(WARN)
# GRUP      -  $ alle Gruppen einschalten
# 
# LF $(LF) EGZ $(G)*1.0 BEZ $(BEZ)
# LC 1001 FAKT 1.0 $Gadd
# LC 1002 FAKT 1.0 $Code
# ENDE
# 
# +PROG ASE
# #define LF =102
# #define BEZ='1.0G+1.0Gadd+1.0Code+1.0Q1'
# KOPF LF$(LF): $(BEZ)
# STEU SOLV $(SOLV) ; STEU ITER $(ITER) ; STEU SEIL $(SEIL)
# SYST PROB $(PROB) ITER $(nITER) FMAX $(FMAX) TOL $(TOL) NMAT $(NMAT)
# STEU WARN $(WARN)
# GRUP      -  $ alle Gruppen einschalten
# 
# LF $(LF) EGZ $(G)*1.0 BEZ $(BEZ)
# LC 1001 FAKT 1.0 $Gadd
# LC 1002 FAKT 1.0 $Code
# LC 1003 FAKT 1.0 $Q1
# ENDE
sls = Panel("""$--------------------------
$SOLVER
#define SOLV = 4 $4 = paralleles Rechnen
#define WARN = 120,575
$SYSTEM
#define PROB = TH2
#define nITER = 250
#define FMAX = 1.1
#define TOL = -0.01
#define NMAT = nein
#define ITER = 3 W2 1 $3 W2 1 = Update Steifigkeit nach jedem Iterationsschritt
$SEILE
#define SEIL = 0 $0=ohne inneren Seildurchhang; 2=mit
$Deadload
#define G=1.00
$--------------------------

+PROG ASE
#define LF =101
#define BEZ='1.0G+1.0Gadd+1.0Code'
KOPF LF$(LF): $(BEZ)
STEU SOLV $(SOLV) ; STEU ITER $(ITER) ; STEU SEIL $(SEIL)
SYST PROB $(PROB) ITER $(nITER) FMAX $(FMAX) TOL $(TOL) NMAT $(NMAT)
STEU WARN $(WARN)
GRUP      -  $ alle Gruppen einschalten

LF $(LF) EGZ $(G)*1.0 BEZ $(BEZ)
LC 1001 FAKT 1.0 $Gadd
LC 1002 FAKT 1.0 $Code
ENDE""")  # disabled
# ULS: $--------------------------
# $SOLVER
# #define SOLV = 4 $4 = paralleles Rechnen
# #define WARN =  120,575
# $SYSTEM
# #define PROB = TH3
# #define nITER = 250
# #define FMAX = 1.1
# #define TOL = -0.0001
# #define NMAT = nein
# #define ITER = 3 W2 1 $3 W2 1 = Update Steifigkeit nach jedem Iterationsschritt
# $SEILE
# #define SEIL = 0 $0=ohne inneren Seildurchhang; 2=mit
# $Deadload
# #define G=1.00
# $--------------------------
# 
# +PROG ASE
# #define LF =200
# #define BEZ='1.35G+1.35Gadd'
# KOPF LF$(LF): $(BEZ)
# STEU SOLV $(SOLV) ; STEU ITER $(ITER) ; STEU SEIL $(SEIL)
# SYST PROB $(PROB) ITER $(nITER) FMAX $(FMAX) TOL $(TOL) NMAT $(NMAT)
# STEU WARN $(WARN)
# GRUP      -  $ alle Gruppen einschalten
# 
# LF $(LF) EGZ $(G)*1.35 BEZ $(BEZ)
# LC 1001 FAKT 1.35 $Gadd
# ENDE
# 
# +PROG ASE
# #define LF =201
# #define BEZ='1.35G+1.35Gadd+1.5Code'
# KOPF LF$(LF): $(BEZ)
# STEU SOLV $(SOLV) ; STEU ITER $(ITER) ; STEU SEIL $(SEIL)
# SYST PROB $(PROB) ITER $(nITER) FMAX $(FMAX) TOL $(TOL) NMAT $(NMAT)
# STEU WARN $(WARN)
# GRUP      -  $ alle Gruppen einschalten
# 
# LF $(LF) EGZ $(G)*1.35 BEZ $(BEZ)
# LC 1001 FAKT 1.35 $Gadd
# LC 1002 FAKT 1.5 $Code
# ENDE
# 
# +PROG ASE
# #define LF =202
# #define BEZ='1.35G+1.35Gadd+1.5Code+1.5Q1'
# KOPF LF$(LF): $(BEZ)
# STEU SOLV $(SOLV) ; STEU ITER $(ITER) ; STEU SEIL $(SEIL)
# SYST PROB $(PROB) ITER $(nITER) FMAX $(FMAX) TOL $(TOL) NMAT $(NMAT)
# STEU WARN $(WARN)
# GRUP      -  $ alle Gruppen einschalten
# 
# LF $(LF) EGZ $(G)*1.35 BEZ $(BEZ)
# LC 1001 FAKT 1.35 $Gadd
# LC 1002 FAKT 1.5 $Code
# LC 1003 FAKT 1.5 $Q1
# ENDE
uls = Panel("""$--------------------------
$SOLVER
#define SOLV = 4 $4 = paralleles Rechnen
#define WARN =  120,575
$SYSTEM
#define PROB = TH2
#define nITER = 250
#define FMAX = 1.1
#define TOL = -0.01
#define NMAT = nein
#define ITER = 3 W2 1 $3 W2 1 = Update Steifigkeit nach jedem Iterationsschritt
$SEILE
#define SEIL = 0 $0=ohne inneren Seildurchhang; 2=mit
$Deadload
#define G=1.00
$--------------------------

+PROG ASE
#define LF =201
#define BEZ='1.35G+1.35Gadd+1.5Code'
KOPF LF$(LF): $(BEZ)
STEU SOLV $(SOLV) ; STEU ITER $(ITER) ; STEU SEIL $(SEIL)
SYST PROB $(PROB) ITER $(nITER) FMAX $(FMAX) TOL $(TOL) NMAT $(NMAT)
STEU WARN $(WARN)
GRUP      -  $ alle Gruppen einschalten

LF $(LF) EGZ $(G)*1.35 BEZ $(BEZ)
LC 1001 FAKT 1.35 $Gadd
LC 1002 FAKT 1.5 $Code
ENDE""")  # disabled
merge_11 = Merge(Data1=ase, Data2=sls, Data3=uls)  # disabled

# ---- group: Loading / Random Point Load / Point Load
panel_20 = Panel("1003")  # disabled
panel_21 = Panel("pzz")  # disabled
panel_22 = Panel("-1.0")  # disabled

# ----
panel_23 = Panel("KF")  # disabled
toggle_2 = BooleanToggle(False)  # disabled
panel_24 = Panel("""101 SLS - Deform
202 ULS - Stresses""")  # disabled
number_slider_10 = Slider(6000, range=0..10000)  # disabled

# ---- group: Deformation / mm
kragarmlänge = Data()  # disabled
multiplication_10 = Multiplication(A=kragarmlänge, B=1000)  # disabled
panel_25 = Panel("150")  # disabled
division = Division(A=multiplication_10, B=panel_25)  # disabled
panel_26 = Panel(division)  # disabled

# ---- group: Manual Stress Calculation
panel_27 = Panel("400")  # disabled
panel_28 = Panel("5")  # disabled
panel_29 = Panel("20")  # disabled
panel_30 = Panel("5")  # disabled
panel_31 = Panel("11000")  # disabled
panel_32 = Panel("0.5")  # disabled
python_2 = GhPythonScript(E0=panel_31, E90=panel_27, t1=panel_28, t2=panel_29, nxx=panel_30, mxx=panel_32, nyy=panel_30, myy=panel_32)  # -> out, sigma_x_top, sigma_x_bot, sig_y_top_1, sig_y_int_1, sig_y_int_2, sig_y_bot_2; disabled
# ---------- python_2: Python ----------
import math 

# -------------- X direction -------------
Ax  = t2
Wxx = Ax*Ax/6

sigma_nx    = nxx / Ax
sigma_mxx   = mxx / Wxx * 1000
sigma_x_top = sigma_nx - sigma_mxx
sigma_x_bot = sigma_nx + sigma_mxx


# -------------- Y direction -------------
by_eq   = E90/E0
Ay_1    = t1
Ay_2    = t2 * by_eq
Ay_eq   = Ay_1 + Ay_2 
zg_y_1  = t1/2
zg_y_2  = t1 + t2/2
zg_y    = (zg_y_1 * Ay_1 + zg_y_2 * Ay_2) / Ay_eq
Iyy_1   = t1*t1*t1/12
Iyy_2   = t2*t2*t2/12*by_eq
Iyy     = Iyy_1 + Iyy_2 + math.pow(zg_y - zg_y_1,2)*Ay_1 + math.pow(zg_y - zg_y_2,2)*Ay_2

eps_y_top = myy / Iyy / E0 * (0 - zg_y) * 1000         + nyy / Ay_eq / E0
eps_y_int = myy / Iyy / E0 * (t1 - zg_y) * 1000        + nyy / Ay_eq / E0
eps_y_bot = myy / Iyy / E0 * (t1 + t2 - zg_y) * 1000   + nyy / Ay_eq / E0

sig_y_top_1 = eps_y_top * E0
sig_y_int_1 = eps_y_int * E0 
sig_y_int_2 = eps_y_int * E90 
sig_y_bot_2 = eps_y_bot * E90
# ---------- end python_2 ----------
panel_33 = Panel([python_2.sig_y_top_1, python_2.sig_y_int_1, python_2.sig_y_int_2, python_2.sig_y_bot_2])  # disabled

# ---- group: Manual Stress Calculation / Make sure you have used the same setting for analysis!
panel_34 = Panel("400")  # disabled
panel_35 = Panel("5")  # disabled
panel_36 = Panel("20")  # disabled
panel_37 = Panel("11000")  # disabled

# ----
panel_38 = Panel("150")  # disabled
panel_39 = Panel("150")  # disabled
number_slider_11 = Slider(0.1, range=0..1)  # disabled

number_slider_12 = Slider(28, range=0..436)  # disabled
fonts = FontTable()  # disabled
item_10 = ListItem(List=fonts, Index=number_slider_12, Wrap=True)  # disabled
panel_40 = Panel(item_10)  # disabled

crv_4 = Curve(dec_reg_3.Polyline)
area_3 = Area(Geometry=crv_4)  # -> Area, Centroid
avr = Average(Input=area_3.Centroid)
bbox_3 = BoundingBox(Content=flatten(avr), Plane=PlaneXY(0, 0, 0), UnionBox=True)  # -> Box, Box_2
debox_3 = DeconstructBox(Box=bbox_3.Box)  # -> Plane, X, Y, Z
dedomain_10 = DeconstructDomain(Domain=debox_3.X)  # -> Start, End
subtraction_3 = Subtraction(A=dedomain_10.End, B=dedomain_10.Start)

trim_2 = TrimTree(Tree=crv_4, Depth=1)

bbox_4 = BoundingBox(Content=trim_2, Plane=PlaneXY(0, 0, 0), UnionBox=True)  # -> Box, Box_2
debox_4 = DeconstructBox(Box=bbox_4.Box)  # -> Plane, X, Y, Z
dedomain_11 = DeconstructDomain(Domain=debox_4.X)  # -> Start, End
subtraction_4 = Subtraction(A=dedomain_11.End, B=dedomain_11.Start)
area_4 = Area(Geometry=bbox_4.Box)  # -> Area, Centroid
division_2 = Division(A=subtraction_4, B=subtraction_3)
scale = Scale(Geometry=avr, Center=area_4.Centroid, Factor=division_2)  # -> Geometry, Transform
yz = YZPlane(Origin=scale.Geometry)

num_15 = Number(num)
num_16 = Number(dec_reg_3.ThicknessBlendedRadius)
pln = Plane(yz)
c_script_4 = CSharpScript(iRadii=num_16, iBoardWidth=num_15, iPlanes=pln)  # -> out, simplify(A); inputs iRadii: tree of Double, iBoardWidth: Double, iPlanes: tree of Plane
# ---------- c_script_4: C# ----------
    DataTree<Point3d> pointTree = new DataTree<Point3d>();

    for (int j = 0; j < iRadii.BranchCount; j++)
    {

      //initialize variables
      Plane bp = iPlanes.Branch(j)[0];
      Point3d startPoint = new Point3d(bp.Origin);
      Point3d centerPoint = startPoint;
      Vector3d rotationAxis = new Vector3d(bp.ZAxis);
      Vector3d centerPointVect = new Vector3d(bp.YAxis);
      centerPointVect.Rotate(Math.PI / 2, rotationAxis);

      for (int i = 0; i < iRadii.Branch(j).Count; i++){
        GH_Path pth = iRadii.Paths[j].AppendElement(i);
        Point3d point1 = startPoint;
        Point3d point2 = startPoint;

        pointTree.Add(point1, pth);

        //calculate rotation angle
        Double arcLength = iBoardWidth;
        Double radius = iRadii.Branch(j)[i];
        Double rotation = (arcLength / radius);

        //calculate rotation center point
        centerPointVect.Unitize();
        centerPointVect *= radius;
        centerPoint += centerPointVect;


        //execute half rotation
        Transform tx = Transform.Rotation(rotation / 2, rotationAxis, centerPoint);


        point2.Transform(tx);
        pointTree.Add(point2, pth);

        //execute full rotation
        tx = Transform.Rotation(rotation, rotationAxis, centerPoint);
        startPoint.Transform(tx);
        pointTree.Add(startPoint, pth);

        //updata rotation parameters
        centerPoint = startPoint;
        centerPointVect.Transform(tx);
      }
    }
    A = pointTree;
# ---------- end c_script_4 ----------

trim_3 = TrimTree(Tree=c_script_4.A, Depth=1)
cullpt = CullDuplicates(Points=trim_3, Tolerance=0.1, CullMode=3)  # -> Points, Indices, Valence
pt_12 = Point(cullpt.Points)

# ---- group: animate
pt_13 = Point(simplify(pt_12))
pln_2 = Plane(graft(pln))
num_17 = Number(Slider(1, range=0..1))
c_script_5 = CSharpScript(iPoints=simplify(pt_13), iPlanes=pln_2, iShapeFactor=num_17)  # -> out, A; inputs iPoints: tree of Point3d, iPlanes: tree of Plane, iShapeFactor: Double
# ---------- c_script_5: C# ----------
    DataTree<Point3d> output = new DataTree<Point3d>();
    
    double shapeFactor = 1.0 - iShapeFactor;

    //step through curves
    for (int i = 0; i < iPoints.BranchCount; i++)
    {
      Plane currentPlane = iPlanes.Branch(iPoints.Path(i)[0])[0];

      //get vectors from plane
      Vector3d zVect = currentPlane.YAxis;

      Vector3d rotVect = currentPlane.ZAxis;

      //create new startpoint inside list
      Point3d startPoint = iPoints.Branch(i)[0];

      //step through points. Create and rotate vectors
      for (int j = 0; j < iPoints.Branch(i).Count; j++)
      {
        if (j == 0) output.Add(startPoint, iPoints.Path(i));
        else{
          //create current segment vector
          Vector3d segmentVect = new Vector3d(iPoints.Branch(i)[j] - iPoints.Branch(i)[j - 1]);

          //measure angle with vertical vector
          double angle = Vector3d.VectorAngle(zVect, segmentVect, currentPlane);

          //rotate
          segmentVect.Rotate(-angle * shapeFactor, rotVect);

          startPoint += segmentVect;
          output.Add(startPoint, iPoints.Path(i));
        }
      }
    }

    A = output;
# ---------- end c_script_5 ----------
pt_14 = Point(c_script_5.A)
intcrv_4 = Interpolate(Vertices=pt_14, Degree=3, Periodic=False, KnotStyle=1)  # -> Curve, Length, Domain
crv_5 = Curve(intcrv_4.Curve)

# ----
crv_6 = Curve(crv_5)
pt_15 = Point(simplify(graft(scale.Geometry)))
end = EndPoints(Curve=crv_6)  # -> Start, End
vec2pt = Vector2Pt(PointA=end.Start, PointB=end.End, Unitize=False)  # -> Vector, Length
yz_2 = YZPlane(Origin=end.Start)
Y_11 = UnitY(Factor="-1")
angle = Angle(VectorA=vec2pt.Vector, VectorB=Y_11, Plane=yz_2)  # -> Angle, Reflex
rotate = Rotate(Geometry=crv_6, Angle=angle.Angle, Plane=yz_2)  # -> Geometry, Transform
curvepoint = PointOnCurve(rotate.Geometry, parameter=0.5)
vec2pt_2 = Vector2Pt(PointA=curvepoint, PointB=pt_15, Unitize=False)  # -> Vector, Length
move_15 = Move(Geometry=rotate.Geometry, Motion=vec2pt_2.Vector)  # -> Geometry, Transform
path_mapper_2 = PathMapper(move_15.Geometry, source=["{A;B}", "{A}"], target=["{A}", "{0}"])
crv_7 = Curve(path_mapper_2)
loft = Loft(Curves=crv_7, Options={Adjust=False, Closed=False, LoftEnds=0, LoftSimp=0, LoftType=2, Rebuild=10, Refit=0.01})

bool = Boolean(relaxation)
cull_7 = CullPattern(List=loft, CullPattern=bool)
number_slider_13 = Slider(8, range=0..100)
srf = Surface(cull_7)
num_18 = Number(number_slider_4)
quads = QuadPanels(Surface=srf, UDivisions=number_slider_13, VDivisions=num_18)
srf_2 = Surface(reparameterize(simplify(quads)))

smesh = SimpleMesh(Brep=srf_2)
area_5 = MeshArea(Mesh=smesh)  # -> Area, Centroid
meshcp = MeshClosestPoint(Point=area_5.Centroid, Mesh=smesh)  # -> Point, Index, Parameter
meval = MeshEval(Mesh=smesh, Parameter=meshcp.Parameter)  # -> Point, Normal, Colour
pl = PlaneNormal(Origin=meval.Point, ZAxis=meval.Normal)
X = UnitX(Factor=1)
deplane = DeconstructPlane(Plane=pl)  # -> Origin, XAxis, YAxis, ZAxis
angle_2 = Angle(VectorA=deplane.XAxis, VectorB=X, Plane=pl)  # -> Angle, Reflex
rotate_2 = Rotate(Geometry=pl, Angle=angle_2.Angle, Plane=pl)  # -> graft(Geometry), Transform

medges = MeshEdges(Mesh=smesh)  # -> simplify(NakedEdges), InteriorEdges, NonManifoldEdges
curvepoint_2 = PointOnCurve(medges.NakedEdges, parameter=0.5)
plcoord = PlaneCoordinates(Point=curvepoint_2, System=rotate_2.Geometry)  # -> XCoordinate, YCoordinate, ZCoordinate
sort = SortList(Keys=plcoord.XCoordinate, ValuesA=medges.NakedEdges)  # -> Keys, ValuesA
item_11 = ListItem(List=reverse(sort.ValuesA), Index=0, Wrap=True)
item_12 = ListItem(List=sort.ValuesA, Index=0, Wrap=True)

merge_12 = Merge(Data1=item_12, Data2=item_11)
trim_4 = TrimTree(Tree=merge_12, Depth=1)
rdlines = RemoveDuplicateLinesKaramba3D(Line=trim_4, LimitDistance=0.005)  # -> OutLine, Info, Indexes
join_3 = JoinCurves(Curves=rdlines.OutLine, Preserve=False)
explode = Explode(Curve=join_3, Recursive=True)  # -> Segments, simplify(Vertices)
pline = PolyLine(Vertices=explode.Vertices, Closed=False)  # -> simplify(graft(Polyline))
path_mapper_3 = PathMapper(pline, source=["{A}", "{A;B}"], target=["{0}", "{A}"])
curvepoint_3 = PointOnCurve(path_mapper_3, parameter=0.5)
pdecon_7 = Deconstruct(Point=curvepoint_3)  # -> XComponent, YComponent, ZComponent
sort_2 = SortList(Keys=pdecon_7.XComponent, ValuesA=path_mapper_3)  # -> Keys, ValuesA
crv_8 = Curve(sort_2.ValuesA)

crv_9 = Curve(crv_8)
item_13 = ListItem(List=crv_9, Index=0, Wrap=True)
curvepoint_4 = PointOnCurve(crv_9, parameter=0.5)
curvepoint_5 = PointOnCurve(item_13, parameter=0.5)
vec2pt_3 = Vector2Pt(PointA=curvepoint_5, PointB=curvepoint_4, Unitize=False)  # -> Vector, Length
move_16 = Move(Geometry=item_13, Motion=vec2pt_3.Vector)  # -> Geometry, Transform

crv_10 = Curve(crv_8)
flip = FlipCurve(Curve=crv_10, Guide=move_16.Geometry)  # -> Curve, Flag

explode_2 = Explode(Curve=flip.Curve, Recursive=True)  # -> simplify(Segments), Vertices
explode_3 = Explode(Curve=move_16.Geometry, Recursive=True)  # -> simplify(Segments), Vertices
lng_3 = ListLength(List=explode_2.Segments)
lng_4 = ListLength(List=explode_2.Segments)
lng_5 = ListLength(List=explode_3.Segments)
lng_6 = ListLength(List=explode_3.Segments)
subtraction_5 = Subtraction(A=lng_3, B=2)
subtraction_6 = Subtraction(A=lng_4, B=1)
subtraction_7 = Subtraction(A=lng_5, B=2)
subtraction_8 = Subtraction(A=lng_6, B=1)
dom_6 = ConstructDomain(DomainStart=0, DomainEnd=subtraction_5)
dom_7 = ConstructDomain(DomainStart=1, DomainEnd=subtraction_6)
dom_8 = ConstructDomain(DomainStart=0, DomainEnd=subtraction_7)
dom_9 = ConstructDomain(DomainStart=1, DomainEnd=subtraction_8)
subset_2 = SubList(List=explode_2.Segments, Domain=dom_6, Wrap=True)  # -> List, Index
subset_3 = SubList(List=explode_2.Segments, Domain=dom_7, Wrap=True)  # -> List, Index
subset_4 = SubList(List=explode_3.Segments, Domain=dom_8, Wrap=True)  # -> List, Index
subset_5 = SubList(List=explode_3.Segments, Domain=dom_9, Wrap=True)  # -> List, Index
angle_3 = Angle(VectorA=subset_4.List, VectorB=subset_5.List)  # -> simplify(Angle), Reflex
angle_4 = Angle(VectorA=subset_2.List, VectorB=subset_3.List)  # -> simplify(Angle), Reflex
num_19 = Number(angle_3.Angle)
num_20 = Number(angle_4.Angle)

explode_4 = Explode(Curve=flip.Curve, Recursive=True)  # -> simplify(Segments), Vertices
explode_5 = Explode(Curve=move_16.Geometry, Recursive=True)  # -> simplify(Segments), Vertices
path_mapper_4 = PathMapper(explode_4.Segments, source=["{A}(i)", "{A;B}(i)"], target=["{i}(A)", "{A;i}(B)"])
path_mapper_5 = PathMapper(explode_5.Segments, source=["{A}(i)", "{A;B}(i)"], target=["{i}(A)", "{A;i}(B)"])
crv_11 = Curve(path_mapper_5)
crv_12 = Curve(path_mapper_4)
lng_7 = ListLength(List=crv_12)  # -> expr("x-2", Length)
lng_8 = ListLength(List=crv_11)  # -> expr("x-2", Length)
lng_9 = ListLength(List=crv_12)  # -> expr("x-1", Length)
lng_10 = ListLength(List=crv_11)  # -> expr("x-1", Length)
dom_10 = ConstructDomain(DomainStart=0, DomainEnd=lng_7)
dom_11 = ConstructDomain(DomainStart=0, DomainEnd=lng_8)
dom_12 = ConstructDomain(DomainStart=1, DomainEnd=lng_9)
dom_13 = ConstructDomain(DomainStart=1, DomainEnd=lng_10)
subset_6 = SubList(List=crv_12, Domain=dom_10, Wrap=True)  # -> graft(List), Index
subset_7 = SubList(List=crv_11, Domain=dom_11, Wrap=True)  # -> graft(List), Index
subset_8 = SubList(List=crv_12, Domain=dom_12, Wrap=True)  # -> graft(List), Index
subset_9 = SubList(List=crv_11, Domain=dom_13, Wrap=True)  # -> graft(List), Index
loft_2 = Loft(
    Curves=[subset_6.List, subset_8.List],
    Options={Adjust=False, Closed=False, LoftEnds=0, LoftSimp=0, LoftType=0, Rebuild=10, Refit=0.01})  # -> simplify(Loft)
loft_3 = Loft(
    Curves=[subset_7.List, subset_9.List],
    Options={Adjust=False, Closed=False, LoftEnds=0, LoftSimp=0, LoftType=0, Rebuild=10, Refit=0.01})  # -> simplify(Loft)
smesh_2 = SimpleMesh(Brep=loft_2)
smesh_3 = SimpleMesh(Brep=loft_3)
path_mapper_6 = PathMapper(smesh_3, source=["{A;B;C}", "{A;B}"], target=["{A}", "{0}"])
path_mapper_7 = PathMapper(smesh_2, source=["{A;B;C}", "{A;B}"], target=["{A}", "{0}"])
mjoin = MeshJoin(Meshes=path_mapper_6)
mjoin_2 = MeshJoin(Meshes=path_mapper_7)
weld = WeldMesh(Mesh=mjoin, Angle=3.141592654)
weld_2 = WeldMesh(Mesh=mjoin_2, Angle=3.141592654)

explode_6 = Explode(Curve=move_16.Geometry, Recursive=True)  # -> Segments, Vertices
num_21 = Number(num_20)
num_22 = Number(num_19)
mesh = Mesh(weld)
path_mapper_8 = PathMapper(explode_6.Vertices, source=["{A;B}(i)", "{A}(i)"], target=["{A;i}(B)", "{i}(A)"])
division_3 = Division(A=num_21, B=num_22)
avr_2 = Average(Input=division_3)
number_slider_14 = Slider(100, range=0..100000)
pline_2 = PolyLine(Vertices=path_mapper_8, Closed=False)  # -> simplify(Polyline)
path_mapper_9 = PathMapper(pline_2, source=["{A;B}", "{A}"], target=["{A}", "{0}"])
crv_13 = Curve(move_16.Geometry)
show = Show(G=mesh)
rod = Rod(
    Polyline=path_mapper_9,
    LengthFactor=1,
    AngleFactor=1,
    AxialStrength=number_slider_14,
    BendStrength=Slider(1, range=0..10000))
path_mapper_10 = PathMapper(rod, source=["{A;B}", "{A}"], target=["{A}", "{0}"])

path_mapper_11 = PathMapper(avr_2, source=["{A}", "{A;B}"], target=["{0}", "{A}"])

rod_2 = Rod(
    Polyline=crv_13,
    LengthFactor=1,
    AngleFactor=path_mapper_11,
    AxialStrength=number_slider_14,
    BendStrength=Slider(10000, range=0..10000))
path_mapper_12 = PathMapper(rod_2, source=["{A;B}", "{A}"], target=["{A}", "{0}"])
merge_13 = Merge(Data1=path_mapper_10, Data2=path_mapper_12, Data3=show)

zombiesolver = ZombieSolver(GoalObjects=merge_13, Threshold=1e-10, Tolerance=0.0001, MaxIterations=Slider(1, range=0..100000))  # -> I, V, O
mesh_2 = Mesh(zombiesolver.O)
clean = CleanTree(RemoveNulls=True, RemoveInvalid=True, RemoveEmpty=False, Tree=mesh_2)

wbedges = WeaverbirdsMeshEdges(MeshOrPolylines=graft(clean))  # -> simplify(Lines)
mesh_3 = Mesh(simplify(graft(clean)))

wbedges_2 = WeaverbirdsMeshEdges(MeshOrPolylines=weld_2)  # -> simplify(Lines)
line = Line(wbedges)
group_2 = Group(Objects=line)  # -> flatten(Group)
len_2 = Length(Curve=wbedges_2)
len_3 = Length(Curve=line)
lng_11 = ListLength(List=group_2)
subtraction_9 = Subtraction(A=len_3, B=len_2)
series_4 = Series(Start=0, Step=Slider(1330, range=0..10000), Count=lng_11)
smaller_2 = SmallerThan(FirstNumber=subtraction_9, SecondNumber=0)  # -> SmallerThan, OrEqualTo
dispatch = Dispatch(List=subtraction_9, DispatchPattern=smaller_2.SmallerThan)  # -> ListA, ListB
Y_12 = UnitY(Factor=series_4)
Y_13 = UnitY(Factor=Slider(5928, range=0..10000))
move_17 = Move(Geometry=group_2, Motion=Y_12)  # -> Geometry, Transform
bnd_8 = Bounds(Numbers=dispatch.ListA)
bnd_9 = Bounds(Numbers=dispatch.ListB)
move_18 = Move(Geometry=move_17.Geometry, Motion=Y_13)  # -> Geometry, Transform
dedomain_12 = DeconstructDomain(Domain=bnd_9)  # -> Start, End
dedomain_13 = DeconstructDomain(Domain=bnd_8)  # -> Start, End
X_2 = UnitX(Factor=Slider(7456, range=0..10000))
move_19 = Move(Geometry=move_18.Geometry, Motion=X_2)  # -> Geometry, Transform
gradient_5 = Gradient(
    LowerLimit=dedomain_13.Start,
    UpperLimit=dedomain_13.End,
    Parameter=dispatch.ListA,
    stops=[0: RGB(75, 107, 169), 0.501: RGB(173, 203, 249), 1: RGB(254, 244, 84)])
gradient_6 = Gradient(
    LowerLimit=dedomain_12.Start,
    UpperLimit=dedomain_12.End,
    Parameter=dispatch.ListB,
    stops=[0: RGB(254, 244, 84), 0.499: RGB(234, 126, 0), 1: RGB(234, 38, 0), 1: RGB(75, 107, 169), 1: RGB(173, 203, 249)])
ungroup_2 = Ungroup(Group=move_19.Geometry)
dispatch_2 = Dispatch(List=ungroup_2, DispatchPattern=smaller_2.SmallerThan)  # -> ListA, ListB
previewlw = CustomPreviewLineweights(Geometry=dispatch_2.ListA, Shader=gradient_5, Thickness=3, Absolute=False)
previewlw_2 = CustomPreviewLineweights(Geometry=dispatch_2.ListB, Shader=gradient_6, Thickness=3, Absolute=False)

crv_14 = Curve(wbedges)
end_2 = EndPoints(Curve=crv_14)  # -> Start, End
pdecon_8 = Deconstruct(Point=end_2.Start)  # -> XComponent, YComponent, ZComponent
pdecon_9 = Deconstruct(Point=end_2.End)  # -> XComponent, YComponent, ZComponent
subtraction_10 = Subtraction(A=pdecon_8.XComponent, B=pdecon_9.XComponent)
abs = Absolute(Value=subtraction_10)
smaller_3 = SmallerThan(FirstNumber=abs, SecondNumber=Slider(100, range=0..100))  # -> SmallerThan, OrEqualTo
cull_8 = CullPattern(List=crv_14, CullPattern=smaller_3.SmallerThan)
join_4 = JoinCurves(Curves=cull_8, Preserve=False)
curvepoint_6 = PointOnCurve(join_4, parameter=0.5)
pdecon_10 = Deconstruct(Point=curvepoint_6)  # -> XComponent, YComponent, ZComponent
sort_3 = SortList(Keys=pdecon_10.XComponent, ValuesA=join_4)  # -> Keys, ValuesA
explode_7 = Explode(Curve=sort_3.ValuesA, Recursive=True)  # -> Segments, simplify(Vertices)
intcrv_5 = Interpolate(Vertices=explode_7.Vertices, Degree=3, Periodic=False, KnotStyle=1)  # -> Curve, Length, Domain
path_mapper_13 = PathMapper(intcrv_5.Curve, source=["{A;B}", "{A}"], target=["{A}", "{0}"])
loft_4 = Loft(Curves=path_mapper_13, Options={Adjust=False, Closed=False, LoftEnds=0, LoftSimp=0, LoftType=0, Rebuild=10, Refit=0.01})

mesh_4 = Mesh(mesh_3)
num_23 = Number(expr("x+1", number_slider_13))
medges_2 = MeshEdges(Mesh=mesh_4)  # -> NakedEdges, InteriorEdges, NonManifoldEdges
demesh = DeconstructMesh(Mesh=mesh_4)  # -> Vertices, Faces, Colours, Normals
join_5 = JoinCurves(Curves=medges_2.NakedEdges, Preserve=False)
patch = Patch(Curves=join_5, Points=demesh.Vertices, Spans=num_23, Flexibility=Slider(1, range=0..1), Trim=True)
srf_3 = Surface(simplify(patch))

# ---- group: control gate
srf_4 = Surface(loft_4)
srf_5 = Surface(loft)
bool_2 = Boolean(relaxation)
not_2 = GateNot(A=bool_2)
cull_9 = CullPattern(List=srf_5, CullPattern=not_2)
merge_14 = Merge(Data1=srf_4, Data2=cull_9)

# ----
srf_6 = Surface(merge_14)
edges = BrepEdges(Brep=srf_6)  # -> Naked, Interior, NonManifold
len_4 = Length(Curve=edges.Naked)
sort_4 = SortList(Keys=len_4, ValuesA=edges.Naked)  # -> Keys, reverse(ValuesA)
item_14 = ListItem(List=sort_4.ValuesA, Index=0, Wrap=True)  # -> Item, Item1
flip_2 = FlipCurve(Curve=item_14.Item1)  # -> Curve, Flag
merge_15 = Merge(Data1=item_14.Item, Data2=flip_2.Curve)
divide_2 = DivideCurve(Curve=merge_15, Count=Slider(100, range=0..100), Kinks=False)  # -> Points, Tangents, Parameters
path_mapper_14 = PathMapper(divide_2.Points, source="{A;B;C}(i)", target="{A;B;i}(C)")
item_15 = ListItem(List=path_mapper_14, Index=0, Wrap=True)  # -> Item, Item1
dist = Distance(PointA=item_15.Item, PointB=item_15.Item1)
trim_5 = TrimTree(Tree=dist, Depth=1)
bnd_10 = Bounds(Numbers=trim_5)
dedomain_14 = DeconstructDomain(Domain=bnd_10)  # -> simplify(Start), End
multiplication_11 = Multiplication(A=dedomain_14.Start, B=Slider(0.95, range=0..1))  # -> flatten(Result)
c_script_6 = CSharpScript(x=multiplication_11)  # -> out, A; inputs x: list of Double
# ---------- c_script_6: C# ----------
    List<double> output = new List<double>();
    
    double currentVal = 0;
    for(int i = 0; i < x.Count; i++)
    {
      output.Add(currentVal);
      currentVal += x[i];
    }
    A = output;
# ---------- end c_script_6 ----------
Y_14 = UnitY(Factor=c_script_6.A)
move_20 = Move(Geometry=srf_6, Motion=Y_14)  # -> Geometry, Transform

mesh_5 = Mesh(mesh_3)
mesh_6 = Mesh(flatten(mesh_5))
c_script_7 = CSharpScript(mesh=mesh_5, surface=srf_3)  # -> out, Curvature; inputs mesh: Mesh, surface: Surface
# ---------- c_script_7: C# ----------
        //get surface gaussian curvature at each mesh point
        List<double> gaussianCurvatures = new List<double>();
        double maxGaussian = 0;
        double minGaussian = double.MaxValue;

        double U;
        double V;

        for (int i = 0; i < mesh.Vertices.Count; i++)
        {
            Point3d currentMeshPoint = mesh.Vertices.Point3dAt(i);
            surface.ClosestPoint(currentMeshPoint, out U, out V);
            SurfaceCurvature surfaceCurvature = surface.CurvatureAt(U, V);
            double gaussian = surfaceCurvature.Gaussian;
            gaussianCurvatures.Add(gaussian);

            //get the range of curvatures
            if (gaussian > maxGaussian) maxGaussian = gaussian;
            if( gaussian < minGaussian) minGaussian = gaussian;
        }


        //get the range of curvatures


        //remap the curvatures to color values on the mesh points
        for (int i = 0; i < mesh.Vertices.Count; i++)
        {
            double hue = (gaussianCurvatures[i] - minGaussian) / (0 - minGaussian) * (0.5 - maxGaussian) + maxGaussian;
        }
        Curvature = gaussianCurvatures;
# ---------- end c_script_7 ----------
move_21 = Move(Geometry=mesh_6, Motion=Y_14)  # -> simplify(graft(Geometry)), Transform
num_24 = Number(c_script_7.Curvature)
Y_15 = UnitY(Factor=Slider(2905, range=0..10000))
bnd_11 = Bounds(Numbers=num_24)
mesh_7 = Mesh(move_21.Geometry)
dedomain_15 = DeconstructDomain(Domain=bnd_11)  # -> Start, End
move_22 = Move(Geometry=mesh_7, Motion=Y_15)  # -> Geometry, Transform
X_3 = UnitX(Factor=Slider(7456, range=0..10000))
gradient_7 = Gradient(
    LowerLimit=dedomain_15.Start,
    UpperLimit=dedomain_15.End,
    Parameter=num_24,
    stops=[0: RGB(0, 128, 0), 0.5: RGB(255, 255, 0), 1: RGB(255, 0, 0)])
move_23 = Move(Geometry=move_22.Geometry, Motion=X_3)  # -> Geometry, Transform
c_script_8 = CSharpScript(mesh=move_23.Geometry, colors=simplify(gradient_7))  # -> out, A; inputs mesh: Mesh, colors: list of Color
# ---------- c_script_8: C# ----------
    for(int i = 0; i < mesh.Vertices.Count; i++)
    {
      mesh.VertexColors.SetColor(i, colors[i]);
    }
    A = mesh;
# ---------- end c_script_8 ----------

gaussian_curvature = Panel(bnd_11)
relaxation_2 = Panel(bnd_8)

crv_15 = Curve(dec_reg_4.Polyline)
srf_7 = Surface(reparameterize(simplify(graft(merge_14))))
rec_4 = Rectangle(rectangle.Rectangle)
explode_8 = Explode(Curve=crv_15, Recursive=True)  # -> Segments, Vertices
path_mapper_15 = PathMapper(crv_15, source=["{A;B}", "{A}", "{A;B;C}"], target=["{A}", "{0}", "{A}"])
len_5 = Length(Curve=explode_8.Segments)
division_4 = Division(A=len_5, B=Slider(100, range=0..100))
divide_3 = DivideCurve(Curve=explode_8.Segments, Count=division_4, Kinks=False)  # -> Points, Tangents, Parameters
path_mapper_16 = PathMapper(divide_3.Points, source=["{A;B;C;D}", "{A;B;C}", "{A;B;C;D;E}"], target=["{A}", "{0}", "{A}"])

tstat = TreeStatistics(Tree=path_mapper_15)  # -> Paths, Length, Count
lng_12 = ListLength(List=tstat.Paths)
dup_6 = DuplicateData(Data=rec_4, Number=lng_12, Order=True)  # -> graft(Data)

srf_8 = Surface(reparameterize(simplify(dup_6)))
srf_cp = SurfaceClosestPoint(Point=path_mapper_16, Surface=srf_8)  # -> Point, UVPoint, Distance
evalsrf = EvaluateSurface(Surface=reparameterize(srf_7), Point=srf_cp.UVPoint)  # -> Point, Normal, UDirection, VDirection, Frame
c_script_9 = CSharpScript(trimmedTree=evalsrf.Point, originalTree=divide_3.Points)  # -> out, A; inputs trimmedTree: tree, originalTree: tree
# ---------- c_script_9: C# ----------
    if(originalTree.DataCount != trimmedTree.DataCount) Component.AddRuntimeMessage(GH_RuntimeMessageLevel.Error, "Number of items in both trees must be equal");

    DataTree<object> outputs = new DataTree<object>();
    List<GH_Path> paths = GetPaths(originalTree);
    //step through trimmed tree objects and add them to output tree with the correct

    int counter = 0;
    for(int i = 0; i < trimmedTree.BranchCount; i++)
    {
      for(int j = 0; j < trimmedTree.Branch(i).Count; j++)
      {
        outputs.Add(trimmedTree.Branch(i)[j], paths[counter]);
        counter++;
      }
    }
    A = outputs;
# ---------- c_script_9: C# additional code ----------
  public List<GH_Path> GetPaths(DataTree<object> originalTree)
  {
    List<GH_Path> output = new List<GH_Path>();
    for(int i = 0; i < originalTree.BranchCount; i++)
    {
      for(int j = 0; j < originalTree.Branch(i).Count; j++)
      {
        output.Add(originalTree.Paths[i]);
      }
    }
    return output;
  }
# ---------- end c_script_9 ----------
intcrv_6 = Interpolate(Vertices=c_script_9.A, Degree=3, Periodic=False, KnotStyle=1)  # -> Curve, Length, Domain
trim_6 = TrimTree(Tree=intcrv_6.Curve, Depth=1)
join_6 = JoinCurves(Curves=trim_6, Preserve=False)  # -> simplify(Curves)
path_mapper_17 = PathMapper(join_6, source=["{A;B;C}", "{A;B}", "{A;B;C;D}"], target=["{A}", "{0}", "{A}"])
crv_16 = Curve(path_mapper_17)
explode_9 = Explode(Curve=crv_16, Recursive=True)  # -> Segments, Vertices
item_16 = ListItem(List=explode_9.Segments, Index=0, Wrap=True)  # -> Item, Item1, Item2, Item3
flip_3 = FlipCurve(Curve=item_16.Item3)  # -> Curve, Flag
merge_16 = Merge(Data1=item_16.Item1, Data2=flip_3.Curve)
loft_5 = Loft(Curves=merge_16, Options={Adjust=False, Closed=False, LoftEnds=0, LoftSimp=0, LoftType=0, Rebuild=10, Refit=0.01})
path_mapper_18 = PathMapper(loft_5, source=["{A}", "{A;B}"], target=["{0}", "{A}"])
c_script_10 = CSharpScript(trimmedTree=path_mapper_18, originalTree=join_6)  # -> out, A; inputs trimmedTree: tree, originalTree: tree; same code as c_script_9

trim_7 = TrimTree(Tree=c_script_10.A, Depth=2)
vec_5 = Vector(Y_14)
join_7 = BrepJoin(Breps=trim_7)  # -> Breps, Closed
trim_8 = TrimTree(Tree=join_7.Breps, Depth=1)
item_17 = ListItem(List=trim_8, Index=0, Wrap=True)  # -> flatten(Item)
move_24 = Move(Geometry=item_17, Motion=vec_5)  # -> simplify(graft(Geometry)), Transform

srf_9 = Surface(move_20.Geometry)
number_slider_15 = Slider(30, range=0..100)

flip_4 = FlipMatrix(Data=srf_9)
item_18 = ListItem(List=flip_4, Index=0, Wrap=True)

shift_2 = ShiftList(List=item_18, Shift=1, Wrap=True)
shift_3 = ShiftList(List=item_18, Shift=-1, Wrap=True)
bbx = BrepBrep(BrepA=item_18, BrepB=shift_3)  # -> Curves, Points
bbx_2 = BrepBrep(BrepA=item_18, BrepB=shift_2)  # -> Curves, Points
merge_17 = Merge(Data1=bbx_2.Curves, Data2=bbx.Curves)  # -> simplify(Result)
srf_10 = Surface(simplify(graft(item_18)))
ext = ExtendCurve(Curve=merge_17, Type=0, Start=number_slider_15, End=number_slider_15)
srfsplit = SurfaceSplit(Surface=srf_10, Curves=ext)  # -> simplify(Fragments)
area_6 = Area(Geometry=srfsplit)  # -> Area, Centroid
area_7 = Area(Geometry=srf_10)  # -> Area, Centroid
dist_2 = Distance(PointA=area_7.Centroid, PointB=area_6.Centroid)
sort_5 = SortList(Keys=dist_2, ValuesA=srfsplit)  # -> Keys, ValuesA
item_19 = ListItem(List=sort_5.ValuesA, Index=0, Wrap=True)  # -> flatten(Item)
clean_2 = CleanTree(RemoveNulls=True, RemoveInvalid=True, RemoveEmpty=False, Tree=item_19)

srf_11 = Surface(clean_2)

item_20 = ListItem(List=srf_11, Index=0, Wrap=True)
item_21 = ListItem(List=srf_11, Index=1, Wrap=True)
number_slider_16 = Slider(1000, range=0..1000)
bbx_3 = BrepBrep(BrepA=item_20, BrepB=item_21)  # -> Curves, Points
ext_2 = ExtendCurve(Curve=bbx_3.Curves, Type=0, Start=number_slider_16, End=number_slider_16)
Y_16 = UnitY(Factor=Slider(10000, range=0..10000))
neg_8 = Negative(Value=Y_16)
extr = Extrude(Base=ext_2, Direction=neg_8)
split = SplitBrep(Brep=item_20, Cutter=extr)
area_8 = Area(Geometry=split)  # -> Area, Centroid
pdecon_11 = Deconstruct(Point=area_8.Centroid)  # -> XComponent, YComponent, ZComponent
sort_6 = SortList(Keys=pdecon_11.ZComponent, ValuesA=split)  # -> Keys, reverse(ValuesA)
item_22 = ListItem(List=sort_6.ValuesA, Index=0, Wrap=True)

item_23 = ListItem(List=reverse(srf_11), Index=0, Wrap=True)
item_24 = ListItem(List=reverse(srf_11), Index=1, Wrap=True)
number_slider_17 = Slider(1000, range=0..1000)
bbx_4 = BrepBrep(BrepA=item_23, BrepB=item_24)  # -> Curves, Points
ext_3 = ExtendCurve(Curve=bbx_4.Curves, Type=0, Start=number_slider_17, End=number_slider_17)
Y_17 = UnitY(Factor=Slider(10000, range=0..10000))
extr_2 = Extrude(Base=ext_3, Direction=Y_17)
split_2 = SplitBrep(Brep=item_23, Cutter=extr_2)
area_9 = Area(Geometry=split_2)  # -> Area, Centroid
pdecon_12 = Deconstruct(Point=area_9.Centroid)  # -> XComponent, YComponent, ZComponent
sort_7 = SortList(Keys=pdecon_12.ZComponent, ValuesA=split_2)  # -> Keys, reverse(ValuesA)
item_25 = ListItem(List=sort_7.ValuesA, Index=0, Wrap=True)

srf_12 = Surface(srf_11)
lng_13 = ListLength(List=srf_12)
dom_14 = ConstructDomain(DomainStart=1, DomainEnd=expr("x-2", lng_13))
larger = LargerThan(FirstNumber=lng_13, SecondNumber=2)  # -> LargerThan, OrEqualTo
subset_10 = SubList(List=srf_12, Domain=dom_14, Wrap=True)  # -> List, Index
cull_10 = CullPattern(List=subset_10.List, CullPattern=larger.LargerThan)

lng_14 = ListLength(List=srf_11)  # -> expr("x-1", Length)
merge_18 = Merge(Data1=flatten(item_22), Data2=flatten(cull_10), Data3=flatten(item_25))
dom_15 = ConstructDomain(DomainStart=0, DomainEnd=lng_14)
subset_11 = SubList(List=merge_18, Domain=dom_15, Wrap=True)  # -> List, Index

srf_13 = Surface(graft(subset_11.List))
debrep = DeconstructBrep(Brep=move_24.Geometry)  # -> simplify(Faces), Edges, Vertices
edges_2 = BrepEdges(Brep=srf_13)  # -> simplify(Naked), Interior, NonManifold
srf_14 = Surface(graft(debrep.Faces))
division_5 = Division(A=num, B=2)
area_10 = Area(Geometry=srf_14)  # -> Area, Centroid
join_8 = JoinCurves(Curves=edges_2.Naked, Preserve=False)  # -> simplify(Curves)
addition = Addition(A=division_5, B=Slider(2, range=0..10))

trim_9 = TrimTree(Tree=area_10.Centroid, Depth=1)

crv_cp = CurveClosestPoint(Point=trim_9, Curve=join_8)  # -> Point, Parameter, Distance
larger_2 = LargerThan(FirstNumber=crv_cp.Distance, SecondNumber=addition)  # -> graft(LargerThan), OrEqualTo
dispatch_3 = Dispatch(List=srf_14, DispatchPattern=larger_2.LargerThan)  # -> ListA, ListB

srf_15 = Surface(simplify(dispatch_3.ListB))
srf_16 = Surface(dispatch_3.ListA)
clean_3 = CleanTree(RemoveNulls=True, RemoveInvalid=True, RemoveEmpty=True, Tree=srf_15)
trim_10 = TrimTree(Tree=clean_3, Depth=1)
lng_15 = ListLength(List=trim_10)
dup_7 = DuplicateData(Data=join_8, Number=lng_15, Order=True)
srf_17 = Surface(flatten(trim_10))
crv_17 = Curve(flatten(dup_7))
c_script_11 = CSharpScript(surfaces=srf_17, curves=crv_17)  # -> out, A; inputs surfaces: list of Brep, curves: list of Curve
# ---------- c_script_11: C# ----------
    var splitBreps = ParallelSplit(surfaces, curves);

    DataTree<Brep> output = new DataTree<Brep>();
    for(int i = 0; i < splitBreps.Length; i++)
    {
      GH_Path path = new GH_Path(i);
      output.AddRange(splitBreps[i], path);
    }
    A = output;
# ---------- c_script_11: C# additional code ----------
  private Brep[][] ParallelSplit(List<Brep> breps, List<Curve> curves)
  {
    if(breps.Count != curves.Count)
    {
      Component.AddRuntimeMessage(GH_RuntimeMessageLevel.Error, "list lengths must be equal");
      return null;
    }

    Brep[][] splitBreps = new Brep[breps.Count][];

    
    System.Threading.Tasks.Parallel.For(0, breps.Count, i =>
      {
      Brep[] results = new Brep[0];
      int tolerance = 0;
      while(tolerance < 30 && results.Length < 2)
      {
        results = breps[i].Split(new Curve[1]{curves[i]}, tolerance);
        tolerance++;
        RhinoApp.WriteLine(tolerance.ToString());
      }
      splitBreps[i] = results;
      });
    return splitBreps;
  }
# ---------- end c_script_11 ----------
match = MatchTree(Tree=c_script_11.A, Guide=clean_3)
merge_19 = Merge(Data1=simplify(srf_16), Data2=simplify(match))

srf_18 = Surface(merge_19)
xy_2 = XYPlane(Origin=Point(0, 0, 0))
srf_19 = Surface(graft(subset_11.List))
area_11 = Area(Geometry=srf_18)  # -> Area, Centroid
trim_11 = TrimTree(Tree=area_11.Centroid, Depth=1)
project = Project(Geometry=srf_19, Plane=xy_2)  # -> simplify(Geometry), Transform
project_2 = Project(Geometry=trim_11, Plane=xy_2)  # -> Geometry, Transform
lng_16 = ListLength(List=area_11.Centroid)
srf_cp_2 = SurfaceClosestPoint(Point=project_2.Geometry, Surface=project.Geometry)  # -> Point, UVPoint, Distance
trim_12 = TrimTree(Tree=lng_16, Depth=1)
partition = PartitionList(List=simplify(srf_cp_2.Distance), Size=trim_12)
smaller_4 = SmallerThan(FirstNumber=partition, SecondNumber=Slider(1, range=0..10))  # -> SmallerThan, OrEqualTo
cull_11 = CullPattern(List=srf_18, CullPattern=smaller_4.SmallerThan)

area_12 = Area(Geometry=cull_11)  # -> Area, Centroid
pdecon_13 = Deconstruct(Point=area_12.Centroid)  # -> XComponent, YComponent, ZComponent
sort_8 = SortList(Keys=pdecon_13.ZComponent, ValuesA=cull_11)  # -> Keys, reverse(ValuesA)
item_26 = ListItem(List=sort_8.ValuesA, Index=0, Wrap=True)
lng_17 = ListLength(List=item_26)
equals = Equality(FirstNumber=lng_17, SecondNumber=0)  # -> Equality, Inequality
srf_20 = Surface(item_26)

# ---- group: support points
srf_21 = Surface(graft(subset_11.List))
srf_22 = Surface(srf_20)
explode_10 = Explode(Curve=srf_21, Recursive=True)  # -> Segments, Vertices
debrep_2 = DeconstructBrep(Brep=srf_22)  # -> Faces, Edges, Vertices
curvepoint_7 = PointOnCurve(explode_10.Segments, parameter=0.5)
trim_13 = TrimTree(Tree=simplify(debrep_2.Vertices), Depth=1)
pdecon_14 = Deconstruct(Point=curvepoint_7)  # -> XComponent, YComponent, ZComponent
sort_9 = SortList(Keys=pdecon_14.XComponent, ValuesA=explode_10.Segments)  # -> Keys, ValuesA
item_27 = ListItem(List=sort_9.ValuesA, Index=0, Wrap=True)  # -> simplify(Item)
crv_cp_2 = CurveClosestPoint(Point=trim_13, Curve=item_27)  # -> Point, Parameter, Distance
smaller_5 = SmallerThan(FirstNumber=crv_cp_2.Distance, SecondNumber=Slider(10, range=0..10))  # -> SmallerThan, OrEqualTo
cull_12 = CullPattern(List=trim_13, CullPattern=smaller_5.SmallerThan)
cullpt_2 = CullDuplicates(Points=cull_12, Tolerance=0.1, CullMode=3)  # -> simplify(Points), Indices, Valence

# ---- group: boards
srf_23 = Surface(reverse(srf_20))

# ----
data_8 = Data(cull_6)
data_9 = Data(species_2)
dec_panel_buildups = DeconstructPanelBuildup(Panels=data_8)  # -> WoodSpecies, Thicknesses
tstat_2 = TreeStatistics(Tree=dec_panel_buildups.Thicknesses)  # -> Paths, Length, Count
lng_18 = ListLength(List=tstat_2.Paths)
dup_8 = DuplicateData(Data=data_9, Number=lng_18, Order=True)  # -> graft(Data)
dup_9 = DuplicateData(Data="4", Number=lng_18, Order=True)  # -> graft(Data)
match_2 = MatchTree(Tree=dup_8, Guide=dec_panel_buildups.WoodSpecies)
match_3 = MatchTree(Tree=dup_9, Guide=dec_panel_buildups.Thicknesses)
merge_20 = Merge(Data1=dec_panel_buildups.WoodSpecies, Data2=match_2)
merge_21 = Merge(Data1=dec_panel_buildups.Thicknesses, Data2=match_3)

# ---- group: species
data_10 = Data(merge_20)

# ---- group: thicknesses
num_25 = Number(merge_21)

# ----
c_script_12 = CSharpScript(x=data_10)  # -> out, A; inputs x: tree
# ---------- c_script_12: C# ----------
    DataTree<object> output = new DataTree<object>();
    int firstIndex = 0;
    int branchCount = 0;
    for(int i = 0; i < x.BranchCount; i++)
    {
      GH_Path path = new GH_Path(firstIndex, branchCount);
      if(x.Paths[i][0] == firstIndex)
      {
        output.AddRange(x.Branch(i), path);
      }
      else
      {
        firstIndex++;
        branchCount = -1;
        i--;
      }
      branchCount++;
    }
    A = output;
# ---------- end c_script_12 ----------
c_script_13 = CSharpScript(x=num_25)  # -> out, A; inputs x: tree; same code as c_script_12

# ---- group: buildups
cull_13 = CullPattern(List=c_script_12.A, CullPattern=equals.Inequality)
dec_secies = DeconstructSpecies(Species=cull_13)  # -> N, LX, RX, TX, LE, RE, TE
cset = CreateSet(List=dec_secies.N)  # -> Set, Map
material_buildups = Panel("""100
200
300
101
201
301""")

# ---- group: buildups / layer count
lng_19 = ListLength(List=dec_secies.N)

# ---- group: buildups / material type
lng_20 = ListLength(List=cset.Set)

# ---- group: buildups (continued)
c_script_14 = CSharpScript(layerCount=lng_19, materialCount=lng_20)  # -> out, A, B, C; inputs layerCount: tree of Int32, materialCount: tree of Int32
# ---------- c_script_14: C# ----------
    DataTree<int> keys = new DataTree<int>();
    DataTree<int> numberize = new DataTree<int>();
    DataTree<double> thickness = new DataTree<double>();

    for(int i = 0; i < layerCount.BranchCount;i++)
    {
      int lCount = layerCount.Branch(i)[0];
      int mCount = materialCount.Branch(i)[0];
      GH_Path path = layerCount.Paths[i];
      numberize.Add(i + 1, path);
      if(lCount == 3 && mCount == 1)
      {
        keys.Add(0, path);
        thickness.Add(2.8, path);
      }
      if(lCount == 5 && mCount == 1)
      {
        keys.Add(1, path);
        thickness.Add(5.2, path);
      }
      if(lCount == 7 && mCount == 1)
      {
        keys.Add(2, path);
        thickness.Add(7.6, path);
      }
      if(lCount == 3 && mCount == 2)
      {
        keys.Add(3, path);
        thickness.Add(2.8, path);
      }
      if(lCount == 5 && mCount == 2)
      {
        keys.Add(4, path);
        thickness.Add(5.2, path);
      }
      if(lCount == 7 && mCount == 2)
      {
        keys.Add(5, path);
        thickness.Add(7.6, path);
      }

    }

    A = keys;
    B = numberize;
    C = thickness;
# ---------- end c_script_14 ----------
item_28 = ListItem(List=material_buildups, Index=c_script_14.A, Wrap=True)

# ----
num_26 = Number(item_28)
num_27 = Number(c_script_14.C)
num_28 = Number(c_script_14.B)
scale_2 = Scale(Geometry=srf_23, Center=Point(0, 0, 0), Factor=0.001)  # -> Geometry, Transform
null = NullItem(Item=scale_2.Geometry)  # -> NullFlags, InvalidFlags, Description
not_3 = GateNot(A=null.NullFlags)
cull_14 = CullPattern(List=num_28, CullPattern=not_3)
cull_15 = CullPattern(List=scale_2.Geometry, CullPattern=not_3)
cull_16 = CullPattern(List=num_27, CullPattern=not_3)
cull_17 = CullPattern(List=num_26, CullPattern=not_3)
scale_3 = Scale(Geometry=cullpt_2.Points, Center=Point(0, 0, 0), Factor=0.001)  # -> Geometry, Transform
clean_4 = CleanTree(RemoveNulls=True, RemoveInvalid=True, RemoveEmpty=True, Tree=cull_15)
clean_5 = CleanTree(RemoveNulls=True, RemoveInvalid=True, RemoveEmpty=True, Tree=cull_14)
clean_6 = CleanTree(RemoveNulls=True, RemoveInvalid=True, RemoveEmpty=True, Tree=cull_16)
clean_7 = CleanTree(RemoveNulls=True, RemoveInvalid=True, RemoveEmpty=True, Tree=cull_17)

# ---- group: InputSurfaces
brep = Brep(clean_4)

# ---- group: Main Surfaces
surfaces = Data(brep)  # disabled
assemble_structural_area_sofistik = AssembleStructuralAreaSofistik(Geometry=surfaces, GroupNr=clean_5)  # -> simplify(StructuralAreasSofiMesh)

# ---- group: Mesh
item_29 = ListItem(List=surfaces, Index=0, Wrap=True)  # disabled
item_30 = ListItem(List=surfaces, Index=0, Wrap=True)  # -> Item1, Item; disabled
debrep_3 = DeconstructBrep(Brep=item_29)  # -> Faces, Edges, Vertices; disabled
debrep_4 = DeconstructBrep(Brep=item_30.Item1)  # -> Faces, Edges, Vertices; disabled
debrep_5 = DeconstructBrep(Brep=surfaces)  # -> Faces, Edges, Vertices; disabled
number_slider_18 = Slider(1, range=0..10)  # disabled
item_31 = ListItem(List=debrep_3.Vertices, Index=0, Wrap=True)  # -> Item, Item1; disabled
item_32 = ListItem(List=debrep_4.Vertices, Index=0, Wrap=True)  # -> Item1, Item; disabled
item_33 = ListItem(List=debrep_5.Edges, Index=number_slider_18, Wrap=True)  # disabled
pt_16 = Point(item_31.Item1)  # disabled
pt_17 = Point(item_31.Item)  # disabled
pt_18 = Point(item_32.Item1)  # disabled
data_11 = Data(item_33)  # disabled
len_6 = Length(Curve=data_11)  # disabled
len_7 = Length(Curve=debrep_5.Edges)  # disabled
rec_3pt = Rectangle3Pt(PointA=pt_17, PointB=pt_18, PointC=pt_16)  # -> Rectangle, Length; disabled
smaller_6 = SmallerThan(FirstNumber=len_6, SecondNumber=len_7)  # -> SmallerThan, OrEqualTo; disabled
boundary = BoundarySurfaces(Edges=rec_3pt.Rectangle)  # disabled
area_13 = Area(Geometry=boundary)  # -> Area, Centroid; disabled
cull_18 = CullPattern(List=debrep_5.Edges, CullPattern=smaller_6.SmallerThan)  # disabled
multiplication_12 = Multiplication(A=area_13.Area, B=1.5)  # disabled
panel_41 = Panel("1")  # disabled
assemble_structural_line_sofistik = AssembleStructuralLineSofistik(Curve=cull_18, GroupNr=item_28)

# ----
# SOFIMESH
generate_mesh_sofistik = GenerateMeshSofistik(
    Path=path,
    StructuralLines=assemble_structural_line_sofistik,
    StructuralAreas=assemble_structural_area_sofistik,
    MeshProperties=assemble_mesh_properties_sofimesh,
    WpsExe=pathwps_exe,
    Cdb_w50Dll=pathcdb_dll,
    Run=button_2,
    meshs_Branch0_Path="{1}",
    meshs_Branch1_Path="{2}",
    meshs_Branch2_Path="{7}",
    meshs_Branch3_Path="{8}",
    meshs_Branch4_Path="{9}",
    meshs_Branch5_Path="{10}",
    meshs_Branch6_Path="{11}",
    meshs_Branch7_Path="{12}",
    meshs_Branch8_Path="{13}",
    meshs_Branch9_Path="{14}",
    meshs_Branch10_Path="{15}",
    meshs_Branch11_Path="{16}",
    meshs_Branch12_Path="{17}",
    meshs_Branch13_Path="{18}",
    meshs_Branch14_Path="{19}",
    meshs_Branch15_Path="{20}",
    meshs_Branch16_Path="{21}",
    meshs_Branch17_Path="{22}",
    meshs_Branch18_Path="{23}",
    meshs_Branch19_Path="{24}",
    meshs_Branch20_Path="{25}",
    meshs_Branch21_Path="{26}",
    meshs_Branch22_Path="{27}",
    meshs_Branch23_Path="{28}",
    meshs_Branch24_Path="{29}",
    meshs_Branch25_Path="{30}",
    meshs_Branch26_Path="{31}",
    meshs_Branch27_Path="{32}",
    meshs_Branch28_Path="{33}",
    meshs_Branch29_Path="{34}"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)  # -> Meshs, Completed
flatten = FlattenTree(Tree=generate_mesh_sofistik.Meshs, Path="{0}")  # -> simplify(graft(Tree)); disabled
mesh_8 = Mesh(flatten)  # disabled

mesh_9 = Data(mesh_8)  # disabled
graft = GraftTree(Tree=mesh_9, IncludeEmptyLists=True, IncludeNullItems=True)  # -> simplify(Tree); disabled
area_14 = Area(Geometry=graft)  # -> Area, Centroid; disabled
addition_2 = Addition(A=panel_17, B=panel_18, C=panel_17)  # disabled
srf_cp_3 = SurfaceClosestPoint(Point=area_14.Centroid, Surface=graft(surfaces))  # -> Point, UVPoint, Distance; disabled
curvature = PrincipalCurvature(Surface=graft(surfaces), Point=srf_cp_3.UVPoint)  # -> Frame, Min, Max, MinDirection, MaxDirection; disabled
deplane_2 = DeconstructPlane(Plane=curvature.Frame)  # -> Origin, XAxis, YAxis, ZAxis; disabled
amp = Amplitude(Vector=deplane_2.XAxis, Amplitude=0.1)  # disabled
amp_2 = Amplitude(Vector=deplane_2.YAxis, Amplitude=0.1)  # disabled
amp_3 = Amplitude(Vector=deplane_2.ZAxis, Amplitude=0.1)  # disabled
vdis = VectorDisplay(Anchor=area_14.Centroid, Vector=amp)  # disabled
vdis_2 = VectorDisplay(Anchor=area_14.Centroid, Vector=amp_2)  # disabled
vdis_3 = VectorDisplay(Anchor=area_14.Centroid, Vector=amp_3)  # disabled
assemble_shell_sofistika = AssembleShellSofistikA(Mesh=simplify(graft(mesh_9)), MaterialNr=item_28, Thickness=reverse(clean_6), GroupNr=simplify(graft(clean_5)))  # -> flatten(Shell)

pt_19 = Point(scale_3.Geometry)  # disabled
support = RemoteSender(pt_19)

# ---- group: Preassembly
preassemble_model_sofistik = PreAssembleModelSofistik(Points=flatten(pt_19), Shells=assemble_shell_sofistika, tol=0.001)  # -> NodeList, Shells, Beams, Trusses, Cables, Couplings

# ---- group: Loading / Random Point Load
mesh_10 = Mesh(mesh_8)  # disabled
item_34 = ListItem(List=flatten(mesh_10), Index=0, Wrap=True)  # -> Item, Item1; disabled
demesh_2 = DeconstructMesh(Mesh=item_34.Item1)  # -> Vertices, Faces, Colours, Normals; disabled
random_point = GhPythonScript(x=demesh_2.Vertices)  # -> out, a; inputs x: list of Point3d; disabled
# ---------- random_point: Python ----------
import Rhino.Geometry as rg
import random

# List of points

# Get a random point from the list
random_point = random.choice(x)

a = random_point
# ---------- end random_point ----------
pt_20 = Point(random_point.a)  # disabled
find_nodes_sofistik = FindNodesSofistik(Nodes=preassemble_model_sofistik.NodeList, Geometry=pt_20, tol=0.001)
assemble_pointload_sofistik = AssemblePointLoadSofistik(LoadNodes=find_nodes_sofistik, LoadcaseNumber=panel_20, LoadType=panel_21, LoadValues=panel_22)

# ----
support_2 = RemoteReceiver(support)

# ---- group: Loading / Selfweight Floor Build Up
item_35 = ListItem(List=preassemble_model_sofistik.Shells, Index=0, Wrap=True)  # -> Item, Item1; disabled
panel_42 = Panel("1001")  # disabled
panel_43 = Panel("pzz")  # disabled
panel_44 = Panel("-1.5")  # disabled
assemble_meshload_sofistik = AssembleMeshLoadSofistik(LoadMesh=item_35.Item1, LoadcaseNumber=panel_42, LoadType=panel_43, LoadValues=panel_44)  # -> flatten(MeshLoad)

# ---- group: Loading / Traffic Loads
item_36 = ListItem(List=preassemble_model_sofistik.Shells, Index=0, Wrap=True)  # -> Item, Item1; disabled
panel_45 = Panel("1002")  # disabled
panel_46 = Panel("pzz")  # disabled
panel_47 = Panel("0")  # disabled
assemble_meshload_sofistik_2 = AssembleMeshLoadSofistik(LoadMesh=item_36.Item1, LoadcaseNumber=panel_45, LoadType=panel_46, LoadValues=panel_47)  # -> flatten(MeshLoad)

# ----
cullpt_3 = CullDuplicates(Points=support_2, Tolerance=number_slider_9, CullMode=1)  # -> Points, Indices, Valence; disabled

# ----
# SUPPORT DEFINITION
node_sofistik = NodeSofistik(preassemble_model_sofistik.NodeList)
find_nodes_sofistik_2 = FindNodesSofistik(Nodes=node_sofistik, Geometry=cullpt_3.Points, tol=0.001)
panel_48 = Panel("F")  # disabled
assemble_support_sofistik = AssembleSupportSofistik(Node=find_nodes_sofistik_2, Type=panel_48)

intersect_shells_sofistik = IntersectShellsSofistik(Shells=preassemble_model_sofistik.Shells, shell_combination=0, tol=0.001)  # -> NodesASofistikA, NodesBSofistikA
assemble_coupling_sofistik = AssembleCouplingSofistik(Node=intersect_shells_sofistik.NodesASofistikA, ReferenceNode=intersect_shells_sofistik.NodesBSofistikA, Type=panel_23)  # -> flatten(CouplingSofistikA)

# ---- group: Loading
merge_22 = Merge(Data1=assemble_meshload_sofistik, Data2=assemble_meshload_sofistik_2)  # disabled

# ---- group: Calculation
support_sofistik = SupportSofistik(flatten(assemble_support_sofistik))
path_2 = Data(path)  # disabled
aqua = Data(aqua_file)  # disabled
button_3 = Button()  # disabled
load_sofistik = LoadSofistik(merge_22)
assemble_model_sofistik = AssembleModelSofistik(
    Path=path_2,
    AquaFile=aqua,
    Nodes=preassemble_model_sofistik.NodeList,
    Shells=flatten(preassemble_model_sofistik.Shells),
    Beams=preassemble_model_sofistik.Beams,
    Couplings=assemble_coupling_sofistik,
    Supports=support_sofistik,
    Loads=load_sofistik,
    AseFile=merge_11,
    SofistikPath=pathwps_exe,
    Run=button_2,
    disable_warnings=False,
    run_sofistik=True)  # -> CdbPath, GroupDivisor, Springs, Beams, Trusses, Cables, Completed, Errors

# ---- group: Sofistik
button_4 = Button()  # disabled
button_5 = Button()  # disabled
button_6 = Button()  # disabled
button_7 = Button()  # disabled
open_sofistik = OpenSofistik(Path=assemble_model_sofistik.CdbPath, Teddy=button_4, Animator=button_5, Wingraf=button_6, FileLocation=button_7)

# ----
number_slider_19 = Slider(2, range=0..100)  # disabled
toggle_3 = BooleanToggle(True)  # disabled
load_case = Panel("101")  # disabled
uls_2 = Panel("201")  # disabled
pathcdb_dll_2 = FilePath(pathcdb_dll)  # disabled
pathcdb = FilePath(assemble_model_sofistik.CdbPath)  # disabled

# ---- group: Manual Stress Calculation
toggle_4 = BooleanToggle(True)  # disabled
pathcdb_dll_3 = FilePath(pathcdb)  # disabled
number_slider_20 = Slider(0, range=0..100)  # disabled
get_shell_forces_sofistik = GetShellForcesSofistik(Path=pathcdb_dll_2, LoadCase=1, SofistikPath=pathcdb_dll_3, Run=toggle_4)  # -> QNR, T, MXX, MYY, MXY, VX, VY, NXX, NYY, NXY
get_deformed_mesh_sofistik = GetDeformedMeshSofistik(LoadCase=1, ScalingFactor=number_slider_20, SofistikPath=pathcdb_dll_3, Run=toggle_4)  # -> InitialMesh, DeformedMesh
int = Integer(get_shell_forces_sofistik.MXX)  # disabled
facen = FaceNormals(Mesh=get_deformed_mesh_sofistik.InitialMesh)  # -> Centers, Normals; disabled
python_3 = GhPythonScript(
    E0=panel_37,
    E90=panel_34,
    t1=panel_35,
    t2=panel_36,
    nxx=get_shell_forces_sofistik.NXX,
    mxx=get_shell_forces_sofistik.MXX,
    nyy=get_shell_forces_sofistik.NYY,
    myy=get_shell_forces_sofistik.MYY)  # -> out, sig_x_top, sig_x_bot, sig_y_top_1, sig_y_int_1, sig_y_int_2, sig_y_bot_2; disabled
# ---------- python_3: Python ----------
import math 

# -------------- X direction -------------
Ax  = t2
Wxx = Ax*Ax/6

sigma_nx    = nxx / Ax
sigma_mxx   = mxx / Wxx * 1000
sig_x_top = sigma_nx - sigma_mxx
sig_x_bot = sigma_nx + sigma_mxx


# -------------- Y direction -------------
by_eq   = E90/E0
Ay_1    = t1
Ay_2    = t2 * by_eq
Ay_eq   = Ay_1 + Ay_2 
zg_y_1  = t1/2
zg_y_2  = t1 + t2/2
zg_y    = (zg_y_1 * Ay_1 + zg_y_2 * Ay_2) / Ay_eq
Iyy_1   = t1*t1*t1/12
Iyy_2   = t2*t2*t2/12*by_eq
Iyy     = Iyy_1 + Iyy_2 + math.pow(zg_y - zg_y_1,2)*Ay_1 + math.pow(zg_y - zg_y_2,2)*Ay_2

eps_y_top = myy / Iyy / E0 * (0 - zg_y) * 1000         + nyy / Ay_eq / E0
eps_y_int = myy / Iyy / E0 * (t1 - zg_y) * 1000        + nyy / Ay_eq / E0
eps_y_bot = myy / Iyy / E0 * (t1 + t2 - zg_y) * 1000   + nyy / Ay_eq / E0

sig_y_top_1 = eps_y_top * E0
sig_y_int_1 = eps_y_int * E0 
sig_y_int_2 = eps_y_int * E90 
sig_y_bot_2 = eps_y_bot * E90
# ---------- end python_3 ----------
number_slider_21 = Slider(10, range=0..10)  # disabled
bnd_12 = Bounds(Numbers=get_shell_forces_sofistik.MXX)  # disabled
entwine_3 = Entwine(Branch00=python_3.sig_x_top, Branch01=python_3.sig_x_bot, FlattenInputs=True)  # disabled
dedomain_16 = DeconstructDomain(Domain=bnd_12)  # -> Start, End; disabled
textdot = DefineTextDot(Text=get_shell_forces_sofistik.MXX, Location=facen.Centers, Font="Arial", Size=number_slider_21)
swatch_2 = ColourSwatch(SwatchColor=RGB(255, 255, 255))  # disabled
flip_5 = FlipMatrix(Data=entwine_3)  # disabled
gradient_8 = Gradient(
    LowerLimit=dedomain_16.Start,
    UpperLimit=dedomain_16.End,
    Parameter=get_shell_forces_sofistik.MXX,
    stops=[0: RGB(234, 38, 0), 0.25: RGB(234, 126, 0), 0.5: RGB(254, 244, 84), 0.75: RGB(173, 203, 249), 1: RGB(75, 107, 169)])  # disabled
abs_2 = Absolute()  # disabled
abs_3 = Absolute(Value=flip_5)  # disabled
sort_10 = SortList(Keys=abs_3, ValuesA=flip_5)  # -> Keys, ValuesA; disabled
item_37 = ListItem(List=reverse(sort_10.ValuesA), Index=0, Wrap=True)  # -> flatten(Item); disabled
colourmesh = ColourMesh(Mesh=get_deformed_mesh_sofistik.InitialMesh, Colors=gradient_8)

# ---- group: Deformation
get_nodal_results_sofistik = GetNodalResultsSofistik(Path=pathcdb, LoadCases=load_case, SofistikPath=pathcdb_dll_2, Run=toggle_3)  # -> NodeNumber, Nodes, LoadForces, LoadMoments, Displacements, Rotations, Forces, Moments
get_deformed_mesh_sofistika = GetDeformedMeshSofistikA(Path=pathcdb, LoadCase=load_case, ScalingFactor=number_slider_19, SofistikPath=pathcdb_dll_2, Run=toggle_3)  # -> InitialMesh, DeformedMesh
vlen = VectorLength(Vector=get_nodal_results_sofistik.Displacements)  # disabled
demesh_3 = DeconstructMesh(Mesh=get_deformed_mesh_sofistika.DeformedMesh)  # -> Vertices, Faces, Colours, Normals; disabled
vec_6 = Vector(get_nodal_results_sofistik.Displacements)  # disabled
num_29 = Number(get_nodal_results_sofistik.Displacements)  # disabled
vlen_2 = VectorLength(Vector=vec_6)  # disabled
bnd_13 = Bounds(Numbers=num_29)  # disabled
num_30 = Number(vlen_2)  # disabled
bnd_14 = Bounds(Numbers=num_30)  # disabled
dedomain_17 = DeconstructDomain(Domain=bnd_13)  # -> Start, End; disabled
dedomain_18 = DeconstructDomain(Domain=bnd_14)  # -> Start, End; disabled
gradient_9 = Gradient(
    LowerLimit=dedomain_17.End,
    UpperLimit=dedomain_17.Start,
    Parameter=panel_38,
    stops=[0: RGB(234, 38, 0), 0.25: RGB(234, 126, 0), 0.5: RGB(254, 244, 84), 0.75: RGB(173, 203, 249), 1: RGB(75, 107, 169)])  # disabled
expression = Expression(x=dedomain_18.End, Expression="Round(x*1000,2)")  # disabled
sort_11 = SortList(Keys=vlen, ValuesA=get_nodal_results_sofistik.Nodes)  # -> reverse(Keys), reverse(ValuesA); disabled
totalmaxdisplacement_mm = Panel(expression)  # disabled
smaller_7 = SmallerThan(FirstNumber=panel_26, SecondNumber=totalmaxdisplacement_mm)  # -> SmallerThan, OrEqualTo; disabled
panel_49 = Panel(smaller_7.SmallerThan)  # disabled
sort_12 = SortList(Keys=vlen, ValuesA=demesh_3.Vertices)  # -> reverse(Keys), reverse(ValuesA); disabled
item_38 = ListItem(List=sort_11.ValuesA, Index=0, Wrap=True)  # disabled
item_39 = ListItem(List=sort_12.ValuesA, Index=0, Wrap=True)  # disabled
panel_50 = Panel(" mm")  # disabled
panel_51 = Panel("   ")  # disabled
concat_3 = Concatenate(FragmentA=panel_51, FragmentB=totalmaxdisplacement_mm, FragmentC=panel_50)  # disabled
swatch_3 = ColourSwatch(SwatchColor=RGB(0, 0, 0))  # disabled
tag = TextTag(Location=item_38, Text=concat_3, Colour=swatch_3)  # disabled
pt_21 = Point(item_38)  # disabled

# ---- group: CLT
pathcdb_2 = FilePath(pathcdb)  # disabled
panel_52 = Panel("0.8")  # disabled
pathcdb_dll_4 = FilePath(pathcdb_dll_2)  # disabled
check_cross_sections = CSharpScript(
    path=pathcdb_2,
    lcNumbers=uls_2,
    dllPath=pathcdb_dll_4,
    kmod=panel_52,
    run=toggle_3,
    Reference="C:\Users\Alex Reiner\AppData\Roaming\Grasshopper\Libraries\Sofistik.gha")  # -> out, eta_x, eta_y, eta_vxy, eta_vz, eta_v, eta; inputs path: String, lcNumbers: list of Int32, dllPath: String, kmod: Double, run: Boolean; disabled
# ---------- check_cross_sections: C# usings ----------
using System.IO;
using System.Linq;
using System.Data;
using System.Drawing;
using System.Reflection;
using System.Windows.Forms;
using System.Xml;
using System.Xml.Linq;
using System.Runtime.InteropServices;

using Rhino.DocObjects;
using Rhino.Collections;
using GH_IO;
using GH_IO.Serialization;
using Sofistik;
using Sofistik.Properties;
using Sofistik.Meshing;
# ---------- check_cross_sections: C# ----------
    // Safety factor
    double gammaM = 1.3;

    // Check for validity
    if (string.IsNullOrWhiteSpace(path)) { return; }
    if (string.IsNullOrWhiteSpace(dllPath)) { return; }

    if (!run)
      return;

    // Load sof_cdb.dll under specified path
    NativeMethods.SetDllDirectory(Path.GetDirectoryName(dllPath));
    IntPtr hModule = NativeMethods.LoadLibrary(dllPath);
    if (hModule == IntPtr.Zero)
    {
      Print("HModule = IntPtr.Zero, aborted");
      return;
    }

    // Retrieve the materials from the database
    materialInfos = CdbMethods.GetMaterialInfos(hModule, path);
    materials = new Dictionary<int, Sofistik.Material>();
    foreach (KeyValuePair<int, MaterialType> materialInfo in materialInfos)
    {
      int mnr = materialInfo.Key;
      materials.Add(mnr, CdbMethods.GetMaterial(hModule, path, mnr));
    }

    //  foreach (KeyValuePair<int, Sofistik.Material> kvp in materials)
    //  {
    //    int mnr = kvp.Key;
    //    TimberMaterial material = kvp.Value as TimberMaterial;
    //    if (material == null)
    //      continue;
    //    Rhino.RhinoApp.WriteLine("material " + mnr.ToString() + " Fv,k " + (0.001 * material.Fv_k).ToString());
    //    Rhino.RhinoApp.WriteLine("material " + mnr.ToString() + " Fvb,k " + (0.001 * material.Fvb_k).ToString());
    //    Rhino.RhinoApp.WriteLine("material " + mnr.ToString() + " Fvb,90,k " + (0.001 * material.Fvb90_k).ToString());
    //  }

    // Retrieve quads and quad results from database
    List<CQUAD> quads = CdbMethods.GetQuads(hModule, path);
    int nQuads = quads.Count;

    quadResults = new Dictionary<int,List<CQUAD_FOR>>();
    foreach (var quad in quads)
    {
      quadResults.Add(quad.m_NR, new List<CQUAD_FOR>());
    }
    foreach (int lcNumber in lcNumbers)
    {
      if (lcNumber <= 0)
        return;
      List<CQUAD_FOR> quadForces = CdbMethods.GetQuadForces(hModule, path, lcNumber);
      if (quadForces.Count != nQuads)
      {
        Print("quadForces.Count != quads.Count");
        return;
      }
      foreach (var quadForce in quadForces)
      {
        int quadNr = quadForce.m_NR;
        if(quadResults.ContainsKey(quadNr))
        {
          quadResults[quadNr].Add(quadForce);
        }
      }
    }

    // Initialize output variables
    List<double> _eta_x = new List<double>();
    List<double> _eta_y = new List<double>();
    List<double> _eta_vxy = new List<double>();
    List<double> _eta_vz = new List<double>();
    List<double> _eta_v = new List<double>();
    List<double> _eta = new List<double>();

    for (int i = 0; i < nQuads; i++)
    {
      double eta_x_i = 0.0;
      double eta_y_i = 0.0;
      double eta_vxy_i = 0.0;
      double eta_vz_i = 0.0;
      double eta_v_i = 0.0;

      // retrieve quadnr and thickness
      int quadNr = quads[i].m_NR;
      double t = 1000.0 * (double) quads[i].m_THICK[0]; // mm

      // retrieve material nr of the quad
      int mnr = quads[i].m_MAT;

      // check if material is mlay or single layer material
      if (materials[mnr].MaterialType != MaterialType.Mlay)
      {
        ComputeSingleLayerResult(quadNr, t, mnr, kmod, gammaM, out eta_x_i, out eta_y_i, out eta_vxy_i, out eta_vz_i);
      }
      else
      {
        ComputeMultiLayerResult(quadNr, mnr, kmod, gammaM, out eta_x_i, out eta_y_i, out eta_vxy_i, out eta_vz_i);
      }
      eta_v_i = eta_vxy_i + eta_vz_i;
      double eta_i = new double[]{eta_x_i, eta_y_i, eta_v_i}.Max();
      _eta_x.Add(eta_x_i);
      _eta_y.Add(eta_y_i);
      _eta_vxy.Add(eta_vxy_i);
      _eta_vz.Add(eta_vz_i);
      _eta_v.Add(eta_v_i);
      _eta.Add(eta_i);
    }

    eta_x = _eta_x;
    eta_y = _eta_y;
    eta_vxy = _eta_vxy;
    eta_vz = _eta_vz;
    eta_v = _eta_v;
    eta = _eta;

    NativeMethods.FreeLibrary(hModule);
    NativeMethods.SetDllDirectory(null);
# ---------- check_cross_sections: C# additional code ----------
  Dictionary<int, MaterialType> materialInfos;
  Dictionary<int, Sofistik.Material> materials;
  Dictionary<int,List<CQUAD_FOR>> quadResults;

  protected void ComputeSingleLayerResult(int quadNr, double t, int mnr, double kmod, double gammaM,
    out double eta_x, out double eta_y, out double eta_vxy, out double eta_vz)
  {
    // retrieve the material values of the quad
    TimberMaterial material = materials[mnr] as TimberMaterial;
    if (material == null)
    {
      Print("Cannot perform timber checks on non-timber materials, aborted.");
      eta_x = 0.0;
      eta_y = 0.0;
      eta_vxy = 0.0;
      eta_vz = 0.0;
      return;
    }
    double fm0_rd = 0.001 * (kmod / gammaM) * material.Fm0_k;
    double fm90_rd = 0.001 * (kmod / gammaM) * material.Fm90_k;   // N/mm²
    double ft0_rd = 0.001 * (kmod / gammaM) * material.Ft0_k;    // N/mm²
    double ft90_rd = 0.001 * (kmod / gammaM) * material.Ft90_k;   // N/mm²
    double fc0_rd = 0.001 * (kmod / gammaM) * material.Fc0_k;    // N/mm²
    double fc90_rd = 0.001 * (kmod / gammaM) * material.Fc90_k;   // N/mm²
    double fv_rd = 0.001 * (kmod / gammaM) * material.Fv_k;     // N/mm²
    double fvb_rd = 0.001 * (kmod / gammaM) * material.Fvb_k;    // N/mm²
    double fvb90_rd = 0.001 * (kmod / gammaM) * material.Fvb90_k;  // N/mm²

    // retrieve the quad forces for this quad, n --> kN/m, m --> kN-m/m
    List<CQUAD_FOR> quadForces = quadResults[quadNr];
    double nx_t = 0.0;
    double nx_c = 0.0;
    double ny_t = 0.0;
    double ny_c = 0.0;
    double nxy = 0.0;
    double mx = 0.0;
    double my = 0.0;
    double mxy = 0.0;
    double vx = 0.0;
    double vy = 0.0;
    foreach (var quadForce in quadForces)
    {
      if (quadForce.m_NX > nx_t)
        nx_t = quadForce.m_NX;
      if (quadForce.m_NX < nx_c)
        nx_c = quadForce.m_NX;
      if (quadForce.m_NY > ny_t)
        ny_t = quadForce.m_NY;
      if (quadForce.m_NY < ny_c)
        ny_c = quadForce.m_NY;
      if (Math.Abs(quadForce.m_NXY) > nxy)
        nxy = Math.Abs(quadForce.m_NXY);

      if (Math.Abs(quadForce.m_MXX) > mx)
        mx = Math.Abs(quadForce.m_MXX);
      if (Math.Abs(quadForce.m_MYY) > my)
        my = Math.Abs(quadForce.m_MYY);
      if (Math.Abs(quadForce.m_MXY) > mxy)
        mxy = Math.Abs(quadForce.m_MXY);

      if (Math.Abs(quadForce.m_VX) > vx)
        vx = Math.Abs(quadForce.m_VX);
      if (Math.Abs(quadForce.m_VY) > vy)
        vy = Math.Abs(quadForce.m_VY);
    }

    // Bending Resistance and Axial resistance
    // x-Direction:
    double mx_rd = 0.001 * fm0_rd * t * t / 6.0;
    double nx_c_rd = fc0_rd * t;  // kN/m
    double nx_t_rd = ft0_rd * t;  // kN/m

    // y-Direction:
    double my_rd = 0.001 * fm90_rd * t * t / 6.0;
    double ny_c_rd = fc90_rd * t;  // kN/m
    double ny_t_rd = ft90_rd * t;  // kN/m

    // Torsion Resistance
    double mxy_rd = 1000.0 * fv_rd * t * t / 6.0; // TODO: CHECK THIS

    // In-Plane shear resistance
    double nxy_rd = 1000.0 * fv_rd * t;

    // Out-of-plane shear resistance
    double vx_rd = fvb_rd * t / 1.5;
    double vy_rd = fvb90_rd * t / 1.5;

    eta_x = Math.Max(
      mx / mx_rd + nx_t / nx_t_rd,
      mx / mx_rd - nx_c / nx_c_rd);

    eta_y = Math.Max(
      my / my_rd + ny_t / ny_t_rd,
      my / my_rd - ny_c / ny_c_rd);
    eta_vxy = mxy / mxy_rd + nxy / nxy_rd;
    eta_vz = Math.Sqrt(Math.Pow(vx / vx_rd, 2) + Math.Pow(vy / vy_rd, 2));
  }

  protected void ComputeMultiLayerResult(int quadNr, int mnr, double kmod, double gammaM,
    out double eta_x, out double eta_y, out double eta_vxy, out double eta_vz)
  {
    eta_x = 0.0;
    eta_y = 0.0;
    eta_vxy = 0.0;
    eta_vz = 0.0;

    int layerMaterialNr = 0;

    LayeredMaterial layeredMaterial = materials[mnr] as LayeredMaterial;
    if (layeredMaterial == null)
    {
      Print("Multi-Layer results can only be computed with multi-layer materials.");
      return;
    }

    Dictionary<int,TimberMaterial> timberMaterials = new Dictionary<int,TimberMaterial>();
    foreach (int key in materials.Keys)
    {
      var timberMaterial = materials[key] as TimberMaterial;
      if (timberMaterial != null)
      {
        timberMaterials.Add(key, timberMaterial);
      }
    }

    List<Tuple<int,double,double>> layers = layeredMaterial.Layers;

    // compute t, assume symetric build-up
    double t = 0.0;     // m
    double tmax = 0.0;  // m
    for (int j = 0; j < layers.Count; j++)
    {
      t += layers[j].Item2;
      if (layers[j].Item2 > tmax)
      {
        tmax = layers[j].Item2;
      }
    }

    // retrieve the quad forces for this quad, n --> kN/m, m --> kN-m/m
    List<CQUAD_FOR> quadForces = quadResults[quadNr];
    double nx_t = 0.0;
    double nx_c = 0.0;
    double ny_t = 0.0;
    double ny_c = 0.0;
    double nxy = 0.0;
    double mx = 0.0;
    double my = 0.0;
    double mxy = 0.0;
    double vx = 0.0;
    double vy = 0.0;
    foreach (var quadForce in quadForces)
    {
      if (quadForce.m_NX > nx_t)
        nx_t = quadForce.m_NX;
      if (quadForce.m_NX < nx_c)
        nx_c = quadForce.m_NX;
      if (quadForce.m_NY > ny_t)
        ny_t = quadForce.m_NY;
      if (quadForce.m_NY < ny_c)
        ny_c = quadForce.m_NY;
      if (Math.Abs(quadForce.m_NXY) > nxy)
        nxy = Math.Abs(quadForce.m_NXY);

      if (Math.Abs(quadForce.m_MXX) > mx)
        mx = Math.Abs(quadForce.m_MXX);
      if (Math.Abs(quadForce.m_MYY) > my)
        my = Math.Abs(quadForce.m_MYY);
      if (Math.Abs(quadForce.m_MXY) > mxy)
        mxy = Math.Abs(quadForce.m_MXY);

      if (Math.Abs(quadForce.m_VX) > vx)
        vx = Math.Abs(quadForce.m_VX);
      if (Math.Abs(quadForce.m_VY) > vy)
        vy = Math.Abs(quadForce.m_VY);
    }

    // compute Bx, By and Bxy
    // compute Dx, Dy and Dxy
    double Bx = 0.0;
    double By = 0.0;
    double Bxy = 0.0;
    double Dx = 0.0;
    double Dy = 0.0;
    double Dxy = 0.0;
    double z_j = -0.5 * t;
    for (int j = 0; j < layers.Count; j++)
    {
      // material properties
      double Ex_j = timberMaterials[layers[j].Item1].E0;   // [kN/m²]
      double Ey_j = timberMaterials[layers[j].Item1].E90;  // [kN/m²]
      double Gxy_j = timberMaterials[layers[j].Item1].G0;  // [kN/m²]

      // geometry information
      double t_j = layers[j].Item2;
      z_j += 0.5 * t_j;
      Bx += Ex_j * (t_j * Math.Pow(z_j, 2) + Math.Pow(t_j, 3) / 12);
      By += Ey_j * (t_j * Math.Pow(z_j, 2) + Math.Pow(t_j, 3) / 12);
      Bxy += Gxy_j * (2 * t_j * Math.Pow(z_j, 2) + Math.Pow(t_j, 3) / 6);
      Dx += Ex_j * t_j;
      Dy += Ey_j * t_j;
      Dxy += Gxy_j * t_j;
      z_j += 0.5 * t_j;
    }

    // compute ESx and ESy
    double ESx = 0.0;
    double ESy = 0.0;
    z_j = 0.0;
    if (layers.Count == 3 || layers.Count == 7 || layers.Count == 11)
    {
      // rolling shear, critical layer for x-Direction: midlayer
      // rolling shear, critical layer for y-Direction: midlayer + 1
      for (int j = layers.Count / 2; j < layers.Count; j++)
      {
        // material properties
        double Ex_j = timberMaterials[layers[j].Item1].E0;   // [kN/m²]
        double Ey_j = timberMaterials[layers[j].Item1].E90;  // [kN/m²]

        // geometry information
        double t_j = layers[j].Item2;
        if (j > layers.Count / 2)
        {
          z_j += 0.5 * t_j;
          ESx += Ex_j * z_j * t_j;
          ESy += Ey_j * z_j * t_j;
        }
        else
        {
          ESx += Ex_j * t_j * t_j / 8.0;
        }
        z_j += 0.5 * t_j;
      }
    }
    else if (layers.Count == 5 || layers.Count == 9 || layers.Count == 13)
    {
      // rolling shear, critical layer for x-Direction: midlayer + 1
      // rolling shear, critical layer for y-Direction: midlayer
      for (int j = layers.Count / 2; j < layers.Count; j++)
      {
        // material properties
        double Ex_j = timberMaterials[layers[j].Item1].E0;   // [kN/m²]
        double Ey_j = timberMaterials[layers[j].Item1].E90;  // [kN/m²]

        // geometry information
        double t_j = layers[j].Item2;
        if (j > layers.Count / 2)
        {
          z_j += 0.5 * t_j;
          ESx += Ex_j * z_j * t_j;
          ESy += Ey_j * z_j * t_j;
        }
        else
        {
          ESy += Ey_j * t_j * t_j / 8.0;
        }
        z_j += 0.5 * t_j;
      }
    }
    else
    {
      Print("Asymetric build-up, or too many layers, not supported.");
      return;
    }

    // Bending Resistance and Axial resistance
    // x-Direction:
    layerMaterialNr = layers[layers.Count - 1].Item1;
    double fm_rd = 0.001 * (kmod / gammaM) * timberMaterials[layerMaterialNr].Fm0_k; // N/mm²
    double ft0_rd = 0.001 * (kmod / gammaM) * timberMaterials[layerMaterialNr].Ft0_k; // N/mm²
    double fc0_rd = 0.001 * (kmod / gammaM) * timberMaterials[layerMaterialNr].Fc0_k; // N/mm²

    double zo = 0.5 * t;
    double mx_rd = 1000.0 * fm_rd * Bx / (timberMaterials[layerMaterialNr].E0 * zo);
    double nx_c_rd = 1000.0 * fc0_rd * Dx / (timberMaterials[layerMaterialNr].E0);
    double nx_t_rd = 1000.0 * ft0_rd * Dx / (timberMaterials[layerMaterialNr].E0);

    // y-Direction:
    layerMaterialNr = layers[layers.Count - 2].Item1;
    fm_rd = 0.001 * (kmod / gammaM) * timberMaterials[layerMaterialNr].Fm0_k; // N/mm²
    ft0_rd = 0.001 * (kmod / gammaM) * timberMaterials[layerMaterialNr].Ft0_k; // N/mm²
    fc0_rd = 0.001 * (kmod / gammaM) * timberMaterials[layerMaterialNr].Fc0_k; // N/mm²

    double to = t - layers[layers.Count - 1].Item2;
    zo = to - 0.5 * t;
    double my_rd = 1000.0 * fm_rd * By / (timberMaterials[layerMaterialNr].E90 * zo);
    double ny_c_rd = 1000.0 * fc0_rd * Dy / (timberMaterials[layerMaterialNr].E90);
    double ny_t_rd = 1000.0 * ft0_rd * Dy / (timberMaterials[layerMaterialNr].E90);

    // Material values shear + torsion
    double fv_k = double.MaxValue;
    double fv_T_k = double.MaxValue;
    foreach (var layer in layers)
    {
      if (timberMaterials[layer.Item1].Fv_k < fv_k)
      {
        fv_k = timberMaterials[layer.Item1].Fv_k;
      }
      if (timberMaterials[layer.Item1].Fvb90_k < fv_T_k)
      {
        fv_T_k = timberMaterials[layer.Item1].Fvb90_k;
      }
    }
    double fv_rd = 0.001 * (kmod / gammaM) * fv_k;       // N/mm²
    double fv_T_rd = 0.001 * (kmod / gammaM) * fv_T_k;   // N/mm²

    // Twisting Resistance
    zo = 0.5 * t;
    layerMaterialNr = layers[layers.Count - 1].Item1;
    double mxy_rd = 1000.0 * fv_T_rd * Bxy / (timberMaterials[layerMaterialNr].G0 * zo);

    // In-Plane shear resistance
    layerMaterialNr = layers[layers.Count - 1].Item1;
    double t0_netto = Dx / (timberMaterials[layerMaterialNr].E0);
    layerMaterialNr = layers[layers.Count - 2].Item1;
    double t90_netto = Dy / (timberMaterials[layerMaterialNr].E90);
    double t_netto = Math.Min(t0_netto, t90_netto);
    double a = 0.15;
    double nxy_1_rd = 1000.0 * fv_T_rd * t_netto * a / (3.0 * tmax);
    double nxy_2_rd = 1000.0 * fv_rd * t;
    double nxy_rd = Math.Min(nxy_1_rd, nxy_2_rd);

    // Out-of-plane shear resistance
    double fv_R_rd = 0.0;    // N/mm²
    double vx_rd = (1000.0 * fv_R_rd * Bx) / ESx;
    double vy_rd = 0.0;
    switch (layers.Count)
    {
      case 3:
        // rolling shear, critical layer for x-Direction: midlayer
        fv_R_rd = 0.001 * (kmod / gammaM) * timberMaterials[layers[1].Item1].Fvb_k;
        vx_rd = (1000.0 * fv_R_rd * Bx) / ESx;
        // for y-Direction: no rolling shear, simple shear for the mid board
        double t_mid = layers[1].Item2;
        vy_rd = (1000.0 * fv_T_rd * t_mid) / 1.5;
        break;
      case 5:
        // rolling shear, critical layer for x-Direction: midlayer - 1
        fv_R_rd = 0.001 * (kmod / gammaM) * timberMaterials[layers[1].Item1].Fvb_k;
        vx_rd = (1000.0 * fv_R_rd * Bx) / ESx;
        // rolling shear, critical layer for y-Direction: midlayer
        fv_R_rd = 0.001 * (kmod / gammaM) * timberMaterials[layers[2].Item1].Fvb_k;
        vy_rd = (1000.0 * fv_R_rd * By) / ESy;
        break;
      case 7:
        // rolling shear, critical layer for x-Direction: midlayer
        fv_R_rd = 0.001 * (kmod / gammaM) * timberMaterials[layers[3].Item1].Fvb_k;
        vx_rd = (1000.0 * fv_R_rd * Bx) / ESx;
        // rolling shear, critical layer for y-Direction: midlayer - 1
        fv_R_rd = 0.001 * (kmod / gammaM) * timberMaterials[layers[2].Item1].Fvb_k;
        vy_rd = (1000.0 * fv_R_rd * By) / ESy;
        break;
      case 9:
        // rolling shear, critical layer for x-Direction: midlayer - 1
        fv_R_rd = 0.001 * (kmod / gammaM) * timberMaterials[layers[3].Item1].Fvb_k;
        vx_rd = (1000.0 * fv_R_rd * Bx) / ESx;
        // rolling shear, critical layer for y-Direction: midlayer
        fv_R_rd = 0.001 * (kmod / gammaM) * timberMaterials[layers[4].Item1].Fvb_k;
        vy_rd = (1000.0 * fv_R_rd * By) / ESy;
        break;
      default:
        Print("Asymetric build-up, or too many layers, not supported.");
        return;
    }
    eta_x = Math.Max(
      mx / mx_rd + nx_t / nx_t_rd,
      mx / mx_rd - nx_c / nx_c_rd);

    eta_y = Math.Max(
      my / my_rd + ny_t / ny_t_rd,
      my / my_rd - ny_c / ny_c_rd);
    eta_vxy = mxy / mxy_rd + nxy / nxy_rd;
    eta_vz = Math.Sqrt(Math.Pow(vx / vx_rd, 2) + Math.Pow(vy / vy_rd, 2));
  }

  internal class NativeMethods
  {
    [DllImport("Kernel32.dll", BestFitMapping = false, CharSet = CharSet.Ansi, SetLastError = true, ThrowOnUnmappableChar = true)]
    internal static extern IntPtr LoadLibrary([MarshalAs(UnmanagedType.LPStr)]string lpFileName);

    [DllImport("Kernel32.dll", BestFitMapping = false, CharSet = CharSet.Ansi, ExactSpelling = true, SetLastError = true, ThrowOnUnmappableChar = true)]
    internal static extern IntPtr GetProcAddress(IntPtr hModule, string procName);

    [DllImport("Kernel32.dll", SetLastError = true)]
    internal static extern bool FreeLibrary(IntPtr hModule);

    [DllImport("Kernel32.dll", CharSet = CharSet.Unicode, SetLastError = true)]
    [return: MarshalAs(UnmanagedType.Bool)]
    internal static extern bool SetDllDirectory(string lpPathName);
  }
# ---------- end check_cross_sections ----------
bnd_15 = Bounds(Numbers=check_cross_sections.eta_x)  # disabled
bnd_16 = Bounds(Numbers=check_cross_sections.eta_y)  # disabled
bnd_17 = Bounds(Numbers=check_cross_sections.eta_vxy)  # disabled
bnd_18 = Bounds(Numbers=check_cross_sections.eta_vz)  # disabled
bnd_19 = Bounds(Numbers=check_cross_sections.eta_v)  # disabled
bnd_20 = Bounds(Numbers=check_cross_sections.eta)  # disabled
addition_3 = Addition(A=check_cross_sections.eta_vxy, B=check_cross_sections.eta_vz)  # disabled
panel_53 = Panel([bnd_15, bnd_16, bnd_17, bnd_18, bnd_19, bnd_20])  # disabled
bnd_21 = Bounds(Numbers=addition_3)  # disabled
get_deformed_mesh_sofistik_2 = GetDeformedMeshSofistik(Path=pathcdb_2, LoadCase=1, ScalingFactor=100, SofistikPath=pathcdb_dll_4, Run=toggle_3)  # -> InitialMesh, DeformedMesh
number_slider_22 = Slider(1, range=0..1)  # disabled
dedomain_19 = DeconstructDomain(Domain=bnd_20)  # -> Start, End; disabled
gradient_10 = Gradient(
    LowerLimit=number_slider_22,
    UpperLimit=dedomain_19.Start,
    Parameter=check_cross_sections.eta,
    stops=[0: RGB(234, 38, 0), 0.25: RGB(234, 126, 0), 0.5: RGB(254, 244, 84), 0.75: RGB(173, 203, 249), 1: RGB(75, 107, 169)])  # disabled

# ----
panel_54 = Panel(check_cross_sections.eta)  # disabled

sort_13 = SortList(Keys=flatten(check_cross_sections.eta))  # -> reverse(Keys), ValuesA; disabled
expression_2 = Expression(x=sort_13.Keys, Expression="Round(x,2)")  # disabled
maxutilisation = Panel(expression_2)  # disabled

eta_vxy_vz = Panel(bnd_21)  # disabled
eta_v = Panel(bnd_19)  # disabled
eta = Panel(bnd_20)  # disabled
eta_y = Panel(bnd_16)  # disabled
eta_vxy = Panel(bnd_17)  # disabled
eta_vz = Panel(bnd_18)  # disabled
eta_x = Panel(bnd_15)  # disabled

# ---- group: Deformed
dedomain_20 = DeconstructDomain(Domain=bnd_20)  # -> Start, End; disabled
gradient_11 = Gradient(
    LowerLimit=dedomain_20.End,
    UpperLimit=dedomain_20.Start,
    Parameter=check_cross_sections.eta,
    stops=[0: RGB(234, 38, 0), 0.25: RGB(234, 126, 0), 0.5: RGB(254, 244, 84), 0.75: RGB(173, 203, 249), 1: RGB(75, 107, 169)])  # disabled
gradient_12 = Gradient(
    LowerLimit=dedomain_20.End,
    UpperLimit=dedomain_20.Start,
    Parameter=check_cross_sections.eta,
    stops=[0: RGB(217, 76, 48), 0.25: RGB(199, 133, 58), 0.5: RGB(214, 205, 71), 0.75: RGB(99, 142, 207), 1: RGB(12, 60, 156)])  # disabled
number_slider_23 = Slider(0.001, range=0..0.1)  # disabled
wbfacepolys = WeaverbirdsFacePolylines(Mesh=get_deformed_mesh_sofistik_2.InitialMesh)  # -> flatten(Polygons); disabled

# ----
facen_2 = FaceNormals(Mesh=get_deformed_mesh_sofistik_2.InitialMesh)  # -> Centers, Normals; disabled
number_slider_24 = Slider(28, range=0..2100)  # disabled
neg_9 = Negative(Value=number_slider_24)  # disabled
panel_55 = Panel("0")  # disabled
dom_16 = ConstructDomain(DomainStart=neg_9, DomainEnd=number_slider_24)  # disabled
dom_17 = ConstructDomain(DomainStart=panel_55, DomainEnd=number_slider_24)  # disabled
sort_14 = SortList(Keys=check_cross_sections.eta, ValuesA=facen_2.Centers, ValuesB=gradient_10)  # -> reverse(flatten(Keys)), reverse(flatten(ValuesA)), reverse(flatten(ValuesB)); disabled
subset_12 = SubList(List=sort_14.Keys, Domain=dom_17, Wrap=True)  # -> List, Index; disabled
subset_13 = SubList(List=sort_14.ValuesA, Domain=dom_17, Wrap=True)  # -> List, Index; disabled
subset_14 = SubList(List=sort_14.ValuesB, Domain=dom_17, Wrap=True)  # -> List, Index; disabled
expression_3 = Expression(x=subset_12.List, Expression="Round(x,2)")  # disabled
swatch_4 = ColourSwatch(SwatchColor=RGB(0, 191, 255))  # disabled
swatch_5 = ColourSwatch(SwatchColor=RGB(0, 0, 0))  # disabled
number_slider_25 = Slider(15, range=1..50)  # disabled
number_slider_26 = Slider(1, range=0..50)  # disabled
maxutilisation_2 = Panel(expression_3)  # disabled

item_40 = ListItem(List=maxutilisation, Index=0, Wrap=True)  # disabled

wbjoin = WeaverbirdsJoinMeshesAndWeld(Mesh=get_deformed_mesh_sofistika.DeformedMesh, Weld=False)  # disabled
wbjoin_2 = WeaverbirdsJoinMeshesAndWeld(Mesh=get_deformed_mesh_sofistika.InitialMesh, Weld=False)  # disabled
number_slider_27 = Slider(0.02, range=0..1)  # disabled
facen_3 = FaceNormals(Mesh=wbjoin_2)  # -> Centers, Normals; disabled
facen_4 = FaceNormals(Mesh=wbjoin)  # -> Centers, Normals; disabled
wbfacepolys_2 = WeaverbirdsFacePolylines(Mesh=wbjoin)  # -> flatten(Polygons); disabled
wbfacepolys_3 = WeaverbirdsFacePolylines(Mesh=wbjoin_2)  # -> flatten(Polygons); disabled
swatch_6 = ColourSwatch(SwatchColor=RGB(255, 0, 0))  # disabled
swatch_7 = ColourSwatch(SwatchColor=RGB(0, 0, 0))  # disabled
dist_3 = Distance(PointA=facen_3.Centers, PointB=facen_4.Centers)  # disabled
sph = Sphere(Base=pt_21, Radius=number_slider_27)  # disabled
sph_2 = Sphere(Base=item_39, Radius=number_slider_27)  # disabled
bnd_22 = Bounds(Numbers=dist_3)  # disabled
dedomain_21 = DeconstructDomain(Domain=bnd_22)  # -> Start, End; disabled
gradient_13 = Gradient(
    LowerLimit=dedomain_21.End,
    UpperLimit=dedomain_21.Start,
    Parameter=dist_3,
    stops=[0: RGBA(235, 39, 0, 80), 0.25: RGBA(235, 125, 0, 80), 0.5: RGBA(255, 244, 84, 80), 0.83: RGBA(172, 203, 250, 80), 1: RGBA(74, 77, 168, 80)])  # disabled
gradient_14 = Gradient(
    LowerLimit=dedomain_21.End,
    UpperLimit=dedomain_21.Start,
    Parameter=dist_3,
    stops=[0: RGBA(186, 31, 0, 45), 0.25: RGBA(199, 106, 0, 45), 0.5: RGBA(232, 217, 0, 45), 0.83: RGBA(0, 97, 242, 45), 1: RGBA(0, 8, 240, 45)])  # disabled
gradient_15 = Gradient(
    LowerLimit=number_slider_11,
    UpperLimit=dedomain_21.Start,
    Parameter=dist_3,
    stops=[0: RGB(234, 38, 0), 0.25: RGB(234, 126, 0), 0.5: RGB(254, 244, 84), 0.83: RGB(173, 203, 249), 1: RGB(74, 77, 168)])  # disabled
number_slider_28 = Slider(0.01, range=0..10)  # disabled
number_slider_29 = Slider(14, range=0..20)  # disabled

maxutilisation_3 = Panel(item_40)  # disabled

# ---- group: CLT Utilization
colourmesh_2 = ColourMesh(Mesh=get_deformed_mesh_sofistik_2.InitialMesh, Colors=gradient_10)
previewlw_3 = CustomPreviewLineweights(Geometry=wbfacepolys, Shader=gradient_12, Thickness=number_slider_23, Absolute=True)  # disabled
screentext = ScreenOrientedText(
    Text=maxutilisation_2,
    Justification=7,
    Location=subset_13.List,
    SizeFactor=number_slider_25,
    Color=swatch_5,
    Depth=number_slider_26,
    Absolute=False)  # disabled

# ---- group: Deformation / Deformed
colourmesh_3 = ColourMesh(Mesh=get_deformed_mesh_sofistika.DeformedMesh, Colors=gradient_15)
previewlw_4 = CustomPreviewLineweights(Geometry=wbfacepolys_2, Shader=gradient_14, Thickness=number_slider_28, Absolute=True)  # disabled
previewlw_5 = CustomPreviewLineweights(Geometry=sph_2, Shader=swatch_6, Thickness=number_slider_28, Absolute=True)  # disabled
screentext_2 = ScreenOrientedText(
    Text=concat_3,
    Font=item_10,
    Justification=7,
    Location=item_39,
    SizeFactor=number_slider_29,
    Color=swatch_7,
    Depth=0,
    Absolute=False)  # disabled

# ---- group: Deformation / Undeformed
colourmesh_4 = ColourMesh(Mesh=get_deformed_mesh_sofistika.InitialMesh, Colors=gradient_9)
previewlw_6 = CustomPreviewLineweights(Geometry=wbfacepolys_3, Shader=gradient_14, Thickness=number_slider_28, Absolute=True)  # disabled
screentext_3 = ScreenOrientedText(
    Text=concat_3,
    Font=item_10,
    Justification=7,
    Location=pt_21,
    SizeFactor=number_slider_29,
    Color=swatch_7,
    Depth=0,
    Absolute=False)  # disabled
previewlw_7 = CustomPreviewLineweights(Geometry=sph, Shader=swatch_6, Thickness=number_slider_28, Absolute=True)  # disabled
