# Grasshopper definition BilayerDesign - version1.2 - demonstrator.gh (Grasshopper 1.0.7)
# plug-ins: HygroDesign, Pufferfish, MeshEdit Components, Karamba3D, Kangaroo2 Components, Weaverbird, Human, LunchBox, Wombat, Opossum2_0_Proto_A

# ---- group: beech
panel = Panel("beech")
number_slider = Slider(0.0001, range=0..0.0001)
number_slider_2 = Slider(0.002, range=0..1)
number_slider_3 = Slider(0.0041, range=0..1)
number_slider_4 = Slider(14000, range=0..20000)
number_slider_5 = Slider(2280, range=0..20000)
number_slider_6 = Slider(1160, range=0..20000)
number_slider_7 = Slider(720, range=0..1000)

# ---- group: spruce
panel_2 = Panel("spruce")
number_slider_8 = Slider(0.0001, range=0..0.0001)
number_slider_9 = Slider(0.0019, range=0..1)
number_slider_10 = Slider(0.0036, range=0..1)
number_slider_11 = Slider(10000, range=0..20000)
number_slider_12 = Slider(800, range=0..20000)
number_slider_13 = Slider(450, range=0..20000)
number_slider_14 = Slider(400, range=0..1000)

# ---- group: must be even
number_slider_15 = Slider(2, range=0..10)

# ----
number_slider_16 = Slider(1000, range=0..1000)
rectangle = Rectangle(Plane=PlaneXY(0, 0, 0), XSize=number_slider_16, YSize=number_slider_16, Radius=0)  # -> Rectangle, Length
drec = DeconstuctRectangle(Rectangle=rectangle.Rectangle)  # -> BasePlane, XInterval, YInterval
dedomain = DeconstructDomain(Domain=drec.YInterval)  # -> Start, End
subtraction = Subtraction(A=dedomain.End, B=dedomain.Start)
division = Division(A=subtraction, B=2)
number_slider_17 = Slider(0.017, range=0..1)
number_slider_18 = Slider(0.997, range=0..1)
dom = ConstructDomain(DomainStart=0, DomainEnd=1)
number_slider_19 = Slider(0.998, range=0..1)
addition = Addition(A=dedomain.Start, B=division)
dom_2 = ConstructDomain(DomainStart=addition, DomainEnd=dedomain.End)
dom_3 = ConstructDomain(DomainStart=addition, DomainEnd=dedomain.Start)
remap = RemapNumbers(Value=number_slider_17, Source=dom, Target=dom_3)  # -> Mapped, Clipped
remap_2 = RemapNumbers(Value=number_slider_18, Source=dom, Target=drec.XInterval)  # -> Mapped, Clipped
remap_3 = RemapNumbers(Value=number_slider_17, Source=dom, Target=dom_2)  # -> Mapped, Clipped
remap_4 = RemapNumbers(Value=number_slider_19, Source=dom, Target=drec.XInterval)  # -> Mapped, Clipped
pt = ConstructPoint(XCoordinate=0, YCoordinate=remap_2.Mapped, ZCoordinate=0)
pt_2 = ConstructPoint(XCoordinate=remap.Mapped, YCoordinate=remap_4.Mapped, ZCoordinate=0)
pt_3 = ConstructPoint(XCoordinate=remap_3.Mapped, YCoordinate=remap_4.Mapped, ZCoordinate=0)
pt_4 = ConstructPoint(XCoordinate=number_slider_16, YCoordinate=remap_2.Mapped, ZCoordinate=0)
merge = Merge(Data1=pt, Data2=pt_2, Data3=pt_3, Data4=pt_4)
nurbs = NurbsCurve(Vertices=merge, Degree=2, Periodic=False)  # -> Curve, Length, Domain

number_slider_20 = Slider(1000, range=0..1000)
rectangle_2 = Rectangle(Plane=PlaneXY(0, 0, 0), XSize=number_slider_20, YSize=number_slider_20, Radius=0)  # -> Rectangle, Length
drec_2 = DeconstuctRectangle(Rectangle=rectangle_2.Rectangle)  # -> BasePlane, XInterval, YInterval
dedomain_2 = DeconstructDomain(Domain=drec_2.YInterval)  # -> Start, End
subtraction_2 = Subtraction(A=dedomain_2.End, B=dedomain_2.Start)
division_2 = Division(A=subtraction_2, B=2)
number_slider_21 = Slider(0.88, range=0..1)
number_slider_22 = Slider(0.025, range=0..1)
dom_4 = ConstructDomain(DomainStart=0, DomainEnd=1)
addition_2 = Addition(A=dedomain_2.Start, B=division_2)
number_slider_23 = Slider(0.998, range=0..1)
dom_5 = ConstructDomain(DomainStart=addition_2, DomainEnd=dedomain_2.End)
dom_6 = ConstructDomain(DomainStart=addition_2, DomainEnd=dedomain_2.Start)
remap_5 = RemapNumbers(Value=number_slider_21, Source=dom_4, Target=dom_6)  # -> Mapped, Clipped
remap_6 = RemapNumbers(Value=number_slider_22, Source=dom_4, Target=drec_2.XInterval)  # -> Mapped, Clipped
remap_7 = RemapNumbers(Value=number_slider_21, Source=dom_4, Target=dom_5)  # -> Mapped, Clipped
remap_8 = RemapNumbers(Value=number_slider_23, Source=dom_4, Target=drec_2.XInterval)  # -> Mapped, Clipped
pt_5 = ConstructPoint(XCoordinate=0, YCoordinate=remap_6.Mapped, ZCoordinate=0)
pt_6 = ConstructPoint(XCoordinate=remap_5.Mapped, YCoordinate=remap_8.Mapped, ZCoordinate=0)
pt_7 = ConstructPoint(XCoordinate=remap_7.Mapped, YCoordinate=remap_8.Mapped, ZCoordinate=0)
pt_8 = ConstructPoint(XCoordinate=number_slider_20, YCoordinate=remap_6.Mapped, ZCoordinate=0)
merge_2 = Merge(Data1=pt_5, Data2=pt_6, Data3=pt_7, Data4=pt_8)
nurbs_2 = NurbsCurve(Vertices=merge_2, Degree=2, Periodic=False)  # -> Curve, Length, Domain

number_slider_24 = Slider(1000, range=0..1000)
rectangle_3 = Rectangle(Plane=PlaneXY(0, 0, 0), XSize=number_slider_24, YSize=number_slider_24, Radius=0)  # -> Rectangle, Length
drec_3 = DeconstuctRectangle(Rectangle=rectangle_3.Rectangle)  # -> BasePlane, XInterval, YInterval
dedomain_3 = DeconstructDomain(Domain=drec_3.YInterval)  # -> Start, End
subtraction_3 = Subtraction(A=dedomain_3.End, B=dedomain_3.Start)
division_3 = Division(A=subtraction_3, B=2)
number_slider_25 = Slider(0.001, range=0..1)
dom_7 = ConstructDomain(DomainStart=0, DomainEnd=1)
number_slider_26 = Slider(0.155, range=0..1)
addition_3 = Addition(A=dedomain_3.Start, B=division_3)
number_slider_27 = Slider(0.01, range=0..1)
dom_8 = ConstructDomain(DomainStart=addition_3, DomainEnd=dedomain_3.End)
dom_9 = ConstructDomain(DomainStart=addition_3, DomainEnd=dedomain_3.Start)
remap_9 = RemapNumbers(Value=number_slider_26, Source=dom_7, Target=dom_9)  # -> Mapped, Clipped
remap_10 = RemapNumbers(Value=number_slider_25, Source=dom_7, Target=drec_3.XInterval)  # -> Mapped, Clipped
remap_11 = RemapNumbers(Value=number_slider_26, Source=dom_7, Target=dom_8)  # -> Mapped, Clipped
remap_12 = RemapNumbers(Value=number_slider_27, Source=dom_7, Target=drec_3.XInterval)  # -> Mapped, Clipped
pt_9 = ConstructPoint(XCoordinate=0, YCoordinate=remap_10.Mapped, ZCoordinate=0)
pt_10 = ConstructPoint(XCoordinate=remap_9.Mapped, YCoordinate=remap_12.Mapped, ZCoordinate=0)
pt_11 = ConstructPoint(XCoordinate=remap_11.Mapped, YCoordinate=remap_12.Mapped, ZCoordinate=0)
pt_12 = ConstructPoint(XCoordinate=number_slider_24, YCoordinate=remap_10.Mapped, ZCoordinate=0)
merge_3 = Merge(Data1=pt_9, Data2=pt_10, Data3=pt_11, Data4=pt_12)
nurbs_3 = NurbsCurve(Vertices=merge_3, Degree=2, Periodic=False)  # -> Curve, Length, Domain

int = Integer(number_slider_15)
number_slider_28 = Slider(0.042, range=0..0.5)
number_slider_29 = Slider(0.51, range=0.5..1)
board_count = Slider(500, range=0..500)
species = WoodSpecies(
    name=panel,
    density=number_slider_7,
    LExp=number_slider,
    RExp=number_slider_2,
    TExp=number_slider_3,
    LEmod=number_slider_4,
    REmod=number_slider_5,
    TEmod=number_slider_6)
species_2 = WoodSpecies(
    name=panel_2,
    density=number_slider_14,
    LExp=number_slider_8,
    RExp=number_slider_9,
    TExp=number_slider_10,
    LEmod=number_slider_11,
    REmod=number_slider_12,
    TEmod=number_slider_13)

number_slider_30 = Slider(150, range=0..10000)
number_slider_31 = Slider(5, range=0..10)
number_slider_32 = Slider(1000, range=0..10000)
number_slider_33 = Slider(13, range=0..100)
xy = XYPlane(Origin=Point(0, 0, 0))
multiplication = Multiplication(A=number_slider_33, B=number_slider_30)
multiplication_2 = Multiplication(A=number_slider_32, B=number_slider_31)
bilayer = Bilayer(
    BasePlane=xy,
    BoardWidth=number_slider_30,
    BoardLength=number_slider_32,
    WidthCount=number_slider_33,
    LengthCount=number_slider_31,
    ActiveThickness=Slider(20, range=0..100),
    PassiveThickness=Slider(4, range=0..100),
    PassiveSpecies=species_2,
    RegionCount=int)
rectangle_4 = Rectangle(Plane=PlaneXY(0, 0, 0), XSize=multiplication_2, YSize=multiplication, Radius=0)  # -> Rectangle, Length
num = Number(number_slider_30)
num_2 = Number(number_slider_32)

drec_4 = DeconstuctRectangle(Rectangle=rectangle_4.Rectangle)  # -> BasePlane, XInterval, YInterval
panel_3 = Panel(drec_4.XInterval)
panel_4 = Panel(drec_4.YInterval)

# ---- group: name
num_3 = Number(board_count)
series = Series(Start=0, Step=1, Count=num_3)
dup = DuplicateData(Data="S", Number=num_3, Order=True)  # -> graft(Data)
txt = Text(graft(series))
merge_4 = Merge(Data1=dup, Data2=txt)  # -> simplify(Result)
join = TextJoin(Text=merge_4)  # -> flatten(Result)

num_4 = Number(board_count)
series_2 = Series(Start=0, Step=1, Count=num_4)
dup_2 = DuplicateData(Data="B", Number=num_4, Order=True)  # -> graft(Data)
txt_2 = Text(graft(series_2))
merge_5 = Merge(Data1=dup_2, Data2=txt_2)  # -> simplify(Result)
join_2 = TextJoin(Text=merge_5)  # -> flatten(Result)

# ---- group: active thickness
number_slider_34 = Slider(20, range=0..100)

# ---- group: RT
dom_10 = ConstructDomain(DomainStart=Slider(15, range=0..100), DomainEnd=Slider(75, range=0..100))
random = Random(Range=dom_10, Number=board_count, Seed=Slider(225, range=0..1000))

# ----
panel_5 = Panel("C:\Users\Alex Reiner\Documents\GitHub\HygroDesign\Grasshopper")

# ---- group: spruce
data = Data(species_2)
num_5 = Number(board_count)
dup_3 = DuplicateData(Data=data, Number=num_5, Order=True)

# ---- group: beech
num_6 = Number(board_count)
data_2 = Data(species)
dup_4 = DuplicateData(Data=data_2, Number=num_6, Order=True)

# ---- group: thickness
num_7 = Number(number_slider_34)
num_8 = Number(board_count)
dup_5 = DuplicateData(Data=num_7, Number=num_8, Order=True)

# ---- group: length
num_9 = Number(num_2)
num_10 = Number(board_count)
dup_6 = DuplicateData(Data=num_9, Number=num_10, Order=True)

# ---- group: width
num_11 = Number(num)
num_12 = Number(board_count)
dup_7 = DuplicateData(Data=num_11, Number=num_12, Order=True)

# ----
num_13 = Number(board_count)
dup_8 = DuplicateData(Data=panel_5, Number=num_13, Order=True)
entwine = Entwine(Branch00=dup_7, Branch01=dup_7, FlattenInputs=True)  # -> flatten(Result)
entwine_2 = Entwine(Branch00=dup_5, Branch01=dup_5, FlattenInputs=True)  # -> flatten(Result)
entwine_3 = Entwine(Branch00=dup_6, Branch01=dup_6, FlattenInputs=True)  # -> flatten(Result)
entwine_4 = Entwine(Branch00=join_2, Branch01=join, FlattenInputs=True)  # -> flatten(Result)
entwine_5 = Entwine(Branch00=random, Branch01=random, FlattenInputs=True)  # -> flatten(Result)
entwine_6 = Entwine(Branch00=dup_8, Branch01=dup_8, FlattenInputs=True)  # -> flatten(Result)
entwine_7 = Entwine(Branch00=dup_4, Branch01=dup_3, FlattenInputs=True)  # -> flatten(Result)
stock_boards = StockBoards(
    Name=entwine_4,
    Species=entwine_7,
    Thickness=entwine_2,
    Length=entwine_3,
    Width=entwine,
    RTAngle=entwine_5,
    ImgPath=entwine_6)
merge_6 = Merge(Data1=nurbs.Curve, Data2=nurbs_2.Curve, Data3=nurbs_3.Curve)

crv = Curve(merge_6)
lng = ListLength(List=crv)  # -> expr("x-2", Length)
dom_11 = ConstructDomain(DomainStart=0, DomainEnd=lng)
subset = SubList(List=crv, Domain=dom_11, Wrap=True)  # -> graft(List), Index
shift = ShiftList(List=crv, Shift=1, Wrap=False)  # -> graft(List)
merge_7 = Merge(Data1=subset.List, Data2=shift)  # -> simplify(Result)
group = Group(Objects=merge_7)  # -> flatten(Group)

deconstruct_bilayer = DeconstructBilayer(Bilayer=bilayer)
dec_board = DeconstructBoard(Board=deconstruct_bilayer)  # -> Polyline, Name, Species, RTAngle, MoistureChange, DesiredRadius, Radius, BlendedRadius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
area = Area(Geometry=dec_board.Polyline)  # -> Area, Centroid
c_script = CSharpScript(rects=flatten(dec_board.Polyline))  # -> out; inputs rects: list of Rectangle3d; disabled
# ---------- c_script: C# usings ----------
using Rhino.DocObjects;
# ---------- c_script: C# ----------
    var object_enumerator_settings = new ObjectEnumeratorSettings();

    var rhinoObjects = RhinoDoc.ActiveDoc.Objects.GetObjectList(object_enumerator_settings);
    var objectTable = RhinoDoc.ActiveDoc.Objects;

    foreach( var rhinoObject in rhinoObjects)
    {
      if(rhinoObject.ObjectType == ObjectType.Curve)
      {
        Curve rhinoCurve = rhinoObject.Geometry as Curve;
        if(rhinoCurve.IsClosed)objectTable.Delete(rhinoObject);
      }
    }

    foreach(var rect in rects)objectTable.AddCurve(rect.ToNurbsCurve());
# ---------- end c_script ----------
pt_13 = Point(simplify(area.Centroid))

# ---- group: Thickness
dec_reg = DeconstructBoardRegion(BoardRegion=dec_board.BoardRegions)  # -> Polyline, Name, Species, RTAngle, MoistureChange, DesiredRadius, Radius, BlendedRadius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
area_2 = Area(Geometry=dec_reg.Polyline)  # -> Area, Centroid
pt_14 = Point(simplify(area_2.Centroid))

# ----
bbox = BoundingBox(Content=dec_board.Polyline, Plane=PlaneXY(0, 0, 0), UnionBox=True)  # -> Box, Box_2
debox = DeconstructBox(Box=bbox.Box)  # -> Plane, X, Y, Z
dedomain_4 = DeconstructDomain(Domain=debox.Y)  # -> Start, End
subtraction_4 = Subtraction(A=dedomain_4.End, B=dedomain_4.Start)
division_4 = Division(A=subtraction_4, B=2)
number_slider_35 = Slider(0.96, range=0.25..1)
number_slider_36 = Slider(0.128, range=0..0.75)
number_slider_37 = Slider(0.01, range=0..1)
addition_4 = Addition(A=dedomain_4.Start, B=division_4)
dom_12 = ConstructDomain(DomainStart=0, DomainEnd=1)
dom_13 = ConstructDomain(DomainStart=addition_4, DomainEnd=dedomain_4.End)
dom_14 = ConstructDomain(DomainStart=addition_4, DomainEnd=dedomain_4.Start)
remap_13 = RemapNumbers(Value=number_slider_35, Source=dom_12, Target=debox.X)  # -> Mapped, Clipped
remap_14 = RemapNumbers(Value=number_slider_36, Source=dom_12, Target=debox.X)  # -> Mapped, Clipped
remap_15 = RemapNumbers(Value=number_slider_37, Source=dom_12, Target=dom_14)  # -> Mapped, Clipped
remap_16 = RemapNumbers(Value=number_slider_37, Source=dom_12, Target=dom_13)  # -> Mapped, Clipped
pt_15 = ConstructPoint(XCoordinate=remap_13.Mapped, YCoordinate=dedomain_4.Start, ZCoordinate=0)
pt_16 = ConstructPoint(XCoordinate=remap_14.Mapped, YCoordinate=remap_15.Mapped, ZCoordinate=0)
pt_17 = ConstructPoint(XCoordinate=remap_14.Mapped, YCoordinate=remap_16.Mapped, ZCoordinate=0)
pt_18 = ConstructPoint(XCoordinate=remap_13.Mapped, YCoordinate=dedomain_4.End, ZCoordinate=0)
merge_8 = Merge(Data1=pt_15, Data2=pt_16, Data3=pt_17, Data4=pt_18)
nurbs_4 = NurbsCurve(Vertices=merge_8, Degree=2, Periodic=False)  # -> Curve, Length, Domain

# ---- group: generate distribution
pt_19 = Point(simplify(pt_14))
data_3 = Data(group)
pdecon = Deconstruct(Point=pt_19)  # -> XComponent, YComponent, ZComponent
bnd = Bounds(Numbers=flatten(pdecon.XComponent))
bnd_2 = Bounds(Numbers=flatten(pdecon.YComponent))
lng_2 = ListLength(List=data_3)
dedomain_5 = DeconstructDomain(Domain=bnd)  # -> Start, End
remap_17 = RemapNumbers(Value=pdecon.YComponent, Source=bnd_2, Target=Domain(0, 1))  # -> graft(Mapped), Clipped
c_script_2 = CSharpScript(count=lng_2, start=dedomain_5.Start, end=dedomain_5.End)  # -> out, A; inputs count: Int32, start: Double, end: Double
# ---------- c_script_2: C# ----------
    double totalLength = end - start;
    double domLength = totalLength / (double) count;

    List<Interval> intervals = new List<Interval>();
    double currentStart = start;
    for(int i = 0; i < count; i++)
    {
      intervals.Add(new Interval(currentStart, currentStart + domLength));
      currentStart += domLength;
    }
    A = intervals;
# ---------- end c_script_2 ----------
num_14 = Number(graft(pdecon.XComponent))
inc = Includes(Value=num_14, Domain=simplify(c_script_2.A))  # -> Includes, Deviation
cull = CullPattern(List=data_3, CullPattern=inc.Includes)
item = ListItem(List=cull, Index=0, Wrap=True)
cull_2 = CullPattern(List=c_script_2.A, CullPattern=inc.Includes)
ungroup = Ungroup(Group=item)  # -> simplify(Objects)
item_2 = ListItem(List=cull_2, Index=0, Wrap=True)
remap_18 = RemapNumbers(Value=num_14, Source=item_2, Target=Domain(0, 1))  # -> Mapped, Clipped
eval = EvaluateCurve(Curve=reparameterize(ungroup), Parameter=remap_17.Mapped)  # -> Point, Tangent, Angle
pdecon_2 = Deconstruct(Point=eval.Point)  # -> XComponent, YComponent, ZComponent
item_3 = ListItem(List=pdecon_2.YComponent, Index=0, Wrap=True)  # -> Item, Item1
twn2nums = TweenTwoNumbers(NumberA=item_3.Item, NumberB=item_3.Item1, Factor=remap_18.Mapped)
num_15 = Number(twn2nums)

# ----
movopossum_3_0_0 = Opossum(
    OpossumData_NumberOfObjectives=1,
    OpossumData_OptimizationType=0,
    OpossumData_ResultSerializationStatus=1,
    OpossumData_ObjectiveValue=[2219.335719, 2462.033712, 2310.644647, 2069.267926, 2290.303136, 2179.881229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],
    OpossumData_ParameterList=["0.050945,0.738086,0.544260,0.439874,0.177623,0.962945,0.787394,0.691938,0.750232,0.560148,0.252757,0.561031,0.905611,0.124175,0.526994,0.919459,0.970444,0.032299,0.117264,0.766929", "0.644515,0.922559,0.642800,0.553941,0.299018,0.161731,0.632700,0.015215,0.206400,0.045967,0.779896,0.281992,0.792653,0.068376,0.727615,0.218421,0.694542,0.398275,0.004620,0.987447", "0.836474,0.019588,0.221970,0.875730,0.665833,0.714385,0.333220,0.301772,0.016042,0.642603,0.402399,0.100442,0.980428,0.200209,0.884646,0.035641,0.844162,0.266007,0.179008,0.894393", "0.318713,0.123364,0.747969,0.783141,0.831072,0.654775,0.541327,0.960918,0.932745,0.232282,0.667290,0.155018,0.722749,0.275895,0.655811,0.100675,0.539461,0.447452,0.326138,0.702958", "0.572198,0.632838,0.826947,0.937734,0.478297,0.250390,0.156184,0.742910,0.403820,0.989954,0.543666,0.731947,0.577477,0.343555,0.612082,0.634597,0.857214,0.207505,0.246201,0.946498", "0.749511,0.386374,0.013276,0.362997,0.788810,0.030790,0.294632,0.162517,0.871688,0.723754,0.589943,0.378999,0.854983,0.189040,0.832528,0.333941,0.789101,0.054201,0.439879,0.620804"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],
    OpossumData_objective=avr_2,
    OpossumData_variable=[number_slider_26, number_slider_27, number_slider_25, number_slider_21, number_slider_23, number_slider_22, number_slider_18, number_slider_19, number_slider_17, number_slider_37, number_slider_35, number_slider_36, number_slider_44, number_slider_43, number_slider_45, number_slider_40, number_slider_42, number_slider_41, number_slider_28, number_slider_29])

# ---- group: material / beech
data_4 = Data(species)

# ---- group: material / Species
crv_2 = Curve(nurbs_4.Curve)

# ---- group: material / spruce
data_5 = Data(species_2)

# ---- group: material
pt_20 = Point(graft(pt_13))
xz = XZPlane(Origin=pt_20)
pcx = CurvePlane(Curve=crv_2, Plane=xz)  # -> simplify(Points), ParamsC, ParamsP
pdecon_3 = Deconstruct(Point=pcx.Points)  # -> XComponent, YComponent, ZComponent
pdecon_4 = Deconstruct(Point=pt_20)  # -> XComponent, YComponent, ZComponent
smaller = SmallerThan(FirstNumber=pdecon_3.XComponent, SecondNumber=pdecon_4.XComponent)  # -> SmallerThan, OrEqualTo
not = GateNot(A=smaller.SmallerThan)
cull_3 = CullPattern(List=data_4, CullPattern=not)
cull_4 = CullPattern(List=data_5, CullPattern=smaller.SmallerThan)
merge_9 = Merge(Data1=cull_3, Data2=cull_4)  # -> simplify(Result)
path_mapper = PathMapper(merge_9, source="{A}", target="{0}")

# ----
pt_21 = Point(pt_13)
pdecon_5 = Deconstruct(Point=pt_21)  # -> XComponent, YComponent, ZComponent
bnd_3 = Bounds(Numbers=flatten(pdecon_5.XComponent))
dom_15 = ConstructDomain(DomainStart="1", DomainEnd="0")
remap_19 = RemapNumbers(Value=pdecon_5.XComponent, Source=bnd_3, Target=dom_15)  # -> simplify(Mapped), Clipped

num_16 = Number(num_15)
rec = Rectangle(rectangle.Rectangle)
drec_5 = DeconstuctRectangle(Rectangle=rec)  # -> BasePlane, XInterval, YInterval
dom_16 = ConstructDomain(DomainStart=0, DomainEnd=Slider(1.2, range=0..10))
remap_20 = RemapNumbers(Value=num_16, Source=drec_5.YInterval, Target=dom_16)  # -> Mapped, Clipped
trim = TrimTree(Tree=remap_20.Mapped, Depth=1)

data_6 = Data(bilayer)

# ---- group: moisture changes
panel_6 = Panel("""10
5""")

# ---- group: timoshenko prediction
c_script_3 = CSharpScript(Reference="C:\Users\Alex Reiner\AppData\Roaming\Grasshopper\Libraries\HygroDesign.Core.dll")  # -> out, A
# ---------- c_script_3: C# usings ----------
using BilayerDesign;
# ---------- c_script_3: C# ----------
    TimoshenkoPrediction timo = new TimoshenkoPrediction();
    A = timo;
# ---------- c_script_3: C# additional code ----------
  public class TimoshenkoPrediction : PredictionEngine
  {

    public TimoshenkoPrediction()
    {
    }

    public override double Predict(StockBoard board, Bilayer bilayer, double moistureChange)
    {
      double h1 = bilayer.PassiveLayer.Height;
      double h2 = bilayer.ActiveThickness;
      double h = h1 + h2;
      double m = h1 / h2;
      double e1 = bilayer.PassiveLayer.Species.Attributes["LEmod"];
      double e2 = GrainAngleInterpolation(board.RTAngle, board.Species.Attributes["REmod"], board.Species.Attributes["TEmod"]);
      double n = e1 / e2;
      double a1 = bilayer.PassiveLayer.Species.Attributes["LExp"];
      double a2 = GrainAngleInterpolation(board.RTAngle, board.Species.Attributes["RExp"], board.Species.Attributes["TExp"]);
      double deltaAlpha = a2 - a1;
      double kValue = 6 * Math.Pow(1.0 + m, 2) / (3 * Math.Pow(1 + m, 2) + (1 + m * n) * Math.Pow(m, 2) + (1 / (m * n)));
      double curvature = kValue * ((moistureChange * deltaAlpha) / h);
      return 1 / (curvature /* * TimError*/ );
    }

    public static double GrainAngleInterpolation(double rtAngle, double eR, double eT)
    {
      double angleConv = RhinoMath.ToRadians(rtAngle);
      double angleT = Math.Cos(angleConv);
      double angleR = Math.Sin(angleConv);
      double eActive = eT * Math.Pow(angleT, 2) + eR * Math.Pow(angleR, 2);
      return eActive;
    }
  }
# ---------- end c_script_3 ----------

# ---- group: convolution v1
c_script_4 = CSharpScript(
    tan=Slider(1, range=0.01..3),
    lon=Slider(1, range=0.01..3),
    rad=Slider(10000, range=0..10000),
    stiff=Slider(0.1, range=0.01..3),
    thick=Slider(0.1, range=0.01..3),
    Reference="C:\Users\Alex Reiner\AppData\Roaming\Grasshopper\Libraries\HygroDesign.Core.dll")  # -> out, A; inputs tan: Double, lon: Double, rad: Double, stiff: Double, thick: Double
# ---------- c_script_4: C# ----------
    MyConvolution convEngine = new MyConvolution(tan, lon, rad, stiff, thick);
    A = convEngine;
# ---------- c_script_4: C# additional code ----------
  public class MyConvolution : ConvolutionEngine
  {
    double Tangential { get; set; }
    double Longitudinal { get; set; }
    double RadiusMax { get; set; }
    double StiffnessInfluence { get; set; }
    double ThicknessInfluence { get; set; }

    public MyConvolution(double tangential, double longitudinal, double radiusMax, double stiffnessInfluence, double thicknessInfluence)
    {
      Tangential = tangential;
      Longitudinal = longitudinal;
      RadiusMax = radiusMax;
      StiffnessInfluence = stiffnessInfluence;
      ThicknessInfluence = thicknessInfluence;
    }

    public override Panel Convolution(Panel panel)
    {
      panel = SetConvolutionFactors(panel, RadiusMax, StiffnessInfluence);
      panel = CurvatureConvolution(panel, Longitudinal, Tangential);
      return ThicknessConvolution(panel, ThicknessInfluence);
    }

    public Panel SetConvolutionFactors(Panel panel, double maxRadiusInfluence, double stiffnessFactor)
    {
      //get stiffness bounds
      double maxLongStiffness = 0;
      double minLongStiffness = double.MaxValue;
      double maxHorizStiffness = 0;
      double minHorizStiffness = double.MaxValue;
      double minCurvature = double.MaxValue;

      foreach (Bilayer bilayer in panel.Bilayers)
      {
        foreach (ActiveBoard board in bilayer.Boards)
        {
          if (board.Species.Attributes["LEmod"] > maxLongStiffness) maxLongStiffness = board.Species.Attributes["LEmod"];
          if (board.Species.Attributes["LEmod"] < minLongStiffness) minLongStiffness = board.Species.Attributes["LEmod"];
          if (board.Species.Attributes["REmod"] > maxHorizStiffness) maxHorizStiffness = board.Species.Attributes["REmod"];
          if (board.Species.Attributes["REmod"] < minHorizStiffness) minHorizStiffness = board.Species.Attributes["REmod"];
          if (board.Radius < minCurvature) minCurvature = board.Radius;
        }
      }

      foreach (Bilayer bilayer in panel.Bilayers)
      {
        //set factors
        foreach (ActiveBoard board in bilayer.Boards)
        {
          board.LongStiffnessFactor = Panel.Remap(board.Species.Attributes["LEmod"], minLongStiffness, maxLongStiffness, 1 - stiffnessFactor, 1);
          board.RadStiffnessFactor = Panel.Remap(board.Species.Attributes["REmod"], minHorizStiffness, maxHorizStiffness, 1 - stiffnessFactor, 1);

          board.RadiusFactor = Panel.Remap(board.Radius, minCurvature, maxRadiusInfluence, 1, 0);
        }
      }

      return panel;

    }

    public Panel CurvatureConvolution(Panel panel, double horizontal, double vertical)
    {
      foreach (Bilayer bilayer in panel.Bilayers)
      {
        foreach (ActiveBoard board in bilayer.Boards)
        {
          board.ConvolutionWeights = new List<Tuple<double, double>>();

          foreach (ActiveBoard testBoard in bilayer.Boards)
          {
            double closestX = double.MaxValue;
            double closestY = double.MaxValue;

            if (Math.Abs(testBoard.RowRange[0] - board.Centroid.X) < closestX) closestX = Math.Abs(testBoard.RowRange[0] - board.Centroid.X);
            if (Math.Abs(testBoard.RowRange[1] - board.Centroid.X) < closestX) closestX = Math.Abs(testBoard.RowRange[1] - board.Centroid.X);
            if (testBoard.RowRange[0] <= board.Centroid.X + 10 && testBoard.RowRange[1] >= board.Centroid.X - 10) closestX = 0;
            if (Math.Abs(testBoard.Centroid.X - board.Centroid.X) < closestX) closestX = Math.Abs(testBoard.Centroid.X - board.Centroid.X);

            if (Math.Abs(testBoard.ColumnRange[0] - board.Centroid.Y) < closestY) closestY = Math.Abs(testBoard.ColumnRange[0] - board.Centroid.Y);
            if (Math.Abs(testBoard.ColumnRange[1] - board.Centroid.Y) < closestY) closestY = Math.Abs(testBoard.ColumnRange[1] - board.Centroid.Y);
            if (testBoard.ColumnRange[0] <= board.Centroid.Y + 10 && testBoard.ColumnRange[1] >= board.Centroid.Y - 10) closestY = board.Width / 2;
            if (Math.Abs(testBoard.Centroid.Y - board.Centroid.Y) < closestY) closestY = Math.Abs(testBoard.Centroid.Y - board.Centroid.Y);

            double LongFactor = testBoard.LongStiffnessFactor / Math.Pow(closestX + 1, horizontal);
            double RadFactor = testBoard.RadStiffnessFactor / Math.Pow(closestY + 1, vertical);

            board.ConvolutionWeights.Add(new Tuple<double, double>(testBoard.Radius, testBoard.RadiusFactor * (LongFactor * RadFactor)));
          }
        }

        foreach (ActiveBoard board in bilayer.Boards)
        {

          double weightSum = 0;
          foreach (Tuple<double, double> valueWeight in board.ConvolutionWeights)
          {
            board.BlendedRadius += valueWeight.Item1 * valueWeight.Item2;
            weightSum += valueWeight.Item2;

          }
          board.BlendedRadius /= weightSum;

        }
      }
      return panel;
    }

    public Panel ThicknessConvolution(Panel panel, double thicknessFactor)
    {
      double minThickness = double.MaxValue;
      double maxThickness = 0;
      foreach (Bilayer bilayer in panel.Bilayers)
      {
        double thickness = bilayer.ActiveThickness + bilayer.PassiveLayer.Height;
        if (thickness < minThickness) minThickness = thickness;
        if (thickness > maxThickness) maxThickness = thickness;
      }

      panel.FindThicknessNeighbors();

      foreach (Bilayer bilayer in panel.Bilayers)
      {
        double bilayerThicknessFactor = 1;
        if (minThickness != maxThickness) bilayerThicknessFactor = Panel.Remap(bilayer.ActiveThickness + bilayer.PassiveLayer.Height, minThickness, maxThickness, 1 - thicknessFactor, 1);

        foreach (ActiveBoard board in bilayer.Boards)
        {
          double weights = board.RadStiffnessFactor + bilayerThicknessFactor;
          double weightedTotal = board.BlendedRadius * weights;

          foreach (BoardRegion region in board.Regions)
          {
            foreach (BoardRegion regionNeighbor in region.RegionStack)
            {
              double neighborThicknessFactor = 1;
              if (minThickness != maxThickness) neighborThicknessFactor = Panel.Remap(regionNeighbor.Parent.Parent.ActiveThickness + regionNeighbor.Parent.Parent.PassiveLayer.Height, minThickness, maxThickness, 1 - thicknessFactor, 1);

              weights += regionNeighbor.Parent.RadStiffnessFactor + neighborThicknessFactor;

              weightedTotal += regionNeighbor.Parent.BlendedRadius * (regionNeighbor.Parent.RadStiffnessFactor + neighborThicknessFactor);
            }

            region.ThicknessBlendedRadius = weightedTotal / weights;
          }
        }
      }
      return panel;
    }
  }
# ---------- end c_script_4 ----------

# ----
division_5 = Division(A=int, B=2)
number_slider_38 = Slider(10, range=0..10)
dom_17 = ConstructDomain(DomainStart=Slider(0.105, range=0..1), DomainEnd=Slider(0.784, range=0..1))

number_slider_39 = Slider(1000, range=0..1000)
neg = Negative(Value=number_slider_39)
rectangle_5 = Rectangle(Plane=PlaneXY(0, 0, 0), XSize=number_slider_39, YSize=neg, Radius=0)  # -> Rectangle, Length
drec_6 = DeconstuctRectangle(Rectangle=rectangle_5.Rectangle)  # -> BasePlane, XInterval, YInterval
dedomain_6 = DeconstructDomain(Domain=drec_6.XInterval)  # -> Start, End
dedomain_7 = DeconstructDomain(Domain=drec_6.YInterval)  # -> Start, End
pt_22 = ConstructPoint(XCoordinate=dedomain_6.Start, YCoordinate=0, ZCoordinate=0)
pt_23 = ConstructPoint(XCoordinate=dedomain_6.End, YCoordinate=0, ZCoordinate=0)
subtraction_5 = Subtraction(A=dedomain_7.End, B=dedomain_7.Start)
ln = Line(StartPoint=pt_22, EndPoint=pt_23)
number_slider_40 = Slider(0.004, range=0..1)
number_slider_41 = Slider(0.003, range=0..0.5)
number_slider_42 = Slider(1, range=0.5..1)
number_slider_43 = Slider(0.485, range=0..0.5)
number_slider_44 = Slider(0.501, range=0.5..1)
number_slider_45 = Slider(0.504, range=0.5..1)
divide = DivideCurve(Curve=ln, Count=expr("x-1", Slider(3, range=0..10)), Kinks=False)  # -> Points, Tangents, Parameters
multiplication_3 = Multiplication(A=subtraction_5, B=number_slider_42)
multiplication_4 = Multiplication(A=subtraction_5, B=number_slider_41)
multiplication_5 = Multiplication(A=subtraction_5, B=number_slider_45)
multiplication_6 = Multiplication(A=subtraction_5, B=number_slider_40)
multiplication_7 = Multiplication(A=subtraction_5, B=number_slider_44)
multiplication_8 = Multiplication(A=subtraction_5, B=number_slider_43)
neg_2 = Negative(Value=multiplication_4)
neg_3 = Negative(Value=multiplication_3)
neg_4 = Negative(Value=multiplication_6)
neg_5 = Negative(Value=multiplication_5)
neg_6 = Negative(Value=multiplication_8)
neg_7 = Negative(Value=multiplication_7)
item_4 = ListItem(List=divide.Points, Index=0, Wrap=True)  # -> Item, Item1, Item2
Y = UnitY(Factor=neg_2)
Y_2 = UnitY(Factor=neg_4)
Y_3 = UnitY(Factor=neg_3)
Y_4 = UnitY(Factor=neg_5)
Y_5 = UnitY(Factor=neg_6)
Y_6 = UnitY(Factor=neg_7)
move = Move(Geometry=[item_4.Item, item_4.Item2], Motion=Y)  # -> Geometry, Transform
move_2 = Move(Geometry=item_4.Item1, Motion=Y_3)  # -> Geometry, Transform
move_3 = Move(Geometry=[item_4.Item, item_4.Item2], Motion=Y_2)  # -> Geometry, Transform
move_4 = Move(Geometry=item_4.Item1, Motion=Y_4)  # -> Geometry, Transform
move_5 = Move(Geometry=[item_4.Item, item_4.Item2], Motion=Y_5)  # -> Geometry, Transform
move_6 = Move(Geometry=item_4.Item1, Motion=Y_6)  # -> Geometry, Transform
item_5 = ListItem(List=move.Geometry, Index=0, Wrap=True)  # -> Item, Item1
item_6 = ListItem(List=move_3.Geometry, Index=0, Wrap=True)  # -> Item, Item1
item_7 = ListItem(List=move_5.Geometry, Index=0, Wrap=True)  # -> Item, Item1
merge_10 = Merge(Data1=flatten(item_5.Item), Data2=flatten(move_2.Geometry), Data3=flatten(item_5.Item1))
merge_11 = Merge(Data1=flatten(item_6.Item), Data2=flatten(move_4.Geometry), Data3=flatten(item_6.Item1))
merge_12 = Merge(Data1=flatten(item_7.Item), Data2=flatten(move_6.Geometry), Data3=flatten(item_7.Item1))
intcrv = Interpolate(Vertices=merge_10, Degree=3, Periodic=False, KnotStyle=1)  # -> Curve, Length, Domain
intcrv_2 = Interpolate(Vertices=merge_11, Degree=3, Periodic=False, KnotStyle=1)  # -> Curve, Length, Domain
intcrv_3 = Interpolate(Vertices=merge_12, Degree=3, Periodic=False, KnotStyle=1)  # -> Curve, Length, Domain
rec_2 = Rectangle(rectangle_5.Rectangle)

multiplication_9 = Multiplication(A=subtraction_5, B=number_slider_29)
multiplication_10 = Multiplication(A=subtraction_5, B=number_slider_28)
neg_8 = Negative(Value=multiplication_10)
neg_9 = Negative(Value=multiplication_9)
Y_7 = UnitY(Factor=neg_8)
Y_8 = UnitY(Factor=neg_9)
move_7 = Move(Geometry=[item_4.Item, item_4.Item2], Motion=Y_7)  # -> Geometry, Transform
move_8 = Move(Geometry=item_4.Item1, Motion=Y_8)  # -> Geometry, Transform
item_8 = ListItem(List=move_7.Geometry, Index=0, Wrap=True)  # -> Item, Item1
merge_13 = Merge(Data1=flatten(item_8.Item), Data2=flatten(move_8.Geometry), Data3=flatten(item_8.Item1))
intcrv_4 = Interpolate(Vertices=merge_13, Degree=3, Periodic=False, KnotStyle=1)  # -> Curve, Length, Domain

merge_14 = Merge(Data1=intcrv.Curve, Data2=intcrv_2.Curve, Data3=intcrv_3.Curve, Data4=intcrv_4.Curve)

# ---- group: bounding rectangle input (rectangle y domain represents full range of radii from stockpiles)
rec_3 = Rectangle(rec_2)

# ---- group: curve controller inputs (represents distribution of radii along a given cross section)
crv_3 = Curve(merge_14)

# ----
crv_4 = Curve(crv_3)
lng_3 = ListLength(List=crv_4)  # -> expr("x-2", Length)
dom_18 = ConstructDomain(DomainStart=0, DomainEnd=lng_3)
subset_2 = SubList(List=crv_4, Domain=dom_18, Wrap=True)  # -> graft(List), Index
shift_2 = ShiftList(List=crv_4, Shift=1, Wrap=False)  # -> graft(List)
merge_15 = Merge(Data1=subset_2.List, Data2=shift_2)  # -> simplify(Result)
group_2 = Group(Objects=merge_15)  # -> flatten(Group)

# ---- group: generate distribution
pt_24 = Point(simplify(pt_13))
data_7 = Data(group_2)
pdecon_6 = Deconstruct(Point=pt_24)  # -> XComponent, YComponent, ZComponent
bnd_4 = Bounds(Numbers=flatten(pdecon_6.XComponent))
bnd_5 = Bounds(Numbers=flatten(pdecon_6.YComponent))
lng_4 = ListLength(List=data_7)
dedomain_8 = DeconstructDomain(Domain=bnd_4)  # -> Start, End
remap_21 = RemapNumbers(Value=pdecon_6.YComponent, Source=bnd_5, Target=Domain(0, 1))  # -> graft(Mapped), Clipped
c_script_5 = CSharpScript(count=lng_4, start=dedomain_8.Start, end=dedomain_8.End)  # -> out, A; inputs count: Int32, start: Double, end: Double; same code as c_script_2
num_17 = Number(graft(pdecon_6.XComponent))
inc_2 = Includes(Value=num_17, Domain=simplify(c_script_5.A))  # -> Includes, Deviation
cull_5 = CullPattern(List=data_7, CullPattern=inc_2.Includes)
item_9 = ListItem(List=cull_5, Index=0, Wrap=True)
cull_6 = CullPattern(List=c_script_5.A, CullPattern=inc_2.Includes)
ungroup_2 = Ungroup(Group=item_9)  # -> simplify(Objects)
item_10 = ListItem(List=cull_6, Index=0, Wrap=True)
remap_22 = RemapNumbers(Value=num_17, Source=item_10, Target=Domain(0, 1))  # -> Mapped, Clipped
eval_2 = EvaluateCurve(Curve=reparameterize(ungroup_2), Parameter=remap_21.Mapped)  # -> Point, Tangent, Angle
pdecon_7 = Deconstruct(Point=eval_2.Point)  # -> XComponent, YComponent, ZComponent
item_11 = ListItem(List=pdecon_7.YComponent, Index=0, Wrap=True)  # -> Item, Item1
twn2nums_2 = TweenTwoNumbers(NumberA=item_11.Item, NumberB=item_11.Item1, Factor=remap_22.Mapped)
num_18 = Number(twn2nums_2)

# ----
num_19 = Number(num_18)
rec_4 = Rectangle(rec_3)
drec_7 = DeconstuctRectangle(Rectangle=rec_4)  # -> BasePlane, XInterval, YInterval
dom_19 = ConstructDomain(DomainStart=0, DomainEnd=1)
remap_23 = RemapNumbers(Value=num_19, Source=drec_7.YInterval, Target=dom_19)  # -> Mapped, Clipped
trim_2 = TrimTree(Tree=remap_23.Mapped, Depth=1)

update_bilayer = UpdateBilayer(Bilayer=data_6, Radius=trim_2, RadiusWeight=remap_19.Mapped, Material=path_mapper)
dup_bilayer = DuplicateBilayer(Bilayer=update_bilayer, Count=Slider(2, range=0..10))
panel_7 = Panel(Bilayers=dup_bilayer)
adjust_cro_sec = AdjustCrossSection(Panel=panel_7, Thicknesses=trim)
dup_panel = DuplicatePanel(Panel=adjust_cro_sec, Count=Slider(3, range=0..10))

data_8 = Data(dup_panel)
data_9 = Data(stock_boards)
num_20 = Number(panel_6)
rad_pred = RadiusPrediction(Panels=data_8, StockBoards=data_9, MoistureChanges=num_20, PredictionEngine=c_script_3.A)
design_env = DesignEnvironment(Panels=data_8, StockPile=rad_pred)
convolution = CurvatureConvolution(Panels=design_env, ConvolutionEngine=c_script_4.A)

item_12 = ListItem(List=convolution, Index=0, Wrap=True)  # -> Item, Item1
deconstruct_panel = DeconstructPanel(Panel=item_12.Item)
deconstruct_bilayer_2 = DeconstructBilayer(Bilayer=deconstruct_panel)
dec_board_2 = DeconstructBoard(Board=deconstruct_bilayer_2)  # -> Polyline, Name, Species, RTAngle, MoistureChange, DesiredRadius, Radius, BlendedRadius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
display_panel = DisplayPanels(Panels=item_12.Item)  # -> ActiveBoards, PassiveBoards
dec_reg_2 = DeconstructBoardRegion(BoardRegion=dec_board_2.BoardRegions)  # -> Polyline, Name, Species, RTAngle, MoistureChange, DesiredRadius, Radius, BlendedRadius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

cross_section = BooleanToggle(True)
relaxation = BooleanToggle(False)
cull_7 = CullPattern(List=convolution, CullPattern=cross_section)

crosecset = UniqueCrossSections(Panel=cull_7)
dec_reg_3 = DeconstructBoardRegion(BoardRegion=crosecset)  # -> Polyline, Name, Species, RTAngle, MoistureChange, DesiredRadius, Radius, BlendedRadius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

bbox_2 = BoundingBox(Content=flatten(dec_reg_2.Polyline), Plane=PlaneXY(0, 0, 0), UnionBox=True)  # -> Box, Box_2
debox_2 = DeconstructBox(Box=bbox_2.Box)  # -> Plane, X, Y, Z
dedomain_9 = DeconstructDomain(Domain=debox_2.Y)  # -> Start, End
subtraction_6 = Subtraction(A=dedomain_9.End, B=dedomain_9.Start)
multiplication_11 = Multiplication(A=subtraction_6, B="1.5")
series_3 = Series(Start=Slider(10000, range=0..10000), Step=multiplication_11, Count=Slider(10, range=0..10))
item_13 = ListItem(List=series_3, Index=0, Wrap=True)  # -> Item, Item1, Item2, Item3, Item4, Item5

deconstruct_bilayer_3 = DeconstructBilayer(Bilayer=deconstruct_panel)
bang = ExplodeTree(Data=deconstruct_bilayer_3)
c_script_6 = CSharpScript(tree=dec_reg_3.Polyline, downsample=division_5)  # -> out, A; inputs tree: tree, downsample: Int32
# ---------- c_script_6: C# ----------
    DataTree<object> output = new DataTree<object>();
    for(int i = 0; i < tree.BranchCount; i++)
    {
      if(tree.Paths[i][1] % downsample == 0)
      {
        output.AddRange(tree.Branch(i), tree.Paths[i]);
      }
    }
    A = output;
# ---------- end c_script_6 ----------
c_script_7 = CSharpScript(tree=dec_reg_3.ThicknessBlendedRadius, downsample=division_5)  # -> out, A; inputs tree: tree, downsample: Int32; same code as c_script_6
dec_board_3 = DeconstructBoard(Board=bang)  # -> Polyline, Name, Species, RTAngle, MoistureChange, DesiredRadius, Radius, BlendedRadius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
dec_reg_4 = DeconstructBoardRegion(BoardRegion=dec_board_3.BoardRegions)  # -> Polyline, Name, Species, RTAngle, MoistureChange, DesiredRadius, Radius, BlendedRadius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

bnd_6 = Bounds(Numbers=flatten(dec_reg_2.ThicknessBlendedRadius))
dedomain_10 = DeconstructDomain(Domain=bnd_6)  # -> Start, End
Y_9 = UnitY(Factor=item_13.Item)
gradient = Gradient(
    LowerLimit=dedomain_10.Start,
    UpperLimit=dedomain_10.End,
    Parameter=dec_reg_2.ThicknessBlendedRadius,
    stops=[0: RGB(255, 255, 255), 1: RGB(0, 0, 0)])
vec = Vector(Y_9)
move_9 = Move(Geometry=display_panel.ActiveBoards, Motion=vec)  # -> Geometry, Transform
move_10 = Move(Geometry=display_panel.PassiveBoards, Motion=vec)  # -> Geometry, Transform
area_3 = Area(Geometry=move_9.Geometry)  # -> Area, Centroid
Z = UnitZ(Factor=Slider(10, range=0..10))
move_11 = Move(Geometry=area_3.Centroid, Motion=Z)  # -> Geometry, Transform
round = Round(Number=dec_reg_2.ThicknessBlendedRadius)  # -> Nearest, Floor, Ceiling
preview = CustomPreview(Geometry=move_10.Geometry, Material=gradient)  # disabled
tag = TextTag3D(Location=move_11.Geometry, Text=round.Nearest, Size=Slider(100, range=0..100), Colour=RGB(255, 0, 0), Justification=5)
preview_2 = CustomPreview(Geometry=move_9.Geometry, Material=gradient)

panel_8 = Panel(bnd_6)
dec_panel_buildups = DeconstructPanelBuildup(Panels=item_12.Item)  # -> WoodSpecies, Thicknesses, Face

python = GhPythonScript(x=dec_reg_2.Species)  # -> out, a
# ---------- python: Python ----------
a = x.Name
# ---------- end python ----------
len = TextLength(Text=python.a)
bnd_7 = Bounds(Numbers=flatten(len))
dedomain_11 = DeconstructDomain(Domain=bnd_7)  # -> Start, End
gradient_2 = Gradient(
    LowerLimit=dedomain_11.Start,
    UpperLimit=dedomain_11.End,
    Parameter=len,
    stops=[0: RGB(80, 55, 25), 0.5: RGB(159, 65, 29), 1: RGB(174, 166, 129)])
Y_10 = UnitY(Factor=item_13.Item4)
vec_2 = Vector(Y_10)
move_12 = Move(Geometry=display_panel.ActiveBoards, Motion=vec_2)  # -> Geometry, Transform
move_13 = Move(Geometry=display_panel.PassiveBoards, Motion=vec_2)  # -> Geometry, Transform
preview_3 = CustomPreview(Geometry=move_12.Geometry, Material=gradient_2)
preview_4 = CustomPreview(Geometry=move_13.Geometry, Material=ColourSwatch(SwatchColor=RGB(115, 115, 115)))  # disabled

mesh = Mesh(dec_reg_4.Polyline)
lng_5 = ListLength(List=dec_panel_buildups.WoodSpecies)

c_script_8 = CSharpScript(desired=dec_reg_2.DesiredRadius, actual=dec_reg_2.ThicknessBlendedRadius)  # -> out, A; inputs desired: Double, actual: Double
# ---------- c_script_8: C# ----------
    A = 100 * Math.Abs(desired - actual) / ((desired + actual) / 2);
# ---------- end c_script_8 ----------
bnd_8 = Bounds(Numbers=flatten(c_script_8.A))
panel_9 = Panel(bnd_8)
Y_11 = UnitY(Factor=item_13.Item1)
gradient_3 = Gradient(LowerLimit=0, UpperLimit="100", Parameter=c_script_8.A, stops=[0.15: RGB(255, 130, 160), 0.85: RGB(220, 0, 40)])
vec_3 = Vector(Y_11)
move_14 = Move(Geometry=display_panel.ActiveBoards, Motion=vec_3)  # -> Geometry, Transform
move_15 = Move(Geometry=display_panel.PassiveBoards, Motion=vec_3)  # -> Geometry, Transform
swatch = ColourSwatch(SwatchColor=RGBA(0, 0, 0, 66))
preview_5 = CustomPreview(Geometry=move_14.Geometry, Material=gradient_3)
preview_6 = CustomPreview(Geometry=move_15.Geometry, Material=gradient_3)  # disabled

c_script_9 = CSharpScript(x=lng_5)  # -> out, flatten(A); inputs x: tree
# ---------- c_script_9: C# ----------
    DataTree<object> output = new DataTree<object>();
    int firstIndex = 0;
    int branchCount = 0;
    for(int i = 0; i < x.BranchCount; i++)
    {
      GH_Path path = new GH_Path(firstIndex, branchCount);
      if(x.Paths[i][0] == firstIndex)
      {
        output.AddRange(x.Branch(i), path);
      }
      else
      {
        firstIndex++;
        branchCount = -1;
        i--;
      }
      branchCount++;
    }
    A = output;
# ---------- end c_script_9 ----------

bnd_9 = Bounds(Numbers=flatten(c_script_9.A))
dedomain_12 = DeconstructDomain(Domain=bnd_9)  # -> Start, End
gradient_4 = Gradient(
    LowerLimit=dedomain_12.Start,
    UpperLimit=dedomain_12.End,
    Parameter=c_script_9.A,
    stops=[0: RGB(0, 128, 0), 0.5: RGB(255, 255, 0), 1: RGB(255, 0, 0)])
Y_12 = UnitY(Factor=item_13.Item5)
vec_4 = Vector(Y_12)
move_16 = Move(Geometry=mesh, Motion=vec_4)  # -> flatten(Geometry), Transform
preview_7 = CustomPreview(Geometry=move_16.Geometry, Material=gradient_4)

bnd_10 = Bounds(Numbers=flatten(dec_reg_2.RTAngle))
dedomain_13 = DeconstructDomain(Domain=bnd_10)  # -> Start, End
gradient_5 = Gradient(
    LowerLimit=dedomain_13.Start,
    UpperLimit=dedomain_13.End,
    Parameter=dec_reg_2.RTAngle,
    stops=[0: RGB(124, 0, 219), 1: RGB(207, 130, 255)])
Y_13 = UnitY(Factor=item_13.Item2)
vec_5 = Vector(Y_13)
move_17 = Move(Geometry=display_panel.ActiveBoards, Motion=vec_5)  # -> Geometry, Transform
move_18 = Move(Geometry=display_panel.PassiveBoards, Motion=vec_5)  # -> Geometry, Transform
preview_8 = CustomPreview(Geometry=move_17.Geometry, Material=gradient_5)
preview_9 = CustomPreview(Geometry=move_18.Geometry, Material=ColourSwatch(SwatchColor=RGB(115, 115, 115)))  # disabled

bnd_11 = Bounds(Numbers=flatten(dec_reg_2.MoistureChange))
dedomain_14 = DeconstructDomain(Domain=bnd_11)  # -> Start, End
Y_14 = UnitY(Factor=item_13.Item3)
gradient_6 = Gradient(
    LowerLimit=dedomain_14.Start,
    UpperLimit=dedomain_14.End,
    Parameter=dec_reg_2.MoistureChange,
    stops=[0: RGB(156, 216, 217), 0.502: RGB(77, 123, 135), 1: RGB(55, 81, 102)])
vec_6 = Vector(Y_14)
move_19 = Move(Geometry=display_panel.ActiveBoards, Motion=vec_6)  # -> Geometry, Transform
move_20 = Move(Geometry=display_panel.PassiveBoards, Motion=vec_6)  # -> Geometry, Transform
preview_10 = CustomPreview(Geometry=move_19.Geometry, Material=gradient_6)
preview_11 = CustomPreview(Geometry=move_20.Geometry, Material=ColourSwatch(SwatchColor=RGB(115, 115, 115)))  # disabled

c_script_10 = CSharpScript(x=c_script_7.A)  # -> out, A; inputs x: tree; same code as c_script_9

crv_5 = Curve(c_script_6.A)
area_4 = Area(Geometry=crv_5)  # -> Area, Centroid
bbox_3 = BoundingBox(Content=flatten(dec_reg_3.Polyline), Plane=PlaneXY(0, 0, 0), UnionBox=True)  # -> Box, Box_2
avr = Average(Input=area_4.Centroid)
debox_3 = DeconstructBox(Box=bbox_3.Box)  # -> Plane, X, Y, Z

pdecon_8 = Deconstruct(Point=avr)  # -> XComponent, YComponent, ZComponent
trim_3 = TrimTree(Tree=pdecon_8.XComponent, Depth=1)
bnd_12 = Bounds(Numbers=trim_3)

remap_24 = RemapNumbers(Value=pdecon_8.XComponent, Source=bnd_12, Target=debox_3.X)  # -> Mapped, Clipped
pt_25 = ConstructPoint(XCoordinate=remap_24.Mapped, YCoordinate=pdecon_8.YComponent, ZCoordinate=pdecon_8.ZComponent)
yz = YZPlane(Origin=pt_25)

c_script_11 = CSharpScript(x=yz)  # -> out, A; inputs x: tree; same code as c_script_9

num_21 = Number(num)
num_22 = Number(c_script_10.A)
pln = Plane(c_script_11.A)
c_script_12 = CSharpScript(iRadii=num_22, iBoardWidth=num_21, iPlanes=pln)  # -> out, simplify(A); inputs iRadii: tree of Double, iBoardWidth: Double, iPlanes: tree of Plane
# ---------- c_script_12: C# ----------
    DataTree<Point3d> pointTree = new DataTree<Point3d>();

    for (int j = 0; j < iRadii.BranchCount; j++)
    {

      //initialize variables
      Plane bp = iPlanes.Branch(j)[0];
      Point3d startPoint = new Point3d(bp.Origin);
      Point3d centerPoint = startPoint;
      Vector3d rotationAxis = new Vector3d(bp.ZAxis);
      Vector3d centerPointVect = new Vector3d(bp.YAxis);
      centerPointVect.Rotate(Math.PI / 2, rotationAxis);

      for (int i = 0; i < iRadii.Branch(j).Count; i++){
        GH_Path pth = iRadii.Paths[j].AppendElement(i);
        Point3d point1 = startPoint;
        Point3d point2 = startPoint;

        pointTree.Add(point1, pth);

        //calculate rotation angle
        Double arcLength = iBoardWidth;
        Double radius = iRadii.Branch(j)[i];
        Double rotation = (arcLength / radius);

        //calculate rotation center point
        centerPointVect.Unitize();
        centerPointVect *= radius;
        centerPoint += centerPointVect;


        //execute half rotation
        Transform tx = Transform.Rotation(rotation / 2, rotationAxis, centerPoint);


        point2.Transform(tx);
        pointTree.Add(point2, pth);

        //execute full rotation
        tx = Transform.Rotation(rotation, rotationAxis, centerPoint);
        startPoint.Transform(tx);
        pointTree.Add(startPoint, pth);

        //updata rotation parameters
        centerPoint = startPoint;
        centerPointVect.Transform(tx);
      }
    }
    A = pointTree;
# ---------- end c_script_12 ----------

trim_4 = TrimTree(Tree=c_script_12.A, Depth=1)
cullpt = CullDuplicates(Points=trim_4, Tolerance=0.1, CullMode=3)  # -> Points, Indices, Valence
pt_26 = Point(cullpt.Points)

# ---- group: animate
pt_27 = Point(simplify(pt_26))
pln_2 = Plane(graft(pln))
num_23 = Number(Slider(1, range=0..1))
c_script_13 = CSharpScript(iPoints=simplify(pt_27), iPlanes=pln_2, iShapeFactor=num_23)  # -> out, A; inputs iPoints: tree of Point3d, iPlanes: tree of Plane, iShapeFactor: Double
# ---------- c_script_13: C# ----------
    DataTree<Point3d> output = new DataTree<Point3d>();
    
    double shapeFactor = 1.0 - iShapeFactor;

    //step through curves
    for (int i = 0; i < iPoints.BranchCount; i++)
    {
      Plane currentPlane = iPlanes.Branch(iPoints.Path(i)[0])[0];

      //get vectors from plane
      Vector3d zVect = currentPlane.YAxis;

      Vector3d rotVect = currentPlane.ZAxis;

      //create new startpoint inside list
      Point3d startPoint = iPoints.Branch(i)[0];

      //step through points. Create and rotate vectors
      for (int j = 0; j < iPoints.Branch(i).Count; j++)
      {
        if (j == 0) output.Add(startPoint, iPoints.Path(i));
        else{
          //create current segment vector
          Vector3d segmentVect = new Vector3d(iPoints.Branch(i)[j] - iPoints.Branch(i)[j - 1]);

          //measure angle with vertical vector
          double angle = Vector3d.VectorAngle(zVect, segmentVect, currentPlane);

          //rotate
          segmentVect.Rotate(-angle * shapeFactor, rotVect);

          startPoint += segmentVect;
          output.Add(startPoint, iPoints.Path(i));
        }
      }
    }

    A = output;
# ---------- end c_script_13 ----------
pt_28 = Point(c_script_13.A)
intcrv_5 = Interpolate(Vertices=pt_28, Degree=3, Periodic=False, KnotStyle=1)  # -> Curve, Length, Domain
crv_6 = Curve(intcrv_5.Curve)

# ----
crv_7 = Curve(crv_6)
pt_29 = Point(simplify(graft(pt_25)))
end = EndPoints(Curve=crv_7)  # -> Start, End
vec2pt = Vector2Pt(PointA=end.Start, PointB=end.End, Unitize=False)  # -> Vector, Length
yz_2 = YZPlane(Origin=end.Start)
Y_15 = UnitY(Factor="-1")
angle = Angle(VectorA=vec2pt.Vector, VectorB=Y_15, Plane=yz_2)  # -> Angle, Reflex
rotate = Rotate(Geometry=crv_7, Angle=angle.Angle, Plane=yz_2)  # -> Geometry, Transform
curvepoint = PointOnCurve(rotate.Geometry, parameter=0.5)
vec2pt_2 = Vector2Pt(PointA=curvepoint, PointB=pt_29, Unitize=False)  # -> Vector, Length
move_21 = Move(Geometry=rotate.Geometry, Motion=vec2pt_2.Vector)  # -> Geometry, Transform
path_mapper_2 = PathMapper(move_21.Geometry, source=["{A;B}", "{A}"], target=["{A}", "{0}"])
crv_8 = Curve(path_mapper_2)
loft = Loft(Curves=crv_8, Options={Adjust=False, Closed=False, LoftEnds=0, LoftSimp=0, LoftType=2, Rebuild=10, Refit=0.01})

bool = Boolean(relaxation)
cull_8 = CullPattern(List=loft, CullPattern=bool)
number_slider_46 = Slider(8, range=0..100)
srf = Surface(cull_8)
num_24 = Number(number_slider_33)
quads = QuadPanels(Surface=srf, UDivisions=number_slider_46, VDivisions=num_24)
srf_2 = Surface(reparameterize(simplify(quads)))

smesh = SimpleMesh(Brep=srf_2)
area_5 = MeshArea(Mesh=smesh)  # -> Area, Centroid
meshcp = MeshClosestPoint(Point=area_5.Centroid, Mesh=smesh)  # -> Point, Index, Parameter
meval = MeshEval(Mesh=smesh, Parameter=meshcp.Parameter)  # -> Point, Normal, Colour
pl = PlaneNormal(Origin=meval.Point, ZAxis=meval.Normal)
X = UnitX(Factor=1)
deplane = DeconstructPlane(Plane=pl)  # -> Origin, XAxis, YAxis, ZAxis
angle_2 = Angle(VectorA=deplane.XAxis, VectorB=X, Plane=pl)  # -> Angle, Reflex
rotate_2 = Rotate(Geometry=pl, Angle=angle_2.Angle, Plane=pl)  # -> graft(Geometry), Transform

medges = MeshEdges(Mesh=smesh)  # -> simplify(NakedEdges), InteriorEdges, NonManifoldEdges
curvepoint_2 = PointOnCurve(medges.NakedEdges, parameter=0.5)
plcoord = PlaneCoordinates(Point=curvepoint_2, System=rotate_2.Geometry)  # -> XCoordinate, YCoordinate, ZCoordinate
sort = SortList(Keys=plcoord.XCoordinate, ValuesA=medges.NakedEdges)  # -> Keys, ValuesA
item_14 = ListItem(List=reverse(sort.ValuesA), Index=0, Wrap=True)
item_15 = ListItem(List=sort.ValuesA, Index=0, Wrap=True)

merge_16 = Merge(Data1=item_15, Data2=item_14)
trim_5 = TrimTree(Tree=merge_16, Depth=1)
rdlines = RemoveDuplicateLinesKaramba3D(Line=trim_5, LimitDistance=0.005)  # -> OutLine, Info, Indexes
join_3 = JoinCurves(Curves=rdlines.OutLine, Preserve=False)
explode = Explode(Curve=join_3, Recursive=True)  # -> Segments, simplify(Vertices)
pline = PolyLine(Vertices=explode.Vertices, Closed=False)  # -> simplify(graft(Polyline))
path_mapper_3 = PathMapper(pline, source=["{A}", "{A;B}"], target=["{0}", "{A}"])
curvepoint_3 = PointOnCurve(path_mapper_3, parameter=0.5)
pdecon_9 = Deconstruct(Point=curvepoint_3)  # -> XComponent, YComponent, ZComponent
sort_2 = SortList(Keys=pdecon_9.XComponent, ValuesA=path_mapper_3)  # -> Keys, ValuesA
crv_9 = Curve(sort_2.ValuesA)

crv_10 = Curve(crv_9)
item_16 = ListItem(List=crv_10, Index=0, Wrap=True)
curvepoint_4 = PointOnCurve(crv_10, parameter=0.5)
curvepoint_5 = PointOnCurve(item_16, parameter=0.5)
vec2pt_3 = Vector2Pt(PointA=curvepoint_5, PointB=curvepoint_4, Unitize=False)  # -> Vector, Length
move_22 = Move(Geometry=item_16, Motion=vec2pt_3.Vector)  # -> Geometry, Transform

crv_11 = Curve(crv_9)
flip = FlipCurve(Curve=crv_11, Guide=move_22.Geometry)  # -> Curve, Flag

explode_2 = Explode(Curve=flip.Curve, Recursive=True)  # -> simplify(Segments), Vertices
explode_3 = Explode(Curve=move_22.Geometry, Recursive=True)  # -> simplify(Segments), Vertices
lng_6 = ListLength(List=explode_2.Segments)
lng_7 = ListLength(List=explode_2.Segments)
lng_8 = ListLength(List=explode_3.Segments)
lng_9 = ListLength(List=explode_3.Segments)
subtraction_7 = Subtraction(A=lng_6, B=2)
subtraction_8 = Subtraction(A=lng_7, B=1)
subtraction_9 = Subtraction(A=lng_8, B=2)
subtraction_10 = Subtraction(A=lng_9, B=1)
dom_20 = ConstructDomain(DomainStart=0, DomainEnd=subtraction_7)
dom_21 = ConstructDomain(DomainStart=1, DomainEnd=subtraction_8)
dom_22 = ConstructDomain(DomainStart=0, DomainEnd=subtraction_9)
dom_23 = ConstructDomain(DomainStart=1, DomainEnd=subtraction_10)
subset_3 = SubList(List=explode_2.Segments, Domain=dom_20, Wrap=True)  # -> graft(List), Index
subset_4 = SubList(List=explode_2.Segments, Domain=dom_21, Wrap=True)  # -> graft(List), Index
subset_5 = SubList(List=explode_3.Segments, Domain=dom_22, Wrap=True)  # -> graft(List), Index
subset_6 = SubList(List=explode_3.Segments, Domain=dom_23, Wrap=True)  # -> graft(List), Index
angle_3 = Angle(VectorA=subset_5.List, VectorB=subset_6.List)  # -> simplify(Angle), Reflex
angle_4 = Angle(VectorA=subset_3.List, VectorB=subset_4.List)  # -> simplify(Angle), Reflex
join_4 = JoinCurves(Curves=[subset_5.List, subset_6.List], Preserve=False)  # -> simplify(Curves)
num_25 = Number(angle_3.Angle)
num_26 = Number(angle_4.Angle)

explode_4 = Explode(Curve=flip.Curve, Recursive=True)  # -> simplify(Segments), Vertices
explode_5 = Explode(Curve=move_22.Geometry, Recursive=True)  # -> simplify(Segments), Vertices
path_mapper_4 = PathMapper(explode_4.Segments, source=["{A}(i)", "{A;B}(i)"], target=["{i}(A)", "{A;i}(B)"])
path_mapper_5 = PathMapper(explode_5.Segments, source=["{A}(i)", "{A;B}(i)"], target=["{i}(A)", "{A;i}(B)"])
crv_12 = Curve(path_mapper_5)
crv_13 = Curve(path_mapper_4)
lng_10 = ListLength(List=crv_13)  # -> expr("x-2", Length)
lng_11 = ListLength(List=crv_12)  # -> expr("x-2", Length)
lng_12 = ListLength(List=crv_13)  # -> expr("x-1", Length)
lng_13 = ListLength(List=crv_12)  # -> expr("x-1", Length)
dom_24 = ConstructDomain(DomainStart=0, DomainEnd=lng_10)
dom_25 = ConstructDomain(DomainStart=0, DomainEnd=lng_11)
dom_26 = ConstructDomain(DomainStart=1, DomainEnd=lng_12)
dom_27 = ConstructDomain(DomainStart=1, DomainEnd=lng_13)
subset_7 = SubList(List=crv_13, Domain=dom_24, Wrap=True)  # -> graft(List), Index
subset_8 = SubList(List=crv_12, Domain=dom_25, Wrap=True)  # -> graft(List), Index
subset_9 = SubList(List=crv_13, Domain=dom_26, Wrap=True)  # -> graft(List), Index
subset_10 = SubList(List=crv_12, Domain=dom_27, Wrap=True)  # -> graft(List), Index
loft_2 = Loft(
    Curves=[subset_7.List, subset_9.List],
    Options={Adjust=False, Closed=False, LoftEnds=0, LoftSimp=0, LoftType=0, Rebuild=10, Refit=0.01})  # -> simplify(Loft)
loft_3 = Loft(
    Curves=[subset_8.List, subset_10.List],
    Options={Adjust=False, Closed=False, LoftEnds=0, LoftSimp=0, LoftType=0, Rebuild=10, Refit=0.01})  # -> simplify(Loft)
smesh_2 = SimpleMesh(Brep=loft_2)
smesh_3 = SimpleMesh(Brep=loft_3)
path_mapper_6 = PathMapper(smesh_3, source=["{A;B;C}", "{A;B}"], target=["{A}", "{0}"])
path_mapper_7 = PathMapper(smesh_2, source=["{A;B;C}", "{A;B}"], target=["{A}", "{0}"])
mjoin = MeshJoin(Meshes=path_mapper_6)
mjoin_2 = MeshJoin(Meshes=path_mapper_7)
weld = WeldMesh(Mesh=mjoin, Angle=3.141592654)
weld_2 = WeldMesh(Mesh=mjoin_2, Angle=3.141592654)

explode_6 = Explode(Curve=move_22.Geometry, Recursive=True)  # -> Segments, Vertices
num_27 = Number(num_26)
num_28 = Number(num_25)
mesh_2 = Mesh(weld)
division_6 = Division(A=num_27, B=num_28)  # -> graft(Result)
path_mapper_8 = PathMapper(explode_6.Vertices, source=["{A;B}(i)", "{A}(i)"], target=["{A;i}(B)", "{i}(A)"])
pline_2 = PolyLine(Vertices=path_mapper_8, Closed=False)  # -> simplify(Polyline)
path_mapper_9 = PathMapper(pline_2, source=["{A;B}", "{A}"], target=["{A}", "{0}"])
crv_14 = Curve(join_4)
show = Show(G=mesh_2)  # -> flatten(G)
rod = Rod(
    Polyline=path_mapper_9,
    LengthFactor=1,
    AngleFactor=1,
    AxialStrength=Slider(1, range=0..100000),
    BendStrength=Slider(1, range=0..10000))  # -> flatten(R)
rod_2 = Rod(
    Polyline=crv_14,
    LengthFactor=1,
    AngleFactor=division_6,
    AxialStrength=Slider(1, range=0..100000),
    BendStrength=Slider(100000, range=0..1000000))  # -> flatten(R)
merge_17 = Merge(Data1=rod, Data2=rod_2, Data3=show)

zombiesolver = ZombieSolver(GoalObjects=flatten(merge_17), Threshold=1e-10, Tolerance=0.0001, MaxIterations=Slider(10000, range=0..100000))  # -> I, V, O
mesh_3 = Mesh(zombiesolver.O)
clean = CleanTree(RemoveNulls=True, RemoveInvalid=True, RemoveEmpty=False, Tree=mesh_3)

wbedges = WeaverbirdsMeshEdges(MeshOrPolylines=graft(clean))  # -> simplify(Lines)
mesh_4 = Mesh(simplify(graft(clean)))

wbedges_2 = WeaverbirdsMeshEdges(MeshOrPolylines=weld_2)  # -> simplify(Lines)
line = Line(wbedges)
group_3 = Group(Objects=line)  # -> flatten(Group)
len_2 = Length(Curve=wbedges_2)
len_3 = Length(Curve=line)
lng_14 = ListLength(List=group_3)
subtraction_11 = Subtraction(A=len_3, B=len_2)
series_4 = Series(Start=0, Step=Slider(1330, range=0..10000), Count=lng_14)
smaller_2 = SmallerThan(FirstNumber=subtraction_11, SecondNumber=0)  # -> SmallerThan, OrEqualTo
dispatch = Dispatch(List=subtraction_11, DispatchPattern=smaller_2.SmallerThan)  # -> ListA, ListB
Y_16 = UnitY(Factor=series_4)
Y_17 = UnitY(Factor=Slider(5928, range=0..10000))
move_23 = Move(Geometry=group_3, Motion=Y_16)  # -> Geometry, Transform
bnd_13 = Bounds(Numbers=dispatch.ListA)
bnd_14 = Bounds(Numbers=dispatch.ListB)
move_24 = Move(Geometry=move_23.Geometry, Motion=Y_17)  # -> Geometry, Transform
dedomain_15 = DeconstructDomain(Domain=bnd_14)  # -> Start, End
dedomain_16 = DeconstructDomain(Domain=bnd_13)  # -> Start, End
X_2 = UnitX(Factor=Slider(7456, range=0..10000))
move_25 = Move(Geometry=move_24.Geometry, Motion=X_2)  # -> Geometry, Transform
gradient_7 = Gradient(
    LowerLimit=dedomain_16.Start,
    UpperLimit=dedomain_16.End,
    Parameter=dispatch.ListA,
    stops=[0: RGB(75, 107, 169), 0.501: RGB(173, 203, 249), 1: RGB(254, 244, 84)])
gradient_8 = Gradient(
    LowerLimit=dedomain_15.Start,
    UpperLimit=dedomain_15.End,
    Parameter=dispatch.ListB,
    stops=[0: RGB(254, 244, 84), 0.499: RGB(234, 126, 0), 1: RGB(234, 38, 0), 1: RGB(75, 107, 169), 1: RGB(173, 203, 249)])
ungroup_3 = Ungroup(Group=move_25.Geometry)
dispatch_2 = Dispatch(List=ungroup_3, DispatchPattern=smaller_2.SmallerThan)  # -> ListA, ListB
previewlw = CustomPreviewLineweights(Geometry=dispatch_2.ListA, Shader=gradient_7, Thickness=3, Absolute=False)
previewlw_2 = CustomPreviewLineweights(Geometry=dispatch_2.ListB, Shader=gradient_8, Thickness=3, Absolute=False)

crv_15 = Curve(wbedges)
end_2 = EndPoints(Curve=crv_15)  # -> Start, End
pdecon_10 = Deconstruct(Point=end_2.Start)  # -> XComponent, YComponent, ZComponent
pdecon_11 = Deconstruct(Point=end_2.End)  # -> XComponent, YComponent, ZComponent
subtraction_12 = Subtraction(A=pdecon_10.XComponent, B=pdecon_11.XComponent)
abs = Absolute(Value=subtraction_12)
smaller_3 = SmallerThan(FirstNumber=abs, SecondNumber=Slider(100, range=0..100))  # -> SmallerThan, OrEqualTo
cull_9 = CullPattern(List=crv_15, CullPattern=smaller_3.SmallerThan)
join_5 = JoinCurves(Curves=cull_9, Preserve=False)
curvepoint_6 = PointOnCurve(join_5, parameter=0.5)
pdecon_12 = Deconstruct(Point=curvepoint_6)  # -> XComponent, YComponent, ZComponent
sort_3 = SortList(Keys=pdecon_12.XComponent, ValuesA=join_5)  # -> Keys, ValuesA
explode_7 = Explode(Curve=sort_3.ValuesA, Recursive=True)  # -> Segments, simplify(Vertices)
intcrv_6 = Interpolate(Vertices=explode_7.Vertices, Degree=3, Periodic=False, KnotStyle=1)  # -> Curve, Length, Domain
path_mapper_10 = PathMapper(intcrv_6.Curve, source=["{A;B}", "{A}"], target=["{A}", "{0}"])
loft_4 = Loft(Curves=path_mapper_10, Options={Adjust=False, Closed=False, LoftEnds=0, LoftSimp=0, LoftType=0, Rebuild=10, Refit=0.01})

mesh_5 = Mesh(mesh_4)
num_29 = Number(expr("x+1", number_slider_46))
medges_2 = MeshEdges(Mesh=mesh_5)  # -> NakedEdges, InteriorEdges, NonManifoldEdges
demesh = DeconstructMesh(Mesh=mesh_5)  # -> Vertices, Faces, Colours, Normals
join_6 = JoinCurves(Curves=medges_2.NakedEdges, Preserve=False)
patch = Patch(Curves=join_6, Points=demesh.Vertices, Spans=num_29, Flexibility=Slider(1, range=0..1), Trim=True)
srf_3 = Surface(simplify(patch))

# ---- group: control gate
srf_4 = Surface(loft_4)
srf_5 = Surface(loft)
bool_2 = Boolean(relaxation)
not_2 = GateNot(A=bool_2)
cull_10 = CullPattern(List=srf_5, CullPattern=not_2)
cull_11 = CullPattern(List=cull_7, CullPattern=cross_section)
merge_18 = Merge(Data1=srf_4, Data2=cull_10)

# ----
srf_6 = Surface(merge_18)
edges = BrepEdges(Brep=srf_6)  # -> Naked, Interior, NonManifold
len_4 = Length(Curve=edges.Naked)
sort_4 = SortList(Keys=len_4, ValuesA=edges.Naked)  # -> Keys, reverse(ValuesA)
item_17 = ListItem(List=sort_4.ValuesA, Index=0, Wrap=True)  # -> Item, Item1
flip_2 = FlipCurve(Curve=item_17.Item1)  # -> Curve, Flag
merge_19 = Merge(Data1=item_17.Item, Data2=flip_2.Curve)
divide_2 = DivideCurve(Curve=merge_19, Count=Slider(100, range=0..100), Kinks=False)  # -> Points, Tangents, Parameters
path_mapper_11 = PathMapper(divide_2.Points, source="{A;B;C}(i)", target="{A;B;i}(C)")
item_18 = ListItem(List=path_mapper_11, Index=0, Wrap=True)  # -> Item, Item1
dist = Distance(PointA=item_18.Item, PointB=item_18.Item1)
trim_6 = TrimTree(Tree=dist, Depth=1)
bnd_15 = Bounds(Numbers=trim_6)
dedomain_17 = DeconstructDomain(Domain=bnd_15)  # -> simplify(Start), End
multiplication_12 = Multiplication(A=dedomain_17.Start, B=Slider(0.95, range=0..1))  # -> flatten(Result)
c_script_14 = CSharpScript(x=multiplication_12)  # -> out, A; inputs x: list of Double
# ---------- c_script_14: C# ----------
    List<double> output = new List<double>();
    
    double currentVal = 0;
    for(int i = 0; i < x.Count; i++)
    {
      output.Add(currentVal);
      currentVal += x[i];
    }
    A = output;
# ---------- end c_script_14 ----------
Y_18 = UnitY(Factor=c_script_14.A)
move_26 = Move(Geometry=srf_6, Motion=graft(Y_18))  # -> Geometry, Transform

mesh_6 = Mesh(mesh_4)  # disabled
mesh_7 = Mesh(flatten(mesh_6))  # disabled
number_slider_47 = Slider(2905, range=0..10000)  # disabled
c_script_15 = CSharpScript(mesh=mesh_6, surface=srf_3)  # -> out, Curvature; inputs mesh: Mesh, surface: Surface; disabled
# ---------- c_script_15: C# ----------
        //get surface gaussian curvature at each mesh point
        List<double> gaussianCurvatures = new List<double>();
        double maxGaussian = 0;
        double minGaussian = double.MaxValue;

        double U;
        double V;

        for (int i = 0; i < mesh.Vertices.Count; i++)
        {
            Point3d currentMeshPoint = mesh.Vertices.Point3dAt(i);
            surface.ClosestPoint(currentMeshPoint, out U, out V);
            SurfaceCurvature surfaceCurvature = surface.CurvatureAt(U, V);
            double gaussian = surfaceCurvature.Gaussian;
            gaussianCurvatures.Add(gaussian);

            //get the range of curvatures
            if (gaussian > maxGaussian) maxGaussian = gaussian;
            if( gaussian < minGaussian) minGaussian = gaussian;
        }


        //get the range of curvatures


        //remap the curvatures to color values on the mesh points
        for (int i = 0; i < mesh.Vertices.Count; i++)
        {
            double hue = (gaussianCurvatures[i] - minGaussian) / (0 - minGaussian) * (0.5 - maxGaussian) + maxGaussian;
        }
        Curvature = gaussianCurvatures;
# ---------- end c_script_15 ----------
move_27 = Move(Geometry=mesh_7, Motion=Y_18)  # -> simplify(graft(Geometry)), Transform; disabled
num_30 = Number(c_script_15.Curvature)  # disabled
Y_19 = UnitY(Factor=number_slider_47)  # disabled
number_slider_48 = Slider(7456, range=0..10000)  # disabled
bnd_16 = Bounds(Numbers=num_30)  # disabled
mesh_8 = Mesh(move_27.Geometry)  # disabled
dedomain_18 = DeconstructDomain(Domain=bnd_16)  # -> Start, End; disabled
move_28 = Move(Geometry=mesh_8, Motion=Y_19)  # -> Geometry, Transform; disabled
X_3 = UnitX(Factor=number_slider_48)  # disabled
gradient_9 = Gradient(
    LowerLimit=dedomain_18.Start,
    UpperLimit=dedomain_18.End,
    Parameter=num_30,
    stops=[0: RGB(0, 128, 0), 0.5: RGB(255, 255, 0), 1: RGB(255, 0, 0)])  # disabled
move_29 = Move(Geometry=move_28.Geometry, Motion=X_3)  # -> Geometry, Transform; disabled
c_script_16 = CSharpScript(mesh=move_29.Geometry, colors=simplify(gradient_9))  # -> out, A; inputs mesh: Mesh, colors: list of Color; disabled
# ---------- c_script_16: C# ----------
    for(int i = 0; i < mesh.Vertices.Count; i++)
    {
      mesh.VertexColors.SetColor(i, colors[i]);
    }
    A = mesh;
# ---------- end c_script_16 ----------

gaussian_curvature = Panel(bnd_16)
relaxation_2 = Panel(bnd_13)

srf_7 = Surface(flatten(move_26.Geometry))
data_10 = Data(cull_11)
pan_srf = UpdatePanelSurface(Panel=data_10, Surface=srf_7)  # -> flatten(Panel)
deconstruct_panel_2 = DeconstructPanel(Panel=pan_srf)
deconstruct_bilayer_4 = DeconstructBilayer(Bilayer=deconstruct_panel_2)
dec_board_4 = DeconstructBoard(Board=deconstruct_bilayer_4)  # -> Polyline, Name, Species, RTAngle, MoistureChange, DesiredRadius, Radius, BlendedRadius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
dec_reg_5 = DeconstructBoardRegion(BoardRegion=dec_board_4.BoardRegions)  # -> Polyline, Name, Species, RTAngle, MoistureChange, DesiredRadius, Radius, BlendedRadius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

trim_7 = TrimTree(Tree=dec_reg_5.ShapedRegion, Depth=1)
join_7 = BrepJoin(Breps=trim_7)  # -> Breps, Closed
trim_8 = TrimTree(Tree=join_7.Breps, Depth=1)
item_19 = ListItem(List=trim_8, Index=0, Wrap=True)  # -> flatten(Item)

brep = Brep(item_19)

# ---- group: brep extension if needed
debrep = DeconstructBrep(Brep=item_19)  # -> simplify(Faces), Edges, Vertices
debrep_2 = DeconstructBrep(Brep=debrep.Faces)  # -> Faces, Edges, Vertices
pdecon_13 = Deconstruct(Point=debrep_2.Vertices)  # -> XComponent, YComponent, ZComponent
sort_5 = SortList(Keys=pdecon_13.XComponent)  # -> Keys, ValuesA
item_20 = ListItem(List=sort_5.Keys, Index=0, Wrap=True)
trim_9 = TrimTree(Tree=debrep_2.Faces, Depth=1)
trim_10 = TrimTree(Tree=item_20, Depth=1)
round_2 = Round(Number=trim_10)  # -> Nearest, Floor, Ceiling
sort_6 = SortList(Keys=round_2.Nearest, ValuesA=trim_9)  # -> Keys, simplify(ValuesA)
cset = CreateSet(List=round_2.Nearest)  # -> Set, Map

# ----
sort_7 = SortList(Keys=cset.Set)  # -> Keys, ValuesA

# ---- group: brep extension if needed (continued)
item_21 = ListItem(List=reverse(sort_7.Keys), Index=0, Wrap=True)
item_22 = ListItem(List=sort_7.Keys, Index=0, Wrap=True)

# ----
equalst = EqualityWithinTolerance(FirstNumber=sort_6.Keys, SecondNumber=item_22, Tolerance=number_slider_38)  # -> Equality, Inequality
equalst_2 = EqualityWithinTolerance(FirstNumber=sort_6.Keys, SecondNumber=item_21, Tolerance=number_slider_38)  # -> Equality, Inequality

# ---- group: brep extension if needed / start
cull_12 = CullPattern(List=sort_6.ValuesA, CullPattern=equalst.Equality)

# ---- group: brep extension if needed / end
cull_13 = CullPattern(List=sort_6.ValuesA, CullPattern=equalst_2.Equality)

# ---- group: brep extension if needed (continued)
and = GateAnd(A=equalst.Inequality, B=equalst_2.Inequality)
extendsrf = ExtendSurface(Surface=cull_12, WestEdge=Slider(1000, range=0..1000), SouthEdge=0, EastEdge=0, NorthEdge=0, ExtensionType=True)
extendsrf_2 = ExtendSurface(Surface=cull_13, WestEdge=0, SouthEdge=0, EastEdge=Slider(1000, range=0..1000), NorthEdge=0, ExtensionType=True)

# ---- group: brep extension if needed / middle
cull_14 = CullPattern(List=sort_6.ValuesA, CullPattern=and)

# ---- group: brep extension if needed (continued)
merge_20 = Merge(Data1=cull_14, Data2=extendsrf, Data3=extendsrf_2)
join_8 = BrepJoin(Breps=merge_20)  # -> flatten(Breps), Closed

# ----
c_script_17 = CSharpScript(breps=join_8.Breps)  # -> out, A; inputs breps: list
# ---------- c_script_17: C# ----------
    DataTree<object> output = new DataTree<object>();
    if(breps.Count == 1) return;
    for(int i = 0; i < breps.Count; i++)
    {
      GH_Path path = new GH_Path(i);
      if(i == 0)output.Add(breps[i + 1], path);
      else if(i == breps.Count - 1)output.Add(breps[i - 1], path);
      else
      {
        output.Add(breps[i - 1], path);
        output.Add(breps[i + 1], path);
      }
    }
    A = output;
# ---------- end c_script_17 ----------
splitmul = SplitBrepMultiple(Brep=graft(brep), Cutters=c_script_17.A)
area_6 = Area(Geometry=splitmul)  # -> Area, Centroid
sort_8 = SortList(Keys=area_6.Area, ValuesA=splitmul)  # -> Keys, reverse(ValuesA)
item_23 = ListItem(List=sort_8.ValuesA, Index=0, Wrap=True)
brep_2 = Brep(flatten(item_23))

item_24 = ListItem(List=reverse(brep_2), Index=0, Wrap=True)
item_25 = ListItem(List=reverse(brep_2), Index=1, Wrap=True)
bbx = BrepBrep(BrepA=item_24, BrepB=item_25)  # -> Curves, Points
crv_16 = Curve(bbx.Curves)
explode_8 = Explode(Curve=crv_16, Recursive=True)  # -> Segments, flatten(Vertices)
pdecon_14 = Deconstruct(Point=explode_8.Vertices)  # -> XComponent, YComponent, ZComponent
sort_9 = SortList(Keys=pdecon_14.XComponent, ValuesA=explode_8.Vertices)  # -> Keys, ValuesA
cullpt_2 = CullDuplicates(Points=sort_9.ValuesA, Tolerance=0.1, CullMode=3)  # -> Points, Indices, Valence
intcrv_7 = Interpolate(Vertices=cullpt_2.Points, Degree=3, Periodic=False, KnotStyle=1)  # -> Curve, Length, Domain
Y_20 = UnitY(Factor=Slider(30, range=0..100))
move_30 = Move(Geometry=intcrv_7.Curve, Motion=Y_20)  # -> Geometry, Transform
number_slider_49 = Slider(1000, range=0..1000)
ext = ExtendCurve(Curve=move_30.Geometry, Type=0, Start=number_slider_49, End=number_slider_49)
Y_21 = UnitY(Factor=Slider(10000, range=0..10000))
extr = Extrude(Base=ext, Direction=Y_21)
split = SplitBrep(Brep=item_24, Cutter=extr)
area_7 = Area(Geometry=split)  # -> Area, Centroid
pdecon_15 = Deconstruct(Point=area_7.Centroid)  # -> XComponent, YComponent, ZComponent
sort_10 = SortList(Keys=pdecon_15.ZComponent, ValuesA=split)  # -> Keys, reverse(ValuesA)
item_26 = ListItem(List=sort_10.ValuesA, Index=0, Wrap=True)

item_27 = ListItem(List=brep_2, Index=1, Wrap=True)

item_28 = ListItem(List=brep_2, Index=0, Wrap=True)
bbx_2 = BrepBrep(BrepA=item_28, BrepB=item_27)  # -> Curves, Points
crv_17 = Curve(bbx_2.Curves)
explode_9 = Explode(Curve=crv_17, Recursive=True)  # -> Segments, flatten(Vertices)
pdecon_16 = Deconstruct(Point=explode_9.Vertices)  # -> XComponent, YComponent, ZComponent
sort_11 = SortList(Keys=pdecon_16.XComponent, ValuesA=explode_9.Vertices)  # -> Keys, ValuesA
cullpt_3 = CullDuplicates(Points=sort_11.ValuesA, Tolerance=0.1, CullMode=3)  # -> Points, Indices, Valence
intcrv_8 = Interpolate(Vertices=cullpt_3.Points, Degree=3, Periodic=False, KnotStyle=1)  # -> Curve, Length, Domain
Y_22 = UnitY(Factor=expr("-x", Slider(30, range=0..100)))
number_slider_50 = Slider(1000, range=0..1000)
move_31 = Move(Geometry=intcrv_8.Curve, Motion=Y_22)  # -> Geometry, Transform
ext_2 = ExtendCurve(Curve=move_31.Geometry, Type=0, Start=number_slider_50, End=number_slider_50)
Y_23 = UnitY(Factor=Slider(10000, range=0..10000))
neg_10 = Negative(Value=Y_23)
extr_2 = Extrude(Base=ext_2, Direction=neg_10)
split_2 = SplitBrep(Brep=item_28, Cutter=extr_2)
area_8 = Area(Geometry=split_2)  # -> Area, Centroid
pdecon_17 = Deconstruct(Point=area_8.Centroid)  # -> XComponent, YComponent, ZComponent
sort_12 = SortList(Keys=pdecon_17.ZComponent, ValuesA=split_2)  # -> Keys, reverse(ValuesA)
item_29 = ListItem(List=sort_12.ValuesA, Index=0, Wrap=True)

brep_3 = Brep(brep_2)

lng_15 = ListLength(List=brep_3)
dom_28 = ConstructDomain(DomainStart=1, DomainEnd=expr("x-2", lng_15))
larger = LargerThan(FirstNumber=lng_15, SecondNumber=2)  # -> LargerThan, OrEqualTo
subset_11 = SubList(List=brep_3, Domain=dom_28, Wrap=True)  # -> List, Index
cull_15 = CullPattern(List=subset_11.List, CullPattern=larger.LargerThan)

lng_16 = ListLength(List=brep_2)  # -> expr("x-1", Length)
merge_21 = Merge(Data1=flatten(item_29), Data2=flatten(cull_15), Data3=flatten(item_26))
dom_29 = ConstructDomain(DomainStart=0, DomainEnd=lng_16)
subset_12 = SubList(List=merge_21, Domain=dom_29, Wrap=True)  # -> List, Index

null = NullItem(Item=splitmul)  # -> NullFlags, InvalidFlags, Description
cull_16 = CullPattern(List=brep, CullPattern=null.NullFlags)
merge_22 = Merge(Data1=cull_16, Data2=subset_12.List)
clean_2 = CleanTree(RemoveNulls=True, RemoveInvalid=True, RemoveEmpty=True, Tree=merge_22)  # -> flatten(Tree)
match_brep = MatchTrimmedRegionBrep(Panel=pan_srf, Brep=clean_2)  # -> Panel, Regions, Faces

python_2 = GhPythonScript(x=match_brep.Panel)  # -> out, a
# ---------- python_2: Python ----------
a = x.Centroid
# ---------- end python_2 ----------
pdecon_18 = Deconstruct(Point=python_2.a)  # -> XComponent, YComponent, ZComponent
avr_2 = Average(Input=flatten(pdecon_18.XComponent))

data_11 = Data(species_2)
data_12 = Data(match_brep.Panel)
dec_panel_buildups_2 = DeconstructPanelBuildup(Panels=data_12)  # -> WoodSpecies, Thicknesses, Face
tstat = TreeStatistics(Tree=dec_panel_buildups_2.Thicknesses)  # -> Paths, Length, Count
lng_17 = ListLength(List=tstat.Paths)
dup_9 = DuplicateData(Data=data_11, Number=lng_17, Order=True)  # -> graft(Data)
dup_10 = DuplicateData(Data="4", Number=lng_17, Order=True)  # -> graft(Data)
match = MatchTree(Tree=dup_9, Guide=dec_panel_buildups_2.WoodSpecies)
match_2 = MatchTree(Tree=dup_10, Guide=dec_panel_buildups_2.Thicknesses)
merge_23 = Merge(Data1=dec_panel_buildups_2.WoodSpecies, Data2=match)
merge_24 = Merge(Data1=dec_panel_buildups_2.Thicknesses, Data2=match_2)

# ---- group: species
data_13 = Data(merge_23)

# ---- group: thicknesses
num_31 = Number(merge_24)

# ----
c_script_18 = CSharpScript(x=data_13)  # -> out, A; inputs x: tree; same code as c_script_9
c_script_19 = CSharpScript(x=num_31)  # -> out, A; inputs x: tree; same code as c_script_9

dec_secies = DeconstructSpecies(Species=c_script_18.A)  # -> N, LX, RX, TX, LE, RE, TE
cset_2 = CreateSet(List=dec_secies.N)  # -> Set, Map
brep_4 = Brep(dec_panel_buildups_2.Face)
lng_18 = ListLength(List=cset_2.Set)
c_script_20 = CSharpScript(x=c_script_19.A)  # -> out, A; inputs x: tree of Double
# ---------- c_script_20: C# ----------
    DataTree<double> offsets = new DataTree<double>();

    for(int i = 0; i < x.BranchCount; i++)
    {
      double total = 0;
      for(int j = 0; j < x.Branch(i).Count; j++)
      {
        offsets.Add(total,x.Paths[i]);
        total += x.Branch(i)[j];
      }
    }
    A = offsets;
# ---------- end c_script_20 ----------
c_script_21 = CSharpScript(x=brep_4)  # -> out, A; inputs x: tree; same code as c_script_9
bnd_17 = Bounds(Numbers=flatten(lng_18))
remap_25 = RemapNumbers(Value=lng_18, Source=bnd_17, Target=dom_17)  # -> Mapped, Clipped
offsrf = OffsetSurface(Surface=c_script_21.A, Distance=c_script_20.A, BothSides=0, CreateSolid=False)  # disabled
panel_10 = Panel(remap_25.Mapped)
offsrf_2 = OffsetSurface(Surface=offsrf, Distance=graft(c_script_19.A), BothSides=0, CreateSolid=True)  # -> simplify(Offset); disabled
trim_11 = TrimTree(Tree=offsrf_2, Depth=1)  # disabled
hsv = ColourHSV(Alpha=Slider(1, range=0..1), Hue=Slider(0.618, range=0..1), Saturation=remap_25.Mapped, Value=1)
preview_12 = CustomPreview(Geometry=c_script_21.A, Material=hsv)
