# Grasshopper definition BilayerDesign - version1.2 - modular.gh (Grasshopper 1.0.7)
# plug-ins: HygroDesign, Pufferfish, MeshEdit Components, Karamba3D, Kangaroo2 Components, Weaverbird, Human, LunchBox, Wombat

number_slider = Slider(1000, range=0..1000)
neg = Negative(Value=number_slider)
rectangle = Rectangle(Plane=PlaneXY(0, 0, 0), XSize=number_slider, YSize=neg, Radius=0)  # -> Rectangle, Length
drec = DeconstuctRectangle(Rectangle=rectangle.Rectangle)  # -> BasePlane, XInterval, YInterval
dedomain = DeconstructDomain(Domain=drec.XInterval)  # -> Start, End
dedomain_2 = DeconstructDomain(Domain=drec.YInterval)  # -> Start, End
pt = ConstructPoint(XCoordinate=dedomain.Start, YCoordinate=0, ZCoordinate=0)
pt_2 = ConstructPoint(XCoordinate=dedomain.End, YCoordinate=0, ZCoordinate=0)
subtraction = Subtraction(A=dedomain_2.End, B=dedomain_2.Start)
ln = Line(StartPoint=pt, EndPoint=pt_2)
divide = DivideCurve(Curve=ln, Count=expr("x-1", Slider(3, range=0..10)), Kinks=False)  # -> Points, Tangents, Parameters
multiplication = Multiplication(A=subtraction, B=Slider(0.999, range=0.5..1))
multiplication_2 = Multiplication(A=subtraction, B=Slider(0.304, range=0..0.5))
multiplication_3 = Multiplication(A=subtraction, B=Slider(1, range=0.5..1))
multiplication_4 = Multiplication(A=subtraction, B=Slider(0.334, range=0..1))
multiplication_5 = Multiplication(A=subtraction, B=Slider(0.841, range=0.5..1))
multiplication_6 = Multiplication(A=subtraction, B=Slider(0.5, range=0..0.5))
neg_2 = Negative(Value=multiplication_2)
neg_3 = Negative(Value=multiplication)
neg_4 = Negative(Value=multiplication_4)
neg_5 = Negative(Value=multiplication_3)
neg_6 = Negative(Value=multiplication_6)
neg_7 = Negative(Value=multiplication_5)
item = ListItem(List=divide.Points, Index=0, Wrap=True)  # -> Item, Item1, Item2
Y = UnitY(Factor=neg_2)
Y_2 = UnitY(Factor=neg_4)
Y_3 = UnitY(Factor=neg_3)
Y_4 = UnitY(Factor=neg_5)
Y_5 = UnitY(Factor=neg_6)
Y_6 = UnitY(Factor=neg_7)
move = Move(Geometry=[item.Item, item.Item2], Motion=Y)  # -> Geometry, Transform
move_2 = Move(Geometry=item.Item1, Motion=Y_3)  # -> Geometry, Transform
move_3 = Move(Geometry=[item.Item, item.Item2], Motion=Y_2)  # -> Geometry, Transform
move_4 = Move(Geometry=item.Item1, Motion=Y_4)  # -> Geometry, Transform
move_5 = Move(Geometry=[item.Item, item.Item2], Motion=Y_5)  # -> Geometry, Transform
move_6 = Move(Geometry=item.Item1, Motion=Y_6)  # -> Geometry, Transform
item_2 = ListItem(List=move.Geometry, Index=0, Wrap=True)  # -> Item, Item1
item_3 = ListItem(List=move_3.Geometry, Index=0, Wrap=True)  # -> Item, Item1
item_4 = ListItem(List=move_5.Geometry, Index=0, Wrap=True)  # -> Item, Item1
merge = Merge(Data1=flatten(item_2.Item), Data2=flatten(move_2.Geometry), Data3=flatten(item_2.Item1))
merge_2 = Merge(Data1=flatten(item_3.Item), Data2=flatten(move_4.Geometry), Data3=flatten(item_3.Item1))
merge_3 = Merge(Data1=flatten(item_4.Item), Data2=flatten(move_6.Geometry), Data3=flatten(item_4.Item1))
intcrv = Interpolate(Vertices=merge, Degree=3, Periodic=False, KnotStyle=1)  # -> Curve, Length, Domain
intcrv_2 = Interpolate(Vertices=merge_2, Degree=3, Periodic=False, KnotStyle=1)  # -> Curve, Length, Domain
intcrv_3 = Interpolate(Vertices=merge_3, Degree=3, Periodic=False, KnotStyle=1)  # -> Curve, Length, Domain
merge_4 = Merge(Data1=intcrv.Curve, Data2=intcrv_2.Curve, Data3=intcrv_3.Curve)
rec = Rectangle(rectangle.Rectangle)

# ---- group: beech
panel = Panel("beech")
number_slider_2 = Slider(0.0001, range=0..0.0001)
number_slider_3 = Slider(0.002, range=0..1)
number_slider_4 = Slider(0.0041, range=0..1)
number_slider_5 = Slider(14000, range=0..20000)
number_slider_6 = Slider(2280, range=0..20000)
number_slider_7 = Slider(1160, range=0..20000)
number_slider_8 = Slider(720, range=0..1000)

# ---- group: spruce
panel_2 = Panel("spruce")
number_slider_9 = Slider(0.0001, range=0..0.0001)
number_slider_10 = Slider(0.0019, range=0..1)
number_slider_11 = Slider(0.0036, range=0..1)
number_slider_12 = Slider(10000, range=0..20000)
number_slider_13 = Slider(800, range=0..20000)
number_slider_14 = Slider(450, range=0..20000)
number_slider_15 = Slider(400, range=0..1000)

# ---- group: must be even
number_slider_16 = Slider(2, range=0..10)

# ----
number_slider_17 = Slider(1000, range=0..1000)
rectangle_2 = Rectangle(Plane=PlaneXY(0, 0, 0), XSize=number_slider_17, YSize=number_slider_17, Radius=0)  # -> Rectangle, Length
drec_2 = DeconstuctRectangle(Rectangle=rectangle_2.Rectangle)  # -> BasePlane, XInterval, YInterval
dedomain_3 = DeconstructDomain(Domain=drec_2.YInterval)  # -> Start, End
subtraction_2 = Subtraction(A=dedomain_3.End, B=dedomain_3.Start)
division = Division(A=subtraction_2, B=2)
number_slider_18 = Slider(0.124, range=0..1)
dom = ConstructDomain(DomainStart=0, DomainEnd=1)
addition = Addition(A=dedomain_3.Start, B=division)
dom_2 = ConstructDomain(DomainStart=addition, DomainEnd=dedomain_3.End)
dom_3 = ConstructDomain(DomainStart=addition, DomainEnd=dedomain_3.Start)
remap = RemapNumbers(Value=number_slider_18, Source=dom, Target=dom_3)  # -> Mapped, Clipped
remap_2 = RemapNumbers(Value=Slider(0.949, range=0..1), Source=dom, Target=drec_2.XInterval)  # -> Mapped, Clipped
remap_3 = RemapNumbers(Value=number_slider_18, Source=dom, Target=dom_2)  # -> Mapped, Clipped
remap_4 = RemapNumbers(Value=Slider(0.998, range=0..1), Source=dom, Target=drec_2.XInterval)  # -> Mapped, Clipped
pt_3 = ConstructPoint(XCoordinate=0, YCoordinate=remap_2.Mapped, ZCoordinate=0)
pt_4 = ConstructPoint(XCoordinate=remap.Mapped, YCoordinate=remap_4.Mapped, ZCoordinate=0)
pt_5 = ConstructPoint(XCoordinate=remap_3.Mapped, YCoordinate=remap_4.Mapped, ZCoordinate=0)
pt_6 = ConstructPoint(XCoordinate=number_slider_17, YCoordinate=remap_2.Mapped, ZCoordinate=0)
merge_5 = Merge(Data1=pt_3, Data2=pt_4, Data3=pt_5, Data4=pt_6)
nurbs = NurbsCurve(Vertices=merge_5, Degree=2, Periodic=False)  # -> Curve, Length, Domain

number_slider_19 = Slider(1000, range=0..1000)
rectangle_3 = Rectangle(Plane=PlaneXY(0, 0, 0), XSize=number_slider_19, YSize=number_slider_19, Radius=0)  # -> Rectangle, Length
drec_3 = DeconstuctRectangle(Rectangle=rectangle_3.Rectangle)  # -> BasePlane, XInterval, YInterval
dedomain_4 = DeconstructDomain(Domain=drec_3.YInterval)  # -> Start, End
subtraction_3 = Subtraction(A=dedomain_4.End, B=dedomain_4.Start)
division_2 = Division(A=subtraction_3, B=2)
number_slider_20 = Slider(0.677, range=0..1)
dom_4 = ConstructDomain(DomainStart=0, DomainEnd=1)
addition_2 = Addition(A=dedomain_4.Start, B=division_2)
dom_5 = ConstructDomain(DomainStart=addition_2, DomainEnd=dedomain_4.End)
dom_6 = ConstructDomain(DomainStart=addition_2, DomainEnd=dedomain_4.Start)
remap_5 = RemapNumbers(Value=number_slider_20, Source=dom_4, Target=dom_6)  # -> Mapped, Clipped
remap_6 = RemapNumbers(Value=Slider(0.831, range=0..1), Source=dom_4, Target=drec_3.XInterval)  # -> Mapped, Clipped
remap_7 = RemapNumbers(Value=number_slider_20, Source=dom_4, Target=dom_5)  # -> Mapped, Clipped
remap_8 = RemapNumbers(Value=Slider(0.491, range=0..1), Source=dom_4, Target=drec_3.XInterval)  # -> Mapped, Clipped
pt_7 = ConstructPoint(XCoordinate=0, YCoordinate=remap_6.Mapped, ZCoordinate=0)
pt_8 = ConstructPoint(XCoordinate=remap_5.Mapped, YCoordinate=remap_8.Mapped, ZCoordinate=0)
pt_9 = ConstructPoint(XCoordinate=remap_7.Mapped, YCoordinate=remap_8.Mapped, ZCoordinate=0)
pt_10 = ConstructPoint(XCoordinate=number_slider_19, YCoordinate=remap_6.Mapped, ZCoordinate=0)
merge_6 = Merge(Data1=pt_7, Data2=pt_8, Data3=pt_9, Data4=pt_10)
nurbs_2 = NurbsCurve(Vertices=merge_6, Degree=2, Periodic=False)  # -> Curve, Length, Domain

number_slider_21 = Slider(1000, range=0..1000)
rectangle_4 = Rectangle(Plane=PlaneXY(0, 0, 0), XSize=number_slider_21, YSize=number_slider_21, Radius=0)  # -> Rectangle, Length
drec_4 = DeconstuctRectangle(Rectangle=rectangle_4.Rectangle)  # -> BasePlane, XInterval, YInterval
dedomain_5 = DeconstructDomain(Domain=drec_4.YInterval)  # -> Start, End
subtraction_4 = Subtraction(A=dedomain_5.End, B=dedomain_5.Start)
division_3 = Division(A=subtraction_4, B=2)
dom_7 = ConstructDomain(DomainStart=0, DomainEnd=1)
number_slider_22 = Slider(0.985, range=0..1)
addition_3 = Addition(A=dedomain_5.Start, B=division_3)
dom_8 = ConstructDomain(DomainStart=addition_3, DomainEnd=dedomain_5.End)
dom_9 = ConstructDomain(DomainStart=addition_3, DomainEnd=dedomain_5.Start)
remap_9 = RemapNumbers(Value=number_slider_22, Source=dom_7, Target=dom_9)  # -> Mapped, Clipped
remap_10 = RemapNumbers(Value=Slider(0.21, range=0..1), Source=dom_7, Target=drec_4.XInterval)  # -> Mapped, Clipped
remap_11 = RemapNumbers(Value=number_slider_22, Source=dom_7, Target=dom_8)  # -> Mapped, Clipped
remap_12 = RemapNumbers(Value=Slider(0.241, range=0..1), Source=dom_7, Target=drec_4.XInterval)  # -> Mapped, Clipped
pt_11 = ConstructPoint(XCoordinate=0, YCoordinate=remap_10.Mapped, ZCoordinate=0)
pt_12 = ConstructPoint(XCoordinate=remap_9.Mapped, YCoordinate=remap_12.Mapped, ZCoordinate=0)
pt_13 = ConstructPoint(XCoordinate=remap_11.Mapped, YCoordinate=remap_12.Mapped, ZCoordinate=0)
pt_14 = ConstructPoint(XCoordinate=number_slider_21, YCoordinate=remap_10.Mapped, ZCoordinate=0)
merge_7 = Merge(Data1=pt_11, Data2=pt_12, Data3=pt_13, Data4=pt_14)
nurbs_3 = NurbsCurve(Vertices=merge_7, Degree=2, Periodic=False)  # -> Curve, Length, Domain

int = Integer(number_slider_16)
board_count = Slider(500, range=0..500)
species = WoodSpecies(
    name=panel,
    density=number_slider_8,
    LExp=number_slider_2,
    RExp=number_slider_3,
    TExp=number_slider_4,
    LEmod=number_slider_5,
    REmod=number_slider_6,
    TEmod=number_slider_7)
species_2 = WoodSpecies(
    name=panel_2,
    density=number_slider_15,
    LExp=number_slider_9,
    RExp=number_slider_10,
    TExp=number_slider_11,
    LEmod=number_slider_12,
    REmod=number_slider_13,
    TEmod=number_slider_14)

number_slider_23 = Slider(150, range=0..10000)
number_slider_24 = Slider(4, range=0..10)
number_slider_25 = Slider(2500, range=0..10000)
number_slider_26 = Slider(21, range=0..100)
xy = XYPlane(Origin=Point(0, 0, 0))
multiplication_7 = Multiplication(A=number_slider_26, B=number_slider_23)
multiplication_8 = Multiplication(A=number_slider_25, B=number_slider_24)
bilayer = Bilayer(
    BasePlane=xy,
    BoardWidth=number_slider_23,
    BoardLength=number_slider_25,
    WidthCount=number_slider_26,
    LengthCount=number_slider_24,
    ActiveThickness=Slider(20, range=0..100),
    PassiveThickness=Slider(4, range=0..100),
    PassiveSpecies=species_2,
    RegionCount=int)
rectangle_5 = Rectangle(Plane=PlaneXY(0, 0, 0), XSize=multiplication_8, YSize=multiplication_7, Radius=0)  # -> Rectangle, Length
num = Number(number_slider_23)
num_2 = Number(number_slider_25)

drec_5 = DeconstuctRectangle(Rectangle=rectangle_5.Rectangle)  # -> BasePlane, XInterval, YInterval
panel_3 = Panel(drec_5.XInterval)
panel_4 = Panel(drec_5.YInterval)

# ---- group: name
num_3 = Number(board_count)
series = Series(Start=0, Step=1, Count=num_3)
dup = DuplicateData(Data="S", Number=num_3, Order=True)  # -> graft(Data)
txt = Text(graft(series))
merge_8 = Merge(Data1=dup, Data2=txt)  # -> simplify(Result)
join = TextJoin(Text=merge_8)  # -> flatten(Result)

num_4 = Number(board_count)
series_2 = Series(Start=0, Step=1, Count=num_4)
dup_2 = DuplicateData(Data="B", Number=num_4, Order=True)  # -> graft(Data)
txt_2 = Text(graft(series_2))
merge_9 = Merge(Data1=dup_2, Data2=txt_2)  # -> simplify(Result)
join_2 = TextJoin(Text=merge_9)  # -> flatten(Result)

# ----
panel_5 = Panel("C:\Users\Alex Reiner\Documents\GitHub\HygroDesign\Grasshopper")

# ---- group: active thickness
number_slider_27 = Slider(20, range=0..100)

# ---- group: RT
dom_10 = ConstructDomain(DomainStart=Slider(15, range=0..100), DomainEnd=Slider(75, range=0..100))
random = Random(Range=dom_10, Number=board_count, Seed=Slider(225, range=0..1000))

# ---- group: spruce
data = Data(species_2)
num_5 = Number(board_count)
dup_3 = DuplicateData(Data=data, Number=num_5, Order=True)

# ---- group: beech
num_6 = Number(board_count)
data_2 = Data(species)
dup_4 = DuplicateData(Data=data_2, Number=num_6, Order=True)

# ---- group: thickness
num_7 = Number(number_slider_27)
num_8 = Number(board_count)
dup_5 = DuplicateData(Data=num_7, Number=num_8, Order=True)

# ---- group: length
num_9 = Number(num_2)
num_10 = Number(board_count)
dup_6 = DuplicateData(Data=num_9, Number=num_10, Order=True)

# ---- group: width
num_11 = Number(num)
num_12 = Number(board_count)
dup_7 = DuplicateData(Data=num_11, Number=num_12, Order=True)

# ----
num_13 = Number(board_count)
num_14 = Number(board_count)
dup_8 = DuplicateData(Data=Slider(1, range=0..1), Number=num_13, Order=True)
dup_9 = DuplicateData(Data=panel_5, Number=num_14, Order=True)
entwine = Entwine(Branch00=dup_7, Branch01=dup_7, FlattenInputs=True)  # -> flatten(Result)
entwine_2 = Entwine(Branch00=dup_5, Branch01=dup_5, FlattenInputs=True)  # -> flatten(Result)
entwine_3 = Entwine(Branch00=dup_6, Branch01=dup_6, FlattenInputs=True)  # -> flatten(Result)
entwine_4 = Entwine(Branch00=join_2, Branch01=join, FlattenInputs=True)  # -> flatten(Result)
entwine_5 = Entwine(Branch00=random, Branch01=random, FlattenInputs=True)  # -> flatten(Result)
entwine_6 = Entwine(Branch00=dup_8, Branch01=dup_8, FlattenInputs=True)  # -> flatten(Result)
entwine_7 = Entwine(Branch00=dup_4, Branch01=dup_3, FlattenInputs=True)  # -> flatten(Result)
entwine_8 = Entwine(Branch00=dup_9, Branch01=dup_9, FlattenInputs=True)  # -> flatten(Result)

# ---- group: bounding rectangle input (rectangle y domain represents full range of radii from stockpiles)
rec_2 = Rectangle(rec)

# ---- group: curve controller inputs (represents distribution of radii along a given cross section)
crv = Curve(merge_4)

# ----
stock_boards = StockBoards(
    Name=entwine_4,
    Species=entwine_7,
    Thickness=entwine_2,
    Length=entwine_3,
    Width=entwine,
    RTAngle=entwine_5,
    ImgPath=entwine_8)

crv_2 = Curve(crv)
lng = ListLength(List=crv_2)  # -> expr("x-2", Length)
dom_11 = ConstructDomain(DomainStart=0, DomainEnd=lng)
subset = SubList(List=crv_2, Domain=dom_11, Wrap=True)  # -> graft(List), Index
shift = ShiftList(List=crv_2, Shift=1, Wrap=False)  # -> graft(List)
merge_10 = Merge(Data1=subset.List, Data2=shift)  # -> simplify(Result)
group = Group(Objects=merge_10)  # -> flatten(Group)

merge_11 = Merge(Data1=nurbs.Curve, Data2=nurbs_2.Curve, Data3=nurbs_3.Curve)

crv_3 = Curve(merge_11)
lng_2 = ListLength(List=crv_3)  # -> expr("x-2", Length)
dom_12 = ConstructDomain(DomainStart=0, DomainEnd=lng_2)
subset_2 = SubList(List=crv_3, Domain=dom_12, Wrap=True)  # -> graft(List), Index
shift_2 = ShiftList(List=crv_3, Shift=1, Wrap=False)  # -> graft(List)
merge_12 = Merge(Data1=subset_2.List, Data2=shift_2)  # -> simplify(Result)
group_2 = Group(Objects=merge_12)  # -> flatten(Group)

deconstruct_bilayer = DeconstructBilayer(Bilayer=bilayer)
dec_board = DeconstructBoard(Board=deconstruct_bilayer)  # -> Polyline, Name, Species, RTAngle, MoistureChange, DesiredRadius, Radius, BlendedRadius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
area = Area(Geometry=dec_board.Polyline)  # -> Area, Centroid
c_script = CSharpScript(rects=flatten(dec_board.Polyline))  # -> out; inputs rects: list of Rectangle3d; disabled
# ---------- c_script: C# usings ----------
using Rhino.DocObjects;
# ---------- c_script: C# ----------
    var object_enumerator_settings = new ObjectEnumeratorSettings();

    var rhinoObjects = RhinoDoc.ActiveDoc.Objects.GetObjectList(object_enumerator_settings);
    var objectTable = RhinoDoc.ActiveDoc.Objects;

    foreach( var rhinoObject in rhinoObjects)
    {
      if(rhinoObject.ObjectType == ObjectType.Curve)
      {
        Curve rhinoCurve = rhinoObject.Geometry as Curve;
        if(rhinoCurve.IsClosed)objectTable.Delete(rhinoObject);
      }
    }

    foreach(var rect in rects)objectTable.AddCurve(rect.ToNurbsCurve());
# ---------- end c_script ----------
pt_15 = Point(simplify(area.Centroid))

# ---- group: Thickness
dec_reg = DeconstructBoardRegion(BoardRegion=dec_board.BoardRegions)  # -> Polyline, Name, Species, RTAngle, MoistureChange, DesiredRadius, Radius, BlendedRadius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
area_2 = Area(Geometry=dec_reg.Polyline)  # -> Area, Centroid
pt_16 = Point(simplify(area_2.Centroid))

# ----
bbox = BoundingBox(Content=dec_board.Polyline, Plane=PlaneXY(0, 0, 0), UnionBox=True)  # -> Box, Box_2
debox = DeconstructBox(Box=bbox.Box)  # -> Plane, X, Y, Z
dedomain_6 = DeconstructDomain(Domain=debox.Y)  # -> Start, End
subtraction_5 = Subtraction(A=dedomain_6.End, B=dedomain_6.Start)
division_4 = Division(A=subtraction_5, B=2)
number_slider_28 = Slider(0.792, range=0..1)
addition_4 = Addition(A=dedomain_6.Start, B=division_4)
dom_13 = ConstructDomain(DomainStart=0, DomainEnd=1)
dom_14 = ConstructDomain(DomainStart=addition_4, DomainEnd=dedomain_6.End)
dom_15 = ConstructDomain(DomainStart=addition_4, DomainEnd=dedomain_6.Start)
remap_13 = RemapNumbers(Value=Slider(0.587, range=0.25..1), Source=dom_13, Target=debox.X)  # -> Mapped, Clipped
remap_14 = RemapNumbers(Value=Slider(0.75, range=0..0.75), Source=dom_13, Target=debox.X)  # -> Mapped, Clipped
remap_15 = RemapNumbers(Value=number_slider_28, Source=dom_13, Target=dom_15)  # -> Mapped, Clipped
remap_16 = RemapNumbers(Value=number_slider_28, Source=dom_13, Target=dom_14)  # -> Mapped, Clipped
pt_17 = ConstructPoint(XCoordinate=remap_13.Mapped, YCoordinate=dedomain_6.Start, ZCoordinate=0)
pt_18 = ConstructPoint(XCoordinate=remap_14.Mapped, YCoordinate=remap_15.Mapped, ZCoordinate=0)
pt_19 = ConstructPoint(XCoordinate=remap_14.Mapped, YCoordinate=remap_16.Mapped, ZCoordinate=0)
pt_20 = ConstructPoint(XCoordinate=remap_13.Mapped, YCoordinate=dedomain_6.End, ZCoordinate=0)
merge_13 = Merge(Data1=pt_17, Data2=pt_18, Data3=pt_19, Data4=pt_20)
nurbs_4 = NurbsCurve(Vertices=merge_13, Degree=2, Periodic=False)  # -> Curve, Length, Domain

# ---- group: generate distribution
pt_21 = Point(simplify(pt_15))
data_3 = Data(group)
pdecon = Deconstruct(Point=pt_21)  # -> XComponent, YComponent, ZComponent
bnd = Bounds(Numbers=flatten(pdecon.XComponent))
bnd_2 = Bounds(Numbers=flatten(pdecon.YComponent))
lng_3 = ListLength(List=data_3)
dedomain_7 = DeconstructDomain(Domain=bnd)  # -> Start, End
remap_17 = RemapNumbers(Value=pdecon.YComponent, Source=bnd_2, Target=Domain(0, 1))  # -> graft(Mapped), Clipped
c_script_2 = CSharpScript(count=lng_3, start=dedomain_7.Start, end=dedomain_7.End)  # -> out, A; inputs count: Int32, start: Double, end: Double
# ---------- c_script_2: C# ----------
    double totalLength = end - start;
    double domLength = totalLength / (double) count;

    List<Interval> intervals = new List<Interval>();
    double currentStart = start;
    for(int i = 0; i < count; i++)
    {
      intervals.Add(new Interval(currentStart, currentStart + domLength));
      currentStart += domLength;
    }
    A = intervals;
# ---------- end c_script_2 ----------
num_15 = Number(graft(pdecon.XComponent))
inc = Includes(Value=num_15, Domain=simplify(c_script_2.A))  # -> Includes, Deviation
cull = CullPattern(List=data_3, CullPattern=inc.Includes)
item_5 = ListItem(List=cull, Index=0, Wrap=True)
cull_2 = CullPattern(List=c_script_2.A, CullPattern=inc.Includes)
ungroup = Ungroup(Group=item_5)  # -> simplify(Objects)
item_6 = ListItem(List=cull_2, Index=0, Wrap=True)
remap_18 = RemapNumbers(Value=num_15, Source=item_6, Target=Domain(0, 1))  # -> Mapped, Clipped
eval = EvaluateCurve(Curve=reparameterize(ungroup), Parameter=remap_17.Mapped)  # -> Point, Tangent, Angle
pdecon_2 = Deconstruct(Point=eval.Point)  # -> XComponent, YComponent, ZComponent
item_7 = ListItem(List=pdecon_2.YComponent, Index=0, Wrap=True)  # -> Item, Item1
twn2nums = TweenTwoNumbers(NumberA=item_7.Item, NumberB=item_7.Item1, Factor=remap_18.Mapped)
num_16 = Number(twn2nums)

pt_22 = Point(simplify(pt_16))
data_4 = Data(group_2)
pdecon_3 = Deconstruct(Point=pt_22)  # -> XComponent, YComponent, ZComponent
bnd_3 = Bounds(Numbers=flatten(pdecon_3.XComponent))
bnd_4 = Bounds(Numbers=flatten(pdecon_3.YComponent))
lng_4 = ListLength(List=data_4)
dedomain_8 = DeconstructDomain(Domain=bnd_3)  # -> Start, End
remap_19 = RemapNumbers(Value=pdecon_3.YComponent, Source=bnd_4, Target=Domain(0, 1))  # -> graft(Mapped), Clipped
c_script_3 = CSharpScript(count=lng_4, start=dedomain_8.Start, end=dedomain_8.End)  # -> out, A; inputs count: Int32, start: Double, end: Double; same code as c_script_2
num_17 = Number(graft(pdecon_3.XComponent))
inc_2 = Includes(Value=num_17, Domain=simplify(c_script_3.A))  # -> Includes, Deviation
cull_3 = CullPattern(List=data_4, CullPattern=inc_2.Includes)
item_8 = ListItem(List=cull_3, Index=0, Wrap=True)
cull_4 = CullPattern(List=c_script_3.A, CullPattern=inc_2.Includes)
ungroup_2 = Ungroup(Group=item_8)  # -> simplify(Objects)
item_9 = ListItem(List=cull_4, Index=0, Wrap=True)
remap_20 = RemapNumbers(Value=num_17, Source=item_9, Target=Domain(0, 1))  # -> Mapped, Clipped
eval_2 = EvaluateCurve(Curve=reparameterize(ungroup_2), Parameter=remap_19.Mapped)  # -> Point, Tangent, Angle
pdecon_4 = Deconstruct(Point=eval_2.Point)  # -> XComponent, YComponent, ZComponent
item_10 = ListItem(List=pdecon_4.YComponent, Index=0, Wrap=True)  # -> Item, Item1
twn2nums_2 = TweenTwoNumbers(NumberA=item_10.Item, NumberB=item_10.Item1, Factor=remap_20.Mapped)
num_18 = Number(twn2nums_2)

# ---- group: material / beech
data_5 = Data(species)

# ---- group: material / Species
crv_4 = Curve(nurbs_4.Curve)

# ---- group: material / spruce
data_6 = Data(species_2)

# ---- group: material
pt_23 = Point(graft(pt_15))
xz = XZPlane(Origin=pt_23)
pcx = CurvePlane(Curve=crv_4, Plane=xz)  # -> simplify(Points), ParamsC, ParamsP
pdecon_5 = Deconstruct(Point=pcx.Points)  # -> XComponent, YComponent, ZComponent
pdecon_6 = Deconstruct(Point=pt_23)  # -> XComponent, YComponent, ZComponent
smaller = SmallerThan(FirstNumber=pdecon_5.XComponent, SecondNumber=pdecon_6.XComponent)  # -> SmallerThan, OrEqualTo
not = GateNot(A=smaller.SmallerThan)
cull_5 = CullPattern(List=data_5, CullPattern=not)
cull_6 = CullPattern(List=data_6, CullPattern=smaller.SmallerThan)
merge_14 = Merge(Data1=cull_5, Data2=cull_6)  # -> simplify(Result)
path_mapper = PathMapper(merge_14, source="{A}", target="{0}")

# ----
pt_24 = Point(pt_15)
pdecon_7 = Deconstruct(Point=pt_24)  # -> XComponent, YComponent, ZComponent
bnd_5 = Bounds(Numbers=flatten(pdecon_7.XComponent))
dom_16 = ConstructDomain(DomainStart="1", DomainEnd="0")
remap_21 = RemapNumbers(Value=pdecon_7.XComponent, Source=bnd_5, Target=dom_16)  # -> simplify(Mapped), Clipped

num_19 = Number(num_16)
rec_3 = Rectangle(rec_2)
drec_6 = DeconstuctRectangle(Rectangle=rec_3)  # -> BasePlane, XInterval, YInterval
dom_17 = ConstructDomain(DomainStart=0, DomainEnd=1)
remap_22 = RemapNumbers(Value=num_19, Source=drec_6.YInterval, Target=dom_17)  # -> Mapped, Clipped
trim = TrimTree(Tree=remap_22.Mapped, Depth=1)

num_20 = Number(num_18)
rec_4 = Rectangle(rectangle_2.Rectangle)
drec_7 = DeconstuctRectangle(Rectangle=rec_4)  # -> BasePlane, XInterval, YInterval
dom_18 = ConstructDomain(DomainStart=0, DomainEnd=Slider(1.2, range=0..10))
remap_23 = RemapNumbers(Value=num_20, Source=drec_7.YInterval, Target=dom_18)  # -> Mapped, Clipped
trim_2 = TrimTree(Tree=remap_23.Mapped, Depth=1)

data_7 = Data(bilayer)

update_bilayer = UpdateBilayer(Bilayer=data_7, Radius=trim, RadiusWeight=remap_21.Mapped, Material=path_mapper)
dup_bilayer = DuplicateBilayer(Bilayer=update_bilayer, Count=Slider(3, range=0..10))
panel_6 = Panel(Bilayers=dup_bilayer)
adjust_cro_sec = AdjustCrossSection(Panel=panel_6, Thicknesses=trim_2)
dup_panel = DuplicatePanel(Panel=adjust_cro_sec, Count=Slider(3, range=0..10))

# ---- group: moisture changes
panel_7 = Panel("""2
4
8""")

# ---- group: timoshenko prediction
c_script_4 = CSharpScript(Reference="C:\Users\Alex Reiner\AppData\Roaming\Grasshopper\Libraries\HygroDesign.Core.dll")  # -> out, A
# ---------- c_script_4: C# usings ----------
using BilayerDesign;
# ---------- c_script_4: C# ----------
    TimoshenkoPrediction timo = new TimoshenkoPrediction();
    A = timo;
# ---------- c_script_4: C# additional code ----------
  public class TimoshenkoPrediction : PredictionBase
  {

    public TimoshenkoPrediction()
    {
    }

    public override double Predict(StockBoard board, Bilayer bilayer, double moistureChange)
    {
      double h1 = bilayer.PassiveLayer.Thickness;
      double h2 = bilayer.ActiveThickness;
      double h = h1 + h2;
      double m = h1 / h2;
      double e1 = bilayer.PassiveLayer.Species.Attributes["LEmod"];
      double e2 = GrainAngleInterpolation(board.RTAngle, board.Species.Attributes["REmod"], board.Species.Attributes["TEmod"]);
      double n = e1 / e2;
      double a1 = bilayer.PassiveLayer.Species.Attributes["LExp"];
      double a2 = GrainAngleInterpolation(board.RTAngle, board.Species.Attributes["RExp"], board.Species.Attributes["TExp"]);
      double deltaAlpha = a2 - a1;
      double kValue = 6 * Math.Pow(1.0 + m, 2) / (3 * Math.Pow(1 + m, 2) + (1 + m * n) * Math.Pow(m, 2) + (1 / (m * n)));
      double curvature = kValue * ((moistureChange * deltaAlpha) / h);
      return 1 / (curvature /* * TimError*/ );
    }

    public static double GrainAngleInterpolation(double rtAngle, double eR, double eT)
    {
      double angleConv = RhinoMath.ToRadians(rtAngle);
      double angleT = Math.Cos(angleConv);
      double angleR = Math.Sin(angleConv);
      double eActive = eT * Math.Pow(angleT, 2) + eR * Math.Pow(angleR, 2);
      return eActive;
    }
  }
# ---------- end c_script_4 ----------

# ---- group: convolution v1
c_script_5 = CSharpScript(
    tan=Slider(0.7, range=0.01..3),
    lon=Slider(0.8, range=0.01..3),
    rad=Slider(10000, range=0..10000),
    stiff=Slider(0.1, range=0.01..3),
    thick=Slider(0.1, range=0.01..3),
    Reference="C:\Users\Alex Reiner\AppData\Roaming\Grasshopper\Libraries\HygroDesign.Core.dll")  # -> out, A; inputs tan: Double, lon: Double, rad: Double, stiff: Double, thick: Double
# ---------- c_script_5: C# ----------
    MyConvolution convEngine = new MyConvolution(tan, lon, rad, stiff, thick);
    A = convEngine;
# ---------- c_script_5: C# additional code ----------
  public class MyConvolution : ConvolutionEngine
  {
    double Tangential { get; set; }
    double Longitudinal { get; set; }
    double RadiusMax { get; set; }
    double StiffnessInfluence { get; set; }
    double ThicknessInfluence { get; set; }

    public MyConvolution(double tangential, double longitudinal, double radiusMax, double stiffnessInfluence, double thicknessInfluence)
    {
      Tangential = tangential;
      Longitudinal = longitudinal;
      RadiusMax = radiusMax;
      StiffnessInfluence = stiffnessInfluence;
      ThicknessInfluence = thicknessInfluence;
    }

    public override Panel Convolution(Panel panel)
    {
      panel = SetConvolutionFactors(panel, RadiusMax, StiffnessInfluence);
      panel = CurvatureConvolution(panel, Longitudinal, Tangential);
      return ThicknessConvolution(panel, ThicknessInfluence);
    }

    public Panel SetConvolutionFactors(Panel panel, double maxRadiusInfluence, double stiffnessFactor)
    {
      //get stiffness bounds
      double maxLongStiffness = 0;
      double minLongStiffness = double.MaxValue;
      double maxHorizStiffness = 0;
      double minHorizStiffness = double.MaxValue;
      double minCurvature = double.MaxValue;

      foreach (Bilayer bilayer in panel.Bilayers)
      {
        foreach (PanelBoard board in bilayer.Boards)
        {
          if (board.Species.Attributes["LEmod"] > maxLongStiffness) maxLongStiffness = board.Species.Attributes["LEmod"];
          if (board.Species.Attributes["LEmod"] < minLongStiffness) minLongStiffness = board.Species.Attributes["LEmod"];
          if (board.Species.Attributes["REmod"] > maxHorizStiffness) maxHorizStiffness = board.Species.Attributes["REmod"];
          if (board.Species.Attributes["REmod"] < minHorizStiffness) minHorizStiffness = board.Species.Attributes["REmod"];
          if (board.Radius < minCurvature) minCurvature = board.Radius;
        }
      }

      foreach (Bilayer bilayer in panel.Bilayers)
      {
        //set factors
        foreach (PanelBoard board in bilayer.Boards)
        {
          board.LongStiffnessFactor = Panel.Remap(board.Species.Attributes["LEmod"], minLongStiffness, maxLongStiffness, 1 - stiffnessFactor, 1);
          board.RadStiffnessFactor = Panel.Remap(board.Species.Attributes["REmod"], minHorizStiffness, maxHorizStiffness, 1 - stiffnessFactor, 1);

          board.RadiusFactor = Panel.Remap(board.Radius, minCurvature, maxRadiusInfluence, 1, 0);
        }
      }

      return panel;

    }

    public Panel CurvatureConvolution(Panel panel, double horizontal, double vertical)
    {
      foreach (Bilayer bilayer in panel.Bilayers)
      {
        foreach (PanelBoard board in bilayer.Boards)
        {
          board.ConvolutionWeights = new List<Tuple<double, double>>();

          foreach (PanelBoard testBoard in bilayer.Boards)
          {
            double closestX = double.MaxValue;
            double closestY = double.MaxValue;

            if (Math.Abs(testBoard.RowRange[0] - board.Centroid.X) < closestX) closestX = Math.Abs(testBoard.RowRange[0] - board.Centroid.X);
            if (Math.Abs(testBoard.RowRange[1] - board.Centroid.X) < closestX) closestX = Math.Abs(testBoard.RowRange[1] - board.Centroid.X);
            if (testBoard.RowRange[0] <= board.Centroid.X + 10 && testBoard.RowRange[1] >= board.Centroid.X - 10) closestX = 0;
            if (Math.Abs(testBoard.Centroid.X - board.Centroid.X) < closestX) closestX = Math.Abs(testBoard.Centroid.X - board.Centroid.X);

            if (Math.Abs(testBoard.ColumnRange[0] - board.Centroid.Y) < closestY) closestY = Math.Abs(testBoard.ColumnRange[0] - board.Centroid.Y);
            if (Math.Abs(testBoard.ColumnRange[1] - board.Centroid.Y) < closestY) closestY = Math.Abs(testBoard.ColumnRange[1] - board.Centroid.Y);
            if (testBoard.ColumnRange[0] <= board.Centroid.Y + 10 && testBoard.ColumnRange[1] >= board.Centroid.Y - 10) closestY = board.Width / 2;
            if (Math.Abs(testBoard.Centroid.Y - board.Centroid.Y) < closestY) closestY = Math.Abs(testBoard.Centroid.Y - board.Centroid.Y);

            double LongFactor = testBoard.LongStiffnessFactor / Math.Pow(closestX + 1, horizontal);
            double RadFactor = testBoard.RadStiffnessFactor / Math.Pow(closestY + 1, vertical);

            board.ConvolutionWeights.Add(new Tuple<double, double>(testBoard.Radius, testBoard.RadiusFactor * (LongFactor * RadFactor)));
          }
        }

        foreach (PanelBoard board in bilayer.Boards)
        {

          double weightSum = 0;
          foreach (Tuple<double, double> valueWeight in board.ConvolutionWeights)
          {
            board.BlendedRadius += valueWeight.Item1 * valueWeight.Item2;
            weightSum += valueWeight.Item2;

          }
          board.BlendedRadius /= weightSum;

        }
      }
      return panel;
    }

    public Panel ThicknessConvolution(Panel panel, double thicknessFactor)
    {
      double minThickness = double.MaxValue;
      double maxThickness = 0;
      foreach (Bilayer bilayer in panel.Bilayers)
      {
        double thickness = bilayer.ActiveThickness + bilayer.PassiveLayer.Thickness;
        if (thickness < minThickness) minThickness = thickness;
        if (thickness > maxThickness) maxThickness = thickness;
      }

      panel.FindThicknessNeighbors();

      foreach (Bilayer bilayer in panel.Bilayers)
      {
        double bilayerThicknessFactor = 1;
        if (minThickness != maxThickness) bilayerThicknessFactor = Panel.Remap(bilayer.ActiveThickness + bilayer.PassiveLayer.Thickness, minThickness, maxThickness, 1 - thicknessFactor, 1);

        foreach (PanelBoard board in bilayer.Boards)
        {
          double weights = board.RadStiffnessFactor + bilayerThicknessFactor;
          double weightedTotal = board.BlendedRadius * weights;

          foreach (BoardRegion region in board.Regions)
          {
            foreach (BoardRegion regionNeighbor in region.RegionStack)
            {
              double neighborThicknessFactor = 1;
              if (minThickness != maxThickness) neighborThicknessFactor = Panel.Remap(regionNeighbor.Parent.Parent.ActiveThickness + regionNeighbor.Parent.Parent.PassiveLayer.Thickness, minThickness, maxThickness, 1 - thicknessFactor, 1);

              weights += regionNeighbor.Parent.RadStiffnessFactor + neighborThicknessFactor;

              weightedTotal += regionNeighbor.Parent.BlendedRadius * (regionNeighbor.Parent.RadStiffnessFactor + neighborThicknessFactor);
            }

            region.ThicknessBlendedRadius = weightedTotal / weights;
          }
        }
      }
      return panel;
    }
  }
# ---------- end c_script_5 ----------

# ----
data_8 = Data(dup_panel)
data_9 = Data(stock_boards)
num_21 = Number(panel_7)
rad_pred = RadiusPrediction(Panels=data_8, StockBoards=data_9, MoistureChanges=num_21, PredictionEngine=c_script_4.A)
design_env = DesignEnvironment(Panels=data_8, StockPile=rad_pred)
convolution = CurvatureConvolution(Panels=design_env, ConvolutionEngine=c_script_5.A)

item_11 = ListItem(List=convolution, Index=0, Wrap=True)  # -> Item, Item1
deconstruct_panel = DeconstructPanel(Panel=item_11.Item)
deconstruct_bilayer_2 = DeconstructBilayer(Bilayer=deconstruct_panel)
dec_board_2 = DeconstructBoard(Board=deconstruct_bilayer_2)  # -> Polyline, Name, Species, RTAngle, MoistureChange, DesiredRadius, Radius, BlendedRadius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
display_panel = DisplayPanels(Panels=item_11.Item)  # -> ActiveBoards, PassiveBoards
dec_reg_2 = DeconstructBoardRegion(BoardRegion=dec_board_2.BoardRegions)  # -> Polyline, Name, Species, RTAngle, MoistureChange, DesiredRadius, Radius, BlendedRadius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

cross_section = BooleanToggle(True)
relaxation = BooleanToggle(True)
cull_7 = CullPattern(List=convolution, CullPattern=cross_section)

crosecset = UniqueCrossSections(Panel=cull_7)
dec_reg_3 = DeconstructBoardRegion(BoardRegion=crosecset)  # -> Polyline, Name, Species, RTAngle, MoistureChange, DesiredRadius, Radius, BlendedRadius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

bbox_2 = BoundingBox(Content=flatten(dec_reg_2.Polyline), Plane=PlaneXY(0, 0, 0), UnionBox=True)  # -> Box, Box_2
debox_2 = DeconstructBox(Box=bbox_2.Box)  # -> Plane, X, Y, Z
dedomain_9 = DeconstructDomain(Domain=debox_2.Y)  # -> Start, End
subtraction_6 = Subtraction(A=dedomain_9.End, B=dedomain_9.Start)
multiplication_9 = Multiplication(A=subtraction_6, B="1.5")
series_3 = Series(Start=Slider(10000, range=0..10000), Step=multiplication_9, Count=Slider(10, range=0..10))
item_12 = ListItem(List=series_3, Index=0, Wrap=True)  # -> Item, Item1, Item2, Item3, Item4, Item5

deconstruct_bilayer_3 = DeconstructBilayer(Bilayer=deconstruct_panel)
division_5 = Division(A=int, B=2)
bang = ExplodeTree(Data=deconstruct_bilayer_3)
c_script_6 = CSharpScript(tree=dec_reg_3.Polyline, downsample=division_5)  # -> out, A; inputs tree: tree, downsample: Int32
# ---------- c_script_6: C# ----------
    DataTree<object> output = new DataTree<object>();
    for(int i = 0; i < tree.BranchCount; i++)
    {
      if(tree.Paths[i][1] % downsample == 0)
      {
        output.AddRange(tree.Branch(i), tree.Paths[i]);
      }
    }
    A = output;
# ---------- end c_script_6 ----------
c_script_7 = CSharpScript(tree=dec_reg_3.ThicknessBlendedRadius, downsample=division_5)  # -> out, A; inputs tree: tree, downsample: Int32; same code as c_script_6
dec_board_3 = DeconstructBoard(Board=bang)  # -> Polyline, Name, Species, RTAngle, MoistureChange, DesiredRadius, Radius, BlendedRadius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
dec_reg_4 = DeconstructBoardRegion(BoardRegion=dec_board_3.BoardRegions)  # -> Polyline, Name, Species, RTAngle, MoistureChange, DesiredRadius, Radius, BlendedRadius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

bnd_6 = Bounds(Numbers=flatten(dec_reg_2.ThicknessBlendedRadius))
dedomain_10 = DeconstructDomain(Domain=bnd_6)  # -> Start, End
Y_7 = UnitY(Factor=item_12.Item)
gradient = Gradient(
    LowerLimit=dedomain_10.Start,
    UpperLimit=dedomain_10.End,
    Parameter=dec_reg_2.ThicknessBlendedRadius,
    stops=[0: RGB(255, 255, 255), 1: RGB(0, 0, 0)])
vec = Vector(Y_7)
move_7 = Move(Geometry=display_panel.ActiveBoards, Motion=vec)  # -> Geometry, Transform
move_8 = Move(Geometry=display_panel.PassiveBoards, Motion=vec)  # -> Geometry, Transform
area_3 = Area(Geometry=move_7.Geometry)  # -> Area, Centroid
Z = UnitZ(Factor=Slider(10, range=0..10))
move_9 = Move(Geometry=area_3.Centroid, Motion=Z)  # -> Geometry, Transform
round = Round(Number=dec_reg_2.ThicknessBlendedRadius)  # -> Nearest, Floor, Ceiling
preview = CustomPreview(Geometry=move_8.Geometry, Material=gradient)  # disabled
tag = TextTag3D(Location=move_9.Geometry, Text=round.Nearest, Size=Slider(100, range=0..100), Colour=RGB(255, 0, 0), Justification=5)
preview_2 = CustomPreview(Geometry=move_7.Geometry, Material=gradient)

panel_8 = Panel(bnd_6)
dec_panel_buildups = DeconstructPanelBuildup(Panels=item_11.Item)  # -> WoodSpecies, Thicknesses

python = GhPythonScript(x=dec_reg_2.Species)  # -> out, a
# ---------- python: Python ----------
a = x.Name
# ---------- end python ----------
len = TextLength(Text=python.a)
bnd_7 = Bounds(Numbers=flatten(len))
dedomain_11 = DeconstructDomain(Domain=bnd_7)  # -> Start, End
gradient_2 = Gradient(
    LowerLimit=dedomain_11.Start,
    UpperLimit=dedomain_11.End,
    Parameter=len,
    stops=[0: RGB(80, 55, 25), 0.5: RGB(159, 65, 29), 1: RGB(174, 166, 129)])
Y_8 = UnitY(Factor=item_12.Item4)
vec_2 = Vector(Y_8)
move_10 = Move(Geometry=display_panel.ActiveBoards, Motion=vec_2)  # -> Geometry, Transform
move_11 = Move(Geometry=display_panel.PassiveBoards, Motion=vec_2)  # -> Geometry, Transform
preview_3 = CustomPreview(Geometry=move_10.Geometry, Material=gradient_2)
preview_4 = CustomPreview(Geometry=move_11.Geometry, Material=ColourSwatch(SwatchColor=RGB(115, 115, 115)))  # disabled

mesh = Mesh(dec_reg_4.Polyline)
lng_5 = ListLength(List=dec_panel_buildups.WoodSpecies)

c_script_8 = CSharpScript(desired=dec_reg_2.DesiredRadius, actual=dec_reg_2.ThicknessBlendedRadius)  # -> out, A; inputs desired: Double, actual: Double
# ---------- c_script_8: C# ----------
    A = 100 * Math.Abs(desired - actual) / ((desired + actual) / 2);
# ---------- end c_script_8 ----------
bnd_8 = Bounds(Numbers=flatten(c_script_8.A))
panel_9 = Panel(bnd_8)
Y_9 = UnitY(Factor=item_12.Item1)
gradient_3 = Gradient(LowerLimit=0, UpperLimit="100", Parameter=c_script_8.A, stops=[0.15: RGB(255, 130, 160), 0.85: RGB(220, 0, 40)])
vec_3 = Vector(Y_9)
move_12 = Move(Geometry=display_panel.ActiveBoards, Motion=vec_3)  # -> Geometry, Transform
move_13 = Move(Geometry=display_panel.PassiveBoards, Motion=vec_3)  # -> Geometry, Transform
swatch = ColourSwatch(SwatchColor=RGBA(0, 0, 0, 66))
preview_5 = CustomPreview(Geometry=move_12.Geometry, Material=gradient_3)
preview_6 = CustomPreview(Geometry=move_13.Geometry, Material=gradient_3)  # disabled

c_script_9 = CSharpScript(x=lng_5)  # -> out, flatten(A); inputs x: tree
# ---------- c_script_9: C# ----------
    DataTree<object> output = new DataTree<object>();
    int firstIndex = 0;
    int branchCount = 0;
    for(int i = 0; i < x.BranchCount; i++)
    {
      GH_Path path = new GH_Path(firstIndex, branchCount);
      if(x.Paths[i][0] == firstIndex)
      {
        output.AddRange(x.Branch(i), path);
      }
      else
      {
        firstIndex++;
        branchCount = -1;
        i--;
      }
      branchCount++;
    }
    A = output;
# ---------- end c_script_9 ----------

bnd_9 = Bounds(Numbers=flatten(c_script_9.A))
dedomain_12 = DeconstructDomain(Domain=bnd_9)  # -> Start, End
gradient_4 = Gradient(
    LowerLimit=dedomain_12.Start,
    UpperLimit=dedomain_12.End,
    Parameter=c_script_9.A,
    stops=[0: RGB(0, 128, 0), 0.5: RGB(255, 255, 0), 1: RGB(255, 0, 0)])
Y_10 = UnitY(Factor=item_12.Item5)
vec_4 = Vector(Y_10)
move_14 = Move(Geometry=mesh, Motion=vec_4)  # -> flatten(Geometry), Transform
preview_7 = CustomPreview(Geometry=move_14.Geometry, Material=gradient_4)

bnd_10 = Bounds(Numbers=flatten(dec_reg_2.RTAngle))
dedomain_13 = DeconstructDomain(Domain=bnd_10)  # -> Start, End
gradient_5 = Gradient(
    LowerLimit=dedomain_13.Start,
    UpperLimit=dedomain_13.End,
    Parameter=dec_reg_2.RTAngle,
    stops=[0: RGB(124, 0, 219), 1: RGB(207, 130, 255)])
Y_11 = UnitY(Factor=item_12.Item2)
vec_5 = Vector(Y_11)
move_15 = Move(Geometry=display_panel.ActiveBoards, Motion=vec_5)  # -> Geometry, Transform
move_16 = Move(Geometry=display_panel.PassiveBoards, Motion=vec_5)  # -> Geometry, Transform
preview_8 = CustomPreview(Geometry=move_15.Geometry, Material=gradient_5)
preview_9 = CustomPreview(Geometry=move_16.Geometry, Material=ColourSwatch(SwatchColor=RGB(115, 115, 115)))  # disabled

bnd_11 = Bounds(Numbers=flatten(dec_reg_2.MoistureChange))
dedomain_14 = DeconstructDomain(Domain=bnd_11)  # -> Start, End
Y_12 = UnitY(Factor=item_12.Item3)
gradient_6 = Gradient(
    LowerLimit=dedomain_14.Start,
    UpperLimit=dedomain_14.End,
    Parameter=dec_reg_2.MoistureChange,
    stops=[0: RGB(156, 216, 217), 0.502: RGB(77, 123, 135), 1: RGB(55, 81, 102)])
vec_6 = Vector(Y_12)
move_17 = Move(Geometry=display_panel.ActiveBoards, Motion=vec_6)  # -> Geometry, Transform
move_18 = Move(Geometry=display_panel.PassiveBoards, Motion=vec_6)  # -> Geometry, Transform
preview_10 = CustomPreview(Geometry=move_17.Geometry, Material=gradient_6)
preview_11 = CustomPreview(Geometry=move_18.Geometry, Material=ColourSwatch(SwatchColor=RGB(115, 115, 115)))  # disabled

c_script_10 = CSharpScript(x=c_script_7.A)  # -> out, A; inputs x: tree; same code as c_script_9
number_slider_29 = Slider(1, range=0..100000)  # disabled
number_slider_30 = Slider(10000, range=0..100000)  # disabled
number_slider_31 = Slider(10, range=0..10)  # disabled

crv_5 = Curve(c_script_6.A)
area_4 = Area(Geometry=crv_5)  # -> Area, Centroid
bbox_3 = BoundingBox(Content=flatten(dec_reg_3.Polyline), Plane=PlaneXY(0, 0, 0), UnionBox=True)  # -> Box, Box_2
avr = Average(Input=area_4.Centroid)
debox_3 = DeconstructBox(Box=bbox_3.Box)  # -> Plane, X, Y, Z

pdecon_8 = Deconstruct(Point=avr)  # -> XComponent, YComponent, ZComponent
trim_3 = TrimTree(Tree=pdecon_8.XComponent, Depth=1)
bnd_12 = Bounds(Numbers=trim_3)

remap_24 = RemapNumbers(Value=pdecon_8.XComponent, Source=bnd_12, Target=debox_3.X)  # -> Mapped, Clipped
pt_25 = ConstructPoint(XCoordinate=remap_24.Mapped, YCoordinate=pdecon_8.YComponent, ZCoordinate=pdecon_8.ZComponent)
yz = YZPlane(Origin=pt_25)

c_script_11 = CSharpScript(x=yz)  # -> out, A; inputs x: tree; same code as c_script_9

num_22 = Number(num)
num_23 = Number(c_script_10.A)
pln = Plane(c_script_11.A)
c_script_12 = CSharpScript(iRadii=num_23, iBoardWidth=num_22, iPlanes=pln)  # -> out, simplify(A); inputs iRadii: tree of Double, iBoardWidth: Double, iPlanes: tree of Plane
# ---------- c_script_12: C# ----------
    DataTree<Point3d> pointTree = new DataTree<Point3d>();

    for (int j = 0; j < iRadii.BranchCount; j++)
    {

      //initialize variables
      Plane bp = iPlanes.Branch(j)[0];
      Point3d startPoint = new Point3d(bp.Origin);
      Point3d centerPoint = startPoint;
      Vector3d rotationAxis = new Vector3d(bp.ZAxis);
      Vector3d centerPointVect = new Vector3d(bp.YAxis);
      centerPointVect.Rotate(Math.PI / 2, rotationAxis);

      for (int i = 0; i < iRadii.Branch(j).Count; i++){
        GH_Path pth = iRadii.Paths[j].AppendElement(i);
        Point3d point1 = startPoint;
        Point3d point2 = startPoint;

        pointTree.Add(point1, pth);

        //calculate rotation angle
        Double arcLength = iBoardWidth;
        Double radius = iRadii.Branch(j)[i];
        Double rotation = (arcLength / radius);

        //calculate rotation center point
        centerPointVect.Unitize();
        centerPointVect *= radius;
        centerPoint += centerPointVect;


        //execute half rotation
        Transform tx = Transform.Rotation(rotation / 2, rotationAxis, centerPoint);


        point2.Transform(tx);
        pointTree.Add(point2, pth);

        //execute full rotation
        tx = Transform.Rotation(rotation, rotationAxis, centerPoint);
        startPoint.Transform(tx);
        pointTree.Add(startPoint, pth);

        //updata rotation parameters
        centerPoint = startPoint;
        centerPointVect.Transform(tx);
      }
    }
    A = pointTree;
# ---------- end c_script_12 ----------

trim_4 = TrimTree(Tree=c_script_12.A, Depth=1)
cullpt = CullDuplicates(Points=trim_4, Tolerance=0.1, CullMode=3)  # -> Points, Indices, Valence
pt_26 = Point(cullpt.Points)

# ---- group: animate
pt_27 = Point(simplify(pt_26))
pln_2 = Plane(graft(pln))
num_24 = Number(Slider(1, range=0..1))
c_script_13 = CSharpScript(iPoints=simplify(pt_27), iPlanes=pln_2, iShapeFactor=num_24)  # -> out, A; inputs iPoints: tree of Point3d, iPlanes: tree of Plane, iShapeFactor: Double
# ---------- c_script_13: C# ----------
    DataTree<Point3d> output = new DataTree<Point3d>();
    
    double shapeFactor = 1.0 - iShapeFactor;

    //step through curves
    for (int i = 0; i < iPoints.BranchCount; i++)
    {
      Plane currentPlane = iPlanes.Branch(iPoints.Path(i)[0])[0];

      //get vectors from plane
      Vector3d zVect = currentPlane.YAxis;

      Vector3d rotVect = currentPlane.ZAxis;

      //create new startpoint inside list
      Point3d startPoint = iPoints.Branch(i)[0];

      //step through points. Create and rotate vectors
      for (int j = 0; j < iPoints.Branch(i).Count; j++)
      {
        if (j == 0) output.Add(startPoint, iPoints.Path(i));
        else{
          //create current segment vector
          Vector3d segmentVect = new Vector3d(iPoints.Branch(i)[j] - iPoints.Branch(i)[j - 1]);

          //measure angle with vertical vector
          double angle = Vector3d.VectorAngle(zVect, segmentVect, currentPlane);

          //rotate
          segmentVect.Rotate(-angle * shapeFactor, rotVect);

          startPoint += segmentVect;
          output.Add(startPoint, iPoints.Path(i));
        }
      }
    }

    A = output;
# ---------- end c_script_13 ----------
pt_28 = Point(c_script_13.A)
intcrv_4 = Interpolate(Vertices=pt_28, Degree=3, Periodic=False, KnotStyle=1)  # -> Curve, Length, Domain
crv_6 = Curve(intcrv_4.Curve)

# ----
crv_7 = Curve(crv_6)
pt_29 = Point(simplify(graft(pt_25)))
end = EndPoints(Curve=crv_7)  # -> Start, End
vec2pt = Vector2Pt(PointA=end.Start, PointB=end.End, Unitize=False)  # -> Vector, Length
yz_2 = YZPlane(Origin=end.Start)
Y_13 = UnitY(Factor="-1")
angle = Angle(VectorA=vec2pt.Vector, VectorB=Y_13, Plane=yz_2)  # -> Angle, Reflex
rotate = Rotate(Geometry=crv_7, Angle=angle.Angle, Plane=yz_2)  # -> Geometry, Transform
curvepoint = PointOnCurve(rotate.Geometry, parameter=0.5)
vec2pt_2 = Vector2Pt(PointA=curvepoint, PointB=pt_29, Unitize=False)  # -> Vector, Length
move_19 = Move(Geometry=rotate.Geometry, Motion=vec2pt_2.Vector)  # -> Geometry, Transform
path_mapper_2 = PathMapper(move_19.Geometry, source=["{A;B}", "{A}"], target=["{A}", "{0}"])
crv_8 = Curve(path_mapper_2)
loft = Loft(Curves=crv_8, Options={Adjust=False, Closed=False, LoftEnds=0, LoftSimp=0, LoftType=2, Rebuild=10, Refit=0.01})

bool = Boolean(relaxation)  # disabled
cull_8 = CullPattern(List=loft, CullPattern=bool)  # disabled
number_slider_32 = Slider(8, range=0..100)  # disabled
srf = Surface(cull_8)  # disabled
num_25 = Number(number_slider_26)  # disabled
quads = QuadPanels(Surface=srf, UDivisions=number_slider_32, VDivisions=num_25)  # disabled
srf_2 = Surface(reparameterize(simplify(quads)))  # disabled

smesh = SimpleMesh(Brep=srf_2)  # disabled
area_5 = MeshArea(Mesh=smesh)  # -> Area, Centroid; disabled
meshcp = MeshClosestPoint(Point=area_5.Centroid, Mesh=smesh)  # -> Point, Index, Parameter; disabled
meval = MeshEval(Mesh=smesh, Parameter=meshcp.Parameter)  # -> Point, Normal, Colour; disabled
pl = PlaneNormal(Origin=meval.Point, ZAxis=meval.Normal)  # disabled
X = UnitX(Factor=1)  # disabled
deplane = DeconstructPlane(Plane=pl)  # -> Origin, XAxis, YAxis, ZAxis; disabled
angle_2 = Angle(VectorA=deplane.XAxis, VectorB=X, Plane=pl)  # -> Angle, Reflex; disabled
rotate_2 = Rotate(Geometry=pl, Angle=angle_2.Angle, Plane=pl)  # -> graft(Geometry), Transform; disabled

medges = MeshEdges(Mesh=smesh)  # -> simplify(NakedEdges), InteriorEdges, NonManifoldEdges; disabled
curvepoint_2 = PointOnCurve(medges.NakedEdges, parameter=0.5)  # disabled
plcoord = PlaneCoordinates(Point=curvepoint_2, System=rotate_2.Geometry)  # -> XCoordinate, YCoordinate, ZCoordinate; disabled
sort = SortList(Keys=plcoord.XCoordinate, ValuesA=medges.NakedEdges)  # -> Keys, ValuesA; disabled
item_13 = ListItem(List=reverse(sort.ValuesA), Index=0, Wrap=True)  # disabled
item_14 = ListItem(List=sort.ValuesA, Index=0, Wrap=True)  # disabled

merge_15 = Merge(Data1=item_14, Data2=item_13)  # disabled
trim_5 = TrimTree(Tree=merge_15, Depth=1)  # disabled
rdlines = RemoveDuplicateLinesKaramba3D(Line=trim_5, LimitDistance=0.005)  # -> OutLine, Info, Indexes; disabled
join_3 = JoinCurves(Curves=rdlines.OutLine, Preserve=False)  # disabled
explode = Explode(Curve=join_3, Recursive=True)  # -> Segments, simplify(Vertices); disabled
pline = PolyLine(Vertices=explode.Vertices, Closed=False)  # -> simplify(graft(Polyline)); disabled
path_mapper_3 = PathMapper(pline, source=["{A}", "{A;B}"], target=["{0}", "{A}"])  # disabled
curvepoint_3 = PointOnCurve(path_mapper_3, parameter=0.5)  # disabled
pdecon_9 = Deconstruct(Point=curvepoint_3)  # -> XComponent, YComponent, ZComponent; disabled
sort_2 = SortList(Keys=pdecon_9.XComponent, ValuesA=path_mapper_3)  # -> Keys, ValuesA; disabled
crv_9 = Curve(sort_2.ValuesA)  # disabled

crv_10 = Curve(crv_9)  # disabled
item_15 = ListItem(List=crv_10, Index=0, Wrap=True)  # disabled
curvepoint_4 = PointOnCurve(crv_10, parameter=0.5)  # disabled
curvepoint_5 = PointOnCurve(item_15, parameter=0.5)  # disabled
vec2pt_3 = Vector2Pt(PointA=curvepoint_5, PointB=curvepoint_4, Unitize=False)  # -> Vector, Length; disabled
move_20 = Move(Geometry=item_15, Motion=vec2pt_3.Vector)  # -> Geometry, Transform; disabled

crv_11 = Curve(crv_9)  # disabled
flip = FlipCurve(Curve=crv_11, Guide=move_20.Geometry)  # -> Curve, Flag; disabled

explode_2 = Explode(Curve=flip.Curve, Recursive=True)  # -> simplify(Segments), Vertices; disabled
explode_3 = Explode(Curve=move_20.Geometry, Recursive=True)  # -> simplify(Segments), Vertices; disabled
lng_6 = ListLength(List=explode_2.Segments)  # disabled
lng_7 = ListLength(List=explode_2.Segments)  # disabled
lng_8 = ListLength(List=explode_3.Segments)  # disabled
lng_9 = ListLength(List=explode_3.Segments)  # disabled
subtraction_7 = Subtraction(A=lng_6, B=2)  # disabled
subtraction_8 = Subtraction(A=lng_7, B=1)  # disabled
subtraction_9 = Subtraction(A=lng_8, B=2)  # disabled
subtraction_10 = Subtraction(A=lng_9, B=1)  # disabled
dom_19 = ConstructDomain(DomainStart=0, DomainEnd=subtraction_7)  # disabled
dom_20 = ConstructDomain(DomainStart=1, DomainEnd=subtraction_8)  # disabled
dom_21 = ConstructDomain(DomainStart=0, DomainEnd=subtraction_9)  # disabled
dom_22 = ConstructDomain(DomainStart=1, DomainEnd=subtraction_10)  # disabled
subset_3 = SubList(List=explode_2.Segments, Domain=dom_19, Wrap=True)  # -> graft(List), Index; disabled
subset_4 = SubList(List=explode_2.Segments, Domain=dom_20, Wrap=True)  # -> graft(List), Index; disabled
subset_5 = SubList(List=explode_3.Segments, Domain=dom_21, Wrap=True)  # -> graft(List), Index; disabled
subset_6 = SubList(List=explode_3.Segments, Domain=dom_22, Wrap=True)  # -> graft(List), Index; disabled
angle_3 = Angle(VectorA=subset_5.List, VectorB=subset_6.List)  # -> simplify(Angle), Reflex; disabled
angle_4 = Angle(VectorA=subset_3.List, VectorB=subset_4.List)  # -> simplify(Angle), Reflex; disabled
join_4 = JoinCurves(Curves=[subset_5.List, subset_6.List], Preserve=False)  # -> simplify(Curves); disabled
num_26 = Number(angle_3.Angle)  # disabled
num_27 = Number(angle_4.Angle)  # disabled

explode_4 = Explode(Curve=flip.Curve, Recursive=True)  # -> simplify(Segments), Vertices; disabled
explode_5 = Explode(Curve=move_20.Geometry, Recursive=True)  # -> simplify(Segments), Vertices; disabled
path_mapper_4 = PathMapper(explode_4.Segments, source=["{A}(i)", "{A;B}(i)"], target=["{i}(A)", "{A;i}(B)"])  # disabled
path_mapper_5 = PathMapper(explode_5.Segments, source=["{A}(i)", "{A;B}(i)"], target=["{i}(A)", "{A;i}(B)"])  # disabled
crv_12 = Curve(path_mapper_5)  # disabled
crv_13 = Curve(path_mapper_4)  # disabled
lng_10 = ListLength(List=crv_13)  # -> expr("x-2", Length); disabled
lng_11 = ListLength(List=crv_12)  # -> expr("x-2", Length); disabled
lng_12 = ListLength(List=crv_13)  # -> expr("x-1", Length); disabled
lng_13 = ListLength(List=crv_12)  # -> expr("x-1", Length); disabled
dom_23 = ConstructDomain(DomainStart=0, DomainEnd=lng_10)  # disabled
dom_24 = ConstructDomain(DomainStart=0, DomainEnd=lng_11)  # disabled
dom_25 = ConstructDomain(DomainStart=1, DomainEnd=lng_12)  # disabled
dom_26 = ConstructDomain(DomainStart=1, DomainEnd=lng_13)  # disabled
subset_7 = SubList(List=crv_13, Domain=dom_23, Wrap=True)  # -> graft(List), Index; disabled
subset_8 = SubList(List=crv_12, Domain=dom_24, Wrap=True)  # -> graft(List), Index; disabled
subset_9 = SubList(List=crv_13, Domain=dom_25, Wrap=True)  # -> graft(List), Index; disabled
subset_10 = SubList(List=crv_12, Domain=dom_26, Wrap=True)  # -> graft(List), Index; disabled
loft_2 = Loft(
    Curves=[subset_7.List, subset_9.List],
    Options={Adjust=False, Closed=False, LoftEnds=0, LoftSimp=0, LoftType=0, Rebuild=10, Refit=0.01})  # -> simplify(Loft); disabled
loft_3 = Loft(
    Curves=[subset_8.List, subset_10.List],
    Options={Adjust=False, Closed=False, LoftEnds=0, LoftSimp=0, LoftType=0, Rebuild=10, Refit=0.01})  # -> simplify(Loft); disabled
smesh_2 = SimpleMesh(Brep=loft_2)  # disabled
smesh_3 = SimpleMesh(Brep=loft_3)  # disabled
path_mapper_6 = PathMapper(smesh_3, source=["{A;B;C}", "{A;B}"], target=["{A}", "{0}"])  # disabled
path_mapper_7 = PathMapper(smesh_2, source=["{A;B;C}", "{A;B}"], target=["{A}", "{0}"])  # disabled
mjoin = MeshJoin(Meshes=path_mapper_6)  # disabled
mjoin_2 = MeshJoin(Meshes=path_mapper_7)  # disabled
weld = WeldMesh(Mesh=mjoin, Angle=3.141592654)  # disabled
weld_2 = WeldMesh(Mesh=mjoin_2, Angle=3.141592654)  # disabled

explode_6 = Explode(Curve=move_20.Geometry, Recursive=True)  # -> Segments, Vertices; disabled
num_28 = Number(num_27)  # disabled
num_29 = Number(num_26)  # disabled
mesh_2 = Mesh(weld)  # disabled
division_6 = Division(A=num_28, B=num_29)  # -> graft(Result); disabled
path_mapper_8 = PathMapper(explode_6.Vertices, source=["{A;B}(i)", "{A}(i)"], target=["{A;i}(B)", "{i}(A)"])  # disabled
number_slider_33 = Slider(1, range=0..100000)  # disabled
number_slider_34 = Slider(1, range=0..10000)  # disabled
number_slider_35 = Slider(100000, range=0..1000000)  # disabled
pline_2 = PolyLine(Vertices=path_mapper_8, Closed=False)  # -> simplify(Polyline); disabled
path_mapper_9 = PathMapper(pline_2, source=["{A;B}", "{A}"], target=["{A}", "{0}"])  # disabled
crv_14 = Curve(join_4)  # disabled
show = Show(G=mesh_2)  # -> flatten(G); disabled
rod = Rod(Polyline=path_mapper_9, LengthFactor=1, AngleFactor=1, AxialStrength=number_slider_33, BendStrength=number_slider_34)  # -> flatten(R); disabled
rod_2 = Rod(Polyline=crv_14, LengthFactor=1, AngleFactor=division_6, AxialStrength=number_slider_29, BendStrength=number_slider_35)  # -> flatten(R); disabled
merge_16 = Merge(Data1=rod, Data2=rod_2, Data3=show)  # disabled

zombiesolver = ZombieSolver(GoalObjects=flatten(merge_16), Threshold=1e-10, Tolerance=0.0001, MaxIterations=number_slider_30)  # -> I, V, O; disabled
mesh_3 = Mesh(zombiesolver.O)  # disabled
clean = CleanTree(RemoveNulls=True, RemoveInvalid=True, RemoveEmpty=False, Tree=mesh_3)  # disabled

wbedges = WeaverbirdsMeshEdges(MeshOrPolylines=graft(clean))  # -> simplify(Lines); disabled
mesh_4 = Mesh(simplify(graft(clean)))  # disabled

wbedges_2 = WeaverbirdsMeshEdges(MeshOrPolylines=weld_2)  # -> simplify(Lines); disabled
line = Line(wbedges)  # disabled
number_slider_36 = Slider(1330, range=0..10000)  # disabled
group_3 = Group(Objects=line)  # -> flatten(Group); disabled
len_2 = Length(Curve=wbedges_2)  # disabled
len_3 = Length(Curve=line)  # disabled
lng_14 = ListLength(List=group_3)  # disabled
subtraction_11 = Subtraction(A=len_3, B=len_2)  # disabled
series_4 = Series(Start=0, Step=number_slider_36, Count=lng_14)  # disabled
number_slider_37 = Slider(5928, range=0..10000)  # disabled
smaller_2 = SmallerThan(FirstNumber=subtraction_11, SecondNumber=0)  # -> SmallerThan, OrEqualTo; disabled
dispatch = Dispatch(List=subtraction_11, DispatchPattern=smaller_2.SmallerThan)  # -> ListA, ListB; disabled
Y_14 = UnitY(Factor=series_4)  # disabled
Y_15 = UnitY(Factor=number_slider_37)  # disabled
move_21 = Move(Geometry=group_3, Motion=Y_14)  # -> Geometry, Transform; disabled
bnd_13 = Bounds(Numbers=dispatch.ListA)  # disabled
bnd_14 = Bounds(Numbers=dispatch.ListB)  # disabled
number_slider_38 = Slider(7456, range=0..10000)  # disabled
move_22 = Move(Geometry=move_21.Geometry, Motion=Y_15)  # -> Geometry, Transform; disabled
dedomain_15 = DeconstructDomain(Domain=bnd_14)  # -> Start, End; disabled
dedomain_16 = DeconstructDomain(Domain=bnd_13)  # -> Start, End; disabled
X_2 = UnitX(Factor=number_slider_38)  # disabled
move_23 = Move(Geometry=move_22.Geometry, Motion=X_2)  # -> Geometry, Transform; disabled
gradient_7 = Gradient(
    LowerLimit=dedomain_16.Start,
    UpperLimit=dedomain_16.End,
    Parameter=dispatch.ListA,
    stops=[0: RGB(75, 107, 169), 0.501: RGB(173, 203, 249), 1: RGB(254, 244, 84)])  # disabled
gradient_8 = Gradient(
    LowerLimit=dedomain_15.Start,
    UpperLimit=dedomain_15.End,
    Parameter=dispatch.ListB,
    stops=[0: RGB(254, 244, 84), 0.499: RGB(234, 126, 0), 1: RGB(234, 38, 0), 1: RGB(75, 107, 169), 1: RGB(173, 203, 249)])  # disabled
ungroup_3 = Ungroup(Group=move_23.Geometry)  # disabled
dispatch_2 = Dispatch(List=ungroup_3, DispatchPattern=smaller_2.SmallerThan)  # -> ListA, ListB; disabled
previewlw = CustomPreviewLineweights(Geometry=dispatch_2.ListA, Shader=gradient_7, Thickness=3, Absolute=False)  # disabled
previewlw_2 = CustomPreviewLineweights(Geometry=dispatch_2.ListB, Shader=gradient_8, Thickness=3, Absolute=False)  # disabled

crv_15 = Curve(wbedges)  # disabled
end_2 = EndPoints(Curve=crv_15)  # -> Start, End; disabled
pdecon_10 = Deconstruct(Point=end_2.Start)  # -> XComponent, YComponent, ZComponent; disabled
pdecon_11 = Deconstruct(Point=end_2.End)  # -> XComponent, YComponent, ZComponent; disabled
subtraction_12 = Subtraction(A=pdecon_10.XComponent, B=pdecon_11.XComponent)  # disabled
number_slider_39 = Slider(100, range=0..100)  # disabled
abs = Absolute(Value=subtraction_12)  # disabled
smaller_3 = SmallerThan(FirstNumber=abs, SecondNumber=number_slider_39)  # -> SmallerThan, OrEqualTo; disabled
cull_9 = CullPattern(List=crv_15, CullPattern=smaller_3.SmallerThan)  # disabled
join_5 = JoinCurves(Curves=cull_9, Preserve=False)  # disabled
curvepoint_6 = PointOnCurve(join_5, parameter=0.5)  # disabled
pdecon_12 = Deconstruct(Point=curvepoint_6)  # -> XComponent, YComponent, ZComponent; disabled
sort_3 = SortList(Keys=pdecon_12.XComponent, ValuesA=join_5)  # -> Keys, ValuesA; disabled
explode_7 = Explode(Curve=sort_3.ValuesA, Recursive=True)  # -> Segments, simplify(Vertices); disabled
intcrv_5 = Interpolate(Vertices=explode_7.Vertices, Degree=3, Periodic=False, KnotStyle=1)  # -> Curve, Length, Domain; disabled
path_mapper_10 = PathMapper(intcrv_5.Curve, source=["{A;B}", "{A}"], target=["{A}", "{0}"])  # disabled
loft_4 = Loft(Curves=path_mapper_10, Options={Adjust=False, Closed=False, LoftEnds=0, LoftSimp=0, LoftType=0, Rebuild=10, Refit=0.01})  # disabled

mesh_5 = Mesh(mesh_4)  # disabled
number_slider_40 = Slider(1, range=0..1)  # disabled
num_30 = Number(expr("x+1", number_slider_32))  # disabled
medges_2 = MeshEdges(Mesh=mesh_5)  # -> NakedEdges, InteriorEdges, NonManifoldEdges; disabled
demesh = DeconstructMesh(Mesh=mesh_5)  # -> Vertices, Faces, Colours, Normals; disabled
join_6 = JoinCurves(Curves=medges_2.NakedEdges, Preserve=False)  # disabled
patch = Patch(Curves=join_6, Points=demesh.Vertices, Spans=num_30, Flexibility=number_slider_40, Trim=True)  # disabled
srf_3 = Surface(simplify(patch))  # disabled

# ---- group: control gate
srf_4 = Surface(loft_4)  # disabled
srf_5 = Surface(loft)  # disabled
bool_2 = Boolean(relaxation)  # disabled
not_2 = GateNot(A=bool_2)  # disabled
cull_10 = CullPattern(List=srf_5, CullPattern=not_2)  # disabled
cull_11 = CullPattern(List=cull_7, CullPattern=cross_section)  # disabled
merge_17 = Merge(Data1=srf_4, Data2=cull_10)  # disabled

# ----
srf_6 = Surface(merge_17)  # disabled
edges = BrepEdges(Brep=srf_6)  # -> Naked, Interior, NonManifold; disabled
len_4 = Length(Curve=edges.Naked)  # disabled
sort_4 = SortList(Keys=len_4, ValuesA=edges.Naked)  # -> Keys, reverse(ValuesA); disabled
item_16 = ListItem(List=sort_4.ValuesA, Index=0, Wrap=True)  # -> Item, Item1; disabled
flip_2 = FlipCurve(Curve=item_16.Item1)  # -> Curve, Flag; disabled
number_slider_41 = Slider(100, range=0..100)  # disabled
merge_18 = Merge(Data1=item_16.Item, Data2=flip_2.Curve)  # disabled
divide_2 = DivideCurve(Curve=merge_18, Count=number_slider_41, Kinks=False)  # -> Points, Tangents, Parameters; disabled
path_mapper_11 = PathMapper(divide_2.Points, source="{A;B;C}(i)", target="{A;B;i}(C)")  # disabled
item_17 = ListItem(List=path_mapper_11, Index=0, Wrap=True)  # -> Item, Item1; disabled
dist = Distance(PointA=item_17.Item, PointB=item_17.Item1)  # disabled
trim_6 = TrimTree(Tree=dist, Depth=1)  # disabled
number_slider_42 = Slider(0.95, range=0..1)  # disabled
bnd_15 = Bounds(Numbers=trim_6)  # disabled
dedomain_17 = DeconstructDomain(Domain=bnd_15)  # -> simplify(Start), End; disabled
multiplication_10 = Multiplication(A=dedomain_17.Start, B=number_slider_42)  # -> flatten(Result); disabled
c_script_14 = CSharpScript(x=multiplication_10)  # -> out, A; inputs x: list of Double; disabled
# ---------- c_script_14: C# ----------
    List<double> output = new List<double>();
    
    double currentVal = 0;
    for(int i = 0; i < x.Count; i++)
    {
      output.Add(currentVal);
      currentVal += x[i];
    }
    A = output;
# ---------- end c_script_14 ----------
Y_16 = UnitY(Factor=c_script_14.A)  # disabled
move_24 = Move(Geometry=srf_6, Motion=graft(Y_16))  # -> Geometry, Transform; disabled

mesh_6 = Mesh(mesh_4)  # disabled
mesh_7 = Mesh(flatten(mesh_6))  # disabled
number_slider_43 = Slider(2905, range=0..10000)  # disabled
c_script_15 = CSharpScript(mesh=mesh_6, surface=srf_3)  # -> out, Curvature; inputs mesh: Mesh, surface: Surface; disabled
# ---------- c_script_15: C# ----------
        //get surface gaussian curvature at each mesh point
        List<double> gaussianCurvatures = new List<double>();
        double maxGaussian = 0;
        double minGaussian = double.MaxValue;

        double U;
        double V;

        for (int i = 0; i < mesh.Vertices.Count; i++)
        {
            Point3d currentMeshPoint = mesh.Vertices.Point3dAt(i);
            surface.ClosestPoint(currentMeshPoint, out U, out V);
            SurfaceCurvature surfaceCurvature = surface.CurvatureAt(U, V);
            double gaussian = surfaceCurvature.Gaussian;
            gaussianCurvatures.Add(gaussian);

            //get the range of curvatures
            if (gaussian > maxGaussian) maxGaussian = gaussian;
            if( gaussian < minGaussian) minGaussian = gaussian;
        }


        //get the range of curvatures


        //remap the curvatures to color values on the mesh points
        for (int i = 0; i < mesh.Vertices.Count; i++)
        {
            double hue = (gaussianCurvatures[i] - minGaussian) / (0 - minGaussian) * (0.5 - maxGaussian) + maxGaussian;
        }
        Curvature = gaussianCurvatures;
# ---------- end c_script_15 ----------
move_25 = Move(Geometry=mesh_7, Motion=Y_16)  # -> simplify(graft(Geometry)), Transform; disabled
num_31 = Number(c_script_15.Curvature)  # disabled
Y_17 = UnitY(Factor=number_slider_43)  # disabled
number_slider_44 = Slider(7456, range=0..10000)  # disabled
bnd_16 = Bounds(Numbers=num_31)  # disabled
mesh_8 = Mesh(move_25.Geometry)  # disabled
dedomain_18 = DeconstructDomain(Domain=bnd_16)  # -> Start, End; disabled
move_26 = Move(Geometry=mesh_8, Motion=Y_17)  # -> Geometry, Transform; disabled
X_3 = UnitX(Factor=number_slider_44)  # disabled
gradient_9 = Gradient(
    LowerLimit=dedomain_18.Start,
    UpperLimit=dedomain_18.End,
    Parameter=num_31,
    stops=[0: RGB(0, 128, 0), 0.5: RGB(255, 255, 0), 1: RGB(255, 0, 0)])  # disabled
move_27 = Move(Geometry=move_26.Geometry, Motion=X_3)  # -> Geometry, Transform; disabled
c_script_16 = CSharpScript(mesh=move_27.Geometry, colors=simplify(gradient_9))  # -> out, A; inputs mesh: Mesh, colors: list of Color; disabled
# ---------- c_script_16: C# ----------
    for(int i = 0; i < mesh.Vertices.Count; i++)
    {
      mesh.VertexColors.SetColor(i, colors[i]);
    }
    A = mesh;
# ---------- end c_script_16 ----------

gaussian_curvature = Panel(bnd_16)  # disabled
relaxation_2 = Panel(bnd_13)  # disabled

srf_7 = Surface(flatten(move_24.Geometry))  # disabled
data_10 = Data(cull_11)  # disabled
pan_srf = UpdatePanelSurface(Panel=data_10, Surface=srf_7)  # -> flatten(Panel); disabled
deconstruct_panel_2 = DeconstructPanel(Panel=pan_srf)  # disabled
deconstruct_bilayer_4 = DeconstructBilayer(Bilayer=deconstruct_panel_2)  # disabled
dec_board_4 = DeconstructBoard(Board=deconstruct_bilayer_4)  # -> Polyline, Name, Species, RTAngle, MoistureChange, DesiredRadius, Radius, BlendedRadius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; disabled
dec_reg_5 = DeconstructBoardRegion(BoardRegion=dec_board_4.BoardRegions)  # -> Polyline, Name, Species, RTAngle, MoistureChange, DesiredRadius, Radius, BlendedRadius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; disabled

trim_7 = TrimTree(Tree=dec_reg_5.ShapedRegion, Depth=1)  # disabled
join_7 = BrepJoin(Breps=trim_7)  # -> Breps, Closed; disabled
trim_8 = TrimTree(Tree=join_7.Breps, Depth=1)  # disabled
item_18 = ListItem(List=trim_8, Index=0, Wrap=True)  # -> flatten(Item); disabled

brep = Brep(item_18)  # disabled

# ---- group: brep extension if needed
debrep = DeconstructBrep(Brep=item_18)  # -> simplify(Faces), Edges, Vertices; disabled
debrep_2 = DeconstructBrep(Brep=debrep.Faces)  # -> Faces, Edges, Vertices; disabled
pdecon_13 = Deconstruct(Point=debrep_2.Vertices)  # -> XComponent, YComponent, ZComponent; disabled
sort_5 = SortList(Keys=pdecon_13.XComponent)  # -> Keys, ValuesA; disabled
item_19 = ListItem(List=sort_5.Keys, Index=0, Wrap=True)  # disabled
trim_9 = TrimTree(Tree=debrep_2.Faces, Depth=1)  # disabled
trim_10 = TrimTree(Tree=item_19, Depth=1)  # disabled
round_2 = Round(Number=trim_10)  # -> Nearest, Floor, Ceiling; disabled
sort_6 = SortList(Keys=round_2.Nearest, ValuesA=trim_9)  # -> Keys, simplify(ValuesA); disabled
cset = CreateSet(List=round_2.Nearest)  # -> Set, Map; disabled
number_slider_45 = Slider(1000, range=0..1000)  # disabled
number_slider_46 = Slider(1000, range=0..1000)  # disabled

# ----
sort_7 = SortList(Keys=cset.Set)  # -> Keys, ValuesA; disabled

# ---- group: brep extension if needed (continued)
item_20 = ListItem(List=reverse(sort_7.Keys), Index=0, Wrap=True)  # disabled
item_21 = ListItem(List=sort_7.Keys, Index=0, Wrap=True)  # disabled

# ----
equalst = EqualityWithinTolerance(FirstNumber=sort_6.Keys, SecondNumber=item_21, Tolerance=number_slider_31)  # -> Equality, Inequality; disabled
equalst_2 = EqualityWithinTolerance(FirstNumber=sort_6.Keys, SecondNumber=item_20, Tolerance=number_slider_31)  # -> Equality, Inequality; disabled

# ---- group: brep extension if needed / start
cull_12 = CullPattern(List=sort_6.ValuesA, CullPattern=equalst.Equality)  # disabled

# ---- group: brep extension if needed / end
cull_13 = CullPattern(List=sort_6.ValuesA, CullPattern=equalst_2.Equality)  # disabled

# ---- group: brep extension if needed (continued)
and = GateAnd(A=equalst.Inequality, B=equalst_2.Inequality)  # disabled
extendsrf = ExtendSurface(Surface=cull_12, WestEdge=number_slider_46, SouthEdge=0, EastEdge=0, NorthEdge=0, ExtensionType=True)  # disabled
extendsrf_2 = ExtendSurface(Surface=cull_13, WestEdge=0, SouthEdge=0, EastEdge=number_slider_45, NorthEdge=0, ExtensionType=True)  # disabled

# ---- group: brep extension if needed / middle
cull_14 = CullPattern(List=sort_6.ValuesA, CullPattern=and)  # disabled

# ---- group: brep extension if needed (continued)
merge_19 = Merge(Data1=cull_14, Data2=extendsrf, Data3=extendsrf_2)  # disabled
join_8 = BrepJoin(Breps=merge_19)  # -> flatten(Breps), Closed; disabled

# ----
c_script_17 = CSharpScript(breps=join_8.Breps)  # -> out, A; inputs breps: list; disabled
# ---------- c_script_17: C# ----------
    DataTree<object> output = new DataTree<object>();
    if(breps.Count == 1) return;
    for(int i = 0; i < breps.Count; i++)
    {
      GH_Path path = new GH_Path(i);
      if(i == 0)output.Add(breps[i + 1], path);
      else if(i == breps.Count - 1)output.Add(breps[i - 1], path);
      else
      {
        output.Add(breps[i - 1], path);
        output.Add(breps[i + 1], path);
      }
    }
    A = output;
# ---------- end c_script_17 ----------
splitmul = SplitBrepMultiple(Brep=graft(brep), Cutters=c_script_17.A)  # disabled
area_6 = Area(Geometry=splitmul)  # -> Area, Centroid; disabled
sort_8 = SortList(Keys=area_6.Area, ValuesA=splitmul)  # -> Keys, reverse(ValuesA); disabled
item_22 = ListItem(List=sort_8.ValuesA, Index=0, Wrap=True)  # disabled
brep_2 = Brep(flatten(item_22))  # disabled

item_23 = ListItem(List=reverse(brep_2), Index=0, Wrap=True)  # disabled
item_24 = ListItem(List=reverse(brep_2), Index=1, Wrap=True)  # disabled
bbx = BrepBrep(BrepA=item_23, BrepB=item_24)  # -> Curves, Points; disabled
crv_16 = Curve(bbx.Curves)  # disabled
explode_8 = Explode(Curve=crv_16, Recursive=True)  # -> Segments, flatten(Vertices); disabled
pdecon_14 = Deconstruct(Point=explode_8.Vertices)  # -> XComponent, YComponent, ZComponent; disabled
sort_9 = SortList(Keys=pdecon_14.XComponent, ValuesA=explode_8.Vertices)  # -> Keys, ValuesA; disabled
cullpt_2 = CullDuplicates(Points=sort_9.ValuesA, Tolerance=0.1, CullMode=3)  # -> Points, Indices, Valence; disabled
intcrv_6 = Interpolate(Vertices=cullpt_2.Points, Degree=3, Periodic=False, KnotStyle=1)  # -> Curve, Length, Domain; disabled
number_slider_47 = Slider(30, range=0..100)  # disabled
Y_18 = UnitY(Factor=number_slider_47)  # disabled
move_28 = Move(Geometry=intcrv_6.Curve, Motion=Y_18)  # -> Geometry, Transform; disabled
number_slider_48 = Slider(1000, range=0..1000)  # disabled
number_slider_49 = Slider(10000, range=0..10000)  # disabled
ext = ExtendCurve(Curve=move_28.Geometry, Type=0, Start=number_slider_48, End=number_slider_48)  # disabled
Y_19 = UnitY(Factor=number_slider_49)  # disabled
extr = Extrude(Base=ext, Direction=Y_19)  # disabled
split = SplitBrep(Brep=item_23, Cutter=extr)  # disabled
area_7 = Area(Geometry=split)  # -> Area, Centroid; disabled
pdecon_15 = Deconstruct(Point=area_7.Centroid)  # -> XComponent, YComponent, ZComponent; disabled
sort_10 = SortList(Keys=pdecon_15.ZComponent, ValuesA=split)  # -> Keys, reverse(ValuesA); disabled
item_25 = ListItem(List=sort_10.ValuesA, Index=0, Wrap=True)  # disabled

item_26 = ListItem(List=brep_2, Index=1, Wrap=True)  # disabled

item_27 = ListItem(List=brep_2, Index=0, Wrap=True)  # disabled
bbx_2 = BrepBrep(BrepA=item_27, BrepB=item_26)  # -> Curves, Points; disabled
crv_17 = Curve(bbx_2.Curves)  # disabled
explode_9 = Explode(Curve=crv_17, Recursive=True)  # -> Segments, flatten(Vertices); disabled
pdecon_16 = Deconstruct(Point=explode_9.Vertices)  # -> XComponent, YComponent, ZComponent; disabled
sort_11 = SortList(Keys=pdecon_16.XComponent, ValuesA=explode_9.Vertices)  # -> Keys, ValuesA; disabled
cullpt_3 = CullDuplicates(Points=sort_11.ValuesA, Tolerance=0.1, CullMode=3)  # -> Points, Indices, Valence; disabled
intcrv_7 = Interpolate(Vertices=cullpt_3.Points, Degree=3, Periodic=False, KnotStyle=1)  # -> Curve, Length, Domain; disabled
number_slider_50 = Slider(30, range=0..100)  # disabled
Y_20 = UnitY(Factor=expr("-x", number_slider_50))  # disabled
number_slider_51 = Slider(1000, range=0..1000)  # disabled
move_29 = Move(Geometry=intcrv_7.Curve, Motion=Y_20)  # -> Geometry, Transform; disabled
number_slider_52 = Slider(10000, range=0..10000)  # disabled
ext_2 = ExtendCurve(Curve=move_29.Geometry, Type=0, Start=number_slider_51, End=number_slider_51)  # disabled
Y_21 = UnitY(Factor=number_slider_52)  # disabled
neg_8 = Negative(Value=Y_21)  # disabled
extr_2 = Extrude(Base=ext_2, Direction=neg_8)  # disabled
split_2 = SplitBrep(Brep=item_27, Cutter=extr_2)  # disabled
area_8 = Area(Geometry=split_2)  # -> Area, Centroid; disabled
pdecon_17 = Deconstruct(Point=area_8.Centroid)  # -> XComponent, YComponent, ZComponent; disabled
sort_12 = SortList(Keys=pdecon_17.ZComponent, ValuesA=split_2)  # -> Keys, reverse(ValuesA); disabled
item_28 = ListItem(List=sort_12.ValuesA, Index=0, Wrap=True)  # disabled

brep_3 = Brep(brep_2)  # disabled

lng_15 = ListLength(List=brep_3)  # disabled
dom_27 = ConstructDomain(DomainStart=1, DomainEnd=expr("x-2", lng_15))  # disabled
larger = LargerThan(FirstNumber=lng_15, SecondNumber=2)  # -> LargerThan, OrEqualTo; disabled
subset_11 = SubList(List=brep_3, Domain=dom_27, Wrap=True)  # -> List, Index; disabled
cull_15 = CullPattern(List=subset_11.List, CullPattern=larger.LargerThan)  # disabled

lng_16 = ListLength(List=brep_2)  # -> expr("x-1", Length); disabled
merge_20 = Merge(Data1=flatten(item_28), Data2=flatten(cull_15), Data3=flatten(item_25))  # disabled
dom_28 = ConstructDomain(DomainStart=0, DomainEnd=lng_16)  # disabled
subset_12 = SubList(List=merge_20, Domain=dom_28, Wrap=True)  # -> List, Index; disabled

null = NullItem(Item=splitmul)  # -> NullFlags, InvalidFlags, Description; disabled
cull_16 = CullPattern(List=brep, CullPattern=null.NullFlags)  # disabled
merge_21 = Merge(Data1=cull_16, Data2=subset_12.List)  # disabled
clean_2 = CleanTree(RemoveNulls=True, RemoveInvalid=True, RemoveEmpty=True, Tree=merge_21)  # -> flatten(Tree); disabled

# ---- group: find cull pattern
brep_4 = Brep(item_18)  # disabled
brep_5 = Brep(clean_2)  # disabled
c_script_18 = CSharpScript(untrimmed=brep_4, trimmed=brep_5)  # -> out, A; inputs untrimmed: list of Brep, trimmed: list of Brep; disabled
# ---------- c_script_18: C# usings ----------
using Rhino.Geometry.Collections;
# ---------- c_script_18: C# ----------
    DataTree<bool> remains = new DataTree<bool>();
    for(int i = 0; i < untrimmed.Count; i++)
    {

      for(int j = 0; j < untrimmed[i].Faces.Count; j++)
      {
        remains.Add(false, new GH_Path(i));
      }

      BrepFaceList untrimmedFaces = untrimmed[i].Faces;

      //System.Threading.Tasks.Parallel.For(0, untrimmedFaces.Count, j =>
      for(int j = 0; j < untrimmedFaces.Count; j++)
      {

        BrepFaceList trimmedFaces = trimmed[i].Faces;

        for(int v = 0; v < trimmedFaces.Count; v++)
        {
          //var surface = trimmedFaces[v];
          //surface.SetDomain(0, new Interval(0, 1));
          //surface.SetDomain(1, new Interval(0, 1));
          Point3d centroid = trimmedFaces[v].PointAt(0.5, 0.5);

          double U;
          double V;
          untrimmedFaces[j].ClosestPoint(centroid, out U, out V);
          Point3d testPoint = untrimmedFaces[j].PointAt(U, V);

          if(testPoint.DistanceToSquared(centroid) < RhinoDoc.ActiveDoc.ModelAbsoluteTolerance * 4)
          {
            remains.Branch(i)[j] = true;
            break;
          }
        }
      }
    }
    A = remains;
# ---------- end c_script_18 ----------

# ----
match_brep = MatchTrimmedRegionBrep(Panel=pan_srf, Brep=clean_2)  # -> Regions, Regions_2; disabled
deconstruct_panel_3 = DeconstructPanel(Panel=match_brep.Regions)  # disabled
deconstruct_bilayer_5 = DeconstructBilayer(Bilayer=deconstruct_panel_3)  # disabled
dec_reg_6 = DeconstructBoardRegion(BoardRegion=match_brep.Regions_2)  # -> Polyline, Name, Species, RTAngle, MoistureChange, DesiredRadius, Radius, BlendedRadius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; disabled
dec_board_5 = DeconstructBoard(Board=deconstruct_bilayer_5)  # -> Polyline, Name, Species, RTAngle, MoistureChange, DesiredRadius, Radius, BlendedRadius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; disabled
panel_10 = Panel(c_script_18.A)  # disabled

brep_6 = Brep(clean_2)  # disabled
debrep_3 = DeconstructBrep(Brep=brep_6)  # -> simplify(graft(Faces)), Edges, flatten(Vertices); disabled
number_slider_53 = Slider(10, range=0..10)  # disabled
pdecon_18 = Deconstruct(Point=debrep_3.Vertices)  # -> XComponent, YComponent, ZComponent; disabled
panel_11 = Panel("0")  # disabled
equalst_3 = EqualityWithinTolerance(FirstNumber=pdecon_18.XComponent, SecondNumber=panel_11, Tolerance=number_slider_53)  # -> Equality, Inequality; disabled
cull_17 = CullPattern(List=debrep_3.Vertices, CullPattern=equalst_3.Equality)  # disabled

# ---- group: surfaces
srf_8 = Surface(debrep_3.Faces)  # disabled

# ----
data_11 = Data(cull_11)  # disabled
data_12 = Data()  # disabled
dec_panel_buildups_2 = DeconstructPanelBuildup(Panels=data_11)  # -> WoodSpecies, Thicknesses; disabled
tstat = TreeStatistics(Tree=dec_panel_buildups_2.Thicknesses)  # -> Paths, Length, Count; disabled
lng_17 = ListLength(List=tstat.Paths)  # disabled
panel_12 = Panel("4")  # disabled
dup_10 = DuplicateData(Data=data_12, Number=lng_17, Order=True)  # -> graft(Data); disabled
dup_11 = DuplicateData(Data=panel_12, Number=lng_17, Order=True)  # -> graft(Data); disabled
match = MatchTree(Tree=dup_10, Guide=dec_panel_buildups_2.WoodSpecies)  # disabled
match_2 = MatchTree(Tree=dup_11, Guide=dec_panel_buildups_2.Thicknesses)  # disabled
merge_22 = Merge(Data1=dec_panel_buildups_2.WoodSpecies, Data2=match)  # disabled
merge_23 = Merge(Data1=dec_panel_buildups_2.Thicknesses, Data2=match_2)  # disabled

# ---- group: species
data_13 = Data(merge_22)  # disabled

# ---- group: thicknesses
num_32 = Number(merge_23)  # disabled

# ----
c_script_19 = CSharpScript(x=data_13)  # -> out, A; inputs x: tree; disabled; same code as c_script_9
c_script_20 = CSharpScript(x=num_32)  # -> out, A; inputs x: tree; disabled; same code as c_script_9

cull_18 = CullPattern(List=c_script_20.A, CullPattern=graft(c_script_18.A))  # disabled
cull_19 = CullPattern(List=c_script_19.A, CullPattern=graft(c_script_18.A))  # disabled

clean_3 = CleanTree(RemoveNulls=True, RemoveInvalid=True, RemoveEmpty=True, Tree=cull_19)  # disabled
clean_4 = CleanTree(RemoveNulls=True, RemoveInvalid=True, RemoveEmpty=True, Tree=cull_18)  # disabled
c_script_21 = CSharpScript(x=clean_3)  # -> out, A; inputs x: tree; disabled; same code as c_script_9
c_script_22 = CSharpScript(x=clean_4)  # -> out, A; inputs x: tree; disabled; same code as c_script_9

# ---- group: species
data_14 = Data(c_script_21.A)  # disabled

# ---- group: thicknesses
num_33 = Number(c_script_22.A)  # disabled

# ---- group: visualize layers
srf_9 = Surface(srf_8)  # disabled
num_34 = Number(num_33)  # disabled

# ---- group: buildups
dec_secies = DeconstructSpecies(Species=data_14)  # -> N, LX, RX, TX, LE, RE, TE; disabled
cset_2 = CreateSet(List=dec_secies.N)  # -> Set, Map; disabled
material_buildups = Panel("""100
200
300
101
201
301""")  # disabled

# ---- group: buildups / layer count
lng_18 = ListLength(List=dec_secies.N)  # disabled

# ---- group: buildups / material type
lng_19 = ListLength(List=cset_2.Set)  # disabled

# ---- group: buildups (continued)
c_script_23 = CSharpScript(layerCount=lng_18, materialCount=lng_19)  # -> out, A; inputs layerCount: tree of Int32, materialCount: tree of Int32; disabled
# ---------- c_script_23: C# ----------
    DataTree<int> keys = new DataTree<int>();

    for(int i = 0; i < layerCount.BranchCount;i++)
    {
      int lCount = layerCount.Branch(i)[0];
      int mCount = materialCount.Branch(i)[0];
      GH_Path path = materialCount.Paths[i];

      if(lCount == 3 && mCount == 1) keys.Add(0, path);
      if(lCount == 5 && mCount == 1) keys.Add(1, path);
      if(lCount == 7 && mCount == 1) keys.Add(2, path);
      if(lCount == 3 && mCount == 2) keys.Add(3, path);
      if(lCount == 5 && mCount == 2) keys.Add(4, path);
      if(lCount == 7 && mCount == 2) keys.Add(5, path);

    }
    A = keys;
# ---------- end c_script_23 ----------
item_29 = ListItem(List=material_buildups, Index=c_script_23.A, Wrap=True)  # disabled

# ---- group: visualize layers
lng_20 = ListLength(List=num_34)  # -> expr("x-2", Length); disabled
dom_29 = ConstructDomain(DomainStart=0, DomainEnd=lng_20)  # disabled
subset_13 = SubList(List=num_34, Domain=dom_29, Wrap=True)  # -> List, Index; disabled
c_script_24 = CSharpScript(thicknesses=subset_13.List)  # -> out, A; inputs thicknesses: tree of Double; disabled
# ---------- c_script_24: C# ----------
    DataTree<double> output = new DataTree<double>();
    for(int i = 0; i < thicknesses.BranchCount; i++)
    {
      var path = thicknesses.Paths[i];
      double total = 0;
      output.Add(total, path);
      for(int j = 0; j < thicknesses.Branch(i).Count; j++)
      {
        total += thicknesses.Branch(i)[j];
        output.Add(total);
      }
    }
    A = output;
# ---------- end c_script_24 ----------
lng_21 = ListLength(List=c_script_24.A)  # -> expr("x-2", Length); disabled
dom_30 = ConstructDomain(DomainStart=0, DomainEnd=lng_21)  # disabled
subset_14 = SubList(List=c_script_24.A, Domain=dom_30, Wrap=True)  # -> List, Index; disabled
smesh_4 = SimpleMesh(Brep=srf_9)  # disabled
neg_9 = Negative(Value=subset_14.List)  # disabled
offmsh = OffsetMesh(Mesh=smesh_4, Distance=neg_9, BothSides=False, CreateSolid=False)  # -> simplify(Offset); disabled
number_slider_54 = Slider(0.093, range=0..1)  # disabled
number_slider_55 = Slider(0.438, range=0..1)  # disabled
number_slider_56 = Slider(0.119, range=0..1)  # disabled
number_slider_57 = Slider(0.551, range=0..1)  # disabled
trim_11 = TrimTree(Tree=offmsh, Depth=1)  # disabled
chars = Characters(Text=item_29)  # -> Result, Unicode; disabled
item_30 = ListItem(List=reverse(chars.Result), Index=0, Wrap=True)  # -> simplify(Item); disabled
dom_31 = ConstructDomain(DomainStart=number_slider_56, DomainEnd=number_slider_54)  # disabled
dom_32 = ConstructDomain(DomainStart=number_slider_57, DomainEnd=number_slider_55)  # disabled
listdexs = ListIndices(List=trim_11)  # disabled
neg_10 = Negative(Value=subset_13.List)  # disabled
number_slider_58 = Slider(0.272, range=0..1)  # disabled
remap_25 = RemapNumbers(Value=item_30, Source=Domain(0, 1), Target=dom_31)  # -> Mapped, Clipped; disabled
remap_26 = RemapNumbers(Value=item_30, Source=Domain(0, 1), Target=dom_32)  # -> Mapped, Clipped; disabled
mod = Modulus(A=listdexs, B=2)  # disabled
offmsh_2 = OffsetMesh(Mesh=trim_11, Distance=neg_10, BothSides=False, CreateSolid=True)  # -> simplify(Offset); disabled
number_slider_59 = Slider(100, range=0..100)  # disabled
lng_22 = ListLength(List=mod)  # disabled
equals = Equality(FirstNumber=mod, SecondNumber=0)  # -> graft(Equality), graft(Inequality); disabled
hsl = ColourHSL(Alpha=1, Hue=remap_25.Mapped, Saturation=number_slider_58, Luminance=remap_26.Mapped)  # disabled
dup_12 = DuplicateData(Data=hsl, Number=lng_22, Order=True)  # -> graft(Data); disabled
item_31 = ListItem(List=flatten(hsl), Index=number_slider_59, Wrap=True)  # disabled
dup_13 = DuplicateData(Data=item_31, Number=lng_22, Order=True)  # -> graft(Data); disabled
cull_20 = CullPattern(List=dup_13, CullPattern=equals.Equality)  # disabled
cull_21 = CullPattern(List=dup_12, CullPattern=equals.Inequality)  # disabled
merge_24 = Merge(Data1=cull_20, Data2=cull_21)  # disabled
trim_12 = TrimTree(Tree=offmsh_2, Depth=1)  # disabled
trim_13 = TrimTree(Tree=merge_24, Depth=1)  # disabled
preview_12 = CustomPreview(Geometry=trim_12, Material=trim_13)  # disabled
