# Grasshopper definition Digital Twins.gh (Grasshopper 1.0.7)
# plug-ins: HygroDesign, Pufferfish

# ---- group: spruce
panel = Panel("spruce")
number_slider = Slider(0.0001, range=0..0.0001)
number_slider_2 = Slider(0.0019, range=0..1)
number_slider_3 = Slider(0.0036, range=0..1)
number_slider_4 = Slider(10000, range=0..20000)
number_slider_5 = Slider(800, range=0..20000)
number_slider_6 = Slider(450, range=0..20000)
number_slider_7 = Slider(400, range=0..1000)

# ---- group: beech
panel_2 = Panel("beech")
number_slider_8 = Slider(0.0001, range=0..0.0001)
number_slider_9 = Slider(0.002, range=0..1)
number_slider_10 = Slider(0.0041, range=0..1)
number_slider_11 = Slider(14000, range=0..20000)
number_slider_12 = Slider(1160, range=0..20000)
number_slider_13 = Slider(2280, range=0..20000)
number_slider_14 = Slider(720, range=0..1000)

# ----
species = WoodSpecies(
    name=panel_2,
    density=number_slider_14,
    LExp=number_slider_8,
    RExp=number_slider_9,
    TExp=number_slider_10,
    LEmod=number_slider_11,
    REmod=number_slider_13,
    TEmod=number_slider_12)
species_2 = WoodSpecies(
    name=panel,
    density=number_slider_7,
    LExp=number_slider,
    RExp=number_slider_2,
    TExp=number_slider_3,
    LEmod=number_slider_4,
    REmod=number_slider_5,
    TEmod=number_slider_6)
panel_3 = CosntructPanel(
    HMaxelLength=Slider(150, range=0..1000),
    HMaxelWidth=Slider(100, range=0..100),
    LengthCount=Slider(7, range=0..10),
    WidthCount=Slider(4, range=0..10))
dec_pan = DeconstructPanel(Panel=panel_3)  # -> Bilayers, graft(HMaxels), LengthRange, WidthRange
lng = ListLength(List=dec_pan.HMaxels)
dup = DuplicateData(Data=species_2, Number=lng, Order=True)
dup_2 = DuplicateData(Data=Slider(100, range=0..100), Number=lng, Order=True)
dup_3 = DuplicateData(Data=Slider(1, range=0..100), Number=lng, Order=True)
panel_4 = Panel("""0
1""")
up_hmaxel = UpdateHMaxel(HMaxel=dec_pan.HMaxels, Height=dup_2, RadiusFactor=dup_3, Species=dup)  # -> flatten(HMaxel)
bilayer = ConstructBilayer(
    Panel=panel_3,
    BoardLength=Slider(2, range=0..10),
    RowOffsets=panel_4,
    PassiveSpecies=species_2,
    ActiveThickness=Slider(12, range=0..100),
    PassiveThickness=Slider(4, range=0..10))
up_pan = UpdatePanel(Panel=panel_3, Bilayers=bilayer, HMaxels=up_hmaxel)
panel_5 = Panel("""9.0
15.1
16.0
20.9
8.6
13.1
17.1
19.2
9.7
13.4
16.4
21.5
9.0
14.2
15.6
17.2""")
panel_6 = Panel("""28.6
35.9
35
51.2
29.7
36.7
45.8
59.8
24.3
31.2
37.8
53.6
30.1
68.7
27.6
54.5""")
lng_2 = ListLength(List=panel_6)
lng_3 = ListLength(List=panel_6)
lng_4 = ListLength(List=panel_6)
lng_5 = ListLength(List=panel_6)
listdexs = ListIndices(List=panel_6)
dup_4 = DuplicateData(Data=Slider(12, range=0..300), Number=lng_2, Order=True)
dup_5 = DuplicateData(Data=species_2, Number=lng_3, Order=True)
dup_6 = DuplicateData(Data=Slider(300, range=0..300), Number=lng_4, Order=True)
dup_7 = DuplicateData(Data=Slider(150, range=0..300), Number=lng_5, Order=True)
num = Number(panel_6)
txt = Text(listdexs)
stock_boards = StockBoards(Name=txt, Species=dup_5, Thickness=dup_4, Length=dup_6, Width=dup_7, RTAngle=num)
python = GhPythonScript(x=up_pan, y=stock_boards)  # -> out, a; inputs y: list
# ---------- python: Python ----------
for bilayer in x.Bilayers:
    for i in range(bilayer.ActiveLayer.Boards.Count):
            bilayer.ActiveLayer.Boards[i].StockBoard = y[i]

a = x
# ---------- end python ----------
dec_pan_2 = DeconstructPanel(Panel=python.a)  # -> Bilayers, HMaxels, LengthRange, WidthRange
dec_pan_3 = DeconstructPanel(Panel=up_pan)  # -> Bilayers, HMaxels, LengthRange, WidthRange
dec_bilayer = DeconstructBilayer(Bilayer=dec_pan_2.Bilayers)  # -> ActiveLayer, PassiveLayer
dec_bilayer_2 = DeconstructBilayer(Bilayer=dec_pan_3.Bilayers)  # -> ActiveLayer, PassiveLayer
dec_active_layer = DeconstructActiveLayer(ActiveLayer=dec_bilayer.ActiveLayer)  # -> ActiveLayerBoards, Thickness
dec_active_layer_2 = DeconstructActiveLayer(ActiveLayer=dec_bilayer_2.ActiveLayer)  # -> ActiveLayerBoards, Thickness
dec_active_board = DeconstructActiveBoard(ActiveBoard=dec_active_layer.ActiveLayerBoards)  # -> HMaxels, StockBoard, Thickness, RowRange, ColumnRange, DesiredRadius, Radius, BlendedRadius, MoistureChange, ShapedBoard
dec_stock_board = DeconstructStockBoard(StockBoard=dec_active_board.StockBoard)  # -> Name, Species, RTAngle, Length, Width, ActiveBoards
dec_active_board_2 = DeconstructActiveBoard(ActiveBoard=dec_active_layer_2.ActiveLayerBoards)  # -> HMaxels, StockBoard, Thickness, RowRange, ColumnRange, DesiredRadius, Radius, BlendedRadius, MoistureChange, ShapedBoard
panel_7 = Panel(dec_active_board.StockBoard)
panel_8 = Panel(dec_stock_board.RTAngle)
rectangle = Rectangle(Plane=PlaneXY(0, 0, 0), XSize=dec_active_board_2.RowRange, YSize=dec_active_board_2.ColumnRange, Radius=0)  # -> flatten(Rectangle), Length
area = Area(Geometry=rectangle.Rectangle)  # -> Area, Centroid
listdexs_2 = ListIndices(List=dec_active_layer_2.ActiveLayerBoards)
tag = TextTag3D(Location=area.Centroid, Text=listdexs_2, Size=Slider(25, range=0..100), Justification=5)
