# Grasshopper definition OOB Nurbs control system.gh (Grasshopper 1.0.7)
# plug-ins: sof_gh_sofistik-2022, HygroDesign, MeshEdit Components, Karamba3D, Kangaroo2 Components, Weaverbird, Human, LunchBox, Opossum2_0_Proto_A, Pufferfish

io = IO(
    SofistikDocumentProperties_VersionMajor="2022",
    SofistikDocumentProperties_VersionMinor="0",
    SofistikDocumentProperties_VersionName="2022")

number_slider = Slider(1000, range=0..1000)
neg = Negative(Value=number_slider)
rectangle = Rectangle(Plane=PlaneXY(0, 0, 0), XSize=number_slider, YSize=neg, Radius=0)  # -> Rectangle, Length
drec = DeconstuctRectangle(Rectangle=rectangle.Rectangle)  # -> BasePlane, XInterval, YInterval
dedomain = DeconstructDomain(Domain=drec.XInterval)  # -> Start, End
dedomain_2 = DeconstructDomain(Domain=drec.YInterval)  # -> Start, End
pt = ConstructPoint(XCoordinate=dedomain.Start, YCoordinate=0, ZCoordinate=0)
pt_2 = ConstructPoint(XCoordinate=dedomain.End, YCoordinate=0, ZCoordinate=0)
subtraction = Subtraction(A=dedomain_2.End, B=dedomain_2.Start)
ln = Line(StartPoint=pt, EndPoint=pt_2)
number_slider_2 = Slider(1, range=0.5..1)
number_slider_3 = Slider(0.498, range=0..0.5)
number_slider_4 = Slider(0.5, range=0..0.5)
number_slider_5 = Slider(1, range=0.5..1)
number_slider_6 = Slider(0.5, range=0.5..1)
number_slider_7 = Slider(0.467, range=0..0.5)
divide = DivideCurve(Curve=ln, Count=expr("x-1", Slider(3, range=0..10)), Kinks=False)  # -> Points, Tangents, Parameters
multiplication = Multiplication(A=subtraction, B=number_slider_2)
multiplication_2 = Multiplication(A=subtraction, B=number_slider_3)
multiplication_3 = Multiplication(A=subtraction, B=number_slider_5)
multiplication_4 = Multiplication(A=subtraction, B=number_slider_4)
multiplication_5 = Multiplication(A=subtraction, B=number_slider_6)
multiplication_6 = Multiplication(A=subtraction, B=number_slider_7)
neg_2 = Negative(Value=multiplication_2)
neg_3 = Negative(Value=multiplication)
neg_4 = Negative(Value=multiplication_4)
neg_5 = Negative(Value=multiplication_3)
neg_6 = Negative(Value=multiplication_6)
neg_7 = Negative(Value=multiplication_5)
item = ListItem(List=divide.Points, Index=0, Wrap=True)  # -> Item, Item1, Item2
Y = UnitY(Factor=neg_2)
Y_2 = UnitY(Factor=neg_4)
Y_3 = UnitY(Factor=neg_3)
Y_4 = UnitY(Factor=neg_5)
Y_5 = UnitY(Factor=neg_6)
Y_6 = UnitY(Factor=neg_7)
move = Move(Geometry=[item.Item, item.Item2], Motion=Y)  # -> Geometry, Transform
move_2 = Move(Geometry=item.Item1, Motion=Y_3)  # -> Geometry, Transform
move_3 = Move(Geometry=[item.Item, item.Item2], Motion=Y_2)  # -> Geometry, Transform
move_4 = Move(Geometry=item.Item1, Motion=Y_4)  # -> Geometry, Transform
move_5 = Move(Geometry=[item.Item, item.Item2], Motion=Y_5)  # -> Geometry, Transform
move_6 = Move(Geometry=item.Item1, Motion=Y_6)  # -> Geometry, Transform
item_2 = ListItem(List=move.Geometry, Index=0, Wrap=True)  # -> Item, Item1
item_3 = ListItem(List=move_3.Geometry, Index=0, Wrap=True)  # -> Item, Item1
item_4 = ListItem(List=move_5.Geometry, Index=0, Wrap=True)  # -> Item, Item1
merge = Merge(Data1=flatten(item_2.Item), Data2=flatten(move_2.Geometry), Data3=flatten(item_2.Item1))
merge_2 = Merge(Data1=flatten(item_3.Item), Data2=flatten(move_4.Geometry), Data3=flatten(item_3.Item1))
merge_3 = Merge(Data1=flatten(item_4.Item), Data2=flatten(move_6.Geometry), Data3=flatten(item_4.Item1))
intcrv = Interpolate(Vertices=merge, Degree=3, Periodic=False, KnotStyle=1)  # -> Curve, Length, Domain
intcrv_2 = Interpolate(Vertices=merge_2, Degree=3, Periodic=False, KnotStyle=1)  # -> Curve, Length, Domain
intcrv_3 = Interpolate(Vertices=merge_3, Degree=3, Periodic=False, KnotStyle=1)  # -> Curve, Length, Domain
merge_4 = Merge(Data1=intcrv.Curve, Data2=intcrv_2.Curve, Data3=intcrv_3.Curve)
rec = Rectangle(rectangle.Rectangle)

# ---- group: tool inputs
compute_double_curvature = BooleanToggle(True)
compute_cross_sections = BooleanToggle(True)
compute_3d_boards = BooleanToggle(True)
compute_structure = BooleanToggle(True)

# ---- group: panel inputs
number_slider_8 = Slider(3000, range=0..3000)
number_slider_9 = Slider(150, range=0..200)
number_slider_10 = Slider(13, range=0..30)
panel_orientation = Panel("-1")
xy = XYPlane(Origin=Point(0, 0, 0))
panel = BilayerPanel(
    BasePlane=xy,
    BoardWidth=number_slider_9,
    BoardLength=number_slider_8,
    WidthCount=number_slider_10,
    LengthCount=Slider(3, range=0..10))

# ---- group: manual input
crv = Curve(<curve referenced from the Rhino model>)
crv_2 = Curve(<curve referenced from the Rhino model>)
crv_3 = Curve(<curve referenced from the Rhino model>)
merge_5 = Merge(Data1=crv, Data2=crv_2, Data3=crv_3)

# ---- group: material inputs
species = WoodSpecies()
board_count = Slider(200, range=0..500)
item_5 = ListItem(List=species, Index=0, Wrap=True)  # -> Item, Item1
panel_2 = Panel("B")

# ---- group: bounding rectangle input (rectangle y domain represents full range of radii from stockpiles)
rec_2 = Rectangle(rec)

# ---- group: curve controller inputs (represents distribution of radii along a given cross section)
crv_4 = Curve(merge_4)

# ---- group: material inputs / beech
data = Data(item_5.Item)

# ---- group: material inputs / spruce
data_2 = Data(item_5.Item1)

# ---- group: material inputs / name
num = Number(board_count)
series = Series(Start=0, Step=1, Count=num)
dup = DuplicateData(Data="S", Number=num, Order=True)  # -> graft(Data)
txt = Text(graft(series))
merge_6 = Merge(Data1=dup, Data2=txt)  # -> simplify(Result)
join = TextJoin(Text=merge_6)  # -> flatten(Result)

num_2 = Number(board_count)
series_2 = Series(Start=0, Step=1, Count=num_2)
dup_2 = DuplicateData(Data=panel_2, Number=num_2, Order=True)  # -> graft(Data)
txt_2 = Text(graft(series_2))
merge_7 = Merge(Data1=dup_2, Data2=txt_2)  # -> simplify(Result)
join_2 = TextJoin(Text=merge_7)  # -> flatten(Result)

# ---- group: material inputs / RT
dom = ConstructDomain(DomainStart=Slider(15, range=0..100), DomainEnd=Slider(75, range=0..100))
random = Random(Range=dom, Number=board_count, Seed=Slider(225, range=0..1000))

dom_2 = ConstructDomain(DomainStart=Slider(15, range=0..100), DomainEnd=Slider(75, range=0..100))
random_2 = Random(Range=dom_2, Number=board_count, Seed=Slider(225, range=0..1000))

# ---- group: material inputs / length
num_3 = Number(number_slider_8)
num_4 = Number(board_count)
dup_3 = DuplicateData(Data=num_3, Number=num_4, Order=True)

num_5 = Number(number_slider_9)
num_6 = Number(board_count)
dup_4 = DuplicateData(Data=num_5, Number=num_6, Order=True)

num_7 = Number(number_slider_9)
num_8 = Number(board_count)
dup_5 = DuplicateData(Data=num_7, Number=num_8, Order=True)

num_9 = Number(number_slider_8)
num_10 = Number(board_count)
dup_6 = DuplicateData(Data=num_9, Number=num_10, Order=True)

# ----
crv_5 = Curve(crv_4)
lng = ListLength(List=crv_5)  # -> expr("x-2", Length)
dom_3 = ConstructDomain(DomainStart=0, DomainEnd=lng)
subset = SubList(List=crv_5, Domain=dom_3, Wrap=True)  # -> graft(List), Index
shift = ShiftList(List=crv_5, Shift=1, Wrap=False)  # -> graft(List)
merge_8 = Merge(Data1=subset.List, Data2=shift)  # -> simplify(Result)
group = Group(Objects=merge_8)  # -> flatten(Group)

# ---- group: moisture changes
panel_3 = Panel("""4
8
12
16
20""")
num_11 = Number(panel_3)

# ----
deconstruct_panel = DeconstructPanel(Panel=panel)
dec_board = DeconstructBoard(Board=deconstruct_panel)  # -> Name, Material, Polyline, Radius, MoistureChange, Error, BlendedRadius, Width
area = Area(Geometry=dec_board.Polyline)  # -> Area, Centroid

crv_6 = Curve(graft(crv_4))
crv_7 = Curve(rec_2)
bbox = BoundingBox(Content=crv_7, Plane=PlaneXY(0, 0, 0))  # -> Box, Box_2
end = EndPoints(Curve=crv_6)  # -> Start, End
debox = DeconstructBox(Box=bbox.Box)  # -> Plane, X, Y, Z
ln_2 = Line(StartPoint=end.Start, EndPoint=end.End)
dedomain_3 = DeconstructDomain(Domain=debox.Y)  # -> Start, End
curvepoint = PointOnCurve(ln_2, parameter=0.5)
addition = Addition(A=Slider(100, range=0..100), B=dedomain_3.End)
pdecon = Deconstruct(Point=curvepoint)  # -> XComponent, YComponent, ZComponent
number_slider_11 = Slider(30, range=0..100)
subtraction_2 = Subtraction(A=addition, B=pdecon.YComponent)
Y_7 = UnitY(Factor=subtraction_2)
move_7 = Move(Geometry=ln_2, Motion=Y_7)  # -> Geometry, Transform
divide_2 = DivideCurve(Curve=move_7.Geometry, Count=number_slider_11, Kinks=False)  # -> simplify(Points), Tangents, Parameters
divide_3 = DivideCurve(Curve=crv_6, Count=number_slider_11, Kinks=False)  # -> simplify(Points), Tangents, Parameters
dist = Distance(PointA=divide_2.Points, PointB=divide_3.Points)

stockpile = Stockpile(Material=data, Name=join_2, Length=dup_3, Width=dup_4, RTAngle=random, MoistureChanges=num_11)
stockpile_2 = Stockpile(Material=data_2, Name=join, Length=dup_6, Width=dup_5, RTAngle=random_2, MoistureChanges=num_11)

pt_3 = Point(area.Centroid)
pdecon_2 = Deconstruct(Point=pt_3)  # -> XComponent, YComponent, ZComponent
bnd = Bounds(Numbers=flatten(pdecon_2.XComponent))
dom_4 = ConstructDomain(DomainStart="1", DomainEnd="0")
remap = RemapNumbers(Value=pdecon_2.XComponent, Source=bnd, Target=dom_4)  # -> simplify(Mapped), Clipped

# ---- group: material / beech
data_3 = Data(item_5.Item)

# ---- group: material / spruce
data_4 = Data(item_5.Item1)

# ---- group: material
crv_8 = Curve(<curve referenced from the Rhino model>)
c_script = CSharpScript(rects=flatten(dec_board.Polyline))  # -> out; inputs rects: list of Rectangle3d
# ---------- c_script: C# usings ----------
using Rhino.DocObjects;
# ---------- c_script: C# ----------
    var object_enumerator_settings = new ObjectEnumeratorSettings();

    var rhinoObjects = RhinoDoc.ActiveDoc.Objects.GetObjectList(object_enumerator_settings);
    var objectTable = RhinoDoc.ActiveDoc.Objects;

    foreach( var rhinoObject in rhinoObjects)
    {
      if(rhinoObject.ObjectType == ObjectType.Curve)
      {
        Curve rhinoCurve = rhinoObject.Geometry as Curve;
        if(rhinoCurve.IsClosed)objectTable.Delete(rhinoObject);
      }
    }

    foreach(var rect in rects)objectTable.AddCurve(rect.ToNurbsCurve());
# ---------- end c_script ----------
pt_4 = Point(graft(area.Centroid))
xz = XZPlane(Origin=pt_4)
pcx = CurvePlane(Curve=crv_8, Plane=xz)  # -> simplify(Points), ParamsC, ParamsP
pdecon_3 = Deconstruct(Point=pcx.Points)  # -> XComponent, YComponent, ZComponent
pdecon_4 = Deconstruct(Point=pt_4)  # -> XComponent, YComponent, ZComponent
smaller = SmallerThan(FirstNumber=pdecon_3.XComponent, SecondNumber=pdecon_4.XComponent)  # -> SmallerThan, OrEqualTo
not = GateNot(A=smaller.SmallerThan)
cull = CullPattern(List=data_3, CullPattern=not)
cull_2 = CullPattern(List=data_4, CullPattern=smaller.SmallerThan)
merge_9 = Merge(Data1=cull, Data2=cull_2)  # -> simplify(Result)
trim = TrimTree(Tree=merge_9, Depth=1)

# ----
merge_10 = Merge(Data1=stockpile, Data2=stockpile_2)

# ---- group: stock radius range
python = GhPythonScript(stockpiles=merge_10)  # -> out, a; inputs stockpiles: list
# ---------- python: Python ----------
import Rhino

minRad = 10000000
maxRad = 0


for stockpile in stockpiles:
    for board in stockpile.Boards:
        for radius in board.PotentialRadii.Keys:
            if radius > maxRad:
                maxRad = radius
            if radius < minRad:
                minRad = radius

a = Rhino.Geometry.Interval(minRad,maxRad)
# ---------- end python ----------
panel_4 = Panel(python.a)

# ----
merge_11 = Merge(Data1=Slider(6, range=0..10), Data2=Slider(1, range=0..4))
int = Integer(merge_11)

# ---- group: radius weight
neg_8 = Negative(Value=Slider(8520, range=0..10000))
crv_9 = Curve(dec_board.Polyline)
Y_8 = UnitY(Factor=neg_8)
srf = Surface(crv_9)
bnd_2 = Bounds(Numbers=flatten(remap.Mapped))
move_8 = Move(Geometry=srf, Motion=Y_8)  # -> Geometry, Transform
dedomain_4 = DeconstructDomain(Domain=bnd_2)  # -> Start, End
roundd = RoundToDecimalPlace(NumberX=remap.Mapped, DecimalPlace=Slider(2, range=0..10), RoundType=0)  # -> Rounded, Difference
area_2 = Area(Geometry=move_8.Geometry)  # -> Area, Centroid
gradient = Gradient(
    LowerLimit=dedomain_4.Start,
    UpperLimit=dedomain_4.End,
    Parameter=remap.Mapped,
    stops=[0: RGB(124, 205, 207), 1: RGB(0, 48, 97)])
preview = CustomPreview(Geometry=move_8.Geometry, Material=gradient)
tag = TextTag3D(Location=area_2.Centroid, Text=roundd.Rounded, Size=Slider(76, range=0..100), Colour=RGB(0, 0, 0), Justification=5)

# ----
bool = Boolean(compute_double_curvature)
Y_9 = UnitY(Factor=Slider(10000, range=0..10000))
Y_10 = UnitY(Factor=Slider(5000, range=0..10000))
bool_2 = Boolean(compute_3d_boards)
python_2 = GhPythonScript(x=data)  # -> out, a, b
# ---------- python_2: Python ----------
a = x.LElasticModulus
b = x.RElasticModulus
# ---------- end python_2 ----------
python_3 = GhPythonScript(x=data_2)  # -> out, a, b; same code as python_2

# ---- group: active layer
ft0 = Slider(80, range=0..100)
gamma = Slider(7.37, range=0..10)
num_12 = Number(Slider(20, range=0..100))

# ---- group: passive layer
num_13 = Number(Slider(4, range=0..10))
ft0_2 = Slider(0, range=0..100)

# ---- group: active layer
ft0_3 = Slider(80, range=0..100)
gamma_2 = Slider(4.21, range=0..10)
num_14 = Number(Slider(20, range=0..100))

# ---- group: passive layer
num_15 = Number(Slider(4, range=0..10))
ft0_4 = Slider(0, range=0..100)

# ---- group: active layer / total thickness
addition_2 = Addition(A=num_12, B=num_13)

addition_3 = Addition(A=num_14, B=num_15)

# ---- group: active layer / distance from bottom
expression = Expression(x=addition_2, y=num_12, Expression="x - y/2")

expression_2 = Expression(x=addition_3, y=num_14, Expression="x - y/2")

# ---- group: passive layer / distance from bottom
expression_3 = Expression(x=expression, y=addition_2, Expression="x - y/2")

expression_4 = Expression(x=expression_2, y=addition_3, Expression="x - y/2")

# ---- group: active layer / CG from bottom
division = Division(A=addition_2, B=2)

division_2 = Division(A=addition_3, B=2)

# ---- group: passive layer / dist from CG
subtraction_3 = Subtraction(A=expression_3, B=division)
abs = Absolute(Value=subtraction_3)

subtraction_4 = Subtraction(A=expression_4, B=division_2)
abs_2 = Absolute(Value=subtraction_4)

# ---- group: active layer / dist from CG
subtraction_5 = Subtraction(A=expression, B=division)
abs_3 = Absolute(Value=subtraction_5)

subtraction_6 = Subtraction(A=expression_2, B=division_2)
abs_4 = Absolute(Value=subtraction_6)

# ---- group: active layer / l
expression_5 = Expression(x=num_12, Expression="1000*x^3/12")

# ---- group: passive layer / l
expression_6 = Expression(x=num_13, Expression="1000*x^3/12")

# ---- group: passive layer / Ax2
expression_7 = Expression(x=num_13, y=abs, Expression="1000*x*y^2")

# ---- group: active layer / l
expression_8 = Expression(x=num_14, Expression="1000*x^3/12")

# ---- group: passive layer / l
expression_9 = Expression(x=num_15, Expression="1000*x^3/12")

# ---- group: passive layer / Ax2
expression_10 = Expression(x=num_15, y=abs_2, Expression="1000*x*y^2")

# ---- group: active layer / Ax2
expression_11 = Expression(x=num_12, y=abs_3, Expression="1000*x*y^2")

expression_12 = Expression(x=num_14, y=abs_4, Expression="1000*x*y^2")

# ---- group: active layer / total l
addition_4 = Addition(A=expression_5, B=expression_11)

addition_5 = Addition(A=expression_8, B=expression_12)

# ---- group: passive layer / total l
addition_6 = Addition(A=expression_6, B=expression_7)

addition_7 = Addition(A=expression_9, B=expression_10)

# ---- group: active layer / El0
multiplication_7 = Multiplication(A=python_2.a, B=addition_4)

# ---- group: active layer / T x ft0
multiplication_8 = Multiplication(A=num_12, B=ft0)

# ---- group: active layer / T x Gam
multiplication_9 = Multiplication(A=gamma, B=num_12)

# ---- group: passive layer / El0
multiplication_10 = Multiplication(A=python_3.b, B=addition_6)

# ---- group: passive layer / El90
multiplication_11 = Multiplication(A=python_3.a, B=addition_6)

# ---- group: passive layer / T x ft0
multiplication_12 = Multiplication(A=num_13, B=ft0_2)

# ---- group: active layer / El90
multiplication_13 = Multiplication(A=python_2.b, B=addition_4)

# ---- group: active layer / El0
multiplication_14 = Multiplication(A=python_3.a, B=addition_5)

# ---- group: active layer / T x ft0
multiplication_15 = Multiplication(A=num_14, B=ft0_3)

# ---- group: active layer / T x Gam
multiplication_16 = Multiplication(A=gamma_2, B=num_14)

# ---- group: passive layer / El0
multiplication_17 = Multiplication(A=python_3.b, B=addition_7)

# ---- group: passive layer / El90
multiplication_18 = Multiplication(A=python_3.a, B=addition_7)

# ---- group: passive layer / T x ft0
multiplication_19 = Multiplication(A=num_15, B=ft0_4)

# ---- group: active layer / El90
multiplication_20 = Multiplication(A=python_3.b, B=addition_5)

# ---- group: effective material properties / El0 eff (Nmm2)
addition_8 = Addition(A=multiplication_7, B=multiplication_10)

# ---- group: effective material properties / El90 eff (Nmm2)
addition_9 = Addition(A=multiplication_13, B=multiplication_11)

# ---- group: effective material properties / Sum T x Ft0
addition_10 = Addition(A=multiplication_8, B=multiplication_12)

# ---- group: effective material properties / total thickness
addition_11 = Addition(A=num_12, B=num_13)

# ---- group: effective material properties / El0 eff (Nmm2)
addition_12 = Addition(A=multiplication_14, B=multiplication_17)

# ---- group: effective material properties / El90 eff (Nmm2)
addition_13 = Addition(A=multiplication_20, B=multiplication_18)

# ---- group: effective material properties / Sum T x Ft0
addition_14 = Addition(A=multiplication_15, B=multiplication_19)

# ---- group: effective material properties / total thickness
addition_15 = Addition(A=num_14, B=num_15)

# ---- group: effective material properties / Sum Tx Gam
addition_16 = Addition(A=multiplication_9)

addition_17 = Addition(A=multiplication_16)

# ---- group: effective material properties / lx / ly
expression_13 = Expression(x=addition_11, Expression="1000*x^3/12")

expression_14 = Expression(x=addition_15, Expression="1000*x^3/12")

# ---- group: effective material properties / E0eff
division_3 = Division(A=addition_8, B=expression_13)

# ---- group: effective material properties / E90eff
division_4 = Division(A=addition_9, B=expression_13)

# ---- group: effective material properties / ft eff
division_5 = Division(A=addition_10, B=addition_11)

# ---- group: effective material properties / E0eff
division_6 = Division(A=addition_12, B=expression_14)

# ---- group: effective material properties / E90eff
division_7 = Division(A=addition_13, B=expression_14)

# ---- group: effective material properties / Gamma eff
division_8 = Division(A=addition_17, B=addition_15)

# ---- group: effective material properties / ft eff
division_9 = Division(A=addition_14, B=addition_15)

# ---- group: effective material properties
matprops = MaterialPropertiesKaramba3D(
    FamilyOfMaterial="Spruce / Spruce",
    Name="Spruce / Spruce",
    ElementIdentifier="Spruce / Spruce",
    YoungsModulusKNCm2Dir1=expr("x*0.1", division_6),
    YoungsModulusKNCm2Dir2=expr("x*0.1", division_7),
    InPlaneShearModulus_kN_cm2="42",
    InPlaneLateralContractionCoefficient=Slider(0.012, range=0..0.1, expression="0.012"),
    TransverseShearModulusKNCm2Dir1="5",
    TransverseShearModulusKNCm2Dir2="5",
    SpecificWeight_kN_m3=division_8,
    CoefficientOfThermalExpansion1CDir1=1.2e-05,
    CoefficientOfThermalExpansion1CDir2=1.2e-05,
    TensileStrengthKNCm2Dir1=division_9,
    TensileStrengthKNCm2Dir2=division_9,
    CompressiveStrengthKNCm2Dir1=-23.5,
    CompressiveStrengthKNCm2Dir2=-23.5,
    ShearStrengthKNCm2Dir12=13.6,
    TsaiWuIntCoeff=0,
    StrengthHypothesis="MISES",
    mode="Orthotropic")  # -> flatten(Material)

# ---- group: effective material properties / Gamma eff
division_10 = Division(A=addition_16, B=addition_11)

# ---- group: effective material properties
matprops_2 = MaterialPropertiesKaramba3D(
    FamilyOfMaterial="Beech / Spruce",
    Name="Beech / Spruce",
    ElementIdentifier="Beech / Spruce",
    YoungsModulusKNCm2Dir1=expr("x*0.1", division_3),
    YoungsModulusKNCm2Dir2=expr("x*0.1", division_4),
    InPlaneShearModulus_kN_cm2="47",
    InPlaneLateralContractionCoefficient=Slider(0.012, range=0..0.1, expression="0.012"),
    TransverseShearModulusKNCm2Dir1="5",
    TransverseShearModulusKNCm2Dir2="5",
    SpecificWeight_kN_m3=division_10,
    CoefficientOfThermalExpansion1CDir1=1.2e-05,
    CoefficientOfThermalExpansion1CDir2=1.2e-05,
    TensileStrengthKNCm2Dir1=division_5,
    TensileStrengthKNCm2Dir2=division_5,
    CompressiveStrengthKNCm2Dir1=-23.5,
    CompressiveStrengthKNCm2Dir2=-23.5,
    ShearStrengthKNCm2Dir12=13.6,
    TsaiWuIntCoeff=0,
    StrengthHypothesis="MISES",
    mode="Orthotropic")  # -> flatten(Material)

# ----
multiplication_21 = Multiplication(A=Slider(1.5, range=0..10), B="1.35")
multiplication_22 = Multiplication(A="-9.8", B="1.35")
Z = UnitZ(Factor=multiplication_21)
Z_2 = UnitZ(Factor=multiplication_22)
rev = Reverse(Vector=Z)

bool_3 = Boolean(compute_3d_boards)
not_2 = GateNot(A=bool_3)
cull_3 = CullPattern(List=matprops, CullPattern=not_2)

loads = LoadsKaramba3D(Vector=Z_2, LCase="0", mode="Gravity")
movopossum_3_0_0 = Opossum(
    OpossumData_NumberOfObjectives=1,
    OpossumData_OptimizationType=0,
    OpossumData_ResultSerializationStatus=1,
    OpossumData_ObjectiveValue=[47.87715272, 58.01375875, 50.6081087, 85.34977565, 55.72102014, 66.70743246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],
    OpossumData_ParameterList=["0.138480,0.983034,0.410980,0.659542,0.249957,0.546915", "0.067811,0.822890,0.018937,0.805498,0.049542,0.839575", "0.355563,0.636073,0.348014,0.949494,0.300807,0.986399", "0.436430,0.531078,0.204018,0.510436,0.483813,0.721467", "0.250000,0.750000,0.250000,0.750000,0.250000,0.750000", "0.492805,0.506669,0.499302,0.995291,0.002829,0.502465"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],
    OpossumData_objective=num_29,
    OpossumData_variable=[number_slider_3, number_slider_2, number_slider_4, number_slider_5, number_slider_7, number_slider_6])
X = UnitX(Factor=Slider(10000, range=0..10000))

data_5 = Data(group)
pt_5 = Point(simplify(area.Centroid))
pdecon_5 = Deconstruct(Point=pt_5)  # -> XComponent, YComponent, ZComponent
bnd_3 = Bounds(Numbers=flatten(pdecon_5.XComponent))
lng_2 = ListLength(List=data_5)
dedomain_5 = DeconstructDomain(Domain=bnd_3)  # -> Start, End
num_16 = Number(graft(pdecon_5.XComponent))
bnd_4 = Bounds(Numbers=flatten(pdecon_5.YComponent))
remap_2 = RemapNumbers(Value=pdecon_5.YComponent, Source=bnd_4, Target=Domain(0, 1))  # -> graft(Mapped), Clipped
rec_3 = Rectangle(rec_2)
drec_2 = DeconstuctRectangle(Rectangle=rec_3)  # -> BasePlane, XInterval, YInterval
dedomain_6 = DeconstructDomain(Domain=python.a)  # -> Start, End
dom_5 = ConstructDomain(DomainStart=dedomain_6.Start, DomainEnd=dedomain_6.End)

# ---- group: create domains
c_script_2 = CSharpScript(count=lng_2, start=dedomain_5.Start, end=dedomain_5.End)  # -> out, A; inputs count: Int32, start: Double, end: Double
# ---------- c_script_2: C# ----------
    double totalLength = end - start;
    double domLength = totalLength / (double) count;

    List<Interval> intervals = new List<Interval>();
    double currentStart = start;
    for(int i = 0; i < count; i++)
    {
      intervals.Add(new Interval(currentStart, currentStart + domLength));
      currentStart += domLength;
    }
    A = intervals;
# ---------- end c_script_2 ----------

# ----
inc = Includes(Value=num_16, Domain=simplify(c_script_2.A))  # -> Includes, Deviation
cull_4 = CullPattern(List=data_5, CullPattern=inc.Includes)
item_6 = ListItem(List=cull_4, Index=0, Wrap=True)
ungroup = Ungroup(Group=item_6)  # -> simplify(Objects)
eval = EvaluateCurve(Curve=reparameterize(ungroup), Parameter=remap_2.Mapped)  # -> Point, Tangent, Angle
pdecon_6 = Deconstruct(Point=eval.Point)  # -> XComponent, YComponent, ZComponent
cull_5 = CullPattern(List=c_script_2.A, CullPattern=inc.Includes)
item_7 = ListItem(List=cull_5, Index=0, Wrap=True)
item_8 = ListItem(List=pdecon_6.YComponent, Index=0, Wrap=True)  # -> Item, Item1
remap_3 = RemapNumbers(Value=num_16, Source=item_7, Target=Domain(0, 1))  # -> Mapped, Clipped
twn2nums = TweenTwoNumbers(NumberA=item_8.Item, NumberB=item_8.Item1, Factor=remap_3.Mapped)
remap_4 = RemapNumbers(Value=twn2nums, Source=drec_2.YInterval, Target=dom_5)  # -> Mapped, Clipped
trim_2 = TrimTree(Tree=remap_4.Mapped, Depth=1)

# ---- group: radius
neg_9 = Negative(Value=Slider(5440, range=0..10000))
crv_10 = Curve(dec_board.Polyline)
num_17 = Number(trim_2)
bnd_5 = Bounds(Numbers=flatten(num_17))
srf_2 = Surface(crv_10)
Y_11 = UnitY(Factor=neg_9)
dom_6 = ConstructDomain(DomainStart="1", DomainEnd="0")
remap_5 = RemapNumbers(Value=num_17, Source=bnd_5, Target=dom_6)  # -> Mapped, Clipped
move_9 = Move(Geometry=srf_2, Motion=Y_11)  # -> Geometry, Transform
gradient_2 = Gradient(LowerLimit=0, UpperLimit=1, Parameter=remap_5.Mapped, stops=[0: RGB(230, 230, 230), 1: RGB(26, 26, 26)])
panel_5 = Panel(bnd_5)
area_3 = Area(Geometry=move_9.Geometry)  # -> Area, Centroid
round = Round(Number=num_17)  # -> Nearest, Floor, Ceiling
tag_2 = TextTag3D(Location=area_3.Centroid, Text=round.Nearest, Size=Slider(72, range=0..100), Colour=RGB(0, 0, 0), Justification=5)
preview_2 = CustomPreview(Geometry=move_9.Geometry, Material=gradient_2)

# ----
lng_3 = ListLength(List=trim_2)
dup_7 = DuplicateData(Data="1", Number=lng_3, Order=True)  # -> simplify(Data)

update_panel = UpdatePanel(Panel=panel, Radius=trim_2, RadiusWeight=remap.Mapped, Material=trim, MaterialWeight=dup_7)
dup_panel = DuplicatePanel(Panel=update_panel, Count=Slider(3, range=0..10))

# ---- group: radius
num_18 = Number(dist)
pt_6 = Point(divide_2.Points)
bnd_6 = Bounds(Numbers=flatten(num_18))
dom_7 = ConstructDomain(DomainStart=Slider(10, range=0..10), DomainEnd=Slider(264, range=0..500))
remap_6 = RemapNumbers(Value=num_18, Source=bnd_6, Target=dom_7)  # -> Mapped, Clipped
Y_12 = UnitY(Factor=remap_6.Mapped)
move_10 = Move(Geometry=pt_6, Motion=Y_12)  # -> Geometry, Transform
ln_3 = Line(StartPoint=pt_6, EndPoint=move_10.Geometry)  # -> simplify(Line)
lng_4 = ListLength(List=ln_3)  # -> expr("x-2", Length)
dom_8 = ConstructDomain(DomainStart=0, DomainEnd=lng_4)
shift_2 = ShiftList(List=ln_3, Shift=1, Wrap=False)  # -> graft(List)
subset_2 = SubList(List=ln_3, Domain=dom_8, Wrap=True)  # -> graft(List), Index
loft = Loft(
    Curves=[subset_2.List, shift_2],
    Options={Adjust=False, Closed=False, LoftEnds=0, LoftSimp=0, LoftType=0, Rebuild=10, Refit=0.01})
trim_3 = TrimTree(Tree=loft, Depth=1)  # -> simplify(Tree)
area_4 = Area(Geometry=trim_3)  # -> Area, Centroid
pdecon_7 = Deconstruct(Point=area_4.Centroid)  # -> XComponent, YComponent, ZComponent
bnd_7 = Bounds(Numbers=flatten(pdecon_7.YComponent))
remap_7 = RemapNumbers(Value=pdecon_7.YComponent, Source=bnd_7, Target=Domain(0, 1))  # -> Mapped, Clipped

# ----
gradient_3 = Gradient(LowerLimit=0, UpperLimit=1, Parameter=remap_7.Mapped, stops=[0: RGB(230, 230, 230), 1: RGB(26, 26, 26)])

# ---- group: radius (continued)
preview_3 = CustomPreview(Geometry=trim_3, Material=gradient_3)

# ---- group: the brains
design_env = DesignEnvironment(Panels=update_panel, Stockpile=merge_10)  # -> Panels, Stockpiles
bool_4 = Boolean(compute_cross_sections)
deconstruct_panel_2 = DeconstructPanel(Panel=design_env.Panels)
dec_board_2 = DeconstructBoard(Board=deconstruct_panel_2)  # -> Name, Material, Polyline, Radius, MoistureChange, Error, BlendedRadius, Width
bnd_8 = Bounds(Numbers=flatten(dec_board_2.Radius))
bnd_9 = Bounds(Numbers=flatten(dec_board_2.Error))
number_slider_12 = Slider(0.5, range=0.0001..2)
number_slider_13 = Slider(0.5, range=0.0001..3)
dedomain_7 = DeconstructDomain(Domain=bnd_8)  # -> Start, End
error = Panel(bnd_9)
multiplication_23 = Multiplication(A=dedomain_7.End, B=Slider(1.25, range=0..10))

# ----
convolution = CurvatureConvolution(
    Panels=design_env.Panels,
    TengentialBlending=number_slider_13,
    LongitudinalBlending=number_slider_12,
    MaxRadiusInfluence=Slider(10000, range=0..10000),
    StiffnessFactor=Slider(0.1, range=0..1),
    VisualizeBoardWeights=int)  # -> Panels, Weights
cull_6 = CullPattern(List=convolution.Panels, CullPattern=bool_4)
deconstruct_panel_3 = DeconstructPanel(Panel=convolution.Panels)

# ---- group: the brains (continued)
crosecset = UniqueCrossSections(Panel=cull_6)
dec_board_3 = DeconstructBoard(Board=crosecset)  # -> Name, Material, Polyline, Radius, MoistureChange, Error, BlendedRadius, Width

# ----
dec_board_4 = DeconstructBoard(Board=deconstruct_panel_3)  # -> Name, Material, Polyline, Radius, MoistureChange, Error, BlendedRadius, Width

# ---- group: rad
round_2 = Round(Number=dec_board_2.Radius)  # -> Nearest, Floor, Ceiling
c_script_3 = CSharpScript(tree=round_2.Nearest, branch=Slider(0, range=0..100))  # -> out, simplify(A); inputs tree: tree, branch: list of Int32
# ---------- c_script_3: C# ----------
    DataTree<object> output = new DataTree<object>();
    for(int i = 0; i < tree.BranchCount; i++)
    {
      
      for(int j = 0; j < branch.Count; j++)
      {
        if(tree.Paths[i][j] != branch[j])break;
        if(j == branch.Count - 1) 
        {
          output.AddRange(tree.Branch(i), tree.Paths[i]);
        }
      }
    }
    
    A = output;
# ---------- end c_script_3 ----------

# ----
python_4 = GhPythonScript(x=deconstruct_panel_2)  # -> out, a
# ---------- python_4: Python ----------
a = x.StockBoard.RTAngle
# ---------- end python_4 ----------

# ---- group: moisture / mc
c_script_4 = CSharpScript(tree=dec_board_2.MoistureChange, branch=Slider(0, range=0..100))  # -> out, simplify(A); inputs tree: tree, branch: list of Int32; same code as c_script_3

# ----
panel_6 = Panel(dec_board_3.BlendedRadius)

# ---- group: species / name
c_script_5 = CSharpScript(tree=dec_board_2.Name, branch=Slider(0, range=0..100))  # -> out, simplify(A); inputs tree: tree, branch: list of Int32; same code as c_script_3

# ---- group: species
python_5 = GhPythonScript(x=trim)  # -> out, a
# ---------- python_5: Python ----------
a = x.Name
# ---------- end python_5 ----------
neg_10 = Negative(Value=Slider(2775, range=0..10000))
crv_11 = Curve(dec_board.Polyline)
Y_13 = UnitY(Factor=neg_10)
len = TextLength(Text=python_5.a)
srf_3 = Surface(crv_11)
bnd_10 = Bounds(Numbers=flatten(len))
move_11 = Move(Geometry=srf_3, Motion=Y_13)  # -> Geometry, Transform
dedomain_8 = DeconstructDomain(Domain=bnd_10)  # -> Start, End
area_5 = Area(Geometry=move_11.Geometry)  # -> Area, Centroid
gradient_4 = Gradient(
    LowerLimit=dedomain_8.Start,
    UpperLimit=dedomain_8.End,
    Parameter=len,
    stops=[0: RGB(201, 171, 133), 1: RGB(235, 201, 160)])
tag_3 = TextTag3D(Location=area_5.Centroid, Text=c_script_5.A, Size=Slider(76, range=0..100), Colour=RGB(0, 0, 0), Justification=5)
preview_4 = CustomPreview(Geometry=move_11.Geometry, Material=gradient_4)

# ----
c_script_6 = CSharpScript(tree=python_4.a, branch=Slider(0, range=0..100))  # -> out, simplify(A); inputs tree: tree, branch: list of Int32; same code as c_script_3
panel_7 = Panel(c_script_5.A)
round_3 = Round(Number=c_script_6.A)  # -> Nearest, Floor, Ceiling
round_4 = Round(Number=c_script_4.A)  # -> Nearest, Floor, Ceiling
round_5 = Round(Number=c_script_3.A)  # -> Nearest, Floor, Ceiling
deconstruct_panel_4 = DeconstructPanel(Panel=cull_6)
dec_board_5 = DeconstructBoard(Board=deconstruct_panel_4)  # -> Name, Material, Polyline, Radius, MoistureChange, Error, BlendedRadius, Width

# ---- group: convolution weight
number_slider_14 = Slider(0, range=0..100)
neg_11 = Negative(Value=Slider(23034, range=0..30000))
crv_12 = Curve(dec_board.Polyline)
Y_14 = UnitY(Factor=neg_11)
srf_4 = Surface(crv_12)
move_12 = Move(Geometry=srf_4, Motion=Y_14)  # -> Geometry, Transform
area_6 = Area(Geometry=move_12.Geometry)  # -> Area, Centroid

# ----
c_script_7 = CSharpScript(tree=convolution.Weights, branch=number_slider_14)  # -> out, A; inputs tree: tree, branch: list of Int32; same code as c_script_3

# ---- group: radius weight
number_slider_15 = Slider(0, range=0..100)
neg_12 = Negative(Value=Slider(20000, range=0..20000))
crv_13 = Curve(dec_board.Polyline)
Y_15 = UnitY(Factor=neg_12)
srf_5 = Surface(crv_13)
move_13 = Move(Geometry=srf_5, Motion=Y_15)  # -> Geometry, Transform
area_7 = Area(Geometry=move_13.Geometry)  # -> Area, Centroid

# ----
c_script_8 = CSharpScript(tree=dec_board_2.Error, branch=number_slider_15)  # -> out, A; inputs tree: tree, branch: list of Int32; same code as c_script_3

# ---- group: radius weight (continued)
bnd_11 = Bounds(Numbers=flatten(c_script_8.A))
dedomain_9 = DeconstructDomain(Domain=bnd_11)  # -> Start, End
roundd_2 = RoundToDecimalPlace(NumberX=c_script_8.A, DecimalPlace=Slider(0, range=0..10), RoundType=0)  # -> Rounded, Difference
gradient_5 = Gradient(
    LowerLimit=dedomain_9.Start,
    UpperLimit=Slider(10, range=0..100),
    Parameter=c_script_8.A,
    stops=[0: RGB(207, 124, 124), 1: RGB(97, 0, 0)])
preview_5 = CustomPreview(Geometry=move_13.Geometry, Material=gradient_5)
tag_4 = TextTag3D(Location=area_7.Centroid, Text=roundd_2.Rounded, Size=Slider(76, range=0..100), Colour=RGB(0, 0, 0), Justification=5)

# ---- group: convolution weight
number_slider_16 = Slider(0, range=0..100)
neg_13 = Negative(Value=Slider(25829, range=0..30000))
crv_14 = Curve(dec_board.Polyline)
Y_16 = UnitY(Factor=neg_13)
srf_6 = Surface(crv_14)
move_14 = Move(Geometry=srf_6, Motion=Y_16)  # -> Geometry, Transform
area_8 = Area(Geometry=move_14.Geometry)  # -> Area, Centroid

# ----
c_script_9 = CSharpScript(tree=dec_board_4.BlendedRadius, branch=number_slider_16)  # -> out, A; inputs tree: tree, branch: list of Int32; same code as c_script_3

crv_15 = Curve(dec_board_3.Polyline)
area_9 = Area(Geometry=crv_15)  # -> Area, Centroid
avr = Average(Input=area_9.Centroid)
bbox_2 = BoundingBox(Content=flatten(avr), Plane=PlaneXY(0, 0, 0), UnionBox=True)  # -> Box, Box_2
debox_2 = DeconstructBox(Box=bbox_2.Box)  # -> Plane, X, Y, Z
dedomain_10 = DeconstructDomain(Domain=debox_2.X)  # -> Start, End
subtraction_7 = Subtraction(A=dedomain_10.End, B=dedomain_10.Start)

trim_4 = TrimTree(Tree=crv_15, Depth=1)

bbox_3 = BoundingBox(Content=trim_4, Plane=PlaneXY(0, 0, 0), UnionBox=True)  # -> Box, Box_2
debox_3 = DeconstructBox(Box=bbox_3.Box)  # -> Plane, X, Y, Z
dedomain_11 = DeconstructDomain(Domain=debox_3.X)  # -> Start, End
subtraction_8 = Subtraction(A=dedomain_11.End, B=dedomain_11.Start)
area_10 = Area(Geometry=bbox_3.Box)  # -> Area, Centroid
division_11 = Division(A=subtraction_8, B=subtraction_7)
scale = Scale(Geometry=avr, Center=area_10.Centroid, Factor=division_11)  # -> Geometry, Transform
yz = YZPlane(Origin=scale.Geometry)

pln = Plane(yz)
num_19 = Number(dec_board_3.BlendedRadius)
num_20 = Number(dec_board_3.Width)
c_script_10 = CSharpScript(iRadii=num_19, iBoardWidth=num_20, iPlanes=pln)  # -> out, simplify(A); inputs iRadii: tree of Double, iBoardWidth: tree of Double, iPlanes: tree of Plane
# ---------- c_script_10: C# ----------
    DataTree<Point3d> pointTree = new DataTree<Point3d>();

    for (int j = 0; j < iRadii.BranchCount; j++)
    {

      //initialize variables
      Plane bp = iPlanes.Branch(j)[0];
      Point3d startPoint = new Point3d(bp.Origin);
      Point3d centerPoint = startPoint;
      Vector3d rotationAxis = new Vector3d(bp.ZAxis);
      Vector3d centerPointVect = new Vector3d(bp.YAxis);
      centerPointVect.Rotate(Math.PI / 2, rotationAxis);

      for (int i = 0; i < iRadii.Branch(j).Count; i++){
        GH_Path pth = iRadii.Paths[j].AppendElement(i);
        Point3d point1 = startPoint;
        Point3d point2 = startPoint;

        pointTree.Add(point1, pth);

        //calculate rotation angle
        Double arcLength = iBoardWidth.Branch(j)[i];
        Double radius = iRadii.Branch(j)[i];
        Double rotation = (arcLength / radius);

        //calculate rotation center point
        centerPointVect.Unitize();
        centerPointVect *= radius;
        centerPoint += centerPointVect;


        //execute half rotation
        Transform tx = Transform.Rotation(rotation / 2, rotationAxis, centerPoint);


        point2.Transform(tx);
        pointTree.Add(point2, pth);

        //execute full rotation
        tx = Transform.Rotation(rotation, rotationAxis, centerPoint);
        startPoint.Transform(tx);
        pointTree.Add(startPoint, pth);

        //updata rotation parameters
        centerPoint = startPoint;
        centerPointVect.Transform(tx);
      }
    }
    A = pointTree;
# ---------- end c_script_10 ----------

trim_5 = TrimTree(Tree=c_script_10.A, Depth=1)
cullpt = CullDuplicates(Points=trim_5, Tolerance=0.1, CullMode=3)  # -> Points, Indices, Valence
pt_7 = Point(cullpt.Points)

# ---- group: animate
pt_8 = Point(simplify(pt_7))
pln_2 = Plane(graft(pln))
num_21 = Number(Slider(1, range=0..1))
c_script_11 = CSharpScript(iPoints=simplify(pt_8), iPlanes=pln_2, iShapeFactor=num_21)  # -> out, A; inputs iPoints: tree of Point3d, iPlanes: tree of Plane, iShapeFactor: Double
# ---------- c_script_11: C# ----------
    DataTree<Point3d> output = new DataTree<Point3d>();
    
    double shapeFactor = 1.0 - iShapeFactor;

    //step through curves
    for (int i = 0; i < iPoints.BranchCount; i++)
    {
      Plane currentPlane = iPlanes.Branch(iPoints.Path(i)[0])[0];

      //get vectors from plane
      Vector3d zVect = currentPlane.YAxis;

      Vector3d rotVect = currentPlane.ZAxis;

      //create new startpoint inside list
      Point3d startPoint = iPoints.Branch(i)[0];

      //step through points. Create and rotate vectors
      for (int j = 0; j < iPoints.Branch(i).Count; j++)
      {
        if (j == 0) output.Add(startPoint, iPoints.Path(i));
        else{
          //create current segment vector
          Vector3d segmentVect = new Vector3d(iPoints.Branch(i)[j] - iPoints.Branch(i)[j - 1]);

          //measure angle with vertical vector
          double angle = Vector3d.VectorAngle(zVect, segmentVect, currentPlane);

          //rotate
          segmentVect.Rotate(-angle * shapeFactor, rotVect);

          startPoint += segmentVect;
          output.Add(startPoint, iPoints.Path(i));
        }
      }
    }

    A = output;
# ---------- end c_script_11 ----------
pt_9 = Point(c_script_11.A)
intcrv_4 = Interpolate(Vertices=pt_9, Degree=3, Periodic=False, KnotStyle=1)  # -> Curve, Length, Domain
crv_16 = Curve(intcrv_4.Curve)

# ----
crv_17 = Curve(crv_16)
pt_10 = Point(simplify(graft(scale.Geometry)))
end_2 = EndPoints(Curve=crv_17)  # -> Start, End
vec2pt = Vector2Pt(PointA=end_2.Start, PointB=end_2.End, Unitize=False)  # -> Vector, Length
yz_2 = YZPlane(Origin=end_2.Start)
Y_17 = UnitY(Factor=panel_orientation)
angle = Angle(VectorA=vec2pt.Vector, VectorB=Y_17, Plane=yz_2)  # -> Angle, Reflex
rotate = Rotate(Geometry=crv_17, Angle=angle.Angle, Plane=yz_2)  # -> Geometry, Transform
curvepoint_2 = PointOnCurve(rotate.Geometry, parameter=0.5)
vec2pt_2 = Vector2Pt(PointA=curvepoint_2, PointB=pt_10, Unitize=False)  # -> Vector, Length
move_15 = Move(Geometry=rotate.Geometry, Motion=vec2pt_2.Vector)  # -> Geometry, Transform
path_mapper = PathMapper(move_15.Geometry, source=["{A;B}", "{A}"], target=["{A}", "{0}"])
crv_18 = Curve(reverse(path_mapper))
loft_2 = Loft(Curves=crv_18, Options={Adjust=False, Closed=False, LoftEnds=0, LoftSimp=0, LoftType=2, Rebuild=10, Refit=0.01})

cull_7 = CullPattern(List=loft_2, CullPattern=bool)

number_slider_17 = Slider(8, range=0..100)
srf_7 = Surface(cull_7)
num_22 = Number(number_slider_10)
quads = QuadPanels(Surface=srf_7, UDivisions=number_slider_17, VDivisions=num_22)
srf_8 = Surface(reparameterize(simplify(quads)))

smesh = SimpleMesh(Brep=srf_8)

area_11 = MeshArea(Mesh=smesh)  # -> Area, Centroid
meshcp = MeshClosestPoint(Point=area_11.Centroid, Mesh=smesh)  # -> Point, Index, Parameter
meval = MeshEval(Mesh=smesh, Parameter=meshcp.Parameter)  # -> Point, Normal, Colour
pl = PlaneNormal(Origin=meval.Point, ZAxis=meval.Normal)
X_2 = UnitX(Factor=1)
deplane = DeconstructPlane(Plane=pl)  # -> Origin, XAxis, YAxis, ZAxis
angle_2 = Angle(VectorA=deplane.XAxis, VectorB=X_2, Plane=pl)  # -> Angle, Reflex
rotate_2 = Rotate(Geometry=pl, Angle=angle_2.Angle, Plane=pl)  # -> graft(Geometry), Transform

medges = MeshEdges(Mesh=smesh)  # -> simplify(NakedEdges), InteriorEdges, NonManifoldEdges
curvepoint_3 = PointOnCurve(medges.NakedEdges, parameter=0.5)
plcoord = PlaneCoordinates(Point=curvepoint_3, System=rotate_2.Geometry)  # -> XCoordinate, YCoordinate, ZCoordinate
sort = SortList(Keys=plcoord.XCoordinate, ValuesA=medges.NakedEdges)  # -> Keys, ValuesA
item_9 = ListItem(List=reverse(sort.ValuesA), Index=0, Wrap=True)
item_10 = ListItem(List=sort.ValuesA, Index=0, Wrap=True)

merge_12 = Merge(Data1=item_10, Data2=item_9)
trim_6 = TrimTree(Tree=merge_12, Depth=1)
rdlines = RemoveDuplicateLinesKaramba3D(Line=trim_6, LimitDistance=0.005)  # -> OutLine, Info, Indexes
join_3 = JoinCurves(Curves=rdlines.OutLine, Preserve=False)
explode = Explode(Curve=join_3, Recursive=True)  # -> Segments, simplify(Vertices)
pline = PolyLine(Vertices=explode.Vertices, Closed=False)  # -> simplify(graft(Polyline))
path_mapper_2 = PathMapper(pline, source=["{A}", "{A;B}"], target=["{0}", "{A}"])
curvepoint_4 = PointOnCurve(path_mapper_2, parameter=0.5)
pdecon_8 = Deconstruct(Point=curvepoint_4)  # -> XComponent, YComponent, ZComponent
sort_2 = SortList(Keys=pdecon_8.XComponent, ValuesA=path_mapper_2)  # -> Keys, ValuesA
crv_19 = Curve(sort_2.ValuesA)

crv_20 = Curve(crv_19)
item_11 = ListItem(List=crv_20, Index=0, Wrap=True)
curvepoint_5 = PointOnCurve(crv_20, parameter=0.5)
curvepoint_6 = PointOnCurve(item_11, parameter=0.5)
vec2pt_3 = Vector2Pt(PointA=curvepoint_6, PointB=curvepoint_5, Unitize=False)  # -> Vector, Length
move_16 = Move(Geometry=item_11, Motion=vec2pt_3.Vector)  # -> Geometry, Transform

crv_21 = Curve(crv_19)
flip = FlipCurve(Curve=crv_21, Guide=move_16.Geometry)  # -> Curve, Flag

explode_2 = Explode(Curve=flip.Curve, Recursive=True)  # -> simplify(Segments), Vertices
explode_3 = Explode(Curve=move_16.Geometry, Recursive=True)  # -> simplify(Segments), Vertices
lng_5 = ListLength(List=explode_2.Segments)
lng_6 = ListLength(List=explode_2.Segments)
lng_7 = ListLength(List=explode_3.Segments)
lng_8 = ListLength(List=explode_3.Segments)
subtraction_9 = Subtraction(A=lng_5, B=2)
subtraction_10 = Subtraction(A=lng_6, B=1)
subtraction_11 = Subtraction(A=lng_7, B=2)
subtraction_12 = Subtraction(A=lng_8, B=1)
dom_9 = ConstructDomain(DomainStart=0, DomainEnd=subtraction_9)
dom_10 = ConstructDomain(DomainStart=1, DomainEnd=subtraction_10)
dom_11 = ConstructDomain(DomainStart=0, DomainEnd=subtraction_11)
dom_12 = ConstructDomain(DomainStart=1, DomainEnd=subtraction_12)
subset_3 = SubList(List=explode_2.Segments, Domain=dom_9, Wrap=True)  # -> List, Index
subset_4 = SubList(List=explode_2.Segments, Domain=dom_10, Wrap=True)  # -> List, Index
subset_5 = SubList(List=explode_3.Segments, Domain=dom_11, Wrap=True)  # -> List, Index
subset_6 = SubList(List=explode_3.Segments, Domain=dom_12, Wrap=True)  # -> List, Index
angle_3 = Angle(VectorA=subset_5.List, VectorB=subset_6.List)  # -> simplify(Angle), Reflex
angle_4 = Angle(VectorA=subset_3.List, VectorB=subset_4.List)  # -> simplify(Angle), Reflex
num_23 = Number(angle_3.Angle)
num_24 = Number(angle_4.Angle)

explode_4 = Explode(Curve=flip.Curve, Recursive=True)  # -> simplify(Segments), Vertices
explode_5 = Explode(Curve=move_16.Geometry, Recursive=True)  # -> simplify(Segments), Vertices
path_mapper_3 = PathMapper(explode_4.Segments, source=["{A}(i)", "{A;B}(i)"], target=["{i}(A)", "{A;i}(B)"])
path_mapper_4 = PathMapper(explode_5.Segments, source=["{A}(i)", "{A;B}(i)"], target=["{i}(A)", "{A;i}(B)"])
crv_22 = Curve(path_mapper_4)
crv_23 = Curve(path_mapper_3)
lng_9 = ListLength(List=crv_23)  # -> expr("x-2", Length)
lng_10 = ListLength(List=crv_22)  # -> expr("x-2", Length)
lng_11 = ListLength(List=crv_23)  # -> expr("x-1", Length)
lng_12 = ListLength(List=crv_22)  # -> expr("x-1", Length)
dom_13 = ConstructDomain(DomainStart=0, DomainEnd=lng_9)
dom_14 = ConstructDomain(DomainStart=0, DomainEnd=lng_10)
dom_15 = ConstructDomain(DomainStart=1, DomainEnd=lng_11)
dom_16 = ConstructDomain(DomainStart=1, DomainEnd=lng_12)
subset_7 = SubList(List=crv_23, Domain=dom_13, Wrap=True)  # -> graft(List), Index
subset_8 = SubList(List=crv_22, Domain=dom_14, Wrap=True)  # -> graft(List), Index
subset_9 = SubList(List=crv_23, Domain=dom_15, Wrap=True)  # -> graft(List), Index
subset_10 = SubList(List=crv_22, Domain=dom_16, Wrap=True)  # -> graft(List), Index
loft_3 = Loft(
    Curves=[subset_7.List, subset_9.List],
    Options={Adjust=False, Closed=False, LoftEnds=0, LoftSimp=0, LoftType=0, Rebuild=10, Refit=0.01})  # -> simplify(Loft)
loft_4 = Loft(
    Curves=[subset_8.List, subset_10.List],
    Options={Adjust=False, Closed=False, LoftEnds=0, LoftSimp=0, LoftType=0, Rebuild=10, Refit=0.01})  # -> simplify(Loft)
smesh_2 = SimpleMesh(Brep=loft_3)
smesh_3 = SimpleMesh(Brep=loft_4)
path_mapper_5 = PathMapper(smesh_3, source=["{A;B;C}", "{A;B}"], target=["{A}", "{0}"])
path_mapper_6 = PathMapper(smesh_2, source=["{A;B;C}", "{A;B}"], target=["{A}", "{0}"])
mjoin = MeshJoin(Meshes=path_mapper_5)
mjoin_2 = MeshJoin(Meshes=path_mapper_6)
weld = WeldMesh(Mesh=mjoin, Angle=3.141592654)
weld_2 = WeldMesh(Mesh=mjoin_2, Angle=3.141592654)

# ---- group: RT
neg_14 = Negative(Value=Slider(11183, range=0..20000))
crv_24 = Curve(dec_board.Polyline)
Y_18 = UnitY(Factor=neg_14)
srf_9 = Surface(crv_24)
bnd_12 = Bounds(Numbers=flatten(c_script_6.A))
move_17 = Move(Geometry=srf_9, Motion=Y_18)  # -> simplify(Geometry), Transform
dedomain_12 = DeconstructDomain(Domain=bnd_12)  # -> Start, End
area_12 = Area(Geometry=move_17.Geometry)  # -> Area, Centroid
tag_5 = TextTag3D(Location=area_12.Centroid, Text=round_3.Nearest, Size=Slider(70, range=0..100), Colour=RGB(0, 0, 0), Justification=5)

# ----
gradient_6 = Gradient(
    LowerLimit=dedomain_12.End,
    UpperLimit=dedomain_12.Start,
    Parameter=c_script_6.A,
    stops=[0.15: RGB(145, 130, 255), 0.85: RGB(92, 33, 219)])

# ---- group: RT (continued)
preview_6 = CustomPreview(Geometry=move_17.Geometry, Material=gradient_6)

# ---- group: actual boards
neg_15 = Negative(Value=Slider(16839, range=0..20000))
crv_25 = Curve(dec_board.Polyline)
Y_19 = UnitY(Factor=neg_15)
srf_10 = Surface(crv_25)
bnd_13 = Bounds(Numbers=flatten(c_script_3.A))
move_18 = Move(Geometry=srf_10, Motion=Y_19)  # -> simplify(Geometry), Transform
dedomain_13 = DeconstructDomain(Domain=bnd_13)  # -> Start, End
area_13 = Area(Geometry=move_18.Geometry)  # -> Area, Centroid
tag_6 = TextTag3D(Location=area_13.Centroid, Text=round_5.Nearest, Size=Slider(70, range=0..100), Colour=RGB(0, 0, 0), Justification=5)

# ----
gradient_7 = Gradient(
    LowerLimit=dedomain_13.End,
    UpperLimit=dedomain_13.Start,
    Parameter=c_script_3.A,
    stops=[0: RGB(230, 230, 230), 1: RGB(26, 26, 26)])

# ---- group: actual boards (continued)
preview_7 = CustomPreview(Geometry=move_18.Geometry, Material=gradient_7)

# ---- group: moisture
neg_16 = Negative(Value=Slider(13804, range=0..20000))
crv_26 = Curve(dec_board.Polyline)
Y_20 = UnitY(Factor=neg_16)
srf_11 = Surface(crv_26)
bnd_14 = Bounds(Numbers=flatten(c_script_4.A))
move_19 = Move(Geometry=srf_11, Motion=Y_20)  # -> simplify(Geometry), Transform
dedomain_14 = DeconstructDomain(Domain=bnd_14)  # -> Start, End
area_14 = Area(Geometry=move_19.Geometry)  # -> Area, Centroid
tag_7 = TextTag3D(Location=area_14.Centroid, Text=round_4.Nearest, Size=Slider(70, range=0..100), Colour=RGB(0, 0, 0), Justification=5)

# ----
gradient_8 = Gradient(
    LowerLimit=dedomain_14.End,
    UpperLimit=dedomain_14.Start,
    Parameter=c_script_4.A,
    stops=[0: RGB(0, 255, 68), 0.328: RGB(94, 255, 108), 0.662: RGB(115, 255, 126), 1: RGB(140, 255, 152)])

# ---- group: moisture (continued)
preview_8 = CustomPreview(Geometry=move_19.Geometry, Material=gradient_8)

# ---- group: convolution weight (continued)
bnd_15 = Bounds(Numbers=flatten(c_script_7.A))

# ----
remap_8 = RemapNumbers(Value=c_script_7.A, Source=bnd_15, Target=Domain(0, 1))  # -> Mapped, Clipped

# ---- group: convolution weight (continued)
roundd_3 = RoundToDecimalPlace(NumberX=remap_8.Clipped, DecimalPlace=Slider(2, range=0..10), RoundType=0)  # -> Rounded, Difference
gradient_9 = Gradient(
    LowerLimit=0,
    UpperLimit=1,
    Parameter=remap_8.Clipped,
    stops=[0: RGB(0, 128, 0), 0.5: RGB(255, 255, 0), 1: RGB(255, 0, 0)])
preview_9 = CustomPreview(Geometry=move_12.Geometry, Material=gradient_9)
tag_8 = TextTag3D(Location=area_6.Centroid, Text=roundd_3.Rounded, Size=Slider(76, range=0..100), Colour=RGB(0, 0, 0), Justification=5)

bnd_16 = Bounds(Numbers=flatten(c_script_9.A))
roundd_4 = RoundToDecimalPlace(NumberX=c_script_9.A, DecimalPlace=Slider(2, range=0..10), RoundType=0)  # -> Rounded, Difference
tag_9 = TextTag3D(Location=area_8.Centroid, Text=roundd_4.Rounded, Size=Slider(76, range=0..100), Colour=RGB(0, 0, 0), Justification=5)

# ----
dedomain_15 = DeconstructDomain(Domain=bnd_16)  # -> Start, End
gradient_10 = Gradient(
    LowerLimit=dedomain_15.End,
    UpperLimit=dedomain_15.Start,
    Parameter=c_script_9.A,
    stops=[0: RGB(230, 230, 230), 1: RGB(26, 26, 26)])

# ---- group: convolution weight (continued)
preview_10 = CustomPreview(Geometry=move_14.Geometry, Material=gradient_10)

# ----
explode_6 = Explode(Curve=move_16.Geometry, Recursive=True)  # -> Segments, Vertices
num_25 = Number(num_24)
num_26 = Number(num_23)
mesh = Mesh(weld)
path_mapper_7 = PathMapper(explode_6.Vertices, source=["{A;B}(i)", "{A}(i)"], target=["{A;i}(B)", "{i}(A)"])
division_12 = Division(A=num_25, B=num_26)
avr_2 = Average(Input=division_12)
number_slider_18 = Slider(100, range=0..100000)
pline_2 = PolyLine(Vertices=path_mapper_7, Closed=False)  # -> simplify(Polyline)
path_mapper_8 = PathMapper(pline_2, source=["{A;B}", "{A}"], target=["{A}", "{0}"])
crv_27 = Curve(move_16.Geometry)
show = Show(G=mesh)
rod = Rod(
    Polyline=path_mapper_8,
    LengthFactor=1,
    AngleFactor=1,
    AxialStrength=number_slider_18,
    BendStrength=Slider(1, range=0..10000))
path_mapper_9 = PathMapper(rod, source=["{A;B}", "{A}"], target=["{A}", "{0}"])

path_mapper_10 = PathMapper(avr_2, source=["{A}", "{A;B}"], target=["{0}", "{A}"])

rod_2 = Rod(
    Polyline=crv_27,
    LengthFactor=1,
    AngleFactor=path_mapper_10,
    AxialStrength=number_slider_18,
    BendStrength=Slider(10000, range=0..10000))
path_mapper_11 = PathMapper(rod_2, source=["{A;B}", "{A}"], target=["{A}", "{0}"])
merge_13 = Merge(Data1=path_mapper_9, Data2=path_mapper_11, Data3=show)

zombiesolver = ZombieSolver(GoalObjects=merge_13, Threshold=1e-10, Tolerance=0.0001, MaxIterations=Slider(30000, range=0..100000))  # -> I, V, O
mesh_2 = Mesh(zombiesolver.O)
clean = CleanTree(RemoveNulls=True, RemoveInvalid=True, RemoveEmpty=False, Tree=mesh_2)

mesh_3 = Mesh(simplify(graft(clean)))
merge_14 = Merge(Data1=clean, Data2=weld_2)  # -> flatten(Result)

mesh_4 = Mesh(mesh_3)
num_27 = Number(expr("x+1", number_slider_17))
medges_2 = MeshEdges(Mesh=mesh_4)  # -> NakedEdges, InteriorEdges, NonManifoldEdges
demesh = DeconstructMesh(Mesh=mesh_4)  # -> Vertices, Faces, Colours, Normals
join_4 = JoinCurves(Curves=medges_2.NakedEdges, Preserve=False)
patch = Patch(Curves=join_4, Points=demesh.Vertices, Spans=num_27, Flexibility=Slider(1, range=0..1), Trim=True)
srf_12 = Surface(simplify(patch))

merge_15 = Merge(Data1=simplify(clean), Data2=simplify(weld_2))  # -> simplify(Result)
wbedges = WeaverbirdsMeshEdges(MeshOrPolylines=graft(merge_14))
c_script_12 = CSharpScript(tree=wbedges)  # -> out, A, B; inputs tree: tree
# ---------- c_script_12: C# ----------
    DataTree<object> even = new DataTree<object>();
    DataTree<object> odd = new DataTree<object>();
    
    for(int i = 0; i < tree.BranchCount; i++)
    {
      if(tree.Paths[i][1] == 0)even.AddRange(tree.Branch(i), tree.Paths[i]);
      else odd.AddRange(tree.Branch(i), tree.Paths[i]);
    }
    A = even;
    B = odd;
# ---------- end c_script_12 ----------
len_2 = Length(Curve=c_script_12.B)
len_3 = Length(Curve=c_script_12.A)
group_2 = Group(Objects=c_script_12.B)  # -> flatten(Group)
lng_13 = ListLength(List=group_2)
subtraction_13 = Subtraction(A=len_2, B=len_3)
series_3 = Series(Start=0, Step=Slider(1856, range=0..10000), Count=lng_13)
smaller_2 = SmallerThan(FirstNumber=subtraction_13, SecondNumber=0)  # -> SmallerThan, OrEqualTo
Y_21 = UnitY(Factor=series_3)
dispatch = Dispatch(List=subtraction_13, DispatchPattern=smaller_2.SmallerThan)  # -> ListA, ListB
move_20 = Move(Geometry=group_2, Motion=Y_21)  # -> Geometry, Transform
bnd_17 = Bounds(Numbers=dispatch.ListA)
bnd_18 = Bounds(Numbers=dispatch.ListB)
dedomain_16 = DeconstructDomain(Domain=bnd_18)  # -> Start, End
dedomain_17 = DeconstructDomain(Domain=bnd_17)  # -> Start, End
gradient_11 = Gradient(
    LowerLimit=dedomain_16.Start,
    UpperLimit=dedomain_16.End,
    Parameter=dispatch.ListB,
    stops=[0: RGB(254, 244, 84), 0.499: RGB(234, 126, 0), 1: RGB(234, 38, 0), 1: RGB(75, 107, 169), 1: RGB(173, 203, 249)])

crv_28 = Curve(c_script_12.A)
end_3 = EndPoints(Curve=crv_28)  # -> Start, End
pdecon_9 = Deconstruct(Point=end_3.Start)  # -> XComponent, YComponent, ZComponent
pdecon_10 = Deconstruct(Point=end_3.End)  # -> XComponent, YComponent, ZComponent
subtraction_14 = Subtraction(A=pdecon_9.XComponent, B=pdecon_10.XComponent)
abs_5 = Absolute(Value=subtraction_14)
smaller_3 = SmallerThan(FirstNumber=abs_5, SecondNumber=Slider(100, range=0..100))  # -> SmallerThan, OrEqualTo
cull_8 = CullPattern(List=crv_28, CullPattern=smaller_3.SmallerThan)
join_5 = JoinCurves(Curves=cull_8, Preserve=False)
curvepoint_7 = PointOnCurve(join_5, parameter=0.5)
pdecon_11 = Deconstruct(Point=curvepoint_7)  # -> XComponent, YComponent, ZComponent
sort_3 = SortList(Keys=pdecon_11.XComponent, ValuesA=join_5)  # -> Keys, ValuesA
explode_7 = Explode(Curve=sort_3.ValuesA, Recursive=True)  # -> Segments, simplify(Vertices)
intcrv_5 = Interpolate(Vertices=explode_7.Vertices, Degree=3, Periodic=False, KnotStyle=1)  # -> Curve, Length, Domain
path_mapper_12 = PathMapper(intcrv_5.Curve, source=["{A;B}", "{A}"], target=["{A}", "{0}"])
loft_5 = Loft(Curves=path_mapper_12, Options={Adjust=False, Closed=False, LoftEnds=0, LoftSimp=0, LoftType=0, Rebuild=10, Refit=0.01})

move_21 = Move(Geometry=move_20.Geometry, Motion=Y_9)  # -> Geometry, Transform
gradient_12 = Gradient(
    LowerLimit=dedomain_17.Start,
    UpperLimit=dedomain_17.End,
    Parameter=dispatch.ListA,
    stops=[0: RGB(75, 107, 169), 0.501: RGB(173, 203, 249), 1: RGB(254, 244, 84)])

ungroup_2 = Ungroup(Group=move_21.Geometry)
dispatch_2 = Dispatch(List=ungroup_2, DispatchPattern=smaller_2.SmallerThan)  # -> ListA, ListB
previewlw = CustomPreviewLineweights(Geometry=dispatch_2.ListA, Shader=gradient_12, Thickness=3, Absolute=False)
previewlw_2 = CustomPreviewLineweights(Geometry=dispatch_2.ListB, Shader=gradient_11, Thickness=3, Absolute=False)

# ---- group: control gate
srf_13 = Surface(loft_5)
srf_14 = Surface(loft_2)
bool_5 = Boolean(compute_double_curvature)
not_3 = GateNot(A=bool_5)
cull_9 = CullPattern(List=srf_14, CullPattern=not_3)
merge_16 = Merge(Data1=srf_13, Data2=cull_9)

# ----
cull_10 = CullPattern(List=merge_16, CullPattern=bool_2)

relaxation = Panel(bnd_17)

mesh_5 = Mesh(mesh_3)
c_script_13 = CSharpScript(mesh=mesh_5, surface=srf_12)  # -> out, Curvature; inputs mesh: Mesh, surface: Surface
# ---------- c_script_13: C# ----------
        //get surface gaussian curvature at each mesh point
        List<double> gaussianCurvatures = new List<double>();
        double maxGaussian = 0;
        double minGaussian = double.MaxValue;

        double U;
        double V;

        for (int i = 0; i < mesh.Vertices.Count; i++)
        {
            Point3d currentMeshPoint = mesh.Vertices.Point3dAt(i);
            surface.ClosestPoint(currentMeshPoint, out U, out V);
            SurfaceCurvature surfaceCurvature = surface.CurvatureAt(U, V);
            double gaussian = surfaceCurvature.Gaussian;
            gaussianCurvatures.Add(gaussian);

            //get the range of curvatures
            if (gaussian > maxGaussian) maxGaussian = gaussian;
            if( gaussian < minGaussian) minGaussian = gaussian;
        }


        //get the range of curvatures


        //remap the curvatures to color values on the mesh points
        for (int i = 0; i < mesh.Vertices.Count; i++)
        {
            double hue = (gaussianCurvatures[i] - minGaussian) / (0 - minGaussian) * (0.5 - maxGaussian) + maxGaussian;
        }
        Curvature = gaussianCurvatures;
# ---------- end c_script_13 ----------
mesh_6 = Mesh(flatten(mesh_5))
num_28 = Number(c_script_13.Curvature)
bnd_19 = Bounds(Numbers=num_28)
dedomain_18 = DeconstructDomain(Domain=bnd_19)  # -> Start, End
gradient_13 = Gradient(
    LowerLimit=dedomain_18.Start,
    UpperLimit=dedomain_18.End,
    Parameter=num_28,
    stops=[0: RGB(0, 128, 0), 0.5: RGB(255, 255, 0), 1: RGB(255, 0, 0)])

gaussian_curvature = Panel(bnd_19)

crv_29 = Curve(dec_board_5.Polyline)
srf_15 = Surface(reparameterize(graft(cull_10)))
explode_8 = Explode(Curve=crv_29, Recursive=True)  # -> Segments, Vertices
len_4 = Length(Curve=explode_8.Segments)
path_mapper_13 = PathMapper(crv_29, source=["{A;B}", "{A}"], target=["{A}", "{0}"])
division_13 = Division(A=len_4, B=Slider(50, range=0..100))
runion = RegionUnion(Curves=path_mapper_13)
divide_4 = DivideCurve(Curve=explode_8.Segments, Count=division_13, Kinks=False)  # -> Points, Tangents, Parameters
path_mapper_14 = PathMapper(divide_4.Points, source=["{A;B;C;D}", "{A;B;C}"], target=["{A}", "{0}"])
srf_16 = Surface(reparameterize(simplify(runion)))
srf_cp = SurfaceClosestPoint(Point=path_mapper_14, Surface=srf_16)  # -> Point, UVPoint, Distance
evalsrf = EvaluateSurface(Surface=reparameterize(srf_15), Point=srf_cp.UVPoint)  # -> Point, Normal, UDirection, VDirection, Frame
c_script_14 = CSharpScript(trimmedTree=evalsrf.Point, originalTree=divide_4.Points)  # -> out, A; inputs trimmedTree: tree, originalTree: tree
# ---------- c_script_14: C# ----------
    if(originalTree.DataCount != trimmedTree.DataCount) Component.AddRuntimeMessage(GH_RuntimeMessageLevel.Error, "Number of items in both trees must be equal");

    DataTree<object> outputs = new DataTree<object>();
    List<GH_Path> paths = GetPaths(originalTree);
    //step through trimmed tree objects and add them to output tree with the correct

    int counter = 0;
    for(int i = 0; i < trimmedTree.BranchCount; i++)
    {
      for(int j = 0; j < trimmedTree.Branch(i).Count; j++)
      {
        outputs.Add(trimmedTree.Branch(i)[j], paths[counter]);
        counter++;
      }
    }
    A = outputs;
# ---------- c_script_14: C# additional code ----------
  public List<GH_Path> GetPaths(DataTree<object> originalTree)
  {
    List<GH_Path> output = new List<GH_Path>();
    for(int i = 0; i < originalTree.BranchCount; i++)
    {
      for(int j = 0; j < originalTree.Branch(i).Count; j++)
      {
        output.Add(originalTree.Paths[i]);
      }
    }
    return output;
  }
# ---------- end c_script_14 ----------
intcrv_6 = Interpolate(Vertices=c_script_14.A, Degree=3, Periodic=False, KnotStyle=1)  # -> Curve, Length, Domain
trim_7 = TrimTree(Tree=intcrv_6.Curve, Depth=1)
join_6 = JoinCurves(Curves=trim_7, Preserve=False)  # -> simplify(Curves)
path_mapper_15 = PathMapper(join_6, source=["{A;B;C}", "{A;B}"], target=["{A}", "{0}"])
lng_14 = ListLength(List=path_mapper_15)
dup_8 = DuplicateData(Data=srf_15, Number=lng_14, Order=True)
c_script_15 = CSharpScript(surface=simplify(graft(dup_8)), curves=simplify(graft(path_mapper_15)))  # -> out, A; inputs surface: tree of Brep, curves: tree of Curve
# ---------- c_script_15: C# ----------
    DataTree<Brep> splitBreps = new DataTree<Brep>();
    for(int i = 0; i < curves.BranchCount; i++)
    {
      Brep[] results = surface.Branch(i)[0].Split(curves.Branch(i), 0.1);
      foreach(Brep brep in results)
      {
        splitBreps.Add(brep, curves.Paths[i]);
      }
    }
    A = splitBreps;
# ---------- end c_script_15 ----------
area_15 = Area(Geometry=c_script_15.A)  # -> Area, Centroid
sort_4 = SortList(Keys=area_15.Area, ValuesA=c_script_15.A)  # -> Keys, reverse(ValuesA)
item_12 = ListItem(List=sort_4.ValuesA, Index=Slider(1, range=0..1), Wrap=True)

path_mapper_16 = PathMapper(item_12, source=["{A}", "{A;B}"], target=["{0}", "{A}"])

c_script_16 = CSharpScript(trimmedTree=path_mapper_16, originalTree=join_6)  # -> out, A; inputs trimmedTree: tree, originalTree: tree; same code as c_script_14
trim_8 = TrimTree(Tree=c_script_16.A, Depth=1)

srf_17 = Surface(merge_16)
edges = BrepEdges(Brep=srf_17)  # -> Naked, Interior, NonManifold
len_5 = Length(Curve=edges.Naked)
sort_5 = SortList(Keys=len_5, ValuesA=edges.Naked)  # -> Keys, reverse(ValuesA)
item_13 = ListItem(List=sort_5.ValuesA, Index=0, Wrap=True)  # -> Item, Item1
flip_2 = FlipCurve(Curve=item_13.Item1)  # -> Curve, Flag
merge_17 = Merge(Data1=item_13.Item, Data2=flip_2.Curve)
divide_5 = DivideCurve(Curve=merge_17, Count=Slider(100, range=0..100), Kinks=False)  # -> Points, Tangents, Parameters
path_mapper_17 = PathMapper(divide_5.Points, source="{A;B;C}(i)", target="{A;B;i}(C)")
item_14 = ListItem(List=path_mapper_17, Index=0, Wrap=True)  # -> Item, Item1
dist_2 = Distance(PointA=item_14.Item, PointB=item_14.Item1)
trim_9 = TrimTree(Tree=dist_2, Depth=1)
bnd_20 = Bounds(Numbers=trim_9)
dedomain_19 = DeconstructDomain(Domain=bnd_20)  # -> simplify(Start), End
srf_18 = Surface(trim_8)
multiplication_24 = Multiplication(A=dedomain_19.Start, B=Slider(0.95, range=0..1))  # -> flatten(Result)
group_3 = Group(Objects=srf_18)
c_script_17 = CSharpScript(x=multiplication_24)  # -> out, A; inputs x: list of Double
# ---------- c_script_17: C# ----------
    List<double> output = new List<double>();
    
    double currentVal = 0;
    for(int i = 0; i < x.Count; i++)
    {
      output.Add(currentVal);
      currentVal += x[i];
    }
    A = output;
# ---------- end c_script_17 ----------
path_mapper_18 = PathMapper(group_3, source=["{A}", "{A;B}"], target=["{0}", "{A}"])
Y_22 = UnitY(Factor=c_script_17.A)
group_4 = Group(Objects=path_mapper_18)  # -> flatten(Group)
move_22 = Move(Geometry=srf_17, Motion=Y_22)  # -> Geometry, Transform
move_23 = Move(Geometry=group_4, Motion=Y_22)  # -> Geometry, Transform

move_24 = Move(Geometry=mesh_6, Motion=Y_22)  # -> simplify(graft(Geometry)), Transform

srf_19 = Surface(move_22.Geometry)
shift_3 = ShiftList(List=srf_19, Shift=1, Wrap=True)
shift_4 = ShiftList(List=srf_19, Shift=-1, Wrap=True)
bbx = BrepBrep(BrepA=srf_19, BrepB=shift_4)  # -> Curves, Points
bbx_2 = BrepBrep(BrepA=srf_19, BrepB=shift_3)  # -> Curves, Points
number_slider_19 = Slider(30, range=0..100)
merge_18 = Merge(Data1=bbx_2.Curves, Data2=bbx.Curves)  # -> simplify(Result)
srf_20 = Surface(simplify(graft(srf_19)))
ext = ExtendCurve(Curve=merge_18, Type=0, Start=number_slider_19, End=number_slider_19)
srfsplit = SurfaceSplit(Surface=srf_20, Curves=ext)  # -> simplify(Fragments)
area_16 = Area(Geometry=srfsplit)  # -> Area, Centroid
area_17 = Area(Geometry=srf_20)  # -> Area, Centroid
dist_3 = Distance(PointA=area_17.Centroid, PointB=area_16.Centroid)
sort_6 = SortList(Keys=dist_3, ValuesA=srfsplit)  # -> Keys, ValuesA
item_15 = ListItem(List=sort_6.ValuesA, Index=0, Wrap=True)  # -> flatten(Item)

ungroup_3 = Ungroup(Group=move_23.Geometry)
ungroup_4 = Ungroup(Group=ungroup_3)  # -> simplify(Objects)
srf_21 = Surface(ungroup_4)
path_mapper_19 = PathMapper(srf_21, source=["{A}", "{A;B}"], target=["{0}", "{A}"])
lng_15 = ListLength(List=srf_21)
group_5 = Group(Objects=merge_18)  # -> simplify(Group)
lng_16 = ListLength(List=path_mapper_19)
path_mapper_20 = PathMapper(lng_15, source=["{A}", "{A;B}"], target=["{0}", "{A}"])
dup_9 = DuplicateData(Data=group_5, Number=lng_16, Order=True)  # -> simplify(Data)
partition = PartitionList(List=dup_9, Size=path_mapper_20)
srf_22 = Surface(graft(srf_21))
ungroup_5 = Ungroup(Group=partition)  # -> simplify(Objects)
scx = SurfaceCurve(Surface=srf_22, Curve=ungroup_5)  # -> simplify(Curves), simplify(Points), UVPoints, Normals, Parameters, Tangents
trim_10 = TrimTree(Tree=scx.Points, Depth=1)
trim_11 = TrimTree(Tree=scx.Curves, Depth=1)
null = NullItem(Item=trim_11)  # -> NullFlags, InvalidFlags, Description
null_2 = NullItem(Item=trim_10)  # -> NullFlags, InvalidFlags, Description
not_4 = GateNot(A=null.NullFlags)
not_5 = GateNot(A=null_2.NullFlags)
toggle = BooleanToggle(True)
cset = CreateSet(List=not_4)  # -> Set, Map
cset_2 = CreateSet(List=not_5)  # -> Set, Map
mindex = MemberIndex(Set=cset.Set, Member=toggle)  # -> simplify(Index), Count
mindex_2 = MemberIndex(Set=cset_2.Set, Member=toggle)  # -> simplify(Index), Count
larger = LargerThan(FirstNumber=mindex.Count, SecondNumber=0)  # -> LargerThan, OrEqualTo
larger_2 = LargerThan(FirstNumber=mindex_2.Count, SecondNumber=0)  # -> LargerThan, OrEqualTo
or = GateOr(A=larger.LargerThan, B=larger_2.LargerThan)
cull_11 = CullPattern(List=ungroup_5, CullPattern=or)
srfsplit_2 = SurfaceSplit(Surface=srf_22, Curves=cull_11)  # -> simplify(Fragments)

srf_23 = Surface(item_15)

item_16 = ListItem(List=srf_23, Index=1, Wrap=True)
item_17 = ListItem(List=srf_23, Index=0, Wrap=True)
number_slider_20 = Slider(1000, range=0..1000)
bbx_3 = BrepBrep(BrepA=item_17, BrepB=item_16)  # -> Curves, Points
ext_2 = ExtendCurve(Curve=bbx_3.Curves, Type=0, Start=number_slider_20, End=number_slider_20)
Y_23 = UnitY(Factor=Slider(10000, range=0..10000))
neg_17 = Negative(Value=Y_23)
extr = Extrude(Base=ext_2, Direction=neg_17)
split = SplitBrep(Brep=item_17, Cutter=extr)
area_18 = Area(Geometry=split)  # -> Area, Centroid
pdecon_12 = Deconstruct(Point=area_18.Centroid)  # -> XComponent, YComponent, ZComponent
sort_7 = SortList(Keys=pdecon_12.ZComponent, ValuesA=split)  # -> Keys, reverse(ValuesA)
item_18 = ListItem(List=sort_7.ValuesA, Index=0, Wrap=True)

item_19 = ListItem(List=reverse(srf_23), Index=0, Wrap=True)
item_20 = ListItem(List=reverse(srf_23), Index=1, Wrap=True)
number_slider_21 = Slider(1000, range=0..1000)
bbx_4 = BrepBrep(BrepA=item_19, BrepB=item_20)  # -> Curves, Points
ext_3 = ExtendCurve(Curve=bbx_4.Curves, Type=0, Start=number_slider_21, End=number_slider_21)
Y_24 = UnitY(Factor=Slider(10000, range=0..10000))
extr_2 = Extrude(Base=ext_3, Direction=Y_24)
split_2 = SplitBrep(Brep=item_19, Cutter=extr_2)
area_19 = Area(Geometry=split_2)  # -> Area, Centroid
pdecon_13 = Deconstruct(Point=area_19.Centroid)  # -> XComponent, YComponent, ZComponent
sort_8 = SortList(Keys=pdecon_13.ZComponent, ValuesA=split_2)  # -> Keys, reverse(ValuesA)
item_21 = ListItem(List=sort_8.ValuesA, Index=0, Wrap=True)

lng_17 = ListLength(List=srf_23)  # -> expr("x-2", Length)
dom_17 = ConstructDomain(DomainStart=1, DomainEnd=lng_17)
subset_11 = SubList(List=srf_23, Domain=dom_17, Wrap=False)  # -> List, Index

bbox_4 = BoundingBox(Content=item_18, Plane=PlaneXY(0, 0, 0))  # -> Box, Box_2
debox_4 = DeconstructBox(Box=bbox_4.Box)  # -> Plane, X, Y, Z
dedomain_20 = DeconstructDomain(Domain=debox_4.Y)  # -> Start, End
subtraction_15 = Subtraction(A=dedomain_20.End, B=dedomain_20.Start)
larger_3 = LargerThan(FirstNumber=subtraction_15, SecondNumber=Slider(300, range=0..1000))  # -> LargerThan, OrEqualTo

lng_18 = ListLength(List=srf_23)  # -> expr("x-1", Length)
merge_19 = Merge(Data1=flatten(item_18), Data2=flatten(subset_11.List), Data3=flatten(item_21))
dom_18 = ConstructDomain(DomainStart=0, DomainEnd=lng_18)
subset_12 = SubList(List=merge_19, Domain=dom_18, Wrap=True)  # -> List, Index

cull_12 = CullPattern(List=subset_12.List, CullPattern=larger_3.LargerThan)

srf_24 = Surface(srfsplit_2)
area_20 = Area(Geometry=srf_24)  # -> Area, simplify(Centroid)
path_mapper_21 = PathMapper(area_20.Centroid, source=["{A;B;C}", "{A;B}"], target=["{A}", "{0}"])
srf_cp_2 = SurfaceClosestPoint(Point=path_mapper_21, Surface=simplify(graft(cull_12)))  # -> Point, UVPoint, Distance
smaller_4 = SmallerThan(FirstNumber=srf_cp_2.Distance, SecondNumber=Slider(25, range=0..100))  # -> SmallerThan, OrEqualTo
c_script_18 = CSharpScript(trimmedTree=smaller_4.SmallerThan, originalTree=area_20.Centroid)  # -> out, A; inputs trimmedTree: tree, originalTree: tree; same code as c_script_14
cull_13 = CullPattern(List=srf_24, CullPattern=c_script_18.A)  # -> simplify(List)

Y_25 = UnitY(Factor=Slider(2329, range=0..20000))
move_25 = Move(Geometry=cull_12, Motion=Y_25)  # -> Geometry, Transform
srf_25 = Surface(move_25.Geometry)
preview_11 = CustomPreview(Geometry=srf_25, Material=ColourSwatch(SwatchColor=RGB(196, 196, 196)))

txt_3 = Text(graft(dec_board_5.Material))
srf_26 = Surface(cull_13)
path_mapper_22 = PathMapper(srf_26, source=["{A;B;C}", "{A;B}"], target=["{A}", "{0}"])
lng_19 = ListLength(List=srf_26)
addition_18 = Addition(A=Y_10, B=X)
dup_10 = DuplicateData(Data=txt_3, Number=lng_19, Order=True)  # -> simplify(Data)
move_26 = Move(Geometry=path_mapper_22, Motion=addition_18)  # -> Geometry, Transform
len_6 = TextLength(Text=dup_10)
c_script_19 = CSharpScript(trimmedTree=move_26.Geometry, originalTree=srf_26)  # -> out, A; inputs trimmedTree: tree, originalTree: tree; same code as c_script_14
bnd_21 = Bounds(Numbers=flatten(len_6))
dedomain_21 = DeconstructDomain(Domain=bnd_21)  # -> Start, End
gradient_14 = Gradient(
    LowerLimit=dedomain_21.Start,
    UpperLimit=dedomain_21.End,
    Parameter=len_6,
    stops=[0: RGB(186, 186, 186), 1: RGB(122, 122, 122)])
clean_2 = CleanTree(RemoveNulls=True, RemoveInvalid=True, RemoveEmpty=True, Tree=gradient_14)
preview_12 = CustomPreview(Geometry=c_script_19.A, Material=clean_2)

bool_6 = Boolean(compute_structure)
cull_14 = CullPattern(List=cull_12, CullPattern=bool_6)
brep = Brep(flatten(cull_13))
mesh_breps = MeshBrepsKaramba3D(
    Brep=cull_14,
    MeshResolution=Slider(100, range=0..100),
    EdgeRefinementFactor=0.67,
    PointReduction=False,
    SmoothingStepSize=0,
    SmoothingIterations=5)  # -> Mesh, Info
txt_4 = Text(flatten(dec_board_5.Material))
mjoin_3 = MeshJoin(Meshes=flatten(mesh_breps.Mesh))
unim = UnifyMesh(Mesh=mjoin_3)  # -> Result, Count
weld_3 = WeldMesh(Mesh=unim.Result, Angle=3.141592654)
c_script_20 = CSharpScript(mesh=weld_3, breps=brep, materials=txt_4)  # -> out, A, B; inputs mesh: Mesh, breps: list of Brep, materials: list of String
# ---------- c_script_20: C# usings ----------
using Rhino.Geometry.Collections;
# ---------- c_script_20: C# ----------
    //add surfaces to brep in order so that material index lines up with face index
    Brep brep = Brep.JoinBreps(breps, RhinoDoc.ActiveDoc.ModelAbsoluteTolerance)[0];

    List<string> faceMaterials = new List<string>();
    List<Point3d> centroids = new List<Point3d>();

    //for each mesh face, find face index of closest point
    MeshFaceList faceList = mesh.Faces;
    for(int i = 0; i < faceList.Count; i++)
    {
      Point3d centroid = faceList.GetFaceCenter(i);

      Point3d closestPoint;
      ComponentIndex ci;
      double s;
      double t;
      Vector3d normal;
      brep.ClosestPoint(centroid, out closestPoint, out ci, out s, out t, 100, out normal);

      faceMaterials.Add(materials[ci.Index]);
      centroids.Add(closestPoint);
    }

    //return list of materials for each face
    A = faceMaterials;
    B = centroids;
# ---------- end c_script_20 ----------

brep_2 = Brep(cull_12)
debrep = DeconstructBrep(Brep=brep_2)  # -> Faces, Edges, Vertices
curvepoint_8 = PointOnCurve(debrep.Edges, parameter=0.5)
pdecon_14 = Deconstruct(Point=curvepoint_8)  # -> XComponent, YComponent, ZComponent
smaller_5 = SmallerThan(FirstNumber=pdecon_14.XComponent, SecondNumber=Slider(1525, range=0..10000))  # -> SmallerThan, OrEqualTo
cull_15 = CullPattern(List=debrep.Edges, CullPattern=smaller_5.SmallerThan)  # -> simplify(flatten(List))

scale_2 = Scale(Geometry=weld_3, Center=Point(0, 0, 0), Factor=0.001)  # -> Geometry, Transform
scale_3 = Scale(Geometry=cull_15, Center=Point(0, 0, 0), Factor=0.001)  # -> Geometry, Transform
demesh_2 = DeconstructMesh(Mesh=scale_2.Geometry)  # -> flatten(Vertices), Faces, Colours, Normals
crv_cp = CurveClosestPoint(Point=demesh_2.Vertices, Curve=graft(scale_3.Geometry))  # -> Point, Parameter, Distance
equalst = EqualityWithinTolerance(FirstNumber=crv_cp.Distance, SecondNumber=0, Tolerance=0.1)  # -> Equality, Inequality
cull_16 = CullPattern(List=demesh_2.Vertices, CullPattern=equalst.Equality)
pt_11 = Point(cull_16)
cullpt_2 = CullDuplicates(Points=flatten(pt_11), Tolerance=0.01, CullMode=3)  # -> simplify(flatten(Points)), Indices, Valence
geo = Geometry(scale_2.Geometry)

len_7 = TextLength(Text=c_script_20.A)
avr_3 = Average(Input=len_7)
larger_4 = LargerThan(FirstNumber=len_7, SecondNumber=avr_3)  # -> simplify(graft(LargerThan)), OrEqualTo
not_6 = GateNot(A=larger_4.LargerThan)
cull_17 = CullPattern(List=matprops_2, CullPattern=not_6)
cull_18 = CullPattern(List=matprops, CullPattern=larger_4.LargerThan)
merge_20 = Merge(Data1=cull_17, Data2=cull_18)  # -> flatten(Result)

mesh_7 = Mesh(move_24.Geometry)

move_27 = Move(Geometry=mesh_7, Motion=Y_10)  # -> Geometry, Transform

c_script_21 = CSharpScript(mesh=move_27.Geometry, colors=simplify(gradient_13))  # -> out, A; inputs mesh: Mesh, colors: list of Color
# ---------- c_script_21: C# ----------
    for(int i = 0; i < mesh.Vertices.Count; i++)
    {
      mesh.VertexColors.SetColor(i, colors[i]);
    }
    A = mesh;
# ---------- end c_script_21 ----------

# ---- group: Karamba simulation
mesh_8 = Mesh(geo)
supp = SupportKaramba3D(PosInd=cullpt_2.Points, menu=[buttons(on, on, on, on, on, on)])
cross_section = CrossSectionKaramba3D(FamilyNameOfCrossSection="DefaultCroSec", Materials=merge_20, Heights_cm=Slider(2.4, range=0..10), mode="Shell - Var")
loads_2 = LoadsKaramba3D(Vector=rev, Mesh=geo, LCase="0", mode="MeshLoad -Const.", menu=[buttons(off, on, off), buttons(on, on)])
meshtoshell = MeshToShellKaramba3D(Mesh=mesh_8, CrossSection=cross_section, LimitDistance_m=0.005)  # -> Element, Points, Info
assemble = AssembleModelKaramba3D(
    Elem=meshtoshell.Element,
    Support=supp,
    Load=flatten([loads_2, loads]),
    CrossSection=cross_section,
    LimitDistance_m=0.005)  # -> Model, Info, Mass_kg, CenterOfGravity, LoadCaseNames

# ----
analyze = AnalyzeKaramba3D(Model=assemble.Model)  # -> CalculatedModel, MaximumDisplacement_cm, ResultingForceOfGravity_kN, ElasticEnergyChange_kNm

null_3 = NullItem(Item=analyze.MaximumDisplacement_cm)  # -> NullFlags, InvalidFlags, Description
cull_19 = CullPattern(List=Slider(1000, range=0..1000), CullPattern=null_3.NullFlags)
merge_21 = Merge(Data1=analyze.MaximumDisplacement_cm, Data2=cull_19)  # -> flatten(Result)
clean_3 = CleanTree(RemoveNulls=True, RemoveInvalid=True, RemoveEmpty=False, Tree=merge_21)
num_29 = Number(flatten(clean_3))
panel_8 = Panel(num_29)

# ---- group: Karamba simulation (continued)
modelview = ModelViewKaramba3D(Model=analyze.CalculatedModel, ResultFactors=1, ResultCase=-1)  # -> Model, DeformedMesh, DeformedAxes, DeformedModel
shellview = ShellViewKaramba3D(Model=modelview.Model, IndexOfLayer=0)  # -> Model, MeshesOfRenderedShells, LegendColors, LegendTags
mesh_9 = Mesh(shellview.MeshesOfRenderedShells)

# ----
legend = Legend(Colour=shellview.LegendColors, Tags=shellview.LegendTags, LegendType=1)
scale_4 = Scale(Geometry=mesh_9, Center=Point(0, 0, 0), Factor=Slider(1000, range=0..1000))  # -> Geometry, Transform
mesh_10 = Mesh(scale_4.Geometry)
move_28 = Move(Geometry=mesh_10, Motion=X)  # -> Geometry, Transform
