# Grasshopper definition Object Oriented Bilayers.gh (Grasshopper 1.0.7)
# plug-ins: sof_gh_sofistik-2022, HygroDesign, MeshEdit Components, Karamba3D, Kangaroo2 Components, Weaverbird, Human, LunchBox, Pufferfish, Opossum2_0_Proto_A, Heteroptera

io = IO(
    SofistikDocumentProperties_VersionMajor="2022",
    SofistikDocumentProperties_VersionMinor="0",
    SofistikDocumentProperties_VersionName="2022")
update = Button()
python = GhPythonScript(update=update)  # inputs update: Boolean
# ---------- python: Python ----------
# Seghier Mohamed Abdelaziz - 2021 - seghierdesign@gmail.com

import Grasshopper as gh

ghDoc = ghenv.Component.OnPingDocument()
objects = ghDoc.Objects

object = []

for obj in objects: 

    if obj.NickName.Length == 0:
        if str(obj.RemovedFromDocument.DeclaringType) == "Grasshopper.Kernel.GH_Component":
            object.append(obj)
                
if update == True:
    gh.Kernel.GH_Document.NewSolution(ghDoc,False)
    for o in object:
        gh.Kernel.GH_Document.RemoveObject(ghDoc ,o,False)
# ---------- end python ----------

number_slider = Slider(3000, range=0..3000)
number_slider_2 = Slider(11, range=0..30)
number_slider_3 = Slider(150, range=0..200)
xy = XYPlane(Origin=Point(0, 0, 0))
panel = BilayerPanel(
    BasePlane=xy,
    BoardWidth=number_slider_3,
    BoardLength=number_slider,
    WidthCount=number_slider_2,
    LengthCount=Slider(3, range=0..10))

panel_orientation = Panel("-1")

species = WoodSpecies()
item = ListItem(List=species, Index=0, Wrap=True)  # -> Item, Item1

multiplication = Multiplication(A=number_slider_3, B=number_slider_2)

# ---- group: spruce
data = Data(item.Item1)

# ---- group: beech
data_2 = Data(item.Item)

# ----
board_count = Slider(500, range=0..500)

deconstruct_panel = DeconstructPanel(Panel=panel)
dec_board = DeconstructBoard(Board=deconstruct_panel)  # -> Name, Material, Polyline, Radius, MoistureChange, Error, BlendedRadius, Width
area = Area(Geometry=dec_board.Polyline)  # -> Area, Centroid

# ---- group: multi-arc control
pt = Point(area.Centroid)
pdecon = Deconstruct(Point=pt)  # -> XComponent, YComponent, ZComponent
bnd = Bounds(Numbers=flatten(pdecon.XComponent))
number_of_controls = Slider(10, range=0..10)
genes = GenePool(
    Decimals=2,
    Maximum=1,
    Minimum=0,
    Value=[0.0007, 0.003554, 0.987914, 0.999347, 0.034011, 0.011303, 0.9684, 0.434234, 0.999084, 0.970658])
dedomain = DeconstructDomain(Domain=bnd)  # -> Start, End
dom = ConstructDomain(DomainStart=0, DomainEnd=1)
pt_2 = ConstructPoint(XCoordinate=dedomain.Start, YCoordinate=0, ZCoordinate=0)
pt_3 = ConstructPoint(XCoordinate=dedomain.End, YCoordinate=0, ZCoordinate=0)
gnc = PoolController(GenePool=genes, Count=number_of_controls, Range=dom, Randomness=0.1)
ln = Line(StartPoint=pt_2, EndPoint=pt_3)
divide = DivideCurve(Curve=ln, Count=expr("x-1", number_of_controls), Kinks=False)  # -> Points, Tangents, Parameters
Y = UnitY(Factor=genes)
move = Move(Geometry=divide.Points, Motion=Y)  # -> Geometry, Transform
yz = YZPlane(Origin=pt)
intcrv = Interpolate(Vertices=move.Geometry, Degree=3, Periodic=False, KnotStyle=1)  # -> Curve, Length, Domain
pcx = CurvePlane(Curve=intcrv.Curve, Plane=yz)  # -> Points, ParamsC, ParamsP
pdecon_2 = Deconstruct(Point=pcx.Points)  # -> XComponent, YComponent, ZComponent
trim = TrimTree(Tree=pdecon_2.YComponent, Depth=1)  # -> simplify(Tree)

# ---- group: simple attractor curvature optimization
pt_4 = Point(area.Centroid)
pdecon_3 = Deconstruct(Point=pt_4)  # -> XComponent, YComponent, ZComponent
bnd_2 = Bounds(Numbers=flatten(pdecon_3.XComponent))
dedomain_2 = DeconstructDomain(Domain=bnd_2)  # -> Start, End
twn2nums = TweenTwoNumbers(NumberA=dedomain_2.Start, NumberB=dedomain_2.End, Factor=Slider(0, range=0..1))
pdecon_4 = Deconstruct(Point=pt_4)  # -> XComponent, YComponent, ZComponent
subtraction = Subtraction(A=twn2nums, B=pdecon_4.XComponent)
abs = Absolute(Value=subtraction)

# ---- group: desired radius
dom_2 = ConstructDomain(DomainStart=Slider(500, range=0..1000), DomainEnd=Slider(2200, range=0..10000))
remap = RemapNumbers(Value=trim, Source=dom, Target=dom_2)  # -> Mapped, Clipped

# ----
bbox = BoundingBox(Content=flatten(dec_board.Polyline), Plane=PlaneXY(0, 0, 0), UnionBox=True)  # -> Box, Box_2
debox = DeconstructBox(Box=bbox.Box)  # -> Plane, X, Y, Z
dedomain_3 = DeconstructDomain(Domain=debox.X)  # -> Start, End
dedomain_4 = DeconstructDomain(Domain=debox.Y)  # -> Start, End
subtraction_2 = Subtraction(A=dedomain_3.End, B=dedomain_3.Start)
subtraction_3 = Subtraction(A=dedomain_4.End, B=dedomain_4.Start)
panel_2 = Panel(subtraction_2)
panel_3 = Panel(subtraction_3)

# ---- group: calculate weights
pt_5 = Point(area.Centroid)
avr = Average(Input=flatten(pt_5))
pdecon_5 = Deconstruct(Point=pt_5)  # -> XComponent, YComponent, ZComponent
pdecon_6 = Deconstruct(Point=avr)  # -> XComponent, YComponent, ZComponent
subtraction_4 = Subtraction(A=pdecon_5.XComponent, B=pdecon_6.XComponent)
abs_2 = Absolute(Value=subtraction_4)
bnd_3 = Bounds(Numbers=flatten(abs_2))
dom_3 = ConstructDomain(DomainStart=Slider(1, range=0..1000), DomainEnd=Slider(1, range=0..10))
remap_2 = RemapNumbers(Value=abs_2, Source=bnd_3, Target=dom_3)  # -> Mapped, Clipped

pt_6 = Point(area.Centroid)
avr_2 = Average(Input=flatten(pt_6))
pdecon_7 = Deconstruct(Point=pt_6)  # -> XComponent, YComponent, ZComponent
pdecon_8 = Deconstruct(Point=avr_2)  # -> XComponent, YComponent, ZComponent
subtraction_5 = Subtraction(A=pdecon_7.XComponent, B=pdecon_8.XComponent)
abs_3 = Absolute(Value=subtraction_5)
bnd_4 = Bounds(Numbers=flatten(abs_3))
dom_4 = ConstructDomain(DomainStart=Slider(1, range=0..1000), DomainEnd=Slider(1, range=0..10))
remap_3 = RemapNumbers(Value=abs_3, Source=bnd_4, Target=dom_4)  # -> Mapped, Clipped

# ---- group: Material goals / beech
data_3 = Data(data_2)

# ---- group: Material goals / spruce
data_4 = Data(data)

# ---- group: Material goals
pt_7 = Point(area.Centroid)
genes_2 = GenePool(Decimals=2, Maximum=8250, Minimum=750, Value=[5419.14, 755.415])
lng = ListLength(List=flatten(pt_7))
lng_2 = ListLength(List=pt_7)  # -> flatten(Length)
bbox_2 = BoundingBox(Content=flatten(pt_7), Plane=PlaneXY(0, 0, 0), UnionBox=True)  # -> Box, Box_2
number_slider_4 = Slider(2, range=0..10)
debox_2 = DeconstructBox(Box=bbox_2.Box)  # -> Plane, X, Y, Z
dup = DuplicateData(Data=data_3, Number=lng, Order=True)
dup_2 = DuplicateData(Data=data_4, Number=lng, Order=True)
partition = PartitionList(List=dup, Size=lng_2)  # -> simplify(Chunks)
partition_2 = PartitionList(List=dup_2, Size=lng_2)  # -> simplify(Chunks)
dedomain_5 = DeconstructDomain(Domain=debox_2.Y)  # -> Start, End
gnc_2 = PoolController(GenePool=genes_2, Count=number_slider_4, Range=debox_2.X, Randomness=0.1)
rev = ReverseList(List=genes_2)
merge = Merge(Data1=flatten(genes_2), Data2=flatten(rev))
pt_8 = ConstructPoint(XCoordinate=0, YCoordinate=dedomain_5.Start, ZCoordinate=0)
pt_9 = ConstructPoint(XCoordinate=0, YCoordinate=dedomain_5.End, ZCoordinate=0)
ln_2 = Line(StartPoint=pt_8, EndPoint=pt_9)
divide_2 = DivideCurve(Curve=ln_2, Count=expr("(x*2)-1", number_slider_4), Kinks=False)  # -> Points, Tangents, Parameters
pt_10 = Point(pt_7)
X = UnitX(Factor=merge)
move_2 = Move(Geometry=divide_2.Points, Motion=X)  # -> Geometry, Transform
xz = XZPlane(Origin=graft(pt_10))
pline = PolyLine(Vertices=move_2.Geometry, Closed=False)
pcx_2 = CurvePlane(Curve=pline, Plane=xz)  # -> simplify(Points), ParamsC, ParamsP
trim_2 = TrimTree(Tree=pcx_2.Points, Depth=1)
pdecon_9 = Deconstruct(Point=pt_10)  # -> XComponent, YComponent, ZComponent
pdecon_10 = Deconstruct(Point=trim_2)  # -> XComponent, YComponent, ZComponent
smaller = SmallerThan(FirstNumber=pdecon_9.XComponent, SecondNumber=pdecon_10.XComponent)  # -> SmallerThan, OrEqualTo
not = GateNot(A=smaller.SmallerThan)
cull = CullPattern(List=partition, CullPattern=smaller.SmallerThan)
cull_2 = CullPattern(List=partition_2, CullPattern=not)
merge_2 = Merge(Data1=cull, Data2=cull_2)  # -> simplify(Result)

# ---- group: Material goals / beech
data_5 = Data(data_2)

# ---- group: Material goals / spruce
data_6 = Data(data)

# ---- group: Material goals
pt_11 = Point(area.Centroid)
genes_3 = GenePool(Decimals=2, Maximum=8250, Minimum=750, Value=[4336.2675, 5825.385])
lng_3 = ListLength(List=flatten(pt_11))
lng_4 = ListLength(List=pt_11)  # -> flatten(Length)
bbox_3 = BoundingBox(Content=flatten(pt_11), Plane=PlaneXY(0, 0, 0), UnionBox=True)  # -> Box, Box_2
number_slider_5 = Slider(2, range=0..10)
debox_3 = DeconstructBox(Box=bbox_3.Box)  # -> Plane, X, Y, Z
dup_3 = DuplicateData(Data=data_5, Number=lng_3, Order=True)
dup_4 = DuplicateData(Data=data_6, Number=lng_3, Order=True)
partition_3 = PartitionList(List=dup_3, Size=lng_4)  # -> simplify(Chunks)
partition_4 = PartitionList(List=dup_4, Size=lng_4)  # -> simplify(Chunks)
dedomain_6 = DeconstructDomain(Domain=debox_3.Y)  # -> Start, End
gnc_3 = PoolController(GenePool=genes_3, Count=number_slider_5, Range=debox_3.X, Randomness=0.1)
rev_2 = ReverseList(List=genes_3)
merge_3 = Merge(Data1=flatten(genes_3), Data2=flatten(rev_2))
pt_12 = ConstructPoint(XCoordinate=0, YCoordinate=dedomain_6.Start, ZCoordinate=0)
pt_13 = ConstructPoint(XCoordinate=0, YCoordinate=dedomain_6.End, ZCoordinate=0)
ln_3 = Line(StartPoint=pt_12, EndPoint=pt_13)
divide_3 = DivideCurve(Curve=ln_3, Count=expr("(x*2)-1", number_slider_5), Kinks=False)  # -> Points, Tangents, Parameters
pt_14 = Point(pt_11)
X_2 = UnitX(Factor=merge_3)
move_3 = Move(Geometry=divide_3.Points, Motion=X_2)  # -> Geometry, Transform
xz_2 = XZPlane(Origin=graft(pt_14))
pline_2 = PolyLine(Vertices=move_3.Geometry, Closed=False)
pcx_3 = CurvePlane(Curve=pline_2, Plane=xz_2)  # -> simplify(Points), ParamsC, ParamsP
trim_3 = TrimTree(Tree=pcx_3.Points, Depth=1)
pdecon_11 = Deconstruct(Point=pt_14)  # -> XComponent, YComponent, ZComponent
pdecon_12 = Deconstruct(Point=trim_3)  # -> XComponent, YComponent, ZComponent
smaller_2 = SmallerThan(FirstNumber=pdecon_11.XComponent, SecondNumber=pdecon_12.XComponent)  # -> SmallerThan, OrEqualTo
not_2 = GateNot(A=smaller_2.SmallerThan)
cull_3 = CullPattern(List=partition_3, CullPattern=smaller_2.SmallerThan)
cull_4 = CullPattern(List=partition_4, CullPattern=not_2)
merge_4 = Merge(Data1=cull_3, Data2=cull_4)  # -> simplify(Result)

# ---- group: variable curvature tangential and longitudinal
pt_15 = Point(area.Centroid)
pdecon_13 = Deconstruct(Point=pt_15)  # -> XComponent, YComponent, ZComponent
bnd_5 = Bounds(Numbers=flatten(pdecon_13.XComponent))
number_of_controls_2 = Slider(5, range=0..10)
genes_4 = GenePool(Decimals=2, Maximum=1, Minimum=0, Value=[0.54622, 0.82, 0.23, 0.128367, 0.999286])
dedomain_7 = DeconstructDomain(Domain=bnd_5)  # -> Start, End
genes_5 = GenePool(Decimals=2, Maximum=1, Minimum=0, Value=[0.769767, 0.726798, 0.758076, 0.976847, 0.00937])
pt_16 = ConstructPoint(XCoordinate=dedomain_7.Start, YCoordinate=0, ZCoordinate=0)
pt_17 = ConstructPoint(XCoordinate=dedomain_7.End, YCoordinate=0, ZCoordinate=0)
dom_5 = ConstructDomain(DomainStart=0, DomainEnd=1)
ln_4 = Line(StartPoint=pt_16, EndPoint=pt_17)
gnc_4 = PoolController(GenePool=[genes_5, genes_4], Count=number_of_controls_2, Range=dom_5, Randomness=0.1)
divide_4 = DivideCurve(Curve=ln_4, Count=expr("x-1", number_of_controls_2), Kinks=False)  # -> Points, Tangents, Parameters
yz_2 = YZPlane(Origin=pt_15)
Y_2 = UnitY(Factor=genes_4)
Y_3 = UnitY(Factor=genes_5)
move_4 = Move(Geometry=divide_4.Points, Motion=Y_2)  # -> Geometry, Transform
move_5 = Move(Geometry=divide_4.Points, Motion=Y_3)  # -> Geometry, Transform
intcrv_2 = Interpolate(Vertices=move_4.Geometry, Degree=3, Periodic=False, KnotStyle=1)  # -> Curve, Length, Domain
intcrv_3 = Interpolate(Vertices=move_5.Geometry, Degree=3, Periodic=False, KnotStyle=1)  # -> Curve, Length, Domain
pcx_4 = CurvePlane(Curve=intcrv_2.Curve, Plane=yz_2)  # -> Points, ParamsC, ParamsP
pcx_5 = CurvePlane(Curve=intcrv_3.Curve, Plane=yz_2)  # -> Points, ParamsC, ParamsP
pdecon_14 = Deconstruct(Point=pcx_4.Points)  # -> XComponent, YComponent, ZComponent
pdecon_15 = Deconstruct(Point=pcx_5.Points)  # -> XComponent, YComponent, ZComponent
trim_4 = TrimTree(Tree=pdecon_14.YComponent, Depth=1)  # -> simplify(Tree)
trim_5 = TrimTree(Tree=pdecon_15.YComponent, Depth=1)  # -> simplify(Tree)
dom_6 = ConstructDomain(DomainStart=Slider(550, range=0..1000), DomainEnd=Slider(2200, range=0..10000))
remap_4 = RemapNumbers(Value=trim_4, Source=dom_5, Target=dom_6)  # -> Mapped, Clipped
num = Number(pdecon_13.YComponent)
remap_5 = RemapNumbers(Value=trim_5, Source=dom_5, Target=dom_6)  # -> Mapped, Clipped
bnd_6 = Bounds(Numbers=flatten(num))
remap_6 = RemapNumbers(Value=num, Source=bnd_6, Target=Domain(0, 1))  # -> Mapped, Clipped
subtraction_6 = Subtraction(A=remap_6.Mapped, B=Slider(0.5, range=0..1))
abs_4 = Absolute(Value=subtraction_6)
bnd_7 = Bounds(Numbers=flatten(abs_4))
remap_7 = RemapNumbers(Value=abs_4, Source=bnd_7, Target=Domain(0, 1))  # -> Mapped, Clipped
twn2nums_2 = TweenTwoNumbers(NumberA=remap_4.Mapped, NumberB=remap_5.Mapped, Factor=remap_7.Mapped)

pt_18 = Point(area.Centroid)
pdecon_16 = Deconstruct(Point=pt_18)  # -> XComponent, YComponent, ZComponent
bnd_8 = Bounds(Numbers=flatten(pdecon_16.XComponent))
number_of_controls_3 = Slider(5, range=0..10)
genes_6 = GenePool(Decimals=2, Maximum=1, Minimum=0, Value=[0.173059, 0.213607, 0.451052, 0.504462, 0.673996])
dedomain_8 = DeconstructDomain(Domain=bnd_8)  # -> Start, End
genes_7 = GenePool(Decimals=2, Maximum=1, Minimum=0, Value=[0.424078, 0.133357, 0.009076, 0.904306, 0.817079])
pt_19 = ConstructPoint(XCoordinate=dedomain_8.Start, YCoordinate=0, ZCoordinate=0)
pt_20 = ConstructPoint(XCoordinate=dedomain_8.End, YCoordinate=0, ZCoordinate=0)
dom_7 = ConstructDomain(DomainStart=0, DomainEnd=1)
ln_5 = Line(StartPoint=pt_19, EndPoint=pt_20)
gnc_5 = PoolController(GenePool=[genes_7, genes_6], Count=number_of_controls_3, Range=dom_7, Randomness=0.1)
divide_5 = DivideCurve(Curve=ln_5, Count=expr("x-1", number_of_controls_3), Kinks=False)  # -> Points, Tangents, Parameters
yz_3 = YZPlane(Origin=pt_18)
Y_4 = UnitY(Factor=genes_6)
Y_5 = UnitY(Factor=genes_7)
move_6 = Move(Geometry=divide_5.Points, Motion=Y_4)  # -> Geometry, Transform
move_7 = Move(Geometry=divide_5.Points, Motion=Y_5)  # -> Geometry, Transform
intcrv_4 = Interpolate(Vertices=move_6.Geometry, Degree=3, Periodic=False, KnotStyle=1)  # -> Curve, Length, Domain
intcrv_5 = Interpolate(Vertices=move_7.Geometry, Degree=3, Periodic=False, KnotStyle=1)  # -> Curve, Length, Domain
pcx_6 = CurvePlane(Curve=intcrv_4.Curve, Plane=yz_3)  # -> Points, ParamsC, ParamsP
pcx_7 = CurvePlane(Curve=intcrv_5.Curve, Plane=yz_3)  # -> Points, ParamsC, ParamsP
pdecon_17 = Deconstruct(Point=pcx_6.Points)  # -> XComponent, YComponent, ZComponent
pdecon_18 = Deconstruct(Point=pcx_7.Points)  # -> XComponent, YComponent, ZComponent
trim_6 = TrimTree(Tree=pdecon_17.YComponent, Depth=1)  # -> simplify(Tree)
trim_7 = TrimTree(Tree=pdecon_18.YComponent, Depth=1)  # -> simplify(Tree)
dom_8 = ConstructDomain(DomainStart=Slider(550, range=0..1000), DomainEnd=Slider(2200, range=0..10000))
remap_8 = RemapNumbers(Value=trim_6, Source=dom_7, Target=dom_8)  # -> Mapped, Clipped
num_2 = Number(pdecon_16.YComponent)
remap_9 = RemapNumbers(Value=trim_7, Source=dom_7, Target=dom_8)  # -> Mapped, Clipped
bnd_9 = Bounds(Numbers=flatten(num_2))
remap_10 = RemapNumbers(Value=num_2, Source=bnd_9, Target=Domain(0, 1))  # -> Mapped, Clipped
subtraction_7 = Subtraction(A=remap_10.Mapped, B=Slider(0.5, range=0..1))
abs_5 = Absolute(Value=subtraction_7)
bnd_10 = Bounds(Numbers=flatten(abs_5))
remap_11 = RemapNumbers(Value=abs_5, Source=bnd_10, Target=Domain(0, 1))  # -> Mapped, Clipped
twn2nums_3 = TweenTwoNumbers(NumberA=remap_8.Mapped, NumberB=remap_9.Mapped, Factor=remap_11.Mapped)

# ---- group: name
num_3 = Number(board_count)
series = Series(Start=0, Step=1, Count=num_3)
dup_5 = DuplicateData(Data="S", Number=num_3, Order=True)  # -> graft(Data)
txt = Text(graft(series))
merge_5 = Merge(Data1=dup_5, Data2=txt)  # -> simplify(Result)
join = TextJoin(Text=merge_5)  # -> flatten(Result)

# ----
compute_double_curvature = BooleanToggle(False)
compute_structure = BooleanToggle(False)
compute_3d_boards = BooleanToggle(False)

# ---- group: RT
dom_9 = ConstructDomain(DomainStart=Slider(11, range=0..100), DomainEnd=Slider(75, range=0..100))
random = Random(Range=dom_9, Number=board_count, Seed=Slider(225, range=0..1000))

dom_10 = ConstructDomain(DomainStart=Slider(15, range=0..100), DomainEnd=Slider(75, range=0..100))
random_2 = Random(Range=dom_10, Number=board_count, Seed=Slider(225, range=0..1000))

# ---- group: name
num_4 = Number(board_count)
series_2 = Series(Start=0, Step=1, Count=num_4)
dup_6 = DuplicateData(Data="B", Number=num_4, Order=True)  # -> graft(Data)
txt_2 = Text(graft(series_2))
merge_6 = Merge(Data1=dup_6, Data2=txt_2)  # -> simplify(Result)
join_2 = TextJoin(Text=merge_6)  # -> flatten(Result)

# ---- group: length
num_5 = Number(number_slider)
num_6 = Number(board_count)
dup_7 = DuplicateData(Data=num_5, Number=num_6, Order=True)

num_7 = Number(number_slider_3)
num_8 = Number(board_count)
dup_8 = DuplicateData(Data=num_7, Number=num_8, Order=True)

num_9 = Number(number_slider_3)
num_10 = Number(board_count)
dup_9 = DuplicateData(Data=num_9, Number=num_10, Order=True)

num_11 = Number(number_slider)
num_12 = Number(board_count)
dup_10 = DuplicateData(Data=num_11, Number=num_12, Order=True)

# ---- group: moisture changes
panel_4 = Panel("""5
10
15
20""")
num_13 = Number(panel_4)

# ----
series_3 = Series(Start=Slider(1, range=0..1), Step=1, Count=Slider(25, range=0..100))
stockpile = Stockpile(Material=data_2, Name=join_2, Length=dup_7, Width=dup_8, RTAngle=random, MoistureChanges=num_13)
stockpile_2 = Stockpile(Material=data, Name=join, Length=dup_10, Width=dup_9, RTAngle=random_2, MoistureChanges=num_13)
merge_7 = Merge(Data1=stockpile, Data2=stockpile_2)
panel_5 = Panel(smaller.SmallerThan)
update_panel = UpdatePanel(Panel=panel, Radius=twn2nums_2, RadiusWeight=remap_2.Mapped, Material=merge_2, MaterialWeight=remap_2.Mapped)
update_panel_2 = UpdatePanel(Panel=panel, Radius=twn2nums_3, RadiusWeight=remap_3.Mapped, Material=merge_4, MaterialWeight=remap_3.Mapped)
int = Integer(Slider(2, range=0..10))
dup_panel = DuplicatePanel(Panel=update_panel_2, Count=int)
item_2 = ListItem(List=dup_panel, Index=0, Wrap=True)  # -> Item, Item1
merge_8 = Merge(Data1=flatten(item_2.Item), Data2=flatten(update_panel), Data3=flatten(item_2.Item1))

# ---- group: the brains
design_env = DesignEnvironment(Panels=merge_8, Stockpile=merge_7)  # -> Panels, Stockpiles
deconstruct_panel_2 = DeconstructPanel(Panel=design_env.Panels)
dec_board_2 = DeconstructBoard(Board=deconstruct_panel_2)  # -> Name, Material, Polyline, Radius, MoistureChange, Error, BlendedRadius, Width
bnd_11 = Bounds(Numbers=flatten(dec_board_2.Radius))
bnd_12 = Bounds(Numbers=flatten(dec_board_2.Error))
dedomain_9 = DeconstructDomain(Domain=bnd_11)  # -> Start, End
error = Panel(bnd_12)
multiplication_2 = Multiplication(A=dedomain_9.End, B=Slider(1.25, range=0..10))
convolution = CurvatureConvolution(
    Panel=design_env.Panels,
    TengentialBlending=Slider(3, range=0.0001..3),
    LongitudinalBlending=Slider(0.3, range=0.0001..2),
    MaxRadiusInfluence=multiplication_2)  # -> simplify(Panel)
crosecset = UniqueCrossSections(Panel=convolution)
dec_board_3 = DeconstructBoard(Board=crosecset)  # -> Name, Material, Polyline, Radius, MoistureChange, Error, BlendedRadius, Width

# ----
bool = Boolean(compute_double_curvature)
Y_6 = UnitY(Factor=Slider(5000, range=0..10000))
deconstruct_panel_3 = DeconstructPanel(Panel=convolution)
dec_board_4 = DeconstructBoard(Board=deconstruct_panel_3)  # -> Name, Material, Polyline, Radius, MoistureChange, Error, BlendedRadius, Width
bool_2 = Boolean(compute_3d_boards)
python_2 = GhPythonScript(x=data_2)  # -> out, a, b
# ---------- python_2: Python ----------
a = x.LElasticModulus
b = x.RElasticModulus
# ---------- end python_2 ----------
python_3 = GhPythonScript(x=data)  # -> out, a, b; same code as python_2

# ---- group: active layer
ft0 = Slider(80, range=0..100)
gamma = Slider(7.37, range=0..10)
num_14 = Number(Slider(20, range=0..100))

# ---- group: passive layer
ft0_2 = Slider(0, range=0..100)
num_15 = Number(Slider(4, range=0..10))

# ---- group: active layer
ft0_3 = Slider(80, range=0..100)
gamma_2 = Slider(4.21, range=0..10)
num_16 = Number(Slider(20, range=0..100))

# ---- group: passive layer
num_17 = Number(Slider(4, range=0..10))
ft0_4 = Slider(0, range=0..100)

# ---- group: active layer / total thickness
addition = Addition(A=num_14, B=num_15)

addition_2 = Addition(A=num_16, B=num_17)

# ---- group: active layer / distance from bottom
expression = Expression(x=addition, y=num_14, Expression="x - y/2")

expression_2 = Expression(x=addition_2, y=num_16, Expression="x - y/2")

# ---- group: passive layer / distance from bottom
expression_3 = Expression(x=expression, y=addition, Expression="x - y/2")

expression_4 = Expression(x=expression_2, y=addition_2, Expression="x - y/2")

# ---- group: active layer / CG from bottom
division = Division(A=addition, B=2)

division_2 = Division(A=addition_2, B=2)

# ---- group: passive layer / dist from CG
subtraction_8 = Subtraction(A=expression_3, B=division)
abs_6 = Absolute(Value=subtraction_8)

subtraction_9 = Subtraction(A=expression_4, B=division_2)
abs_7 = Absolute(Value=subtraction_9)

# ---- group: active layer / dist from CG
subtraction_10 = Subtraction(A=expression, B=division)
abs_8 = Absolute(Value=subtraction_10)

subtraction_11 = Subtraction(A=expression_2, B=division_2)
abs_9 = Absolute(Value=subtraction_11)

# ---- group: active layer / l
expression_5 = Expression(x=num_14, Expression="1000*x^3/12")

# ---- group: passive layer / l
expression_6 = Expression(x=num_15, Expression="1000*x^3/12")

# ---- group: passive layer / Ax2
expression_7 = Expression(x=num_15, y=abs_6, Expression="1000*x*y^2")

# ----
number_slider_6 = Slider(0.001, range=0..0.001)

# ---- group: active layer / l
expression_8 = Expression(x=num_16, Expression="1000*x^3/12")

# ---- group: passive layer / l
expression_9 = Expression(x=num_17, Expression="1000*x^3/12")

# ---- group: passive layer / Ax2
expression_10 = Expression(x=num_17, y=abs_7, Expression="1000*x*y^2")

# ---- group: active layer / Ax2
expression_11 = Expression(x=num_14, y=abs_8, Expression="1000*x*y^2")

# ----
bool_3 = Boolean(compute_structure)

# ---- group: active layer / Ax2
expression_12 = Expression(x=num_16, y=abs_9, Expression="1000*x*y^2")

# ---- group: active layer / total l
addition_3 = Addition(A=expression_5, B=expression_11)

addition_4 = Addition(A=expression_8, B=expression_12)

# ---- group: passive layer / total l
addition_5 = Addition(A=expression_6, B=expression_7)

addition_6 = Addition(A=expression_9, B=expression_10)

# ---- group: active layer / El0
multiplication_3 = Multiplication(A=python_2.a, B=addition_3)

# ---- group: active layer / T x ft0
multiplication_4 = Multiplication(A=num_14, B=ft0)

# ---- group: active layer / T x Gam
multiplication_5 = Multiplication(A=gamma, B=num_14)

# ---- group: passive layer / El0
multiplication_6 = Multiplication(A=python_3.b, B=addition_5)

# ---- group: passive layer / El90
multiplication_7 = Multiplication(A=python_3.a, B=addition_5)

# ---- group: passive layer / T x ft0
multiplication_8 = Multiplication(A=num_15, B=ft0_2)

# ---- group: active layer / El90
multiplication_9 = Multiplication(A=python_2.b, B=addition_3)

# ---- group: active layer / El0
multiplication_10 = Multiplication(A=python_3.a, B=addition_4)

# ---- group: active layer / T x ft0
multiplication_11 = Multiplication(A=num_16, B=ft0_3)

# ---- group: active layer / T x Gam
multiplication_12 = Multiplication(A=gamma_2, B=num_16)

# ---- group: passive layer / El0
multiplication_13 = Multiplication(A=python_3.b, B=addition_6)

# ---- group: passive layer / El90
multiplication_14 = Multiplication(A=python_3.a, B=addition_6)

# ---- group: passive layer / T x ft0
multiplication_15 = Multiplication(A=num_17, B=ft0_4)

# ---- group: active layer / El90
multiplication_16 = Multiplication(A=python_3.b, B=addition_4)

# ---- group: effective material properties / El0 eff (Nmm2)
addition_7 = Addition(A=multiplication_3, B=multiplication_6)

# ---- group: effective material properties / El90 eff (Nmm2)
addition_8 = Addition(A=multiplication_9, B=multiplication_7)

# ---- group: effective material properties / Sum T x Ft0
addition_9 = Addition(A=multiplication_4, B=multiplication_8)

# ---- group: effective material properties / total thickness
addition_10 = Addition(A=num_14, B=num_15)

# ---- group: effective material properties / El0 eff (Nmm2)
addition_11 = Addition(A=multiplication_10, B=multiplication_13)

# ---- group: effective material properties / El90 eff (Nmm2)
addition_12 = Addition(A=multiplication_16, B=multiplication_14)

# ---- group: effective material properties / Sum T x Ft0
addition_13 = Addition(A=multiplication_11, B=multiplication_15)

# ---- group: effective material properties / total thickness
addition_14 = Addition(A=num_16, B=num_17)

# ---- group: effective material properties / Sum Tx Gam
addition_15 = Addition(A=multiplication_5)

addition_16 = Addition(A=multiplication_12)

# ---- group: effective material properties / lx / ly
expression_13 = Expression(x=addition_10, Expression="1000*x^3/12")

expression_14 = Expression(x=addition_14, Expression="1000*x^3/12")

# ---- group: effective material properties / E0eff
division_3 = Division(A=addition_7, B=expression_13)

# ---- group: effective material properties / E90eff
division_4 = Division(A=addition_8, B=expression_13)

# ---- group: effective material properties / ft eff
division_5 = Division(A=addition_9, B=addition_10)

# ---- group: effective material properties / E0eff
division_6 = Division(A=addition_11, B=expression_14)

# ---- group: effective material properties / E90eff
division_7 = Division(A=addition_12, B=expression_14)

# ---- group: effective material properties / Gamma eff
division_8 = Division(A=addition_16, B=addition_14)

# ---- group: effective material properties / ft eff
division_9 = Division(A=addition_13, B=addition_14)

# ---- group: effective material properties
matprops = MaterialPropertiesKaramba3D(
    FamilyOfMaterial="Spruce / Spruce",
    Name="Spruce / Spruce",
    ElementIdentifier="Spruce / Spruce",
    YoungsModulusKNCm2Dir1=expr("x*0.1", division_6),
    YoungsModulusKNCm2Dir2=expr("x*0.1", division_7),
    InPlaneShearModulus_kN_cm2="42",
    InPlaneLateralContractionCoefficient=Slider(0.012, range=0..0.1, expression="0.012"),
    TransverseShearModulusKNCm2Dir1="5",
    TransverseShearModulusKNCm2Dir2="5",
    SpecificWeight_kN_m3=division_8,
    CoefficientOfThermalExpansion1CDir1=1.2e-05,
    CoefficientOfThermalExpansion1CDir2=1.2e-05,
    TensileStrengthKNCm2Dir1=division_9,
    TensileStrengthKNCm2Dir2=division_9,
    CompressiveStrengthKNCm2Dir1=-23.5,
    CompressiveStrengthKNCm2Dir2=-23.5,
    ShearStrengthKNCm2Dir12=13.6,
    TsaiWuIntCoeff=0,
    StrengthHypothesis="MISES",
    mode="Orthotropic")  # -> flatten(Material)

# ---- group: effective material properties / Gamma eff
division_10 = Division(A=addition_15, B=addition_10)

# ---- group: effective material properties
matprops_2 = MaterialPropertiesKaramba3D(
    FamilyOfMaterial="Beech / Spruce",
    Name="Beech / Spruce",
    ElementIdentifier="Beech / Spruce",
    YoungsModulusKNCm2Dir1=expr("x*0.1", division_3),
    YoungsModulusKNCm2Dir2=expr("x*0.1", division_4),
    InPlaneShearModulus_kN_cm2="47",
    InPlaneLateralContractionCoefficient=Slider(0.012, range=0..0.1, expression="0.012"),
    TransverseShearModulusKNCm2Dir1="5",
    TransverseShearModulusKNCm2Dir2="5",
    SpecificWeight_kN_m3=division_10,
    CoefficientOfThermalExpansion1CDir1=1.2e-05,
    CoefficientOfThermalExpansion1CDir2=1.2e-05,
    TensileStrengthKNCm2Dir1=division_5,
    TensileStrengthKNCm2Dir2=division_5,
    CompressiveStrengthKNCm2Dir1=-23.5,
    CompressiveStrengthKNCm2Dir2=-23.5,
    ShearStrengthKNCm2Dir12=13.6,
    TsaiWuIntCoeff=0,
    StrengthHypothesis="MISES",
    mode="Orthotropic")  # -> flatten(Material)

# ----
txt_3 = Text(flatten(dec_board_2.Material))
number_slider_7 = Slider(1, range=0..10)
multiplication_17 = Multiplication(A=Slider(1.5, range=0..10), B="1.35")
multiplication_18 = Multiplication(A="-9.8", B="1.35")
Z = UnitZ(Factor=multiplication_17)
Z_2 = UnitZ(Factor=multiplication_18)
rev_3 = Reverse(Vector=Z)
loads = LoadsKaramba3D(Vector=Z_2, LCase="0", mode="Gravity")
movopossum_3_0_0 = Opossum(
    OpossumData_OptimizationType=0,
    OpossumData_ResultSerializationStatus=0,
    OpossumData_objective=num_28,
    OpossumData_variable=[genes_6, genes_7, genes_5, genes_4, genes_2, genes_3])
X_3 = UnitX(Factor=Slider(10000, range=0..10000))

crv = Curve(dec_board_3.Polyline)
area_2 = Area(Geometry=crv)  # -> Area, Centroid
avr_3 = Average(Input=area_2.Centroid)
bbox_4 = BoundingBox(Content=flatten(avr_3), Plane=PlaneXY(0, 0, 0), UnionBox=True)  # -> Box, Box_2
debox_4 = DeconstructBox(Box=bbox_4.Box)  # -> Plane, X, Y, Z
dedomain_10 = DeconstructDomain(Domain=debox_4.X)  # -> Start, End
subtraction_12 = Subtraction(A=dedomain_10.End, B=dedomain_10.Start)

trim_8 = TrimTree(Tree=crv, Depth=1)

bbox_5 = BoundingBox(Content=trim_8, Plane=PlaneXY(0, 0, 0), UnionBox=True)  # -> Box, Box_2
debox_5 = DeconstructBox(Box=bbox_5.Box)  # -> Plane, X, Y, Z
dedomain_11 = DeconstructDomain(Domain=debox_5.X)  # -> Start, End
subtraction_13 = Subtraction(A=dedomain_11.End, B=dedomain_11.Start)
area_3 = Area(Geometry=bbox_5.Box)  # -> Area, Centroid
division_11 = Division(A=subtraction_13, B=subtraction_12)
scale = Scale(Geometry=avr_3, Center=area_3.Centroid, Factor=division_11)  # -> Geometry, Transform
yz_4 = YZPlane(Origin=scale.Geometry)

num_18 = Number(dec_board_3.Width)
pln = Plane(yz_4)
num_19 = Number(dec_board_3.BlendedRadius)
c_script = CSharpScript(iRadii=num_19, iBoardWidth=num_18, iPlanes=pln)  # -> out, simplify(A); inputs iRadii: tree of Double, iBoardWidth: tree of Double, iPlanes: tree of Plane
# ---------- c_script: C# ----------
    DataTree<Point3d> pointTree = new DataTree<Point3d>();

    for (int j = 0; j < iRadii.BranchCount; j++)
    {

      //initialize variables
      Plane bp = iPlanes.Branch(j)[0];
      Point3d startPoint = new Point3d(bp.Origin);
      Point3d centerPoint = startPoint;
      Vector3d rotationAxis = new Vector3d(bp.ZAxis);
      Vector3d centerPointVect = new Vector3d(bp.YAxis);
      centerPointVect.Rotate(Math.PI / 2, rotationAxis);

      for (int i = 0; i < iRadii.Branch(j).Count; i++){
        GH_Path pth = iRadii.Paths[j].AppendElement(i);
        Point3d point1 = startPoint;
        Point3d point2 = startPoint;

        pointTree.Add(point1, pth);

        //calculate rotation angle
        Double arcLength = iBoardWidth.Branch(j)[i];
        Double radius = iRadii.Branch(j)[i];
        Double rotation = (arcLength / radius);

        //calculate rotation center point
        centerPointVect.Unitize();
        centerPointVect *= radius;
        centerPoint += centerPointVect;


        //execute half rotation
        Transform tx = Transform.Rotation(rotation / 2, rotationAxis, centerPoint);


        point2.Transform(tx);
        pointTree.Add(point2, pth);

        //execute full rotation
        tx = Transform.Rotation(rotation, rotationAxis, centerPoint);
        startPoint.Transform(tx);
        pointTree.Add(startPoint, pth);

        //updata rotation parameters
        centerPoint = startPoint;
        centerPointVect.Transform(tx);
      }
    }
    A = pointTree;
# ---------- end c_script ----------

trim_9 = TrimTree(Tree=c_script.A, Depth=1)
cullpt = CullDuplicates(Points=trim_9, Tolerance=0.1, CullMode=3)  # -> Points, Indices, Valence
pt_21 = Point(cullpt.Points)

# ---- group: animate
pt_22 = Point(simplify(pt_21))
pln_2 = Plane(graft(pln))
num_20 = Number(Slider(1, range=0..1))
c_script_2 = CSharpScript(iPoints=simplify(pt_22), iPlanes=pln_2, iShapeFactor=num_20)  # -> out, A; inputs iPoints: tree of Point3d, iPlanes: tree of Plane, iShapeFactor: Double
# ---------- c_script_2: C# ----------
    DataTree<Point3d> output = new DataTree<Point3d>();
    
    double shapeFactor = 1.0 - iShapeFactor;

    //step through curves
    for (int i = 0; i < iPoints.BranchCount; i++)
    {
      Plane currentPlane = iPlanes.Branch(iPoints.Path(i)[0])[0];

      //get vectors from plane
      Vector3d zVect = currentPlane.YAxis;

      Vector3d rotVect = currentPlane.ZAxis;

      //create new startpoint inside list
      Point3d startPoint = iPoints.Branch(i)[0];

      //step through points. Create and rotate vectors
      for (int j = 0; j < iPoints.Branch(i).Count; j++)
      {
        if (j == 0) output.Add(startPoint, iPoints.Path(i));
        else{
          //create current segment vector
          Vector3d segmentVect = new Vector3d(iPoints.Branch(i)[j] - iPoints.Branch(i)[j - 1]);

          //measure angle with vertical vector
          double angle = Vector3d.VectorAngle(zVect, segmentVect, currentPlane);

          //rotate
          segmentVect.Rotate(-angle * shapeFactor, rotVect);

          startPoint += segmentVect;
          output.Add(startPoint, iPoints.Path(i));
        }
      }
    }

    A = output;
# ---------- end c_script_2 ----------
pt_23 = Point(c_script_2.A)
intcrv_6 = Interpolate(Vertices=pt_23, Degree=3, Periodic=False, KnotStyle=1)  # -> Curve, Length, Domain
crv_2 = Curve(intcrv_6.Curve)

# ----
crv_3 = Curve(crv_2)
pt_24 = Point(simplify(graft(scale.Geometry)))
end = EndPoints(Curve=crv_3)  # -> Start, End
vec2pt = Vector2Pt(PointA=end.Start, PointB=end.End, Unitize=False)  # -> Vector, Length
yz_5 = YZPlane(Origin=end.Start)
Y_7 = UnitY(Factor=panel_orientation)
angle = Angle(VectorA=vec2pt.Vector, VectorB=Y_7, Plane=yz_5)  # -> Angle, Reflex
rotate = Rotate(Geometry=crv_3, Angle=angle.Angle, Plane=yz_5)  # -> Geometry, Transform
curvepoint = PointOnCurve(rotate.Geometry, parameter=0.5)
vec2pt_2 = Vector2Pt(PointA=curvepoint, PointB=pt_24, Unitize=False)  # -> Vector, Length
move_8 = Move(Geometry=rotate.Geometry, Motion=vec2pt_2.Vector)  # -> Geometry, Transform
trim_10 = TrimTree(Tree=move_8.Geometry, Depth=1)
crv_4 = Curve(reverse(trim_10))
loft = Loft(Curves=crv_4, Options={Adjust=False, Closed=False, LoftEnds=0, LoftSimp=0, LoftType=2, Rebuild=10, Refit=0.01})

cull_5 = CullPattern(List=loft, CullPattern=bool)

number_slider_8 = Slider(8, range=0..100)
srf = Surface(cull_5)
num_21 = Number(number_slider_2)
quads = QuadPanels(Surface=srf, UDivisions=number_slider_8, VDivisions=num_21)
srf_2 = Surface(reparameterize(simplify(quads)))

smesh = SimpleMesh(Brep=srf_2)

area_4 = MeshArea(Mesh=smesh)  # -> Area, Centroid
meshcp = MeshClosestPoint(Point=area_4.Centroid, Mesh=smesh)  # -> Point, Index, Parameter
meval = MeshEval(Mesh=smesh, Parameter=meshcp.Parameter)  # -> Point, Normal, Colour
pl = PlaneNormal(Origin=meval.Point, ZAxis=meval.Normal)
X_4 = UnitX(Factor=1)
deplane = DeconstructPlane(Plane=pl)  # -> Origin, XAxis, YAxis, ZAxis
angle_2 = Angle(VectorA=deplane.XAxis, VectorB=X_4, Plane=pl)  # -> Angle, Reflex
rotate_2 = Rotate(Geometry=pl, Angle=angle_2.Angle, Plane=pl)  # -> graft(Geometry), Transform

medges = MeshEdges(Mesh=smesh)  # -> simplify(NakedEdges), InteriorEdges, NonManifoldEdges
curvepoint_2 = PointOnCurve(medges.NakedEdges, parameter=0.5)
plcoord = PlaneCoordinates(Point=curvepoint_2, System=rotate_2.Geometry)  # -> XCoordinate, YCoordinate, ZCoordinate
sort = SortList(Keys=plcoord.XCoordinate, ValuesA=medges.NakedEdges)  # -> Keys, ValuesA
sort_2 = SortList(Keys=plcoord.YCoordinate, ValuesA=medges.NakedEdges)  # -> Keys, ValuesA
item_3 = ListItem(List=reverse(sort.ValuesA), Index=0, Wrap=True)
item_4 = ListItem(List=reverse(sort_2.ValuesA), Index=0, Wrap=True)
item_5 = ListItem(List=sort.ValuesA, Index=0, Wrap=True)
item_6 = ListItem(List=sort_2.ValuesA, Index=0, Wrap=True)

merge_9 = Merge(Data1=item_5, Data2=item_3)
trim_11 = TrimTree(Tree=merge_9, Depth=1)
rdlines = RemoveDuplicateLinesKaramba3D(Line=trim_11, LimitDistance=0.005)  # -> OutLine, Info, Indexes
join_3 = JoinCurves(Curves=rdlines.OutLine, Preserve=False)
explode = Explode(Curve=join_3, Recursive=True)  # -> Segments, simplify(Vertices)
pline_3 = PolyLine(Vertices=explode.Vertices, Closed=False)  # -> simplify(graft(Polyline))
trim_12 = TrimTree(Tree=pline_3, Depth=1)
curvepoint_3 = PointOnCurve(trim_12, parameter=0.5)
pdecon_19 = Deconstruct(Point=curvepoint_3)  # -> XComponent, YComponent, ZComponent
sort_3 = SortList(Keys=pdecon_19.XComponent, ValuesA=trim_12)  # -> Keys, ValuesA
crv_5 = Curve(sort_3.ValuesA)

merge_10 = Merge(Data1=item_6, Data2=item_4)
trim_13 = TrimTree(Tree=merge_10, Depth=1)
rdlines_2 = RemoveDuplicateLinesKaramba3D(Line=trim_13, LimitDistance=0.005)  # -> OutLine, Info, Indexes
join_4 = JoinCurves(Curves=rdlines_2.OutLine, Preserve=False)
explode_2 = Explode(Curve=join_4, Recursive=True)  # -> Segments, Vertices
pline_4 = PolyLine(Vertices=explode_2.Vertices, Closed=False)  # -> simplify(Polyline)
trim_14 = TrimTree(Tree=pline_4, Depth=1)
curvepoint_4 = PointOnCurve(trim_14, parameter=0.5)
pdecon_20 = Deconstruct(Point=curvepoint_4)  # -> XComponent, YComponent, ZComponent
sort_4 = SortList(Keys=pdecon_20.YComponent, ValuesA=trim_14)  # -> Keys, ValuesA
crv_6 = Curve(sort_4.ValuesA)

crv_7 = Curve(crv_5)
item_7 = ListItem(List=crv_7, Index=0, Wrap=True)
curvepoint_5 = PointOnCurve(crv_7, parameter=0.5)
curvepoint_6 = PointOnCurve(item_7, parameter=0.5)
vec2pt_3 = Vector2Pt(PointA=curvepoint_6, PointB=curvepoint_5, Unitize=False)  # -> Vector, Length
move_9 = Move(Geometry=item_7, Motion=vec2pt_3.Vector)  # -> Geometry, Transform

crv_8 = Curve(crv_5)
flip = FlipCurve(Curve=crv_8, Guide=move_9.Geometry)  # -> Curve, Flag

explode_3 = Explode(Curve=flip.Curve, Recursive=True)  # -> simplify(Segments), Vertices
explode_4 = Explode(Curve=move_9.Geometry, Recursive=True)  # -> simplify(Segments), Vertices
lng_5 = ListLength(List=explode_3.Segments)
lng_6 = ListLength(List=explode_3.Segments)
lng_7 = ListLength(List=explode_4.Segments)
lng_8 = ListLength(List=explode_4.Segments)
subtraction_14 = Subtraction(A=lng_5, B=2)
subtraction_15 = Subtraction(A=lng_6, B=1)
subtraction_16 = Subtraction(A=lng_7, B=2)
subtraction_17 = Subtraction(A=lng_8, B=1)
dom_11 = ConstructDomain(DomainStart=0, DomainEnd=subtraction_14)
dom_12 = ConstructDomain(DomainStart=1, DomainEnd=subtraction_15)
dom_13 = ConstructDomain(DomainStart=0, DomainEnd=subtraction_16)
dom_14 = ConstructDomain(DomainStart=1, DomainEnd=subtraction_17)
subset = SubList(List=explode_3.Segments, Domain=dom_11, Wrap=True)  # -> List, Index
subset_2 = SubList(List=explode_3.Segments, Domain=dom_12, Wrap=True)  # -> List, Index
subset_3 = SubList(List=explode_4.Segments, Domain=dom_13, Wrap=True)  # -> List, Index
subset_4 = SubList(List=explode_4.Segments, Domain=dom_14, Wrap=True)  # -> List, Index
angle_3 = Angle(VectorA=subset_3.List, VectorB=subset_4.List)  # -> simplify(Angle), Reflex
angle_4 = Angle(VectorA=subset.List, VectorB=subset_2.List)  # -> simplify(Angle), Reflex
num_22 = Number(angle_3.Angle)
num_23 = Number(angle_4.Angle)

explode_5 = Explode(Curve=flip.Curve, Recursive=True)  # -> simplify(Segments), Vertices
explode_6 = Explode(Curve=move_9.Geometry, Recursive=True)  # -> simplify(Segments), Vertices
path_mapper = PathMapper(explode_5.Segments, source=["{A}(i)", "{A;B}(i)"], target=["{i}(A)", "{A;i}(B)"])
path_mapper_2 = PathMapper(explode_6.Segments, source=["{A}(i)", "{A;B}(i)"], target=["{i}(A)", "{A;i}(B)"])
crv_9 = Curve(path_mapper_2)
crv_10 = Curve(path_mapper)
lng_9 = ListLength(List=crv_10)  # -> expr("x-2", Length)
lng_10 = ListLength(List=crv_9)  # -> expr("x-2", Length)
lng_11 = ListLength(List=crv_10)  # -> expr("x-1", Length)
lng_12 = ListLength(List=crv_9)  # -> expr("x-1", Length)
dom_15 = ConstructDomain(DomainStart=0, DomainEnd=lng_9)
dom_16 = ConstructDomain(DomainStart=0, DomainEnd=lng_10)
dom_17 = ConstructDomain(DomainStart=1, DomainEnd=lng_11)
dom_18 = ConstructDomain(DomainStart=1, DomainEnd=lng_12)
subset_5 = SubList(List=crv_10, Domain=dom_15, Wrap=True)  # -> graft(List), Index
subset_6 = SubList(List=crv_9, Domain=dom_16, Wrap=True)  # -> graft(List), Index
subset_7 = SubList(List=crv_10, Domain=dom_17, Wrap=True)  # -> graft(List), Index
subset_8 = SubList(List=crv_9, Domain=dom_18, Wrap=True)  # -> graft(List), Index
loft_2 = Loft(
    Curves=[subset_5.List, subset_7.List],
    Options={Adjust=False, Closed=False, LoftEnds=0, LoftSimp=0, LoftType=0, Rebuild=10, Refit=0.01})  # -> simplify(Loft)
loft_3 = Loft(
    Curves=[subset_6.List, subset_8.List],
    Options={Adjust=False, Closed=False, LoftEnds=0, LoftSimp=0, LoftType=0, Rebuild=10, Refit=0.01})  # -> simplify(Loft)
smesh_2 = SimpleMesh(Brep=loft_2)
smesh_3 = SimpleMesh(Brep=loft_3)
path_mapper_3 = PathMapper(smesh_3, source=["{A;B;C}", "{A;B}"], target=["{A}", "{0}"])
path_mapper_4 = PathMapper(smesh_2, source=["{A;B;C}", "{A;B}"], target=["{A}", "{0}"])
mjoin = MeshJoin(Meshes=path_mapper_3)
mjoin_2 = MeshJoin(Meshes=path_mapper_4)
weld = WeldMesh(Mesh=mjoin, Angle=3.141592654)
weld_2 = WeldMesh(Mesh=mjoin_2, Angle=3.141592654)

explode_7 = Explode(Curve=move_9.Geometry, Recursive=True)  # -> Segments, Vertices
num_24 = Number(num_23)
num_25 = Number(num_22)
mesh = Mesh(weld)
path_mapper_5 = PathMapper(explode_7.Vertices, source=["{A;B}(i)", "{A}(i)"], target=["{A;i}(B)", "{i}(A)"])
division_12 = Division(A=num_24, B=num_25)
avr_4 = Average(Input=division_12)
number_slider_9 = Slider(10, range=0..100000)
pline_5 = PolyLine(Vertices=path_mapper_5, Closed=False)  # -> simplify(Polyline)
trim_15 = TrimTree(Tree=avr_4, Depth=1)
path_mapper_6 = PathMapper(pline_5, source=["{A;B}", "{A}"], target=["{A}", "{0}"])
crv_11 = Curve(move_9.Geometry)
show = Show(G=mesh)
rod = Rod(
    Polyline=path_mapper_6,
    LengthFactor=1,
    AngleFactor=1,
    AxialStrength=number_slider_9,
    BendStrength=Slider(10000, range=0..10000))
rod_2 = Rod(
    Polyline=crv_11,
    LengthFactor=1,
    AngleFactor=trim_15,
    AxialStrength=number_slider_9,
    BendStrength=Slider(10000, range=0..10000))
path_mapper_7 = PathMapper(rod, source=["{A;B}", "{A}"], target=["{A}", "{0}"])
path_mapper_8 = PathMapper(rod_2, source=["{A;B}", "{A}"], target=["{A}", "{0}"])
merge_11 = Merge(Data1=path_mapper_7, Data2=path_mapper_8, Data3=show)

zombiesolver = ZombieSolver(GoalObjects=merge_11, Threshold=1e-10, Tolerance=0.0001, MaxIterations=Slider(5000, range=0..100000))  # -> I, V, O
mesh_2 = Mesh(zombiesolver.O)
clean = CleanTree(RemoveNulls=True, RemoveInvalid=True, RemoveEmpty=False, Tree=mesh_2)

mesh_3 = Mesh(simplify(graft(clean)))

merge_12 = Merge(Data1=simplify(graft(clean)), Data2=weld_2)
wbedges = WeaverbirdsMeshEdges(MeshOrPolylines=graft(merge_12))
c_script_3 = CSharpScript(tree=wbedges)  # -> out, A, B; inputs tree: tree
# ---------- c_script_3: C# ----------
    DataTree<object> even = new DataTree<object>();
    DataTree<object> odd = new DataTree<object>();
    
    for(int i = 0; i < tree.BranchCount; i++)
    {
      if(tree.Paths[i][1] == 0)even.AddRange(tree.Branch(i), tree.Paths[i]);
      else odd.AddRange(tree.Branch(i), tree.Paths[i]);
    }
    A = even;
    B = odd;
# ---------- end c_script_3 ----------
len = Length(Curve=c_script_3.B)
len_2 = Length(Curve=c_script_3.A)
group = Group(Objects=c_script_3.A)  # -> flatten(Group)
lng_13 = ListLength(List=group)
subtraction_18 = Subtraction(A=len, B=len_2)
series_4 = Series(Start=0, Step=Slider(2300, range=0..10000), Count=lng_13)
smaller_3 = SmallerThan(FirstNumber=subtraction_18, SecondNumber=0)  # -> SmallerThan, OrEqualTo
Y_8 = UnitY(Factor=series_4)
dispatch = Dispatch(List=subtraction_18, DispatchPattern=smaller_3.SmallerThan)  # -> ListA, ListB
move_10 = Move(Geometry=group, Motion=Y_8)  # -> Geometry, Transform
ungroup = Ungroup(Group=move_10.Geometry)
bnd_13 = Bounds(Numbers=dispatch.ListA)
bnd_14 = Bounds(Numbers=dispatch.ListB)
dedomain_12 = DeconstructDomain(Domain=bnd_13)  # -> Start, End
dedomain_13 = DeconstructDomain(Domain=bnd_14)  # -> Start, End
gradient = Gradient(
    LowerLimit=dedomain_12.Start,
    UpperLimit=dedomain_12.End,
    Parameter=dispatch.ListA,
    stops=[0: RGB(234, 38, 0), 0.499: RGB(234, 126, 0), 1: RGB(254, 244, 84), 1: RGB(75, 107, 169), 1: RGB(173, 203, 249)])
dispatch_2 = Dispatch(List=ungroup, DispatchPattern=smaller_3.SmallerThan)  # -> ListA, ListB
gradient_2 = Gradient(
    LowerLimit=dedomain_13.Start,
    UpperLimit=dedomain_13.End,
    Parameter=dispatch.ListB,
    stops=[0: RGB(254, 244, 84), 0.501: RGB(173, 203, 249), 1: RGB(75, 107, 169)])
previewlw = CustomPreviewLineweights(Geometry=dispatch_2.ListA, Shader=gradient, Thickness=3, Absolute=False)
previewlw_2 = CustomPreviewLineweights(Geometry=dispatch_2.ListB, Shader=gradient_2, Thickness=3, Absolute=False)

crv_12 = Curve(c_script_3.A)
end_2 = EndPoints(Curve=crv_12)  # -> Start, End
pdecon_21 = Deconstruct(Point=end_2.Start)  # -> XComponent, YComponent, ZComponent
pdecon_22 = Deconstruct(Point=end_2.End)  # -> XComponent, YComponent, ZComponent
subtraction_19 = Subtraction(A=pdecon_21.XComponent, B=pdecon_22.XComponent)
abs_10 = Absolute(Value=subtraction_19)
smaller_4 = SmallerThan(FirstNumber=abs_10, SecondNumber=Slider(100, range=0..100))  # -> SmallerThan, OrEqualTo
cull_6 = CullPattern(List=crv_12, CullPattern=smaller_4.SmallerThan)
join_5 = JoinCurves(Curves=cull_6, Preserve=False)
curvepoint_7 = PointOnCurve(join_5, parameter=0.5)
pdecon_23 = Deconstruct(Point=curvepoint_7)  # -> XComponent, YComponent, ZComponent
sort_5 = SortList(Keys=pdecon_23.XComponent, ValuesA=join_5)  # -> Keys, ValuesA
explode_8 = Explode(Curve=sort_5.ValuesA, Recursive=True)  # -> Segments, simplify(Vertices)
intcrv_7 = Interpolate(Vertices=explode_8.Vertices, Degree=3, Periodic=False, KnotStyle=1)  # -> Curve, Length, Domain
path_mapper_9 = PathMapper(intcrv_7.Curve, source=["{A;B}", "{A}"], target=["{A}", "{0}"])
loft_4 = Loft(Curves=path_mapper_9, Options={Adjust=False, Closed=False, LoftEnds=0, LoftSimp=0, LoftType=0, Rebuild=10, Refit=0.01})

mesh_4 = Mesh(mesh_3)
num_26 = Number(expr("x+1", number_slider_8))
medges_2 = MeshEdges(Mesh=mesh_4)  # -> NakedEdges, InteriorEdges, NonManifoldEdges
demesh = DeconstructMesh(Mesh=mesh_4)  # -> Vertices, Faces, Colours, Normals
join_6 = JoinCurves(Curves=medges_2.NakedEdges, Preserve=False)
patch = Patch(Curves=join_6, Points=demesh.Vertices, Spans=num_26, Flexibility=Slider(1, range=0..1), Trim=True)
srf_3 = Surface(simplify(patch))

# ---- group: control gate
srf_4 = Surface(loft_4)
srf_5 = Surface(loft)
bool_4 = Boolean(compute_double_curvature)
not_3 = GateNot(A=bool_4)
cull_7 = CullPattern(List=srf_5, CullPattern=not_3)
merge_13 = Merge(Data1=srf_4, Data2=cull_7)

# ----
cull_8 = CullPattern(List=merge_13, CullPattern=bool_2)

crv_13 = Curve(dec_board_4.Polyline)
srf_6 = Surface(reparameterize(graft(cull_8)))
explode_9 = Explode(Curve=crv_13, Recursive=True)  # -> Segments, Vertices
len_3 = Length(Curve=explode_9.Segments)
path_mapper_10 = PathMapper(crv_13, source=["{A;B}", "{A}"], target=["{A}", "{0}"])
division_13 = Division(A=len_3, B=Slider(50, range=0..100))
runion = RegionUnion(Curves=path_mapper_10)
divide_6 = DivideCurve(Curve=explode_9.Segments, Count=division_13, Kinks=False)  # -> Points, Tangents, Parameters
path_mapper_11 = PathMapper(divide_6.Points, source=["{A;B;C;D}", "{A;B;C}"], target=["{A}", "{0}"])
srf_7 = Surface(reparameterize(simplify(runion)))
srf_cp = SurfaceClosestPoint(Point=path_mapper_11, Surface=srf_7)  # -> Point, UVPoint, Distance
evalsrf = EvaluateSurface(Surface=reparameterize(srf_6), Point=srf_cp.UVPoint)  # -> Point, Normal, UDirection, VDirection, Frame
c_script_4 = CSharpScript(trimmedTree=evalsrf.Point, originalTree=divide_6.Points)  # -> out, A; inputs trimmedTree: tree, originalTree: tree
# ---------- c_script_4: C# ----------
    if(originalTree.DataCount != trimmedTree.DataCount) Component.AddRuntimeMessage(GH_RuntimeMessageLevel.Error, "Number of items in both trees must be equal");

    DataTree<object> outputs = new DataTree<object>();
    List<GH_Path> paths = GetPaths(originalTree);
    //step through trimmed tree objects and add them to output tree with the correct

    int counter = 0;
    for(int i = 0; i < trimmedTree.BranchCount; i++)
    {
      for(int j = 0; j < trimmedTree.Branch(i).Count; j++)
      {
        outputs.Add(trimmedTree.Branch(i)[j], paths[counter]);
        counter++;
      }
    }
    A = outputs;
# ---------- c_script_4: C# additional code ----------
  public List<GH_Path> GetPaths(DataTree<object> originalTree)
  {
    List<GH_Path> output = new List<GH_Path>();
    for(int i = 0; i < originalTree.BranchCount; i++)
    {
      for(int j = 0; j < originalTree.Branch(i).Count; j++)
      {
        output.Add(originalTree.Paths[i]);
      }
    }
    return output;
  }
# ---------- end c_script_4 ----------
intcrv_8 = Interpolate(Vertices=c_script_4.A, Degree=3, Periodic=False, KnotStyle=1)  # -> Curve, Length, Domain
trim_16 = TrimTree(Tree=intcrv_8.Curve, Depth=1)
join_7 = JoinCurves(Curves=trim_16, Preserve=False)  # -> simplify(Curves)
path_mapper_12 = PathMapper(join_7, source=["{A;B;C}", "{A;B}"], target=["{A}", "{0}"])
lng_14 = ListLength(List=path_mapper_12)
dup_11 = DuplicateData(Data=srf_6, Number=lng_14, Order=True)
c_script_5 = CSharpScript(surface=simplify(graft(dup_11)), curves=simplify(graft(path_mapper_12)))  # -> out, A; inputs surface: tree of Brep, curves: tree of Curve
# ---------- c_script_5: C# ----------
    DataTree<Brep> splitBreps = new DataTree<Brep>();
    for(int i = 0; i < curves.BranchCount; i++)
    {
      Brep[] results = surface.Branch(i)[0].Split(curves.Branch(i), 0.1);
      foreach(Brep brep in results)
      {
        splitBreps.Add(brep, curves.Paths[i]);
      }
    }
    A = splitBreps;
# ---------- end c_script_5 ----------
area_5 = Area(Geometry=c_script_5.A)  # -> Area, Centroid
sort_6 = SortList(Keys=area_5.Area, ValuesA=c_script_5.A)  # -> Keys, reverse(ValuesA)
item_8 = ListItem(List=sort_6.ValuesA, Index=Slider(1, range=0..1), Wrap=True)
trim_17 = TrimTree(Tree=item_8, Depth=1)
c_script_6 = CSharpScript(trimmedTree=trim_17, originalTree=join_7)  # -> out, A; inputs trimmedTree: tree, originalTree: tree; same code as c_script_4
trim_18 = TrimTree(Tree=c_script_6.A, Depth=1)

srf_8 = Surface(reparameterize(flatten(merge_13)))

srf_9 = Surface(srf_8)
edges = BrepEdges(Brep=srf_9)  # -> Naked, Interior, NonManifold
len_4 = Length(Curve=edges.Naked)
sort_7 = SortList(Keys=len_4, ValuesA=edges.Naked)  # -> Keys, reverse(ValuesA)
item_9 = ListItem(List=sort_7.ValuesA, Index=0, Wrap=True)  # -> Item, Item1
flip_2 = FlipCurve(Curve=item_9.Item1)  # -> Curve, Flag
merge_14 = Merge(Data1=item_9.Item, Data2=flip_2.Curve)
divide_7 = DivideCurve(Curve=merge_14, Count=Slider(100, range=0..100), Kinks=False)  # -> Points, Tangents, Parameters
path_mapper_13 = PathMapper(divide_7.Points, source="{A;B;C}(i)", target="{A;B;i}(C)")
item_10 = ListItem(List=path_mapper_13, Index=0, Wrap=True)  # -> Item, Item1
dist = Distance(PointA=item_10.Item, PointB=item_10.Item1)
trim_19 = TrimTree(Tree=dist, Depth=1)
bnd_15 = Bounds(Numbers=trim_19)
dedomain_14 = DeconstructDomain(Domain=bnd_15)  # -> simplify(Start), End
srf_10 = Surface(trim_18)
multiplication_19 = Multiplication(A=dedomain_14.Start, B=Slider(0.9, range=0..1))  # -> flatten(Result)
group_2 = Group(Objects=srf_10)
c_script_7 = CSharpScript(x=multiplication_19)  # -> out, A; inputs x: list of Double
# ---------- c_script_7: C# ----------
    List<double> output = new List<double>();
    
    double currentVal = 0;
    for(int i = 0; i < x.Count; i++)
    {
      output.Add(currentVal);
      currentVal += x[i];
    }
    A = output;
# ---------- end c_script_7 ----------
trim_20 = TrimTree(Tree=group_2, Depth=1)
Y_9 = UnitY(Factor=c_script_7.A)
group_3 = Group(Objects=trim_20)  # -> flatten(Group)
move_11 = Move(Geometry=srf_9, Motion=Y_9)  # -> Geometry, Transform

move_12 = Move(Geometry=group_3, Motion=Y_9)  # -> Geometry, Transform

srf_11 = Surface(move_11.Geometry)
shift = ShiftList(List=srf_11, Shift=1, Wrap=True)
shift_2 = ShiftList(List=srf_11, Shift=-1, Wrap=True)
bbx = BrepBrep(BrepA=srf_11, BrepB=shift_2)  # -> Curves, Points
bbx_2 = BrepBrep(BrepA=srf_11, BrepB=shift)  # -> Curves, Points
merge_15 = Merge(Data1=bbx_2.Curves, Data2=bbx.Curves)  # -> simplify(Result)
srf_12 = Surface(simplify(graft(srf_11)))
srfsplit = SurfaceSplit(Surface=srf_12, Curves=merge_15)  # -> simplify(Fragments)
area_6 = Area(Geometry=srfsplit)  # -> Area, Centroid
sort_8 = SortList(Keys=area_6.Area, ValuesA=srfsplit)  # -> Keys, reverse(ValuesA)
item_11 = ListItem(List=sort_8.ValuesA, Index=0, Wrap=True)  # -> flatten(Item)

ungroup_2 = Ungroup(Group=move_12.Geometry)
group_4 = Group(Objects=merge_15)
ungroup_3 = Ungroup(Group=ungroup_2)  # -> simplify(Objects)
srf_13 = Surface(ungroup_3)
trim_21 = TrimTree(Tree=srf_13, Depth=1)
lng_15 = ListLength(List=trim_21)
lng_16 = ListLength(List=srf_13)
dup_12 = DuplicateData(Data=group_4, Number=lng_15, Order=True)  # -> simplify(Data)
trim_22 = TrimTree(Tree=lng_16, Depth=1)
partition_5 = PartitionList(List=dup_12, Size=trim_22)
srf_14 = Surface(graft(srf_13))
ungroup_4 = Ungroup(Group=partition_5)
scx = SurfaceCurve(Surface=srf_14, Curve=ungroup_4)  # -> simplify(Curves), simplify(Points), UVPoints, Normals, Parameters, Tangents
trim_23 = TrimTree(Tree=scx.Points, Depth=1)
trim_24 = TrimTree(Tree=scx.Curves, Depth=1)
null = NullItem(Item=trim_24)  # -> NullFlags, InvalidFlags, Description
null_2 = NullItem(Item=trim_23)  # -> NullFlags, InvalidFlags, Description
not_4 = GateNot(A=null.NullFlags)
not_5 = GateNot(A=null_2.NullFlags)
toggle = BooleanToggle(True)
cset = CreateSet(List=not_4)  # -> Set, Map
cset_2 = CreateSet(List=not_5)  # -> Set, Map
mindex = MemberIndex(Set=cset.Set, Member=toggle)  # -> simplify(Index), Count
mindex_2 = MemberIndex(Set=cset_2.Set, Member=toggle)  # -> simplify(Index), Count
larger = LargerThan(FirstNumber=mindex.Count, SecondNumber=0)  # -> LargerThan, OrEqualTo
larger_2 = LargerThan(FirstNumber=mindex_2.Count, SecondNumber=0)  # -> LargerThan, OrEqualTo
or = GateOr(A=larger.LargerThan, B=larger_2.LargerThan)
cull_9 = CullPattern(List=ungroup_4, CullPattern=or)
srfsplit_2 = SurfaceSplit(Surface=srf_14, Curves=cull_9)

srf_15 = Surface(item_11)
preview = CustomPreview(Geometry=srf_15, Material=ColourSwatch(SwatchColor=RGB(196, 196, 196)))

srf_16 = Surface(srfsplit_2)
area_7 = Area(Geometry=srf_16)  # -> Area, simplify(Centroid)
path_mapper_14 = PathMapper(area_7.Centroid, source=["{A;B;C}", "{A;B}"], target=["{A}", "{0}"])
srf_cp_2 = SurfaceClosestPoint(Point=path_mapper_14, Surface=simplify(graft(item_11)))  # -> Point, UVPoint, Distance
smaller_5 = SmallerThan(FirstNumber=srf_cp_2.Distance, SecondNumber=Slider(5, range=0..100))  # -> SmallerThan, OrEqualTo
c_script_8 = CSharpScript(trimmedTree=smaller_5.SmallerThan, originalTree=area_7.Centroid)  # -> out, A; inputs trimmedTree: tree, originalTree: tree; same code as c_script_4
cull_10 = CullPattern(List=srf_16, CullPattern=c_script_8.A)  # -> simplify(List)

txt_4 = Text(graft(dec_board_4.Material))
srf_17 = Surface(cull_10)
path_mapper_15 = PathMapper(srf_17, source=["{A;B;C}", "{A;B}"], target=["{A}", "{0}"])
lng_17 = ListLength(List=srf_17)
addition_17 = Addition(A=Y_6, B=X_3)
dup_13 = DuplicateData(Data=txt_4, Number=lng_17, Order=True)  # -> simplify(Data)
move_13 = Move(Geometry=path_mapper_15, Motion=addition_17)  # -> Geometry, Transform
len_5 = TextLength(Text=dup_13)
c_script_9 = CSharpScript(trimmedTree=move_13.Geometry, originalTree=srf_17)  # -> out, A; inputs trimmedTree: tree, originalTree: tree; same code as c_script_4
bnd_16 = Bounds(Numbers=flatten(len_5))
dedomain_15 = DeconstructDomain(Domain=bnd_16)  # -> Start, End
gradient_3 = Gradient(
    LowerLimit=dedomain_15.Start,
    UpperLimit=dedomain_15.End,
    Parameter=len_5,
    stops=[0: RGB(186, 186, 186), 1: RGB(122, 122, 122)])
clean_2 = CleanTree(RemoveNulls=True, RemoveInvalid=True, RemoveEmpty=True, Tree=gradient_3)
preview_2 = CustomPreview(Geometry=c_script_9.A, Material=clean_2)

cull_11 = CullPattern(List=item_11, CullPattern=bool_3)
brep = Brep(item_11)
scale_2 = Scale(Geometry=cull_11, Center=Point(0, 0, 0), Factor=number_slider_6)  # -> Geometry, Transform
debrep = DeconstructBrep(Brep=brep)  # -> Faces, Edges, Vertices
curvepoint_8 = PointOnCurve(debrep.Edges, parameter=0.5)
pdecon_24 = Deconstruct(Point=curvepoint_8)  # -> XComponent, YComponent, ZComponent
debrep_2 = DeconstructBrep(Brep=scale_2.Geometry)  # -> Faces, Edges, Vertices
smaller_6 = SmallerThan(FirstNumber=pdecon_24.XComponent, SecondNumber=Slider(1525, range=0..10000))  # -> SmallerThan, OrEqualTo
mesh_breps = MeshBrepsKaramba3D(
    Brep=debrep_2.Faces,
    MeshResolution=Slider(0.25, range=0..100),
    EdgeRefinementFactor=0.67,
    PointReduction=False,
    SmoothingStepSize=0,
    SmoothingIterations=5)  # -> Mesh, Info
cull_12 = CullPattern(List=debrep.Edges, CullPattern=smaller_6.SmallerThan)  # -> simplify(flatten(List))
mjoin_3 = MeshJoin(Meshes=flatten(mesh_breps.Mesh))
scale_3 = Scale(Geometry=cull_12, Center=Point(0, 0, 0), Factor=number_slider_6)  # -> Geometry, Transform
unim = UnifyMesh(Mesh=mjoin_3)  # -> Result, Count
ungroup_5 = Ungroup(Group=move_12.Geometry)  # -> simplify(graft(Objects))
weld_3 = WeldMesh(Mesh=unim.Result, Angle=3.141592654)
scale_4 = Scale(Geometry=weld_3, Center=Point(0, 0, 0), Factor=Slider(1000, range=0..1000))  # -> Geometry, Transform
ungroup_6 = Ungroup(Group=ungroup_5)  # -> simplify(flatten(Objects))
facen = FaceNormals(Mesh=scale_4.Geometry)  # -> graft(Centers), Normals

demesh_2 = DeconstructMesh(Mesh=weld_3)  # -> flatten(Vertices), Faces, Colours, Normals
crv_cp = CurveClosestPoint(Point=demesh_2.Vertices, Curve=graft(scale_3.Geometry))  # -> Point, Parameter, Distance
equalst = EqualityWithinTolerance(FirstNumber=crv_cp.Distance, SecondNumber=0, Tolerance=0.1)  # -> Equality, Inequality
cull_13 = CullPattern(List=demesh_2.Vertices, CullPattern=equalst.Equality)
pt_25 = Point(cull_13)

srf_cp_3 = SurfaceClosestPoint(Point=facen.Centers, Surface=ungroup_6)  # -> Point, UVPoint, Distance
listdexs = ListIndices(List=srf_cp_3.Distance)
sort_9 = SortList(Keys=srf_cp_3.Distance, ValuesA=listdexs)  # -> Keys, ValuesA
item_12 = ListItem(List=sort_9.ValuesA, Index=0, Wrap=True)  # -> flatten(Item)
item_13 = ListItem(List=txt_3, Index=item_12, Wrap=True)
cullpt_2 = CullDuplicates(Points=flatten(pt_25), Tolerance=0.01, CullMode=3)  # -> simplify(flatten(Points)), Indices, Valence
len_6 = TextLength(Text=item_13)
avr_5 = Average(Input=len_6)
larger_3 = LargerThan(FirstNumber=len_6, SecondNumber=avr_5)  # -> simplify(graft(LargerThan)), OrEqualTo
not_6 = GateNot(A=larger_3.LargerThan)
cull_14 = CullPattern(List=matprops_2, CullPattern=not_6)
cull_15 = CullPattern(List=matprops, CullPattern=larger_3.LargerThan)
merge_16 = Merge(Data1=cull_14, Data2=cull_15)  # -> flatten(Result)

relaxation = Panel(bnd_13)

mesh_5 = Mesh(mesh_3)
c_script_10 = CSharpScript(mesh=mesh_5, surface=srf_3)  # -> out, Curvature; inputs mesh: Mesh, surface: Surface
# ---------- c_script_10: C# ----------
        //get surface gaussian curvature at each mesh point
        List<double> gaussianCurvatures = new List<double>();
        double maxGaussian = 0;
        double minGaussian = double.MaxValue;

        double U;
        double V;

        for (int i = 0; i < mesh.Vertices.Count; i++)
        {
            Point3d currentMeshPoint = mesh.Vertices.Point3dAt(i);
            surface.ClosestPoint(currentMeshPoint, out U, out V);
            SurfaceCurvature surfaceCurvature = surface.CurvatureAt(U, V);
            double gaussian = surfaceCurvature.Gaussian;
            gaussianCurvatures.Add(gaussian);

            //get the range of curvatures
            if (gaussian > maxGaussian) maxGaussian = gaussian;
            if( gaussian < minGaussian) minGaussian = gaussian;
        }


        //get the range of curvatures


        //remap the curvatures to color values on the mesh points
        for (int i = 0; i < mesh.Vertices.Count; i++)
        {
            double hue = (gaussianCurvatures[i] - minGaussian) / (0 - minGaussian) * (0.5 - maxGaussian) + maxGaussian;
        }
        Curvature = gaussianCurvatures;
# ---------- end c_script_10 ----------
mesh_6 = Mesh(flatten(mesh_5))
num_27 = Number(c_script_10.Curvature)
bnd_17 = Bounds(Numbers=num_27)
dedomain_16 = DeconstructDomain(Domain=bnd_17)  # -> Start, End
gradient_4 = Gradient(
    LowerLimit=dedomain_16.Start,
    UpperLimit=dedomain_16.End,
    Parameter=num_27,
    stops=[0: RGB(0, 128, 0), 0.5: RGB(255, 255, 0), 1: RGB(255, 0, 0)])

gaussian_curvature = Panel(bnd_17)

move_14 = Move(Geometry=mesh_6, Motion=Y_9)  # -> simplify(graft(Geometry)), Transform

mesh_7 = Mesh(move_14.Geometry)

move_15 = Move(Geometry=mesh_7, Motion=Y_6)  # -> Geometry, Transform

c_script_11 = CSharpScript(mesh=move_15.Geometry, colors=simplify(gradient_4))  # -> out, A; inputs mesh: Mesh, colors: list of Color
# ---------- c_script_11: C# ----------
    for(int i = 0; i < mesh.Vertices.Count; i++)
    {
      mesh.VertexColors.SetColor(i, colors[i]);
    }
    A = mesh;
# ---------- end c_script_11 ----------

# ---- group: Karamba simulation
mesh_8 = Mesh(weld_3)
supp = SupportKaramba3D(PosInd=cullpt_2.Points, menu=[buttons(on, on, on, on, on, on)])
cross_section = CrossSectionKaramba3D(FamilyNameOfCrossSection="DefaultCroSec", Materials=merge_16, Heights_cm=Slider(2.4, range=0..10), mode="Shell - Var")
loads_2 = LoadsKaramba3D(Vector=rev_3, Mesh=weld_3, LCase="0", mode="MeshLoad -Const.", menu=[buttons(off, on, off), buttons(on, on)])
meshtoshell = MeshToShellKaramba3D(Mesh=mesh_8, CrossSection=cross_section, LimitDistance_m=0.005)  # -> Element, Points, Info
assemble = AssembleModelKaramba3D(
    Elem=meshtoshell.Element,
    Support=supp,
    Load=flatten([loads_2, loads]),
    CrossSection=cross_section,
    LimitDistance_m=0.005)  # -> Model, Info, Mass_kg, CenterOfGravity, LoadCaseNames

# ----
analyze = AnalyzeKaramba3D(Model=assemble.Model)  # -> CalculatedModel, MaximumDisplacement_cm, ResultingForceOfGravity_kN, ElasticEnergyChange_kNm
num_28 = Number(flatten(analyze.MaximumDisplacement_cm))

# ---- group: Karamba simulation (continued)
modelview = ModelViewKaramba3D(Model=analyze.CalculatedModel, ResultFactors=1, ResultCase=-1)  # -> Model, DeformedMesh, DeformedAxes, DeformedModel
shellview = ShellViewKaramba3D(Model=modelview.Model, IndexOfLayer=0)  # -> Model, MeshesOfRenderedShells, LegendColors, LegendTags
mesh_9 = Mesh(shellview.MeshesOfRenderedShells)

# ----
panel_6 = Panel(num_28)
scale_5 = Scale(Geometry=mesh_9, Center=Point(0, 0, 0), Factor=Slider(1000, range=0..1000))  # -> Geometry, Transform
mesh_10 = Mesh(scale_5.Geometry)
move_16 = Move(Geometry=mesh_10, Motion=X_3)  # -> Geometry, Transform
