# Grasshopper definition BilayerDesign - Fabrication - Prototype - with columns.gh (Grasshopper 1.0.7)
# plug-ins: HygroDesign, Pufferfish, Bookworm, treesloth01, Utils, Sofistik, Human, Weaverbird, EleFront, Telepathy, Leopard version 0a1

# ---- group: Template
od_outdated = ColourSwatch(SwatchColor=RGBA(97, 97, 97, 150))
u_updated = ColourSwatch(SwatchColor=RGBA(208, 115, 230, 112))
toggle = BooleanToggle(True)
o_outputs = ColourSwatch(SwatchColor=RGBA(160, 218, 242, 203))
s_settings = ColourSwatch(SwatchColor=RGBA(224, 145, 81, 154))
g_general = ColourSwatch(SwatchColor=RGBA(245, 243, 237, 156))
y_yellow = ColourSwatch(SwatchColor=RGBA(247, 244, 64, 188))
i_inputs = ColourSwatch(SwatchColor=RGBA(125, 217, 98, 150))
c_core = ColourSwatch(SwatchColor=RGBA(235, 227, 206, 203))
r_red = ColourSwatch(SwatchColor=RGBA(242, 63, 63, 203))

# ----
file = CSharpScript()  # -> File
# ---------- file: C# usings ----------
using System.IO;
# ---------- file: C# ----------
    GH_Document doc = owner.OnPingDocument();
    string filePath = doc.FilePath;
    string pathOnly = Path.GetDirectoryName(filePath);


    File = pathOnly;
# ---------- end file ----------
filepath = RemoteSender(file)

# ---- group: Template
change_background_color = Button()
toggle_2 = BooleanToggle(True)
button = Button()
button_2 = Button()
button_3 = Button()
changebackground = GhPythonScript(
    change=change_background_color,
    newBackgroundColor=ColourSwatch(SwatchColor=RGB(255, 255, 255)),
    wireColor=RGB(110, 110, 110),
    selectedWireColor=RGB(47, 255, 0))  # inputs newBackgroundColor: Color, wireColor: Color, selectedWireColor: Color
# ---------- changebackground: Python ----------
import Grasshopper as gh
import rhinoscriptsyntax as rs

newShadeColor = rs.CreateColor(0,0,0,20)
newEdgeColor = rs.CreateColor(0,0,0,40)

if(change):
     gh.GUI.Canvas.GH_Skin.canvas_back = newBackgroundColor
     gh.GUI.Canvas.GH_Skin.canvas_shade = newShadeColor
     gh.GUI.Canvas.GH_Skin.canvas_edge = newEdgeColor
     gh.GUI.Canvas.GH_Skin.wire_default = wireColor
     gh.GUI.Canvas.GH_Skin.wire_selected_a = selectedWireColor
     gh.GUI.Canvas.GH_Skin.wire_selected_b = selectedWireColor
# ---------- end changebackground ----------

# ---- group: beech
panel = Panel("beech")
number_slider = Slider(0.0001, range=0..0.0001)
number_slider_2 = Slider(0.002, range=0..1)
number_slider_3 = Slider(0.0041, range=0..1)
number_slider_4 = Slider(14000, range=0..20000)
number_slider_5 = Slider(2280, range=0..20000)
number_slider_6 = Slider(1160, range=0..20000)
number_slider_7 = Slider(720, range=0..1000)

# ---- group: Template
# Do not modify this
# component without setting
# enable to false first!
toggle_3 = BooleanToggle(True)
colorgroups = CSharpScript(
    Colors=[i_inputs, s_settings, g_general, c_core, o_outputs, r_red, y_yellow, u_updated, od_outdated],
    Enable=toggle,
    Rename=toggle_2,
    RunOnce=button,
    Debug=toggle_3)  # -> out; inputs Colors: list of Color, Enable: Boolean, Rename: Boolean, RunOnce: Boolean, Debug: Boolean
# ---------- colorgroups: C# usings ----------
using System.Linq;
using System.Text;
using System.Reflection;
# ---------- colorgroups: C# ----------
    msg.Clear();


    this.Component.Message = "id: " + id.ToString();

    _debug = Debug; //Set to true to have all events printed in rhino log
    _rename = Rename;

    if (Enable)
    {
      msg.AppendFormat("Set up events on ID {0}\n", id);
      SetupDict(); // Create a dictionary of the input swatches
      SetEventHandlers(); // This would do the job.


    }
    else
    {
      RemoveEventHandlers();
    }
    if (RunOnce)
    {
      foreach(Grasshopper.Kernel.Special.GH_Group grp in Grasshopper.Instances.ActiveCanvas.Document.Objects.OfType<Grasshopper.Kernel.Special.GH_Group>())
      {
        ColorGroup(grp, null); // You decide if it should run once on all existing groups

      }
    }

    Print(msg.ToString());


    // Component setup
    Component.Description = "Set up event handlers to color groups based on prefixes such as 'in_' and 'out_'.\n"
      + "Please insert only swatcheds directly into the Colors input\n\n"
      + "MIT License. Copyright Mathias Sønderskov Schaltz 2022";
    Component.Params.Input[0].Description = "Please insert only swatcheds directly into the Colors input.\nRemember to rename them";
    Component.Params.Input[1].Description = "Toggle to run...";
    Component.Params.Input[2].Description = "Set to true if you want to automatically rename the groups and remove prefix. Default is false.";
    Component.Params.Input[3].Description = "Set to true to run it once and color all existing groups.";
    Component.Params.Input[Component.Params.Input.Count - 1].Description = "Set debug to true to get all the events printed in the rhino log";
# ---------- colorgroups: C# additional code ----------
  public static Random rnd = new Random();
  public int id = rnd.Next(0, 1000);
  StringBuilder msg = new StringBuilder();
  Dictionary<string, System.Drawing.Color> colorDict = new Dictionary<string, System.Drawing.Color>();

  bool _debug = false;
  bool _rename = false;

  public bool IdExists(int id)
  {
    IList<IGH_DocumentObject> objs = Grasshopper.Instances.ActiveCanvas.Document.Objects;
    return objs
      .OfType<IGH_Component>()
      .Where(ob => ob.NickName == this.Component.NickName)
      .Where(ob => ob.GetType().ToString() == "ScriptComponents.Component_CSNET_Script")
      .Where(ob => ob.Message == "id: " + id.ToString()).Any();

  }


  public void SetupDict()
  {
    colorDict.Clear();
    // Get all inputs to "Colors"
    IList<IGH_Param> colorSources = this.Component.Params.Input[0].Sources;
    if (colorSources.Count == 0)
    {
      throw new Exception("You forgot to setup the colors. Please input swatch components and rename them");
    }
    foreach(IGH_Param source in colorSources)
    {
      //if (source.Type.ToString() == "Grasshopper.Kernel.Types.GH_Colour")
      if (source is Grasshopper.Kernel.Special.GH_ColourSwatch)
      {
        string nickName = source.NickName.Split('_')[0].Trim() + "_";
        if(!colorDict.ContainsKey(nickName))
        {
          Grasshopper.Kernel.Special.GH_ColourSwatch swatch = (Grasshopper.Kernel.Special.GH_ColourSwatch) source;
          colorDict.Add(nickName, swatch.SwatchColour);
        }
        else
        {
          throw new Exception("Multiple swatches using the same name detected. Please rename");
        }
      }
      else
      {
        throw new Exception("Whacko! Why did you input a non-swatch into the Colors? " + source.Type.ToString());
      }

    }

    msg.AppendFormat("Set up the dictionaries with {0} colors\n", colorDict.Count);
    foreach(var pairs in colorDict)
    {
      msg.AppendFormat("{0} -> {1}\n", ("\"" + pairs.Key + "\"").PadRight(5 + colorDict.Keys.Select(k => k.Length).Max()), pairs.Value);
    }
  }

  public void SetEventHandlers()
  {

    // Always remove events first to avoid duplicates
    GrasshopperDocument.ObjectsAdded -= OnObjectsAdded;
    GrasshopperDocument.ObjectsDeleted -= OnObjectsRemoved;
    GrasshopperDocument.ObjectsDeleted -= OnDeleteThisComponent;

    // Attach events
    GrasshopperDocument.ObjectsAdded += OnObjectsAdded;
    GrasshopperDocument.ObjectsDeleted += OnObjectsRemoved;
    GrasshopperDocument.ObjectsDeleted += OnDeleteThisComponent;


    foreach(Grasshopper.Kernel.Special.GH_Group grp in GrasshopperDocument.Objects.OfType<Grasshopper.Kernel.Special.GH_Group>())
    {
      grp.ObjectChanged -= ColorGroup;
      grp.ObjectChanged += ColorGroup;

      //ColorGroup(grp, null); // Make sure to run it once
    }
    msg.AppendFormat("Added the eventhandlers on {0} existing groups and on future created groups\n", GrasshopperDocument.Objects.OfType<Grasshopper.Kernel.Special.GH_Group>().Count());
  }

  public void OnObjectsAdded(object sender, GH_DocObjectEventArgs e)
  {
    bool any = false;
    foreach (Grasshopper.Kernel.Special.GH_Group grp in e.Objects.OfType<Grasshopper.Kernel.Special.GH_Group>())
    {
      grp.ObjectChanged -= ColorGroup;
      grp.ObjectChanged += ColorGroup;
      any = true;
    }

    DebugWrite(any ? "Group Objects Added: Attaching Events to ObjectChanged" : "Objects Added - but no groups");
  }

  //Same but reversed
  public void OnObjectsRemoved(object sender, GH_DocObjectEventArgs e)
  {
    bool any = false;
    foreach (Grasshopper.Kernel.Special.GH_Group grp in e.Objects.OfType<Grasshopper.Kernel.Special.GH_Group>())
    {
      grp.ObjectChanged -= ColorGroup;
      any = true;
    }

    DebugWrite(any ? "Group Objects Removed, removing event" : "Objects Removed - although not a group");

  }



  public void RemoveEventHandlers()
  {
    GrasshopperDocument.ObjectsAdded -= OnObjectsAdded;
    GrasshopperDocument.ObjectsDeleted -= OnObjectsRemoved;


    foreach(Grasshopper.Kernel.Special.GH_Group grp in GrasshopperDocument.Objects.OfType<Grasshopper.Kernel.Special.GH_Group>())
    {
      grp.ObjectChanged -= ColorGroup;

    }
    msg.AppendFormat("Removed event handlers on document and on {0} groups\n", GrasshopperDocument.Objects.OfType<Grasshopper.Kernel.Special.GH_Group>().Count());

  }

  public void ColorGroup(object sender, EventArgs e)
  {
    if (!IdExists(id))
    {
      DebugWrite("Component not relevant. Disabling old id + " + id.ToString());
      RemoveEventHandlers();
      return;
    }

    Grasshopper.Kernel.Special.GH_Group grp = sender as Grasshopper.Kernel.Special.GH_Group;
    if (grp == null) return; //not type GH_Group
    //if (!grp.NickName.EndsWith("_")) return;

    string[] nameParts = grp.NickName.Split('_');
    if (nameParts.Length <= 1)
      return;
    string prefix = grp.NickName.Split('_')[0].Trim() + '_';

    string prefixes = String.Join(", ", colorDict.Keys.Select(k => "\"" + k + "\""));

    msg.Append("prefix " + prefix + "\n");
    if (colorDict.ContainsKey(prefix))
    {
      //if (grp.NickName.EndsWith("_"))
      grp.Colour = colorDict[prefix];
      if (_rename)
      {
        grp.NickName = grp.NickName.Replace(prefix, "");
      }

      DebugWrite("Colored " + grp.NickName);

    }
    else
    {
      DebugWrite("Group changed but not relevant: prefix " + prefix + " is not among " + prefixes);
    }

  }
  public void DebugWrite(string msg)
  {
    if (_debug)
    {
      Rhino.RhinoApp.WriteLine(String.Format("[ColGrps {0}]: {1}", id, msg));
    }
  }

  public void OnDeleteThisComponent(object sender, GH_DocObjectEventArgs e)
  {

    if (e.Objects.OfType<Grasshopper.Kernel.GH_Component>().Where(o => o.NickName == this.Component.NickName).Any())
    {
      DebugWrite("Removed template component. Removing all the eventhandlers");
      RemoveEventHandlers();
    }

  }
# ---------- end colorgroups ----------

fixwires = CSharpScript(FixOnce=button_2, Enable=toggle, Debug=Toggle(True))  # -> out; inputs FixOnce: Boolean, Enable: Boolean, Debug: Boolean
# ---------- fixwires: C# usings ----------
using System.Text;
using System.Linq;
using Grasshopper.Kernel.Special;
# ---------- fixwires: C# ----------
    _debug = Debug;
    _enable = Enable;
    msg.Clear();
    this.Component.Message = "id: " + id.ToString();


    SetDictionary();

    if (Enable)
    {
      SetEventHandlers();
    }
    else
    {
      RemoveEventHandlers();
    }


    if (FixOnce)
    {
      FixAll();
    }

    Print(msg.ToString());
    
    // Component setup
    Component.Description = "Set up event handlers to change all wire types across groups to faint"
      + "\n\n"
      + "MIT License. Copyright Mathias Sønderskov Schaltz 2022";
    Component.Params.Input[0].Description = "Run me once on the document";
    Component.Params.Input[1].Description = "Toggle to enable event listener";
    Component.Params.Input[Component.Params.Input.Count - 1].Description = "Set debug to true to get all the events printed in the rhino log";
# ---------- fixwires: C# additional code ----------
  public static Random rnd = new Random();
  public int id = rnd.Next(0, 1000);
  StringBuilder msg = new StringBuilder();
  bool _debug = false;
  bool _enable = false;

  public Dictionary<IGH_ActiveObject, HashSet<GH_Group>> groupsPerObject = new Dictionary<IGH_ActiveObject, HashSet<GH_Group>>();


  public void OnSolutionExpired(object sender, GH_DocUndoEventArgs e)
  {
    if(_enable)
      FixAll();
  }

  public void FixAll()
  {
    //DebugWrite("Fixing all?");
    foreach(IGH_ActiveObject key in groupsPerObject.Keys.Where(k => groupsPerObject[k].Count() > 0))
    {

      FixInputs(key);
    }
  }



  public bool HasGroup(IGH_ActiveObject obj)
  {
    return groupsPerObject[obj].Count > 0;
  }


  public void FixInputs(IGH_ActiveObject obj)
  {

    if (!IdExists(id))
    {
      DebugWrite("Component not relevant. Disabling old id " + id.ToString());
      RemoveEventHandlers();
      return;
    }

    //List<List<IGH_ActiveObject>> parents = new List<List<IGH_ActiveObject>>();
    IGH_Param par = obj as IGH_Param;
    if (par != null && par.Sources != null)
    {


      IEnumerable<IGH_ActiveObject> p = par.Sources.Select(s => s.Attributes.GetTopLevel.DocObject as IGH_ActiveObject);
      //parents.Add(p);
      if(HasGroup(obj) && p.All(o => !HasGroupsInCommon(o, obj)) && par.WireDisplay != GH_ParamWireDisplay.faint)
      {
        DebugWrite("Fixing " + par.Attributes.GetTopLevel.DocObject.NickName);
        par.WireDisplay = GH_ParamWireDisplay.faint;
      }

    }

    IGH_Component comp = obj as IGH_Component;
    if (comp != null)
    {
      foreach(IGH_Param inp in comp.Params.Input)
      {

        IEnumerable<IGH_ActiveObject> p = inp.Sources.Select(i => i.Attributes.GetTopLevel.DocObject as IGH_ActiveObject);

        if(HasGroup(obj) && p.All(o => !HasGroupsInCommon(o, obj)) && inp.WireDisplay != GH_ParamWireDisplay.faint)
        {
          DebugWrite("Fixing " + inp.Attributes.GetTopLevel.DocObject.NickName);
          inp.WireDisplay = GH_ParamWireDisplay.faint;
        }
      }

    }



  }





  public void SetDictionary()
  {
    IList<IGH_DocumentObject> objects = Grasshopper.Instances.ActiveCanvas.Document.Objects.ToList();
    //Print(String.Join(", ", objects.Select(o => o.NickName)));

    groupsPerObject = objects
      .Where(o => o.GetType() != typeof(GH_Group))
      .OfType<IGH_ActiveObject>()
      .ToDictionary(o => o, o => new HashSet<GH_Group>());

    foreach(GH_Group grp in objects.OfType<GH_Group>())
    {

      foreach(IGH_ActiveObject obj in grp.ObjectsRecursive().OfType<IGH_ActiveObject>())
      {
        groupsPerObject[obj].Add(grp);

      }
    }



  }

  public bool HasGroupsInCommon(IGH_ActiveObject obj1, IGH_ActiveObject obj2)
  {
    HashSet<GH_Group> set1 = groupsPerObject[obj1];
    HashSet<GH_Group> set2 = groupsPerObject[obj2];

    set1.IntersectWith(set2);

    return set1.Any();
  }

  public void SetEventHandlers()
  {

    GrasshopperDocument.UndoStateChanged -= OnSolutionExpired;
    GrasshopperDocument.UndoStateChanged += OnSolutionExpired;
    GrasshopperDocument.ObjectsDeleted -= OnDeleteThisComponent;
    GrasshopperDocument.ObjectsDeleted += OnDeleteThisComponent;
    msg.AppendFormat("Added the eventhandlers to UndoStateChanged\n", GrasshopperDocument.Objects.OfType<Grasshopper.Kernel.Special.GH_Group>().Count());
  }

  public void RemoveEventHandlers()
  {
    GrasshopperDocument.UndoStateChanged -= OnSolutionExpired;
    GrasshopperDocument.ObjectsDeleted -= OnDeleteThisComponent;

    msg.AppendFormat("Removed wire event handlers on document\n", GrasshopperDocument.Objects.OfType<Grasshopper.Kernel.Special.GH_Group>().Count());

  }

  public void OnDeleteThisComponent(object sender, GH_DocObjectEventArgs e)
  {

    if (e.Objects.OfType<Grasshopper.Kernel.GH_Component>().Where(o => o.NickName == this.Component.NickName).Any())
    {
      DebugWrite("Removed template component. Removing all the eventhandlers");
      RemoveEventHandlers();
    }

  }

  public bool IdExists(int id)
  {
    IList<IGH_DocumentObject> objs = Grasshopper.Instances.ActiveCanvas.Document.Objects;
    return objs
      .OfType<IGH_Component>()
      .Where(ob => ob.NickName == this.Component.NickName)
      .Where(ob => ob.GetType().ToString() == "ScriptComponents.Component_CSNET_Script")
      .Where(ob => ob.Message == "id: " + id.ToString()).Any();

  }

  public void DebugWrite(string msg)
  {
    if (_debug)
    {
      Rhino.RhinoApp.WriteLine(String.Format("[FixWire {0}]: {1}", id, msg));
    }
  }
# ---------- end fixwires ----------

fixparams = CSharpScript(FixOnce=button_3, Enable=toggle, Debug=Toggle(True))  # -> out; inputs FixOnce: Boolean, Enable: Boolean, Debug: Boolean
# ---------- fixparams: C# ----------
    _debug = Debug;
    _enable = Enable;
    msg.Clear();
    this.Component.Message = "id: " + id.ToString();




    if (Enable)
    {
      SetEventHandlers();
    }
    else
    {
      RemoveEventHandlers();
    }


    if (FixOnce)
    {
      FixAll();
    }

    Print(msg.ToString());

    // Component setup
    Component.Description = "Set up event handlers to change params to show nickname and not icon"
      + "\n\n"
      + "MIT License. Copyright Mathias Sønderskov Schaltz 2022";
    Component.Params.Input[0].Description = "Run me once on the document";
    Component.Params.Input[1].Description = "Toggle to enable event listener";
    Component.Params.Input[Component.Params.Input.Count - 1].Description = "Set debug to true to get all the events printed in the rhino log";
# ---------- fixparams: C# additional code ----------
  public static Random rnd = new Random();
  public int id = rnd.Next(0, 1000);
  StringBuilder msg = new StringBuilder();
  bool _debug = false;
  bool _enable = false;

  public Dictionary<IGH_ActiveObject, HashSet<GH_Group>> groupsPerObject = new Dictionary<IGH_ActiveObject, HashSet<GH_Group>>();


  public void OnObjectsAdded(object sender, GH_DocObjectEventArgs e)
  {
    if (!IdExists(id))
    {
      DebugWrite("[FixParam] Component not relevant. Disabling old id " + id.ToString());
      RemoveEventHandlers();
      return;
    }


    if(_enable)
    {
      foreach(IGH_Param par in e.Objects.OfType<IGH_Param>())
      {
        FixInputs(par);
      }
    }


  }

  public void FixAll()
  {
    //DebugWrite("Fixing all?");
    foreach(IGH_Param par in GrasshopperDocument.Objects.OfType<IGH_Param>())
    {

      FixInputs(par);
    }
  }




  public void FixInputs(IGH_ActiveObject obj)
  {



    IGH_Param par = obj as IGH_Param;
    if (par != null)
    {

      par.IconDisplayMode = GH_IconDisplayMode.name;


    }

  }


  public void SetEventHandlers()
  {

    GrasshopperDocument.ObjectsAdded -= OnObjectsAdded;
    GrasshopperDocument.ObjectsAdded += OnObjectsAdded;
    GrasshopperDocument.ObjectsDeleted -= OnDeleteThisComponent;
    GrasshopperDocument.ObjectsDeleted += OnDeleteThisComponent;
    msg.AppendFormat("Added the eventhandlers to OnObjectsAdded\n", GrasshopperDocument.Objects.OfType<Grasshopper.Kernel.Special.GH_Group>().Count());
  }

  public void RemoveEventHandlers()
  {
    GrasshopperDocument.ObjectsAdded -= OnObjectsAdded;
    GrasshopperDocument.ObjectsDeleted -= OnDeleteThisComponent;

    msg.AppendFormat("Removed wire event handlers on document\n", GrasshopperDocument.Objects.OfType<Grasshopper.Kernel.Special.GH_Group>().Count());

  }

  public void OnDeleteThisComponent(object sender, GH_DocObjectEventArgs e)
  {

    if (e.Objects.OfType<Grasshopper.Kernel.GH_Component>().Where(o => o.NickName == this.Component.NickName).Any())
    {
      DebugWrite("Removed template component. Removing all the eventhandlers");
      RemoveEventHandlers();
    }

  }

  public bool IdExists(int id)
  {
    IList<IGH_DocumentObject> objs = Grasshopper.Instances.ActiveCanvas.Document.Objects;
    return objs
      .OfType<IGH_Component>()
      .Where(ob => ob.NickName == this.Component.NickName)
      .Where(ob => ob.GetType().ToString() == "ScriptComponents.Component_CSNET_Script")
      .Where(ob => ob.Message == "id: " + id.ToString()).Any();

  }

  public void DebugWrite(string msg)
  {
    if (_debug)
    {
      Rhino.RhinoApp.WriteLine(String.Format("[FixParams {0}]: {1}", id, msg));
    }
  }
# ---------- end fixparams ----------

# ---- group: spruce
panel_2 = Panel("spruce")
number_slider_8 = Slider(0.0001, range=0..0.0001)
number_slider_9 = Slider(0.0019, range=0..1)
number_slider_10 = Slider(0.0036, range=0..1)
number_slider_11 = Slider(10000, range=0..20000)
number_slider_12 = Slider(450, range=0..20000)
number_slider_13 = Slider(800, range=0..20000)
number_slider_14 = Slider(400, range=0..1000)

# ----
division = Division(A=Slider(991, range=0..1000), B="6")
division_2 = Division(A=Slider(5000, range=0..10000), B=division)
num = Number(Slider(140, range=0..1000))
round = Round(Number=division_2)  # -> Nearest, Floor, Ceiling
num_2 = Number(round.Floor)
species = WoodSpecies(
    name=panel,
    density=number_slider_7,
    LExp=number_slider,
    RExp=number_slider_2,
    TExp=number_slider_3,
    LEmod=number_slider_4,
    REmod=number_slider_5,
    TEmod=number_slider_6)
species_2 = WoodSpecies(
    name=panel_2,
    density=number_slider_14,
    LExp=number_slider_8,
    RExp=number_slider_9,
    TExp=number_slider_10,
    LEmod=number_slider_11,
    REmod=number_slider_13,
    TEmod=number_slider_12)
panel_3 = Panel(HMaxelLength=division, HMaxelWidth=num, LengthCount=num_2, WidthCount=Slider(15, range=0..100))
panel_4 = Panel(division)
dec_pan = DeconstructPanel(Panel=panel_3)  # -> Bilayers, graft(HMaxels), LengthRange, WidthRange

number_slider_15 = Slider(1000, range=0..1000)
rectangle = Rectangle(Plane=PlaneXY(0, 0, 0), XSize=number_slider_15, YSize=number_slider_15, Radius=0)  # -> Rectangle, Length
drec = DeconstuctRectangle(Rectangle=rectangle.Rectangle)  # -> BasePlane, XInterval, YInterval
dedomain = DeconstructDomain(Domain=drec.YInterval)  # -> Start, End
subtraction = Subtraction(A=dedomain.End, B=dedomain.Start)
division_3 = Division(A=subtraction, B=2)
dom = ConstructDomain(DomainStart=0, DomainEnd=1)
addition = Addition(A=dedomain.Start, B=division_3)
number_slider_16 = Slider(0.412, range=0..1)
dom_2 = ConstructDomain(DomainStart=addition, DomainEnd=dedomain.End)
dom_3 = ConstructDomain(DomainStart=addition, DomainEnd=dedomain.Start)
remap = RemapNumbers(Value=number_slider_16, Source=dom, Target=dom_3)  # -> Mapped, Clipped
remap_2 = RemapNumbers(Value=Slider(1, range=0..1), Source=dom, Target=drec.XInterval)  # -> Mapped, Clipped
remap_3 = RemapNumbers(Value=number_slider_16, Source=dom, Target=dom_2)  # -> Mapped, Clipped
remap_4 = RemapNumbers(Value=Slider(1, range=0..1), Source=dom, Target=drec.XInterval)  # -> Mapped, Clipped
pt = ConstructPoint(XCoordinate=0, YCoordinate=remap_2.Mapped, ZCoordinate=0)
pt_2 = ConstructPoint(XCoordinate=remap.Mapped, YCoordinate=remap_4.Mapped, ZCoordinate=0)
pt_3 = ConstructPoint(XCoordinate=remap_3.Mapped, YCoordinate=remap_4.Mapped, ZCoordinate=0)
pt_4 = ConstructPoint(XCoordinate=number_slider_15, YCoordinate=remap_2.Mapped, ZCoordinate=0)
merge = Merge(Data1=pt, Data2=pt_2, Data3=pt_3, Data4=pt_4)
nurbs = NurbsCurve(Vertices=merge, Degree=2, Periodic=False)  # -> Curve, Length, Domain

number_slider_17 = Slider(1000, range=0..1000)
rectangle_2 = Rectangle(Plane=PlaneXY(0, 0, 0), XSize=number_slider_17, YSize=number_slider_17, Radius=0)  # -> Rectangle, Length
drec_2 = DeconstuctRectangle(Rectangle=rectangle_2.Rectangle)  # -> BasePlane, XInterval, YInterval
dedomain_2 = DeconstructDomain(Domain=drec_2.YInterval)  # -> Start, End
subtraction_2 = Subtraction(A=dedomain_2.End, B=dedomain_2.Start)
division_4 = Division(A=subtraction_2, B=2)
dom_4 = ConstructDomain(DomainStart=0, DomainEnd=1)
addition_2 = Addition(A=dedomain_2.Start, B=division_4)
number_slider_18 = Slider(0.743, range=0..1)
dom_5 = ConstructDomain(DomainStart=addition_2, DomainEnd=dedomain_2.End)
dom_6 = ConstructDomain(DomainStart=addition_2, DomainEnd=dedomain_2.Start)
remap_5 = RemapNumbers(Value=number_slider_18, Source=dom_4, Target=dom_6)  # -> Mapped, Clipped
remap_6 = RemapNumbers(Value=Slider(0.35, range=0..1), Source=dom_4, Target=drec_2.XInterval)  # -> Mapped, Clipped
remap_7 = RemapNumbers(Value=number_slider_18, Source=dom_4, Target=dom_5)  # -> Mapped, Clipped
remap_8 = RemapNumbers(Value=Slider(0, range=0..1), Source=dom_4, Target=drec_2.XInterval)  # -> Mapped, Clipped
pt_5 = ConstructPoint(XCoordinate=0, YCoordinate=remap_6.Mapped, ZCoordinate=0)
pt_6 = ConstructPoint(XCoordinate=remap_5.Mapped, YCoordinate=remap_8.Mapped, ZCoordinate=0)
pt_7 = ConstructPoint(XCoordinate=remap_7.Mapped, YCoordinate=remap_8.Mapped, ZCoordinate=0)
pt_8 = ConstructPoint(XCoordinate=number_slider_17, YCoordinate=remap_6.Mapped, ZCoordinate=0)
merge_2 = Merge(Data1=pt_5, Data2=pt_6, Data3=pt_7, Data4=pt_8)
nurbs_2 = NurbsCurve(Vertices=merge_2, Degree=2, Periodic=False)  # -> Curve, Length, Domain

number_slider_19 = Slider(1000, range=0..1000)
rectangle_3 = Rectangle(Plane=PlaneXY(0, 0, 0), XSize=number_slider_19, YSize=number_slider_19, Radius=0)  # -> Rectangle, Length
drec_3 = DeconstuctRectangle(Rectangle=rectangle_3.Rectangle)  # -> BasePlane, XInterval, YInterval
dedomain_3 = DeconstructDomain(Domain=drec_3.YInterval)  # -> Start, End
subtraction_3 = Subtraction(A=dedomain_3.End, B=dedomain_3.Start)
division_5 = Division(A=subtraction_3, B=2)
dom_7 = ConstructDomain(DomainStart=0, DomainEnd=1)
addition_3 = Addition(A=dedomain_3.Start, B=division_5)
number_slider_20 = Slider(0.852, range=0..1)
dom_8 = ConstructDomain(DomainStart=addition_3, DomainEnd=dedomain_3.End)
dom_9 = ConstructDomain(DomainStart=addition_3, DomainEnd=dedomain_3.Start)
remap_9 = RemapNumbers(Value=number_slider_20, Source=dom_7, Target=dom_9)  # -> Mapped, Clipped
remap_10 = RemapNumbers(Value=Slider(0, range=0..1), Source=dom_7, Target=drec_3.XInterval)  # -> Mapped, Clipped
remap_11 = RemapNumbers(Value=number_slider_20, Source=dom_7, Target=dom_8)  # -> Mapped, Clipped
remap_12 = RemapNumbers(Value=Slider(0, range=0..1), Source=dom_7, Target=drec_3.XInterval)  # -> Mapped, Clipped
pt_9 = ConstructPoint(XCoordinate=0, YCoordinate=remap_10.Mapped, ZCoordinate=0)
pt_10 = ConstructPoint(XCoordinate=remap_9.Mapped, YCoordinate=remap_12.Mapped, ZCoordinate=0)
pt_11 = ConstructPoint(XCoordinate=remap_11.Mapped, YCoordinate=remap_12.Mapped, ZCoordinate=0)
pt_12 = ConstructPoint(XCoordinate=number_slider_19, YCoordinate=remap_10.Mapped, ZCoordinate=0)
merge_3 = Merge(Data1=pt_9, Data2=pt_10, Data3=pt_11, Data4=pt_12)
nurbs_3 = NurbsCurve(Vertices=merge_3, Degree=2, Periodic=False)  # -> Curve, Length, Domain

number_slider_21 = Slider(1000, range=0..1000)
rectangle_4 = Rectangle(Plane=PlaneXY(0, 0, 0), XSize=number_slider_21, YSize=number_slider_21, Radius=0)  # -> Rectangle, Length
drec_4 = DeconstuctRectangle(Rectangle=rectangle_4.Rectangle)  # -> BasePlane, XInterval, YInterval
dedomain_4 = DeconstructDomain(Domain=drec_4.YInterval)  # -> Start, End
subtraction_4 = Subtraction(A=dedomain_4.End, B=dedomain_4.Start)
division_6 = Division(A=subtraction_4, B=2)
number_slider_22 = Slider(0.466, range=0..1)
dom_10 = ConstructDomain(DomainStart=0, DomainEnd=1)
addition_4 = Addition(A=dedomain_4.Start, B=division_6)
dom_11 = ConstructDomain(DomainStart=addition_4, DomainEnd=dedomain_4.End)
dom_12 = ConstructDomain(DomainStart=addition_4, DomainEnd=dedomain_4.Start)
remap_13 = RemapNumbers(Value=number_slider_22, Source=dom_10, Target=dom_12)  # -> Mapped, Clipped
remap_14 = RemapNumbers(Value=Slider(0.1, range=0..1), Source=dom_10, Target=drec_4.XInterval)  # -> Mapped, Clipped
remap_15 = RemapNumbers(Value=number_slider_22, Source=dom_10, Target=dom_11)  # -> Mapped, Clipped
remap_16 = RemapNumbers(Value=Slider(0, range=0..1), Source=dom_10, Target=drec_4.XInterval)  # -> Mapped, Clipped
pt_13 = ConstructPoint(XCoordinate=0, YCoordinate=remap_14.Mapped, ZCoordinate=0)
pt_14 = ConstructPoint(XCoordinate=remap_13.Mapped, YCoordinate=remap_16.Mapped, ZCoordinate=0)
pt_15 = ConstructPoint(XCoordinate=remap_15.Mapped, YCoordinate=remap_16.Mapped, ZCoordinate=0)
pt_16 = ConstructPoint(XCoordinate=number_slider_21, YCoordinate=remap_14.Mapped, ZCoordinate=0)
merge_4 = Merge(Data1=pt_13, Data2=pt_14, Data3=pt_15, Data4=pt_16)
nurbs_4 = NurbsCurve(Vertices=merge_4, Degree=2, Periodic=False)  # -> Curve, Length, Domain

number_slider_23 = Slider(1000, range=0..1000)
rectangle_5 = Rectangle(Plane=PlaneXY(0, 0, 0), XSize=number_slider_23, YSize=number_slider_23, Radius=0)  # -> Rectangle, Length
drec_5 = DeconstuctRectangle(Rectangle=rectangle_5.Rectangle)  # -> BasePlane, XInterval, YInterval
dedomain_5 = DeconstructDomain(Domain=drec_5.YInterval)  # -> Start, End
subtraction_5 = Subtraction(A=dedomain_5.End, B=dedomain_5.Start)
division_7 = Division(A=subtraction_5, B=2)
dom_13 = ConstructDomain(DomainStart=0, DomainEnd=1)
addition_5 = Addition(A=dedomain_5.Start, B=division_7)
number_slider_24 = Slider(0.37, range=0..1)
dom_14 = ConstructDomain(DomainStart=addition_5, DomainEnd=dedomain_5.End)
dom_15 = ConstructDomain(DomainStart=addition_5, DomainEnd=dedomain_5.Start)
remap_17 = RemapNumbers(Value=number_slider_24, Source=dom_13, Target=dom_15)  # -> Mapped, Clipped
remap_18 = RemapNumbers(Value=Slider(0.6, range=0..1), Source=dom_13, Target=drec_5.XInterval)  # -> Mapped, Clipped
remap_19 = RemapNumbers(Value=number_slider_24, Source=dom_13, Target=dom_14)  # -> Mapped, Clipped
remap_20 = RemapNumbers(Value=Slider(0.4, range=0..1), Source=dom_13, Target=drec_5.XInterval)  # -> Mapped, Clipped
pt_17 = ConstructPoint(XCoordinate=0, YCoordinate=remap_18.Mapped, ZCoordinate=0)
pt_18 = ConstructPoint(XCoordinate=remap_17.Mapped, YCoordinate=remap_20.Mapped, ZCoordinate=0)
pt_19 = ConstructPoint(XCoordinate=remap_19.Mapped, YCoordinate=remap_20.Mapped, ZCoordinate=0)
pt_20 = ConstructPoint(XCoordinate=number_slider_23, YCoordinate=remap_18.Mapped, ZCoordinate=0)
merge_5 = Merge(Data1=pt_17, Data2=pt_18, Data3=pt_19, Data4=pt_20)
nurbs_5 = NurbsCurve(Vertices=merge_5, Degree=2, Periodic=False)  # -> Curve, Length, Domain

number_slider_25 = Slider(1000, range=0..1000)
rectangle_6 = Rectangle(Plane=PlaneXY(0, 0, 0), XSize=number_slider_25, YSize=number_slider_25, Radius=0)  # -> Rectangle, Length
drec_6 = DeconstuctRectangle(Rectangle=rectangle_6.Rectangle)  # -> BasePlane, XInterval, YInterval
dedomain_6 = DeconstructDomain(Domain=drec_6.YInterval)  # -> Start, End
subtraction_6 = Subtraction(A=dedomain_6.End, B=dedomain_6.Start)
division_8 = Division(A=subtraction_6, B=2)
dom_16 = ConstructDomain(DomainStart=0, DomainEnd=1)
addition_6 = Addition(A=dedomain_6.Start, B=division_8)
number_slider_26 = Slider(0.852, range=0..1)
dom_17 = ConstructDomain(DomainStart=addition_6, DomainEnd=dedomain_6.End)
dom_18 = ConstructDomain(DomainStart=addition_6, DomainEnd=dedomain_6.Start)
remap_21 = RemapNumbers(Value=number_slider_26, Source=dom_16, Target=dom_18)  # -> Mapped, Clipped
remap_22 = RemapNumbers(Value=Slider(1, range=0..1), Source=dom_16, Target=drec_6.XInterval)  # -> Mapped, Clipped
remap_23 = RemapNumbers(Value=number_slider_26, Source=dom_16, Target=dom_17)  # -> Mapped, Clipped
remap_24 = RemapNumbers(Value=Slider(1, range=0..1), Source=dom_16, Target=drec_6.XInterval)  # -> Mapped, Clipped
pt_21 = ConstructPoint(XCoordinate=0, YCoordinate=remap_22.Mapped, ZCoordinate=0)
pt_22 = ConstructPoint(XCoordinate=remap_21.Mapped, YCoordinate=remap_24.Mapped, ZCoordinate=0)
pt_23 = ConstructPoint(XCoordinate=remap_23.Mapped, YCoordinate=remap_24.Mapped, ZCoordinate=0)
pt_24 = ConstructPoint(XCoordinate=number_slider_25, YCoordinate=remap_22.Mapped, ZCoordinate=0)
merge_6 = Merge(Data1=pt_21, Data2=pt_22, Data3=pt_23, Data4=pt_24)
nurbs_6 = NurbsCurve(Vertices=merge_6, Degree=2, Periodic=False)  # -> Curve, Length, Domain

merge_7 = Merge(Data1=nurbs.Curve, Data2=nurbs_3.Curve)
lng = ListLength(List=merge_7)
merge_8 = Merge(Data1=nurbs_2.Curve, Data2=nurbs_4.Curve, Data3=nurbs_5.Curve, Data4=nurbs_6.Curve)
subtraction_7 = Subtraction(A=lng, B=1)
lng_2 = ListLength(List=merge_8)
division_9 = Division(A=Slider(4466, range=0..10000), B=subtraction_7)
subtraction_8 = Subtraction(A=lng_2, B=1)
series = Series(Start=0, Step=division_9, Count=lng)
division_10 = Division(A=Slider(4466, range=0..10000), B=subtraction_8)
X = UnitX(Factor=series)
series_2 = Series(Start=0, Step=division_10, Count=lng_2)
neg = Negative(Value=Slider(3000, range=0..3000))
move = Move(Geometry=merge_7, Motion=X)  # -> Geometry, Transform
X_2 = UnitX(Factor=series_2)

crv = Curve(merge_7)
lng_3 = ListLength(List=crv)  # -> expr("x-2", Length)
dom_19 = ConstructDomain(DomainStart=0, DomainEnd=lng_3)
subset = SubList(List=crv, Domain=dom_19, Wrap=True)  # -> graft(List), Index
shift = ShiftList(List=crv, Shift=1, Wrap=False)  # -> graft(List)
merge_9 = Merge(Data1=subset.List, Data2=shift)  # -> simplify(Result)
group = Group(Objects=merge_9)  # -> flatten(Group)

Y = UnitY(Factor=neg)
neg_2 = Negative(Value=Slider(1496, range=0..3000))
move_2 = Move(Geometry=move.Geometry, Motion=Y)  # -> Geometry, Transform
move_3 = Move(Geometry=merge_8, Motion=X_2)  # -> Geometry, Transform

crv_2 = Curve(merge_8)
lng_4 = ListLength(List=crv_2)  # -> expr("x-2", Length)
dom_20 = ConstructDomain(DomainStart=0, DomainEnd=lng_4)
subset_2 = SubList(List=crv_2, Domain=dom_20, Wrap=True)  # -> graft(List), Index
shift_2 = ShiftList(List=crv_2, Shift=1, Wrap=False)  # -> graft(List)
merge_10 = Merge(Data1=subset_2.List, Data2=shift_2)  # -> simplify(Result)
group_2 = Group(Objects=merge_10)  # -> flatten(Group)

data = Data(dec_pan.HMaxels)
dec_hmaxel = DeconstructHMaxel(HMaxel=data)  # -> PassiveLayers, ActiveBoards, Height, RowRange, ColumnRange, DesiredRadius, BlendedRadius, ShapedHMaxel
rectangle_7 = Rectangle(Plane=PlaneXY(0, 0, 0), XSize=dec_hmaxel.RowRange, YSize=dec_hmaxel.ColumnRange, Radius=0)  # -> Rectangle, Length
area = Area(Geometry=rectangle_7.Rectangle)  # -> Area, Centroid

Y_2 = UnitY(Factor=neg_2)
move_4 = Move(Geometry=move_3.Geometry, Motion=Y_2)  # -> Geometry, Transform

num_3 = Number(dec_pan.WidthRange)
num_4 = Number(dec_pan.LengthRange)
dedomain_7 = DeconstructDomain(Domain=num_3)  # -> Start, End
subtraction_9 = Subtraction(A=dedomain_7.End, B=dedomain_7.Start)
division_11 = Division(A=subtraction_9, B=2)
number_slider_27 = Slider(0.174, range=0..1)
addition_7 = Addition(A=dedomain_7.Start, B=division_11)
dom_21 = ConstructDomain(DomainStart=0, DomainEnd=1)
dom_22 = ConstructDomain(DomainStart=addition_7, DomainEnd=dedomain_7.End)
dom_23 = ConstructDomain(DomainStart=addition_7, DomainEnd=dedomain_7.Start)
remap_25 = RemapNumbers(Value=Slider(0.36, range=0.25..1), Source=dom_21, Target=num_4)  # -> Mapped, Clipped
remap_26 = RemapNumbers(Value=Slider(0.051, range=0..0.75), Source=dom_21, Target=num_4)  # -> Mapped, Clipped
remap_27 = RemapNumbers(Value=number_slider_27, Source=dom_21, Target=dom_23)  # -> Mapped, Clipped
remap_28 = RemapNumbers(Value=number_slider_27, Source=dom_21, Target=dom_22)  # -> Mapped, Clipped
pt_25 = ConstructPoint(XCoordinate=remap_25.Mapped, YCoordinate=dedomain_7.Start, ZCoordinate=0)
pt_26 = ConstructPoint(XCoordinate=remap_26.Mapped, YCoordinate=remap_27.Mapped, ZCoordinate=0)
pt_27 = ConstructPoint(XCoordinate=remap_26.Mapped, YCoordinate=remap_28.Mapped, ZCoordinate=0)
pt_28 = ConstructPoint(XCoordinate=remap_25.Mapped, YCoordinate=dedomain_7.End, ZCoordinate=0)
merge_11 = Merge(Data1=pt_25, Data2=pt_26, Data3=pt_27, Data4=pt_28)
nurbs_7 = NurbsCurve(Vertices=merge_11, Degree=2, Periodic=False)  # -> Curve, Length, Domain

# ---- group: generate distribution
pt_29 = Point(simplify(area.Centroid))
data_2 = Data(group)
pdecon = Deconstruct(Point=pt_29)  # -> XComponent, YComponent, ZComponent
bnd = Bounds(Numbers=flatten(pdecon.XComponent))
bnd_2 = Bounds(Numbers=flatten(pdecon.YComponent))
lng_5 = ListLength(List=data_2)
dedomain_8 = DeconstructDomain(Domain=bnd)  # -> Start, End
remap_29 = RemapNumbers(Value=pdecon.YComponent, Source=bnd_2, Target=Domain(0, 1))  # -> graft(Mapped), Clipped
c_script = CSharpScript(count=lng_5, start=dedomain_8.Start, end=dedomain_8.End)  # -> out, A; inputs count: Int32, start: Double, end: Double
# ---------- c_script: C# ----------
    double totalLength = end - start;
    double domLength = totalLength / (double) count;

    List<Interval> intervals = new List<Interval>();
    double currentStart = start;
    for(int i = 0; i < count; i++)
    {
      intervals.Add(new Interval(currentStart, currentStart + domLength));
      currentStart += domLength;
    }
    A = intervals;
# ---------- end c_script ----------
num_5 = Number(graft(pdecon.XComponent))
inc = Includes(Value=num_5, Domain=simplify(c_script.A))  # -> Includes, Deviation
cull = CullPattern(List=data_2, CullPattern=inc.Includes)
item = ListItem(List=cull, Index=0, Wrap=True)
cull_2 = CullPattern(List=c_script.A, CullPattern=inc.Includes)
ungroup = Ungroup(Group=item)  # -> simplify(Objects)
item_2 = ListItem(List=cull_2, Index=0, Wrap=True)
remap_30 = RemapNumbers(Value=num_5, Source=item_2, Target=Domain(0, 1))  # -> Mapped, Clipped
eval = EvaluateCurve(Curve=reparameterize(ungroup), Parameter=remap_29.Mapped)  # -> Point, Tangent, Angle
pdecon_2 = Deconstruct(Point=eval.Point)  # -> XComponent, YComponent, ZComponent
item_3 = ListItem(List=pdecon_2.YComponent, Index=0, Wrap=True)  # -> Item, Item1
twn2nums = TweenTwoNumbers(NumberA=item_3.Item, NumberB=item_3.Item1, Factor=remap_30.Mapped)
num_6 = Number(twn2nums)

pt_30 = Point(simplify(area.Centroid))
data_3 = Data(group_2)
pdecon_3 = Deconstruct(Point=pt_30)  # -> XComponent, YComponent, ZComponent
bnd_3 = Bounds(Numbers=flatten(pdecon_3.XComponent))
bnd_4 = Bounds(Numbers=flatten(pdecon_3.YComponent))
lng_6 = ListLength(List=data_3)
dedomain_9 = DeconstructDomain(Domain=bnd_3)  # -> Start, End
remap_31 = RemapNumbers(Value=pdecon_3.YComponent, Source=bnd_4, Target=Domain(0, 1))  # -> graft(Mapped), Clipped
c_script_2 = CSharpScript(count=lng_6, start=dedomain_9.Start, end=dedomain_9.End)  # -> out, A; inputs count: Int32, start: Double, end: Double; same code as c_script
num_7 = Number(graft(pdecon_3.XComponent))
inc_2 = Includes(Value=num_7, Domain=simplify(c_script_2.A))  # -> Includes, Deviation
cull_3 = CullPattern(List=data_3, CullPattern=inc_2.Includes)
item_4 = ListItem(List=cull_3, Index=0, Wrap=True)
cull_4 = CullPattern(List=c_script_2.A, CullPattern=inc_2.Includes)
ungroup_2 = Ungroup(Group=item_4)  # -> simplify(Objects)
item_5 = ListItem(List=cull_4, Index=0, Wrap=True)
remap_32 = RemapNumbers(Value=num_7, Source=item_5, Target=Domain(0, 1))  # -> Mapped, Clipped
eval_2 = EvaluateCurve(Curve=reparameterize(ungroup_2), Parameter=remap_31.Mapped)  # -> Point, Tangent, Angle
pdecon_4 = Deconstruct(Point=eval_2.Point)  # -> XComponent, YComponent, ZComponent
item_6 = ListItem(List=pdecon_4.YComponent, Index=0, Wrap=True)  # -> Item, Item1
twn2nums_2 = TweenTwoNumbers(NumberA=item_6.Item, NumberB=item_6.Item1, Factor=remap_32.Mapped)
num_8 = Number(twn2nums_2)

# ---- group: material / beech
data_4 = Data(species)

# ---- group: material / spruce
data_5 = Data(species_2)

# ---- group: material / Species
crv_3 = Curve(nurbs_7.Curve)

# ---- group: material
pt_31 = Point(graft(area.Centroid))
xz = XZPlane(Origin=pt_31)
pcx = CurvePlane(Curve=crv_3, Plane=xz)  # -> simplify(Points), ParamsC, ParamsP
pdecon_5 = Deconstruct(Point=pcx.Points)  # -> XComponent, YComponent, ZComponent
pdecon_6 = Deconstruct(Point=pt_31)  # -> XComponent, YComponent, ZComponent
smaller = SmallerThan(FirstNumber=pdecon_5.XComponent, SecondNumber=pdecon_6.XComponent)  # -> SmallerThan, OrEqualTo
not = GateNot(A=smaller.SmallerThan)
cull_5 = CullPattern(List=data_4, CullPattern=not)
cull_6 = CullPattern(List=data_5, CullPattern=smaller.SmallerThan)
merge_12 = Merge(Data1=cull_5, Data2=cull_6)  # -> simplify(Result)
dup = DuplicateData(Data=merge_12, Number="2", Order=True)  # -> simplify(Data)

# ----
num_9 = Number(num_6)
rec = Rectangle(rectangle.Rectangle)
drec_7 = DeconstuctRectangle(Rectangle=rec)  # -> BasePlane, XInterval, YInterval
dom_24 = ConstructDomain(DomainStart=Slider(24, range=0..100), DomainEnd=Slider(75, range=0..100))
remap_33 = RemapNumbers(Value=num_9, Source=drec_7.YInterval, Target=dom_24)  # -> Mapped, Clipped
trim = TrimTree(Tree=remap_33.Mapped, Depth=1)

num_10 = Number(num_8)
rec_2 = Rectangle(rectangle.Rectangle)
drec_8 = DeconstuctRectangle(Rectangle=rec_2)  # -> BasePlane, XInterval, YInterval
dom_25 = ConstructDomain(DomainStart=0, DomainEnd=1)
remap_34 = RemapNumbers(Value=num_10, Source=drec_8.YInterval, Target=dom_25)  # -> Mapped, Clipped
trim_2 = TrimTree(Tree=remap_34.Mapped, Depth=1)

data_6 = Data(panel_3)
data_7 = Data(species_2)
data_8 = Data(dec_pan.HMaxels)

data_9 = Data(data_6)
panel_5 = Panel("""0
1""")
data_10 = Data(data_7)
bilayer = ConstructBilayer(
    Panel=data_9,
    BoardLength=Slider(5, range=0..10),
    RowOffsets=panel_5,
    PassiveSpecies=data_10,
    ActiveThickness=Slider(20, range=0..100),
    PassiveThickness=Slider(4, range=0..10))

data_11 = Data(data_6)
panel_6 = Panel("""1
0""")
data_12 = Data(data_7)
bilayer_2 = ConstructBilayer(
    Panel=data_11,
    BoardLength=Slider(5, range=0..10),
    RowOffsets=panel_6,
    PassiveSpecies=data_12,
    ActiveThickness=Slider(20, range=0..100),
    PassiveThickness=Slider(4, range=0..10))

up_hmaxel = UpdateHMaxel(HMaxel=simplify(data_8), Height=simplify(trim), RadiusFactor=simplify(trim_2), Species=simplify(dup))  # -> flatten(HMaxel)
merge_13 = Merge(Data1=bilayer, Data2=bilayer_2)
data_13 = Data(panel_3)
panel_7 = Panel("""SL7
SR37
SR21
SR32
SR40
SR11
SL16
SR49""")
panel_8 = Panel("""82.6
66.05 * 2
82.6 * 2
(66.05 * 2) + 82.6
82.6
66.05 * 3
82.6
82.6 * 2""")
up_pan = UpdatePanel(Panel=data_13, Bilayers=merge_13, HMaxels=up_hmaxel)
num_11 = Number(panel_8)
name = Panel("SL79")
number_slider_28 = Slider(6, range=0..10)
num_12 = Number(num_2)
division_12 = Division(A=num_12, B=number_slider_28)
num_13 = Number(dec_pan.LengthRange)
num_14 = Number(dec_pan.WidthRange)
rectangle_8 = Rectangle(Plane=PlaneXY(0, 0, 0), XSize=num_13, YSize=num_14, Radius=0)  # -> Rectangle, Length
boundary = BoundarySurfaces(Edges=rectangle_8.Rectangle)

num_15 = Number(dec_pan.WidthRange)
num_16 = Number(dec_pan.LengthRange)
dedomain_10 = DeconstructDomain(Domain=num_15)  # -> Start, End
subtraction_10 = Subtraction(A=dedomain_10.End, B=dedomain_10.Start)
division_13 = Division(A=subtraction_10, B=2)
number_slider_29 = Slider(0.4, range=0..1)
addition_8 = Addition(A=dedomain_10.Start, B=division_13)
dom_26 = ConstructDomain(DomainStart=0, DomainEnd=1)
dom_27 = ConstructDomain(DomainStart=addition_8, DomainEnd=dedomain_10.End)
dom_28 = ConstructDomain(DomainStart=addition_8, DomainEnd=dedomain_10.Start)
remap_35 = RemapNumbers(Value=Slider(0.355, range=0.25..1), Source=dom_26, Target=num_16)  # -> Mapped, Clipped
remap_36 = RemapNumbers(Value=Slider(0.48, range=0..1), Source=dom_26, Target=num_16)  # -> Mapped, Clipped
remap_37 = RemapNumbers(Value=number_slider_29, Source=dom_26, Target=dom_28)  # -> Mapped, Clipped
remap_38 = RemapNumbers(Value=number_slider_29, Source=dom_26, Target=dom_27)  # -> Mapped, Clipped
pt_32 = ConstructPoint(XCoordinate=remap_35.Mapped, YCoordinate=dedomain_10.Start, ZCoordinate=0)
pt_33 = ConstructPoint(XCoordinate=remap_36.Mapped, YCoordinate=remap_37.Mapped, ZCoordinate=0)
pt_34 = ConstructPoint(XCoordinate=remap_36.Mapped, YCoordinate=remap_38.Mapped, ZCoordinate=0)
pt_35 = ConstructPoint(XCoordinate=remap_35.Mapped, YCoordinate=dedomain_10.End, ZCoordinate=0)
merge_14 = Merge(Data1=pt_32, Data2=pt_33, Data3=pt_34, Data4=pt_35)
nurbs_8 = NurbsCurve(Vertices=merge_14, Degree=2, Periodic=False)  # -> Curve, Length, Domain
divide = DivideCurve(Curve=nurbs_8.Curve, Count=Slider(50, range=0..100), Kinks=False)  # -> Points, Tangents, Parameters
srf_cp = SurfaceClosestPoint(Point=divide.Points, Surface=boundary)  # -> Point, UVPoint, Distance

# ---- group: TRIMMING ENDS / Back Trim
number_slider_30 = Slider(140, range=0..360)

# ---- group: TRIMMING ENDS / Front Trim
number_slider_31 = Slider(230, range=0..360)

# ----
number_slider_32 = Slider(6, range=0..10)
num_17 = Number(num_2)
division_14 = Division(A=num_17, B=number_slider_32)
num_18 = Number(dec_pan.WidthRange)
num_19 = Number(dec_pan.LengthRange)
rectangle_9 = Rectangle(Plane=PlaneXY(0, 0, 0), XSize=num_19, YSize=num_18, Radius=0)  # -> Rectangle, Length
boundary_2 = BoundarySurfaces(Edges=rectangle_9.Rectangle)

num_20 = Number(dec_pan.WidthRange)
num_21 = Number(dec_pan.LengthRange)
dedomain_11 = DeconstructDomain(Domain=num_20)  # -> Start, End
subtraction_11 = Subtraction(A=dedomain_11.End, B=dedomain_11.Start)
division_15 = Division(A=subtraction_11, B=2)
number_slider_33 = Slider(0.4, range=0..1)
addition_9 = Addition(A=dedomain_11.Start, B=division_15)
dom_29 = ConstructDomain(DomainStart=0, DomainEnd=1)
dom_30 = ConstructDomain(DomainStart=addition_9, DomainEnd=dedomain_11.End)
dom_31 = ConstructDomain(DomainStart=addition_9, DomainEnd=dedomain_11.Start)
remap_39 = RemapNumbers(Value=Slider(0.355, range=0.25..1), Source=dom_29, Target=num_21)  # -> Mapped, Clipped
remap_40 = RemapNumbers(Value=Slider(0.48, range=0..1), Source=dom_29, Target=num_21)  # -> Mapped, Clipped
remap_41 = RemapNumbers(Value=number_slider_33, Source=dom_29, Target=dom_31)  # -> Mapped, Clipped
remap_42 = RemapNumbers(Value=number_slider_33, Source=dom_29, Target=dom_30)  # -> Mapped, Clipped
pt_36 = ConstructPoint(XCoordinate=remap_39.Mapped, YCoordinate=dedomain_11.Start, ZCoordinate=0)
pt_37 = ConstructPoint(XCoordinate=remap_40.Mapped, YCoordinate=remap_41.Mapped, ZCoordinate=0)
pt_38 = ConstructPoint(XCoordinate=remap_40.Mapped, YCoordinate=remap_42.Mapped, ZCoordinate=0)
pt_39 = ConstructPoint(XCoordinate=remap_39.Mapped, YCoordinate=dedomain_11.End, ZCoordinate=0)
merge_15 = Merge(Data1=pt_36, Data2=pt_37, Data3=pt_38, Data4=pt_39)
nurbs_9 = NurbsCurve(Vertices=merge_15, Degree=2, Periodic=False)  # -> Curve, Length, Domain
divide_2 = DivideCurve(Curve=nurbs_9.Curve, Count=Slider(50, range=0..100), Kinks=False)  # -> Points, Tangents, Parameters
srf_cp_2 = SurfaceClosestPoint(Point=divide_2.Points, Surface=boundary_2)  # -> Point, UVPoint, Distance

Z = UnitZ(Factor=Slider(62, range=0..100))
Y_3 = UnitY(Factor=Slider(2775, range=0..10000))
division_16 = Division(A=Slider(5.6, range=0..10), B="2")
material_buildups = Panel("""100
200
300
101
201
301""")

# ---- group: TRIMMING ENDS / Front Trim
number_slider_34 = Slider(230, range=0..360)

# ---- group: TRIMMING ENDS / Back Trim
number_slider_35 = Slider(140, range=0..360)

# ----
crv_4 = Curve(<curve referenced from the Rhino model>)
crv_5 = Curve(<curve referenced from the Rhino model>)
boundary_3 = BoundarySurfaces(Edges=crv_4)
boundary_4 = BoundarySurfaces(Edges=crv_5)

# ---- group: Create_Data_Path
button_4 = Button()

# ----
panel_9 = Panel("C:\Program Files\SOFiSTiK\2020\SOFiSTiK 2020\sof_cdb_w-70.dll")
panel_10 = Panel("C:\Program Files\SOFiSTiK\2023\SOFiSTiK 2023\sof_cdb_w_edu-2023.dll")
sofistik_path = ValueList({"2022-Edgar": 1, "2022-Other Users": 2}, selected="2022-Edgar")
entwine = Entwine(Branch00="C:\Program Files\SOFiSTiK\2020\SOFiSTiK 2020\wps.exe", Branch01=panel_9, FlattenInputs=True)  # -> simplify(Result)
entwine_2 = Entwine(Branch00="C:\Program Files\SOFiSTiK\2023\SOFiSTiK 2023\wps.exe", Branch01=panel_10, FlattenInputs=True)  # -> simplify(Result)
filter = StreamFilter(Gate=sofistik_path, Stream0=entwine, Stream1=entwine_2)
bang = ExplodeTree(Data=filter)  # -> Branch0, Branch1
pathwps_exe = Data(bang.Branch0)
pathcdb_dll = FilePath(bang.Branch1)
pathinfo = PathInfo()  # -> Directory, Filename, Path
concat = Concatenate(FragmentA=pathinfo.Path)
concat_2 = Concatenate(FragmentA=pathinfo.Path, FragmentB="\", FragmentD="structure")
createfolder = CSharpScript(path=concat, create=button_4)  # -> out, A; inputs path: String, create: Boolean
# ---------- createfolder: C# ----------
 
    
    if (create)
    {    
      if(!System.IO.Directory.Exists(path))
        System.IO.Directory.CreateDirectory(path);
    }
# ---------- end createfolder ----------
panel_11 = Panel(concat)
panel_12 = Panel(concat_2)
path = Data(panel_12)

assemble_mesh_properties_sofimesh = AssembleMeshPropertiesSofiMesh(GroupDivisor="10000", Topo="ON 0", TolG="-0.0001", HMin="0.10", Fein="0.10", EFak="1.5", Prog="1.5", NodeIndex=1000)

panel_13 = Panel("""4.8
4.8""")
panel_14 = Panel("""500
501""")
panel_15 = Panel("""10
10""")
# Material: KOPF
# UNIT 5
# NORM 'DIN' 'en199x-200x' COUN 49 UNIT 5
# 
# HOLZ 1    C '24:1' E90 370 BEZ "=Spruce"
# ARBL EPS BRUC SIG 1.300000[-]
# HMAT 1 TYP FOUR NSP 0.100000 A 1
# 
# HOLZ 4  PLY '40:1' TMAX 10 BEZ "=Plywood 40 Cl.1 (EN 1995)"
# ARBL EPS BRUC SIG 1.200000[-]
# HMAT 4 TYP FOUR NSP 0.100000 A 1
# 
# STAH 6    S '235' TMAX 40 BEZ "=S 235 (EN 10025-2)" GAM 0.0
# ARBL EPS GEBR SIG 1[-]
# ARBL EPS BRUC SIG 1[-] TYP  EXT
# HMAT 3 TYP FOUR NSP 0 A 1
# 
# HOLZ NR 20 ep 17130[N/mm2] g 880[N/mm2] e90 1000[N/mm2] g90 61[N/mm2] gam 7.4[KN/m3]
# 
# 
# HOLZ NR 10 ep 11000[N/mm2] g 690[N/mm2] e90 370[N/mm2] g90 50[N/mm2] gam 4.8[KN/m3]
# 
# 
# HOLZ NR 11 ep 370[N/mm2] g 690[N/mm2] e90 12200[N/mm2] g90 50[N/mm2] gam 4.8[KN/m3]
# 
# MLAY NR 100  T0 {0}[mm]  11 $$
#              T1 {1}[mm]  10 $$
#              T2 {0}[mm]  11 Bez 'Bilayer'
# 
# MLAY NR 101  T0 {0}[mm]  11 $$
#              T1 {1}[mm]  20 $$
#              T2 {0}[mm]  11 Bez 'BilayerB'
# 
# MLAY NR 200  T0 {0}[mm]  11 $$
#              T1 {1}[mm]  10 $$
# 	     T3 {0}[mm]  11 $$
#              T4 {1}[mm]  10 $$
#              T5 {0}[mm]  11 Bez '2Bilayer'
# 
# MLAY NR 201  T0 {0}[mm]  11 $$
#              T1 {1}[mm]  20 $$
# 	     T3 {0}[mm]  11 $$
#              T4 {1}[mm]  20 $$
#              T5 {0}[mm]  11 Bez '2BilayerB'
# 
# MLAY NR 300  T0 {0}[mm]  11 $$
#              T1 {1}[mm]  10 $$
# 	     T2 {0}[mm]  11 $$
#              T3 {1}[mm]  10 $$
# 	     T4 {0}[mm]  11 $$
#              T5 {1}[mm]  10 $$
#              T6 {0}[mm]  11 Bez '3Bilayer'
# 
# MLAY NR 301  T0 {0}[mm]  11 $$
#              T1 {1}[mm]  20 $$
# 	     T2 {0}[mm]  11 $$
#              T3 {1}[mm]  20 $$
# 	     T4 {0}[mm]  11 $$
#              T5 {1}[mm]  20 $$
#              T6 {0}[mm]  11 Bez '3BilayerB'
# timb no 11 ep 17136[N/mm2] g 667[N/mm2] e90 370[N/mm2] g90 50[N/mm2] gam 7.2[KN/m3]
panel_16 = Panel("beech")
# timb no 11 ep 12200[N/mm2] g 690[N/mm2] e90 370[N/mm2] g90 50[N/mm2] gam 4.8[KN/m3]
panel_17 = Panel("Süruce")

# ---- group: AQUA
material = Panel("""KOPF
UNIT 5
NORM 'DIN' 'en199x-200x' COUN 49 UNIT 5

HOLZ 1    C '24:1' E90 370 BEZ "=Spruce"
ARBL EPS BRUC SIG 1.300000[-]
HMAT 1 TYP FOUR NSP 0.100000 A 1

HOLZ 4  PLY '40:1' TMAX 10 BEZ "=Plywood 40 Cl.1 (EN 1995)"
ARBL EPS BRUC SIG 1.200000[-]
HMAT 4 TYP FOUR NSP 0.100000 A 1

STAH 6    S '235' TMAX 40 BEZ "=S 235 (EN 10025-2)" GAM 0.0
ARBL EPS GEBR SIG 1[-]
ARBL EPS BRUC SIG 1[-] TYP  EXT
HMAT 3 TYP FOUR NSP 0 A 1

HOLZ 2    D '30:1' BEZ "=D 30 Cl.1 (EN 1995)"
ARBL EPS BRUC SIG 1.300000[-] TYP  LIM
HMAT 2 TYP FOUR NSP 0.100000 A 1
MATE 99 E  1.00000E+07 G  5.00000E+08 BEZ "Connections"


HOLZ NR 20 ep 17130[N/mm2] g 880[N/mm2] e90 1000[N/mm2] g90 61[N/mm2] gam 7.4[KN/m3]


HOLZ NR 10 ep 11000[N/mm2] g 690[N/mm2] e90 370[N/mm2] g90 50[N/mm2] gam 4.8[KN/m3]


HOLZ NR 11 ep 370[N/mm2] g 690[N/mm2] e90 12200[N/mm2] g90 50[N/mm2] gam 4.8[KN/m3]

MLAY NR 100  T0 {0}[mm]  11 $$
             T1 {1}[mm]  10 $$
             T2 {0}[mm]  11 Bez 'Bilayer'

MLAY NR 101  T0 {0}[mm]  11 $$
             T1 {1}[mm]  20 $$
             T2 {0}[mm]  11 Bez 'BilayerB'

MLAY NR 200  T0 {0}[mm]  11 $$
             T1 {1}[mm]  10 $$
	     T3 {0}[mm]  11 $$
             T4 {1}[mm]  10 $$
             T5 {0}[mm]  11 Bez '2Bilayer'

MLAY NR 201  T0 {0}[mm]  11 $$
             T1 {1}[mm]  20 $$
	     T3 {0}[mm]  11 $$
             T4 {1}[mm]  20 $$
             T5 {0}[mm]  11 Bez '2BilayerB'

MLAY NR 300  T0 {0}[mm]  11 $$
             T1 {1}[mm]  10 $$
	     T2 {0}[mm]  11 $$
             T3 {1}[mm]  10 $$
	     T4 {0}[mm]  11 $$
             T5 {1}[mm]  10 $$
             T6 {0}[mm]  11 Bez '3Bilayer'

MLAY NR 301  T0 {0}[mm]  11 $$
             T1 {1}[mm]  20 $$
	     T2 {0}[mm]  11 $$
             T3 {1}[mm]  20 $$
	     T4 {0}[mm]  11 $$
             T5 {1}[mm]  20 $$
             T6 {0}[mm]  11 Bez '3BilayerB'



STEU
STEU BEWQ 0
QC   2 D 2 MNR 99 MBW 0 IT 100[o/o] AY 100[o/o] AZ 100[o/o] BEZ "Connections"
""")
panel_18 = Panel("4")
panel_19 = Panel("20")
format = Format(Format=material, Culture=127, Data0=panel_18, Data1=panel_19)
panel_20 = Panel(format)
aqua_file = Data(panel_20)

# ----
# Ase: +prog ase urs:5 $ SINGLE LCs
# kopf
# steu solv 4
# WARN = 120,575
# syst prob line iter 1000
# lf 1000 egz 1.0 bez 'G'
# ende
number_slider_36 = Slider(0.05, range=0..0.1)

# ----
# SLS: $--------------------------
# $SOLVER
# #define SOLV = 4 $4 = paralleles Rechnen
# #define WARN = 120,575
# $SYSTEM
# #define PROB = TH3
# #define nITER = 250
# #define FMAX = 1.1
# #define TOL = -0.0001
# #define NMAT = nein
# #define ITER = 3 W2 1 $3 W2 1 = Update Steifigkeit nach jedem Iterationsschritt
# $SEILE
# #define SEIL = 0 $0=ohne inneren Seildurchhang; 2=mit
# $Deadload
# #define G=1.00
# $--------------------------
# 
# +PROG ASE
# #define LF =100
# #define BEZ='1.0G+1.0Gadd'
# KOPF LF$(LF): $(BEZ)
# STEU SOLV $(SOLV) ; STEU ITER $(ITER) ; STEU SEIL $(SEIL)
# SYST PROB $(PROB) ITER $(nITER) FMAX $(FMAX) TOL $(TOL) NMAT $(NMAT)
# STEU WARN $(WARN)
# GRUP      -  $ alle Gruppen einschalten
# 
# LF $(LF) EGZ $(G)*1.0 BEZ $(BEZ)
# LC 1001 FAKT 1.0 $Gadd
# ENDE
# 
# +PROG ASE
# #define LF =101
# #define BEZ='1.0G+1.0Gadd+1.0Code'
# KOPF LF$(LF): $(BEZ)
# STEU SOLV $(SOLV) ; STEU ITER $(ITER) ; STEU SEIL $(SEIL)
# SYST PROB $(PROB) ITER $(nITER) FMAX $(FMAX) TOL $(TOL) NMAT $(NMAT)
# STEU WARN $(WARN)
# GRUP      -  $ alle Gruppen einschalten
# 
# LF $(LF) EGZ $(G)*1.0 BEZ $(BEZ)
# LC 1001 FAKT 1.0 $Gadd
# LC 1002 FAKT 1.0 $Code
# ENDE
# 
# +PROG ASE
# #define LF =102
# #define BEZ='1.0G+1.0Gadd+1.0Code+1.0Q1'
# KOPF LF$(LF): $(BEZ)
# STEU SOLV $(SOLV) ; STEU ITER $(ITER) ; STEU SEIL $(SEIL)
# SYST PROB $(PROB) ITER $(nITER) FMAX $(FMAX) TOL $(TOL) NMAT $(NMAT)
# STEU WARN $(WARN)
# GRUP      -  $ alle Gruppen einschalten
# 
# LF $(LF) EGZ $(G)*1.0 BEZ $(BEZ)
# LC 1001 FAKT 1.0 $Gadd
# LC 1002 FAKT 1.0 $Code
# LC 1003 FAKT 1.0 $Q1
# ENDE
# ULS: $--------------------------
# $SOLVER
# #define SOLV = 4 $4 = paralleles Rechnen
# #define WARN =  120,575
# $SYSTEM
# #define PROB = TH3
# #define nITER = 250
# #define FMAX = 1.1
# #define TOL = -0.0001
# #define NMAT = nein
# #define ITER = 3 W2 1 $3 W2 1 = Update Steifigkeit nach jedem Iterationsschritt
# $SEILE
# #define SEIL = 0 $0=ohne inneren Seildurchhang; 2=mit
# $Deadload
# #define G=1.00
# $--------------------------
# 
# +PROG ASE
# #define LF =200
# #define BEZ='1.35G+1.35Gadd'
# KOPF LF$(LF): $(BEZ)
# STEU SOLV $(SOLV) ; STEU ITER $(ITER) ; STEU SEIL $(SEIL)
# SYST PROB $(PROB) ITER $(nITER) FMAX $(FMAX) TOL $(TOL) NMAT $(NMAT)
# STEU WARN $(WARN)
# GRUP      -  $ alle Gruppen einschalten
# 
# LF $(LF) EGZ $(G)*1.35 BEZ $(BEZ)
# LC 1001 FAKT 1.35 $Gadd
# ENDE
# 
# +PROG ASE
# #define LF =201
# #define BEZ='1.35G+1.35Gadd+1.5Code'
# KOPF LF$(LF): $(BEZ)
# STEU SOLV $(SOLV) ; STEU ITER $(ITER) ; STEU SEIL $(SEIL)
# SYST PROB $(PROB) ITER $(nITER) FMAX $(FMAX) TOL $(TOL) NMAT $(NMAT)
# STEU WARN $(WARN)
# GRUP      -  $ alle Gruppen einschalten
# 
# LF $(LF) EGZ $(G)*1.35 BEZ $(BEZ)
# LC 1001 FAKT 1.35 $Gadd
# LC 1002 FAKT 1.5 $Code
# ENDE
# 
# +PROG ASE
# #define LF =202
# #define BEZ='1.35G+1.35Gadd+1.5Code+1.5Q1'
# KOPF LF$(LF): $(BEZ)
# STEU SOLV $(SOLV) ; STEU ITER $(ITER) ; STEU SEIL $(SEIL)
# SYST PROB $(PROB) ITER $(nITER) FMAX $(FMAX) TOL $(TOL) NMAT $(NMAT)
# STEU WARN $(WARN)
# GRUP      -  $ alle Gruppen einschalten
# 
# LF $(LF) EGZ $(G)*1.35 BEZ $(BEZ)
# LC 1001 FAKT 1.35 $Gadd
# LC 1002 FAKT 1.5 $Code
# LC 1003 FAKT 1.5 $Q1
# ENDE
# ULS: $--------------------------
# $SOLVER
# #define SOLV = 4 $4 = paralleles Rechnen
# #define WARN =  120,575
# $SYSTEM
# #define PROB = line
# #define nITER = 250
# #define FMAX = 1.1
# #define TOL = -0.01
# #define NMAT = nein
# #define ITER = 3 W2 1 $3 W2 1 = Update Steifigkeit nach jedem Iterationsschritt
# $SEILE
# #define SEIL = 0 $0=ohne inneren Seildurchhang; 2=mit
# $Deadload
# #define G=1.00
# $--------------------------
# 
# +PROG ASE
# #define LF =201
# #define BEZ='1.35G+1.35Gadd+1.5Code'
# KOPF LF$(LF): $(BEZ)
# STEU SOLV $(SOLV) ; STEU ITER $(ITER) ; STEU SEIL $(SEIL)
# SYST PROB $(PROB) ITER $(nITER) FMAX $(FMAX) TOL $(TOL) NMAT $(NMAT)
# STEU WARN $(WARN)
# GRUP      -  $ alle Gruppen einschalten
# 
# LF $(LF) EGZ $(G)*1.35 BEZ $(BEZ)
# LC 1001 FAKT 1.35 $Gadd
# LC 1002 FAKT 1.5 $Code
# ENDE
sls = Panel("""$--------------------------
$SOLVER
#define SOLV = 4 $4 = paralleles Rechnen
#define WARN = 120,575
$SYSTEM
#define PROB = line
#define nITER = 250
#define FMAX = 1.1
#define TOL = -0.01
#define NMAT = nein
#define ITER = 3 W2 1 $3 W2 1 = Update Steifigkeit nach jedem Iterationsschritt
$SEILE
#define SEIL = 0 $0=ohne inneren Seildurchhang; 2=mit
$Deadload
#define G=1.00
$--------------------------

+PROG ASE
#define LF =101
#define BEZ='1.0G'
KOPF LF$(LF): $(BEZ)
STEU SOLV $(SOLV) ; STEU ITER $(ITER) ; STEU SEIL $(SEIL)
SYST PROB $(PROB) ITER $(nITER) FMAX $(FMAX) TOL $(TOL) NMAT $(NMAT)
STEU WARN $(WARN)
GRUP      -  $ alle Gruppen einschalten

LF $(LF) EGZ $(G)*1.0 BEZ $(BEZ)
ENDE""")
ase = Panel("""+prog ase urs:5 $ SINGLE LCs
kopf
steu solv 4
WARN = 120,575
syst prob line iter 1000
lf 1000 egz 1.0 bez 'G'
ende""")
merge_16 = Merge(Data1=ase, Data2=sls)

# ---- group: Loading / Random Point Load / Point Load
panel_21 = Panel("1003")  # disabled
panel_22 = Panel("pzz")  # disabled
panel_23 = Panel("-1.0")  # disabled

# ----
button_5 = Button()
panel_24 = Panel("""101 SLS - Deform
202 ULS - Stresses""")
number_slider_37 = Slider(6000, range=0..10000)

# ---- group: Deformation / mm
kragarmlänge = Data()
multiplication = Multiplication(A=kragarmlänge, B=1000)
division_17 = Division(A=multiplication, B="150")
panel_25 = Panel(division_17)

# ---- group: Manual Stress Calculation
python = GhPythonScript(E0="11000", E90="400", t1="5", t2="20", nxx="5", mxx="0.5", nyy="5", myy="0.5")  # -> out, sigma_x_top, sigma_x_bot, sig_y_top_1, sig_y_int_1, sig_y_int_2, sig_y_bot_2
# ---------- python: Python ----------
import math 

# -------------- X direction -------------
Ax  = t2
Wxx = Ax*Ax/6

sigma_nx    = nxx / Ax
sigma_mxx   = mxx / Wxx * 1000
sigma_x_top = sigma_nx - sigma_mxx
sigma_x_bot = sigma_nx + sigma_mxx


# -------------- Y direction -------------
by_eq   = E90/E0
Ay_1    = t1
Ay_2    = t2 * by_eq
Ay_eq   = Ay_1 + Ay_2 
zg_y_1  = t1/2
zg_y_2  = t1 + t2/2
zg_y    = (zg_y_1 * Ay_1 + zg_y_2 * Ay_2) / Ay_eq
Iyy_1   = t1*t1*t1/12
Iyy_2   = t2*t2*t2/12*by_eq
Iyy     = Iyy_1 + Iyy_2 + math.pow(zg_y - zg_y_1,2)*Ay_1 + math.pow(zg_y - zg_y_2,2)*Ay_2

eps_y_top = myy / Iyy / E0 * (0 - zg_y) * 1000         + nyy / Ay_eq / E0
eps_y_int = myy / Iyy / E0 * (t1 - zg_y) * 1000        + nyy / Ay_eq / E0
eps_y_bot = myy / Iyy / E0 * (t1 + t2 - zg_y) * 1000   + nyy / Ay_eq / E0

sig_y_top_1 = eps_y_top * E0
sig_y_int_1 = eps_y_int * E0 
sig_y_int_2 = eps_y_int * E90 
sig_y_bot_2 = eps_y_bot * E90
# ---------- end python ----------
panel_26 = Panel([python.sig_y_top_1, python.sig_y_int_1, python.sig_y_int_2, python.sig_y_bot_2])

# ---- group: Manual Stress Calculation / Make sure you have used the same setting for analysis!
panel_27 = Panel("5")
panel_28 = Panel("20")
panel_29 = Panel("11000")
panel_30 = Panel("400")

# ----
number_slider_38 = Slider(0.2, range=0..1)
panel_31 = Panel("150")

fonts = FontTable()
item_7 = ListItem(List=fonts, Index=Slider(28, range=0..436), Wrap=True)
panel_32 = Panel(item_7)

# ---- group: spruce left
panel_33 = Panel("https://docs.google.com/spreadsheets/d/1Q0xuMOoM9MJtYBJnVYEzEPmUDS6WbwrvgMLvJoCEvrc/edit#gid=0")
readcell = ReadCell(
    SpreadsheetURL=panel_33,
    SheetName="Sheet1",
    CellRange="A3:B82",
    DuplicateMerged=False,
    SameLength=False,
    Read=Toggle(True))
decell = DeconstructCell(Cell=readcell)  # -> FormattedValue, UserEnteredValue, CellFormat

# ---- group: spruce left / remove null branches
c_script_3 = CSharpScript(obj=decell.FormattedValue)  # -> out, A; inputs obj: tree
# ---------- c_script_3: C# ----------
    DataTree<object> output = new DataTree<object>();
    
    int currentID = 0;
    for(int i = 0; i < obj.BranchCount; i++)
    {
      if(obj.Branch(i)[1] as string != "null")
      {
        output.AddRange(obj.Branch(i), new GH_Path(currentID));
        currentID++;
      }
    }
    A = output;
# ---------- end c_script_3 ----------

# ---- group: spruce left (continued)
item_8 = ListItem(List=c_script_3.A, Index=0, Wrap=True)  # -> flatten(Item), Item1

# ---- group: name
data_14 = Data(item_8.Item)
lng_7 = ListLength(List=data_14)
dup_2 = DuplicateData(Data="SL", Number=lng_7, Order=True)  # -> graft(Data)
txt = Text(graft(data_14))
merge_17 = Merge(Data1=simplify(dup_2), Data2=simplify(txt))
join = TextJoin(Text=merge_17)

# ---- group: rt
num_22 = Number(item_8.Item1)

# ---- group: spruce right
panel_34 = Panel("https://docs.google.com/spreadsheets/d/1Q0xuMOoM9MJtYBJnVYEzEPmUDS6WbwrvgMLvJoCEvrc/edit#gid=0")
readcell_2 = ReadCell(
    SpreadsheetURL=panel_34,
    SheetName="Sheet1",
    CellRange="D3:E70",
    DuplicateMerged=False,
    SameLength=False,
    Read=Toggle(True))
decell_2 = DeconstructCell(Cell=readcell_2)  # -> FormattedValue, UserEnteredValue, CellFormat

# ---- group: spruce right / remove null branches
c_script_4 = CSharpScript(obj=decell_2.FormattedValue)  # -> out, A; inputs obj: tree; same code as c_script_3

# ---- group: spruce right (continued)
item_9 = ListItem(List=c_script_4.A, Index=0, Wrap=True)  # -> flatten(Item), Item1

# ---- group: name
data_15 = Data(item_9.Item)
lng_8 = ListLength(List=data_15)
dup_3 = DuplicateData(Data="SR", Number=lng_8, Order=True)  # -> graft(Data)
txt_2 = Text(graft(data_15))
merge_18 = Merge(Data1=simplify(dup_3), Data2=simplify(txt_2))
join_2 = TextJoin(Text=merge_18)

# ---- group: rt
num_23 = Number(item_9.Item1)

# ----
merge_19 = Merge(Data1=join, Data2=num_22)
merge_20 = Merge(Data1=join_2, Data2=num_23)
entwine_3 = Entwine(Branch0X=merge_19, Branch1X=merge_20, FlattenInputs=False)
renumber = RenumberPaths(Data=entwine_3)
item_10 = ListItem(List=renumber, Index=0, Wrap=True)  # -> flatten(Item), flatten(Item1)

# ---- group: beech left
panel_35 = Panel("https://docs.google.com/spreadsheets/d/1Q0xuMOoM9MJtYBJnVYEzEPmUDS6WbwrvgMLvJoCEvrc/edit#gid=0")
readcell_3 = ReadCell(
    SpreadsheetURL=panel_35,
    SheetName="Sheet1",
    CellRange="G3:H36",
    DuplicateMerged=False,
    SameLength=False,
    Read=Toggle(True))
decell_3 = DeconstructCell(Cell=readcell_3)  # -> FormattedValue, UserEnteredValue, CellFormat

# ---- group: beech left / remove null branches
c_script_5 = CSharpScript(obj=decell_3.FormattedValue)  # -> out, A; inputs obj: tree; same code as c_script_3

# ---- group: beech left (continued)
item_11 = ListItem(List=c_script_5.A, Index=0, Wrap=True)  # -> flatten(Item), Item1

# ---- group: name
data_16 = Data(item_11.Item)
lng_9 = ListLength(List=data_16)
dup_4 = DuplicateData(Data="BL", Number=lng_9, Order=True)  # -> graft(Data)
txt_3 = Text(graft(data_16))
merge_21 = Merge(Data1=simplify(dup_4), Data2=simplify(txt_3))
join_3 = TextJoin(Text=merge_21)

# ---- group: rt
num_24 = Number(item_11.Item1)

# ---- group: beech right
panel_36 = Panel("https://docs.google.com/spreadsheets/d/1Q0xuMOoM9MJtYBJnVYEzEPmUDS6WbwrvgMLvJoCEvrc/edit#gid=0")
readcell_4 = ReadCell(
    SpreadsheetURL=panel_36,
    SheetName="Sheet1",
    CellRange="J3:K38",
    DuplicateMerged=False,
    SameLength=False,
    Read=Toggle(True))
decell_4 = DeconstructCell(Cell=readcell_4)  # -> FormattedValue, UserEnteredValue, CellFormat

# ---- group: beech right / remove null branches
c_script_6 = CSharpScript(obj=decell_4.FormattedValue)  # -> out, A; inputs obj: tree; same code as c_script_3

# ---- group: beech right (continued)
item_12 = ListItem(List=c_script_6.A, Index=0, Wrap=True)  # -> flatten(Item), Item1

# ---- group: name
data_17 = Data(item_12.Item)
lng_10 = ListLength(List=data_17)
dup_5 = DuplicateData(Data="BR", Number=lng_10, Order=True)  # -> graft(Data)
txt_4 = Text(graft(data_17))
merge_22 = Merge(Data1=simplify(dup_5), Data2=simplify(txt_4))
join_4 = TextJoin(Text=merge_22)

# ---- group: rt
num_25 = Number(item_12.Item1)

# ----
merge_23 = Merge(Data1=join_3, Data2=num_24)
merge_24 = Merge(Data1=join_4, Data2=num_25)
entwine_4 = Entwine(Branch0X=merge_23, Branch1X=merge_24, FlattenInputs=False)
renumber_2 = RenumberPaths(Data=entwine_4)
item_13 = ListItem(List=renumber_2, Index=0, Wrap=True)  # -> flatten(Item), flatten(Item1)

lng_11 = ListLength(List=item_10.Item)
lng_12 = ListLength(List=item_13.Item)
dup_6 = DuplicateData(Data=Slider(1000, range=0..1000), Number=lng_12, Order=True)
dup_7 = DuplicateData(Data=Slider(150, range=0..1000), Number=lng_12, Order=True)
dup_8 = DuplicateData(Data=Slider(27, range=0..100), Number=lng_11, Order=True)
dup_9 = DuplicateData(Data=species, Number=lng_12, Order=True)
dup_10 = DuplicateData(Data=Slider(27, range=0..100), Number=lng_12, Order=True)
dup_11 = DuplicateData(Data=species_2, Number=lng_11, Order=True)
dup_12 = DuplicateData(Data=Slider(2400, range=0..2500), Number=lng_11, Order=True)
dup_13 = DuplicateData(Data=Slider(150, range=0..1000), Number=lng_11, Order=True)
merge_25 = Merge(Data1=item_10.Item1, Data2=item_13.Item1)
merge_26 = Merge(Data1=dup_8, Data2=dup_10)
merge_27 = Merge(Data1=dup_12, Data2=dup_6)
merge_28 = Merge(Data1=dup_13, Data2=dup_7)
merge_29 = Merge(Data1=item_10.Item, Data2=item_13.Item)
merge_30 = Merge(Data1=dup_11, Data2=dup_9)

stock_boards = StockBoards(Name=merge_29, Species=merge_30, Thickness=merge_26, Length=merge_27, Width=merge_28, RTAngle=merge_25, MoistureChange=0)
python_2 = GhPythonScript(board=stock_boards)  # -> out, simplify(a)
# ---------- python_2: Python ----------
a = board.DesignBoards
# ---------- end python_2 ----------
dec_active_board = DeconstructActiveBoard(ActiveBoard=python_2.a)  # -> HMaxels, StockBoard, Thickness, RowRange, ColumnRange, DesiredRadius, Radius, BlendedRadius, MoistureChange, ShapedBoard
python_3 = GhPythonScript(AB=python_2.a)  # -> out, a
# ---------- python_3: Python ----------
if AB == None:
    a = -1
else:
    a = AB.ActiveLayer.Bilayer.ID
# ---------- end python_3 ----------
dedomain_12 = DeconstructDomain(Domain=dec_active_board.RowRange)  # -> graft(Start), End
null = NullItem(Item=python_2.a)  # -> NullFlags, InvalidFlags, Description
trim_3 = TrimTree(Tree=simplify(dedomain_12.Start), Depth=1)
cull_7 = CullPattern(List=Slider(10000, range=0..10000), CullPattern=null.NullFlags)
merge_31 = Merge(Data1=simplify(trim_3), Data2=simplify(cull_7))

panel_37 = Panel("""7
2.5""")
data_18 = Data(up_pan)
c_script_7 = CSharpScript(Reference="C:\Users\Alex Reiner\AppData\Roaming\Grasshopper\Libraries\HygroDesign.Core.dll")  # -> out, A
# ---------- c_script_7: C# usings ----------
using BilayerDesign;
# ---------- c_script_7: C# ----------
    TimoshenkoPrediction timo = new TimoshenkoPrediction();
    A = timo;
# ---------- c_script_7: C# additional code ----------
  public class TimoshenkoPrediction : PredictionEngine
  {

    public TimoshenkoPrediction()
    {
    }

    public override double Predict(StockBoard board, Bilayer bilayer, double moistureChange)
    {
      double h1 = bilayer.PassiveLayer.Thickness;
      double h2 = bilayer.ActiveLayer.Thickness;
      double h = h1 + h2;
      double m = h1 / h2;
      double e1 = bilayer.PassiveLayer.Species.Attributes["LEmod"];
      double e2 = GrainAngleInterpolation(board.RTAngle, board.Species.Attributes["REmod"], board.Species.Attributes["TEmod"]);
      double n = e1 / e2;
      double a1 = bilayer.PassiveLayer.Species.Attributes["LExp"];
      double a2 = GrainAngleInterpolation(board.RTAngle, board.Species.Attributes["RExp"], board.Species.Attributes["TExp"]);
      double deltaAlpha = a2 - a1;
      double kValue = 6 * Math.Pow(1.0 + m, 2) / (3 * Math.Pow(1 + m, 2) + (1 + m * n) * Math.Pow(m, 2) + (1 / (m * n)));
      double curvature = kValue * ((moistureChange * deltaAlpha) / h);
      return 1 / (curvature /* * TimError*/ );
    }

    public static double GrainAngleInterpolation(double rtAngle, double eR, double eT)
    {
      double angleConv = RhinoMath.ToRadians(rtAngle);
      double angleT = Math.Cos(angleConv);
      double angleR = Math.Sin(angleConv);
      double eActive = eT * Math.Pow(angleT, 2) + eR * Math.Pow(angleR, 2);
      return eActive;
    }
  }
# ---------- end c_script_7 ----------
data_19 = Data(stock_boards)
stockpile = ConstructStockPile(Panels=data_18, StockBoards=data_19, MoistureChanges=panel_37, PredictionEngine=c_script_7.A)
sel_env = ConstructSelectionEnvironment(Panels=data_18, StockPile=stockpile)

sort = SortList(Keys=python_3.a, ValuesA=merge_31)  # -> Keys, ValuesA
item_14 = ListItem(List=sort.ValuesA, Index=0, Wrap=True)  # -> flatten(Item)
item_15 = ListItem(List=sort.Keys, Index=0, Wrap=True)  # -> flatten(Item)
cset = CreateSet(List=flatten(item_15))  # -> graft(Set), Map

# ---- group: convolution
c_script_8 = CSharpScript(
    tan=Slider(3, range=0.01..3),
    lon=Slider(3, range=0.01..3),
    rad=Slider(10000, range=0..10000),
    stiff=Slider(0.75, range=0.01..3),
    Reference="C:\USERS\ALEX REINER\APPDATA\ROAMING\GRASSHOPPER\LIBRARIES\HygroDesign.Core.dll")  # -> out, A; inputs tan: Double, lon: Double, rad: Double, stiff: Double, thick: Double
# ---------- c_script_8: C# ----------
    HMaxelConvolution convEngine = new HMaxelConvolution(tan, lon, rad, stiff, thick);
    A = convEngine;
# ---------- c_script_8: C# additional code ----------
  public class HMaxelConvolution : ConvolutionEngine
  {
    public double Tangential { get; set; }
    public double Longitudinal { get; set; }
    public double RadiusMax { get; set; }
    public double StiffnessInfluence { get; set; }
    public double ThicknessInfluence { get; set; }
    public HMaxelConvolution(double tangential, double longitudinal, double radiusMax, double stiffnessInfluence, double thicknessInfluence)
    {
      Tangential = tangential;
      Longitudinal = longitudinal;
      RadiusMax = radiusMax;
      StiffnessInfluence = stiffnessInfluence;
      ThicknessInfluence = thicknessInfluence;
    }

    public override Panel Convolution(Panel panel)
    {
      double MaxRad = double.MinValue;
      double MinRad = double.MaxValue;

      double MaxRStiff = double.MinValue;
      double MinRStiff = double.MaxValue;
      double MaxLStiff = double.MinValue;
      double MinLStiff = double.MaxValue;

      for (int i = 0; i < panel.HMaxels.GetLength(0); i++)
      {
        for (int j = 0; j < panel.HMaxels.GetLength(1); j++)
        {
          double averageRStiffness = 0;
          double averageLStiffness = 0;
          double weightedRadius = 0;
          double totalRWeights = 0;

          HMaxel hmaxel = panel.HMaxels[i, j];
          List<Tuple<double, double>> tuples = new List<Tuple<double, double>>();
          for (int v = 0; v < hmaxel.ActiveBoards.Count; v++)
          {
            averageRStiffness += (double) hmaxel.ActiveBoards[v].StockBoard.Species.Attributes["REmod"];
            averageLStiffness += (double) hmaxel.ActiveBoards[v].StockBoard.Species.Attributes["LEmod"];

            weightedRadius += (hmaxel.ActiveBoards[v].Radius * (double) hmaxel.ActiveBoards[v].StockBoard.Species.Attributes["REmod"]);
            totalRWeights += (double) hmaxel.ActiveBoards[v].StockBoard.Species.Attributes["REmod"];

          }
          averageRStiffness /= hmaxel.ActiveBoards.Count;
          averageLStiffness /= hmaxel.ActiveBoards.Count;
          weightedRadius /= totalRWeights;
          panel.HMaxels[i, j].Attributes.Add("REmod", averageRStiffness);
          panel.HMaxels[i, j].Attributes.Add("LEmod", averageLStiffness);
          panel.HMaxels[i, j].Attributes.Add("weighted radius", weightedRadius);
          panel.HMaxels[i, j].BlendedRaidus = weightedRadius;

          /*
          if (weightedRadius > MaxRad) MaxRad = weightedRadius;
          if (weightedRadius < MinRad) MinRad = weightedRadius;
          if (averageLStiffness > MaxLStiff) MaxLStiff = averageLStiffness;
          if (averageLStiffness < MinLStiff) MinLStiff = averageLStiffness;
          if (averageRStiffness > MaxRStiff) MaxRStiff = averageRStiffness;
          if (averageRStiffness < MinRStiff) MinRStiff = averageRStiffness;
     */
        }
      }

      /*
      //set factors
      for (int i = 0; i < panel.HMaxels.GetLength(0); i++)
      {
        for (int j = 0; j < panel.HMaxels.GetLength(1); j++)
        {
          panel.HMaxels[i, j].Attributes.Add("REmodFactor", Remap((double) panel.HMaxels[i, j].Attributes["REmod"], MinRStiff, MaxRStiff, 1 - StiffnessInfluence, 1));
          panel.HMaxels[i, j].Attributes.Add("LEmodFactor", Remap((double) panel.HMaxels[i, j].Attributes["LEmod"], MinLStiff, MaxLStiff, 1 - StiffnessInfluence, 1));
          panel.HMaxels[i, j].Attributes.Add("RadiusFactor", Remap((double) panel.HMaxels[i, j].Attributes["weighted radius"], MinRad, RadiusMax, 1, 0));

        }
      }

      //horizontal convolution
      for (int i = 0; i < panel.HMaxels.GetLength(0); i++)
      {
        for (int j = 0; j < panel.HMaxels.GetLength(1); j++)
        {
          double totalWeights = 0;
          double blendedRadius = 0;
          for (int x = 0; x < panel.HMaxels.GetLength(0); x++)
          {
            for (int y = 0; y < panel.HMaxels.GetLength(1); y++)
            {

              double xdist = Math.Abs(panel.HMaxels[i, j].X - panel.HMaxels[x, y].X);
              double ydist = Math.Abs(panel.HMaxels[i, j].Y - panel.HMaxels[x, y].Y);
              double LFactor = (double) panel.HMaxels[x, y].Attributes["LEmodFactor"] / Math.Pow(xdist + 1, Longitudinal);
              double RFactor = (double) panel.HMaxels[x, y].Attributes["REmodFactor"] / Math.Pow(ydist + 1, Tangential);
              blendedRadius += (double) panel.HMaxels[x, y].Attributes["weighted radius"] * (double) panel.HMaxels[i, j].Attributes["RadiusFactor"] * LFactor * RFactor;
              totalWeights += (double) panel.HMaxels[x, y].Attributes["RadiusFactor"] * LFactor * RFactor;

            }
          }

          panel.HMaxels[i, j].BlendedRaidus = blendedRadius / totalWeights;

        }
      }
  */


      return panel;
    }
    public static double Remap(double val, double from1, double to1, double from2, double to2)
    {
      return (val - from1) / (to1 - from1) * (to2 - from2) + from2;
    }
  }
# ---------- end c_script_8 ----------
data_20 = Data(sel_env)
rad_blend = RadiusBlending(Panels=data_20, ConvolutionEngine=c_script_8.A)
dec_pan_2 = DeconstructPanel(Panel=rad_blend)  # -> Bilayers, HMaxels, LengthRange, WidthRange
dec_hmaxel_2 = DeconstructHMaxel(HMaxel=dec_pan_2.HMaxels)  # -> PassiveLayers, ActiveBoards, Height, RowRange, ColumnRange, DesiredRadius, BlendedRadius, ShapedHMaxel

# ----
equals = Equality(FirstNumber=cset.Set, SecondNumber=item_15)  # -> Equality, Inequality
data_21 = Data(stock_boards)
cull_8 = CullPattern(List=data_21, CullPattern=equals.Equality)  # -> simplify(List)
cull_9 = CullPattern(List=item_14, CullPattern=equals.Equality)  # -> simplify(List)
sort_2 = SortList(Keys=cull_9, ValuesA=cull_8)  # -> reverse(Keys), reverse(ValuesA)
python_4 = GhPythonScript(x=stockpile)  # -> out, graft(Boards)
# ---------- python_4: Python ----------
boards = []
for stockboard in x.StockBoards:
    if stockboard.DesignBoards.Count == 0:
        boards.append(stockboard)
        
Boards = boards
# ---------- end python_4 ----------
bang_2 = ExplodeTree(Data=sort_2.ValuesA)  # -> Branch0, Branch1, Branch2
dec_stock_board = DeconstructStockBoard(StockBoard=python_4.Boards)  # -> Name, Species, RTAngle, Length, Width, ActiveBoards
python_5 = GhPythonScript(stockpile=stockpile, name=name)  # -> out, thisBoard, similarUnused
# ---------- python_5: Python ----------
board = None
similarList = []

def rtDiff(stockboard):
    return abs(stockboard.RTAngle - board.RTAngle)

for stockboard in stockpile.StockBoards:
    if stockboard.Name == name:
        board = stockboard

for stockboard in stockpile.StockBoards:
    if board.Species == stockboard.Species and stockboard.DesignBoards.Count == 0:
        similarList.append(stockboard)

similarList.sort(key=rtDiff)

thisBoard = board
similarUnused = similarList
# ---------- end python_5 ----------
merge_32 = Merge(Data1=flatten(bang_2.Branch1), Data2=flatten(bang_2.Branch2))
dec_secies = DeconstructSpecies(Species=dec_stock_board.Species)
dec_stock_board_2 = DeconstructStockBoard(StockBoard=bang_2.Branch0)  # -> flatten(Name), Species, RTAngle, Length, Width, ActiveBoards
dec_stock_board_3 = DeconstructStockBoard(StockBoard=merge_32)  # -> flatten(Name), Species, RTAngle, Length, Width, ActiveBoards
chars = Characters(Text=dec_secies)  # -> Result, Unicode
dec_stock_board_4 = DeconstructStockBoard(StockBoard=python_5.thisBoard)  # -> Name, Species, RTAngle, Length, Width, ActiveBoards
dec_stock_board_5 = DeconstructStockBoard(StockBoard=python_5.similarUnused)  # -> flatten(Name), Species, flatten(RTAngle), Length, Width, ActiveBoards

num_26 = Number(expr("x/2", num_12))
dedomain_13 = DeconstructDomain(Domain=dec_hmaxel_2.RowRange)  # -> Start, End
bnd_5 = Bounds(Numbers=dedomain_13.Start)
bnd_6 = Bounds(Numbers=dedomain_13.End)
dedomain_14 = DeconstructDomain(Domain=bnd_5)  # -> Start, End
dedomain_15 = DeconstructDomain(Domain=bnd_6)  # -> Start, End
x_minus_one = XMinusOne(NumberX=division_12)
subtraction_12 = Subtraction(A=dedomain_15.End, B=dedomain_14.Start)
division_18 = Division(A=subtraction_12, B=x_minus_one)
series_3 = Series(Start=dedomain_14.Start, Step=division_18, Count=division_12)
pt_40 = ConstructPoint(XCoordinate=series_3, YCoordinate=0, ZCoordinate=0)
yz = YZPlane(Origin=pt_40)  # -> simplify(graft(Plane))

lng_13 = ListLength(List=chars.Result)
panel_38 = Panel(dec_stock_board_2.Name)
panel_39 = Panel(dec_stock_board_3.Name)
panel_40 = Panel(dec_stock_board_4.RTAngle)
panel_41 = Panel(dec_stock_board_5.Name)
panel_42 = Panel(dec_stock_board_5.RTAngle)
equals_2 = Equality(FirstNumber=lng_13, SecondNumber=Slider(5, range=0..10))  # -> Equality, Inequality

partition = PartitionList(List=dec_hmaxel_2.BlendedRadius, Size=num_12)  # -> simplify(Chunks)
flip = FlipMatrix(Data=partition)
num_27 = Number(flip)
c_script_9 = CSharpScript(x=num_27, y=number_slider_28)  # -> out, A; inputs x: tree, y: Int32
# ---------- c_script_9: C# ----------
    DataTree<object> output = new DataTree<object>();

    for(int i = 0; i < x.BranchCount; i++)
    {
      if(i % y == 0)output.AddRange(x.Branch(i), new GH_Path(i));
    }
    A = output;
# ---------- end c_script_9 ----------
renumber_3 = RenumberPaths(Data=c_script_9.A)

dispatch = Dispatch(List=python_4.Boards, DispatchPattern=equals_2.Equality)  # -> flatten(ListA), flatten(ListB)
data_22 = Data(dispatch.ListA)
data_23 = Data(dispatch.ListB)

num_28 = Number(num)
pln = Plane(yz)
num_29 = Number(renumber_3)
c_script_10 = CSharpScript()  # -> out, A; inputs x: tree
# ---------- c_script_10: C# ----------
    DataTree<object> output = new DataTree<object>();
    int firstIndex = 0;
    int branchCount = 0;
    for(int i = 0; i < x.BranchCount; i++)
    {
      GH_Path path = new GH_Path(firstIndex, branchCount);
      if(x.Paths[i][0] == firstIndex)
      {
        output.AddRange(x.Branch(i), path);
      }
      else
      {
        firstIndex++;
        branchCount = -1;
        i--;
      }
      branchCount++;
    }
    A = output;
# ---------- end c_script_10 ----------
c_script_11 = CSharpScript(iRadii=num_29, iBoardWidth=num_28, iPlanes=pln)  # -> out, simplify(A); inputs iRadii: tree of Double, iBoardWidth: Double, iPlanes: tree of Plane
# ---------- c_script_11: C# ----------
    DataTree<Point3d> pointTree = new DataTree<Point3d>();

    for (int j = 0; j < iRadii.BranchCount; j++)
    {

      //initialize variables
      Plane bp = iPlanes.Branch(j)[0];
      Point3d startPoint = new Point3d(bp.Origin);
      Point3d centerPoint = startPoint;
      Vector3d rotationAxis = new Vector3d(bp.ZAxis);
      Vector3d centerPointVect = new Vector3d(bp.YAxis);
      centerPointVect.Rotate(Math.PI / 2, rotationAxis);

      for (int i = 0; i < iRadii.Branch(j).Count; i++){
        GH_Path pth = iRadii.Paths[j].AppendElement(i);
        Point3d point1 = startPoint;
        Point3d point2 = startPoint;

        pointTree.Add(point1, pth);

        //calculate rotation angle
        Double arcLength = iBoardWidth;
        Double radius = iRadii.Branch(j)[i];
        Double rotation = (arcLength / radius);

        //calculate rotation center point
        centerPointVect.Unitize();
        centerPointVect *= radius;
        centerPoint += centerPointVect;


        //execute half rotation
        Transform tx = Transform.Rotation(rotation / 2, rotationAxis, centerPoint);


        point2.Transform(tx);
        pointTree.Add(point2, pth);

        //execute full rotation
        tx = Transform.Rotation(rotation, rotationAxis, centerPoint);
        startPoint.Transform(tx);
        pointTree.Add(startPoint, pth);

        //updata rotation parameters
        centerPoint = startPoint;
        centerPointVect.Transform(tx);
      }
    }
    A = pointTree;
# ---------- end c_script_11 ----------

trim_4 = TrimTree(Tree=c_script_11.A, Depth=1)
cullpt = CullDuplicates(Points=trim_4, Tolerance=0.1, CullMode=3)  # -> Points, Indices, Valence
pt_41 = Point(cullpt.Points)

# ---- group: animate
pt_42 = Point(simplify(pt_41))
pln_2 = Plane(graft(pln))
num_30 = Number(Slider(1, range=0..1))
c_script_12 = CSharpScript(iPoints=simplify(pt_42), iPlanes=pln_2, iShapeFactor=num_30)  # -> out, A; inputs iPoints: tree of Point3d, iPlanes: tree of Plane, iShapeFactor: Double
# ---------- c_script_12: C# ----------
    DataTree<Point3d> output = new DataTree<Point3d>();
    
    double shapeFactor = 1.0 - iShapeFactor;

    //step through curves
    for (int i = 0; i < iPoints.BranchCount; i++)
    {
      Plane currentPlane = iPlanes.Branch(iPoints.Path(i)[0])[0];

      //get vectors from plane
      Vector3d zVect = currentPlane.YAxis;

      Vector3d rotVect = currentPlane.ZAxis;

      //create new startpoint inside list
      Point3d startPoint = iPoints.Branch(i)[0];

      //step through points. Create and rotate vectors
      for (int j = 0; j < iPoints.Branch(i).Count; j++)
      {
        if (j == 0) output.Add(startPoint, iPoints.Path(i));
        else{
          //create current segment vector
          Vector3d segmentVect = new Vector3d(iPoints.Branch(i)[j] - iPoints.Branch(i)[j - 1]);

          //measure angle with vertical vector
          double angle = Vector3d.VectorAngle(zVect, segmentVect, currentPlane);

          //rotate
          segmentVect.Rotate(-angle * shapeFactor, rotVect);

          startPoint += segmentVect;
          output.Add(startPoint, iPoints.Path(i));
        }
      }
    }

    A = output;
# ---------- end c_script_12 ----------
pt_43 = Point(c_script_12.A)
intcrv = Interpolate(Vertices=pt_43, Degree=3, Periodic=False, KnotStyle=1)  # -> Curve, Length, Domain
crv_6 = Curve(intcrv.Curve)

# ----
crv_7 = Curve(crv_6)
pt_44 = Point(simplify(graft(yz)))
end = EndPoints(Curve=crv_7)  # -> Start, End
vec2pt = Vector2Pt(PointA=end.Start, PointB=end.End, Unitize=False)  # -> Vector, Length
yz_2 = YZPlane(Origin=end.Start)
Y_4 = UnitY(Factor="-1")
angle = Angle(VectorA=vec2pt.Vector, VectorB=Y_4, Plane=yz_2)  # -> Angle, Reflex
rotate = Rotate(Geometry=crv_7, Angle=angle.Angle, Plane=yz_2)  # -> Geometry, Transform
curvepoint = PointOnCurve(rotate.Geometry, parameter=0.5)
vec2pt_2 = Vector2Pt(PointA=curvepoint, PointB=pt_44, Unitize=False)  # -> Vector, Length
move_5 = Move(Geometry=rotate.Geometry, Motion=vec2pt_2.Vector)  # -> Geometry, Transform
path_mapper = PathMapper(move_5.Geometry, source=["{A;B}", "{A}"], target=["{A}", "{0}"])
crv_8 = Curve(path_mapper)
flip_2 = FlipCurve(Curve=crv_8)  # -> Curve, Flag
loft = Loft(Curves=flip_2.Curve, Options={Adjust=False, Closed=False, LoftEnds=0, LoftSimp=0, LoftType=0, Rebuild=10, Refit=0.01})
srf = Surface(loft)

dedom2 = DeconstructDomain²(Domain=srf)  # -> UComponent, VComponent

crv_9 = Curve(flip_2.Curve)
crv_10 = Curve(reparameterize(crv_9))
number_slider_39 = Slider(0, range=0..30)
item_16 = ListItem(List=crv_10, Index=0, Wrap=True)
bbox = BoundingBox(Content=crv_9, Plane=PlaneXY(0, 0, 0), UnionBox=True)  # -> Box, Box_2
srf_2 = Surface(boundary)
end_2 = EndPoints(Curve=item_16)  # -> Start, End
debox = DeconstructBox(Box=bbox.Box)  # -> Plane, X, Y, Z
debrep = DeconstructBrep(Brep=srf_2)  # -> Faces, Edges, Vertices
pdecon_7 = Deconstruct(Point=end_2.Start)  # -> XComponent, YComponent, ZComponent
pdecon_8 = Deconstruct(Point=end_2.End)  # -> XComponent, YComponent, ZComponent
dedomain_16 = DeconstructDomain(Domain=debox.X)  # -> Start, End
addition_10 = Addition(A=pdecon_7.YComponent, B=number_slider_39)
subtraction_13 = Subtraction(A=pdecon_8.YComponent, B=number_slider_39)
len = Length(Curve=debrep.Edges)
pt_45 = ConstructPoint(XCoordinate=0, YCoordinate=addition_10, ZCoordinate=0)
pt_46 = ConstructPoint(XCoordinate=dedomain_16.End, YCoordinate=addition_10, ZCoordinate=0)
sort_3 = SortList(Keys=len, ValuesA=debrep.Edges)  # -> Keys, reverse(ValuesA)
pt_47 = ConstructPoint(XCoordinate=0, YCoordinate=subtraction_13, ZCoordinate=0)
pt_48 = ConstructPoint(XCoordinate=dedomain_16.End, YCoordinate=subtraction_13, ZCoordinate=0)
vec2pt_3 = Vector2Pt(PointA=pt_45, PointB=pt_46, Unitize=False)  # -> Vector, Length
item_17 = ListItem(List=sort_3.ValuesA, Index=0, Wrap=True)  # -> Item, Item1
Z_2 = UnitZ(Factor=1)
vec2pt_4 = Vector2Pt(PointA=pt_47, PointB=pt_48, Unitize=False)  # -> Vector, Length
Z_3 = UnitZ(Factor=1)
pl = ConstructPlane(Origin=pt_45, XAxis=vec2pt_3.Vector, YAxis=Z_2)
flip_3 = FlipCurve(Curve=item_17.Item)  # -> Curve, Flag
pl_2 = ConstructPlane(Origin=pt_47, XAxis=vec2pt_4.Vector, YAxis=Z_3)
merge_33 = Merge(Data1=flip_3.Curve, Data2=item_17.Item1)
lng_14 = ListLength(List=crv_9)
merge_34 = Merge(Data1=pl, Data2=pl_2)
divide_3 = DivideCurve(Curve=reparameterize(merge_33), Count=expr("x-1", lng_14), Kinks=False)  # -> Points, Tangents, Parameters
pcx_2 = CurvePlane(Curve=reparameterize(graft(crv_10)), Plane=merge_34)  # -> Points, ParamsC, ParamsP
flip_4 = FlipMatrix(Data=divide_3.Points)
item_18 = ListItem(List=flip_4, Index=0, Wrap=True)  # -> Item, Item1
ln = Line(StartPoint=item_18.Item, EndPoint=item_18.Item1)

pdecon_9 = Deconstruct(Point=pcx_2.Points)  # -> XComponent, YComponent, ZComponent
sort_4 = SortList(Keys=pdecon_9.ZComponent, ValuesA=pcx_2.ParamsC)  # -> Keys, reverse(ValuesA)
item_19 = ListItem(List=sort_4.ValuesA, Index=0, Wrap=True)

trim_5 = TrimTree(Tree=item_19, Depth=1)
eval_3 = EvaluateCurve(Curve=ln, Parameter=trim_5)  # -> simplify(Point), Tangent, Angle
flip_5 = FlipMatrix(Data=eval_3.Point)
intcrv_2 = Interpolate(Vertices=flip_5, Degree=3, Periodic=False, KnotStyle=1)  # -> Curve, Length, Domain

divide_4 = DivideCurve(Curve=intcrv_2.Curve, Count=Slider(100, range=0..1000), Kinks=False)  # -> simplify(Points), Tangents, Parameters
srf_cp_3 = SurfaceClosestPoint(Point=divide_4.Points, Surface=boundary)  # -> Point, UVPoint, Distance

pdecon_10 = Deconstruct(Point=srf_cp_3.UVPoint)  # -> XComponent, YComponent, ZComponent
bnd_7 = Bounds(Numbers=flatten(pdecon_10.XComponent))
bnd_8 = Bounds(Numbers=flatten(pdecon_10.YComponent))
remap_43 = RemapNumbers(Value=pdecon_10.XComponent, Source=bnd_7, Target=dedom2.UComponent)  # -> Mapped, Clipped
remap_44 = RemapNumbers(Value=pdecon_10.YComponent, Source=bnd_8, Target=dedom2.VComponent)  # -> Mapped, Clipped
pt_49 = ConstructPoint(XCoordinate=remap_43.Mapped, YCoordinate=remap_44.Mapped, ZCoordinate=0)

srf_3 = Surface(srf)
evalsrf = EvaluateSurface(Surface=srf_3, Point=pt_49)  # -> Point, Normal, UDirection, VDirection, Frame
number_slider_40 = Slider(92, range=0..100)
intcrv_3 = Interpolate(Vertices=evalsrf.Point, Degree=3, Periodic=False, KnotStyle=1)  # -> Curve, Length, Domain
ext = ExtendCurve(Curve=intcrv_3.Curve, Type=0, Start=number_slider_40, End=number_slider_40)
srfsplit = SurfaceSplit(Surface=srf_3, Curves=flatten(ext))
area_2 = Area(Geometry=srf_3)  # -> Area, Centroid
area_3 = Area(Geometry=srfsplit)  # -> Area, Centroid
pdecon_11 = Deconstruct(Point=area_2.Centroid)  # -> XComponent, YComponent, ZComponent
pdecon_12 = Deconstruct(Point=area_3.Centroid)  # -> XComponent, YComponent, ZComponent
subtraction_14 = Subtraction(A=pdecon_11.YComponent, B=pdecon_12.YComponent)
abs = Absolute(Value=subtraction_14)
sort_5 = SortList(Keys=abs, ValuesA=srfsplit)  # -> Keys, ValuesA
item_20 = ListItem(List=sort_5.ValuesA, Index=0, Wrap=True)

# ---- group: TRIMMING ENDS
# End Trims
srf_4 = Surface(item_20)
debrep_2 = DeconstructBrep(Brep=srf_4)  # -> Faces, Edges, Vertices
midpt = CurveMiddle(Curve=debrep_2.Edges)
pdecon_13 = Deconstruct(Point=midpt)  # -> XComponent, YComponent, ZComponent
sort_6 = SortList(Keys=pdecon_13.XComponent, ValuesA=debrep_2.Edges)  # -> Keys, ValuesA
item_21 = ListItem(List=sort_6.ValuesA, Index=0, Wrap=True)  # -> Item1, Item
crv_11 = Curve(item_21.Item1)
crv_12 = Curve(item_21.Item)
midpt_2 = CurveMiddle(Curve=crv_11)
midpt_3 = CurveMiddle(Curve=crv_12)
ln_2 = Line(StartPoint=midpt_2, EndPoint=midpt_3)

pframe = PerpFrame(Curve=reparameterize(ln_2), Parameter=Slider(0.007, range=0..1))
pframe_2 = PerpFrame(Curve=reparameterize(ln_2), Parameter=Slider(0.999, range=0..1))
Y_5 = UnitY(Factor=1)
Y_6 = UnitY(Factor=1)
deplane = DeconstructPlane(Plane=pframe)  # -> Origin, XAxis, YAxis, ZAxis
padjust = AdjustPlane(Plane=pframe, Normal=Y_5)
deplane_2 = DeconstructPlane(Plane=pframe_2)  # -> Origin, XAxis, YAxis, ZAxis
padjust_2 = AdjustPlane(Plane=pframe_2, Normal=Y_6)
neg_3 = Negative(Value=deplane.ZAxis)
neg_4 = Negative(Value=deplane_2.ZAxis)
line = LineSDL(Start=pframe, Direction=neg_3, Length=1)
line_2 = LineSDL(Start=pframe_2, Direction=neg_4, Length=1)
rotate_2 = Rotate(Geometry=line, Angle=degrees(number_slider_31), Plane=padjust)  # -> Geometry, Transform
rotate_3 = Rotate(Geometry=line_2, Angle=degrees(number_slider_30), Plane=padjust_2)  # -> Geometry, Transform
srf_5 = Surface(srf_4)
padjust_3 = AdjustPlane(Plane=pframe, Normal=rotate_2.Geometry)
padjust_4 = AdjustPlane(Plane=pframe_2, Normal=rotate_3.Geometry)
sec = BrepPlane(Brep=srf_5, Plane=padjust_3)  # -> Curves, Points
srfsplit_2 = SurfaceSplit(Surface=srf_5, Curves=flatten(sec.Curves))
item_22 = ListItem(List=srfsplit_2, Index=0, Wrap=True)
srf_6 = Surface(item_22)
sec_2 = BrepPlane(Brep=srf_6, Plane=padjust_4)  # -> Curves, Points
srfsplit_3 = SurfaceSplit(Surface=srf_6, Curves=flatten(sec_2.Curves))
item_23 = ListItem(List=srfsplit_3, Index=0, Wrap=True)  # -> Item, Item1
srf_7 = Surface(item_23.Item1)

# ----
evalsrf_2 = EvaluateSurface(Surface=srf, Point=srf_cp.UVPoint)  # -> Point, Normal, UDirection, VDirection, Frame
srf_8 = Surface(srf_7)
intcrv_4 = Interpolate(Vertices=evalsrf_2.Point, Degree=3, Periodic=False, KnotStyle=1)  # -> Curve, Length, Domain
srfsplit_4 = SurfaceSplit(Surface=srf_8, Curves=intcrv_4.Curve)
area_4 = Area(Geometry=srfsplit_4)  # -> Area, Centroid
pdecon_14 = Deconstruct(Point=area_4.Centroid)  # -> XComponent, YComponent, ZComponent
sort_7 = SortList(Keys=pdecon_14.XComponent, ValuesA=srfsplit_4)  # -> Keys, ValuesA
item_24 = ListItem(List=sort_7.ValuesA, Index=0, Wrap=True)
brep = Brep(item_24)

pan_srf = PanelSurface(Panel=rad_blend, Surface=srf_7)
entwine_5 = Entwine(Branch00=srf_7, Branch01=brep, FlattenInputs=True)
trim_breps = TrimmingBreps(Panel=pan_srf, Breps=entwine_5)
dec_pan_3 = DeconstructPanel(Panel=trim_breps)  # -> Bilayers, HMaxels, LengthRange, WidthRange
dec_hmaxel_3 = DeconstructHMaxel(HMaxel=dec_pan_3.HMaxels)  # -> PassiveLayers, ActiveBoards, Height, RowRange, ColumnRange, DesiredRadius, BlendedRadius, ShapedHMaxel

# ---- group: convolution
c_script_13 = CSharpScript(
    tan=Slider(1, range=0.01..3),
    lon=Slider(0.7, range=0.01..3),
    rad=Slider(10000, range=0..10000),
    stiff=Slider(0.75, range=0.01..3),
    Reference="C:\USERS\ALEX REINER\APPDATA\ROAMING\GRASSHOPPER\LIBRARIES\HygroDesign.Core.dll")  # -> out, A; inputs tan: Double, lon: Double, rad: Double, stiff: Double, thick: Double
# ---------- c_script_13: C# ----------
    HMaxelConvolution convEngine = new HMaxelConvolution(tan, lon, rad, stiff, thick);
    A = convEngine;
# ---------- c_script_13: C# additional code ----------
    public class HMaxelConvolution : ConvolutionEngine
  {
    public double Tangential { get; set; }
    public double Longitudinal { get; set; }
    public double RadiusMax { get; set; }
    public double StiffnessInfluence { get; set; }
    public double ThicknessInfluence { get; set; }
    public HMaxelConvolution(double tangential, double longitudinal, double radiusMax, double stiffnessInfluence, double thicknessInfluence)
    {
      Tangential = tangential;
      Longitudinal = longitudinal;
      RadiusMax = radiusMax;
      StiffnessInfluence = stiffnessInfluence;
      ThicknessInfluence = thicknessInfluence;
    }

    public override Panel Convolution(Panel panel)
    {
      double MaxRad = double.MinValue;
      double MinRad = double.MaxValue;

      double MaxRStiff = double.MinValue;
      double MinRStiff = double.MaxValue;
      double MaxLStiff = double.MinValue;
      double MinLStiff = double.MaxValue;

      for (int i = 0; i < panel.HMaxels.GetLength(0); i++)
      {
        for (int j = 0; j < panel.HMaxels.GetLength(1); j++)
        {
          double averageRStiffness = 0;
          double averageLStiffness = 0;
          double weightedRadius = 0;
          double totalRWeights = 0;

          HMaxel hmaxel = panel.HMaxels[i, j];
          List<Tuple<double, double>> tuples = new List<Tuple<double, double>>();
          for (int v = 0; v < hmaxel.ActiveBoards.Count; v++)
          {
            averageRStiffness += (double) hmaxel.ActiveBoards[v].StockBoard.Species.Attributes["REmod"];
            averageLStiffness += (double) hmaxel.ActiveBoards[v].StockBoard.Species.Attributes["LEmod"];

            weightedRadius += (hmaxel.ActiveBoards[v].Radius * (double) hmaxel.ActiveBoards[v].StockBoard.Species.Attributes["REmod"]);
            totalRWeights += (double) hmaxel.ActiveBoards[v].StockBoard.Species.Attributes["REmod"];

          }
          averageRStiffness /= hmaxel.ActiveBoards.Count;
          averageLStiffness /= hmaxel.ActiveBoards.Count;
          weightedRadius /= totalRWeights;
          panel.HMaxels[i, j].Attributes.Add("REmod", averageRStiffness);
          panel.HMaxels[i, j].Attributes.Add("LEmod", averageLStiffness);
          panel.HMaxels[i, j].Attributes.Add("weighted radius", weightedRadius);

          if (weightedRadius > MaxRad) MaxRad = weightedRadius;
          if (weightedRadius < MinRad) MinRad = weightedRadius;
          if (averageLStiffness > MaxLStiff) MaxLStiff = averageLStiffness;
          if (averageLStiffness < MinLStiff) MinLStiff = averageLStiffness;
          if (averageRStiffness > MaxRStiff) MaxRStiff = averageRStiffness;
          if (averageRStiffness < MinRStiff) MinRStiff = averageRStiffness;
        }
      }
      //set factors
      for (int i = 0; i < panel.HMaxels.GetLength(0); i++)
      {
        for (int j = 0; j < panel.HMaxels.GetLength(1); j++)
        {
          panel.HMaxels[i, j].Attributes.Add("REmodFactor", Remap((double) panel.HMaxels[i, j].Attributes["REmod"], MinRStiff, MaxRStiff, 1 - StiffnessInfluence, 1));
          panel.HMaxels[i, j].Attributes.Add("LEmodFactor", Remap((double) panel.HMaxels[i, j].Attributes["LEmod"], MinLStiff, MaxLStiff, 1 - StiffnessInfluence, 1));
          panel.HMaxels[i, j].Attributes.Add("RadiusFactor", Remap((double) panel.HMaxels[i, j].Attributes["weighted radius"], MinRad, RadiusMax, 1, 0));

        }
      }

      //horizontal convolution
      for (int i = 0; i < panel.HMaxels.GetLength(0); i++)
      {
        for (int j = 0; j < panel.HMaxels.GetLength(1); j++)
        {
          double totalWeights = 0;
          double blendedRadius = 0;
          for (int x = 0; x < panel.HMaxels.GetLength(0); x++)
          {
            for (int y = 0; y < panel.HMaxels.GetLength(1); y++)
            {



              double xdist = Math.Abs(panel.HMaxels[i, j].X - panel.HMaxels[x, y].X);
              double ydist = Math.Abs(panel.HMaxels[i, j].Y - panel.HMaxels[x, y].Y);
              double LFactor = (double) panel.HMaxels[x, y].Attributes["LEmodFactor"] / Math.Pow(xdist + 1, Longitudinal);
              double RFactor = (double) panel.HMaxels[x, y].Attributes["REmodFactor"] / Math.Pow(ydist + 1, Tangential);
              if(panel.HMaxels[i, j].ShapedHMaxel == null)continue;
              else
              {
                blendedRadius += (double) panel.HMaxels[x, y].Attributes["weighted radius"] * (double) panel.HMaxels[i, j].Attributes["RadiusFactor"] * LFactor * RFactor;
                totalWeights += (double) panel.HMaxels[x, y].Attributes["RadiusFactor"] * LFactor * RFactor;

              }



            }
          }


          if(totalWeights == 0) panel.HMaxels[i, j].BlendedRaidus = (double)panel.HMaxels[i, j].Attributes["weighted radius"];
          else panel.HMaxels[i, j].BlendedRaidus = blendedRadius / totalWeights;


        }
      }
      return panel;
    }
    public static double Remap(double val, double from1, double to1, double from2, double to2)
    {
      return (val - from1) / (to1 - from1) * (to2 - from2) + from2;
    }
  }
# ---------- end c_script_13 ----------
data_24 = Data(trim_breps)
rad_blend_2 = RadiusBlending(Panels=data_24, ConvolutionEngine=c_script_13.A)
dec_pan_4 = DeconstructPanel(Panel=rad_blend_2)  # -> Bilayers, HMaxels, LengthRange, WidthRange
dec_hmaxel_4 = DeconstructHMaxel(HMaxel=dec_pan_4.HMaxels)  # -> PassiveLayers, ActiveBoards, Height, RowRange, ColumnRange, DesiredRadius, BlendedRadius, ShapedHMaxel

# ----
panel_43 = Panel(dec_hmaxel_3.ShapedHMaxel)

num_31 = Number(expr("x/2", num_17))
dedomain_17 = DeconstructDomain(Domain=dec_hmaxel_4.RowRange)  # -> Start, End
bnd_9 = Bounds(Numbers=dedomain_17.Start)
bnd_10 = Bounds(Numbers=dedomain_17.End)
dedomain_18 = DeconstructDomain(Domain=bnd_9)  # -> Start, End
dedomain_19 = DeconstructDomain(Domain=bnd_10)  # -> Start, End
x_minus_one_2 = XMinusOne(NumberX=division_14)
subtraction_15 = Subtraction(A=dedomain_19.End, B=dedomain_18.Start)
division_19 = Division(A=subtraction_15, B=x_minus_one_2)
series_4 = Series(Start=dedomain_18.Start, Step=division_19, Count=division_14)
pt_50 = ConstructPoint(XCoordinate=series_4, YCoordinate=0, ZCoordinate=0)
yz_3 = YZPlane(Origin=pt_50)  # -> simplify(graft(Plane))

partition_2 = PartitionList(List=dec_hmaxel_4.BlendedRadius, Size=num_17)  # -> simplify(Chunks)
flip_6 = FlipMatrix(Data=partition_2)
num_32 = Number(flip_6)
c_script_14 = CSharpScript(x=num_32, y=number_slider_32)  # -> out, A; inputs x: tree, y: Int32; same code as c_script_9
renumber_4 = RenumberPaths(Data=c_script_14.A)

num_33 = Number(num)
pln_3 = Plane(yz_3)
num_34 = Number(renumber_4)
c_script_15 = CSharpScript()  # -> out, A; inputs x: tree; same code as c_script_10
c_script_16 = CSharpScript(iRadii=num_34, iBoardWidth=num_33, iPlanes=pln_3)  # -> out, simplify(A); inputs iRadii: tree of Double, iBoardWidth: Double, iPlanes: tree of Plane; same code as c_script_11

trim_6 = TrimTree(Tree=c_script_16.A, Depth=1)
cullpt_2 = CullDuplicates(Points=trim_6, Tolerance=0.1, CullMode=3)  # -> Points, Indices, Valence
pt_51 = Point(cullpt_2.Points)

# ---- group: animate
pt_52 = Point(simplify(pt_51))
pln_4 = Plane(graft(pln_3))
num_35 = Number(Slider(1, range=0..1))
c_script_17 = CSharpScript(iPoints=simplify(pt_52), iPlanes=pln_4, iShapeFactor=num_35)  # -> out, A; inputs iPoints: tree of Point3d, iPlanes: tree of Plane, iShapeFactor: Double; same code as c_script_12
pt_53 = Point(c_script_17.A)
intcrv_5 = Interpolate(Vertices=pt_53, Degree=3, Periodic=False, KnotStyle=1)  # -> Curve, Length, Domain
crv_13 = Curve(intcrv_5.Curve)

# ----
crv_14 = Curve(crv_13)
pt_54 = Point(simplify(graft(yz_3)))
end_3 = EndPoints(Curve=crv_14)  # -> Start, End
vec2pt_5 = Vector2Pt(PointA=end_3.Start, PointB=end_3.End, Unitize=False)  # -> Vector, Length
yz_4 = YZPlane(Origin=end_3.Start)
Y_7 = UnitY(Factor="-1")
angle_2 = Angle(VectorA=vec2pt_5.Vector, VectorB=Y_7, Plane=yz_4)  # -> Angle, Reflex
rotate_4 = Rotate(Geometry=crv_14, Angle=angle_2.Angle, Plane=yz_4)  # -> Geometry, Transform
curvepoint_2 = PointOnCurve(rotate_4.Geometry, parameter=0.5)
vec2pt_6 = Vector2Pt(PointA=curvepoint_2, PointB=pt_54, Unitize=False)  # -> Vector, Length
move_6 = Move(Geometry=rotate_4.Geometry, Motion=vec2pt_6.Vector)  # -> Geometry, Transform
path_mapper_2 = PathMapper(move_6.Geometry, source=["{A;B}", "{A}"], target=["{A}", "{0}"])
crv_15 = Curve(path_mapper_2)
flip_7 = FlipCurve(Curve=crv_15)  # -> Curve, Flag
loft_2 = Loft(Curves=flip_7.Curve, Options={Adjust=False, Closed=False, LoftEnds=0, LoftSimp=0, LoftType=0, Rebuild=10, Refit=0.01})
srf_9 = Surface(loft_2)

dedom2_2 = DeconstructDomain²(Domain=srf_9)  # -> UComponent, VComponent

lamination_width = Slider(991, range=0..1500)
num_36 = Number(division)

crv_16 = Curve(flip_7.Curve)
crv_17 = Curve(reparameterize(crv_16))
number_slider_41 = Slider(0, range=0..30)
item_25 = ListItem(List=crv_17, Index=0, Wrap=True)
bbox_2 = BoundingBox(Content=crv_16, Plane=PlaneXY(0, 0, 0), UnionBox=True)  # -> Box, Box_2
srf_10 = Surface(boundary_2)
end_4 = EndPoints(Curve=item_25)  # -> Start, End
debox_2 = DeconstructBox(Box=bbox_2.Box)  # -> Plane, X, Y, Z
debrep_3 = DeconstructBrep(Brep=srf_10)  # -> Faces, Edges, Vertices
pdecon_15 = Deconstruct(Point=end_4.Start)  # -> XComponent, YComponent, ZComponent
pdecon_16 = Deconstruct(Point=end_4.End)  # -> XComponent, YComponent, ZComponent
dedomain_20 = DeconstructDomain(Domain=debox_2.X)  # -> Start, End
addition_11 = Addition(A=pdecon_15.YComponent, B=number_slider_41)
subtraction_16 = Subtraction(A=pdecon_16.YComponent, B=number_slider_41)
len_2 = Length(Curve=debrep_3.Edges)
pt_55 = ConstructPoint(XCoordinate=0, YCoordinate=addition_11, ZCoordinate=0)
pt_56 = ConstructPoint(XCoordinate=dedomain_20.End, YCoordinate=addition_11, ZCoordinate=0)
sort_8 = SortList(Keys=len_2, ValuesA=debrep_3.Edges)  # -> Keys, reverse(ValuesA)
pt_57 = ConstructPoint(XCoordinate=0, YCoordinate=subtraction_16, ZCoordinate=0)
pt_58 = ConstructPoint(XCoordinate=dedomain_20.End, YCoordinate=subtraction_16, ZCoordinate=0)
vec2pt_7 = Vector2Pt(PointA=pt_55, PointB=pt_56, Unitize=False)  # -> Vector, Length
item_26 = ListItem(List=sort_8.ValuesA, Index=0, Wrap=True)  # -> Item, Item1
Z_4 = UnitZ(Factor=1)
vec2pt_8 = Vector2Pt(PointA=pt_57, PointB=pt_58, Unitize=False)  # -> Vector, Length
Z_5 = UnitZ(Factor=1)
pl_3 = ConstructPlane(Origin=pt_55, XAxis=vec2pt_7.Vector, YAxis=Z_4)
flip_8 = FlipCurve(Curve=item_26.Item)  # -> Curve, Flag
pl_4 = ConstructPlane(Origin=pt_57, XAxis=vec2pt_8.Vector, YAxis=Z_5)
merge_35 = Merge(Data1=flip_8.Curve, Data2=item_26.Item1)
lng_15 = ListLength(List=crv_16)
merge_36 = Merge(Data1=pl_3, Data2=pl_4)
divide_5 = DivideCurve(Curve=reparameterize(merge_35), Count=expr("x-1", lng_15), Kinks=False)  # -> Points, Tangents, Parameters
pcx_3 = CurvePlane(Curve=reparameterize(graft(crv_17)), Plane=merge_36)  # -> Points, ParamsC, ParamsP
flip_9 = FlipMatrix(Data=divide_5.Points)
item_27 = ListItem(List=flip_9, Index=0, Wrap=True)  # -> Item, Item1
ln_3 = Line(StartPoint=item_27.Item, EndPoint=item_27.Item1)

pdecon_17 = Deconstruct(Point=pcx_3.Points)  # -> XComponent, YComponent, ZComponent
sort_9 = SortList(Keys=pdecon_17.ZComponent, ValuesA=pcx_3.ParamsC)  # -> Keys, reverse(ValuesA)
item_28 = ListItem(List=sort_9.ValuesA, Index=0, Wrap=True)

trim_7 = TrimTree(Tree=item_28, Depth=1)
eval_4 = EvaluateCurve(Curve=ln_3, Parameter=trim_7)  # -> simplify(Point), Tangent, Angle
flip_10 = FlipMatrix(Data=eval_4.Point)
intcrv_6 = Interpolate(Vertices=flip_10, Degree=3, Periodic=False, KnotStyle=1)  # -> Curve, Length, Domain

divide_6 = DivideCurve(Curve=intcrv_6.Curve, Count=Slider(100, range=0..1000), Kinks=False)  # -> simplify(Points), Tangents, Parameters
srf_cp_4 = SurfaceClosestPoint(Point=divide_6.Points, Surface=boundary_2)  # -> Point, UVPoint, Distance

pdecon_18 = Deconstruct(Point=srf_cp_4.UVPoint)  # -> XComponent, YComponent, ZComponent
bnd_11 = Bounds(Numbers=flatten(pdecon_18.XComponent))
bnd_12 = Bounds(Numbers=flatten(pdecon_18.YComponent))
remap_45 = RemapNumbers(Value=pdecon_18.XComponent, Source=bnd_11, Target=dedom2_2.UComponent)  # -> Mapped, Clipped
remap_46 = RemapNumbers(Value=pdecon_18.YComponent, Source=bnd_12, Target=dedom2_2.VComponent)  # -> Mapped, Clipped
pt_59 = ConstructPoint(XCoordinate=remap_45.Mapped, YCoordinate=remap_46.Mapped, ZCoordinate=0)

srf_11 = Surface(srf_9)
evalsrf_3 = EvaluateSurface(Surface=srf_11, Point=pt_59)  # -> Point, Normal, UDirection, VDirection, Frame
number_slider_42 = Slider(92, range=0..100)
intcrv_7 = Interpolate(Vertices=evalsrf_3.Point, Degree=3, Periodic=False, KnotStyle=1)  # -> Curve, Length, Domain
ext_2 = ExtendCurve(Curve=intcrv_7.Curve, Type=0, Start=number_slider_42, End=number_slider_42)
srfsplit_5 = SurfaceSplit(Surface=srf_11, Curves=flatten(ext_2))
area_5 = Area(Geometry=srf_11)  # -> Area, Centroid
area_6 = Area(Geometry=srfsplit_5)  # -> Area, Centroid
pdecon_19 = Deconstruct(Point=area_5.Centroid)  # -> XComponent, YComponent, ZComponent
pdecon_20 = Deconstruct(Point=area_6.Centroid)  # -> XComponent, YComponent, ZComponent
subtraction_17 = Subtraction(A=pdecon_19.YComponent, B=pdecon_20.YComponent)
abs_2 = Absolute(Value=subtraction_17)
sort_10 = SortList(Keys=abs_2, ValuesA=srfsplit_5)  # -> Keys, ValuesA
item_29 = ListItem(List=sort_10.ValuesA, Index=0, Wrap=True)

# ---- group: TRIMMING ENDS
# End Trims
srf_12 = Surface(item_29)
debrep_4 = DeconstructBrep(Brep=srf_12)  # -> Faces, Edges, Vertices
midpt_4 = CurveMiddle(Curve=debrep_4.Edges)
pdecon_21 = Deconstruct(Point=midpt_4)  # -> XComponent, YComponent, ZComponent
sort_11 = SortList(Keys=pdecon_21.XComponent, ValuesA=debrep_4.Edges)  # -> Keys, ValuesA
item_30 = ListItem(List=sort_11.ValuesA, Index=0, Wrap=True)  # -> Item1, Item
crv_18 = Curve(item_30.Item1)
crv_19 = Curve(item_30.Item)
midpt_5 = CurveMiddle(Curve=crv_18)
midpt_6 = CurveMiddle(Curve=crv_19)
ln_4 = Line(StartPoint=midpt_5, EndPoint=midpt_6)

pframe_3 = PerpFrame(Curve=reparameterize(ln_4), Parameter=Slider(0.02, range=0..1))
pframe_4 = PerpFrame(Curve=reparameterize(ln_4), Parameter=Slider(0.999, range=0..1))
Y_8 = UnitY(Factor=1)
Y_9 = UnitY(Factor=1)
deplane_3 = DeconstructPlane(Plane=pframe_3)  # -> Origin, XAxis, YAxis, ZAxis
padjust_5 = AdjustPlane(Plane=pframe_3, Normal=Y_8)
deplane_4 = DeconstructPlane(Plane=pframe_4)  # -> Origin, XAxis, YAxis, ZAxis
padjust_6 = AdjustPlane(Plane=pframe_4, Normal=Y_9)
neg_5 = Negative(Value=deplane_3.ZAxis)
neg_6 = Negative(Value=deplane_4.ZAxis)
line_3 = LineSDL(Start=pframe_3, Direction=neg_5, Length=1)
line_4 = LineSDL(Start=pframe_4, Direction=neg_6, Length=1)
rotate_5 = Rotate(Geometry=line_3, Angle=degrees(number_slider_34), Plane=padjust_5)  # -> Geometry, Transform
rotate_6 = Rotate(Geometry=line_4, Angle=degrees(number_slider_35), Plane=padjust_6)  # -> Geometry, Transform
srf_13 = Surface(srf_12)
padjust_7 = AdjustPlane(Plane=pframe_3, Normal=rotate_5.Geometry)
padjust_8 = AdjustPlane(Plane=pframe_4, Normal=rotate_6.Geometry)
sec_3 = BrepPlane(Brep=srf_13, Plane=padjust_7)  # -> Curves, Points
srfsplit_6 = SurfaceSplit(Surface=srf_13, Curves=flatten(sec_3.Curves))
item_31 = ListItem(List=srfsplit_6, Index=0, Wrap=True)
srf_14 = Surface(item_31)
sec_4 = BrepPlane(Brep=srf_14, Plane=padjust_8)  # -> Curves, Points
srfsplit_7 = SurfaceSplit(Surface=srf_14, Curves=flatten(sec_4.Curves))
item_32 = ListItem(List=srfsplit_7, Index=0, Wrap=True)  # -> Item, Item1
srf_15 = Surface(item_32.Item1)

# ----
evalsrf_4 = EvaluateSurface(Surface=srf_9, Point=srf_cp_2.UVPoint)  # -> Point, Normal, UDirection, VDirection, Frame
srf_16 = Surface(srf_15)
intcrv_8 = Interpolate(Vertices=evalsrf_4.Point, Degree=3, Periodic=False, KnotStyle=1)  # -> Curve, Length, Domain
srfsplit_8 = SurfaceSplit(Surface=srf_16, Curves=intcrv_8.Curve)
area_7 = Area(Geometry=srfsplit_8)  # -> Area, Centroid
pdecon_22 = Deconstruct(Point=area_7.Centroid)  # -> XComponent, YComponent, ZComponent
sort_12 = SortList(Keys=pdecon_22.XComponent, ValuesA=srfsplit_8)  # -> Keys, ValuesA
item_33 = ListItem(List=sort_12.ValuesA, Index=0, Wrap=True)
brep_2 = Brep(item_33)

pan_srf_2 = PanelSurface(Panel=rad_blend_2, Surface=srf_15)
entwine_6 = Entwine(Branch00=srf_15, Branch01=brep_2, FlattenInputs=True)
trim_breps_2 = TrimmingBreps(Panel=pan_srf_2, Breps=entwine_6)

dec_pan_5 = DeconstructPanel(Panel=trim_breps_2)  # -> Bilayers, HMaxels, LengthRange, WidthRange
dec_bilayer = DeconstructBilayer(Bilayer=dec_pan_5.Bilayers)  # -> ActiveLayer, PassiveLayer
dec_active_layer = DeconstructActiveLayer(ActiveLayer=dec_bilayer.ActiveLayer)  # -> simplify(ActiveLayerBoards), Thickness
dec_active_board_2 = DeconstructActiveBoard(ActiveBoard=dec_active_layer.ActiveLayerBoards)  # -> HMaxels, StockBoard, Thickness, RowRange, ColumnRange, DesiredRadius, Radius, BlendedRadius, MoistureChange, ShapedBoard

trim_8 = TrimTree(Tree=dec_active_board_2.ShapedBoard, Depth=1)
null_2 = NullItem(Item=trim_8)  # -> NullFlags, InvalidFlags, Description
not_2 = GateNot(A=null_2.NullFlags)

dec_stock_board_6 = DeconstructStockBoard(StockBoard=dec_active_board_2.StockBoard)  # -> Name, Species, RTAngle, Length, Width, ActiveBoards
dec_secies_2 = DeconstructSpecies(Species=dec_stock_board_6.Species)
trim_9 = TrimTree(Tree=simplify(dec_secies_2), Depth=1)

domain = Domain(dec_active_board_2.RowRange)
trim_10 = TrimTree(Tree=domain, Depth=1)
c_script_18 = CSharpScript(
    boards=dec_active_layer.ActiveLayerBoards,
    ranges=trim_10,
    length=lamination_width,
    overlap=num_36,
    Reference="C:\USERS\ALEX REINER\APPDATA\ROAMING\GRASSHOPPER\LIBRARIES\HygroDesign.Core.dll")  # -> out, A; inputs boards: tree, ranges: tree, length: Double, overlap: Double
# ---------- c_script_18: C# ----------
    DataTree<ActiveBoard> laminationGroups = new DataTree<ActiveBoard>();


    for(int i = 0; i < ranges.BranchCount; i++)
    {
      for(int j = 0; j < ranges.Branch(i).Count; j++)
      {
        for(int x = 1; x < 10; x++)
        {
          double test = (x * length) - ((x - 1) * overlap);

          if(Math.Floor(ranges.Branch(i)[j][1]) > test)continue;
          GH_Path path = ranges.Paths[i].AppendElement(x);
          laminationGroups.Add(boards.Branch(i)[j] as ActiveBoard, path);
          break;
        }
      }
    }
    A = laminationGroups;
# ---------- end c_script_18 ----------
dec_active_board_3 = DeconstructActiveBoard(ActiveBoard=c_script_18.A)  # -> HMaxels, StockBoard, Thickness, RowRange, ColumnRange, DesiredRadius, Radius, BlendedRadius, MoistureChange, ShapedBoard
dec_stock_board_7 = DeconstructStockBoard(StockBoard=dec_active_board_3.StockBoard)  # -> Name, Species, RTAngle, Length, Width, ActiveBoards

trim_11 = TrimTree(Tree=dec_active_board_2.BlendedRadius, Depth=1)

cull_10 = CullPattern(List=trim_11, CullPattern=not_2)
num_37 = Number(cull_10)
bnd_13 = Bounds(Numbers=flatten(num_37))
dedomain_21 = DeconstructDomain(Domain=bnd_13)  # -> Start, End
gradient = Gradient(
    LowerLimit=dedomain_21.Start,
    UpperLimit=dedomain_21.End,
    Parameter=num_37,
    stops=[0: RGB(234, 38, 0), 0.25: RGB(234, 126, 0), 0.5: RGB(254, 244, 84), 0.75: RGB(173, 203, 249), 1: RGB(75, 107, 169)])

python_6 = GhPythonScript(x=c_script_18.A)  # -> out, a
# ---------- python_6: Python ----------
a = x.Length
# ---------- end python_6 ----------

cull_11 = CullPattern(List=simplify(trim_9), CullPattern=simplify(not_2))
chars_2 = Characters(Text=cull_11)  # -> Result, Unicode
lng_16 = ListLength(List=chars_2.Result)
equals_3 = Equality(FirstNumber=lng_16, SecondNumber="5")  # -> Equality, Inequality
cset_2 = CreateSet(List=flatten(lng_16))  # -> Set, Map
cull_12 = CullPattern(List=ColourSwatch(SwatchColor=RGB(250, 116, 82)), CullPattern=equals_3.Equality)
cull_13 = CullPattern(List=ColourSwatch(SwatchColor=RGB(250, 165, 90)), CullPattern=equals_3.Inequality)
merge_37 = Merge(Data1=cull_12, Data2=cull_13)  # -> simplify(Result)

panel_44 = Panel(python_6.a)

rectangle_10 = Rectangle(Plane=PlaneXY(0, 0, 0), XSize=dec_active_board_3.RowRange, YSize=dec_active_board_3.ColumnRange, Radius=0)  # -> Rectangle, Length
trim_12 = TrimTree(Tree=rectangle_10.Rectangle, Depth=1)
group_3 = Group(Objects=trim_12)  # -> flatten(Group)
bbox_3 = BoundingBox(Content=trim_12, Plane=PlaneXY(0, 0, 0), UnionBox=True)  # -> flatten(Box), Box_2
debox_3 = DeconstructBox(Box=bbox_3.Box)  # -> Plane, X, Y, Z
number_slider_43 = Slider(1071, range=0..10000)
dedomain_22 = DeconstructDomain(Domain=debox_3.X)  # -> Start, End
neg_7 = Negative(Value=dedomain_22.Start)
lng_17 = ListLength(List=group_3)
X_3 = UnitX(Factor=neg_7)
series_5 = Series(Start=number_slider_43, Step=number_slider_43, Count=lng_17)  # -> simplify(Series)
move_7 = Move(Geometry=group_3, Motion=X_3)  # -> Geometry, Transform
X_4 = UnitX(Factor=series_5)
move_8 = Move(Geometry=move_7.Geometry, Motion=X_4)  # -> Geometry, Transform
Y_10 = UnitY(Factor=Slider(1000, range=0..1000))
move_9 = Move(Geometry=move_8.Geometry, Motion=Y_10)  # -> Geometry, Transform
ungroup_3 = Ungroup(Group=move_9.Geometry)
boundary_5 = BoundarySurfaces(Edges=ungroup_3)

round_2 = Round(Number=cull_10)  # -> Nearest, Floor, Ceiling

dec_secies_3 = DeconstructSpecies(Species=dec_stock_board_7.Species)
trim_13 = TrimTree(Tree=simplify(dec_secies_3), Depth=1)
chars_3 = Characters(Text=trim_13)  # -> Result, Unicode
lng_18 = ListLength(List=chars_3.Result)
equals_4 = Equality(FirstNumber=lng_18, SecondNumber="5")  # -> Equality, Inequality
cull_14 = CullPattern(List=ColourSwatch(SwatchColor=RGB(250, 116, 82)), CullPattern=equals_4.Equality)
cull_15 = CullPattern(List=ColourSwatch(SwatchColor=RGB(250, 165, 90)), CullPattern=equals_4.Inequality)
merge_38 = Merge(Data1=cull_14, Data2=cull_15)  # -> simplify(Result)
trim_14 = TrimTree(Tree=merge_38, Depth=1)

# ---- group: COG
python_7 = GhPythonScript(x=trim_breps_2)  # -> out, a
# ---------- python_7: Python ----------
x.CalculateCenterOfGravity()
a = x.Centroid
# ---------- end python_7 ----------

# ----
trim_15 = TrimTree(Tree=simplify(dec_stock_board_7.Name), Depth=1)
area_8 = Area(Geometry=boundary_5)  # -> Area, Centroid
tag = TextTag3D(
    Location=area_8.Centroid,
    Text=trim_15,
    Size=Slider(54, range=0..100),
    Colour=ColourSwatch(SwatchColor=RGB(0, 0, 0)),
    Justification=5)
preview = CustomPreview(Geometry=boundary_5, Material=trim_14)

bang_3 = ExplodeTree(Data=boundary_5)

dec_pan_6 = DeconstructPanel(Panel=trim_breps_2)  # -> Bilayers, HMaxels, LengthRange, WidthRange
dec_pan_7 = DeconstructPanel(Panel=trim_breps_2)  # -> Bilayers, HMaxels, LengthRange, WidthRange
dec_bilayer_2 = DeconstructBilayer(Bilayer=dec_pan_6.Bilayers)  # -> ActiveLayer, PassiveLayer
dec_hmaxel_5 = DeconstructHMaxel(HMaxel=dec_pan_7.HMaxels)  # -> PassiveLayers, simplify(ActiveBoards), Height, RowRange, ColumnRange, DesiredRadius, BlendedRadius, ShapedHMaxel
item_34 = ListItem(List=dec_bilayer_2.ActiveLayer, Index=0, Wrap=True)  # -> Item, Item1
dec_active_layer_2 = DeconstructActiveLayer(ActiveLayer=dec_bilayer_2.ActiveLayer)  # -> simplify(ActiveLayerBoards), Thickness
dec_active_board_4 = DeconstructActiveBoard(ActiveBoard=dec_active_layer_2.ActiveLayerBoards)  # -> HMaxels, StockBoard, Thickness, RowRange, ColumnRange, DesiredRadius, Radius, BlendedRadius, MoistureChange, simplify(ShapedBoard)

move_10 = Move(Geometry=bang_3, Motion=Y_3)  # -> Geometry, Transform
bbox_4 = BoundingBox(Content=move_10.Geometry, Plane=PlaneXY(0, 0, 0))  # -> Box, Box_2
area_9 = Area(Geometry=move_10.Geometry)  # -> Area, Centroid
debox_4 = DeconstructBox(Box=bbox_4.Box)  # -> Plane, X, Y, Z
dec_active_board_5 = DeconstructActiveBoard(ActiveBoard=dec_hmaxel_5.ActiveBoards)  # -> HMaxels, StockBoard, flatten(Thickness), RowRange, ColumnRange, DesiredRadius, Radius, BlendedRadius, MoistureChange, ShapedBoard
dedomain_23 = DeconstructDomain(Domain=debox_4.X)  # -> Start, End
subtraction_18 = Subtraction(A=dedomain_23.End, B=dedomain_23.Start)
dec_stock_board_8 = DeconstructStockBoard(StockBoard=dec_active_board_5.StockBoard)  # -> Name, Species, RTAngle, Length, Width, ActiveBoards
panel_45 = Panel(subtraction_18)
brep_3 = Brep(simplify(dec_hmaxel_5.ShapedHMaxel))
null_3 = NullItem(Item=brep_3)  # -> NullFlags, InvalidFlags, Description
dec_secies_4 = DeconstructSpecies(Species=dec_stock_board_8.Species)  # -> simplify(Name)
trim_16 = TrimTree(Tree=dec_secies_4, Depth=1)
chars_4 = Characters(Text=trim_16)  # -> Result, Unicode
not_3 = GateNot(A=null_3.NullFlags)
lng_19 = ListLength(List=chars_4.Result)
trim_17 = TrimTree(Tree=lng_19, Depth=1)
lng_20 = ListLength(List=trim_16)
sort_13 = SortList(Keys=trim_17)  # -> Keys, ValuesA
item_35 = ListItem(List=sort_13.Keys, Index=0, Wrap=True)  # -> flatten(Item)
cull_16 = CullPattern(List=flatten(lng_20), CullPattern=not_3)
cull_17 = CullPattern(List=item_35, CullPattern=not_3)
cull_18 = CullPattern(List=brep_3, CullPattern=not_3)
c_script_19 = CSharpScript(layers=cull_16, materials=cull_17)  # -> out, A, B, C; inputs layers: list of Int32, materials: list of Int32
# ---------- c_script_19: C# ----------
    
    List<int> keys = new List<int>();
    List<int> numberize = new List<int>();
    List<double> thickness = new List<double>();

    for(int i = 0; i < layers.Count ;i++)
    {
      int lCount = layers[i];
      int mat = materials[i];

      numberize.Add(i + 1);

      if(lCount == 1 && mat == 5)
      {
        keys.Add(0);
        thickness.Add(2.8);
      }
      if(lCount == 1 && mat == 6)
      {
        keys.Add(3);
        thickness.Add(2.8);
      }
      if(lCount == 2 && mat == 5)
      {
        keys.Add(1);
        thickness.Add(5.2);
      }
      if(lCount == 2 && mat == 6)
      {
        keys.Add(4);
        thickness.Add(5.2);
      }

    }

    A = keys;
    B = numberize;
    C = thickness;
# ---------- end c_script_19 ----------
item_36 = ListItem(List=material_buildups, Index=c_script_19.A, Wrap=True)
num_38 = Number(c_script_19.B)
num_39 = Number(c_script_19.C)

# ---- group: material ids
num_40 = Number(item_36)

# ----
thicknesses = RemoteSender(num_39)
group_nr = RemoteSender(num_38)
mat = RemoteSender(num_40)

# ---- group: Support Points
brep_4 = Brep(cull_18)
debrep_5 = DeconstructBrep(Brep=brep_4)  # -> simplify(Faces), Edges, flatten(Vertices)
pdecon_23 = Deconstruct(Point=debrep_5.Vertices)  # -> XComponent, YComponent, ZComponent
equalst = EqualityWithinTolerance(FirstNumber=pdecon_23.XComponent, SecondNumber="0", Tolerance=Slider(10, range=0..10))  # -> Equality, Inequality
cull_19 = CullPattern(List=debrep_5.Vertices, CullPattern=equalst.Equality)

# ---- group: Support Points / surfaces
srf_17 = Surface(debrep_5.Faces)

# ---- group: Support Points / support points
pt_60 = Point(cull_19)

# ---- group: Support Points
panel_46 = Panel("0.001")
scale = Scale(Geometry=brep_4, Center=Point(0, 0, 0), Factor=panel_46)  # -> Geometry, Transform
scale_2 = Scale(Geometry=pt_60, Center=Point(0, 0, 0), Factor=panel_46)  # -> Geometry, Transform
pt_61 = Point(scale_2.Geometry)

# ---- group: Main Surfaces
surfaces = Data(scale.Geometry)
assemble_structural_area_sofistik = AssembleStructuralAreaSofistik(Geometry=surfaces, GroupNr=group_nr)  # -> simplify(StructuralAreasSofiMesh)

# ----
scale_3 = Scale(Geometry=[boundary_3, boundary_4], Center=Point(0, 0, 0), Factor=panel_46)  # -> Geometry, Transform
assemble_structural_area_sofistik_2 = AssembleStructuralAreaSofistik(Geometry=graft(scale_3.Geometry), GroupNr=0)  # -> simplify(StructuralAreasSofiMesh)
data_25 = Data(flatten(assemble_structural_area_sofistik))
merge_39 = Merge(Data1=flatten(data_25), Data2=flatten(assemble_structural_area_sofistik_2))  # -> graft(Result)

# ---- group: Mesh
item_37 = ListItem(List=surfaces, Index=0, Wrap=True)  # disabled
item_38 = ListItem(List=surfaces, Index=0, Wrap=True)  # -> Item1, Item; disabled
debrep_6 = DeconstructBrep(Brep=item_37)  # -> Faces, Edges, Vertices; disabled
debrep_7 = DeconstructBrep(Brep=item_38.Item1)  # -> Faces, Edges, Vertices; disabled
debrep_8 = DeconstructBrep(Brep=surfaces)  # -> Faces, Edges, Vertices; disabled
number_slider_44 = Slider(1, range=0..10)  # disabled
item_39 = ListItem(List=debrep_6.Vertices, Index=0, Wrap=True)  # -> Item, Item1; disabled
item_40 = ListItem(List=debrep_7.Vertices, Index=0, Wrap=True)  # -> Item1, Item; disabled
item_41 = ListItem(List=debrep_8.Edges, Index=number_slider_44, Wrap=True)  # disabled
pt_62 = Point(item_39.Item)  # disabled
pt_63 = Point(item_39.Item1)  # disabled
pt_64 = Point(item_40.Item1)  # disabled
data_26 = Data(item_41)  # disabled
len_3 = Length(Curve=data_26)  # disabled
len_4 = Length(Curve=debrep_8.Edges)  # disabled
rec_3pt = Rectangle3Pt(PointA=pt_62, PointB=pt_64, PointC=pt_63)  # -> Rectangle, Length; disabled
smaller_2 = SmallerThan(FirstNumber=len_3, SecondNumber=len_4)  # -> SmallerThan, OrEqualTo; disabled
boundary_6 = BoundarySurfaces(Edges=rec_3pt.Rectangle)  # disabled
area_10 = Area(Geometry=boundary_6)  # -> Area, Centroid; disabled
cull_20 = CullPattern(List=debrep_8.Edges, CullPattern=smaller_2.SmallerThan)  # disabled
multiplication_2 = Multiplication(A=area_10.Area, B=1.5)  # disabled
panel_47 = Panel("1")  # disabled
assemble_structural_line_sofistik = AssembleStructuralLineSofistik(Curve=cull_20, GroupNr=0)  # disabled

# ----
generate_mesh_sofistik = GenerateMeshSofistik(
    Path=path,
    StructuralLines=assemble_structural_line_sofistik,
    StructuralAreas=flatten(merge_39),
    MeshProperties=assemble_mesh_properties_sofimesh,
    WpsExe=pathwps_exe,
    Cdb_w50Dll=pathcdb_dll,
    Run=Button(),
    meshs_Branch0_Path="{1}",
    meshs_Branch1_Path="{2}",
    meshs_Branch2_Path="{3}",
    meshs_Branch3_Path="{4}",
    meshs_Branch4_Path="{5}",
    meshs_Branch5_Path="{6}",
    meshs_Branch6_Path="{7}",
    meshs_Branch7_Path="{8}",
    meshs_Branch8_Path="{9}",
    meshs_Branch9_Path="{10}",
    meshs_Branch10_Path="{11}",
    meshs_Branch11_Path="{12}",
    meshs_Branch12_Path="{13}",
    meshs_Branch13_Path="{14}",
    meshs_Branch14_Path="{15}",
    meshs_Branch15_Path="{16}",
    meshs_Branch16_Path="{17}",
    meshs_Branch17_Path="{18}",
    meshs_Branch18_Path="{19}",
    meshs_Branch19_Path="{20}",
    meshs_Branch20_Path="{21}",
    meshs_Branch21_Path="{22}",
    meshs_Branch22_Path="{23}",
    meshs_Branch23_Path="{24}",
    meshs_Branch24_Path="{25}",
    meshs_Branch25_Path="{26}",
    meshs_Branch26_Path="{27}",
    meshs_Branch27_Path="{28}",
    meshs_Branch28_Path="{29}",
    meshs_Branch29_Path="{30}"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)  # -> Meshs, Completed
flatten = FlattenTree(Tree=generate_mesh_sofistik.Meshs, Path="{0}")  # -> simplify(graft(Tree))
mesh = Mesh(flatten(flatten))
thicknesses_2 = RemoteReceiver(thicknesses)
support = RemoteSender(pt_61)
mat_2 = RemoteReceiver(mat)
lng_21 = ListLength(List=thicknesses_2)
ins = InsertItems(List=thicknesses_2, Item=panel_13, Indices=lng_21, Wrap=True)
ins_2 = InsertItems(List=mat_2, Item=panel_15, Indices=lng_21, Wrap=True)
ins_3 = InsertItems(List=group_nr, Item=panel_14, Indices=lng_21, Wrap=True)

mesh_2 = Data(mesh)
graft = GraftTree(Tree=mesh_2, IncludeEmptyLists=True, IncludeNullItems=True)  # -> simplify(Tree)
area_11 = Area(Geometry=graft)  # -> Area, Centroid
srf_cp_5 = SurfaceClosestPoint(Point=area_11.Centroid, Surface=graft(surfaces))  # -> Point, UVPoint, Distance
curvature = PrincipalCurvature(Surface=graft(surfaces), Point=srf_cp_5.UVPoint)  # -> Frame, Min, Max, MinDirection, MaxDirection
deplane_5 = DeconstructPlane(Plane=curvature.Frame)  # -> Origin, XAxis, YAxis, ZAxis
amp = Amplitude(Vector=deplane_5.XAxis, Amplitude=0.1)
amp_2 = Amplitude(Vector=deplane_5.YAxis, Amplitude=0.1)
amp_3 = Amplitude(Vector=deplane_5.ZAxis, Amplitude=0.1)
vdis = VectorDisplay(Anchor=area_11.Centroid, Vector=amp)
vdis_2 = VectorDisplay(Anchor=area_11.Centroid, Vector=amp_2)
vdis_3 = VectorDisplay(Anchor=area_11.Centroid, Vector=amp_3)
addition_12 = Addition(A=panel_18, B=panel_19, C=panel_18)
assemble_shell_sofistika = AssembleShellSofistikA(Mesh=simplify(graft(mesh_2)), MaterialNr=graft(ins_2), Thickness=graft(ins), GroupNr=simplify(graft(ins_3)))  # -> flatten(Shell)

l_selvertices = LeopardsSelectMeshVertices(Mesh=assemble_shell_sofistika, lock=True, maintain=False, order=False, selectedobject="4374|403")  # -> Geometry, Index
l_selvertices_2 = LeopardsSelectMeshVertices(Mesh=assemble_shell_sofistika, lock=True, maintain=False, order=False, selectedobject="4485|3977")  # -> Geometry, Index
l_selvertices_3 = LeopardsSelectMeshVertices(Mesh=assemble_shell_sofistika, lock=True, maintain=False, order=False, selectedobject="4465|4210")  # -> Geometry, Index
l_selvertices_4 = LeopardsSelectMeshVertices(Mesh=assemble_shell_sofistika, lock=True, maintain=False, order=False, selectedobject="58|4352")  # -> Geometry, Index
item_42 = ListItem(List=assemble_shell_sofistika, Index=0, Wrap=True)  # -> Item2, Item1, Item

# ---- group: Preassembly
preassemble_model_sofistik = PreAssembleModelSofistik(Points=flatten(pt_61), Shells=assemble_shell_sofistika, tol=0.001)  # -> NodeList, Shells, Beams, Trusses, Cables, Couplings

# ----
find_nodes_sofistik = FindNodesSofistik(Nodes=preassemble_model_sofistik.NodeList, Geometry=l_selvertices_4.Geometry, tol=0.001)
find_nodes_sofistik_2 = FindNodesSofistik(Nodes=preassemble_model_sofistik.NodeList, Geometry=l_selvertices.Geometry, tol=0.001)
find_nodes_sofistik_3 = FindNodesSofistik(Nodes=preassemble_model_sofistik.NodeList, Geometry=l_selvertices_2.Geometry, tol=0.001)
find_nodes_sofistik_4 = FindNodesSofistik(Nodes=preassemble_model_sofistik.NodeList, Geometry=l_selvertices_3.Geometry, tol=0.001)
item_43 = ListItem(List=find_nodes_sofistik, Index=0, Wrap=True)  # -> Item, Item1, Item2
item_44 = ListItem(List=find_nodes_sofistik_2, Index=0, Wrap=True)  # -> Item, Item1, Item2
item_45 = ListItem(List=find_nodes_sofistik_3, Index=0, Wrap=True)  # -> Item, Item1, Item2
item_46 = ListItem(List=find_nodes_sofistik_4, Index=0, Wrap=True)  # -> Item, Item1, Item2
ln_5 = Line(StartPoint=item_45.Item, EndPoint=item_45.Item1)
ln_6 = Line(StartPoint=item_44.Item, EndPoint=item_44.Item1)
assemble_beam_sofistik = AssembleBeamSofistik(GroupNr=1, StartNode=item_44.Item, EndNode=item_44.Item1, StartSectionNr="2", EndSectionNr="2")
assemble_beam_sofistik_2 = AssembleBeamSofistik(GroupNr=1, StartNode=item_46.Item, EndNode=item_46.Item1, StartSectionNr="2", EndSectionNr="2")
assemble_beam_sofistik_3 = AssembleBeamSofistik(GroupNr=1, StartNode=item_43.Item, EndNode=item_43.Item1, StartSectionNr="2", EndSectionNr="2")
assemble_beam_sofistik_4 = AssembleBeamSofistik(GroupNr=1, StartNode=item_45.Item, EndNode=item_45.Item2, StartSectionNr="2", EndSectionNr="2")
len_5 = Length(Curve=ln_5)
panel_48 = Panel(len_5)
relay = Relay([assemble_beam_sofistik, assemble_beam_sofistik_4, assemble_beam_sofistik_2, assemble_beam_sofistik_3])

# ---- group: Loading / Random Point Load
mesh_3 = Mesh(mesh)  # disabled
item_47 = ListItem(List=flatten(mesh_3), Index=0, Wrap=True)  # -> Item, Item1; disabled
demesh = DeconstructMesh(Mesh=item_47.Item1)  # -> Vertices, Faces, Colours, Normals; disabled
random_point = GhPythonScript(x=demesh.Vertices)  # -> out, a; inputs x: list of Point3d; disabled
# ---------- random_point: Python ----------
import Rhino.Geometry as rg
import random

# List of points

# Get a random point from the list
random_point = random.choice(x)

a = random_point
# ---------- end random_point ----------
pt_65 = Point(random_point.a)  # disabled
find_nodes_sofistik_5 = FindNodesSofistik(Nodes=preassemble_model_sofistik.NodeList, Geometry=pt_65, tol=0.001)  # disabled
assemble_pointload_sofistik = AssemblePointLoadSofistik(LoadNodes=find_nodes_sofistik_5, LoadcaseNumber=panel_21, LoadType=panel_22, LoadValues=panel_23)  # disabled

# ----
support_2 = RemoteReceiver(support)
l_selvertices_5 = LeopardsSelectMeshVertices(Mesh=item_42.Item2, lock=True, maintain=False, order=False, selectedobject="25|24|2|23|22|21|1")  # -> Geometry, Index
l_selvertices_6 = LeopardsSelectMeshVertices(Mesh=item_42.Item1, lock=True, maintain=False, order=False, selectedobject="25|24|2|23|22|21|1")  # -> Geometry, Index
cullpt_3 = CullDuplicates(Points=support_2, Tolerance=number_slider_36, CullMode=1)  # -> Points, Indices, Valence

node_sofistik = NodeSofistik(preassemble_model_sofistik.NodeList)
find_nodes_sofistik_6 = FindNodesSofistik(Nodes=node_sofistik, Geometry=[l_selvertices_5.Geometry, l_selvertices_6.Geometry], tol=0.001)
assemble_support_sofistik = AssembleSupportSofistik(Node=find_nodes_sofistik_6, Type="F")

mesh_4 = Mesh(preassemble_model_sofistik.Shells)  # disabled

# ---- group: Loading / Traffic Loads
item_48 = ListItem(List=preassemble_model_sofistik.Shells, Index=0, Wrap=True)  # -> Item, Item1; disabled
panel_49 = Panel("1002")  # disabled
panel_50 = Panel("pzz")  # disabled
panel_51 = Panel("0")  # disabled
assemble_meshload_sofistik = AssembleMeshLoadSofistik(LoadMesh=mesh_4, LoadcaseNumber=panel_49, LoadType=panel_50, LoadValues=panel_51)  # -> flatten(MeshLoad); disabled

# ----
intersect_shells_sofistik = IntersectShellsSofistik(Shells=preassemble_model_sofistik.Shells, shell_combination=0, tol=0.001)  # -> NodesASofistikA, NodesBSofistikA

# ---- group: Loading / Selfweight Floor Build Up
panel_52 = Panel("1001")  # disabled
panel_53 = Panel("pzz")  # disabled
panel_54 = Panel("-1.0")  # disabled
assemble_meshload_sofistik_2 = AssembleMeshLoadSofistik(LoadMesh=mesh_4, LoadcaseNumber=panel_52, LoadType=panel_53, LoadValues=panel_54)  # -> flatten(MeshLoad); disabled

# ---- group: Loading
merge_40 = Merge(Data1=assemble_meshload_sofistik_2, Data2=assemble_meshload_sofistik)  # disabled

# ----
assemble_coupling_sofistik = AssembleCouplingSofistik(Node=intersect_shells_sofistik.NodesASofistikA, ReferenceNode=intersect_shells_sofistik.NodesBSofistikA, Type="KF")  # -> flatten(CouplingSofistikA)

# ---- group: Calculation
path_2 = Data(path)
aqua = Data(aqua_file)
support_sofistik = SupportSofistik(flatten(assemble_support_sofistik))
load_sofistik = LoadSofistik(merge_40)
assemble_model_sofistik = AssembleModelSofistik(
    Path=path_2,
    AquaFile=aqua,
    Nodes=preassemble_model_sofistik.NodeList,
    Shells=flatten(preassemble_model_sofistik.Shells),
    Beams=[preassemble_model_sofistik.Beams, relay],
    Couplings=assemble_coupling_sofistik,
    Supports=support_sofistik,
    Loads=load_sofistik,
    AseFile=merge_16,
    SofistikPath=pathwps_exe,
    Run=button_5,
    disable_warnings=False,
    run_sofistik=True)  # -> CdbPath, GroupDivisor, Springs, Beams, Trusses, Cables, Completed, Errors

# ---- group: Sofistik
open_sofistik = OpenSofistik(Path=assemble_model_sofistik.CdbPath, Teddy=Button(), Animator=Button(), Wingraf=Button(), FileLocation=Button())

# ----
toggle_4 = BooleanToggle(True)
load_case = Panel("101")
uls = Panel("201")
pathcdb_dll_2 = FilePath(pathcdb_dll)
pathcdb = FilePath(assemble_model_sofistik.CdbPath)

# ---- group: CLT
pathcdb_2 = FilePath(pathcdb)
pathcdb_dll_3 = FilePath(pathcdb_dll_2)
check_cross_sections = CSharpScript(
    path=pathcdb_2,
    lcNumbers=uls,
    dllPath=pathcdb_dll_3,
    kmod="0.8",
    run=toggle_4,
    Reference="C:\USERS\EDDY\DESKTOP\Templates\Sofistik\GH Scripts\Sofistik.gha")  # -> out, eta_x, eta_y, eta_vxy, eta_vz, eta_v, eta; inputs path: String, lcNumbers: list of Int32, dllPath: String, kmod: Double, run: Boolean
# ---------- check_cross_sections: C# usings ----------
using System.IO;
using System.Linq;
using System.Data;
using System.Drawing;
using System.Reflection;
using System.Windows.Forms;
using System.Xml;
using System.Xml.Linq;
using System.Runtime.InteropServices;

using Rhino.DocObjects;
using Rhino.Collections;
using GH_IO;
using GH_IO.Serialization;
using Sofistik;
using Sofistik.Properties;
using Sofistik.Meshing;
# ---------- check_cross_sections: C# ----------
    // Safety factor
    double gammaM = 1.3;

    // Check for validity
    if (string.IsNullOrWhiteSpace(path)) { return; }
    if (string.IsNullOrWhiteSpace(dllPath)) { return; }

    if (!run)
      return;

    // Load sof_cdb.dll under specified path
    NativeMethods.SetDllDirectory(Path.GetDirectoryName(dllPath));
    IntPtr hModule = NativeMethods.LoadLibrary(dllPath);
    if (hModule == IntPtr.Zero)
    {
      Print("HModule = IntPtr.Zero, aborted");
      return;
    }

    // Retrieve the materials from the database
    materialInfos = CdbMethods.GetMaterialInfos(hModule, path);
    materials = new Dictionary<int, Sofistik.Material>();
    foreach (KeyValuePair<int, MaterialType> materialInfo in materialInfos)
    {
      int mnr = materialInfo.Key;
      materials.Add(mnr, CdbMethods.GetMaterial(hModule, path, mnr));
    }

    //  foreach (KeyValuePair<int, Sofistik.Material> kvp in materials)
    //  {
    //    int mnr = kvp.Key;
    //    TimberMaterial material = kvp.Value as TimberMaterial;
    //    if (material == null)
    //      continue;
    //    Rhino.RhinoApp.WriteLine("material " + mnr.ToString() + " Fv,k " + (0.001 * material.Fv_k).ToString());
    //    Rhino.RhinoApp.WriteLine("material " + mnr.ToString() + " Fvb,k " + (0.001 * material.Fvb_k).ToString());
    //    Rhino.RhinoApp.WriteLine("material " + mnr.ToString() + " Fvb,90,k " + (0.001 * material.Fvb90_k).ToString());
    //  }

    // Retrieve quads and quad results from database
    List<CQUAD> quads = CdbMethods.GetQuads(hModule, path);
    int nQuads = quads.Count;

    quadResults = new Dictionary<int,List<CQUAD_FOR>>();
    foreach (var quad in quads)
    {
      quadResults.Add(quad.m_NR, new List<CQUAD_FOR>());
    }
    foreach (int lcNumber in lcNumbers)
    {
      if (lcNumber <= 0)
        return;
      List<CQUAD_FOR> quadForces = CdbMethods.GetQuadForces(hModule, path, lcNumber);
      if (quadForces.Count != nQuads)
      {
        Print("quadForces.Count != quads.Count");
        return;
      }
      foreach (var quadForce in quadForces)
      {
        int quadNr = quadForce.m_NR;
        if(quadResults.ContainsKey(quadNr))
        {
          quadResults[quadNr].Add(quadForce);
        }
      }
    }

    // Initialize output variables
    List<double> _eta_x = new List<double>();
    List<double> _eta_y = new List<double>();
    List<double> _eta_vxy = new List<double>();
    List<double> _eta_vz = new List<double>();
    List<double> _eta_v = new List<double>();
    List<double> _eta = new List<double>();

    for (int i = 0; i < nQuads; i++)
    {
      double eta_x_i = 0.0;
      double eta_y_i = 0.0;
      double eta_vxy_i = 0.0;
      double eta_vz_i = 0.0;
      double eta_v_i = 0.0;

      // retrieve quadnr and thickness
      int quadNr = quads[i].m_NR;
      double t = 1000.0 * (double) quads[i].m_THICK[0]; // mm

      // retrieve material nr of the quad
      int mnr = quads[i].m_MAT;

      // check if material is mlay or single layer material
      if (materials[mnr].MaterialType != MaterialType.Mlay)
      {
        ComputeSingleLayerResult(quadNr, t, mnr, kmod, gammaM, out eta_x_i, out eta_y_i, out eta_vxy_i, out eta_vz_i);
      }
      else
      {
        ComputeMultiLayerResult(quadNr, mnr, kmod, gammaM, out eta_x_i, out eta_y_i, out eta_vxy_i, out eta_vz_i);
      }
      eta_v_i = eta_vxy_i + eta_vz_i;
      double eta_i = new double[]{eta_x_i, eta_y_i, eta_v_i}.Max();
      _eta_x.Add(eta_x_i);
      _eta_y.Add(eta_y_i);
      _eta_vxy.Add(eta_vxy_i);
      _eta_vz.Add(eta_vz_i);
      _eta_v.Add(eta_v_i);
      _eta.Add(eta_i);
    }

    eta_x = _eta_x;
    eta_y = _eta_y;
    eta_vxy = _eta_vxy;
    eta_vz = _eta_vz;
    eta_v = _eta_v;
    eta = _eta;

    NativeMethods.FreeLibrary(hModule);
    NativeMethods.SetDllDirectory(null);
# ---------- check_cross_sections: C# additional code ----------
  Dictionary<int, MaterialType> materialInfos;
  Dictionary<int, Sofistik.Material> materials;
  Dictionary<int,List<CQUAD_FOR>> quadResults;

  protected void ComputeSingleLayerResult(int quadNr, double t, int mnr, double kmod, double gammaM,
    out double eta_x, out double eta_y, out double eta_vxy, out double eta_vz)
  {
    // retrieve the material values of the quad
    TimberMaterial material = materials[mnr] as TimberMaterial;
    if (material == null)
    {
      Print("Cannot perform timber checks on non-timber materials, aborted.");
      eta_x = 0.0;
      eta_y = 0.0;
      eta_vxy = 0.0;
      eta_vz = 0.0;
      return;
    }
    double fm0_rd = 0.001 * (kmod / gammaM) * material.Fm0_k;
    double fm90_rd = 0.001 * (kmod / gammaM) * material.Fm90_k;   // N/mm²
    double ft0_rd = 0.001 * (kmod / gammaM) * material.Ft0_k;    // N/mm²
    double ft90_rd = 0.001 * (kmod / gammaM) * material.Ft90_k;   // N/mm²
    double fc0_rd = 0.001 * (kmod / gammaM) * material.Fc0_k;    // N/mm²
    double fc90_rd = 0.001 * (kmod / gammaM) * material.Fc90_k;   // N/mm²
    double fv_rd = 0.001 * (kmod / gammaM) * material.Fv_k;     // N/mm²
    double fvb_rd = 0.001 * (kmod / gammaM) * material.Fvb_k;    // N/mm²
    double fvb90_rd = 0.001 * (kmod / gammaM) * material.Fvb90_k;  // N/mm²

    // retrieve the quad forces for this quad, n --> kN/m, m --> kN-m/m
    List<CQUAD_FOR> quadForces = quadResults[quadNr];
    double nx_t = 0.0;
    double nx_c = 0.0;
    double ny_t = 0.0;
    double ny_c = 0.0;
    double nxy = 0.0;
    double mx = 0.0;
    double my = 0.0;
    double mxy = 0.0;
    double vx = 0.0;
    double vy = 0.0;
    foreach (var quadForce in quadForces)
    {
      if (quadForce.m_NX > nx_t)
        nx_t = quadForce.m_NX;
      if (quadForce.m_NX < nx_c)
        nx_c = quadForce.m_NX;
      if (quadForce.m_NY > ny_t)
        ny_t = quadForce.m_NY;
      if (quadForce.m_NY < ny_c)
        ny_c = quadForce.m_NY;
      if (Math.Abs(quadForce.m_NXY) > nxy)
        nxy = Math.Abs(quadForce.m_NXY);

      if (Math.Abs(quadForce.m_MXX) > mx)
        mx = Math.Abs(quadForce.m_MXX);
      if (Math.Abs(quadForce.m_MYY) > my)
        my = Math.Abs(quadForce.m_MYY);
      if (Math.Abs(quadForce.m_MXY) > mxy)
        mxy = Math.Abs(quadForce.m_MXY);

      if (Math.Abs(quadForce.m_VX) > vx)
        vx = Math.Abs(quadForce.m_VX);
      if (Math.Abs(quadForce.m_VY) > vy)
        vy = Math.Abs(quadForce.m_VY);
    }

    // Bending Resistance and Axial resistance
    // x-Direction:
    double mx_rd = 0.001 * fm0_rd * t * t / 6.0;
    double nx_c_rd = fc0_rd * t;  // kN/m
    double nx_t_rd = ft0_rd * t;  // kN/m

    // y-Direction:
    double my_rd = 0.001 * fm90_rd * t * t / 6.0;
    double ny_c_rd = fc90_rd * t;  // kN/m
    double ny_t_rd = ft90_rd * t;  // kN/m

    // Torsion Resistance
    double mxy_rd = 1000.0 * fv_rd * t * t / 6.0; // TODO: CHECK THIS

    // In-Plane shear resistance
    double nxy_rd = 1000.0 * fv_rd * t;

    // Out-of-plane shear resistance
    double vx_rd = fvb_rd * t / 1.5;
    double vy_rd = fvb90_rd * t / 1.5;

    eta_x = Math.Max(
      mx / mx_rd + nx_t / nx_t_rd,
      mx / mx_rd - nx_c / nx_c_rd);

    eta_y = Math.Max(
      my / my_rd + ny_t / ny_t_rd,
      my / my_rd - ny_c / ny_c_rd);
    eta_vxy = mxy / mxy_rd + nxy / nxy_rd;
    eta_vz = Math.Sqrt(Math.Pow(vx / vx_rd, 2) + Math.Pow(vy / vy_rd, 2));
  }

  protected void ComputeMultiLayerResult(int quadNr, int mnr, double kmod, double gammaM,
    out double eta_x, out double eta_y, out double eta_vxy, out double eta_vz)
  {
    eta_x = 0.0;
    eta_y = 0.0;
    eta_vxy = 0.0;
    eta_vz = 0.0;

    int layerMaterialNr = 0;

    LayeredMaterial layeredMaterial = materials[mnr] as LayeredMaterial;
    if (layeredMaterial == null)
    {
      Print("Multi-Layer results can only be computed with multi-layer materials.");
      return;
    }

    Dictionary<int,TimberMaterial> timberMaterials = new Dictionary<int,TimberMaterial>();
    foreach (int key in materials.Keys)
    {
      var timberMaterial = materials[key] as TimberMaterial;
      if (timberMaterial != null)
      {
        timberMaterials.Add(key, timberMaterial);
      }
    }

    List<Tuple<int,double,double>> layers = layeredMaterial.Layers;

    // compute t, assume symetric build-up
    double t = 0.0;     // m
    double tmax = 0.0;  // m
    for (int j = 0; j < layers.Count; j++)
    {
      t += layers[j].Item2;
      if (layers[j].Item2 > tmax)
      {
        tmax = layers[j].Item2;
      }
    }

    // retrieve the quad forces for this quad, n --> kN/m, m --> kN-m/m
    List<CQUAD_FOR> quadForces = quadResults[quadNr];
    double nx_t = 0.0;
    double nx_c = 0.0;
    double ny_t = 0.0;
    double ny_c = 0.0;
    double nxy = 0.0;
    double mx = 0.0;
    double my = 0.0;
    double mxy = 0.0;
    double vx = 0.0;
    double vy = 0.0;
    foreach (var quadForce in quadForces)
    {
      if (quadForce.m_NX > nx_t)
        nx_t = quadForce.m_NX;
      if (quadForce.m_NX < nx_c)
        nx_c = quadForce.m_NX;
      if (quadForce.m_NY > ny_t)
        ny_t = quadForce.m_NY;
      if (quadForce.m_NY < ny_c)
        ny_c = quadForce.m_NY;
      if (Math.Abs(quadForce.m_NXY) > nxy)
        nxy = Math.Abs(quadForce.m_NXY);

      if (Math.Abs(quadForce.m_MXX) > mx)
        mx = Math.Abs(quadForce.m_MXX);
      if (Math.Abs(quadForce.m_MYY) > my)
        my = Math.Abs(quadForce.m_MYY);
      if (Math.Abs(quadForce.m_MXY) > mxy)
        mxy = Math.Abs(quadForce.m_MXY);

      if (Math.Abs(quadForce.m_VX) > vx)
        vx = Math.Abs(quadForce.m_VX);
      if (Math.Abs(quadForce.m_VY) > vy)
        vy = Math.Abs(quadForce.m_VY);
    }

    // compute Bx, By and Bxy
    // compute Dx, Dy and Dxy
    double Bx = 0.0;
    double By = 0.0;
    double Bxy = 0.0;
    double Dx = 0.0;
    double Dy = 0.0;
    double Dxy = 0.0;
    double z_j = -0.5 * t;
    for (int j = 0; j < layers.Count; j++)
    {
      // material properties
      double Ex_j = timberMaterials[layers[j].Item1].E0;   // [kN/m²]
      double Ey_j = timberMaterials[layers[j].Item1].E90;  // [kN/m²]
      double Gxy_j = timberMaterials[layers[j].Item1].G0;  // [kN/m²]

      // geometry information
      double t_j = layers[j].Item2;
      z_j += 0.5 * t_j;
      Bx += Ex_j * (t_j * Math.Pow(z_j, 2) + Math.Pow(t_j, 3) / 12);
      By += Ey_j * (t_j * Math.Pow(z_j, 2) + Math.Pow(t_j, 3) / 12);
      Bxy += Gxy_j * (2 * t_j * Math.Pow(z_j, 2) + Math.Pow(t_j, 3) / 6);
      Dx += Ex_j * t_j;
      Dy += Ey_j * t_j;
      Dxy += Gxy_j * t_j;
      z_j += 0.5 * t_j;
    }

    // compute ESx and ESy
    double ESx = 0.0;
    double ESy = 0.0;
    z_j = 0.0;
    if (layers.Count == 3 || layers.Count == 7 || layers.Count == 11)
    {
      // rolling shear, critical layer for x-Direction: midlayer
      // rolling shear, critical layer for y-Direction: midlayer + 1
      for (int j = layers.Count / 2; j < layers.Count; j++)
      {
        // material properties
        double Ex_j = timberMaterials[layers[j].Item1].E0;   // [kN/m²]
        double Ey_j = timberMaterials[layers[j].Item1].E90;  // [kN/m²]

        // geometry information
        double t_j = layers[j].Item2;
        if (j > layers.Count / 2)
        {
          z_j += 0.5 * t_j;
          ESx += Ex_j * z_j * t_j;
          ESy += Ey_j * z_j * t_j;
        }
        else
        {
          ESx += Ex_j * t_j * t_j / 8.0;
        }
        z_j += 0.5 * t_j;
      }
    }
    else if (layers.Count == 5 || layers.Count == 9 || layers.Count == 13)
    {
      // rolling shear, critical layer for x-Direction: midlayer + 1
      // rolling shear, critical layer for y-Direction: midlayer
      for (int j = layers.Count / 2; j < layers.Count; j++)
      {
        // material properties
        double Ex_j = timberMaterials[layers[j].Item1].E0;   // [kN/m²]
        double Ey_j = timberMaterials[layers[j].Item1].E90;  // [kN/m²]

        // geometry information
        double t_j = layers[j].Item2;
        if (j > layers.Count / 2)
        {
          z_j += 0.5 * t_j;
          ESx += Ex_j * z_j * t_j;
          ESy += Ey_j * z_j * t_j;
        }
        else
        {
          ESy += Ey_j * t_j * t_j / 8.0;
        }
        z_j += 0.5 * t_j;
      }
    }
    else
    {
      Print("Asymetric build-up, or too many layers, not supported.");
      return;
    }

    // Bending Resistance and Axial resistance
    // x-Direction:
    layerMaterialNr = layers[layers.Count - 1].Item1;
    double fm_rd = 0.001 * (kmod / gammaM) * timberMaterials[layerMaterialNr].Fm0_k; // N/mm²
    double ft0_rd = 0.001 * (kmod / gammaM) * timberMaterials[layerMaterialNr].Ft0_k; // N/mm²
    double fc0_rd = 0.001 * (kmod / gammaM) * timberMaterials[layerMaterialNr].Fc0_k; // N/mm²

    double zo = 0.5 * t;
    double mx_rd = 1000.0 * fm_rd * Bx / (timberMaterials[layerMaterialNr].E0 * zo);
    double nx_c_rd = 1000.0 * fc0_rd * Dx / (timberMaterials[layerMaterialNr].E0);
    double nx_t_rd = 1000.0 * ft0_rd * Dx / (timberMaterials[layerMaterialNr].E0);

    // y-Direction:
    layerMaterialNr = layers[layers.Count - 2].Item1;
    fm_rd = 0.001 * (kmod / gammaM) * timberMaterials[layerMaterialNr].Fm0_k; // N/mm²
    ft0_rd = 0.001 * (kmod / gammaM) * timberMaterials[layerMaterialNr].Ft0_k; // N/mm²
    fc0_rd = 0.001 * (kmod / gammaM) * timberMaterials[layerMaterialNr].Fc0_k; // N/mm²

    double to = t - layers[layers.Count - 1].Item2;
    zo = to - 0.5 * t;
    double my_rd = 1000.0 * fm_rd * By / (timberMaterials[layerMaterialNr].E90 * zo);
    double ny_c_rd = 1000.0 * fc0_rd * Dy / (timberMaterials[layerMaterialNr].E90);
    double ny_t_rd = 1000.0 * ft0_rd * Dy / (timberMaterials[layerMaterialNr].E90);

    // Material values shear + torsion
    double fv_k = double.MaxValue;
    double fv_T_k = double.MaxValue;
    foreach (var layer in layers)
    {
      if (timberMaterials[layer.Item1].Fv_k < fv_k)
      {
        fv_k = timberMaterials[layer.Item1].Fv_k;
      }
      if (timberMaterials[layer.Item1].Fvb90_k < fv_T_k)
      {
        fv_T_k = timberMaterials[layer.Item1].Fvb90_k;
      }
    }
    double fv_rd = 0.001 * (kmod / gammaM) * fv_k;       // N/mm²
    double fv_T_rd = 0.001 * (kmod / gammaM) * fv_T_k;   // N/mm²

    // Twisting Resistance
    zo = 0.5 * t;
    layerMaterialNr = layers[layers.Count - 1].Item1;
    double mxy_rd = 1000.0 * fv_T_rd * Bxy / (timberMaterials[layerMaterialNr].G0 * zo);

    // In-Plane shear resistance
    layerMaterialNr = layers[layers.Count - 1].Item1;
    double t0_netto = Dx / (timberMaterials[layerMaterialNr].E0);
    layerMaterialNr = layers[layers.Count - 2].Item1;
    double t90_netto = Dy / (timberMaterials[layerMaterialNr].E90);
    double t_netto = Math.Min(t0_netto, t90_netto);
    double a = 0.15;
    double nxy_1_rd = 1000.0 * fv_T_rd * t_netto * a / (3.0 * tmax);
    double nxy_2_rd = 1000.0 * fv_rd * t;
    double nxy_rd = Math.Min(nxy_1_rd, nxy_2_rd);

    // Out-of-plane shear resistance
    double fv_R_rd = 0.0;    // N/mm²
    double vx_rd = (1000.0 * fv_R_rd * Bx) / ESx;
    double vy_rd = 0.0;
    switch (layers.Count)
    {
      case 3:
        // rolling shear, critical layer for x-Direction: midlayer
        fv_R_rd = 0.001 * (kmod / gammaM) * timberMaterials[layers[1].Item1].Fvb_k;
        vx_rd = (1000.0 * fv_R_rd * Bx) / ESx;
        // for y-Direction: no rolling shear, simple shear for the mid board
        double t_mid = layers[1].Item2;
        vy_rd = (1000.0 * fv_T_rd * t_mid) / 1.5;
        break;
      case 5:
        // rolling shear, critical layer for x-Direction: midlayer - 1
        fv_R_rd = 0.001 * (kmod / gammaM) * timberMaterials[layers[1].Item1].Fvb_k;
        vx_rd = (1000.0 * fv_R_rd * Bx) / ESx;
        // rolling shear, critical layer for y-Direction: midlayer
        fv_R_rd = 0.001 * (kmod / gammaM) * timberMaterials[layers[2].Item1].Fvb_k;
        vy_rd = (1000.0 * fv_R_rd * By) / ESy;
        break;
      case 7:
        // rolling shear, critical layer for x-Direction: midlayer
        fv_R_rd = 0.001 * (kmod / gammaM) * timberMaterials[layers[3].Item1].Fvb_k;
        vx_rd = (1000.0 * fv_R_rd * Bx) / ESx;
        // rolling shear, critical layer for y-Direction: midlayer - 1
        fv_R_rd = 0.001 * (kmod / gammaM) * timberMaterials[layers[2].Item1].Fvb_k;
        vy_rd = (1000.0 * fv_R_rd * By) / ESy;
        break;
      case 9:
        // rolling shear, critical layer for x-Direction: midlayer - 1
        fv_R_rd = 0.001 * (kmod / gammaM) * timberMaterials[layers[3].Item1].Fvb_k;
        vx_rd = (1000.0 * fv_R_rd * Bx) / ESx;
        // rolling shear, critical layer for y-Direction: midlayer
        fv_R_rd = 0.001 * (kmod / gammaM) * timberMaterials[layers[4].Item1].Fvb_k;
        vy_rd = (1000.0 * fv_R_rd * By) / ESy;
        break;
      default:
        Print("Asymetric build-up, or too many layers, not supported.");
        return;
    }
    eta_x = Math.Max(
      mx / mx_rd + nx_t / nx_t_rd,
      mx / mx_rd - nx_c / nx_c_rd);

    eta_y = Math.Max(
      my / my_rd + ny_t / ny_t_rd,
      my / my_rd - ny_c / ny_c_rd);
    eta_vxy = mxy / mxy_rd + nxy / nxy_rd;
    eta_vz = Math.Sqrt(Math.Pow(vx / vx_rd, 2) + Math.Pow(vy / vy_rd, 2));
  }

  internal class NativeMethods
  {
    [DllImport("Kernel32.dll", BestFitMapping = false, CharSet = CharSet.Ansi, SetLastError = true, ThrowOnUnmappableChar = true)]
    internal static extern IntPtr LoadLibrary([MarshalAs(UnmanagedType.LPStr)]string lpFileName);

    [DllImport("Kernel32.dll", BestFitMapping = false, CharSet = CharSet.Ansi, ExactSpelling = true, SetLastError = true, ThrowOnUnmappableChar = true)]
    internal static extern IntPtr GetProcAddress(IntPtr hModule, string procName);

    [DllImport("Kernel32.dll", SetLastError = true)]
    internal static extern bool FreeLibrary(IntPtr hModule);

    [DllImport("Kernel32.dll", CharSet = CharSet.Unicode, SetLastError = true)]
    [return: MarshalAs(UnmanagedType.Bool)]
    internal static extern bool SetDllDirectory(string lpPathName);
  }
# ---------- end check_cross_sections ----------
bnd_14 = Bounds(Numbers=check_cross_sections.eta_x)
bnd_15 = Bounds(Numbers=check_cross_sections.eta_y)
bnd_16 = Bounds(Numbers=check_cross_sections.eta_vxy)
bnd_17 = Bounds(Numbers=check_cross_sections.eta_vz)
bnd_18 = Bounds(Numbers=check_cross_sections.eta_v)
bnd_19 = Bounds(Numbers=check_cross_sections.eta)
addition_13 = Addition(A=check_cross_sections.eta_vxy, B=check_cross_sections.eta_vz)
panel_55 = Panel([bnd_14, bnd_15, bnd_16, bnd_17, bnd_18, bnd_19])
bnd_20 = Bounds(Numbers=addition_13)
get_deformed_mesh_sofistik = GetDeformedMeshSofistik(Path=pathcdb_2, LoadCase=1, ScalingFactor=100, SofistikPath=pathcdb_dll_3, Run=toggle_4)  # -> InitialMesh, DeformedMesh
number_slider_45 = Slider(1, range=0..1)
dedomain_24 = DeconstructDomain(Domain=bnd_19)  # -> Start, End
gradient_2 = Gradient(
    LowerLimit=dedomain_24.End,
    UpperLimit=dedomain_24.Start,
    Parameter=check_cross_sections.eta,
    stops=[0: RGB(234, 38, 0), 0.25: RGB(234, 126, 0), 0.5: RGB(254, 244, 84), 0.75: RGB(173, 203, 249), 1: RGB(75, 107, 169)])

# ---- group: Manual Stress Calculation
toggle_5 = BooleanToggle(True)
pathcdb_dll_4 = FilePath(pathcdb)
get_shell_forces_sofistik = GetShellForcesSofistik(Path=pathcdb_dll_2, LoadCase=1, SofistikPath=pathcdb_dll_4, Run=toggle_5)  # -> QNR, T, MXX, MYY, MXY, VX, VY, NXX, NYY, NXY
get_deformed_mesh_sofistik_2 = GetDeformedMeshSofistik(LoadCase=1, ScalingFactor=Slider(0, range=0..100), SofistikPath=pathcdb_dll_4, Run=toggle_5)  # -> InitialMesh, DeformedMesh
int = Integer(get_shell_forces_sofistik.MXX)
facen = FaceNormals(Mesh=get_deformed_mesh_sofistik_2.InitialMesh)  # -> Centers, Normals
python_8 = GhPythonScript(
    E0=panel_29,
    E90=panel_30,
    t1=panel_27,
    t2=panel_28,
    nxx=get_shell_forces_sofistik.NXX,
    mxx=get_shell_forces_sofistik.MXX,
    nyy=get_shell_forces_sofistik.NYY,
    myy=get_shell_forces_sofistik.MYY)  # -> out, sig_x_top, sig_x_bot, sig_y_top_1, sig_y_int_1, sig_y_int_2, sig_y_bot_2
# ---------- python_8: Python ----------
import math 

# -------------- X direction -------------
Ax  = t2
Wxx = Ax*Ax/6

sigma_nx    = nxx / Ax
sigma_mxx   = mxx / Wxx * 1000
sig_x_top = sigma_nx - sigma_mxx
sig_x_bot = sigma_nx + sigma_mxx


# -------------- Y direction -------------
by_eq   = E90/E0
Ay_1    = t1
Ay_2    = t2 * by_eq
Ay_eq   = Ay_1 + Ay_2 
zg_y_1  = t1/2
zg_y_2  = t1 + t2/2
zg_y    = (zg_y_1 * Ay_1 + zg_y_2 * Ay_2) / Ay_eq
Iyy_1   = t1*t1*t1/12
Iyy_2   = t2*t2*t2/12*by_eq
Iyy     = Iyy_1 + Iyy_2 + math.pow(zg_y - zg_y_1,2)*Ay_1 + math.pow(zg_y - zg_y_2,2)*Ay_2

eps_y_top = myy / Iyy / E0 * (0 - zg_y) * 1000         + nyy / Ay_eq / E0
eps_y_int = myy / Iyy / E0 * (t1 - zg_y) * 1000        + nyy / Ay_eq / E0
eps_y_bot = myy / Iyy / E0 * (t1 + t2 - zg_y) * 1000   + nyy / Ay_eq / E0

sig_y_top_1 = eps_y_top * E0
sig_y_int_1 = eps_y_int * E0 
sig_y_int_2 = eps_y_int * E90 
sig_y_bot_2 = eps_y_bot * E90
# ---------- end python_8 ----------
bnd_21 = Bounds(Numbers=get_shell_forces_sofistik.MXX)
entwine_7 = Entwine(Branch00=python_8.sig_x_top, Branch01=python_8.sig_x_bot, FlattenInputs=True)
dedomain_25 = DeconstructDomain(Domain=bnd_21)  # -> Start, End
textdot = DefineTextDot(Text=get_shell_forces_sofistik.MXX, Location=facen.Centers, Font="Arial", Size=Slider(10, range=0..10))
swatch = ColourSwatch(SwatchColor=RGB(255, 255, 255))
flip_11 = FlipMatrix(Data=entwine_7)
gradient_3 = Gradient(
    LowerLimit=dedomain_25.Start,
    UpperLimit=dedomain_25.End,
    Parameter=get_shell_forces_sofistik.MXX,
    stops=[0: RGB(234, 38, 0), 0.25: RGB(234, 126, 0), 0.5: RGB(254, 244, 84), 0.75: RGB(173, 203, 249), 1: RGB(75, 107, 169)])
abs_3 = Absolute()
abs_4 = Absolute(Value=flip_11)
sort_14 = SortList(Keys=abs_4, ValuesA=flip_11)  # -> Keys, ValuesA
item_49 = ListItem(List=reverse(sort_14.ValuesA), Index=0, Wrap=True)  # -> flatten(Item)
colourmesh = ColourMesh(Mesh=get_deformed_mesh_sofistik_2.InitialMesh, Colors=gradient_3)

# ---- group: Deformation
get_nodal_results_sofistik = GetNodalResultsSofistik(Path=pathcdb, LoadCases=load_case, SofistikPath=pathcdb_dll_2, Run=toggle_4)  # -> NodeNumber, Nodes, LoadForces, LoadMoments, Displacements, Rotations, Forces, Moments
get_deformed_mesh_sofistika = GetDeformedMeshSofistikA(Path=pathcdb, LoadCase=load_case, ScalingFactor=Slider(2, range=0..100), SofistikPath=pathcdb_dll_2, Run=toggle_4)  # -> InitialMesh, DeformedMesh
vlen = VectorLength(Vector=get_nodal_results_sofistik.Displacements)
demesh_2 = DeconstructMesh(Mesh=get_deformed_mesh_sofistika.DeformedMesh)  # -> Vertices, Faces, Colours, Normals
vec = Vector(get_nodal_results_sofistik.Displacements)
num_41 = Number(get_nodal_results_sofistik.Displacements)
vlen_2 = VectorLength(Vector=vec)
bnd_22 = Bounds(Numbers=num_41)
num_42 = Number(vlen_2)
bnd_23 = Bounds(Numbers=num_42)
dedomain_26 = DeconstructDomain(Domain=bnd_22)  # -> Start, End
dedomain_27 = DeconstructDomain(Domain=bnd_23)  # -> Start, End
gradient_4 = Gradient(
    LowerLimit=dedomain_26.End,
    UpperLimit=dedomain_26.Start,
    Parameter="150",
    stops=[0: RGB(234, 38, 0), 0.25: RGB(234, 126, 0), 0.5: RGB(254, 244, 84), 0.75: RGB(173, 203, 249), 1: RGB(75, 107, 169)])
expression = Expression(x=dedomain_27.End, Expression="Round(x*1000,2)")
sort_15 = SortList(Keys=vlen, ValuesA=get_nodal_results_sofistik.Nodes)  # -> reverse(Keys), reverse(ValuesA)
totalmaxdisplacement_mm = Panel(expression)
smaller_3 = SmallerThan(FirstNumber=panel_25, SecondNumber=totalmaxdisplacement_mm)  # -> SmallerThan, OrEqualTo
panel_56 = Panel(smaller_3.SmallerThan)
sort_16 = SortList(Keys=vlen, ValuesA=demesh_2.Vertices)  # -> reverse(Keys), reverse(ValuesA)
item_50 = ListItem(List=sort_15.ValuesA, Index=0, Wrap=True)
item_51 = ListItem(List=sort_16.ValuesA, Index=0, Wrap=True)
concat_3 = Concatenate(FragmentA="   ", FragmentB=totalmaxdisplacement_mm, FragmentC=" mm")
tag_2 = TextTag(Location=item_50, Text=concat_3, Colour=ColourSwatch(SwatchColor=RGB(0, 0, 0)))
pt_66 = Point(item_50)

# ----
panel_57 = Panel(check_cross_sections.eta)

sort_17 = SortList(Keys=flatten(check_cross_sections.eta))  # -> reverse(Keys), ValuesA
expression_2 = Expression(x=sort_17.Keys, Expression="Round(x,2)")
maxutilisation = Panel(expression_2)

eta_vxy_vz = Panel(bnd_20)
eta_v = Panel(bnd_18)
eta = Panel(bnd_19)
eta_y = Panel(bnd_15)
eta_vxy = Panel(bnd_16)
eta_vz = Panel(bnd_17)
eta_x = Panel(bnd_14)

# ---- group: Deformed
dedomain_28 = DeconstructDomain(Domain=bnd_19)  # -> Start, End
gradient_5 = Gradient(
    LowerLimit=dedomain_28.End,
    UpperLimit=dedomain_28.Start,
    Parameter=check_cross_sections.eta,
    stops=[0: RGB(234, 38, 0), 0.25: RGB(234, 126, 0), 0.5: RGB(254, 244, 84), 0.75: RGB(173, 203, 249), 1: RGB(75, 107, 169)])
gradient_6 = Gradient(
    LowerLimit=dedomain_28.End,
    UpperLimit=dedomain_28.Start,
    Parameter=check_cross_sections.eta,
    stops=[0: RGB(217, 76, 48), 0.25: RGB(199, 133, 58), 0.5: RGB(214, 205, 71), 0.75: RGB(99, 142, 207), 1: RGB(12, 60, 156)])
number_slider_46 = Slider(0.001, range=0..0.1)
wbfacepolys = WeaverbirdsFacePolylines(Mesh=get_deformed_mesh_sofistik.InitialMesh)  # -> flatten(Polygons)

# ----
facen_2 = FaceNormals(Mesh=get_deformed_mesh_sofistik.InitialMesh)  # -> Centers, Normals
number_slider_47 = Slider(28, range=0..2100)
neg_8 = Negative(Value=number_slider_47)
dom_32 = ConstructDomain(DomainStart=neg_8, DomainEnd=number_slider_47)
dom_33 = ConstructDomain(DomainStart="0", DomainEnd=number_slider_47)
sort_18 = SortList(Keys=check_cross_sections.eta, ValuesA=facen_2.Centers, ValuesB=gradient_2)  # -> reverse(flatten(Keys)), reverse(flatten(ValuesA)), reverse(flatten(ValuesB))
subset_3 = SubList(List=sort_18.Keys, Domain=dom_33, Wrap=True)  # -> List, Index
subset_4 = SubList(List=sort_18.ValuesA, Domain=dom_33, Wrap=True)  # -> List, Index
subset_5 = SubList(List=sort_18.ValuesB, Domain=dom_33, Wrap=True)  # -> List, Index
expression_3 = Expression(x=subset_3.List, Expression="Round(x,2)")
swatch_2 = ColourSwatch(SwatchColor=RGB(0, 191, 255))
maxutilisation_2 = Panel(expression_3)

item_52 = ListItem(List=maxutilisation, Index=0, Wrap=True)
maxutilisation_3 = Panel(item_52)

wbjoin = WeaverbirdsJoinMeshesAndWeld(Mesh=get_deformed_mesh_sofistika.DeformedMesh, Weld=False)
wbjoin_2 = WeaverbirdsJoinMeshesAndWeld(Mesh=get_deformed_mesh_sofistika.InitialMesh, Weld=False)
number_slider_48 = Slider(0.02, range=0..1)
facen_3 = FaceNormals(Mesh=wbjoin_2)  # -> Centers, Normals
facen_4 = FaceNormals(Mesh=wbjoin)  # -> Centers, Normals
wbfacepolys_2 = WeaverbirdsFacePolylines(Mesh=wbjoin)  # -> flatten(Polygons)
wbfacepolys_3 = WeaverbirdsFacePolylines(Mesh=wbjoin_2)  # -> flatten(Polygons)
swatch_3 = ColourSwatch(SwatchColor=RGB(255, 0, 0))
swatch_4 = ColourSwatch(SwatchColor=RGB(0, 0, 0))
dist = Distance(PointA=facen_3.Centers, PointB=facen_4.Centers)
sph = Sphere(Base=pt_66, Radius=number_slider_48)
sph_2 = Sphere(Base=item_51, Radius=number_slider_48)
bnd_24 = Bounds(Numbers=dist)
dedomain_29 = DeconstructDomain(Domain=bnd_24)  # -> Start, End
gradient_7 = Gradient(
    LowerLimit=dedomain_29.End,
    UpperLimit=dedomain_29.Start,
    Parameter=dist,
    stops=[0: RGBA(235, 39, 0, 80), 0.25: RGBA(235, 125, 0, 80), 0.5: RGBA(255, 244, 84, 80), 0.83: RGBA(172, 203, 250, 80), 1: RGBA(74, 77, 168, 80)])
gradient_8 = Gradient(
    LowerLimit=dedomain_29.End,
    UpperLimit=dedomain_29.Start,
    Parameter=dist,
    stops=[0: RGBA(186, 31, 0, 45), 0.25: RGBA(199, 106, 0, 45), 0.5: RGBA(232, 217, 0, 45), 0.83: RGBA(0, 97, 242, 45), 1: RGBA(0, 8, 240, 45)])
gradient_9 = Gradient(
    LowerLimit=Slider(0.1, range=0..1),
    UpperLimit=dedomain_29.Start,
    Parameter=dist,
    stops=[0: RGB(234, 38, 0), 0.25: RGB(234, 126, 0), 0.5: RGB(254, 244, 84), 0.83: RGB(173, 203, 249), 1: RGB(74, 77, 168)])
number_slider_49 = Slider(0.01, range=0..10)
number_slider_50 = Slider(14, range=0..20)

# ---- group: CLT Utilization
previewlw = CustomPreviewLineweights(Geometry=wbfacepolys, Shader=gradient_6, Thickness=number_slider_46, Absolute=True)
screentext = ScreenOrientedText(
    Text=maxutilisation_2,
    Justification=7,
    Location=subset_4.List,
    SizeFactor=Slider(15, range=1..50),
    Color=ColourSwatch(SwatchColor=RGB(0, 0, 0)),
    Depth=Slider(1, range=0..50),
    Absolute=False)
colourmesh_2 = ColourMesh(Mesh=get_deformed_mesh_sofistik.InitialMesh, Colors=gradient_2)

# ---- group: Deformation / Deformed
previewlw_2 = CustomPreviewLineweights(Geometry=wbfacepolys_2, Shader=gradient_8, Thickness=number_slider_49, Absolute=True)
previewlw_3 = CustomPreviewLineweights(Geometry=sph_2, Shader=swatch_3, Thickness=number_slider_49, Absolute=True)
# SOFIMESH
screentext_2 = ScreenOrientedText(
    Text=concat_3,
    Font=item_7,
    Justification=7,
    Location=item_51,
    SizeFactor=number_slider_50,
    Color=swatch_4,
    Depth=0,
    Absolute=False)
colourmesh_3 = ColourMesh(Mesh=get_deformed_mesh_sofistika.DeformedMesh, Colors=gradient_9)

# ---- group: Deformation / Undeformed
previewlw_4 = CustomPreviewLineweights(Geometry=wbfacepolys_3, Shader=gradient_8, Thickness=number_slider_49, Absolute=True)
colourmesh_4 = ColourMesh(Mesh=get_deformed_mesh_sofistika.InitialMesh, Colors=gradient_4)
screentext_3 = ScreenOrientedText(
    Text=concat_3,
    Font=item_7,
    Justification=7,
    Location=pt_66,
    SizeFactor=number_slider_50,
    Color=swatch_4,
    Depth=0,
    Absolute=False)
previewlw_5 = CustomPreviewLineweights(Geometry=sph, Shader=swatch_3, Thickness=number_slider_49, Absolute=True)

# ----
number_slider_51 = Slider(24, range=0..100)
cull_21 = CullPattern(List=trim_8, CullPattern=not_2)
bang_4 = ExplodeTree(Data=cull_21)  # -> Branch0, Branch1
offsrf = OffsetSurface(Surface=bang_4.Branch1, Distance=expr("-x", number_slider_51), BothSides=0, CreateSolid=True)
offsrf_2 = OffsetSurface(Surface=bang_4.Branch0, Distance=number_slider_51, BothSides=0, CreateSolid=True)

offsrf_3 = OffsetSurface(Surface=bang_4.Branch1, Distance=expr("-x", number_slider_51), BothSides=False, CreateSolid=True)
offsrf_4 = OffsetSurface(Surface=bang_4.Branch0, Distance=number_slider_51, BothSides=False, CreateSolid=True)

entwine_8 = Entwine(Branch00=offsrf_4, Branch01=offsrf_3, FlattenInputs=True)  # -> graft(Result)

area_12 = Area(Geometry=cull_21)  # -> Area, Centroid
move_11 = Move(Geometry=area_12.Centroid, Motion=Z)  # -> Geometry, Transform
tag_3 = TextTag3D(Location=move_11.Geometry, Text=round_2.Nearest, Size=Slider(29, range=0..100), Colour=RGB(0, 0, 0), Justification=5)

# ---- group: PANEL
preview_2 = CustomPreview(Geometry=entwine_8, Material=graft(gradient))
