# Grasshopper definition TypologyExplorer.gh (Grasshopper 1.0.7)
# plug-ins: sof_gh_sofistik-2022, Karamba3D, LunchBox, Opossum2_0_Proto_A, HygroDesign, Heteroptera, Pufferfish, ABxM.Grasshopper

crosec = BilayerCrossSection(
    Radii=<missing>,
    Directions=<missing>,
    BoardWidth=<missing>,
    SnapTolerance=<missing>,
    SupportParameters=<missing>,
    BasePlane=<missing>)
io = IO(
    SofistikDocumentProperties_VersionMajor="2022",
    SofistikDocumentProperties_VersionMinor="4",
    SofistikDocumentProperties_VersionName="2022")
number_slider = Slider(1, range=0..10)
genes = GenePool(
    Decimals=2,
    Maximum=1,
    Minimum=-1,
    Value=[0.5550358237, -0.8119721617, 0.6383034054, 0.9835135909, -0.6513712693, 0.6727321817, -0.3406666496, -0.6062679736, 0.5638630351, 0.7659066765, -0.5128728345, -0.1654117234, 0.6089472648, 0.9818360628, 0.8400640543])
genes_2 = GenePool(
    Decimals=2,
    Maximum=1,
    Minimum=-1,
    Value=[0.992103, 0.999166, 0.995923, 0.167512, 0.994825, 0.986005, 0.98451, -0.989025, 0.996277, -0.99236, -0.664128, 1, -0.987683, -0.981429, -0.999751])  # disabled
number_slider_2 = Slider(1, range=0..10)  # disabled
neg = Negative(Value=number_slider)
number_slider_3 = Slider(15, range=0..15)  # disabled
neg_2 = Negative(Value=number_slider_2)  # disabled
panel = Panel("0")  # disabled
dom = ConstructDomain(DomainStart=neg, DomainEnd=number_slider)
dom_2 = ConstructDomain(DomainStart=neg_2, DomainEnd=number_slider_2)  # disabled
merge = Merge(Data1="0", Data2=genes)
gnc = PoolController(GenePool=genes, Count=Slider(15, range=0..15), Range=dom, Randomness=1)
merge_2 = Merge(Data1=panel, Data2=genes_2, Data3=panel)  # disabled
gnc_2 = PoolController(GenePool=genes_2, Count=number_slider_3, Range=dom_2, Randomness=1)  # disabled
number_slider_4 = Slider(0.5, range=0..1)  # disabled
rev = ReverseList(List=merge)
lng = ListLength(List=rev)  # -> expr("x-1", Length)
lng_2 = ListLength(List=merge)  # -> expr("(x*2) - 1", Length)
lng_3 = ListLength(List=merge_2)  # disabled
dom_3 = ConstructDomain(DomainStart=1, DomainEnd=lng)
series = Series(Start=0, Step=Slider(0.5, range=0..1), Count=lng_2)
subset = SubList(List=rev, Domain=dom_3, Wrap=True)  # -> List, Index
number_slider_5 = Slider(20, range=0..100)  # disabled
number_slider_6 = Slider(4, range=0..10)  # disabled
series_2 = Series(Start=0, Step=number_slider_4, Count=lng_3)  # disabled
merge_3 = Merge(Data1=flatten(merge), Data2=flatten(subset.List))
pt = ConstructPoint(XCoordinate=series, YCoordinate=0, ZCoordinate=merge_3)
pt_2 = ConstructPoint(XCoordinate=series_2, YCoordinate=0, ZCoordinate=merge_2)  # disabled
board_width = Slider(0.15, range=0.1..0.5)
nurbs = NurbsCurve(Vertices=pt, Degree=3, Periodic=False)  # -> reparameterize(Curve), Length, Domain
board_width_2 = Slider(0.15, range=0.1..0.5)  # disabled
nurbs_2 = NurbsCurve(Vertices=pt_2, Degree=3, Periodic=False)  # -> reparameterize(Curve), Length, Domain; disabled

# ---- group: active layer
e0 = Slider(13449, range=0..100000)
e90 = Slider(764, range=0..100000)
ft0 = Slider(80, range=0..100)
gamma = Slider(6.91, range=0..10)
num = Number(Slider(20, range=0..100))

# ---- group: passive layer
ft0_2 = Slider(0, range=0..100)
num_2 = Number(Slider(4, range=0..10))
e0_2 = Slider(464, range=0..100000)
e90_2 = Slider(10800, range=0..100000)
gamma_2 = Slider(4.58, range=0..10)

# ----
number_slider_7 = Slider(0.5, range=0..2)

# ---- group: passive layer
num_3 = Number(number_slider_6)  # disabled
e90_3 = Slider(10800, range=0..100000)  # disabled
ft0_3 = Slider(0, range=0..100)  # disabled
e0_3 = Slider(464, range=0..100000)  # disabled
gamma_3 = Slider(4.58, range=0..10)  # disabled

# ----
crv_cp = CurveClosestPoint(Point=pt, Curve=nurbs.Curve)  # -> Point, Parameter, Distance
number_slider_8 = Slider(1, range=0..2)  # disabled
geo = Geometry(nurbs.Curve)
c_script = CSharpScript(
    minimumRadius=number_slider_7,
    Reference=["C:\Users\Alex Reiner\AppData\Roaming\Grasshopper\Libraries\ABxM.Core.dll", "C:\Users\Alex Reiner\AppData\Roaming\Grasshopper\Libraries\HygroDesign.Core.dll"])  # -> out, oBehaviour; inputs minimumRadius: Double
# ---------- c_script: C# usings ----------
using ABxM.Core;
using ABxM.Core.Agent;
using ABxM.Core.Behavior;

using HygroDesign.Core;
# ---------- c_script: C# ----------
    minRad = minimumRadius;
    oBehaviour = radBehaviour;
# ---------- c_script: C# additional code ----------
  static double minRad;
  RadiusBehaviour radBehaviour = new RadiusBehaviour();

  public class RadiusBehaviour : BehaviorBase
  {
    public RadiusBehaviour()
    {
    }
    
    public override void Execute(AgentBase agent)
    {
      CrossSectionAgent CSAgent = agent as CrossSectionAgent;
      double minimumStep = 0.01;
      //check clusters
      CrossSectionAgentSystem agentSystem = agent.AgentSystem as CrossSectionAgentSystem;
      CrossSection crossSection = agentSystem.CrossSection;

      bool smaller = false;
      for(int i = 0; i < crossSection.BoardCurves.Count; i++)
      {
        //check if this agent has control over this board curve
        if(crossSection.BoardCurves[i].ControlPointID != agent.Id) continue;
        if(crossSection.BoardCurves[i].AverageRadius < minRad){ smaller = true; break;}
      }
      if(smaller == false) return;

      //update control points
      Line midLine = new Line(crossSection.NurbsCurve.Points[agent.Id - 1].Location, crossSection.NurbsCurve.Points[agent.Id + 1].Location);
      Point3d targetPoint = midLine.ClosestPoint(crossSection.NurbsCurve.Points[agent.Id].Location, true);
      Vector3d moveVector = new Vector3d(targetPoint - crossSection.NurbsCurve.Points[agent.Id].Location);
      moveVector *= 0.1;

      if (moveVector.Length < minimumStep) { moveVector.Unitize(); moveVector *= minimumStep; }

      //nurbsPoints.Add(new Tuple<int, Point3d>(agent.Id, new Point3d(crossSection.NurbsCurve.Points[agent.Id].Location.X, 0.0, (NurbsCurve.Points[agent.Id].Location + moveVector).Z)));
      CSAgent.Moves.Add(moveVector);
      CSAgent.Weights.Add(1.0);
      return;
    }
  }

  /*
  MinimumRadius = minRadius;
            double minimumStep = 0.01;
            int safety = 100;

            while(safety >= 0)
            {
                safety--;

                //loop to check clusters
                bool[] memberSmaller = new bool[NurbsCurve.Points.Count];
                int falseCount = 0;
                for (int i = 0; i < BoardCurves.Count; i++)
                {
                    if (BoardCurves[i].AverageRadius < MinimumRadius) memberSmaller[BoardCurves[i].ControlPointID] = true;
                    else falseCount++;
                }
                if (falseCount == BoardCurves.Count) return;

                List<Tuple<int, Point3d>> nurbsPoints = new List<Tuple<int, Point3d>>();
                //loop to update control points
                for (int i = 0; i < NurbsCurve.Points.Count; i++)
                {
                    if (memberSmaller[i] == false) continue;

                    Line midLine = new Line(NurbsCurve.Points[i - 1].Location, NurbsCurve.Points[i + 1].Location);
                    Point3d targetPoint = midLine.ClosestPoint(NurbsCurve.Points[i].Location, true);
                    Vector3d moveVector = new Vector3d(targetPoint - NurbsCurve.Points[i].Location);
                    moveVector *= 0.1;

                    if (moveVector.Length < minimumStep) { moveVector.Unitize(); moveVector *= minimumStep; }

                    nurbsPoints.Add(new Tuple<int, Point3d>(i, new Point3d(NurbsCurve.Points[i].Location.X, 0.0, (NurbsCurve.Points[i].Location + moveVector).Z)));
                }

                foreach (Tuple<int, Point3d> pair in nurbsPoints)
                    NurbsCurve.Points.SetPoint(pair.Item1, pair.Item2);

                //update nurbs curve
                BoardCurves = NurbsToBoardCurves();
            }
 */
# ---------- end c_script ----------
geo_2 = Geometry(nurbs_2.Curve)  # disabled
crosec_2 = CrossSectionFromNurbsCurve(NurbsCurve=geo, BoardWidth=board_width)
crosec_3 = CrossSectionFromNurbsCurve(NurbsCurve=geo_2, BoardWidth=board_width_2)  # disabled

# ---- group: active layer / total thickness
addition = Addition(A=num, B=num_2)

# ----
minrad = SatisfyMinimumRadius(CrossSection=crosec_2, MinimumRadius=number_slider_7)  # disabled
agent = CrossSectionAgent(StartingPoint=pt, Behaviours=c_script.oBehaviour)
data = Data(crosec_2)
minrad_2 = SatisfyMinimumRadius(CrossSection=crosec_3, MinimumRadius=number_slider_8)  # disabled
data_2 = Data(crosec_3)  # disabled
python = GhPythonScript(x=data)  # -> out, a, b, c, d, e
# ---------- python: Python ----------
curves = []
ids = []
radii = []
controlPoints = []

for board in x.BoardCurves:
    curves.append(board.Curve)
    ids.append(board.ControlPointID)
    radii.append(board.AverageRadius)

for point in x.NurbsCurve.Points:
    controlPoints.append(point.Location)

e = x.NurbsCurve

a = curves
b = ids
c = radii
d = controlPoints
# ---------- end python ----------

# ---- group: active layer / distance from bottom
expression = Expression(x=addition, y=num, Expression="x - y/2")

# ----
agentsystem = CrossSectionAgentSystem(CrossSection=crosec_2, Agents=agent)

# ---- group: passive layer / distance from bottom
expression_2 = Expression(x=expression, y=addition, Expression="x - y/2")

# ---- group: active layer / CG from bottom
division = Division(A=addition, B=2)

# ----
python_2 = GhPythonScript(x=data_2)  # -> out, a, b, c, d, e; disabled; same code as python
trigger = Trigger(Interval=20, TimerInterval=20, Target=solver)  # disabled
num_4 = Number(python.b)
num_5 = Number(python.c)
crv = Curve(python.a)
pt_3 = Point(python.d)
data_3 = Data(minrad_2)  # disabled
num_6 = Number(python_2.b)  # disabled
num_7 = Number(python_2.c)  # disabled
pt_4 = Point(python_2.d)  # disabled
crv_2 = Curve(python_2.a)  # disabled
solver = StepByStepSolver(Reset=Button(), Execute=Toggle(False), AgentSystems=agentsystem)  # -> DisplayGeometries, AllAgentSystems, IterationCount
data_4 = Data(solver.AllAgentSystems)
python_3 = GhPythonScript(x=data_4)  # -> out, a, b, c, d, e
# ---------- python_3: Python ----------
curves = []
ids = []
radii = []
controlPoints = []

for board in x.CrossSection.BoardCurves:
    curves.append(board.Curve)
    ids.append(board.ControlPointID)
    radii.append(board.AverageRadius)

for agent in x.Agents:
    controlPoints.append(agent.Position)

e = x.CrossSection.NurbsCurve

a = curves
b = ids
c = radii
d = controlPoints
# ---------- end python_3 ----------
python_4 = GhPythonScript(x=data_3)  # -> out, a, b, c, d, e; disabled; same code as python

# ---- group: passive layer / dist from CG
subtraction = Subtraction(A=expression_2, B=division)
abs = Absolute(Value=subtraction)

# ---- group: active layer / dist from CG
subtraction_2 = Subtraction(A=expression, B=division)
abs_2 = Absolute(Value=subtraction_2)

# ----
smaller = SmallerThan(FirstNumber=num_5, SecondNumber=number_slider_7)  # -> SmallerThan, OrEqualTo
smaller_2 = SmallerThan(FirstNumber=num_7, SecondNumber=number_slider_8)  # -> SmallerThan, OrEqualTo; disabled
pt_5 = Point(python_3.d)
num_8 = Number(python_3.b)
crv_3 = Curve(python_3.a)
num_9 = Number(python_3.c)
cull = CullPattern(List=num_5, CullPattern=smaller.SmallerThan)
num_10 = Number(python_4.b)  # disabled
pt_6 = Point(python_4.d)  # disabled
crv_4 = Curve(python_4.a)  # disabled
num_11 = Number(python_4.c)  # disabled
number_slider_9 = Slider(50, range=0..200)
cull_2 = CullPattern(List=num_7, CullPattern=smaller_2.SmallerThan)  # disabled

# ---- group: active layer / l
expression_3 = Expression(x=num, Expression="1000*x^3/12")

# ---- group: passive layer / l
expression_4 = Expression(x=num_2, Expression="1000*x^3/12")

# ---- group: passive layer / Ax2
expression_5 = Expression(x=num_2, y=abs, Expression="1000*x*y^2")

# ---- group: active layer / Ax2
expression_6 = Expression(x=num, y=abs_2, Expression="1000*x*y^2")

# ----
number_slider_10 = Slider(50, range=0..200)  # disabled
crv_5 = Curve(python_3.e)
lng_4 = ListLength(List=cull)

# ---- group: passive layer / l
expression_7 = Expression(x=num_3, Expression="1000*x^3/12")  # disabled

# ----
lng_5 = ListLength(List=cull_2)  # disabled
crv_6 = Curve(python_4.e)  # disabled
panel_2 = Panel(lng_4)
ln = Line(StartPoint=pt_3, EndPoint=pt_5)
panel_3 = Panel(lng_5)  # disabled
ln_2 = Line(StartPoint=pt_4, EndPoint=pt_6)  # disabled
reb = RebuildCurve(Curve=crv_5, Count=number_slider_9, Tangents=False)

# ---- group: active layer / total l
addition_2 = Addition(A=expression_3, B=expression_6)

# ---- group: passive layer / total l
addition_3 = Addition(A=expression_4, B=expression_5)

# ----
reb_2 = RebuildCurve(Curve=crv_6, Count=number_slider_10, Tangents=False)  # disabled

number_slider_11 = Slider(10, range=0..10000)  # disabled
crv_7 = Curve(reb)  # disabled
Y = UnitY(Factor=number_slider_11)  # disabled
extr = Extrude(Base=crv_7, Direction=Y)  # disabled

number_slider_12 = Slider(10, range=0..10000)  # disabled
crv_8 = Curve(reb_2)  # disabled
Y_2 = UnitY(Factor=number_slider_12)  # disabled
extr_2 = Extrude(Base=crv_8, Direction=Y_2)  # disabled

# ---- group: active layer / El0
multiplication = Multiplication(A=e0, B=addition_2)

# ---- group: active layer / T x ft0
multiplication_2 = Multiplication(A=num, B=ft0)

# ---- group: active layer / T x Gam
multiplication_3 = Multiplication(A=gamma, B=num)

# ---- group: passive layer / El0
multiplication_4 = Multiplication(A=e0_2, B=addition_3)

# ---- group: passive layer / El90
multiplication_5 = Multiplication(A=e90_2, B=addition_3)

# ---- group: passive layer / T x ft0
multiplication_6 = Multiplication(A=num_2, B=ft0_2)

# ---- group: active layer / El90
multiplication_7 = Multiplication(A=e90, B=addition_2)

# ----
number_slider_13 = Slider(2.5, range=0..10)  # disabled

# ---- group: passive layer / T x ft0
multiplication_8 = Multiplication(A=num_3, B=ft0_3)  # disabled

# ----
tria = TriangularPanelsA(Surface=extr, UDivisions=number_slider_9, VDivisions=number_slider_9)  # -> simplify(Panels); disabled
mesh = Mesh(flatten(tria))  # disabled
mjoin = MeshJoin(Meshes=mesh)  # disabled
unim = UnifyMesh(Mesh=mjoin)  # -> Result, Count; disabled
weld = WeldMesh(Mesh=unim.Result, Angle=3.141592654)  # disabled
mesh_2 = Mesh(weld)  # disabled

medges = MeshEdges(Mesh=mesh_2)  # -> NakedEdges, InteriorEdges, NonManifoldEdges; disabled
divlength = DivideLength(Curve=reparameterize(reb_2), Length=number_slider_13)  # -> Points, Tangents, Parameters; disabled

tria_2 = TriangularPanelsA(Surface=extr_2, UDivisions=number_slider_10, VDivisions=number_slider_10)  # -> simplify(Panels); disabled
mesh_3 = Mesh(flatten(tria_2))  # disabled
mjoin_2 = MeshJoin(Meshes=mesh_3)  # disabled
unim_2 = UnifyMesh(Mesh=mjoin_2)  # -> Result, Count; disabled
weld_2 = WeldMesh(Mesh=unim_2.Result, Angle=3.141592654)  # disabled
mesh_4 = Mesh(weld_2)  # disabled

# ---- group: effective material properties / El0 eff (Nmm2)
addition_4 = Addition(A=multiplication, B=multiplication_4)

# ---- group: effective material properties / El90 eff (Nmm2)
addition_5 = Addition(A=multiplication_7, B=multiplication_5)

# ---- group: effective material properties / Sum T x Ft0
addition_6 = Addition(A=multiplication_2, B=multiplication_6)

# ---- group: effective material properties / total thickness
addition_7 = Addition(A=num, B=num_2)

# ---- group: effective material properties / Sum Tx Gam
addition_8 = Addition(A=multiplication_3)

# ----
medges_2 = MeshEdges(Mesh=mesh_4)  # -> NakedEdges, InteriorEdges, NonManifoldEdges; disabled
panel_4 = Panel("1")  # disabled
crv_9 = Curve(medges.NakedEdges)  # disabled
merge_4 = Merge(Data1=flatten(divlength.Parameters), Data2=flatten(panel_4))  # disabled
crv_10 = Curve(medges_2.NakedEdges)  # disabled
explode = Explode(Curve=crv_9, Recursive=True)  # -> Segments, flatten(Vertices); disabled

# ---- group: effective material properties / lx / ly
expression_8 = Expression(x=addition_7, Expression="1000*x^3/12")

# ----
explode_2 = Explode(Curve=crv_10, Recursive=True)  # -> Segments, flatten(Vertices); disabled
lng_6 = ListLength(List=merge_4)  # -> expr("x-2", Length); disabled
lng_7 = ListLength(List=merge_4)  # -> expr("x-1", Length); disabled
cullpt = CullDuplicates(Points=explode.Vertices, Tolerance=0.01, CullMode=3)  # -> graft(Points), Indices, Valence; disabled
panel_5 = Panel("0")  # disabled
cullpt_2 = CullDuplicates(Points=explode_2.Vertices, Tolerance=0.01, CullMode=3)  # -> graft(Points), Indices, Valence; disabled
panel_6 = Panel("0")  # disabled
dom_4 = ConstructDomain(DomainStart=0, DomainEnd=lng_6)  # disabled
merge_5 = Merge(Data1=panel_5, Data2=number_slider_11)  # disabled
dom_5 = ConstructDomain(DomainStart=1, DomainEnd=lng_7)  # disabled
pdecon = Deconstruct(Point=cullpt.Points)  # -> XComponent, YComponent, ZComponent; disabled
merge_6 = Merge(Data1=panel_6, Data2=number_slider_12)  # disabled
pdecon_2 = Deconstruct(Point=cullpt_2.Points)  # -> XComponent, YComponent, ZComponent; disabled
subset_2 = SubList(List=merge_4, Domain=dom_4, Wrap=True)  # -> List, Index; disabled

# ---- group: effective material properties / E0eff
division_2 = Division(A=addition_4, B=expression_8)

# ---- group: effective material properties / E90eff
division_3 = Division(A=addition_5, B=expression_8)

# ---- group: effective material properties / Gamma eff
division_4 = Division(A=addition_8, B=addition_7)

# ---- group: effective material properties / ft eff
division_5 = Division(A=addition_6, B=addition_7)

# ---- group: effective material properties
matprops = MaterialPropertiesKaramba3D(
    FamilyOfMaterial="CLT",
    Name="CLT",
    ElementIdentifier="CLT",
    YoungsModulusKNCm2Dir1=expr("x*0.1", division_2),
    YoungsModulusKNCm2Dir2=expr("x*0.1", division_3),
    InPlaneShearModulus_kN_cm2="42",
    InPlaneLateralContractionCoefficient=Slider(0.012, range=0..0.1, expression="0.012"),
    TransverseShearModulusKNCm2Dir1="5",
    TransverseShearModulusKNCm2Dir2="5",
    SpecificWeight_kN_m3=division_4,
    CoefficientOfThermalExpansion1CDir1=1.2e-05,
    CoefficientOfThermalExpansion1CDir2=1.2e-05,
    TensileStrengthKNCm2Dir1=division_5,
    TensileStrengthKNCm2Dir2=division_5,
    CompressiveStrengthKNCm2Dir1=-23.5,
    CompressiveStrengthKNCm2Dir2=-23.5,
    ShearStrengthKNCm2Dir12=13.6,
    TsaiWuIntCoeff=0,
    StrengthHypothesis="MISES",
    mode="Orthotropic")  # -> flatten(Material)
num_12 = Number(flatten(addition_7))

# ----
subset_3 = SubList(List=merge_4, Domain=dom_5, Wrap=True)  # -> List, Index; disabled
equals = Equality(FirstNumber=pdecon.YComponent, SecondNumber=merge_5)  # -> Equality, Inequality; disabled
equals_2 = Equality(FirstNumber=pdecon_2.YComponent, SecondNumber=merge_6)  # -> Equality, Inequality; disabled
dom_6 = ConstructDomain(DomainStart=subset_2.List, DomainEnd=subset_3.List)  # disabled
cset = CreateSet(List=equals.Equality)  # -> simplify(Set), Map; disabled
subcrv = SubCurve(BaseCurve=reparameterize(reb_2), Domain=dom_6)  # disabled
cset_2 = CreateSet(List=equals_2.Equality)  # -> simplify(Set), Map; disabled
lng_8 = ListLength(List=cset.Set)  # disabled
lng_9 = ListLength(List=cset_2.Set)  # disabled
larger = LargerThan(FirstNumber=lng_8, SecondNumber=1)  # -> LargerThan, OrEqualTo; disabled
len = Length(Curve=subcrv)  # disabled
lng_10 = ListLength(List=subcrv)  # disabled
number_slider_14 = Slider(3, range=0..5)  # disabled
larger_2 = LargerThan(FirstNumber=lng_9, SecondNumber=1)  # -> LargerThan, OrEqualTo; disabled
pt_7 = ConstructPoint(XCoordinate=0, YCoordinate=0, ZCoordinate=0)  # disabled
pt_8 = ConstructPoint(XCoordinate=len, YCoordinate=0, ZCoordinate=0)  # disabled
cull_3 = CullPattern(List=cullpt.Points, CullPattern=larger.LargerThan)  # -> flatten(List); disabled
cull_4 = CullPattern(List=cullpt_2.Points, CullPattern=larger_2.LargerThan)  # -> flatten(List); disabled
ln_3 = Line(StartPoint=pt_7, EndPoint=pt_8)  # disabled
series_3 = Series(Start=0, Step=number_slider_14, Count=lng_10)  # disabled
avr = Average(Input=cull_3)  # disabled
avr_2 = Average(Input=cull_4)  # disabled
X = UnitX(Factor=series_3)  # disabled
move = Move(Geometry=ln_3, Motion=X)  # -> Geometry, Transform; disabled
pdecon_3 = Deconstruct(Point=cull_3)  # -> XComponent, YComponent, ZComponent; disabled
pdecon_4 = Deconstruct(Point=avr)  # -> XComponent, YComponent, ZComponent; disabled
end = EndPoints(Curve=subcrv)  # -> Start, End; disabled
end_2 = EndPoints(Curve=move.Geometry)  # -> Start, End; disabled
pdecon_5 = Deconstruct(Point=cull_4)  # -> XComponent, YComponent, ZComponent; disabled
pdecon_6 = Deconstruct(Point=avr_2)  # -> XComponent, YComponent, ZComponent; disabled
larger_3 = LargerThan(FirstNumber=pdecon_3.YComponent, SecondNumber=pdecon_4.YComponent)  # -> LargerThan, OrEqualTo; disabled
pt_9 = Point(end.Start)  # disabled
pt_10 = Point(end_2.Start)  # disabled
larger_4 = LargerThan(FirstNumber=pdecon_5.YComponent, SecondNumber=pdecon_6.YComponent)  # -> LargerThan, OrEqualTo; disabled
dispatch = Dispatch(List=cull_3, DispatchPattern=larger_3.LargerThan)  # -> ListA, ListB; disabled
vec2pt = Vector2Pt(PointA=pt_9, PointB=pt_10, Unitize=False)  # -> Vector, Length; disabled
dispatch_2 = Dispatch(List=cull_4, DispatchPattern=larger_4.LargerThan)  # -> ListA, ListB; disabled
move_2 = Move(Geometry=subcrv, Motion=vec2pt.Vector)  # -> Geometry, Transform; disabled
end_3 = EndPoints(Curve=move_2.Geometry)  # -> Start, End; disabled
supp = SupportKaramba3D(PosInd=dispatch.ListB, menu=[buttons(on, off, on, off, off, off)])  # disabled
supp_2 = SupportKaramba3D(PosInd=dispatch.ListA, menu=[buttons(on, off, on, off, off, off)])  # disabled
cross_section = CrossSectionKaramba3D(FamilyNameOfCrossSection="DefaultCroSec", Height_cm=expr("x/10", num_12), mode="Shell - Const")  # disabled
loads = LoadsKaramba3D(Vector=Vector(0, 0, -1), LCase="0", mode="Gravity")  # disabled
supp_3 = SupportKaramba3D(PosInd=dispatch_2.ListB, menu=[buttons(on, off, on, off, off, off)])  # disabled
supp_4 = SupportKaramba3D(PosInd=dispatch_2.ListA, menu=[buttons(on, off, on, off, off, off)])  # disabled
meshtoshell = MeshToShellKaramba3D(Mesh=mesh_2, CrossSection=cross_section, LimitDistance_m=0.005)  # -> Element, Points, Info; disabled
vec2pt_2 = Vector2Pt(PointA=end_3.Start, PointB=end_3.End, Unitize=False)  # -> Vector, Length; disabled
X_2 = UnitX(Factor=1)  # disabled
loads_2 = LoadsKaramba3D(Vector=Vector(0, 0, -1), LCase="0", mode="Gravity")  # disabled
xz = XZPlane(Origin=end_3.Start)  # disabled
angle = Angle(VectorA=vec2pt_2.Vector, VectorB=X_2, Plane=xz)  # -> Angle, Reflex; disabled
rotate = Rotate(Geometry=move_2.Geometry, Angle=angle.Angle, Plane=xz)  # -> Geometry, Transform; disabled

# ---- group: active layer
e0_4 = Slider(13449, range=0..100000)  # disabled
e90_4 = Slider(764, range=0..100000)  # disabled
ft0_4 = Slider(80, range=0..100)  # disabled
gamma_4 = Slider(6.91, range=0..10)  # disabled
num_13 = Number(number_slider_5)  # disabled

# ---- group: effective material properties / total thickness
addition_9 = Addition(A=num_13, B=num_3)  # disabled

# ---- group: effective material properties / lx / ly
expression_9 = Expression(x=addition_9, Expression="1000*x^3/12")  # disabled

# ----
extr_3 = Extrude(Base=rotate.Geometry, Direction=Y_2)  # disabled
assemble = AssembleModelKaramba3D(
    Elem=meshtoshell.Element,
    Support=[supp, supp_2],
    Load=loads,
    CrossSection=cross_section,
    Material=matprops,
    LimitDistance_m=0.005)  # -> Model, Info, Mass_kg, CenterOfGravity, LoadCaseNames; disabled
bbox = BoundingBox(Content=extr_3, Plane=PlaneXY(0, 0, 0))  # -> Box, Box_2; disabled
debox = DeconstructBox(Box=bbox.Box)  # -> Plane, X, Y, Z; disabled

# ---- group: active layer / total thickness
addition_10 = Addition(A=num_13, B=num_3)  # disabled

# ----
analyze = AnalyzeKaramba3D(Model=assemble.Model)  # -> CalculatedModel, MaximumDisplacement_cm, ResultingForceOfGravity_kN, ElasticEnergyChange_kNm; disabled
number_slider_15 = Slider(1000, range=0..1000)  # disabled
dedomain = DeconstructDomain(Domain=debox.Z)  # -> expr("-x", Start), End; disabled
crv_11 = Curve(reb_2)  # disabled
number_slider_16 = Slider(1000, range=0..1000)  # disabled

# ---- group: active layer / distance from bottom
expression_10 = Expression(x=addition_10, y=num_13, Expression="x - y/2")  # disabled

# ---- group: passive layer / distance from bottom
expression_11 = Expression(x=expression_10, y=addition_10, Expression="x - y/2")  # disabled

# ---- group: active layer / CG from bottom
division_6 = Division(A=addition_10, B=2)  # disabled

# ---- group: passive layer / dist from CG
subtraction_3 = Subtraction(A=expression_11, B=division_6)  # disabled
abs_3 = Absolute(Value=subtraction_3)  # disabled

# ---- group: passive layer / Ax2
expression_12 = Expression(x=num_3, y=abs_3, Expression="1000*x*y^2")  # disabled

# ---- group: passive layer / total l
addition_11 = Addition(A=expression_7, B=expression_12)  # disabled

# ---- group: passive layer / El0
multiplication_9 = Multiplication(A=e0_3, B=addition_11)  # disabled

# ---- group: passive layer / El90
multiplication_10 = Multiplication(A=e90_3, B=addition_11)  # disabled

# ----
Z = UnitZ(Factor=dedomain.Start)  # disabled
move_3 = Move(Geometry=extr_3, Motion=Z)  # -> Geometry, Transform; disabled
extr_4 = Extrude(Base=crv_11, Direction=Y_2)  # disabled
extr_5 = Extrude(Base=move.Geometry, Direction=Y_2)  # disabled
modelview = ModelViewKaramba3D(Model=analyze.CalculatedModel, ResultFactors=1, ResultCase=-1)  # -> Model, DeformedMesh, DeformedAxes, DeformedModel; disabled
multiplication_11 = Multiplication(A=analyze.MaximumDisplacement_cm, B=number_slider_15)  # disabled
number_slider_17 = Slider(0.024, range=0..0.1)  # disabled

# ---- group: active layer / dist from CG
subtraction_4 = Subtraction(A=expression_10, B=division_6)  # disabled
abs_4 = Absolute(Value=subtraction_4)  # disabled

# ----
panel_7 = Panel(analyze.MaximumDisplacement_cm)  # disabled
shellview = ShellViewKaramba3D(Model=modelview.Model, IndexOfLayer=0)  # -> Model, MeshesOfRenderedShells, LegendColors, LegendTags; disabled
optimization_solver_with_surrogate_model = MOpossum224(
    OpossumData_OptimizationType=0,
    OpossumData_ResultSerializationStatus=0,
    OpossumData_objective=num_14,
    OpossumData_variable=genes)  # "Optimization Solver with Surrogate Models"; disabled
num_14 = Number(multiplication_11)  # disabled
offsrf = OffsetSurface(Surface=move_3.Geometry, Distance=number_slider_17, BothSides=False, CreateSolid=True)  # disabled
offsrf_2 = OffsetSurface(Surface=extr_5, Distance=number_slider_17, BothSides=False, CreateSolid=True)  # disabled
optimization_solver_with_surrogate_model_2 = MOpossum224(
    OpossumData_OptimizationType=0,
    OpossumData_ResultSerializationStatus=0,
    OpossumData_objective=num_16,
    OpossumData_variable=genes_2)  # "Optimization Solver with Surrogate Models"; disabled
offsrf_3 = OffsetSurface(Surface=extr_4, Distance=number_slider_17, BothSides=False, CreateSolid=True)  # disabled

# ---- group: active layer / l
expression_13 = Expression(x=num_13, Expression="1000*x^3/12")  # disabled

# ---- group: active layer / Ax2
expression_14 = Expression(x=num_13, y=abs_4, Expression="1000*x*y^2")  # disabled

# ----
mesh_5 = Mesh(shellview.MeshesOfRenderedShells)  # disabled
swatch = ColourSwatch(SwatchColor=RGB(214, 214, 214))  # disabled

# ---- group: active layer / total l
addition_12 = Addition(A=expression_13, B=expression_14)  # disabled

# ----
preview = CustomPreview(Geometry=offsrf, Material=swatch)  # disabled
preview_2 = CustomPreview(Geometry=offsrf_2, Material=swatch)  # disabled
preview_3 = CustomPreview(Geometry=offsrf_2, Material=swatch)  # disabled

# ---- group: active layer / El0
multiplication_12 = Multiplication(A=e0_4, B=addition_12)  # disabled

# ---- group: effective material properties / El0 eff (Nmm2)
addition_13 = Addition(A=multiplication_12, B=multiplication_9)  # disabled

# ---- group: effective material properties / E0eff
division_7 = Division(A=addition_13, B=expression_9)  # disabled

# ---- group: active layer / T x ft0
multiplication_13 = Multiplication(A=num_13, B=ft0_4)  # disabled

# ---- group: effective material properties / Sum T x Ft0
addition_14 = Addition(A=multiplication_13, B=multiplication_8)  # disabled

# ---- group: effective material properties / ft eff
division_8 = Division(A=addition_14, B=addition_9)  # disabled

# ---- group: active layer / T x Gam
multiplication_14 = Multiplication(A=gamma_4, B=num_13)  # disabled

# ---- group: effective material properties / Sum Tx Gam
addition_15 = Addition(A=multiplication_14)  # disabled

# ---- group: effective material properties / Gamma eff
division_9 = Division(A=addition_15, B=addition_9)  # disabled

# ---- group: active layer / El90
multiplication_15 = Multiplication(A=e90_4, B=addition_12)  # disabled

# ---- group: effective material properties / El90 eff (Nmm2)
addition_16 = Addition(A=multiplication_15, B=multiplication_10)  # disabled

# ---- group: effective material properties / E90eff
division_10 = Division(A=addition_16, B=expression_9)  # disabled

# ---- group: effective material properties
number_slider_18 = Slider(0.012, range=0..0.1, expression="0.012")  # disabled
panel_8 = Panel("42")  # disabled
panel_9 = Panel("5")  # disabled
panel_10 = Panel("CLT")  # disabled
matprops_2 = MaterialPropertiesKaramba3D(
    FamilyOfMaterial=panel_10,
    Name=panel_10,
    ElementIdentifier=panel_10,
    YoungsModulusKNCm2Dir1=expr("x*0.1", division_7),
    YoungsModulusKNCm2Dir2=expr("x*0.1", division_10),
    InPlaneShearModulus_kN_cm2=panel_8,
    InPlaneLateralContractionCoefficient=number_slider_18,
    TransverseShearModulusKNCm2Dir1=panel_9,
    TransverseShearModulusKNCm2Dir2=panel_9,
    SpecificWeight_kN_m3=division_9,
    CoefficientOfThermalExpansion1CDir1=1.2e-05,
    CoefficientOfThermalExpansion1CDir2=1.2e-05,
    TensileStrengthKNCm2Dir1=division_8,
    TensileStrengthKNCm2Dir2=division_8,
    CompressiveStrengthKNCm2Dir1=-23.5,
    CompressiveStrengthKNCm2Dir2=-23.5,
    ShearStrengthKNCm2Dir12=13.6,
    TsaiWuIntCoeff=0,
    StrengthHypothesis="MISES",
    mode="Orthotropic")  # -> flatten(Material); disabled
num_15 = Number(flatten(addition_9))  # disabled

# ----
cross_section_2 = CrossSectionKaramba3D(FamilyNameOfCrossSection="DefaultCroSec", Height_cm=expr("x/10", num_15), mode="Shell - Const")  # disabled
meshtoshell_2 = MeshToShellKaramba3D(Mesh=mesh_4, CrossSection=cross_section_2, LimitDistance_m=0.005)  # -> Element, Points, Info; disabled
assemble_2 = AssembleModelKaramba3D(
    Elem=meshtoshell_2.Element,
    Support=[supp_3, supp_4],
    Load=loads_2,
    CrossSection=cross_section_2,
    Material=matprops_2,
    LimitDistance_m=0.005)  # -> Model, Info, Mass_kg, CenterOfGravity, LoadCaseNames; disabled
analyze_2 = AnalyzeKaramba3D(Model=assemble_2.Model)  # -> CalculatedModel, MaximumDisplacement_cm, ResultingForceOfGravity_kN, ElasticEnergyChange_kNm; disabled
modelview_2 = ModelViewKaramba3D(Model=analyze_2.CalculatedModel, ResultFactors=1, ResultCase=-1)  # -> Model, DeformedMesh, DeformedAxes, DeformedModel; disabled
multiplication_16 = Multiplication(A=analyze_2.MaximumDisplacement_cm, B=number_slider_16)  # disabled
panel_11 = Panel(analyze_2.MaximumDisplacement_cm)  # disabled
shellview_2 = ShellViewKaramba3D(Model=modelview_2.Model, IndexOfLayer=0)  # -> Model, MeshesOfRenderedShells, LegendColors, LegendTags; disabled
num_16 = Number(multiplication_16)  # disabled
mesh_6 = Mesh(shellview_2.MeshesOfRenderedShells)  # disabled
